# Grasshopper definition TheaterRayTrace.gh (Grasshopper 0.9.76)
# plug-ins: Python Interpreter, LunchBox

pt1_position = Slider(0.3, range=0..1)
p2_position = Slider(0.6, range=0..1)
attractor_crv = Curve(<curve referenced from the Rhino model>)
# Attractor
evaluate_length = EvaluateLength(Curve=attractor_crv, Length=[p2_position, pt1_position], Normalized=True)  # -> Point, Tangent, Parameter
points = Point(evaluate_length.Point)

list_item = ListItem(List=points, Index=1, Wrap=True)
list_item_2 = ListItem(List=points, Index=0, Wrap=True)
line = Line(StartPoint=list_item_2, EndPoint=list_item)
divide_curve = DivideCurve(Curve=line, Count=Slider(2, range=0..10), Kinks=False)  # -> Points, Tangents, Parameters
list_item_3 = ListItem(List=divide_curve.Points, Index=Slider(1, range=0..1), Wrap=True)

pt = ConstructPoint(XCoordinate="0.5", YCoordinate="0.5", ZCoordinate="0.5")
brep = Brep(<brep referenced from the Rhino model>)
evalsrf = EvaluateSurface(Surface=reparameterize(brep), Point=pt)  # -> Point, Normal, Frame
python = PythonScript()  # -> skyV
# ---------- python: Python ----------
skyVectors = (
    (0.0,0.998533,0.054139),(0.104375,0.993063,0.054139),(0.207607,0.976713,0.054139),
    (0.308564,0.949662,0.054139),(0.40614,0.912206,0.054139),(0.499267,0.864755,0.054139),
    (0.586923,0.807831,0.054139),(0.668149,0.742055,0.054139),(0.742055,0.668149,0.054139),
    (0.807831,0.586923,0.054139),(0.864755,0.499267,0.054139),(0.912206,0.40614,0.054139),
    (0.949662,0.308564,0.054139),(0.976713,0.207607,0.054139),(0.993063,0.104375,0.054139),
    (0.998533,0.0,0.054139),(0.993063,-0.104375,0.054139),(0.976713,-0.207607,0.054139),
    (0.949662,-0.308564,0.054139),(0.912206,-0.40614,0.054139),(0.864755,-0.499267,0.054139),
    (0.807831,-0.586923,0.054139),(0.742055,-0.668149,0.054139),(0.668149,-0.742055,0.054139),
    (0.586923,-0.807831,0.054139),(0.499267,-0.864755,0.054139),(0.40614,-0.912206,0.054139),
    (0.308564,-0.949662,0.054139),(0.207607,-0.976713,0.054139),(0.104375,-0.993063,0.054139),
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

import Rhino.Geometry.Vector3d as Vector

skyV = (Vector(*v) for v in skyVectors)
# ---------- end python ----------
graft = GraftTree(Tree=evalsrf.Point, IncludeEmptyLists=True, IncludeNullItems=True)
graft_2 = GraftTree(Tree=evalsrf.Normal, IncludeEmptyLists=True, IncludeNullItems=True)
angle = Angle(VectorA=graft_2, VectorB=python)  # -> Angle, Reflex
deg = Degrees(Radians=angle.Angle)
smaller = SmallerThan(FirstNumber=deg, SecondNumber=90)  # -> SmallerThan, OrEqualTo
dispatch = Dispatch(List=python, DispatchPattern=smaller.SmallerThan)  # -> ListA, ListB
vdis = VectorDisplay(Anchor=graft, Vector=dispatch.ListA)

ladybug = Ladybug_Ladybug()  # -> out; plug-in component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
galapagos = Galapagos(fitness=division_6, gene=[p2_position, pt1_position])

crv = Curve(<curve referenced from the Rhino model>)
srf = Surface(crv)
brep_2 = Brep(srf)
quads = QuadPanels(Surface=brep_2, UDivisions=Slider(5, range=0..10), VDivisions=Slider(1, range=0..10))
area = Area(Geometry=quads)  # -> Area, Centroid
wires = BrepWireframe(Brep=quads, Density=-1)
item = ListItem(List=wires, Index=Slider(3, range=0..10), Wrap=True)
# Panelling Back Wall
number_slider = Slider(2, range=0..4)

distance = Distance(PointA=list_item_3, PointB=area.Centroid)
list_item_4 = ListItem(List=distance, Index=-1, Wrap=True)
# Angle
panel = Panel(distance)
panel_2 = Panel(list_item_4)
division = Division(A=Slider(90, range=0..100), B=list_item_4)
panel_3 = Panel(division)
multiplication = Multiplication(A=division, B=distance)
multiplication_2 = Multiplication(A=multiplication, B=Slider(0.2, range=0..1))

rotax = RotateAxis(Geometry=quads, Angle=degrees(multiplication_2), Axis=flatten(item))  # -> Geometry, Transform
quad_panels = QuadPanels(Surface=rotax.Geometry, UDivisions=Slider(1, range=0..1), VDivisions=Slider(3, range=0..10))  # -> simplify(Panels)
brep_wireframe = BrepWireframe(Brep=quad_panels, Density=-1)
list_item_5 = ListItem(List=brep_wireframe, Index=number_slider, Wrap=True)
rotax_2 = RotateAxis(Geometry=graft(quad_panels), Angle=graft(degrees(multiplication_2)), Axis=list_item_5)  # -> Geometry, Transform

crv_2 = Curve(<curve referenced from the Rhino model>)
srf_2 = Surface(crv_2)
length = Slider(8, range=0..100)
brep_3 = Brep(srf_2)
Z = UnitZ(Factor=1)
wires_2 = BrepWireframe(Brep=brep_3, Density=-1)
neg = Negative(Value=Z)
item_2 = ListItem(List=wires_2, Index=Slider(1, range=0..10), Wrap=True)
panel_length = Slider(1.6, range=0.5..2)
divide_curve_2 = DivideCurve(Curve=item_2, Count=Slider(7, range=0..10), Kinks=False)  # -> Points, Tangents, Parameters
line_2 = LineSDL(Start=divide_curve_2.Points, Direction=neg, Length=length)
bcx = BrepCurve(Brep=brep_3, Curve=line_2)  # -> Curves, Points
end = EndPoints(Curve=flatten(bcx.Curves))  # -> Start, End
unit_x = UnitX(Factor=panel_length)
line_3 = Line(StartPoint=divide_curve_2.Points, EndPoint=end.End)
neg_2 = Negative(Value=unit_x)
extr = Extrude(Base=line_3, Direction=neg_2)

distance_2 = Distance(PointA=list_item_3, PointB=flatten(divide_curve_2.Points))
# Angle
sort_list = SortList(Keys=distance_2)  # -> Keys, ValuesValuesA
list_item_6 = ListItem(List=sort_list.Keys, Index=-1, Wrap=True)
panel_4 = Panel(sort_list.Keys)
panel_5 = Panel(list_item_6)
division_2 = Division(A=Slider(90, range=-90..100), B=list_item_6)
panel_6 = Panel(division_2)

multiplication_3 = Multiplication(A=division_2, B=distance_2)
negative = Negative(Value=multiplication_3)
rotax_3 = RotateAxis(Geometry=extr, Angle=reverse(degrees(negative)), Axis=line_3)  # -> Geometry, Transform
panel_7 = Panel(multiplication_3)
quad_panels_2 = QuadPanels(Surface=rotax_3.Geometry, UDivisions=Slider(1, range=0..1), VDivisions=Slider(4, range=0..10))  # -> graft(Panels)
# Panelling Side Walls
division_3 = Division(A=Slider(45, range=0..100), B=list_item_6)
panel_8 = Panel(division_3)
multiplication_4 = Multiplication(A=division_3, B=distance_2)
brep_wireframe_2 = BrepWireframe(Brep=quad_panels_2, Density=-1)
negative_2 = Negative(Value=multiplication_4)
list_item_7 = ListItem(List=brep_wireframe_2, Index=Slider(2, range=0..10), Wrap=True)
rotax_4 = RotateAxis(Geometry=quad_panels_2, Angle=graft(degrees(negative_2)), Axis=list_item_7)  # -> Geometry, Transform

crv_3 = Curve(<curve referenced from the Rhino model>)
srf_3 = Surface(crv_3)
brep_4 = Brep(srf_3)
panel_length_2 = Slider(1.3, range=0.5..2)
quad_panels_3 = QuadPanels(Surface=brep_4, UDivisions=Slider(6, range=0..10), VDivisions=Slider(7, range=0..10))
wires_3 = BrepWireframe(Brep=quad_panels_3, Density=-1)
Z_2 = UnitZ(Factor=panel_length_2)
neg_3 = Negative(Value=Z_2)
item_3 = ListItem(List=wires_3, Index=0, Wrap=True)
extr_2 = Extrude(Base=item_3, Direction=neg_3)
area_2 = Area(Geometry=extr_2)  # -> Area, Centroid
brep_wireframe_3 = BrepWireframe(Brep=extr_2, Density=-1)
list_item_8 = ListItem(List=brep_wireframe_3, Index=Slider(2, range=0..10), Wrap=True)

distance_3 = Distance(PointA=list_item_3, PointB=flatten(area_2.Centroid))  # -> reverse(Distance)
# Angle
sort_list_2 = SortList(Keys=distance_3)  # -> Keys, ValuesValuesA
list_item_9 = ListItem(List=sort_list_2.Keys, Index=-1, Wrap=True)
division_4 = Division(A=Slider(90, range=0..100), B=list_item_9)
panel_9 = Panel(sort_list_2.Keys)
panel_10 = Panel(list_item_9)
panel_11 = Panel(division_4)

multiplication_5 = Multiplication(A=division_4, B=distance_3)
# Roof Panelling
negative_3 = Negative(Value=multiplication_5)
division_5 = Division(A=multiplication_5, B=Slider(2, range=0..10))
rotx = RotateAxis(Geometry=extr_2, Angle=graft(degrees(negative_3)), Axis=item_3)  # -> Geometry, Transform
roty = RotateAxis(Geometry=rotx.Geometry, Angle=reverse(graft(degrees(division_5))), Axis=list_item_8)  # -> Geometry, Transform

# ----
# Mirroring
mirror = Mirror(Geometry=[rotax_4.Geometry, roty.Geometry, rotax_2.Geometry], Plane=PlaneYZ(0, 0, 0))  # -> Geometry, Transform

# ----
# Panels
brep_5 = Brep([mirror.Geometry, rotax_4.Geometry, roty.Geometry, rotax_2.Geometry])

point = Point(<point referenced from the Rhino model>)
forwardraytracing = Ladybug_ForwardRaytracing(
    startPts=point,
    startVectors=graft(dispatch.ListA),
    context=flatten(brep_5),
    numOfBounce=Slider(1, range=0..10),
    lastBounceLen=Slider(10, range=0..10))  # -> rays; plug-in component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
# Vector Rays
number_slider_2 = Slider(0.1, range=0..1)
end_points = EndPoints(Curve=forwardraytracing)  # -> Start, simplify(End)
sphere = Sphere(Base=end_points.End, Radius=number_slider_2)

crv_4 = Curve(<curve referenced from the Rhino model>)
surface = Surface(crv_4)
quad_panels_4 = QuadPanels(Surface=surface, UDivisions=Slider(11, range=0..100), VDivisions=Slider(8, range=0..100))
area_3 = Area(Geometry=quad_panels_4)  # -> Area, Centroid
circle_cnr = CircleCNR(Center=area_3.Centroid, Normal=Vector(0, 0, 1), Radius=Slider(0.65, range=0..1))
mirror_2 = Mirror(Geometry=circle_cnr, Plane=PlaneYZ(0, 0, 0))  # -> Geometry, Transform
flatten_tree = FlattenTree(Tree=forwardraytracing, Path="{0}")
# Target Surfaces
mesh = Mesh([circle_cnr, mirror_2.Geometry])
mesh_curve = MeshCurve(Mesh=mesh, Curve=graft(flatten_tree))  # -> Points, Faces
list_length = ListLength(List=flatten(mesh_curve.Points))
list_length_2 = ListLength(List=flatten(end_points.End))
division_6 = Division(A=list_length, B=list_length_2)
panel_12 = Panel(list_length)
panel_13 = Panel(list_length_2)
panel_14 = Panel(division_6)
