# Grasshopper definition Grasshopper_Octopus.gh (Grasshopper 0.9.76)
# plug-ins: Python Interpreter, Octopus

ladybug = Ladybug_Ladybug()  # -> Vviiiiiiiiiizzz; plug-in component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

# ---- group: window
bottom_area = Brep(<brep referenced from the Rhino model>)

# ---- group: context
brep = Brep([<brep referenced from the Rhino model> x45])

# ---- group: geometries
number_slider = Slider(4.4, range=0..10)
wires = BrepWireframe(Brep=brep, Density=-1)
ext = ExtendCurve(Curve=wires, Type=0, Start=number_slider, End=number_slider)
preview = CustomPreview(Geometry=ext, Shader=ColourSwatch(SwatchColor=RGB(0, 0, 0)))
preview_2 = CustomPreview(Geometry=brep, Shader=ColourSwatch(SwatchColor=RGBA(255, 255, 255, 144)))

# ----
panel = Panel("https://www.energyplus.net/weather-download/north_and_central_america_wmo_region_4/USA/NY/USA_NY_New.York-Central.Park.725033_TMY3/all")

smesh = SimpleMesh(Brep=brep)
mjoin = MeshJoin(Meshes=smesh)

panel_2 = Panel(ladybug)
window = Brep(<brep referenced from the Rhino model>)
preview_3 = CustomPreview(Geometry=bottom_area, Shader=ColourSwatch(SwatchColor=RGBA(92, 155, 255, 94)))
number_slider_2 = Slider(5, range=0..10)
number_slider_3 = Slider(9, range=0..10)

# ---- group: PV Setup
wires_2 = BrepWireframe(Brep=window, Density=-1)
range = Range(Domain=Domain(0, 1), Steps=Slider(3, range=0..10))
item = ListItem(List=wires_2, Index=Slider(1, range=0..10), Wrap=True)
eval = EvaluateCurve(Curve=reparameterize(item), Parameter=range)  # -> Point, Tangent, Angle

# ----
epw_stat = Ladybug_OpenEPWAndSTATWeatherFiles(weatherFileURL=panel)  # -> epwFile, statFile; plug-in component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

length = Slider(0, range=0..20)
tilt_angle = Slider(2, range=-90..90)
tilt_angle_2 = Slider(-15, range=-90..90)
tilt_angle_3 = Slider(-4, range=-90..90)

evalsrf = EvaluateSurface(Surface=reparameterize(bottom_area), Point="0.5, 0.5, 0.5")  # -> Point, Normal, Frame
gencumulativeskymtx = Ladybug_GenCumulativeSkyMtx(epwFile=epw_stat.epwFile, skyDensity=0, useOldRes=True, runIt=Toggle(True))  # -> readMe, cumulativeSkyMtx; plug-in component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

item_2 = ListItem(List=eval.Point, Index=Slider(2, range=0..5), Wrap=True)
item_3 = ListItem(List=eval.Point, Index=Slider(3, range=0..10), Wrap=True)
ln = Line(StartPoint=item_2, EndPoint=item_3)
Y = UnitY(Factor=length)
pln = Plane(ln)
rev = Reverse(Vector=Y)
extr = Extrude(Base=ln, Direction=rev)
rotate = Rotate(Geometry=extr, Angle=degrees(tilt_angle_3), Plane=pln)  # -> Geometry, Transform
wires_3 = BrepWireframe(Brep=rotate.Geometry, Density=-1)

item_4 = ListItem(List=eval.Point, Index=Slider(0, range=0..1), Wrap=True)
item_5 = ListItem(List=eval.Point, Index=Slider(1, range=0..10), Wrap=True)
ln_2 = Line(StartPoint=item_4, EndPoint=item_5)
Y_2 = UnitY(Factor=length)
pln_2 = Plane(ln_2)
rev_2 = Reverse(Vector=Y_2)
extr_2 = Extrude(Base=ln_2, Direction=rev_2)
rotate_2 = Rotate(Geometry=extr_2, Angle=degrees(tilt_angle), Plane=pln_2)  # -> Geometry, Transform
wires_4 = BrepWireframe(Brep=rotate_2.Geometry, Density=-1)

item_6 = ListItem(List=eval.Point, Index=Slider(1, range=0..1), Wrap=True)
item_7 = ListItem(List=eval.Point, Index=Slider(2, range=0..10), Wrap=True)
ln_3 = Line(StartPoint=item_6, EndPoint=item_7)
Y_3 = UnitY(Factor=length)
pln_3 = Plane(ln_3)
rev_3 = Reverse(Vector=Y_3)
extr_3 = Extrude(Base=ln_3, Direction=rev_3)
rotate_3 = Rotate(Geometry=extr_3, Angle=degrees(tilt_angle_2), Plane=pln_3)  # -> Geometry, Transform
wires_5 = BrepWireframe(Brep=rotate_3.Geometry, Density=-1)

bottom_area_2 = Brep(<brep referenced from the Rhino model>)

analysisperiod = Ladybug_AnalysisPeriod(fromMonth=Slider(5, range=0..10), toMonth=Slider(9, range=0..10))  # -> readMe, analysisPeriod; plug-in component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
selectskymtx = Ladybug_selectSkyMtx(
    cumulativeSkyMtx=gencumulativeskymtx.cumulativeSkyMtx,
    analysisPeriod=analysisperiod.analysisPeriod,
    removeDiffuse=False,
    removeDirect=False)  # -> readMe, selectedSkyMtx; plug-in component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

# ---- group: Summer / set to True
toggle = BooleanToggle(True)

# ----
analysisperiod_2 = Ladybug_AnalysisPeriod(fromMonth="12", toMonth="3")  # -> readMe, analysisPeriod; plug-in component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
selectskymtx_2 = Ladybug_selectSkyMtx(
    cumulativeSkyMtx=gencumulativeskymtx.cumulativeSkyMtx,
    analysisPeriod=analysisperiod_2.analysisPeriod,
    removeDiffuse=False,
    removeDirect=False)  # -> readMe, selectedSkyMtx; plug-in component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

# ---- group: Winter / set to True
toggle_2 = BooleanToggle(True)

# ---- group: add your shading here
brep_2 = Brep([rotate_2.Geometry, rotate_3.Geometry, rotate.Geometry])

# ----
merge = Merge(Data1=mjoin, Data2=brep_2)

# ---- group: Summer
radiationanalysis = Ladybug_RadiationAnalysis(
    north=0,
    geometry=flatten(bottom_area),
    context=flatten(merge),
    gridSize="1",
    disFromBase=Slider(0.01, range=0..0.01),
    selectedSkyMtx=flatten(selectskymtx.selectedSkyMtx),
    runIt=toggle)  # -> readMe, contextMesh, analysisMesh, testPts, testVec, port, radiationResult, radiationMesh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; plug-in component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
panel_3 = Panel(radiationanalysis.readMe)
minimize = Panel(radiationanalysis.totalRadiation)

# ---- group: Winter
radiationanalysis_2 = Ladybug_RadiationAnalysis(
    north=0,
    geometry=flatten(bottom_area),
    context=flatten(merge),
    gridSize="1",
    disFromBase=Slider(0.01, range=0..0.01),
    selectedSkyMtx=flatten(selectskymtx_2.selectedSkyMtx),
    runIt=toggle_2)  # -> readMe, contextMesh, analysisMesh, testPts, testVec, port, radiationResult, radiationMesh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; plug-in component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
maximize = Panel(radiationanalysis_2.readMe)

# ----
panel_4 = Panel("""total_radiation
area""")
txt = Text(panel_4)
panel_5 = Panel(radiationanalysis_2.totalRadiation)
area = Area(Geometry=brep_2)  # -> Area, Centroid
minimize_2 = Panel(area.Area)
minimize_3 = Panel(minimize)
maximize_2 = Panel(radiationanalysis_2.totalRadiation)
ma = MassAddition(Input=minimize_2)  # -> Result, PartialResults
panel_6 = Panel("""total_radiation
area""")
subtraction = Subtraction(A=maximize_2, B=minimize_3)
mesh = Mesh(brep_2)
num = Number(ma.Result)
num_2 = Number(subtraction)
galapagos = Galapagos(fitness=num_2, gene=[length, tilt_angle, tilt_angle_2, tilt_angle_3])
txt_2 = Text(panel_6)
mjoin_2 = MeshJoin(Meshes=mesh)
neg = Negative(Value=num_2)
num_3 = Number([num, neg])
octopus = Octopus(Phenotype=mjoin_2, OctopusData_gene=length, OctopusData_obj=[num_3, txt_2])
