# Grasshopper definition Medlinsky_Schroth_TYP_Commercial_GH_Final_Submission.gh (Grasshopper 0.9.76)
# plug-ins: Python Interpreter, ItemSelector, Colibri

massinsul = Panel(".075")
concrete = Panel(".2032")
stucco = Panel(".0253")
concrete_2 = Panel("8INCONCRETE")
renameplz = Panel("STUCCO")
epopaquemat = Honeybee_EnergyPlusOpaqueMaterial(
    name=renameplz,
    roughness="Smooth",
    thickness=stucco,
    conductivity=".691",
    density="1858",
    specificHeat="836",
    thermAbsp=".9",
    solAbsp=".9",
    visAbsp=".9")  # -> EPMaterial; plug-in component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
epopaquemat_2 = Honeybee_EnergyPlusOpaqueMaterial(
    name=concrete_2,
    roughness="Rough",
    thickness=concrete,
    conductivity="1.3",
    density="2240",
    specificHeat="836.8",
    thermAbsp=".8",
    solAbsp=".8",
    visAbsp=".8")  # -> EPMaterial; plug-in component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
epopaquemat_3 = Honeybee_EnergyPlusOpaqueMaterial(
    name="MASSWALLINSUL",
    roughness="MediumRough",
    thickness=massinsul,
    conductivity=".049",
    density="265",
    specificHeat="836.8",
    thermAbsp=".8",
    solAbsp=".8",
    visAbsp=".8")  # -> EPMaterial; plug-in component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
epconstruction = Honeybee_EnergyPlusConstruction(name="TYP COMMERCIAL WALL ASSEMBLY", layer_1=epopaquemat_3, layer_2=epopaquemat_2, layer_3=epopaquemat_3)  # -> EPConstruction; plug-in component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
merge = Merge(Data4=epconstruction)
floor_brep = Brep(<brep referenced from the Rhino model>)
roof_brep = Brep(<brep referenced from the Rhino model>)
wall_brep = Brep([<brep referenced from the Rhino model> x4])
item = ListItem(List=merge, Index=0, Wrap=True)
panel = Panel(item)
ladybug = Ladybug_Ladybug()  # -> Vviiiiiiiiiizzz; plug-in component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
honeybee = Honeybee_Honeybee()  # -> Vviiiiiiiiiizzz; plug-in component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
shgc = Slider(0.6, range=0.6..1.6)
vt = Slider(0.7, range=0.7..1.7)
createhbsrfs = Honeybee_createHBSrfs(geometry=[roof_brep, floor_brep], EPBC="Adiabatic")  # -> readMe, simplify(HBSurface); plug-in component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
createhbsrfs_2 = Honeybee_createHBSrfs(geometry=wall_brep, EPConstruction=item)  # -> readMe, simplify(HBSurface); plug-in component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
panel_2 = Panel(ladybug)
bldgprograms = Honeybee_bldgPrograms({"Office": 0, "Retail": 1, "MidriseApartment": 2, "PrimarySchool": 3, "SecondarySchool": 4, "SmallHotel": 5, "LargeHotel": 6, "Hospital": 7, "Outpatient": 8, "Warehouse": 9, "SuperMarket": 10, "FullServiceRestaurant": 11, "QuickServiceRestaurant": 12}, selected="Office")
epwindowmat = Honeybee_EnergyPlusWindowMaterial(name="Window_Opening", U_Value=Slider(0.3, range=0..10), SHGC=shgc, VT=vt)  # -> EPMaterial; plug-in component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
commercial_window = Brep([<brep referenced from the Rhino model> x17])
epconstruction_2 = Honeybee_EnergyPlusConstruction(name="Window_Construction", layer_1=epwindowmat)  # -> EPConstruction; plug-in component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
listzoneprograms = Honeybee_ListZonePrograms(bldgProgram=bldgprograms)  # -> OfficeZonePrograms; plug-in component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
addhbglz = Honeybee_addHBGlz(HBObj=createhbsrfs_2.HBSurface, childSurfaces=flatten(commercial_window), EPConstructions=epconstruction_2)  # -> HBObjWGLZ; plug-in component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
list = Honeybee_ItemSelector(
    listzoneprograms,
    {"Office::BreakRoom", "Office::Storage", "Office::Vending", "Office::OpenOffice", "Office::ClosedOffice", "Office::Conference", "Office::PrintRoom", "Office::Restroom", "Office::Elec/MechRoom", "Office::IT_Room", "Office::Stair", "Office::Corridor", "Office::Lobby"}, selected="Office::BreakRoom")
geteploads = Honeybee_GetEnergyPlusLoads()  # -> equipmentLoadPerArea, infiltrationRatePerArea, lightingDensityPerArea, numOfPeoplePerArea, ventilationPerArea, ventilationPerPerson; plug-in component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
createhbzones = Honeybee_createHBZones(name="testZone", zoneProgram=list, HBSurfaces=flatten([createhbsrfs.HBSurface, addhbglz]), isConditioned=True)  # -> readMe, HBZone; plug-in component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
panel_3 = Panel("https://www.energyplus.net/weather-download/north_and_central_america_wmo_region_4/USA/NY/USA_NY_New.York-LaGuardia.AP.725030_TMY3/all")
epw_stat = Ladybug_OpenEPWAndSTATWeatherFiles(weatherFileURL=panel_3)  # -> epwFile, statFile; plug-in component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
epoutput = Honeybee_GenerateEPOutput(
    zoneEnergyUse=Toggle(True),
    zoneGainsAndLosses="False",
    zoneComfortMetrics="False",
    surfaceTempAnalysis="False",
    timestep="annual")  # -> report, flatten(simulationOutputs); plug-in component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
toggle = BooleanToggle(True)
runenergysimulation = Honeybee_RunEnergySimulation(
    epwFile=epw_stat.epwFile,
    HBZones=flatten(createhbzones.HBZone),
    simulationOutputs=flatten(epoutput.simulationOutputs),
    writeIdf=toggle,
    runEnergyPlus=toggle)  # -> report, idfFileAddress, resultFileAddress; plug-in component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
iterator = ColibriIteratorFly(STUCCO=stucco, CONCRETE=concrete, MASSINSUL=massinsul)  # -> STUCCO, CONCRETE, MASSINSUL, Value_N, FlyID
readepresult = Honeybee_ReadEPResult(resultFileAddress=runenergysimulation.resultFileAddress)  # -> totalThermalLoad, thermalLoadBalance, cooling, heating, electricLight, electricEquip, fanElectric, pumpElectric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; plug-in component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
strnum = Ladybug_SeparateData(inputList=flatten([readepresult.cooling, readepresult.heating]))  # -> numbers, strings; plug-in component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
panel_4 = Panel(strnum.numbers)
panel_5 = Panel("""cooling
heating""")
flyresults = ColibriOutputs(Names=flatten(panel_5), Values=flatten(strnum.numbers))
panel_6 = Panel(flyresults)
aggregator = ColibriAggregator(
    Folder="C:\Users\Adam\Desktop\COLIBRI\COMMERCIAL RUNS",
    FlyIDInputs=iterator.FlyID,
    FlyResultsOutputs=flyresults,
    Write=Toggle(False))
