# Grasshopper definition Medlinsky_Schroth_Wall_Assembly_GH_Final_Submission.gh (Grasshopper 0.9.76)
# plug-ins: Python Interpreter, ItemSelector, Colibri

steel_thickness = Slider(1, range=0..1)
fiber_composite_thickness = Slider(0.1, range=0.1..0.4)
fiber_composite_thickness2 = Slider(0.1, range=0.1..0.4)
mycelium_thickness = Slider(0.4, range=0..1)
concrete_thickness = Slider(0.4, range=0..1)
mycelium_thickness_2 = Slider(0.4, range=0..1)
number_slider = Slider(15, range=0..50)
number_slider_2 = Slider(15, range=0..50)
epopaquemat = Honeybee_EnergyPlusOpaqueMaterial(
    name="Mycelium2",
    roughness="MediumRough",
    thickness=mycelium_thickness,
    conductivity=".04",
    density="121.74",
    specificHeat="2000")  # -> EPMaterial; plug-in component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
epopaquemat_2 = Honeybee_EnergyPlusOpaqueMaterial(
    name="Mycelium",
    roughness="MediumRough",
    thickness=mycelium_thickness_2,
    conductivity=".04",
    density="121.74",
    specificHeat="2000")  # -> EPMaterial; plug-in component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
epopaquemat_3 = Honeybee_EnergyPlusOpaqueMaterial(
    name="Steel",
    roughness="MediumSmooth",
    thickness=steel_thickness,
    conductivity="16",
    density="8050",
    specificHeat="490",
    solAbsp=".5")  # -> EPMaterial; plug-in component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
epopaquemat_4 = Honeybee_EnergyPlusOpaqueMaterial(
    name="Fiber Composite2",
    roughness="MediumRough",
    thickness=fiber_composite_thickness2,
    conductivity=".04",
    density="90",
    specificHeat="1800")  # -> EPMaterial; plug-in component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
epopaquemat_5 = Honeybee_EnergyPlusOpaqueMaterial(
    name="Fiber Composite",
    roughness="MediumRough",
    thickness=fiber_composite_thickness,
    conductivity=".04",
    density="90",
    specificHeat="1800")  # -> EPMaterial; plug-in component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
epopaquemat_6 = Honeybee_EnergyPlusOpaqueMaterial(
    name="Concrete",
    roughness="Rough",
    thickness=concrete_thickness,
    conductivity="1.4",
    density="2400",
    specificHeat="850",
    solAbsp=".7")  # -> EPMaterial; plug-in component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
rectangle = Rectangle(Plane=PlaneXY(0, 0, 0), XSize=number_slider_2, YSize=number_slider, Radius=0)  # -> Rectangle, Length
planesrf = PlaneSurface(Plane=PlaneXY(0, 0, 0), XSize=number_slider_2, YSize=number_slider)
planesrf_2 = PlaneSurface(Plane=PlaneXY(0, 0, 0), XSize=number_slider_2, YSize=number_slider)
number_slider_3 = Slider(10, range=0..25)
epconstruction = Honeybee_EnergyPlusConstruction(name="Fiber Composite (.5 Layer) Steel Wall", layer_1=epopaquemat_5, layer_2=epopaquemat_3)  # -> EPConstruction; plug-in component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
epconstruction_2 = Honeybee_EnergyPlusConstruction(name="Mycelium (.5 Layer) Concrete Panel", layer_1=epopaquemat_6, layer_2=epopaquemat_2)  # -> EPConstruction; plug-in component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
epconstruction_3 = Honeybee_EnergyPlusConstruction(name="Steel (.5 Layer) Fiber Composite Wall", layer_1=epopaquemat_3, layer_2=epopaquemat_5)  # -> EPConstruction; plug-in component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
epconstruction_4 = Honeybee_EnergyPlusConstruction(name="Fiber Composite (1 Layer) Steel Wall", layer_1=epopaquemat_5, layer_2=epopaquemat_3, layer_3=epopaquemat_4)  # -> EPConstruction; plug-in component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
epconstruction_5 = Honeybee_EnergyPlusConstruction(name="Mycelium (Reverse Layer) Concrete Panel", layer_1=epopaquemat_2, layer_2=epopaquemat_6, layer_3=epopaquemat)  # -> EPConstruction; plug-in component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
epconstruction_6 = Honeybee_EnergyPlusConstruction(name="Mycelium (1 Layer) Concrete Panel", layer_1=epopaquemat_6, layer_2=epopaquemat_2, layer_3=epopaquemat_6)  # -> EPConstruction; plug-in component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
Z = UnitZ(Factor=number_slider_3)
Z_2 = UnitZ(Factor=number_slider_3)
move = Move(Geometry=planesrf_2, Motion=Z)  # -> Geometry, Transform
extr = Extrude(Base=rectangle.Rectangle, Direction=Z_2)
roof_brep = Brep(move.Geometry)
ground_brep = Brep(planesrf)
wall_brep = Brep(extr)
flip = Flip(Surface=ground_brep)  # -> Surface, Result

floor_brep = Brep(<brep referenced from the Rhino model>)
wall_brep_2 = Brep(<brep referenced from the Rhino model>)
roof_brep_2 = Brep(<brep referenced from the Rhino model>)

floor_brep_2 = Brep(<brep referenced from the Rhino model>)
wall_brep_3 = Brep([<brep referenced from the Rhino model> x6])
roof_brep_3 = Brep([<brep referenced from the Rhino model> x3])

merge = Merge(Data4=epconstruction_4)
item = ListItem(List=merge, Index=0, Wrap=True)
number_slider_4 = Slider(0.99, range=0..1)
number_slider_5 = Slider(0.99, range=0..1)
number_slider_6 = Slider(0.99, range=0..1)
panel = Panel(item)
ladybug = Ladybug_Ladybug()  # -> Vviiiiiiiiiizzz; plug-in component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
honeybee = Honeybee_Honeybee()  # -> Vviiiiiiiiiizzz; plug-in component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
shgc = Slider(0.6, range=0.6..1.6)
vt = Slider(0.7, range=0.7..1.7)
createhbsrfs = Honeybee_createHBSrfs(geometry=[roof_brep_3, floor_brep_2], EPBC="Adiabatic")  # -> readMe, simplify(HBSurface); plug-in component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
createhbsrfs_2 = Honeybee_createHBSrfs(geometry=wall_brep_3, EPConstruction=item)  # -> readMe, simplify(HBSurface); plug-in component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
panel_2 = Panel(ladybug)
bldgprograms = Honeybee_bldgPrograms({"Office": 0, "Retail": 1, "MidriseApartment": 2, "PrimarySchool": 3, "SecondarySchool": 4, "SmallHotel": 5, "LargeHotel": 6, "Hospital": 7, "Outpatient": 8, "Warehouse": 9, "SuperMarket": 10, "FullServiceRestaurant": 11, "QuickServiceRestaurant": 12}, selected="Office")
epwindowmat = Honeybee_EnergyPlusWindowMaterial(name="Window_Opening", U_Value=Slider(0.3, range=0..10), SHGC=shgc, VT=vt)  # -> EPMaterial; plug-in component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
window_brep_adam = Brep([<brep referenced from the Rhino model> x4])
window_brep_noah = Brep([<brep referenced from the Rhino model> x2])
epconstruction_7 = Honeybee_EnergyPlusConstruction(name="Window_Construction", layer_1=epwindowmat)  # -> EPConstruction; plug-in component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
brep = Brep(<brep referenced from the Rhino model>)
listzoneprograms = Honeybee_ListZonePrograms(bldgProgram=bldgprograms)  # -> OfficeZonePrograms; plug-in component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
addhbglz = Honeybee_addHBGlz(HBObj=createhbsrfs_2.HBSurface, childSurfaces=flatten(window_brep_adam), EPConstructions=epconstruction_7)  # -> HBObjWGLZ; plug-in component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
list = Honeybee_ItemSelector(
    listzoneprograms,
    {"Office::BreakRoom", "Office::Storage", "Office::Vending", "Office::OpenOffice", "Office::ClosedOffice", "Office::Conference", "Office::PrintRoom", "Office::Restroom", "Office::Elec/MechRoom", "Office::IT_Room", "Office::Stair", "Office::Corridor", "Office::Lobby"}, selected="Office::BreakRoom")
geteploads = Honeybee_GetEnergyPlusLoads()  # -> equipmentLoadPerArea, infiltrationRatePerArea, lightingDensityPerArea, numOfPeoplePerArea, ventilationPerArea, ventilationPerPerson; plug-in component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
createhbzones = Honeybee_createHBZones(name="testZone", zoneProgram=list, HBSurfaces=flatten([createhbsrfs.HBSurface, addhbglz]), isConditioned=True)  # -> readMe, HBZone; plug-in component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
panel_3 = Panel("https://www.energyplus.net/weather-download/north_and_central_america_wmo_region_4/USA/NY/USA_NY_New.York-LaGuardia.AP.725030_TMY3/all")
epoutput = Honeybee_GenerateEPOutput(
    zoneEnergyUse=Toggle(True),
    zoneGainsAndLosses="False",
    zoneComfortMetrics="False",
    surfaceTempAnalysis="False",
    timestep="annual")  # -> report, flatten(simulationOutputs); plug-in component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
epw_stat = Ladybug_OpenEPWAndSTATWeatherFiles(weatherFileURL=panel_3)  # -> epwFile, statFile; plug-in component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
toggle = BooleanToggle(False)
runenergysimulation = Honeybee_RunEnergySimulation(
    epwFile=epw_stat.epwFile,
    HBZones=flatten(createhbzones.HBZone),
    simulationOutputs=flatten(epoutput.simulationOutputs),
    writeIdf=toggle,
    runEnergyPlus=toggle)  # -> report, idfFileAddress, resultFileAddress; plug-in component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
iterator = ColibriIteratorFly(
    Fiber_Composite_thickness=fiber_composite_thickness,
    steel_thickness=steel_thickness,
    Fiber_Composite_thickness2=fiber_composite_thickness2)  # -> Fiber_Composite_thickness, steel_thickness, Fiber_Composite_thickness2, Value_N, FlyID
readepresult = Honeybee_ReadEPResult(resultFileAddress=runenergysimulation.resultFileAddress)  # -> totalThermalLoad, thermalLoadBalance, cooling, heating, electricLight, electricEquip, fanElectric, pumpElectric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; plug-in component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
strnum = Ladybug_SeparateData(inputList=flatten([readepresult.cooling, readepresult.heating]))  # -> numbers, strings; plug-in component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
panel_4 = Panel(strnum.numbers)
panel_5 = Panel("""cooling
heating""")
flyresults = ColibriOutputs(Names=flatten(panel_5), Values=flatten(strnum.numbers))
panel_6 = Panel(flyresults)
aggregator = ColibriAggregator(
    Folder="C:\Users\Adam\Desktop\COLIBRI\03\DBL GLAZED",
    FlyIDInputs=iterator.FlyID,
    FlyResultsOutputs=flyresults,
    Write=Toggle(False))
