# Dynamo graph Dynamo_04_20_2017.dyn (Dynamo 1.2.1.3083)

file_path = Filename(".\The%20Final.xlsx")
boolean = BoolSelector(true)
code_block = CodeBlock { "Revit design option"; }
boolean_2 = BoolSelector(false)
read_excel = Custom[Read Excel](filePath=file_path, RunIt=boolean, SheetName=code_block, ByColumn=boolean_2)  # This node will read an excel file. You can read an entore sheet contents, read from specific origin cell, read only specific range, or do all of the former for multiple sheets at the same time.
watch = Watch(read_excel)
count = List.Count(watch)
code_block_2 = CodeBlock(x=watch, count=count) { x[1]; x[2..count-1 ]; }
data = Charts.ParallelCoordinates.Data(code_block_2.out0, code_block_2.out1)
code_block_3 = CodeBlock { 2; }
address = Charts.MiscNodes.Address(code_block_3, code_block_3)
style = Charts.ParallelCoordinates.Style(arg1=address)
chart = Charts.ParallelCoordinates.Chart(data, style)
create_report = MandrillReportNode(chart)
report_window = MandrillWindowNodeModel(create_report)
code_block_4 = CodeBlock { "C:\Users\Josh\Desktop\Whole-Building Life-Cycle Analysis\data.csv"; }
code_block_5 = CodeBlock()
# ---------- code_block_5.designscript (10 lines) ----------
"Design Option";
"Acidification";
"Eutrophication";
"Global Warming";
"Ozone Depletion";
"Smog Formation";
"Primary Energy";
"Non-renewable Energy";
"Renewable Energy";
"Mass Sum";
# ----------------------------------------
create = List.Create(code_block_5.out0, code_block_5.out1, code_block_5.out2, code_block_5.out3, code_block_5.out4, code_block_5.out5, code_block_5.out6, code_block_5.out7, code_block_5.out8, code_block_5.out9)
create_2 = List.Create(create)
code_block_6 = CodeBlock { 0; 1; 21; }
removeItemAtIndex = List.RemoveItemAtIndex(list=read_excel, indices=code_block_6.out0)
removeItemAtIndex_2 = List.RemoveItemAtIndex(list=removeItemAtIndex, indices=code_block_6.out0)
removeItemAtIndex_3 = List.RemoveItemAtIndex(list=removeItemAtIndex_2, indices=code_block_6.out2)
join = List.Join(create_2, removeItemAtIndex_3)
watch_2 = Watch(join)
code_block_7 = CodeBlock { "img"; }
directory_path = Directory("C:\Users\Josh\Desktop\Tally Images")
python_script = Python(IN[0]=directory_path)
# ---------- python_script.python (12 lines) ----------
import sys
sys.path.append(r'C:\Program Files (x86)\IronPython 2.7\Lib')
import os

#The inputs to this node will be stored as a list in the IN variables.
folder = IN[0]

files = os.listdir(folder)
pngs = [int(f[:-4]) for f in files if f.lower().endswith(".png")]
pngs.sort()

OUT = [str(n) + '.PNG' for n in pngs]
# ----------------------------------------
create_3 = List.Create(code_block_7, python_script)
flatten = Flatten(create_3)
count_2 = Count(create)
insert = Insert(watch_2, flatten, count_2, lacing=Longest)
writeToFile = CSV.WriteToFile(code_block_4, insert)
code_block_8 = CodeBlock { "Option"; }
code_block_9 = CodeBlock { " "; }
code_block_10 = CodeBlock { -1; }
code_block_11 = CodeBlock { "C:\Users\Josh\Desktop\Tally Images"; }
