# Grasshopper definition Tan & Xiong & Hou Atrium performce with Human UI final.gh (Grasshopper 0.9.76)
# plug-ins: Python Interpreter, Human UI, Human

ladybug = Ladybug_Ladybug()  # -> out; plug-in component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
brep = Brep(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)
domain_box = DomainBox(Base=PlaneXY(0, 0, 0), X="32", Y="32", Z="16")
honeybee = Honeybee_Honeybee()  # -> out; plug-in component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
brep_wireframe = BrepWireframe(Brep=domain_box, Density=-1)
deconstruct_brep = DeconstructBrep(Brep=domain_box)  # -> Faces, Edges, Vertices

# ---- group: bottom
list_item = ListItem(List=deconstruct_brep.Faces, Index=Slider(4, range=0..10), Wrap=True)

# ---- group: top
list_item_2 = ListItem(List=deconstruct_brep.Faces, Index=Slider(5, range=0..10), Wrap=True)

# ----
custom_preview_lineweights = CustomPreviewLineweights(
    Geometry=brep_wireframe,
    Shader=ColourSwatch(SwatchColor=RGB(0, 0, 0)),
    Thickness=Slider(2.3, range=0..10),
    Absolute=False)
downloadepw = Ladybug_downloadEPWWeatherFile(download=Button())  # -> Output; plug-in component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

# ---- group: radius bottom
bottom_radius = Slider(10, range=0..10)

top_radius = Slider(7, range=0..10)

# ----
number_slider = Slider(4, range=0..10)
panel = Panel("https://www.energyplus.net/weather-download/north_and_central_america_wmo_region_4/USA/AZ/USA_AZ_Phoenix-Sky.Harbor.Intl.AP.722780_TMY3/all")
list_item_3 = ListItem(List=deconstruct_brep.Edges, Index=Slider(5, range=0..100), Wrap=True)
list_item_4 = ListItem(List=deconstruct_brep.Edges, Index=Slider(6, range=0..100), Wrap=True)
area = Area(Geometry=list_item_2)  # -> Area, Centroid
area_2 = Area(Geometry=list_item)  # -> Area, Centroid
create_slider = CreateSlider(Slider=[top_radius, bottom_radius], ShowBounds=False, ShowTicks=False, ShowTooltip=False, ShowValLabel=True)
create_slider_2 = CreateSlider(Slider=[top_radius, bottom_radius], ShowBounds=False, ShowTicks=False, ShowTooltip=False, ShowValLabel=True)
create_slider_3 = CreateSlider(Slider=[top_radius, bottom_radius], ShowBounds=False, ShowTicks=False, ShowTooltip=False, ShowValLabel=True)
epw_stat = Ladybug_OpenEPWAndSTATWeatherFiles(weatherFileURL=panel)  # -> epwFile, statFile; plug-in component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
curve = Curve(list_item_4)
curve_array = CurveArray(Geometry=curve, Curve=list_item_3, Count=Slider(27, range=0..100))  # -> Geometry, Transform
value_listener = ValueListener(Elements=create_slider_3, SomeProperty=True)  # -> flatten(Values), Indices
list_item_5 = ListItem(List=value_listener.Values, Index=0, Wrap=True)
circle = Circle(Plane=area.Centroid, Radius=list_item_5)
list_item_6 = ListItem(List=value_listener.Values, Index=1, Wrap=True)
circle_2 = Circle(Plane=area_2.Centroid, Radius=list_item_6)
rebuild_curve = RebuildCurve(Curve=circle_2, Degree=Slider(1, range=0..1), Count=Slider(8, range=0..10), Tangents=False)
xz_plane = XZPlane(Origin=Point(0, 0, 0))
rebuild_curve_2 = RebuildCurve(Curve=circle, Degree=Slider(1, range=0..1), Count=Slider(8, range=0..10), Tangents=False)
split_brep = SplitBrep(Brep=domain_box, Cutter=rebuild_curve_2)

# ---- group: hole
list_item_7 = ListItem(List=split_brep, Index=Slider(1, range=0..1), Wrap=True)

# ----
deconstruct_brep_2 = DeconstructBrep(Brep=list_item_7)  # -> Faces, Edges, Vertices
cull_index = CullIndex(List=deconstruct_brep_2.Faces, Indices=number_slider, Wrap=True)
list_item_8 = ListItem(List=deconstruct_brep_2.Faces, Index=number_slider, Wrap=True)
trim_with_region = TrimWithRegion(Curve=curve_array.Geometry, Region=rebuild_curve_2)  # -> Inside, Outside
curve_2 = Curve(trim_with_region.Inside)
offset = Offset(Curve=curve_2, Distance="-0.8", Plane=xz_plane, Corners=1)
loft = Loft(
    Curves=[rebuild_curve_2, rebuild_curve],
    Options={Adjust=False, Closed=False, LoftEnds=0, LoftSimp=0, LoftType=0, Rebuild=10, Refit=0.01})
edge_surface = EdgeSurface(CurveA=trim_with_region.Inside, CurveB=offset)
pi = Pi(Factor=Slider(-0.2, range=-0.8..0))
plane_surface = PlaneSurface(Plane=area_2.Centroid, XSize="-20 to 20", YSize="-20 to 20")

# ---- group: model
solid_difference = SolidDifference(BrepsA=domain_box, BrepsB=loft)

# ----
rotate_axis = RotateAxis(Geometry=edge_surface, Angle=pi, Axis=trim_with_region.Inside)  # -> Geometry, Transform
unit_z = UnitZ(Factor=Slider(4, range=0..10))
brep_wireframe_2 = BrepWireframe(Brep=edge_surface, Density=-1)
move = Move(Geometry=plane_surface, Motion=unit_z)  # -> Geometry, Transform
custom_preview_lineweights_2 = CustomPreviewLineweights(
    Geometry=brep_wireframe_2,
    Shader=ColourSwatch(SwatchColor=RGB(0, 76, 255)),
    Thickness=Slider(2, range=0..10),
    Absolute=False)
split_brep_2 = SplitBrep(Brep=solid_difference, Cutter=move.Geometry)
number_slider_2 = Slider(1, range=0..10)

# ---- group: 1st floor
list_item_9 = ListItem(List=flatten(split_brep_2), Index=number_slider_2, Wrap=True)

# ---- group: atrium
cap_holes = CapHoles(Brep=loft)

# ---- group: upper floor
cull_index_2 = CullIndex(List=split_brep_2, Indices=number_slider_2, Wrap=True)

# ----
cap_holes_2 = CapHoles(Brep=list_item_9)
cap_holes_3 = CapHoles(Brep=cull_index_2)
split_brep_3 = SplitBrep(Brep=cap_holes, Cutter=move.Geometry)
unit_z_2 = UnitZ(Factor=Slider(4, range=0..10))
cull_index_3 = CullIndex(List=split_brep_3, Indices=Slider(0, range=0..100), Wrap=True)
move_2 = Move(Geometry=move.Geometry, Motion=unit_z_2)  # -> Geometry, Transform
unit_z_3 = UnitZ(Factor=1)

# ---- group: model
brep_2 = Brep(solid_difference)

# ----
split_brep_4 = SplitBrep(Brep=cull_index_3, Cutter=move_2.Geometry)
deconstruct_brep_3 = DeconstructBrep(Brep=solid_difference)  # -> Faces, Edges, Vertices
unit_z_4 = UnitZ(Factor=Slider(4, range=0..10))
contour = Contour(Shape=brep_2, Point=Point(0, 0, 0), Direction=unit_z_3, Distance=Slider(4, range=0..10))
number_slider_3 = Slider(0, range=0..10)
move_3 = Move(Geometry=move_2.Geometry, Motion=unit_z_4)  # -> Geometry, Transform
series = Series(Start=Slider(0, range=0..100), Step=1, Count=Slider(4, range=0..10))
number_slider_4 = Slider(1, range=0..1)
cull_index_4 = CullIndex(List=split_brep_4, Indices=number_slider_4, Wrap=True)
boundary_surfaces = BoundarySurfaces(Edges=contour)  # -> flatten(Surfaces)

# ---- group: top
list_item_10 = ListItem(List=deconstruct_brep_3.Faces, Index=Slider(5, range=0..100), Wrap=True)

# ----
list_item_11 = ListItem(List=deconstruct_brep_3.Faces, Index=series, Wrap=True)
cull_index_5 = CullIndex(List=boundary_surfaces, Indices=number_slider_3, Wrap=True)
split_brep_5 = SplitBrep(Brep=cull_index_4, Cutter=move_3.Geometry)
curve_3 = Curve(rebuild_curve_2)

# ---- group: atrium bottom
boundary_surfaces_2 = BoundarySurfaces(Edges=rebuild_curve)

# ---- group: 1st floor
list_item_12 = ListItem(List=boundary_surfaces, Index=number_slider_3, Wrap=True)

# ----
offset_2 = Offset(Curve=curve_3, Distance=Slider(-2, range=-3..0), Plane=PlaneXY(0, 0, 0), Corners=1)

# ---- group: 3rd floor
cull_index_6 = CullIndex(List=split_brep_5, Indices=Slider(0, range=0..100), Wrap=True)

# ---- group: 4th floor
list_item_13 = ListItem(List=split_brep_5, Index=0, Wrap=True)

# ---- group: 2nd floor
list_item_14 = ListItem(List=split_brep_4, Index=number_slider_4, Wrap=True)

# ---- group: first
list_item_15 = ListItem(List=split_brep_3, Index=0, Wrap=True)

# ---- group: 2-5 floor
merge = Merge(Data1=list_item_10, Data2=cull_index_5, Data3=list_item_11)

# ----
number_slider_5 = Slider(0, range=0..1)
split_brep_6 = SplitBrep(Brep=list_item_13, Cutter=offset_2)
brep_wireframe_3 = BrepWireframe(Brep=[merge, list_item_12, boundary_surfaces_2, solid_difference], Density=-1)
createhbsrfs = Honeybee_createHBSrfs(geometry=cap_holes_3, srfType="0")  # -> out, simplify(HBSurface); plug-in component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

# ---- group: 4th floor
cull_index_7 = CullIndex(List=split_brep_6, Indices=number_slider_5, Wrap=True)

# ---- group: window
list_item_16 = ListItem(List=split_brep_6, Index=number_slider_5, Wrap=True)

# ----
createhbsrfs_2 = Honeybee_createHBSrfs(geometry=cap_holes_2, srfType="0")  # -> out, simplify(HBSurface); plug-in component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
hatch_table = HatchTable(Update=brep_wireframe_3)
createhbsrfs_3 = Honeybee_createHBSrfs(geometry=[cull_index_7, list_item_14, list_item_15, cull_index_6], srfType="0")  # -> out, simplify(HBSurface); plug-in component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
createhbsrfs_4 = Honeybee_createHBSrfs(geometry=list_item_16, srfType="1")  # -> out, simplify(HBSurface); plug-in component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
boolean_toggle = BooleanToggle(False)
merge_2 = Merge(Data2=merge, Data3=list_item_15, Data4=list_item_14, Data5=cull_index_6, Data6=list_item_13)  # -> flatten(Result)
createhbzones = Honeybee_createHBZones(name="ground floor", HBSurfaces=flatten(createhbsrfs_2.HBSurface), isConditioned=boolean_toggle)  # -> out, HBZone; plug-in component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
createhbzones_2 = Honeybee_createHBZones(name="context", HBSurfaces=flatten(createhbsrfs.HBSurface), isConditioned=boolean_toggle)  # -> out, HBZone; plug-in component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

# ---- group: context
brep_3 = Brep(merge)

# ----
brep_4 = Brep(edge_surface)

# ---- group: site
brep_5 = Brep(list_item_12)

# ----
createhbzones_3 = Honeybee_createHBZones(name="Atrium", HBSurfaces=flatten([createhbsrfs_4.HBSurface, createhbsrfs_3.HBSurface]), isConditioned=Toggle(False))  # -> out, HBZone; plug-in component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

unit_x = UnitX(Factor=1)
brep_6 = Brep([createhbzones_3.HBZone, createhbzones.HBZone])
solid_union = SolidUnion(Breps=brep_6)
contour_2 = Contour(Shape=solid_union, Point=Point(0, 0, 0), Direction=unit_x, Distance="16")
# SECTION
boundary_surfaces_3 = BoundarySurfaces(Edges=flatten(contour_2))
list_item_17 = ListItem(List=boundary_surfaces_3, Index=Slider(1, range=0..10), Wrap=True)

create_label = CreateLabel(LabelText="CFD Analysis", LabelSize=24, Justification=1)
create_label_2 = CreateLabel(LabelText="CFD Analysis", LabelSize=24, Justification=1)
create_label_3 = CreateLabel(LabelText="CFD Analysis", LabelSize=24, Justification=1)
solveadjc = Honeybee_SolveAdjacencies(
    HBZones=flatten([createhbzones_2.HBZone, createhbzones_3.HBZone, createhbzones.HBZone]),
    removeCurrentAdjc=False,
    findAdjc=Toggle(True))  # -> out, HBZonesWADJ; plug-in component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
cfd = Data()
cfd_2 = Data()
cfd_3 = Data()
format = Format(Format="CFD Analysis: {0:0.00}", Culture=127, Data0=cfd)
format_2 = Format(Format="CFD Analysis: {0:0.00}", Culture=127, Data0=cfd_2)
format_3 = Format(Format="CFD Analysis: {0:0.00}", Culture=127, Data0=cfd_3)

# ---- group: Load EPW File
epw_stat_2 = Ladybug_OpenEPWAndSTATWeatherFiles(weatherFileURL=panel)  # -> epwFile, statFile; plug-in component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
importepw = Ladybug_ImportEpw(epwFile=epw_stat_2.epwFile)  # -> Output, latitude, location, dryBulbTemperature, dewPointTemperature, relativeHumidity, windSpeed, windDirection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; plug-in component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

# ----
set_label_contents = SetLabelContents(LabelToModify=create_label, NewLabelContents=format)
set_label_contents_2 = SetLabelContents(LabelToModify=create_label_2, NewLabelContents=format_2)
set_label_contents_3 = SetLabelContents(LabelToModify=create_label_3, NewLabelContents=format_3)

# ----
# FIND THE EXTREME DAY
strnum = Ladybug_SeparateData(inputList=flatten(importepw.windSpeed))  # -> numbers, strings; plug-in component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
selectandaveragedata = Ladybug_AverageData(annualHourlyData=strnum.numbers)  # -> readMe, selHourlyData, averagedDaily, averagedMonthly, avrMonthlyPerHour, avrAnalysisPeriod; plug-in component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
strnum_2 = Ladybug_SeparateData(inputList=flatten(selectandaveragedata.averagedDaily))  # -> numbers, strings; plug-in component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
series_2 = Series(Start=0, Step=1, Count="365")  # -> graft(Series)
series_3 = Series(Start=0, Step=1, Count="7")  # -> flatten(Series)
shift_list = ShiftList(List=strnum_2.numbers, Shift=series_2, Wrap=True)
all_7_day_periods = Panel(shift_list)
list_item_18 = ListItem(List=shift_list, Index=series_3, Wrap=True)  # -> simplify(Item)
mass_addition = MassAddition(Input=list_item_18)  # -> flatten(Result), PartialResults
value_per_week = Panel(mass_addition.Result)
sort_list = SortList(Keys=mass_addition.Result)  # -> reverse(Keys), ValuesValuesA
highest_value = Panel(sort_list.Keys)
list_item_19 = ListItem(List=sort_list.Keys, Index="0", Wrap=True)
find_domain = FindDomain(Domains=mass_addition.Result, Number=list_item_19, Strict=False)  # -> Index, Neighbour
year_day_of_week = Panel(find_domain.Index)
multiplication = Multiplication(A=year_day_of_week, B=24)
day_month_hour_calculator = Ladybug_Day_Month_Hour(HOY=multiplication)  # -> day, month, hour, date; plug-in component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

create_label_4 = CreateLabel(LabelText="Percentage of Time comfortable", LabelSize=24, Justification=1)
hb_epcontextsrf = HoneybeeEPContextSurfaces(shdSurfaces=flatten(brep_4))  # -> HBContext; inputs shdSurfaces: list of Brep, justBoundingBox: Boolean
# ---------- hb_epcontextsrf: Python ----------
"""
prepare shading/context geometries

    Args:
        northVectorOrRotation: A vector that shows North or a number that shows
                               the rotation of the North from the Y axis
        bldgMasses: List of closed Breps as thermal zones.
    Returns:
        report: ...
        thermalZones: Thermal zone's geometries for visualiza
"""

ghenv.Component.Name = 'Honeybee EP context Surfaces'
ghenv.Component.NickName = 'HB_EPContextSrf'
ghenv.Component.Message = 'VER 0.0.61\nFEB_05_2017'
ghenv.Component.IconDisplayMode = ghenv.Component.IconDisplayMode.application
ghenv.Component.Category = "Honeybee"
ghenv.Component.SubCategory = "10 | Energy | Energy"
#compatibleHBVersion = VER 0.0.57\nNOV_04_2016
#compatibleLBVersion = VER 0.0.59\nFEB_01_2015
ghenv.Component.AdditionalHelpFromDocStrings = "2"

import rhinoscriptsyntax as rs
import Rhino as rc
import scriptcontext as sc
import os
import System
import Grasshopper.Kernel as gh
import uuid

tolerance = sc.doc.ModelAbsoluteTolerance
import math


def main(shdSurfaces, EPTransSchedule, meshingSettings, justBoundingBox):
    
    # import the classes
    if sc.sticky.has_key('honeybee_release'):

        try:
            if not sc.sticky['honeybee_release'].isCompatible(ghenv.Component): return -1
            if sc.sticky['honeybee_release'].isInputMissing(ghenv.Component): return -1
        except:
            warning = "You need a newer version of Honeybee to use this compoent." + \
            " Use updateHoneybee component to update userObjects.\n" + \
            "If you have already updated userObjects drag Honeybee_Honeybee component " + \
            "into canvas and try again."
            w = gh.GH_RuntimeMessageLevel.Warning
            ghenv.Component.AddRuntimeMessage(w, warning)
            return -1
        
        # don't customize this part
        hb_EPSrf = sc.sticky["honeybee_EPSurface"]
        hb_EPSHDSurface = sc.sticky["honeybee_EPShdSurface"]
        hb_RADMaterialAUX = sc.sticky["honeybee_RADMaterialAUX"]
        hb_EPObjectsAux = sc.sticky["honeybee_EPObjectsAUX"]()
        HBScheduleList = sc.sticky["honeybee_ScheduleLib"].keys()

        ########################################################################
        #----------------------------------------------------------------------#
        shdBreps = []
        # create bounding box of shading geometries
        if justBoundingBox:
            for brep in shdSurfaces:
                if brep.Faces.Count>1 or not brep.Faces[0].IsPlanar(sc.doc.ModelAbsoluteTolerance):
                    shdBreps.append(brep.GetBoundingBox(True).ToBrep())
                else:
                    shdBreps.append(brep)
        else:
            shdBreps = shdSurfaces
        
        shadingClasses = []
        shadingMeshPreview = []
        
        if meshingSettings == None:
            mp = rc.Geometry.MeshingParameters.Minimal
            mp.SimplePlanes = True
        else:
            mp = meshingSettings
        
        def getRadMaterialName(radMaterial):
            nameStr = radMaterial.split(" ")[2]
            name =  nameStr.split("\n")[0]
            return name
        
        for brepCount, brep in enumerate(shdBreps):
            if brep != None:
                isPlanar = True
                # check planarity
                for face in brep.Faces:
                    if not face.IsPlanar(tolerance):
                        isPlanar = False
                        break
                
                shadingBreps = []
                if not isPlanar:
                    meshArray = rc.Geometry.Mesh.CreateFromBrep(brep, mp)
                    for mesh in meshArray:
                        for meshFace in range(mesh.Faces.Count):
                            vertices = list(mesh.Faces.GetFaceVertices(meshFace))[1:]
                            vertices = vertices + [sc.doc.ModelAbsoluteTolerance]
                            # create the brep from mesh
                            shdBrep = rc.Geometry.Brep.CreateFromCornerPoints(*vertices)
                            shadingBreps.append(shdBrep)
                else:
                    for face in brep.Faces:
                        shadingBreps.append(face.DuplicateFace(False))
                
                for faceCount, shdBrep in enumerate(shadingBreps):
                        thisShading = hb_EPSHDSurface(shdBrep, 1000*brepCount + faceCount, 'shdSrf_' + `brepCount` + '_' + `faceCount` + "_" + str(uuid.uuid4()))
                        
                        # add transmittance schedule if any
                        if EPTransSchedule!=None:
                            schedule= EPTransSchedule.upper()
                            if schedule!=None and not schedule.lower().endswith(".csv") and schedule not in HBScheduleList:
                                msg = "Cannot find " + schedule + " in Honeybee schedule library."
                                print msg
                                ghenv.Component.AddRuntimeMessage(gh.GH_RuntimeMessageLevel.Warning, msg)
                                return -1
                            elif schedule!=None and schedule.lower().endswith(".csv"):
                                # check if csv file is existed
                                if not os.path.isfile(schedule):
                                    msg = "Cannot find the shchedule file: " + schedule
                                    print msg
                                    ghenv.Component.AddRuntimeMessage(gh.GH_RuntimeMessageLevel.Warning, msg)
                                    return -1
                            
                            thisShading.TransmittanceSCH = schedule
                        
                        # add the Rad Material if any
                        if RADMaterial!=None:
                            # if it is just the name of the material make sure it is already defined
                            if len(RADMaterial.split(" ")) == 1:
                                # if the material is not in the library add it to the library
                                if not hb_RADMaterialAUX.isMatrialExistInLibrary(RADMaterial):
                                    warningMsg = "Can't find " + RADMaterial + " in RAD Material Library.\n" + \
                                                "Add the material to the library and try again."
                                    ghenv.Component.AddRuntimeMessage(gh.GH_RuntimeMessageLevel.Warning, warningMsg)
                                    return
                                
                                try:
                                    thisShading.setRADMaterial(RADMaterial)
                                except Exception, e:
                                    print e
                                    warningMsg = "You are using an old version of Honeybee_Honeybee! Update your files and try again."
                                    print warningMsg
                                    ghenv.Component.AddRuntimeMessage(gh.GH_RuntimeMessageLevel.Warning, warningMsg)
                                    return
                                
                                addedToLib = True
                            else:
                                
                                # try to add the material to the library
                                addedToLib, thisShading.RadMaterial = hb_RADMaterialAUX.analyseRadMaterials(RADMaterial, True)
                                
                            if addedToLib==False:
                                warningMsg = "Failed to add " + RADMaterial + " to the Library."
                                ghenv.Component.AddRuntimeMessage(gh.GH_RuntimeMessageLevel.Warning, warningMsg)
                                return
                        
                        # add shading to the list
                        shadingClasses.append(thisShading)
                
        # add to the hive
        hb_hive = sc.sticky["honeybee_Hive"]()
        HBContext  = hb_hive.addToHoneybeeHive(shadingClasses, ghenv.Component)
        return HBContext
        ################################################################################################
    else:
        print "You should first let Honeybee to fly..."
        w = gh.GH_RuntimeMessageLevel.Warning
        ghenv.Component.AddRuntimeMessage(w, "You should first let Honeybee to fly...")
        return -1
        

if _shdSurfaces and _shdSurfaces[0]!=None:
    # add cleaning function
    result= main(_shdSurfaces, EPTransSchedule_, meshingSettings_, justBoundingBox_)
    
    if result != -1: HBContext = result
# ---------- end hb_epcontextsrf ----------
create_label_5 = CreateLabel(LabelText="Percentage of Time comfortable", LabelSize=24, Justification=1)
number_slider_6 = Slider(464, range=0..1000)
addition = Addition(A="15", B="1")
create_label_6 = CreateLabel(LabelText="Percentage of Time comfortable", LabelSize=24, Justification=1)

# ---- group: comfort / Context
brep_7 = Brep(brep_3)

# ---- group: comfort / Site
brep_8 = Brep(boundary_surfaces_2)

# ---- group: comfort / building
brep_9 = Brep(edge_surface)

# ----
analysisperiod = Ladybug_AnalysisPeriod(fromMonth="4", fromDay="27", fromHour="15", toMonth="4", toDay="27", toHour=addition)  # -> out, analysisPeriod; plug-in component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

# ----
# Energy Simulation
boolean_toggle_2 = BooleanToggle(True)
boolean_toggle_3 = BooleanToggle(True)
epoutput = Honeybee_GenerateEPOutput(
    zoneEnergyUse=boolean_toggle_2,
    zoneGainsAndLosses=boolean_toggle_2,
    zoneComfortMetrics=boolean_toggle_2,
    comfortMapVariables=boolean_toggle_2,
    zoneHVACParams=boolean_toggle_2,
    surfaceTempAnalysis=boolean_toggle_3,
    surfaceEnergyAnalysis=boolean_toggle_3,
    glazingSolarAnalysis=boolean_toggle_3,
    summaryReports=True,
    timestep="hourly")  # -> out, flatten(simulationOutputs); plug-in component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
energysimpar = Honeybee_EnergySimulationPar(timestep=6, solarDistribution=Slider(1, range=0..1))  # -> energySimPar; plug-in component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
boolean_toggle_4 = BooleanToggle(True)
runenergysimulation = Honeybee_RunEnergySimulation(
    epwFile=epw_stat.epwFile,
    analysisPeriod=analysisperiod.analysisPeriod,
    energySimPar=energysimpar,
    HBZones=solveadjc.HBZonesWADJ,
    HBContext=flatten(hb_epcontextsrf),
    simulationOutputs=flatten(epoutput.simulationOutputs),
    writeIdf=boolean_toggle_4,
    runEnergyPlus=boolean_toggle_4)  # -> out, idfFileAddress, htmlReport, resultFileAddress; plug-in component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
readepsrfresult = Honeybee_ReadEPSurfaceResult(resultFileAddress=runenergysimulation.resultFileAddress)  # -> surfaceIndoorTemp, surfaceOutdoorTemp, surfaceEnergyFlow, opaqueEnergyFlow, glazEnergyFlow, windowTotalSolarEnergy, windowBeamEnergy, windowDiffEnergy, windowTransmissivity, otherSurfaceData; plug-in component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
# Calculate High Resolution Thermal Map
colorsurfaces = Honeybee_ColorSurfacesByEPResult(srfData=readepsrfresult.surfaceOutdoorTemp, HBZones=solveadjc.HBZonesWADJ, runIt=Toggle(True))  # -> readMe, srfColoredMesh, zoneWireFrame, legend, legendBasePt, analysisTitle, srfBreps, srfColors, srfValues, normalizedSrfData; plug-in component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
series_4 = Series(Start=Slider(0, range=0..100), Step=1, Count=Slider(22, range=0..100))
geometry = Geometry(colorsurfaces.legend)
cull_index_8 = CullIndex(List=colorsurfaces.srfColoredMesh, Indices=series_4, Wrap=True)
unit_x_2 = UnitX(Factor=Slider(-50, range=-50..0))
unit_y = UnitY(Factor="-60")
move_4 = Move(Geometry=geometry, Motion=unit_x_2)  # -> Geometry, Transform
move_5 = Move(Geometry=[cull_index_8, brep_wireframe_3, move_4.Geometry], Motion=unit_y)  # -> Geometry, Transform
mesh = Mesh(cull_index_8)

legendpar = Ladybug_LegendParameters()  # -> legendPar; plug-in component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
point = Point(Point(16, -87, 0))
windrose = Ladybug_WindRose(
    north=0,
    hourlyWindDirection=importepw.windDirection,
    hourlyWindSpeed=importepw.windSpeed,
    analysisPeriod=analysisperiod.analysisPeriod,
    centerPoint=point,
    scale="0.02",
    legendPar=legendpar,
    runIt=Toggle(True))  # -> out, calmRoseMesh, windRoseMesh, windRoseCrvs, windRoseCenPts, legend, legendBasePts, title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; plug-in component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

create_color_picker = CreateColorPicker(DefaultColor=RGBA(255, 255, 255, 166), AvailableColors=RGB(255, 255, 255))
value_listener_2 = ValueListener(Elements=create_color_picker, SomeProperty=True)  # -> Values, Indices
create_3d_view = Create3DView(MeshToDisplay=merge_2, MeshColors=RGB(255, 0, 0), ViewWidth=number_slider_6, ViewHeight=Slider(500, range=0..1000))
create_3d_view_2 = Create3DView(MeshToDisplay=merge_2, MeshColors=RGB(255, 0, 0), ViewWidth=number_slider_6, ViewHeight=Slider(500, range=0..1000))
create_3d_view_3 = Create3DView(MeshToDisplay=merge_2, MeshColors=RGB(255, 0, 0), ViewWidth=number_slider_6, ViewHeight=Slider(500, range=0..1000))
set_3d_view = Set3DView(_3DView=create_3d_view_3, MeshToDisplay=merge_2, MeshColors=value_listener_2.Values)
set_3d_view_2 = Set3DView(_3DView=create_3d_view, MeshToDisplay=merge_2, MeshColors=value_listener_2.Values)
set_3d_view_3 = Set3DView(_3DView=create_3d_view_2, MeshToDisplay=merge_2, MeshColors=value_listener_2.Values)

create_gradient_editor = CreateGradientEditor(ShowEditor=True, ShowPresets=False)
launch_window = LaunchWindow(
    Show=Toggle(True),
    Name="Atrium Shape Research",
    Width=number_slider_6,
    Height=Slider(444, range=0..1000),
    ChildStatus=1,
    EnableHorizScroll=False)
create_graph_mapper = CreateGraphMapper()
create_multidimensional_slider = CreateMultidimensionalSlider()
point_2 = Point(Point(-20, 2, 0))
create_label_7 = CreateLabel(LabelText="Spatial Daylight Autonomy", LabelSize=24, Justification=1)
panel_2 = Panel("""Philadelphia
Phoenix
Minnepolis""")
create_label_8 = CreateLabel(LabelText="Spatial Daylight Autonomy", LabelSize=24, Justification=1)
number_slider_7 = Slider(5, range=0..10)
create_label_9 = CreateLabel(LabelText="Spatial Daylight Autonomy", LabelSize=24, Justification=1)
random = Random(Range=Slider(6, range=0..10), Number=number_slider_7, Seed=2)
sequence = Sequence(Count=number_slider_7, CharPool="ABCDEFGHIJKLMNOPQRSTUVWXYZ", Format="{0}")
tabbed_view = TabbedView(
    TabNames=panel_2,
    Tab0=flatten([create_slider_3, create_3d_view_3, create_label_7, create_label_4, create_label_3]),
    Tab1=flatten([create_slider_2, create_3d_view, create_label_8, create_label_5, create_label]),
    Tab2=flatten([create_slider, create_3d_view_2, create_label_9, create_label_6, create_label_2]))
create_chart = CreateChart(Data=random, Names=sequence, Title="My Values", ChartType=0)
value_listener_3 = ValueListener(Elements=create_chart, SomeProperty=True)  # -> Values, Indices
accent_colors = ValueList({"Amber", "Blue", "Brown", "Cobalt", "Crimson", "Cyan", "Emerald", "Green", "Indigo", "Lime", "Magenta", "Mauve", "Olive", "Orange", "Pink", "Purple", "Red", "Sienna", "Steel", "Taupe", "Teal", "Violet", "Yellow"}, selected="Blue")
add_elements = AddElements(Window=launch_window, Elements=flatten(tabbed_view), DoVLChecking=True)  # -> AddedElements, ElementNames
panel_3 = Panel(value_listener_3.Values)
set_window_properties = SetWindowProperties(Window=launch_window, Theme=1, AccentColor=accent_colors, ShowTitleBar=True, ScaleFactor=1)
point_3 = Point(Point(-37, 2, 0))
number_slider_8 = Slider(51, range=0..100)
number_slider_9 = Slider(14, range=0..100)
number_slider_10 = Slider(52, range=0..100)
number_slider_11 = Slider(54, range=0..100)
number_slider_12 = Slider(53, range=0..100)
number_slider_13 = Slider(32, range=0..100)
series_5 = Series(Start=Slider(23, range=0..100), Step=1, Count=Slider(9, range=0..100))
series_6 = Series(Start=Slider(33, range=0..100), Step=1, Count=Slider(18, range=0..100))

# ---- group: INLET
list_item_20 = ListItem(List=colorsurfaces.srfBreps, Index=number_slider_8, Wrap=True)
list_item_21 = ListItem(List=colorsurfaces.srfColoredMesh, Index=number_slider_8, Wrap=True)
list_item_22 = ListItem(List=colorsurfaces.srfValues, Index=number_slider_8, Wrap=True)

# ---- group: WALL
list_item_23 = ListItem(
    List=colorsurfaces.srfColoredMesh,
    Index=[series_5, number_slider_9, series_6, number_slider_10, number_slider_11],
    Wrap=True)
list_item_24 = ListItem(List=colorsurfaces.srfValues, Index=[series_5, number_slider_9, series_6, number_slider_10, number_slider_11], Wrap=True)
list_item_25 = ListItem(List=colorsurfaces.srfBreps, Index=[series_5, number_slider_9, series_6, number_slider_10, number_slider_11], Wrap=True)

# ---- group: OUTLET
list_item_26 = ListItem(List=colorsurfaces.srfColoredMesh, Index=number_slider_13, Wrap=True)
list_item_27 = ListItem(List=colorsurfaces.srfValues, Index=number_slider_13, Wrap=True)
list_item_28 = ListItem(List=colorsurfaces.srfBreps, Index=number_slider_13, Wrap=True)

list_item_29 = ListItem(List=colorsurfaces.srfColoredMesh, Index=number_slider_12, Wrap=True)
list_item_30 = ListItem(List=colorsurfaces.srfBreps, Index=number_slider_12, Wrap=True)
list_item_31 = ListItem(List=colorsurfaces.srfValues, Index=number_slider_12, Wrap=True)

# ----
area_3 = Area(Geometry=list_item_30)  # -> Area, Centroid
area_4 = Area(Geometry=list_item_26)  # -> Area, Centroid
area_5 = Area(Geometry=list_item_20)  # -> Area, Centroid
integer = Integer(list_item_22)
integer_2 = Integer(list_item_31)
integer_3 = Integer(list_item_27)
unit_y_2 = UnitY(Factor="3")
move_6 = Move(Geometry=area_3.Centroid, Motion=unit_y_2)  # -> Geometry, Transform
concatenate = Concatenate(FragmentA=integer, FragmentB="℃")
concatenate_2 = Concatenate(FragmentA=integer_2, FragmentB="℃")
unit_y_3 = UnitY(Factor="-5")
move_7 = Move(Geometry=area_5.Centroid, Motion=unit_y_3)  # -> Geometry, Transform
concatenate_3 = Concatenate(FragmentA=integer_3, FragmentB="℃")
text_tag_3d = TextTag3D(Location=move_6.Geometry, Text=concatenate_2, Size=Slider(2, range=0..10), Justification=7)
text_tag_3d_2 = TextTag3D(Location=move_7.Geometry, Text=concatenate, Size=Slider(2, range=0..10), Justification=8)
text_tag_3d_3 = TextTag3D(Location=area_4.Centroid, Text=concatenate_3, Size=Slider(2, range=0..10), Justification=8)
flatten_tree = FlattenTree(Tree=list_item_25, Path="{0}")  # -> simplify(graft(Tree))
flatten_tree_2 = FlattenTree(Tree=list_item_24, Path="{0}")
list_length = ListLength(List=flatten_tree_2)
series_7 = Series(Start=0, Step=1, Count=list_length)
integer_4 = Integer(series_7)
number_slider_14 = Slider(2, range=0..10)
number_slider_15 = Slider(1, range=0..1)

snappyhexmeshdict = Butterfly_snappyHexMeshDict(
    castellatedMesh=True,
    snap=True,
    addLayers=False,
    nCellsBetweenLevels=Slider(3, range=0..10),
    maxGlobalCells=Slider(4000000, range=0..10000000),
    surfaceFeatureLevel=Slider(3, range=0..10),
    expansionRatio=1.1,
    finalLayerThickness=0.7,
    minThickness=0.1,
    nLayerIter=50)  # -> snappyHexMeshDict; plug-in component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
# Generate Probes
decomposepardict_scotch = Butterfly_decomposeParDictScotch(numOfCpus=Slider(4, range=0..10))  # -> decomposeParDict; plug-in component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

# ----
# blockMesh
construct_point = ConstructPoint(XCoordinate=number_slider_15, YCoordinate=number_slider_15, ZCoordinate=number_slider_15)
number_slider_16 = Slider(2, range=0..10)
area_6 = Area(Geometry=boundary_surfaces_2)  # -> Area, Centroid
unit_z_5 = UnitZ(Factor=Slider(0.5, range=0..1))
move_8 = Move(Geometry=area_6.Centroid, Motion=unit_z_5)  # -> Geometry, Transform

brep_10 = Brep(list_item_17)
area_7 = Area(Geometry=brep_10)  # -> Area, Centroid
scale = Scale(Geometry=brep_10, Center=move_8.Geometry, Factor=Slider(0.9, range=0..1))  # -> Geometry, Transform
gentestpts = Honeybee_GenerateTestPoints(
    testGeometry=scale.Geometry,
    gridSize=Slider(0.5, range=0..1),
    distBaseSrf=Slider(0.005, range=0..0.01),
    moveTestMesh=True)  # -> out, simplify(testPoints), simplify(ptsVectors), simplify(facesArea), simplify(mesh); plug-in component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
panel_4 = Panel("""T
U""")
probes = Butterfly_probes(points=gentestpts.testPoints, fields=panel_4)  # -> probes; plug-in component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

controldict = Butterfly_controlDict(
    startTime=0,
    endTime="600",
    writeInterval=Slider(50, range=0..100),
    writeCompression=False,
    purgeWrite=Slider(2, range=0..10))  # -> controlDict; plug-in component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
number_slider_17 = Slider(0, range=0..10)
series_8 = Series(Start=Slider(0, range=0..100), Step=1, Count=Slider(2, range=0..10))

createhbsrfs_5 = Honeybee_createHBSrfs(geometry=brep_5, srfType=Slider(2, range=0..10))  # -> out, simplify(HBSurface); plug-in component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
createhbsrfs_6 = Honeybee_createHBSrfs(geometry=brep_3, srfType="6")  # -> readMe, simplify(HBSurface); plug-in component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
brep_wireframe_4 = BrepWireframe(Brep=[brep_5, brep_3], Density=-1)
gentestpts_2 = Honeybee_GenerateTestPoints(testGeometry=createhbsrfs_5.HBSurface, gridSize="4", distBaseSrf="0.762", moveTestMesh=True)  # -> readMe, simplify(testPoints), simplify(ptsVectors), simplify(facesArea), simplify(mesh); plug-in component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
panel_5 = Panel(createhbsrfs_5.HBSurface)
annualdaylightsimulation = Honeybee_AnnualDaylightSimulation(
    epwWeatherFile=epw_stat.epwFile,
    testPoints=gentestpts_2.testPoints,
    ptsVectors=gentestpts_2.ptsVectors,
    testMesh=gentestpts_2.mesh)  # -> analysisRecipe; plug-in component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
boolean_toggle_5 = BooleanToggle(True)
gradientlibrary = Ladybug_GradientLibrary(gradIndex="16")  # -> customColors; plug-in component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
legendpar_2 = Ladybug_LegendParameters(
    lowBound=Slider(0, range=0..100),
    highBound=Slider(100, range=0..100),
    numSegments=Slider(11, range=0..12),
    customColors=flatten(gradientlibrary),
    legendLocation=point_2)  # -> legendPar; plug-in component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
construct_domain = ConstructDomain(DomainStart=Slider(0, range=0..100), DomainEnd=Slider(1, range=0..1))
number_slider_18 = Slider(2, range=0..10)
unit_y_4 = UnitY(Factor=Slider(3, range=0..10))
point_4 = Point(Point(3, -9, 0))
move_9 = Move(Geometry=point_4, Motion=unit_y_4)  # -> Geometry, Transform

createhbsrfs_7 = Honeybee_createHBSrfs(geometry=brep_4, srfType="6")  # -> readMe, simplify(HBSurface); plug-in component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
rundaylightanalysis = Honeybee_RunDaylightSimulation(
    HBObjects=flatten([createhbsrfs_5.HBSurface, createhbsrfs_6.HBSurface]),
    analysisRecipe=annualdaylightsimulation,
    writeRad=boolean_toggle_5,
    runRad=boolean_toggle_5,
    numOfCPUs=Slider(4, range=0..10),
    overwriteResults=True)  # -> out, analysisType, resultsUnit, results, testPts, resultFiles, radGeoFile, studyFolder, done; plug-in component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
panel_6 = Panel(rundaylightanalysis.done)

# ---- group: comfort
panel_7 = Panel("https://www.energyplus.net/weather-download/north_and_central_america_wmo_region_4/USA/AZ/USA_AZ_Phoenix-Sky.Harbor.Intl.AP.722780_TMY3/all")
epw_stat_3 = Ladybug_OpenEPWAndSTATWeatherFiles(weatherFileURL=panel_7)  # -> epwFile, statFile; plug-in component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
merge_3 = Merge(Data1=brep_7, Data2=brep_9)
gentestpts_3 = Honeybee_GenerateTestPoints(testGeometry=brep_8, gridSize=Slider(4, range=0..15), distBaseSrf=0.75, moveTestMesh=True)  # -> readMe, simplify(testPoints), simplify(ptsVectors), simplify(facesArea), simplify(mesh); plug-in component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
annual = Annual()
cluster = Cluster()
legendpar_3 = Ladybug_LegendParameters(
    numSegments=Slider(9, range=0..100),
    customColors=flatten(cluster),
    legendLocation=point_3,
    legendScale=Slider(1.8, range=0..10),
    fontSize=Slider(1.2, range=0..2))  # -> legendPar; plug-in component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

# ----
importepw_2 = Ladybug_ImportEpw(epwFile=epw_stat_3.epwFile)  # -> readMe, latitude, location, dryBulbTemperature, dewPointTemperature, relativeHumidity, windSpeed, windDirection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; plug-in component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

# ---- group: comfort (continued)
solaradjusttemperature = Ladybug_OutdoorSolarTemperatureAdjustor(
    location=importepw_2.location,
    cumSkyMtxOrDirNormRad=importepw_2.directNormalRadiation,
    diffuseHorizRad=importepw_2.diffuseHorizontalRadiation,
    baseTemperature=importepw_2.dryBulbTemperature,
    baseDryBulbOrMRT=Toggle(False),
    port=importepw_2.horizontalInfraredRadiation,
    bodyLocation=gentestpts_3.testPoints,
    contextShading=flatten(merge_3),
    analysisPeriodOrHOY=annual,
    parallel=Toggle(True),
    runIt=Toggle(True))  # -> readMe, port, effectiveRadiantField, MRTDelta, solarAdjustedMRT, port_2, mannequinMesh, port_3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; plug-in component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
outdoorcomfortcalculator = Ladybug_OutdoorComfortCalculator(
    dryBulbTemperature=importepw_2.dryBulbTemperature,
    meanRadiantTemperature=solaradjusttemperature.solarAdjustedMRT,
    windSpeed_tenMeters=Slider(0.1, range=0..0.1),
    relativeHumidity=importepw_2.relativeHumidity,
    runIt=Toggle(True))  # -> readMe, port, universalThermalClimateIndex, comfortableOrNot, thermalStress, conditionOfPerson, port_2, percentOfTimeComfortable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; plug-in component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
data = Data(flatten(outdoorcomfortcalculator.percentOfTimeComfortable))
output_data = Panel(outdoorcomfortcalculator.percentOfTimeComfortable)
recolormesh = Ladybug_RecolorMesh(analysisResult=data, inputMesh=gentestpts_3.mesh, legendPar=legendpar_3, analysisTitle=" ", legendTitle="Comfort %")  # -> out, newMesh, newLegend, legendBasePt, meshColors, legendColors; plug-in component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

# ----
thermal_comfort = Data(flatten(outdoorcomfortcalculator.percentOfTimeComfortable))
thermal_comfort_2 = Data(flatten(outdoorcomfortcalculator.percentOfTimeComfortable))
list_item_32 = ListItem(List=thermal_comfort, Index=0, Wrap=True)
format_4 = Format(Format="Percentage of Time comfortable(%): {0:0.00}", Culture=127, Data0=list_item_32)
list_item_33 = ListItem(List=thermal_comfort_2, Index=0, Wrap=True)
thermal_comfort_3 = Data(flatten(outdoorcomfortcalculator.percentOfTimeComfortable))
format_5 = Format(Format="Percentage of Time comfortable: {0:0.00}", Culture=127, Data0=list_item_33)
set_label_contents_4 = SetLabelContents(LabelToModify=create_label_4, NewLabelContents=format_4)
list_item_34 = ListItem(List=thermal_comfort_3, Index=0, Wrap=True)
set_label_contents_5 = SetLabelContents(LabelToModify=create_label_5, NewLabelContents=format_5)
format_6 = Format(Format="Percentage of Time comfortable: {0:0.00}", Culture=127, Data0=list_item_34)
set_label_contents_6 = SetLabelContents(LabelToModify=create_label_6, NewLabelContents=format_6)
flatten_tree_3 = FlattenTree(Tree=outdoorcomfortcalculator.percentOfTimeComfortable, Path="{0}")
panel_8 = Panel(outdoorcomfortcalculator.universalThermalClimateIndex)
mass_addition_2 = MassAddition(Input=flatten_tree_3)  # -> Result, PartialResults
list_length_2 = ListLength(List=flatten_tree_3)
division = Division(A=mass_addition_2.Result, B=list_length_2)
panel_9 = Panel(division)

readannualresultsi = Honeybee_ReadAnnualResultI(
    illFilesAddress=rundaylightanalysis.resultFiles,
    testPoints=simplify(rundaylightanalysis.testPts),
    DLAIllumThresholds=300,
    runIt=Toggle(True))  # -> DLA, UDLI_Less_100, UDLI_100_2000, UDLI_More_2000, CDA, sDA, annualProfiles, htmReport; plug-in component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
panel_10 = Panel(readannualresultsi.sDA)
recolormesh_2 = Ladybug_RecolorMesh(analysisResult=readannualresultsi.UDLI_100_2000, inputMesh=gentestpts_2.mesh, legendPar=legendpar_2, legendTitle="UDI %")  # -> out, newMesh, newLegend, legendBasePt, meshColors, legendColors; plug-in component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
panel_11 = Panel(panel_9)
multiplication_2 = Multiplication(A=panel_11, B=Slider(100, range=0..100))
panel_12 = Panel(multiplication_2)
concatenate_4 = Concatenate(Fragment_A="SDA: ", Fragment_B=panel_10, A="%")
integer_5 = Integer(panel_12)
division_2 = Division(A=integer_5, B=Slider(100, range=0..100))
concatenate_5 = Concatenate(Fragment_A="Comfort ", Fragment_B=division_2, A="%")
text_tag_3d_4 = TextTag3D(Location=point_4, Text=concatenate_5, Size=number_slider_18, Justification=7)
text_tag_3d_5 = TextTag3D(Location=move_9.Geometry, Text=concatenate_4, Size=number_slider_18, Justification=7)

sunlight_factor = Data(flatten(readannualresultsi.sDA))
format_7 = Format(Format="Spatial Daylight Autonomy(%): {0:0.00}", Culture=127, Data0=sunlight_factor)
sunlight_factor_2 = Data(flatten(readannualresultsi.sDA))
set_label_contents_7 = SetLabelContents(LabelToModify=create_label_7, NewLabelContents=format_7)
format_8 = Format(Format="Spatial Daylight Autonomy(%): {0:0.00}", Culture=127, Data0=sunlight_factor_2)
sunlight_factor_3 = Data(flatten(readannualresultsi.sDA))
set_label_contents_8 = SetLabelContents(LabelToModify=create_label_8, NewLabelContents=format_8)
format_9 = Format(Format="Spatial Daylight Autonomy(%): {0:0.00}", Culture=127, Data0=sunlight_factor_3)
set_label_contents_9 = SetLabelContents(LabelToModify=create_label_9, NewLabelContents=format_9)
concatenate_6 = Concatenate(FragmentA="Comfort:", FragmentB=panel_9)

strnum_3 = Ladybug_SeparateData(inputList=flatten(importepw.dryBulbTemperature))  # -> numbers, strings; plug-in component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
wall = Butterfly_WallBoundary(temperature=flatten_tree_2)  # -> simplify(graft(wallBoundary)); plug-in component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
doy_hoy = Ladybug_DOY_HOY(days="27", months="4", hours="15")  # -> HOY, DOY, date; plug-in component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
# Creating Butterfly Geometries
evaluate_surface = EvaluateSurface(Surface=list_item_20, Point=area_5.Centroid)  # -> Point, Normal, Frame
outlet = Butterfly_OutletBoundary()  # -> outletBoundary; plug-in component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
outlet_2 = Butterfly_OutletBoundary()  # -> outletBoundary; plug-in component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
vector = Vector(evaluate_surface.Normal)
list_item_35 = ListItem(List=strnum_3.numbers, Index=doy_hoy.HOY, Wrap=True)
reverse = Reverse(Vector=vector)
createbfgeometry = Butterfly_CreateButterflyGeometry(name="WindowOutlets", geo=flatten(list_item_28), boundary=outlet, refineLevels="(1,1)")  # -> out, BFGeometries; plug-in component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
createbfgeometry_2 = Butterfly_CreateButterflyGeometry(name="WindowOutlets2", geo=flatten(list_item_30), boundary=outlet_2, refineLevels="(1,1)")  # -> out, BFGeometries; plug-in component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
inlet = Butterfly_InletBoundary(velocityVec=reverse, temperature=list_item_35)  # -> inletBoundary; plug-in component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
vector_display = VectorDisplay(Anchor=area_5.Centroid, Vector=reverse)
createbfgeometry_3 = Butterfly_CreateButterflyGeometry(name="WindowInlets", geo=flatten(list_item_20), boundary=inlet, refineLevels="(1,1)")  # -> out, BFGeometries; plug-in component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

concatenate_7 = Concatenate(FragmentA="WALL", FragmentB=integer_4)  # -> graft(Result)

createbfgeometry_4 = Butterfly_CreateButterflyGeometry(name=concatenate_7, geo=flatten_tree, boundary=wall, refineLevels="(1,1)")  # -> out, BFGeometries; plug-in component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

data_2 = Data(flatten([createbfgeometry_3.BFGeometries, createbfgeometry_4.BFGeometries, createbfgeometry.BFGeometries, createbfgeometry_2.BFGeometries]))
panel_13 = Panel(data_2)

# ---- group: Generate Case
# Generate Case
casefromgeos = Butterfly_CreateCaseFromGeometries(name="Atrium02", BFGeometries=flatten(data_2), expandBlockMesh=True, run=Toggle(True))  # -> out, blockPts, case; plug-in component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
bounding_box = BoundingBox(Content=casefromgeos.blockPts, Plane=PlaneXY(0, 0, 0))  # -> Box, Box_2
volume = Volume(Geometry=bounding_box.Box)  # -> Volume, Centroid

# ---- group: color by temperature
python_script = PythonScript(geos=data_2)  # -> mesh, temp; inputs geos: list
# ---------- python_script: Python ----------
mesh = (g.geometry for g in geos if g.boundaryCondition.type == 'wall')
temp = (float(g.boundaryCondition.T.value.split()[-1]) - 273.15 for g in geos if g.boundaryCondition.type == 'wall')
# ---------- end python_script ----------
bounds = Bounds(Numbers=python_script.temp)
deconstruct_domain = DeconstructDomain(Domain=bounds)  # -> Start, End
gradient = Gradient(
    LowerLimit=deconstruct_domain.End,
    UpperLimit=deconstruct_domain.Start,
    Parameter=python_script.temp,
    stops=[0: RGB(234, 38, 0), 0.25: RGB(234, 126, 0), 0.5: RGB(254, 244, 84), 0.75: RGB(173, 203, 249), 1: RGB(75, 107, 169)])
mesh_colours = MeshColours(Mesh=graft(python_script.mesh), Colours=graft(gradient))

# ----
python_script_2 = PythonScript(x=python_script.mesh)  # -> out, a; inputs x: Mesh
# ---------- python_script_2: Python ----------
import Rhino

a = Rhino.Geometry.Curve.JoinCurves(tuple(e.ToNurbsCurve() for e in x.GetNakedEdges()))
# ---------- end python_script_2 ----------
area_8 = Area(Geometry=python_script_2.a)  # -> Area, simplify(Centroid)
text_tag_3d_6 = TextTag3D(Location=area_8.Centroid, Text=graft(python_script.temp), Size=1, Justification=5)

blockmesh = Butterfly_blockMesh(case=casefromgeos.case, cellSizeXYZ=construct_point, overwrite=True, run=Toggle(True))  # -> out, case; plug-in component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

# ----
# 1. Solution exception:
#  --> snappyHexMesh Failed!
# --> FOAM FATAL IO ERROR:
# Cannot find patchField entry for boundingbox
# 
# file: /home/ofuser/workingDir/butterfly/Atrium/0/T.boundaryField from line 29 to line 58.
# 
#     From function void Foam::GeometricField<Type, PatchField, GeoMesh>::Boundary::readField(const Foam::DimensionedField<TypeR, GeoMesh>&, const Foam::dictionary&) [with Type = double; PatchField = Foam::fvPatchField; GeoMesh = Foam::volMesh]
#     in file /home/buzz2/pawan/OpenFOAM/OpenFOAM-v1612+/src/OpenFOAM/lnInclude/GeometricBoundaryField.C at line 191.
# 
# FOAM exiting
panel_14 = Panel(blockmesh.case)
# snappyHexMesh
snappyhexmesh = Butterfly_snappyHexMesh(case=blockmesh.case, snappyHexMeshDict=snappyhexmeshdict, run=Toggle(True))  # -> out, case; plug-in component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
panel_15 = Panel(snappyhexmesh.case)

# ----
# blockMesh
boolean_toggle_6 = BooleanToggle(True)
loadmesh = Butterfly_LoadMesh(case=blockmesh.case, innerMesh=False, load=boolean_toggle_6)  # -> mesh; plug-in component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
custom_preview = CustomPreview(Geometry=loadmesh, Shader=ColourSwatch(SwatchColor=RGB(0, 0, 0)))

ras = Butterfly_RASTurbulanceModel(RASModel="RNGkEpsilon", turbulence=True, printCoeffs=True)  # -> RAS; plug-in component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
solutionparams = Butterfly_SolutionParameters(controlDict=controldict, probes=probes)  # -> solutionParams; plug-in component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
# Run Simulation
heattransfer = Butterfly_HeatTransferRecipe(turbulenceProp=ras)  # -> out, recipe; plug-in component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
solution = Butterfly_Solution(
    case=casefromgeos.case,
    recipe=heattransfer.recipe,
    solutionParams=solutionparams,
    interval=2,
    write=Toggle(True),
    run=Toggle(True))  # -> out, solution, isRunning, timestep, residualFields, residualValues, logFiles; plug-in component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

list_item_36 = ListItem(List=solution.solution, Index=series_8, Wrap=True)
panel_16 = Panel(solution.residualFields)
loadprobesvalue = Butterfly_LoadProbesValue(solution=solution.solution, field="U")  # -> values; plug-in component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
samplecase = Butterfly_SampleCase(solution=solution.solution, name="temp_section", points=gentestpts.testPoints, field="T", run=Toggle(True))  # -> out, probes, values; plug-in component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
samplecase_2 = Butterfly_SampleCase(solution=solution.solution, name="vel_section", points=gentestpts.testPoints, field="U", run=Toggle(True))  # -> out, probes, values; plug-in component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
panel_17 = Panel(solution.solution)
bounds_2 = Bounds(Numbers=samplecase.values)
multiplication_3 = Multiplication(A=samplecase_2.values, B=Slider(0.4, range=0..1))
deconstruct_domain_2 = DeconstructDomain(Domain=bounds_2)  # -> Start, End
vector_display_ex = VectorDisplayEx(Point=samplecase_2.probes, Vector=multiplication_3, Colour=RGB(0, 0, 0), Width=2)
gradient_2 = Gradient(
    LowerLimit=deconstruct_domain_2.End,
    UpperLimit=deconstruct_domain_2.Start,
    Parameter=samplecase.values,
    stops=[0: RGB(234, 38, 0), 0.25: RGB(234, 126, 0), 0.5: RGB(254, 244, 84), 0.75: RGB(173, 203, 249), 1: RGB(75, 107, 169)])
custom_preview_2 = CustomPreview(Geometry=samplecase.probes, Shader=gradient_2)

point_5 = Point(Point(46, 0, 0))
legendpar_4 = Ladybug_LegendParameters(legendLocation=point_5)  # -> legendPar; plug-in component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

# ----
# Post-process results
loadprobesvalue_2 = Butterfly_LoadProbesValue(solution=solution.solution, field="T")  # -> values; plug-in component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

subtraction = Subtraction(A=loadprobesvalue_2, B="273.15")
recolormesh_3 = Ladybug_RecolorMesh(analysisResult=subtraction, inputMesh=gentestpts.mesh, legendPar=legendpar_4, legendTitle="Temp ℃")  # -> out, newMesh, newLegend, legendBasePt, meshColors, legendColors; plug-in component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

# ==== cluster Annual
analysisperiod = Ladybug_AnalysisPeriod()  # -> readMe, analysisPeriod; plug-in component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
analysisperiod_2 = ClusterOutput(analysisperiod.analysisPeriod)

# ==== cluster Cluster
merge = Merge(Data1=ColourSwatch(SwatchColor=RGB(255, 81, 0)), Data2=ColourSwatch(SwatchColor=RGB(250, 234, 57)))
R = ClusterOutput(merge)
