# Grasshopper definition daylight_final_project.gh (Grasshopper 0.9.76)
# plug-ins: Python Interpreter, Colibri

srf = Surface(graft([<surface referenced from the Rhino model> x7]))
srf_2 = Surface(graft(srf))
ladybug = Ladybug_Ladybug()  # -> Vviiiiiiiiiizzz; plug-in component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
honeybee = Honeybee_Honeybee()  # -> Vviiiiiiiiiizzz; plug-in component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
window_ratio = Slider(5, range=5..9)
wires = BrepWireframe(Brep=srf_2, Density=-1)
area = Area(Geometry=srf_2)  # -> Area, Centroid
srf_cp = SurfaceClosestPoint(Point=area.Centroid, Surface=srf_2)  # -> Point, UVPoint, Distance
join = JoinCurves(Curves=wires, Preserve=False)
division = Division(A=window_ratio, B=10)
evalsrf = EvaluateSurface(Surface=srf_2, Point=srf_cp.UVPoint)  # -> Point, Normal, Frame
scale = Scale(Geometry=join, Center=evalsrf.Frame, Factor=division)  # -> Geometry, Transform
srfsplit = SurfaceSplit(Surface=srf_2, Curves=scale.Geometry)
item = ListItem(List=srfsplit, Index=0, Wrap=True)  # -> Item, Item1
srf_3 = Surface(item.Item)
srf_4 = Surface(item.Item1)

# ---- group: opaque materials
brep = Brep([<brep referenced from the Rhino model> x5])
debrep = DeconstructBrep(Brep=[brep, srf_3])  # -> Faces, Edges, Vertices

# ---- group: glass surfaces
brep_2 = Brep([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])
debrep_2 = DeconstructBrep(Brep=[brep_2, srf_4])  # -> Faces, Edges, Vertices

# ---- group: floor
brep_3 = Brep([<brep referenced from the Rhino model> x34])
debrep_3 = DeconstructBrep(Brep=brep_3)  # -> Faces, Edges, Vertices

# ----
wires_2 = BrepWireframe(Brep=[brep_3, brep, brep_2, srf_3, srf_4], Density=-1)
createhbsrfs = Honeybee_createHBSrfs(geometry=debrep_3.Faces)  # -> readMe, simplify(HBSurface); plug-in component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
createhbsrfs_2 = Honeybee_createHBSrfs(geometry=debrep.Faces, srfType="0")  # -> readMe, simplify(HBSurface); plug-in component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
createhbsrfs_3 = Honeybee_createHBSrfs(geometry=debrep_2.Faces, srfType="5")  # -> readMe, simplify(HBSurface); plug-in component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
brep_4 = Brep([<brep referenced from the Rhino model> x15])
month = Slider(0, range=0..2)
panel = Panel("""6
9
12""")
item_2 = ListItem(List=panel, Index=month, Wrap=True)

# ---- group: Date and Time of Year
panel_2 = Panel("https://www.energyplus.net/weather-download/north_and_central_america_wmo_region_4/USA/PA/USA_PA_Philadelphia.Intl.AP.724080_TMY3/all")
epw_stat = Ladybug_OpenEPWAndSTATWeatherFiles(weatherFileURL=panel_2)  # -> epwFile, statFile; plug-in component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
hour = Slider(9, range=9..17)
genclimatebasedsky = Honeybee_GenerateClimateBasedSky(weatherFile=epw_stat.epwFile, month=item_2, day="21", hour=hour)  # -> radiationValues, skyFilePath; plug-in component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

# ----
gentestpts = Honeybee_GenerateTestPoints(testGeometry=flatten(brep_4), gridSize="1", distBaseSrf="0.762", moveTestMesh=True)  # -> readMe, simplify(testPoints), simplify(ptsVectors), simplify(facesArea), simplify(mesh); plug-in component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
pt = Point(gentestpts.testPoints)
mjoin = MeshJoin(Meshes=flatten(gentestpts.mesh))
clean = CleanTree(
    RemoveNulls=True,
    RemoveInvalid=True,
    RemoveEmpty=False,
    Tree=flatten([createhbsrfs_3.HBSurface, createhbsrfs_2.HBSurface, createhbsrfs.HBSurface]))
daylighfactorsimulation = Honeybee_DaylightFactorSimulation(testPoints=gentestpts.testPoints, ptsVectors=gentestpts.ptsVectors, testMesh=gentestpts.mesh, uniformSky=False)  # -> analysisRecipe; plug-in component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
gridbasedsimulation = Honeybee_GridBasedSimulation(
    skyFile=genclimatebasedsky.skyFilePath,
    testPoints=gentestpts.testPoints,
    ptsVectors=gentestpts.ptsVectors,
    simulationType=0)  # -> analysisRecipe; plug-in component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
toggle = BooleanToggle(True)
rundaylightanalysis = Honeybee_RunDaylightSimulation(HBObjects=flatten(clean), analysisRecipe=gridbasedsimulation, writeRad=toggle, runRad=toggle, overwriteResults=True)  # -> readMe, analysisType, resultsUnit, illuminance_values, testPts, illuminance_files, radGeoFile, studyFolder, done; plug-in component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
pt_2 = Point(Point(-156.8195125, 10.81604689, 0))
legendpar = Ladybug_LegendParameters(lowBound="100", highBound="2000", legendLocation=pt_2)  # -> legendPar; plug-in component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
flatten = FlattenTree(Tree=rundaylightanalysis.illuminance_values, Path="{0}")
recolormesh = Ladybug_RecolorMesh(
    analysisResult=flatten,
    inputMesh=mjoin,
    lowBoundColor=ColourSwatch(SwatchColor=RGBA(61, 53, 55, 133)),
    highBoundColor=ColourSwatch(SwatchColor=RGB(194, 39, 93)),
    legendPar=legendpar,
    analysisTitle=" ",
    legendTitle=rundaylightanalysis.resultsUnit)  # -> readMe, newMesh, newLegend, legendBasePt, meshColors, legendColors; plug-in component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

# ---- group: Comfortable Ratio
dom = ConstructDomain(DomainStart="200", DomainEnd="2000")
mesh = Mesh(gentestpts.mesh)
inc = Includes(Value=rundaylightanalysis.illuminance_values, Domain=dom)  # -> Includes, Deviation
demesh = DeconstructMesh(Mesh=mesh)  # -> Vertices, Faces, Colours, Normals
area_2 = Area(Geometry=mesh)  # -> Area, Centroid
dispatch = Dispatch(List=demesh.Faces, DispatchPattern=inc.Includes)  # -> ListA, ListB
ma = MassAddition(Input=flatten(area_2.Area))  # -> Result, PartialResults
conmesh = ConstructMesh(Vertices=demesh.Vertices, Faces=dispatch.ListA, Colours=demesh.Colours)
area_3 = Area(Geometry=conmesh)  # -> Area, Centroid
ma_2 = MassAddition(Input=flatten(area_3.Area))  # -> Result, PartialResults
comfortable_area = Panel(ma_2.Result)
total_reading_area = Panel(ma.Result)
division_2 = Division(A=comfortable_area, B=total_reading_area)

# ----
multiplication = Multiplication(A=division_2, B=100)

# ---- group: Comfortable Ratio (continued)
comfortable_ratio = Panel(multiplication)

# ----
num = Number(flatten(comfortable_ratio))
avr = Average(Input=num)
iterator = ColibriFlyIDIterator(Window_Ratio=window_ratio, Month=month, hour=hour)  # -> Window_Ratio, Month, hour, FlyID
flyresults = ColibriFlyResults(Names=flatten("Comfortable Area Ratio%"), Values=flatten(avr))
panel_3 = Panel("G:\632 Performance design GH\final project\Final_data_collection")
aggregator = ColibriAggregator(Folder=panel_3, FlyIDInputs=iterator.FlyID, FlyResultsOutputs=flyresults, Write=Toggle(False))

panel_4 = Panel("""Reading Space Illuminance Analysis
Comfortable Area Ratio%""")
L = Location(PlaneXY(-209.5670218, -10.6793455, 0))
L_2 = Location(PlaneXY(-172.5176914, -14.361187, 0))
tag = TextTag3D(Location=L, Text=panel_4, Size="2.0", Colour=RGB(0, 0, 0), Justification=7)
tag_2 = TextTag3D(Location=L_2, Text=comfortable_ratio, Size="1.5", Colour=RGB(13, 12, 12), Justification=7)
