# Grasshopper definition final.gh (Grasshopper 0.9.76)
# plug-ins: Python Interpreter, Octopus, Colibri

geo = Geometry(<brep referenced from the Rhino model>)
ladybug = Ladybug_Ladybug()  # -> Vviiiiiiiiiizzz; plug-in component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
path = FilePath("D:\ladybug")
number_slider = Slider(2, range=0..10)
number_slider_2 = Slider(5, range=0..10)
honeybee = Honeybee_Honeybee(defaultFolder=path)  # -> Vviiiiiiiiiizzz; plug-in component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
geo_2 = Geometry(<curve referenced from the Rhino model>)
series = Series(Start=Slider(0, range=0..100), Step=Slider(2, range=0..10), Count=number_slider)
series_2 = Series(Start=Slider(0, range=0..100), Step=Slider(2, range=0..10), Count=number_slider_2)
panel = Panel("https://www.energyplus.net/weather-download/north_and_central_america_wmo_region_4/USA/PA/USA_PA_Philadelphia.Intl.AP.724080_TMY3/all")
Z = UnitZ(Factor=series)
X = UnitX(Factor=series_2)
panel_2 = Panel(series)
move = Move(Geometry=geo_2, Motion=Z)  # -> Geometry, Transform
move_2 = Move(Geometry=graft(move.Geometry), Motion=X)  # -> Geometry, Transform

# ----
# right
number_slider_3 = Slider(5, range=0..10)
division = Division(A=number_slider_2, B=number_slider_3)
series_3 = Series(Start=Slider(0, range=0..100), Step=Slider(2, range=0..10), Count=number_slider)
series_4 = Series(Start=Slider(0, range=0..100), Step=Slider(5, range=0..10), Count=division)
addition = Addition(A=series_4, B=graft(series_3))
item = ListItem(List=move_2.Geometry, Index=addition, Wrap=True)

# ----
# UP
number_slider_4 = Slider(5, range=0..10)
division_2 = Division(A=number_slider_2, B=number_slider_4)
series_5 = Series(Start=Slider(0, range=0..100), Step=Slider(2, range=0..10), Count=number_slider)
series_6 = Series(Start=Slider(1, range=0..100), Step=Slider(5, range=0..10), Count=division_2)
addition_2 = Addition(A=series_6, B=graft(series_5))
item_2 = ListItem(List=move_2.Geometry, Index=addition_2, Wrap=True)

# ----
# middle
number_slider_5 = Slider(5, range=0..10)
division_3 = Division(A=number_slider_2, B=number_slider_5)
series_7 = Series(Start=Slider(0, range=0..100), Step=Slider(2, range=0..10), Count=number_slider)
series_8 = Series(Start=Slider(4, range=0..100), Step=Slider(5, range=0..10), Count=division_3)
addition_3 = Addition(A=series_8, B=graft(series_7))
item_3 = ListItem(List=move_2.Geometry, Index=addition_3, Wrap=True)

# ----
# DOWN
number_slider_6 = Slider(5, range=0..10)
division_4 = Division(A=number_slider_2, B=number_slider_6)
series_9 = Series(Start=Slider(0, range=0..100), Step=Slider(2, range=0..10), Count=number_slider)
series_10 = Series(Start=Slider(2, range=0..100), Step=Slider(5, range=0..10), Count=division_4)
addition_4 = Addition(A=series_10, B=graft(series_9))
item_4 = ListItem(List=move_2.Geometry, Index=addition_4, Wrap=True)

# ----
# left
number_slider_7 = Slider(5, range=0..10)
division_5 = Division(A=number_slider_2, B=number_slider_7)
series_11 = Series(Start=Slider(0, range=0..100), Step=Slider(2, range=0..10), Count=number_slider)
series_12 = Series(Start=Slider(3, range=0..100), Step=Slider(5, range=0..10), Count=division_5)
addition_5 = Addition(A=series_12, B=graft(series_11))
item_5 = ListItem(List=move_2.Geometry, Index=addition_5, Wrap=True)

epw_stat = Ladybug_OpenEPWAndSTATWeatherFiles(weatherFileURL=panel)  # -> epwFile, statFile; plug-in component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
addition_6 = Addition(A=series_4, B=series_3)
brep = Brep(<brep referenced from the Rhino model>)
panel_3 = Panel(series_3)
panel_4 = Panel(move_2.Geometry)
flip = Flip(Surface=brep)  # -> Surface, Result
gencumulativeskymtx = Ladybug_GenCumulativeSkyMtx(epwFile=epw_stat.epwFile, skyDensity=0, useOldRes=True, runIt=Toggle(True))  # -> readMe, cumulativeSkyMtx; plug-in component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
down1 = Slider(0, range=0..1)
down2 = Slider(0, range=0..1)
left1 = Slider(0, range=0..1)
left2 = Slider(0, range=0..1)
up2 = Slider(0, range=0..1)
genes = GenePool(Decimals=2, Maximum=100, Minimum=0, Value=[50, 50, 34, 50, 50, 50, 50, 50, 50, 50])
right2 = Slider(0, range=0..1)
up1 = Slider(0, range=0..1)
right1 = Slider(0, range=0..1)
panel_5 = Panel(item)
gentestpts = Honeybee_GenerateTestPoints(testGeometry=flip.Surface, gridSize="0.5", distBaseSrf="0", moveTestMesh=True)  # -> readMe, simplify(testPoints), simplify(ptsVectors), simplify(facesArea), simplify(mesh); plug-in component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

# ----
# wall
# balcony
flatten = FlattenTree(Tree=item, Path="{0}")
equals = Equality(FirstNumber=[right1, right2], SecondNumber=Slider(0, range=0..100))  # -> Equality, Inequality
cull = CullPattern(List=flatten, CullPattern=equals.Equality)
cull_2 = CullPattern(List=flatten, CullPattern=equals.Inequality)
area = Area(Geometry=cull)  # -> Area, Centroid
area_2 = Area(Geometry=cull_2)  # -> Area, Centroid
geo_3 = Geometry(graft(<brep referenced from the Rhino model>))
geo_4 = Geometry(graft([<brep referenced from the Rhino model> x2]))
geo_5 = Geometry(graft([<brep referenced from the Rhino model> x2]))
pt = Point(<point referenced from the Rhino model>)
pt_2 = Point(<point referenced from the Rhino model>)
geo_6 = Geometry(graft(<brep referenced from the Rhino model>))
orient = Orient(Geometry=geo_5, Source=pt, Target=area.Centroid)  # -> Geometry, Transform
orient_2 = Orient(Geometry=geo_3, Source=pt, Target=area.Centroid)  # -> Geometry, Transform
# WINDOW
orient_3 = Orient(Geometry=geo_4, Source=pt_2, Target=area_2.Centroid)  # -> Geometry, Transform
orient_4 = Orient(Geometry=geo_6, Source=pt_2, Target=area_2.Centroid)  # -> Geometry, Transform

panel_6 = Panel(flatten)
number_slider_8 = Slider(100, range=0..100)
number_slider_9 = Slider(100, range=0..100)
number_slider_10 = Slider(100, range=0..100)
sel = IterationSelection()
selectskymtx = Ladybug_selectSkyMtx(cumulativeSkyMtx=gencumulativeskymtx.cumulativeSkyMtx, removeDiffuse=False, removeDirect=False)  # -> readMe, selectedSkyMtx; plug-in component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
daylighfactorsimulation = Honeybee_DaylightFactorSimulation(testPoints=gentestpts.testPoints, ptsVectors=gentestpts.ptsVectors, uniformSky=False)  # -> analysisRecipe; plug-in component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
geo_7 = Geometry(graft(<brep referenced from the Rhino model>))

# ----
# wall
flatten_2 = FlattenTree(Tree=item_3, Path="{0}")
area_3 = Area(Geometry=flatten_2)  # -> Area, Centroid
pt_3 = Point(<point referenced from the Rhino model>)
orient_5 = Orient(Geometry=geo_7, Source=pt_3, Target=area_3.Centroid)  # -> Geometry, Transform

iterator = ColibriFlyIDIterator(right1=right1, right2=right2, up1=up1, up2=up2, down1=down1, down2=down2, left1=left1, left2=left2)  # -> right1, right2, up1, up2, down1, down2, left1, left2, Value_N, FlyID
# Right click for "Fly test"
panel_7 = Panel(iterator.FlyID)
geo_8 = Geometry(graft(<brep referenced from the Rhino model>))

# ----
# wall
# wall
flatten_3 = FlattenTree(Tree=item_4, Path="{0}")
equals_2 = Equality(FirstNumber=[down1, down2], SecondNumber=Slider(0, range=0..100))  # -> Equality, Inequality
cull_3 = CullPattern(List=flatten_3, CullPattern=equals_2.Equality)
cull_4 = CullPattern(List=flatten_3, CullPattern=equals_2.Inequality)
area_4 = Area(Geometry=cull_3)  # -> Area, Centroid
area_5 = Area(Geometry=cull_4)  # -> Area, Centroid
geo_9 = Geometry(graft([<brep referenced from the Rhino model> x2]))
geo_10 = Geometry(graft([<brep referenced from the Rhino model> x2]))
pt_4 = Point(<point referenced from the Rhino model>)
pt_5 = Point(<point referenced from the Rhino model>)
geo_11 = Geometry(graft(<brep referenced from the Rhino model>))
orient_6 = Orient(Geometry=geo_10, Source=pt_4, Target=area_4.Centroid)  # -> Geometry, Transform
orient_7 = Orient(Geometry=geo_8, Source=pt_4, Target=area_4.Centroid)  # -> Geometry, Transform
orient_8 = Orient(Geometry=geo_9, Source=pt_5, Target=area_5.Centroid)  # -> Geometry, Transform
orient_9 = Orient(Geometry=geo_11, Source=pt_5, Target=area_5.Centroid)  # -> Geometry, Transform

geo_12 = Geometry(graft(<brep referenced from the Rhino model>))

# ----
# wall
# wall
flatten_4 = FlattenTree(Tree=item_2, Path="{0}")
equals_3 = Equality(FirstNumber=[up1, up2], SecondNumber=Slider(0, range=0..100))  # -> Equality, Inequality
cull_5 = CullPattern(List=flatten_4, CullPattern=equals_3.Equality)
cull_6 = CullPattern(List=flatten_4, CullPattern=equals_3.Inequality)
area_6 = Area(Geometry=cull_5)  # -> Area, Centroid
area_7 = Area(Geometry=cull_6)  # -> Area, Centroid
geo_13 = Geometry(graft([<brep referenced from the Rhino model> x2]))
geo_14 = Geometry(graft([<brep referenced from the Rhino model> x2]))
pt_6 = Point(<point referenced from the Rhino model>)
pt_7 = Point(<point referenced from the Rhino model>)
geo_15 = Geometry(graft(<brep referenced from the Rhino model>))
orient_10 = Orient(Geometry=geo_14, Source=pt_6, Target=area_6.Centroid)  # -> Geometry, Transform
orient_11 = Orient(Geometry=geo_12, Source=pt_6, Target=area_6.Centroid)  # -> Geometry, Transform
orient_12 = Orient(Geometry=geo_13, Source=pt_7, Target=area_7.Centroid)  # -> Geometry, Transform
orient_13 = Orient(Geometry=geo_15, Source=pt_7, Target=area_7.Centroid)  # -> Geometry, Transform

geo_16 = Geometry(graft(<brep referenced from the Rhino model>))

# ----
# wall
# balcony
flatten_5 = FlattenTree(Tree=item_5, Path="{0}")
equals_4 = Equality(FirstNumber=[left1, left2], SecondNumber=Slider(0, range=0..100))  # -> Equality, Inequality
cull_7 = CullPattern(List=flatten_5, CullPattern=equals_4.Equality)
cull_8 = CullPattern(List=flatten_5, CullPattern=equals_4.Inequality)
area_8 = Area(Geometry=cull_7)  # -> Area, Centroid
area_9 = Area(Geometry=cull_8)  # -> Area, Centroid
geo_17 = Geometry(graft([<brep referenced from the Rhino model> x2]))
geo_18 = Geometry(graft([<brep referenced from the Rhino model> x2]))
pt_8 = Point(<point referenced from the Rhino model>)
pt_9 = Point(<point referenced from the Rhino model>)
geo_19 = Geometry(graft(<brep referenced from the Rhino model>))
orient_14 = Orient(Geometry=geo_18, Source=pt_8, Target=area_8.Centroid)  # -> Geometry, Transform
orient_15 = Orient(Geometry=geo_16, Source=pt_8, Target=area_8.Centroid)  # -> Geometry, Transform
orient_16 = Orient(Geometry=geo_17, Source=pt_9, Target=area_9.Centroid)  # -> Geometry, Transform
orient_17 = Orient(Geometry=geo_19, Source=pt_9, Target=area_9.Centroid)  # -> Geometry, Transform

# ----
# WINDOW
panel_8 = Panel(area_2.Centroid)
toggle = BooleanToggle(True)
geo_20 = Geometry(flatten([orient_4.Geometry, orient_17.Geometry]))
geo_21 = Geometry(flatten([orient_2.Geometry, orient_3.Geometry, orient_11.Geometry, orient_12.Geometry, orient_7.Geometry, orient_8.Geometry, orient_15.Geometry, orient_16.Geometry, orient_5.Geometry]))
geo_22 = Geometry(flatten([orient.Geometry, orient_4.Geometry, orient_10.Geometry, orient_13.Geometry, orient_6.Geometry, orient_9.Geometry, orient_14.Geometry, orient_17.Geometry]))
flatten_6 = FlattenTree(Tree=[orient_4.Geometry, orient_17.Geometry], Path="{0}")
lng = ListLength(List=geo_20)
lng_2 = ListLength(List=flatten_6)
brep_2 = Brep(flatten(<brep referenced from the Rhino model>))
panel_9 = Panel(lng_2)
createhbsrfs = Honeybee_createHBSrfs(geometry=geo_21, srfType="5")  # -> readMe, simplify(HBSurface); plug-in component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
createhbsrfs_2 = Honeybee_createHBSrfs(geometry=brep_2, srfType="0")  # -> readMe, simplify(HBSurface); plug-in component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
createhbsrfs_3 = Honeybee_createHBSrfs(geometry=geo_22, srfType="0")  # -> readMe, simplify(HBSurface); plug-in component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
brep_3 = Brep(flatten([createhbsrfs_2.HBSurface, createhbsrfs_3.HBSurface, createhbsrfs.HBSurface]))
rundaylightanalysis = Honeybee_RunDaylightSimulation(
    HBObjects=flatten(brep_3),
    analysisRecipe=daylighfactorsimulation,
    writeRad=toggle,
    runRad=toggle,
    numOfCPUs=Slider(3, range=0..10),
    overwriteResults=True)  # -> readMe, analysisType, resultsUnit, DF_values, testPts, DF_files, radGeoFile, studyFolder, done; plug-in component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
larger = LargerThan(FirstNumber=rundaylightanalysis.DF_values, SecondNumber=Slider(2, range=0..10))  # -> LargerThan, OrEqualTo
cull_9 = CullPattern(List=rundaylightanalysis.DF_values, CullPattern=larger.OrEqualTo)
geo_23 = Geometry(<brep referenced from the Rhino model>)
# Calculate the area with more than 5%
# daylight factor and add it to the description.
panel_10 = Panel(rundaylightanalysis.DF_values)
preview = CustomPreview(Geometry=createhbsrfs.HBSurface, Shader=ColourSwatch(SwatchColor=RGBA(0, 255, 220, 138)))
smaller = SmallerThan(FirstNumber=cull_9, SecondNumber=Slider(20, range=0..100))  # -> SmallerThan, OrEqualTo
lng_3 = ListLength(List=flatten(rundaylightanalysis.DF_values))
cull_10 = CullPattern(List=cull_9, CullPattern=smaller.OrEqualTo)
lng_4 = ListLength(List=flatten(cull_10))
preview_2 = CustomPreview(Geometry=createhbsrfs_3.HBSurface, Shader=ColourSwatch(SwatchColor=RGBA(255, 15, 255, 138)))
division_6 = Division(A=lng_4, B=lng_3)
panel_11 = Panel(division_6)
merge = Merge(Data1=panel_11, Data2=lng)

# ----
# Results
panel_12 = Panel("""Ratio
Balcony Count""")
flyresults = ColibriOutputs(Names=flatten(panel_12), Values=flatten(merge))

panel_13 = Panel(flyresults)

# ----
# Aggregator
panel_14 = Panel("D:\17SPRING\Computer design\FINAL\Final submission")
# Toggle will be auto-off when:
#        1.Iterator fly finished
#        2.This grasshopper file re-open
toggle_2 = BooleanToggle(False)
aggregator = ColibriAggregator(Folder=panel_14, FlyIDInputs=iterator.FlyID, FlyResultsOutputs=flyresults, Write=toggle_2)

number_slider_11 = Slider(0.01, range=0..0.01)
panel_15 = Panel("1")
merge_2 = Merge(Data2=geo_23, Data3=geo_22)
legendpar = Ladybug_LegendParameters(lowBound="2", highBound="20")  # -> legendPar; plug-in component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
panel_16 = Panel(rundaylightanalysis.resultsUnit)
toggle_3 = BooleanToggle(False)
brep_4 = Brep([<brep referenced from the Rhino model> x5])
recolormesh = Ladybug_RecolorMesh(
    analysisResult=rundaylightanalysis.DF_values,
    inputMesh=gentestpts.mesh,
    lowBoundColor=ColourSwatch(SwatchColor=RGBA(92, 82, 84, 133)),
    highBoundColor=ColourSwatch(SwatchColor=RGB(255, 3, 218)),
    legendPar=legendpar,
    analysisTitle=rundaylightanalysis.analysisType,
    legendTitle=panel_16)  # -> readMe, newMesh, newLegend, legendBasePt, meshColors, legendColors; plug-in component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
galapagos = Galapagos(fitness=num, gene=left1)
octopus = Octopus()
num = Number()
