# Grasshopper definition Yoon, Ji_Final.gh (Grasshopper 0.9.76)
# plug-ins: Python Interpreter

brep = Brep(graft([<brep referenced from the Rhino model> x13]))
debrep = DeconstructBrep(Brep=brep)  # -> Faces, graft(Edges), Vertices
wires = BrepWireframe(Brep=debrep.Faces, Density=-1)
panel = Panel(debrep.Edges)
rev = ReverseList()
viewer = ParamViewer(debrep.Edges)
item = ListItem(List=debrep.Vertices, Index=Slider(2, range=0..10), Wrap=True)
item_2 = ListItem(List=debrep.Vertices, Index=Slider(3, range=0..10), Wrap=True)
item_3 = ListItem(List=debrep.Vertices, Index=Slider(1, range=0..1), Wrap=True)
item_4 = ListItem(List=debrep.Vertices, Index=0, Wrap=True)
rec_2pt = Rectangle2Pt(Plane=brep, PointA=item_4, PointB=item, Radius=0)  # -> Rectangle, Length
area = Area(Geometry=brep)  # -> Area, Centroid
scale = Scale(Geometry=rec_2pt.Rectangle, Center=area.Centroid, Factor=Slider(0.7, range=-0.1..0.9))  # -> Geometry, Transform
srfsplit = SurfaceSplit(Surface=brep, Curves=scale.Geometry)
brep_2 = Brep(srfsplit)
boundary = BoundarySurfaces(Edges=scale.Geometry)
panel_2 = Panel(srfsplit)
item_5 = ListItem(List=brep_2, Index=0, Wrap=True)
ladybug = Ladybug_Ladybug()  # -> Vviiiiiiiiiizzz; plug-in component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
honeybee = Honeybee_Honeybee()  # -> Vviiiiiiiiiizzz; plug-in component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

# ---- group: additional glazing
brep_3 = Brep([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])

# ---- group: glazing
brep_4 = Brep([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])

# ---- group: roof
brep_5 = Brep(<brep referenced from the Rhino model>)

# ---- group: floor
brep_6 = Brep(<brep referenced from the Rhino model>)

# ---- group: walls
brep_7 = Brep([<brep referenced from the Rhino model> x86])

# ----
createhbsrfs = Honeybee_createHBSrfs(geometry=brep_3, srfType="0")  # -> readMe, simplify(HBSurface); plug-in component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
number_slider = Slider(0.78, range=0..1)
createhbsrfs_2 = Honeybee_createHBSrfs(geometry=brep_7, srfType="0")  # -> readMe, simplify(HBSurface); plug-in component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
createhbsrfs_3 = Honeybee_createHBSrfs(geometry=brep_6, srfType="2")  # -> readMe, simplify(HBSurface); plug-in component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
createhbsrfs_4 = Honeybee_createHBSrfs(geometry=brep_5, srfType="3")  # -> readMe, simplify(HBSurface); plug-in component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
createhbsrfs_5 = Honeybee_createHBSrfs(geometry=brep_4, srfType="5")  # -> readMe, simplify(HBSurface); plug-in component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
glazingcreator = Honeybee_GlazingBasedOnRatio(
    HBObjects=createhbsrfs.HBSurface,
    glzRatio=Slider(0.5, range=0..1),
    sillHeight=Slider(4, range=0..10),
    runIt=Toggle(True))  # -> readMe, HBObjWGLZ; plug-in component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
flip = Flip(Surface=brep_6)  # -> Surface, Result
brep_8 = Brep(flatten([createhbsrfs_3.HBSurface, createhbsrfs_4.HBSurface, createhbsrfs_5.HBSurface, createhbsrfs_2.HBSurface, glazingcreator.HBObjWGLZ]))
wires_2 = BrepWireframe(Brep=brep_8, Density=-1)
gentestpts = Honeybee_GenerateTestPoints(testGeometry=flip.Surface, gridSize="3", distBaseSrf="0.762", moveTestMesh=True)  # -> readMe, simplify(testPoints), simplify(ptsVectors), simplify(facesArea), simplify(mesh); plug-in component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
daylighfactorsimulation = Honeybee_DaylightFactorSimulation(testPoints=gentestpts.testPoints, ptsVectors=gentestpts.ptsVectors, uniformSky=False)  # -> analysisRecipe; plug-in component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
rundaylightanalysis = Honeybee_RunDaylightSimulation(
    HBObjects=flatten(brep_8),
    analysisRecipe=daylighfactorsimulation,
    writeRad=Toggle(False),
    runRad=Toggle(True),
    numOfCPUs="7",
    overwriteResults=True)  # -> readMe, analysisType, resultsUnit, results, testPts, resultFiles, radGeoFile, studyFolder, done; plug-in component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
legendpar = Ladybug_LegendParameters(lowBound="2", highBound="20")  # -> legendPar; plug-in component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
ma = MassAddition(Input=rundaylightanalysis.results)  # -> Result, PartialResults
smaller = SmallerThan(FirstNumber=rundaylightanalysis.results, SecondNumber="2")  # -> SmallerThan, OrEqualTo
larger = LargerThan(FirstNumber=rundaylightanalysis.results, SecondNumber="20")  # -> LargerThan, OrEqualTo
smaller_2 = SmallerThan(FirstNumber=rundaylightanalysis.results, SecondNumber="20")  # -> SmallerThan, OrEqualTo
larger_2 = LargerThan(FirstNumber=rundaylightanalysis.results, SecondNumber="2")  # -> LargerThan, OrEqualTo
or = GateOr(A=larger.OrEqualTo, B=smaller.OrEqualTo)
recolormesh = Ladybug_RecolorMesh(
    analysisResult=rundaylightanalysis.results,
    inputMesh=gentestpts.mesh,
    legendPar=legendpar,
    analysisTitle=rundaylightanalysis.analysisType,
    legendTitle=rundaylightanalysis.resultsUnit)  # -> readMe, newMesh, newLegend, legendBasePt, meshColors, legendColors; plug-in component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
cullf = CullFaces(Mesh=gentestpts.mesh, Pattern=larger_2.LargerThan)
cullf_2 = CullFaces(Mesh=gentestpts.mesh, Pattern=or)
cullf_3 = CullFaces(Mesh=gentestpts.mesh, Pattern=smaller_2.SmallerThan)
mcol = MeshColours(Mesh=cullf_2, Colours=ColourSwatch(SwatchColor=RGB(255, 255, 255)))
mcol_2 = MeshColours(Mesh=cullf, Colours=ColourSwatch(SwatchColor=RGB(197, 197, 199)))
mcol_3 = MeshColours(Mesh=cullf_3, Colours=ColourSwatch(SwatchColor=RGB(247, 64, 174)))
area_2 = Area(Geometry=mcol_2)  # -> Area, Centroid

# ---- group: maximize this
area_3 = Area(Geometry=mcol)  # -> Area, Centroid

# ----
area_4 = Area(Geometry=mcol_3)  # -> Area, Centroid
ma_2 = MassAddition(Input=flatten([area_3.Area, area_4.Area, area_2.Area]))  # -> Result, PartialResults
division = Division(A=area_3.Area, B=ma_2.Result)
panel_3 = Panel(division)
