# Grasshopper definition Albakr_Majed_Final Project(GHFile).gh (Grasshopper 0.9.76)
# plug-ins: Python Interpreter, ItemSelector

panel = Panel("""Honeybee
Energy
Daylighting
EnergyPlus
Daysim
Radiance
HBExampleFiles""")
panel_2 = Panel("This is an example that shows how to integrate results of daylighting simulation with an energy simulation")
exporthydra = Hydra_ExportFile(
    fileName="Integrated_Daylight_and_Energy_similation",
    fileDescription=panel_2,
    fileTags=panel,
    targetFolder="C:\Users\Administrator\Documents\GitHub\hydra_1",
    export=Toggle(False))  # -> readMe; inputs fileDescription: list, changeLog: list, fileTags: list, includeRhino: Boolean, GHForThumb: Boolean, additionalImgs: list, export: Boolean; plug-in component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

epglassmat = Honeybee_EnergyPlusGlassMaterial()  # -> EPMaterial; plug-in component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

epwindowmat = Honeybee_EnergyPlusWindowMaterial(name="MAJED_GLASS_BOOM", U_Value=Slider(0.5, range=0..1), SHGC=Slider(0.3, range=0..1))  # -> EPMaterial; plug-in component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
epconstruction = Honeybee_EnergyPlusConstruction(name="MAJED_CONST_BOOM", layer_1=epwindowmat, layer_3=epwindowmat)  # -> EPConstruction; plug-in component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

toggle = BooleanToggle(True)
radopaquematerial = Honeybee_RadianceOpaqueMaterial(roughness=0.05, specularity=0)  # -> avrgRef, RADMaterial; plug-in component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
epnomassmat = Honeybee_EnergyPlusNoMassOpaqueMaterial(name="insulation", R_Value=Slider(2.5, range=0..10))  # -> EPMaterial; plug-in component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
updatehoneybee = Honeybee_UpdateHoneybee(updateThisFile=toggle, updateAllUObjects=toggle)  # -> readMe; plug-in component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
updateladybug = Ladybug_UpdateLadybug(updateThisFile=toggle, updateAllUObjects=toggle)  # -> readMe; plug-in component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
ladybug = Ladybug_Ladybug()  # -> Vviiiiiiiiiizzz; plug-in component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
honeybee = Honeybee_Honeybee()  # -> Vviiiiiiiiiizzz; plug-in component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
epconstruction_2 = Honeybee_EnergyPlusConstruction(name="wallinsulation", layer_1=epnomassmat)  # -> EPConstruction; disabled; plug-in component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

number_slider = Slider(0.5, range=0..1)
radglassmaterial = Honeybee_RadianceGlassMaterial(
    materialName="windoow",
    RTransmittance=number_slider,
    GTransmittance=number_slider,
    BTransmittance=number_slider,
    refractiveIndex=1.52)  # -> avrgTrans, RADMaterial; plug-in component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

exterior_wall = Brep(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)

# ---- group: ceiling
ceiling = Brep([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])

# ----
walls = Brep([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])
ledge = Brep(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)

# ---- group: floor
floor = Brep(<brep referenced from the Rhino model>)

# ----
wall_surface_with_opening = Brep(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)

# ---- group: walls
furniture = Brep([<brep referenced from the Rhino model> x12])

# ----
legendpar = Ladybug_LegendParameters(lowBound="-15", highBound=Slider(40, range=0..100), numSegments=Slider(11, range=0..100))  # -> legendPar; plug-in component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
updatehoneybee_2 = Honeybee_UpdateHoneybee()  # -> readMe; plug-in component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

brep = Brep([<brep referenced from the Rhino model> x10])
createhbsrfs = Honeybee_createHBSrfs(geometry=brep, srfType="6")  # -> readMe, simplify(HBSurface); plug-in component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

brep_2 = Brep(<brep referenced from the Rhino model>)
# Geometry Preparation
panel_3 = Panel("0")
list = Honeybee_ItemSelector(
    brep,
    {"Referenced Brep", "Referenced Brep", "Referenced Brep", "Referenced Brep", "Referenced Brep", "Referenced Brep", "Referenced Brep", "Referenced Brep", "Referenced Brep", "Referenced Brep"}, selected="Referenced Brep")
createhbsrfs_2 = Honeybee_createHBSrfs(geometry=ledge, srfType="2", EPConstruction=epconstruction_2)  # -> readMe, simplify(HBSurface); plug-in component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
createhbsrfs_3 = Honeybee_createHBSrfs(geometry=exterior_wall, srfType="0")  # -> readMe, simplify(HBSurface); plug-in component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
createhbsrfs_4 = Honeybee_createHBSrfs(geometry=wall_surface_with_opening, srfType="0")  # -> readMe, simplify(HBSurface); plug-in component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
analysisperiod = Ladybug_AnalysisPeriod(
    fromMonth=Slider(5, range=0..10),
    fromHour=Slider(12, range=0..100),
    toMonth=Slider(8, range=0..10),
    toHour=Slider(18, range=0..100))  # -> readMe, analysisPeriod; plug-in component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

createhbsrfs_5 = Honeybee_createHBSrfs(geometry=ceiling, srfType="3", EPConstruction=epconstruction_2)  # -> readMe, simplify(HBSurface); plug-in component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
createhbsrfs_6 = Honeybee_createHBSrfs(geometry=floor, srfType="2", EPConstruction=epconstruction_2)  # -> readMe, simplify(HBSurface); plug-in component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
createhbsrfs_7 = Honeybee_createHBSrfs(geometry=walls, srfType=panel_3, EPConstruction=epconstruction_2)  # -> readMe, simplify(HBSurface); plug-in component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

brep_3 = Brep([<brep referenced from the Rhino model> x4])  # disabled
glass = Brep(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)
createhbsrfs_8 = Honeybee_createHBSrfs(geometry=furniture)  # -> readMe, simplify(HBSurface); plug-in component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
preview = CustomPreview(Geometry=glass, Shader=ColourSwatch(SwatchColor=RGBA(80, 222, 255, 160)))
# Honeybee default materials will be assigned
# based on surface type
bldgprograms = Honeybee_bldgPrograms({"Office": 0, "Retail": 1, "MidriseApartment": 2, "PrimarySchool": 3, "SecondarySchool": 4, "SmallHotel": 5, "LargeHotel": 6, "Hospital": 7, "Outpatient": 8, "Warehouse": 9, "SuperMarket": 10, "FullServiceRestaurant": 11, "QuickServiceRestaurant": 12}, selected="MidriseApartment")
addhbglz = Honeybee_addHBGlz(HBObj=createhbsrfs_4.HBSurface, childSurfaces=flatten(glass), RADMaterials=radglassmaterial.RADMaterial)  # -> simplify(HBObjWGLZ); plug-in component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
listzoneprograms = Honeybee_ListZonePrograms(bldgProgram=bldgprograms)  # -> MidriseApartmentZonePrograms; plug-in component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
listzoneprograms_2 = Honeybee_ListZonePrograms(bldgProgram=bldgprograms)  # -> MidriseApartmentZonePrograms; plug-in component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

# ---- group: Make all surfaces except the exterior wall adiabatic
makeadiabatic = Honeybee_MakeAdiabatic(HBSrfs=flatten([createhbsrfs_6.HBSurface, createhbsrfs_5.HBSurface, createhbsrfs_7.HBSurface]))  # -> HBSrfs; disabled; plug-in component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

# ----
hb_epcontextsrf = HoneybeeEPContextSurfaces(shdSurfaces=flatten(createhbsrfs.HBSurface))  # -> HBContext; inputs shdSurfaces: list of Brep, justBoundingBox: Boolean
# ---------- hb_epcontextsrf: Python ----------
"""
prepare shading/context geometries

    Args:
        northVectorOrRotation: A vector that shows North or a number that shows
                               the rotation of the North from the Y axis
        bldgMasses: List of closed Breps as thermal zones.
    Returns:
        report: ...
        thermalZones: Thermal zone's geometries for visualiza
"""

ghenv.Component.Name = 'Honeybee EP context Surfaces'
ghenv.Component.NickName = 'HB_EPContextSrf'
ghenv.Component.Message = 'VER 0.0.58\nNOV_20_2015'
ghenv.Component.Category = "Honeybee"
ghenv.Component.SubCategory = "09 | Energy | Energy"
#compatibleHBVersion = VER 0.0.57\nNOV_01_2015
#compatibleLBVersion = VER 0.0.59\nFEB_01_2015
ghenv.Component.AdditionalHelpFromDocStrings = "2"

import rhinoscriptsyntax as rs
import Rhino as rc
import scriptcontext as sc
import os
import System
import Grasshopper.Kernel as gh
import uuid

tolerance = sc.doc.ModelAbsoluteTolerance
import math


def main(shdSurfaces, EPTransSchedule, meshingSettings, justBoundingBox):
    
    # import the classes
    if sc.sticky.has_key('honeybee_release'):

        try:
            if not sc.sticky['honeybee_release'].isCompatible(ghenv.Component): return -1
        except:
            warning = "You need a newer version of Honeybee to use this compoent." + \
            " Use updateHoneybee component to update userObjects.\n" + \
            "If you have already updated userObjects drag Honeybee_Honeybee component " + \
            "into canvas and try again."
            w = gh.GH_RuntimeMessageLevel.Warning
            ghenv.Component.AddRuntimeMessage(w, warning)
            return -1
        
        # don't customize this part
        hb_EPSrf = sc.sticky["honeybee_EPSurface"]
        hb_EPSHDSurface = sc.sticky["honeybee_EPShdSurface"]
        hb_RADMaterialAUX = sc.sticky["honeybee_RADMaterialAUX"]
        hb_EPObjectsAux = sc.sticky["honeybee_EPObjectsAUX"]()
        HBScheduleList = sc.sticky["honeybee_ScheduleLib"].keys()

        ########################################################################
        #----------------------------------------------------------------------#
        shdBreps = []
        # create bounding box of shading geometries
        if justBoundingBox:
            for brep in shdSurfaces:
                if brep.Faces.Count>1 or not brep.Faces[0].IsPlanar(sc.doc.ModelAbsoluteTolerance):
                    shdBreps.append(brep.GetBoundingBox(True).ToBrep())
                else:
                    shdBreps.append(brep)
        else:
            shdBreps = shdSurfaces
        
        shadingClasses = []
        shadingMeshPreview = []
        
        if meshingSettings == None:
            mp = rc.Geometry.MeshingParameters.Minimal
            mp.SimplePlanes = True
        else:
            mp = meshingSettings
        
        def getRadMaterialName(radMaterial):
            nameStr = radMaterial.split(" ")[2]
            name =  nameStr.split("\n")[0]
            return name
        
        for brepCount, brep in enumerate(shdBreps):
            if brep != None:
                isPlanar = True
                # check planarity
                for face in brep.Faces:
                    if not face.IsPlanar(tolerance):
                        isPlanar = False
                        break
                
                shadingBreps = []
                if not isPlanar:
                    meshArray = rc.Geometry.Mesh.CreateFromBrep(brep, mp)
                    for mesh in meshArray:
                        for meshFace in range(mesh.Faces.Count):
                            vertices = list(mesh.Faces.GetFaceVertices(meshFace))[1:]
                            vertices = vertices + [sc.doc.ModelAbsoluteTolerance]
                            # create the brep from mesh
                            shdBrep = rc.Geometry.Brep.CreateFromCornerPoints(*vertices)
                            shadingBreps.append(shdBrep)
                else:
                    for face in brep.Faces:
                        shadingBreps.append(face.DuplicateFace(False))
                
                for faceCount, shdBrep in enumerate(shadingBreps):
                        thisShading = hb_EPSHDSurface(shdBrep, 1000*brepCount + faceCount, 'shdSrf_' + `brepCount` + '_' + `faceCount` + "_" + str(uuid.uuid4()))
                        
                        # add transmittance schedule if any
                        if EPTransSchedule!=None:
                            schedule= EPTransSchedule.upper()
                            if schedule!=None and not schedule.lower().endswith(".csv") and schedule not in HBScheduleList:
                                msg = "Cannot find " + schedule + " in Honeybee schedule library."
                                print msg
                                ghenv.Component.AddRuntimeMessage(gh.GH_RuntimeMessageLevel.Warning, msg)
                                return -1
                            elif schedule!=None and schedule.lower().endswith(".csv"):
                                # check if csv file is existed
                                if not os.path.isfile(schedule):
                                    msg = "Cannot find the shchedule file: " + schedule
                                    print msg
                                    ghenv.Component.AddRuntimeMessage(gh.GH_RuntimeMessageLevel.Warning, msg)
                                    return -1
                            
                            thisShading.TransmittanceSCH = schedule
                        
                        # add the Rad Material if any
                        if RADMaterial!=None:
                            # if it is just the name of the material make sure it is already defined
                            if len(RADMaterial.split(" ")) == 1:
                                # if the material is not in the library add it to the library
                                if not hb_RADMaterialAUX.isMatrialExistInLibrary(RADMaterial):
                                    warningMsg = "Can't find " + RADMaterial + " in RAD Material Library.\n" + \
                                                "Add the material to the library and try again."
                                    ghenv.Component.AddRuntimeMessage(gh.GH_RuntimeMessageLevel.Warning, warningMsg)
                                    return
                                
                                try:
                                    thisShading.setRADMaterial(RADMaterial)
                                except Exception, e:
                                    print e
                                    warningMsg = "You are using an old version of Honeybee_Honeybee! Update your files and try again."
                                    print warningMsg
                                    ghenv.Component.AddRuntimeMessage(gh.GH_RuntimeMessageLevel.Warning, warningMsg)
                                    return
                                
                                addedToLib = True
                            else:
                                
                                # try to add the material to the library
                                addedToLib, thisShading.RadMaterial = hb_RADMaterialAUX.analyseRadMaterials(RADMaterial, True)
                                
                            if addedToLib==False:
                                warningMsg = "Failed to add " + RADMaterial + " to the Library."
                                ghenv.Component.AddRuntimeMessage(gh.GH_RuntimeMessageLevel.Warning, warningMsg)
                                return
                        
                        # add shading to the list
                        shadingClasses.append(thisShading)
                
        # add to the hive
        hb_hive = sc.sticky["honeybee_Hive"]()
        HBContext  = hb_hive.addToHoneybeeHive(shadingClasses, ghenv.Component.InstanceGuid.ToString())
        return HBContext
        ################################################################################################
    else:
        print "You should first let Honeybee to fly..."
        w = gh.GH_RuntimeMessageLevel.Warning
        ghenv.Component.AddRuntimeMessage(w, "You should first let Honeybee to fly...")
        return -1
        

if _shdSurfaces and _shdSurfaces[0]!=None:
    # add cleaning function
    result= main(_shdSurfaces, EPTransSchedule_, meshingSettings_, justBoundingBox_)
    
    if result != -1: HBContext = result
# ---------- end hb_epcontextsrf ----------

# ---- group: collect all honeybee surfaces
brep_4 = Brep(flatten([makeadiabatic, addhbglz, createhbsrfs_2.HBSurface, createhbsrfs_3.HBSurface, createhbsrfs_6.HBSurface, createhbsrfs_5.HBSurface, createhbsrfs_7.HBSurface]))

# ----
item = ListItem(List=listzoneprograms, Index=0, Wrap=True)
panel_4 = Panel(item)
createhbzones = Honeybee_createHBZones(name="test_room", zoneProgram=item, HBSurfaces=flatten(brep_4), isConditioned=Toggle(False))  # -> readMe, HBZone; plug-in component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

panel_5 = Panel("http://apps1.eere.energy.gov/buildings/energyplus/weatherdata/2_asia_wmo_region_2/CHN_Beijing.Beijing.545110_IWEC.zip")
number_slider_2 = Slider(90, range=0..360)
open_epw_stat = Ladybug_OpenEPWAndSTATWeatherFiles(weatherFileURL=panel_5)  # -> epwFile, statFile; plug-in component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
northarrow = Ladybug_North(north=number_slider_2, scale=".05")  # -> northSign; plug-in component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
importepw = Ladybug_ImportEpw(epwFile=open_epw_stat.epwFile)  # -> readMe, latitude, location, dryBulbTemperature, dewPointTemperature, relativeHumidity, windSpeed, windDirection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; plug-in component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

wires = BrepWireframe(Brep=createhbzones.HBZone, Density=-1)
test_surface = Brep(<brep referenced from the Rhino model>)
gentestpts = Honeybee_GenerateTestPoints(testGeometry=test_surface, gridSize=".3", distBaseSrf=".762", moveTestMesh=True)  # -> readMe, simplify(testPoints), simplify(ptsVectors), simplify(facesArea), simplify(mesh); plug-in component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
points = PointList(Points=gentestpts.testPoints)  # disabled
radparameters = Honeybee_RADParameters(quality=0, ab=Slider(3, range=0..10))  # -> readMe, radParameters; plug-in component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

genclimatebasedsky = Honeybee_GenerateClimateBasedSky(north=number_slider_2, weatherFile=open_epw_stat.epwFile, month="3", day="21", hour="12")  # -> radiationValues, skyFilePath; plug-in component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
gridbasedsimulation = Honeybee_GridBasedSimulation(
    skyFile=genclimatebasedsky.skyFilePath,
    testPoints=gentestpts.testPoints,
    simulationType=0,
    radParameters=radparameters.radParameters)  # -> analysisRecipe; plug-in component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
legendpar_2 = Ladybug_LegendParameters(lowBound=Slider(100, range=0..100), highBound=Slider(2000, range=0..10000))  # -> legendPar; plug-in component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

annualdaylightsimulation = Honeybee_AnnualDaylightSimulation(
    north=number_slider_2,
    epwWeatherFile=open_epw_stat.epwFile,
    testPoints=gentestpts.testPoints,
    ptsVectors=gentestpts.ptsVectors,
    testMesh=gentestpts.mesh,
    radParameters=radparameters.radParameters)  # -> analysisRecipe; plug-in component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
item_2 = ListItem(List=gentestpts.testPoints, Index="58", Wrap=True)
sph = Sphere(Base=item_2, Radius=Slider(0.1, range=0..0.1))
# Run Annual Daylight
toggle_2 = BooleanToggle(True)
lightingcontrol = Honeybee_LightingControlRecipe(
    controlType="4",
    sensorPoints=item_2,
    lightingPower=250,
    lightingSetpoint=300,
    ballastLossFactor=20,
    standbyPower=3,
    delayTime=5)  # -> lightingControlGroup; plug-in component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
rundaylightanalysis = Honeybee_RunDaylightSimulation(
    HBObjects=flatten([createhbzones.HBZone, hb_epcontextsrf]),
    analysisRecipe=annualdaylightsimulation,
    writeRad=toggle_2,
    runRad=toggle_2,
    numOfCPUs=Slider(8, range=0..10),
    overwriteResults=True)  # -> readMe, analysisType, resultsUnit, results, testPts, annual_analysis_files, radGeoFile, studyFolder, done; plug-in component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
gethbzoneepschedules = Honeybee_GetZoneEnergyPlusSchedules(HBZone=createhbzones.HBZone)  # -> occupancySchedule, occupancyActivitySch, heatingSetPtSchedule, coolingSetPtSchedule, lightingSchedule, equipmentSchedule, infiltrationSchedule; plug-in component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
occupancygenerator = Honeybee_DaysimOccupancyGenerator(weekendDays=[1, 2], writeTheOcc=Toggle(True))  # -> occupancyFile; plug-in component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
readannualresultsi = Honeybee_ReadAnnualResultI(
    illFilesAddress=rundaylightanalysis.annual_analysis_files,
    testPoints=simplify(rundaylightanalysis.testPts),
    occupancyFiles=occupancygenerator,
    DLAIllumThresholds=300,
    lightingControlGroups=lightingcontrol,
    runIt=Toggle(True))  # -> DLA, UDLI_Less_100, UDLI_100_2000, UDLI_More_2000, CDA, sDA, annualProfiles, htmReport; plug-in component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
number_slider_3 = Slider(0.1, range=0..0.1)
panel_6 = Panel(readannualresultsi.sDA)
pt = Point(Point(319.5549973, 328.2886425, 0))

# ---- group: just for visualization
# Compare Schedules!
dsannualprofiles = Honeybee_DaysimAnnualProfiles(annualProfiles=readannualresultsi.annualProfiles)  # -> simplify(occupancyProfile), simplify(shadingProfiles), simplify(lightingControlProfiles), simplify(dgpProfile); plug-in component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
convertepschvalues = Honeybee_ConvertEnergyPlusScheduleToValues(schName=gethbzoneepschedules.lightingSchedule)  # -> values; plug-in component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
_3dchart = Ladybug_3DChart(
    inputData=flatten([convertepschvalues, dsannualprofiles.lightingControlProfiles]),
    basePoint=pt,
    xScale=Slider(0.033, range=0..0.1),
    yScale=Slider(0.2, range=0..1))  # -> readMe, graphMesh, graphCurves, legend, legendBasePts, title, titleBasePts, dataPts, conditionalHOY; plug-in component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

# ----
panel_7 = Panel("Annual Daylight Autonomy")
panel_8 = Panel("UDLI 100-2000")
panel_9 = Panel("UDLI <100")
panel_10 = Panel("DLA%")
# update lighting schedule
setepzoneschedules = Honeybee_SetEnergyPlusZoneSchedules(HBZones=createhbzones.HBZone, lightingSchedules=readannualresultsi.annualProfiles)  # -> schedules, simplify(HBZones); plug-in component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
legendpar_3 = Ladybug_LegendParameters(lowBound=Slider(0, range=0..100), highBound=Slider(100, range=0..100))  # -> legendPar; plug-in component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

setepnatvent = Honeybee_SetEPAirFlow(
    HBZones=setepzoneschedules.HBZones,
    naturalVentilationType=Slider(1, range=0..1),
    minIndoorTempForNatVent="21",
    maxOutdoorTempForNatVent="28")  # -> readMe, simplify(HBZones); plug-in component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

recolormesh = Ladybug_RecolorMesh(
    analysisResult=readannualresultsi.UDLI_More_2000,
    inputMesh=gentestpts.mesh,
    legendPar=legendpar_3,
    analysisTitle="UDLI >2000",
    legendTitle="%")  # -> readMe, newMesh, newLegend, legendBasePt, meshColors, legendColors; plug-in component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
toggle_3 = BooleanToggle(True)
epoutput = Honeybee_GenerateEPOutput(
    zoneEnergyUse=toggle_3,
    zoneGainsAndLosses="False",
    zoneComfortMetrics=toggle_3,
    surfaceTempAnalysis="False",
    timestep="hourly")  # -> report, flatten(simulationOutputs); plug-in component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
toggle_4 = BooleanToggle(True)
# Run the analysis
runenergysimulation = Honeybee_RunEnergySimulation(
    north=number_slider_2,
    epwFile=open_epw_stat.epwFile,
    HBZones=flatten(setepnatvent.HBZones),
    HBContext=flatten(hb_epcontextsrf),
    simulationOutputs=flatten(epoutput.simulationOutputs),
    writeIdf=toggle_4,
    runEnergyPlus=toggle_4)  # -> report, idfFileAddress, resultFileAddress; plug-in component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
readepresult = Honeybee_ReadEPResult(resultFileAddress=runenergysimulation.resultFileAddress)  # -> port, port_2, port_3, port_4, electricLight, electricEquip, fanElectric, port_5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; plug-in component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
pt_2 = Point()

adaptivecomfortcalculator = Ladybug_AdaptiveComfortCalculator(
    dryBulbTemperature=readepresult.airTemperature,
    meanRadiantTemperature=readepresult.meanRadTemperature,
    prevailingOutdoorTemp=importepw.dryBulbTemperature,
    runIt=Toggle(True))  # -> readMe, port, comfortableOrNot, conditionOfPerson, degreesFromTarget, port_2, targetTemperature, upperTemperatureBound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; plug-in component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
separatedata = Ladybug_SeparateData(inputList=flatten(adaptivecomfortcalculator.comfortableOrNot))  # -> numbers, strings; plug-in component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
ma = MassAddition(Input=separatedata.numbers)  # -> Result, PartialResults
comfort_adaptive = Panel(adaptivecomfortcalculator.percentHotCold)
panel_11 = Panel(ma.Result)

pmvcomfortcalculator = Ladybug_PMVComfortCalculator(
    dryBulbTemperature=readepresult.airTemperature,
    meanRadiantTemperature=readepresult.meanRadTemperature,
    relativeHumidity=readepresult.relativeHumidity,
    calcBalanceTemperature=False,
    runIt=Toggle(True))  # -> readMe, port, predictedMeanVote, percentPeopleDissatisfied, standardEffectiveTemperature, port_2, comfortableOrNot, percentOfTimeComfortable, port_3, balanceTemperature; plug-in component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
separatedata_2 = Ladybug_SeparateData(inputList=flatten(pmvcomfortcalculator.comfortableOrNot))  # -> numbers, strings; plug-in component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
ma_2 = MassAddition(Input=separatedata_2.numbers)  # -> Result, PartialResults
comfort_pmv = Panel(pmvcomfortcalculator.percentOfTimeComfortable)
panel_12 = Panel(ma_2.Result)

# ----
# Generate lighting Schedule
comfort_pmv_2 = Panel(pmvcomfortcalculator.percentOfTimeComfortable)
panel_13 = Panel("""Cooling, Heating
& Lighting Loads""")

separatedata_3 = Ladybug_SeparateData(inputList=flatten(readepresult.port_3))  # -> numbers, strings; plug-in component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
separatedata_4 = Ladybug_SeparateData(inputList=flatten(readepresult.port_4))  # -> numbers, strings; plug-in component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
separatedata_5 = Ladybug_SeparateData(inputList=flatten(readepresult.electricLight))  # -> numbers, strings; plug-in component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
ma_3 = MassAddition(Input=separatedata_3.numbers)  # -> Result, PartialResults
ma_4 = MassAddition(Input=separatedata_4.numbers)  # -> Result, PartialResults
ma_5 = MassAddition(Input=separatedata_5.numbers)  # -> Result, PartialResults
total_cooling = Panel(ma_3.Result)
total_heating = Panel(ma_4.Result)
total_lighting = Panel(ma_5.Result)
addition = Addition(A=total_cooling, B=total_heating, C=total_lighting)
panel_14 = Panel(addition)

legendpar_4 = Ladybug_LegendParameters(lowBound=Slider(0, range=0..100), highBound=Slider(1000, range=0..1000))  # -> legendPar; plug-in component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
barchart = Ladybug_MonthlyBarChart(
    inputData=flatten([readepresult.port_3, readepresult.electricLight, readepresult.port_4]),
    altYAxisTitle=panel_13,
    basePoint=pt_2,
    xScale=Slider(0.5, range=0..1),
    yScale=Slider(0.7, range=0..1),
    legendPar=legendpar_4)  # -> readMe, dataMesh, dataCurves, dataCrvColors, graphAxes, graphLabels, title, titleBasePt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; plug-in component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
legendpar_5 = Ladybug_LegendParameters(lowBound="-15", highBound=Slider(40, range=0..100), numSegments=Slider(11, range=0..100))  # -> legendPar; disabled; plug-in component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
_3dchart_2 = Ladybug_3DChart(
    inputData=flatten(pmvcomfortcalculator.predictedMeanVote),
    basePoint="300, 0",
    xScale=Slider(0.033, range=0..0.1),
    yScale=Slider(0.2, range=0..1),
    legendPar=legendpar_5,
    condStatement="2<a")  # -> readMe, graphMesh, graphCurves, legend, legendBasePts, title, titleBasePts, dataPts, conditionalHOY; plug-in component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

# ----
# Run the analysis
# DGP: Daylight glare probability:
# Imperceptible Glare [0.35 > DGP]
# Perceptible Glare [0.4 > DGP >= 0.35]
# Disturbing Glare [0.45 > DGP >= 0.4]
# Intolerable Glare [DGP >= 0.45]
# Analysis Recipe
# set the view
panel_15 = Panel("http://apps1.eere.energy.gov/buildings/energyplus/weatherdata/2_asia_wmo_region_2/CHN_Beijing.Beijing.545110_IWEC.zip")
open_epw_stat_2 = Ladybug_OpenEPWAndSTATWeatherFiles(weatherFileURL=panel_15)  # -> epwFile, statFile; plug-in component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
genclimatebasedsky_2 = Honeybee_GenerateClimateBasedSky(north=number_slider_2, weatherFile=open_epw_stat_2.epwFile, month="12", day="21", hour="15")  # -> radiationValues, skyFilePath; plug-in component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
genavgsky = Honeybee_GenerateAverageSky(weatherFile=open_epw_stat_2.epwFile, month="12", hour="15")  # -> radiationValues, skyFilePath; plug-in component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
panel_16 = Panel([genclimatebasedsky_2.radiationValues, genavgsky.radiationValues])
set_the_view_to_fisheye_for_glare_analys = Panel("1")  # "set the view to FishEye for Glare Analysis"
radparameters_2 = Honeybee_RADParameters(quality=0, ab="3")  # -> readMe, radParameters; plug-in component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
doy_hoy = Ladybug_DOY_HOY(days="21", months="12", hours="15")  # -> HOY, DOY, date; plug-in component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
imagebasedsimulation = Honeybee_ImageBasedSimulation(
    skyFile=genavgsky.skyFilePath,
    cameraType=set_the_view_to_fisheye_for_glare_analys,
    simulationType=2,
    radParameters=radparameters_2.radParameters,
    backupImages=0)  # -> analysisRecipe; plug-in component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
toggle_5 = BooleanToggle(True)
panel_17 = Panel("""Radiance
Grasshopper
Honeybee
Glare
Daylight
Set View""")
panel_18 = Panel("""This file shows how to run a glare analysis using Honeybee. This example is using same geometry as the other daylighting examples [[1](http://hydrashare.github.io/hydra/viewer?owner=mostaphaRoudsari&fork=hydra_1&id=Surface_by_surface_geometry_preparation_for_daylight_simulation_II), [2](http://hydrashare.github.io/hydra/viewer?owner=mostaphaRoudsari&fork=hydra_1&id=Find_when_sun_is_visible_to_a_point)].
The example is uses Averaged Climate-based Sky for glare analysis which uses the average value for that hour during the whole month.""")
rundaylightanalysis_2 = Honeybee_RunDaylightSimulation(
    HBObjects=flatten([brep_4, createhbsrfs_8.HBSurface, createhbsrfs.HBSurface]),
    analysisRecipe=imagebasedsimulation,
    writeRad=toggle_5,
    runRad=toggle_5,
    numOfCPUs="8",
    radFileName=doy_hoy.date,
    overwriteResults=True)  # -> readMe, analysisType, resultsUnit, results, testPts, luminance_files, radGeoFile, studyFolder, done; plug-in component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
md_slider = MDSlider(
    slider_value=Point(0.4825383628, 0.429903356, 0.5),
    SliderMode=0,
    x_domain=Domain(-1, 1),
    y_domain=Domain(-1, 1),
    z_domain=Domain(0, 1))
panel_19 = Panel("C:\Users\Administrator\Dropbox\ladybug\helpDesk\PennDesign2015\Daylight_Glare_Analysis.png")
glareanalysis = Honeybee_GlareAnalysis(HDRImagePath=rundaylightanalysis_2.luminance_files, runIt=Toggle(True))  # -> readMe, glareCheckImage, DGP, DGI, imageWithTaskArea; plug-in component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
exporthydra_2 = Hydra_ExportFile(
    fileName="Glare Analysis",
    fileDescription=panel_18,
    fileTags=panel_17,
    targetFolder="C:\Users\Administrator\Documents\GitHub\hydra_1",
    includeRhino=Toggle(True),
    additionalImgs=panel_19,
    export=Toggle(False))  # -> readMe; inputs fileDescription: list, changeLog: list, fileTags: list, includeRhino: Boolean, GHForThumb: Boolean, additionalImgs: list, export: Boolean; disabled; plug-in component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
panel_20 = Panel(glareanalysis.DGP)
hdr_tif = Honeybee_ConvertHDRToTIF(HDRFilePath=glareanalysis.glareCheckImage, adjustExposure=Toggle(True))  # -> TIFFFilePath; plug-in component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
number_slider_4 = Slider(0.8, range=0..1)
panel_21 = Panel(hdr_tif)
gallery = ImageGallery(
    CycleDelay=30,
    Randomize=False,
    UseLocalImages=True,
    UseRemoteImages=False,
    RemoteUrl="C:/Users/Majed/AppData/Roaming/Ladybug/21DEC900/imageBasedSimulation//21DEC900_IMG_GLARE_ANALYSIS_chkFile.TIF")

# ---- group: For better visualization - Doesn't effect the results of the analysis
importlocation = Ladybug_ImportLocation(epwFile=open_epw_stat_2.epwFile)  # -> location; plug-in component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
sunpath = Ladybug_SunPath(
    north=number_slider_2,
    location=importlocation,
    hour=["9", "12", "15"],
    day="21",
    month="12",
    timeStep=1,
    analysisPeriod=analysisperiod.analysisPeriod,
    sunPathScale=Slider(0.2, range=0..1),
    annualHourlyData=flatten(importepw.dryBulbTemperature),
    legendPar=legendpar,
    dailyOrAnnualSunPath=True)  # -> readMe, sunVectors, sunAltitudes, sunAzimuths, port, sunSpheresMesh, sunPathCrvs, legend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; disabled; plug-in component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

# ----
falsecolor = Honeybee_FalseColor(
    HDRFilePath=rundaylightanalysis_2.luminance_files,
    contourBands=False,
    numOfSegments=Slider(4, range=0..10),
    maskThreshold=0.1,
    useAlterColors=False,
    render=Toggle(True))  # -> outputFilePath; plug-in component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

pt_3 = Point(Point(3, 2.544838682, 0.1224289629))
comfortmannequin = Ladybug_ComfortMannequin(rotationAngle="175", bodyLocation=pt_3)  # -> mannequinMesh, legend, legendBasePt; plug-in component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

# ---- group: Person's face!
item_3 = ListItem(List=comfortmannequin.mannequinMesh, Index=121, Wrap=True)

# ----
preview_2 = CustomPreview(Geometry=item_3, Shader=ColourSwatch(SwatchColor=RGB(255, 0, 0)))

facen = FaceNormals(Mesh=item_3)  # -> Centers, Normals
settheview = Ladybug_SetTheView(cameraLocation=facen.Centers, cameraDirection=facen.Normals, uvLookAround=md_slider)  # -> readMe; plug-in component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
hdr_tif_2 = Honeybee_ConvertHDRToTIF(HDRFilePath=falsecolor, adjustExposure=False)  # -> TIFFFilePath; plug-in component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
