# Grasshopper definition Albakr_Majed_FinalProject(ClimateData).gh (Grasshopper 0.9.76)
# plug-ins: Python Interpreter

# ----
# http://apps1.eere.energy.gov/buildings/energyplus/weatherdata/4_north_and_central_america_wmo_region_4/1_usa/USA_VA_Arlington-Ronald.Reagan.Washington.Natl.AP.724050_TMY3.zip
weather_data_url = Panel("http://apps1.eere.energy.gov/buildings/energyplus/weatherdata/2_asia_wmo_region_2/CHN_Beijing.Beijing.545110_IWEC.zip")
city_name = Panel("Beijing")

ladybug = Ladybug_Ladybug()  # -> Vviiiiiiiiiizzz; plug-in component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
toggle = BooleanToggle(True)
toggle_2 = BooleanToggle(True)
honeybee = Honeybee_Honeybee()  # -> Vviiiiiiiiiizzz; plug-in component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
downloadepw = Ladybug_downloadEPWWeatherFile(download=Toggle(False))  # -> readMe; plug-in component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
updatehoneybee = Honeybee_UpdateHoneybee(updateThisFile=toggle, updateAllUObjects=toggle_2)  # -> readMe; plug-in component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
updateladybug = Ladybug_UpdateLadybug(updateThisFile=toggle, updateAllUObjects=toggle_2)  # -> readMe; plug-in component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

spring = Slider(0.2, range=0..1)
summer = Slider(0.25, range=0..1)
fall = Slider(0.27, range=0..1)
winter = Slider(0.17, range=0..1)

open_epw_stat = Ladybug_OpenEPWAndSTATWeatherFiles(weatherFileURL=weather_data_url)  # -> epwFile, statFile; plug-in component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
importepw = Ladybug_ImportEpw(epwFile=open_epw_stat.epwFile)  # -> readMe, latitude, location, dryBulbTemperature, dewPointTemperature, relativeHumidity, windSpeed, windDirection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; plug-in component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

pt = Point(Point(-100, -100, 0))

number_slider = Slider(1, range=0..1)  # disabled
toggle_3 = BooleanToggle(False)  # disabled
gencumulativeskymtx = Ladybug_GenCumulativeSkyMtx(epwFile=open_epw_stat.epwFile, skyDensity=number_slider, useOldRes=True, runIt=toggle_3)  # -> readMe, cumulativeSkyMtx; disabled; plug-in component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
selectskymtx = Ladybug_selectSkyMtx(cumulativeSkyMtx=gencumulativeskymtx.cumulativeSkyMtx, removeDiffuse=False, removeDirect=False)  # -> readMe, selectedSkyMtx; disabled; plug-in component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

windrose = BooleanToggle(True)

branchdatadailymonthlyhourly = Ladybug_BranchData(data=importepw.dryBulbTemperature)  # -> dataEachDayOfYear, dataEachMonth, dataEachHourOfDay; disabled; plug-in component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
panel = Panel("Monthly")  # disabled
panel_2 = Panel("Temperature")  # disabled
panel_3 = Panel("C")  # disabled
createheader = Ladybug_CreateLBHeader(location=importepw.location, dataType=panel_2, units=panel_3, timeStep=panel)  # -> flatten(LBHeader); disabled; plug-in component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
avr = Average(Input=branchdatadailymonthlyhourly.dataEachMonth)  # -> flatten(ArithmeticMean); disabled
merge = Merge(Data1=createheader, Data2=avr)  # disabled
panel_4 = Panel(merge)  # disabled

legendpar = Ladybug_LegendParameters(lowBound="0", highBound=Slider(100, range=0..100), numSegments=Slider(11, range=0..11), legendLocation=pt)  # -> legendPar; plug-in component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

selectandaveragedata = Ladybug_AverageData(annualHourlyData=importepw.liquidPrecipitationDepth, totalOrAverage=Toggle(True))  # -> readMe, selHourlyData, totaledDaily, totaledMonthly, totMonthlyPerHour, totAnalysisPeriod; plug-in component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
legendpar_2 = Ladybug_LegendParameters(
    lowBound="0",
    highBound=Slider(100, range=0..100),
    numSegments=Slider(11, range=0..11),
    customColors=flatten([ColourSwatch(SwatchColor=RGB(79, 164, 255)), ColourSwatch(SwatchColor=RGB(79, 164, 255))]),
    legendLocation=pt)  # -> legendPar; plug-in component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

number_slider_2 = Slider(21, range=0..100)

pt_2 = Point(<point referenced from the Rhino model>)
analysisperiod = Ladybug_AnalysisPeriod(fromMonth=Slider(1, range=1..12), toMonth=Slider(3, range=1..12))  # -> readMe, analysisPeriod; plug-in component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
legendpar_3 = Ladybug_LegendParameters(highBound=Slider(30, range=0..100), numSegments=Slider(7, range=0..100), legendLocation=pt_2)  # -> legendPar; plug-in component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

pt_3 = Point(<point referenced from the Rhino model>)
analysisperiod_2 = Ladybug_AnalysisPeriod(fromMonth=Slider(7, range=1..12), toMonth=Slider(9, range=1..12))  # -> readMe, analysisPeriod; plug-in component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
legendpar_4 = Ladybug_LegendParameters(highBound=Slider(30, range=0..100), numSegments=Slider(7, range=0..100), legendLocation=pt_3)  # -> legendPar; plug-in component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

legendpar_5 = Ladybug_LegendParameters(
    lowBound="-20",
    highBound=Slider(50, range=0..100),
    numSegments=Slider(8, range=0..10),
    customColors=flatten([ColourSwatch(SwatchColor=RGB(209, 0, 0)), ColourSwatch(SwatchColor=RGB(102, 52, 52))]),
    legendLocation=pt)  # -> legendPar; plug-in component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

pt_4 = Point(<point referenced from the Rhino model>)
legendpar_6 = Ladybug_LegendParameters(highBound=Slider(30, range=0..100), numSegments=Slider(7, range=0..100), legendLocation=pt_4)  # -> legendPar; plug-in component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
analysisperiod_3 = Ladybug_AnalysisPeriod(fromMonth=Slider(1, range=1..12), toMonth=Slider(12, range=1..12))  # -> readMe, analysisPeriod; plug-in component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

pt_5 = Point(<point referenced from the Rhino model>)
analysisperiod_4 = Ladybug_AnalysisPeriod(fromMonth=Slider(10, range=1..12), toMonth=Slider(12, range=1..12))  # -> readMe, analysisPeriod; plug-in component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
legendpar_7 = Ladybug_LegendParameters(highBound=Slider(30, range=0..100), numSegments=Slider(7, range=0..100), legendLocation=pt_5)  # -> legendPar; plug-in component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

legendpar_8 = Ladybug_LegendParameters(lowBound=Slider(100, range=0..100), highBound=Slider(1000, range=0..1000), numSegments=Slider(10, range=0..100))  # -> legendPar; plug-in component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

selectandaveragedata_2 = Ladybug_AverageData(annualHourlyData=importepw.dryBulbTemperature)  # -> readMe, selHourlyData, averagedDaily, averagedMonthly, avrMonthlyPerHour, avrAnalysisPeriod; plug-in component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

selectandaveragedata_3 = Ladybug_AverageData(annualHourlyData=importepw.relativeHumidity)  # -> readMe, selHourlyData, averagedDaily, averagedMonthly, avrMonthlyPerHour, avrAnalysisPeriod; plug-in component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

analysisperiod_5 = Ladybug_AnalysisPeriod(fromMonth=Slider(1, range=0..21), toMonth=Slider(12, range=0..100))  # -> readMe, analysisPeriod; plug-in component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

legendpar_9 = Ladybug_LegendParameters()  # -> legendPar; disabled; plug-in component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

number_slider_3 = Slider(1, range=0..1000)
pt_6 = Point(Point(164685.2291, 173220.6743, 0))
barchart = Ladybug_MonthlyBarChart(
    inputData=flatten(selectandaveragedata_2.averagedMonthly),
    comfortModel=Slider(3, range=0..3),
    stackValues=Toggle(False),
    altTitle=city_name,
    basePoint=pt_6,
    xScale=number_slider_3,
    yScale=number_slider_3,
    legendPar=legendpar_5)  # -> readMe, dataMesh, dataCurves, dataCrvColors, graphAxes, graphLabels, title, titleBasePt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; plug-in component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
preview = CustomPreview(Geometry=barchart.comfortBand, Shader=ColourSwatch(SwatchColor=RGB(128, 128, 128)))

number_slider_4 = Slider(1, range=0..1000)
pt_7 = Point(Point(271779.6235, 43542.26941, 0))
barchart_2 = Ladybug_MonthlyBarChart(
    inputData=flatten(selectandaveragedata_3.averagedMonthly),
    stackValues=Toggle(True),
    altTitle=city_name,
    basePoint=pt_7,
    xScale=number_slider_4,
    yScale=number_slider_4,
    legendPar=legendpar)  # -> readMe, dataMesh, dataCurves, dataCrvColors, graphAxes, graphLabels, title, titleBasePt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; plug-in component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

pt_8 = Point(Point(-188.8419194, 349.4982757, 0))
psychchart = Ladybug_PsychrometricChart(
    dryBulbTemperature=importepw.dryBulbTemperature,
    relativeHumidity=importepw.relativeHumidity,
    basePoint=pt_8,
    scale=Slider(3.5, range=0..10),
    runIt=Toggle(True))  # -> readMe, port, totalComfortPercent, totalComfortOrNot, strategyNames, strategyPercentOfTime, strategyOrNot, port_2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; plug-in component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

panel_5 = Panel("21")
panel_6 = Panel("""3
6
12""")
panel_7 = Panel("""9
12
15""")
pt_9 = Point(<point referenced from the Rhino model>)
sunpath = Ladybug_SunPath(
    location=importepw.location,
    hour=12,
    day=21,
    month=12,
    timeStep=1,
    analysisPeriod=analysisperiod_5.analysisPeriod,
    centerPt=pt_9,
    sunPathScale=Slider(0.3, range=0..1),
    sunScale=Slider(2, range=0..10),
    annualHourlyData=flatten(importepw.globalHorizontalRadiation),
    legendPar=legendpar_8,
    dailyOrAnnualSunPath=True)  # -> readMe, sunVectors, sunAltitudes, sunAzimuths, port, sunSpheresMesh, sunPathCrvs, legend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; plug-in component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

number_slider_5 = Slider(0.2, range=0..1)  # disabled
toggle_4 = BooleanToggle(False)  # disabled
toggle_5 = BooleanToggle(False)  # disabled
pt_10 = Point(<point referenced from the Rhino model>)  # disabled
radiationcallalily = Ladybug_RadiationCallaLily(
    selectedSkyMtx=selectskymtx.selectedSkyMtx,
    centerPoint=pt_10,
    horScale=number_slider_5,
    verScale=number_slider_5,
    domeOrLily=toggle_4,
    runIt=toggle_5)  # -> readMe, radiationLilyMesh, baseCrvs, legend, testPts, testPtsInfo, values, maxRadPt, maxRadVector, maxRadInfo; disabled; plug-in component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

number_slider_6 = Slider(0.2, range=0..1)  # disabled
toggle_6 = BooleanToggle(True)  # disabled
toggle_7 = BooleanToggle(False)  # disabled
pt_11 = Point(<point referenced from the Rhino model>)  # disabled
radiationrose = Ladybug_RadiationRose(
    selectedSkyMtx=selectskymtx.selectedSkyMtx,
    centerPoint=pt_11,
    scale=number_slider_6,
    arrowHeadScale=1,
    legendPar=legendpar_9,
    showTotalOnly=toggle_6,
    runIt=toggle_7)  # -> readMe, radiationArrowsMesh, radRoseBaseCrvs, legend, legendBasePts, radRoseEndPts, radRoseValues; disabled; plug-in component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

pt_12 = Point(Point(-143.9582389, -435.1601359, 0))
windrose_2 = Ladybug_WindRose(
    north=0,
    hourlyWindDirection=importepw.windDirection,
    hourlyWindSpeed=importepw.windSpeed,
    analysisPeriod=analysisperiod.analysisPeriod,
    centerPoint=pt_12,
    scale=spring,
    legendPar=legendpar_3,
    runIt=windrose)  # -> readMe, calmRoseMesh, windRoseMesh, windRoseCrvs, windRoseCenPts, legend, legendBasePts, title; plug-in component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

pt_13 = Point(Point(3.88015762, -468.7657799, 0))
windrose_3 = Ladybug_WindRose(
    north=0,
    hourlyWindDirection=importepw.windDirection,
    hourlyWindSpeed=importepw.windSpeed,
    analysisPeriod=analysisperiod_3.analysisPeriod,
    centerPoint=pt_13,
    scale=summer,
    legendPar=legendpar_6,
    runIt=windrose)  # -> readMe, calmRoseMesh, windRoseMesh, windRoseCrvs, windRoseCenPts, legend, legendBasePts, title; plug-in component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

pt_14 = Point(Point(184.9737858, -491.0595671, 0))
windrose_4 = Ladybug_WindRose(
    north=0,
    hourlyWindDirection=importepw.windDirection,
    hourlyWindSpeed=importepw.windSpeed,
    analysisPeriod=analysisperiod_2.analysisPeriod,
    centerPoint=pt_14,
    scale=fall,
    legendPar=legendpar_4,
    runIt=windrose)  # -> readMe, calmRoseMesh, windRoseMesh, windRoseCrvs, windRoseCenPts, legend, legendBasePts, title; plug-in component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

pt_15 = Point(Point(403.8333458, -506.5223191, 0))
windrose_5 = Ladybug_WindRose(
    north=0,
    hourlyWindDirection=importepw.windDirection,
    hourlyWindSpeed=importepw.windSpeed,
    analysisPeriod=analysisperiod_4.analysisPeriod,
    centerPoint=pt_15,
    scale=winter,
    legendPar=legendpar_7,
    runIt=windrose)  # -> readMe, calmRoseMesh, windRoseMesh, windRoseCrvs, windRoseCenPts, legend, legendBasePts, title; plug-in component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

pt_16 = Point(Point(189797.4557, -55285.48687, 0))
barchart_3 = Ladybug_MonthlyBarChart(inputData=flatten(selectandaveragedata.totaledMonthly), basePoint=pt_16, legendPar=legendpar_2)  # -> readMe, dataMesh, dataCurves, dataCrvColors, graphAxes, graphLabels, title, titleBasePt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; plug-in component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

gradientlibrary = Ladybug_GradientLibrary(gradIndex=Slider(15, range=0..21))  # -> customColors; plug-in component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
legendpar_10 = Ladybug_LegendParameters(numSegments=Slider(11, range=0..100), customColors=flatten(gradientlibrary))  # -> legendPar; plug-in component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

gradientlibrary_2 = Ladybug_GradientLibrary(gradIndex=Slider(0, range=0..21))  # -> customColors; plug-in component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
legendpar_11 = Ladybug_LegendParameters(highBound=Slider(1000, range=0..1000), numSegments=Slider(11, range=0..100), customColors=flatten(gradientlibrary_2))  # -> legendPar; plug-in component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

gradientlibrary_3 = Ladybug_GradientLibrary(gradIndex=Slider(15, range=0..21))  # -> customColors; plug-in component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
legendpar_12 = Ladybug_LegendParameters(lowBound=Slider(0, range=0..100), numSegments=Slider(11, range=0..100))  # -> legendPar; plug-in component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

gradientlibrary_4 = Ladybug_GradientLibrary(gradIndex=Slider(15, range=0..21))  # -> customColors; plug-in component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
legendpar_13 = Ladybug_LegendParameters(lowBound=Slider(-15, range=-20..100), highBound=Slider(40, range=0..100), numSegments=Slider(11, range=0..100))  # -> legendPar; plug-in component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

pt_17 = Point(Point(415.8728403, -112.1578196, 0))
_3dchart = Ladybug_3DChart(
    inputData=flatten(importepw.totalSkyCover),
    basePoint=pt_17,
    xScale=Slider(0.033, range=0..0.1),
    yScale=Slider(0.2, range=0..1),
    zScale=Slider(0, range=0..100),
    legendPar=legendpar_10)  # -> readMe, graphMesh, graphCurves, legend, legendBasePts, title, titleBasePts, dataPts, conditionalHOY; plug-in component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

pt_18 = Point(Point(416.0094958, -189.7606502, 0))
_3dchart_2 = Ladybug_3DChart(
    inputData=flatten(importepw.globalHorizontalRadiation),
    basePoint=pt_18,
    xScale=Slider(0.033, range=0..0.1),
    yScale=Slider(0.2, range=0..1),
    zScale=Slider(0, range=0..100),
    legendPar=legendpar_11)  # -> readMe, graphMesh, graphCurves, legend, legendBasePts, title, titleBasePts, dataPts, conditionalHOY; plug-in component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

pt_19 = Point(Point(406.8157833, 45.28038567, 0))
_3dchart_3 = Ladybug_3DChart(
    inputData=flatten(importepw.dryBulbTemperature),
    basePoint=pt_19,
    xScale=Slider(0.033, range=0..0.1),
    yScale=Slider(0.2, range=0..1),
    zScale=Slider(0, range=0..100),
    legendPar=legendpar_13,
    condStatement="a>-15")  # -> readMe, graphMesh, graphCurves, legend, legendBasePts, title, titleBasePts, dataPts, conditionalHOY; plug-in component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

pt_20 = Point(Point(407.5221748, -25.06567263, 0))
_3dchart_4 = Ladybug_3DChart(
    inputData=flatten(importepw.relativeHumidity),
    basePoint=pt_20,
    xScale=Slider(0.033, range=0..0.1),
    yScale=Slider(0.2, range=0..1),
    zScale=Slider(0, range=0..100),
    legendPar=legendpar_12)  # -> readMe, graphMesh, graphCurves, legend, legendBasePts, title, titleBasePts, dataPts, conditionalHOY; plug-in component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

panel_9 = Panel("a>80")
