# Grasshopper definition Seung Bae (Comfort test).gh (Grasshopper 0.9.76)
# plug-ins: Python Interpreter

updateladybug = Ladybug_UpdateLadybug(updateThisFile=Toggle(True), updateAllUObjects=Toggle(True))  # -> readMe; plug-in component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
updatehoneybee = Honeybee_UpdateHoneybee(updateThisFile=Toggle(True), updateAllUObjects=Toggle(True))  # -> readMe; plug-in component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

honeybee = Honeybee_Honeybee(defaultFolder="c:\ladybug")  # -> Vviiiiiiiiiizzz; plug-in component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
ladybug = Ladybug_Ladybug(defaultFolder="c:\ladybug")  # -> Vviiiiiiiiiizzz; plug-in component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

# ---- group: ceiling
ceiling = Brep([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])

# ---- group: floor
floor = Brep(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)

# ----
# Geometry Preparation
# Honeybee default materials will be assigned
# based on surface type
wall_surface_with_opening = Brep(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)
ledge = Brep(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)
walls = Brep([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])
createhbsrfs = Honeybee_createHBSrfs(geometry=ceiling, srfType="3")  # -> readMe, simplify(HBSurface); plug-in component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
createhbsrfs_2 = Honeybee_createHBSrfs(geometry=flatten([floor, ledge]), srfType="2")  # -> readMe, simplify(HBSurface); plug-in component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
createhbsrfs_3 = Honeybee_createHBSrfs(geometry=wall_surface_with_opening, srfType="0")  # -> readMe, simplify(HBSurface); plug-in component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
createhbsrfs_4 = Honeybee_createHBSrfs(geometry=walls, srfType="0")  # -> readMe, simplify(HBSurface); plug-in component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

bldgprograms = Honeybee_bldgPrograms({"Office": 0, "Retail": 1, "MidriseApartment": 2, "PrimarySchool": 3, "SecondarySchool": 4, "SmallHotel": 5, "LargeHotel": 6, "Hospital": 7, "Outpatient": 8, "Warehouse": 9, "SuperMarket": 10, "FullServiceRestaurant": 11, "QuickServiceRestaurant": 12}, selected="MidriseApartment")
listzoneprograms = Honeybee_ListZonePrograms(bldgProgram=bldgprograms)  # -> MidriseApartmentZonePrograms; plug-in component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
item = ListItem(List=listzoneprograms, Index=0, Wrap=True)
panel = Panel(item)

# ---- group: Make all surfaces except the facade with window adiabatic
makeadiabatic = Honeybee_MakeAdiabatic(HBSrfs=flatten([createhbsrfs_4.HBSurface, createhbsrfs.HBSurface, createhbsrfs_2.HBSurface]))  # -> HBSrfs; plug-in component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

# ----
glass = Brep(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)
preview = CustomPreview(Geometry=glass, Shader=ColourSwatch(SwatchColor=RGBA(79, 223, 255, 51)))

shading = Geometry([<brep referenced from the Rhino model> x13])
hb_epcontextsrf = HoneybeeEPContextSurfaces(shdSurfaces=flatten(shading))  # -> HBContext; inputs shdSurfaces: list of GeometryBase, justBoundingBox: Boolean
# ---------- hb_epcontextsrf: Python ----------
"""
prepare shading/context geometries

    Args:
        northVectorOrRotation: A vector that shows North or a number that shows
                               the rotation of the North from the Y axis
        bldgMasses: List of closed Breps as thermal zones.
    Returns:
        report: ...
        thermalZones: Thermal zone's geometries for visualiza
"""

ghenv.Component.Name = 'Honeybee EP context Surfaces'
ghenv.Component.NickName = 'HB_EPContextSrf'
ghenv.Component.Message = 'VER 0.0.58\nNOV_20_2015'
ghenv.Component.Category = "Honeybee"
ghenv.Component.SubCategory = "09 | Energy | Energy"
#compatibleHBVersion = VER 0.0.57\nNOV_01_2015
#compatibleLBVersion = VER 0.0.59\nFEB_01_2015
ghenv.Component.AdditionalHelpFromDocStrings = "2"

import rhinoscriptsyntax as rs
import Rhino as rc
import scriptcontext as sc
import os
import System
import Grasshopper.Kernel as gh
import uuid

tolerance = sc.doc.ModelAbsoluteTolerance
import math


def main(shdSurfaces, EPTransSchedule, meshingSettings, justBoundingBox):
    
    # import the classes
    if sc.sticky.has_key('honeybee_release'):

        try:
            if not sc.sticky['honeybee_release'].isCompatible(ghenv.Component): return -1
        except:
            warning = "You need a newer version of Honeybee to use this compoent." + \
            " Use updateHoneybee component to update userObjects.\n" + \
            "If you have already updated userObjects drag Honeybee_Honeybee component " + \
            "into canvas and try again."
            w = gh.GH_RuntimeMessageLevel.Warning
            ghenv.Component.AddRuntimeMessage(w, warning)
            return -1
        
        # don't customize this part
        hb_EPSrf = sc.sticky["honeybee_EPSurface"]
        hb_EPSHDSurface = sc.sticky["honeybee_EPShdSurface"]
        hb_RADMaterialAUX = sc.sticky["honeybee_RADMaterialAUX"]
        hb_EPObjectsAux = sc.sticky["honeybee_EPObjectsAUX"]()
        HBScheduleList = sc.sticky["honeybee_ScheduleLib"].keys()

        ########################################################################
        #----------------------------------------------------------------------#
        shdBreps = []
        # create bounding box of shading geometries
        if justBoundingBox:
            for brep in shdSurfaces:
                if brep.Faces.Count>1 or not brep.Faces[0].IsPlanar(sc.doc.ModelAbsoluteTolerance):
                    shdBreps.append(brep.GetBoundingBox(True).ToBrep())
                else:
                    shdBreps.append(brep)
        else:
            shdBreps = shdSurfaces
        
        shadingClasses = []
        shadingMeshPreview = []
        
        if meshingSettings == None:
            mp = rc.Geometry.MeshingParameters.Minimal
            mp.SimplePlanes = True
        else:
            mp = meshingSettings
        
        def getRadMaterialName(radMaterial):
            nameStr = radMaterial.split(" ")[2]
            name =  nameStr.split("\n")[0]
            return name
        
        for brepCount, brep in enumerate(shdBreps):
            if brep != None:
                isPlanar = True
                # check planarity
                for face in brep.Faces:
                    if not face.IsPlanar(tolerance):
                        isPlanar = False
                        break
                
                shadingBreps = []
                if not isPlanar:
                    meshArray = rc.Geometry.Mesh.CreateFromBrep(brep, mp)
                    for mesh in meshArray:
                        for meshFace in range(mesh.Faces.Count):
                            vertices = list(mesh.Faces.GetFaceVertices(meshFace))[1:]
                            vertices = vertices + [sc.doc.ModelAbsoluteTolerance]
                            # create the brep from mesh
                            shdBrep = rc.Geometry.Brep.CreateFromCornerPoints(*vertices)
                            shadingBreps.append(shdBrep)
                else:
                    for face in brep.Faces:
                        shadingBreps.append(face.DuplicateFace(False))
                
                for faceCount, shdBrep in enumerate(shadingBreps):
                        thisShading = hb_EPSHDSurface(shdBrep, 1000*brepCount + faceCount, 'shdSrf_' + `brepCount` + '_' + `faceCount` + "_" + str(uuid.uuid4()))
                        
                        # add transmittance schedule if any
                        if EPTransSchedule!=None:
                            schedule= EPTransSchedule.upper()
                            if schedule!=None and not schedule.lower().endswith(".csv") and schedule not in HBScheduleList:
                                msg = "Cannot find " + schedule + " in Honeybee schedule library."
                                print msg
                                ghenv.Component.AddRuntimeMessage(gh.GH_RuntimeMessageLevel.Warning, msg)
                                return -1
                            elif schedule!=None and schedule.lower().endswith(".csv"):
                                # check if csv file is existed
                                if not os.path.isfile(schedule):
                                    msg = "Cannot find the shchedule file: " + schedule
                                    print msg
                                    ghenv.Component.AddRuntimeMessage(gh.GH_RuntimeMessageLevel.Warning, msg)
                                    return -1
                            
                            thisShading.TransmittanceSCH = schedule
                        
                        # add the Rad Material if any
                        if RADMaterial!=None:
                            # if it is just the name of the material make sure it is already defined
                            if len(RADMaterial.split(" ")) == 1:
                                # if the material is not in the library add it to the library
                                if not hb_RADMaterialAUX.isMatrialExistInLibrary(RADMaterial):
                                    warningMsg = "Can't find " + RADMaterial + " in RAD Material Library.\n" + \
                                                "Add the material to the library and try again."
                                    ghenv.Component.AddRuntimeMessage(gh.GH_RuntimeMessageLevel.Warning, warningMsg)
                                    return
                                
                                try:
                                    thisShading.setRADMaterial(RADMaterial)
                                except Exception, e:
                                    print e
                                    warningMsg = "You are using an old version of Honeybee_Honeybee! Update your files and try again."
                                    print warningMsg
                                    ghenv.Component.AddRuntimeMessage(gh.GH_RuntimeMessageLevel.Warning, warningMsg)
                                    return
                                
                                addedToLib = True
                            else:
                                
                                # try to add the material to the library
                                addedToLib, thisShading.RadMaterial = hb_RADMaterialAUX.analyseRadMaterials(RADMaterial, True)
                                
                            if addedToLib==False:
                                warningMsg = "Failed to add " + RADMaterial + " to the Library."
                                ghenv.Component.AddRuntimeMessage(gh.GH_RuntimeMessageLevel.Warning, warningMsg)
                                return
                        
                        # add shading to the list
                        shadingClasses.append(thisShading)
                
        # add to the hive
        hb_hive = sc.sticky["honeybee_Hive"]()
        HBContext  = hb_hive.addToHoneybeeHive(shadingClasses, ghenv.Component.InstanceGuid.ToString())
        return HBContext
        ################################################################################################
    else:
        print "You should first let Honeybee to fly..."
        w = gh.GH_RuntimeMessageLevel.Warning
        ghenv.Component.AddRuntimeMessage(w, "You should first let Honeybee to fly...")
        return -1
        

if _shdSurfaces and _shdSurfaces[0]!=None:
    # add cleaning function
    result= main(_shdSurfaces, EPTransSchedule_, meshingSettings_, justBoundingBox_)
    
    if result != -1: HBContext = result
# ---------- end hb_epcontextsrf ----------

# ----
# Run!
windowbasednaturalventilation = BooleanToggle(False)

adaptive_comfort = BooleanToggle(False)
pmv_comfort = BooleanToggle(False)

toggle = BooleanToggle(True)
epoutput = Honeybee_GenerateEPOutput(
    zoneEnergyUse=toggle,
    zoneGainsAndLosses="False",
    zoneComfortMetrics=toggle,
    surfaceTempAnalysis="False",
    timestep="hourly")  # -> report, flatten(simulationOutputs); plug-in component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

panel_2 = Panel("http://apps1.eere.energy.gov/buildings/energyplus/weatherdata/5_southwest_pacific_wmo_region_5/MYS_Kuala.Lumpur.486470_IWEC.zip")
number_slider = Slider(45, range=0..100)
open_epw_stat = Ladybug_OpenEPWAndSTATWeatherFiles(weatherFileURL=panel_2)  # -> epwFile, statFile; plug-in component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
northarrow = Ladybug_North(north=number_slider, scale=".05")  # -> northSign; disabled; plug-in component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

panel_3 = Panel("C:\ARCH753_BuildingPerformanceSimulation\1116SimulationData")

importepw = Ladybug_ImportEpw(epwFile=open_epw_stat.epwFile)  # -> readMe, latitude, location, dryBulbTemperature, dewPointTemperature, relativeHumidity, windSpeed, windDirection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; plug-in component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

panel_4 = Panel("""1
1
1
1
1
1
1
1
0
0
0
0
0
0
0
0
1
1
1
1
1
1
1
1""")
legendpar = Ladybug_LegendParameters(lowBound=Slider(-3, range=-3..3), highBound=Slider(3, range=-3..3), numSegments=Slider(11, range=0..11))  # -> legendPar; plug-in component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

addhbglz = Honeybee_addHBGlz(HBObj=createhbsrfs_3.HBSurface, childSurfaces=flatten(glass))  # -> simplify(HBObjWGLZ); plug-in component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

# ---- group: collect all honeybee surfaces
brep = Brep(flatten([makeadiabatic, addhbglz]))

# ----
createhbzones = Honeybee_createHBZones(name="test_room", zoneProgram=item, HBSurfaces=flatten(brep), isConditioned=Toggle(False))  # -> readMe, HBZone; plug-in component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
wires = BrepWireframe(Brep=createhbzones.HBZone, Density=-1)

gethbzoneepschedules = Honeybee_GetZoneEnergyPlusSchedules(HBZone=createhbzones.HBZone)  # -> occupancySchedule, occupancyActivitySch, heatingSetPtSchedule, coolingSetPtSchedule, lightingSchedule, equipmentSchedule, infiltrationSchedule; plug-in component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
setepzoneschedules = Honeybee_SetEnergyPlusZoneSchedules(
    HBZones=createhbzones.HBZone,
    occupancySchedules=gethbzoneepschedules.occupancySchedule,
    occupancyActivitySchs=gethbzoneepschedules.occupancyActivitySch)  # -> schedules, simplify(HBZones); plug-in component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
convertepschvalues = Honeybee_ConvertEnergyPlusScheduleToValues(schName=gethbzoneepschedules.occupancySchedule)  # -> values; plug-in component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
_3dchart = Ladybug_3DChart(inputData=flatten(convertepschvalues), xScale=Slider(0.1, range=0..0.1), condStatement="a>0.5")  # -> readMe, graphMesh, graphCurves, legend, legendBasePts, title, titleBasePts, dataPts, conditionalHOY; plug-in component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
panel_5 = Panel(convertepschvalues)

solveadjc = Honeybee_SolveAdjacencies(HBZones=flatten(setepzoneschedules.HBZones), altConstruction="air wall", removeCurrentAdjc=False, findAdjc=Toggle(True))  # -> readMe, HBZonesWADJ; plug-in component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
decomposebytype = Honeybee_DecomposeBasedOnType(HBZone=solveadjc.HBZonesWADJ)  # -> walls, interiorWalls, airWalls, windows, interiorWindows, skylights, roofs, ceilings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; plug-in component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
preview_2 = CustomPreview(Geometry=decomposebytype.windows, Shader=ColourSwatch(SwatchColor=RGBA(107, 218, 255, 120)))

zoneattributelist = Honeybee_ZoneAttributeList({"Name": "name", "Zone Program": "zoneProgram", "Zone Floor Area": "zoneFloorArea", "Zone Volume": "zoneVolume", "Building Program": "bldgProgram", "Is Conditioned": "isConditioned", "Occupancy Schedule": "occupancySchedule", "Occupancy Activity Schedule": "occupancyActivitySch", "Heating SetPoint Schedule": "heatingSetPtSchedule", "Cooling SetPoint Schedule": "coolingSetPtSchedule"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}, selected="Natural Ventilation": "natVent")
setepnatvent = Honeybee_SetEPAirFlow(HBZones=solveadjc.HBZonesWADJ, naturalVentilationType="1", minIndoorTempForNatVent="24", maxOutdoorTempForNatVent="28")  # -> readMe, simplify(HBZones); plug-in component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
labelzones = Honeybee_LabelZones(HBZones=flatten(setepnatvent.HBZones), attribute=zoneattributelist)  # -> zoneTxtLabels, labelBasePts, brepTxtLabels, zoneWireFrames; plug-in component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
runenergysimulation = Honeybee_RunEnergySimulation(
    north=number_slider,
    epwFile=open_epw_stat.epwFile,
    HBZones=flatten(setepnatvent.HBZones),
    HBContext=flatten(hb_epcontextsrf),
    simulationOutputs=flatten(epoutput.simulationOutputs),
    writeIdf=windowbasednaturalventilation,
    runEnergyPlus=windowbasednaturalventilation,
    workingDir=panel_3)  # -> report, idfFileAddress, resultFileAddress; plug-in component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

panel_6 = Panel(runenergysimulation.resultFileAddress)
readepresult = Honeybee_ReadEPResult(resultFileAddress=runenergysimulation.resultFileAddress)  # -> totalThermalEnergy, thermalEnergyBalance, cooling, heating, electricLight, electricEquip, fanElectric, pumpElectric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; plug-in component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

adaptivecomfortcalculator = Ladybug_AdaptiveComfortCalculator(
    dryBulbTemperature=readepresult.airTemperature,
    meanRadiantTemperature=readepresult.meanRadTemperature,
    prevailingOutdoorTemp=importepw.dryBulbTemperature,
    runIt=adaptive_comfort)  # -> readMe, port, comfortableOrNot, conditionOfPerson, degreesFromTarget, port_2, targetTemperature, upperTemperatureBound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; plug-in component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
pmvcomfortcalculator = Ladybug_PMVComfortCalculator(
    dryBulbTemperature=readepresult.airTemperature,
    meanRadiantTemperature=readepresult.meanRadTemperature,
    relativeHumidity=readepresult.relativeHumidity,
    calcBalanceTemperature=False,
    runIt=pmv_comfort)  # -> readMe, port, predictedMeanVote, percentPeopleDissatisfied, standardEffectiveTemperature, port_2, comfortableOrNot, percentOfTimeComfortable, port_3, balanceTemperature; plug-in component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

# ----
# Result
separatedata = Ladybug_SeparateData(inputList=flatten(readepresult.cooling))  # -> numbers, strings; plug-in component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
separatedata_2 = Ladybug_SeparateData(inputList=flatten(readepresult.totalThermalEnergy))  # -> numbers, strings; plug-in component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
separatedata_3 = Ladybug_SeparateData(inputList=flatten(readepresult.heating))  # -> numbers, strings; plug-in component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
separatedata_4 = Ladybug_SeparateData(inputList=flatten(readepresult.electricLight))  # -> numbers, strings; plug-in component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
ma = MassAddition(Input=separatedata.numbers)  # -> Result, PartialResults
ma_2 = MassAddition(Input=separatedata_3.numbers)  # -> Result, PartialResults
ma_3 = MassAddition(Input=separatedata_2.numbers)  # -> Result, PartialResults
ma_4 = MassAddition(Input=separatedata_4.numbers)  # -> Result, PartialResults
total_thermal = Panel(ma_3.Result)
total_lighting = Panel(ma_4.Result)

# ----
# Energy
total_thermal_2 = Panel(ma_3.Result)

total_cooling = Panel(ma.Result)
total_heating = Panel(ma_2.Result)

# ----
# Result
separatedata_5 = Ladybug_SeparateData(inputList=flatten(pmvcomfortcalculator.predictedMeanVote))  # -> numbers, strings; plug-in component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
separatedata_6 = Ladybug_SeparateData(inputList=flatten(pmvcomfortcalculator.comfortableOrNot))  # -> numbers, strings; plug-in component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
separatedata_7 = Ladybug_SeparateData(inputList=flatten(adaptivecomfortcalculator.comfortableOrNot))  # -> numbers, strings; plug-in component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
ma_5 = MassAddition(Input=separatedata_5.numbers)  # -> Result, PartialResults
ma_6 = MassAddition(Input=separatedata_7.numbers)  # -> Result, PartialResults
ma_7 = MassAddition(Input=separatedata_6.numbers)  # -> Result, PartialResults
division = Division(A=ma_5.Result, B=8760)
pmv_y_n = Panel(ma_7.Result)
adaptive_y_n = Panel(ma_6.Result)
adaptive__oftime = Panel(adaptivecomfortcalculator.percentOfTimeComfortable)
pmv_predictedvote = Panel(division)
pmv__oftime = Panel(pmvcomfortcalculator.percentOfTimeComfortable)

# ----
# Comfort
adaptive_y_n_2 = Panel(ma_6.Result)

separatedata_8 = Ladybug_SeparateData(inputList=flatten(adaptivecomfortcalculator.conditionOfPerson))  # -> numbers, strings; plug-in component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

separatedata_9 = Ladybug_SeparateData(inputList=flatten(adaptivecomfortcalculator.comfortableOrNot))  # -> numbers, strings; plug-in component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
dup = DuplicateData(Data=panel_4, Number="365", Order=True)
ma_8 = MassAddition(Input=panel_4)  # -> Result, PartialResults
multiplication = Multiplication(A=separatedata_9.numbers, B=dup)
multiplication_2 = Multiplication(A=ma_8.Result, B="365")
ma_9 = MassAddition(Input=multiplication)  # -> Result, PartialResults
panel_7 = Panel(multiplication_2)
panel_8 = Panel(ma_9.Result)
division_2 = Division(A=panel_8, B=panel_7)
multiplication_3 = Multiplication(A=division_2, B=100)
adaptivecomfort_occ = Panel(multiplication_3)

separatedata_10 = Ladybug_SeparateData(inputList=flatten(pmvcomfortcalculator.comfortableOrNot))  # -> numbers, strings; plug-in component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
dup_2 = DuplicateData(Data=panel_4, Number="365", Order=True)
ma_10 = MassAddition(Input=panel_4)  # -> Result, PartialResults
multiplication_4 = Multiplication(A=separatedata_10.numbers, B=dup_2)
multiplication_5 = Multiplication(A=ma_10.Result, B="365")
ma_11 = MassAddition(Input=multiplication_4)  # -> Result, PartialResults
panel_9 = Panel(multiplication_5)
panel_10 = Panel(ma_11.Result)
division_3 = Division(A=panel_10, B=panel_9)
multiplication_6 = Multiplication(A=division_3, B=100)
pmvcomfort_occ = Panel(multiplication_6)

ma_12 = MassAddition(Input=separatedata_8.numbers)  # -> Result, PartialResults
adaptive_conditionofperson = Panel(ma_12.Result)

pt = Point(Point(10, 0, 0))
_3dchart_2 = Ladybug_3DChart(
    inputData=flatten([readepresult.thermalEnergyBalance, readepresult.cooling, readepresult.heating, readepresult.electricLight]),
    basePoint=pt,
    xScale=Slider(0.01, range=0..0.1),
    yScale=Slider(0.01, range=0..1),
    zScale=Slider(0, range=0..1))  # -> readMe, graphMesh, graphCurves, legend, legendBasePts, title, titleBasePts, dataPts, conditionalHOY; plug-in component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

pt_2 = Point(Point(60, 0, 0))
_3dchart_3 = Ladybug_3DChart(
    inputData=flatten([adaptivecomfortcalculator.comfortableOrNot, adaptivecomfortcalculator.conditionOfPerson, pmvcomfortcalculator.comfortableOrNot, pmvcomfortcalculator.predictedMeanVote]),
    basePoint=pt_2,
    xScale=Slider(0.01, range=0..0.1),
    yScale=Slider(0.01, range=0..1),
    zScale=Slider(0, range=0..1),
    legendPar=legendpar)  # -> readMe, graphMesh, graphCurves, legend, legendBasePts, title, titleBasePts, dataPts, conditionalHOY; plug-in component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
