# Grasshopper definition Seung Bae (Glare + Other Analysis).gh (Grasshopper 0.9.76)
# plug-ins: Python Interpreter, embryoA

panel = Panel("http://apps1.eere.energy.gov/buildings/energyplus/weatherdata/5_southwest_pacific_wmo_region_5/MYS_Kuala.Lumpur.486470_IWEC.zip")
updateladybug = Ladybug_UpdateLadybug(updateThisFile=Toggle(True), updateAllUObjects=Toggle(True))  # -> readMe; plug-in component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
updatehoneybee = Honeybee_UpdateHoneybee(updateThisFile=Toggle(True), updateAllUObjects=Toggle(True))  # -> readMe; plug-in component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

# ---- group: furniture
furniture = Brep([<brep referenced from the Rhino model> x12])

# ----
ledge = Brep(<brep referenced from the Rhino model>)
honeybee = Honeybee_Honeybee(defaultFolder="c:\ladybug")  # -> Vviiiiiiiiiizzz; plug-in component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
ladybug = Ladybug_Ladybug(defaultFolder="c:\ladybug")  # -> Vviiiiiiiiiizzz; plug-in component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
radopaquematerial = Honeybee_RadianceOpaqueMaterial(materialName="generic_35", RReflectance=".35", GReflectance=".35", BReflectance=".35", roughness=0.05, specularity=0)  # -> avrgRef, RADMaterial; plug-in component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
open_epw_stat = Ladybug_OpenEPWAndSTATWeatherFiles(weatherFileURL=panel)  # -> epwFile, statFile; plug-in component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
radglassmaterial = Honeybee_RadianceGlassMaterial(materialName="glass_.65", RTransmittance=".65", GTransmittance=".65", BTransmittance=".65", refractiveIndex=1.52)  # -> avrgTrans, RADMaterial; plug-in component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
radglassmaterial_2 = Honeybee_RadianceGlassMaterial(materialName="Shading_.20", RTransmittance=".20", GTransmittance=".20", BTransmittance=".20", refractiveIndex=1.52)  # -> avrgTrans, RADMaterial; plug-in component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

# ---- group: glass facade
glass = Brep(<brep referenced from the Rhino model>)

# ---- group: ceiling
ceiling = Brep([<brep referenced from the Rhino model> x3])

# ----
walls = Brep([<brep referenced from the Rhino model> x9])

# ---- group: floor
floor = Brep(<brep referenced from the Rhino model>)

# ----
brep = Brep([<brep referenced from the Rhino model> x10])
number_slider = Slider(45, range=0..360)
importlocation = Ladybug_ImportLocation(epwFile=open_epw_stat.epwFile)  # -> location; plug-in component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
# Assign specific materials
createhbsrfs = Honeybee_createHBSrfs(geometry=[ledge, furniture], RADMaterial=radopaquematerial.RADMaterial)  # -> readMe, simplify(HBSurface); plug-in component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
# Geometry Preparation
# Honeybee default materials will be assigned
# based on surface type
createhbsrfs_2 = Honeybee_createHBSrfs(geometry=walls, srfType="0")  # -> readMe, simplify(HBSurface); plug-in component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
createhbsrfs_3 = Honeybee_createHBSrfs(geometry=glass, RADMaterial=radglassmaterial.RADMaterial)  # -> readMe, simplify(HBSurface); plug-in component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
createhbsrfs_4 = Honeybee_createHBSrfs(geometry=ceiling, srfType="3")  # -> readMe, simplify(HBSurface); plug-in component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
createhbsrfs_5 = Honeybee_createHBSrfs(geometry=floor, srfType="2")  # -> readMe, simplify(HBSurface); plug-in component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
genclimatebasedsky = Honeybee_GenerateClimateBasedSky(north=number_slider, weatherFile=open_epw_stat.epwFile, month="12", day="21", hour="15")  # -> radiationValues, skyFilePath; plug-in component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
createhbsrfs_6 = Honeybee_createHBSrfs(geometry=brep, RADMaterial=radglassmaterial_2.RADMaterial)  # -> readMe, simplify(HBSurface); plug-in component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
sunpath = Ladybug_SunPath(
    north=Slider(45, range=0..100),
    location=importlocation,
    hour=Slider(9, range=0..24),
    day=Slider(21, range=0..100),
    month=Slider(3, range=0..100),
    timeStep=1,
    sunPathScale=Slider(0, range=0..5),
    dailyOrAnnualSunPath=True)  # -> readMe, sunVectors, sunAltitudes, sunAzimuths, port, sunSpheresMesh, sunPathCrvs, legend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; plug-in component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
northarrow = Ladybug_North(north=number_slider, scale=".05")  # -> northSign; plug-in component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
explodelocation = Ladybug_DecomposeLocation(location=importlocation)  # -> locationName, latitude, longitude, timeZone, elevation; plug-in component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
test_surfaces = Brep(<brep referenced from the Rhino model>)
radparameters = Honeybee_RADParameters(quality=0, ab="3")  # -> readMe, radParameters; plug-in component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
doy_hoy = Ladybug_DOY_HOY(days="21", months="12", hours="15")  # -> HOY, DOY, date; plug-in component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
set_the_view_to_fisheye_for_glare_analys = Panel("1")  # "set the view to FishEye for Glare Analysis"
gentestpts = Honeybee_GenerateTestPoints(testGeometry=test_surfaces, gridSize=Slider(0.3, range=0..1), distBaseSrf=".762", moveTestMesh=True)  # -> readMe, simplify(testPoints), simplify(ptsVectors), simplify(facesArea), simplify(mesh); plug-in component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
# Analysis Recipe
number_slider_2 = Slider(0, range=0..100)

# ---- group: collect all honeybee surfaces
brep_2 = Brep(flatten([createhbsrfs_2.HBSurface, createhbsrfs_4.HBSurface, createhbsrfs_5.HBSurface, createhbsrfs.HBSurface, createhbsrfs_3.HBSurface, createhbsrfs_6.HBSurface]))

# ----
imagebasedsimulation = Honeybee_ImageBasedSimulation(
    skyFile=genclimatebasedsky.skyFilePath,
    cameraType=set_the_view_to_fisheye_for_glare_analys,
    simulationType=2,
    radParameters=radparameters.radParameters,
    backupImages=0)  # -> analysisRecipe; plug-in component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
toggle = BooleanToggle(False)
gridbasedsimulation = Honeybee_GridBasedSimulation(
    skyFile=genclimatebasedsky.skyFilePath,
    testPoints=gentestpts.testPoints,
    ptsVectors=gentestpts.ptsVectors,
    testMesh=gentestpts.mesh,
    simulationType=number_slider_2,
    radParameters=radparameters.radParameters)  # -> analysisRecipe; plug-in component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
# Run the analysis
panel_2 = Panel("4")
panel_3 = Panel("Glare")
md_slider = MDSlider(
    slider_value=Point(0.5215606689, 0.5079524343, 0.5),
    SliderMode=0,
    x_domain=Domain(-1, 1),
    y_domain=Domain(-1, 1),
    z_domain=Domain(0, 1))
rundaylightanalysis = Honeybee_RunDaylightSimulation(
    HBObjects=flatten(brep_2),
    analysisRecipe=[gridbasedsimulation, imagebasedsimulation],
    writeRad=toggle,
    runRad=toggle,
    numOfCPUs=panel_2,
    radFileName=doy_hoy.date,
    overwriteResults=True)  # -> readMe, analysisType, resultsUnit, results, testPts, resultFiles, radGeoFile, studyFolder, done; plug-in component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
gradientlibrary = Ladybug_GradientLibrary(gradIndex="1")  # -> customColors; plug-in component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

# ---- group: Study Title
merge = Merge(
    Data2=flatten(rundaylightanalysis.analysisType),
    Data3=flatten(doy_hoy.date),
    Data4=flatten(explodelocation.locationName))
join = TextJoin(Text=merge)

# ----
pt = Point(<point referenced from the Rhino model>)
dom = ConstructDomain(DomainStart="-.5", DomainEnd=".5")
# Result Visualization
legendpar = Ladybug_LegendParameters(lowBound="0", highBound="3000", customColors=flatten(gradientlibrary), legendLocation=pt)  # -> legendPar; plug-in component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
panel_4 = Panel(join)
panel_5 = Panel(rundaylightanalysis.studyFolder)
recolormesh = Ladybug_RecolorMesh(
    analysisResult=rundaylightanalysis.results,
    inputMesh=gentestpts.mesh,
    heightDomain=dom,
    legendPar=legendpar,
    analysisTitle=join,
    legendTitle=rundaylightanalysis.resultsUnit)  # -> readMe, newMesh, newLegend, legendBasePt, meshColors, legendColors; plug-in component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
glareanalysis = Honeybee_GlareAnalysis(HDRImagePath=rundaylightanalysis.resultFiles, runIt=Toggle(True))  # -> readMe, glareCheckImage, DGP, DGI, imageWithTaskArea; plug-in component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
falsecolor = Honeybee_FalseColor(
    HDRFilePath=rundaylightanalysis.resultFiles,
    contourBands=False,
    maskThreshold=0.1,
    useAlterColors=False,
    render=Toggle(True))  # -> outputFilePath; plug-in component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
importdgp = Honeybee_ImportDgpFile()  # -> viewPoints, viewDirections, dgpValues; plug-in component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
# DGP: Daylight glare probability:
# Imperceptible Glare [0.35 > DGP]
# Perceptible Glare [0.4 > DGP >= 0.35]
# Disturbing Glare [0.45 > DGP >= 0.4]
# Intolerable Glare [DGP >= 0.45]
panel_6 = Panel(glareanalysis.DGP)
hdr_tif = Honeybee_ConvertHDRToTIF(HDRFilePath=falsecolor, adjustExposure=False)  # -> TIFFFilePath; plug-in component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
hdr_tif_2 = Honeybee_ConvertHDRToTIF(HDRFilePath=glareanalysis.glareCheckImage, adjustExposure=Toggle(False))  # -> TIFFFilePath; plug-in component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
number_slider_3 = Slider(0.8, range=0..1)
image = ImageFromPath(P=hdr_tif_2, S=number_slider_3)
image_2 = ImageFromPath(P=hdr_tif, S=number_slider_3)

pt_2 = Point(Point(3, 2.544838682, 0.1224289629))
# set the view
comfortmannequin = Ladybug_ComfortMannequin(rotationAngle="175", bodyLocation=pt_2)  # -> mannequinMesh, legend, legendBasePt; plug-in component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

# ---- group: Person's face!
item = ListItem(List=comfortmannequin.mannequinMesh, Index=121, Wrap=True)

# ----
preview = CustomPreview(Geometry=item, Shader=ColourSwatch(SwatchColor=RGB(255, 0, 0)))

facen = FaceNormals(Mesh=item)  # -> Centers, Normals
settheview = Ladybug_SetTheView(cameraLocation=facen.Centers, cameraDirection=facen.Normals, uvLookAround=md_slider)  # -> readMe; plug-in component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
