# Grasshopper definition Seung Bae (general).gh (Grasshopper 0.9.76)
# plug-ins: Python Interpreter

updateladybug = Ladybug_UpdateLadybug(updateThisFile=Toggle(True), updateAllUObjects=Toggle(True))  # -> readMe; plug-in component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
updatehoneybee = Honeybee_UpdateHoneybee(updateThisFile=Toggle(True), updateAllUObjects=Toggle(True))  # -> readMe; plug-in component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
ladybug = Ladybug_Ladybug(defaultFolder="c:\ladybug")  # -> Vviiiiiiiiiizzz; plug-in component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
honeybee = Honeybee_Honeybee(defaultFolder="c:\ladybug")  # -> Vviiiiiiiiiizzz; plug-in component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
panel = Panel("""Honeybee
Energy
Daylighting
EnergyPlus
Daysim
Radiance
HBExampleFiles""")
panel_2 = Panel([ladybug, honeybee])
panel_3 = Panel("This is an example that shows how to integrate results of daylighting simulation with an energy simulation")
exterior_wall = Brep(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)
wall_surface_with_opening = Brep(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)
exporthydra = Hydra_ExportFile(
    fileName="Integrated_Daylight_and_Energy_similation",
    fileDescription=panel_3,
    fileTags=panel,
    targetFolder="C:\Users\Administrator\Documents\GitHub\hydra_1",
    export=Toggle(False))  # -> readMe; inputs fileDescription: list, changeLog: list, fileTags: list, includeRhino: Boolean, GHForThumb: Boolean, additionalImgs: list, export: Boolean; plug-in component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

# ---- group: ceiling
ceiling = Brep([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])

# ----
ledge = Brep(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)

# ---- group: floor
floor = Brep(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)

# ----
walls = Brep([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])
shading = Brep([<brep referenced from the Rhino model> x10])
createhbsrfs = Honeybee_createHBSrfs(geometry=shading, srfType="6")  # -> readMe, simplify(HBSurface); plug-in component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
createhbsrfs_2 = Honeybee_createHBSrfs(geometry=flatten(floor), srfType="2")  # -> readMe, simplify(HBSurface); plug-in component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
createhbsrfs_3 = Honeybee_createHBSrfs(geometry=flatten(ledge), srfType="2")  # -> readMe, simplify(HBSurface); plug-in component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
createhbsrfs_4 = Honeybee_createHBSrfs(geometry=flatten(exterior_wall), srfType="0")  # -> readMe, simplify(HBSurface); plug-in component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
createhbsrfs_5 = Honeybee_createHBSrfs(geometry=ceiling, srfType="3")  # -> readMe, simplify(HBSurface); plug-in component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
# Geometry Preparation
createhbsrfs_6 = Honeybee_createHBSrfs(geometry=walls, srfType="0")  # -> readMe, simplify(HBSurface); plug-in component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
createhbsrfs_7 = Honeybee_createHBSrfs(geometry=wall_surface_with_opening, srfType="0")  # -> readMe, simplify(HBSurface); plug-in component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
bldgprograms = Honeybee_bldgPrograms({"Office": 0, "Retail": 1, "MidriseApartment": 2, "PrimarySchool": 3, "SecondarySchool": 4, "SmallHotel": 5, "LargeHotel": 6, "Hospital": 7, "Outpatient": 8, "Warehouse": 9, "SuperMarket": 10, "FullServiceRestaurant": 11, "QuickServiceRestaurant": 12}, selected="MidriseApartment")
glass = Brep(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)

# ---- group: Make all surfaces except the exterior wall adiabatic
# Honeybee default materials will be assigned
# based on surface type
makeadiabatic = Honeybee_MakeAdiabatic(HBSrfs=flatten([createhbsrfs_6.HBSurface, createhbsrfs_5.HBSurface, createhbsrfs_2.HBSurface]))  # -> HBSrfs; plug-in component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

# ----
preview = CustomPreview(Geometry=glass, Shader=ColourSwatch(SwatchColor=RGBA(80, 222, 255, 160)))
addhbglz = Honeybee_addHBGlz(HBObj=createhbsrfs_7.HBSurface, childSurfaces=flatten(glass))  # -> simplify(HBObjWGLZ); plug-in component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

# ---- group: collect all honeybee surfaces
brep = Brep(flatten([makeadiabatic, addhbglz, createhbsrfs_3.HBSurface, createhbsrfs_4.HBSurface, createhbsrfs.HBSurface]))

# ----
listzoneprograms = Honeybee_ListZonePrograms(bldgProgram=bldgprograms)  # -> MidriseApartmentZonePrograms; plug-in component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
item = ListItem(List=listzoneprograms, Index=0, Wrap=True)

panel_4 = Panel("http://apps1.eere.energy.gov/buildings/energyplus/weatherdata/5_southwest_pacific_wmo_region_5/MYS_Kuala.Lumpur.486470_IWEC.zip")
number_slider = Slider(45, range=0..360)
open_epw_stat = Ladybug_OpenEPWAndSTATWeatherFiles(weatherFileURL=panel_4)  # -> epwFile, statFile; plug-in component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
northarrow = Ladybug_North(north=number_slider, scale=".05")  # -> northSign; plug-in component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

createhbzones = Honeybee_createHBZones(name="test_room", zoneProgram=item, HBSurfaces=flatten(brep), isConditioned=Toggle(False))  # -> readMe, HBZone; plug-in component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
panel_5 = Panel(item)
wires = BrepWireframe(Brep=createhbzones.HBZone, Density=-1)
flip = Flip(Surface=floor)  # -> Surface, Result
radparameters = Honeybee_RADParameters(quality=0)  # -> readMe, radParameters; plug-in component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
gentestpts = Honeybee_GenerateTestPoints(testGeometry=flip.Surface, gridSize=".5", distBaseSrf=".762", moveTestMesh=True)  # -> readMe, simplify(testPoints), simplify(ptsVectors), simplify(facesArea), simplify(mesh); plug-in component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
importepw = Ladybug_ImportEpw(epwFile=open_epw_stat.epwFile)  # -> readMe, latitude, location, dryBulbTemperature, dewPointTemperature, relativeHumidity, windSpeed, windDirection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; plug-in component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
item_2 = ListItem(List=gentestpts.testPoints, Index="58", Wrap=True)
# Run Annual Daylight
toggle = BooleanToggle(False)
annualdaylightsimulation = Honeybee_AnnualDaylightSimulation(
    north=number_slider,
    epwWeatherFile=open_epw_stat.epwFile,
    testPoints=gentestpts.testPoints,
    ptsVectors=gentestpts.ptsVectors,
    testMesh=gentestpts.mesh,
    radParameters=radparameters.radParameters)  # -> analysisRecipe; plug-in component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
sph = Sphere(Base=item_2, Radius=Slider(1, range=0..136))
rundaylightanalysis = Honeybee_RunDaylightSimulation(
    HBObjects=flatten(createhbzones.HBZone),
    analysisRecipe=annualdaylightsimulation,
    writeRad=toggle,
    runRad=toggle,
    numOfCPUs=Slider(3, range=0..10),
    overwriteResults=True)  # -> readMe, analysisType, resultsUnit, results, testPts, resultFiles, radGeoFile, studyFolder, done; plug-in component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
lightingcontrol = Honeybee_LightingControlRecipe(
    controlType="4",
    sensorPoints=item_2,
    lightingPower=250,
    lightingSetpoint=300,
    ballastLossFactor=20,
    standbyPower=3,
    delayTime=5)  # -> lightingControlGroup; plug-in component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
occupancygenerator = Honeybee_DaysimOccupancyGenerator(weekendDays=[1, 2], writeTheOcc=Toggle(True))  # -> occupancyFile; plug-in component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
gethbzoneepschedules = Honeybee_GetZoneEnergyPlusSchedules(HBZone=createhbzones.HBZone)  # -> occupancySchedule, occupancyActivitySch, heatingSetPtSchedule, coolingSetPtSchedule, lightingSchedule, equipmentSchedule, infiltrationSchedule; plug-in component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
panel_6 = Panel(occupancygenerator)
# Generate lighting Schedule
readannualresultsi = Honeybee_ReadAnnualResultI(
    illFilesAddress=rundaylightanalysis.resultFiles,
    testPoints=simplify(rundaylightanalysis.testPts),
    occupancyFiles=occupancygenerator,
    DLAIllumThresholds=300,
    lightingControlGroups=lightingcontrol,
    runIt=Toggle(True))  # -> DLA, UDLI_Less_100, UDLI_100_2000, UDLI_More_2000, CDA, sDA, annualProfiles, htmReport; plug-in component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

# ---- group: just for visualization
# Compare Schedules!
dsannualprofiles = Honeybee_DaysimAnnualProfiles(annualProfiles=readannualresultsi.annualProfiles)  # -> simplify(occupancyProfile), simplify(shadingProfiles), simplify(lightingControlProfiles), simplify(dgpProfile); plug-in component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
convertepschvalues = Honeybee_ConvertEnergyPlusScheduleToValues(schName=gethbzoneepschedules.lightingSchedule)  # -> values; plug-in component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
_3dchart = Ladybug_3DChart(inputData=flatten([convertepschvalues, dsannualprofiles.lightingControlProfiles]))  # -> readMe, graphMesh, graphCurves, legend, legendBasePts, title, titleBasePts, dataPts, conditionalHOY; plug-in component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

# ----
gradientlibrary = Ladybug_GradientLibrary(gradIndex=Slider(1, range=0..1))  # -> customColors; plug-in component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
# update lighting schedule
setepzoneschedules = Honeybee_SetEnergyPlusZoneSchedules(HBZones=createhbzones.HBZone, lightingSchedules=readannualresultsi.annualProfiles)  # -> schedules, simplify(HBZones); plug-in component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
toggle_2 = BooleanToggle(False)
pt = Point(<point referenced from the Rhino model>)
epoutput = Honeybee_GenerateEPOutput(
    zoneEnergyUse=toggle_2,
    zoneGainsAndLosses=toggle_2,
    zoneComfortMetrics=toggle_2,
    surfaceTempAnalysis="False",
    timestep="hourly")  # -> report, flatten(simulationOutputs); plug-in component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
legendpar = Ladybug_LegendParameters(lowBound="0", highBound="100", customColors=flatten(gradientlibrary), legendLocation=pt)  # -> legendPar; plug-in component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
toggle_3 = BooleanToggle(False)
concat = Concatenate(FragmentA=rundaylightanalysis.analysisType, FragmentB="(sDA:", FragmentC=readannualresultsi.sDA, FragmentD=")")
panel_7 = Panel(concat)
dom = ConstructDomain(DomainStart=0, DomainEnd=Slider(1, range=0..1))
# Run the analysis
runenergysimulation = Honeybee_RunEnergySimulation(
    north=number_slider,
    epwFile=open_epw_stat.epwFile,
    HBZones=flatten(setepzoneschedules.HBZones),
    simulationOutputs=flatten(epoutput.simulationOutputs),
    writeIdf=toggle_3,
    runEnergyPlus=toggle_3)  # -> report, idfFileAddress, resultFileAddress; plug-in component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
readepresult = Honeybee_ReadEPResult(resultFileAddress=runenergysimulation.resultFileAddress)  # -> totalThermalEnergy, thermalEnergyBalance, cooling, heating, electricLight, electricEquip, fanElectric, pumpElectric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; plug-in component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
recolormesh = Ladybug_RecolorMesh(
    analysisResult=readannualresultsi.DLA,
    inputMesh=gentestpts.mesh,
    heightDomain=dom,
    legendPar=legendpar,
    analysisTitle=concat,
    legendTitle="%")  # -> readMe, newMesh, newLegend, legendBasePt, meshColors, legendColors; plug-in component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
selectandaveragedata = Ladybug_AverageData(annualHourlyData=readepresult.totalSolarGain, totalOrAverage=1)  # -> readMe, selHourlyData, totaledDaily, totaledMonthly, totMonthlyPerHour, totAnalysisPeriod; plug-in component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
separatedata = Ladybug_SeparateData(inputList=flatten(readepresult.cooling))  # -> numbers, strings; plug-in component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
separatedata_2 = Ladybug_SeparateData(inputList=flatten(readepresult.heating))  # -> numbers, strings; plug-in component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
# Run the analysis
panel_8 = Panel(selectandaveragedata.totAnalysisPeriod)

col = Colour([ColourSwatch(SwatchColor=RGB(0, 125, 178)), ColourSwatch(SwatchColor=RGB(255, 0, 0)), ColourSwatch(SwatchColor=RGB(255, 217, 0))])

panel_9 = Panel("""Cooling, Heating
& Lighting Loads""")
ma = MassAddition(Input=separatedata.numbers)  # -> Result, PartialResults
ma_2 = MassAddition(Input=separatedata_2.numbers)  # -> Result, PartialResults
legendpar_2 = Ladybug_LegendParameters(lowBound=Slider(0, range=0..100), highBound=Slider(3000, range=0..10000), customColors=flatten(col))  # -> legendPar; plug-in component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
total_cooling = Panel(ma.Result)
total_heating = Panel(ma_2.Result)
barchart = Ladybug_MonthlyBarChart(
    inputData=flatten(readepresult.electricLight),
    altYAxisTitle=panel_9,
    basePoint="20, 0, 0",
    xScale=Slider(0.5, range=0..1),
    yScale=Slider(0.7, range=0..1),
    legendPar=legendpar_2)  # -> readMe, dataMesh, dataCurves, dataCrvColors, graphAxes, graphLabels, title, titleBasePt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; plug-in component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
legendpar_3 = Ladybug_LegendParameters(lowBound="-3", highBound="3")  # -> legendPar; plug-in component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
pt_2 = Point(<point referenced from the Rhino model>)
legendpar_4 = Ladybug_LegendParameters(lowBound="-1", highBound="1")  # -> legendPar; plug-in component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

toggle_4 = BooleanToggle(False)

adaptivecomfortcalculator = Ladybug_AdaptiveComfortCalculator(
    dryBulbTemperature=readepresult.airTemperature,
    meanRadiantTemperature=readepresult.meanRadTemperature,
    prevailingOutdoorTemp=importepw.dryBulbTemperature,
    runIt=toggle_4)  # -> readMe, port, comfortableOrNot, conditionOfPerson, degreesFromTarget, port_2, targetTemperature, upperTemperatureBound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; plug-in component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
panel_10 = Panel("Adaptive")

pmvcomfortcalculator = Ladybug_PMVComfortCalculator(
    dryBulbTemperature=readepresult.airTemperature,
    meanRadiantTemperature=readepresult.meanRadTemperature,
    relativeHumidity=readepresult.relativeHumidity,
    calcBalanceTemperature=False,
    runIt=toggle_4)  # -> readMe, port, predictedMeanVote, percentPeopleDissatisfied, standardEffectiveTemperature, port_2, comfortableOrNot, percentOfTimeComfortable, port_3, balanceTemperature; plug-in component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
panel_11 = Panel(pmvcomfortcalculator.percentOfTimeComfortable)
panel_12 = Panel("PMV")

_3dchart_2 = Ladybug_3DChart(
    inputData=flatten(adaptivecomfortcalculator.conditionOfPerson),
    basePoint=pt_2,
    xScale=".25",
    zScale="0",
    legendPar=legendpar_4)  # -> readMe, graphMesh, graphCurves, legend, legendBasePts, title, titleBasePts, dataPts, conditionalHOY; plug-in component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
_3dchart_3 = Ladybug_3DChart(inputData=flatten(pmvcomfortcalculator.predictedMeanVote), xScale=".25", zScale="0", legendPar=legendpar_3)  # -> readMe, graphMesh, graphCurves, legend, legendBasePts, title, titleBasePts, dataPts, conditionalHOY; plug-in component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

panel_13 = Panel(adaptivecomfortcalculator.percentOfTimeComfortable)
preview_2 = CustomPreview(
    Geometry=[_3dchart_2.graphCurves, _3dchart_2.legend, _3dchart_3.graphCurves, _3dchart_3.legend],
    Shader=ColourSwatch(SwatchColor=RGB(0, 0, 0)))
