# Grasshopper definition Benghi_Niccolo_energy simulation_integrated.gh (Grasshopper 0.9.76)
# plug-ins: Python Interpreter

panel = Panel("""Honeybee
Energy
Daylighting
EnergyPlus
Daysim
Radiance""")
ladybug = Ladybug_Ladybug()  # -> Vviiiiiiiiiizzz; plug-in component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
honeybee = Honeybee_Honeybee()  # -> Vviiiiiiiiiizzz; plug-in component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
panel_2 = Panel("This is an example that shows how to integrate results of daylighting simulation with an energy simulation")

# ---- group: floor
floor = Brep(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)

# ----
ledge = Brep(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)

# ---- group: ceiling
ceiling = Brep([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])

# ----
walls = Brep([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])
wall_surface_with_opening = Brep(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)
exporthydra = Hydra_ExportFile(
    fileName="Integrated_Daylight_and_Energy_similation",
    fileDescription=panel_2,
    fileTags=panel,
    targetFolder="C:\Users\Administrator\Documents\GitHub\hydra_1",
    export=Toggle(False))  # -> readMe; inputs fileDescription: list, changeLog: list, fileTags: list, includeRhino: Boolean, GHForThumb: Boolean, additionalImgs: list, export: Boolean; plug-in component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
# Geometry Preparation
panel_3 = Panel("0")
createhbsrfs = Honeybee_createHBSrfs(geometry=flatten([floor, ledge]), srfType="2")  # -> readMe, simplify(HBSurface); plug-in component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
createhbsrfs_2 = Honeybee_createHBSrfs(geometry=ceiling, srfType="3")  # -> readMe, simplify(HBSurface); plug-in component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
createhbsrfs_3 = Honeybee_createHBSrfs(geometry=wall_surface_with_opening, srfType="0")  # -> readMe, simplify(HBSurface); plug-in component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
# Honeybee default materials will be assigned
# based on surface type
createhbsrfs_4 = Honeybee_createHBSrfs(geometry=walls, srfType=panel_3)  # -> readMe, simplify(HBSurface); plug-in component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
glass = Brep(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)
preview = CustomPreview(Geometry=glass, Shader=ColourSwatch(SwatchColor=RGBA(80, 222, 255, 160)))
glazingcreator = Honeybee_GlazingBasedOnRatio(
    HBObjects=createhbsrfs_3.HBSurface,
    glzRatio=Slider(0.4, range=0..1),
    windowHeight=Slider(1.8, range=0..10),
    sillHeight=Slider(0.1, range=0..1),
    runIt=Toggle(True))  # -> readMe, HBObjWGLZ; plug-in component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
addhbglz = Honeybee_addHBGlz(HBObj=createhbsrfs_3.HBSurface, childSurfaces=flatten(glass))  # -> simplify(HBObjWGLZ); plug-in component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

# ---- group: Make all surfaces except the facade with window adiabatic
makeadiabatic = Honeybee_MakeAdiabatic(HBSrfs=flatten([createhbsrfs_4.HBSurface, createhbsrfs_2.HBSurface, createhbsrfs.HBSurface]))  # -> HBSrfs; plug-in component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

# ----
bldgprograms = Honeybee_bldgPrograms({"Office": 0, "Retail": 1, "MidriseApartment": 2, "PrimarySchool": 3, "SecondarySchool": 4, "SmallHotel": 5, "LargeHotel": 6, "Hospital": 7, "Outpatient": 8, "Warehouse": 9, "SuperMarket": 10, "FullServiceRestaurant": 11, "QuickServiceRestaurant": 12}, selected="MidriseApartment")
listzoneprograms = Honeybee_ListZonePrograms(bldgProgram=bldgprograms)  # -> MidriseApartmentZonePrograms; plug-in component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
item = ListItem(List=listzoneprograms, Index=0, Wrap=True)

# ---- group: collect all honeybee surfaces
brep = Brep(flatten([makeadiabatic, addhbglz]))

# ----
panel_4 = Panel(item)
createhbzones = Honeybee_createHBZones(name="test_room", zoneProgram=item, HBSurfaces=flatten(brep), isConditioned=True)  # -> readMe, HBZone; plug-in component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

number_slider = Slider(45, range=0..100)
panel_5 = Panel("http://apps1.eere.energy.gov/buildings/energyplus/weatherdata/4_north_and_central_america_wmo_region_4/1_usa/USA_PA_Philadelphia.Intl.AP.724080_TMY3.zip")
open_epw_stat = Ladybug_OpenEPWAndSTATWeatherFiles(weatherFileURL=panel_5)  # -> epwFile, statFile; plug-in component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
northarrow = Ladybug_North(north=number_slider, scale=".05")  # -> northSign; plug-in component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

wires = BrepWireframe(Brep=createhbzones.HBZone, Density=-1)
flip = Flip(Surface=floor)  # -> Surface, Result
gentestpts = Honeybee_GenerateTestPoints(testSurface=flip.Surface, gridSize=".5", distBaseSrf=".762", moveTestMesh=True)  # -> readMe, simplify(testPoints), simplify(ptsVectors), simplify(facesArea), simplify(mesh); plug-in component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
radparameters = Honeybee_RADParameters(quality=0)  # -> readMe, radParameters; plug-in component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
annualdaylightsimulation = Honeybee_AnnualDaylightSimulation(
    north=number_slider,
    epwWeatherFile=open_epw_stat.epwFile,
    testPoints=gentestpts.testPoints,
    ptsVectors=gentestpts.ptsVectors,
    testMesh=gentestpts.mesh,
    radParameters=radparameters.radParameters)  # -> analysisRecipe; plug-in component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
# Run Annual Daylight
toggle = BooleanToggle(False)
rundaylightanalysis = Honeybee_RunDaylightSimulation(
    HBObjects=flatten(createhbzones.HBZone),
    analysisRecipe=annualdaylightsimulation,
    writeRad=toggle,
    runRad=toggle,
    numOfCPUs=Slider(3, range=0..10),
    overwriteResults=True)  # -> readMe, analysisType, resultsUnit, results, testPts, resultFiles, radGeoFile, studyFolder, done; plug-in component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
gethbzoneepschedules = Honeybee_GetZoneEnergyPlusSchedules(HBZone=createhbzones.HBZone)  # -> occupancySchedule, occupancyActivitySch, heatingSetPtSchedule, coolingSetPtSchedule, lightingSchedule, equipmentSchedule, infiltrationSchedule; plug-in component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
# Generate lighting Schedule
readannualresultsi = Honeybee_ReadAnnualResultI(
    illFilesAddress=rundaylightanalysis.resultFiles,
    testPoints=simplify(rundaylightanalysis.testPts),
    occupancyFiles=gethbzoneepschedules.lightingSchedule,
    DLAIllumThresholds=300,
    runIt=Toggle(True))  # -> DLA, UDLI_Less_100, UDLI_100_2000, UDLI_More_2000, CDA, sDA, annualProfiles, htmReport; plug-in component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
panel_6 = Panel(readannualresultsi.sDA)

# ---- group: just for visualization
# Compare Schedules!
dsannualprofiles = Honeybee_DaysimAnnualProfiles(annualProfiles=readannualresultsi.annualProfiles)  # -> simplify(occupancyProfile), simplify(shadingProfiles), simplify(lightingControlProfiles), simplify(dgpProfile); plug-in component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
convertepschvalues = Honeybee_ConvertEnergyPlusScheduleToValues(schName=gethbzoneepschedules.lightingSchedule)  # -> values; plug-in component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
_3dchart = Ladybug_3DChart(inputData=flatten([convertepschvalues, dsannualprofiles.lightingControlProfiles]))  # -> readMe, graphMesh, graphCurves, legend, legendBasePts, title, titleBasePts, dataPts, conditionalHOY; plug-in component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

# ----
# update lighting schedule
setepzoneschedules = Honeybee_SetEnergyPlusZoneSchedules(HBZones=createhbzones.HBZone, lightingSchedules=readannualresultsi.annualProfiles)  # -> schedules, simplify(HBZones); plug-in component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

# ---- group: make it 3D!
dom = ConstructDomain(DomainStart=0, DomainEnd=Slider(1, range=0..1))

# ----
epoutput = Honeybee_GenerateEPOutput(
    zoneEnergyUse=Toggle(True),
    zoneGainsAndLosses="False",
    zoneComfortMetrics="False",
    surfaceTempAnalysis="False",
    timestep="monthly")  # -> report, flatten(simulationOutputs); plug-in component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
toggle_2 = BooleanToggle(False)
gradientlibrary = Ladybug_GradientLibrary(gradIndex=Slider(1, range=0..10))  # -> customColors; plug-in component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
# Run the analysis
runenergysimulation = Honeybee_RunEnergySimulation(
    north=number_slider,
    epwFile=open_epw_stat.epwFile,
    HBZones=flatten(setepzoneschedules.HBZones),
    simulationOutputs=flatten(epoutput.simulationOutputs),
    writeIdf=toggle_2,
    runEnergyPlus=toggle_2)  # -> report, idfFileAddress, resultFileAddress; plug-in component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
legendpar = Ladybug_LegendParameters(
    lowBound=Slider(0, range=0..100),
    highBound=Slider(100, range=0..100),
    numSegments=Slider(6, range=0..10),
    customColors=flatten(gradientlibrary))  # -> legendPar; plug-in component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
readepresult = Honeybee_ReadEPResult(resultFileAddress=runenergysimulation.resultFileAddress)  # -> totalThermalEnergy, thermalEnergyBalance, cooling, heating, electricLight, electricEquip, fanElectric, pumpElectric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; plug-in component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
concat = Concatenate(FragmentB="sda:")
recolormesh = Ladybug_ReColorMesh(
    analysisResult=readannualresultsi.DLA,
    inputMesh=gentestpts.mesh,
    heightDomain=dom,
    legendPar=legendpar,
    analysisTitle=concat,
    legendTitle="%")  # -> readMe, newMesh, newLegend, legendBasePt, meshColors, legendColors; plug-in component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
separatedata = Ladybug_SeparateData(inputList=flatten(readepresult.electricLight))  # -> numbers, strings; plug-in component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
panel_7 = Panel("""Cooling, Heating
& Lighting Loads""")
panel_8 = Panel(readepresult.electricLight)
separatedata_2 = Ladybug_SeparateData(inputList=flatten(readepresult.cooling))  # -> numbers, strings; plug-in component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
separatedata_3 = Ladybug_SeparateData(inputList=flatten(readepresult.heating))  # -> numbers, strings; plug-in component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
ma = MassAddition(Input=separatedata.numbers)  # -> Result, PartialResults
barchart = Ladybug_MonthlyBarChart(
    inputData=flatten([readepresult.cooling, readepresult.electricLight, readepresult.heating]),
    altYAxisTitle=panel_7,
    basePoint="20, 0, 0",
    xScale=Slider(0.5, range=0..1),
    yScale=Slider(0.7, range=0..1))  # -> readMe, dataMesh, dataCurves, dataCrvColors, graphAxes, graphLabels, title, titleBasePt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; plug-in component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
ma_2 = MassAddition(Input=separatedata_2.numbers)  # -> Result, PartialResults
ma_3 = MassAddition(Input=separatedata_3.numbers)  # -> Result, PartialResults
total_cooling = Panel(ma.Result)
total_cooling_2 = Panel(ma_2.Result)
total_heating = Panel(ma_3.Result)
ma_4 = MassAddition(Input=[total_cooling_2, total_heating])  # -> Result, PartialResults
panel_9 = Panel(ma_4.Result)

# ---- group: SHADING
number_slider_2 = Slider(2, range=0..10)
number_slider_3 = Slider(3, range=0..10)
number_slider_4 = Slider(2, range=0..10)
number_slider_5 = Slider(2, range=0..10)
number_slider_6 = Slider(-55, range=-90..90)
number_slider_7 = Slider(-80, range=-90..90)
number_slider_8 = Slider(-46, range=-90..90)
bottom_edge = Curve(<curve referenced from the Rhino model>)
bottom_edge_2 = Curve(<curve referenced from the Rhino model>)
bottom_edge_3 = Curve(<curve referenced from the Rhino model>)
number_slider_9 = Slider(-35, range=-90..90)
bottom_edge_4 = Curve(<curve referenced from the Rhino model>)
top_edge = Curve(<curve referenced from the Rhino model>)
top_edge_2 = Curve(<curve referenced from the Rhino model>)
top_edge_3 = Curve(<curve referenced from the Rhino model>)
top_edge_4 = Curve(<curve referenced from the Rhino model>)
flip_2 = FlipCurve(Curve=top_edge_2)  # -> Curve, Flag
flip_3 = FlipCurve(Curve=top_edge)  # -> Curve, Flag
flip_4 = FlipCurve(Curve=top_edge_3)  # -> Curve, Flag
flip_5 = FlipCurve(Curve=top_edge_4)  # -> Curve, Flag

# ---- group: SHADING / HORIZ
louvers = LOUVERS(top_edge=flip_3.Curve, number_of_louvers=number_slider_2, bottom_edge=bottom_edge, rotation_angle=number_slider_6)  # -> G, panel_2

# ---- group: SHADING / VERT
louvers_2 = LOUVERS(top_edge=flip_2.Curve, number_of_louvers=number_slider_3, bottom_edge=bottom_edge_2, rotation_angle=number_slider_7)  # -> G, panel_2

# ---- group: SHADING / HORIZ
louvers_3 = LOUVERS(top_edge=flip_4.Curve, number_of_louvers=number_slider_4, bottom_edge=bottom_edge_3, rotation_angle=number_slider_8)  # -> G, panel_2

louvers_4 = LOUVERS(top_edge=flip_5.Curve, number_of_louvers=number_slider_5, bottom_edge=bottom_edge_4, rotation_angle=number_slider_9)  # -> G, panel_2

# ---- group: SHADING (continued)
distance_between_louvers = Data(louvers.panel_2)
distance_between_louvers_2 = Data(louvers_2.panel_2)
distance_between_louvers_3 = Data(louvers_3.panel_2)
distance_between_louvers_4 = Data(louvers_4.panel_2)
louvers_5 = Data(louvers.G)
louvers_6 = Data(louvers_2.G)
louvers_7 = Data(louvers_3.G)
louvers_8 = Data(louvers_4.G)
panel_10 = Panel(distance_between_louvers)
panel_11 = Panel(distance_between_louvers_2)
panel_12 = Panel(distance_between_louvers_3)
panel_13 = Panel(distance_between_louvers_4)
hb_epcontextsrf = HoneybeeEPContextSurfaces(shdSurfaces=flatten([louvers_6, louvers_5, louvers_7, louvers_8]))  # -> HBContext; inputs shdSurfaces: list of GeometryBase, justBoundingBox: Boolean
# ---------- hb_epcontextsrf: Python ----------
"""
prepare shading/context geometries

    Args:
        northVectorOrRotation: A vector that shows North or a number that shows
                               the rotation of the North from the Y axis
        bldgMasses: List of closed Breps as thermal zones.
    Returns:
        report: ...
        thermalZones: Thermal zone's geometries for visualiza
"""

ghenv.Component.Name = 'Honeybee EP context Surfaces'
ghenv.Component.NickName = 'HB_EPContextSrf'
ghenv.Component.Message = 'VER 0.0.58\nNOV_05_2015'
ghenv.Component.Category = "Honeybee"
ghenv.Component.SubCategory = "09 | Energy | Energy"
#compatibleHBVersion = VER 0.0.57\nNOV_01_2015
#compatibleLBVersion = VER 0.0.59\nFEB_01_2015
ghenv.Component.AdditionalHelpFromDocStrings = "2"

import rhinoscriptsyntax as rs
import Rhino as rc
import scriptcontext as sc
import os
import System
import Grasshopper.Kernel as gh
import uuid

tolerance = sc.doc.ModelAbsoluteTolerance
import math


def main(shdSurfaces, EPTransSchedule, meshingSettings, justBoundingBox):
    
    # import the classes
    if sc.sticky.has_key('honeybee_release'):

        try:
            if not sc.sticky['honeybee_release'].isCompatible(ghenv.Component): return -1
        except:
            warning = "You need a newer version of Honeybee to use this compoent." + \
            " Use updateHoneybee component to update userObjects.\n" + \
            "If you have already updated userObjects drag Honeybee_Honeybee component " + \
            "into canvas and try again."
            w = gh.GH_RuntimeMessageLevel.Warning
            ghenv.Component.AddRuntimeMessage(w, warning)
            return -1
        
        # don't customize this part
        hb_EPSrf = sc.sticky["honeybee_EPSurface"]
        hb_EPSHDSurface = sc.sticky["honeybee_EPShdSurface"]
        hb_RADMaterialAUX = sc.sticky["honeybee_RADMaterialAUX"]
        hb_EPObjectsAux = sc.sticky["honeybee_EPObjectsAUX"]()
        HBScheduleList = sc.sticky["honeybee_ScheduleLib"].keys()

        ########################################################################
        #----------------------------------------------------------------------#
        shdBreps = []
        # create bounding box of shading geometries
        if justBoundingBox:
            for brep in shdSurfaces:
                if brep.Faces.Count>1 or not brep.Faces[0].IsPlanar(sc.doc.ModelAbsoluteTolerance):
                    shdBreps.append(brep.GetBoundingBox(True).ToBrep())
                else:
                    shdBreps.append(brep)
        else: shdBreps = shdSurfaces
        
        shadingClasses = []
        shadingMeshPreview = []
        
        if meshingSettings == None:
            mp = rc.Geometry.MeshingParameters.Minimal
            mp.SimplePlanes = True
        else:
            mp = meshingSettings
        
        def getRadMaterialName(radMaterial):
            nameStr = radMaterial.split(" ")[2]
            name =  nameStr.split("\n")[0]
            return name
        
        for brepCount, brep in enumerate(shdBreps):
            if brep != None:
                #if len(brep.DuplicateEdgeCurves(False))>1:
                
                meshArray = rc.Geometry.Mesh.CreateFromBrep(brep, mp)
                for mesh in meshArray:
                    for meshFace in range(mesh.Faces.Count):
                        vertices = list(mesh.Faces.GetFaceVertices(meshFace))[1:]
                        vertices = vertices + [sc.doc.ModelAbsoluteTolerance]
                        # create the brep from mesh
                        shdBrep = rc.Geometry.Brep.CreateFromCornerPoints(*vertices)
                        
                        thisShading = hb_EPSHDSurface(shdBrep, 1000*brepCount + meshFace, 'shdSrf_' + `brepCount` + '_' + `meshFace` + "_" + str(uuid.uuid4()))
                        
                        # add transmittance schedule if any
                        if EPTransSchedule!=None:
                            schedule= EPTransSchedule.upper()
                            if schedule!=None and not schedule.lower().endswith(".csv") and schedule not in HBScheduleList:
                                msg = "Cannot find " + schedule + " in Honeybee schedule library."
                                print msg
                                ghenv.Component.AddRuntimeMessage(gh.GH_RuntimeMessageLevel.Warning, msg)
                                return -1
                            elif schedule!=None and schedule.lower().endswith(".csv"):
                                # check if csv file is existed
                                if not os.path.isfile(schedule):
                                    msg = "Cannot find the shchedule file: " + schedule
                                    print msg
                                    ghenv.Component.AddRuntimeMessage(gh.GH_RuntimeMessageLevel.Warning, msg)
                                    return -1
                            
                            thisShading.TransmittanceSCH = schedule
                        
                        # add the Rad Material if any
                        if RADMaterial!=None:
                            # if it is just the name of the material make sure it is already defined
                            if len(RADMaterial.split(" ")) == 1:
                                # if the material is not in the library add it to the library
                                if not hb_RADMaterialAUX.isMatrialExistInLibrary(RADMaterial):
                                    warningMsg = "Can't find " + RADMaterial + " in RAD Material Library.\n" + \
                                                "Add the material to the library and try again."
                                    ghenv.Component.AddRuntimeMessage(gh.GH_RuntimeMessageLevel.Warning, warningMsg)
                                    return
                                
                                try:
                                    thisShading.setRADMaterial(RADMaterial)
                                except Exception, e:
                                    print e
                                    warningMsg = "You are using an old version of Honeybee_Honeybee! Update your files and try again."
                                    print warningMsg
                                    ghenv.Component.AddRuntimeMessage(gh.GH_RuntimeMessageLevel.Warning, warningMsg)
                                    return
                                
                                addedToLib = True
                            else:
                                
                                # try to add the material to the library
                                addedToLib, thisShading.RadMaterial = hb_RADMaterialAUX.analyseRadMaterials(RADMaterial, True)
                                
                            if addedToLib==False:
                                warningMsg = "Failed to add " + RADMaterial + " to the Library."
                                ghenv.Component.AddRuntimeMessage(gh.GH_RuntimeMessageLevel.Warning, warningMsg)
                                return
                        
                        # add shading to the list
                        shadingClasses.append(thisShading)
                
        # add to the hive
        hb_hive = sc.sticky["honeybee_Hive"]()
        HBContext  = hb_hive.addToHoneybeeHive(shadingClasses, ghenv.Component.InstanceGuid.ToString())
        return HBContext
        ################################################################################################
    else:
        print "You should first let Honeybee to fly..."
        w = gh.GH_RuntimeMessageLevel.Warning
        ghenv.Component.AddRuntimeMessage(w, "You should first let Honeybee to fly...")
        return -1
        

if _shdSurfaces and _shdSurfaces[0]!=None:
    # add cleaning function
    result= main(_shdSurfaces, EPTransSchedule_, meshingSettings_, justBoundingBox_)
    
    if result != -1: HBContext = result
# ---------- end hb_epcontextsrf ----------

# ==== cluster LOUVERS
bottom_edge = ClusterInput()
top_edge = ClusterInput()
top_edge_2 = Data(top_edge)
bottom_edge_2 = Data(bottom_edge)
number_of_louvers = ClusterInput()
flip = FlipCurve(Curve=top_edge_2)  # -> Curve, Flag
end = EndPoints(Curve=bottom_edge_2)  # -> Start, End
divide = DivideCurve(Curve=flip.Curve, Count=number_of_louvers, Kinks=False)  # -> Points, Tangents, Parameters
lnpt = LinePt(Line=top_edge_2, Point=end.Start)
divide_2 = DivideCurve(Curve=bottom_edge_2, Count=number_of_louvers, Kinks=False)  # -> Points, Tangents, Parameters

# ---- group: rotation axis
ln = Line(StartPoint=divide.Points, EndPoint=divide_2.Points)

# ----
item = ListItem(List=divide.Points, Index=0, Wrap=True)
item_2 = ListItem(List=divide.Points, Index=1, Wrap=True)
pt = PointOriented(BasePlane=lnpt, UComponent=0, VComponent=0, WComponent="-1")
item_3 = ListItem(List=ln, Index=0, Wrap=True)
dist = Distance(PointA=item, PointB=item_2)
lnpt_2 = LinePt(Line=item_3, Point=pt)
offset = Offset(Curve=ln, Distance=Slider(0.25, range=0.1..1.1), Plane=lnpt_2, Corners=1)
offset_2 = Offset(Curve=ln, Distance=Slider(-0.25, range=-0.5..0.5), Plane=lnpt_2, Corners=1)
end_2 = EndPoints(Curve=offset)  # -> Start, End
end_3 = EndPoints(Curve=offset_2)  # -> Start, End
rec_3pt = Rectangle3Pt(PointA=end_3.Start, PointB=end_3.End, PointC=end_2.Start)  # -> Rectangle, Length
rotation_angle = ClusterInput()
panel = Panel(dist)
boundary = BoundarySurfaces(Edges=rec_3pt.Rectangle)  # -> flatten(Surfaces)
rad = Radians(Degrees=rotation_angle)
panel_2 = ClusterOutput(panel)
rotax = RotateAxis(Geometry=boundary, Angle=rad, Axis=ln)  # -> Geometry, Transform
G = ClusterOutput(rotax.Geometry)
