# Grasshopper definition 753_LA_Benghi.gh (Grasshopper 0.9.76)
# plug-ins: Python Interpreter, embryoA

ladybug = Ladybug_Ladybug()  # -> Vviiiiiiiiiizzz; plug-in component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
toggle = BooleanToggle(False)
epopaquemat = Honeybee_EnergyPlusOpaqueMaterial(
    name="roof",
    thickness=Slider(0.5, range=0..1),
    conductivity=Slider(0.35, range=0.1..1.1),
    density="2000",
    specificHeat="800")  # -> EPMaterial; plug-in component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
epopaquemat_2 = Honeybee_EnergyPlusOpaqueMaterial(
    name="floor",
    thickness=Slider(0.5, range=0..1),
    conductivity=Slider(0.4, range=0.1..1.1),
    density="2000",
    specificHeat="800")  # -> EPMaterial; plug-in component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
epopaquemat_3 = Honeybee_EnergyPlusOpaqueMaterial(
    name="wall",
    thickness=Slider(0.4, range=0..1),
    conductivity=Slider(0.3, range=0.1..1.1),
    density="2000",
    specificHeat="800")  # -> EPMaterial; plug-in component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
epwindowmat = Honeybee_EnergyPlusWindowMaterial(name="glass", U_Value=Slider(0.3, range=0..4), SHGC=Slider(0.4, range=0..1), VT=Slider(0.3, range=0..1))  # -> EPMaterial; plug-in component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
updateladybug = Ladybug_UpdateLadybug(updateAllUObjects=toggle)  # -> readMe; plug-in component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
updatehoneybee = Honeybee_UpdateHoneybee(updateAllUObjects=toggle)  # -> readMe; plug-in component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
epconstruction = Honeybee_EnergyPlusConstruction(name="glass", layer_1=epwindowmat)  # -> EPConstruction; plug-in component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
epconstruction_2 = Honeybee_EnergyPlusConstruction(name="roof", layer_1=epopaquemat)  # -> EPConstruction; plug-in component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
epconstruction_3 = Honeybee_EnergyPlusConstruction(name="floor", layer_1=epopaquemat_2)  # -> EPConstruction; plug-in component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
epconstruction_4 = Honeybee_EnergyPlusConstruction(name="wall", layer_1=epopaquemat_3)  # -> EPConstruction; plug-in component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
honeybee = Honeybee_Honeybee()  # -> Vviiiiiiiiiizzz; plug-in component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
panel = Panel([updateladybug, updatehoneybee])
exterior_wall = Brep(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)

# ---- group: ceiling
ceiling = Brep([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])

# ----
walls = Brep([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])

# ---- group: floor
floor = Brep(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)

# ----
ledge = Brep(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)
wall_surface_with_opening = Brep(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)
panel_2 = Panel("""0
1
2
3""")
item = ListItem(List=walls, Index=Slider(5, range=1..5), Wrap=True)
brep = Brep(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)
item_2 = ListItem(List=walls, Index=Slider(4, range=1..5), Wrap=True)
# Geometry Preparation
item_3 = ListItem(List=walls, Index=panel_2, Wrap=True)
createhbsrfs = Honeybee_createHBSrfs(geometry=flatten(exterior_wall), srfType="0", EPConstruction=epconstruction_4)  # -> readMe, simplify(HBSurface); plug-in component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
createhbsrfs_2 = Honeybee_createHBSrfs(geometry=flatten(floor), srfType="2", EPBC="ground")  # -> readMe, simplify(HBSurface); plug-in component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
createhbsrfs_3 = Honeybee_createHBSrfs(geometry=flatten(ledge), srfType="3", EPConstruction=epconstruction_4)  # -> readMe, simplify(HBSurface); plug-in component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
createhbsrfs_4 = Honeybee_createHBSrfs(geometry=item_3, srfType="0", EPConstruction=epconstruction_4)  # -> readMe, simplify(HBSurface); plug-in component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
# Honeybee default materials will be assigned
# based on surface type
createhbsrfs_5 = Honeybee_createHBSrfs(geometry=ceiling, srfType="3", EPConstruction=epconstruction_2)  # -> readMe, simplify(HBSurface); plug-in component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
createhbsrfs_6 = Honeybee_createHBSrfs(geometry=wall_surface_with_opening, srfType="0", EPConstruction=epconstruction_4)  # -> readMe, simplify(HBSurface); plug-in component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

# ---- group: EAST GLAZING
glass = Brep(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)
preview = CustomPreview(Geometry=glass, Shader=ColourSwatch(SwatchColor=RGBA(80, 222, 255, 160)))
createhbsrfs_7 = Honeybee_createHBSrfs(geometry=item_2, EPConstruction=epconstruction_4)  # -> readMe, simplify(HBSurface); plug-in component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
addhbglz = Honeybee_addHBGlz(HBObj=createhbsrfs_7.HBSurface, childSurfaces=flatten(glass), EPConstructions=epconstruction)  # -> simplify(HBObjWGLZ); plug-in component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

# ---- group: WEST GLAZING
glass_2 = Brep(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)
preview_2 = CustomPreview(Geometry=glass_2, Shader=ColourSwatch(SwatchColor=RGBA(80, 222, 255, 160)))
createhbsrfs_8 = Honeybee_createHBSrfs(geometry=item, EPConstruction=epconstruction_4)  # -> readMe, simplify(HBSurface); plug-in component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
addhbglz_2 = Honeybee_addHBGlz(HBObj=createhbsrfs_8.HBSurface, childSurfaces=flatten(glass_2), EPConstructions=epconstruction)  # -> simplify(HBObjWGLZ); plug-in component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

# ---- group: SOUTH GLAZING
glass_3 = Brep(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)
preview_3 = CustomPreview(Geometry=glass_3, Shader=ColourSwatch(SwatchColor=RGBA(80, 222, 255, 160)))
addhbglz_3 = Honeybee_addHBGlz(HBObj=createhbsrfs_6.HBSurface, childSurfaces=flatten(glass_3), EPConstructions=epconstruction)  # -> simplify(HBObjWGLZ); plug-in component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

# ----
bldgprograms = Honeybee_bldgPrograms({"Office": 0, "Retail": 1, "MidriseApartment": 2, "PrimarySchool": 3, "SecondarySchool": 4, "SmallHotel": 5, "LargeHotel": 6, "Hospital": 7, "Outpatient": 8, "Warehouse": 9, "SuperMarket": 10, "FullServiceRestaurant": 11, "QuickServiceRestaurant": 12}, selected="MidriseApartment")
listzoneprograms = Honeybee_ListZonePrograms(bldgProgram=bldgprograms)  # -> MidriseApartmentZonePrograms; plug-in component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
item_4 = ListItem(List=listzoneprograms, Index=0, Wrap=True)

# ---- group: collect all honeybee surfaces
brep_2 = Brep(flatten([createhbsrfs_3.HBSurface, createhbsrfs.HBSurface, createhbsrfs_4.HBSurface, createhbsrfs_5.HBSurface, createhbsrfs_2.HBSurface, addhbglz_3, addhbglz_2, addhbglz]))

# ----
panel_3 = Panel(item_4)

number_slider = Slider(90, range=0..100)
panel_4 = Panel("http://apps1.eere.energy.gov/buildings/energyplus/weatherdata/4_north_and_central_america_wmo_region_4/1_usa/USA_CA_Los.Angeles.Intl.AP.722950_TMY3.zip")
open_epw_stat = Ladybug_OpenEPWAndSTATWeatherFiles(weatherFileURL=panel_4)  # -> epwFile, statFile; plug-in component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
northarrow = Ladybug_North(north=number_slider, scale=".05")  # -> northSign; plug-in component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

createhbzones = Honeybee_createHBZones(name="test_room", zoneProgram=item_4, HBSurfaces=flatten(brep_2), isConditioned=Toggle(False))  # -> readMe, HBZone; plug-in component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
decomposebybc = Honeybee_DecomposeBasedOnBoundaryCondition(HBZone=createhbzones.HBZone)  # -> outdoors, surface, adiabatic, ground; plug-in component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
wires = BrepWireframe(Brep=createhbzones.HBZone, Density=-1)
brep_3 = Brep(decomposebybc.ground)
flip = Flip(Surface=floor)  # -> Surface, Result
gentestpts = Honeybee_GenerateTestPoints(testSurface=flip.Surface, gridSize=".5", distBaseSrf=".762", moveTestMesh=True)  # -> readMe, simplify(testPoints), simplify(ptsVectors), simplify(facesArea), simplify(mesh); plug-in component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
radparameters = Honeybee_RADParameters(quality=0)  # -> readMe, radParameters; plug-in component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

panel_5 = Panel("""0
0
0
0
0
1
1
1
1
1
1
1
1
1
1
1
1
1
1
1
1
1
0
0""")
dup = DuplicateData(Data=panel_5, Number=365, Order=True)
# natural ventilation
csvschedule = Honeybee_CreateCSVSchedule(values=dup, scheduleName="NightFlushSched", writeFile=Toggle(True))  # -> readMe, csvSchedule; plug-in component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

# ---- group: FOR EN SIMUL
item_5 = ListItem(List=gentestpts.testPoints, Index="58", Wrap=True)
sph = Sphere(Base=item_5, Radius=Slider(0.1, range=0..0.1))
lightingcontrol = Honeybee_LightingControlRecipe(
    controlType="4",
    sensorPoints=item_5,
    lightingPower=250,
    lightingSetpoint=300,
    ballastLossFactor=20,
    standbyPower=3,
    delayTime=5)  # -> lightingControlGroup; plug-in component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
gethbzoneepschedules = Honeybee_GetZoneEnergyPlusSchedules(HBZone=createhbzones.HBZone)  # -> occupancySchedule, occupancyActivitySch, heatingSetPtSchedule, coolingSetPtSchedule, lightingSchedule, equipmentSchedule, infiltrationSchedule; plug-in component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

# ----
number_slider_2 = Slider(2, range=0..10)
annualdaylightsimulation = Honeybee_AnnualDaylightSimulation(
    north=number_slider,
    epwWeatherFile=open_epw_stat.epwFile,
    testPoints=gentestpts.testPoints,
    ptsVectors=gentestpts.ptsVectors,
    testMesh=gentestpts.mesh)  # -> analysisRecipe; plug-in component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
# Run Annual Daylight
toggle_2 = BooleanToggle(False)

zoneattributelist = Honeybee_ZoneAttributeList({"Name": "name", "Zone Program": "zoneProgram", "Zone Floor Area": "zoneFloorArea", "Zone Volume": "zoneVolume", "Building Program": "bldgProgram", "Is Conditioned": "isConditioned", "Occupancy Schedule": "occupancySchedule", "Occupancy Activity Schedule": "occupancyActivitySch", "Heating SetPoint Schedule": "heatingSetPtSchedule", "Cooling SetPoint Schedule": "coolingSetPtSchedule"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}, selected="Natural Ventilation": "natVent")
setepnatvent = Honeybee_SetEPAirFlow(
    HBZones=createhbzones.HBZone,
    naturalVentilationType="1",
    minIndoorTempForNatVent="24",
    maxOutdoorTempForNatVent="28",
    openingAreaFractionalSched=csvschedule.csvSchedule)  # -> readMe, simplify(HBZones); plug-in component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
labelzones = Honeybee_LabelZones(HBZones=flatten(setepnatvent.HBZones), attribute=zoneattributelist)  # -> zoneTxtLabels, labelBasePts, brepTxtLabels, zoneWireFrames; plug-in component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

toggle_3 = BooleanToggle(False)
# Generate lighting Schedule
toggle_4 = BooleanToggle(True)
dom = ConstructDomain(DomainStart=0, DomainEnd=Slider(1, range=0..1))
toggle_5 = BooleanToggle(True)
# DGP: Daylight glare probability:
# Imperceptible Glare [0.35 > DGP]
# Perceptible Glare [0.4 > DGP >= 0.35]
# Disturbing Glare [0.45 > DGP >= 0.4]
# Intolerable Glare [DGP >= 0.45]
gradientlibrary = Ladybug_GradientLibrary(gradIndex=Slider(1, range=0..10))  # -> customColors; plug-in component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

# ---- group: EPW - LA
importepw = Ladybug_ImportEpw(epwFile=open_epw_stat.epwFile)  # -> readMe, latitude, location, dryBulbTemperature, dewPointTemperature, relativeHumidity, windSpeed, windDirection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; plug-in component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

# ----
epoutput = Honeybee_GenerateEPOutput(
    zoneEnergyUse=toggle_5,
    zoneGainsAndLosses=toggle_5,
    zoneComfortMetrics=toggle_5,
    surfaceTempAnalysis="False",
    timestep="hourly")  # -> report, flatten(simulationOutputs); plug-in component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
toggle_6 = BooleanToggle(True)
legendpar = Ladybug_LegendParameters(
    lowBound=Slider(0, range=0..100),
    highBound=Slider(100, range=0..5000),
    numSegments=Slider(6, range=0..10),
    customColors=flatten(gradientlibrary))  # -> legendPar; plug-in component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
number_slider_3 = Slider(0.8, range=0..1)
genavgsky = Honeybee_GenerateAverageSky(north=number_slider, weatherFile=open_epw_stat.epwFile, month=Slider(12, range=1..12), hour=Slider(15, range=1..24))  # -> radiationValues, skyFilePath; plug-in component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
imagebasedsimulation = Honeybee_ImageBasedSimulation(skyFile=genavgsky.skyFilePath, cameraType="1", simulationType=2, imageWidth="800", imageHeight="800", backupImages=0)  # -> analysisRecipe; plug-in component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
comfort_82_no_thermal_mass = Data("c:\ladybug\unnamed\EnergyPlus\unnamed.csv")
comfort_99 = Data("c:\ladybug\unnamed\EnergyPlus\unnamed.csv")
comfort_95 = Data("c:\ladybug\unnamed\EnergyPlus\unnamed.csv")
panel_6 = Panel("""Cooling, Heating
& Lighting Loads""")
gencumulativeskymtx = Ladybug_GenCumulativeSkyMtx(epwFile=open_epw_stat.epwFile, skyDensity=0, useOldRes=True, runIt=Toggle(False))  # -> readMe, cumulativeSkyMtx; plug-in component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
panel_7 = Panel("ALWAYS EVERYTIME")
analysisperiod = Ladybug_AnalysisPeriod()  # -> readMe, analysisPeriod; plug-in component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
# why is the legend not working ???
legendpar_2 = Ladybug_LegendParameters()  # -> legendPar; plug-in component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
legendpar_3 = Ladybug_LegendParameters(lowBound="-1", highBound="1", numSegments="3")  # -> legendPar; plug-in component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
selectskymtx = Ladybug_selectSkyMtx(
    cumulativeSkyMtx=gencumulativeskymtx.cumulativeSkyMtx,
    analysisPeriod=analysisperiod.analysisPeriod,
    removeDiffuse=False,
    removeDirect=False)  # -> readMe, selectedSkyMtx; plug-in component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
panel_8 = Panel("a<0")
number_slider_4 = Slider(1, range=0..1)
panel_9 = Panel("a>30")
pt = Point(Point(5.245991135, 4.247441151, 0))

# ---- group: WEST
number_slider_5 = Slider(3, range=0..10)
number_slider_6 = Slider(4, range=0..10)
number_slider_7 = Slider(7, range=0..10)
number_slider_8 = Slider(-83, range=-90..90)
number_slider_9 = Slider(27, range=-90..90)
bottom_edge = Curve(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)
bottom_edge_2 = Curve(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)
# parametric shades
number_slider_10 = Slider(-31, range=-90..90)
bottom_edge_3 = Curve(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)
top_edge = Curve(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)
top_edge_2 = Curve(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)
top_edge_3 = Curve(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)
flip_2 = FlipCurve(Curve=top_edge)  # -> Curve, Flag
flip_3 = FlipCurve(Curve=top_edge_2)  # -> Curve, Flag
flip_4 = FlipCurve(Curve=top_edge_3)  # -> Curve, Flag

# ---- group: WEST / EAST
louvers = LOUVERS(top_edge=flip_2.Curve, number_of_louvers=number_slider_5, bottom_edge=bottom_edge, rotation_angle=number_slider_8)  # -> G, panel_2

# ---- group: WEST / SOUTH
louvers_2 = LOUVERS(top_edge=flip_3.Curve, number_of_louvers=number_slider_6, bottom_edge=bottom_edge_2, rotation_angle=number_slider_9)  # -> G, panel_2

# ---- group: WEST
louvers_3 = LOUVERS(top_edge=flip_4.Curve, number_of_louvers=number_slider_7, bottom_edge=bottom_edge_3, rotation_angle=number_slider_10)  # -> G, panel_2

distance_between_louvers = Data(louvers.panel_2)
distance_between_louvers_2 = Data(louvers_2.panel_2)
distance_between_louvers_3 = Data(louvers_3.panel_2)
louvers_4 = Data(louvers.G)
louvers_5 = Data(louvers_2.G)
louvers_6 = Data(louvers_3.G)
panel_10 = Panel(distance_between_louvers)
panel_11 = Panel(distance_between_louvers_2)
panel_12 = Panel(distance_between_louvers_3)

# ----
hb_epcontextsrf = HoneybeeEPContextSurfaces(shdSurfaces=flatten([louvers_5, louvers_6, louvers_4, brep]))  # -> HBContext; inputs shdSurfaces: list of GeometryBase, justBoundingBox: Boolean
# ---------- hb_epcontextsrf: Python ----------
"""
prepare shading/context geometries

    Args:
        northVectorOrRotation: A vector that shows North or a number that shows
                               the rotation of the North from the Y axis
        bldgMasses: List of closed Breps as thermal zones.
    Returns:
        report: ...
        thermalZones: Thermal zone's geometries for visualiza
"""

ghenv.Component.Name = 'Honeybee EP context Surfaces'
ghenv.Component.NickName = 'HB_EPContextSrf'
ghenv.Component.Message = 'VER 0.0.58\nNOV_05_2015'
ghenv.Component.Category = "Honeybee"
ghenv.Component.SubCategory = "09 | Energy | Energy"
#compatibleHBVersion = VER 0.0.57\nNOV_01_2015
#compatibleLBVersion = VER 0.0.59\nFEB_01_2015
ghenv.Component.AdditionalHelpFromDocStrings = "2"

import rhinoscriptsyntax as rs
import Rhino as rc
import scriptcontext as sc
import os
import System
import Grasshopper.Kernel as gh
import uuid

tolerance = sc.doc.ModelAbsoluteTolerance
import math


def main(shdSurfaces, EPTransSchedule, meshingSettings, justBoundingBox):
    
    # import the classes
    if sc.sticky.has_key('honeybee_release'):

        try:
            if not sc.sticky['honeybee_release'].isCompatible(ghenv.Component): return -1
        except:
            warning = "You need a newer version of Honeybee to use this compoent." + \
            " Use updateHoneybee component to update userObjects.\n" + \
            "If you have already updated userObjects drag Honeybee_Honeybee component " + \
            "into canvas and try again."
            w = gh.GH_RuntimeMessageLevel.Warning
            ghenv.Component.AddRuntimeMessage(w, warning)
            return -1
        
        # don't customize this part
        hb_EPSrf = sc.sticky["honeybee_EPSurface"]
        hb_EPSHDSurface = sc.sticky["honeybee_EPShdSurface"]
        hb_RADMaterialAUX = sc.sticky["honeybee_RADMaterialAUX"]
        hb_EPObjectsAux = sc.sticky["honeybee_EPObjectsAUX"]()
        HBScheduleList = sc.sticky["honeybee_ScheduleLib"].keys()

        ########################################################################
        #----------------------------------------------------------------------#
        shdBreps = []
        # create bounding box of shading geometries
        if justBoundingBox:
            for brep in shdSurfaces:
                if brep.Faces.Count>1 or not brep.Faces[0].IsPlanar(sc.doc.ModelAbsoluteTolerance):
                    shdBreps.append(brep.GetBoundingBox(True).ToBrep())
                else:
                    shdBreps.append(brep)
        else: shdBreps = shdSurfaces
        
        shadingClasses = []
        shadingMeshPreview = []
        
        if meshingSettings == None:
            mp = rc.Geometry.MeshingParameters.Minimal
            mp.SimplePlanes = True
        else:
            mp = meshingSettings
        
        def getRadMaterialName(radMaterial):
            nameStr = radMaterial.split(" ")[2]
            name =  nameStr.split("\n")[0]
            return name
        
        for brepCount, brep in enumerate(shdBreps):
            if brep != None:
                #if len(brep.DuplicateEdgeCurves(False))>1:
                
                meshArray = rc.Geometry.Mesh.CreateFromBrep(brep, mp)
                for mesh in meshArray:
                    for meshFace in range(mesh.Faces.Count):
                        vertices = list(mesh.Faces.GetFaceVertices(meshFace))[1:]
                        vertices = vertices + [sc.doc.ModelAbsoluteTolerance]
                        # create the brep from mesh
                        shdBrep = rc.Geometry.Brep.CreateFromCornerPoints(*vertices)
                        
                        thisShading = hb_EPSHDSurface(shdBrep, 1000*brepCount + meshFace, 'shdSrf_' + `brepCount` + '_' + `meshFace` + "_" + str(uuid.uuid4()))
                        
                        # add transmittance schedule if any
                        if EPTransSchedule!=None:
                            schedule= EPTransSchedule.upper()
                            if schedule!=None and not schedule.lower().endswith(".csv") and schedule not in HBScheduleList:
                                msg = "Cannot find " + schedule + " in Honeybee schedule library."
                                print msg
                                ghenv.Component.AddRuntimeMessage(gh.GH_RuntimeMessageLevel.Warning, msg)
                                return -1
                            elif schedule!=None and schedule.lower().endswith(".csv"):
                                # check if csv file is existed
                                if not os.path.isfile(schedule):
                                    msg = "Cannot find the shchedule file: " + schedule
                                    print msg
                                    ghenv.Component.AddRuntimeMessage(gh.GH_RuntimeMessageLevel.Warning, msg)
                                    return -1
                            
                            thisShading.TransmittanceSCH = schedule
                        
                        # add the Rad Material if any
                        if RADMaterial!=None:
                            # if it is just the name of the material make sure it is already defined
                            if len(RADMaterial.split(" ")) == 1:
                                # if the material is not in the library add it to the library
                                if not hb_RADMaterialAUX.isMatrialExistInLibrary(RADMaterial):
                                    warningMsg = "Can't find " + RADMaterial + " in RAD Material Library.\n" + \
                                                "Add the material to the library and try again."
                                    ghenv.Component.AddRuntimeMessage(gh.GH_RuntimeMessageLevel.Warning, warningMsg)
                                    return
                                
                                try:
                                    thisShading.setRADMaterial(RADMaterial)
                                except Exception, e:
                                    print e
                                    warningMsg = "You are using an old version of Honeybee_Honeybee! Update your files and try again."
                                    print warningMsg
                                    ghenv.Component.AddRuntimeMessage(gh.GH_RuntimeMessageLevel.Warning, warningMsg)
                                    return
                                
                                addedToLib = True
                            else:
                                
                                # try to add the material to the library
                                addedToLib, thisShading.RadMaterial = hb_RADMaterialAUX.analyseRadMaterials(RADMaterial, True)
                                
                            if addedToLib==False:
                                warningMsg = "Failed to add " + RADMaterial + " to the Library."
                                ghenv.Component.AddRuntimeMessage(gh.GH_RuntimeMessageLevel.Warning, warningMsg)
                                return
                        
                        # add shading to the list
                        shadingClasses.append(thisShading)
                
        # add to the hive
        hb_hive = sc.sticky["honeybee_Hive"]()
        HBContext  = hb_hive.addToHoneybeeHive(shadingClasses, ghenv.Component.InstanceGuid.ToString())
        return HBContext
        ################################################################################################
    else:
        print "You should first let Honeybee to fly..."
        w = gh.GH_RuntimeMessageLevel.Warning
        ghenv.Component.AddRuntimeMessage(w, "You should first let Honeybee to fly...")
        return -1
        

if _shdSurfaces and _shdSurfaces[0]!=None:
    # add cleaning function
    result= main(_shdSurfaces, EPTransSchedule_, meshingSettings_, justBoundingBox_)
    
    if result != -1: HBContext = result
# ---------- end hb_epcontextsrf ----------
rundaylightanalysis = Honeybee_RunDaylightSimulation(
    HBObjects=flatten([brep_2, hb_epcontextsrf]),
    analysisRecipe=annualdaylightsimulation,
    writeRad=toggle_2,
    runRad=toggle_2,
    numOfCPUs=number_slider_2,
    overwriteResults=True)  # -> readMe, analysisType, resultsUnit, results, testPts, resultFiles, radGeoFile, studyFolder, done; plug-in component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
rundaylightanalysis_2 = Honeybee_RunDaylightSimulation(
    HBObjects=flatten([brep_2, hb_epcontextsrf]),
    analysisRecipe=imagebasedsimulation,
    writeRad=toggle_3,
    runRad=toggle_3,
    numOfCPUs=number_slider_2,
    overwriteResults=True)  # -> readMe, analysisType, resultsUnit, results, testPts, resultFiles, radGeoFile, studyFolder, done; plug-in component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
readannualresultsi = Honeybee_ReadAnnualResultI(
    illFilesAddress=rundaylightanalysis.resultFiles,
    testPoints=simplify(rundaylightanalysis.testPts),
    DLAIllumThresholds=300,
    runIt=toggle_4)  # -> DLA, UDLI_Less_100, UDLI_100_2000, UDLI_More_2000, CDA, sDA, annualProfiles, htmReport; plug-in component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
# Visualize the results
panel_13 = Panel(readannualresultsi.DLA)
panel_14 = Panel(readannualresultsi.sDA)
panel_15 = Panel(readannualresultsi.UDLI_Less_100)
glareanalysis = Honeybee_GlareAnalysis(HDRImagePath=rundaylightanalysis_2.resultFiles, runIt=Toggle(True))  # -> readMe, glareCheckImage, DGP, DGI, imageWithTaskArea; plug-in component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
falsecolor = Honeybee_FalseColor(
    HDRFilePath=rundaylightanalysis_2.resultFiles,
    contourBands=False,
    maskThreshold=0.1,
    useAlterColors=False,
    render=Toggle(True))  # -> outputFilePath; plug-in component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
panel_16 = Panel(glareanalysis.DGP)
recolormesh = Ladybug_RecolorMesh(
    analysisResult=readannualresultsi.UDLI_More_2000,
    inputMesh=gentestpts.mesh,
    heightDomain=dom,
    legendPar=legendpar,
    legendTitle="%")  # -> readMe, newMesh, newLegend, legendBasePt, meshColors, legendColors; plug-in component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
hdr_tif = Honeybee_ConvertHDRToTIF(HDRFilePath=glareanalysis.glareCheckImage, adjustExposure=Toggle(False))  # -> TIFFFilePath; plug-in component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
hdr_tif_2 = Honeybee_ConvertHDRToTIF(HDRFilePath=falsecolor, adjustExposure=False)  # -> TIFFFilePath; plug-in component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
panel_17 = Panel(recolormesh.readMe)
# Run the analysis
runenergysimulation = Honeybee_RunEnergySimulation(
    north=number_slider,
    epwFile=open_epw_stat.epwFile,
    HBZones=flatten(setepnatvent.HBZones),
    HBContext=flatten(hb_epcontextsrf),
    simulationOutputs=flatten(epoutput.simulationOutputs),
    writeIdf=toggle_6,
    runEnergyPlus=toggle_6)  # -> report, idfFileAddress, resultFileAddress; plug-in component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
image = ImageFromPath(P=hdr_tif, S=number_slider_3)
readepresult = Honeybee_ReadEPResult(resultFileAddress=runenergysimulation.resultFileAddress)  # -> port, port_2, port_3, port_4, electricLight, electricEquip, fanElectric, port_5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; plug-in component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
separatedata = Ladybug_SeparateData(inputList=flatten(readepresult.port_3))  # -> numbers, strings; plug-in component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
separatedata_2 = Ladybug_SeparateData(inputList=flatten(readepresult.port_4))  # -> numbers, strings; plug-in component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
image_2 = ImageFromPath(P=hdr_tif_2, S=number_slider_3)
adaptivecomfortcalculator = Ladybug_AdaptiveComfortCalculator(
    dryBulbTemperature=readepresult.airTemperature,
    meanRadiantTemperature=readepresult.meanRadTemperature,
    prevailingOutdoorTemp=importepw.dryBulbTemperature,
    runIt=Toggle(True))  # -> readMe, port, comfortableOrNot, conditionOfPerson, degreesFromTarget, port_2, targetTemperature, upperTemperatureBound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; plug-in component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
barchart = Ladybug_MonthlyBarChart(
    inputData=flatten([readepresult.port_3, readepresult.electricLight, readepresult.port_4]),
    altYAxisTitle=panel_6,
    basePoint="20, 0, 0",
    xScale=Slider(0.5, range=0..1),
    yScale=Slider(0.7, range=0..1))  # -> readMe, dataMesh, dataCurves, dataCrvColors, graphAxes, graphLabels, title, titleBasePt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; plug-in component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
ma = MassAddition(Input=separatedata.numbers)  # -> Result, PartialResults
ma_2 = MassAddition(Input=separatedata_2.numbers)  # -> Result, PartialResults
panel_18 = Panel(adaptivecomfortcalculator.percentOfTimeComfortable)
total_cooling = Panel(ma.Result)
total_heating = Panel(ma_2.Result)
_3dchart = Ladybug_3DChart(
    inputData=flatten(readepresult.airTemperature),
    basePoint="0,500,0",
    xScale=number_slider_4,
    yScale=number_slider_4,
    zScale=number_slider_4)  # -> readMe, graphMesh, graphCurves, legend, legendBasePts, title, titleBasePts, dataPts, conditionalHOY; plug-in component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
_3dchart_2 = Ladybug_3DChart(
    inputData=flatten(adaptivecomfortcalculator.conditionOfPerson),
    basePoint="0,100,0",
    xScale=number_slider_4,
    yScale=number_slider_4,
    zScale=number_slider_4,
    legendPar=legendpar_3)  # -> readMe, graphMesh, graphCurves, legend, legendBasePts, title, titleBasePts, dataPts, conditionalHOY; plug-in component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
sunpath = Ladybug_SunPath(
    north=number_slider,
    location=importepw.location,
    hour=12,
    day=21,
    month=12,
    timeStep=1,
    analysisPeriod=analysisperiod.analysisPeriod,
    centerPt=pt,
    sunPathScale=Slider(0.08, range=0..1),
    annualHourlyData=flatten(adaptivecomfortcalculator.conditionOfPerson),
    legendPar=legendpar_3,
    dailyOrAnnualSunPath=True)  # -> readMe, sunVectors, sunAltitudes, sunAzimuths, port, sunSpheresMesh, sunPathCrvs, legend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; plug-in component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
radiationanalysis = Ladybug_RadiationAnalysis(
    north=number_slider,
    geometry=flatten(brep_2),
    context=flatten(hb_epcontextsrf),
    gridSize=Slider(0.2, range=0..1),
    disFromBase=Slider(0.001, range=0..0.01),
    selectedSkyMtx=flatten(selectskymtx.selectedSkyMtx),
    runIt=Toggle(False))  # -> readMe, contextMesh, analysisMesh, testPts, testVec, port, radiationResult, radiationMesh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; plug-in component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
ln = Line(StartPoint=sunpath.sunPathCenPts, EndPoint=sunpath.sunPositions)

# ==== cluster LOUVERS
bottom_edge = ClusterInput()
top_edge = ClusterInput()
top_edge_2 = Data(top_edge)
bottom_edge_2 = Data(bottom_edge)
number_of_louvers = ClusterInput()
flip = FlipCurve(Curve=top_edge_2)  # -> Curve, Flag
end = EndPoints(Curve=bottom_edge_2)  # -> Start, End
divide = DivideCurve(Curve=flip.Curve, Count=number_of_louvers, Kinks=False)  # -> Points, Tangents, Parameters
lnpt = LinePt(Line=top_edge_2, Point=end.Start)
divide_2 = DivideCurve(Curve=bottom_edge_2, Count=number_of_louvers, Kinks=False)  # -> Points, Tangents, Parameters

# ---- group: rotation axis
ln = Line(StartPoint=divide.Points, EndPoint=divide_2.Points)

# ----
item = ListItem(List=divide.Points, Index=0, Wrap=True)
item_2 = ListItem(List=divide.Points, Index=1, Wrap=True)
pt = PointOriented(BasePlane=lnpt, UComponent=0, VComponent=0, WComponent="-1")
item_3 = ListItem(List=ln, Index=0, Wrap=True)
dist = Distance(PointA=item, PointB=item_2)
lnpt_2 = LinePt(Line=item_3, Point=pt)
offset = Offset(Curve=ln, Distance=Slider(0.15, range=0.1..1.1), Plane=lnpt_2, Corners=1)
offset_2 = Offset(Curve=ln, Distance=Slider(-0.05, range=-0.5..0.5), Plane=lnpt_2, Corners=1)
end_2 = EndPoints(Curve=offset)  # -> Start, End
end_3 = EndPoints(Curve=offset_2)  # -> Start, End
rec_3pt = Rectangle3Pt(PointA=end_3.Start, PointB=end_3.End, PointC=end_2.Start)  # -> Rectangle, Length
rotation_angle = ClusterInput()
panel = Panel(dist)
boundary = BoundarySurfaces(Edges=rec_3pt.Rectangle)  # -> flatten(Surfaces)
rad = Radians(Degrees=rotation_angle)
panel_2 = ClusterOutput(panel)
rotax = RotateAxis(Geometry=boundary, Angle=rad, Axis=ln)  # -> Geometry, Transform
G = ClusterOutput(rotax.Geometry)
