# Grasshopper definition Benghi_Niccolo_shade_GH.gh (Grasshopper 0.9.76)
# plug-ins: Python Interpreter

path = FilePath("C:\Users\Niccolo\Desktop\00_BUILD SIMULATION\01_WEATHER DATA\USA_PA_Philadelphia\USA_PA_Philadelphia.724086_TMY2.epw")
number_slider = Slider(1, range=1..12)
number_slider_2 = Slider(9, range=1..12)

# ---- group: Import the WeatherFile
importepw = Ladybug_ImportEpw(epwFile=path)  # -> readMe, latitude, location, dryBulbTemperature, dewPointTemperature, relativeHumidity, windSpeed, windDirection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; plug-in component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

# ----
ladybug = Ladybug_Ladybug()  # -> Vviiiiiiiiiizzz; plug-in component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
analysisperiod = Ladybug_AnalysisPeriod()  # -> readMe, analysisPeriod; plug-in component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
pt = Point(Point(-21.948125, 3.02875, 1.5))
solaradjusttemperature = Ladybug_OutdoorSolarTemperatureAdjustor(
    location=importepw.location,
    cumSkyMtxOrDirNormRad=importepw.directNormalRadiation,
    diffuseHorizRad=importepw.diffuseHorizontalRadiation,
    meanRadTemperature=importepw.dryBulbTemperature,
    bodyPosture=Slider(1, range=0..2),
    rotationAngle=Slider(70, range=0..180),
    bodyLocation=pt,
    north=Slider(5, range=-90..90),
    analysisPeriodOrHOY=analysisperiod.analysisPeriod,
    parallel=Toggle(True),
    runIt=Toggle(True))  # -> readMe, port, effectiveRadiantField, MRTDelta, solarAdjustedMRT, port_2, mannequinMesh, port_3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; plug-in component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
outdoorcomfortcalculator = Ladybug_OutdoorComfortCalculator(
    dryBulbTemperature=importepw.dryBulbTemperature,
    windSpeed_tenMeters=importepw.windSpeed,
    relativeHumidity=importepw.relativeHumidity,
    runIt=Toggle(True))  # -> readMe, port, universalThermalClimateIndex, comfortableOrNot, thermalStress, conditionOfPerson, port_2, percentOfTimeComfortable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; plug-in component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
outdoorcomfortcalculator_2 = Ladybug_OutdoorComfortCalculator(
    dryBulbTemperature=importepw.dryBulbTemperature,
    meanRadiantTemperature=solaradjusttemperature.solarAdjustedMRT,
    windSpeed_tenMeters=importepw.windSpeed,
    relativeHumidity=importepw.relativeHumidity,
    runIt=Toggle(True))  # -> readMe, port, universalThermalClimateIndex, comfortableOrNot, thermalStress, conditionOfPerson, port_2, percentOfTimeComfortable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; plug-in component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

# ---- group: Visualize Data
pt_2 = Point(Point(88.47226712, 166.2122937, 0))
_3dchart = Ladybug_3DChart(
    inputData=flatten([outdoorcomfortcalculator.conditionOfPerson, outdoorcomfortcalculator_2.conditionOfPerson]),
    basePoint=pt_2,
    xScale="0.25",
    zScale="0")  # -> readMe, graphMesh, graphCurves, legend, legendBasePts, titleText, titleBasePts, conditionalHOY; plug-in component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
preview = CustomPreview(Geometry=[_3dchart.graphCurves, _3dchart.legend], Shader=ColourSwatch(SwatchColor=RGB(0, 0, 0)))

# ----
meyerson = Brep([<brep referenced from the Rhino model> x137])
fish_arts = Brep([<brep referenced from the Rhino model> x102])
busstop_seat = Brep(<brep referenced from the Rhino model>)
busstop_seat_2 = Brep([<brep referenced from the Rhino model> x3])
busstop_seat_3 = Brep(<brep referenced from the Rhino model>)
busstop_seat_4 = Brep(<brep referenced from the Rhino model>)
busstop_shade = Brep(<brep referenced from the Rhino model>)
comfortshadebenefit = Ladybug_ComfortShadeBenefitEvaluator(
    location=importepw.location,
    temperatures=outdoorcomfortcalculator_2.universalThermalClimateIndex,
    balanceTemperature="20",
    testShades=busstop_shade,
    testRegion=busstop_seat_3,
    gridSize=".5",
    skyResolution="4",
    delNonIntersect=False,
    parallel=Toggle(True),
    runIt=Toggle(True))  # -> readMe, port, sunVectors, regionTestPts, shadeMesh, legend, legendBasePoint, port_2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; plug-in component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
shadecreator = Honeybee_OptimalShadeCreator(
    shadeMesh=comfortshadebenefit.shadeMesh,
    shadeNetEffect=comfortshadebenefit.shadeNetEffect,
    percentToKeep=Slider(80, range=0..100))  # -> readMe, energySavedByShade, areaOfShade, newColoredMesh, newShadeBrep; plug-in component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
panel = Panel(shadecreator.areaOfShade)
panel_2 = Panel(shadecreator.energySavedByShade)
preview_2 = CustomPreview(Geometry=shadecreator.newShadeBrep, Shader=ColourSwatch(SwatchColor=RGB(0, 0, 0)))
