# Grasshopper definition Bhatti_Munazza_LondonGrasshopperFile.gh (Grasshopper 0.9.76)
# plug-ins: Python Interpreter

toggle = BooleanToggle(True)

callfromepconstrlibrary = Honeybee_CallFromEPConstructionLibrary(keywords="wall insulation [46]")  # -> ThermMaterials, EPMaterials, EPWindowMaterials, EPConstructions; plug-in component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
callfromepconstrlibrary_2 = Honeybee_CallFromEPConstructionLibrary(keywords="1/2 gypsum")  # -> ThermMaterials, EPMaterials, EPWindowMaterials, EPConstructions; plug-in component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
callfromepconstrlibrary_3 = Honeybee_CallFromEPConstructionLibrary(keywords="8in concrete hw")  # -> ThermMaterials, EPMaterials, EPWindowMaterials, EPConstructions; plug-in component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
callfromepconstrlibrary_4 = Honeybee_CallFromEPConstructionLibrary(keywords="stucco")  # -> ThermMaterials, EPMaterials, EPWindowMaterials, EPConstructions; plug-in component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
item = ListItem(List=callfromepconstrlibrary_3.EPMaterials, Index=0, Wrap=True)  # -> Item, Item1
toggle_2 = BooleanToggle(True)
epconstruction = Honeybee_EnergyPlusConstruction(
    name="46_Wall",
    layer_1=callfromepconstrlibrary_4.EPMaterials,
    layer_2=item.Item,
    layer_3=callfromepconstrlibrary.EPMaterials,
    layer_4=callfromepconstrlibrary_2.EPMaterials)  # -> EPConstruction; plug-in component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
addtoeplibrary = Honeybee_AddToEnergyPlusLibrary(EPObject=epconstruction, addToProjectLib=toggle_2, overwrite=toggle_2)  # -> readMe; plug-in component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

honeybee = Honeybee_Honeybee()  # -> Vviiiiiiiiiizzz; plug-in component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
ladybug = Ladybug_Ladybug()  # -> Vviiiiiiiiiizzz; plug-in component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
updateladybug = Ladybug_UpdateLadybug(updateThisFile=toggle, updateAllUObjects=toggle)  # -> readMe; plug-in component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
updatehoneybee = Honeybee_UpdateHoneybee(updateThisFile=toggle, updateAllUObjects=toggle)  # -> readMe; plug-in component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
callfromepconstrlibrary_5 = Honeybee_CallFromEPConstructionLibrary()  # -> EPMaterials, EPWindowMaterils, EPConstructions; plug-in component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
_1_10wall = Brep([<brep referenced from the Rhino model> x5])
exterior_wall = Brep(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)
wall_surface_with_opening = Brep(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)
ledge = Brep(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)

# ---- group: floor
floor = Brep(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)

# ---- group: ceiling
ceiling = Brep([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])

# ----
walls = Brep([<brep referenced from the Rhino model> x4])
southwall = Brep(<brep referenced from the Rhino model>)
brep = Brep(<brep referenced from the Rhino model>)
callfromepconstrlibrary_6 = Honeybee_CallFromEPConstructionLibrary(keywords="clear")  # -> ThermMaterials, EPMaterials, EPWindowMaterials, EPConstructions; plug-in component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
callfromepconstrlibrary_7 = Honeybee_CallFromEPConstructionLibrary(keywords="air")  # -> ThermMaterials, EPMaterials, EPWindowMaterials, EPConstructions; plug-in component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
searchepconstruction = Honeybee_SearchEPConstruction(EPConstrList=callfromepconstrlibrary_5.EPConstructions, standard="2", climateZone="4", surfaceType="4")  # -> EPSelectedConstr; plug-in component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
callfromepconstrlibrary_8 = Honeybee_CallFromEPConstructionLibrary(keywords="roof 4")  # -> EPMaterials, EPWindowMaterils, EPConstructions; plug-in component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
createhbsrfs = Honeybee_createHBSrfs(geometry=flatten(floor), srfType="2", EPBC="ground")  # -> readMe, simplify(HBSurface); plug-in component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
item_2 = ListItem(List=searchepconstruction, Index=0, Wrap=True)  # -> Item, Item1
createhbsrfs_2 = Honeybee_createHBSrfs(geometry=flatten(ledge), srfType="2")  # -> readMe, simplify(HBSurface); plug-in component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
createhbsrfs_3 = Honeybee_createHBSrfs(geometry=flatten(exterior_wall), srfType="0")  # -> readMe, simplify(HBSurface); plug-in component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
createhbsrfs_4 = Honeybee_createHBSrfs(geometry=_1_10wall, srfType="0")  # -> readMe, simplify(HBSurface); plug-in component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
createhbsrfs_5 = Honeybee_createHBSrfs(geometry=ceiling, srfType="3")  # -> readMe, simplify(HBSurface); plug-in component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
createhbsrfs_6 = Honeybee_createHBSrfs(geometry=[wall_surface_with_opening, southwall], srfType="0")  # -> readMe, simplify(HBSurface); plug-in component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
epconstruction_2 = Honeybee_EnergyPlusConstruction(
    name="DoublePane",
    layer_1=callfromepconstrlibrary_6.EPWindowMaterials,
    layer_2=callfromepconstrlibrary_7.EPWindowMaterials,
    layer_3=callfromepconstrlibrary_6.EPWindowMaterials,
    layer_4=callfromepconstrlibrary_7.EPWindowMaterials,
    layer_5=callfromepconstrlibrary_6.EPWindowMaterials)  # -> EPConstruction; plug-in component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
brep_2 = Brep([<brep referenced from the Rhino model> x2])
glass = Brep(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)
side_window = Brep(<brep referenced from the Rhino model>)
brep_3 = Brep([<brep referenced from the Rhino model> x2])
brep_4 = Brep([<brep referenced from the Rhino model> x2])
decomposeepmaterial = Honeybee_DecomposeEPMaterial(materialName=simplify(item_2.Item))  # -> names, values, comments, UValue_SI, UValue_IP, RValue_SI, RValue_IP; plug-in component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
toggle_3 = BooleanToggle(True)
decomposeepconstruction = Honeybee_DecomposeEPConstruction(cnstrName=item_2.Item)  # -> materials, comments, UValue_SI, UValue_IP, RValue_SI, RValue_IP; plug-in component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
preview = CustomPreview(Geometry=brep_3, Shader=ColourSwatch(SwatchColor=RGBA(80, 222, 255, 160)))
# Honeybee default materials will be assigned
# based on surface type
epconstruction_3 = Honeybee_EnergyPlusConstruction()  # -> EPConstruction; plug-in component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
_3 = Brep([<brep referenced from the Rhino model> x3])
addhbglz = Honeybee_addHBGlz(HBObj=createhbsrfs_6.HBSurface, childSurfaces=flatten(brep_3))  # -> simplify(HBObjWGLZ); plug-in component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
addtoeplibrary_2 = Honeybee_AddToEnergyPlusLibrary(EPObject=epconstruction_2, addToProjectLib=toggle_3, overwrite=toggle_3)  # -> readMe; plug-in component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
panel = Panel(decomposeepmaterial.values)
bldgprograms = Honeybee_bldgPrograms({"Office": 0, "Retail": 1, "MidriseApartment": 2, "PrimarySchool": 3, "SecondarySchool": 4, "SmallHotel": 5, "LargeHotel": 6, "Hospital": 7, "Outpatient": 8, "Warehouse": 9, "SuperMarket": 10, "FullServiceRestaurant": 11, "QuickServiceRestaurant": 12}, selected="MidriseApartment")
listzoneprograms = Honeybee_ListZonePrograms(bldgProgram=bldgprograms)  # -> MidriseApartmentZonePrograms; plug-in component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
item_3 = ListItem(List=listzoneprograms, Index=0, Wrap=True)
brep_5 = Brep(flatten([addhbglz, createhbsrfs_2.HBSurface, createhbsrfs_3.HBSurface, createhbsrfs_4.HBSurface, createhbsrfs_5.HBSurface, createhbsrfs.HBSurface]))
brep_6 = Brep(flatten([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]))
panel_2 = Panel(item_3)
createhbzones = Honeybee_createHBZones(name="test_room", zoneProgram=item_3, HBSurfaces=flatten(brep_5), isConditioned=True)  # -> readMe, HBZone; plug-in component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
open_epw_stat = Ladybug_OpenEPWAndSTATWeatherFiles(weatherFileURL="http://apps1.eere.energy.gov/buildings/energyplus/weatherdata/Example.zip")  # -> epwFile, statFile; plug-in component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

panel_3 = Panel("http://apps1.eere.energy.gov/buildings/energyplus/weatherdata/6_europe_wmo_region_6/GBR_London.Gatwick.037760_IWEC.zip")
open_epw_stat_2 = Ladybug_OpenEPWAndSTATWeatherFiles(weatherFileURL=panel_3)  # -> epwFile, statFile; plug-in component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
northarrow = Ladybug_North(north="90", scale=".05")  # -> northSign; plug-in component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

decomposebytype = Honeybee_DecomposeBasedOnType(HBZone=createhbzones.HBZone)  # -> walls, interiorWalls, airWalls, windows, interiorWindows, skylights, roofs, ceilings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; plug-in component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
wires = BrepWireframe(Brep=createhbzones.HBZone, Density=-1)
number_slider = Slider(0.762, range=0..1)
number_slider_2 = Slider(0.5, range=0..1)
flip = Flip(Surface=floor)  # -> Surface, Result
genclimatebasedsky = Honeybee_GenerateClimateBasedSky(north="90", weatherFile=open_epw_stat_2.epwFile, month="6", day="21", hour="9")  # -> radiationValues, skyFilePath; plug-in component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
importstat = Ladybug_ImportStat(statFile=open_epw_stat_2.statFile)  # -> readMe, ashraeClimateZone, koppenClimateZone, port, heatingDesignTemp, coolingDesignTemp, port_2, extremeHotWeek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; plug-in component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
genhbzonetestpts = Honeybee_GenerateZoneTestPoints(HBZone=createhbzones.HBZone, gridSize=number_slider_2, distBaseSrf=number_slider, moveTestMesh=True)  # -> readMe, simplify(testPoints), simplify(ptsVectors), simplify(facesArea), simplify(mesh); plug-in component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
preview_2 = CustomPreview(Geometry=decomposebytype.windows, Shader=ColourSwatch(SwatchColor=RGB(125, 255, 255)))
preview_3 = CustomPreview(Geometry=decomposebytype.walls, Shader=ColourSwatch(SwatchColor=RGB(255, 255, 255)))
preview_4 = CustomPreview(Geometry=decomposebytype.ceilings, Shader=ColourSwatch(SwatchColor=RGB(138, 138, 138)))
preview_5 = CustomPreview(Geometry=decomposebytype.floors, Shader=ColourSwatch(SwatchColor=RGB(138, 67, 67)))
gentestpts = Honeybee_GenerateTestPoints(testGeometry=flip.Surface, gridSize=number_slider_2, distBaseSrf=number_slider, moveTestMesh=Toggle(True))  # -> readMe, simplify(testPoints), simplify(ptsVectors), simplify(facesArea), simplify(mesh); plug-in component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
radparameters = Honeybee_RADParameters(quality=0)  # -> readMe, radParameters; plug-in component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
setepzonecnstr = Honeybee_SetEPZoneConstruction(HBZone=createhbzones.HBZone, wallEPConstruction="46_Wall", windowEPConstruction="DoublePane")  # -> simplify(modifiedHBZone); plug-in component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
importlocation = Ladybug_ImportLocation(epwFile=open_epw_stat_2.epwFile)  # -> location; plug-in component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
watchthesky = Honeybee_WatchTheSky()  # -> HDRImagePath, globalHorIrradiance; plug-in component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
genstandardciesky = Honeybee_GenerateStandardCIESky(north="90", weatherFile=open_epw_stat_2.epwFile, month="6", day="21", hour="9", skyType="4")  # -> skyFilePath; plug-in component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
genclimatebasedsky_2 = Honeybee_GenerateClimateBasedSky(north="90", weatherFile=open_epw_stat_2.epwFile, month="6", day="21", hour="12")  # -> radiationValues, skyFilePath; plug-in component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
gentestpts_2 = Honeybee_GenerateTestPoints(testGeometry=flip.Surface, gridSize=".5", distBaseSrf=".762", moveTestMesh=True)  # -> readMe, simplify(testPoints), simplify(ptsVectors), simplify(facesArea), simplify(mesh); plug-in component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
gridbasedsimulation = Honeybee_GridBasedSimulation(
    skyFile=genstandardciesky,
    testPoints=gentestpts.testPoints,
    ptsVectors=gentestpts.ptsVectors,
    testMesh=gentestpts.mesh,
    simulationType=gentestpts.mesh)  # -> analysisRecipe; plug-in component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
pt = Point(<point referenced from the Rhino model>)
sunpath = Ladybug_SunPath(
    north="90",
    location=importlocation,
    hour="9",
    day="21",
    month="12",
    timeStep=1,
    centerPt=pt,
    sunPathScale=".05",
    dailyOrAnnualSunPath=True)  # -> readMe, sunVectors, sunAltitudes, sunAzimuths, port, sunSpheresMesh, sunPathCrvs, legend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; plug-in component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
item_4 = ListItem(List=gentestpts_2.testPoints, Index="58", Wrap=True)
toggle_4 = BooleanToggle(True)
gridbasedsimulation_2 = Honeybee_GridBasedSimulation(
    skyFile=genclimatebasedsky_2.skyFilePath,
    testPoints=genhbzonetestpts.testPoints,
    ptsVectors=genhbzonetestpts.ptsVectors,
    testMesh=genhbzonetestpts.mesh,
    simulationType=genhbzonetestpts.mesh)  # -> analysisRecipe; plug-in component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
annualdaylightsimulation = Honeybee_AnnualDaylightSimulation(
    north="90",
    epwWeatherFile=open_epw_stat_2.epwFile,
    testPoints=gentestpts_2.testPoints,
    ptsVectors=gentestpts_2.ptsVectors,
    testMesh=gentestpts_2.mesh)  # -> analysisRecipe; plug-in component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
sph = Sphere(Base=item_4, Radius=Slider(0.1, range=0..0.1))
# Run Annual Daylight
toggle_5 = BooleanToggle(True)
rundaylightanalysis = Honeybee_RunDaylightSimulation(
    HBObjects=flatten(createhbzones.HBZone),
    analysisRecipe=gridbasedsimulation_2,
    writeRad=toggle_4,
    runRad=toggle_4,
    numOfCPUs="3",
    overwriteResults=True)  # -> readMe, analysisType, resultsUnit, results, testPts, resultFiles, radGeoFile, studyFolder, done; plug-in component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
lightingcontrol = Honeybee_LightingControlRecipe(
    controlType="4",
    sensorPoints=item_4,
    lightingPower=250,
    lightingSetpoint=300,
    ballastLossFactor=20,
    standbyPower=3,
    delayTime=5)  # -> lightingControlGroup; plug-in component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
gethbzoneepschedules = Honeybee_GetZoneEnergyPlusSchedules(HBZone=createhbzones.HBZone)  # -> occupancySchedule, occupancyActivitySch, heatingSetPtSchedule, coolingSetPtSchedule, lightingSchedule, equipmentSchedule, infiltrationSchedule; plug-in component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
rundaylightanalysis_2 = Honeybee_RunDaylightSimulation(
    HBObjects=flatten(createhbzones.HBZone),
    analysisRecipe=annualdaylightsimulation,
    writeRad=toggle_5,
    runRad=toggle_5,
    numOfCPUs=Slider(3, range=0..10),
    overwriteResults=True)  # -> readMe, analysisType, resultsUnit, results, testPts, annual_analysis_files, radGeoFile, studyFolder, done; plug-in component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
gradientlibrary = Ladybug_GradientLibrary(gradIndex=Slider(1, range=0..10))  # -> customColors; plug-in component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
legendpar = Ladybug_LegendParameters(
    lowBound=Slider(0, range=0..100),
    highBound=Slider(500, range=0..1000),
    numSegments=Slider(6, range=0..10),
    customColors=flatten(gradientlibrary))  # -> legendPar; plug-in component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
readannualresultsi = Honeybee_ReadAnnualResultI(
    illFilesAddress=rundaylightanalysis_2.annual_analysis_files,
    testPoints=simplify(rundaylightanalysis_2.testPts),
    occupancyFiles=gethbzoneepschedules.lightingSchedule,
    DLAIllumThresholds=300,
    lightingControlGroups=lightingcontrol,
    runIt=Toggle(True))  # -> DLA, UDLI_Less_100, UDLI_100_2000, UDLI_More_2000, CDA, sDA, annualProfiles, htmReport; plug-in component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

# ---- group: make it 3D!
dom = ConstructDomain(DomainStart=0, DomainEnd=Slider(1, range=0..1))

# ----
gradientlibrary_2 = Ladybug_GradientLibrary(gradIndex="1")  # -> customColors; plug-in component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
# Visualize the results
recolormesh = Ladybug_ReColorMesh(inputMesh=gentestpts.mesh, heightDomain=dom, legendPar=legendpar)  # -> readMe, newMesh, newLegend, legendBasePt, meshColors, legendColors; plug-in component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
dla_base = Data("C:\Users\Munazza\AppData\Roaming\Ladybug\unnamed\annualSimulation\unnamed_0_space_0_intgain.csv")
legendpar_2 = Ladybug_LegendParameters(lowBound="0", highBound="100", numSegments="6", customColors=flatten(gradientlibrary_2), decimalPlaces="0")  # -> legendPar; plug-in component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

# ---- group: just for visualization
# Compare Schedules!
dsannualprofiles = Honeybee_DaysimAnnualProfiles(annualProfiles=readannualresultsi.annualProfiles)  # -> simplify(occupancyProfile), simplify(shadingProfiles), simplify(lightingControlProfiles), simplify(dgpProfile); plug-in component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
convertepschvalues = Honeybee_ConvertEnergyPlusScheduleToValues(schName=gethbzoneepschedules.lightingSchedule)  # -> values; plug-in component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
_3dchart = Ladybug_3DChart(inputData=flatten([convertepschvalues, dsannualprofiles.lightingControlProfiles]))  # -> readMe, graphMesh, graphCurves, legend, legendBasePts, title, titleBasePts, dataPts, conditionalHOY; plug-in component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

# ----
# update lighting schedule
setepzoneschedules = Honeybee_SetEnergyPlusZoneSchedules(HBZones=setepzonecnstr, lightingSchedules=readannualresultsi.annualProfiles)  # -> schedules, simplify(HBZones); plug-in component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
recolormesh_2 = Ladybug_RecolorMesh(analysisResult=readannualresultsi.UDLI_100_2000, inputMesh=gentestpts_2.mesh, legendPar=legendpar_2, legendTitle="%")  # -> readMe, newMesh, newLegend, legendBasePt, meshColors, legendColors; plug-in component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

setepnatvent = Honeybee_SetEPAirFlow(
    HBZones=setepzoneschedules.HBZones,
    naturalVentilationType="1",
    minIndoorTempForNatVent="24",
    maxOutdoorTempForNatVent="28")  # -> readMe, simplify(HBZones); plug-in component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

toggle_6 = BooleanToggle(True)
epoutput = Honeybee_GenerateEPOutput(
    zoneEnergyUse=toggle_6,
    zoneGainsAndLosses=toggle_6,
    zoneComfortMetrics=toggle_6,
    surfaceTempAnalysis="False",
    timestep="hourly")  # -> report, flatten(simulationOutputs); plug-in component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
toggle_7 = BooleanToggle(True)
runenergysimulation = Honeybee_RunEnergySimulation(
    north="90",
    epwFile=open_epw_stat_2.epwFile,
    HBZones=flatten(setepnatvent.HBZones),
    simulationOutputs=flatten(epoutput.simulationOutputs),
    writeIdf=toggle_7,
    runEnergyPlus=toggle_7)  # -> report, idfFileAddress, resultFileAddress; plug-in component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
importepw = Ladybug_ImportEpw(epwFile=open_epw_stat_2.epwFile)  # -> readMe, latitude, location, dryBulbTemperature, dewPointTemperature, relativeHumidity, windSpeed, windDirection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; plug-in component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
toggle_8 = BooleanToggle(True)

# ---- group: Adaptive Comfort Oct 25 to Apr 10
analysisperiod = Ladybug_AnalysisPeriod(fromMonth="10", fromDay="25", toMonth="4", toDay="10")  # -> readMe, analysisPeriod; plug-in component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

# ----
adaptcomfortpar = Ladybug_AdaptiveComfortParameters(ASHRAEorEN=Toggle(False))  # -> comfortPar; plug-in component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
readepresult = Honeybee_ReadEPResult(resultFileAddress=runenergysimulation.resultFileAddress)  # -> totalThermalEnergy, thermalEnergyBalance, cooling, heating, electricLight, electricEquip, fanElectric, port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; plug-in component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

# ---- group: Base window with Wall_46 and Triple pane + NatVent
# AdapComfort = 88.7%
# PMV = 36.7%
# Psychor = -%
int = Integer(564)
int_2 = Integer(2484)
int_3 = Integer(1213)
cooling_load = Panel(int)
heating_load = Panel(int_2)
lighting_load = Panel(int_3)
ma = MassAddition(Input=[heating_load, lighting_load, cooling_load])  # -> Result, PartialResults
panel_4 = Panel(ma.Result)

# ----
solaradjusttemperature = Ladybug_OutdoorSolarTemperatureAdjustor(
    location=importepw.location,
    cumSkyMtxOrDirNormRad=importepw.directNormalRadiation,
    diffuseHorizRad=importepw.diffuseHorizontalRadiation,
    meanRadTemperature=importepw.dryBulbTemperature,
    north="65",
    parallel=toggle_8,
    runIt=toggle_8)  # -> readMe, port, effectiveRadiantField, MRTDelta, solarAdjustedMRT, port_2, mannequinMesh, port_3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; plug-in component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

# ---- group: two windows
# AdapComfort = 88%
# PMV = 32%
# Psychor = 97.5%
int_4 = Integer(448)
int_5 = Integer(3596)
int_6 = Integer(1208)
cooling_load_2 = Panel(int_4)
heating_load_2 = Panel(int_5)
lighting_load_2 = Panel(int_6)
ma_2 = MassAddition(Input=[heating_load_2, lighting_load_2, cooling_load_2])  # -> Result, PartialResults
panel_5 = Panel(ma_2.Result)

# ----
toggle_9 = BooleanToggle(True)
separatedata = Ladybug_SeparateData(inputList=flatten(readepresult.cooling))  # -> numbers, strings; plug-in component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

# ---- group: April to Oct 10
analysisperiod_2 = Ladybug_AnalysisPeriod(fromMonth="4", toMonth="10", toDay="10")  # -> readMe, analysisPeriod; plug-in component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

# ----
separatedata_2 = Ladybug_SeparateData(inputList=flatten(readepresult.heating))  # -> numbers, strings; plug-in component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
separatedata_3 = Ladybug_SeparateData(inputList=flatten(readepresult.electricLight))  # -> numbers, strings; plug-in component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

# ---- group: Outdoor Comfort
outdoorcomfortcalculator = Ladybug_OutdoorComfortCalculator(
    dryBulbTemperature=importepw.dryBulbTemperature,
    meanRadiantTemperature=solaradjusttemperature.solarAdjustedMRT,
    relativeHumidity=importepw.relativeHumidity,
    runIt=toggle_8)  # -> readMe, port, universalThermalClimateIndex, comfortableOrNot, thermalStress, conditionOfPerson, port_2, percentOfTimeComfortable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; plug-in component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
panel_6 = Panel(outdoorcomfortcalculator.percentOfTimeComfortable)
legendpar_3 = Ladybug_LegendParameters(lowBound="-3", highBound="3", numSegments="7")  # -> legendPar; plug-in component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
pt_2 = Point(Point(95.34809288, -33.04499866, 0))
_3dchart_2 = Ladybug_3DChart(
    inputData=flatten(outdoorcomfortcalculator.conditionOfPerson),
    basePoint=pt_2,
    xScale=".05",
    yScale=".25",
    zScale="0",
    legendPar=legendpar_3)  # -> readMe, graphMesh, graphCurves, legend, legendBasePts, title, titleBasePts, dataPts, conditionalHOY; plug-in component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

# ----
adaptivecomfortcalculator = Ladybug_AdaptiveComfortCalculator(
    dryBulbTemperature=readepresult.airTemperature,
    meanRadiantTemperature=readepresult.meanRadTemperature,
    prevailingOutdoorTemp=importepw.dryBulbTemperature,
    comfortPar=adaptcomfortpar,
    analysisPeriod=analysisperiod.analysisPeriod,
    runIt=toggle_9)  # -> readMe, port, comfortableOrNot, conditionOfPerson, degreesFromTarget, port_2, targetTemperature, upperTemperatureBound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; plug-in component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
pmvcomfortcalculator = Ladybug_PMVComfortCalculator(
    dryBulbTemperature=readepresult.airTemperature,
    meanRadiantTemperature=readepresult.meanRadTemperature,
    relativeHumidity=readepresult.relativeHumidity,
    calcBalanceTemperature=False,
    runIt=toggle_9)  # -> readMe, port, predictedMeanVote, percentPeopleDissatisfied, standardEffectiveTemperature, port_2, comfortableOrNot, percentOfTimeComfortable, port_3, balanceTemperature; plug-in component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
panel_7 = Panel("""0
.25
.5
1""")
panel_8 = Panel("""1
.9
.8
.6""")
ma_3 = MassAddition(Input=separatedata.numbers)  # -> Result, PartialResults
ma_4 = MassAddition(Input=separatedata_2.numbers)  # -> Result, PartialResults
ma_5 = MassAddition(Input=separatedata_3.numbers)  # -> Result, PartialResults
int_7 = Integer(ma_3.Result)

# ---- group: 2W w/Base Construction and triple pane windows
# AdapComfort = 88%
# PMV = 33%
# Psychor = 97.5%
int_8 = Integer(442)
int_9 = Integer(3419)
int_10 = Integer(1208)
cooling_load_3 = Panel(int_8)
heating_load_3 = Panel(int_9)
lighting_load_3 = Panel(int_10)
ma_6 = MassAddition(Input=[heating_load_3, lighting_load_3, cooling_load_3])  # -> Result, PartialResults
panel_9 = Panel(ma_6.Result)

# ---- group: BaseWindo with side window, wall_46 and triple pane + NatVent
# AdapComfort = 87.7%
# PMV = 35.4%
# Psychor = 97.8%
int_11 = Integer(654)
int_12 = Integer(2673)
int_13 = Integer(1143)
cooling_load_4 = Panel(int_11)
heating_load_4 = Panel(int_12)
lighting_load_4 = Panel(int_13)
ma_7 = MassAddition(Input=[heating_load_4, lighting_load_4, cooling_load_4])  # -> Result, PartialResults
panel_10 = Panel(ma_7.Result)

# ----
int_14 = Integer(ma_4.Result)
int_15 = Integer(ma_5.Result)
pt_3 = Point(Point(6.351915397, -33.04499866, 0))
rec = DataRecorder(int_7, DataLimit=-10, RecordData=True)
psychchart = Ladybug_PsychrometricChart(
    dryBulbTemperature=readepresult.airTemperature,
    relativeHumidity=readepresult.relativeHumidity,
    barometricPressure=importepw.barometricPressure,
    mergeComfPolygons=Toggle(False),
    basePoint=pt_3,
    runIt=Toggle(True))  # -> readMe, port, totalComfortPercent, totalComfortOrNot, strategyNames, strategyPercentOfTime, strategyOrNot, port_2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; plug-in component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
rec_2 = DataRecorder(int_14, DataLimit=-10, RecordData=True)
rec_3 = DataRecorder(int_15, DataLimit=-10, RecordData=True)
separatedata_4 = Ladybug_SeparateData(inputList=flatten(pmvcomfortcalculator.predictedMeanVote))  # -> numbers, strings; plug-in component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
int_16 = Integer(adaptivecomfortcalculator.percentOfTimeComfortable)
panel_11 = Panel(int_16)
toggle_10 = BooleanToggle(True)

legendpar_4 = Ladybug_LegendParameters(lowBound="0", highBound="1", numSegments="2", decimalPlaces="0", removeLessThan=toggle_10)  # -> legendPar; plug-in component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
pt_4 = Point(Point(96.48627943, -122.4319102, 0))
_3dchart_3 = Ladybug_3DChart(
    inputData=flatten(adaptivecomfortcalculator.comfortableOrNot),
    basePoint=pt_4,
    xScale="0.05",
    yScale=".25",
    zScale="0",
    legendPar=legendpar_4)  # -> readMe, graphMesh, graphCurves, legend, legendBasePts, titleText, titleBasePts, conditionalHOY; plug-in component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
panel_12 = Panel(adaptivecomfortcalculator.percentOfTimeComfortable)

round = Round(Number=separatedata_4.numbers)  # -> Nearest, Floor, Ceiling
int_17 = Integer(separatedata_4.numbers)

legendpar_5 = Ladybug_LegendParameters(lowBound="-3", highBound="3", numSegments="7", removeLessThan=Toggle(True))  # -> legendPar; plug-in component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
pt_5 = Point(Point(95.34809288, -33.04499866, 0))
_3dchart_4 = Ladybug_3DChart(
    inputData=flatten(round.Nearest),
    basePoint=pt_5,
    xScale="0.05",
    yScale=".25",
    zScale="0",
    legendPar=legendpar_5,
    condStatement="a>0 or a<0")  # -> readMe, graphMesh, graphCurves, legend, legendBasePts, title, titleBasePts, dataPts, conditionalHOY; plug-in component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
panel_13 = Panel(pmvcomfortcalculator.percentOfTimeComfortable)

int_18 = Integer(psychchart.totalComfortPercent)
rec_4 = DataRecorder(psychchart.totalComfortPercent, DataLimit=-10, RecordData=True)
panel_14 = Panel(rec_4)

# ---- group: 2W w/wall_46 and triple pane
# AdapComfort = 91%
# PMV = 36%
# Psychor = 97.7%
int_19 = Integer(455)
int_20 = Integer(2684)
int_21 = Integer(1208)
cooling_load_5 = Panel(int_19)
heating_load_5 = Panel(int_20)
lighting_load_5 = Panel(int_21)
ma_8 = MassAddition(Input=[heating_load_5, lighting_load_5, cooling_load_5])  # -> Result, PartialResults
panel_15 = Panel(ma_8.Result)

# ---- group: Final Design
# AdapComfort = 91%
# PMV = 36.1%
# Psychor = 97.6%
int_22 = Integer(435)
int_23 = Integer(2704)
int_24 = Integer(1212)
cooling_load_6 = Panel(int_22)
heating_load_6 = Panel(int_23)
lighting_load_6 = Panel(int_24)
ma_9 = MassAddition(Input=[heating_load_6, lighting_load_6, cooling_load_6])  # -> Result, PartialResults
panel_16 = Panel(ma_9.Result)

# ----
hot_cold = Panel(adaptivecomfortcalculator.percentHotCold)
total_cooling = Panel(rec)
legendpar_6 = Ladybug_LegendParameters(lowBound="-1", highBound="1", numSegments="3", decimalPlaces="0", removeLessThan=toggle_10)  # -> legendPar; plug-in component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
pt_6 = Point(Point(96.48627943, -122.4319102, 0))
legendpar_7 = Ladybug_LegendParameters(lowBound="0", highBound="1", numSegments="2", removeLessThan=Toggle(True))  # -> legendPar; plug-in component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
pt_7 = Point(Point(97.91460748, 43.78177414, 0))
total_heating = Panel(rec_2)
_3dchart_5 = Ladybug_3DChart(
    inputData=flatten(adaptivecomfortcalculator.conditionOfPerson),
    basePoint=pt_6,
    xScale="0.05",
    yScale=".25",
    zScale="0",
    legendPar=legendpar_6)  # -> readMe, graphMesh, graphCurves, legend, legendBasePts, titleText, titleBasePts, conditionalHOY; plug-in component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
_3dchart_6 = Ladybug_3DChart(
    inputData=flatten(psychchart.totalComfortOrNot),
    basePoint=pt_7,
    xScale="0.05",
    yScale=".25",
    zScale="0",
    legendPar=legendpar_7)  # -> readMe, graphMesh, graphCurves, legend, legendBasePts, titleText, titleBasePts, conditionalHOY; plug-in component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
total_lighting = Panel(rec_3)
ma_10 = MassAddition(Input=[int_7, int_14, int_15])  # -> Result, PartialResults
panel_17 = Panel(ma_10.Result)
