# Grasshopper definition Shading Device Daylighting and comfort.gh (Grasshopper 0.9.76)
# plug-ins: Python Interpreter

callfromepconstrlibrary = Honeybee_CallFromEPConstructionLibrary(keywords="glass_construction")  # -> ThermMaterials, EPMaterials, EPWindowMaterials, EPConstructions; plug-in component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
decomposeepconstruction = Honeybee_DecomposeEPConstruction(cnstrName=callfromepconstrlibrary.EPConstructions)  # -> materials, comments, UValue_SI, UValue_IP, RValue_SI, RValue_IP; plug-in component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
solar_transmittance = Slider(0, range=0..1)

open_weather_file = Ladybug_OpenEPWWeatherFile(open=Toggle(True))  # -> epwFile; plug-in component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
importepw = Ladybug_ImportEpw(epwFile=open_weather_file)  # -> readMe, latitude, location, dryBulbTemperature, dewPointTemperature, relativeHumidity, windSpeed, windDirection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; plug-in component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
number_slider = Slider(6, range=0..10)
analysisperiod = Ladybug_AnalysisPeriod(fromMonth=number_slider, toMonth=Slider(10, range=0..10))  # -> readMe, analysisPeriod; plug-in component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
sunpath = Ladybug_SunPath(location=importepw.location, hour=12, day=21, month=number_slider, timeStep=1, dailyOrAnnualSunPath=True)  # -> readMe, sunVectors, sunAltitudes, sunAzimuths, port, sunSpheresMesh, sunPathCrvs, legend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; plug-in component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
srf = Surface(<surface referenced from the Rhino model>)
shddesigner = Ladybug_ShadingDesigner(
    glzSrf=flatten(srf),
    depthOrVector=flatten(sunpath.sunVectors),
    numOfShds=Slider(11, range=0..100),
    distBetween=Slider(0.3, range=0..1),
    runIt=Toggle(True),
    mergeVectors=False)  # -> readMe, shadingSrfs; plug-in component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
panel = Panel(shddesigner.shadingSrfs)

epglassmat = Honeybee_EnergyPlusGlassMaterial(name="glassLayer", solarTransmittance=solar_transmittance, conductivity=Slider(0.5, range=0..1))  # -> EPMaterial; plug-in component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
epwindowairgap = Honeybee_EnergyPlusWindowAirGap(name="airgap", thickness="0.005")  # -> EPMaterial; plug-in component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
epconstruction = Honeybee_EnergyPlusConstruction(name="glass_construction", layer_1=epglassmat, layer_2=epwindowairgap, layer_3=epglassmat)  # -> EPConstruction; plug-in component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
wall_surface_with_opening = Brep(<brep referenced from the Rhino model>)
honeybee = Honeybee_Honeybee()  # -> Vviiiiiiiiiizzz; plug-in component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
ladybug = Ladybug_Ladybug()  # -> Vviiiiiiiiiizzz; plug-in component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
panel_2 = Panel(epconstruction)
createhbsrfs = Honeybee_createHBSrfs(geometry=wall_surface_with_opening, srfType="0")  # -> readMe, simplify(HBSurface); plug-in component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

# ---- group: glass facade
glass = Brep([<brep referenced from the Rhino model> x9])

# ----
radopaquematerial = Honeybee_RadianceOpaqueMaterial(materialName="generic_35", RReflectance=".35", GReflectance=".35", BReflectance=".35", roughness=0.05, specularity=0)  # -> avrgRef, RADMaterial; plug-in component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

# ---- group: furniture
furniture = Brep([<brep referenced from the Rhino model> x12])

# ----
ledge = Brep(<brep referenced from the Rhino model>)

# ---- group: ceiling
ceiling = Brep([<brep referenced from the Rhino model> x2])

# ---- group: floor
floor = Brep(<brep referenced from the Rhino model>)

# ----
walls = Brep([<brep referenced from the Rhino model> x2])
createhbsrfs_2 = Honeybee_createHBSrfs(geometry=createhbsrfs.HBSurface)  # -> readMe, simplify(HBSurface); plug-in component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
preview = CustomPreview(Geometry=glass, Shader=ColourSwatch(SwatchColor=RGBA(79, 223, 255, 51)))
addhbglz = Honeybee_addHBGlz(HBObj=createhbsrfs_2.HBSurface, childSurfaces=flatten(glass), EPConstructions=epconstruction)  # -> simplify(HBObjWGLZ); plug-in component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
createhbsrfs_3 = Honeybee_createHBSrfs(geometry=[ledge, furniture], RADMaterial=radopaquematerial.RADMaterial)  # -> readMe, simplify(HBSurface); plug-in component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
createhbsrfs_4 = Honeybee_createHBSrfs(geometry=floor, srfType="2")  # -> readMe, simplify(HBSurface); plug-in component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
createhbsrfs_5 = Honeybee_createHBSrfs(geometry=ceiling, srfType="3")  # -> readMe, simplify(HBSurface); plug-in component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
createhbsrfs_6 = Honeybee_createHBSrfs(geometry=walls, srfType="0")  # -> readMe, simplify(HBSurface); plug-in component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
makeadiabatic = Honeybee_MakeAdiabatic(HBSrfs=flatten([createhbsrfs_6.HBSurface, createhbsrfs_5.HBSurface, createhbsrfs_4.HBSurface, createhbsrfs_3.HBSurface]))  # -> HBSrfs; plug-in component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
brep = Brep(flatten([makeadiabatic, addhbglz]))
panel_3 = Panel("http://apps1.eere.energy.gov/buildings/energyplus/weatherdata/4_north_and_central_america_wmo_region_4/MEX_Mexico.City.766790_IWEC.zip")

bldgprograms = Honeybee_bldgPrograms({"Office": 0, "Retail": 1, "MidriseApartment": 2, "PrimarySchool": 3, "SecondarySchool": 4, "SmallHotel": 5, "LargeHotel": 6, "Hospital": 7, "Outpatient": 8, "Warehouse": 9, "SuperMarket": 10, "FullServiceRestaurant": 11, "QuickServiceRestaurant": 12}, selected="MidriseApartment")
listzoneprograms = Honeybee_ListZonePrograms(bldgProgram=bldgprograms)  # -> MidriseApartmentZonePrograms; plug-in component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
item = ListItem(List=listzoneprograms, Index=0, Wrap=True)
panel_4 = Panel(item)

open_epw_stat = Ladybug_OpenEPWAndSTATWeatherFiles(weatherFileURL=panel_3)  # -> epwFile, statFile; plug-in component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
createhbzones = Honeybee_createHBZones(zoneProgram=item, HBSurfaces=flatten(brep), isConditioned=True)  # -> readMe, HBZone; plug-in component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
wires = BrepWireframe(Brep=createhbzones.HBZone, Density=-1)

# ----
# Test Points Setup
panel_5 = Panel(".5")

# ---- group: collect all honeybee surfaces
brep_2 = Brep(flatten([createhbsrfs_6.HBSurface, createhbsrfs_5.HBSurface, createhbsrfs_4.HBSurface, createhbsrfs_3.HBSurface, addhbglz]))

# ----
# Shade Preparation
number_slider_2 = Slider(0.5, range=0..1)
radopaquematerial_2 = Honeybee_RadianceOpaqueMaterial(
    materialName="wall",
    RReflectance=number_slider_2,
    GReflectance=number_slider_2,
    BReflectance=number_slider_2,
    roughness=0.05,
    specularity=0)  # -> avrgRef, RADMaterial; plug-in component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
brep_3 = Brep([<brep referenced from the Rhino model> x36])
hb_epcontextsrf = HoneybeeEPContextSurfaces(shdSurfaces=flatten(brep_3), RADMaterial=radopaquematerial_2.RADMaterial)  # -> HBContext; inputs shdSurfaces: list of GeometryBase, justBoundingBox: Boolean
# ---------- hb_epcontextsrf: Python ----------
"""
prepare shading/context geometries

    Args:
        northVectorOrRotation: A vector that shows North or a number that shows
                               the rotation of the North from the Y axis
        bldgMasses: List of closed Breps as thermal zones.
    Returns:
        report: ...
        thermalZones: Thermal zone's geometries for visualiza
"""

ghenv.Component.Name = 'Honeybee EP context Surfaces'
ghenv.Component.NickName = 'HB_EPContextSrf'
ghenv.Component.Message = 'VER 0.0.58\nNOV_20_2015'
ghenv.Component.Category = "Honeybee"
ghenv.Component.SubCategory = "09 | Energy | Energy"
#compatibleHBVersion = VER 0.0.57\nNOV_01_2015
#compatibleLBVersion = VER 0.0.59\nFEB_01_2015
ghenv.Component.AdditionalHelpFromDocStrings = "2"

import rhinoscriptsyntax as rs
import Rhino as rc
import scriptcontext as sc
import os
import System
import Grasshopper.Kernel as gh
import uuid

tolerance = sc.doc.ModelAbsoluteTolerance
import math


def main(shdSurfaces, EPTransSchedule, meshingSettings, justBoundingBox):
    
    # import the classes
    if sc.sticky.has_key('honeybee_release'):

        try:
            if not sc.sticky['honeybee_release'].isCompatible(ghenv.Component): return -1
        except:
            warning = "You need a newer version of Honeybee to use this compoent." + \
            " Use updateHoneybee component to update userObjects.\n" + \
            "If you have already updated userObjects drag Honeybee_Honeybee component " + \
            "into canvas and try again."
            w = gh.GH_RuntimeMessageLevel.Warning
            ghenv.Component.AddRuntimeMessage(w, warning)
            return -1
        
        # don't customize this part
        hb_EPSrf = sc.sticky["honeybee_EPSurface"]
        hb_EPSHDSurface = sc.sticky["honeybee_EPShdSurface"]
        hb_RADMaterialAUX = sc.sticky["honeybee_RADMaterialAUX"]
        hb_EPObjectsAux = sc.sticky["honeybee_EPObjectsAUX"]()
        HBScheduleList = sc.sticky["honeybee_ScheduleLib"].keys()

        ########################################################################
        #----------------------------------------------------------------------#
        shdBreps = []
        # create bounding box of shading geometries
        if justBoundingBox:
            for brep in shdSurfaces:
                if brep.Faces.Count>1 or not brep.Faces[0].IsPlanar(sc.doc.ModelAbsoluteTolerance):
                    shdBreps.append(brep.GetBoundingBox(True).ToBrep())
                else:
                    shdBreps.append(brep)
        else:
            shdBreps = shdSurfaces
        
        shadingClasses = []
        shadingMeshPreview = []
        
        if meshingSettings == None:
            mp = rc.Geometry.MeshingParameters.Minimal
            mp.SimplePlanes = True
        else:
            mp = meshingSettings
        
        def getRadMaterialName(radMaterial):
            nameStr = radMaterial.split(" ")[2]
            name =  nameStr.split("\n")[0]
            return name
        
        for brepCount, brep in enumerate(shdBreps):
            if brep != None:
                isPlanar = True
                # check planarity
                for face in brep.Faces:
                    if not face.IsPlanar(tolerance):
                        isPlanar = False
                        break
                
                shadingBreps = []
                if not isPlanar:
                    meshArray = rc.Geometry.Mesh.CreateFromBrep(brep, mp)
                    for mesh in meshArray:
                        for meshFace in range(mesh.Faces.Count):
                            vertices = list(mesh.Faces.GetFaceVertices(meshFace))[1:]
                            vertices = vertices + [sc.doc.ModelAbsoluteTolerance]
                            # create the brep from mesh
                            shdBrep = rc.Geometry.Brep.CreateFromCornerPoints(*vertices)
                            shadingBreps.append(shdBrep)
                else:
                    for face in brep.Faces:
                        shadingBreps.append(face.DuplicateFace(False))
                
                for faceCount, shdBrep in enumerate(shadingBreps):
                        thisShading = hb_EPSHDSurface(shdBrep, 1000*brepCount + faceCount, 'shdSrf_' + `brepCount` + '_' + `faceCount` + "_" + str(uuid.uuid4()))
                        
                        # add transmittance schedule if any
                        if EPTransSchedule!=None:
                            schedule= EPTransSchedule.upper()
                            if schedule!=None and not schedule.lower().endswith(".csv") and schedule not in HBScheduleList:
                                msg = "Cannot find " + schedule + " in Honeybee schedule library."
                                print msg
                                ghenv.Component.AddRuntimeMessage(gh.GH_RuntimeMessageLevel.Warning, msg)
                                return -1
                            elif schedule!=None and schedule.lower().endswith(".csv"):
                                # check if csv file is existed
                                if not os.path.isfile(schedule):
                                    msg = "Cannot find the shchedule file: " + schedule
                                    print msg
                                    ghenv.Component.AddRuntimeMessage(gh.GH_RuntimeMessageLevel.Warning, msg)
                                    return -1
                            
                            thisShading.TransmittanceSCH = schedule
                        
                        # add the Rad Material if any
                        if RADMaterial!=None:
                            # if it is just the name of the material make sure it is already defined
                            if len(RADMaterial.split(" ")) == 1:
                                # if the material is not in the library add it to the library
                                if not hb_RADMaterialAUX.isMatrialExistInLibrary(RADMaterial):
                                    warningMsg = "Can't find " + RADMaterial + " in RAD Material Library.\n" + \
                                                "Add the material to the library and try again."
                                    ghenv.Component.AddRuntimeMessage(gh.GH_RuntimeMessageLevel.Warning, warningMsg)
                                    return
                                
                                try:
                                    thisShading.setRADMaterial(RADMaterial)
                                except Exception, e:
                                    print e
                                    warningMsg = "You are using an old version of Honeybee_Honeybee! Update your files and try again."
                                    print warningMsg
                                    ghenv.Component.AddRuntimeMessage(gh.GH_RuntimeMessageLevel.Warning, warningMsg)
                                    return
                                
                                addedToLib = True
                            else:
                                
                                # try to add the material to the library
                                addedToLib, thisShading.RadMaterial = hb_RADMaterialAUX.analyseRadMaterials(RADMaterial, True)
                                
                            if addedToLib==False:
                                warningMsg = "Failed to add " + RADMaterial + " to the Library."
                                ghenv.Component.AddRuntimeMessage(gh.GH_RuntimeMessageLevel.Warning, warningMsg)
                                return
                        
                        # add shading to the list
                        shadingClasses.append(thisShading)
                
        # add to the hive
        hb_hive = sc.sticky["honeybee_Hive"]()
        HBContext  = hb_hive.addToHoneybeeHive(shadingClasses, ghenv.Component.InstanceGuid.ToString())
        return HBContext
        ################################################################################################
    else:
        print "You should first let Honeybee to fly..."
        w = gh.GH_RuntimeMessageLevel.Warning
        ghenv.Component.AddRuntimeMessage(w, "You should first let Honeybee to fly...")
        return -1
        

if _shdSurfaces and _shdSurfaces[0]!=None:
    # add cleaning function
    result= main(_shdSurfaces, EPTransSchedule_, meshingSettings_, justBoundingBox_)
    
    if result != -1: HBContext = result
# ---------- end hb_epcontextsrf ----------

brep_4 = Brep(<brep referenced from the Rhino model>)
gentestpts = Honeybee_GenerateTestPoints(testGeometry=brep_4, gridSize=panel_5, distBaseSrf=".762", moveTestMesh=True)  # -> readMe, simplify(testPoints), simplify(ptsVectors), simplify(facesArea), simplify(mesh); plug-in component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

# ----
# Run Annual Daylight
radparameters = Honeybee_RADParameters(quality=0)  # -> readMe, radParameters; plug-in component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
annualdaylightsimulation = Honeybee_AnnualDaylightSimulation(
    epwWeatherFile=open_epw_stat.epwFile,
    testPoints=gentestpts.testPoints,
    ptsVectors=gentestpts.ptsVectors,
    testMesh=gentestpts.mesh,
    radParameters=radparameters.radParameters)  # -> analysisRecipe; plug-in component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
gethbzoneepschedules = Honeybee_GetZoneEnergyPlusSchedules(HBZone=createhbzones.HBZone)  # -> occupancySchedule, occupancyActivitySch, heatingSetPtSchedule, coolingSetPtSchedule, lightingSchedule, equipmentSchedule, infiltrationSchedule; plug-in component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
toggle = BooleanToggle(True)
rundaylightanalysis = Honeybee_RunDaylightSimulation(
    HBObjects=flatten([hb_epcontextsrf, createhbzones.HBZone]),
    analysisRecipe=annualdaylightsimulation,
    writeRad=toggle,
    runRad=toggle,
    numOfCPUs=Slider(10, range=0..10),
    overwriteResults=True)  # -> readMe, analysisType, resultsUnit, results, testPts, resultFiles, radGeoFile, studyFolder, done; plug-in component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

gradientlibrary = Ladybug_GradientLibrary(gradIndex=Slider(1, range=0..10))  # -> customColors; plug-in component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
# Visualize the results
number_slider_3 = Slider(1, range=0..1)
legendpar = Ladybug_LegendParameters(
    lowBound=Slider(0, range=0..100),
    highBound=Slider(100, range=0..100),
    numSegments=Slider(6, range=0..10),
    customColors=flatten(gradientlibrary))  # -> legendPar; plug-in component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

# ---- group: make it 3D!
dom = ConstructDomain(DomainStart=0, DomainEnd=number_slider_3)

# ----
item_2 = ListItem(List=gentestpts.testPoints, Index="11", Wrap=True)
number_slider_4 = Slider(100, range=0..100)
number_slider_5 = Slider(300, range=0..1000)
sph = Sphere(Base=item_2, Radius=Slider(0.1, range=0..0.1))
lightingcontrol = Honeybee_LightingControlRecipe(
    controlType="4",
    sensorPoints=item_2,
    lightingPower=250,
    lightingSetpoint=Slider(500, range=0..1000),
    ballastLossFactor=20,
    standbyPower=3,
    delayTime=5)  # -> lightingControlGroup; plug-in component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

# ----
# Generate lighting Schedule
toggle_2 = BooleanToggle(True)
readannualresultsi = Honeybee_ReadAnnualResultI(
    illFilesAddress=rundaylightanalysis.resultFiles,
    testPoints=simplify(rundaylightanalysis.testPts),
    occupancyFiles=gethbzoneepschedules.lightingSchedule,
    DLAIllumThresholds=300,
    lightingControlGroups=lightingcontrol,
    runIt=toggle_2)  # -> DLA, UDLI_Less_100, UDLI_100_2000, UDLI_More_2000, CDA, sDA, annualProfiles, htmReport; plug-in component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

recolormesh = Ladybug_ReColorMesh(
    analysisResult=readannualresultsi.DLA,
    inputMesh=gentestpts.mesh,
    heightDomain=dom,
    legendPar=legendpar,
    analysisTitle=rundaylightanalysis.analysisType,
    legendTitle="%")  # -> readMe, newMesh, newLegend, legendBasePt, meshColors, legendColors; plug-in component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

# ----
# update lighting schedule
setepzoneschedules = Honeybee_SetEnergyPlusZoneSchedules(HBZones=createhbzones.HBZone, lightingSchedules=readannualresultsi.annualProfiles)  # -> schedules, simplify(HBZones); plug-in component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

epoutput = Honeybee_GenerateEPOutput(zoneGainsAndLosses="False", zoneComfortMetrics=Toggle(True), surfaceTempAnalysis="False")  # -> out, flatten(simulationOutputs); plug-in component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
toggle_3 = BooleanToggle(True)

analysisperiod_2 = Ladybug_AnalysisPeriod(fromMonth=Slider(4, range=1..12), toMonth=Slider(10, range=1..12))  # -> readMe, analysisPeriod; plug-in component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

panel_6 = Panel(setepzoneschedules.schedules)
runenergysimulation = Honeybee_RunEnergySimulation(
    epwFile=open_epw_stat.epwFile,
    analysisPeriod=analysisperiod_2.analysisPeriod,
    HBZones=flatten(setepzoneschedules.HBZones),
    HBContext=flatten(hb_epcontextsrf),
    simulationOutputs=flatten(epoutput.simulationOutputs),
    writeIdf=toggle_3,
    runEnergyPlus=toggle_3)  # -> report, idfFileAddress, resultFileAddress; plug-in component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
panel_7 = Panel(runenergysimulation.resultFileAddress)
# Run the analysis Energy Plus
importepw_2 = Ladybug_ImportEpw(epwFile=open_epw_stat.epwFile)  # -> Output, latitude, location, dryBulbTemperature, dewPointTemperature, relativeHumidity, windSpeed, windDirection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; plug-in component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
readepresult = Honeybee_ReadEPResult(resultFileAddress=runenergysimulation.resultFileAddress)  # -> totalThermalEnergy, thermalEnergyBalance, cooling, heating, electricLight, electricEquip, fanElectric, pumpElectric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; plug-in component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
toggle_4 = BooleanToggle(True)
panel_8 = Panel(readepresult.relativeHumidity)
separatedata = Ladybug_SeparateData(inputList=flatten(readepresult.cooling))  # -> numbers, strings; plug-in component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
separatedata_2 = Ladybug_SeparateData(inputList=flatten(readepresult.heating))  # -> numbers, strings; plug-in component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
panel_9 = Panel(runenergysimulation.report)
adaptivecomfortcalculator = Ladybug_AdaptiveComfortCalculator(
    dryBulbTemperature=readepresult.airTemperature,
    meanRadiantTemperature=readepresult.meanRadTemperature,
    prevailingOutdoorTemp=importepw_2.dryBulbTemperature,
    runIt=toggle_4)  # -> out, port, comfortableOrNot, conditionOfPerson, degreesFromTarget, port_2, targetTemperature, upperTemperatureBound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; plug-in component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
pmvcomfortcalculator = Ladybug_PMVComfortCalculator(
    dryBulbTemperature=readepresult.airTemperature,
    meanRadiantTemperature=readepresult.meanRadTemperature,
    relativeHumidity=readepresult.relativeHumidity,
    calcBalanceTemperature=False,
    runIt=toggle_4)  # -> readMe, port, predictedMeanVote, percentPeopleDissatisfied, standardEffectiveTemperature, port_2, comfortableOrNot, percentOfTimeComfortable, port_3, balanceTemperature; plug-in component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
ma = MassAddition(Input=separatedata.numbers)  # -> Result, PartialResults
ma_2 = MassAddition(Input=separatedata_2.numbers)  # -> Result, PartialResults
total_cooling = Panel(ma.Result)
total_heating = Panel(ma_2.Result)
panel_10 = Panel(pmvcomfortcalculator.percentOfTimeComfortable)
panel_11 = Panel(adaptivecomfortcalculator.percentOfTimeComfortable)
rec = DataRecorder(panel_10, DataLimit=-10, RecordData=True)
panel_12 = Panel(adaptivecomfortcalculator.upperTemperatureBound)
rec_2 = DataRecorder(panel_11, DataLimit=-10, RecordData=True)
panel_13 = Panel(rec)
panel_14 = Panel(rec_2)
number_slider_6 = Slider(0.005, range=0..1)
pt = Point(<point referenced from the Rhino model>)
pt_2 = Point(<point referenced from the Rhino model>)
number_slider_7 = Slider(0.005, range=0..1)
_3dchart = Ladybug_3DChart(
    inputData=flatten(pmvcomfortcalculator.percentPeopleDissatisfied),
    basePoint=pt_2,
    xScale=number_slider_7,
    yScale=number_slider_7,
    zScale=number_slider_7)  # -> readMe, graphMesh, graphCurves, legend, legendBasePts, title, titleBasePts, dataPts, conditionalHOY; plug-in component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
_3dchart_2 = Ladybug_3DChart(
    inputData=flatten(adaptivecomfortcalculator.conditionOfPerson),
    basePoint=pt,
    xScale=number_slider_6,
    yScale=number_slider_6,
    zScale=number_slider_6)  # -> readMe, graphMesh, graphCurves, legend, legendBasePts, title, titleBasePts, dataPts, conditionalHOY; plug-in component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

open_weather_file_2 = Ladybug_OpenEPWWeatherFile(open=Toggle(True))  # -> epwFile; plug-in component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
importlocation = Ladybug_ImportLocation(epwFile=open_weather_file_2)  # -> location; plug-in component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
number_slider_8 = Slider(45, range=0..100)
# Geometry Preparation
# Honeybee default materials will be assigned
# based on surface type
# Assign specific materials
# Analysis Recipe
explodelocation = Ladybug_DecomposeLocation(location=importlocation)  # -> locationName, latitude, longitude, timeZone, elevation; plug-in component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
northarrow = Ladybug_North(north=number_slider_8, scale=".05")  # -> northSign; plug-in component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
genclimatebasedsky = Honeybee_GenerateClimateBasedSky(north=number_slider_8, weatherFile=open_weather_file_2, month="12", day="21", hour="12")  # -> radiationValues, skyFilePath; plug-in component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
# Run the analysis
panel_15 = Panel("3")
test_surfaces = Brep(<brep referenced from the Rhino model>)
radparameters_2 = Honeybee_RADParameters(quality=0, ab=panel_15)  # -> readMe, radParameters; plug-in component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
gentestpts_2 = Honeybee_GenerateTestPoints(testSurface=test_surfaces, gridSize=Slider(0.3, range=0..1), distBaseSrf=".762", moveTestMesh=True)  # -> readMe, simplify(testPoints), simplify(ptsVectors), simplify(facesArea), simplify(mesh); plug-in component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
gridbasedsimulation = Honeybee_GridBasedSimulation(
    skyFile=genclimatebasedsky.skyFilePath,
    testPoints=gentestpts_2.testPoints,
    ptsVectors=gentestpts_2.ptsVectors,
    testMesh=gentestpts_2.mesh,
    simulationType=0,
    radParameters=radparameters_2.radParameters)  # -> analysisRecipe; plug-in component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
doy_hoy = Ladybug_DOY_HOY(days="21", months="12", hours="12")  # -> HOY, DOY, date; plug-in component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
toggle_5 = BooleanToggle(True)
rundaylightanalysis_2 = Honeybee_RunDaylightSimulation(
    HBObjects=flatten(brep_2),
    analysisRecipe=gridbasedsimulation,
    writeRad=toggle_5,
    runRad=toggle_5,
    numOfCPUs="4",
    radFileName=doy_hoy.date,
    overwriteResults=True)  # -> readMe, analysisType, resultsUnit, illuminance_values, testPts, illuminance_files, radGeoFile, studyFolder, done; plug-in component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
gradientlibrary_2 = Ladybug_GradientLibrary(gradIndex="1")  # -> customColors; plug-in component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
panel_16 = Panel(rundaylightanalysis_2.studyFolder)
legendpar_2 = Ladybug_LegendParameters(lowBound="0", highBound="500", customColors=flatten(gradientlibrary_2))  # -> legendPar; plug-in component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
dom_2 = ConstructDomain(DomainStart="-.5", DomainEnd=".5")

# ---- group: Study Title
merge = Merge(
    Data2=flatten(rundaylightanalysis_2.analysisType),
    Data3=flatten(doy_hoy.date),
    Data4=flatten(explodelocation.locationName))
join = TextJoin(Text=merge)

# ----
panel_17 = Panel(join)
recolormesh_2 = Ladybug_ReColorMesh(
    analysisResult=rundaylightanalysis_2.illuminance_values,
    inputMesh=gentestpts_2.mesh,
    heightDomain=dom_2,
    legendPar=legendpar_2,
    analysisTitle=join,
    legendTitle=rundaylightanalysis_2.resultsUnit)  # -> readMe, newMesh, newLegend, legendBasePt, meshColors, legendColors; plug-in component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
