# Grasshopper definition 1102 Energy-Jin_Jaeho.gh (Grasshopper 0.9.76)
# plug-ins: Python Interpreter

ladybug = Ladybug_Ladybug()  # -> Vviiiiiiiiiizzz; plug-in component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
honeybee = Honeybee_Honeybee()  # -> Vviiiiiiiiiizzz; plug-in component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

# ---- group: floor
floor = Brep(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)

# ----
ledge = Brep(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)

# ---- group: ceiling
ceiling = Brep([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])

# ----
walls = Brep([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])
wall_surface_with_opening = Brep(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)
# Geometry Preparation
panel = Panel("0")
glass = Brep(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)
createhbsrfs = Honeybee_createHBSrfs(geometry=flatten([floor, ledge]), srfType="2")  # -> readMe, simplify(HBSurface); plug-in component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
brep = Brep([<brep referenced from the Rhino model> x91])
createhbsrfs_2 = Honeybee_createHBSrfs(geometry=ceiling, srfType="3")  # -> readMe, simplify(HBSurface); plug-in component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
# Honeybee default materials will be assigned
# based on surface type
createhbsrfs_3 = Honeybee_createHBSrfs(geometry=walls, srfType=panel)  # -> readMe, simplify(HBSurface); plug-in component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
createhbsrfs_4 = Honeybee_createHBSrfs(geometry=wall_surface_with_opening, srfType="0")  # -> readMe, simplify(HBSurface); plug-in component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

# ---- group: Horizontal #
number_slider = Slider(3, range=1..15)  # disabled

# ----
preview = CustomPreview(Geometry=glass, Shader=ColourSwatch(SwatchColor=RGBA(80, 222, 255, 160)))
addhbglz = Honeybee_addHBGlz(HBObj=createhbsrfs_4.HBSurface, childSurfaces=flatten(glass))  # -> simplify(HBObjWGLZ); plug-in component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
preview_2 = CustomPreview(Geometry=brep, Shader=ColourSwatch(SwatchColor=RGBA(199, 185, 98, 160)))

# ---- group: Shading A Depth
number_slider_2 = Slider(0.3, range=0..1)  # disabled

# ---- group: Shading A Angle
number_slider_3 = Slider(20, range=-90..90)  # disabled

# ---- group: Horizontal - Depth
# Control
number_slider_4 = Slider(0.4, range=0..1)  # disabled

# ---- group: Make all surfaces except the facade with window adiabatic
makeadiabatic = Honeybee_MakeAdiabatic(HBSrfs=flatten([createhbsrfs_3.HBSurface, createhbsrfs_2.HBSurface, createhbsrfs.HBSurface]))  # -> HBSrfs; plug-in component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

# ----
bldgprograms = Honeybee_bldgPrograms({"Office": 0, "Retail": 1, "MidriseApartment": 2, "PrimarySchool": 3, "SecondarySchool": 4, "SmallHotel": 5, "LargeHotel": 6, "Hospital": 7, "Outpatient": 8, "Warehouse": 9, "SuperMarket": 10, "FullServiceRestaurant": 11, "QuickServiceRestaurant": 12}, selected="MidriseApartment")
listzoneprograms = Honeybee_ListZonePrograms(bldgProgram=bldgprograms)  # -> MidriseApartmentZonePrograms; plug-in component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

# ---- group: Vertical - Depth
number_slider_5 = Slider(0.1, range=0..1)  # disabled

# ---- group: Shading B #
number_slider_6 = Slider(10, range=0..20)  # disabled

# ---- group: Vertical #
number_slider_7 = Slider(4, range=0..20)  # disabled

# ---- group: Shading B Depth
number_slider_8 = Slider(0.053, range=0..0.5)  # disabled

# ---- group: Shading B Angle
number_slider_9 = Slider(30, range=-90..90)  # disabled

# ----
item = ListItem(List=listzoneprograms, Index=0, Wrap=True)

# ---- group: collect all honeybee surfaces
brep_2 = Brep(flatten([makeadiabatic, addhbglz]))

# ----
panel_2 = Panel(item)
hb_epcontextsrf = HoneybeeEPContextSurfaces(shdSurfaces=flatten(brep))  # -> HBContext; inputs shdSurfaces: list of GeometryBase, justBoundingBox: Boolean
# ---------- hb_epcontextsrf: Python ----------
"""
prepare shading/context geometries

    Args:
        northVectorOrRotation: A vector that shows North or a number that shows
                               the rotation of the North from the Y axis
        bldgMasses: List of closed Breps as thermal zones.
    Returns:
        report: ...
        thermalZones: Thermal zone's geometries for visualiza
"""

ghenv.Component.Name = 'Honeybee EP context Surfaces'
ghenv.Component.NickName = 'HB_EPContextSrf'
ghenv.Component.Message = 'VER 0.0.57\nJUL_06_2015'
ghenv.Component.Category = "Honeybee"
ghenv.Component.SubCategory = "09 | Energy | Energy"
#compatibleHBVersion = VER 0.0.56\nFEB_01_2015
#compatibleLBVersion = VER 0.0.59\nFEB_01_2015
ghenv.Component.AdditionalHelpFromDocStrings = "2"

import rhinoscriptsyntax as rs
import Rhino as rc
import scriptcontext as sc
import os
import System
import Grasshopper.Kernel as gh
import uuid

tolerance = sc.doc.ModelAbsoluteTolerance
import math


def main(shdSurfaces, EPTransSchedule, meshingSettings, justBoundingBox):
    
    # import the classes
    if sc.sticky.has_key('honeybee_release'):

        try:
            if not sc.sticky['honeybee_release'].isCompatible(ghenv.Component): return -1
        except:
            warning = "You need a newer version of Honeybee to use this compoent." + \
            " Use updateHoneybee component to update userObjects.\n" + \
            "If you have already updated userObjects drag Honeybee_Honeybee component " + \
            "into canvas and try again."
            w = gh.GH_RuntimeMessageLevel.Warning
            ghenv.Component.AddRuntimeMessage(w, warning)
            return -1
        
        # don't customize this part
        hb_EPSrf = sc.sticky["honeybee_EPSurface"]
        hb_EPSHDSurface = sc.sticky["honeybee_EPShdSurface"]
        hb_RADMaterialAUX = sc.sticky["honeybee_RADMaterialAUX"]()
        hb_EPObjectsAux = sc.sticky["honeybee_EPObjectsAUX"]()
        HBScheduleList = sc.sticky["honeybee_ScheduleLib"].keys()

        ########################################################################
        #----------------------------------------------------------------------#
        shdBreps = []
        # create bounding box of shading geometries
        if justBoundingBox:
            for brep in shdSurfaces:
                if brep.Faces.Count>1 or not brep.Faces[0].IsPlanar(sc.doc.ModelAbsoluteTolerance):
                    shdBreps.append(brep.GetBoundingBox(True).ToBrep())
                else:
                    shdBreps.append(brep)
        else: shdBreps = shdSurfaces
        
        shadingClasses = []
        shadingMeshPreview = []
        
        if meshingSettings == None:
            mp = rc.Geometry.MeshingParameters.Minimal
            mp.SimplePlanes = True
        else:
            mp = meshingSettings
        
        def getRadMaterialName(radMaterial):
            nameStr = radMaterial.split(" ")[2]
            name =  nameStr.split("\n")[0]
            return name
        
        for brepCount, brep in enumerate(shdBreps):
            if brep != None:
                #if len(brep.DuplicateEdgeCurves(False))>1:
                
                meshArray = rc.Geometry.Mesh.CreateFromBrep(brep, mp)
                for mesh in meshArray:
                    for meshFace in range(mesh.Faces.Count):
                        vertices = list(mesh.Faces.GetFaceVertices(meshFace))[1:]
                        vertices = vertices + [sc.doc.ModelAbsoluteTolerance]
                        # create the brep from mesh
                        shdBrep = rc.Geometry.Brep.CreateFromCornerPoints(*vertices)
                        
                        thisShading = hb_EPSHDSurface(shdBrep, 1000*brepCount + meshFace, 'shdSrf_' + `brepCount` + '_' + `meshFace` + "_" + str(uuid.uuid4()))
                        
                        # add transmittance schedule if any
                        if EPTransSchedule!=None:
                            schedule= EPTransSchedule.upper()
                            if schedule!=None and not schedule.lower().endswith(".csv") and schedule not in HBScheduleList:
                                msg = "Cannot find " + schedule + " in Honeybee schedule library."
                                print msg
                                ghenv.Component.AddRuntimeMessage(gh.GH_RuntimeMessageLevel.Warning, msg)
                                return -1
                            elif schedule!=None and schedule.lower().endswith(".csv"):
                                # check if csv file is existed
                                if not os.path.isfile(schedule):
                                    msg = "Cannot find the shchedule file: " + schedule
                                    print msg
                                    ghenv.Component.AddRuntimeMessage(gh.GH_RuntimeMessageLevel.Warning, msg)
                                    return -1
                            
                            thisShading.TransmittanceSCH = schedule
                        
                        # add the Rad Material if any
                        if RADMaterial!=None:
                            # if it is just the name of the material make sure it is already defined
                            if len(RADMaterial.split(" ")) == 1:
                                # if the material is not in the library add it to the library
                                if RADMaterial not in sc.sticky ["honeybee_RADMaterialLib"].keys():
                                    warningMsg = "Can't find " + RADMaterial + " in RAD Material Library.\n" + \
                                                "Add the material to the library and try again."
                                    ghenv.Component.AddRuntimeMessage(gh.GH_RuntimeMessageLevel.Warning, warningMsg)
                                    return
                                
                                try:
                                    thisShading.setRADMaterial(RADMaterial)
                                except Exception, e:
                                    print e
                                    warningMsg = "You are using an old version of Honeybee_Honeybee! Update your files and try again."
                                    print warningMsg
                                    ghenv.Component.AddRuntimeMessage(gh.GH_RuntimeMessageLevel.Warning, warningMsg)
                                    return
                                
                                addedToLib = True
                            else:
                                
                                # try to add the material to the library
                                addedToLib, thisShading.RadMaterial = hb_RADMaterialAUX.analyseRadMaterials(RADMaterial, True)
                                
                            if addedToLib==False:
                                warningMsg = "Failed to add " + RADMaterial + " to the Library."
                                ghenv.Component.AddRuntimeMessage(gh.GH_RuntimeMessageLevel.Warning, warningMsg)
                                return
                        
                        # add shading to the list
                        shadingClasses.append(thisShading)
                
        # add to the hive
        hb_hive = sc.sticky["honeybee_Hive"]()
        HBContext  = hb_hive.addToHoneybeeHive(shadingClasses, ghenv.Component.InstanceGuid.ToString())
        return HBContext
        ################################################################################################
    else:
        print "You should first let Honeybee to fly..."
        w = gh.GH_RuntimeMessageLevel.Warning
        ghenv.Component.AddRuntimeMessage(w, "You should first let Honeybee to fly...")
        return -1
        

if _shdSurfaces and _shdSurfaces[0]!=None:
    # add cleaning function
    result= main(_shdSurfaces, EPTransSchedule_, meshingSettings_, justBoundingBox_)
    
    if result != -1: HBContext = result
# ---------- end hb_epcontextsrf ----------
createhbzones = Honeybee_createHBZones(name="test_room", zoneProgram=item, HBSurfaces=flatten(brep_2), isConditioned=True)  # -> readMe, HBZone; plug-in component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
panel_3 = Panel("http://apps1.eere.energy.gov/buildings/energyplus/weatherdata/4_north_and_central_america_wmo_region_4/1_usa/USA_PA_Philadelphia.Intl.AP.724080_TMY3.zip")
wires = BrepWireframe(Brep=createhbzones.HBZone, Density=-1)
epoutput = Honeybee_GenerateEPOutput(
    zoneEnergyUse=Toggle(True),
    zoneGainsAndLosses="False",
    zoneComfortMetrics="False",
    surfaceTempAnalysis="False",
    timestep="monthly")  # -> report, flatten(simulationOutputs); plug-in component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
open_epw_stat = Ladybug_OpenEPWAndSTATWeatherFiles(weatherFileURL=panel_3)  # -> epwFile, statFile; plug-in component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
energy_cooling_heating = BooleanToggle(True)
number_slider_10 = Slider(45, range=0..100)
# Run the analysis
panel_4 = Panel(".05")
northarrow = Ladybug_North(north=number_slider_10, scale=panel_4)  # -> northSign; plug-in component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
runenergysimulation = Honeybee_RunEnergySimulation(
    north=number_slider_10,
    epwFile=open_epw_stat.epwFile,
    HBZones=flatten(createhbzones.HBZone),
    HBContext=flatten(hb_epcontextsrf),
    simulationOutputs=flatten(epoutput.simulationOutputs),
    writeIdf=energy_cooling_heating,
    runEnergyPlus=energy_cooling_heating)  # -> report, idfFileAddress, resultFileAddress; plug-in component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
glass_2 = Brep(<brep referenced from the Rhino model>)  # disabled

demesh = DeconstructMesh(Mesh=glass_2)  # -> Vertices, Faces, Colours, Normals; disabled
number_slider_11 = Slider(1, range=0..3)  # disabled
number_slider_12 = Slider(0, range=0..3)  # disabled
number_slider_13 = Slider(2, range=0..3)  # disabled
number_slider_14 = Slider(3, range=0..3)  # disabled
item_2 = ListItem(List=demesh.Vertices, Index=number_slider_12, Wrap=True)  # disabled
item_3 = ListItem(List=demesh.Vertices, Index=number_slider_14, Wrap=True)  # disabled
item_4 = ListItem(List=demesh.Vertices, Index=number_slider_11, Wrap=True)  # disabled
item_5 = ListItem(List=demesh.Vertices, Index=number_slider_13, Wrap=True)  # disabled

readepresult = Honeybee_ReadEPResult(resultFileAddress=runenergysimulation.resultFileAddress)  # -> totalThermalEnergy, thermalEnergyBalance, cooling, heating, electricLight, electricEquip, port, port_2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; plug-in component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

ln = Line(StartPoint=item_3, EndPoint=item_4)  # disabled
ln_2 = Line(StartPoint=item_2, EndPoint=item_5)  # disabled
divide = DivideCurve(Curve=ln_2, Count=number_slider, Kinks=False)  # -> Points, Tangents, Parameters; disabled
divide_2 = DivideCurve(Curve=ln, Count=number_slider, Kinks=False)  # -> Points, Tangents, Parameters; disabled
ln_3 = Line(StartPoint=reverse(divide_2.Points), EndPoint=divide.Points)  # disabled
X = UnitX(Factor=number_slider_5)  # disabled
X_2 = UnitX(Factor=number_slider_4)  # disabled
extr = Extrude(Base=[ln_2, ln], Direction=X_2)  # disabled
extr_2 = Extrude(Base=ln_3, Direction=X)  # disabled
top_bottom = Geometry(extr)  # disabled
vertical = Geometry(extr_2)  # disabled

ln_4 = Line(StartPoint=item_3, EndPoint=item_5)  # disabled
ln_5 = Line(StartPoint=item_4, EndPoint=item_2)  # disabled
divide_3 = DivideCurve(Curve=ln_5, Count=number_slider_7, Kinks=False)  # -> Points, Tangents, Parameters; disabled
divide_4 = DivideCurve(Curve=ln_4, Count=number_slider_7, Kinks=False)  # -> Points, Tangents, Parameters; disabled
item_6 = ListItem(List=divide_4.Points, Index=1, Wrap=True)  # disabled
item_7 = ListItem(List=divide_3.Points, Index=1, Wrap=True)  # disabled
item_8 = ListItem(List=divide_3.Points, Index=1, Wrap=True)  # disabled
ln_6 = Line(StartPoint=item_7, EndPoint=item_6)  # disabled
dist = Distance(PointA=item_4, PointB=item_7)  # disabled
X_3 = UnitX(Factor=number_slider_2)  # disabled
multiplication = Multiplication(A=dist, B=-1)  # disabled
extr_3 = Extrude(Base=ln_6, Direction=X_3)  # disabled
Y = UnitY(Factor=1)  # disabled
Z = UnitZ(Factor=multiplication)  # disabled
rot3d = Rotate3D(Geometry=extr_3, Angle=degrees(number_slider_3), Center=item_7, Axis=Y)  # -> Geometry, Transform; disabled
subtraction = Subtraction(A=number_slider_7, B=1)  # disabled
arrlinear = LinearArray(Geometry=rot3d.Geometry, Direction=Z, Count=subtraction)  # -> Geometry, Transform; disabled

legendpar = Ladybug_LegendParameters(highBound=Slider(350, range=0..1000), numSegments=Slider(8, range=0..10))  # -> legendPar; plug-in component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
separatedata = Ladybug_SeparateData(inputList=flatten(readepresult.cooling))  # -> numbers, strings; plug-in component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
number_slider_15 = Slider(2, range=1..2)  # disabled

ln_7 = Line(StartPoint=item_4, EndPoint=item_7)  # disabled
ln_8 = Line(StartPoint=item_3, EndPoint=item_6)  # disabled
divide_5 = DivideCurve(Curve=ln_8, Count=number_slider_6, Kinks=False)  # -> Points, Tangents, Parameters; disabled
divide_6 = DivideCurve(Curve=ln_7, Count=number_slider_6, Kinks=False)  # -> Points, Tangents, Parameters; disabled
item_9 = ListItem(List=divide_6.Points, Index=1, Wrap=True)  # disabled
dist_2 = Distance(PointA=item_4, PointB=item_9)  # disabled
multiplication_2 = Multiplication(A=dist_2, B=-1)  # disabled
item_10 = ListItem(List=divide_5.Points, Index=1, Wrap=True)  # disabled
Z_2 = UnitZ(Factor=multiplication_2)  # disabled
ln_9 = Line(StartPoint=item_9, EndPoint=item_10)  # disabled
X_4 = UnitX(Factor=number_slider_8)  # disabled
extr_4 = Extrude(Base=ln_9, Direction=X_4)  # disabled
Y_2 = UnitY(Factor=1)  # disabled
rot3d_2 = Rotate3D(Geometry=extr_4, Angle=degrees(number_slider_9), Center=item_9, Axis=Y_2)  # -> Geometry, Transform; disabled
subtraction_2 = Subtraction(A=number_slider_6, B=1)  # disabled
arrlinear_2 = LinearArray(Geometry=rot3d_2.Geometry, Direction=Z_2, Count=subtraction_2)  # -> Geometry, Transform; disabled
division = Division(A=number_slider_7, B=number_slider_15)  # disabled
arrlinear_3 = LinearArray(Geometry=arrlinear_2.Geometry, Direction=Z, Count=division)  # -> Geometry, Transform; disabled

separatedata_2 = Ladybug_SeparateData(inputList=flatten(readepresult.heating))  # -> numbers, strings; plug-in component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
barchart = Ladybug_MonthlyBarChart(
    inputData=flatten([readepresult.cooling, readepresult.heating]),
    altYAxisTitle="Cooling and Heating Loads",
    basePoint="20, 0, 0",
    xScale=Slider(0.5, range=0..1),
    yScale=Slider(0.7, range=0..1),
    legendPar=legendpar)  # -> readMe, dataMesh, dataCurves, dataCrvColors, graphAxes, graphLabels, title, titleBasePt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; plug-in component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
ma = MassAddition(Input=separatedata.numbers)  # -> Result, PartialResults
ma_2 = MassAddition(Input=separatedata_2.numbers)  # -> Result, PartialResults
subtraction_3 = Subtraction(B=1)  # disabled
addition = Addition(A=division, B=1)  # disabled

total_cooling = Panel(ma.Result)
total_heating = Panel(ma_2.Result)
addition_2 = Addition(A=total_cooling, B=total_heating)
round = Round(Number=addition_2)  # -> Nearest, Floor, Ceiling
panel_5 = Panel(round.Nearest)

# ----
# Adaptive Shading Grid
shading = Geometry([top_bottom, vertical, arrlinear.Geometry, arrlinear_3.Geometry])  # disabled

total_cooling_2 = Panel(ma.Result)
shading_2 = Geometry([top_bottom, vertical, arrlinear.Geometry, arrlinear_3.Geometry])  # disabled
total_heating_2 = Panel(ma_2.Result)
