# Grasshopper definition Jin_Jaeho_Final Proposal Progress.gh (Grasshopper 0.9.76)
# plug-ins: Python Interpreter, ItemSelector

toggle = BooleanToggle(False)  # disabled
toggle_2 = BooleanToggle(False)  # disabled
updateladybug = Ladybug_UpdateLadybug(updateThisFile=toggle, updateAllUObjects=toggle_2)  # -> readMe; disabled; plug-in component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
updatehoneybee = Honeybee_UpdateHoneybee(updateThisFile=toggle, updateAllUObjects=toggle_2)  # -> readMe; disabled; plug-in component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

ladybug = Ladybug_Ladybug()  # -> Vviiiiiiiiiizzz; disabled; plug-in component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
honeybee = Honeybee_Honeybee()  # -> Vviiiiiiiiiizzz; disabled; plug-in component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

toggle_3 = BooleanToggle(False)  # disabled
toggle_4 = BooleanToggle(True)  # disabled
panel = Panel("Hall")  # disabled
mass2zone = Honeybee_Masses2Zones(zoneNames=panel, isConditioned=toggle_3, maxRoofAngle=30, createHBZones=toggle_4)  # -> readMe, HBZones; disabled; plug-in component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

# ----
# Shading
top_bottom_depth = ValueList({"0.1", "0.2", "0.3", "0.4", "0.5"}, selected="0.3")  # disabled
void = ValueList({"0", "1", "2", "3", "4"}, selected="3")  # disabled

toggle_5 = BooleanToggle(False)  # disabled
toggle_6 = BooleanToggle(False)  # disabled
updateladybug_2 = Ladybug_UpdateLadybug(updateThisFile=toggle_5, updateAllUObjects=toggle_6)  # -> readMe; disabled; plug-in component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
updatehoneybee_2 = Honeybee_UpdateHoneybee(updateThisFile=toggle_5, updateAllUObjects=toggle_6)  # -> readMe; disabled; plug-in component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

ladybug_2 = Ladybug_Ladybug()  # -> Vviiiiiiiiiizzz; disabled; plug-in component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
honeybee_2 = Honeybee_Honeybee()  # -> Vviiiiiiiiiizzz; disabled; plug-in component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

shadinga_depth = ValueList({"0.1", "0.2", "0.3", "0.4", "0.5"}, selected="0.2")  # disabled
shadinga_angle = ValueList({"-30", "-15", "0", "15", "30"}, selected="0")  # disabled
shadinga = ValueList({"2", "4", "6", "8"}, selected="4")  # disabled

shadingb_depth = ValueList({"0.1", "0.2", "0.3", "0.4", "0.5"}, selected="0.1")  # disabled
shadingb_angle = ValueList({"-30", "-15", "0", "15", "30"}, selected="0")  # disabled
shadingb = ValueList({"3", "5", "7", "9"}, selected="5")  # disabled

vertical_depth = ValueList({"0.1", "0.2", "0.3", "0.4"}, selected="0.2")  # disabled
vertical_angle = ValueList({"-30", "-15", "0", "15", "30"}, selected="0")  # disabled
vertical = ValueList({"3", "6", "9", "12"}, selected="9")  # disabled

# ---- group: ceiling
ceiling = Brep([<brep referenced from the Rhino model> x2])  # disabled

# ---- group: floor
floor = Brep(<brep referenced from the Rhino model>)  # disabled

# ----
# Geometry Preparation
# Honeybee default materials will be assigned
# based on surface type
wall_surface_with_opening = Brep(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)  # disabled
walls = Brep(<brep referenced from the Rhino model>)  # disabled
ledge = Brep(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)  # disabled
panel_2 = Panel("3")  # disabled
panel_3 = Panel("2")  # disabled
panel_4 = Panel("0")  # disabled
panel_5 = Panel("0")  # disabled
createhbsrfs = Honeybee_createHBSrfs(geometry=flatten([floor, ledge]), srfType=panel_3)  # -> readMe, simplify(HBSurface); disabled; plug-in component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
createhbsrfs_2 = Honeybee_createHBSrfs(geometry=walls, srfType=panel_5)  # -> readMe, simplify(HBSurface); disabled; plug-in component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
createhbsrfs_3 = Honeybee_createHBSrfs(geometry=ceiling, srfType=panel_2)  # -> readMe, simplify(HBSurface); disabled; plug-in component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
createhbsrfs_4 = Honeybee_createHBSrfs(geometry=wall_surface_with_opening, srfType=panel_4)  # -> readMe, simplify(HBSurface); disabled; plug-in component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

# ---- group: furniture
furniture = Brep([<brep referenced from the Rhino model> x12])  # disabled

# ---- group: glass facade
glass = Brep(<brep referenced from the Rhino model>)  # disabled

# ---- group: floor
floor_2 = Brep(<brep referenced from the Rhino model>)  # disabled

# ---- group: ceiling
ceiling_2 = Brep([<brep referenced from the Rhino model> x2])  # disabled

# ---- group: SHADE
shade = Brep([<brep referenced from the Rhino model> x11])  # disabled

# ---- group: floor
floor_3 = Brep(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)  # disabled

# ---- group: ceiling
ceiling_3 = Brep([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])  # disabled

# ----
swatch = ColourSwatch(SwatchColor=RGBA(79, 223, 255, 51))  # disabled
glass_2 = Brep(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)  # disabled
preview = CustomPreview(Geometry=glass_2, Shader=swatch)  # disabled

# ---- group: ceiling
ceiling_4 = Brep([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])  # disabled

# ---- group: floor
floor_4 = Brep(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)  # disabled

# ----
bldgprograms = Honeybee_bldgPrograms({"Office": 0, "Retail": 1, "MidriseApartment": 2, "PrimarySchool": 3, "SecondarySchool": 4, "SmallHotel": 5, "LargeHotel": 6, "Hospital": 7, "Outpatient": 8, "Warehouse": 9, "SuperMarket": 10, "FullServiceRestaurant": 11, "QuickServiceRestaurant": 12}, selected="MidriseApartment")  # disabled
listzoneprograms = Honeybee_ListZonePrograms(bldgProgram=bldgprograms)  # -> MidriseApartmentZonePrograms; disabled; plug-in component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
item = ListItem(List=listzoneprograms, Index=0, Wrap=True)  # disabled
panel_6 = Panel(item)  # disabled

# ---- group: ceiling
ceiling_5 = Brep([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])  # disabled

# ---- group: floor
floor_5 = Brep(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)  # disabled

# ----
# Geometry Preparation
# Honeybee default materials will be assigned
# based on surface type
walls_2 = Brep([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])  # disabled
ledge_2 = Brep(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)  # disabled
wall_surface_with_opening_2 = Brep(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)  # disabled
panel_7 = Panel("0")  # disabled
panel_8 = Panel("0")  # disabled
panel_9 = Panel("3")  # disabled
panel_10 = Panel("2")  # disabled
createhbsrfs_5 = Honeybee_createHBSrfs(geometry=flatten([floor_5, ledge_2]), srfType=panel_10)  # -> readMe, simplify(HBSurface); disabled; plug-in component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
createhbsrfs_6 = Honeybee_createHBSrfs(geometry=walls_2, srfType=panel_8)  # -> readMe, simplify(HBSurface); disabled; plug-in component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
createhbsrfs_7 = Honeybee_createHBSrfs(geometry=ceiling_5, srfType=panel_9)  # -> readMe, simplify(HBSurface); disabled; plug-in component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
createhbsrfs_8 = Honeybee_createHBSrfs(geometry=wall_surface_with_opening_2, srfType=panel_7)  # -> readMe, simplify(HBSurface); disabled; plug-in component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

bldgprograms_2 = Honeybee_bldgPrograms({"Office": 0, "Retail": 1, "MidriseApartment": 2, "PrimarySchool": 3, "SecondarySchool": 4, "SmallHotel": 5, "LargeHotel": 6, "Hospital": 7, "Outpatient": 8, "Warehouse": 9, "SuperMarket": 10, "FullServiceRestaurant": 11, "QuickServiceRestaurant": 12}, selected="MidriseApartment")  # disabled
listzoneprograms_2 = Honeybee_ListZonePrograms(bldgProgram=bldgprograms_2)  # -> MidriseApartmentZonePrograms; disabled; plug-in component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
item_2 = ListItem(List=listzoneprograms_2, Index=0, Wrap=True)  # disabled
panel_11 = Panel(item_2)  # disabled

number_slider = Slider(45, range=0..100)  # disabled
panel_12 = Panel("http://apps1.eere.energy.gov/buildings/energyplus/weatherdata/4_north_and_central_america_wmo_region_4/1_usa/USA_NY_New.York.City-Central.Park.744860_TMY2.zip")  # disabled
panel_13 = Panel(".05")  # disabled
open_epw_stat = Ladybug_OpenEPWAndSTATWeatherFiles(weatherFileURL=panel_12)  # -> epwFile, statFile; disabled; plug-in component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
northarrow = Ladybug_North(north=number_slider, scale=panel_13)  # -> northSign; disabled; plug-in component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

panel_14 = Panel(".5")  # disabled
panel_15 = Panel(".762")  # disabled
flip = Flip(Surface=floor)  # -> Surface, Result; disabled
gentestpts = Honeybee_GenerateTestPoints(testSurface=flip.Surface, gridSize=panel_14, distBaseSrf=panel_15, moveTestMesh=True)  # -> readMe, simplify(testPoints), simplify(ptsVectors), simplify(facesArea), simplify(mesh); disabled; plug-in component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
radparameters = Honeybee_RADParameters(quality=0)  # -> readMe, radParameters; disabled; plug-in component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
annualdaylightsimulation = Honeybee_AnnualDaylightSimulation(
    north=number_slider,
    epwWeatherFile=open_epw_stat.epwFile,
    testPoints=gentestpts.testPoints,
    ptsVectors=gentestpts.ptsVectors,
    testMesh=gentestpts.mesh,
    radParameters=radparameters.radParameters)  # -> analysisRecipe; disabled; plug-in component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

daylighting_simulation = BooleanToggle(False)  # disabled
# Run!
energy_simulation = BooleanToggle(False)  # disabled

# ---- group: Make all surfaces except the facade with window adiabatic
makeadiabatic = Honeybee_MakeAdiabatic(HBSrfs=flatten([createhbsrfs_2.HBSurface, createhbsrfs_3.HBSurface, createhbsrfs.HBSurface]))  # -> HBSrfs; disabled; plug-in component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

# ----
bldgprograms_3 = Honeybee_bldgPrograms({"Office": 0, "Retail": 1, "MidriseApartment": 2, "PrimarySchool": 3, "SecondarySchool": 4, "SmallHotel": 5, "LargeHotel": 6, "Hospital": 7, "Outpatient": 8, "Warehouse": 9, "SuperMarket": 10, "FullServiceRestaurant": 11, "QuickServiceRestaurant": 12}, selected="MidriseApartment")  # disabled
listzoneprograms_3 = Honeybee_ListZonePrograms(bldgProgram=bldgprograms_3)  # -> MidriseApartmentZonePrograms; disabled; plug-in component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
item_3 = ListItem(List=listzoneprograms_3, Index=0, Wrap=True)  # disabled
panel_16 = Panel(item_3)  # disabled

swatch_2 = ColourSwatch(SwatchColor=RGBA(79, 223, 255, 51))  # disabled
glass_3 = Brep(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)  # disabled
preview_2 = CustomPreview(Geometry=glass_3, Shader=swatch_2)  # disabled

# ---- group: Make all surfaces except the facade with window adiabatic
makeadiabatic_2 = Honeybee_MakeAdiabatic(HBSrfs=flatten([createhbsrfs_6.HBSurface, createhbsrfs_7.HBSurface, createhbsrfs_5.HBSurface]))  # -> HBSrfs; disabled; plug-in component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

# ----
# Shading
top_bot_depth = Panel("""0.1
0.2
0.3""")  # disabled
top_bot_depth_2 = Honeybee_ItemSelector(top_bot_depth, {"0.1", "0.2", "0.3"}, selected="0.3")  # disabled

# ----
# Run!
windowbasednaturalventilation = BooleanToggle(False)  # disabled

adaptive_comfort = BooleanToggle(True)  # disabled
pmv_comfort = BooleanToggle(True)  # disabled

toggle_7 = BooleanToggle(True)  # disabled
panel_17 = Panel("hourly")  # disabled
epoutput = Honeybee_GenerateEPOutput(
    zoneEnergyUse=toggle_7,
    zoneGainsAndLosses="False",
    zoneComfortMetrics=toggle_7,
    surfaceTempAnalysis="False",
    timestep=panel_17)  # -> report, flatten(simulationOutputs); disabled; plug-in component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

number_slider_2 = Slider(1, range=1..12)  # disabled
number_slider_3 = Slider(12, range=1..12)  # disabled
analysisperiod = Ladybug_AnalysisPeriod(fromMonth=number_slider_2, toMonth=number_slider_3)  # -> readMe, analysisPeriod; disabled; plug-in component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

# ----
# Run!
windowbasednaturalventilation_2 = BooleanToggle(True)  # disabled

panel_18 = Panel("http://apps1.eere.energy.gov/buildings/energyplus/weatherdata/4_north_and_central_america_wmo_region_4/1_usa/USA_NY_New.York.City-Central.Park.744860_TMY2.zip")  # disabled
number_slider_4 = Slider(90, range=0..100)  # disabled
panel_19 = Panel(".05")  # disabled
open_epw_stat_2 = Ladybug_OpenEPWAndSTATWeatherFiles(weatherFileURL=panel_18)  # -> epwFile, statFile; disabled; plug-in component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
northarrow_2 = Ladybug_North(north=number_slider_4, scale=panel_19)  # -> northSign; disabled; plug-in component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

adaptive_comfort_2 = BooleanToggle(True)  # disabled
pmv_comfort_2 = BooleanToggle(True)  # disabled

toggle_8 = BooleanToggle(True)  # disabled
panel_20 = Panel("hourly")  # disabled
epoutput_2 = Honeybee_GenerateEPOutput(
    zoneEnergyUse=toggle_8,
    zoneGainsAndLosses="False",
    zoneComfortMetrics=toggle_8,
    surfaceTempAnalysis="False",
    timestep=panel_20)  # -> report, flatten(simulationOutputs); disabled; plug-in component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

number_slider_5 = Slider(0.01, range=0..1)  # disabled
number_slider_6 = Slider(0.02, range=0..1)  # disabled
number_slider_7 = Slider(0.05, range=0..1)  # disabled

number_slider_8 = Slider(45, range=0..100)  # disabled
panel_21 = Panel("http://apps1.eere.energy.gov/buildings/energyplus/weatherdata/4_north_and_central_america_wmo_region_4/1_usa/USA_PA_Philadelphia.Intl.AP.724080_TMY3.zip")  # disabled
panel_22 = Panel(".05")  # disabled
open_epw_stat_3 = Ladybug_OpenEPWAndSTATWeatherFiles(weatherFileURL=panel_21)  # -> epwFile, statFile; disabled; plug-in component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
northarrow_3 = Ladybug_North(north=number_slider_8, scale=panel_22)  # -> northSign; disabled; plug-in component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

importepw = Ladybug_ImportEpw(epwFile=open_epw_stat_2.epwFile)  # -> readMe, latitude, location, dryBulbTemperature, dewPointTemperature, relativeHumidity, windSpeed, windDirection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; disabled; plug-in component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

importepw_2 = Ladybug_ImportEpw(epwFile=open_epw_stat_3.epwFile)  # -> readMe, latitude, location, dryBulbTemperature, dewPointTemperature, relativeHumidity, windSpeed, windDirection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; disabled; plug-in component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

number_slider_9 = Slider(7, range=0..10)  # disabled
number_slider_10 = Slider(3, range=-3..3)  # disabled
number_slider_11 = Slider(-3, range=-3..3)  # disabled
legendpar = Ladybug_LegendParameters(lowBound=number_slider_11, highBound=number_slider_10, numSegments=number_slider_9)  # -> legendPar; disabled; plug-in component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

panel_23 = Panel(".65")  # disabled
panel_24 = Panel("generic_35")  # disabled
panel_25 = Panel("glass_.65")  # disabled
panel_26 = Panel(".65")  # disabled
panel_27 = Panel(".35")  # disabled
radopaquematerial = Honeybee_RadianceOpaqueMaterial(
    materialName=panel_24,
    RReflectance=panel_27,
    GReflectance=panel_27,
    BReflectance=panel_27,
    roughness=0.05,
    specularity=0)  # -> avrgRef, RADMaterial; disabled; plug-in component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
radopaquematerial_2 = Honeybee_RadianceOpaqueMaterial(RReflectance=panel_23, GReflectance=panel_23, BReflectance=panel_23, roughness=0.05, specularity=0)  # -> avrgRef, RADMaterial; disabled; plug-in component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
ledge_3 = Brep(<brep referenced from the Rhino model>)  # disabled
radglassmaterial = Honeybee_RadianceGlassMaterial(materialName=panel_25, RTransmittance=panel_26, GTransmittance=panel_26, BTransmittance=panel_26, refractiveIndex=1.52)  # -> avrgTrans, RADMaterial; disabled; plug-in component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
walls_3 = Brep([<brep referenced from the Rhino model> x2])  # disabled
panel_28 = Panel("6")  # disabled
panel_29 = Panel("0")  # disabled
panel_30 = Panel("2")  # disabled
panel_31 = Panel("3")  # disabled
createhbsrfs_9 = Honeybee_createHBSrfs(geometry=shade, srfType=panel_28, RADMaterial=radopaquematerial_2.RADMaterial)  # -> readMe, simplify(HBSurface); disabled; plug-in component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
createhbsrfs_10 = Honeybee_createHBSrfs(geometry=[ledge_3, furniture], RADMaterial=radopaquematerial.RADMaterial)  # -> readMe, simplify(HBSurface); disabled; plug-in component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
createhbsrfs_11 = Honeybee_createHBSrfs(geometry=glass, RADMaterial=radglassmaterial.RADMaterial)  # -> readMe, simplify(HBSurface); disabled; plug-in component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
createhbsrfs_12 = Honeybee_createHBSrfs(geometry=floor_2, srfType=panel_30)  # -> readMe, simplify(HBSurface); disabled; plug-in component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
createhbsrfs_13 = Honeybee_createHBSrfs(geometry=ceiling_2, srfType=panel_31)  # -> readMe, simplify(HBSurface); disabled; plug-in component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
createhbsrfs_14 = Honeybee_createHBSrfs(geometry=walls_3, srfType=panel_29)  # -> readMe, simplify(HBSurface); disabled; plug-in component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
toggle_9 = BooleanToggle(True)  # disabled
number_slider_12 = Slider(0.762, range=0..1)  # disabled
number_slider_13 = Slider(0.4, range=0..1)  # disabled
panel_32 = Panel("http://apps1.eere.energy.gov/buildings/energyplus/weatherdata/4_north_and_central_america_wmo_region_4/1_usa/USA_PA_Philadelphia.Intl.AP.724080_TMY3.zip")  # disabled
# Add glazing based on percentage
# In case you want to add custom windows
# use Honeybee_addHBGlz component.
brep = Brep(<brep referenced from the Rhino model>)  # disabled
open_epw_stat_4 = Ladybug_OpenEPWAndSTATWeatherFiles(weatherFileURL=panel_32)  # -> epwFile, statFile; disabled; plug-in component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
gentestpts_2 = Honeybee_GenerateTestPoints(testSurface=brep, gridSize=number_slider_13, distBaseSrf=number_slider_12, moveTestMesh=toggle_9)  # -> readMe, simplify(testPoints), simplify(ptsVectors), simplify(facesArea), simplify(mesh); disabled; plug-in component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
wires = BrepWireframe(Brep=brep, Density=-1)  # disabled
# Put the recipie together!
annualdaylightsimulation_2 = Honeybee_AnnualDaylightSimulation(
    epwWeatherFile=open_epw_stat_4.epwFile,
    testPoints=gentestpts_2.testPoints,
    ptsVectors=gentestpts_2.ptsVectors,
    testMesh=gentestpts_2.mesh)  # -> analysisRecipe; disabled; plug-in component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
number_slider_14 = Slider(10, range=0..10)  # disabled
toggle_10 = BooleanToggle(True)  # disabled
toggle_11 = BooleanToggle(True)  # disabled
# Run the analysis
occupancygenerator = Honeybee_DaysimOccupancyGenerator(weekendDays=[1, 2], writeTheOcc=toggle_11)  # -> occupancyFile; disabled; plug-in component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
toggle_12 = BooleanToggle(True)  # disabled
number_slider_15 = Slider(1, range=0..10)  # disabled
number_slider_16 = Slider(100, range=0..100)  # disabled
number_slider_17 = Slider(0, range=0..100)  # disabled
number_slider_18 = Slider(11, range=0..11)  # disabled
gradientlibrary = Ladybug_GradientLibrary(gradIndex=number_slider_15)  # -> customColors; disabled; plug-in component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
number_slider_19 = Slider(1, range=0..1)  # disabled
legendpar_2 = Ladybug_LegendParameters(
    lowBound=number_slider_17,
    highBound=number_slider_16,
    numSegments=number_slider_18,
    customColors=flatten(gradientlibrary))  # -> legendPar; disabled; plug-in component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
panel_33 = Panel("%")  # disabled
panel_34 = Panel("(sDA:")  # disabled
panel_35 = Panel(")")  # disabled

# ---- group: collect all honeybee surfaces
brep_2 = Brep(flatten([createhbsrfs_14.HBSurface, createhbsrfs_13.HBSurface, createhbsrfs_12.HBSurface, createhbsrfs_10.HBSurface, createhbsrfs_11.HBSurface, createhbsrfs_9.HBSurface]))  # disabled

# ---- group: make it 3D!
dom = ConstructDomain(DomainStart=0, DomainEnd=number_slider_19)  # disabled

# ----
rundaylightanalysis = Honeybee_RunDaylightSimulation(
    HBObjects=flatten([brep, brep_2]),
    analysisRecipe=annualdaylightsimulation_2,
    writeRad=toggle_10,
    runRad=toggle_10,
    numOfCPUs=number_slider_14,
    overwriteResults=True)  # -> readMe, analysisType, resultsUnit, results, testPts, annual_analysis_files, radGeoFile, studyFolder, done; disabled; plug-in component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
# Generate annual results
readannualresultsi = Honeybee_ReadAnnualResultI(
    illFilesAddress=rundaylightanalysis.annual_analysis_files,
    testPoints=simplify(rundaylightanalysis.testPts),
    occupancyFiles=occupancygenerator,
    DLAIllumThresholds=300,
    runIt=toggle_12)  # -> DLA, UDLI_Less_100, UDLI_100_2000, UDLI_More_2000, CDA, sDA, annualProfiles, htmReport; disabled; plug-in component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
concat = Concatenate(FragmentA=rundaylightanalysis.analysisType, FragmentB=panel_34, FragmentC=readannualresultsi.sDA, FragmentD=panel_35)  # disabled
recolormesh = Ladybug_ReColorMesh(
    analysisResult=readannualresultsi.UDLI_100_2000,
    inputMesh=gentestpts_2.mesh,
    heightDomain=dom,
    legendPar=legendpar_2,
    analysisTitle=concat,
    legendTitle=panel_33)  # -> readMe, newMesh, newLegend, legendBasePt, meshColors, legendColors; disabled; plug-in component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
# Visualize the results
panel_36 = Panel(concat)  # disabled

# ----
# Geometry Preparation
# Run the analysis
panel_37 = Panel("Honeybee Annual Daylight Simulation Example")  # disabled
panel_38 = Panel("This file shows the minimum steps to set up a daylight model for a room in Honeybee. This example uses mass2zones component to prepare the geometries however you can create the geometries surface by surface using createHBSurface.")  # disabled
panel_39 = Panel("C:\Users\Administrator\Documents\GitHub\hydra_1")  # disabled
ladybug_3 = Ladybug_Ladybug()  # -> Vviiiiiiiiiizzz; disabled; plug-in component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
panel_40 = Panel("""Grasshopper
Daylighting
Annual
Radiance
Daysim
Honeybee""")  # disabled
honeybee_3 = Honeybee_Honeybee()  # -> Vviiiiiiiiiizzz; disabled; plug-in component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
toggle_13 = BooleanToggle(False)  # disabled
number_slider_20 = Slider(3.9, range=0..10)  # disabled
number_slider_21 = Slider(7, range=0..10)  # disabled
number_slider_22 = Slider(3.1, range=0..10)  # disabled
exporthydra = Hydra_ExportFile(fileName=panel_37, fileDescription=panel_38, fileTags=panel_40, targetFolder=panel_39, export=toggle_13)  # -> readMe; inputs fileDescription: list, changeLog: list, fileTags: list, includeRhino: Boolean, GHForThumb: Boolean, additionalImgs: list, export: Boolean; disabled; plug-in component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
brep_3 = Brep([<brep referenced from the Rhino model> x2])  # disabled
box = DomainBox(Base=PlaneXY(0, 0, 0), X=number_slider_20, Y=number_slider_21, Z=number_slider_22)  # disabled
toggle_14 = BooleanToggle(True)  # disabled
mass2zone_2 = Honeybee_Masses2Zones(zoneMasses=flatten(box), isConditioned=True, maxRoofAngle=30, createHBZones=toggle_14)  # -> readMe, HBZones; disabled; plug-in component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
number_slider_23 = Slider(0.3, range=0..1)  # disabled
glzparamlist = Honeybee_GlazingParametersList(northGlzParam=0, westGlzParam=0, southGlzParam=number_slider_23, eastGlzParam=0)  # -> glzParamList; disabled; plug-in component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
toggle_15 = BooleanToggle(True)  # disabled
# Honeybee default materials will be assigned
# based on surface type
glazingcreator = Honeybee_GlazingBasedOnRatio(HBObjects=mass2zone_2.HBZones, glzRatio=glzparamlist, runIt=toggle_15)  # -> readMe, HBObjWGLZ; disabled; plug-in component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
toggle_16 = BooleanToggle(True)  # disabled
number_slider_24 = Slider(0.794, range=0..1)  # disabled
brep_4 = Brep(<brep referenced from the Rhino model>)  # disabled
number_slider_25 = Slider(0.5, range=0..1)  # disabled
panel_41 = Panel("http://apps1.eere.energy.gov/buildings/energyplus/weatherdata/4_north_and_central_america_wmo_region_4/1_usa/USA_PA_Philadelphia.Intl.AP.724080_TMY3.zip")  # disabled
pt = ConstructPoint(XCoordinate=number_slider_20, YCoordinate=expr("-x", number_slider_21), ZCoordinate=0)  # disabled
pt_2 = ConstructPoint(XCoordinate=0, YCoordinate=0, ZCoordinate=0)  # disabled
genhbzonetestpts = Honeybee_GenerateZoneTestPoints(HBZone=brep_4, gridSize=number_slider_25, distBaseSrf=number_slider_24, moveTestMesh=toggle_16)  # -> readMe, simplify(testPoints), simplify(ptsVectors), simplify(facesArea), simplify(mesh); disabled; plug-in component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
open_epw_stat_5 = Ladybug_OpenEPWAndSTATWeatherFiles(weatherFileURL=panel_41)  # -> epwFile, statFile; disabled; plug-in component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
rec_2pt = Rectangle2Pt(Plane=PlaneXY(0, 0, 0), PointA=pt_2, PointB=pt, Radius=0)  # -> Rectangle, Length; disabled
boundary = BoundarySurfaces(Edges=rec_2pt.Rectangle)  # disabled
wires_2 = BrepWireframe(Brep=boundary, Density=-1)  # disabled
createhbsrfs_15 = Honeybee_createHBSrfs(geometry=boundary)  # -> readMe, simplify(HBSurface); disabled; plug-in component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
annualdaylightsimulation_3 = Honeybee_AnnualDaylightSimulation(
    epwWeatherFile=open_epw_stat_5.epwFile,
    testPoints=genhbzonetestpts.testPoints,
    ptsVectors=genhbzonetestpts.ptsVectors,
    testMesh=genhbzonetestpts.mesh)  # -> analysisRecipe; disabled; plug-in component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
toggle_17 = BooleanToggle(True)  # disabled
rundaylightanalysis_2 = Honeybee_RunDaylightSimulation(analysisRecipe=annualdaylightsimulation_3, writeRad=toggle_17, runRad=toggle_17, overwriteResults=True)  # -> readMe, analysisType, resultsUnit, results, testPts, resultFiles, radGeoFile, studyFolder, done; disabled; plug-in component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
toggle_18 = BooleanToggle(True)  # disabled
occupancygenerator_2 = Honeybee_DaysimOccupancyGenerator(weekendDays=[1, 2], writeTheOcc=toggle_18)  # -> occupancyFile; disabled; plug-in component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
toggle_19 = BooleanToggle(True)  # disabled
readannualresultsi_2 = Honeybee_ReadAnnualResultI(
    illFilesAddress=rundaylightanalysis_2.resultFiles,
    testPoints=simplify(rundaylightanalysis_2.testPts),
    occupancyFiles=occupancygenerator_2,
    DLAIllumThresholds=300,
    runIt=toggle_19)  # -> DLA, UDLI_Less_100, UDLI_100_2000, UDLI_More_2000, CDA, sDA, annualProfiles, htmReport; disabled; plug-in component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
number_slider_26 = Slider(1, range=0..10)  # disabled
number_slider_27 = Slider(100, range=0..100)  # disabled
number_slider_28 = Slider(0, range=0..100)  # disabled
number_slider_29 = Slider(6, range=0..10)  # disabled
gradientlibrary_2 = Ladybug_GradientLibrary(gradIndex=number_slider_26)  # -> customColors; disabled; plug-in component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
number_slider_30 = Slider(1, range=0..1)  # disabled
legendpar_3 = Ladybug_LegendParameters(
    lowBound=number_slider_28,
    highBound=number_slider_27,
    numSegments=number_slider_29,
    customColors=flatten(gradientlibrary_2))  # -> legendPar; disabled; plug-in component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
panel_42 = Panel("%")  # disabled

# ---- group: HB Zone With Glazing
brep_5 = Brep(glazingcreator.HBObjWGLZ)  # disabled

# ---- group: make it 3D!
dom_2 = ConstructDomain(DomainStart=0, DomainEnd=number_slider_30)  # disabled

# ----
wires_3 = BrepWireframe(Brep=brep_5, Density=-1)  # disabled
recolormesh_2 = Ladybug_ReColorMesh(
    analysisResult=readannualresultsi_2.DLA,
    inputMesh=genhbzonetestpts.mesh,
    heightDomain=dom_2,
    legendPar=legendpar_3,
    analysisTitle=rundaylightanalysis_2.analysisType,
    legendTitle=panel_42)  # -> readMe, newMesh, newLegend, legendBasePt, meshColors, legendColors; disabled; plug-in component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

ladybug_4 = Ladybug_Ladybug()  # -> Vviiiiiiiiiizzz; disabled; plug-in component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
honeybee_4 = Honeybee_Honeybee()  # -> Vviiiiiiiiiizzz; disabled; plug-in component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
ledge_4 = Brep(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)  # disabled
walls_4 = Brep([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])  # disabled
wall_surface_with_opening_3 = Brep(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)  # disabled
panel_43 = Panel("0")  # disabled
panel_44 = Panel("2")  # disabled
panel_45 = Panel("0")  # disabled
glass_4 = Brep(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)  # disabled
panel_46 = Panel("3")  # disabled
createhbsrfs_16 = Honeybee_createHBSrfs(geometry=flatten([floor_3, ledge_4]), srfType=panel_44)  # -> readMe, simplify(HBSurface); disabled; plug-in component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
brep_6 = Brep([<brep referenced from the Rhino model> x91])  # disabled
createhbsrfs_17 = Honeybee_createHBSrfs(geometry=ceiling_3, srfType=panel_46)  # -> readMe, simplify(HBSurface); disabled; plug-in component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
createhbsrfs_18 = Honeybee_createHBSrfs(geometry=walls_4, srfType=panel_43)  # -> readMe, simplify(HBSurface); disabled; plug-in component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
createhbsrfs_19 = Honeybee_createHBSrfs(geometry=wall_surface_with_opening_3, srfType=panel_45)  # -> readMe, simplify(HBSurface); disabled; plug-in component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
swatch_3 = ColourSwatch(SwatchColor=RGBA(80, 222, 255, 160))  # disabled
swatch_4 = ColourSwatch(SwatchColor=RGBA(199, 185, 98, 160))  # disabled
preview_3 = CustomPreview(Geometry=glass_4, Shader=swatch_3)  # disabled
addhbglz = Honeybee_addHBGlz(HBObj=createhbsrfs_19.HBSurface, childSurfaces=flatten(glass_4))  # -> simplify(HBObjWGLZ); disabled; plug-in component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
preview_4 = CustomPreview(Geometry=brep_6, Shader=swatch_4)  # disabled
bldgprograms_4 = Honeybee_bldgPrograms({"Office": 0, "Retail": 1, "MidriseApartment": 2, "PrimarySchool": 3, "SecondarySchool": 4, "SmallHotel": 5, "LargeHotel": 6, "Hospital": 7, "Outpatient": 8, "Warehouse": 9, "SuperMarket": 10, "FullServiceRestaurant": 11, "QuickServiceRestaurant": 12}, selected="MidriseApartment")  # disabled
listzoneprograms_4 = Honeybee_ListZonePrograms(bldgProgram=bldgprograms_4)  # -> MidriseApartmentZonePrograms; disabled; plug-in component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
item_4 = ListItem(List=listzoneprograms_4, Index=0, Wrap=True)  # disabled
panel_47 = Panel("test_room")  # disabled
panel_48 = Panel(item_4)  # disabled
hb_epcontextsrf = HoneybeeEPContextSurfaces(shdSurfaces=flatten(brep_6))  # -> HBContext; inputs shdSurfaces: list of GeometryBase, justBoundingBox: Boolean; disabled
# ---------- hb_epcontextsrf: Python ----------
"""
prepare shading/context geometries

    Args:
        northVectorOrRotation: A vector that shows North or a number that shows
                               the rotation of the North from the Y axis
        bldgMasses: List of closed Breps as thermal zones.
    Returns:
        report: ...
        thermalZones: Thermal zone's geometries for visualiza
"""

ghenv.Component.Name = 'Honeybee EP context Surfaces'
ghenv.Component.NickName = 'HB_EPContextSrf'
ghenv.Component.Message = 'VER 0.0.57\nJUL_06_2015'
ghenv.Component.Category = "Honeybee"
ghenv.Component.SubCategory = "09 | Energy | Energy"
#compatibleHBVersion = VER 0.0.56\nFEB_01_2015
#compatibleLBVersion = VER 0.0.59\nFEB_01_2015
ghenv.Component.AdditionalHelpFromDocStrings = "2"

import rhinoscriptsyntax as rs
import Rhino as rc
import scriptcontext as sc
import os
import System
import Grasshopper.Kernel as gh
import uuid

tolerance = sc.doc.ModelAbsoluteTolerance
import math


def main(shdSurfaces, EPTransSchedule, meshingSettings, justBoundingBox):
    
    # import the classes
    if sc.sticky.has_key('honeybee_release'):

        try:
            if not sc.sticky['honeybee_release'].isCompatible(ghenv.Component): return -1
        except:
            warning = "You need a newer version of Honeybee to use this compoent." + \
            " Use updateHoneybee component to update userObjects.\n" + \
            "If you have already updated userObjects drag Honeybee_Honeybee component " + \
            "into canvas and try again."
            w = gh.GH_RuntimeMessageLevel.Warning
            ghenv.Component.AddRuntimeMessage(w, warning)
            return -1
        
        # don't customize this part
        hb_EPSrf = sc.sticky["honeybee_EPSurface"]
        hb_EPSHDSurface = sc.sticky["honeybee_EPShdSurface"]
        hb_RADMaterialAUX = sc.sticky["honeybee_RADMaterialAUX"]()
        hb_EPObjectsAux = sc.sticky["honeybee_EPObjectsAUX"]()
        HBScheduleList = sc.sticky["honeybee_ScheduleLib"].keys()

        ########################################################################
        #----------------------------------------------------------------------#
        shdBreps = []
        # create bounding box of shading geometries
        if justBoundingBox:
            for brep in shdSurfaces:
                if brep.Faces.Count>1 or not brep.Faces[0].IsPlanar(sc.doc.ModelAbsoluteTolerance):
                    shdBreps.append(brep.GetBoundingBox(True).ToBrep())
                else:
                    shdBreps.append(brep)
        else: shdBreps = shdSurfaces
        
        shadingClasses = []
        shadingMeshPreview = []
        
        if meshingSettings == None:
            mp = rc.Geometry.MeshingParameters.Minimal
            mp.SimplePlanes = True
        else:
            mp = meshingSettings
        
        def getRadMaterialName(radMaterial):
            nameStr = radMaterial.split(" ")[2]
            name =  nameStr.split("\n")[0]
            return name
        
        for brepCount, brep in enumerate(shdBreps):
            if brep != None:
                #if len(brep.DuplicateEdgeCurves(False))>1:
                
                meshArray = rc.Geometry.Mesh.CreateFromBrep(brep, mp)
                for mesh in meshArray:
                    for meshFace in range(mesh.Faces.Count):
                        vertices = list(mesh.Faces.GetFaceVertices(meshFace))[1:]
                        vertices = vertices + [sc.doc.ModelAbsoluteTolerance]
                        # create the brep from mesh
                        shdBrep = rc.Geometry.Brep.CreateFromCornerPoints(*vertices)
                        
                        thisShading = hb_EPSHDSurface(shdBrep, 1000*brepCount + meshFace, 'shdSrf_' + `brepCount` + '_' + `meshFace` + "_" + str(uuid.uuid4()))
                        
                        # add transmittance schedule if any
                        if EPTransSchedule!=None:
                            schedule= EPTransSchedule.upper()
                            if schedule!=None and not schedule.lower().endswith(".csv") and schedule not in HBScheduleList:
                                msg = "Cannot find " + schedule + " in Honeybee schedule library."
                                print msg
                                ghenv.Component.AddRuntimeMessage(gh.GH_RuntimeMessageLevel.Warning, msg)
                                return -1
                            elif schedule!=None and schedule.lower().endswith(".csv"):
                                # check if csv file is existed
                                if not os.path.isfile(schedule):
                                    msg = "Cannot find the shchedule file: " + schedule
                                    print msg
                                    ghenv.Component.AddRuntimeMessage(gh.GH_RuntimeMessageLevel.Warning, msg)
                                    return -1
                            
                            thisShading.TransmittanceSCH = schedule
                        
                        # add the Rad Material if any
                        if RADMaterial!=None:
                            # if it is just the name of the material make sure it is already defined
                            if len(RADMaterial.split(" ")) == 1:
                                # if the material is not in the library add it to the library
                                if RADMaterial not in sc.sticky ["honeybee_RADMaterialLib"].keys():
                                    warningMsg = "Can't find " + RADMaterial + " in RAD Material Library.\n" + \
                                                "Add the material to the library and try again."
                                    ghenv.Component.AddRuntimeMessage(gh.GH_RuntimeMessageLevel.Warning, warningMsg)
                                    return
                                
                                try:
                                    thisShading.setRADMaterial(RADMaterial)
                                except Exception, e:
                                    print e
                                    warningMsg = "You are using an old version of Honeybee_Honeybee! Update your files and try again."
                                    print warningMsg
                                    ghenv.Component.AddRuntimeMessage(gh.GH_RuntimeMessageLevel.Warning, warningMsg)
                                    return
                                
                                addedToLib = True
                            else:
                                
                                # try to add the material to the library
                                addedToLib, thisShading.RadMaterial = hb_RADMaterialAUX.analyseRadMaterials(RADMaterial, True)
                                
                            if addedToLib==False:
                                warningMsg = "Failed to add " + RADMaterial + " to the Library."
                                ghenv.Component.AddRuntimeMessage(gh.GH_RuntimeMessageLevel.Warning, warningMsg)
                                return
                        
                        # add shading to the list
                        shadingClasses.append(thisShading)
                
        # add to the hive
        hb_hive = sc.sticky["honeybee_Hive"]()
        HBContext  = hb_hive.addToHoneybeeHive(shadingClasses, ghenv.Component.InstanceGuid.ToString())
        return HBContext
        ################################################################################################
    else:
        print "You should first let Honeybee to fly..."
        w = gh.GH_RuntimeMessageLevel.Warning
        ghenv.Component.AddRuntimeMessage(w, "You should first let Honeybee to fly...")
        return -1
        

if _shdSurfaces and _shdSurfaces[0]!=None:
    # add cleaning function
    result= main(_shdSurfaces, EPTransSchedule_, meshingSettings_, justBoundingBox_)
    
    if result != -1: HBContext = result
# ---------- end hb_epcontextsrf ----------
panel_49 = Panel("http://apps1.eere.energy.gov/buildings/energyplus/weatherdata/4_north_and_central_america_wmo_region_4/1_usa/USA_PA_Philadelphia.Intl.AP.724080_TMY3.zip")  # disabled
toggle_20 = BooleanToggle(True)  # disabled
epoutput_3 = Honeybee_GenerateEPOutput(
    zoneEnergyUse=toggle_20,
    zoneGainsAndLosses="False",
    zoneComfortMetrics="False",
    surfaceTempAnalysis="False",
    timestep="monthly")  # -> report, flatten(simulationOutputs); disabled; plug-in component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
open_epw_stat_6 = Ladybug_OpenEPWAndSTATWeatherFiles(weatherFileURL=panel_49)  # -> epwFile, statFile; disabled; plug-in component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
energy_cooling_heating = BooleanToggle(True)  # disabled
number_slider_31 = Slider(45, range=0..100)  # disabled
panel_50 = Panel(".05")  # disabled
northarrow_4 = Ladybug_North(north=number_slider_31, scale=panel_50)  # -> northSign; disabled; plug-in component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
number_slider_32 = Slider(8, range=0..10)  # disabled
number_slider_33 = Slider(350, range=0..1000)  # disabled
panel_51 = Panel("Cooling and Heating Loads")  # disabled
legendpar_4 = Ladybug_LegendParameters(highBound=number_slider_33, numSegments=number_slider_32)  # -> legendPar; disabled; plug-in component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
panel_52 = Panel("20, 0, 0")  # disabled
number_slider_34 = Slider(0.5, range=0..1)  # disabled
number_slider_35 = Slider(0.7, range=0..1)  # disabled

# ---- group: Make all surfaces except the facade with window adiabatic
makeadiabatic_3 = Honeybee_MakeAdiabatic(HBSrfs=flatten([createhbsrfs_18.HBSurface, createhbsrfs_17.HBSurface, createhbsrfs_16.HBSurface]))  # -> HBSrfs; disabled; plug-in component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

# ---- group: collect all honeybee surfaces
brep_7 = Brep(flatten([makeadiabatic_3, addhbglz]))  # disabled

# ----
createhbzones = Honeybee_createHBZones(name=panel_47, zoneProgram=item_4, HBSurfaces=flatten(brep_7), isConditioned=True)  # -> readMe, HBZone; disabled; plug-in component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
wires_4 = BrepWireframe(Brep=createhbzones.HBZone, Density=-1)  # disabled
runenergysimulation = Honeybee_RunEnergySimulation(
    north=number_slider_31,
    epwFile=open_epw_stat_6.epwFile,
    HBZones=flatten(createhbzones.HBZone),
    HBContext=flatten(hb_epcontextsrf),
    simulationOutputs=flatten(epoutput_3.simulationOutputs),
    writeIdf=energy_cooling_heating,
    runEnergyPlus=energy_cooling_heating)  # -> report, idfFileAddress, resultFileAddress; disabled; plug-in component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
readepresult = Honeybee_ReadEPResult(resultFileAddress=runenergysimulation.resultFileAddress)  # -> totalThermalEnergy, thermalEnergyBalance, cooling, heating, electricLight, electricEquip, port, port_2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; disabled; plug-in component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
separatedata = Ladybug_SeparateData(inputList=flatten(readepresult.cooling))  # -> numbers, strings; disabled; plug-in component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
separatedata_2 = Ladybug_SeparateData(inputList=flatten(readepresult.heating))  # -> numbers, strings; disabled; plug-in component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
barchart = Ladybug_MonthlyBarChart(
    inputData=flatten([readepresult.cooling, readepresult.heating]),
    altYAxisTitle=panel_51,
    basePoint=panel_52,
    xScale=number_slider_34,
    yScale=number_slider_35,
    legendPar=legendpar_4)  # -> readMe, dataMesh, dataCurves, dataCrvColors, graphAxes, graphLabels, title, titleBasePt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; disabled; plug-in component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
ma = MassAddition(Input=separatedata.numbers)  # -> Result, PartialResults; disabled
ma_2 = MassAddition(Input=separatedata_2.numbers)  # -> Result, PartialResults; disabled
total_cooling = Panel(ma.Result)  # disabled
total_heating = Panel(ma_2.Result)  # disabled

total_cooling_2 = Panel(ma.Result)  # disabled
total_heating_2 = Panel(ma_2.Result)  # disabled
addition = Addition(A=total_cooling_2, B=total_heating_2)  # disabled
round = Round(Number=addition)  # -> Nearest, Floor, Ceiling; disabled
panel_53 = Panel(round.Nearest)  # disabled

hall = Geometry(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)  # disabled
separatebynormal = Honeybee_SeparateByNormal(geometry=hall)  # -> simplify(lookingUp), simplify(lookingDown), simplify(lookingSide); disabled; plug-in component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

panel_54 = Panel("""0
1
2""")  # disabled
item_5 = ListItem(List=separatebynormal.lookingSide, Index=panel_54, Wrap=True)  # disabled
panel_55 = Panel("0")  # disabled
createhbsrfs_20 = Honeybee_createHBSrfs(geometry=item_5, srfType=panel_55)  # -> readMe, simplify(HBSurface); disabled; plug-in component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
brep_8 = Brep(createhbsrfs_20.HBSurface)  # disabled

panel_56 = Panel("""3
4
5""")  # disabled
item_6 = ListItem(List=separatebynormal.lookingSide, Index=panel_56, Wrap=True)  # disabled
panel_57 = Panel("0")  # disabled
createhbsrfs_21 = Honeybee_createHBSrfs(geometry=separatebynormal.lookingDown)  # -> readMe, simplify(HBSurface); disabled; plug-in component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
createhbsrfs_22 = Honeybee_createHBSrfs(geometry=separatebynormal.lookingUp)  # -> readMe, simplify(HBSurface); disabled; plug-in component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
createhbsrfs_23 = Honeybee_createHBSrfs(geometry=item_6, srfType=panel_57)  # -> readMe, simplify(HBSurface); disabled; plug-in component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
makeadiabatic_4 = Honeybee_MakeAdiabatic(HBSrfs=[createhbsrfs_22.HBSurface, createhbsrfs_21.HBSurface, createhbsrfs_23.HBSurface])  # -> HBSrfs; disabled; plug-in component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

walls_5 = Brep([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])  # disabled
ledge_5 = Brep(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)  # disabled

debrep = DeconstructBrep(Brep=walls_5)  # -> Faces, Edges, Vertices; disabled
panel_58 = Panel("""1
5
6""")  # disabled
item_7 = ListItem(List=flatten(debrep.Faces), Index=panel_58, Wrap=True)  # disabled
panel_59 = Panel("0")  # disabled
panel_60 = Panel("3")  # disabled
panel_61 = Panel("2")  # disabled
createhbsrfs_24 = Honeybee_createHBSrfs(geometry=flatten([floor_4, ledge_5]), srfType=panel_61)  # -> readMe, simplify(HBSurface); disabled; plug-in component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
createhbsrfs_25 = Honeybee_createHBSrfs(geometry=item_7, srfType=panel_59)  # -> readMe, simplify(HBSurface); disabled; plug-in component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
createhbsrfs_26 = Honeybee_createHBSrfs(geometry=ceiling_4, srfType=panel_60)  # -> readMe, simplify(HBSurface); disabled; plug-in component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

debrep_2 = DeconstructBrep(Brep=walls_5)  # -> Faces, Edges, Vertices; disabled
wall_surface_with_opening_4 = Brep(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)  # disabled
panel_62 = Panel("""2
3
4
7""")  # disabled
panel_63 = Panel("0")  # disabled
item_8 = ListItem(List=flatten(debrep_2.Faces), Index=panel_62, Wrap=True)  # disabled
createhbsrfs_27 = Honeybee_createHBSrfs(geometry=wall_surface_with_opening_4, srfType=panel_63)  # -> readMe, simplify(HBSurface); disabled; plug-in component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
panel_64 = Panel("0")  # disabled
createhbsrfs_28 = Honeybee_createHBSrfs(geometry=item_8, srfType=panel_64)  # -> readMe, simplify(HBSurface); disabled; plug-in component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
addhbglz_2 = Honeybee_addHBGlz(HBObj=createhbsrfs_27.HBSurface, childSurfaces=flatten(glass_2))  # -> simplify(HBObjWGLZ); disabled; plug-in component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

# ---- group: Make all surfaces except the facade with window adiabatic
makeadiabatic_5 = Honeybee_MakeAdiabatic(HBSrfs=flatten([createhbsrfs_26.HBSurface, createhbsrfs_24.HBSurface, createhbsrfs_25.HBSurface]))  # -> HBSrfs; disabled; plug-in component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

# ---- group: collect all honeybee surfaces
brep_9 = Brep(flatten([makeadiabatic_5, addhbglz_2, createhbsrfs_28.HBSurface]))  # disabled

# ----
toggle_21 = BooleanToggle(False)  # disabled
panel_65 = Panel("test_room")  # disabled
createhbzones_2 = Honeybee_createHBZones(name=panel_65, zoneProgram=item, HBSurfaces=flatten(brep_9), isConditioned=toggle_21)  # -> readMe, HBZone; disabled; plug-in component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

wires_5 = BrepWireframe(Brep=createhbzones_2.HBZone, Density=-1)  # disabled

# ----
# Result
glass_5 = Brep(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)  # disabled
swatch_5 = ColourSwatch(SwatchColor=RGBA(80, 222, 255, 160))  # disabled
addhbglz_3 = Honeybee_addHBGlz(HBObj=createhbsrfs_4.HBSurface, childSurfaces=flatten(glass_5))  # -> simplify(HBObjWGLZ); disabled; plug-in component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
preview_5 = CustomPreview(Geometry=glass_5, Shader=swatch_5)  # disabled
shading = Geometry([<brep referenced from the Rhino model> x11])  # disabled
panel_66 = Panel("test_room")  # disabled
hb_epcontextsrf_2 = HoneybeeEPContextSurfaces(shdSurfaces=flatten(shading))  # -> HBContext; inputs shdSurfaces: list of Brep, justBoundingBox: Boolean; disabled
# ---------- hb_epcontextsrf_2: Python ----------
"""
prepare shading/context geometries

    Args:
        northVectorOrRotation: A vector that shows North or a number that shows
                               the rotation of the North from the Y axis
        bldgMasses: List of closed Breps as thermal zones.
    Returns:
        report: ...
        thermalZones: Thermal zone's geometries for visualiza
"""

ghenv.Component.Name = 'Honeybee EP context Surfaces'
ghenv.Component.NickName = 'HB_EPContextSrf'
ghenv.Component.Message = 'VER 0.0.58\nNOV_20_2015'
ghenv.Component.Category = "Honeybee"
ghenv.Component.SubCategory = "09 | Energy | Energy"
#compatibleHBVersion = VER 0.0.57\nNOV_01_2015
#compatibleLBVersion = VER 0.0.59\nFEB_01_2015
ghenv.Component.AdditionalHelpFromDocStrings = "2"

import rhinoscriptsyntax as rs
import Rhino as rc
import scriptcontext as sc
import os
import System
import Grasshopper.Kernel as gh
import uuid

tolerance = sc.doc.ModelAbsoluteTolerance
import math


def main(shdSurfaces, EPTransSchedule, meshingSettings, justBoundingBox):
    
    # import the classes
    if sc.sticky.has_key('honeybee_release'):

        try:
            if not sc.sticky['honeybee_release'].isCompatible(ghenv.Component): return -1
        except:
            warning = "You need a newer version of Honeybee to use this compoent." + \
            " Use updateHoneybee component to update userObjects.\n" + \
            "If you have already updated userObjects drag Honeybee_Honeybee component " + \
            "into canvas and try again."
            w = gh.GH_RuntimeMessageLevel.Warning
            ghenv.Component.AddRuntimeMessage(w, warning)
            return -1
        
        # don't customize this part
        hb_EPSrf = sc.sticky["honeybee_EPSurface"]
        hb_EPSHDSurface = sc.sticky["honeybee_EPShdSurface"]
        hb_RADMaterialAUX = sc.sticky["honeybee_RADMaterialAUX"]
        hb_EPObjectsAux = sc.sticky["honeybee_EPObjectsAUX"]()
        HBScheduleList = sc.sticky["honeybee_ScheduleLib"].keys()

        ########################################################################
        #----------------------------------------------------------------------#
        shdBreps = []
        # create bounding box of shading geometries
        if justBoundingBox:
            for brep in shdSurfaces:
                if brep.Faces.Count>1 or not brep.Faces[0].IsPlanar(sc.doc.ModelAbsoluteTolerance):
                    shdBreps.append(brep.GetBoundingBox(True).ToBrep())
                else:
                    shdBreps.append(brep)
        else:
            shdBreps = shdSurfaces
        
        shadingClasses = []
        shadingMeshPreview = []
        
        if meshingSettings == None:
            mp = rc.Geometry.MeshingParameters.Minimal
            mp.SimplePlanes = True
        else:
            mp = meshingSettings
        
        def getRadMaterialName(radMaterial):
            nameStr = radMaterial.split(" ")[2]
            name =  nameStr.split("\n")[0]
            return name
        
        for brepCount, brep in enumerate(shdBreps):
            if brep != None:
                isPlanar = True
                # check planarity
                for face in brep.Faces:
                    if not face.IsPlanar(tolerance):
                        isPlanar = False
                        break
                
                shadingBreps = []
                if not isPlanar:
                    meshArray = rc.Geometry.Mesh.CreateFromBrep(brep, mp)
                    for mesh in meshArray:
                        for meshFace in range(mesh.Faces.Count):
                            vertices = list(mesh.Faces.GetFaceVertices(meshFace))[1:]
                            vertices = vertices + [sc.doc.ModelAbsoluteTolerance]
                            # create the brep from mesh
                            shdBrep = rc.Geometry.Brep.CreateFromCornerPoints(*vertices)
                            shadingBreps.append(shdBrep)
                else:
                    for face in brep.Faces:
                        shadingBreps.append(face.DuplicateFace(False))
                
                for faceCount, shdBrep in enumerate(shadingBreps):
                        thisShading = hb_EPSHDSurface(shdBrep, 1000*brepCount + faceCount, 'shdSrf_' + `brepCount` + '_' + `faceCount` + "_" + str(uuid.uuid4()))
                        
                        # add transmittance schedule if any
                        if EPTransSchedule!=None:
                            schedule= EPTransSchedule.upper()
                            if schedule!=None and not schedule.lower().endswith(".csv") and schedule not in HBScheduleList:
                                msg = "Cannot find " + schedule + " in Honeybee schedule library."
                                print msg
                                ghenv.Component.AddRuntimeMessage(gh.GH_RuntimeMessageLevel.Warning, msg)
                                return -1
                            elif schedule!=None and schedule.lower().endswith(".csv"):
                                # check if csv file is existed
                                if not os.path.isfile(schedule):
                                    msg = "Cannot find the shchedule file: " + schedule
                                    print msg
                                    ghenv.Component.AddRuntimeMessage(gh.GH_RuntimeMessageLevel.Warning, msg)
                                    return -1
                            
                            thisShading.TransmittanceSCH = schedule
                        
                        # add the Rad Material if any
                        if RADMaterial!=None:
                            # if it is just the name of the material make sure it is already defined
                            if len(RADMaterial.split(" ")) == 1:
                                # if the material is not in the library add it to the library
                                if not hb_RADMaterialAUX.isMatrialExistInLibrary(RADMaterial):
                                    warningMsg = "Can't find " + RADMaterial + " in RAD Material Library.\n" + \
                                                "Add the material to the library and try again."
                                    ghenv.Component.AddRuntimeMessage(gh.GH_RuntimeMessageLevel.Warning, warningMsg)
                                    return
                                
                                try:
                                    thisShading.setRADMaterial(RADMaterial)
                                except Exception, e:
                                    print e
                                    warningMsg = "You are using an old version of Honeybee_Honeybee! Update your files and try again."
                                    print warningMsg
                                    ghenv.Component.AddRuntimeMessage(gh.GH_RuntimeMessageLevel.Warning, warningMsg)
                                    return
                                
                                addedToLib = True
                            else:
                                
                                # try to add the material to the library
                                addedToLib, thisShading.RadMaterial = hb_RADMaterialAUX.analyseRadMaterials(RADMaterial, True)
                                
                            if addedToLib==False:
                                warningMsg = "Failed to add " + RADMaterial + " to the Library."
                                ghenv.Component.AddRuntimeMessage(gh.GH_RuntimeMessageLevel.Warning, warningMsg)
                                return
                        
                        # add shading to the list
                        shadingClasses.append(thisShading)
                
        # add to the hive
        hb_hive = sc.sticky["honeybee_Hive"]()
        HBContext  = hb_hive.addToHoneybeeHive(shadingClasses, ghenv.Component.InstanceGuid.ToString())
        return HBContext
        ################################################################################################
    else:
        print "You should first let Honeybee to fly..."
        w = gh.GH_RuntimeMessageLevel.Warning
        ghenv.Component.AddRuntimeMessage(w, "You should first let Honeybee to fly...")
        return -1
        

if _shdSurfaces and _shdSurfaces[0]!=None:
    # add cleaning function
    result= main(_shdSurfaces, EPTransSchedule_, meshingSettings_, justBoundingBox_)
    
    if result != -1: HBContext = result
# ---------- end hb_epcontextsrf_2 ----------
daylighting_test = ValueList({"0. DayLightingAtonomy": 0, "1. UDLI_less_100": 1, "2. UCLI_100_2000": 2, "3. UCLI_More_2000": 3}, selected="0. DayLightingAtonomy")  # disabled
toggle_22 = BooleanToggle(True)  # disabled
number_slider_36 = Slider(1.5, range=0..2)  # disabled
number_slider_37 = Slider(0.9, range=0..1)  # disabled
number_slider_38 = Slider(5, range=0..10)  # disabled
swatch_6 = ColourSwatch(SwatchColor=RGB(0, 0, 0))  # disabled

# ---- group: collect all honeybee surfaces
brep_10 = Brep(flatten([makeadiabatic, addhbglz_3]))  # disabled

# ----
panel_67 = Panel("""DayLightingAtomony,0,100,%
UDLI_less_100,0,100,%
UDLI_100_2000,0,100,%
UDLI_More_2000,0,100,%""")  # disabled
item_9 = ListItem(List=panel_67, Index=daylighting_test, Wrap=True)  # disabled
split = TextSplit(Text=item_9, Separators=",")  # disabled
item_10 = ListItem(List=split, Index=2, Wrap=True)  # disabled
item_11 = ListItem(List=split, Index=0, Wrap=True)  # disabled
item_12 = ListItem(List=split, Index=1, Wrap=True)  # disabled
item_13 = ListItem(List=split, Index=3, Wrap=True)  # disabled

number_slider_39 = Slider(300, range=0..10000)  # disabled
swatch_7 = ColourSwatch(SwatchColor=RGB(255, 217, 0))  # disabled
number_slider_40 = Slider(0, range=0..100)  # disabled
swatch_8 = ColourSwatch(SwatchColor=RGB(255, 143, 143))  # disabled
swatch_9 = ColourSwatch(SwatchColor=RGB(92, 149, 255))  # disabled
col = Colour([swatch_8, swatch_9, swatch_7])  # disabled
legendpar_5 = Ladybug_LegendParameters(lowBound=number_slider_40, highBound=number_slider_39, customColors=flatten(col), legendScale=number_slider_36)  # -> legendPar; disabled; plug-in component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

addhbglz_4 = Honeybee_addHBGlz(HBObj=createhbsrfs_8.HBSurface, childSurfaces=flatten(glass_3))  # -> simplify(HBObjWGLZ); disabled; plug-in component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
panel_68 = Panel("test_room")  # disabled

# ---- group: collect all honeybee surfaces
brep_11 = Brep(flatten([makeadiabatic_2, addhbglz_4]))  # disabled

# ----
createhbzones_3 = Honeybee_createHBZones(name=panel_68, zoneProgram=item_3, HBSurfaces=flatten(brep_11), isConditioned=True)  # -> readMe, HBZone; disabled; plug-in component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
wires_6 = BrepWireframe(Brep=createhbzones_3.HBZone, Density=-1)  # disabled

gethbzoneepschedules = Honeybee_GetZoneEnergyPlusSchedules(HBZone=createhbzones_3.HBZone)  # -> occupancySchedule, occupancyActivitySch, heatingSetPtSchedule, coolingSetPtSchedule, lightingSchedule, equipmentSchedule, infiltrationSchedule; disabled; plug-in component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
convertepschvalues = Honeybee_ConvertEnergyPlusScheduleToValues(schName=gethbzoneepschedules.occupancySchedule)  # -> values; disabled; plug-in component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
setepzoneschedules = Honeybee_SetEnergyPlusZoneSchedules(
    HBZones=createhbzones_3.HBZone,
    occupancySchedules=gethbzoneepschedules.occupancySchedule,
    occupancyActivitySchs=gethbzoneepschedules.occupancyActivitySch)  # -> schedules, simplify(HBZones); disabled; plug-in component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
number_slider_41 = Slider(0.1, range=0..0.1)  # disabled
panel_69 = Panel("a>0.5")  # disabled
panel_70 = Panel(convertepschvalues)  # disabled
_3dchart = Ladybug_3DChart(inputData=flatten(convertepschvalues), xScale=number_slider_41, condStatement=panel_69)  # -> readMe, graphMesh, graphCurves, legend, legendBasePts, title, titleBasePts, dataPts, conditionalHOY; disabled; plug-in component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

toggle_23 = BooleanToggle(True)  # disabled
panel_71 = Panel("air wall")  # disabled
solveadjc = Honeybee_SolveAdjacencies(HBZones=flatten(setepzoneschedules.HBZones), altConstruction=panel_71, removeCurrentAdjc=False, findAdjc=toggle_23)  # -> readMe, HBZonesWADJ; disabled; plug-in component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
decomposebytype = Honeybee_DecomposeBasedOnType(HBZone=solveadjc.HBZonesWADJ)  # -> walls, interiorWalls, airWalls, windows, interiorWindows, skylights, roofs, ceilings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; disabled; plug-in component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
swatch_10 = ColourSwatch(SwatchColor=RGBA(107, 218, 255, 120))  # disabled
preview_6 = CustomPreview(Geometry=decomposebytype.windows, Shader=swatch_10)  # disabled

wires_7 = BrepWireframe(Brep=brep_8, Density=-1)  # disabled
wires_8 = BrepWireframe(Brep=makeadiabatic_4, Density=-1)  # disabled
wires_9 = BrepWireframe(Brep=makeadiabatic_5, Density=-1)  # disabled
shading_2 = Geometry([<brep referenced from the Rhino model> x11])  # disabled
hb_epcontextsrf_3 = HoneybeeEPContextSurfaces(shdSurfaces=flatten(shading_2))  # -> HBContext; inputs shdSurfaces: list of GeometryBase, justBoundingBox: Boolean; disabled
# ---------- hb_epcontextsrf_3: Python ----------
"""
prepare shading/context geometries

    Args:
        northVectorOrRotation: A vector that shows North or a number that shows
                               the rotation of the North from the Y axis
        bldgMasses: List of closed Breps as thermal zones.
    Returns:
        report: ...
        thermalZones: Thermal zone's geometries for visualiza
"""

ghenv.Component.Name = 'Honeybee EP context Surfaces'
ghenv.Component.NickName = 'HB_EPContextSrf'
ghenv.Component.Message = 'VER 0.0.58\nNOV_07_2015'
ghenv.Component.Category = "Honeybee"
ghenv.Component.SubCategory = "09 | Energy | Energy"
#compatibleHBVersion = VER 0.0.57\nNOV_01_2015
#compatibleLBVersion = VER 0.0.59\nFEB_01_2015
ghenv.Component.AdditionalHelpFromDocStrings = "2"

import rhinoscriptsyntax as rs
import Rhino as rc
import scriptcontext as sc
import os
import System
import Grasshopper.Kernel as gh
import uuid

tolerance = sc.doc.ModelAbsoluteTolerance
import math


def main(shdSurfaces, EPTransSchedule, meshingSettings, justBoundingBox):
    
    # import the classes
    if sc.sticky.has_key('honeybee_release'):

        try:
            if not sc.sticky['honeybee_release'].isCompatible(ghenv.Component): return -1
        except:
            warning = "You need a newer version of Honeybee to use this compoent." + \
            " Use updateHoneybee component to update userObjects.\n" + \
            "If you have already updated userObjects drag Honeybee_Honeybee component " + \
            "into canvas and try again."
            w = gh.GH_RuntimeMessageLevel.Warning
            ghenv.Component.AddRuntimeMessage(w, warning)
            return -1
        
        # don't customize this part
        hb_EPSrf = sc.sticky["honeybee_EPSurface"]
        hb_EPSHDSurface = sc.sticky["honeybee_EPShdSurface"]
        hb_RADMaterialAUX = sc.sticky["honeybee_RADMaterialAUX"]
        hb_EPObjectsAux = sc.sticky["honeybee_EPObjectsAUX"]()
        HBScheduleList = sc.sticky["honeybee_ScheduleLib"].keys()

        ########################################################################
        #----------------------------------------------------------------------#
        shdBreps = []
        # create bounding box of shading geometries
        if justBoundingBox:
            for brep in shdSurfaces:
                if brep.Faces.Count>1 or not brep.Faces[0].IsPlanar(sc.doc.ModelAbsoluteTolerance):
                    shdBreps.append(brep.GetBoundingBox(True).ToBrep())
                else:
                    shdBreps.append(brep)
        else: shdBreps = shdSurfaces
        
        shadingClasses = []
        shadingMeshPreview = []
        
        if meshingSettings == None:
            mp = rc.Geometry.MeshingParameters.Minimal
            mp.SimplePlanes = True
        else:
            mp = meshingSettings
        
        def getRadMaterialName(radMaterial):
            nameStr = radMaterial.split(" ")[2]
            name =  nameStr.split("\n")[0]
            return name
        
        for brepCount, brep in enumerate(shdBreps):
            if brep != None:
                #if len(brep.DuplicateEdgeCurves(False))>1:
                
                meshArray = rc.Geometry.Mesh.CreateFromBrep(brep, mp)
                for mesh in meshArray:
                    for meshFace in range(mesh.Faces.Count):
                        vertices = list(mesh.Faces.GetFaceVertices(meshFace))[1:]
                        vertices = vertices + [sc.doc.ModelAbsoluteTolerance]
                        # create the brep from mesh
                        shdBrep = rc.Geometry.Brep.CreateFromCornerPoints(*vertices)
                        
                        thisShading = hb_EPSHDSurface(shdBrep, 1000*brepCount + meshFace, 'shdSrf_' + `brepCount` + '_' + `meshFace` + "_" + str(uuid.uuid4()))
                        
                        # add transmittance schedule if any
                        if EPTransSchedule!=None:
                            schedule= EPTransSchedule.upper()
                            if schedule!=None and not schedule.lower().endswith(".csv") and schedule not in HBScheduleList:
                                msg = "Cannot find " + schedule + " in Honeybee schedule library."
                                print msg
                                ghenv.Component.AddRuntimeMessage(gh.GH_RuntimeMessageLevel.Warning, msg)
                                return -1
                            elif schedule!=None and schedule.lower().endswith(".csv"):
                                # check if csv file is existed
                                if not os.path.isfile(schedule):
                                    msg = "Cannot find the shchedule file: " + schedule
                                    print msg
                                    ghenv.Component.AddRuntimeMessage(gh.GH_RuntimeMessageLevel.Warning, msg)
                                    return -1
                            
                            thisShading.TransmittanceSCH = schedule
                        
                        # add the Rad Material if any
                        if RADMaterial!=None:
                            # if it is just the name of the material make sure it is already defined
                            if len(RADMaterial.split(" ")) == 1:
                                # if the material is not in the library add it to the library
                                if not hb_RADMaterialAUX.isMatrialExistInLibrary(RADMaterial):
                                    warningMsg = "Can't find " + RADMaterial + " in RAD Material Library.\n" + \
                                                "Add the material to the library and try again."
                                    ghenv.Component.AddRuntimeMessage(gh.GH_RuntimeMessageLevel.Warning, warningMsg)
                                    return
                                
                                try:
                                    thisShading.setRADMaterial(RADMaterial)
                                except Exception, e:
                                    print e
                                    warningMsg = "You are using an old version of Honeybee_Honeybee! Update your files and try again."
                                    print warningMsg
                                    ghenv.Component.AddRuntimeMessage(gh.GH_RuntimeMessageLevel.Warning, warningMsg)
                                    return
                                
                                addedToLib = True
                            else:
                                
                                # try to add the material to the library
                                addedToLib, thisShading.RadMaterial = hb_RADMaterialAUX.analyseRadMaterials(RADMaterial, True)
                                
                            if addedToLib==False:
                                warningMsg = "Failed to add " + RADMaterial + " to the Library."
                                ghenv.Component.AddRuntimeMessage(gh.GH_RuntimeMessageLevel.Warning, warningMsg)
                                return
                        
                        # add shading to the list
                        shadingClasses.append(thisShading)
                
        # add to the hive
        hb_hive = sc.sticky["honeybee_Hive"]()
        HBContext  = hb_hive.addToHoneybeeHive(shadingClasses, ghenv.Component.InstanceGuid.ToString())
        return HBContext
        ################################################################################################
    else:
        print "You should first let Honeybee to fly..."
        w = gh.GH_RuntimeMessageLevel.Warning
        ghenv.Component.AddRuntimeMessage(w, "You should first let Honeybee to fly...")
        return -1
        

if _shdSurfaces and _shdSurfaces[0]!=None:
    # add cleaning function
    result= main(_shdSurfaces, EPTransSchedule_, meshingSettings_, justBoundingBox_)
    
    if result != -1: HBContext = result
# ---------- end hb_epcontextsrf_3 ----------
void_2 = Panel("2")  # disabled
panel_72 = Panel("C")  # disabled
swatch_11 = ColourSwatch(SwatchColor=RGB(0, 0, 0))  # disabled
panel_73 = Panel("""1
1
1
1
1
1
1
1
0
0
0
0
0
0
0
0
1
1
1
1
1
1
1
1""")  # disabled
number_slider_42 = Slider(0.7, range=0..1)  # disabled
toggle_24 = BooleanToggle(True)  # disabled
pt_3 = Point(Point(27, -55, 0))  # disabled
swatch_12 = ColourSwatch(SwatchColor=RGB(0, 0, 0))  # disabled

brep_12 = Brep([makeadiabatic_4, brep_8])  # disabled

toggle_25 = BooleanToggle(False)  # disabled
panel_74 = Panel("Hall")  # disabled
createhbzones_4 = Honeybee_createHBZones(name=panel_74, zoneProgram=item, HBSurfaces=flatten(brep_12), isConditioned=toggle_25)  # -> readMe, HBZone; disabled; plug-in component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

wires_10 = BrepWireframe(Brep=createhbzones_4.HBZone, Density=-1)  # disabled

createhbzones_5 = Honeybee_createHBZones(name=panel_66, zoneProgram=item_2, HBSurfaces=flatten(brep_10), isConditioned=True)  # -> readMe, HBZone; disabled; plug-in component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
wires_11 = BrepWireframe(Brep=createhbzones_5.HBZone, Density=-1)  # disabled

# ----
# Run Annual Daylight
number_slider_43 = Slider(3, range=0..10)  # disabled
rundaylightanalysis_3 = Honeybee_RunDaylightSimulation(
    HBObjects=flatten(createhbzones_5.HBZone),
    analysisRecipe=annualdaylightsimulation,
    writeRad=daylighting_simulation,
    runRad=daylighting_simulation,
    numOfCPUs=number_slider_43,
    overwriteResults=True)  # -> readMe, analysisType, resultsUnit, results, testPts, resultFiles, radGeoFile, studyFolder, done; disabled; plug-in component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
gethbzoneepschedules_2 = Honeybee_GetZoneEnergyPlusSchedules(HBZone=createhbzones_5.HBZone)  # -> occupancySchedule, occupancyActivitySch, heatingSetPtSchedule, coolingSetPtSchedule, lightingSchedule, equipmentSchedule, infiltrationSchedule; disabled; plug-in component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

# ----
# Generate
# lighting
# Schedule
toggle_26 = BooleanToggle(True)  # disabled
readannualresultsi_3 = Honeybee_ReadAnnualResultI(
    illFilesAddress=rundaylightanalysis_3.resultFiles,
    testPoints=simplify(rundaylightanalysis_3.testPts),
    occupancyFiles=gethbzoneepschedules_2.lightingSchedule,
    DLAIllumThresholds=300,
    runIt=toggle_26)  # -> DLA, UDLI_Less_100, UDLI_100_2000, UDLI_More_2000, CDA, sDA, annualProfiles, htmReport; disabled; plug-in component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

number_slider_44 = Slider(11, range=0..11)  # disabled
number_slider_45 = Slider(0.9, range=0..1)  # disabled
gradientlibrary_3 = Ladybug_GradientLibrary(gradIndex=0)  # -> customColors; disabled; plug-in component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
number_slider_46 = Slider(0.3, range=0..1)  # disabled
legendpar_6 = Ladybug_LegendParameters(
    lowBound=item_12,
    highBound=item_10,
    numSegments=number_slider_44,
    customColors=flatten(gradientlibrary_3),
    legendScale=number_slider_45)  # -> legendPar; disabled; plug-in component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
multiplication = Multiplication(A=number_slider_46, B=-1)  # disabled
dom_3 = ConstructDomain(DomainStart=number_slider_46, DomainEnd=multiplication)  # disabled
recolormesh_3 = Ladybug_ReColorMesh(
    analysisResult=readannualresultsi_3.DLA,
    inputMesh=gentestpts.mesh,
    heightDomain=dom_3,
    legendPar=legendpar_6,
    analysisTitle=item_11,
    legendTitle=item_13)  # -> readMe, newMesh, newLegend, legendBasePt, meshColors, legendColors; disabled; plug-in component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

# ----
# Update
# lighting
# schedule
setepzoneschedules_2 = Honeybee_SetEnergyPlusZoneSchedules(HBZones=createhbzones_5.HBZone, lightingSchedules=readannualresultsi_3.annualProfiles)  # -> schedules, simplify(HBZones); disabled; plug-in component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

# ----
# Run the analysis
toggle_27 = BooleanToggle(True)  # disabled
epoutput_4 = Honeybee_GenerateEPOutput(
    zoneEnergyUse=toggle_27,
    zoneGainsAndLosses="False",
    zoneComfortMetrics="False",
    surfaceTempAnalysis="False",
    timestep="monthly")  # -> report, flatten(simulationOutputs); disabled; plug-in component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
runenergysimulation_2 = Honeybee_RunEnergySimulation(
    north=number_slider,
    epwFile=open_epw_stat.epwFile,
    analysisPeriod=analysisperiod.analysisPeriod,
    HBZones=flatten(setepzoneschedules_2.HBZones),
    HBContext=flatten(hb_epcontextsrf_2),
    simulationOutputs=flatten(epoutput_4.simulationOutputs),
    writeIdf=toggle_22,
    runEnergyPlus=energy_simulation)  # -> report, idfFileAddress, resultFileAddress; disabled; plug-in component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
panel_75 = Panel(runenergysimulation_2.idfFileAddress)  # disabled

# ----
# Compare Schedules!
dsannualprofiles = Honeybee_DaysimAnnualProfiles(annualProfiles=readannualresultsi_3.annualProfiles)  # -> simplify(occupancyProfile), simplify(shadingProfiles), simplify(lightingControlProfiles), simplify(dgpProfile); disabled; plug-in component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
convertepschvalues_2 = Honeybee_ConvertEnergyPlusScheduleToValues(schName=gethbzoneepschedules_2.lightingSchedule)  # -> values; disabled; plug-in component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
number_slider_47 = Slider(11, range=0..11)  # disabled
legendpar_7 = Ladybug_LegendParameters(numSegments=number_slider_47, customColors=flatten(gradientlibrary_3))  # -> legendPar; disabled; plug-in component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
pt_4 = Point(Point(20, 20, 0))  # disabled
_3dchart_2 = Ladybug_3DChart(
    inputData=flatten([convertepschvalues_2, dsannualprofiles.lightingControlProfiles, dsannualprofiles.occupancyProfile]),
    basePoint=pt_4,
    xScale=number_slider_5,
    yScale=number_slider_7,
    zScale=number_slider_6,
    legendPar=legendpar_7)  # -> readMe, graphMesh, graphCurves, legend, legendBasePts, title, titleBasePts, dataPts, conditionalHOY; disabled; plug-in component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

readepresult_2 = Honeybee_ReadEPResult(resultFileAddress=runenergysimulation_2.resultFileAddress)  # -> totalThermalEnergy, thermalEnergyBalance, cooling, heating, electricLight, electricEquip, fanElectric, pumpElectric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; disabled; plug-in component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

panel_76 = Panel("""Cooling, Heating
& Lighting Loads""")  # disabled
number_slider_48 = Slider(0.5, range=0..1)  # disabled
number_slider_49 = Slider(0.5, range=0..1)  # disabled
panel_77 = Panel("100, 0, 0")  # disabled
barchart_2 = Ladybug_MonthlyBarChart(
    inputData=flatten([readepresult_2.heating, readepresult_2.cooling, readepresult_2.electricLight]),
    altYAxisTitle=panel_76,
    basePoint=panel_77,
    xScale=number_slider_48,
    yScale=number_slider_49,
    legendPar=legendpar_5)  # -> readMe, dataMesh, dataCurves, dataCrvColors, graphAxes, graphLabels, title, titleBasePt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; disabled; plug-in component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

separatedata_3 = Ladybug_SeparateData(inputList=flatten(readepresult_2.totalThermalEnergy))  # -> numbers, strings; disabled; plug-in component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
ma_3 = MassAddition(Input=separatedata_3.numbers)  # -> Result, PartialResults; disabled
total_thermal_energy = Panel(ma_3.Result)  # disabled

separatedata_4 = Ladybug_SeparateData(inputList=flatten(readepresult_2.cooling))  # -> numbers, strings; disabled; plug-in component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
separatedata_5 = Ladybug_SeparateData(inputList=flatten(readepresult_2.heating))  # -> numbers, strings; disabled; plug-in component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
separatedata_6 = Ladybug_SeparateData(inputList=flatten(readepresult_2.electricLight))  # -> numbers, strings; disabled; plug-in component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
ma_4 = MassAddition(Input=separatedata_4.numbers)  # -> Result, PartialResults; disabled
ma_5 = MassAddition(Input=separatedata_5.numbers)  # -> Result, PartialResults; disabled
ma_6 = MassAddition(Input=separatedata_6.numbers)  # -> Result, PartialResults; disabled
total_heating_3 = Panel(ma_5.Result)  # disabled
total_cooling_3 = Panel(ma_4.Result)  # disabled
total_lighting = Panel(ma_6.Result)  # disabled

sda = Panel(readannualresultsi_3.sDA)  # disabled
total_cooling_4 = Panel(ma_4.Result)  # disabled
total_heating_4 = Panel(ma_5.Result)  # disabled
separatedata_7 = Ladybug_SeparateData(inputList=flatten([readepresult_2.heating, readepresult_2.cooling, readepresult_2.electricLight]))  # -> numbers, strings; disabled; plug-in component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
addition_2 = Addition(A=total_cooling_4, B=total_heating_4)  # disabled
round_2 = Round(Number=addition_2)  # -> Nearest, Floor, Ceiling; disabled
round_3 = Round(Number=separatedata_7.numbers)  # -> Nearest, Floor, Ceiling; disabled
panel_78 = Panel(round_2.Nearest)  # disabled
tag = TextTag3D(
    Location=barchart_2.dataLabelPts,
    Text=round_3.Nearest,
    Size=number_slider_37,
    Colour=swatch_6,
    Justification=number_slider_38)  # disabled

brep_13 = Brep([createhbzones_2.HBZone, createhbzones_4.HBZone])  # disabled

gethbzoneepschedules_3 = Honeybee_GetZoneEnergyPlusSchedules(HBZone=brep_13)  # -> occupancySchedule, occupancyActivitySch, heatingSetPtSchedule, coolingSetPtSchedule, lightingSchedule, equipmentSchedule, infiltrationSchedule; disabled; plug-in component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
setepzoneschedules_3 = Honeybee_SetEnergyPlusZoneSchedules(
    HBZones=brep_13,
    occupancySchedules=gethbzoneepschedules_3.occupancySchedule,
    occupancyActivitySchs=gethbzoneepschedules_3.occupancyActivitySch)  # -> schedules, simplify(HBZones); disabled; plug-in component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
convertepschvalues_3 = Honeybee_ConvertEnergyPlusScheduleToValues(schName=gethbzoneepschedules_3.occupancySchedule)  # -> values; disabled; plug-in component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

toggle_28 = BooleanToggle(True)  # disabled
panel_79 = Panel("air wall")  # disabled
solveadjc_2 = Honeybee_SolveAdjacencies(HBZones=flatten(setepzoneschedules_3.HBZones), removeCurrentAdjc=False, findAdjc=toggle_28)  # -> readMe, HBZonesWADJ; disabled; plug-in component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
decomposebytype_2 = Honeybee_DecomposeBasedOnType(HBZone=solveadjc_2.HBZonesWADJ)  # -> walls, interiorWalls, airWalls, windows, interiorWindows, skylights, roofs, ceilings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; disabled; plug-in component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
swatch_13 = ColourSwatch(SwatchColor=RGBA(107, 218, 255, 120))  # disabled
preview_7 = CustomPreview(Geometry=decomposebytype_2.windows, Shader=swatch_13)  # disabled

number_slider_50 = Slider(0.01, range=0..0.1)  # disabled
number_slider_51 = Slider(0, range=0..1)  # disabled
number_slider_52 = Slider(0.05, range=0..1)  # disabled
panel_80 = Panel("a>0.5")  # disabled
pt_5 = Point(Point(12, 0, 0))  # disabled
panel_81 = Panel(convertepschvalues_3)  # disabled
_3dchart_3 = Ladybug_3DChart(
    inputData=flatten(convertepschvalues_3),
    basePoint=pt_5,
    xScale=number_slider_50,
    yScale=number_slider_52,
    zScale=number_slider_51,
    condStatement=panel_80)  # -> readMe, graphMesh, graphCurves, legend, legendBasePts, title, titleBasePts, dataPts, conditionalHOY; disabled; plug-in component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

shading_3 = Geometry([<brep referenced from the Rhino model> x11])  # disabled
hb_epcontextsrf_4 = HoneybeeEPContextSurfaces(shdSurfaces=flatten(shading_3))  # -> HBContext; inputs shdSurfaces: list of GeometryBase, justBoundingBox: Boolean; disabled; same code as hb_epcontextsrf_3
panel_82 = Panel("C:\ARCH753_BuildingPerformanceSimulation\1116SimulationData")  # disabled
panel_83 = Panel("""1
1
1
1
1
1
1
1
0
0
0
0
0
0
0
0
1
1
1
1
1
1
1
1""")  # disabled
number_slider_53 = Slider(7, range=0..10)  # disabled
number_slider_54 = Slider(3, range=-3..3)  # disabled
number_slider_55 = Slider(-3, range=-3..3)  # disabled
legendpar_8 = Ladybug_LegendParameters(lowBound=number_slider_55, highBound=number_slider_54, numSegments=number_slider_53)  # -> legendPar; disabled; plug-in component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

panel_84 = Panel("1")  # disabled
panel_85 = Panel("24")  # disabled
panel_86 = Panel("28")  # disabled
zoneattributelist = Honeybee_ZoneAttributeList({"Name": "name", "Zone Program": "zoneProgram", "Zone Floor Area": "zoneFloorArea", "Zone Volume": "zoneVolume", "Building Program": "bldgProgram", "Is Conditioned": "isConditioned", "Occupancy Schedule": "occupancySchedule", "Occupancy Activity Schedule": "occupancyActivitySch", "Heating SetPoint Schedule": "heatingSetPtSchedule", "Cooling SetPoint Schedule": "coolingSetPtSchedule"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}, selected="Natural Ventilation": "natVent")  # disabled
setepnatvent = Honeybee_SetEPAirFlow(
    HBZones=solveadjc.HBZonesWADJ,
    naturalVentilationType=panel_84,
    minIndoorTempForNatVent=panel_85,
    maxOutdoorTempForNatVent=panel_86)  # -> readMe, simplify(HBZones); disabled; plug-in component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
labelzones = Honeybee_LabelZones(HBZones=flatten(setepnatvent.HBZones), attribute=zoneattributelist)  # -> zoneTxtLabels, labelBasePts, brepTxtLabels, zoneWireFrames; disabled; plug-in component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
runenergysimulation_3 = Honeybee_RunEnergySimulation(
    north=number_slider_4,
    epwFile=open_epw_stat_2.epwFile,
    HBZones=flatten(setepnatvent.HBZones),
    HBContext=flatten(hb_epcontextsrf_4),
    simulationOutputs=flatten(epoutput.simulationOutputs),
    writeIdf=windowbasednaturalventilation,
    runEnergyPlus=windowbasednaturalventilation,
    workingDir=panel_82)  # -> report, idfFileAddress, resultFileAddress; disabled; plug-in component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

vertical_2 = Panel("""4
8
12""")  # disabled
vertical_depth_2 = Panel("""0.1
0.2
0.3""")  # disabled
vertical_angle_2 = Panel("""-15
0
15""")  # disabled
vertical_depth_3 = Honeybee_ItemSelector(vertical_depth_2, {"0.1", "0.2", "0.3"}, selected="0.1")  # disabled
vertical_3 = Honeybee_ItemSelector(vertical_2, {"4", "8", "12"}, selected="4")  # disabled

itemindex_of_namelist = Slider(1, range=0..26)  # disabled
panel_87 = Panel("/")  # disabled
toggle_29 = BooleanToggle(False)  # disabled
fly = Ladybug_fly(inputSliders=itemindex_of_namelist, fly=toggle_29)  # -> Vviiiiiiiiiizzz; disabled; plug-in component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
panel_88 = Panel("A")  # disabled
panel_89 = Panel("B")  # disabled
panel_90 = Panel("V")  # disabled

shadinga_angle_2 = Panel("""-15
0
15""")  # disabled
shadinga_2 = Panel("""3
5
7""")  # disabled
shadinga_depth_2 = Panel("""0.1
0.2
0.3""")  # disabled
shadinga_3 = Honeybee_ItemSelector(shadinga_2, {"3", "5", "7"}, selected="3")  # disabled
shadinga_depth_3 = Honeybee_ItemSelector(shadinga_depth_2, {"0.1", "0.2", "0.3"}, selected="0.1")  # disabled

shadingb_angle_2 = Panel("""-30
0
30""")  # disabled
shadingb_2 = Panel("""3
4
5""")  # disabled
shadingb_depth_2 = Panel("""0.1
0.2
0.3""")  # disabled
shadingb_depth_3 = Honeybee_ItemSelector(shadingb_depth_2, {"0.1", "0.2", "0.3"}, selected="0.1")  # disabled
shadingb_3 = Honeybee_ItemSelector(shadingb_2, {"3", "4", "5"}, selected="3")  # disabled

# ----
# Input
crossref = CrossReference(ListA=vertical_angle_2, ListB=shadinga_angle_2, ListC=shadingb_angle_2, ListD=void_2, CrossMode=1)  # -> flatten(ListA), flatten(ListB), flatten(ListC), ListD; disabled

concat_2 = Concatenate(FragmentA=crossref.ListA, FragmentB=panel_87, FragmentC=crossref.ListB)  # disabled
concat_3 = Concatenate(FragmentA=concat_2, FragmentB=panel_87, FragmentC=crossref.ListC)  # disabled

concat_4 = Concatenate(FragmentA=concat_3, FragmentB=panel_87, FragmentC=crossref.ListD)  # disabled
preview_8 = CustomPreview(Geometry=_3dchart_3.graphMesh, Shader=swatch_11)  # disabled

item_14 = ListItem(List=concat_4, Index=itemindex_of_namelist, Wrap=True)  # disabled
split_2 = TextSplit(Text=item_14, Separators=panel_87)  # disabled
item_15 = ListItem(List=split_2, Index=0, Wrap=True)  # -> flatten(Item); disabled
item_16 = ListItem(List=split_2, Index=1, Wrap=True)  # -> flatten(Item); disabled
item_17 = ListItem(List=split_2, Index=2, Wrap=True)  # -> flatten(Item); disabled
panel_91 = Panel(item_15)  # disabled
panel_92 = Panel(item_16)  # disabled
panel_93 = Panel(item_17)  # disabled

item_18 = ListItem(List=split_2, Index=3, Wrap=True)  # -> flatten(Item); disabled
panel_94 = Panel(item_18)  # disabled

# ----
# Output
crossref_2 = CrossReference(ListA=panel_91, ListB=panel_92, ListC=panel_93, ListD=panel_94, CrossMode=1)  # -> ListA, ListB, ListC, ListD; disabled
output = Panel([crossref_2.ListA, crossref_2.ListB, crossref_2.ListC, crossref_2.ListD])  # disabled

vertical_depth_4 = Honeybee_ItemSelector(crossref_2.ListA, {"0"}, selected="0")  # disabled

shadinga_depth_4 = Honeybee_ItemSelector(crossref_2.ListB, {"-15"}, selected="-15")  # disabled

shadingb_depth_4 = Honeybee_ItemSelector(crossref_2.ListC, {"-30"}, selected="-30")  # disabled

concat_5 = Concatenate(
    FragmentA=itemindex_of_namelist,
    FragmentB=panel_90,
    FragmentC=panel_91,
    FragmentD=panel_88,
    FragmentE=panel_92,
    FragmentF=panel_89,
    FragmentG=panel_93,
    FragmentJ=panel_72,
    FragmentK=panel_94)  # disabled

panel_95 = Panel("1")  # disabled
panel_96 = Panel("24")  # disabled
panel_97 = Panel("28")  # disabled
zoneattributelist_2 = Honeybee_ZoneAttributeList({"Name": "name", "Zone Program": "zoneProgram", "Zone Floor Area": "zoneFloorArea", "Zone Volume": "zoneVolume", "Building Program": "bldgProgram", "Is Conditioned": "isConditioned", "Occupancy Schedule": "occupancySchedule", "Occupancy Activity Schedule": "occupancyActivitySch", "Heating SetPoint Schedule": "heatingSetPtSchedule", "Cooling SetPoint Schedule": "coolingSetPtSchedule"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}, selected="Natural Ventilation": "natVent")  # disabled
setepnatvent_2 = Honeybee_SetEPAirFlow(
    HBZones=solveadjc_2.HBZonesWADJ,
    naturalVentilationType=panel_95,
    minIndoorTempForNatVent=panel_96,
    maxOutdoorTempForNatVent=panel_97)  # -> readMe, simplify(HBZones); disabled; plug-in component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
panel_98 = Panel("C:\ARCH753_BuildingPerformanceSimulation\1123SimulationData")  # disabled
labelzones_2 = Honeybee_LabelZones(HBZones=flatten(setepnatvent_2.HBZones), attribute=zoneattributelist_2)  # -> zoneTxtLabels, labelBasePts, brepTxtLabels, zoneWireFrames; disabled; plug-in component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
runenergysimulation_4 = Honeybee_RunEnergySimulation(
    north=number_slider_8,
    epwFile=open_epw_stat_3.epwFile,
    HBZones=flatten(setepnatvent_2.HBZones),
    HBContext=flatten(hb_epcontextsrf_3),
    simulationOutputs=flatten(epoutput_2.simulationOutputs),
    writeIdf=windowbasednaturalventilation_2,
    runEnergyPlus=windowbasednaturalventilation_2,
    workingDir=panel_98,
    idfFileName=concat_5)  # -> report, idfFileAddress, resultFileAddress; disabled; plug-in component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

readepresult_3 = Honeybee_ReadEPResult(resultFileAddress=runenergysimulation_4.resultFileAddress)  # -> port, port_2, port_3, port_4, electricLight, electricEquip, fanElectric, port_5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; disabled; plug-in component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
list = ValueList({"Test_Room": 0, "Hall": 1}, selected="Test_Room")  # disabled
branch = TreeBranch(Tree=readepresult_3.airTemperature, Path=list, MaintainPaths=True)  # disabled
branch_2 = TreeBranch(Tree=readepresult_3.electricLight, Path=list, MaintainPaths=True)  # disabled
branch_3 = TreeBranch(Tree=readepresult_3.meanRadTemperature, Path=list, MaintainPaths=True)  # disabled
branch_4 = TreeBranch(Tree=readepresult_3.relativeHumidity, Path=list, MaintainPaths=True)  # disabled

number_slider_56 = Slider(0.01, range=0..0.1)  # disabled
number_slider_57 = Slider(0, range=0..1)  # disabled
number_slider_58 = Slider(0.05, range=0..1)  # disabled
pt_6 = Point(Point(10, 0, 0))  # disabled
_3dchart_4 = Ladybug_3DChart(inputData=flatten(branch_2), basePoint=pt_6, xScale=number_slider_56, yScale=number_slider_58, zScale=number_slider_57)  # -> readMe, graphMesh, graphCurves, legend, legendBasePts, title, titleBasePts, dataPts, conditionalHOY; disabled; plug-in component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

# ----
# Result
separatedata_8 = Ladybug_SeparateData(inputList=flatten(readepresult_3.port_3))  # -> numbers, strings; disabled; plug-in component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
separatedata_9 = Ladybug_SeparateData(inputList=flatten(readepresult_3.port))  # -> numbers, strings; disabled; plug-in component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
separatedata_10 = Ladybug_SeparateData(inputList=flatten(readepresult_3.port_4))  # -> numbers, strings; disabled; plug-in component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
separatedata_11 = Ladybug_SeparateData(inputList=flatten(branch_2))  # -> numbers, strings; disabled; plug-in component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
ma_7 = MassAddition(Input=separatedata_8.numbers)  # -> Result, PartialResults; disabled
ma_8 = MassAddition(Input=separatedata_10.numbers)  # -> Result, PartialResults; disabled
ma_9 = MassAddition(Input=separatedata_9.numbers)  # -> Result, PartialResults; disabled
ma_10 = MassAddition(Input=separatedata_11.numbers)  # -> Result, PartialResults; disabled
total_lighting_3 = Panel(ma_10.Result)  # disabled
total_thermal = Panel(ma_9.Result)  # disabled

adaptivecomfortcalculator = Ladybug_AdaptiveComfortCalculator(
    dryBulbTemperature=branch,
    meanRadiantTemperature=branch_3,
    prevailingOutdoorTemp=importepw_2.dryBulbTemperature,
    runIt=adaptive_comfort_2)  # -> readMe, port, comfortableOrNot, conditionOfPerson, degreesFromTarget, port_2, targetTemperature, upperTemperatureBound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; disabled; plug-in component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
pmvcomfortcalculator = Ladybug_PMVComfortCalculator(
    dryBulbTemperature=branch,
    meanRadiantTemperature=branch_3,
    relativeHumidity=branch_4,
    calcBalanceTemperature=False,
    runIt=pmv_comfort_2)  # -> readMe, port, predictedMeanVote, percentPeopleDissatisfied, standardEffectiveTemperature, port_2, comfortableOrNot, percentOfTimeComfortable, port_3, balanceTemperature; disabled; plug-in component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

total_cooling_5 = Panel(ma_7.Result)  # disabled
total_heating_5 = Panel(ma_8.Result)  # disabled

# ----
# Energy
total_thermal_2 = Panel(ma_9.Result)  # disabled

separatedata_12 = Ladybug_SeparateData(inputList=flatten(pmvcomfortcalculator.comfortableOrNot))  # -> numbers, strings; disabled; plug-in component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
panel_99 = Panel("365")  # disabled
dup = DuplicateData(Data=panel_73, Number=panel_99, Order=True)  # disabled
ma_11 = MassAddition(Input=panel_73)  # -> Result, PartialResults; disabled
multiplication_2 = Multiplication(A=separatedata_12.numbers, B=dup)  # disabled
multiplication_3 = Multiplication(A=ma_11.Result, B=panel_99)  # disabled
ma_12 = MassAddition(Input=multiplication_2)  # -> Result, PartialResults; disabled
panel_100 = Panel(multiplication_3)  # disabled
panel_101 = Panel(ma_12.Result)  # disabled
division = Division(A=panel_101, B=panel_100)  # disabled
multiplication_4 = Multiplication(A=division, B=100)  # disabled
pmvcomfort_occ = Panel(multiplication_4)  # disabled

separatedata_13 = Ladybug_SeparateData(inputList=flatten(adaptivecomfortcalculator.comfortableOrNot))  # -> numbers, strings; disabled; plug-in component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
panel_102 = Panel("365")  # disabled
dup_2 = DuplicateData(Data=panel_73, Number=panel_102, Order=True)  # disabled
ma_13 = MassAddition(Input=panel_73)  # -> Result, PartialResults; disabled
multiplication_5 = Multiplication(A=separatedata_13.numbers, B=dup_2)  # disabled
multiplication_6 = Multiplication(A=ma_13.Result, B=panel_102)  # disabled
ma_14 = MassAddition(Input=multiplication_5)  # -> Result, PartialResults; disabled
panel_103 = Panel(multiplication_6)  # disabled
panel_104 = Panel(ma_14.Result)  # disabled
division_2 = Division(A=panel_104, B=panel_103)  # disabled
multiplication_7 = Multiplication(A=division_2, B=100)  # disabled
adaptivecomfort_occ = Panel(multiplication_7)  # disabled

number_slider_59 = Slider(0.01, range=0..0.1)  # disabled
number_slider_60 = Slider(0, range=0..1)  # disabled
number_slider_61 = Slider(0.05, range=0..1)  # disabled
pt_7 = Point(Point(60, 0, 0))  # disabled
_3dchart_5 = Ladybug_3DChart(
    inputData=flatten([adaptivecomfortcalculator.comfortableOrNot, adaptivecomfortcalculator.conditionOfPerson, pmvcomfortcalculator.comfortableOrNot, pmvcomfortcalculator.predictedMeanVote]),
    basePoint=pt_7,
    xScale=number_slider_59,
    yScale=number_slider_61,
    zScale=number_slider_60,
    legendPar=legendpar)  # -> readMe, graphMesh, graphCurves, legend, legendBasePts, title, titleBasePts, dataPts, conditionalHOY; disabled; plug-in component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

void_3 = Honeybee_ItemSelector(crossref_2.ListD, {"2"}, selected="2")  # disabled
panel_105 = Panel(concat_5)  # disabled
separatedata_14 = Ladybug_SeparateData(inputList=flatten(adaptivecomfortcalculator.conditionOfPerson))  # -> numbers, strings; disabled; plug-in component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
ma_15 = MassAddition(Input=separatedata_14.numbers)  # -> Result, PartialResults; disabled
adaptivechart = Ladybug_AdaptiveComfortChart(
    dryBulbTemperature=branch,
    meanRadiantTemperature=branch_3,
    prevailingOutdoorTemp=importepw_2.dryBulbTemperature,
    basePoint=pt_3,
    scale=number_slider_42,
    runIt=toggle_24)  # -> readMe, comfPercentOfTime, percentHotCold, comfortableOrNot, conditionOfPerson, degreesFromTarget, port, chartCurvesAndTxt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; disabled; plug-in component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
preview_9 = CustomPreview(Geometry=_3dchart_5.graphMesh, Shader=swatch_12)  # disabled

# ----
# Result
separatedata_15 = Ladybug_SeparateData(inputList=flatten(pmvcomfortcalculator.predictedMeanVote))  # -> numbers, strings; disabled; plug-in component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
separatedata_16 = Ladybug_SeparateData(inputList=flatten(pmvcomfortcalculator.comfortableOrNot))  # -> numbers, strings; disabled; plug-in component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
separatedata_17 = Ladybug_SeparateData(inputList=flatten(adaptivecomfortcalculator.comfortableOrNot))  # -> numbers, strings; disabled; plug-in component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
ma_16 = MassAddition(Input=separatedata_15.numbers)  # -> Result, PartialResults; disabled
ma_17 = MassAddition(Input=separatedata_16.numbers)  # -> Result, PartialResults; disabled
ma_18 = MassAddition(Input=separatedata_17.numbers)  # -> Result, PartialResults; disabled
division_3 = Division(A=ma_16.Result, B=8760)  # disabled
adaptive_conditionofperson = Panel(ma_15.Result)  # disabled
adaptive__ofh_c = Panel(adaptivecomfortcalculator.percentHotCold)  # disabled
pmv_y_n = Panel(ma_17.Result)  # disabled
adaptive_y_n = Panel(ma_18.Result)  # disabled
adaptive__oftime = Panel(adaptivecomfortcalculator.percentOfTimeComfortable)  # disabled
pmv_predictedvote = Panel(division_3)  # disabled
pmv__oftime = Panel(pmvcomfortcalculator.percentOfTimeComfortable)  # disabled

adaptive__oftime_2 = Panel(adaptivecomfortcalculator.percentOfTimeComfortable)  # disabled
adaptive__oftime_occ = Panel(multiplication_7)  # disabled

rec = DataRecorder(concat_5, DataLimit=-10, RecordData=True)  # disabled
filename = Panel(rec)  # disabled
rec_2 = DataRecorder(adaptive__oftime_2, DataLimit=-10, RecordData=True)  # disabled
adaptivecomfort = Panel(rec_2)  # disabled
rec_3 = DataRecorder(adaptivecomfort_occ, DataLimit=-10, RecordData=True)  # disabled
adaptivecomfort_occ_2 = Panel(rec_3)  # disabled
rec_4 = DataRecorder(pmv__oftime, DataLimit=-10, RecordData=True)  # disabled
pmvcomfort = Panel(rec_4)  # disabled
rec_5 = DataRecorder(pmvcomfort_occ, DataLimit=-10, RecordData=True)  # disabled
pmvcomfort_occ_2 = Panel(rec_5)  # disabled

pmv__oftime_2 = Panel(pmvcomfortcalculator.percentOfTimeComfortable)  # disabled
# Comfort
pmv__oftime_occ = Panel(multiplication_4)  # disabled

panel_106 = Panel(runenergysimulation_3.resultFileAddress)  # disabled
readepresult_4 = Honeybee_ReadEPResult(resultFileAddress=runenergysimulation_3.resultFileAddress)  # -> totalThermalEnergy, thermalEnergyBalance, cooling, heating, electricLight, electricEquip, fanElectric, pumpElectric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; disabled; plug-in component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

pmvcomfortcalculator_2 = Ladybug_PMVComfortCalculator(
    dryBulbTemperature=readepresult_4.airTemperature,
    meanRadiantTemperature=readepresult_4.meanRadTemperature,
    relativeHumidity=readepresult_4.relativeHumidity,
    calcBalanceTemperature=False,
    runIt=pmv_comfort)  # -> readMe, port, predictedMeanVote, percentPeopleDissatisfied, standardEffectiveTemperature, port_2, comfortableOrNot, percentOfTimeComfortable, port_3, balanceTemperature; disabled; plug-in component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
adaptivecomfortcalculator_2 = Ladybug_AdaptiveComfortCalculator(
    dryBulbTemperature=readepresult_4.airTemperature,
    meanRadiantTemperature=readepresult_4.meanRadTemperature,
    prevailingOutdoorTemp=importepw.dryBulbTemperature,
    runIt=adaptive_comfort)  # -> readMe, port, comfortableOrNot, conditionOfPerson, degreesFromTarget, port_2, targetTemperature, upperTemperatureBound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; disabled; plug-in component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

separatedata_18 = Ladybug_SeparateData(inputList=flatten(pmvcomfortcalculator_2.comfortableOrNot))  # -> numbers, strings; disabled; plug-in component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
panel_107 = Panel("365")  # disabled
dup_3 = DuplicateData(Data=panel_83, Number=panel_107, Order=True)  # disabled
ma_19 = MassAddition(Input=panel_83)  # -> Result, PartialResults; disabled
multiplication_8 = Multiplication(A=separatedata_18.numbers, B=dup_3)  # disabled
multiplication_9 = Multiplication(A=ma_19.Result, B=panel_107)  # disabled
ma_20 = MassAddition(Input=multiplication_8)  # -> Result, PartialResults; disabled
panel_108 = Panel(multiplication_9)  # disabled
panel_109 = Panel(ma_20.Result)  # disabled
division_4 = Division(A=panel_109, B=panel_108)  # disabled
multiplication_10 = Multiplication(A=division_4, B=100)  # disabled
pmvcomfort_occ_3 = Panel(multiplication_10)  # disabled

separatedata_19 = Ladybug_SeparateData(inputList=flatten(adaptivecomfortcalculator_2.comfortableOrNot))  # -> numbers, strings; disabled; plug-in component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
panel_110 = Panel("365")  # disabled
dup_4 = DuplicateData(Data=panel_83, Number=panel_110, Order=True)  # disabled
ma_21 = MassAddition(Input=panel_83)  # -> Result, PartialResults; disabled
multiplication_11 = Multiplication(A=separatedata_19.numbers, B=dup_4)  # disabled
multiplication_12 = Multiplication(A=ma_21.Result, B=panel_110)  # disabled
ma_22 = MassAddition(Input=multiplication_11)  # -> Result, PartialResults; disabled
panel_111 = Panel(multiplication_12)  # disabled
panel_112 = Panel(ma_22.Result)  # disabled
division_5 = Division(A=panel_112, B=panel_111)  # disabled
multiplication_13 = Multiplication(A=division_5, B=100)  # disabled
adaptivecomfort_occ_3 = Panel(multiplication_13)  # disabled

# ----
# Result
separatedata_20 = Ladybug_SeparateData(inputList=flatten(readepresult_4.cooling))  # -> numbers, strings; disabled; plug-in component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
separatedata_21 = Ladybug_SeparateData(inputList=flatten(readepresult_4.totalThermalEnergy))  # -> numbers, strings; disabled; plug-in component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
separatedata_22 = Ladybug_SeparateData(inputList=flatten(readepresult_4.heating))  # -> numbers, strings; disabled; plug-in component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
separatedata_23 = Ladybug_SeparateData(inputList=flatten(readepresult_4.electricLight))  # -> numbers, strings; disabled; plug-in component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
ma_23 = MassAddition(Input=separatedata_20.numbers)  # -> Result, PartialResults; disabled
ma_24 = MassAddition(Input=separatedata_22.numbers)  # -> Result, PartialResults; disabled
ma_25 = MassAddition(Input=separatedata_21.numbers)  # -> Result, PartialResults; disabled
ma_26 = MassAddition(Input=separatedata_23.numbers)  # -> Result, PartialResults; disabled
total_thermal_3 = Panel(ma_25.Result)  # disabled
total_lighting_5 = Panel(ma_26.Result)  # disabled

# ----
# Energy
total_thermal_4 = Panel(ma_25.Result)  # disabled

total_cooling_7 = Panel(ma_23.Result)  # disabled
total_heating_7 = Panel(ma_24.Result)  # disabled

# ----
# Result
separatedata_24 = Ladybug_SeparateData(inputList=flatten(pmvcomfortcalculator_2.predictedMeanVote))  # -> numbers, strings; disabled; plug-in component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
separatedata_25 = Ladybug_SeparateData(inputList=flatten(pmvcomfortcalculator_2.comfortableOrNot))  # -> numbers, strings; disabled; plug-in component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
separatedata_26 = Ladybug_SeparateData(inputList=flatten(adaptivecomfortcalculator_2.comfortableOrNot))  # -> numbers, strings; disabled; plug-in component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
ma_27 = MassAddition(Input=separatedata_24.numbers)  # -> Result, PartialResults; disabled
ma_28 = MassAddition(Input=separatedata_26.numbers)  # -> Result, PartialResults; disabled
ma_29 = MassAddition(Input=separatedata_25.numbers)  # -> Result, PartialResults; disabled
division_6 = Division(A=ma_27.Result, B=8760)  # disabled
adaptive__oftime_3 = Panel(adaptivecomfortcalculator_2.percentOfTimeComfortable)  # disabled
pmv_predictedvote_2 = Panel(division_6)  # disabled
pmv_y_n_3 = Panel(ma_29.Result)  # disabled
adaptive_y_n_3 = Panel(ma_28.Result)  # disabled
pmv__oftime_3 = Panel(pmvcomfortcalculator_2.percentOfTimeComfortable)  # disabled

# ----
# Comfort
adaptive_y_n_4 = Panel(ma_28.Result)  # disabled

separatedata_27 = Ladybug_SeparateData(inputList=flatten(adaptivecomfortcalculator_2.conditionOfPerson))  # -> numbers, strings; disabled; plug-in component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
ma_30 = MassAddition(Input=separatedata_27.numbers)  # -> Result, PartialResults; disabled
adaptive_conditionofperson_2 = Panel(ma_30.Result)  # disabled

number_slider_62 = Slider(0.01, range=0..0.1)  # disabled
number_slider_63 = Slider(0, range=0..1)  # disabled
number_slider_64 = Slider(0.05, range=0..1)  # disabled
pt_8 = Point(Point(10, 0, 0))  # disabled
_3dchart_6 = Ladybug_3DChart(
    inputData=flatten([readepresult_4.thermalEnergyBalance, readepresult_4.cooling, readepresult_4.heating, readepresult_4.electricLight]),
    basePoint=pt_8,
    xScale=number_slider_62,
    yScale=number_slider_64,
    zScale=number_slider_63)  # -> readMe, graphMesh, graphCurves, legend, legendBasePts, title, titleBasePts, dataPts, conditionalHOY; disabled; plug-in component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

number_slider_65 = Slider(0.01, range=0..0.1)  # disabled
number_slider_66 = Slider(0, range=0..1)  # disabled
number_slider_67 = Slider(0.05, range=0..1)  # disabled
pt_9 = Point(Point(60, 0, 0))  # disabled
_3dchart_7 = Ladybug_3DChart(
    inputData=flatten([adaptivecomfortcalculator_2.comfortableOrNot, adaptivecomfortcalculator_2.conditionOfPerson, pmvcomfortcalculator_2.comfortableOrNot, pmvcomfortcalculator_2.predictedMeanVote]),
    basePoint=pt_9,
    xScale=number_slider_65,
    yScale=number_slider_67,
    zScale=number_slider_66,
    legendPar=legendpar_8)  # -> readMe, graphMesh, graphCurves, legend, legendBasePts, title, titleBasePts, dataPts, conditionalHOY; disabled; plug-in component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
