# Grasshopper definition Jin_Jaeho_Meyerson-Shade.gh (Grasshopper 0.9.76)
# plug-ins: Python Interpreter

ladybug = Ladybug_Ladybug()  # -> Vviiiiiiiiiizzz; plug-in component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
panel = Panel("http://apps1.eere.energy.gov/buildings/energyplus/weatherdata/4_north_and_central_america_wmo_region_4/1_usa/USA_PA_Philadelphia.724086_TMY2.zip")
open_epw_stat = Ladybug_OpenEPWAndSTATWeatherFiles(weatherFileURL=panel)  # -> epwFile, statFile; plug-in component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
importepw = Ladybug_ImportEpw(epwFile=open_epw_stat.epwFile)  # -> readMe, latitude, location, dryBulbTemperature, dewPointTemperature, relativeHumidity, windSpeed, windDirection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; plug-in component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

# ---- group: Visualize Rough Context
crv = Curve([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])
preview = CustomPreview(Geometry=crv, Shader=ColourSwatch(SwatchColor=RGB(0, 0, 0)))

# ----
analysisperiod = Ladybug_AnalysisPeriod()  # -> readMe, analysisPeriod; plug-in component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
pt = Point(Point(35.26425865, 24.32257932, 0))
solaradjusttemperature = Ladybug_OutdoorSolarTemperatureAdjustor(
    location=importepw.location,
    cumSkyMtxOrDirNormRad=importepw.directNormalRadiation,
    diffuseHorizRad=importepw.diffuseHorizontalRadiation,
    meanRadTemperature=importepw.dryBulbTemperature,
    bodyPosture=Slider(1, range=0..2),
    rotationAngle=Slider(70, range=0..180),
    bodyLocation=pt,
    analysisPeriodOrHOY=analysisperiod.analysisPeriod,
    parallel=Toggle(True),
    runIt=Toggle(True))  # -> readMe, port, effectiveRadiantField, MRTDelta, solarAdjustedMRT, port_2, mannequinMesh, port_3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; plug-in component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
outdoorcomfortcalculator = Ladybug_OutdoorComfortCalculator(
    dryBulbTemperature=importepw.dryBulbTemperature,
    windSpeed_tenMeters=importepw.windSpeed,
    relativeHumidity=importepw.relativeHumidity,
    runIt=Toggle(True))  # -> readMe, port, universalThermalClimateIndex, comfortableOrNot, thermalStress, conditionOfPerson, port_2, percentOfTimeComfortable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; plug-in component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
outdoorcomfortcalculator_2 = Ladybug_OutdoorComfortCalculator(
    dryBulbTemperature=importepw.dryBulbTemperature,
    meanRadiantTemperature=solaradjusttemperature.solarAdjustedMRT,
    windSpeed_tenMeters=importepw.windSpeed,
    relativeHumidity=importepw.relativeHumidity,
    runIt=Toggle(True))  # -> readMe, port, universalThermalClimateIndex, comfortableOrNot, thermalStress, conditionOfPerson, port_2, percentOfTimeComfortable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; plug-in component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
pt_2 = Point(Point(88.47226712, 166.2122937, 0))
_3dchart = Ladybug_3DChart(inputData=flatten(outdoorcomfortcalculator.conditionOfPerson), basePoint=pt_2, xScale="0.25", yScale="0")  # -> readMe, graphMesh, graphCurves, legend, legendBasePts, title, titleBasePts, dataPts, conditionalHOY; plug-in component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
meyerson_bench_shade = Brep(<brep referenced from the Rhino model>)
busstop_seat = Brep([<brep referenced from the Rhino model> x2])
preview_2 = CustomPreview(Geometry=[_3dchart.legend, _3dchart.graphCurves], Shader=ColourSwatch(SwatchColor=RGB(0, 0, 0)))
comfortshadebenefit = Ladybug_ComfortShadeBenefitEvaluator(
    location=importepw.location,
    temperatures=outdoorcomfortcalculator_2.universalThermalClimateIndex,
    balanceTemperature="20",
    testShades=meyerson_bench_shade,
    testRegion=busstop_seat,
    gridSize=".5",
    skyResolution="7",
    delNonIntersect=False,
    parallel=Toggle(True),
    runIt=Toggle(True))  # -> readMe, port, sunVectors, regionTestPts, shadeMesh, legend, legendBasePoint, port_2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; plug-in component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
exporthydra = Hydra_ExportFile()  # -> readMe; inputs fileDescription: list, changeLog: list, fileTags: list, includeRhino: Boolean, GHForThumb: Boolean, additionalImgs: list, export: Boolean; plug-in component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
shadecreator = Honeybee_OptimalShadeCreator(
    shadeMesh=comfortshadebenefit.shadeMesh,
    shadeNetEffect=comfortshadebenefit.shadeNetEffect,
    percentToKeep=Slider(51, range=0..100))  # -> readMe, energySavedByShade, areaOfShade, newColoredMesh, newShadeBrep; plug-in component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
panel_2 = Panel(shadecreator.energySavedByShade)
panel_3 = Panel(shadecreator.areaOfShade)
preview_3 = CustomPreview(Geometry=shadecreator.newShadeBrep, Shader=ColourSwatch(SwatchColor=RGB(0, 0, 0)))
