# Grasshopper definition Integrated_Daylight_and_Energy_simulation.gh (Grasshopper 0.9.76)
# plug-ins: Python Interpreter

panel = Panel("""Honeybee
Energy
Daylighting
EnergyPlus
Daysim
Radiance
HBExampleFiles""")
honeybee = Honeybee_Honeybee()  # -> Vviiiiiiiiiizzz; plug-in component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
ladybug = Ladybug_Ladybug()  # -> Vviiiiiiiiiizzz; plug-in component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
panel_2 = Panel("This is an example that shows how to integrate results of daylighting simulation with an energy simulation")
exterior_wall = Brep(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)

# ---- group: ceiling
ceiling = Brep([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])

# ---- group: floor
floor = Brep(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)

# ----
walls = Brep([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])
ledge = Brep(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)
wall_surface_with_opening = Brep(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)
exporthydra = Hydra_ExportFile(
    fileName="Integrated_Daylight_and_Energy_similation",
    fileDescription=panel_2,
    fileTags=panel,
    targetFolder="C:\Users\Administrator\Documents\GitHub\hydra_1",
    export=Toggle(False))  # -> readMe; inputs fileDescription: list, changeLog: list, fileTags: list, includeRhino: Boolean, GHForThumb: Boolean, additionalImgs: list, export: Boolean; plug-in component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
# Geometry Preparation
panel_3 = Panel("0")
createhbsrfs = Honeybee_createHBSrfs(geometry=wall_surface_with_opening, srfType="0")  # -> readMe, simplify(HBSurface); plug-in component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
createhbsrfs_2 = Honeybee_createHBSrfs(geometry=flatten(exterior_wall), srfType="0")  # -> readMe, simplify(HBSurface); plug-in component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
createhbsrfs_3 = Honeybee_createHBSrfs(geometry=flatten(floor), srfType="2")  # -> readMe, simplify(HBSurface); plug-in component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
createhbsrfs_4 = Honeybee_createHBSrfs(geometry=flatten(ledge), srfType="2")  # -> readMe, simplify(HBSurface); plug-in component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
createhbsrfs_5 = Honeybee_createHBSrfs(geometry=ceiling, srfType="3")  # -> readMe, simplify(HBSurface); plug-in component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
# Honeybee default materials will be assigned
# based on surface type
createhbsrfs_6 = Honeybee_createHBSrfs(geometry=walls, srfType=panel_3)  # -> readMe, simplify(HBSurface); plug-in component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
glass = Brep(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)
preview = CustomPreview(Geometry=glass, Shader=ColourSwatch(SwatchColor=RGBA(80, 222, 255, 160)))
addhbglz = Honeybee_addHBGlz(HBObj=createhbsrfs.HBSurface, childSurfaces=flatten(glass))  # -> simplify(HBObjWGLZ); plug-in component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

# ---- group: Make all surfaces except the exterior wall adiabatic
makeadiabatic = Honeybee_MakeAdiabatic(HBSrfs=flatten([createhbsrfs_6.HBSurface, createhbsrfs_5.HBSurface, createhbsrfs_3.HBSurface]))  # -> HBSrfs; plug-in component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

# ----
bldgprograms = Honeybee_bldgPrograms({"Office": 0, "Retail": 1, "MidriseApartment": 2, "PrimarySchool": 3, "SecondarySchool": 4, "SmallHotel": 5, "LargeHotel": 6, "Hospital": 7, "Outpatient": 8, "Warehouse": 9, "SuperMarket": 10, "FullServiceRestaurant": 11, "QuickServiceRestaurant": 12}, selected="MidriseApartment")
listzoneprograms = Honeybee_ListZonePrograms(bldgProgram=bldgprograms)  # -> MidriseApartmentZonePrograms; plug-in component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
item = ListItem(List=listzoneprograms, Index=0, Wrap=True)

# ---- group: collect all honeybee surfaces
brep = Brep(flatten([makeadiabatic, addhbglz, createhbsrfs_4.HBSurface, createhbsrfs_2.HBSurface]))

# ----
panel_4 = Panel(item)
createhbzones = Honeybee_createHBZones(name="test_room", zoneProgram=item, HBSurfaces=flatten(brep), isConditioned=True)  # -> readMe, HBZone; plug-in component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

number_slider = Slider(90, range=0..360)
panel_5 = Panel("http://apps1.eere.energy.gov/buildings/energyplus/weatherdata/1_africa_wmo_region_1/ZAF_Cape.Town.688160_IWEC.zip")
open_epw_stat = Ladybug_OpenEPWAndSTATWeatherFiles(weatherFileURL=panel_5)  # -> epwFile, statFile; plug-in component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
northarrow = Ladybug_North(north=number_slider, scale=".075")  # -> northSign; plug-in component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

wires = BrepWireframe(Brep=createhbzones.HBZone, Density=-1)
flip = Flip(Surface=floor)  # -> Surface, Result
gentestpts = Honeybee_GenerateTestPoints(testSurface=flip.Surface, gridSize=".5", distBaseSrf=".762", moveTestMesh=True)  # -> readMe, simplify(testPoints), simplify(ptsVectors), simplify(facesArea), simplify(mesh); plug-in component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
radparameters = Honeybee_RADParameters(quality=0)  # -> readMe, radParameters; plug-in component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
importepw = Ladybug_ImportEpw(epwFile=open_epw_stat.epwFile)  # -> readMe, latitude, location, dryBulbTemperature, dewPointTemperature, relativeHumidity, windSpeed, windDirection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; plug-in component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
annualdaylightsimulation = Honeybee_AnnualDaylightSimulation(
    north=number_slider,
    epwWeatherFile=open_epw_stat.epwFile,
    testPoints=gentestpts.testPoints,
    ptsVectors=gentestpts.ptsVectors,
    testMesh=gentestpts.mesh,
    radParameters=radparameters.radParameters)  # -> analysisRecipe; plug-in component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
toggle = BooleanToggle(True)
item_2 = ListItem(List=gentestpts.testPoints, Index="58", Wrap=True)
sph = Sphere(Base=item_2, Radius=Slider(0.1, range=0..0.1))
# Run Annual Daylight
rundaylightanalysis = Honeybee_RunDaylightSimulation(
    HBObjects=flatten(createhbzones.HBZone),
    analysisRecipe=annualdaylightsimulation,
    writeRad=toggle,
    runRad=toggle,
    numOfCPUs=Slider(4, range=0..10),
    overwriteResults=True)  # -> readMe, analysisType, resultsUnit, results, testPts, annual_analysis_files, radGeoFile, studyFolder, done; plug-in component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
lightingcontrol = Honeybee_LightingControlRecipe(
    controlType="4",
    sensorPoints=item_2,
    lightingPower=250,
    lightingSetpoint=300,
    ballastLossFactor=20,
    standbyPower=3,
    delayTime=5)  # -> lightingControlGroup; plug-in component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
gethbzoneepschedules = Honeybee_GetZoneEnergyPlusSchedules(HBZone=createhbzones.HBZone)  # -> occupancySchedule, occupancyActivitySch, heatingSetPtSchedule, coolingSetPtSchedule, lightingSchedule, equipmentSchedule, infiltrationSchedule; plug-in component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
# Generate lighting Schedule
toggle_2 = BooleanToggle(True)
readannualresultsi = Honeybee_ReadAnnualResultI(
    illFilesAddress=rundaylightanalysis.annual_analysis_files,
    testPoints=simplify(rundaylightanalysis.testPts),
    occupancyFiles=gethbzoneepschedules.lightingSchedule,
    DLAIllumThresholds=300,
    lightingControlGroups=lightingcontrol,
    runIt=toggle_2)  # -> DLA, UDLI_Less_100, UDLI_100_2000, UDLI_More_2000, CDA, sDA, annualProfiles, htmReport; plug-in component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

# ---- group: just for visualization
# Compare Schedules!
dsannualprofiles = Honeybee_DaysimAnnualProfiles(annualProfiles=readannualresultsi.annualProfiles)  # -> simplify(occupancyProfile), simplify(shadingProfiles), simplify(lightingControlProfiles), simplify(dgpProfile); plug-in component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
convertepschvalues = Honeybee_ConvertEnergyPlusScheduleToValues(schName=gethbzoneepschedules.lightingSchedule)  # -> values; plug-in component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
_3dchart = Ladybug_3DChart(inputData=flatten([convertepschvalues, dsannualprofiles.lightingControlProfiles]))  # -> readMe, graphMesh, graphCurves, legend, legendBasePts, title, titleBasePts, dataPts, conditionalHOY; plug-in component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

# ----
recolormesh = Ladybug_RecolorMesh(analysisResult=readannualresultsi.DLA, inputMesh=gentestpts.mesh)  # -> readMe, newMesh, newLegend, legendBasePt, meshColors, legendColors; plug-in component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
# update lighting schedule
setepzoneschedules = Honeybee_SetEnergyPlusZoneSchedules(HBZones=createhbzones.HBZone, lightingSchedules=readannualresultsi.annualProfiles)  # -> schedules, simplify(HBZones); plug-in component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
solveadjc = Honeybee_SolveAdjacencies(HBZones=flatten(createhbzones.HBZone), removeCurrentAdjc=False, findAdjc=Toggle(False))  # -> readMe, HBZonesWADJ; plug-in component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
setepnatvent = Honeybee_SetEPAirFlow(HBZones=solveadjc.HBZonesWADJ)  # -> readMe, simplify(HBZones); plug-in component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
toggle_3 = BooleanToggle(True)
epoutput = Honeybee_GenerateEPOutput(
    zoneEnergyUse=toggle_3,
    zoneGainsAndLosses="False",
    zoneComfortMetrics=toggle_3,
    surfaceTempAnalysis="False",
    timestep="monthly")  # -> report, flatten(simulationOutputs); plug-in component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
zoneattributelist = Honeybee_ZoneAttributeList({"Name": "name", "Zone Program": "zoneProgram", "Zone Floor Area": "zoneFloorArea", "Zone Volume": "zoneVolume", "Building Program": "bldgProgram", "Is Conditioned": "isConditioned", "Occupancy Schedule": "occupancySchedule", "Occupancy Activity Schedule": "occupancyActivitySch", "Heating SetPoint Schedule": "heatingSetPtSchedule", "Cooling SetPoint Schedule": "coolingSetPtSchedule"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}, selected="Natural Ventilation": "natVent")
toggle_4 = BooleanToggle(True)
# Run the analysis
runenergysimulation = Honeybee_RunEnergySimulation(
    north=number_slider,
    epwFile=open_epw_stat.epwFile,
    HBZones=flatten(setepzoneschedules.HBZones),
    HBContext=flatten(setepnatvent.HBZones),
    simulationOutputs=flatten(epoutput.simulationOutputs),
    writeIdf=toggle_4,
    runEnergyPlus=toggle_4)  # -> report, idfFileAddress, resultFileAddress; plug-in component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
labelzones = Honeybee_LabelZones(HBZones=flatten(setepnatvent.HBZones), attribute=zoneattributelist)  # -> zoneTxtLabels, labelBasePts, brepTxtLabels, zoneWireFrames; plug-in component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
readepresult = Honeybee_ReadEPResult(resultFileAddress=runenergysimulation.resultFileAddress)  # -> totalThermalEnergy, thermalEnergyBalance, cooling, heating, electricLight, electricEquip, port, port_2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; plug-in component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
panel_6 = Panel("""Cooling, Heating
& Lighting Loads""")
separatedata = Ladybug_SeparateData(inputList=flatten(readepresult.cooling))  # -> numbers, strings; plug-in component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
separatedata_2 = Ladybug_SeparateData(inputList=flatten(readepresult.heating))  # -> numbers, strings; plug-in component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
separatedata_3 = Ladybug_SeparateData(inputList=flatten(readepresult.electricLight))  # -> numbers, strings; plug-in component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
legendpar = Ladybug_LegendParameters(lowBound="0", highBound="700")  # -> legendPar; plug-in component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
adaptivecomfortcalculator = Ladybug_AdaptiveComfortCalculator()  # -> readMe, port, comfortableOrNot, conditionOfPerson, degreesFromTarget, port_2, targetTemperature, upperTemperatureBound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; plug-in component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
pmvcomfortcalculator = Ladybug_PMVComfortCalculator(calcBalanceTemperature=False)  # -> readMe, port, predictedMeanVote, percentPeopleDissatisfied, standardEffectiveTemperature, port_2, comfortableOrNot, percentOfTimeComfortable, port_3, balanceTemperature; plug-in component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
barchart = Ladybug_MonthlyBarChart(
    inputData=flatten([readepresult.cooling, readepresult.electricLight, readepresult.heating]),
    altYAxisTitle=panel_6,
    basePoint="20, 0, 0",
    xScale=Slider(0.4, range=0..1),
    yScale=Slider(0.6, range=0..1),
    legendPar=legendpar)  # -> readMe, dataMesh, dataCurves, dataCrvColors, graphAxes, graphLabels, title, titleBasePt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; plug-in component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
ma = MassAddition(Input=separatedata.numbers)  # -> Result, PartialResults
ma_2 = MassAddition(Input=separatedata_2.numbers)  # -> Result, PartialResults
ma_3 = MassAddition(Input=separatedata_3.numbers)  # -> Result, PartialResults
total_cooling = Panel(ma.Result)
total_heating = Panel(ma_2.Result)
total_lighting = Panel(ma_3.Result)
