# Grasshopper definition Outdoor_Comfort_Shade_Benefit_Philly.gh (Grasshopper 0.9.76)
# plug-ins: Python Interpreter

ladybug = Ladybug_Ladybug()  # -> Vviiiiiiiiiizzz; plug-in component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

# ---- group: Import the WeatherFile
open_weather_file = Ladybug_OpenEPWWeatherFile(open=Toggle(True))  # -> epwFile; plug-in component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
importepw = Ladybug_ImportEpw(epwFile=open_weather_file)  # -> readMe, latitude, location, dryBulbTemperature, dewPointTemperature, relativeHumidity, windSpeed, windDirection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; plug-in component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

# ---- group: Visualize Rough Context
crv = Curve([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])
preview = CustomPreview(Geometry=crv, Shader=ColourSwatch(SwatchColor=RGB(0, 0, 0)))

# ----
analysisperiod = Ladybug_AnalysisPeriod()  # -> readMe, analysisPeriod; plug-in component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
pt = Point(Point(-19.07631582, -6.25, 1))
context_shade = Brep([<brep referenced from the Rhino model> x8])
solaradjusttemperature = Ladybug_OutdoorSolarTemperatureAdjustor(
    location=importepw.location,
    cumSkyMtxOrDirNormRad=importepw.directNormalRadiation,
    diffuseHorizRad=importepw.diffuseHorizontalRadiation,
    meanRadTemperature=importepw.dryBulbTemperature,
    bodyPosture=Slider(1, range=0..2),
    rotationAngle=Slider(70, range=0..180),
    bodyLocation=pt,
    contextShading=context_shade,
    analysisPeriodOrHOY=analysisperiod.analysisPeriod,
    parallel=Toggle(True),
    runIt=Toggle(True))  # -> readMe, port, effectiveRadiantField, MRTDelta, solarAdjustedMRT, port_2, mannequinMesh, port_3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; plug-in component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
outdoorcomfortcalculator = Ladybug_OutdoorComfortCalculator(
    dryBulbTemperature=importepw.dryBulbTemperature,
    windSpeed_tenMeters=importepw.windSpeed,
    relativeHumidity=importepw.relativeHumidity,
    runIt=Toggle(True))  # -> readMe, port, universalThermalClimateIndex, comfortableOrNot, thermalStress, conditionOfPerson, port_2, percentOfTimeComfortable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; plug-in component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
outdoorcomfortcalculator_2 = Ladybug_OutdoorComfortCalculator(
    dryBulbTemperature=importepw.dryBulbTemperature,
    meanRadiantTemperature=solaradjusttemperature.solarAdjustedMRT,
    windSpeed_tenMeters=importepw.windSpeed,
    relativeHumidity=importepw.relativeHumidity,
    runIt=Toggle(True))  # -> readMe, port, universalThermalClimateIndex, comfortableOrNot, thermalStress, conditionOfPerson, port_2, percentOfTimeComfortable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; plug-in component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

# ---- group: Visualize Data
pt_2 = Point(Point(88.47226712, 166.2122937, 0))
_3dchart = Ladybug_3DChart(inputData=flatten(outdoorcomfortcalculator.conditionOfPerson), basePoint=pt_2, xScale="0.25", zScale="0")  # -> readMe, graphMesh, graphCurves, legend, legendBasePts, titleText, titleBasePts, conditionalHOY; plug-in component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
preview_2 = CustomPreview(Geometry=[_3dchart.graphCurves, _3dchart.legend], Shader=ColourSwatch(SwatchColor=RGB(0, 0, 0)))

# ----
panel = Panel(outdoorcomfortcalculator_2.percentOfTimeComfortable)
_3dchart_2 = Ladybug_3DChart(inputData=flatten("Connect input data here"))  # -> readMe, graphMesh, graphCurves, legend, legendBasePts, titleText, titleBasePts, conditionalHOY; plug-in component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
bench_01 = Brep(<brep referenced from the Rhino model>)
bench_02 = Brep(<brep referenced from the Rhino model>)
bench_03 = Brep(<brep referenced from the Rhino model>)
shade = Brep([<brep referenced from the Rhino model> x7])
context = Brep([<brep referenced from the Rhino model> x2])
comfortshadebenefit = Ladybug_ComfortShadeBenefitEvaluator(
    location=importepw.location,
    temperatures=outdoorcomfortcalculator_2.universalThermalClimateIndex,
    balanceTemperature="20",
    testShades=shade,
    testRegion=bench_03,
    gridSize="1",
    context=context,
    skyResolution="5",
    delNonIntersect=False,
    parallel=Toggle(True),
    runIt=Toggle(True))  # -> readMe, port, sunVectors, regionTestPts, shadeMesh, legend, legendBasePoint, port_2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; plug-in component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
panel_2 = Panel("""This file shows you how to run a basic shade benefit simulation based on outdoor comfort.
The file takes as its starting point the idea of designing a shade for a bus shelter.""")
exporthydra = Hydra_ExportFile(fileName="Sade Benefit Based on Outdoor Comfort", fileDescription=panel_2, fileVersion="0.0.60", export=Toggle(False))  # -> readMe, ghFile, ghImgFile, rhinoImg, thumbnail, descriptFile, changeLog, metadataFile; inputs fileDescription: list, changeLog: list, fileTags: list, includeRhinoFile: Boolean, useGHForThumbnail: Boolean, export: Boolean; plug-in component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
shadecreator = Honeybee_OptimalShadeCreator(
    shadeMesh=comfortshadebenefit.shadeMesh,
    shadeNetEffect=comfortshadebenefit.shadeNetEffect,
    percentToKeep=Slider(100, range=0..100))  # -> readMe, energySavedByShade, areaOfShade, newColoredMesh, newShadeBrep; plug-in component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
panel_3 = Panel(shadecreator.energySavedByShade)
panel_4 = Panel(shadecreator.areaOfShade)
preview_3 = CustomPreview(Geometry=shadecreator.newShadeBrep, Shader=ColourSwatch(SwatchColor=RGB(0, 0, 0)))
