# Grasshopper definition Outdoor_Comfort_Sunpath_Philly.gh (Grasshopper 0.9.76)
# plug-ins: Python Interpreter

ladybug = Ladybug_Ladybug()  # -> Vviiiiiiiiiizzz; plug-in component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
open_weather_file = Ladybug_OpenEPWWeatherFile(open=Toggle(True))  # -> epwFile; plug-in component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
importepw = Ladybug_ImportEpw(epwFile=open_weather_file)  # -> readMe, latitude, location, dryBulbTemperature, dewPointTemperature, relativeHumidity, windSpeed, windDirection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; plug-in component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
panel = Panel("15<a<25 and 20<b<100")
analysisperiod = Ladybug_AnalysisPeriod(
    fromMonth=Slider(12, range=1..12),
    fromDay=Slider(31, range=1..31),
    fromHour=Slider(11, range=6..20),
    toMonth=Slider(1, range=1..12),
    toDay=Slider(1, range=1..31),
    toHour=Slider(12, range=6..20))  # -> readMe, analysisPeriod; plug-in component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
panel_2 = Panel("""9
12
15""")
series = Series(Start=1, Step=1, Count=24)
panel_3 = Panel("a<20")
panel_4 = Panel("a>25")
panel_5 = Panel("""6
9
12""")
pt = Point(Point(-18.948125, -7, 0))
sunpath = Ladybug_SunPath(
    location=importepw.location,
    hour=panel_2,
    day=21,
    month=panel_5,
    timeStep=1,
    centerPt=pt,
    sunPathScale=".5",
    sunScale="2",
    annualHourlyData=flatten(importepw.globalHorizontalRadiation),
    dailyOrAnnualSunPath=True)  # -> readMe, sunVectors, sunAltitudes, sunAzimuths, port, sunSpheresMesh, sunPathCrvs, legend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; disabled; plug-in component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
ln = Line(StartPoint=sunpath.sunPathCenPts, EndPoint=sunpath.sunPositions)
orient2camera = Ladybug_OrientToCamera(initPosition=sunpath.sunPositions, refresh=Toggle(True))  # -> orientedToCam; plug-in component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
tag = TextTag3D(Location=orient2camera, Size="1", Colour=RGB(133, 68, 68), Justification=7)
loft = Loft(Options={Adjust=False, Closed=False, LoftEnds=0, LoftSimp=0, LoftType=0, Rebuild=10, Refit=0.01})  # disabled
preview = CustomPreview(Geometry=[sunpath.sunPathCrvs, sunpath.legend], Shader=ColourSwatch(SwatchColor=RGB(0, 0, 0)))
preview_2 = CustomPreview(Geometry=loft, Shader=ColourSwatch(SwatchColor=RGBA(181, 172, 101, 47)))
