# Grasshopper definition Knyazkina_Ksenia_Energy_Daylight.gh (Grasshopper 0.9.76)
# plug-ins: Python Interpreter

panel = Panel("""Honeybee
Energy
Daylighting
EnergyPlus
Daysim
Radiance
HBExampleFiles""")
panel_2 = Panel("1")
ladybug = Ladybug_Ladybug()  # -> Vviiiiiiiiiizzz; plug-in component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
honeybee = Honeybee_Honeybee()  # -> Vviiiiiiiiiizzz; plug-in component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
panel_3 = Panel("This is an example that shows how to integrate results of daylighting simulation with an energy simulation")

honeybee_bldgprograms = Honeybee_bldgPrograms({"Office": 0, "Retail": 1, "MidriseApartment": 2, "PrimarySchool": 3, "SecondarySchool": 4, "SmallHotel": 5, "LargeHotel": 6, "Hospital": 7, "Outpatient": 8, "Warehouse": 9, "SuperMarket": 10, "FullServiceRestaurant": 11, "QuickServiceRestaurant": 12}, selected="MidriseApartment")
listzoneprograms = Honeybee_ListZonePrograms(bldgProgram=honeybee_bldgprograms)  # -> MidriseApartmentZonePrograms; plug-in component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
list_item = ListItem(List=listzoneprograms, Index=Slider(2, range=0..3), Wrap=True)
panel_4 = Panel(list_item)

honeybee_bldgprograms_2 = Honeybee_bldgPrograms({"Office": 0, "Retail": 1, "MidriseApartment": 2, "PrimarySchool": 3, "SecondarySchool": 4, "SmallHotel": 5, "LargeHotel": 6, "Hospital": 7, "Outpatient": 8, "Warehouse": 9, "SuperMarket": 10, "FullServiceRestaurant": 11, "QuickServiceRestaurant": 12}, selected="MidriseApartment")
listzoneprograms_2 = Honeybee_ListZonePrograms(bldgProgram=honeybee_bldgprograms_2)  # -> MidriseApartmentZonePrograms; plug-in component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
list_item_2 = ListItem(List=listzoneprograms_2, Index=Slider(3, range=0..3), Wrap=True)
panel_5 = Panel(list_item_2)

honeybee_bldgprograms_3 = Honeybee_bldgPrograms({"Office": 0, "Retail": 1, "MidriseApartment": 2, "PrimarySchool": 3, "SecondarySchool": 4, "SmallHotel": 5, "LargeHotel": 6, "Hospital": 7, "Outpatient": 8, "Warehouse": 9, "SuperMarket": 10, "FullServiceRestaurant": 11, "QuickServiceRestaurant": 12}, selected="MidriseApartment")
listzoneprograms_3 = Honeybee_ListZonePrograms(bldgProgram=honeybee_bldgprograms_3)  # -> MidriseApartmentZonePrograms; plug-in component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
list_item_3 = ListItem(List=listzoneprograms_3, Index=Slider(3, range=0..3), Wrap=True)
panel_6 = Panel(list_item_3)

epopaquemat = Honeybee_EnergyPlusOpaqueMaterial(thickness="0.9", conductivity="0.6", density="2000", specificHeat="867")  # -> EPMaterial; plug-in component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

# ---- group: floor
floor = Brep(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)

# ----
ledge = Brep(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)

# ---- group: ceiling
ceiling = Brep([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])

# ----
walls = Brep([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])
wall_surface_with_opening = Brep(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)
exporthydra = Hydra_ExportFile(
    fileName="Integrated_Daylight_and_Energy_similation",
    fileDescription=panel_3,
    fileTags=panel,
    targetFolder="C:\Users\Administrator\Documents\GitHub\hydra_1",
    export=Toggle(False))  # -> readMe; inputs fileDescription: list, changeLog: list, fileTags: list, includeRhino: Boolean, GHForThumb: Boolean, additionalImgs: list, export: Boolean; plug-in component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
epconstruction = Honeybee_EnergyPlusConstruction(layer_1=epopaquemat)  # -> EPConstruction; plug-in component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
# Geometry Preparation
panel_7 = Panel("0")
createhbsrfs = Honeybee_createHBSrfs(geometry=flatten([floor, ledge]), srfType="2")  # -> readMe, simplify(HBSurface); plug-in component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
createhbsrfs_2 = Honeybee_createHBSrfs(geometry=ceiling, srfType="3")  # -> readMe, simplify(HBSurface); plug-in component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
createhbsrfs_3 = Honeybee_createHBSrfs(geometry=wall_surface_with_opening, srfType="0", EPConstruction=epconstruction)  # -> readMe, simplify(HBSurface); plug-in component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
# Honeybee default materials will be assigned
# based on surface type
createhbsrfs_4 = Honeybee_createHBSrfs(geometry=walls, srfType=panel_7)  # -> readMe, simplify(HBSurface); plug-in component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

# ---- group: Make all surfaces except the facade with window adiabatic
makeadiabatic = Honeybee_MakeAdiabatic(HBSrfs=flatten([createhbsrfs_2.HBSurface, createhbsrfs.HBSurface]))  # -> HBSrfs; plug-in component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

# ----
glazingcreator = Honeybee_GlazingBasedOnRatio(HBObjects=createhbsrfs_3.HBSurface, glzRatio=Slider(0.6, range=0..1), breakUpWindow=Toggle(True), runIt=Toggle(True))  # -> out, HBObjWGLZ; plug-in component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
bldgprograms = Honeybee_bldgPrograms({"Office": 0, "Retail": 1, "MidriseApartment": 2, "PrimarySchool": 3, "SecondarySchool": 4, "SmallHotel": 5, "LargeHotel": 6, "Hospital": 7, "Outpatient": 8, "Warehouse": 9, "SuperMarket": 10, "FullServiceRestaurant": 11, "QuickServiceRestaurant": 12}, selected="MidriseApartment")
listzoneprograms_4 = Honeybee_ListZonePrograms(bldgProgram=bldgprograms)  # -> MidriseApartmentZonePrograms; plug-in component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
item = ListItem(List=listzoneprograms_4, Index=0, Wrap=True)
panel_8 = Panel(item)
deconstruct_brep = DeconstructBrep(Brep=glazingcreator.HBObjWGLZ)  # -> Faces, Edges, Vertices
panel_9 = Panel("""1
2
3""")
list_item_4 = ListItem(List=deconstruct_brep.Faces, Index=panel_9, Wrap=True)
addhbglz = Honeybee_addHBGlz(HBObj=createhbsrfs_3.HBSurface, childSurfaces=flatten(list_item_4))  # -> simplify(HBObjWGLZ); plug-in component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

# ---- group: collect all honeybee surfaces
brep = Brep(flatten([makeadiabatic, addhbglz]))

# ----
glass = Brep(list_item_4)
preview = CustomPreview(Geometry=glass, Shader=ColourSwatch(SwatchColor=RGBA(80, 222, 255, 160)))
edges = BrepEdges(Brep=glass)  # -> Naked, Interior, NonManifold
number_slider = Slider(1, range=0..10)
createhbzones = Honeybee_createHBZones(name="test_room", zoneProgram=item, HBSurfaces=flatten([brep, createhbsrfs_4.HBSurface]), isConditioned=Toggle(False))  # -> readMe, HBZone; plug-in component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

rm_left = Brep(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)
corridor = Brep(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)
rm_right = Brep(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)
mass2zone = Honeybee_Masses2Zones(
    zoneMasses=flatten(rm_right),
    zoneNames="RM RIGHT",
    zonePrograms=list_item_2,
    isConditioned=Toggle(False),
    maxRoofAngle=30,
    createHBZones=Toggle(True))  # -> out, HBZones; plug-in component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
mass2zone_2 = Honeybee_Masses2Zones(
    zoneMasses=flatten(corridor),
    zoneNames="CORRIDOR",
    zonePrograms=list_item,
    isConditioned=Toggle(False),
    maxRoofAngle=30,
    createHBZones=Toggle(True))  # -> out, HBZones; plug-in component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
mass2zone_3 = Honeybee_Masses2Zones(
    zoneMasses=flatten(rm_left),
    zoneNames="RM LEFT",
    zonePrograms=list_item_3,
    isConditioned=Toggle(False),
    maxRoofAngle=30,
    createHBZones=Toggle(True))  # -> out, HBZones; plug-in component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
boolean_toggle = BooleanToggle(True)
boolean_toggle_2 = BooleanToggle(True)
boolean_toggle_3 = BooleanToggle(True)
makeadiabaticbytype = Honeybee_MakeAdiabaticByType(HBZones=mass2zone.HBZones, roofs=boolean_toggle_2, ceilings=boolean_toggle_2, floors=boolean_toggle_2)  # -> HBZones; plug-in component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
makeadiabaticbytype_2 = Honeybee_MakeAdiabaticByType(HBZones=mass2zone_2.HBZones, roofs=boolean_toggle, floors=boolean_toggle)  # -> HBZones; plug-in component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
makeadiabaticbytype_3 = Honeybee_MakeAdiabaticByType(HBZones=mass2zone_3.HBZones, roofs=boolean_toggle_3, ceilings=boolean_toggle_3, floors=boolean_toggle_3)  # -> HBZones; plug-in component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
solveadjc = Honeybee_SolveAdjacencies(
    HBZones=flatten([createhbzones.HBZone, makeadiabaticbytype, makeadiabaticbytype_3, makeadiabaticbytype_2]),
    removeCurrentAdjc=False,
    findAdjc=Toggle(True))  # -> out, HBZonesWADJ; plug-in component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

wires = BrepWireframe(Brep=createhbzones.HBZone, Density=-1)
crv = Curve(edges.Naked)
area = Area(Geometry=glass)  # -> Area, Centroid
ma = MassAddition(Input=area.Area)  # -> Result, PartialResults
sdivide = DivideSurface(Surface=glass, UCount=number_slider, VCount=number_slider)  # -> flatten(Points), Normals, Parameters
panel_10 = Panel(area.Area)
panel_11 = Panel("""2
6
10
14""")
panel_12 = Panel("""0
4
8
12""")
panel_13 = Panel("""3
7
11
15""")
panel_14 = Panel("""1
5
9
13""")
flip = Flip(Surface=floor)  # -> Surface, Result
item_2 = ListItem(List=sdivide.Points, Index=panel_12, Wrap=True)
item_3 = ListItem(List=sdivide.Points, Index=panel_11, Wrap=True)
item_4 = ListItem(List=sdivide.Points, Index=panel_13, Wrap=True)
item_5 = ListItem(List=sdivide.Points, Index=panel_14, Wrap=True)

# ---- group: Top right
pt = Point(item_3)

# ---- group: bottom right
pt_2 = Point(item_2)

# ---- group: Top left
pt_3 = Point(item_4)

# ---- group: bottom left
pt_4 = Point(item_5)

# ----
gentestpts = Honeybee_GenerateTestPoints(testSurface=flip.Surface, gridSize=".5", distBaseSrf=".762", moveTestMesh=True)  # -> readMe, simplify(testPoints), simplify(ptsVectors), simplify(facesArea), simplify(mesh); plug-in component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
path = FilePath("C:\Users\kksenia\Desktop\Building Simulations\week 4\USA_PA_Philadelphia.724086_TMY2.epw")
importepw = Ladybug_ImportEpw(epwFile=path)  # -> readMe, latitude, location, dryBulbTemperature, dewPointTemperature, relativeHumidity, windSpeed, windDirection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; plug-in component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
vec = Vector(Vector(-2.656571779, 2.65144778, 0))

number_slider_2 = Slider(45, range=0..100)
panel_15 = Panel("http://apps1.eere.energy.gov/buildings/energyplus/weatherdata/4_north_and_central_america_wmo_region_4/1_usa/USA_PA_Philadelphia.Intl.AP.724080_TMY3.zip")
open_epw_stat = Ladybug_OpenEPWAndSTATWeatherFiles(weatherFileURL=panel_15)  # -> epwFile, statFile; plug-in component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
northarrow = Ladybug_North(north=number_slider_2, scale=".05")  # -> northSign; plug-in component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

importepw_2 = Ladybug_ImportEpw(epwFile=open_epw_stat.epwFile)  # -> Output, latitude, location, dryBulbTemperature, dewPointTemperature, relativeHumidity, windSpeed, windDirection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; plug-in component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
importlocation = Ladybug_ImportLocation(epwFile=open_epw_stat.epwFile)  # -> location; plug-in component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
sunpath = Ladybug_SunPath(
    north=number_slider_2,
    location=importlocation,
    hour=12,
    day=21,
    month=12,
    timeStep=1,
    sunPathScale=Slider(0.5, range=0..1),
    dailyOrAnnualSunPath=True)  # -> out, sunVectors, sunAltitudes, sunAzimuths, port, sunSpheresMesh, sunPathCrvs, legend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; plug-in component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

vec_2 = Vector(Vector(13.63396663, -31.31604271, 0))
ln = Line(StartPoint=pt, EndPoint=pt_3)
radparameters = Honeybee_RADParameters(quality=0)  # -> readMe, radParameters; plug-in component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
ln_2 = Line(StartPoint=pt_3, EndPoint=pt_4)
ln_3 = Line(StartPoint=pt, EndPoint=pt_2)
item_6 = ListItem(List=ln_3, Index=1, Wrap=True)
len = Length(Curve=item_6)
multiplication = Multiplication(A=len, B="-1")
number_slider_3 = Slider(0.1, range=0.1..1.5)
gencumulativeskymtx = Ladybug_GenCumulativeSkyMtx(epwFile=path, skyDensity=0, useOldRes=True, runIt=Toggle(True))  # -> readMe, cumulativeSkyMtx; plug-in component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
analysisperiod = Ladybug_AnalysisPeriod()  # -> readMe, analysisPeriod; plug-in component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
len_2 = Length(Curve=ln)
xy = XYPlane(Origin=Point(0, 0, 0))
panel_16 = Panel(importepw.globalHorizontalRadiation)
Z = UnitZ(Factor=Slider(0.5, range=0.1..1.5))
Z_2 = UnitZ(Factor=1)
Y = UnitY(Factor=len_2)
rev = Reverse(Vector=vec_2)
curvepoint = PointOnCurve(ln_2, parameter=0)
legendpar = Ladybug_LegendParameters(highBound=panel_16)  # -> legendPar; plug-in component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
legendpar_2 = Ladybug_LegendParameters(highBound=panel_16, legendScale="0.01")  # -> legendPar; plug-in component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
Z_3 = UnitZ(Factor=Slider(0, range=0..1))
analysisperiod_2 = Ladybug_AnalysisPeriod(fromMonth="6", fromDay="1", toMonth="9", toDay="31")  # -> readMe, analysisPeriod; plug-in component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
toggle = BooleanToggle(True)
angle = Angle(VectorA=ln, VectorB=vec_2, Plane=xy)  # -> Angle, Reflex
selectskymtx = Ladybug_selectSkyMtx(
    cumulativeSkyMtx=gencumulativeskymtx.cumulativeSkyMtx,
    analysisPeriod=analysisperiod.analysisPeriod,
    removeDiffuse=False,
    removeDirect=False)  # -> readMe, selectedSkyMtx; plug-in component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
vrot = Rotate(Vector=vec_2, Axis=Z_2, Angle=degrees("90"))
annualdaylightsimulation = Honeybee_AnnualDaylightSimulation(
    north=number_slider_2,
    epwWeatherFile=open_epw_stat.epwFile,
    testPoints=gentestpts.testPoints,
    ptsVectors=gentestpts.ptsVectors,
    testMesh=gentestpts.mesh,
    radParameters=radparameters.radParameters)  # -> analysisRecipe; plug-in component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
move = Move(Geometry=pt_2, Motion=Z_3)  # -> Geometry, Transform
move_2 = Move(Geometry=pt_4, Motion=Z)  # -> Geometry, Transform
item_7 = ListItem(List=len_2, Index="0", Wrap=True)
item_8 = ListItem(List=angle.Angle, Index="0", Wrap=True)
toggle_2 = BooleanToggle(True)
analysisperiod_3 = Ladybug_AnalysisPeriod()  # -> readMe, analysisPeriod; plug-in component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
panel_17 = Panel("0.25")
sin = Sine(Value=item_8)
legendpar_3 = Ladybug_LegendParameters(lowBound="0", highBound="1000")  # -> legendPar; plug-in component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
multiplication_2 = Multiplication(A=item_7, B=sin)

# ---- group: VENT
panel_18 = Panel("""1
1
1
1
1
1
1
0
0
0
0
0
0
0
0
0
0
0
0
0
0
1
1
1""")
dup = DuplicateData(Data=panel_18, Number=365, Order=True)
csvschedule = Honeybee_CreateCSVSchedule(values=dup, scheduleName="NightFlushSched", writeFile=Toggle(True))  # -> readMe, csvSchedule; plug-in component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
setepnatvent = Honeybee_SetEPAirFlow(
    naturalVentilationType="3",
    minIndoorTempForNatVent="18",
    openingAreaFractionalSched=csvschedule.csvSchedule,
    fractionOfGlzAreaOperable="0.5")  # -> readMe, simplify(HBZones); plug-in component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

# Run the analysis
panel_19 = Panel("1")
setepnatvent_2 = Honeybee_SetEPAirFlow(
    HBZones=solveadjc.HBZonesWADJ,
    naturalVentilationType=panel_19,
    minIndoorTempForNatVent="24",
    maxOutdoorTempForNatVent="28")  # -> readMe, simplify(HBZones); plug-in component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
zoneattributelist = Honeybee_ZoneAttributeList({"Name": "name", "Zone Program": "zoneProgram", "Zone Floor Area": "zoneFloorArea", "Zone Volume": "zoneVolume", "Building Program": "bldgProgram", "Is Conditioned": "isConditioned", "Occupancy Schedule": "occupancySchedule", "Occupancy Activity Schedule": "occupancyActivitySch", "Heating SetPoint Schedule": "heatingSetPtSchedule", "Cooling SetPoint Schedule": "coolingSetPtSchedule"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}, selected="Natural Ventilation": "natVent")
labelzones = Honeybee_LabelZones(HBZones=flatten(setepnatvent_2.HBZones), attribute=zoneattributelist)  # -> zoneTxtLabels, labelBasePts, brepTxtLabels, zoneWireFrames; plug-in component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

# ----
addition = Addition(A=multiplication_2, B=Slider(0.5, range=0..1))
data = Data(addition)
ln_4 = Line(StartPoint=pt_4, EndPoint=curvepoint)
panel_20 = Panel(multiplication_2)

# ---- group: VENT
setepnatvent_3 = Honeybee_SetEPAirFlow(
    naturalVentilationType="2",
    minIndoorTempForNatVent="20",
    maxOutdoorTempForNatVent="28",
    fractionOfGlzAreaOperable="1",
    fractionOfGlzHeightOperable="5",
    windDischargeCoeff="0",
    windowAngle2North="0")  # -> readMe, simplify(HBZones); plug-in component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

# ----
toggle_3 = BooleanToggle(True)
amp = Amplitude(Vector=vrot, Amplitude=Slider(0.1, range=0..0.1))
division = Division(A=data, B=2)
len_3 = Length(Curve=ln_4)
move_3 = Move(Geometry=pt_4, Motion=amp)  # -> Geometry, Transform
epoutput = Honeybee_GenerateEPOutput(
    zoneEnergyUse=toggle_3,
    zoneGainsAndLosses=toggle_3,
    zoneComfortMetrics=toggle_3,
    surfaceTempAnalysis=toggle_3,
    surfaceEnergyAnalysis=toggle_3,
    timestep="hourly")  # -> report, flatten(simulationOutputs); plug-in component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
# Run the analysis
toggle_4 = BooleanToggle(True)
# update lighting schedule
setepzoneschedules = Honeybee_SetEnergyPlusZoneSchedules(HBZones=createhbzones.HBZone)  # -> schedules, simplify(HBZones); plug-in component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
amp_2 = Amplitude(Vector=vrot, Amplitude=data)
move_4 = Move(Geometry=curvepoint, Motion=amp_2)  # -> Geometry, Transform
X = UnitX(Factor=1)
move_5 = Move(Geometry=curvepoint, Motion=Y)  # -> Geometry, Transform
move_6 = Move(Geometry=move_5.Geometry, Motion=X)  # -> Geometry, Transform
srf4pt = _4PointSurface(CornerA=curvepoint, CornerB=move_2.Geometry, CornerC=move_4.Geometry)
runenergysimulation = Honeybee_RunEnergySimulation(
    north=number_slider_2,
    epwFile=open_epw_stat.epwFile,
    HBZones=flatten(setepnatvent_2.HBZones),
    simulationOutputs=flatten(epoutput.simulationOutputs),
    writeIdf=toggle_4,
    runEnergyPlus=toggle_4)  # -> report, idfFileAddress, resultFileAddress; plug-in component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
legendpar_4 = Ladybug_LegendParameters(lowBound="20", highBound="100")  # -> legendPar; plug-in component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
readepresult = Honeybee_ReadEPResult(resultFileAddress=runenergysimulation.resultFileAddress)  # -> port, port_2, port_3, port_4, electricLight, electricEquip, fanElectric, port_5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; plug-in component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
adaptivecomfortcalculator = Ladybug_AdaptiveComfortCalculator(
    dryBulbTemperature=readepresult.airTemperature,
    meanRadiantTemperature=readepresult.meanRadTemperature,
    prevailingOutdoorTemp=importepw_2.dryBulbTemperature,
    windSpeed=importepw_2.windSpeed,
    runIt=Toggle(True))  # -> out, port, comfortableOrNot, conditionOfPerson, degreesFromTarget, port_2, targetTemperature, upperTemperatureBound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; plug-in component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
setepzoneloads = Honeybee_SetEnergyPlusZoneLoads(HBZones=setepzoneschedules.HBZones, lightingDensityPerArea=Slider(0, range=0..100))  # -> loads, HBZones; plug-in component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
separatedata = Ladybug_SeparateData(inputList=flatten(readepresult.port_3))  # -> numbers, strings; plug-in component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
separatedata_2 = Ladybug_SeparateData(inputList=flatten(readepresult.port_4))  # -> numbers, strings; plug-in component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
analysisperiod_4 = Ladybug_AnalysisPeriod()  # -> readMe, analysisPeriod; plug-in component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
bang = ExplodeTree(Data=adaptivecomfortcalculator.conditionOfPerson)  # -> Branch0, Branch1, Branch2, Branch3
bang_2 = ExplodeTree(Data=adaptivecomfortcalculator.percentOfTimeComfortable)  # -> Branch0, Branch1, Branch2, Branch3
bang_3 = ExplodeTree(Data=adaptivecomfortcalculator.percentHotCold)  # -> Branch0, Branch1, Branch2, Branch3
ma_2 = MassAddition(Input=separatedata.numbers)  # -> Result, PartialResults
panel_21 = Panel(bang_2.Branch0)
ma_3 = MassAddition(Input=separatedata_2.numbers)  # -> Result, PartialResults
_3dchart = Ladybug_3DChart(inputData=flatten(readepresult.operativeTemperature), xScale="0.25", zScale="0")  # -> out, graphMesh, graphCurves, legend, legendBasePts, title, titleBasePts, dataPts, conditionalHOY; plug-in component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
total_cooling = Panel(ma_2.Result)
total_heating = Panel(ma_3.Result)
panel_22 = Panel(bang_3.Branch0)
sunpath_2 = Ladybug_SunPath(
    north=number_slider_2,
    location=importepw_2.location,
    hour=12,
    day=21,
    month=12,
    timeStep=1,
    analysisPeriod=analysisperiod_4.analysisPeriod,
    annualHourlyData=flatten(bang.Branch0),
    conditionalStatement="a>0",
    dailyOrAnnualSunPath=True)  # -> readMe, sunVectors, sunAltitudes, sunAzimuths, port, sunSpheresMesh, sunPathCrvs, legend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; plug-in component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
data_recorder = DataRecorder(bang.Branch0, DataLimit=-10, RecordData=False)
panel_23 = Panel(bang.Branch0)
panel_24 = Panel("""Cooling, Heating
& Lighting Loads""")
ln_5 = Line(StartPoint=sunpath_2.sunPositions, EndPoint=sunpath_2.sunVectors)
brep_2 = Brep(<brep referenced from the Rhino model>)
blx = BrepLine(Brep=brep_2, Line=ln_5, LimitToFirst=False)  # -> Curves, Points
_3dchart_2 = Ladybug_3DChart(inputData=flatten(bang.Branch0), xScale="0.5", zScale="0")  # -> out, graphMesh, graphCurves, legend, legendBasePts, title, titleBasePts, dataPts, conditionalHOY; plug-in component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
barchart = Ladybug_MonthlyBarChart(altYAxisTitle=panel_24, basePoint="20, 0, 0", xScale=Slider(0.5, range=0..1), yScale=Slider(0.7, range=0..1))  # -> readMe, dataMesh, dataCurves, dataCrvColors, graphAxes, graphLabels, title, titleBasePt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; plug-in component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
blx_2 = BrepLine(LimitToFirst=False)  # -> Curves, Points
sunpath_3 = Ladybug_SunPath(
    north=vec,
    location=importepw.location,
    hour=12,
    day=21,
    month=12,
    timeStep=1,
    analysisPeriod=analysisperiod_3.analysisPeriod,
    sunPathScale="0.5",
    annualHourlyData=flatten(importepw.globalHorizontalRadiation),
    conditionalStatement="a>900",
    dailyOrAnnualSunPath=True)  # -> readMe, sunVectors, sunAltitudes, sunAzimuths, port, sunSpheresMesh, sunPathCrvs, legend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; plug-in component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
ln_6 = Line(StartPoint=sunpath_3.sunPositions, EndPoint=sunpath_3.sunPathCenPts)
project = Project(Geometry=ln_6, Plane=PlaneXY(0, 0, 0))  # -> Geometry, Transform
preview_2 = CustomPreview(Geometry=sunpath_3.sunPathCrvs, Shader=ColourSwatch(SwatchColor=RGB(0, 0, 0)))
panel_25 = Panel(ln_6)
preview_3 = CustomPreview(Geometry=ln_6, Shader=ColourSwatch(SwatchColor=RGB(255, 0, 0)))
angle_2 = Angle(VectorA=ln_6, VectorB=project.Geometry)  # -> Angle, Reflex
deg = Degrees(Radians=angle_2.Angle)
panel_26 = Panel("90")
lng = ListLength(List=deg)
ma_4 = MassAddition(Input=deg)  # -> Result, PartialResults
division_2 = Division(A=ma_4.Result, B=lng)
panel_27 = Panel(division_2)
subtraction = Subtraction(A=90, B=panel_27)
rad = Radians(Degrees=subtraction)
tan = Tangent(Value=rad)
multiplication_3 = Multiplication(A=len_3, B=tan)
item_9 = ListItem(List=multiplication_3, Index="0", Wrap=True)
X_2 = UnitX(Factor=item_9)
move_7 = Move(Geometry=move_5.Geometry, Motion=X_2)  # -> Geometry, Transform
srf4pt_2 = _4PointSurface(CornerA=curvepoint, CornerB=move_4.Geometry, CornerC=move_7.Geometry, CornerD=move_5.Geometry)
srf4pt_3 = _4PointSurface(CornerA=move_5.Geometry, CornerB=move.Geometry, CornerC=move_7.Geometry)
brep_3 = Brep([srf4pt_3, srf4pt_2, srf4pt])
number_slider_4 = Slider(4, range=1..10)
division_3 = Division(A=multiplication, B=number_slider_4)
Z_4 = UnitZ(Factor=division_3)
crv_2 = Curve(ln)
number_slider_5 = Slider(11, range=0..360)
arrlinear = LinearArray(Geometry=crv_2, Direction=Z_4, Count=number_slider_4)  # -> Geometry, Transform
X_3 = UnitX(Factor=Slider(0.1, range=0.1..1.1))
Y_2 = UnitY(Factor=1)
vrot_2 = Rotate(Vector=X_3, Axis=Y_2, Angle=degrees(division_2))
vrot_3 = Rotate(Vector=X_3, Axis=Y_2, Angle=degrees(Slider(0, range=0..360)))
extr = Extrude(Base=arrlinear.Geometry, Direction=vrot_2)
rec = Brep(extr)
hb_epcontextsrf = HoneybeeEPContextSurfaces(shdSurfaces=flatten(rec))  # -> HBContext; inputs shdSurfaces: list of Brep, justBoundingBox: Boolean
# ---------- hb_epcontextsrf: Python ----------
"""
prepare shading/context geometries

    Args:
        northVectorOrRotation: A vector that shows North or a number that shows
                               the rotation of the North from the Y axis
        bldgMasses: List of closed Breps as thermal zones.
    Returns:
        report: ...
        thermalZones: Thermal zone's geometries for visualiza
"""

ghenv.Component.Name = 'Honeybee EP context Surfaces'
ghenv.Component.NickName = 'HB_EPContextSrf'
ghenv.Component.Message = 'VER 0.0.58\nNOV_20_2015'
ghenv.Component.Category = "Honeybee"
ghenv.Component.SubCategory = "09 | Energy | Energy"
#compatibleHBVersion = VER 0.0.57\nNOV_01_2015
#compatibleLBVersion = VER 0.0.59\nFEB_01_2015
ghenv.Component.AdditionalHelpFromDocStrings = "2"

import rhinoscriptsyntax as rs
import Rhino as rc
import scriptcontext as sc
import os
import System
import Grasshopper.Kernel as gh
import uuid

tolerance = sc.doc.ModelAbsoluteTolerance
import math


def main(shdSurfaces, EPTransSchedule, meshingSettings, justBoundingBox):
    
    # import the classes
    if sc.sticky.has_key('honeybee_release'):

        try:
            if not sc.sticky['honeybee_release'].isCompatible(ghenv.Component): return -1
        except:
            warning = "You need a newer version of Honeybee to use this compoent." + \
            " Use updateHoneybee component to update userObjects.\n" + \
            "If you have already updated userObjects drag Honeybee_Honeybee component " + \
            "into canvas and try again."
            w = gh.GH_RuntimeMessageLevel.Warning
            ghenv.Component.AddRuntimeMessage(w, warning)
            return -1
        
        # don't customize this part
        hb_EPSrf = sc.sticky["honeybee_EPSurface"]
        hb_EPSHDSurface = sc.sticky["honeybee_EPShdSurface"]
        hb_RADMaterialAUX = sc.sticky["honeybee_RADMaterialAUX"]
        hb_EPObjectsAux = sc.sticky["honeybee_EPObjectsAUX"]()
        HBScheduleList = sc.sticky["honeybee_ScheduleLib"].keys()

        ########################################################################
        #----------------------------------------------------------------------#
        shdBreps = []
        # create bounding box of shading geometries
        if justBoundingBox:
            for brep in shdSurfaces:
                if brep.Faces.Count>1 or not brep.Faces[0].IsPlanar(sc.doc.ModelAbsoluteTolerance):
                    shdBreps.append(brep.GetBoundingBox(True).ToBrep())
                else:
                    shdBreps.append(brep)
        else:
            shdBreps = shdSurfaces
        
        shadingClasses = []
        shadingMeshPreview = []
        
        if meshingSettings == None:
            mp = rc.Geometry.MeshingParameters.Minimal
            mp.SimplePlanes = True
        else:
            mp = meshingSettings
        
        def getRadMaterialName(radMaterial):
            nameStr = radMaterial.split(" ")[2]
            name =  nameStr.split("\n")[0]
            return name
        
        for brepCount, brep in enumerate(shdBreps):
            if brep != None:
                isPlanar = True
                # check planarity
                for face in brep.Faces:
                    if not face.IsPlanar(tolerance):
                        isPlanar = False
                        break
                
                shadingBreps = []
                if not isPlanar:
                    meshArray = rc.Geometry.Mesh.CreateFromBrep(brep, mp)
                    for mesh in meshArray:
                        for meshFace in range(mesh.Faces.Count):
                            vertices = list(mesh.Faces.GetFaceVertices(meshFace))[1:]
                            vertices = vertices + [sc.doc.ModelAbsoluteTolerance]
                            # create the brep from mesh
                            shdBrep = rc.Geometry.Brep.CreateFromCornerPoints(*vertices)
                            shadingBreps.append(shdBrep)
                else:
                    for face in brep.Faces:
                        shadingBreps.append(face.DuplicateFace(False))
                
                for faceCount, shdBrep in enumerate(shadingBreps):
                        thisShading = hb_EPSHDSurface(shdBrep, 1000*brepCount + faceCount, 'shdSrf_' + `brepCount` + '_' + `faceCount` + "_" + str(uuid.uuid4()))
                        
                        # add transmittance schedule if any
                        if EPTransSchedule!=None:
                            schedule= EPTransSchedule.upper()
                            if schedule!=None and not schedule.lower().endswith(".csv") and schedule not in HBScheduleList:
                                msg = "Cannot find " + schedule + " in Honeybee schedule library."
                                print msg
                                ghenv.Component.AddRuntimeMessage(gh.GH_RuntimeMessageLevel.Warning, msg)
                                return -1
                            elif schedule!=None and schedule.lower().endswith(".csv"):
                                # check if csv file is existed
                                if not os.path.isfile(schedule):
                                    msg = "Cannot find the shchedule file: " + schedule
                                    print msg
                                    ghenv.Component.AddRuntimeMessage(gh.GH_RuntimeMessageLevel.Warning, msg)
                                    return -1
                            
                            thisShading.TransmittanceSCH = schedule
                        
                        # add the Rad Material if any
                        if RADMaterial!=None:
                            # if it is just the name of the material make sure it is already defined
                            if len(RADMaterial.split(" ")) == 1:
                                # if the material is not in the library add it to the library
                                if not hb_RADMaterialAUX.isMatrialExistInLibrary(RADMaterial):
                                    warningMsg = "Can't find " + RADMaterial + " in RAD Material Library.\n" + \
                                                "Add the material to the library and try again."
                                    ghenv.Component.AddRuntimeMessage(gh.GH_RuntimeMessageLevel.Warning, warningMsg)
                                    return
                                
                                try:
                                    thisShading.setRADMaterial(RADMaterial)
                                except Exception, e:
                                    print e
                                    warningMsg = "You are using an old version of Honeybee_Honeybee! Update your files and try again."
                                    print warningMsg
                                    ghenv.Component.AddRuntimeMessage(gh.GH_RuntimeMessageLevel.Warning, warningMsg)
                                    return
                                
                                addedToLib = True
                            else:
                                
                                # try to add the material to the library
                                addedToLib, thisShading.RadMaterial = hb_RADMaterialAUX.analyseRadMaterials(RADMaterial, True)
                                
                            if addedToLib==False:
                                warningMsg = "Failed to add " + RADMaterial + " to the Library."
                                ghenv.Component.AddRuntimeMessage(gh.GH_RuntimeMessageLevel.Warning, warningMsg)
                                return
                        
                        # add shading to the list
                        shadingClasses.append(thisShading)
                
        # add to the hive
        hb_hive = sc.sticky["honeybee_Hive"]()
        HBContext  = hb_hive.addToHoneybeeHive(shadingClasses, ghenv.Component.InstanceGuid.ToString())
        return HBContext
        ################################################################################################
    else:
        print "You should first let Honeybee to fly..."
        w = gh.GH_RuntimeMessageLevel.Warning
        ghenv.Component.AddRuntimeMessage(w, "You should first let Honeybee to fly...")
        return -1
        

if _shdSurfaces and _shdSurfaces[0]!=None:
    # add cleaning function
    result= main(_shdSurfaces, EPTransSchedule_, meshingSettings_, justBoundingBox_)
    
    if result != -1: HBContext = result
# ---------- end hb_epcontextsrf ----------
# Run Annual Daylight
rundaylightanalysis = Honeybee_RunDaylightSimulation(
    HBObjects=flatten([createhbzones.HBZone, hb_epcontextsrf]),
    analysisRecipe=annualdaylightsimulation,
    writeRad=toggle,
    runRad=toggle,
    numOfCPUs=Slider(3, range=0..10),
    overwriteResults=True)  # -> readMe, analysisType, resultsUnit, results, testPts, annual_analysis_files, radGeoFile, studyFolder, done; plug-in component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
readannualresultsi = Honeybee_ReadAnnualResultI(
    illFilesAddress=rundaylightanalysis.annual_analysis_files,
    testPoints=simplify(rundaylightanalysis.testPts),
    DLAIllumThresholds=300,
    runIt=Toggle(True))  # -> DLA, UDLI_Less_100, UDLI_100_2000, UDLI_More_2000, CDA, sDA, annualProfiles, htmReport; plug-in component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
panel_28 = Panel(readannualresultsi.sDA)
panel_29 = Panel(readannualresultsi.DLA)
recolormesh = Ladybug_RecolorMesh(analysisResult=readannualresultsi.DLA, inputMesh=gentestpts.mesh, legendPar=legendpar_4)  # -> readMe, newMesh, newLegend, legendBasePt, meshColors, legendColors; plug-in component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

# ---- group: just for visualization
# Compare Schedules!
dsannualprofiles = Honeybee_DaysimAnnualProfiles(annualProfiles=readannualresultsi.annualProfiles)  # -> simplify(occupancyProfile), simplify(shadingProfiles), simplify(lightingControlProfiles), simplify(dgpProfile); plug-in component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
convertepschvalues = Honeybee_ConvertEnergyPlusScheduleToValues()  # -> values; plug-in component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
_3dchart_3 = Ladybug_3DChart(inputData=flatten([convertepschvalues, dsannualprofiles.lightingControlProfiles]))  # -> readMe, graphMesh, graphCurves, legend, legendBasePts, title, titleBasePts, dataPts, conditionalHOY; plug-in component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

# ----
extr_2 = Extrude(Base=arrlinear.Geometry, Direction=vrot_3)
