# Grasshopper definition Knyazkina_Ksenia_1102 energy simulation.gh (Grasshopper 0.9.76)
# plug-ins: Python Interpreter

panel = Panel("""Honeybee
Energy
Daylighting
EnergyPlus""")
panel_2 = Panel("Surface_by_surface_geometry_preparation_for_energy_similation_I")
panel_3 = Panel("This is an example that shows how to prepare the geometry surface by surface for energy simulation. The same model can be used for daylighting")
panel_4 = Panel("C:\Users\Administrator\Dropbox\ladybug\helpDesk\PennDesign2015\Energy Loads 2D Graph.jpg")
exporthydra = Hydra_ExportFile(
    fileName=panel_2,
    fileDescription=panel_3,
    fileTags=panel,
    targetFolder="C:\Users\Administrator\Documents\GitHub\hydra_1",
    additionalImgs=panel_4,
    export=Toggle(False))  # -> readMe; inputs fileDescription: list, changeLog: list, fileTags: list, includeRhino: Boolean, GHForThumb: Boolean, additionalImgs: list, export: Boolean; plug-in component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

ladybug = Ladybug_Ladybug()  # -> Vviiiiiiiiiizzz; plug-in component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
honeybee = Honeybee_Honeybee()  # -> Vviiiiiiiiiizzz; plug-in component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
brep = Brep(<brep referenced from the Rhino model>)
number_slider = Slider(1, range=0..10)
ladybug_2 = Ladybug_Ladybug()  # -> Vviiiiiiiiiizzz; plug-in component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
honeybee_2 = Honeybee_Honeybee()  # -> Vviiiiiiiiiizzz; plug-in component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
sdivide = DivideSurface(Surface=brep, UCount=number_slider, VCount=number_slider)  # -> flatten(Points), Normals, Parameters

# ---- group: floor
floor = Brep(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)

# ----
ledge = Brep(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)

# ---- group: ceiling
ceiling = Brep([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])

# ----
walls = Brep([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])
wall_surface_with_opening = Brep(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)
item = ListItem(List=sdivide.Points, Index="0", Wrap=True)
item_2 = ListItem(List=sdivide.Points, Index="1", Wrap=True)
item_3 = ListItem(List=sdivide.Points, Index="3", Wrap=True)
glass = Brep([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])
# Geometry Preparation
panel_5 = Panel("0")
createhbsrfs = Honeybee_createHBSrfs(geometry=flatten(ledge), srfType="2")  # -> readMe, simplify(HBSurface); plug-in component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
ln = Line(StartPoint=item_2, EndPoint=item_3)
ln_2 = Line(StartPoint=item, EndPoint=item_2)
createhbsrfs_2 = Honeybee_createHBSrfs(geometry=flatten(floor), srfType="2")  # -> readMe, simplify(HBSurface); plug-in component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
createhbsrfs_3 = Honeybee_createHBSrfs(geometry=wall_surface_with_opening, srfType="0")  # -> readMe, simplify(HBSurface); plug-in component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
addhbglz = Honeybee_addHBGlz(HBObj=createhbsrfs_3.HBSurface, childSurfaces=flatten(glass))  # -> simplify(HBObjWGLZ); plug-in component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
createhbsrfs_4 = Honeybee_createHBSrfs(geometry=ceiling, srfType="3")  # -> readMe, simplify(HBSurface); plug-in component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
# Honeybee default materials will be assigned
# based on surface type
createhbsrfs_5 = Honeybee_createHBSrfs(geometry=walls, srfType=panel_5)  # -> readMe, simplify(HBSurface); plug-in component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
preview = CustomPreview(Geometry=glass, Shader=ColourSwatch(SwatchColor=RGBA(80, 222, 255, 160)))
divide = DivideCurve(Curve=ln, Count=10, Kinks=False)  # -> Points, Tangents, Parameters
edges = BrepEdges(Brep=glass)  # -> Naked, Interior, NonManifold
len = Length(Curve=ln_2)
Z = UnitZ(Factor=len)
number_slider_2 = Slider(1, range=0..10)
number_slider_3 = Slider(0.3, range=0..1)
crv = Curve(edges.Naked)
move = Move(Geometry=divide.Points, Motion=Z)  # -> Geometry, Transform
xz = XZPlane(Origin=divide.Points)
sdivide_2 = DivideSurface(Surface=glass, UCount=number_slider_2, VCount=number_slider_2)  # -> flatten(Points), Normals, Parameters
ln_3 = Line(StartPoint=divide.Points, EndPoint=move.Geometry)

# ---- group: Make all surfaces except the facade with window adiabatic
makeadiabatic = Honeybee_MakeAdiabatic(HBSrfs=flatten([createhbsrfs_5.HBSurface, createhbsrfs_4.HBSurface, createhbsrfs_2.HBSurface, createhbsrfs.HBSurface]))  # -> HBSrfs; plug-in component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

# ----
panel_6 = Panel("""2
6
10
14""")
panel_7 = Panel("""0
4
8
12""")
panel_8 = Panel("""3
7
11
15""")
panel_9 = Panel("""1
5
9
13""")
rotax = RotateAxis(Geometry=xz, Angle=degrees(Slider(30, range=0..90)), Axis=ln_3)  # -> Geometry, Transform
item_4 = ListItem(List=sdivide_2.Points, Index=panel_7, Wrap=True)
item_5 = ListItem(List=sdivide_2.Points, Index=panel_6, Wrap=True)
item_6 = ListItem(List=sdivide_2.Points, Index=panel_8, Wrap=True)
item_7 = ListItem(List=sdivide_2.Points, Index=panel_9, Wrap=True)
bldgprograms = Honeybee_bldgPrograms({"Office": 0, "Retail": 1, "MidriseApartment": 2, "PrimarySchool": 3, "SecondarySchool": 4, "SmallHotel": 5, "LargeHotel": 6, "Hospital": 7, "Outpatient": 8, "Warehouse": 9, "SuperMarket": 10, "FullServiceRestaurant": 11, "QuickServiceRestaurant": 12}, selected="MidriseApartment")
listzoneprograms = Honeybee_ListZonePrograms(bldgProgram=bldgprograms)  # -> MidriseApartmentZonePrograms; plug-in component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
glazingcreator = Honeybee_GlazingBasedOnRatio(
    HBObjects=createhbsrfs_3.HBSurface,
    glzRatio=Slider(0.5, range=0.1..1.1),
    breakUpDist=Slider(1.6, range=0..10),
    windowHeight=Slider(2.6, range=0..10),
    runIt=Toggle(True))  # -> readMe, HBObjWGLZ; plug-in component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
planesrf = PlaneSurface(Plane=rotax.Geometry, XSize=Slider(0.4, range=0.1..0.5), YSize=len)
item_8 = ListItem(List=listzoneprograms, Index=0, Wrap=True)

# ---- group: Top right
pt = Point(item_5)

# ---- group: bottom right
pt_2 = Point(item_4)

# ---- group: Top left
pt_3 = Point(item_6)

# ---- group: bottom left
pt_4 = Point(item_7)

# ---- group: collect all honeybee surfaces
brep_2 = Brep(flatten([makeadiabatic, addhbglz]))

# ----
vec = Vector(Vector(13.63396663, -31.31604271, 0))
panel_10 = Panel(item_8)
ln_4 = Line(StartPoint=pt, EndPoint=pt_3)
ln_5 = Line(StartPoint=pt_3, EndPoint=pt_4)
ln_6 = Line(StartPoint=pt, EndPoint=pt_2)
number_slider_4 = Slider(0.1, range=0.1..1.5)
len_2 = Length(Curve=ln_4)
createhbzones = Honeybee_createHBZones(name="test_room", zoneProgram=item_8, HBSurfaces=flatten(brep_2), isConditioned=True)  # -> readMe, HBZone; plug-in component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
# Convert the box to Honeybee zone
# All the material will be set to default
# In case you want to change them search
# for Honeybee_Set Radiance Materials
# component.
# Add glazing based on percentage
# In case you want to add custom windows
# use Honeybee_addHBGlz component.
mass2zone = Honeybee_Masses2Zones(zoneMasses=flatten(createhbzones.HBZone), isConditioned=True, maxRoofAngle=30, createHBZones=Toggle(True))  # -> readMe, HBZones; plug-in component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
xy = XYPlane(Origin=Point(0, 0, 0))
Z_2 = UnitZ(Factor=Slider(0.5, range=0.1..1.5))
panel_11 = Panel("http://apps1.eere.energy.gov/buildings/energyplus/weatherdata/4_north_and_central_america_wmo_region_4/1_usa/USA_PA_Philadelphia.Intl.AP.724080_TMY3.zip")
Z_3 = UnitZ(Factor=1)
Y = UnitY(Factor=len_2)
curvepoint = PointOnCurve(ln_5, parameter=0)
rev = Reverse(Vector=vec)
Z_4 = UnitZ(Factor=Slider(0, range=0..1))
angle = Angle(VectorA=ln_4, VectorB=vec, Plane=xy)  # -> Angle, Reflex
number_slider_5 = Slider(0.762, range=0..1)
number_slider_6 = Slider(0.5, range=0..1)
panel_12 = Panel("http://apps1.eere.energy.gov/buildings/energyplus/weatherdata/4_north_and_central_america_wmo_region_4/1_usa/USA_PA_Philadelphia.Intl.AP.724080_TMY3.zip")

# ---- group: HB Zone With Glazing
brep_3 = Brep(mass2zone.HBZones)

# ----
toggle = BooleanToggle(False)
vrot = Rotate(Vector=vec, Axis=Z_3, Angle=degrees("90"))
move_2 = Move(Geometry=pt_2, Motion=Z_4)  # -> Geometry, Transform
move_3 = Move(Geometry=pt_4, Motion=Z_2)  # -> Geometry, Transform
item_9 = ListItem(List=len_2, Index="0", Wrap=True)
wires = BrepWireframe(Brep=createhbzones.HBZone, Density=-1)
path = FilePath("C:\Users\kksenia\Desktop\Building Simulations\week 4\USA_PA_Philadelphia.724086_TMY2.epw")
importepw = Ladybug_ImportEpw(epwFile=path)  # -> readMe, latitude, location, dryBulbTemperature, dewPointTemperature, relativeHumidity, windSpeed, windDirection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; plug-in component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
vec_2 = Vector(Vector(-2.656571779, 2.65144778, 0))
item_10 = ListItem(List=angle.Angle, Index="0", Wrap=True)
wires_2 = BrepWireframe(Brep=brep_3, Density=-1)
open_epw_stat = Ladybug_OpenEPWAndSTATWeatherFiles(weatherFileURL=panel_12)  # -> epwFile, statFile; plug-in component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
epoutput = Honeybee_GenerateEPOutput(
    zoneEnergyUse=Toggle(True),
    zoneGainsAndLosses="False",
    zoneComfortMetrics="False",
    surfaceTempAnalysis="False",
    timestep="monthly")  # -> report, flatten(simulationOutputs); plug-in component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
open_epw_stat_2 = Ladybug_OpenEPWAndSTATWeatherFiles(weatherFileURL=panel_11)  # -> epwFile, statFile; plug-in component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
# Put the recipie together!
gentestpts = Honeybee_GenerateTestPoints(testSurface=createhbsrfs_2.HBSurface, gridSize=number_slider_6, distBaseSrf=number_slider_5, moveTestMesh=toggle)  # -> readMe, simplify(testPoints), simplify(ptsVectors), simplify(facesArea), simplify(mesh); plug-in component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
genhbzonetestpts = Honeybee_GenerateZoneTestPoints(HBZone=mass2zone.HBZones, gridSize=number_slider_6, distBaseSrf=number_slider_5, moveTestMesh=toggle)  # -> readMe, simplify(testPoints), simplify(ptsVectors), simplify(facesArea), simplify(mesh); plug-in component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
sin = Sine(Value=item_10)
multiplication = Multiplication(A=item_9, B=sin)
gencumulativeskymtx = Ladybug_GenCumulativeSkyMtx(epwFile=path, skyDensity=0, useOldRes=True, runIt=Toggle(True))  # -> readMe, cumulativeSkyMtx; plug-in component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
analysisperiod = Ladybug_AnalysisPeriod()  # -> readMe, analysisPeriod; plug-in component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
number_slider_7 = Slider(45, range=0..100)
addition = Addition(A=multiplication, B=Slider(0.5, range=0..1))
data = Data(addition)
legendpar = Ladybug_LegendParameters(highBound="800")  # -> legendPar; plug-in component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
legendpar_2 = Ladybug_LegendParameters(highBound="800", legendScale="0.01")  # -> legendPar; plug-in component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
analysisperiod_2 = Ladybug_AnalysisPeriod(fromMonth="6", fromDay="1", toMonth="9", toDay="31")  # -> readMe, analysisPeriod; plug-in component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
ln_7 = Line(StartPoint=pt_4, EndPoint=curvepoint)
panel_13 = Panel(multiplication)
# Run the analysis
panel_14 = Panel(".05")
toggle_2 = BooleanToggle(True)
selectskymtx = Ladybug_selectSkyMtx(
    cumulativeSkyMtx=gencumulativeskymtx.cumulativeSkyMtx,
    analysisPeriod=analysisperiod.analysisPeriod,
    removeDiffuse=False,
    removeDirect=False)  # -> readMe, selectedSkyMtx; plug-in component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
amp = Amplitude(Vector=vrot, Amplitude=Slider(0.1, range=0..0.1))
division = Division(A=data, B=2)
annualdaylightsimulation = Honeybee_AnnualDaylightSimulation(
    epwWeatherFile=open_epw_stat.epwFile,
    testPoints=gentestpts.testPoints,
    ptsVectors=gentestpts.ptsVectors,
    testMesh=gentestpts.mesh,
    radParameters=gentestpts.mesh)  # -> analysisRecipe; disabled; plug-in component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
len_3 = Length(Curve=ln_7)
northarrow = Ladybug_North(north=number_slider_7, scale=panel_14)  # -> northSign; plug-in component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
move_4 = Move(Geometry=pt_4, Motion=amp)  # -> Geometry, Transform
pt_5 = Point(<point referenced from the Rhino model>)
legendpar_3 = Ladybug_LegendParameters(lowBound="0", highBound="1000")  # -> legendPar; plug-in component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
toggle_3 = BooleanToggle(True)
pt_6 = Point(<point referenced from the Rhino model>)
legendpar_4 = Ladybug_LegendParameters(legendLocation=pt_5)  # -> legendPar; plug-in component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
amp_2 = Amplitude(Vector=vrot, Amplitude=data)
move_5 = Move(Geometry=curvepoint, Motion=amp_2)  # -> Geometry, Transform
srf4pt = _4PointSurface(CornerA=curvepoint, CornerB=move_3.Geometry, CornerC=move_5.Geometry)
# Run the analysis
rundaylightanalysis = Honeybee_RunDaylightSimulation(
    HBObjects=flatten(makeadiabatic),
    analysisRecipe=annualdaylightsimulation,
    writeRad=toggle_3,
    runRad=toggle_3,
    overwriteResults=True)  # -> readMe, analysisType, resultsUnit, results, testPts, resultFiles, radGeoFile, studyFolder, done; plug-in component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
sunpath = Ladybug_SunPath(
    north=vec_2,
    location=importepw.location,
    hour=12,
    day=21,
    month=12,
    timeStep=1,
    analysisPeriod=analysisperiod_2.analysisPeriod,
    centerPt=pt_6,
    sunPathScale="0.5",
    annualHourlyData=flatten(importepw.globalHorizontalRadiation),
    legendPar=legendpar,
    dailyOrAnnualSunPath=True)  # -> readMe, sunVectors, sunAltitudes, sunAzimuths, port, sunSpheresMesh, sunPathCrvs, legend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; disabled; plug-in component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
sunpath_2 = Ladybug_SunPath(
    north=vec_2,
    location=importepw.location,
    hour=12,
    day=21,
    month=12,
    timeStep=1,
    analysisPeriod=analysisperiod_2.analysisPeriod,
    centerPt=pt_6,
    sunPathScale="0.5",
    annualHourlyData=flatten(importepw.globalHorizontalRadiation),
    conditionalStatement="a>900",
    legendPar=legendpar_2,
    dailyOrAnnualSunPath=True)  # -> readMe, sunVectors, sunAltitudes, sunAzimuths, port, sunSpheresMesh, sunPathCrvs, legend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; plug-in component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
X = UnitX(Factor=1)
radiationrose = Ladybug_RadiationRose(
    north=vec_2,
    selectedSkyMtx=selectskymtx.selectedSkyMtx,
    centerPoint=pt_6,
    scale="0.25",
    arrowHeadScale=1,
    legendPar=legendpar_3,
    runIt=Toggle(True))  # -> readMe, radiationArrowsMesh, radRoseBaseCrvs, legend, legendBasePts, radRoseEndPts, radRoseValues; plug-in component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
occupancygenerator = Honeybee_DaysimOccupancyGenerator(weekendDays=[1, 2], writeTheOcc=Toggle(True))  # -> occupancyFile; plug-in component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
move_6 = Move(Geometry=curvepoint, Motion=Y)  # -> Geometry, Transform
move_7 = Move(Geometry=move_6.Geometry, Motion=X)  # -> Geometry, Transform
sort = SortList(Keys=radiationrose.radRoseValues)  # -> Keys, ValuesA
rev_2 = ReverseList(List=sort.Keys)
ln_8 = Line(StartPoint=sunpath_2.sunPositions, EndPoint=sunpath_2.sunPathCenPts)
pt_7 = Point(radiationrose.radRoseEndPts)
# Generate annual results
readannualresultsi = Honeybee_ReadAnnualResultI(
    illFilesAddress=rundaylightanalysis.resultFiles,
    testPoints=simplify(rundaylightanalysis.testPts),
    occupancyFiles=occupancygenerator,
    DLAIllumThresholds=300,
    runIt=Toggle(True))  # -> DLA, UDLI_Less_100, UDLI_100_2000, UDLI_More_2000, CDA, sDA, annualProfiles, htmReport; plug-in component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
preview_2 = CustomPreview(Geometry=ln_8, Shader=ColourSwatch(SwatchColor=RGB(255, 0, 0)))
ln_9 = Line(StartPoint=curvepoint, EndPoint=move_6.Geometry)
project = Project(Geometry=ln_8, Plane=PlaneXY(0, 0, 0))  # -> Geometry, Transform
item_11 = ListItem(List=rev_2, Index="0", Wrap=True)
angle_2 = Angle(VectorA=ln_8, VectorB=project.Geometry)  # -> Angle, Reflex
deg = Degrees(Radians=angle_2.Angle)
index = ItemIndex(List=radiationrose.radRoseValues, Item=item_11)
curvepoint_2 = PointOnCurve(ln_9, parameter=0.5)
panel_15 = Panel(item_11)
xz_2 = XZPlane(Origin=curvepoint_2)
ma = MassAddition(Input=deg)  # -> Result, PartialResults
mirror = Mirror(Geometry=srf4pt, Plane=xz_2)  # -> Geometry, Transform
lng = ListLength(List=deg)
item_12 = ListItem(List=pt_7, Index=index, Wrap=True)
gradientlibrary = Ladybug_GradientLibrary(gradIndex=Slider(1, range=0..10))  # -> customColors; plug-in component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
division_2 = Division(A=ma.Result, B=lng)
panel_16 = Panel(division_2)
legendpar_5 = Ladybug_LegendParameters(
    lowBound=Slider(0, range=0..100),
    highBound=Slider(100, range=0..100),
    numSegments=Slider(6, range=0..10),
    customColors=flatten(gradientlibrary))  # -> legendPar; plug-in component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
subtraction = Subtraction(A=90, B="63")
rad = Radians(Degrees=subtraction)
tan = Tangent(Value=rad)
multiplication_2 = Multiplication(A=len_3, B=tan)
item_13 = ListItem(List=multiplication_2, Index="0", Wrap=True)
X_2 = UnitX(Factor=item_13)
move_8 = Move(Geometry=move_6.Geometry, Motion=X_2)  # -> Geometry, Transform
srf4pt_2 = _4PointSurface(CornerA=curvepoint, CornerB=move_5.Geometry, CornerC=move_8.Geometry, CornerD=move_6.Geometry)
srf4pt_3 = _4PointSurface(CornerA=move_6.Geometry, CornerB=move_2.Geometry, CornerC=move_8.Geometry)
brep_4 = Brep([srf4pt, srf4pt_2, srf4pt_3])

brep_5 = Brep(brep_4)
preview_3 = CustomPreview(Geometry=brep_5, Shader=ColourSwatch(SwatchColor=RGB(255, 0, 234)))
hb_epcontextsrf = HoneybeeEPContextSurfaces(shdSurfaces=flatten(brep_5))  # -> HBContext; inputs shdSurfaces: list of GeometryBase, justBoundingBox: Boolean
# ---------- hb_epcontextsrf: Python ----------
"""
prepare shading/context geometries

    Args:
        northVectorOrRotation: A vector that shows North or a number that shows
                               the rotation of the North from the Y axis
        bldgMasses: List of closed Breps as thermal zones.
    Returns:
        report: ...
        thermalZones: Thermal zone's geometries for visualiza
"""

ghenv.Component.Name = 'Honeybee EP context Surfaces'
ghenv.Component.NickName = 'HB_EPContextSrf'
ghenv.Component.Message = 'VER 0.0.57\nJUL_06_2015'
ghenv.Component.Category = "Honeybee"
ghenv.Component.SubCategory = "09 | Energy | Energy"
#compatibleHBVersion = VER 0.0.56\nFEB_01_2015
#compatibleLBVersion = VER 0.0.59\nFEB_01_2015
ghenv.Component.AdditionalHelpFromDocStrings = "2"

import rhinoscriptsyntax as rs
import Rhino as rc
import scriptcontext as sc
import os
import System
import Grasshopper.Kernel as gh
import uuid

tolerance = sc.doc.ModelAbsoluteTolerance
import math


def main(shdSurfaces, EPTransSchedule, meshingSettings, justBoundingBox):
    
    # import the classes
    if sc.sticky.has_key('honeybee_release'):

        try:
            if not sc.sticky['honeybee_release'].isCompatible(ghenv.Component): return -1
        except:
            warning = "You need a newer version of Honeybee to use this compoent." + \
            " Use updateHoneybee component to update userObjects.\n" + \
            "If you have already updated userObjects drag Honeybee_Honeybee component " + \
            "into canvas and try again."
            w = gh.GH_RuntimeMessageLevel.Warning
            ghenv.Component.AddRuntimeMessage(w, warning)
            return -1
        
        # don't customize this part
        hb_EPSrf = sc.sticky["honeybee_EPSurface"]
        hb_EPSHDSurface = sc.sticky["honeybee_EPShdSurface"]
        hb_RADMaterialAUX = sc.sticky["honeybee_RADMaterialAUX"]()
        hb_EPObjectsAux = sc.sticky["honeybee_EPObjectsAUX"]()
        HBScheduleList = sc.sticky["honeybee_ScheduleLib"].keys()

        ########################################################################
        #----------------------------------------------------------------------#
        shdBreps = []
        # create bounding box of shading geometries
        if justBoundingBox:
            for brep in shdSurfaces:
                if brep.Faces.Count>1 or not brep.Faces[0].IsPlanar(sc.doc.ModelAbsoluteTolerance):
                    shdBreps.append(brep.GetBoundingBox(True).ToBrep())
                else:
                    shdBreps.append(brep)
        else: shdBreps = shdSurfaces
        
        shadingClasses = []
        shadingMeshPreview = []
        
        if meshingSettings == None:
            mp = rc.Geometry.MeshingParameters.Minimal
            mp.SimplePlanes = True
        else:
            mp = meshingSettings
        
        def getRadMaterialName(radMaterial):
            nameStr = radMaterial.split(" ")[2]
            name =  nameStr.split("\n")[0]
            return name
        
        for brepCount, brep in enumerate(shdBreps):
            if brep != None:
                #if len(brep.DuplicateEdgeCurves(False))>1:
                
                meshArray = rc.Geometry.Mesh.CreateFromBrep(brep, mp)
                for mesh in meshArray:
                    for meshFace in range(mesh.Faces.Count):
                        vertices = list(mesh.Faces.GetFaceVertices(meshFace))[1:]
                        vertices = vertices + [sc.doc.ModelAbsoluteTolerance]
                        # create the brep from mesh
                        shdBrep = rc.Geometry.Brep.CreateFromCornerPoints(*vertices)
                        
                        thisShading = hb_EPSHDSurface(shdBrep, 1000*brepCount + meshFace, 'shdSrf_' + `brepCount` + '_' + `meshFace` + "_" + str(uuid.uuid4()))
                        
                        # add transmittance schedule if any
                        if EPTransSchedule!=None:
                            schedule= EPTransSchedule.upper()
                            if schedule!=None and not schedule.lower().endswith(".csv") and schedule not in HBScheduleList:
                                msg = "Cannot find " + schedule + " in Honeybee schedule library."
                                print msg
                                ghenv.Component.AddRuntimeMessage(gh.GH_RuntimeMessageLevel.Warning, msg)
                                return -1
                            elif schedule!=None and schedule.lower().endswith(".csv"):
                                # check if csv file is existed
                                if not os.path.isfile(schedule):
                                    msg = "Cannot find the shchedule file: " + schedule
                                    print msg
                                    ghenv.Component.AddRuntimeMessage(gh.GH_RuntimeMessageLevel.Warning, msg)
                                    return -1
                            
                            thisShading.TransmittanceSCH = schedule
                        
                        # add the Rad Material if any
                        if RADMaterial!=None:
                            # if it is just the name of the material make sure it is already defined
                            if len(RADMaterial.split(" ")) == 1:
                                # if the material is not in the library add it to the library
                                if RADMaterial not in sc.sticky ["honeybee_RADMaterialLib"].keys():
                                    warningMsg = "Can't find " + RADMaterial + " in RAD Material Library.\n" + \
                                                "Add the material to the library and try again."
                                    ghenv.Component.AddRuntimeMessage(gh.GH_RuntimeMessageLevel.Warning, warningMsg)
                                    return
                                
                                try:
                                    thisShading.setRADMaterial(RADMaterial)
                                except Exception, e:
                                    print e
                                    warningMsg = "You are using an old version of Honeybee_Honeybee! Update your files and try again."
                                    print warningMsg
                                    ghenv.Component.AddRuntimeMessage(gh.GH_RuntimeMessageLevel.Warning, warningMsg)
                                    return
                                
                                addedToLib = True
                            else:
                                
                                # try to add the material to the library
                                addedToLib, thisShading.RadMaterial = hb_RADMaterialAUX.analyseRadMaterials(RADMaterial, True)
                                
                            if addedToLib==False:
                                warningMsg = "Failed to add " + RADMaterial + " to the Library."
                                ghenv.Component.AddRuntimeMessage(gh.GH_RuntimeMessageLevel.Warning, warningMsg)
                                return
                        
                        # add shading to the list
                        shadingClasses.append(thisShading)
                
        # add to the hive
        hb_hive = sc.sticky["honeybee_Hive"]()
        HBContext  = hb_hive.addToHoneybeeHive(shadingClasses, ghenv.Component.InstanceGuid.ToString())
        return HBContext
        ################################################################################################
    else:
        print "You should first let Honeybee to fly..."
        w = gh.GH_RuntimeMessageLevel.Warning
        ghenv.Component.AddRuntimeMessage(w, "You should first let Honeybee to fly...")
        return -1
        

if _shdSurfaces and _shdSurfaces[0]!=None:
    # add cleaning function
    result= main(_shdSurfaces, EPTransSchedule_, meshingSettings_, justBoundingBox_)
    
    if result != -1: HBContext = result
# ---------- end hb_epcontextsrf ----------

runenergysimulation = Honeybee_RunEnergySimulation(
    north=number_slider_7,
    epwFile=open_epw_stat_2.epwFile,
    HBZones=flatten(createhbzones.HBZone),
    HBContext=flatten(hb_epcontextsrf),
    simulationOutputs=flatten(epoutput.simulationOutputs),
    writeIdf=toggle_2,
    runEnergyPlus=toggle_2)  # -> report, idfFileAddress, resultFileAddress; plug-in component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
radiationanalysis = Ladybug_RadiationAnalysis(
    north=vec_2,
    geometry=flatten(glass),
    context=flatten(brep_5),
    gridSize="0.05",
    disFromBase="0.01",
    selectedSkyMtx=flatten(selectskymtx.selectedSkyMtx),
    legendPar=flatten(legendpar_4),
    runIt=Toggle(True))  # -> readMe, contextMesh, analysisMesh, testPts, testVec, port, radiationResult, radiationMesh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; plug-in component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
panel_17 = Panel(radiationanalysis.totalRadiation)
mirror_2 = Mirror(Geometry=srf4pt_2, Plane=xz_2)  # -> Geometry, Transform
readepresult = Honeybee_ReadEPResult(resultFileAddress=runenergysimulation.resultFileAddress)  # -> totalThermalEnergy, thermalEnergyBalance, cooling, heating, electricLight, electricEquip, port, port_2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; plug-in component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

# ---- group: make it 3D!
dom = ConstructDomain(DomainStart=0, DomainEnd=Slider(1, range=0..1))

# ----
separatedata = Ladybug_SeparateData(inputList=flatten(readepresult.cooling))  # -> numbers, strings; plug-in component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
separatedata_2 = Ladybug_SeparateData(inputList=flatten(readepresult.heating))  # -> numbers, strings; plug-in component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
# Visualize the results
recolormesh = Ladybug_ReColorMesh(
    analysisResult=readannualresultsi.DLA,
    inputMesh=genhbzonetestpts.mesh,
    heightDomain=dom,
    legendPar=legendpar_5,
    analysisTitle=rundaylightanalysis.analysisType,
    legendTitle="%")  # -> readMe, newMesh, newLegend, legendBasePt, meshColors, legendColors; plug-in component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
legendpar_6 = Ladybug_LegendParameters()  # -> legendPar; plug-in component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
ma_2 = MassAddition(Input=separatedata.numbers)  # -> Result, PartialResults
ma_3 = MassAddition(Input=separatedata_2.numbers)  # -> Result, PartialResults
barchart = Ladybug_MonthlyBarChart(
    inputData=flatten([readepresult.cooling, readepresult.heating]),
    altYAxisTitle="Cooling and Heating Loads",
    basePoint="20, 0, 0",
    xScale=Slider(0.5, range=0..1),
    yScale=Slider(0.7, range=0..1),
    legendPar=legendpar_6)  # -> dataMesh, dataCurves, dataCrvColors, graphAxes, graphLabels, title, titleBasePt, legend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; plug-in component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
total_cooling = Panel(ma_2.Result)
total_heating = Panel(ma_3.Result)
ma_4 = MassAddition(Input=[total_cooling, total_heating])  # -> Result, PartialResults
tag = TextTag(Location=barchart.dataLabelPts, Text=[separatedata.numbers, separatedata_2.numbers])
