# Grasshopper definition Knyazkina_Ksenia_comfort_hours.gh (Grasshopper 0.9.76)
# plug-ins: Python Interpreter

panel = Panel("""Honeybee
Energy
Daylighting
EnergyPlus
Daysim
Radiance""")
ladybug = Ladybug_Ladybug()  # -> Vviiiiiiiiiizzz; plug-in component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
honeybee = Honeybee_Honeybee()  # -> Vviiiiiiiiiizzz; plug-in component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
epopaquemat = Honeybee_EnergyPlusOpaqueMaterial()  # -> EPMaterial; plug-in component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
panel_2 = Panel("This is an example that shows how to integrate results of daylighting simulation with an energy simulation")
callfromepconstrlibrary = Honeybee_CallFromEPConstructionLibrary(keywords="wall 4a")  # -> EPMaterials, EPWindowMaterils, EPConstructions; plug-in component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

# ---- group: floor
floor = Brep(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)

# ----
ledge = Brep(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)

# ---- group: ceiling
ceiling = Brep([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])

# ----
walls = Brep([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])
wall_surface_with_opening = Brep(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)
exporthydra = Hydra_ExportFile(
    fileName="Integrated_Daylight_and_Energy_similation",
    fileDescription=panel_2,
    fileTags=panel,
    targetFolder="C:\Users\Administrator\Documents\GitHub\hydra_1",
    export=Toggle(False))  # -> readMe; inputs fileDescription: list, changeLog: list, fileTags: list, includeRhino: Boolean, GHForThumb: Boolean, additionalImgs: list, export: Boolean; plug-in component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
panel_3 = Panel("""1
2
3
4""")
item = ListItem(List=callfromepconstrlibrary.EPConstructions, Index=0, Wrap=True)
# Geometry Preparation
panel_4 = Panel("0")
createhbsrfs = Honeybee_createHBSrfs(geometry=flatten([floor, ledge]), srfType="2")  # -> readMe, simplify(HBSurface); plug-in component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
createhbsrfs_2 = Honeybee_createHBSrfs(geometry=ceiling, srfType="3")  # -> readMe, simplify(HBSurface); plug-in component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
createhbsrfs_3 = Honeybee_createHBSrfs(geometry=wall_surface_with_opening, srfType="0", EPConstruction=item)  # -> readMe, simplify(HBSurface); plug-in component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
glazingcreator = Honeybee_GlazingBasedOnRatio(
    HBObjects=createhbsrfs_3.HBSurface,
    glzRatio=Slider(0.6, range=0.1..1.1),
    breakUpDist=Slider(1.4, range=1.2..2.3),
    sillHeight="0.1",
    runIt=Toggle(True))  # -> readMe, HBObjWGLZ; plug-in component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
debrep = DeconstructBrep(Brep=glazingcreator.HBObjWGLZ)  # -> Faces, Edges, Vertices
srf = Surface(debrep.Faces)
item_2 = ListItem(List=srf, Index=panel_3, Wrap=True)
# Honeybee default materials will be assigned
# based on surface type
createhbsrfs_4 = Honeybee_createHBSrfs(geometry=walls, srfType=panel_4, EPConstruction=item)  # -> readMe, simplify(HBSurface); plug-in component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
brep = Brep(item_2)
preview = CustomPreview(Geometry=brep, Shader=ColourSwatch(SwatchColor=RGBA(80, 222, 255, 160)))
epwindowmat = Honeybee_EnergyPlusWindowMaterial(name="tripple", U_Value="0.3", SHGC="0.2", VT="0.5")  # -> EPMaterial; plug-in component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
epwindowmat_2 = Honeybee_EnergyPlusWindowMaterial(name="sing", U_Value="1", SHGC="0.6", VT="0.66")  # -> EPMaterial; plug-in component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
epwindowmat_3 = Honeybee_EnergyPlusWindowMaterial(name="double", U_Value="0.6", SHGC="0.53", VT="0.29")  # -> EPMaterial; plug-in component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
glass = Brep(brep)
glass_2 = Brep(glass)
epconstruction = Honeybee_EnergyPlusConstruction(layer_1=epwindowmat)  # -> EPConstruction; plug-in component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

# ---- group: Make all surfaces except the facade with window adiabatic
makeadiabatic = Honeybee_MakeAdiabatic(HBSrfs=flatten([createhbsrfs_4.HBSurface, createhbsrfs_2.HBSurface, createhbsrfs.HBSurface]))  # -> HBSrfs; plug-in component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

# ----
preview_2 = CustomPreview(Geometry=glass, Shader=ColourSwatch(SwatchColor=RGBA(80, 222, 255, 160)))
edges = BrepEdges(Brep=glass)  # -> Naked, Interior, NonManifold
addhbglz = Honeybee_addHBGlz(HBObj=createhbsrfs_3.HBSurface, childSurfaces=flatten(glass_2), EPConstructions=epconstruction)  # -> simplify(HBObjWGLZ); plug-in component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
bldgprograms = Honeybee_bldgPrograms({"Office": 0, "Retail": 1, "MidriseApartment": 2, "PrimarySchool": 3, "SecondarySchool": 4, "SmallHotel": 5, "LargeHotel": 6, "Hospital": 7, "Outpatient": 8, "Warehouse": 9, "SuperMarket": 10, "FullServiceRestaurant": 11, "QuickServiceRestaurant": 12}, selected="MidriseApartment")
listzoneprograms = Honeybee_ListZonePrograms(bldgProgram=bldgprograms)  # -> MidriseApartmentZonePrograms; plug-in component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
number_slider = Slider(1, range=0..10)
crv = Curve(edges.Naked)
area = Area(Geometry=glass)  # -> Area, Centroid
epopaquemat_2 = Honeybee_EnergyPlusOpaqueMaterial(thickness="0.9", conductivity="0.6", density="2000", specificHeat="867")  # -> EPMaterial; plug-in component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
item_3 = ListItem(List=listzoneprograms, Index=0, Wrap=True)
epconstruction_2 = Honeybee_EnergyPlusConstruction(layer_1=epopaquemat_2)  # -> EPConstruction; plug-in component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
ma = MassAddition(Input=area.Area)  # -> Result, PartialResults
sdivide = DivideSurface(Surface=glass, UCount=number_slider, VCount=number_slider)  # -> flatten(Points), Normals, Parameters
panel_5 = Panel(area.Area)
panel_6 = Panel(item_3)  # disabled
panel_7 = Panel("""2
6
10
14""")
panel_8 = Panel("""0
4
8
12""")
panel_9 = Panel("""3
7
11
15""")
panel_10 = Panel("""1
5
9
13""")
item_4 = ListItem(List=sdivide.Points, Index=panel_8, Wrap=True)
item_5 = ListItem(List=sdivide.Points, Index=panel_7, Wrap=True)
item_6 = ListItem(List=sdivide.Points, Index=panel_9, Wrap=True)
item_7 = ListItem(List=sdivide.Points, Index=panel_10, Wrap=True)

# ---- group: collect all honeybee surfaces
brep_2 = Brep(flatten([makeadiabatic, addhbglz]))

# ---- group: Top right
pt = Point(item_5)

# ---- group: bottom right
pt_2 = Point(item_4)

# ---- group: Top left
pt_3 = Point(item_6)

# ---- group: bottom left
pt_4 = Point(item_7)

# ----
path = FilePath("C:\Users\kksenia\Desktop\Building Simulations\week 4\USA_PA_Philadelphia.724086_TMY2.epw")
importepw = Ladybug_ImportEpw(epwFile=path)  # -> readMe, latitude, location, dryBulbTemperature, dewPointTemperature, relativeHumidity, windSpeed, windDirection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; plug-in component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
vec = Vector(Vector(-2.656571779, 2.65144778, 0))
vec_2 = Vector(Vector(13.63396663, -31.31604271, 0))
ln = Line(StartPoint=pt, EndPoint=pt_3)
ln_2 = Line(StartPoint=pt_3, EndPoint=pt_4)
ln_3 = Line(StartPoint=pt, EndPoint=pt_2)
item_8 = ListItem(List=ln_3, Index=1, Wrap=True)
len = Length(Curve=item_8)
multiplication = Multiplication(A=len, B="-1")
number_slider_2 = Slider(0.1, range=0.1..1.5)
gencumulativeskymtx = Ladybug_GenCumulativeSkyMtx(epwFile=path, skyDensity=0, useOldRes=True, runIt=Toggle(True))  # -> readMe, cumulativeSkyMtx; plug-in component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
analysisperiod = Ladybug_AnalysisPeriod()  # -> readMe, analysisPeriod; plug-in component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
len_2 = Length(Curve=ln)
number_slider_3 = Slider(6, range=1..10)
division = Division(A=multiplication, B=number_slider_3)
Z = UnitZ(Factor=division)
xy = XYPlane(Origin=Point(0, 0, 0))
crv_2 = Curve(ln)
Z_2 = UnitZ(Factor=Slider(0.5, range=0.1..1.5))
Z_3 = UnitZ(Factor=1)
Y = UnitY(Factor=len_2)
curvepoint = PointOnCurve(ln_2, parameter=0)
rev = Reverse(Vector=vec_2)
legendpar = Ladybug_LegendParameters(highBound="800")  # -> legendPar; plug-in component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
legendpar_2 = Ladybug_LegendParameters(highBound="800", legendScale="0.01")  # -> legendPar; plug-in component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
Z_4 = UnitZ(Factor=Slider(0, range=0..1))
analysisperiod_2 = Ladybug_AnalysisPeriod(fromMonth="6", fromDay="1", toMonth="9", toDay="31")  # -> readMe, analysisPeriod; plug-in component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
createhbzones = Honeybee_createHBZones(name="test_room", zoneProgram=item_3, HBSurfaces=flatten(brep_2), isConditioned=Toggle(False))  # -> readMe, HBZone; plug-in component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
wires = BrepWireframe(Brep=createhbzones.HBZone, Density=-1)
angle = Angle(VectorA=ln, VectorB=vec_2, Plane=xy)  # -> Angle, Reflex
selectskymtx = Ladybug_selectSkyMtx(
    cumulativeSkyMtx=gencumulativeskymtx.cumulativeSkyMtx,
    analysisPeriod=analysisperiod.analysisPeriod,
    removeDiffuse=False,
    removeDirect=False)  # -> readMe, selectedSkyMtx; plug-in component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
vrot = Rotate(Vector=vec_2, Axis=Z_3, Angle=degrees("90"))
move = Move(Geometry=pt_2, Motion=Z_4)  # -> Geometry, Transform
move_2 = Move(Geometry=pt_4, Motion=Z_2)  # -> Geometry, Transform
item_9 = ListItem(List=len_2, Index="0", Wrap=True)
arrlinear = LinearArray(Geometry=crv_2, Direction=Z, Count=number_slider_3)  # -> Geometry, Transform
item_10 = ListItem(List=angle.Angle, Index="0", Wrap=True)
X = UnitX(Factor=Slider(0.2, range=0.1..1.1))
pt_5 = Point(<point referenced from the Rhino model>)
Y_2 = UnitY(Factor=1)
sin = Sine(Value=item_10)
legendpar_3 = Ladybug_LegendParameters(lowBound="0", highBound="1000")  # -> legendPar; plug-in component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

number_slider_4 = Slider(45, range=0..100)
panel_11 = Panel("http://apps1.eere.energy.gov/buildings/energyplus/weatherdata/4_north_and_central_america_wmo_region_4/1_usa/USA_PA_Philadelphia.Intl.AP.724080_TMY3.zip")
open_epw_stat = Ladybug_OpenEPWAndSTATWeatherFiles(weatherFileURL=panel_11)  # -> epwFile, statFile; plug-in component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
northarrow = Ladybug_North(north=number_slider_4, scale=".05")  # -> northSign; plug-in component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

multiplication_2 = Multiplication(A=item_9, B=sin)
vrot_2 = Rotate(Vector=X, Axis=Y_2, Angle=degrees(Slider(36, range=0..360)))
vrot_3 = Rotate(Vector=X, Axis=Y_2, Angle=degrees(Slider(0, range=0..360)))
addition = Addition(A=multiplication_2, B=Slider(0.5, range=0..1))
data = Data(addition)
extr = Extrude(Base=arrlinear.Geometry, Direction=vrot_2)
sunpath = Ladybug_SunPath(
    north=vec,
    location=importepw.location,
    hour=12,
    day=21,
    month=12,
    timeStep=1,
    analysisPeriod=analysisperiod_2.analysisPeriod,
    centerPt=pt_5,
    sunPathScale="0.5",
    annualHourlyData=flatten(importepw.globalHorizontalRadiation),
    conditionalStatement="a>900",
    legendPar=legendpar_2,
    dailyOrAnnualSunPath=True)  # -> readMe, sunVectors, sunAltitudes, sunAzimuths, port, sunSpheresMesh, sunPathCrvs, legend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; plug-in component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
sunpath_2 = Ladybug_SunPath(
    north=vec,
    location=importepw.location,
    hour=12,
    day=21,
    month=12,
    timeStep=1,
    analysisPeriod=analysisperiod_2.analysisPeriod,
    centerPt=pt_5,
    sunPathScale="0.5",
    annualHourlyData=flatten(importepw.globalHorizontalRadiation),
    legendPar=legendpar,
    dailyOrAnnualSunPath=True)  # -> readMe, sunVectors, sunAltitudes, sunAzimuths, port, sunSpheresMesh, sunPathCrvs, legend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; disabled; plug-in component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
extr_2 = Extrude(Base=arrlinear.Geometry, Direction=vrot_3)
ln_4 = Line(StartPoint=pt_4, EndPoint=curvepoint)
panel_12 = Panel(multiplication_2)
radiationrose = Ladybug_RadiationRose(
    north=vec,
    selectedSkyMtx=selectskymtx.selectedSkyMtx,
    centerPoint=pt_5,
    scale="0.25",
    arrowHeadScale=1,
    legendPar=legendpar_3,
    runIt=Toggle(True))  # -> readMe, radiationArrowsMesh, radRoseBaseCrvs, legend, legendBasePts, radRoseEndPts, radRoseValues; plug-in component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
amp = Amplitude(Vector=vrot, Amplitude=Slider(0.1, range=0..0.1))
division_2 = Division(A=data, B=2)
len_3 = Length(Curve=ln_4)
radopaquematerial = Honeybee_RadianceOpaqueMaterial(materialName="generic_35", RReflectance=".9", GReflectance=".9", BReflectance=".9", roughness=0.05, specularity=0)  # -> avrgRef, RADMaterial; plug-in component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
move_3 = Move(Geometry=pt_4, Motion=amp)  # -> Geometry, Transform
sort = SortList(Keys=radiationrose.radRoseValues)  # -> Keys, ValuesA

# ---- group: Summer
horizontal = Brep(extr)

# ---- group: Winter
horizontal_2 = Brep(extr_2)

# ----
rev_2 = ReverseList(List=sort.Keys)
tag = TextTag3D(Location=sunpath.sunPositions, Text=sunpath.selHourlyData, Size=1, Justification=7)
pt_6 = Point(radiationrose.radRoseEndPts)
solveadjc = Honeybee_SolveAdjacencies(HBZones=flatten(createhbzones.HBZone), removeCurrentAdjc=False, findAdjc=Toggle(True))  # -> readMe, HBZonesWADJ; plug-in component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
amp_2 = Amplitude(Vector=vrot, Amplitude=data)
move_4 = Move(Geometry=curvepoint, Motion=amp_2)  # -> Geometry, Transform
srf4pt = _4PointSurface(CornerA=curvepoint, CornerB=move_2.Geometry, CornerC=move_4.Geometry)
item_11 = ListItem(List=rev_2, Index="0", Wrap=True)
X_2 = UnitX(Factor=1)

# ---- group: Winter
hb_epcontextsrf = HoneybeeEPContextSurfaces(shdSurfaces=flatten(horizontal_2), RADMaterial=radopaquematerial.RADMaterial)  # -> HBContext; inputs shdSurfaces: list of GeometryBase, justBoundingBox: Boolean
# ---------- hb_epcontextsrf: Python ----------
"""
prepare shading/context geometries

    Args:
        northVectorOrRotation: A vector that shows North or a number that shows
                               the rotation of the North from the Y axis
        bldgMasses: List of closed Breps as thermal zones.
    Returns:
        report: ...
        thermalZones: Thermal zone's geometries for visualiza
"""

ghenv.Component.Name = 'Honeybee EP context Surfaces'
ghenv.Component.NickName = 'HB_EPContextSrf'
ghenv.Component.Message = 'VER 0.0.58\nNOV_05_2015'
ghenv.Component.Category = "Honeybee"
ghenv.Component.SubCategory = "09 | Energy | Energy"
#compatibleHBVersion = VER 0.0.57\nNOV_01_2015
#compatibleLBVersion = VER 0.0.59\nFEB_01_2015
ghenv.Component.AdditionalHelpFromDocStrings = "2"

import rhinoscriptsyntax as rs
import Rhino as rc
import scriptcontext as sc
import os
import System
import Grasshopper.Kernel as gh
import uuid

tolerance = sc.doc.ModelAbsoluteTolerance
import math


def main(shdSurfaces, EPTransSchedule, meshingSettings, justBoundingBox):
    
    # import the classes
    if sc.sticky.has_key('honeybee_release'):

        try:
            if not sc.sticky['honeybee_release'].isCompatible(ghenv.Component): return -1
        except:
            warning = "You need a newer version of Honeybee to use this compoent." + \
            " Use updateHoneybee component to update userObjects.\n" + \
            "If you have already updated userObjects drag Honeybee_Honeybee component " + \
            "into canvas and try again."
            w = gh.GH_RuntimeMessageLevel.Warning
            ghenv.Component.AddRuntimeMessage(w, warning)
            return -1
        
        # don't customize this part
        hb_EPSrf = sc.sticky["honeybee_EPSurface"]
        hb_EPSHDSurface = sc.sticky["honeybee_EPShdSurface"]
        hb_RADMaterialAUX = sc.sticky["honeybee_RADMaterialAUX"]
        hb_EPObjectsAux = sc.sticky["honeybee_EPObjectsAUX"]()
        HBScheduleList = sc.sticky["honeybee_ScheduleLib"].keys()

        ########################################################################
        #----------------------------------------------------------------------#
        shdBreps = []
        # create bounding box of shading geometries
        if justBoundingBox:
            for brep in shdSurfaces:
                if brep.Faces.Count>1 or not brep.Faces[0].IsPlanar(sc.doc.ModelAbsoluteTolerance):
                    shdBreps.append(brep.GetBoundingBox(True).ToBrep())
                else:
                    shdBreps.append(brep)
        else: shdBreps = shdSurfaces
        
        shadingClasses = []
        shadingMeshPreview = []
        
        if meshingSettings == None:
            mp = rc.Geometry.MeshingParameters.Minimal
            mp.SimplePlanes = True
        else:
            mp = meshingSettings
        
        def getRadMaterialName(radMaterial):
            nameStr = radMaterial.split(" ")[2]
            name =  nameStr.split("\n")[0]
            return name
        
        for brepCount, brep in enumerate(shdBreps):
            if brep != None:
                #if len(brep.DuplicateEdgeCurves(False))>1:
                
                meshArray = rc.Geometry.Mesh.CreateFromBrep(brep, mp)
                for mesh in meshArray:
                    for meshFace in range(mesh.Faces.Count):
                        vertices = list(mesh.Faces.GetFaceVertices(meshFace))[1:]
                        vertices = vertices + [sc.doc.ModelAbsoluteTolerance]
                        # create the brep from mesh
                        shdBrep = rc.Geometry.Brep.CreateFromCornerPoints(*vertices)
                        
                        thisShading = hb_EPSHDSurface(shdBrep, 1000*brepCount + meshFace, 'shdSrf_' + `brepCount` + '_' + `meshFace` + "_" + str(uuid.uuid4()))
                        
                        # add transmittance schedule if any
                        if EPTransSchedule!=None:
                            schedule= EPTransSchedule.upper()
                            if schedule!=None and not schedule.lower().endswith(".csv") and schedule not in HBScheduleList:
                                msg = "Cannot find " + schedule + " in Honeybee schedule library."
                                print msg
                                ghenv.Component.AddRuntimeMessage(gh.GH_RuntimeMessageLevel.Warning, msg)
                                return -1
                            elif schedule!=None and schedule.lower().endswith(".csv"):
                                # check if csv file is existed
                                if not os.path.isfile(schedule):
                                    msg = "Cannot find the shchedule file: " + schedule
                                    print msg
                                    ghenv.Component.AddRuntimeMessage(gh.GH_RuntimeMessageLevel.Warning, msg)
                                    return -1
                            
                            thisShading.TransmittanceSCH = schedule
                        
                        # add the Rad Material if any
                        if RADMaterial!=None:
                            # if it is just the name of the material make sure it is already defined
                            if len(RADMaterial.split(" ")) == 1:
                                # if the material is not in the library add it to the library
                                if not hb_RADMaterialAUX.isMatrialExistInLibrary(RADMaterial):
                                    warningMsg = "Can't find " + RADMaterial + " in RAD Material Library.\n" + \
                                                "Add the material to the library and try again."
                                    ghenv.Component.AddRuntimeMessage(gh.GH_RuntimeMessageLevel.Warning, warningMsg)
                                    return
                                
                                try:
                                    thisShading.setRADMaterial(RADMaterial)
                                except Exception, e:
                                    print e
                                    warningMsg = "You are using an old version of Honeybee_Honeybee! Update your files and try again."
                                    print warningMsg
                                    ghenv.Component.AddRuntimeMessage(gh.GH_RuntimeMessageLevel.Warning, warningMsg)
                                    return
                                
                                addedToLib = True
                            else:
                                
                                # try to add the material to the library
                                addedToLib, thisShading.RadMaterial = hb_RADMaterialAUX.analyseRadMaterials(RADMaterial, True)
                                
                            if addedToLib==False:
                                warningMsg = "Failed to add " + RADMaterial + " to the Library."
                                ghenv.Component.AddRuntimeMessage(gh.GH_RuntimeMessageLevel.Warning, warningMsg)
                                return
                        
                        # add shading to the list
                        shadingClasses.append(thisShading)
                
        # add to the hive
        hb_hive = sc.sticky["honeybee_Hive"]()
        HBContext  = hb_hive.addToHoneybeeHive(shadingClasses, ghenv.Component.InstanceGuid.ToString())
        return HBContext
        ################################################################################################
    else:
        print "You should first let Honeybee to fly..."
        w = gh.GH_RuntimeMessageLevel.Warning
        ghenv.Component.AddRuntimeMessage(w, "You should first let Honeybee to fly...")
        return -1
        

if _shdSurfaces and _shdSurfaces[0]!=None:
    # add cleaning function
    result= main(_shdSurfaces, EPTransSchedule_, meshingSettings_, justBoundingBox_)
    
    if result != -1: HBContext = result
# ---------- end hb_epcontextsrf ----------

# ---- group: Summer
hb_epcontextsrf_2 = HoneybeeEPContextSurfaces(shdSurfaces=flatten(horizontal), RADMaterial=radopaquematerial.RADMaterial)  # -> HBContext; inputs shdSurfaces: list of GeometryBase, justBoundingBox: Boolean; same code as hb_epcontextsrf

# ----
ln_5 = Line(StartPoint=sunpath.sunPositions, EndPoint=sunpath.sunPathCenPts)
index = ItemIndex(List=radiationrose.radRoseValues, Item=item_11)
move_5 = Move(Geometry=curvepoint, Motion=Y)  # -> Geometry, Transform
panel_13 = Panel(item_11)
preview_3 = CustomPreview(Geometry=ln_5, Shader=ColourSwatch(SwatchColor=RGB(255, 0, 0)))
move_6 = Move(Geometry=move_5.Geometry, Motion=X_2)  # -> Geometry, Transform
project = Project(Geometry=ln_5, Plane=PlaneXY(0, 0, 0))  # -> Geometry, Transform
angle_2 = Angle(VectorA=ln_5, VectorB=project.Geometry)  # -> Angle, Reflex
item_12 = ListItem(List=pt_6, Index=index, Wrap=True)
setepnatvent = Honeybee_SetEPAirFlow(HBZones=solveadjc.HBZonesWADJ, naturalVentilationType=Slider(1, range=1..3))  # -> readMe, simplify(HBZones); plug-in component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
deg = Degrees(Radians=angle_2.Angle)
importepw_2 = Ladybug_ImportEpw(epwFile=open_epw_stat.epwFile)  # -> readMe, latitude, location, dryBulbTemperature, dewPointTemperature, relativeHumidity, windSpeed, windDirection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; plug-in component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
# update lighting schedule
brep_3 = Brep([createhbzones.HBZone, hb_epcontextsrf_2])
ma_2 = MassAddition(Input=deg)  # -> Result, PartialResults
lng = ListLength(List=deg)
division_3 = Division(A=ma_2.Result, B=lng)
panel_14 = Panel(division_3)
setepzoneloads = Honeybee_SetEnergyPlusZoneLoads(HBZones=setepnatvent.HBZones, lightingDensityPerArea="3")  # -> loads, HBZones; plug-in component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
subtraction = Subtraction(A=90, B="70")
rad = Radians(Degrees=subtraction)
tan = Tangent(Value=rad)
multiplication_3 = Multiplication(A=len_3, B=tan)
item_13 = ListItem(List=multiplication_3, Index="0", Wrap=True)
X_3 = UnitX(Factor=item_13)
move_7 = Move(Geometry=move_5.Geometry, Motion=X_3)  # -> Geometry, Transform
srf4pt_2 = _4PointSurface(CornerA=move_5.Geometry, CornerB=move.Geometry, CornerC=move_7.Geometry)
srf4pt_3 = _4PointSurface(CornerA=curvepoint, CornerB=move_4.Geometry, CornerC=move_7.Geometry, CornerD=move_5.Geometry)
rec = Brep([srf4pt, srf4pt_3, srf4pt_2])
# Generate lighting Schedule
flip = Flip(Surface=floor)  # -> Surface, Result
panel_15 = Panel("""1
1
0
0
0
0
0
0
0
0
0
1
1
1
1
0
0
0
0
0
1
1
1
1""")
dup = DuplicateData(Data=panel_15, Number=365, Order=True)
csvschedule = Honeybee_CreateCSVSchedule(values=dup, writeFile=Toggle(True))  # -> readMe, csvSchedule; plug-in component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
gentestpts = Honeybee_GenerateTestPoints(testSurface=flip.Surface, gridSize=".5", distBaseSrf=".762", moveTestMesh=True)  # -> readMe, simplify(testPoints), simplify(ptsVectors), simplify(facesArea), simplify(mesh); plug-in component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
pt_7 = Point(<point referenced from the Rhino model>)
gethbzoneepschedules = Honeybee_GetZoneEnergyPlusSchedules(HBZone=setepzoneloads.HBZones)  # -> occupancySchedule, occupancyActivitySch, heatingSetPtSchedule, coolingSetPtSchedule, lightingSchedule, equipmentSchedule, infiltrationSchedule; plug-in component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
dup_2 = DuplicateData(Data=panel_15, Number=365, Order=True)
legendpar_4 = Ladybug_LegendParameters(lowBound="700", legendLocation=pt_7)  # -> legendPar; plug-in component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
radparameters = Honeybee_RADParameters(quality=0)  # -> readMe, radParameters; plug-in component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
convertepschvalues = Honeybee_ConvertEnergyPlusScheduleToValues(schName=gethbzoneepschedules.occupancySchedule)  # -> values; plug-in component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
toggle = BooleanToggle(True)

# ---- group: PERIOD
number_slider_5 = Slider(3, range=1..12)
number_slider_6 = Slider(11, range=1..12)

# ----
setepzoneschedules = Honeybee_SetEnergyPlusZoneSchedules(
    HBZones=setepzoneloads.HBZones,
    occupancySchedules=gethbzoneepschedules.occupancySchedule,
    lightingSchedules=gethbzoneepschedules.lightingSchedule,
    equipmentSchedules=gethbzoneepschedules.equipmentSchedule,
    infiltrationSchedules=gethbzoneepschedules.infiltrationSchedule)  # -> schedules, simplify(HBZones); plug-in component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
epoutput = Honeybee_GenerateEPOutput(
    zoneEnergyUse=toggle,
    zoneGainsAndLosses=toggle,
    zoneComfortMetrics=toggle,
    surfaceTempAnalysis="False",
    surfaceEnergyAnalysis=toggle,
    timestep="hourly")  # -> report, flatten(simulationOutputs); plug-in component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
setepnatvent_2 = Honeybee_SetEPAirFlow(HBZones=solveadjc.HBZonesWADJ, naturalVentilationType=Slider(1, range=1..3))  # -> readMe, simplify(HBZones); plug-in component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
_3dchart = Ladybug_3DChart(inputData=flatten(convertepschvalues))  # -> readMe, graphMesh, graphCurves, legend, legendBasePts, title, titleBasePts, dataPts, conditionalHOY; plug-in component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
setepzoneloads_2 = Honeybee_SetEnergyPlusZoneLoads(HBZones=setepnatvent_2.HBZones, lightingDensityPerArea="3")  # -> loads, HBZones; plug-in component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

# ---- group: Summer
analysisperiod_3 = Ladybug_AnalysisPeriod(fromMonth=number_slider_5, toMonth=number_slider_6)  # -> readMe, analysisPeriod; plug-in component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

# ----
toggle_2 = BooleanToggle(True)

# ---- group: Summer
runenergysimulation = Honeybee_RunEnergySimulation(
    north=number_slider_4,
    epwFile=open_epw_stat.epwFile,
    HBZones=flatten(setepzoneschedules.HBZones),
    HBContext=flatten(hb_epcontextsrf_2),
    simulationOutputs=flatten(epoutput.simulationOutputs),
    port_2=setepzoneloads.HBZones,
    writeIdf=toggle_2,
    runEnergyPlus=toggle_2)  # -> report, idfFileAddress, resultFileAddress; plug-in component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

# ----
gethbzoneepschedules_2 = Honeybee_GetZoneEnergyPlusSchedules(HBZone=setepzoneloads_2.HBZones)  # -> occupancySchedule, occupancyActivitySch, heatingSetPtSchedule, coolingSetPtSchedule, lightingSchedule, equipmentSchedule, infiltrationSchedule; plug-in component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
toggle_3 = BooleanToggle(False)

brep_4 = Brep(rec)
preview_4 = CustomPreview(Geometry=brep_4, Shader=ColourSwatch(SwatchColor=RGB(255, 0, 234)))

radiationanalysis = Ladybug_RadiationAnalysis(
    north=vec,
    geometry=flatten(glass),
    context=flatten(brep_4),
    gridSize="0.05",
    disFromBase="0.01",
    selectedSkyMtx=flatten(selectskymtx.selectedSkyMtx),
    legendPar=flatten(legendpar_4),
    runIt=Toggle(True))  # -> readMe, contextMesh, analysisMesh, testPts, testVec, port, radiationResult, radiationMesh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; plug-in component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
panel_16 = Panel(radiationanalysis.totalRadiation)
item_14 = ListItem(List=radiationanalysis.radiationResult, Index="0", Wrap=True)
sort_2 = SortList(Keys=item_14)  # -> Keys, ValuesA
lng_2 = ListLength(List=sort_2.Keys)
item_15 = ListItem(List=sort_2.Keys, Index=lng_2, Wrap=True)
panel_17 = Panel(item_15)
setepzoneschedules_2 = Honeybee_SetEnergyPlusZoneSchedules(
    HBZones=setepzoneloads_2.HBZones,
    occupancySchedules=gethbzoneepschedules_2.occupancySchedule,
    lightingSchedules=gethbzoneepschedules_2.lightingSchedule,
    equipmentSchedules=gethbzoneepschedules_2.equipmentSchedule,
    infiltrationSchedules=gethbzoneepschedules_2.infiltrationSchedule)  # -> schedules, simplify(HBZones); plug-in component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
readepresult = Honeybee_ReadEPResult(resultFileAddress=runenergysimulation.resultFileAddress)  # -> port, port_2, port_3, port_4, electricLight, electricEquip, port_5, port_6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; plug-in component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
toggle_4 = BooleanToggle(True)
panel_18 = Panel(readepresult.airTemperature)

# ---- group: winter
analysisperiod_4 = Ladybug_AnalysisPeriod(fromMonth=number_slider_6, toMonth=number_slider_5)  # -> readMe, analysisPeriod; plug-in component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

# ----
separatedata = Ladybug_SeparateData(inputList=flatten(panel_18))  # -> numbers, strings; plug-in component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
adaptivecomfortcalculator = Ladybug_AdaptiveComfortCalculator(
    dryBulbTemperature=readepresult.airTemperature,
    meanRadiantTemperature=readepresult.meanRadTemperature,
    prevailingOutdoorTemp=importepw_2.dryBulbTemperature,
    runIt=toggle_4)  # -> readMe, port, comfortableOrNot, conditionOfPerson, degreesFromTarget, port_2, targetTemperature, upperTemperatureBound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; plug-in component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
panel_19 = Panel(adaptivecomfortcalculator.upperTemperatureBound)
separatedata_2 = Ladybug_SeparateData(inputList=flatten(panel_19))  # -> numbers, strings; plug-in component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
toggle_5 = BooleanToggle(True)
pmvcomfortcalculator = Ladybug_PMVComfortCalculator(
    dryBulbTemperature=readepresult.airTemperature,
    meanRadiantTemperature=readepresult.meanRadTemperature,
    relativeHumidity=readepresult.relativeHumidity,
    calcBalanceTemperature=False,
    runIt=toggle_4)  # -> readMe, port, predictedMeanVote, percentPeopleDissatisfied, standardEffectiveTemperature, port_2, comfortableOrNot, percentOfTimeComfortable, port_3, balanceTemperature; plug-in component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
panel_20 = Panel(separatedata_2.numbers)
runenergysimulation_2 = Honeybee_RunEnergySimulation(
    north=number_slider_4,
    epwFile=open_epw_stat.epwFile,
    HBZones=flatten(setepzoneschedules_2.HBZones),
    HBContext=flatten(hb_epcontextsrf),
    simulationOutputs=flatten(epoutput.simulationOutputs),
    port_2=setepzoneloads.HBZones,
    writeIdf=toggle_5,
    runEnergyPlus=toggle_5)  # -> report, idfFileAddress, resultFileAddress; plug-in component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
panel_21 = Panel("0")
addition_2 = Addition(A=panel_20, B="2")
number_slider_7 = Slider(0.25, range=0..1)
_3dchart_2 = Ladybug_3DChart(inputData=flatten(pmvcomfortcalculator.predictedMeanVote), xScale=number_slider_7, zScale=0)  # -> readMe, graphMesh, graphCurves, legend, legendBasePts, title, titleBasePts, dataPts, conditionalHOY; plug-in component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
panel_22 = Panel(pmvcomfortcalculator.percentOfTimeComfortable)
panel_23 = Panel(adaptivecomfortcalculator.percentOfTimeComfortable)
panel_24 = Panel(adaptivecomfortcalculator.percentHotCold)
_3dchart_3 = Ladybug_3DChart(inputData=flatten(pmvcomfortcalculator.predictedMeanVote), xScale=number_slider_7, zScale=0)  # -> readMe, graphMesh, graphCurves, legend, legendBasePts, title, titleBasePts, dataPts, conditionalHOY; plug-in component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
larger = LargerThan(FirstNumber=separatedata.numbers, SecondNumber=addition_2)  # -> LargerThan, OrEqualTo
energybalance = Honeybee_ConstructEnergyBalance(
    HBZones=flatten(setepzoneschedules.HBZones),
    cooling=readepresult.port_3,
    heating=readepresult.port_4,
    electricLight=readepresult.electricLight,
    electricEquip=readepresult.electricEquip,
    peopleGains=readepresult.peopleGains,
    totalSolarGain=readepresult.totalSolarGain,
    infiltrationEnergy=readepresult.infiltrationEnergy)  # -> readMe, port, flrNormEnergyBal, flrNormBalWStorage, port_2, modelEnergyBalance, energyBalWithStorage; plug-in component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
X_4 = UnitX(Factor=Slider(130, range=0..1000))
smaller = SmallerThan(FirstNumber=panel_20, SecondNumber="21")  # -> SmallerThan, OrEqualTo
readepresult_2 = Honeybee_ReadEPResult(resultFileAddress=runenergysimulation_2.resultFileAddress)  # -> port, port_2, port_3, port_4, electricLight, electricEquip, port_5, port_6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; plug-in component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
_3dchart_4 = Ladybug_3DChart(inputData=flatten(adaptivecomfortcalculator.conditionOfPerson), xScale=number_slider_7, zScale=0)  # -> readMe, graphMesh, graphCurves, legend, legendBasePts, title, titleBasePts, dataPts, conditionalHOY; plug-in component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
pt_8 = Point(<point referenced from the Rhino model>)
move_8 = Move(Geometry=pt_8, Motion=X_4)  # -> Geometry, Transform
annualdaylightsimulation = Honeybee_AnnualDaylightSimulation(
    north=number_slider_4,
    epwWeatherFile=open_epw_stat.epwFile,
    testPoints=gentestpts.testPoints,
    ptsVectors=gentestpts.ptsVectors,
    testMesh=gentestpts.mesh,
    radParameters=radparameters.radParameters)  # -> analysisRecipe; plug-in component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
panel_25 = Panel(larger.LargerThan)
gradientlibrary = Ladybug_GradientLibrary(gradIndex="19")  # -> customColors; plug-in component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
toggle_6 = BooleanToggle(True)
tag_2 = TextTag(Location=pt_8, Text=panel_23)
rev_3 = ReverseList(List=gradientlibrary)
toggle_7 = BooleanToggle(True)
csvschedule_2 = Honeybee_CreateCSVSchedule(values=dup_2, writeFile=toggle_7)  # -> readMe, csvSchedule; plug-in component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
rundaylightanalysis = Honeybee_RunDaylightSimulation(
    HBObjects=flatten(brep_3),
    analysisRecipe=annualdaylightsimulation,
    writeRad=toggle_6,
    runRad=toggle_6,
    numOfCPUs=Slider(3, range=0..10),
    overwriteResults=True)  # -> readMe, analysisType, resultsUnit, results, testPts, annual_analysis_files, radGeoFile, studyFolder, done; disabled; plug-in component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
panel_26 = Panel("""Cooling, Heating
& Lighting Loads""")
occupancygenerator = Honeybee_DaysimOccupancyGenerator(weekendDays=[1, 2], writeTheOcc=Toggle(True))  # -> occupancyFile; plug-in component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
legendpar_5 = Ladybug_LegendParameters(lowBound="-450", highBound="450", customColors=flatten(rev_3))  # -> legendPar; plug-in component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
gethbzoneepschedules_3 = Honeybee_GetZoneEnergyPlusSchedules(HBZone=createhbzones.HBZone)  # -> occupancySchedule, occupancyActivitySch, heatingSetPtSchedule, coolingSetPtSchedule, lightingSchedule, equipmentSchedule, infiltrationSchedule; plug-in component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
csvschedule_3 = Honeybee_CreateCSVSchedule(values=panel_25, writeFile=toggle_7)  # -> readMe, csvSchedule; plug-in component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

# ---- group: Comfort
separatedata_3 = Ladybug_SeparateData(inputList=flatten(panel_19))  # -> numbers, strings; plug-in component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

# ---- group: Temp
separatedata_4 = Ladybug_SeparateData(inputList=flatten(panel_18))  # -> numbers, strings; plug-in component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

# ----
toggle_8 = BooleanToggle(True)  # disabled
convertepschvalues_2 = Honeybee_ConvertEnergyPlusScheduleToValues(schName=csvschedule_3.csvSchedule)  # -> values; plug-in component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
barchart = Ladybug_MonthlyBarChart(
    inputData=flatten(energybalance.energyBalWithStorage),
    stackValues=Toggle(True),
    altTitle="room energy balance",
    altYAxisTitle="Energy (kWh)",
    legendPar=legendpar_5)  # -> readMe, dataMesh, dataCurves, dataCrvColors, graphAxes, graphLabels, title, titleBasePt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; plug-in component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
panel_27 = Panel(occupancygenerator)  # disabled
readannualresultsi = Honeybee_ReadAnnualResultI(
    illFilesAddress=rundaylightanalysis.annual_analysis_files,
    testPoints=simplify(rundaylightanalysis.testPts),
    occupancyFiles=occupancygenerator,
    DLAIllumThresholds=300,
    runIt=toggle_8)  # -> DLA, UDLI_Less_100, UDLI_100_2000, UDLI_More_2000, CDA, sDA, annualProfiles, htmReport; disabled; plug-in component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
panel_28 = Panel(separatedata_3.numbers)
setepnatvent_3 = Honeybee_SetEPAirFlow(
    HBZones=solveadjc.HBZonesWADJ,
    interZoneAirFlowSched=csvschedule_3.csvSchedule,
    naturalVentilationType=Slider(3, range=1..3),
    openingAreaFractionalSched=csvschedule_3.csvSchedule,
    fanFlowRate="0.08")  # -> readMe, simplify(HBZones); plug-in component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
subtraction_2 = Subtraction(A=separatedata_4.numbers, B=separatedata_3.numbers)
_3dchart_5 = Ladybug_3DChart(inputData=flatten(convertepschvalues_2))  # -> readMe, graphMesh, graphCurves, legend, legendBasePts, title, titleBasePts, dataPts, conditionalHOY; plug-in component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
separatedata_5 = Ladybug_SeparateData(inputList=flatten(readepresult.electricLight))  # -> numbers, strings; plug-in component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
separatedata_6 = Ladybug_SeparateData(inputList=flatten(readepresult.port_3))  # -> numbers, strings; plug-in component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
separatedata_7 = Ladybug_SeparateData(inputList=flatten(readepresult.port_4))  # -> numbers, strings; plug-in component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
int = Integer(subtraction_2)
sort_3 = SortList(Keys=int)  # -> Keys, ValuesA
ma_3 = MassAddition(Input=separatedata_5.numbers)  # -> Result, PartialResults
ma_4 = MassAddition(Input=separatedata_6.numbers)  # -> Result, PartialResults
ma_5 = MassAddition(Input=separatedata_7.numbers)  # -> Result, PartialResults
rev_4 = ReverseList(List=sort_3.Keys)

# ---- group: just for visualization
# Compare Schedules!
dsannualprofiles = Honeybee_DaysimAnnualProfiles(annualProfiles=readannualresultsi.annualProfiles)  # -> simplify(occupancyProfile), simplify(shadingProfiles), simplify(lightingControlProfiles), simplify(dgpProfile); disabled; plug-in component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
convertepschvalues_3 = Honeybee_ConvertEnergyPlusScheduleToValues(schName=gethbzoneepschedules_3.lightingSchedule)  # -> values; disabled; plug-in component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
_3dchart_6 = Ladybug_3DChart(inputData=flatten([convertepschvalues_3, dsannualprofiles.lightingControlProfiles]))  # -> readMe, graphMesh, graphCurves, legend, legendBasePts, title, titleBasePts, dataPts, conditionalHOY; disabled; plug-in component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

# ----
panel_29 = Panel(readannualresultsi.sDA)  # disabled
item_16 = ListItem(List=rev_4, Index=0, Wrap=True)
division_4 = Division(A=subtraction_2, B=item_16)
setepzoneloads_3 = Honeybee_SetEnergyPlusZoneLoads(HBZones=setepnatvent_3.HBZones, lightingDensityPerArea="3")  # -> loads, HBZones; plug-in component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
pt_9 = Point(<point referenced from the Rhino model>)
total_lighting = Panel(ma_3.Result)
total_cooling = Panel(ma_4.Result)
total_heating = Panel(ma_5.Result)
X_5 = UnitX(Factor=Slider(130, range=0..1000))
pt_10 = Point(<point referenced from the Rhino model>)
panel_30 = Panel(division_4)
toggle_9 = BooleanToggle(True)
move_9 = Move(Geometry=pt_10, Motion=X_5)  # -> Geometry, Transform
adaptivecomfortcalculator_2 = Ladybug_AdaptiveComfortCalculator(
    dryBulbTemperature=readepresult_2.airTemperature,
    meanRadiantTemperature=readepresult_2.meanRadTemperature,
    prevailingOutdoorTemp=importepw_2.dryBulbTemperature,
    runIt=toggle_4)  # -> readMe, port, comfortableOrNot, conditionOfPerson, degreesFromTarget, port_2, targetTemperature, upperTemperatureBound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; plug-in component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
panel_31 = Panel(adaptivecomfortcalculator_2.percentHotCold)
panel_32 = Panel(adaptivecomfortcalculator_2.percentOfTimeComfortable)
_3dchart_7 = Ladybug_3DChart(
    inputData=flatten(adaptivecomfortcalculator_2.conditionOfPerson),
    basePoint=pt_9,
    xScale=Slider(0.25, range=0..1),
    zScale=0)  # -> readMe, graphMesh, graphCurves, legend, legendBasePts, title, titleBasePts, dataPts, conditionalHOY; plug-in component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
legendpar_6 = Ladybug_LegendParameters()  # -> legendPar; disabled; plug-in component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
ma_6 = MassAddition(Input=[total_lighting, total_cooling, total_heating])  # -> Result, PartialResults
barchart_2 = Ladybug_MonthlyBarChart(
    inputData=flatten([readepresult.port_3, readepresult.electricLight, readepresult.port_4]),
    altYAxisTitle=panel_26,
    basePoint="20, 0, 0",
    xScale=Slider(0.5, range=0..1),
    yScale=Slider(0.7, range=0..1))  # -> readMe, dataMesh, dataCurves, dataCrvColors, graphAxes, graphLabels, title, titleBasePt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; plug-in component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
total_cooling_2 = Panel(ma_6.Result)
gethbzoneepschedules_4 = Honeybee_GetZoneEnergyPlusSchedules(HBZone=setepzoneloads_3.HBZones)  # -> occupancySchedule, occupancyActivitySch, heatingSetPtSchedule, coolingSetPtSchedule, lightingSchedule, equipmentSchedule, infiltrationSchedule; plug-in component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
tag_3 = TextTag(Location=pt_10, Text=panel_32)
number_slider_8 = Slider(1, range=0..10)  # disabled
panel_33 = Panel(adaptivecomfortcalculator_2.upperTemperatureBound)
panel_34 = Panel(readepresult_2.airTemperature)
number_slider_9 = Slider(100, range=0..100)  # disabled
gradientlibrary_2 = Ladybug_GradientLibrary(gradIndex=number_slider_8)  # -> customColors; disabled; plug-in component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
number_slider_10 = Slider(6, range=0..10)  # disabled
number_slider_11 = Slider(0, range=0..100)  # disabled
number_slider_12 = Slider(1, range=0..1)  # disabled
setepzoneschedules_3 = Honeybee_SetEnergyPlusZoneSchedules(
    HBZones=setepzoneloads_3.HBZones,
    occupancySchedules=gethbzoneepschedules_4.occupancySchedule,
    lightingSchedules=gethbzoneepschedules_4.lightingSchedule,
    equipmentSchedules=gethbzoneepschedules_4.equipmentSchedule,
    infiltrationSchedules=gethbzoneepschedules_4.infiltrationSchedule)  # -> schedules, simplify(HBZones); plug-in component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

# ---- group: Summer + Vent
runenergysimulation_3 = Honeybee_RunEnergySimulation(
    north=number_slider_4,
    epwFile=open_epw_stat.epwFile,
    analysisPeriod=analysisperiod_3.analysisPeriod,
    HBZones=flatten(setepzoneschedules_3.HBZones),
    HBContext=flatten(hb_epcontextsrf_2),
    simulationOutputs=flatten(epoutput.simulationOutputs),
    port_2=setepzoneloads.HBZones,
    writeIdf=toggle_2,
    runEnergyPlus=toggle_2)  # -> report, idfFileAddress, resultFileAddress; plug-in component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

# ----
readepresult_3 = Honeybee_ReadEPResult(resultFileAddress=runenergysimulation_3.resultFileAddress)  # -> port, port_2, port_3, port_4, electricLight, electricEquip, fanElectric, port_5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; plug-in component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
adaptivecomfortcalculator_3 = Ladybug_AdaptiveComfortCalculator(
    dryBulbTemperature=readepresult_3.airTemperature,
    meanRadiantTemperature=readepresult_3.meanRadTemperature,
    prevailingOutdoorTemp=importepw_2.dryBulbTemperature,
    runIt=toggle_9)  # -> readMe, port, comfortableOrNot, conditionOfPerson, degreesFromTarget, port_2, targetTemperature, upperTemperatureBound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; plug-in component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
pmvcomfortcalculator_2 = Ladybug_PMVComfortCalculator(
    dryBulbTemperature=readepresult_3.airTemperature,
    meanRadiantTemperature=readepresult_3.meanRadTemperature,
    relativeHumidity=readepresult_3.relativeHumidity,
    calcBalanceTemperature=False,
    runIt=toggle_9)  # -> readMe, port, predictedMeanVote, percentPeopleDissatisfied, standardEffectiveTemperature, port_2, comfortableOrNot, percentOfTimeComfortable, port_3, balanceTemperature; plug-in component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

# ---- group: Real temp
separatedata_8 = Ladybug_SeparateData(inputList=flatten(panel_34))  # -> numbers, strings; plug-in component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

# ---- group: Upper Comfort
separatedata_9 = Ladybug_SeparateData(inputList=flatten(panel_33))  # -> numbers, strings; plug-in component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

# ----
panel_35 = Panel(separatedata_9.numbers)
panel_36 = Panel(pmvcomfortcalculator_2.percentOfTimeComfortable)
panel_37 = Panel(adaptivecomfortcalculator_3.percentOfTimeComfortable)
panel_38 = Panel(adaptivecomfortcalculator_3.percentHotCold)

# ---- group: make it 3D!
dom = ConstructDomain(DomainStart=0, DomainEnd=number_slider_12)  # disabled

# ----
legendpar_7 = Ladybug_LegendParameters(
    lowBound=number_slider_11,
    highBound=number_slider_9,
    numSegments=number_slider_10,
    customColors=flatten(gradientlibrary_2))  # -> legendPar; disabled; plug-in component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
recolormesh = Ladybug_ReColorMesh(analysisResult=readannualresultsi.DLA, inputMesh=gentestpts.mesh, heightDomain=dom, legendPar=legendpar_7)  # -> readMe, newMesh, newLegend, legendBasePt, meshColors, legendColors; disabled; plug-in component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
pt_11 = Point(<point referenced from the Rhino model>)
X_6 = UnitX(Factor=Slider(130, range=0..1000))
addition_3 = Addition(A=panel_35, B="2")
_3dchart_8 = Ladybug_3DChart(
    inputData=flatten(adaptivecomfortcalculator_3.conditionOfPerson),
    basePoint=pt_11,
    xScale=Slider(0.25, range=0..1),
    zScale=0)  # -> readMe, graphMesh, graphCurves, legend, legendBasePts, title, titleBasePts, dataPts, conditionalHOY; plug-in component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
pt_12 = Point(<point referenced from the Rhino model>)
move_10 = Move(Geometry=pt_12, Motion=X_6)  # -> Geometry, Transform
subtraction_3 = Subtraction(A=separatedata_8.numbers, B=separatedata_9.numbers)
larger_2 = LargerThan(FirstNumber=separatedata_8.numbers, SecondNumber=addition_3)  # -> LargerThan, OrEqualTo
panel_39 = Panel(larger_2.LargerThan)
int_2 = Integer(subtraction_3)
tag_4 = TextTag(Location=pt_12, Text=panel_37)
sort_4 = SortList(Keys=int_2)  # -> Keys, ValuesA
rev_5 = ReverseList(List=sort_4.Keys)
toggle_10 = BooleanToggle(True)
csvschedule_4 = Honeybee_CreateCSVSchedule(values=division_4, writeFile=toggle_10)  # -> readMe, csvSchedule; plug-in component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
item_17 = ListItem(List=rev_5, Index=0, Wrap=True)
division_5 = Division(A=subtraction_3, B=item_17)
csvschedule_5 = Honeybee_CreateCSVSchedule(values=division_5, writeFile=toggle_10)  # -> readMe, csvSchedule; plug-in component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
panel_40 = Panel(division_5)
convertepschvalues_4 = Honeybee_ConvertEnergyPlusScheduleToValues(schName=csvschedule_5.csvSchedule)  # -> values; plug-in component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
_3dchart_9 = Ladybug_3DChart(inputData=flatten(convertepschvalues_4), xScale="0.2")  # -> readMe, graphMesh, graphCurves, legend, legendBasePts, title, titleBasePts, dataPts, conditionalHOY; plug-in component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
setepnatvent_4 = Honeybee_SetEPAirFlow(
    HBZones=solveadjc.HBZonesWADJ,
    interZoneAirFlowSched=csvschedule_5.csvSchedule,
    naturalVentilationType=Slider(3, range=1..3),
    openingAreaFractionalSched=csvschedule_5.csvSchedule,
    fanFlowRate="0.08")  # -> readMe, simplify(HBZones); plug-in component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
setepzoneloads_4 = Honeybee_SetEnergyPlusZoneLoads(HBZones=setepnatvent_4.HBZones, lightingDensityPerArea="3")  # -> loads, HBZones; plug-in component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
gethbzoneepschedules_5 = Honeybee_GetZoneEnergyPlusSchedules(HBZone=setepzoneloads_4.HBZones)  # -> occupancySchedule, occupancyActivitySch, heatingSetPtSchedule, coolingSetPtSchedule, lightingSchedule, equipmentSchedule, infiltrationSchedule; plug-in component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
setepzoneschedules_4 = Honeybee_SetEnergyPlusZoneSchedules(
    HBZones=setepzoneloads_4.HBZones,
    occupancySchedules=gethbzoneepschedules_5.occupancySchedule,
    lightingSchedules=gethbzoneepschedules_5.lightingSchedule,
    equipmentSchedules=gethbzoneepschedules_5.equipmentSchedule,
    infiltrationSchedules=gethbzoneepschedules_5.infiltrationSchedule)  # -> schedules, simplify(HBZones); plug-in component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
runenergysimulation_4 = Honeybee_RunEnergySimulation(
    north=number_slider_4,
    epwFile=open_epw_stat.epwFile,
    HBZones=flatten(setepzoneschedules_4.HBZones),
    HBContext=flatten(hb_epcontextsrf),
    simulationOutputs=flatten(epoutput.simulationOutputs),
    port_2=setepzoneloads.HBZones,
    writeIdf=toggle_5,
    runEnergyPlus=toggle_5)  # -> report, idfFileAddress, resultFileAddress; plug-in component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
readepresult_4 = Honeybee_ReadEPResult(resultFileAddress=runenergysimulation_4.resultFileAddress)  # -> port, port_2, port_3, port_4, electricLight, electricEquip, fanElectric, port_5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; plug-in component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
adaptivecomfortcalculator_4 = Ladybug_AdaptiveComfortCalculator(
    dryBulbTemperature=readepresult_4.airTemperature,
    meanRadiantTemperature=readepresult_4.meanRadTemperature,
    prevailingOutdoorTemp=importepw_2.dryBulbTemperature,
    analysisPeriod=analysisperiod_4.analysisPeriod,
    runIt=Toggle(True))  # -> readMe, port, comfortableOrNot, conditionOfPerson, degreesFromTarget, port_2, targetTemperature, upperTemperatureBound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; plug-in component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
pmvcomfortcalculator_3 = Ladybug_PMVComfortCalculator(
    dryBulbTemperature=readepresult_4.meanRadTemperature,
    meanRadiantTemperature=readepresult_3.meanRadTemperature,
    relativeHumidity=readepresult_3.relativeHumidity,
    calcBalanceTemperature=False,
    runIt=toggle_9)  # -> readMe, port, predictedMeanVote, percentPeopleDissatisfied, standardEffectiveTemperature, port_2, comfortableOrNot, percentOfTimeComfortable, port_3, balanceTemperature; plug-in component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
panel_41 = Panel(pmvcomfortcalculator_3.percentOfTimeComfortable)
panel_42 = Panel(adaptivecomfortcalculator_4.percentOfTimeComfortable)
panel_43 = Panel(adaptivecomfortcalculator_4.percentHotCold)
pt_13 = Point(<point referenced from the Rhino model>)
X_7 = UnitX(Factor=Slider(130, range=0..1000))
_3dchart_10 = Ladybug_3DChart(
    inputData=flatten(adaptivecomfortcalculator_4.conditionOfPerson),
    basePoint=pt_9,
    xScale=Slider(0.25, range=0..1),
    zScale=0)  # -> readMe, graphMesh, graphCurves, legend, legendBasePts, title, titleBasePts, dataPts, conditionalHOY; plug-in component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
pt_14 = Point(<point referenced from the Rhino model>)
move_11 = Move(Geometry=pt_14, Motion=X_7)  # -> Geometry, Transform
tag_5 = TextTag(Location=pt_10, Text=panel_42)
