# Grasshopper definition Ksenia Knyazkina final submission definition.gh (Grasshopper 0.9.76)
# plug-ins: Python Interpreter, embryoA

honeybee = Honeybee_Honeybee()  # -> Vviiiiiiiiiizzz; plug-in component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
ladybug = Ladybug_Ladybug()  # -> Vviiiiiiiiiizzz; plug-in component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
thermal_mass = Panel("m2")
thermal_mass_2 = Panel("m3")
i = Panel("insulationeps")
epopaquemat = Honeybee_EnergyPlusOpaqueMaterial(name=thermal_mass, thickness=Slider(0.3, range=0.1..1), conductivity="0.5", density="1840", specificHeat="880")  # -> EPMaterial; plug-in component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
epopaquemat_2 = Honeybee_EnergyPlusOpaqueMaterial(name=thermal_mass_2, thickness=Slider(0.5, range=0.1..1), conductivity="0.5", density="1840", specificHeat="880")  # -> EPMaterial; plug-in component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
epopaquemat_3 = Honeybee_EnergyPlusOpaqueMaterial(name="i2 - concrete", thickness="0.2", conductivity="0.22", density="1700", specificHeat="880")  # -> EPMaterial; plug-in component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
epopaquemat_4 = Honeybee_EnergyPlusOpaqueMaterial(name=i, thickness="0.08", conductivity="0.025", density="40", specificHeat="1300")  # -> EPMaterial; plug-in component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
thermal_mass_3 = Panel("w1")
epconstruction = Honeybee_EnergyPlusConstruction(name=thermal_mass_3, layer_1=epopaquemat)  # -> EPConstruction; plug-in component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
insulation = Panel("in")
thermal_mass_4 = Panel("s00")
epconstruction_2 = Honeybee_EnergyPlusConstruction(name=thermal_mass_4, layer_1=epopaquemat_2)  # -> EPConstruction; plug-in component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
epconstruction_3 = Honeybee_EnergyPlusConstruction(name=insulation, layer_1=epopaquemat_4, layer_2=epopaquemat_3)  # -> EPConstruction; plug-in component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

# ---- group: SKYLIGHTS
panel = Panel("outdoors")
skylight = Brep([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])
epwindowmat = Honeybee_EnergyPlusWindowMaterial(name="g12", U_Value="0.15", SHGC="0.9", VT="0.5")  # -> EPMaterial; plug-in component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
area = Area(Geometry=skylight)  # -> Area, Centroid
epconstruction_4 = Honeybee_EnergyPlusConstruction(name="glass2333", layer_1=epwindowmat)  # -> EPConstruction; plug-in component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
createhbsrfs = Honeybee_createHBSrfs(geometry=skylight, EPBC=panel, EPConstruction=epconstruction_2)  # -> readMe, simplify(HBSurface); plug-in component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
scale = Scale(Geometry=skylight, Center=area.Centroid, Factor=Slider(0.8, range=0.1..0.9))  # -> Geometry, Transform
addhbglz = Honeybee_addHBGlz(HBObj=createhbsrfs.HBSurface, childSurfaces=flatten(scale.Geometry), EPConstructions=epconstruction_4)  # -> simplify(HBObjWGLZ); plug-in component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

# ----
epwindowmat_2 = Honeybee_EnergyPlusWindowMaterial(name="g1", U_Value="0.15", SHGC="0.9", VT="0.63")  # -> EPMaterial; plug-in component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
roor2 = Brep([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])
gr = Brep(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)
epwindowmat_3 = Honeybee_EnergyPlusWindowMaterial(name="g1", U_Value="0.15", SHGC="0.9", VT="0.63")  # -> EPMaterial; plug-in component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

# ---- group: floor
floor = Brep(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)

# ----
createhbsrfs_2 = Honeybee_createHBSrfs(geometry=[gr, roor2], EPBC=panel, EPConstruction=epconstruction_3)  # -> readMe, simplify(HBSurface); plug-in component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
epconstruction_5 = Honeybee_EnergyPlusConstruction(name="glass32", layer_1=epwindowmat_2)  # -> EPConstruction; plug-in component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

top = Brep(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)
back = Brep([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])

right = Brep(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)
right2 = Brep(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)
left = Brep([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])
facade = Brep(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)
createhbsrfs_3 = Honeybee_createHBSrfs(geometry=flatten(floor), EPBC="ground", EPConstruction=epconstruction_3)  # -> readMe, simplify(HBSurface); plug-in component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
createhbsrfs_4 = Honeybee_createHBSrfs(geometry=[back, top], EPBC="outdoors", EPConstruction=epconstruction)  # -> readMe, simplify(HBSurface); plug-in component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
createhbsrfs_5 = Honeybee_createHBSrfs(geometry=left, EPBC="outdoors", EPConstruction=epconstruction_3)  # -> readMe, simplify(HBSurface); plug-in component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
createhbsrfs_6 = Honeybee_createHBSrfs(geometry=flatten(facade), EPConstruction=epconstruction)  # -> readMe, simplify(HBSurface); plug-in component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
glazingcreator = Honeybee_GlazingBasedOnRatio(HBObjects=createhbsrfs_6.HBSurface, glzRatio="0.5", breakUpWindow=Toggle(False), runIt=Toggle(True))  # -> readMe, HBObjWGLZ; plug-in component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
createhbsrfs_7 = Honeybee_createHBSrfs(geometry=right2, EPBC="outdoors", EPConstruction=epconstruction_3)  # -> readMe, simplify(HBSurface); plug-in component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
glazingcreator_2 = Honeybee_GlazingBasedOnRatio(HBObjects=createhbsrfs_7.HBSurface, glzRatio=Slider(0.7, range=0..1), breakUpWindow=Toggle(False), runIt=Toggle(True))  # -> readMe, HBObjWGLZ; plug-in component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
createhbsrfs_8 = Honeybee_createHBSrfs(geometry=right, EPBC="outdoors", EPConstruction=epconstruction_3)  # -> readMe, simplify(HBSurface); plug-in component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
epconstruction_6 = Honeybee_EnergyPlusConstruction(name="glass2", layer_1=epwindowmat_3)  # -> EPConstruction; plug-in component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
panel_2 = Panel("""1
2""")
debrep = DeconstructBrep(Brep=glazingcreator_2.HBObjWGLZ)  # -> Faces, Edges, Vertices
debrep_2 = DeconstructBrep(Brep=glazingcreator.HBObjWGLZ)  # -> Faces, Edges, Vertices
item = ListItem(List=debrep.Faces, Index=panel_2, Wrap=True)
item_2 = ListItem(List=debrep_2.Faces, Index="1", Wrap=True)
addhbglz_2 = Honeybee_addHBGlz(HBObj=createhbsrfs_7.HBSurface, childSurfaces=flatten(item), EPConstructions=epconstruction_5)  # -> simplify(HBObjWGLZ); plug-in component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
addhbglz_3 = Honeybee_addHBGlz(HBObj=createhbsrfs_6.HBSurface, childSurfaces=flatten(item_2), EPConstructions=epconstruction_6)  # -> simplify(HBObjWGLZ); plug-in component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
epwindowshades = Honeybee_EnergyPlusWindowShadeGenerator(
    HBObjects=glazingcreator.HBObjWGLZ,
    depth="0.1",
    numOfShds="5",
    distBetween="0.3",
    horOrVertical=Toggle(True),
    shdAngle="15",
    interiorOrExter=Toggle(False),
    runIt=Toggle(True))  # -> readMe, port, HBObjWShades, port_2, windowBreps, shadeBreps, port_3, zoneData1Tree, zoneData2Tree, zoneData3Tree; plug-in component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
panel_3 = Panel("""0.6
0.6
0.6
0.6
0.6
0.6
0.6
0.6
0.6
0.6
0.6
0.6
0.6
0.6
0.6
0.6
0.6
0.6
0.6
0.6
0.6
0.6
0.6
0.6""")
bldgprograms = Honeybee_bldgPrograms({"Office": 0, "Retail": 1, "MidriseApartment": 2, "PrimarySchool": 3, "SecondarySchool": 4, "SmallHotel": 5, "LargeHotel": 6, "Hospital": 7, "Outpatient": 8, "Warehouse": 9, "SuperMarket": 10, "FullServiceRestaurant": 11, "QuickServiceRestaurant": 12}, selected="MidriseApartment")
listzoneprograms = Honeybee_ListZonePrograms(bldgProgram=bldgprograms)  # -> MidriseApartmentZonePrograms; plug-in component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
item_3 = ListItem(List=listzoneprograms, Index=0, Wrap=True)
panel_4 = Panel(item_3)
dup = DuplicateData(Data=panel_3, Number=Slider(365, range=0..1000), Order=True)
csvschedule = Honeybee_CreateCSVSchedule(values=dup, writeFile=Toggle(True))  # -> readMe, flatten(csvSchedule); plug-in component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

# ---- group: small louvres
brep = Brep([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])

# ---- group: Louvers
brep_2 = Brep([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])

# ---- group: collect all honeybee surfaces
brep_3 = Brep(flatten([createhbsrfs_4.HBSurface, createhbsrfs_3.HBSurface, addhbglz_3, addhbglz_2, addhbglz, createhbsrfs_2.HBSurface, createhbsrfs_5.HBSurface, createhbsrfs_8.HBSurface]))

# ---- group: Before shading
state_3 = Brep([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])

# ---- group: with louvres and overhang
state_4 = Brep([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])

# ---- group: with louvres and small overhang
state4_1 = Brep([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])

# ---- group: small overhang
brep_4 = Brep(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)

# ---- group: tilt 1.2m
state_5 = Brep([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])

# ---- group: overhang
brep_5 = Brep(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)

# ----
louvres = Brep([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])
hb_epcontextsrf = HoneybeeEPContextSurfaces(shdSurfaces=flatten([brep, brep_4]), EPTransSchedule=csvschedule.csvSchedule)  # -> HBContext; inputs shdSurfaces: list of Brep, justBoundingBox: Boolean
# ---------- hb_epcontextsrf: Python ----------
"""
prepare shading/context geometries

    Args:
        northVectorOrRotation: A vector that shows North or a number that shows
                               the rotation of the North from the Y axis
        bldgMasses: List of closed Breps as thermal zones.
    Returns:
        report: ...
        thermalZones: Thermal zone's geometries for visualiza
"""

ghenv.Component.Name = 'Honeybee EP context Surfaces'
ghenv.Component.NickName = 'HB_EPContextSrf'
ghenv.Component.Message = 'VER 0.0.58\nNOV_20_2015'
ghenv.Component.Category = "Honeybee"
ghenv.Component.SubCategory = "09 | Energy | Energy"
#compatibleHBVersion = VER 0.0.57\nNOV_01_2015
#compatibleLBVersion = VER 0.0.59\nFEB_01_2015
ghenv.Component.AdditionalHelpFromDocStrings = "2"

import rhinoscriptsyntax as rs
import Rhino as rc
import scriptcontext as sc
import os
import System
import Grasshopper.Kernel as gh
import uuid

tolerance = sc.doc.ModelAbsoluteTolerance
import math


def main(shdSurfaces, EPTransSchedule, meshingSettings, justBoundingBox):
    
    # import the classes
    if sc.sticky.has_key('honeybee_release'):

        try:
            if not sc.sticky['honeybee_release'].isCompatible(ghenv.Component): return -1
        except:
            warning = "You need a newer version of Honeybee to use this compoent." + \
            " Use updateHoneybee component to update userObjects.\n" + \
            "If you have already updated userObjects drag Honeybee_Honeybee component " + \
            "into canvas and try again."
            w = gh.GH_RuntimeMessageLevel.Warning
            ghenv.Component.AddRuntimeMessage(w, warning)
            return -1
        
        # don't customize this part
        hb_EPSrf = sc.sticky["honeybee_EPSurface"]
        hb_EPSHDSurface = sc.sticky["honeybee_EPShdSurface"]
        hb_RADMaterialAUX = sc.sticky["honeybee_RADMaterialAUX"]
        hb_EPObjectsAux = sc.sticky["honeybee_EPObjectsAUX"]()
        HBScheduleList = sc.sticky["honeybee_ScheduleLib"].keys()

        ########################################################################
        #----------------------------------------------------------------------#
        shdBreps = []
        # create bounding box of shading geometries
        if justBoundingBox:
            for brep in shdSurfaces:
                if brep.Faces.Count>1 or not brep.Faces[0].IsPlanar(sc.doc.ModelAbsoluteTolerance):
                    shdBreps.append(brep.GetBoundingBox(True).ToBrep())
                else:
                    shdBreps.append(brep)
        else:
            shdBreps = shdSurfaces
        
        shadingClasses = []
        shadingMeshPreview = []
        
        if meshingSettings == None:
            mp = rc.Geometry.MeshingParameters.Minimal
            mp.SimplePlanes = True
        else:
            mp = meshingSettings
        
        def getRadMaterialName(radMaterial):
            nameStr = radMaterial.split(" ")[2]
            name =  nameStr.split("\n")[0]
            return name
        
        for brepCount, brep in enumerate(shdBreps):
            if brep != None:
                isPlanar = True
                # check planarity
                for face in brep.Faces:
                    if not face.IsPlanar(tolerance):
                        isPlanar = False
                        break
                
                shadingBreps = []
                if not isPlanar:
                    meshArray = rc.Geometry.Mesh.CreateFromBrep(brep, mp)
                    for mesh in meshArray:
                        for meshFace in range(mesh.Faces.Count):
                            vertices = list(mesh.Faces.GetFaceVertices(meshFace))[1:]
                            vertices = vertices + [sc.doc.ModelAbsoluteTolerance]
                            # create the brep from mesh
                            shdBrep = rc.Geometry.Brep.CreateFromCornerPoints(*vertices)
                            shadingBreps.append(shdBrep)
                else:
                    for face in brep.Faces:
                        shadingBreps.append(face.DuplicateFace(False))
                
                for faceCount, shdBrep in enumerate(shadingBreps):
                        thisShading = hb_EPSHDSurface(shdBrep, 1000*brepCount + faceCount, 'shdSrf_' + `brepCount` + '_' + `faceCount` + "_" + str(uuid.uuid4()))
                        
                        # add transmittance schedule if any
                        if EPTransSchedule!=None:
                            schedule= EPTransSchedule.upper()
                            if schedule!=None and not schedule.lower().endswith(".csv") and schedule not in HBScheduleList:
                                msg = "Cannot find " + schedule + " in Honeybee schedule library."
                                print msg
                                ghenv.Component.AddRuntimeMessage(gh.GH_RuntimeMessageLevel.Warning, msg)
                                return -1
                            elif schedule!=None and schedule.lower().endswith(".csv"):
                                # check if csv file is existed
                                if not os.path.isfile(schedule):
                                    msg = "Cannot find the shchedule file: " + schedule
                                    print msg
                                    ghenv.Component.AddRuntimeMessage(gh.GH_RuntimeMessageLevel.Warning, msg)
                                    return -1
                            
                            thisShading.TransmittanceSCH = schedule
                        
                        # add the Rad Material if any
                        if RADMaterial!=None:
                            # if it is just the name of the material make sure it is already defined
                            if len(RADMaterial.split(" ")) == 1:
                                # if the material is not in the library add it to the library
                                if not hb_RADMaterialAUX.isMatrialExistInLibrary(RADMaterial):
                                    warningMsg = "Can't find " + RADMaterial + " in RAD Material Library.\n" + \
                                                "Add the material to the library and try again."
                                    ghenv.Component.AddRuntimeMessage(gh.GH_RuntimeMessageLevel.Warning, warningMsg)
                                    return
                                
                                try:
                                    thisShading.setRADMaterial(RADMaterial)
                                except Exception, e:
                                    print e
                                    warningMsg = "You are using an old version of Honeybee_Honeybee! Update your files and try again."
                                    print warningMsg
                                    ghenv.Component.AddRuntimeMessage(gh.GH_RuntimeMessageLevel.Warning, warningMsg)
                                    return
                                
                                addedToLib = True
                            else:
                                
                                # try to add the material to the library
                                addedToLib, thisShading.RadMaterial = hb_RADMaterialAUX.analyseRadMaterials(RADMaterial, True)
                                
                            if addedToLib==False:
                                warningMsg = "Failed to add " + RADMaterial + " to the Library."
                                ghenv.Component.AddRuntimeMessage(gh.GH_RuntimeMessageLevel.Warning, warningMsg)
                                return
                        
                        # add shading to the list
                        shadingClasses.append(thisShading)
                
        # add to the hive
        hb_hive = sc.sticky["honeybee_Hive"]()
        HBContext  = hb_hive.addToHoneybeeHive(shadingClasses, ghenv.Component.InstanceGuid.ToString())
        return HBContext
        ################################################################################################
    else:
        print "You should first let Honeybee to fly..."
        w = gh.GH_RuntimeMessageLevel.Warning
        ghenv.Component.AddRuntimeMessage(w, "You should first let Honeybee to fly...")
        return -1
        

if _shdSurfaces and _shdSurfaces[0]!=None:
    # add cleaning function
    result= main(_shdSurfaces, EPTransSchedule_, meshingSettings_, justBoundingBox_)
    
    if result != -1: HBContext = result
# ---------- end hb_epcontextsrf ----------

number_slider = Slider(90, range=0..100)
northarrow = Ladybug_North(north=number_slider, scale=".05")  # -> northSign; plug-in component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

panel_5 = Panel("http://apps1.eere.energy.gov/buildings/energyplus/weatherdata/6_europe_wmo_region_6/GBR_London.Gatwick.037760_IWEC.zip")
createhbzones = Honeybee_createHBZones(name="test_room", zoneProgram=item_3, HBSurfaces=flatten(brep_3), isConditioned=Toggle(False))  # -> readMe, HBZone; plug-in component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
flip = Flip(Surface=floor)  # -> Surface, Result
open_weather_file = Ladybug_OpenEPWWeatherFile(open=panel_5)  # -> epwFile; plug-in component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

# ---- group: LONDON
path = FilePath("C:\Users\kksenia\Desktop\Building Simulations\week 3\London weather data\GBR_London.Gatwick.037760_IWEC.epw")

# ---- group: Room with shading
brep_6 = Brep([brep_3, hb_epcontextsrf])

# ----
gentestpts = Honeybee_GenerateTestPoints(testSurface=flip.Surface, gridSize=".5", distBaseSrf=".762", moveTestMesh=True)  # -> readMe, simplify(testPoints), simplify(ptsVectors), simplify(facesArea), simplify(mesh); plug-in component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
radparameters = Honeybee_RADParameters(quality=0)  # -> readMe, radParameters; plug-in component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
decomposebybc = Honeybee_DecomposeBasedOnBoundaryCondition(HBZone=createhbzones.HBZone)  # -> outdoors, surface, adiabatic, ground; plug-in component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
brep_7 = Brep(decomposebybc.outdoors)
annualdaylightsimulation = Honeybee_AnnualDaylightSimulation(
    north=number_slider,
    epwWeatherFile=open_weather_file,
    testPoints=gentestpts.testPoints,
    ptsVectors=gentestpts.ptsVectors,
    testMesh=gentestpts.mesh,
    radParameters=radparameters.radParameters)  # -> analysisRecipe; plug-in component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
toggle = BooleanToggle(True)
importepw = Ladybug_ImportEpw(epwFile=open_weather_file)  # -> readMe, latitude, location, dryBulbTemperature, dewPointTemperature, relativeHumidity, windSpeed, windDirection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; plug-in component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
rundaylightanalysis = Honeybee_RunDaylightSimulation(
    HBObjects=flatten(brep_6),
    analysisRecipe=annualdaylightsimulation,
    writeRad=toggle,
    runRad=toggle,
    numOfCPUs=Slider(3, range=0..10),
    overwriteResults=True)  # -> readMe, analysisType, resultsUnit, results, testPts, annual_analysis_files, radGeoFile, studyFolder, done; plug-in component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
setepnatvent = Honeybee_SetEPAirFlow(
    HBZones=createhbzones.HBZone,
    naturalVentilationType="1",
    minIndoorTempForNatVent="24",
    maxOutdoorTempForNatVent="29",
    fractionOfGlzAreaOperable="0.6")  # -> readMe, simplify(HBZones); plug-in component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
separatedata = Ladybug_SeparateData(inputList=flatten(importepw.dryBulbTemperature))  # -> numbers, strings; plug-in component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
readannualresultsi = Honeybee_ReadAnnualResultI(
    illFilesAddress=rundaylightanalysis.annual_analysis_files,
    testPoints=simplify(rundaylightanalysis.testPts),
    DLAIllumThresholds=300,
    runIt=Toggle(True))  # -> DLA, UDLI_Less_100, UDLI_100_2000, UDLI_More_2000, CDA, sDA, annualProfiles, htmReport; plug-in component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
_3dchart = Ladybug_3DChart(inputData=flatten(importepw.dryBulbTemperature), xScale="0.25")  # -> readMe, graphMesh, graphCurves, legend, legendBasePts, title, titleBasePts, dataPts, conditionalHOY; plug-in component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
larger = LargerThan(FirstNumber=separatedata.numbers, SecondNumber="25")  # -> LargerThan, OrEqualTo
set_the_view_to_fisheye_for_glare_analys = Panel("1")  # "set the view to FishEye for Glare Analysis"
num = Number(larger.LargerThan)
radparameters_2 = Honeybee_RADParameters(quality=0, ab="3")  # -> readMe, radParameters; plug-in component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
panel_6 = Panel("20")
legendpar = Ladybug_LegendParameters(lowBound=Slider(10, range=0..10), highBound=Slider(80, range=0..100))  # -> legendPar; plug-in component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
panel_7 = Panel(num)
recolormesh = Ladybug_RecolorMesh(
    analysisResult=readannualresultsi.DLA,
    inputMesh=gentestpts.mesh,
    legendPar=legendpar,
    analysisTitle="more than 300",
    legendTitle="%")  # -> readMe, newMesh, newLegend, legendBasePt, meshColors, legendColors; plug-in component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
recolormesh_2 = Ladybug_RecolorMesh(
    analysisResult=readannualresultsi.UDLI_100_2000,
    inputMesh=gentestpts.mesh,
    legendPar=legendpar,
    analysisTitle="100-2000",
    legendTitle="%")  # -> readMe, newMesh, newLegend, legendBasePt, meshColors, legendColors; plug-in component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
recolormesh_3 = Ladybug_RecolorMesh(
    analysisResult=readannualresultsi.UDLI_More_2000,
    inputMesh=gentestpts.mesh,
    legendPar=legendpar,
    analysisTitle="more than 2000",
    legendTitle="%")  # -> readMe, newMesh, newLegend, legendBasePt, meshColors, legendColors; plug-in component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
csvschedule_2 = Honeybee_CreateCSVSchedule(values=panel_7, writeFile=Toggle(True))  # -> readMe, flatten(csvSchedule); plug-in component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
toggle_2 = BooleanToggle(True)
md_slider = MDSlider(
    slider_value=Point(0.6067817502, 0.5254873881, 0.5),
    SliderMode=0,
    x_domain=Domain(-1, 1),
    y_domain=Domain(-1, 1),
    z_domain=Domain(0, 1))
toggle_3 = BooleanToggle(True)
epoutput = Honeybee_GenerateEPOutput(
    zoneEnergyUse=toggle_3,
    zoneGainsAndLosses=toggle_3,
    zoneComfortMetrics=toggle_3,
    surfaceTempAnalysis=toggle_3,
    glazingSolarAnalysis=toggle_3,
    timestep="hourly")  # -> report, flatten(simulationOutputs); plug-in component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
toggle_4 = BooleanToggle(True)
runenergysimulation = Honeybee_RunEnergySimulation(
    north=number_slider,
    epwFile=open_weather_file,
    HBZones=flatten(setepnatvent.HBZones),
    HBContext=flatten(hb_epcontextsrf),
    simulationOutputs=flatten(epoutput.simulationOutputs),
    writeIdf=toggle_4,
    runEnergyPlus=toggle_4)  # -> report, idfFileAddress, resultFileAddress; plug-in component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
readepresult = Honeybee_ReadEPResult(resultFileAddress=runenergysimulation.resultFileAddress)  # -> port, port_2, port_3, port_4, electricLight, electricEquip, fanElectric, port_5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; plug-in component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
panel_8 = Panel("""Cooling, Heating
& Lighting Loads""")
separatedata_2 = Ladybug_SeparateData(inputList=flatten(readepresult.port_3))  # -> numbers, strings; plug-in component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
separatedata_3 = Ladybug_SeparateData(inputList=flatten(readepresult.port_4))  # -> numbers, strings; plug-in component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
outdoorcomfortcalculator = Ladybug_OutdoorComfortCalculator(
    dryBulbTemperature=readepresult.airTemperature,
    meanRadiantTemperature=readepresult.meanRadTemperature,
    windSpeed_tenMeters=".5",
    relativeHumidity=readepresult.relativeHumidity,
    runIt=Toggle(True))  # -> readMe, port, universalThermalClimateIndex, comfortableOrNot, thermalStress, conditionOfPerson, port_2, percentOfTimeComfortable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; plug-in component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
barchart = Ladybug_MonthlyBarChart(
    inputData=flatten([readepresult.port_3, readepresult.electricLight, readepresult.port_4]),
    altYAxisTitle=panel_8,
    basePoint="20, 0, 0",
    xScale=Slider(0.5, range=0..1),
    yScale=Slider(0.7, range=0..1))  # -> readMe, dataMesh, dataCurves, dataCrvColors, graphAxes, graphLabels, title, titleBasePt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; plug-in component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
adaptivecomfortcalculator = Ladybug_AdaptiveComfortCalculator(
    dryBulbTemperature=readepresult.airTemperature,
    meanRadiantTemperature=readepresult.meanRadTemperature,
    prevailingOutdoorTemp=importepw.dryBulbTemperature,
    windSpeed=".5",
    runIt=Toggle(True))  # -> readMe, port, comfortableOrNot, conditionOfPerson, degreesFromTarget, port_2, targetTemperature, upperTemperatureBound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; plug-in component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
ma = MassAddition(Input=separatedata_2.numbers)  # -> Result, PartialResults
ma_2 = MassAddition(Input=separatedata_3.numbers)  # -> Result, PartialResults
num_2 = Number(Slider(1, range=0..1))
total_cooling = Panel(ma.Result)
total_heating = Panel(ma_2.Result)
doy_hoy = Ladybug_DOY_HOY(days="21", months="7", hours="9")  # -> HOY, DOY, date; plug-in component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
panel_9 = Panel(adaptivecomfortcalculator.conditionOfPerson)
panel_10 = Panel(adaptivecomfortcalculator.percentHotCold)
panel_11 = Panel(adaptivecomfortcalculator.percentOfTimeComfortable)
legendpar_2 = Ladybug_LegendParameters(lowBound="18", highBound="28")  # -> legendPar; plug-in component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
genavgsky = Honeybee_GenerateAverageSky(north=number_slider, weatherFile=open_weather_file, month="7", hour="9")  # -> radiationValues, skyFilePath; plug-in component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
# Analysis Recipe
imagebasedsimulation = Honeybee_ImageBasedSimulation(
    skyFile=genavgsky.skyFilePath,
    cameraType=set_the_view_to_fisheye_for_glare_analys,
    simulationType=2,
    radParameters=radparameters_2.radParameters,
    backupImages=0)  # -> analysisRecipe; plug-in component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
# Run the analysis
rundaylightanalysis_2 = Honeybee_RunDaylightSimulation(
    HBObjects=flatten(brep_6),
    analysisRecipe=imagebasedsimulation,
    writeRad=toggle_2,
    runRad=toggle_2,
    numOfCPUs="4",
    radFileName=doy_hoy.date,
    overwriteResults=True)  # -> readMe, analysisType, resultsUnit, results, testPts, luminance_files, radGeoFile, studyFolder, done; plug-in component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
glareanalysis = Honeybee_GlareAnalysis(HDRImagePath=rundaylightanalysis_2.luminance_files, runIt=Toggle(True))  # -> readMe, glareCheckImage, DGP, DGI, imageWithTaskArea; plug-in component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
falsecolor = Honeybee_FalseColor(
    HDRFilePath=rundaylightanalysis_2.luminance_files,
    contourBands=False,
    maskThreshold=0.1,
    useAlterColors=False,
    render=Toggle(True))  # -> outputFilePath; plug-in component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
# DGP: Daylight glare probability:
# Imperceptible Glare [0.35 > DGP]
# Perceptible Glare [0.4 > DGP >= 0.35]
# Disturbing Glare [0.45 > DGP >= 0.4]
# Intolerable Glare [DGP >= 0.45]
panel_12 = Panel(glareanalysis.DGP)
hdr_tif = Honeybee_ConvertHDRToTIF(HDRFilePath=glareanalysis.glareCheckImage, adjustExposure=Toggle(False))  # -> TIFFFilePath; plug-in component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
hdr_tif_2 = Honeybee_ConvertHDRToTIF(HDRFilePath=falsecolor, adjustExposure=False)  # -> TIFFFilePath; plug-in component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
image = ImageFromPath(P=hdr_tif, S=num_2)
genclimatebasedsky = Honeybee_GenerateClimateBasedSky(north=number_slider, weatherFile=open_weather_file, month="7", day="21", hour="9")  # -> radiationValues, skyFilePath; plug-in component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
panel_13 = Panel([genclimatebasedsky.radiationValues, genavgsky.radiationValues])
legendpar_3 = Ladybug_LegendParameters(lowBound="-1", highBound="1", numSegments="3")  # -> legendPar; plug-in component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
_3dchart_2 = Ladybug_3DChart(inputData=flatten(outdoorcomfortcalculator.conditionOfPerson), xScale=Slider(0.25, range=0..1), legendPar=legendpar_3)  # -> readMe, graphMesh, graphCurves, legend, legendBasePts, title, titleBasePts, dataPts, conditionalHOY; plug-in component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
image_2 = ImageFromPath(P=hdr_tif_2, S=num_2)
item_4 = ListItem(List=adaptivecomfortcalculator.percentHotCold, Index="1", Wrap=True)
pt = Point(<point referenced from the Rhino model>)
pt_2 = Point(<point referenced from the Rhino model>)
_3dchart_3 = Ladybug_3DChart(inputData=flatten(readepresult.airTemperature), xScale=Slider(0.25, range=0..1), legendPar=legendpar_2)  # -> readMe, graphMesh, graphCurves, legend, legendBasePts, title, titleBasePts, dataPts, conditionalHOY; plug-in component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
_3dchart_4 = Ladybug_3DChart(inputData=flatten(adaptivecomfortcalculator.conditionOfPerson), xScale=Slider(0.25, range=0..1), legendPar=legendpar_3)  # -> readMe, graphMesh, graphCurves, legend, legendBasePts, title, titleBasePts, dataPts, conditionalHOY; plug-in component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
tag = TextTag(Location=pt_2, Text=item_4, Colour=ColourSwatch(SwatchColor=RGB(0, 106, 255)))
tag_2 = TextTag(Location=pt, Text=panel_11)

pt_3 = Point(Point(2.818708588, 1.593326524, 0))
# set the view
comfortmannequin = Ladybug_ComfortMannequin(rotationAngle="175", bodyLocation=pt_3)  # -> mannequinMesh, legend, legendBasePt; plug-in component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

# ---- group: Person's face!
item_5 = ListItem(List=comfortmannequin.mannequinMesh, Index=121, Wrap=True)

# ----
preview = CustomPreview(Geometry=item_5, Shader=ColourSwatch(SwatchColor=RGB(255, 0, 0)))

facen = FaceNormals(Mesh=item_5)  # -> Centers, Normals
settheview = Ladybug_SetTheView(cameraLocation=facen.Centers, cameraDirection=facen.Normals, uvLookAround=md_slider)  # -> readMe; plug-in component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
