# Grasshopper definition Kwan_ShinYi_Final project.gh (Grasshopper 0.9.76)
# plug-ins: Python Interpreter, ItemSelector, embryoA

number_slider = Slider(0, range=0..2)
panel = Panel("""0
30
60""")
number_slider_2 = Slider(0, range=0..2)
number_slider_3 = Slider(1, range=0..1)
item = ListItem(List=panel, Index=number_slider, Wrap=True)
panel_2 = Panel("""0
30
60""")
panel_3 = Panel("""10
30""")
concat = Concatenate(FragmentA="shd3Ang_", FragmentB=item)
item_2 = ListItem(List=panel_2, Index=number_slider_2, Wrap=True)
rad = Radians(Degrees=item)
item_3 = ListItem(List=panel_3, Index=number_slider_3, Wrap=True)
panel_4 = Panel("\")
rad_2 = Radians(Degrees=item_2)
concat_2 = Concatenate(FragmentA="shd2Ang_", FragmentB=item_2)
rad_3 = Radians(Degrees=item_3)
concat_3 = Concatenate(FragmentA="shd1Ang_", FragmentB=item_3)
pt = Point(Point(7.3, 2.985922502, 3.2))
pt_2 = Point(Point(7.3, 2.985922502, 0.9))
pt_3 = Point(Point(7.3, 4.999632001, 3.2))
pt_4 = Point(Point(7.3, 4.999632001, 0.9))
pt_5 = Point(Point(7.3, 7, 3.2))
pt_6 = Point(Point(7.3, 7, 0.9))
vec2pt = Vector2Pt(PointA=pt, PointB=pt_2, Unitize=False)  # -> Vector, Length
vec2pt_2 = Vector2Pt(PointA=pt_3, PointB=pt_4, Unitize=False)  # -> Vector, Length
vec2pt_3 = Vector2Pt(PointA=pt_5, PointB=pt_6, Unitize=False)  # -> Vector, Length
fly = Ladybug_fly(inputSliders=[number_slider_3, number_slider_2, number_slider], fly=Toggle(False))  # -> Vviiiiiiiiiizzz; plug-in component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
pt_7 = Point(Point(8.137089933, 2.985922502, 2.7))
pt_8 = Point(Point(7.3, 2.985922502, 3.2))
pt_9 = Point(Point(7.3, 4, 3.2))
pt_10 = Point(Point(8.137089933, 4.999632001, 2.7))
pt_11 = Point(Point(7.3, 4.999632001, 3.2))
pt_12 = Point(Point(7.3, 6.000005898, 3.2))
pt_13 = Point(Point(8.137089933, 7, 2.7))
pt_14 = Point(Point(7.3, 7, 3.2))
pt_15 = Point(Point(7.3, 6.000005898, 3.2))
pt_16 = Point(Point(7.3, 1, 3.2))
pt_17 = Point(Point(7.3, 1, 0.9))
pt_18 = Point(Point(7.3, 7, 3.2))
pt_19 = Point(Point(7.3, 1, 3.2))
line = LineSDL(Start=pt, Direction=vec2pt.Vector, Length=1)
line_2 = LineSDL(Start=pt_3, Direction=vec2pt_2.Vector, Length=1)
line_3 = LineSDL(Start=pt_5, Direction=vec2pt_3.Vector, Length=1)
vec2pt_4 = Vector2Pt(PointA=pt_16, PointB=pt_17, Unitize=False)  # -> Vector, Length
vec2pt_5 = Vector2Pt(PointA=pt_18, PointB=pt_19, Unitize=False)  # -> Vector, Length
rotax = RotateAxis(Geometry=pt_10, Angle=expr("-x", rad), Axis=line_2)  # -> Geometry, Transform
rotax_2 = RotateAxis(Geometry=pt_7, Angle=expr("-x", rad), Axis=line)  # -> Geometry, Transform
rotax_3 = RotateAxis(Geometry=pt_13, Angle=expr("-x", rad), Axis=line_3)  # -> Geometry, Transform
line_4 = LineSDL(Start=pt_16, Direction=vec2pt_4.Vector, Length=1)
pt_20 = Point(Point(7.3, 1.993031263, 3.2))
pt_21 = Point(Point(7.3, 1.993031263, 0.9))
pt_22 = Point(Point(7.3, 4, 3.2))
pt_23 = Point(Point(7.3, 4, 0.9))
pt_24 = Point(<point referenced from the Rhino model>)
pt_25 = Point(Point(7.3, 4, 3.2))
pt_26 = Point(Point(7.3, 4.999632001, 3.2))
pt_27 = Point(Point(7.3, 6.000005898, 3.2))
pt_28 = Point(Point(7.3, 6.000005898, 0.9))
pt_29 = Point(Point(7.3, 6.000005898, 3.2))
pt_30 = Point(Point(7.3, 7, 3.2))
line_5 = LineSDL(Start=pt_18, Direction=vec2pt_5.Vector, Length=1)
srf4pt = _4PointSurface(CornerA=pt, CornerB=pt_2, CornerC=rotax_2.Geometry)
srf4pt_2 = _4PointSurface(CornerA=pt_8, CornerB=pt_9, CornerC=rotax_2.Geometry)
vec2pt_6 = Vector2Pt(PointA=pt_20, PointB=pt_21, Unitize=False)  # -> Vector, Length
srf4pt_3 = _4PointSurface(CornerA=pt_3, CornerB=pt_4, CornerC=rotax.Geometry)
srf4pt_4 = _4PointSurface(CornerA=pt_11, CornerB=pt_12, CornerC=rotax.Geometry)
srf4pt_5 = _4PointSurface(CornerA=pt_5, CornerB=pt_6, CornerC=rotax_3.Geometry)  # disabled
pt_31 = Point(Point(8.137089933, 1, 3.2))
vec2pt_7 = Vector2Pt(PointA=pt_22, PointB=pt_23, Unitize=False)  # -> Vector, Length
srf4pt_6 = _4PointSurface(CornerA=pt_14, CornerB=pt_15, CornerC=rotax_3.Geometry)  # disabled
vec2pt_8 = Vector2Pt(PointA=pt_27, PointB=pt_28, Unitize=False)  # -> Vector, Length
rotax_4 = RotateAxis(Geometry=pt_24, Angle=expr("-x", rad_3), Axis=line_4)  # -> Geometry, Transform
rotax_5 = RotateAxis(Geometry=pt_31, Angle=expr("-x", rad_3), Axis=line_5)  # -> Geometry, Transform
line_6 = LineSDL(Start=pt_20, Direction=vec2pt_6.Vector, Length=1)
line_7 = LineSDL(Start=pt_22, Direction=vec2pt_7.Vector, Length=1)
line_8 = LineSDL(Start=pt_27, Direction=vec2pt_8.Vector, Length=1)
pt_32 = Point(Point(8.137089933, 1.993031263, 2.7))
pt_33 = Point(Point(8.137089933, 4, 2.05))
pt_34 = Point(Point(8.137089933, 6.000005898, 1.502202842))
rotax_6 = RotateAxis(Geometry=pt_32, Angle=expr("-x", rad_2), Axis=line_6)  # -> Geometry, Transform
rotax_7 = RotateAxis(Geometry=pt_33, Angle=expr("-x", rad_2), Axis=line_7)  # -> Geometry, Transform
rotax_8 = RotateAxis(Geometry=pt_34, Angle=expr("-x", rad_2), Axis=line_8)  # -> Geometry, Transform
srf4pt_7 = _4PointSurface(CornerA=pt_16, CornerB=pt_17, CornerC=rotax_5.Geometry)
srf4pt_8 = _4PointSurface(CornerA=pt_18, CornerB=pt_19, CornerC=rotax_5.Geometry)
pt_35 = Point(Point(7.3, 1.993031263, 3.2))
pt_36 = Point(Point(7.3, 2.985922502, 3.2))
merge = Merge(Data1=srf4pt_7, Data2=srf4pt_8)
srf4pt_9 = _4PointSurface(CornerA=pt_35, CornerB=pt_36, CornerC=rotax_6.Geometry)
srf4pt_10 = _4PointSurface(CornerA=pt_20, CornerB=pt_21, CornerC=rotax_6.Geometry)
srf4pt_11 = _4PointSurface(CornerA=pt_27, CornerB=pt_28, CornerC=rotax_8.Geometry)
srf4pt_12 = _4PointSurface(CornerA=pt_29, CornerB=pt_30, CornerC=rotax_8.Geometry)
srf4pt_13 = _4PointSurface(CornerA=pt_22, CornerB=pt_23, CornerC=rotax_7.Geometry)
srf4pt_14 = _4PointSurface(CornerA=pt_25, CornerB=pt_26, CornerC=rotax_7.Geometry)
merge_2 = Merge(Data1=srf4pt, Data2=srf4pt_2, Data3=srf4pt_3, Data4=srf4pt_4, Data5=srf4pt_5, Data6=srf4pt_6)
merge_3 = Merge(Data1=srf4pt_10, Data2=srf4pt_13, Data3=srf4pt_11, Data4=srf4pt_9, Data5=srf4pt_14, Data6=srf4pt_12)
hb_epcontextsrf = HoneybeeEPContextSurfaces(shdSurfaces=flatten([merge_2, merge_3, merge]))  # -> HBContext; inputs shdSurfaces: list of Brep, justBoundingBox: Boolean
# ---------- hb_epcontextsrf: Python ----------
"""
prepare shading/context geometries

    Args:
        northVectorOrRotation: A vector that shows North or a number that shows
                               the rotation of the North from the Y axis
        bldgMasses: List of closed Breps as thermal zones.
    Returns:
        report: ...
        thermalZones: Thermal zone's geometries for visualiza
"""

ghenv.Component.Name = 'Honeybee EP context Surfaces'
ghenv.Component.NickName = 'HB_EPContextSrf'
ghenv.Component.Message = 'VER 0.0.58\nNOV_20_2015'
ghenv.Component.Category = "Honeybee"
ghenv.Component.SubCategory = "09 | Energy | Energy"
#compatibleHBVersion = VER 0.0.57\nNOV_01_2015
#compatibleLBVersion = VER 0.0.59\nFEB_01_2015
ghenv.Component.AdditionalHelpFromDocStrings = "2"

import rhinoscriptsyntax as rs
import Rhino as rc
import scriptcontext as sc
import os
import System
import Grasshopper.Kernel as gh
import uuid

tolerance = sc.doc.ModelAbsoluteTolerance
import math


def main(shdSurfaces, EPTransSchedule, meshingSettings, justBoundingBox):
    
    # import the classes
    if sc.sticky.has_key('honeybee_release'):

        try:
            if not sc.sticky['honeybee_release'].isCompatible(ghenv.Component): return -1
        except:
            warning = "You need a newer version of Honeybee to use this compoent." + \
            " Use updateHoneybee component to update userObjects.\n" + \
            "If you have already updated userObjects drag Honeybee_Honeybee component " + \
            "into canvas and try again."
            w = gh.GH_RuntimeMessageLevel.Warning
            ghenv.Component.AddRuntimeMessage(w, warning)
            return -1
        
        # don't customize this part
        hb_EPSrf = sc.sticky["honeybee_EPSurface"]
        hb_EPSHDSurface = sc.sticky["honeybee_EPShdSurface"]
        hb_RADMaterialAUX = sc.sticky["honeybee_RADMaterialAUX"]
        hb_EPObjectsAux = sc.sticky["honeybee_EPObjectsAUX"]()
        HBScheduleList = sc.sticky["honeybee_ScheduleLib"].keys()

        ########################################################################
        #----------------------------------------------------------------------#
        shdBreps = []
        # create bounding box of shading geometries
        if justBoundingBox:
            for brep in shdSurfaces:
                if brep.Faces.Count>1 or not brep.Faces[0].IsPlanar(sc.doc.ModelAbsoluteTolerance):
                    shdBreps.append(brep.GetBoundingBox(True).ToBrep())
                else:
                    shdBreps.append(brep)
        else:
            shdBreps = shdSurfaces
        
        shadingClasses = []
        shadingMeshPreview = []
        
        if meshingSettings == None:
            mp = rc.Geometry.MeshingParameters.Minimal
            mp.SimplePlanes = True
        else:
            mp = meshingSettings
        
        def getRadMaterialName(radMaterial):
            nameStr = radMaterial.split(" ")[2]
            name =  nameStr.split("\n")[0]
            return name
        
        for brepCount, brep in enumerate(shdBreps):
            if brep != None:
                isPlanar = True
                # check planarity
                for face in brep.Faces:
                    if not face.IsPlanar(tolerance):
                        isPlanar = False
                        break
                
                shadingBreps = []
                if not isPlanar:
                    meshArray = rc.Geometry.Mesh.CreateFromBrep(brep, mp)
                    for mesh in meshArray:
                        for meshFace in range(mesh.Faces.Count):
                            vertices = list(mesh.Faces.GetFaceVertices(meshFace))[1:]
                            vertices = vertices + [sc.doc.ModelAbsoluteTolerance]
                            # create the brep from mesh
                            shdBrep = rc.Geometry.Brep.CreateFromCornerPoints(*vertices)
                            shadingBreps.append(shdBrep)
                else:
                    for face in brep.Faces:
                        shadingBreps.append(face.DuplicateFace(False))
                
                for faceCount, shdBrep in enumerate(shadingBreps):
                        thisShading = hb_EPSHDSurface(shdBrep, 1000*brepCount + faceCount, 'shdSrf_' + `brepCount` + '_' + `faceCount` + "_" + str(uuid.uuid4()))
                        
                        # add transmittance schedule if any
                        if EPTransSchedule!=None:
                            schedule= EPTransSchedule.upper()
                            if schedule!=None and not schedule.lower().endswith(".csv") and schedule not in HBScheduleList:
                                msg = "Cannot find " + schedule + " in Honeybee schedule library."
                                print msg
                                ghenv.Component.AddRuntimeMessage(gh.GH_RuntimeMessageLevel.Warning, msg)
                                return -1
                            elif schedule!=None and schedule.lower().endswith(".csv"):
                                # check if csv file is existed
                                if not os.path.isfile(schedule):
                                    msg = "Cannot find the shchedule file: " + schedule
                                    print msg
                                    ghenv.Component.AddRuntimeMessage(gh.GH_RuntimeMessageLevel.Warning, msg)
                                    return -1
                            
                            thisShading.TransmittanceSCH = schedule
                        
                        # add the Rad Material if any
                        if RADMaterial!=None:
                            # if it is just the name of the material make sure it is already defined
                            if len(RADMaterial.split(" ")) == 1:
                                # if the material is not in the library add it to the library
                                if not hb_RADMaterialAUX.isMatrialExistInLibrary(RADMaterial):
                                    warningMsg = "Can't find " + RADMaterial + " in RAD Material Library.\n" + \
                                                "Add the material to the library and try again."
                                    ghenv.Component.AddRuntimeMessage(gh.GH_RuntimeMessageLevel.Warning, warningMsg)
                                    return
                                
                                try:
                                    thisShading.setRADMaterial(RADMaterial)
                                except Exception, e:
                                    print e
                                    warningMsg = "You are using an old version of Honeybee_Honeybee! Update your files and try again."
                                    print warningMsg
                                    ghenv.Component.AddRuntimeMessage(gh.GH_RuntimeMessageLevel.Warning, warningMsg)
                                    return
                                
                                addedToLib = True
                            else:
                                
                                # try to add the material to the library
                                addedToLib, thisShading.RadMaterial = hb_RADMaterialAUX.analyseRadMaterials(RADMaterial, True)
                                
                            if addedToLib==False:
                                warningMsg = "Failed to add " + RADMaterial + " to the Library."
                                ghenv.Component.AddRuntimeMessage(gh.GH_RuntimeMessageLevel.Warning, warningMsg)
                                return
                        
                        # add shading to the list
                        shadingClasses.append(thisShading)
                
        # add to the hive
        hb_hive = sc.sticky["honeybee_Hive"]()
        HBContext  = hb_hive.addToHoneybeeHive(shadingClasses, ghenv.Component.InstanceGuid.ToString())
        return HBContext
        ################################################################################################
    else:
        print "You should first let Honeybee to fly..."
        w = gh.GH_RuntimeMessageLevel.Warning
        ghenv.Component.AddRuntimeMessage(w, "You should first let Honeybee to fly...")
        return -1
        

if _shdSurfaces and _shdSurfaces[0]!=None:
    # add cleaning function
    result= main(_shdSurfaces, EPTransSchedule_, meshingSettings_, justBoundingBox_)
    
    if result != -1: HBContext = result
# ---------- end hb_epcontextsrf ----------

# ---- group: north window
northwall_with_opening = Brep(<brep referenced from the Rhino model>)
Y = UnitY(Factor=Slider(0.5, range=0..1))
Z = UnitZ(Factor=Slider(0.5, range=0..1))
addition = Addition(A=Y, B=Z)
area = Area(Geometry=northwall_with_opening)  # -> Area, Centroid
createhbsrfs = Honeybee_createHBSrfs(geometry=northwall_with_opening, srfType="0")  # -> readMe, simplify(HBSurface); plug-in component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
scale = Scale(Geometry=northwall_with_opening, Center=area.Centroid, Factor=Slider(0.5, range=0..1))  # -> Geometry, Transform
move = Move(Geometry=scale.Geometry, Motion=addition)  # -> Geometry, Transform
addhbglz = Honeybee_addHBGlz(HBObj=createhbsrfs.HBSurface, childSurfaces=flatten(move.Geometry))  # -> simplify(HBObjWGLZ); plug-in component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

# ----
epwindowmat = Honeybee_EnergyPlusWindowMaterial(name="tripple", U_Value="0.3", SHGC="0.2", VT="0.5")  # -> EPMaterial; plug-in component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
updatehoneybee = Honeybee_UpdateHoneybee(updateThisFile=Button(), updateAllUObjects=Button())  # -> readMe; plug-in component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
updateladybug = Ladybug_UpdateLadybug(updateThisFile=Button(), updateAllUObjects=Button())  # -> readMe; plug-in component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
honeybee = Honeybee_Honeybee()  # -> Vviiiiiiiiiizzz; plug-in component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
ladybug = Ladybug_Ladybug()  # -> Vviiiiiiiiiizzz; plug-in component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
epconstruction = Honeybee_EnergyPlusConstruction(layer_1=epwindowmat)  # -> EPConstruction; disabled; plug-in component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
exterior_wall = Brep(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)
wall_surface_with_opening = Brep(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)

# ---- group: ceiling
ceiling = Brep([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])

# ----
ledge = Brep(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)

# ---- group: floor
floor = Brep(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)

# ----
walls = Brep([<brep referenced from the Rhino model> x9])
createhbsrfs_2 = Honeybee_createHBSrfs(geometry=wall_surface_with_opening, srfType="0")  # -> readMe, simplify(HBSurface); plug-in component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

# ---- group: addwindow
number_slider_4 = Slider(4, range=0..4)
panel_6 = Panel(""".5
.6
.7
.8
.9""")
item_4 = ListItem(List=panel_6, Index=number_slider_4, Wrap=True)
concat_4 = Concatenate(FragmentA="glzR_", FragmentB=item_4)
glazingcreator = Honeybee_GlazingBasedOnRatio(
    HBObjects=createhbsrfs_2.HBSurface,
    glzRatio=item_4,
    breakUpWindow=Toggle(True),
    breakUpDist="1",
    windowHeight="2.25",
    sillHeight=".9",
    splitGlzVertDist=".9",
    runIt=Toggle(True))  # -> readMe, HBObjWGLZ; plug-in component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
preview = CustomPreview(Geometry=glazingcreator.HBObjWGLZ, Shader=ColourSwatch(SwatchColor=RGBA(80, 222, 255, 160)))

# ----
fly_2 = Ladybug_fly(inputSliders=number_slider_4, fly=Toggle(False))  # -> Vviiiiiiiiiizzz; plug-in component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
createhbsrfs_3 = Honeybee_createHBSrfs(geometry=flatten(exterior_wall), srfType="0")  # -> readMe, simplify(HBSurface); plug-in component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
createhbsrfs_4 = Honeybee_createHBSrfs(geometry=flatten(floor), srfType="2")  # -> readMe, simplify(HBSurface); plug-in component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
createhbsrfs_5 = Honeybee_createHBSrfs(geometry=flatten(ledge), srfType="2")  # -> readMe, simplify(HBSurface); plug-in component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
createhbsrfs_6 = Honeybee_createHBSrfs(geometry=ceiling, srfType="3")  # -> readMe, simplify(HBSurface); plug-in component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
# Geometry Preparation
# Honeybee default materials will be assigned
# based on surface type
createhbsrfs_7 = Honeybee_createHBSrfs(geometry=walls, srfType="0")  # -> readMe, simplify(HBSurface); plug-in component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
glass = Brep(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)
addhbglz_2 = Honeybee_addHBGlz(HBObj=createhbsrfs_2.HBSurface, childSurfaces=flatten(glass))  # -> simplify(HBObjWGLZ); plug-in component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

# ---- group: Make all surfaces except the exterior wall adiabatic
makeadiabatic = Honeybee_MakeAdiabatic()  # -> HBSrfs; plug-in component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

# ----
wires = BrepWireframe(Brep=glazingcreator.HBObjWGLZ, Density=-1)
bldgprograms = Honeybee_bldgPrograms({"Office": 0, "Retail": 1, "MidriseApartment": 2, "PrimarySchool": 3, "SecondarySchool": 4, "SmallHotel": 5, "LargeHotel": 6, "Hospital": 7, "Outpatient": 8, "Warehouse": 9, "SuperMarket": 10, "FullServiceRestaurant": 11, "QuickServiceRestaurant": 12}, selected="MidriseApartment")

# ---- group: collect all honeybee surfaces
brep = Brep(flatten([createhbsrfs_5.HBSurface, createhbsrfs_7.HBSurface, createhbsrfs_6.HBSurface, createhbsrfs_4.HBSurface, glazingcreator.HBObjWGLZ]))

# ----
listzoneprograms = Honeybee_ListZonePrograms(bldgProgram=bldgprograms)  # -> MidriseApartmentZonePrograms; plug-in component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
item_5 = ListItem(List=listzoneprograms, Index=0, Wrap=True)
panel_7 = Panel(item_5)
createhbzones = Honeybee_createHBZones(name="designproposal", zoneProgram=item_5, HBSurfaces=flatten(brep), isConditioned=Toggle(False))  # -> readMe, HBZone; plug-in component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

callfromepconstrlibrary = Honeybee_CallFromEPConstructionLibrary()  # -> ThermMaterials, EPMaterials, EPWindowMaterials, EPConstructions; plug-in component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
callfromepconstrlibrary_2 = Honeybee_CallFromEPConstructionLibrary()  # -> ThermMaterials, EPMaterials, EPWindowMaterials, EPConstructions; plug-in component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
callfromepconstrlibrary_3 = Honeybee_CallFromEPConstructionLibrary()  # -> ThermMaterials, EPMaterials, EPWindowMaterials, EPConstructions; plug-in component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
callfromepconstrlibrary_4 = Honeybee_CallFromEPConstructionLibrary()  # -> ThermMaterials, EPMaterials, EPWindowMaterials, EPConstructions; plug-in component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
searchepconstruction = Honeybee_SearchEPConstruction(
    EPConstrList=callfromepconstrlibrary_2.EPConstructions,
    standard=Slider(3, range=0..10),
    climateZone="3B",
    surfaceType=Slider(4, range=0..10))  # -> EPSelectedConstr; plug-in component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
list = Honeybee_ItemSelector(
    searchepconstruction,
    {"ASHRAE 189.1-2009 EXTWINDOW CLIMATEZONE 3"}, selected="ASHRAE 189.1-2009 EXTWINDOW CLIMATEZONE 3")
searchepconstruction_2 = Honeybee_SearchEPConstruction(
    EPConstrList=callfromepconstrlibrary.EPConstructions,
    standard=Slider(3, range=0..10),
    climateZone="3B",
    surfaceType=Slider(2, range=0..10))  # -> EPSelectedConstr; plug-in component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
list_2 = Honeybee_ItemSelector(
    searchepconstruction_2,
    {"ASHRAE 189.1-2009 ATTICFLOOR CLIMATEZONE 1-8"}, selected="ASHRAE 189.1-2009 ATTICFLOOR CLIMATEZONE 1-8")
searchepconstruction_3 = Honeybee_SearchEPConstruction(
    EPConstrList=callfromepconstrlibrary_4.EPConstructions,
    standard=Slider(3, range=0..10),
    climateZone="3B",
    surfaceType=Slider(1, range=0..10))  # -> EPSelectedConstr; plug-in component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
list_3 = Honeybee_ItemSelector(
    searchepconstruction_3,
    {"ASHRAE 189.1-2009 EXTROOF IEAD CLIMATEZONE 2-5", "ASHRAE 189.1-2009 EXTROOF METAL CLIMATEZONE 2-5"}, selected="ASHRAE 189.1-2009 EXTROOF IEAD CLIMATEZONE 2-5")
searchepconstruction_4 = Honeybee_SearchEPConstruction(
    EPConstrList=callfromepconstrlibrary_3.EPConstructions,
    standard=Slider(3, range=0..10),
    climateZone="3B",
    surfaceType=Slider(0, range=0..10))  # -> EPSelectedConstr; plug-in component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
list_4 = Honeybee_ItemSelector(
    searchepconstruction_4,
    {"ASHRAE 189.1-2009 EXTWALL MASS CLIMATEZONE 3", "ASHRAE 189.1-2009 EXTWALL MASS CLIMATEZONE ALT-RES 3", "ASHRAE 189.1-2009 EXTWALL METAL CLIMATEZONE 1-3", "ASHRAE 189.1-2009 EXTWALL STEELFRAME CLIMATEZONE 1-3", "ASHRAE 189.1-2009 EXTWALL WOODFRAME CLIMATEZONE 1-4"}, selected="ASHRAE 189.1-2009 EXTWALL MASS CLIMATEZONE 3")
setepzonecnstr = Honeybee_SetEPZoneConstruction(
    HBZone=createhbzones.HBZone,
    wallEPConstruction=list_4,
    windowEPConstruction=list,
    roofEPConstruction=list_3,
    floorEPConstruction=list_2)  # -> simplify(modifiedHBZone); plug-in component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

panel_8 = Panel(searchepconstruction_4)
decomposeepconstruction = Honeybee_DecomposeEPConstruction(cnstrName=list_4)  # -> materials, comments, UValue_SI, UValue_IP, RValue_SI, RValue_IP; plug-in component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
panel_9 = Panel(decomposeepconstruction.materials)
pt_37 = Point(Point(5.638987476, -0.2543383982, 0))
wires_2 = BrepWireframe(Brep=createhbzones.HBZone, Density=-1)
flip = Flip(Surface=floor)  # -> Surface, Result

number_slider_5 = Slider(45, range=0..180)
panel_10 = Panel("http://apps1.eere.energy.gov/buildings/energyplus/weatherdata/4_north_and_central_america_wmo_region_4/1_usa/USA_CA_Los.Angeles.Intl.AP.722950_TMY3.zip")
open_epw_stat = Ladybug_OpenEPWAndSTATWeatherFiles(weatherFileURL=panel_10)  # -> epwFile, statFile; plug-in component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
northarrow = Ladybug_North(north=number_slider_5, centerPt=pt_37, scale=".05")  # -> northSign; plug-in component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

importlocation = Ladybug_ImportLocation(epwFile=open_epw_stat.epwFile)  # -> location; plug-in component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
explodelocation = Ladybug_DecomposeLocation(location=importlocation)  # -> locationName, latitude, longitude, timeZone, elevation; plug-in component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
gentestpts = Honeybee_GenerateTestPoints(testGeometry=flip.Surface, gridSize=".5", distBaseSrf=".762", moveTestMesh=True)  # -> readMe, simplify(testPoints), simplify(ptsVectors), simplify(facesArea), simplify(mesh); plug-in component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
panel_11 = Panel("""1
1
1
1
1
1
1
1
1
1
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""")
concat_5 = Concatenate(FragmentB=concat_3, FragmentC=concat_2, FragmentD=concat)
panel_12 = Panel("""1
1
1
1
1
1
1
1
1
1
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""")
csvschedule = Honeybee_CreateCSVSchedule(values=panel_11, scheduleName="InfiltrationSched", writeFile=Toggle(True))  # -> readMe, flatten(csvSchedule); plug-in component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
csvschedule_2 = Honeybee_CreateCSVSchedule(values=panel_12, scheduleName="LightingSched", writeFile=Toggle(True))  # -> readMe, flatten(csvSchedule); plug-in component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
radparameters = Honeybee_RADParameters(quality="1")  # -> readMe, radParameters; plug-in component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
panel_13 = Panel("1")
panel_14 = Panel(concat_5)
concat_6 = Concatenate(FragmentA="c:\ladybug\", FragmentB="0.4\", FragmentD="-", FragmentF="h")
list_5 = Honeybee_ItemSelector(
    listzoneprograms,
    {"MidriseApartment::Apartment", "MidriseApartment::Office", "MidriseApartment::Corridor"}, selected="MidriseApartment::Apartment")  # disabled
panel_15 = Panel(concat_6)
panel_16 = Panel("corridor")  # disabled
captureview = Ladybug_CaptureView(
    fileName=concat_5,
    folder="C:\ladybug\screenshot",
    viewNames="3droom",
    imageWidth="800",
    imageHeight="800",
    capture=Toggle(False))  # -> imagePath; plug-in component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
toggle = BooleanToggle(False)  # disabled
toggle_2 = BooleanToggle(True)  # disabled
brep_2 = Brep(<brep referenced from the Rhino model>)  # disabled
mass2zone = Honeybee_Masses2Zones(
    zoneMasses=flatten(brep_2),
    zoneNames=panel_16,
    zonePrograms=list_5,
    isConditioned=toggle,
    maxRoofAngle=30,
    createHBZones=toggle_2)  # -> readMe, HBZones; disabled; plug-in component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
brep_3 = Brep([<brep referenced from the Rhino model> x11])
createhbsrfs_8 = Honeybee_createHBSrfs(geometry=brep_3)  # -> readMe, simplify(HBSurface); plug-in component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
pt_38 = Point(Point(2.992425051, 2.302596534, 0))
toggle_3 = BooleanToggle(True)  # disabled
wires_3 = BrepWireframe(Brep=mass2zone.HBZones, Density=-1)  # disabled
comfortmannequin = Ladybug_ComfortMannequin(rotationAngle="175", bodyLocation=pt_38)  # -> mannequinMesh, legend, legendBasePt; plug-in component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
pt_39 = ConstructPoint(XCoordinate="10", YCoordinate=".5", ZCoordinate=0)
toggle_4 = BooleanToggle(True)
pt_40 = ConstructPoint(XCoordinate="15", YCoordinate=0, ZCoordinate=0)
toggle_5 = BooleanToggle(True)
epoutput = Honeybee_GenerateEPOutput(
    zoneEnergyUse=toggle_5,
    zoneGainsAndLosses="False",
    zoneComfortMetrics=toggle_5,
    surfaceTempAnalysis="False",
    timestep="hourly")  # -> report, flatten(simulationOutputs); plug-in component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
item_6 = ListItem(List=comfortmannequin.mannequinMesh, Index=Slider(121, range=0..1000), Wrap=True)
preview_2 = CustomPreview(Geometry=item_6, Shader=ColourSwatch(SwatchColor=RGB(255, 0, 0)))
md_slider = MDSlider(
    slider_value=Point(0.4850776486, 0.5068270055, 0.5),
    SliderMode=0,
    x_domain=Domain(-1, 1),
    y_domain=Domain(-1, 1),
    z_domain=Domain(0, 1))
facen = FaceNormals(Mesh=item_6)  # -> Centers, Normals
panel_17 = Panel("kwh")
toggle_6 = BooleanToggle(False)

# ----
# Run Annual Daylight
# Generate lighting Schedule
radparameters_2 = Honeybee_RADParameters(quality=0)  # -> readMe, radParameters; plug-in component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
number_slider_6 = Slider(100, range=0..100)
number_slider_7 = Slider(300, range=0..1000)
item_7 = ListItem(List=gentestpts.testPoints, Index="11", Wrap=True)
points = PointList(Points=gentestpts.testPoints)
annualdaylightsimulation = Honeybee_AnnualDaylightSimulation(
    north=number_slider_5,
    epwWeatherFile=open_epw_stat.epwFile,
    testPoints=gentestpts.testPoints,
    ptsVectors=gentestpts.ptsVectors,
    testMesh=gentestpts.mesh,
    radParameters=radparameters_2.radParameters)  # -> analysisRecipe; plug-in component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
sph = Sphere(Base=item_7, Radius=Slider(0.1, range=0..0.1))
gethbzoneepschedules = Honeybee_GetZoneEnergyPlusSchedules(HBZone=setepzonecnstr)  # -> occupancySchedule, occupancyActivitySch, heatingSetPtSchedule, coolingSetPtSchedule, lightingSchedule, equipmentSchedule, infiltrationSchedule; plug-in component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
lightingcontrol = Honeybee_LightingControlRecipe(
    controlType="4",
    sensorPoints=item_7,
    lightingPower=250,
    lightingSetpoint=Slider(500, range=0..1000),
    ballastLossFactor=20,
    standbyPower=3,
    delayTime=5)  # -> lightingControlGroup; plug-in component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
toggle_7 = BooleanToggle(False)
occupancygenerator = Honeybee_DaysimOccupancyGenerator(weekendDays=[1, 2], writeTheOcc=Toggle(True))  # -> occupancyFile; plug-in component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
rundaylightanalysis = Honeybee_RunDaylightSimulation(
    HBObjects=flatten([setepzonecnstr, hb_epcontextsrf]),
    analysisRecipe=annualdaylightsimulation,
    writeRad=toggle_7,
    runRad=toggle_7,
    numOfCPUs=Slider(6, range=0..10),
    workingDir="c:\ladybug\design",
    radFileName=concat_5,
    overwriteResults=True)  # -> readMe, analysisType, resultsUnit, results, testPts, resultFiles, radGeoFile, studyFolder, done; plug-in component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
readannualresultsi = Honeybee_ReadAnnualResultI(
    illFilesAddress=rundaylightanalysis.resultFiles,
    testPoints=simplify(rundaylightanalysis.testPts),
    occupancyFiles=gethbzoneepschedules.lightingSchedule,
    DLAIllumThresholds=300,
    lightingControlGroups=lightingcontrol,
    runIt=Toggle(False))  # -> DLA, UDLI_Less_100, UDLI_100_2000, UDLI_More_2000, CDA, sDA, annualProfiles, htmReport; plug-in component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
path = FilePath(readannualresultsi.annualProfiles)
panel_18 = Panel(readannualresultsi.sDA)
legendpar = Ladybug_LegendParameters(lowBound="0", highBound="100", legendLocation=pt_40)  # -> legendPar; plug-in component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
panel_19 = Panel("%")
recolormesh = Ladybug_RecolorMesh(analysisResult=readannualresultsi.UDLI_More_2000, inputMesh=gentestpts.mesh, legendPar=legendpar, analysisTitle=concat_5)  # -> readMe, newMesh, newLegend, legendBasePt, meshColors, legendColors; plug-in component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

# ---- group: just for visualization
# Compare Schedules!
dsannualprofiles = Honeybee_DaysimAnnualProfiles(annualProfiles=path)  # -> simplify(occupancyProfile), simplify(shadingProfiles), simplify(lightingControlProfiles), simplify(dgpProfile); plug-in component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
convertepschvalues = Honeybee_ConvertEnergyPlusScheduleToValues(schName=gethbzoneepschedules.lightingSchedule)  # -> values; plug-in component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
_3dchart = Ladybug_3DChart(inputData=flatten(dsannualprofiles.lightingControlProfiles))  # -> readMe, graphMesh, graphCurves, legend, legendBasePts, title, titleBasePts, dataPts, conditionalHOY; plug-in component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

# ----
# update lighting schedule
setepzoneschedules = Honeybee_SetEnergyPlusZoneSchedules(
    HBZones=setepzonecnstr,
    lightingSchedules=readannualresultsi.annualProfiles,
    infiltrationSchedules=csvschedule.csvSchedule)  # -> schedules, simplify(HBZones); plug-in component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

setepzoneloads = Honeybee_SetEnergyPlusZoneLoads(HBZones=setepzoneschedules.HBZones, infiltrationRatePerArea="0.0002", lightingDensityPerArea="15")  # -> loads, HBZones; plug-in component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

solveadjc = Honeybee_SolveAdjacencies(HBZones=flatten([setepzoneloads.HBZones, mass2zone.HBZones]), removeCurrentAdjc=False, findAdjc=toggle_3)  # -> readMe, HBZonesWADJ; disabled; plug-in component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
makeadiabaticbytype = Honeybee_MakeAdiabaticByType(
    HBZones=setepzoneschedules.HBZones,
    roofs=toggle_4,
    ceilings=toggle_4,
    floors=toggle_4,
    exposedFloors=toggle_4,
    groundFloors=toggle_4)  # -> HBZones; plug-in component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
settheview = Ladybug_SetTheView(cameraLocation=facen.Centers, cameraDirection=facen.Normals, uvLookAround=md_slider, lensLength=Slider(18, range=0..100))  # plug-in component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
number_slider_8 = Slider(0, range=0..18)
fly_3 = Ladybug_fly(inputSliders=number_slider_8, fly=Toggle(False))  # -> Vviiiiiiiiiizzz; plug-in component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

# ---- group: ventilation
setepnatvent = Honeybee_SetEPAirFlow(HBZones=makeadiabaticbytype, naturalVentilationType="1", minIndoorTempForNatVent="24", maxOutdoorTempForNatVent="28")  # -> readMe, simplify(HBZones); plug-in component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
zoneattributelist = Honeybee_ZoneAttributeList({"Name": "name", "Zone Program": "zoneProgram", "Zone Floor Area": "zoneFloorArea", "Zone Volume": "zoneVolume", "Building Program": "bldgProgram", "Is Conditioned": "isConditioned", "Occupancy Schedule": "occupancySchedule", "Occupancy Activity Schedule": "occupancyActivitySch", "Heating SetPoint Schedule": "heatingSetPtSchedule", "Cooling SetPoint Schedule": "coolingSetPtSchedule"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}, selected="Natural Ventilation": "natVent")
labelzones = Honeybee_LabelZones(HBZones=flatten(setepnatvent.HBZones), attribute=zoneattributelist)  # -> zoneTxtLabels, labelBasePts, brepTxtLabels, zoneWireFrames; plug-in component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

# ----
# Run the analysis
runenergysimulation = Honeybee_RunEnergySimulation(
    north=number_slider_5,
    epwFile=open_epw_stat.epwFile,
    HBZones=flatten(setepnatvent.HBZones),
    HBContext=flatten(hb_epcontextsrf),
    simulationOutputs=flatten(epoutput.simulationOutputs),
    writeIdf=toggle_6,
    runEnergyPlus=toggle_6,
    workingDir="c:\ladybug\design",
    idfFileName=concat_4)  # -> report, idfFileAddress, resultFileAddress; plug-in component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
lookupfolder = LookUpFolder(
    MasterDir=runenergysimulation.resultFileAddress,
    subStudyFolder="EnergyPlus",
    itemIndex=number_slider_8,
    refresh=Button(ExpressionNormal="true", ExpressionPressed="False"))  # -> NameList, DirList, Name, resultFiles; inputs itemIndex: Int32
# ---------- lookupfolder: Python ----------
ghenv.Component.Message = 'VER 0.0.02\nDEC_05_2015'

import os
MasterDir = str(MasterDir)
DirList = []
resultFiles = []

if refresh == 1:
    NameList = os.listdir( MasterDir )
    NameList.sort()
    for i in NameList:
        DirList.append(MasterDir+"\\" + str(i)+ "\\"+subStudyFolder)
    if itemIndex != None:
        Name = NameList[itemIndex]
        resultDir = DirList[itemIndex]
    #print resultFiles
    
    if subStudyFolder == "EnergyPlus":
        fileNames = os.listdir( resultDir )
        fileNames.sort()
        for fileName in fileNames:
            #print fileName
            if fileName.find(str(Name)+".csv") != -1:
                print fileName
                resultFiles.append(resultDir+"\\"+ fileName)
# ---------- end lookupfolder ----------
panel_20 = Panel(lookupfolder.NameList)
panel_21 = Panel(lookupfolder.Name)
readepresult = Honeybee_ReadEPResult(resultFileAddress=runenergysimulation.resultFileAddress)  # -> totalThermalEnergy, thermalEnergyBalance, cooling, heating, electricLight, electricEquip, fanElectric, pumpElectric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; plug-in component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
list_6 = ValueList({"One": 1, "zero": 0}, selected="One")
importepw = Ladybug_ImportEpw(epwFile=open_epw_stat.epwFile)  # -> readMe, latitude, location, dryBulbTemperature, dewPointTemperature, relativeHumidity, windSpeed, windDirection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; plug-in component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
branch = TreeBranch(Tree=readepresult.relativeHumidity, Path=list_6, MaintainPaths=True)  # disabled
branch_2 = TreeBranch(Tree=readepresult.airTemperature, Path=list_6, MaintainPaths=True)  # disabled
lookupfolder_daylighting = Honeybee_LookupDaylightingFolder()  # -> analysisType, resultsUnit, resultFiles, ptsFiles, hdrFiles, imageFiles, epwFile, radianceFiles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; plug-in component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
importepw_2 = Ladybug_ImportEpw(epwFile=open_epw_stat.epwFile)  # -> readMe, latitude, location, dryBulbTemperature, dewPointTemperature, relativeHumidity, windSpeed, windDirection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; plug-in component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
gallery = ImageGallery(
    CycleDelay=30,
    Randomize=False,
    UseLocalImages=True,
    UseRemoteImages=True,
    RemoteUrl="c:/ladybug/cladybug0.1/imageBasedSimulation//cladybug01_IMG_mimi_chkFile.GIF")
panel_22 = Panel("""1
.9
.8
.6""")
panel_23 = Panel("""0
.25
.5
1""")
psychchart = Ladybug_PsychrometricChart(
    dryBulbTemperature=branch_2,
    relativeHumidity=branch,
    barometricPressure=importepw.barometricPressure,
    windSpeed=panel_23,
    metabolicRate=panel_22,
    mergeComfPolygons=Toggle(True),
    runIt=Toggle(True))  # -> readMe, port, totalComfortPercent, totalComfortOrNot, strategyNames, strategyPercentOfTime, strategyOrNot, port_2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; plug-in component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
toggle_8 = BooleanToggle(True)
panel_24 = Panel(psychchart.totalComfortPercent)
pmvcomfortcalculator = Ladybug_PMVComfortCalculator(
    dryBulbTemperature=readepresult.airTemperature,
    meanRadiantTemperature=readepresult.meanRadTemperature,
    relativeHumidity=readepresult.relativeHumidity,
    calcBalanceTemperature=False,
    runIt=toggle_8)  # -> readMe, port, predictedMeanVote, percentPeopleDissatisfied, standardEffectiveTemperature, port_2, comfortableOrNot, percentOfTimeComfortable, port_3, balanceTemperature; plug-in component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
adaptivecomfortcalculator = Ladybug_AdaptiveComfortCalculator(
    dryBulbTemperature=readepresult.airTemperature,
    meanRadiantTemperature=readepresult.meanRadTemperature,
    prevailingOutdoorTemp=importepw.dryBulbTemperature,
    runIt=toggle_8)  # -> readMe, port, comfortableOrNot, conditionOfPerson, degreesFromTarget, port_2, targetTemperature, upperTemperatureBound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; plug-in component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

pt_41 = ConstructPoint(XCoordinate=0, YCoordinate="300", ZCoordinate=0)
legendpar_2 = Ladybug_LegendParameters(lowBound="0", highBound="1000", legendLocation=pt_41)  # -> legendPar; plug-in component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
panel_26 = Panel("7")
panel_27 = Panel("8")
panel_28 = Panel("9")
panel_29 = Panel("3")
panel_30 = Panel("6")
panel_31 = Panel("15")
point = Point(<point referenced from the Rhino model>)
pt_42 = Point(<point referenced from the Rhino model>)
_3dchart_2 = Ladybug_3DChart(inputData=flatten(importepw_2.dryBulbTemperature), basePoint=pt_42, xScale=".25", zScale="0")  # -> readMe, graphMesh, graphCurves, legend, legendBasePts, title, titleBasePts, dataPts, conditionalHOY; plug-in component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
sunpath = Ladybug_SunPath(
    north=number_slider_5,
    location=importepw_2.location,
    hour=["9", "12"],
    day="21",
    month=["12", "1", "2"],
    timeStep=Slider(0.2, range=0..1),
    centerPt=point,
    sunPathScale=".75",
    sunScale="1",
    annualHourlyData=flatten(importepw_2.globalHorizontalRadiation),
    legendPar=legendpar_2,
    dailyOrAnnualSunPath=True)  # -> readMe, sunVectors, sunAltitudes, sunAzimuths, port, sunSpheresMesh, sunPathCrvs, legend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; plug-in component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
ln = Line(StartPoint=sunpath.sunPathCenPts, EndPoint=sunpath.sunPositions)
panel_32 = Panel(ln)
item_8 = ListItem(List=ln, Index=0, Wrap=True)  # -> Item, Item1, Item2, Item3, Item4, Item5
point_2 = Point([<point referenced from the Rhino model> x3])
loft = Loft(
    Curves=[item_8.Item5, item_8.Item4],
    Options={Adjust=False, Closed=False, LoftEnds=0, LoftSimp=0, LoftType=0, Rebuild=10, Refit=0.01})
loft_2 = Loft(
    Curves=[item_8.Item1, item_8.Item],
    Options={Adjust=False, Closed=False, LoftEnds=0, LoftSimp=0, LoftType=0, Rebuild=10, Refit=0.01})
loft_3 = Loft(
    Curves=[item_8.Item3, item_8.Item2],
    Options={Adjust=False, Closed=False, LoftEnds=0, LoftSimp=0, LoftType=0, Rebuild=10, Refit=0.01})
custom_preview = CustomPreview(Geometry=[sunpath.sunPathCrvs, sunpath.sunSpheresMesh], Shader=ColourSwatch(SwatchColor=RGBA(178, 178, 178, 118)))
subtraction = Subtraction(A=point_2, B=sunpath.sunPathCenPts)
orient2camera = Ladybug_OrientToCamera(initPosition=sunpath.sunPositions)  # -> orientedToCam; plug-in component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
move_2 = Move(Geometry=ln, Motion=subtraction)  # -> Geometry, Transform
timer = Timer(TimerInterval=1000, Target=orient2camera)
preview_3 = CustomPreview(Geometry=[loft_3, loft_2, loft], Shader=ColourSwatch(SwatchColor=RGBA(255, 255, 45, 41)))
Z_2 = UnitZ(Factor=Slider(5, range=0..10))
pipe = Pipe(Curve=ln, Radius=".01", Caps=0)
move_3 = Move(Geometry=orient2camera, Motion=Z_2)  # -> Geometry, Transform
tag = TextTag3D(
    Location=move_3.Geometry,
    Text=sunpath.sunPositionsInfo,
    Size="6",
    Colour=ColourSwatch(SwatchColor=RGB(0, 0, 0)),
    Justification=7)
custom_preview_2 = CustomPreview(Geometry=pipe, Shader=ColourSwatch(SwatchColor=RGB(6, 166, 207)))

selectandaveragedata = Ladybug_AverageData(annualHourlyData=importepw_2.dryBulbTemperature)  # -> readMe, selHourlyData, averagedDaily, averagedMonthly, avrMonthlyPerHour, avrAnalysisPeriod; plug-in component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
legendpar_3 = Ladybug_LegendParameters(
    lowBound="-20",
    highBound=Slider(50, range=0..100),
    numSegments=Slider(8, range=0..10),
    customColors=flatten([ColourSwatch(SwatchColor=RGB(209, 0, 0)), ColourSwatch(SwatchColor=RGB(102, 52, 52))]))  # -> legendPar; plug-in component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
concat_7 = Concatenate(FragmentA=lookupfolder.Name, FragmentC="_", FragmentB=pmvcomfortcalculator.percentOfTimeComfortable)
rec = DataRecorder(concat_7, DataLimit=-10, RecordData=True)
panel_33 = Panel(rec)
number_slider_9 = Slider(1, range=0..1000)
panel_34 = Panel(pmvcomfortcalculator.percentOfTimeComfortable)
concat_8 = Concatenate(FragmentA=lookupfolder.Name, FragmentC="_", FragmentB=adaptivecomfortcalculator.percentOfTimeComfortable)
rec_2 = DataRecorder(concat_8, DataLimit=-10, RecordData=True)
panel_35 = Panel(adaptivecomfortcalculator.percentOfTimeComfortable)
pt_43 = Point(<point referenced from the Rhino model>)
pt_44 = ConstructPoint(XCoordinate=0, YCoordinate="400", ZCoordinate=0)
barchart = Ladybug_MonthlyBarChart(
    inputData=flatten(selectandaveragedata.averagedMonthly),
    comfortModel=Slider(3, range=0..3),
    stackValues=Toggle(False),
    basePoint=pt_43,
    xScale=number_slider_9,
    yScale=number_slider_9,
    legendPar=legendpar_3)  # -> readMe, dataMesh, dataCurves, dataCrvColors, graphAxes, graphLabels, title, titleBasePt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; plug-in component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
panel_36 = Panel(rec_2)
legendpar_4 = Ladybug_LegendParameters(lowBound="-3", highBound="3")  # -> legendPar; plug-in component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
legendpar_5 = Ladybug_LegendParameters()  # -> legendPar; plug-in component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
preview_4 = CustomPreview(Geometry=barchart.comfortBand, Shader=ColourSwatch(SwatchColor=RGB(128, 128, 128)))
_3dchart_3 = Ladybug_3DChart(
    inputData=flatten(pmvcomfortcalculator.predictedMeanVote),
    basePoint=pt_44,
    xScale="0.25",
    zScale="0",
    legendPar=legendpar_4)  # -> readMe, graphMesh, graphCurves, legend, legendBasePts, title, titleBasePts, dataPts, conditionalHOY; plug-in component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
_3dchart_4 = Ladybug_3DChart(inputData=flatten(adaptivecomfortcalculator.conditionOfPerson), xScale="0.25", zScale="0", legendPar=legendpar_5)  # -> readMe, graphMesh, graphCurves, legend, legendBasePts, title, titleBasePts, dataPts, conditionalHOY; plug-in component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

genclimatebasedsky = Honeybee_GenerateClimateBasedSky(north=number_slider_5, weatherFile=open_epw_stat.epwFile, month="12", day="21", hour="15")  # -> radiationValues, skyFilePath; plug-in component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
radparameters_3 = Honeybee_RADParameters(quality="1")  # -> readMe, radParameters; plug-in component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
imagebasedsimulation = Honeybee_ImageBasedSimulation(
    skyFile=genclimatebasedsky.skyFilePath,
    cameraType="1",
    simulationType=2,
    radParameters=radparameters_3.radParameters,
    backupImages=0)  # -> analysisRecipe; plug-in component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
toggle_9 = BooleanToggle(False)

# ----
# title
doy_hoy = Ladybug_DOY_HOY(days="21", months="12", hours="15")  # -> HOY, DOY, date; plug-in component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
gridbasedsimulation = Honeybee_GridBasedSimulation(
    skyFile=genclimatebasedsky.skyFilePath,
    testPoints=gentestpts.testPoints,
    ptsVectors=gentestpts.ptsVectors,
    testMesh=gentestpts.mesh,
    simulationType="0",
    radParameters=radparameters.radParameters)  # -> analysisRecipe; plug-in component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
toggle_10 = BooleanToggle(False)
gradientlibrary = Ladybug_GradientLibrary(gradIndex="1")  # -> customColors; plug-in component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
legendpar_6 = Ladybug_LegendParameters(lowBound="250", highBound="500", customColors=flatten(gradientlibrary), legendLocation=pt_39)  # -> legendPar; plug-in component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
dom = ConstructDomain(DomainStart="-.5", DomainEnd=".5")

concat_9 = Concatenate(FragmentA=doy_hoy.date, FragmentC="_", FragmentB=concat_5)

rundaylightanalysis_2 = Honeybee_RunDaylightSimulation(
    HBObjects=flatten([hb_epcontextsrf, setepzonecnstr, createhbsrfs_8.HBSurface]),
    analysisRecipe=imagebasedsimulation,
    writeRad=toggle_9,
    runRad=toggle_9,
    numOfCPUs=Slider(6, range=0..10),
    workingDir="c:\ladybug\Daylight\",
    radFileName=doy_hoy.date,
    overwriteResults=True)  # -> readMe, analysisType, resultsUnit, results, testPts, resultFiles, radGeoFile, studyFolder, done; plug-in component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
glareanalysis = Honeybee_GlareAnalysis(HDRImagePath=rundaylightanalysis_2.resultFiles, runIt=Toggle(True))  # -> readMe, glareCheckImage, DGP, DGI, imageWithTaskArea; plug-in component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
falsecolor = Honeybee_FalseColor(
    HDRFilePath=rundaylightanalysis_2.resultFiles,
    contourBands=False,
    maskThreshold=0.1,
    useAlterColors=False,
    render=Toggle(True))  # -> outputFilePath; plug-in component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
hdr_tif = Honeybee_ConvertHDRToTIF(HDRFilePath=glareanalysis.glareCheckImage, adjustExposure=False)  # -> TIFFFilePath; plug-in component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
hdr_tif_2 = Honeybee_ConvertHDRToTIF(HDRFilePath=falsecolor, adjustExposure=False)  # -> TIFFFilePath; plug-in component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
image = ImageFromPath(P=hdr_tif, S=".8")
image_2 = ImageFromPath(P=hdr_tif_2, S=".8")

rundaylightanalysis_3 = Honeybee_RunDaylightSimulation(
    HBObjects=flatten([setepzonecnstr, hb_epcontextsrf]),
    analysisRecipe=gridbasedsimulation,
    writeRad=toggle_10,
    runRad=toggle_10,
    numOfCPUs=Slider(5, range=0..8),
    workingDir="c:\ladybug\PointimeDaylight",
    radFileName=concat_9,
    overwriteResults=True)  # -> readMe, analysisType, resultsUnit, results, testPts, resultFiles, radGeoFile, studyFolder, done; plug-in component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
panel_37 = Panel(rundaylightanalysis_3.studyFolder)

# ---- group: Study Title
merge_4 = Merge(
    Data2=flatten(rundaylightanalysis_3.analysisType),
    Data3=flatten(doy_hoy.date),
    Data4=flatten(explodelocation.locationName))
join = TextJoin(Text=merge_4)

# ----
panel_38 = Panel(join)
recolormesh_2 = Ladybug_RecolorMesh(
    analysisResult=rundaylightanalysis_3.results,
    inputMesh=gentestpts.mesh,
    heightDomain=dom,
    legendPar=legendpar_6,
    analysisTitle=join,
    legendTitle="lux")  # -> readMe, newMesh, newLegend, legendBasePt, meshColors, legendColors; plug-in component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
