# Grasshopper definition Kwan_ShinYi_Meyerson shading analysis.gh (Grasshopper 0.9.76)
# plug-ins: Python Interpreter

ladybug = Ladybug_Ladybug()  # -> Vviiiiiiiiiizzz; plug-in component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
panel = Panel("http://apps1.eere.energy.gov/buildings/energyplus/weatherdata/4_north_and_central_america_wmo_region_4/1_usa/USA_PA_Philadelphia.Intl.AP.724080_TMY3.zip")
open_epw_stat = Ladybug_OpenEPWAndSTATWeatherFiles(weatherFileURL=panel)  # -> epwFile, statFile; plug-in component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
importepw = Ladybug_ImportEpw(epwFile=open_epw_stat.epwFile)  # -> readMe, latitude, location, dryBulbTemperature, dewPointTemperature, relativeHumidity, windSpeed, windDirection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; plug-in component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

pt = Point(Point(-17.22287022, -5.533704668, 0))
analysisperiod = Ladybug_AnalysisPeriod()  # -> readMe, analysisPeriod; plug-in component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
solaradjusttemperature = Ladybug_OutdoorSolarTemperatureAdjustor(
    location=importepw.location,
    cumSkyMtxOrDirNormRad=importepw.directNormalRadiation,
    diffuseHorizRad=importepw.diffuseHorizontalRadiation,
    meanRadTemperature=importepw.dryBulbTemperature,
    bodyPosture="1",
    rotationAngle="70",
    bodyLocation=pt,
    analysisPeriodOrHOY=analysisperiod.analysisPeriod,
    parallel=Toggle(True),
    runIt=Toggle(True))  # -> readMe, port, effectiveRadiantField, MRTDelta, solarAdjustedMRT, port_2, mannequinMesh, port_3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; plug-in component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
outdoorcomfortcalculator = Ladybug_OutdoorComfortCalculator(
    dryBulbTemperature=importepw.dryBulbTemperature,
    meanRadiantTemperature=solaradjusttemperature.solarAdjustedMRT,
    windSpeed_tenMeters=importepw.windSpeed,
    relativeHumidity=importepw.relativeHumidity,
    runIt=Toggle(True))  # -> readMe, port, universalThermalClimateIndex, comfortableOrNot, thermalStress, conditionOfPerson, port_2, percentOfTimeComfortable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; plug-in component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
legendpar = Ladybug_LegendParameters()  # -> legendPar; plug-in component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
brep = Brep(<brep referenced from the Rhino model>)
brep_2 = Brep([<brep referenced from the Rhino model> x348])
comfortshadebenefit = Ladybug_ComfortShadeBenefitEvaluator(
    location=importepw.location,
    temperatures=outdoorcomfortcalculator.universalThermalClimateIndex,
    balanceTemperature="20",
    testShades=brep_2,
    testRegion=brep,
    gridSize=".5",
    skyResolution="4",
    delNonIntersect=False,
    parallel=Toggle(False),
    runIt=Toggle(False))  # -> readMe, port, sunVectors, regionTestPts, shadeMesh, legend, legendBasePoint, port_2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; plug-in component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
panel_2 = Panel("60")
panel_3 = Panel("80")
panel_4 = Panel("40")
panel_5 = Panel("100")
panel_6 = Panel(comfortshadebenefit.shadeHelpfulness)
panel_7 = Panel(comfortshadebenefit.shadeHarmfulness)
shadecreator = Honeybee_OptimalShadeCreator(shadeMesh=comfortshadebenefit.shadeMesh, shadeNetEffect=comfortshadebenefit.shadeNetEffect, percentToKeep="20")  # -> readMe, energySavedByShade, areaOfShade, newColoredMesh, newShadeBrep; plug-in component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
panel_8 = Panel(shadecreator.areaOfShade)
panel_9 = Panel(shadecreator.energySavedByShade)
preview = CustomPreview(Geometry=shadecreator.newShadeBrep, Shader=ColourSwatch(SwatchColor=RGB(31, 21, 21)))
