# Grasshopper definition Kwan_ShinYi_Shading unit.gh (Grasshopper 0.9.76)

pt = Point(<point referenced from the Rhino model>)
pt_2 = Point(<point referenced from the Rhino model>)
pt_3 = Point(<point referenced from the Rhino model>)
pt_4 = Point(<point referenced from the Rhino model>)

pt_5 = Point(<point referenced from the Rhino model>)
pt_6 = Point(<point referenced from the Rhino model>)
pt_7 = Point(<point referenced from the Rhino model>)
pt_8 = Point(<point referenced from the Rhino model>)

pt_9 = Point(<point referenced from the Rhino model>)
pt_10 = Point(<point referenced from the Rhino model>)
pt_11 = Point(<point referenced from the Rhino model>)
pt_12 = Point(<point referenced from the Rhino model>)

# ---- group: Rotation Axis Vectors
vec2pt = Vector2Pt(PointA=pt_4, PointB=pt, Unitize=False)  # -> Vector, Length
vdis = VectorDisplay(Anchor=pt_4, Vector=vec2pt.Vector)  # disabled

vec2pt_2 = Vector2Pt(PointA=pt_2, PointB=pt_3, Unitize=False)  # -> Vector, Length
vdis_2 = VectorDisplay(Anchor=pt_2, Vector=vec2pt_2.Vector)  # disabled

vec2pt_3 = Vector2Pt(PointA=pt_5, PointB=pt_6, Unitize=False)  # -> Vector, Length
vdis_3 = VectorDisplay(Anchor=pt_5, Vector=vec2pt_3.Vector)  # disabled

vec2pt_4 = Vector2Pt(PointA=pt_3, PointB=pt_4, Unitize=False)  # -> Vector, Length
vdis_4 = VectorDisplay(Anchor=pt_3, Vector=vec2pt_4.Vector)  # disabled

vec2pt_5 = Vector2Pt(PointA=pt_7, PointB=pt_8, Unitize=False)  # -> Vector, Length
vdis_5 = VectorDisplay(Anchor=pt_7, Vector=vec2pt_5.Vector)  # disabled

vec2pt_6 = Vector2Pt(PointA=pt_12, PointB=pt_9, Unitize=False)  # -> Vector, Length
vdis_6 = VectorDisplay(Anchor=pt_12, Vector=vec2pt_6.Vector)  # disabled

vec2pt_7 = Vector2Pt(PointA=pt_8, PointB=pt_5, Unitize=False)  # -> Vector, Length
vdis_7 = VectorDisplay(Anchor=pt_8, Vector=vec2pt_7.Vector)  # disabled

vec2pt_8 = Vector2Pt(PointA=pt, PointB=pt_2, Unitize=False)  # -> Vector, Length
vdis_8 = VectorDisplay(Anchor=pt, Vector=vec2pt_8.Vector)  # disabled

vec2pt_9 = Vector2Pt(PointA=pt_10, PointB=pt_11, Unitize=False)  # -> Vector, Length
vdis_9 = VectorDisplay(Anchor=pt_10, Vector=vec2pt_9.Vector)  # disabled

vec2pt_10 = Vector2Pt(PointA=pt_11, PointB=pt_12, Unitize=False)  # -> Vector, Length
vdis_10 = VectorDisplay(Anchor=pt_11, Vector=vec2pt_10.Vector)  # disabled

vec2pt_11 = Vector2Pt(PointA=pt_6, PointB=pt_7, Unitize=False)  # -> Vector, Length
vdis_11 = VectorDisplay(Anchor=pt_6, Vector=vec2pt_11.Vector)  # disabled

vec2pt_12 = Vector2Pt(PointA=pt_9, PointB=pt_10, Unitize=False)  # -> Vector, Length
vdis_12 = VectorDisplay(Anchor=pt_9, Vector=vec2pt_12.Vector)  # disabled

# ----
pt_13 = Point(<point referenced from the Rhino model>)
pt_14 = Point(<point referenced from the Rhino model>)
pt_15 = Point(<point referenced from the Rhino model>)
pt_16 = Point(<point referenced from the Rhino model>)

pt_17 = Point(<point referenced from the Rhino model>)
pt_18 = Point(<point referenced from the Rhino model>)
pt_19 = Point(<point referenced from the Rhino model>)
pt_20 = Point(<point referenced from the Rhino model>)

pt_21 = Point(<point referenced from the Rhino model>)
pt_22 = Point(<point referenced from the Rhino model>)
pt_23 = Point(<point referenced from the Rhino model>)
pt_24 = Point(<point referenced from the Rhino model>)

# ---- group: Folding Control
number_slider = Slider(83, range=0..90)
rad = Radians(Degrees=number_slider)

number_slider_2 = Slider(37, range=0..180)
rad_2 = Radians(Degrees=number_slider_2)

number_slider_3 = Slider(65, range=0..90)
rad_3 = Radians(Degrees=number_slider_3)

# ---- group: Rotations
line = LineSDL(Start=pt_3, Direction=vec2pt_4.Vector, Length=1)
rotax = RotateAxis(Geometry=pt_15, Angle=expr("-x", rad), Axis=line)  # -> Geometry, Transform

line_2 = LineSDL(Start=pt_4, Direction=vec2pt.Vector, Length=1)
rotax_2 = RotateAxis(Geometry=pt_16, Angle=expr("-x", rad), Axis=line_2)  # -> Geometry, Transform

line_3 = LineSDL(Start=pt_8, Direction=vec2pt_7.Vector, Length=1)
rotax_3 = RotateAxis(Geometry=pt_19, Angle=expr("-x", rad_2), Axis=line_3)  # -> Geometry, Transform

line_4 = LineSDL(Start=pt_5, Direction=vec2pt_3.Vector, Length=1)
rotax_4 = RotateAxis(Geometry=pt_20, Angle=expr("-x", rad_2), Axis=line_4)  # -> Geometry, Transform

line_5 = LineSDL(Start=pt_2, Direction=vec2pt_2.Vector, Length=1)
rotax_5 = RotateAxis(Geometry=pt_13, Angle=expr("-x", rad), Axis=line_5)  # -> Geometry, Transform

line_6 = LineSDL(Start=pt_11, Direction=vec2pt_10.Vector, Length=1)
rotax_6 = RotateAxis(Geometry=pt_23, Angle=expr("-x", rad_3), Axis=line_6)  # -> Geometry, Transform

line_7 = LineSDL(Start=pt_12, Direction=vec2pt_6.Vector, Length=1)
rotax_7 = RotateAxis(Geometry=pt_24, Angle=expr("-x", rad_3), Axis=line_7)  # -> Geometry, Transform

line_8 = LineSDL(Start=pt_7, Direction=vec2pt_5.Vector, Length=1)
rotax_8 = RotateAxis(Geometry=pt_17, Angle=expr("-x", rad_2), Axis=line_8)  # -> Geometry, Transform

line_9 = LineSDL(Start=pt_10, Direction=vec2pt_9.Vector, Length=1)
rotax_9 = RotateAxis(Geometry=pt_21, Angle=expr("-x", rad_3), Axis=line_9)  # -> Geometry, Transform

line_10 = LineSDL(Start=pt, Direction=vec2pt_8.Vector, Length=1)
rotax_10 = RotateAxis(Geometry=pt_14, Angle=expr("-x", rad), Axis=line_10)  # -> Geometry, Transform

line_11 = LineSDL(Start=pt_6, Direction=vec2pt_11.Vector, Length=1)
rotax_11 = RotateAxis(Geometry=pt_18, Angle=expr("-x", rad_2), Axis=line_11)  # -> Geometry, Transform

line_12 = LineSDL(Start=pt_9, Direction=vec2pt_12.Vector, Length=1)
rotax_12 = RotateAxis(Geometry=pt_22, Angle=expr("-x", rad_3), Axis=line_12)  # -> Geometry, Transform

# ---- group: Folding Surfaces
srf4pt = _4PointSurface(CornerA=pt_2, CornerB=pt_3, CornerC=rotax_5.Geometry)
srf4pt_2 = _4PointSurface(CornerA=pt, CornerB=pt_2, CornerC=rotax_10.Geometry)
srf4pt_3 = _4PointSurface(CornerA=pt_4, CornerB=pt, CornerC=rotax_2.Geometry)
srf4pt_4 = _4PointSurface(CornerA=pt_3, CornerB=pt_4, CornerC=rotax.Geometry)

srf4pt_5 = _4PointSurface(CornerA=pt_7, CornerB=pt_8, CornerC=rotax_8.Geometry)
srf4pt_6 = _4PointSurface(CornerA=pt_6, CornerB=pt_7, CornerC=rotax_11.Geometry)
srf4pt_7 = _4PointSurface(CornerA=pt_5, CornerB=pt_6, CornerC=rotax_4.Geometry)
srf4pt_8 = _4PointSurface(CornerA=pt_8, CornerB=pt_5, CornerC=rotax_3.Geometry)

srf4pt_9 = _4PointSurface(CornerA=pt_10, CornerB=pt_11, CornerC=rotax_9.Geometry)
srf4pt_10 = _4PointSurface(CornerA=pt_9, CornerB=pt_10, CornerC=rotax_12.Geometry)
srf4pt_11 = _4PointSurface(CornerA=pt_12, CornerB=pt_9, CornerC=rotax_7.Geometry)
srf4pt_12 = _4PointSurface(CornerA=pt_11, CornerB=pt_12, CornerC=rotax_6.Geometry)

# ----
merge = Merge(Data1=srf4pt_2, Data2=srf4pt, Data3=srf4pt_4, Data4=srf4pt_3)
pt_25 = Point([<point referenced from the Rhino model> x42])
merge_2 = Merge(Data1=srf4pt_10, Data2=srf4pt_9, Data3=srf4pt_12, Data4=srf4pt_11)
pt_26 = Point(<point referenced from the Rhino model>)
merge_3 = Merge(Data1=srf4pt_6, Data2=srf4pt_5, Data3=srf4pt_8, Data4=srf4pt_7)
vec2pt_13 = Vector2Pt(PointA=pt_26, PointB=pt_25, Unitize=False)  # -> Vector, Length
pt_27 = Point(<point referenced from the Rhino model>)
pt_28 = Point([<point referenced from the Rhino model> x18])
pt_29 = Point(<point referenced from the Rhino model>)
pt_30 = Point([<point referenced from the Rhino model> x32])
move = Move(Geometry=graft(merge_3), Motion=vec2pt_13.Vector)  # -> Geometry, Transform
vec2pt_14 = Vector2Pt(PointA=pt_27, PointB=pt_28, Unitize=False)  # -> Vector, Length
vec2pt_15 = Vector2Pt(PointA=pt_29, PointB=pt_30, Unitize=False)  # -> Vector, Length
move_2 = Move(Geometry=graft(merge), Motion=vec2pt_14.Vector)  # -> Geometry, Transform
move_3 = Move(Geometry=graft(merge_2), Motion=vec2pt_15.Vector)  # -> Geometry, Transform
