# Grasshopper definition 1211Anchorage-EP.gh (Grasshopper 0.9.76)
# plug-ins: Python Interpreter, embryoA

count = Panel("""3
6
9""")
short_length = Panel("""-15
0
+15""")
shading_length = Panel("""0.1
0.2
0.3""")
concat = Concatenate(FragmentA=graft(count), FragmentB="/", FragmentC=short_length)
panel = Panel(concat)
concat_2 = Concatenate(FragmentA=graft(concat), FragmentB="/", FragmentC=shading_length)  # -> flatten(Result)
panel_2 = Panel(concat_2)

shadingvalue2 = Slider(2, range=0..2)
shadingvalue1 = Slider(0, range=0..26)
shadingvalue2_2 = Slider(0, range=0..4)

step1 = Panel("""3/-15/0.1
3/-15/0.2
3/-15/0.3
3/0/0.1
3/0/0.2
3/0/0.3
3/+15/0.1
3/+15/0.2
3/+15/0.3
6/-15/0.1
6/-15/0.2
6/-15/0.3
6/0/0.1
6/0/0.2
6/0/0.3
6/+15/0.1
6/+15/0.2
6/+15/0.3
9/-15/0.1
9/-15/0.2
9/-15/0.3
9/0/0.1
9/0/0.2
9/0/0.3
9/+15/0.1
9/+15/0.2
9/+15/0.3""")
step2 = Panel("""3/-15/0.2
3/-15/0.3
6/-15/0.2
9/-15/0.1
9/-15/0.2""")
item = ListItem(List=step1, Index=shadingvalue1, Wrap=True)
panel_3 = Panel(item)
split = TextSplit(Text=item, Separators="/")
item_2 = ListItem(List=split, Index=0, Wrap=True)  # -> Item, Item1, Item2

step3 = Panel("""3/-15/0.2
3/-10/0.2
3/-20/0.2""")
fly = Ladybug_fly(inputSliders=shadingvalue1, fly=Toggle(False))  # -> Vviiiiiiiiiizzz; plug-in component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

toggle = BooleanToggle(False)
updatehoneybee = Honeybee_UpdateHoneybee(updateThisFile=toggle, updateAllUObjects=toggle)  # -> readMe; plug-in component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
updateladybug = Ladybug_UpdateLadybug(updateThisFile=toggle, updateAllUObjects=toggle)  # -> readMe; plug-in component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
honeybee = Honeybee_Honeybee()  # -> Vviiiiiiiiiizzz; plug-in component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
ladybug = Ladybug_Ladybug()  # -> Vviiiiiiiiiizzz; plug-in component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

searchepconstruction = Honeybee_SearchEPConstruction(
    EPConstrList="Floor",
    standard=Slider(2, range=0..5),
    climateZone=Slider(7, range=1..8),
    surfaceType=Slider(2, range=0..4),
    keywords="MASS")  # -> EPSelectedConstr; plug-in component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
searchepconstruction_2 = Honeybee_SearchEPConstruction(
    EPConstrList="Wall",
    standard=Slider(2, range=0..5),
    climateZone=Slider(7, range=1..8),
    surfaceType=Slider(0, range=0..4),
    keywords="MASS")  # -> EPSelectedConstr; plug-in component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
searchepconstruction_3 = Honeybee_SearchEPConstruction(
    EPConstrList="Ceiling",
    standard=Slider(2, range=0..5),
    climateZone=Slider(7, range=1..8),
    surfaceType=Slider(3, range=0..4),
    keywords="MASS")  # -> EPSelectedConstr; plug-in component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

north = ValueList({"0", "45", "90", "135", "180", "225", "270", "315"}, selected="90")
panel_4 = Panel("http://apps1.eere.energy.gov/buildings/energyplus/weatherdata/4_north_and_central_america_wmo_region_4/1_usa/USA_AK_Anchorage-Merrill.Field.702735_TMY3.zip")
open_epw_stat = Ladybug_OpenEPWAndSTATWeatherFiles(weatherFileURL=panel_4)  # -> epwFile, statFile; plug-in component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
northarrow = Ladybug_North(north=north, scale=".05")  # -> northSign; plug-in component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
importlocation = Ladybug_ImportLocation(epwFile=open_epw_stat.epwFile)  # -> location; plug-in component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
explodelocation = Ladybug_DecomposeLocation(location=importlocation)  # -> locationName, latitude, longitude, timeZone, elevation; plug-in component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

table = Brep([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])
kitchen = Brep([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])
bed = Brep([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])
desk = Brep([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])
exterior_wall = Brep(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)
furniture = Brep([kitchen, table, desk, bed])
walls = Brep([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])
ledge = Brep(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)

# ---- group: ceiling
ceiling = Brep([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])

# ---- group: floor
floor = Brep(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)

# ----
wall_surface_with_opening = Brep(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)
# Geometry Preparation
panel_5 = Panel("0")
createhbsrfs = Honeybee_createHBSrfs(geometry=flatten(exterior_wall), srfType="0")  # -> readMe, simplify(HBSurface); plug-in component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
createhbsrfs_2 = Honeybee_createHBSrfs(geometry=flatten(furniture), srfType="0")  # -> readMe, simplify(HBSurface); plug-in component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
createhbsrfs_3 = Honeybee_createHBSrfs(geometry=flatten(floor), srfType="2")  # -> readMe, simplify(HBSurface); plug-in component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
createhbsrfs_4 = Honeybee_createHBSrfs(geometry=flatten(ledge), srfType="2")  # -> readMe, simplify(HBSurface); plug-in component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
createhbsrfs_5 = Honeybee_createHBSrfs(geometry=wall_surface_with_opening, srfType="0")  # -> readMe, simplify(HBSurface); plug-in component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
createhbsrfs_6 = Honeybee_createHBSrfs(geometry=ceiling, srfType="3")  # -> readMe, simplify(HBSurface); plug-in component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
# Honeybee default materials will be assigned
# based on surface type
createhbsrfs_7 = Honeybee_createHBSrfs(geometry=walls, srfType=panel_5)  # -> readMe, simplify(HBSurface); plug-in component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
glass = Brep(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)
addhbglz = Honeybee_addHBGlz(HBObj=createhbsrfs_5.HBSurface, childSurfaces=flatten(glass))  # -> simplify(HBObjWGLZ); plug-in component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
wires = BrepWireframe(Brep=createhbsrfs_2.HBSurface, Density=-1)

# ---- group: Make all surfaces except the exterior wall adiabatic
makeadiabatic = Honeybee_MakeAdiabatic(HBSrfs=flatten([createhbsrfs_7.HBSurface, createhbsrfs_6.HBSurface, createhbsrfs_3.HBSurface]))  # -> HBSrfs; plug-in component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

# ----
bldgprograms = Honeybee_bldgPrograms({"Office": 0, "Retail": 1, "MidriseApartment": 2, "PrimarySchool": 3, "SecondarySchool": 4, "SmallHotel": 5, "LargeHotel": 6, "Hospital": 7, "Outpatient": 8, "Warehouse": 9, "SuperMarket": 10, "FullServiceRestaurant": 11, "QuickServiceRestaurant": 12}, selected="MidriseApartment")
listzoneprograms = Honeybee_ListZonePrograms(bldgProgram=bldgprograms)  # -> MidriseApartmentZonePrograms; plug-in component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
item_3 = ListItem(List=listzoneprograms, Index=0, Wrap=True)
panel_6 = Panel(item_3)

# ---- group: collect all honeybee surfaces
brep = Brep(flatten([addhbglz, createhbsrfs_4.HBSurface, createhbsrfs.HBSurface, makeadiabatic]))

# ----
number_slider = Slider(0, range=0..8)

panel_7 = Panel("""03_21_09
03_21_12
03_21_15
06_21_09
06_21_12
06_21_15
12_21_09
12_21_12
12_21_15""")
item_4 = ListItem(List=panel_7, Index=number_slider, Wrap=True)
split_2 = TextSplit(Text=item_4, Separators="_")
panel_8 = Panel(item_4)
item_5 = ListItem(List=split_2, Index=0, Wrap=True)  # -> Item, Item1, Item2

preview = CustomPreview(Geometry=brep, Shader=ColourSwatch(SwatchColor=RGBA(0, 0, 67, 0)))
createhbzones = Honeybee_createHBZones(name="test_room", zoneProgram=item_3, HBSurfaces=flatten(brep), isConditioned=Toggle(False))  # -> readMe, HBZone; plug-in component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
wires_2 = BrepWireframe(Brep=createhbzones.HBZone, Density=-1)
fly_2 = Ladybug_fly(inputSliders=number_slider, fly=Toggle(False))  # -> Vviiiiiiiiiizzz; plug-in component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
preview_2 = CustomPreview(Geometry=glass, Shader=ColourSwatch(SwatchColor=RGBA(79, 223, 255, 70)))

brep_2 = Brep(floor)
flip = Flip(Surface=brep_2)  # -> Surface, Result
gentestpts = Honeybee_GenerateTestPoints(testSurface=flip.Surface, gridSize=".5", distBaseSrf=".762", moveTestMesh=True)  # -> readMe, simplify(testPoints), simplify(ptsVectors), simplify(facesArea), simplify(mesh); plug-in component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
radparameters = Honeybee_RADParameters(quality=0)  # -> readMe, radParameters; plug-in component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

genclimatebasedsky = Honeybee_GenerateClimateBasedSky(north=north, weatherFile=open_epw_stat.epwFile, month=item_5.Item, day=item_5.Item1, hour=item_5.Item2)  # -> radiationValues, skyFilePath; plug-in component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
radparameters_2 = Honeybee_RADParameters(quality=Slider(1, range=0..2))  # -> readMe, radParameters; plug-in component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

concat_3 = Concatenate(FragmentA="Shading_", FragmentB=panel_3)
testing_time = ValueList({"Mar 21 9am": 0, "Mar 21 12pm": 1, "Mar 21 3pm": 2, "Jun 21 9am": 3, "Jun 21 12pm": 4, "Jun 21 3pm": 5, "Dec 21 9am": 6, "Dec 21 12pm": 7, "Dec 21 3pm": 8}, selected="Dec 21 3pm")
panel_9 = Panel(concat_3)
toggle_2 = BooleanToggle(False)
toggle_3 = BooleanToggle(True)

toggle_4 = BooleanToggle(False)

split_3 = TextSplit(Text=explodelocation.locationName, Separators="_")
item_6 = ListItem(List=split_3, Index=0, Wrap=True)  # -> Item, Item1, Item2
split_4 = TextSplit(Text=item_6.Item, Separators=" ")
item_7 = ListItem(List=split_4, Index=0, Wrap=True)  # -> Item, Item1, Item2
concat_4 = Concatenate(FragmentA=item_7.Item, FragmentC="_Orient", FragmentD=north, FragmentF="_")
panel_10 = Panel(concat_4)

item_8 = ListItem(List=gentestpts.testPoints, Index="58", Wrap=True)
sph = Sphere(Base=item_8, Radius=Slider(0.1, range=0..0.1))
lightingcontrol = Honeybee_LightingControlRecipe(
    controlType="4",
    sensorPoints=item_8,
    lightingPower=250,
    lightingSetpoint=300,
    ballastLossFactor=20,
    standbyPower=3,
    delayTime=5)  # -> lightingControlGroup; plug-in component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

# ----
# Generate Lighting Schedule
gethbzoneepschedules = Honeybee_GetZoneEnergyPlusSchedules(HBZone=createhbzones.HBZone)  # -> occupancySchedule, occupancyActivitySch, heatingSetPtSchedule, coolingSetPtSchedule, lightingSchedule, equipmentSchedule, infiltrationSchedule; plug-in component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

# ----
# Natural Ventilation
panel_11 = Panel("1")
zoneattributelist = Honeybee_ZoneAttributeList({"Name": "name", "Zone Program": "zoneProgram", "Zone Floor Area": "zoneFloorArea", "Zone Volume": "zoneVolume", "Building Program": "bldgProgram", "Is Conditioned": "isConditioned", "Occupancy Schedule": "occupancySchedule", "Occupancy Activity Schedule": "occupancyActivitySch", "Heating SetPoint Schedule": "heatingSetPtSchedule", "Cooling SetPoint Schedule": "coolingSetPtSchedule"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}, selected="Natural Ventilation": "natVent")
setepnatvent = Honeybee_SetEPAirFlow(
    HBZones=createhbzones.HBZone,
    naturalVentilationType=panel_11,
    minIndoorTempForNatVent="24",
    maxOutdoorTempForNatVent="28")  # -> readMe, simplify(HBZones); plug-in component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
labelzones = Honeybee_LabelZones(HBZones=flatten(setepnatvent.HBZones), attribute=zoneattributelist)  # -> zoneTxtLabels, labelBasePts, brepTxtLabels, zoneWireFrames; plug-in component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

importgroundtemp = Ladybug_ImportGroundTemp(epwFile=open_epw_stat.epwFile, visualisedata_Season=Toggle(False), visualisedata_Month=Toggle(False))  # -> readMe, groundtemp1st, groundtemp2nd, groundtemp3rd, profileCrvs, crvColors, graphAxes, graphtext, Legend; plug-in component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
importepw = Ladybug_ImportEpw(epwFile=open_epw_stat.epwFile)  # -> readMe, latitude, location, dryBulbTemperature, dewPointTemperature, relativeHumidity, windSpeed, windDirection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; plug-in component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
panel_12 = Panel(importgroundtemp.groundtemp1st)

legendpar = Ladybug_LegendParameters(lowBound=Slider(0, range=0..100), highBound=Slider(100, range=0..100), decimalPlaces=Slider(1, range=0..2))  # -> legendPar; plug-in component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

captureview = Ladybug_CaptureView()  # -> imagePath; plug-in component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
toggle_5 = BooleanToggle(True)

pt = Point(Point(3, 4, 0))
comfortmannequin = Ladybug_ComfortMannequin(bodyPosture=Slider(1, range=0..2), rotationAngle=Slider(180, range=0..360), bodyLocation=pt)  # -> mannequinMesh, legend, legendBasePt; plug-in component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
item_9 = ListItem(List=comfortmannequin.mannequinMesh, Index=Slider(121, range=0..134), Wrap=True)
preview_3 = CustomPreview(Geometry=item_9, Shader=ColourSwatch(SwatchColor=RGB(255, 69, 0)))
preview_4 = CustomPreview(Geometry=comfortmannequin.mannequinMesh, Shader=ColourSwatch(SwatchColor=RGBA(10, 6, 255, 94)))
facen = FaceNormals(Mesh=item_9)  # -> Centers, Normals
md_slider = MDSlider(
    slider_value=Point(0.4968767864, 0.4998049852, 0.5),
    SliderMode=0,
    x_domain=Domain(-1, 1),
    y_domain=Domain(-1, 1),
    z_domain=Domain(0, 1))
settheview = Ladybug_SetTheView(cameraLocation=facen.Centers, cameraDirection=facen.Normals, uvLookAround=md_slider)  # plug-in component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

importepw_2 = Ladybug_ImportEpw(epwFile=open_epw_stat.epwFile)  # -> readMe, latitude, location, dryBulbTemperature, dewPointTemperature, relativeHumidity, windSpeed, windDirection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; plug-in component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
number_slider_2 = Slider(0, range=0..1)  # disabled
crossref = CrossReference(ListA=item_5.Item, ListB=item_5.Item1, ListC=item_5.Item2, CrossMode=1)  # -> ListA, ListB, ListC

thermalcomfortindices = Ladybug_ThermalComfortIndices(
    comfortIndex=Slider(11, range=0..14),
    location=importepw_2.location,
    dryBulbTemperature=importepw_2.dryBulbTemperature,
    dewPointTemperature=importepw_2.dewPointTemperature,
    relativeHumidity=importepw_2.relativeHumidity,
    windSpeed=importepw_2.windSpeed,
    globalHorizontalRadiation=importepw_2.globalHorizontalRadiation,
    totalSkyCover=importepw_2.totalSkyCover,
    metabolicRate=2.32,
    age=30,
    gender="male",
    acclimated=False,
    runIt=Toggle(True))  # -> readMe, MRT, port, port_2, port_3, port_4, port_5; plug-in component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
panel_13 = Panel(thermalcomfortindices.MRT)
analysisperiod = Ladybug_AnalysisPeriod()  # -> readMe, analysisPeriod; plug-in component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
analysisperiod_2 = Ladybug_AnalysisPeriod(
    fromMonth=Slider(12, range=1..12),
    fromDay=Slider(21, range=1..31),
    fromHour=Slider(11, range=0..24),
    toMonth=Slider(12, range=1..12),
    toDay=Slider(21, range=1..31),
    toHour=Slider(12, range=0..24))  # -> readMe, analysisPeriod; plug-in component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
person = Point(Point(3, 4, 0))
solaradjusttemperature = Ladybug_OutdoorSolarTemperatureAdjustor(
    location=importepw_2.location,
    cumSkyMtxOrDirNormRad=importepw_2.directNormalRadiation,
    diffuseHorizRad=importepw_2.diffuseHorizontalRadiation,
    meanRadTemperature=thermalcomfortindices.MRT,
    bodyPosture=Slider(1, range=0..5),
    rotationAngle=Slider(180, range=0..360),
    bodyLocation=person,
    north=north,
    analysisPeriodOrHOY=analysisperiod.analysisPeriod,
    parallel=Toggle(True),
    runIt=Toggle(True))  # -> readMe, port, effectiveRadiantField, MRTDelta, solarAdjustedMRT, port_2, mannequinMesh, port_3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; plug-in component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
panel_14 = Panel(solaradjusttemperature.solarAdjustedMRT)
panel_15 = Panel(solaradjusttemperature.effectiveRadiantField)
panel_16 = Panel(solaradjusttemperature.MRTDelta)
panel_17 = Panel(solaradjusttemperature.mannequinMesh)
preview_5 = CustomPreview(Geometry=solaradjusttemperature.mannequinMesh, Shader=ColourSwatch(SwatchColor=RGBA(0, 0, 107, 182)))

number_slider_3 = Slider(10, range=1..11)  # disabled
number_slider_4 = Slider(30, range=-20..30)  # disabled
number_slider_5 = Slider(-20, range=-20..25)  # disabled
legendpar_2 = Ladybug_LegendParameters(lowBound=number_slider_5, highBound=number_slider_4, numSegments=number_slider_3)  # -> legendPar; disabled; plug-in component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
number_slider_6 = Slider(0.2, range=0..1)  # disabled
pt_2 = Point(<point referenced from the Rhino model>)  # disabled
_3dchart = Ladybug_3DChart(inputData=flatten(importepw.dryBulbTemperature), basePoint=pt_2, xScale=number_slider_6, legendPar=legendpar_2)  # -> readMe, graphMesh, graphCurves, legend, legendBasePts, title, titleBasePts, dataPts, conditionalHOY; disabled; plug-in component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

number_slider_7 = Slider(-25, range=-25..30)  # disabled
number_slider_8 = Slider(30, range=-25..30)  # disabled
number_slider_9 = Slider(15, range=1..100)  # disabled
legendpar_3 = Ladybug_LegendParameters(lowBound=number_slider_7, highBound=number_slider_8)  # -> legendPar; disabled; plug-in component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
pt_3 = Point(<point referenced from the Rhino model>)  # disabled

toggle_6 = BooleanToggle(False)  # disabled
psychchart = Ladybug_PsychrometricChart(
    dryBulbTemperature=importepw.dryBulbTemperature,
    relativeHumidity=importepw.relativeHumidity,
    windSpeed=importepw.windSpeed,
    runIt=toggle_6)  # -> readMe, port, totalComfortPercent, totalComfortOrNot, strategyNames, strategyPercentOfTime, strategyOrNot, port_2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; disabled; plug-in component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
toggle_7 = BooleanToggle(False)  # disabled
bioclimatic_chart = Ladybug_BioclimaticChart(dryBulbTemperature=importepw.dryBulbTemperature, relativeHumidity=importepw.relativeHumidity, runIt=toggle_7)  # -> readMe, port, comfortResults, totalComfortOrNot, strategyOrNot, port_2, chartGridAndTxt, chartMesh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; disabled; plug-in component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

number_slider_10 = Slider(0, range=0..10)  # disabled
number_slider_11 = Slider(10, range=0..10)  # disabled
swatch = ColourSwatch(SwatchColor=RGB(0, 69, 130))  # disabled
swatch_2 = ColourSwatch(SwatchColor=RGB(255, 255, 255))  # disabled
legendpar_4 = Ladybug_LegendParameters(lowBound=number_slider_10, highBound=number_slider_11, customColors=flatten([swatch_2, swatch]))  # -> legendPar; disabled; plug-in component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
number_slider_12 = Slider(0.2, range=0..1)  # disabled
pt_4 = Point(<point referenced from the Rhino model>)  # disabled
_3dchart_2 = Ladybug_3DChart(inputData=flatten(importepw.liquidPrecipitationDepth), basePoint=pt_4, xScale=number_slider_12, legendPar=legendpar_4)  # -> readMe, graphMesh, graphCurves, legend, legendBasePts, title, titleBasePts, dataPts, conditionalHOY; disabled; plug-in component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

toggle_8 = BooleanToggle(True)  # disabled

number_slider_13 = Slider(21, range=0..100)  # disabled
number_slider_14 = Slider(6, range=0..10)  # disabled
number_slider_15 = Slider(12, range=0..100)  # disabled
toggle_9 = BooleanToggle(True)  # disabled
gencumulativeskymtx = Ladybug_GenCumulativeSkyMtx(epwFile=open_epw_stat.epwFile, skyDensity=number_slider_2, useOldRes=toggle_8, runIt=toggle_9)  # -> readMe, cumulativeSkyMtx; disabled; plug-in component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
doy_hoy = Ladybug_DOY_HOY(days=number_slider_13, months=number_slider_14, hours=number_slider_15)  # -> HOY, DOY, date; disabled; plug-in component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
selectskymtx = Ladybug_selectSkyMtx(cumulativeSkyMtx=gencumulativeskymtx.cumulativeSkyMtx, HOY=doy_hoy.HOY, removeDiffuse=False, removeDirect=False)  # -> readMe, selectedSkyMtx; disabled; plug-in component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
toggle_10 = BooleanToggle(False)  # disabled
radiationrose = Ladybug_RadiationRose(selectedSkyMtx=selectskymtx.selectedSkyMtx, arrowHeadScale=1, showTotalOnly=toggle_10, runIt=toggle_10)  # -> readMe, radiationArrowsMesh, radRoseBaseCrvs, legend, legendBasePts, radRoseEndPts, radRoseValues; disabled; plug-in component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

cdd_hdd = Ladybug_CDD_HDD(hourlyDryBulbTemperature=importepw.dryBulbTemperature)  # -> readMe, daily_coolingDegDays, daily_heatingDegDays, monthly_coolingDegDays, monthly_heatingDegDays, annual_coolingDegDays, annual_heatingDegDays; disabled; plug-in component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
number_slider_16 = Slider(8, range=1..11)  # disabled
number_slider_17 = Slider(700, range=0..800)  # disabled
number_slider_18 = Slider(0, range=0..800)  # disabled
legendpar_5 = Ladybug_LegendParameters(lowBound=number_slider_18, highBound=number_slider_17, numSegments=number_slider_16)  # -> legendPar; disabled; plug-in component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
panel_18 = Panel(cdd_hdd.daily_coolingDegDays)  # disabled
panel_19 = Panel(cdd_hdd.monthly_coolingDegDays)  # disabled
panel_20 = Panel(cdd_hdd.daily_heatingDegDays)  # disabled
panel_21 = Panel(cdd_hdd.monthly_heatingDegDays)  # disabled
pt_graph3 = Point(<point referenced from the Rhino model>)  # disabled
barchart = Ladybug_MonthlyBarChart(
    inputData=flatten([cdd_hdd.monthly_coolingDegDays, cdd_hdd.monthly_heatingDegDays]),
    basePoint=pt_graph3,
    legendPar=legendpar_5)  # -> readMe, dataMesh, dataCurves, dataCrvColors, graphAxes, graphLabels, title, titleBasePt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; disabled; plug-in component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
separatedata = Ladybug_SeparateData(inputList=flatten(panel_20))  # -> numbers, strings; disabled; plug-in component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
separatedata_2 = Ladybug_SeparateData(inputList=flatten(panel_18))  # -> numbers, strings; disabled; plug-in component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
ma = MassAddition(Input=separatedata.numbers)  # -> Result, PartialResults; disabled
ma_2 = MassAddition(Input=separatedata_2.numbers)  # -> Result, PartialResults; disabled
panel_22 = Panel(ma.Result)  # disabled
panel_23 = Panel(ma_2.Result)  # disabled

person_2 = Point(Point(3, 4, 0))

swatch_3 = ColourSwatch(SwatchColor=RGB(51, 88, 209))  # disabled
swatch_4 = ColourSwatch(SwatchColor=RGB(255, 255, 255))  # disabled
legendpar_6 = Ladybug_LegendParameters(customColors=reverse(flatten([swatch_3, swatch_4])))  # -> legendPar; disabled; plug-in component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
number_slider_19 = Slider(0.2, range=0..1)  # disabled
pt_5 = Point(<point referenced from the Rhino model>)  # disabled
_3dchart_3 = Ladybug_3DChart(inputData=flatten(importepw.relativeHumidity), basePoint=pt_5, xScale=number_slider_19, legendPar=legendpar_6)  # -> readMe, graphMesh, graphCurves, legend, legendBasePts, title, titleBasePts, dataPts, conditionalHOY; disabled; plug-in component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

swatch_5 = ColourSwatch(SwatchColor=RGBA(0, 0, 0, 171))  # disabled
swatch_6 = ColourSwatch(SwatchColor=RGB(255, 255, 255))  # disabled
legendpar_7 = Ladybug_LegendParameters(customColors=reverse(flatten([swatch_5, swatch_6])))  # -> legendPar; disabled; plug-in component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
number_slider_20 = Slider(0.2, range=0..1)  # disabled
pt_6 = Point(<point referenced from the Rhino model>)  # disabled
_3dchart_4 = Ladybug_3DChart(inputData=flatten(importepw.totalSkyCover), basePoint=pt_6, xScale=number_slider_20, legendPar=legendpar_7)  # -> readMe, graphMesh, graphCurves, legend, legendBasePts, title, titleBasePts, dataPts, conditionalHOY; disabled; plug-in component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

number_slider_21 = Slider(3, range=0..10)  # disabled
number_slider_22 = Slider(6, range=1..10)  # disabled
panel_24 = Panel("0,0,0")  # disabled
box = DomainBox(Base=panel_24, X=number_slider_22, Y=number_slider_22, Z=number_slider_21)  # disabled
panel_25 = Panel("-3,-3,0")  # disabled
move = Move(Geometry=box, Motion=panel_25)  # -> Geometry, Transform; disabled

number_slider_23 = Slider(0, range=0..1000)  # disabled
number_slider_24 = Slider(1000, range=0..1000)  # disabled
number_slider_25 = Slider(30, range=0..360)  # disabled
number_slider_26 = Slider(180, range=0..360)  # disabled
toggle_11 = BooleanToggle(True)  # disabled
toggle_12 = BooleanToggle(True)  # disabled
panel_26 = Panel("0,0,0")  # disabled
number_slider_27 = Slider(0.01, range=0..0.01)  # disabled
selectskymtx_2 = Ladybug_selectSkyMtx(cumulativeSkyMtx=gencumulativeskymtx.cumulativeSkyMtx, removeDiffuse=False, removeDirect=False)  # -> readMe, selectedSkyMtx; disabled; plug-in component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
number_slider_28 = Slider(4, range=0..10)  # disabled
orientationstudypar = Ladybug_OrientationStudyParameters(
    divisionAngle=number_slider_25,
    totalAngle=number_slider_26,
    basePoint=panel_26,
    rotateContext=toggle_12,
    runTheStudy=toggle_11)  # -> orientationStudyPar; disabled; plug-in component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
legendpar_8 = Ladybug_LegendParameters(lowBound=number_slider_23, highBound=number_slider_24)  # -> legendPar; disabled; plug-in component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
number_slider_29 = Slider(132, range=0..180)  # disabled
panel_27 = Panel(selectskymtx_2.selectedSkyMtx)  # disabled
toggle_13 = BooleanToggle(True)  # disabled
toggle_14 = BooleanToggle(True)  # disabled
panel_28 = Panel("AnchorageOrientation")  # disabled
rotate = Rotate(Geometry=move.Geometry, Angle=number_slider_29, Plane=PlaneXY(0, 0, 0))  # -> Geometry, Transform; disabled
radiationanalysis = Ladybug_RadiationAnalysis(
    north=0,
    geometry=flatten(rotate.Geometry),
    gridSize=number_slider_28,
    disFromBase=number_slider_27,
    selectedSkyMtx=flatten(selectskymtx_2.selectedSkyMtx),
    legendPar=flatten(legendpar_8),
    parallel=toggle_14,
    runIt=toggle_13,
    projectName=panel_28)  # -> readMe, contextMesh, analysisMesh, testPts, testVec, port, radiationResult, radiationMesh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; disabled; plug-in component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
panel_29 = Panel(radiationanalysis.radiationResult)  # disabled

number_slider_30 = Slider(11, range=1..11)  # disabled
number_slider_31 = Slider(0, range=0..1000)  # disabled
number_slider_32 = Slider(1000, range=0..1000)  # disabled
legendpar_9 = Ladybug_LegendParameters(lowBound=number_slider_31, highBound=number_slider_32, numSegments=number_slider_30)  # -> legendPar; disabled; plug-in component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
number_slider_33 = Slider(0.2, range=0..1)  # disabled
pt_7 = Point(<point referenced from the Rhino model>)  # disabled
_3dchart_5 = Ladybug_3DChart(inputData=flatten(importepw.globalHorizontalRadiation), basePoint=pt_7, xScale=number_slider_33, legendPar=legendpar_9)  # -> readMe, graphMesh, graphCurves, legend, legendBasePts, title, titleBasePts, dataPts, conditionalHOY; disabled; plug-in component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

legendpar_10 = Ladybug_LegendParameters(
    lowBound=Slider(-3, range=-3..3),
    highBound=Slider(3, range=-3..3),
    numSegments=Slider(7, range=3..11),
    customColors=flatten([ColourSwatch(SwatchColor=RGB(124, 72, 133)), ColourSwatch(SwatchColor=RGB(255, 255, 255)), ColourSwatch(SwatchColor=RGB(255, 208, 0))]))  # -> legendPar; plug-in component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

number_slider_34 = Slider(100000, range=0..100000)  # disabled
number_slider_35 = Slider(11, range=1..11)  # disabled
number_slider_36 = Slider(0, range=0..100000)  # disabled
legendpar_11 = Ladybug_LegendParameters(lowBound=number_slider_36, highBound=number_slider_34, numSegments=number_slider_35)  # -> legendPar; disabled; plug-in component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
number_slider_37 = Slider(0.2, range=0..1)  # disabled
pt_8 = Point(<point referenced from the Rhino model>)  # disabled
_3dchart_6 = Ladybug_3DChart(
    inputData=flatten(importepw.globalHorizontalIlluminance),
    basePoint=pt_8,
    xScale=number_slider_37,
    legendPar=legendpar_11)  # -> readMe, graphMesh, graphCurves, legend, legendBasePts, title, titleBasePts, dataPts, conditionalHOY; disabled; plug-in component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

legendpar_12 = Ladybug_LegendParameters(lowBound=Slider(0, range=0..1000), highBound=Slider(1000, range=0..1000), numSegments=Slider(11, range=0..100))  # -> legendPar; plug-in component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
series = Series(Start=Slider(1, range=1..12), Step=1, Count=Slider(24, range=0..100))
number_slider_38 = Slider(21, range=1..31)
panel_30 = Panel("""3
6
9
12""")
panel_31 = Panel(series)
sunpath = Ladybug_SunPath(
    north=north,
    location=importepw.location,
    hour=crossref.ListC,
    day=crossref.ListB,
    month=crossref.ListA,
    timeStep=1,
    centerPt=person_2,
    sunPathScale=Slider(0.2, range=0..1),
    annualHourlyData=flatten(importepw.directNormalRadiation),
    legendPar=legendpar_12,
    dailyOrAnnualSunPath=True)  # -> readMe, sunVectors, sunAltitudes, sunAzimuths, port, sunSpheresMesh, sunPathCrvs, legend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; plug-in component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
round = Round(Number=sunpath.selHourlyData)  # -> Nearest, Floor, Ceiling
tag = TextTag3D(
    Location=sunpath.sunPositions,
    Text=round.Nearest,
    Size=Slider(1.5, range=0.1..3),
    Justification=Slider(0.01, range=0..0.01))

number_slider_39 = Slider(11, range=0..11)  # disabled
number_slider_40 = Slider(-20, range=-20..25)  # disabled
number_slider_41 = Slider(25, range=-20..25)  # disabled
panel_32 = Panel("1")  # disabled
panel_33 = Panel("24")  # disabled
series_2 = Series(Start=panel_32, Step=1, Count=panel_33)  # disabled
panel_34 = Panel("""3
6
9
12""")  # disabled
panel_35 = Panel("21")  # disabled
number_slider_42 = Slider(0.2, range=0..1)  # disabled
legendpar_13 = Ladybug_LegendParameters(lowBound=number_slider_40, highBound=number_slider_41, numSegments=number_slider_39)  # -> legendPar; disabled; plug-in component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
panel_36 = Panel("a>0")  # disabled
sunpath_2 = Ladybug_SunPath(
    north=north,
    location=importepw.location,
    hour=series_2,
    day=panel_35,
    month=panel_34,
    timeStep=1,
    centerPt=person_2,
    sunPathScale=number_slider_42,
    annualHourlyData=flatten(importepw.dryBulbTemperature),
    conditionalStatement=panel_36,
    legendPar=legendpar_13,
    dailyOrAnnualSunPath=True)  # -> readMe, sunVectors, sunAltitudes, sunAzimuths, port, sunSpheresMesh, sunPathCrvs, legend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; disabled; plug-in component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
number_slider_43 = Slider(0.01, range=0..0.01)  # disabled
number_slider_44 = Slider(0.1, range=0..0.1)  # disabled
number_slider_45 = Slider(0.5, range=0.1..3)  # disabled
swatch_7 = ColourSwatch(SwatchColor=RGB(255, 217, 0))  # disabled
ln = Line(StartPoint=sunpath_2.sunPathCenPts, EndPoint=sunpath_2.sunPositions)  # disabled
preview_6 = CustomPreview(Geometry=ln, Shader=swatch_7)  # disabled
tag_2 = TextTag3D(Location=sunpath_2.sunPositions, Text=sunpath_2.sunPositionsInfo, Size=number_slider_45, Justification=number_slider_43)  # disabled

number_slider_46 = Slider(7, range=1..12)  # disabled
number_slider_47 = Slider(9, range=1..12)  # disabled
analysisperiod_3 = Ladybug_AnalysisPeriod(fromMonth=number_slider_46, toMonth=number_slider_47)  # -> readMe, analysisPeriod; disabled; plug-in component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
toggle_15 = BooleanToggle(True)  # disabled
windrose = Ladybug_WindRose(
    north=0,
    hourlyWindDirection=importepw.windDirection,
    hourlyWindSpeed=importepw.windSpeed,
    annualHourlyData=flatten(importepw.dryBulbTemperature),
    analysisPeriod=analysisperiod_3.analysisPeriod,
    centerPoint=pt_3,
    maxFrequency=number_slider_9,
    legendPar=legendpar_3,
    runIt=toggle_15)  # -> readMe, calmRoseMesh, windRoseMesh, windRoseCrvs, windRoseCenPts, legend, legendBasePts, title; disabled; plug-in component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

number_slider_48 = Slider(10, range=1..12)  # disabled
number_slider_49 = Slider(12, range=1..12)  # disabled
analysisperiod_4 = Ladybug_AnalysisPeriod(fromMonth=number_slider_48, toMonth=number_slider_49)  # -> readMe, analysisPeriod; disabled; plug-in component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
toggle_16 = BooleanToggle(True)  # disabled
windrose_2 = Ladybug_WindRose(
    north=0,
    hourlyWindDirection=importepw.windDirection,
    hourlyWindSpeed=importepw.windSpeed,
    annualHourlyData=flatten(importepw.dryBulbTemperature),
    analysisPeriod=analysisperiod_4.analysisPeriod,
    centerPoint=pt_3,
    maxFrequency=number_slider_9,
    legendPar=legendpar_3,
    runIt=toggle_16)  # -> readMe, calmRoseMesh, windRoseMesh, windRoseCrvs, windRoseCenPts, legend, legendBasePts, title; disabled; plug-in component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

number_slider_50 = Slider(1, range=1..12)  # disabled
number_slider_51 = Slider(3, range=1..12)  # disabled
analysisperiod_5 = Ladybug_AnalysisPeriod(fromMonth=number_slider_50, toMonth=number_slider_51)  # -> readMe, analysisPeriod; disabled; plug-in component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
toggle_17 = BooleanToggle(True)  # disabled
windrose_3 = Ladybug_WindRose(
    north=0,
    hourlyWindDirection=importepw.windDirection,
    hourlyWindSpeed=importepw.windSpeed,
    annualHourlyData=flatten(importepw.dryBulbTemperature),
    analysisPeriod=analysisperiod_5.analysisPeriod,
    centerPoint=pt_3,
    maxFrequency=number_slider_9,
    legendPar=legendpar_3,
    runIt=toggle_17)  # -> readMe, calmRoseMesh, windRoseMesh, windRoseCrvs, windRoseCenPts, legend, legendBasePts, title; disabled; plug-in component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

number_slider_52 = Slider(4, range=1..12)  # disabled
number_slider_53 = Slider(6, range=1..12)  # disabled
analysisperiod_6 = Ladybug_AnalysisPeriod(fromMonth=number_slider_52, toMonth=number_slider_53)  # -> readMe, analysisPeriod; disabled; plug-in component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
toggle_18 = BooleanToggle(True)  # disabled
windrose_4 = Ladybug_WindRose(
    north=0,
    hourlyWindDirection=importepw.windDirection,
    hourlyWindSpeed=importepw.windSpeed,
    annualHourlyData=flatten(importepw.dryBulbTemperature),
    analysisPeriod=analysisperiod_6.analysisPeriod,
    centerPoint=pt_3,
    maxFrequency=number_slider_9,
    legendPar=legendpar_3,
    runIt=toggle_18)  # -> readMe, calmRoseMesh, windRoseMesh, windRoseCrvs, windRoseCenPts, legend, legendBasePts, title; disabled; plug-in component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

panel_37 = Panel(gencumulativeskymtx.cumulativeSkyMtx)  # disabled

analysisperiod_7 = Ladybug_AnalysisPeriod()  # -> readMe, analysisPeriod; disabled; plug-in component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
toggle_19 = BooleanToggle(True)  # disabled
windrose_5 = Ladybug_WindRose(
    north=0,
    hourlyWindDirection=importepw.windDirection,
    hourlyWindSpeed=importepw.windSpeed,
    annualHourlyData=flatten(importepw.dryBulbTemperature),
    analysisPeriod=analysisperiod_7.analysisPeriod,
    centerPoint=pt_3,
    maxFrequency=number_slider_9,
    legendPar=legendpar_3,
    runIt=toggle_19)  # -> readMe, calmRoseMesh, windRoseMesh, windRoseCrvs, windRoseCenPts, legend, legendBasePts, title; disabled; plug-in component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

legendpar_14 = Ladybug_LegendParameters(
    numSegments=Slider(3, range=3..11),
    customColors=flatten([ColourSwatch(SwatchColor=RGB(124, 72, 133)), ColourSwatch(SwatchColor=RGB(255, 255, 255)), ColourSwatch(SwatchColor=RGB(255, 208, 0))]))  # -> legendPar; plug-in component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

pt_9 = Point(<point referenced from the Rhino model>)

pmvcomfortpar = Ladybug_PMVComfortParameters()  # -> comfortPar; disabled; plug-in component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
analysisperiod_8 = Ladybug_AnalysisPeriod()  # -> readMe, analysisPeriod; disabled; plug-in component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
toggle_20 = BooleanToggle(True)  # disabled
pmvcomfortcalculator = Ladybug_PMVComfortCalculator(
    dryBulbTemperature=importepw.dryBulbTemperature,
    windSpeed=importepw.windSpeed,
    relativeHumidity=importepw.relativeHumidity,
    comfortPar=pmvcomfortpar,
    analysisPeriod=analysisperiod_8.analysisPeriod,
    calcBalanceTemperature=False,
    runIt=toggle_20)  # -> readMe, port, port_2, port_3, OUT_SET, port_4, restrictedComfOrNot, restrictedPercentComf, port_5, balanceTemperature; disabled; plug-in component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
panel_38 = Panel(pmvcomfortcalculator.restrictedPercentComf)  # disabled
number_slider_54 = Slider(30, range=-25..30)  # disabled
number_slider_55 = Slider(-25, range=-25..30)  # disabled
number_slider_56 = Slider(11, range=0..100)  # disabled
legendpar_15 = Ladybug_LegendParameters(lowBound=number_slider_55, highBound=number_slider_54, numSegments=number_slider_56)  # -> legendPar; disabled; plug-in component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
number_slider_57 = Slider(0.2, range=0..1)  # disabled
_3dchart_7 = Ladybug_3DChart(inputData=flatten(pmvcomfortcalculator.OUT_SET), basePoint=pt_9, xScale=number_slider_57, legendPar=legendpar_15)  # -> readMe, graphMesh, graphCurves, legend, legendBasePts, title, titleBasePts, dataPts, conditionalHOY; disabled; plug-in component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

analysisperiod_9 = Ladybug_AnalysisPeriod()  # -> readMe, analysisPeriod; disabled; plug-in component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
toggle_21 = BooleanToggle(True)  # disabled
toggle_22 = BooleanToggle(True)  # disabled
pt_10 = Point(<point referenced from the Rhino model>)  # disabled
adaptivechart = Ladybug_AdaptiveComfortChart(
    dryBulbTemperature=importepw.dryBulbTemperature,
    meanRadiantTemperature=importepw.dryBulbTemperature,
    prevailingOutdoorTemp=importepw.dryBulbTemperature,
    includeColdTime=toggle_21,
    analysisPeriod=analysisperiod_9.analysisPeriod,
    basePoint=pt_10,
    runIt=toggle_22)  # -> readMe, comfPercentOfTime, percentHotCold, comfortableOrNot, conditionOfPerson, degreesFromTarget, port, chartCurvesAndTxt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; disabled; plug-in component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
swatch_8 = ColourSwatch(SwatchColor=RGBA(0, 0, 0, 50))  # disabled
panel_39 = Panel(adaptivechart.percentHotCold)  # disabled
panel_40 = Panel(adaptivechart.comfPercentOfTime)  # disabled
preview_7 = CustomPreview(Geometry=adaptivechart.comfortPolygons, Shader=swatch_8)  # disabled
number_slider_58 = Slider(0.2, range=0..1)  # disabled
_3dchart_8 = Ladybug_3DChart(inputData=flatten(adaptivechart.conditionOfPerson), basePoint=pt_9, xScale=number_slider_58, legendPar=legendpar_14)  # -> readMe, graphMesh, graphCurves, legend, legendBasePts, title, titleBasePts, dataPts, conditionalHOY; disabled; plug-in component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

analysisperiod_10 = Ladybug_AnalysisPeriod()  # -> readMe, analysisPeriod; disabled; plug-in component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
toggle_23 = BooleanToggle(True)  # disabled
outdoorcomfortcalculator = Ladybug_OutdoorComfortCalculator(
    dryBulbTemperature=importepw.dryBulbTemperature,
    windSpeed_tenMeters=importepw.windSpeed,
    relativeHumidity=importepw.relativeHumidity,
    analysisPeriod=analysisperiod_10.analysisPeriod,
    runIt=toggle_23)  # -> readMe, port, universalThermalClimateIndex, comfortableOrNot, thermalStress, conditionOfPerson, port_2, percentOfTimeComfortable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; disabled; plug-in component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
panel_41 = Panel(outdoorcomfortcalculator.universalThermalClimateIndex)  # disabled
panel_42 = Panel(outdoorcomfortcalculator.percentOfTimeComfortable)  # disabled
number_slider_59 = Slider(0.2, range=0..1)  # disabled
_3dchart_9 = Ladybug_3DChart(inputData=flatten(outdoorcomfortcalculator.thermalStress), basePoint=pt_9, xScale=number_slider_59)  # -> readMe, graphMesh, graphCurves, legend, legendBasePts, title, titleBasePts, dataPts, conditionalHOY; disabled; plug-in component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

pt_11 = Point(<point referenced from the Rhino model>)

separatedata_3 = Ladybug_SeparateData(inputList=flatten(adaptivechart.comfortableOrNot))  # -> numbers, strings; disabled; plug-in component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
ma_3 = MassAddition(Input=separatedata_3.numbers)  # -> Result, PartialResults; disabled
panel_43 = Panel(ma_3.Result)  # disabled

ln_2 = Line(StartPoint=sunpath.sunPathCenPts, EndPoint=sunpath.sunPositions)
preview_8 = CustomPreview(Geometry=ln_2, Shader=ColourSwatch(SwatchColor=RGB(255, 203, 33)))

legendpar_16 = Ladybug_LegendParameters(lowBound=Slider(-20, range=-20..25), highBound=Slider(30, range=-20..30), numSegments=Slider(10, range=1..11))  # -> legendPar; plug-in component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
_3dchart_10 = Ladybug_3DChart(
    inputData=flatten(solaradjusttemperature.solarAdjustedMRT),
    basePoint=pt_11,
    xScale=Slider(0.2, range=0..1),
    legendPar=legendpar_16)  # -> readMe, graphMesh, graphCurves, legend, legendBasePts, title, titleBasePts, dataPts, conditionalHOY; plug-in component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

glass_2 = Brep(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)
debrep = DeconstructBrep(Brep=glass_2)  # -> Faces, Edges, Vertices
item_10 = ListItem(List=debrep.Vertices, Index=0, Wrap=True)  # -> Item, Item1, Item2, Item3
brep_3 = Brep(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)

ln_3 = Line(StartPoint=item_10.Item, EndPoint=item_10.Item1)
ln_4 = Line(StartPoint=item_10.Item3, EndPoint=item_10.Item2)
divide = DivideCurve(Curve=ln_4, Count=item_2.Item, Kinks=False)  # -> Points, Tangents, Parameters
divide_2 = DivideCurve(Curve=ln_3, Count=item_2.Item, Kinks=False)  # -> Points, Tangents, Parameters
series_3 = Series(Start=Slider(0, range=0..8), Step=1, Count=item_2.Item)
addition = Addition(A=series_3, B=1)
vec = VectorXYZ(XComponent=item_2.Item2, YComponent=0, ZComponent=0)  # -> Vector, Length
item_11 = ListItem(List=divide_2.Points, Index=series_3, Wrap=True)
item_12 = ListItem(List=divide.Points, Index=addition, Wrap=True)
move_2 = Move(Geometry=item_11, Motion=vec.Vector)  # -> Geometry, Transform
Y = UnitY(Factor=1)
ln_5 = Line(StartPoint=item_11, EndPoint=move_2.Geometry)
ln_6 = Line(StartPoint=item_11, EndPoint=item_12)
rot3d = Rotate3D(Geometry=ln_5, Angle=degrees(item_2.Item1), Center=item_11, Axis=Y)  # -> Geometry, Transform
extrcrv = ExtrudeAlong(Base=rot3d.Geometry, Curve=ln_6)
mirror = MirrorSurface(Geometry=extrcrv, Surface=brep_3, Frame=True)

vec_2 = VectorXYZ(XComponent=item_2.Item2, YComponent=0, ZComponent=0)  # -> Vector, Length
extr = Extrude(Base=debrep.Edges, Direction=vec_2.Vector)

tilted2 = Brep(mirror)
boundary = Brep(extr)
tilted1 = Brep(extrcrv)

shading = Brep([tilted1, tilted2, boundary])
preview_9 = CustomPreview(Geometry=shading, Shader=ColourSwatch(SwatchColor=RGBA(0, 0, 0, 11)))
createhbsrfs_8 = Honeybee_createHBSrfs(geometry=shading, srfName="Shading", srfType="6")  # -> readMe, simplify(HBSurface); plug-in component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
hb_epcontextsrf = HoneybeeEPContextSurfaces(shdSurfaces=flatten(createhbsrfs_8.HBSurface))  # -> HBContext; inputs shdSurfaces: list of Brep, justBoundingBox: Boolean
# ---------- hb_epcontextsrf: Python ----------
"""
prepare shading/context geometries

    Args:
        northVectorOrRotation: A vector that shows North or a number that shows
                               the rotation of the North from the Y axis
        bldgMasses: List of closed Breps as thermal zones.
    Returns:
        report: ...
        thermalZones: Thermal zone's geometries for visualiza
"""

ghenv.Component.Name = 'Honeybee EP context Surfaces'
ghenv.Component.NickName = 'HB_EPContextSrf'
ghenv.Component.Message = 'VER 0.0.58\nNOV_20_2015'
ghenv.Component.Category = "Honeybee"
ghenv.Component.SubCategory = "09 | Energy | Energy"
#compatibleHBVersion = VER 0.0.57\nNOV_01_2015
#compatibleLBVersion = VER 0.0.59\nFEB_01_2015
ghenv.Component.AdditionalHelpFromDocStrings = "2"

import rhinoscriptsyntax as rs
import Rhino as rc
import scriptcontext as sc
import os
import System
import Grasshopper.Kernel as gh
import uuid

tolerance = sc.doc.ModelAbsoluteTolerance
import math


def main(shdSurfaces, EPTransSchedule, meshingSettings, justBoundingBox):
    
    # import the classes
    if sc.sticky.has_key('honeybee_release'):

        try:
            if not sc.sticky['honeybee_release'].isCompatible(ghenv.Component): return -1
        except:
            warning = "You need a newer version of Honeybee to use this compoent." + \
            " Use updateHoneybee component to update userObjects.\n" + \
            "If you have already updated userObjects drag Honeybee_Honeybee component " + \
            "into canvas and try again."
            w = gh.GH_RuntimeMessageLevel.Warning
            ghenv.Component.AddRuntimeMessage(w, warning)
            return -1
        
        # don't customize this part
        hb_EPSrf = sc.sticky["honeybee_EPSurface"]
        hb_EPSHDSurface = sc.sticky["honeybee_EPShdSurface"]
        hb_RADMaterialAUX = sc.sticky["honeybee_RADMaterialAUX"]
        hb_EPObjectsAux = sc.sticky["honeybee_EPObjectsAUX"]()
        HBScheduleList = sc.sticky["honeybee_ScheduleLib"].keys()

        ########################################################################
        #----------------------------------------------------------------------#
        shdBreps = []
        # create bounding box of shading geometries
        if justBoundingBox:
            for brep in shdSurfaces:
                if brep.Faces.Count>1 or not brep.Faces[0].IsPlanar(sc.doc.ModelAbsoluteTolerance):
                    shdBreps.append(brep.GetBoundingBox(True).ToBrep())
                else:
                    shdBreps.append(brep)
        else:
            shdBreps = shdSurfaces
        
        shadingClasses = []
        shadingMeshPreview = []
        
        if meshingSettings == None:
            mp = rc.Geometry.MeshingParameters.Minimal
            mp.SimplePlanes = True
        else:
            mp = meshingSettings
        
        def getRadMaterialName(radMaterial):
            nameStr = radMaterial.split(" ")[2]
            name =  nameStr.split("\n")[0]
            return name
        
        for brepCount, brep in enumerate(shdBreps):
            if brep != None:
                isPlanar = True
                # check planarity
                for face in brep.Faces:
                    if not face.IsPlanar(tolerance):
                        isPlanar = False
                        break
                
                shadingBreps = []
                if not isPlanar:
                    meshArray = rc.Geometry.Mesh.CreateFromBrep(brep, mp)
                    for mesh in meshArray:
                        for meshFace in range(mesh.Faces.Count):
                            vertices = list(mesh.Faces.GetFaceVertices(meshFace))[1:]
                            vertices = vertices + [sc.doc.ModelAbsoluteTolerance]
                            # create the brep from mesh
                            shdBrep = rc.Geometry.Brep.CreateFromCornerPoints(*vertices)
                            shadingBreps.append(shdBrep)
                else:
                    for face in brep.Faces:
                        shadingBreps.append(face.DuplicateFace(False))
                
                for faceCount, shdBrep in enumerate(shadingBreps):
                        thisShading = hb_EPSHDSurface(shdBrep, 1000*brepCount + faceCount, 'shdSrf_' + `brepCount` + '_' + `faceCount` + "_" + str(uuid.uuid4()))
                        
                        # add transmittance schedule if any
                        if EPTransSchedule!=None:
                            schedule= EPTransSchedule.upper()
                            if schedule!=None and not schedule.lower().endswith(".csv") and schedule not in HBScheduleList:
                                msg = "Cannot find " + schedule + " in Honeybee schedule library."
                                print msg
                                ghenv.Component.AddRuntimeMessage(gh.GH_RuntimeMessageLevel.Warning, msg)
                                return -1
                            elif schedule!=None and schedule.lower().endswith(".csv"):
                                # check if csv file is existed
                                if not os.path.isfile(schedule):
                                    msg = "Cannot find the shchedule file: " + schedule
                                    print msg
                                    ghenv.Component.AddRuntimeMessage(gh.GH_RuntimeMessageLevel.Warning, msg)
                                    return -1
                            
                            thisShading.TransmittanceSCH = schedule
                        
                        # add the Rad Material if any
                        if RADMaterial!=None:
                            # if it is just the name of the material make sure it is already defined
                            if len(RADMaterial.split(" ")) == 1:
                                # if the material is not in the library add it to the library
                                if not hb_RADMaterialAUX.isMatrialExistInLibrary(RADMaterial):
                                    warningMsg = "Can't find " + RADMaterial + " in RAD Material Library.\n" + \
                                                "Add the material to the library and try again."
                                    ghenv.Component.AddRuntimeMessage(gh.GH_RuntimeMessageLevel.Warning, warningMsg)
                                    return
                                
                                try:
                                    thisShading.setRADMaterial(RADMaterial)
                                except Exception, e:
                                    print e
                                    warningMsg = "You are using an old version of Honeybee_Honeybee! Update your files and try again."
                                    print warningMsg
                                    ghenv.Component.AddRuntimeMessage(gh.GH_RuntimeMessageLevel.Warning, warningMsg)
                                    return
                                
                                addedToLib = True
                            else:
                                
                                # try to add the material to the library
                                addedToLib, thisShading.RadMaterial = hb_RADMaterialAUX.analyseRadMaterials(RADMaterial, True)
                                
                            if addedToLib==False:
                                warningMsg = "Failed to add " + RADMaterial + " to the Library."
                                ghenv.Component.AddRuntimeMessage(gh.GH_RuntimeMessageLevel.Warning, warningMsg)
                                return
                        
                        # add shading to the list
                        shadingClasses.append(thisShading)
                
        # add to the hive
        hb_hive = sc.sticky["honeybee_Hive"]()
        HBContext  = hb_hive.addToHoneybeeHive(shadingClasses, ghenv.Component.InstanceGuid.ToString())
        return HBContext
        ################################################################################################
    else:
        print "You should first let Honeybee to fly..."
        w = gh.GH_RuntimeMessageLevel.Warning
        ghenv.Component.AddRuntimeMessage(w, "You should first let Honeybee to fly...")
        return -1
        

if _shdSurfaces and _shdSurfaces[0]!=None:
    # add cleaning function
    result= main(_shdSurfaces, EPTransSchedule_, meshingSettings_, justBoundingBox_)
    
    if result != -1: HBContext = result
# ---------- end hb_epcontextsrf ----------
brep_for_daylignting = Brep([brep, createhbsrfs_8.HBSurface])

# ----
# Run Annual Daylight
number_slider_60 = Slider(4, range=0..10)
annualdaylightsimulation = Honeybee_AnnualDaylightSimulation(
    north=north,
    epwWeatherFile=open_epw_stat.epwFile,
    testPoints=gentestpts.testPoints,
    ptsVectors=gentestpts.ptsVectors,
    testMesh=gentestpts.mesh,
    radParameters=radparameters.radParameters)  # -> analysisRecipe; plug-in component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
rundaylightanalysis = Honeybee_RunDaylightSimulation(
    HBObjects=flatten(brep_for_daylignting),
    analysisRecipe=annualdaylightsimulation,
    writeRad=toggle_3,
    runRad=toggle_3,
    numOfCPUs=number_slider_60,
    radFileName=panel_10,
    overwriteResults=Toggle(False))  # -> readMe, analysisType, resultsUnit, results, testPts, resultFiles, radGeoFile, studyFolder, done; plug-in component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
readannualresultsi = Honeybee_ReadAnnualResultI(
    illFilesAddress=rundaylightanalysis.resultFiles,
    testPoints=simplify(rundaylightanalysis.testPts),
    occupancyFiles=gethbzoneepschedules.lightingSchedule,
    DLAIllumThresholds=300,
    lightingControlGroups=lightingcontrol,
    runIt=Toggle(True))  # -> DLA, UDLI_Less_100, UDLI_100_2000, UDLI_More_2000, CDA, sDA, annualProfiles, htmReport; plug-in component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
panel_44 = Panel(readannualresultsi.sDA)

occupancygenerator = Honeybee_DaysimOccupancyGenerator(weekendDays=[1, 2], writeTheOcc=Toggle(True))  # -> occupancyFile; plug-in component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
readannualresultsi_2 = Honeybee_ReadAnnualResultI(
    illFilesAddress=rundaylightanalysis.resultFiles,
    testPoints=simplify(gentestpts.testPoints),
    occupancyFiles=occupancygenerator,
    DLAIllumThresholds=300,
    runIt=Toggle(True))  # -> DLA, UDLI_Less_100, UDLI_100_2000, UDLI_More_2000, CDA, sDA, annualProfiles, htmReport; plug-in component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
panel_45 = Panel(readannualresultsi_2.sDA)

panel_46 = Panel(readannualresultsi.annualProfiles)

# ---- group: just for visualization
# Compare
# Schedules!
dsannualprofiles = Honeybee_DaysimAnnualProfiles(annualProfiles=readannualresultsi.annualProfiles)  # -> simplify(occupancyProfile), simplify(shadingProfiles), simplify(lightingControlProfiles), simplify(dgpProfile); plug-in component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
convertepschvalues = Honeybee_ConvertEnergyPlusScheduleToValues(schName=gethbzoneepschedules.lightingSchedule)  # -> values; plug-in component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
pt_12 = Point(<point referenced from the Rhino model>)
_3dchart_11 = Ladybug_3DChart(
    inputData=flatten([convertepschvalues, dsannualprofiles.lightingControlProfiles]),
    basePoint=pt_12,
    xScale=Slider(0.2, range=0..1))  # -> readMe, graphMesh, graphCurves, legend, legendBasePts, title, titleBasePts, dataPts, conditionalHOY; plug-in component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

# ----
# update lighting schedule
toggle_24 = BooleanToggle(False)
toggle_25 = BooleanToggle(True)
list = ValueList({"Monthly": monthly, "Daily": daily, "Hourly": hourly}, selected="Monthly")
epoutput = Honeybee_GenerateEPOutput(
    zoneEnergyUse=toggle_25,
    zoneGainsAndLosses="False",
    zoneComfortMetrics=toggle_25,
    surfaceTempAnalysis=toggle_24,
    timestep=list)  # -> report, flatten(simulationOutputs); plug-in component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
setepzoneschedules = Honeybee_SetEnergyPlusZoneSchedules(HBZones=setepnatvent.HBZones, lightingSchedules=readannualresultsi.annualProfiles)  # -> schedules, simplify(HBZones); plug-in component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

concat_5 = Concatenate(
    FragmentA=rundaylightanalysis.analysisType,
    FragmentB="_Orient",
    FragmentC=north,
    FragmentD="_Shading",
    FragmentE=panel_3)
number_slider_61 = Slider(0.5, range=0..1)
multiplication = Multiplication(A=number_slider_61, B=-1)
dom = ConstructDomain(DomainStart=number_slider_61, DomainEnd=multiplication)
recolormesh = Ladybug_RecolorMesh(
    analysisResult=readannualresultsi_2.DLA,
    inputMesh=gentestpts.mesh,
    heightDomain=dom,
    legendPar=legendpar,
    analysisTitle=concat_5,
    legendTitle="%")  # -> readMe, newMesh, newLegend, legendBasePt, meshColors, legendColors; plug-in component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
tag_3 = TextTag3D(Location=gentestpts.testPoints, Text=readannualresultsi_2.DLA, Size=Slider(0.1, range=0.1..1), Justification=7)

# ----
# Run the analysis
runenergysimulation = Honeybee_RunEnergySimulation(
    north=north,
    epwFile=open_epw_stat.epwFile,
    HBZones=flatten(setepzoneschedules.HBZones),
    HBContext=flatten(hb_epcontextsrf),
    simulationOutputs=flatten(epoutput.simulationOutputs),
    writeIdf=toggle_5,
    runEnergyPlus=toggle_5,
    idfFileName=panel_10)  # -> report, idfFileAddress, resultFileAddress; plug-in component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
readepresult = Honeybee_ReadEPResult(resultFileAddress=runenergysimulation.resultFileAddress)  # -> port, port_2, port_3, port_4, electricLight, electricEquip, fanElectric, port_5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; plug-in component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
panel_47 = Panel(runenergysimulation.idfFileAddress)

separatedata_4 = Ladybug_SeparateData(inputList=flatten(readepresult.port_3))  # -> numbers, strings; plug-in component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
separatedata_5 = Ladybug_SeparateData(inputList=flatten(readepresult.port_4))  # -> numbers, strings; plug-in component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
separatedata_6 = Ladybug_SeparateData(inputList=flatten(readepresult.electricLight))  # -> numbers, strings; plug-in component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
selectandaveragedata = Ladybug_AverageData(annualHourlyData=readepresult.electricLight, totalOrAverage=Toggle(True))  # -> readMe, selHourlyData, totaledDaily, totaledMonthly, totMonthlyPerHour, totAnalysisPeriod; plug-in component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
ma_4 = MassAddition(Input=separatedata_4.numbers)  # -> Result, PartialResults
ma_5 = MassAddition(Input=separatedata_5.numbers)  # -> Result, PartialResults
ma_6 = MassAddition(Input=separatedata_6.numbers)  # -> Result, PartialResults
total_cooling = Panel(ma_4.Result)
total_heating = Panel(ma_5.Result)
total_lighting = Panel(ma_6.Result)
legendpar_17 = Ladybug_LegendParameters(
    lowBound=Slider(0, range=0..3000),
    highBound=Slider(150, range=0..3000),
    numSegments=Slider(6, range=1..16),
    customColors=flatten([ColourSwatch(SwatchColor=RGB(255, 198, 0)), ColourSwatch(SwatchColor=RGB(255, 86, 98)), ColourSwatch(SwatchColor=RGB(38, 124, 192))]))  # -> legendPar; plug-in component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
pt_graph3_2 = Point(<point referenced from the Rhino model>)
barchart_2 = Ladybug_MonthlyBarChart(
    inputData=flatten(selectandaveragedata.totaledMonthly),
    altTitle=panel_10,
    altYAxisTitle="Cooling, Heating and Lighting Loads",
    basePoint=pt_graph3_2,
    xScale=Slider(0.5, range=0..1),
    yScale=Slider(0.7, range=0..1),
    legendPar=legendpar_17)  # -> readMe, dataMesh, dataCurves, dataCrvColors, graphAxes, graphLabels, title, titleBasePt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; plug-in component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

legendpar_18 = Ladybug_LegendParameters(lowBound=Slider(-20, range=-20..30), highBound=Slider(30, range=-20..30))  # -> legendPar; plug-in component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
pt_13 = Point(<point referenced from the Rhino model>)
_3dchart_12 = Ladybug_3DChart(inputData=flatten(readepresult.airTemperature), basePoint=pt_13, xScale=Slider(0.2, range=0..1), legendPar=legendpar_18)  # -> readMe, graphMesh, graphCurves, legend, legendBasePts, title, titleBasePts, dataPts, conditionalHOY; plug-in component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

legendpar_19 = Ladybug_LegendParameters(lowBound=Slider(-20, range=-20..30), highBound=Slider(30, range=-20..30))  # -> legendPar; plug-in component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
pt_14 = Point(<point referenced from the Rhino model>)
_3dchart_13 = Ladybug_3DChart(
    inputData=flatten(readepresult.meanRadTemperature),
    basePoint=pt_14,
    xScale=Slider(0.2, range=0..1),
    legendPar=legendpar_19)  # -> readMe, graphMesh, graphCurves, legend, legendBasePts, title, titleBasePts, dataPts, conditionalHOY; plug-in component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

adaptcomfortpar = Ladybug_AdaptiveComfortParameters(avgMonthOrRunMean=Toggle(True))  # -> comfortPar; plug-in component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
adaptivecomfortcalculator = Ladybug_AdaptiveComfortCalculator(
    dryBulbTemperature=readepresult.airTemperature,
    meanRadiantTemperature=readepresult.meanRadTemperature,
    prevailingOutdoorTemp=importepw_2.dryBulbTemperature,
    comfortPar=adaptcomfortpar,
    runIt=Toggle(True))  # -> readMe, port, comfortableOrNot, conditionOfPerson, degreesFromTarget, port_2, targetTemperature, upperTemperatureBound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; plug-in component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
panel_48 = Panel(adaptivecomfortcalculator.conditionOfPerson)
panel_49 = Panel([adaptivecomfortcalculator.upperTemperatureBound, adaptivecomfortcalculator.lowerTemperatureBound])
adaptive = Panel(adaptivecomfortcalculator.percentOfTimeComfortable)
panel_50 = Panel(adaptivecomfortcalculator.percentHotCold)
_3dchart_14 = Ladybug_3DChart(
    inputData=flatten(adaptivecomfortcalculator.conditionOfPerson),
    basePoint=pt_11,
    xScale=Slider(0.2, range=0..1),
    legendPar=legendpar_14)  # -> readMe, graphMesh, graphCurves, legend, legendBasePts, title, titleBasePts, dataPts, conditionalHOY; plug-in component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

pmvcomfortpar_2 = Ladybug_PMVComfortParameters()  # -> comfortPar; plug-in component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
pmvcomfortcalculator_2 = Ladybug_PMVComfortCalculator(
    dryBulbTemperature=readepresult.airTemperature,
    meanRadiantTemperature=readepresult.meanRadTemperature,
    relativeHumidity=readepresult.relativeHumidity,
    comfortPar=pmvcomfortpar_2,
    calcBalanceTemperature=False,
    runIt=Toggle(True))  # -> readMe, port, predictedMeanVote, percentPeopleDissatisfied, standardEffectiveTemperature, port_2, comfortableOrNot, percentOfTimeComfortable, port_3, balanceTemperature; plug-in component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
separatedata_7 = Ladybug_SeparateData(inputList=flatten(pmvcomfortcalculator_2.comfortableOrNot))  # -> numbers, strings; plug-in component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
pmv = Panel(pmvcomfortcalculator_2.percentOfTimeComfortable)
ma_7 = MassAddition(Input=separatedata_7.numbers)  # -> Result, PartialResults
panel_51 = Panel(ma_7.Result)
pt_15 = Point(<point referenced from the Rhino model>)
_3dchart_15 = Ladybug_3DChart(
    inputData=flatten(pmvcomfortcalculator_2.predictedMeanVote),
    basePoint=pt_11,
    xScale=Slider(0.2, range=0..1),
    legendPar=legendpar_10)  # -> readMe, graphMesh, graphCurves, legend, legendBasePts, title, titleBasePts, dataPts, conditionalHOY; plug-in component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

analysisperiod_11 = Ladybug_AnalysisPeriod()  # -> readMe, analysisPeriod; plug-in component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
pt_16 = Point(<point referenced from the Rhino model>)
adaptivechart_2 = Ladybug_AdaptiveComfortChart(
    dryBulbTemperature=readepresult.airTemperature,
    meanRadiantTemperature=readepresult.meanRadTemperature,
    prevailingOutdoorTemp=importepw_2.dryBulbTemperature,
    includeColdTime=Toggle(True),
    analysisPeriod=analysisperiod_11.analysisPeriod,
    basePoint=pt_16,
    runIt=Toggle(True))  # -> readMe, comfPercentOfTime, percentHotCold, comfortableOrNot, conditionOfPerson, degreesFromTarget, port, chartCurvesAndTxt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; plug-in component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
panel_52 = Panel(adaptivechart_2.comfPercentOfTime)
panel_53 = Panel(adaptivechart_2.percentHotCold)
preview_10 = CustomPreview(Geometry=adaptivechart_2.comfortPolygons, Shader=ColourSwatch(SwatchColor=RGBA(0, 0, 0, 50)))
_3dchart_16 = Ladybug_3DChart(
    inputData=flatten(adaptivechart_2.conditionOfPerson),
    basePoint=pt_9,
    xScale=Slider(0.2, range=0..1),
    legendPar=legendpar_14)  # -> readMe, graphMesh, graphCurves, legend, legendBasePts, title, titleBasePts, dataPts, conditionalHOY; plug-in component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

separatedata_8 = Ladybug_SeparateData(inputList=flatten(adaptivecomfortcalculator.comfortableOrNot))  # -> numbers, strings; plug-in component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

multiplication_2 = Multiplication(A=total_cooling, B=100)
multiplication_3 = Multiplication(A=total_heating, B=100)
multiplication_4 = Multiplication(A=total_lighting, B=100)
round_2 = Round(Number=multiplication_2)  # -> Nearest, Floor, Ceiling
round_3 = Round(Number=multiplication_3)  # -> Nearest, Floor, Ceiling
round_4 = Round(Number=multiplication_4)  # -> Nearest, Floor, Ceiling
division = Division(A=round_2.Nearest, B=100)
division_2 = Division(A=round_3.Nearest, B=100)
division_3 = Division(A=round_4.Nearest, B=100)
addition_2 = Addition(A=division, B=division_2, C=division_3)
concat_6 = Concatenate(
    FragmentH="Shading_",
    FragmentG=panel_3,
    FragmentA="__Load_C",
    FragmentB=division,
    FragmentC="_H",
    FragmentD=division_2,
    FragmentE="_L",
    FragmentF=division_3,
    FragmentI="_T",
    FragmentJ=addition_2)
panel_54 = Panel(concat_6)

rec = DataRecorder(panel_54, DataLimit=-10, RecordData=True)
panel_55 = Panel(rec)
ma_8 = MassAddition(Input=separatedata_8.numbers)  # -> Result, PartialResults
panel_56 = Panel(ma_8.Result)

# ----
# Run Image-Based Daylight
number_slider_62 = Slider(1, range=0..2)
number_slider_63 = Slider(600, range=0..1000)
imagebasedsimulation = Honeybee_ImageBasedSimulation(
    skyFile=genclimatebasedsky.skyFilePath,
    rhinoViewsName="Glare",
    cameraType=number_slider_62,
    simulationType=Slider(2, range=0..2),
    imageWidth=number_slider_63,
    imageHeight=number_slider_63,
    radParameters=radparameters_2.radParameters,
    backupImages=0)  # -> analysisRecipe; plug-in component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

concat_7 = Concatenate(FragmentA="Glare2_", FragmentB="NoShading", FragmentC="_", FragmentD=panel_8)
panel_57 = Panel(concat_7)

rundaylightanalysis_2 = Honeybee_RunDaylightSimulation(
    HBObjects=flatten(brep_for_daylignting),
    analysisRecipe=imagebasedsimulation,
    writeRad=toggle_2,
    runRad=toggle_2,
    numOfCPUs=Slider(4, range=1..4),
    workingDir="C:\Users\NEW\Desktop\Final_Anchorage\GlareImage",
    radFileName=concat_7,
    overwriteResults=Toggle(False))  # -> readMe, analysisType, resultsUnit, results, testPts, resultFiles, radGeoFile, studyFolder, done; plug-in component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
glareanalysis = Honeybee_GlareAnalysis(HDRImagePath=rundaylightanalysis_2.resultFiles, runIt=Toggle(True))  # -> readMe, glareCheckImage, DGP, DGI, imageWithTaskArea; plug-in component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
falsecolor = Honeybee_FalseColor(
    HDRFilePath=rundaylightanalysis_2.resultFiles,
    contourBands=False,
    maskThreshold=0.1,
    useAlterColors=False,
    render=Toggle(False))  # -> outputFilePath; plug-in component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
dgp = Panel(glareanalysis.DGP)
hdr_tif = Honeybee_ConvertHDRToTIF(HDRFilePath=falsecolor, adjustExposure=False)  # -> TIFFFilePath; plug-in component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
hdr_gif = Honeybee_ConvertHDRToGIF(HDRFilePath=glareanalysis.glareCheckImage, adjustExposure=Toggle(False))  # -> GIFFilePath; plug-in component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
image = ImageFromPath(P=hdr_gif, S=Slider(0.8, range=0..1))

dgi = Panel(glareanalysis.DGI)
multiplication_5 = Multiplication(A=dgp, B=100)
multiplication_6 = Multiplication(A=dgi, B=100)
round_5 = Round(Number=multiplication_5)  # -> Nearest, Floor, Ceiling
round_6 = Round(Number=multiplication_6)  # -> Nearest, Floor, Ceiling
division_4 = Division(A=round_5.Nearest, B=100)
division_5 = Division(A=round_6.Nearest, B=100)

concat_8 = Concatenate(
    FragmentA=rundaylightanalysis_2.analysisType,
    FragmentB="_",
    FragmentC=panel_8,
    FragmentD="_DGP:",
    FragmentE=division_4,
    FragmentF="_DGI:",
    FragmentG=division_5)
panel_58 = Panel(concat_8)
rec_2 = DataRecorder(panel_58, DataLimit=-10, RecordData=True)
panel_59 = Panel(rec_2)

# ----
# Run Grid-Based Daylight
number_slider_64 = Slider(0, range=0..2)
gridbasedsimulation = Honeybee_GridBasedSimulation(
    skyFile=genclimatebasedsky.skyFilePath,
    testPoints=gentestpts.testPoints,
    ptsVectors=gentestpts.ptsVectors,
    testMesh=gentestpts.mesh,
    simulationType=number_slider_64,
    radParameters=radparameters_2.radParameters)  # -> analysisRecipe; plug-in component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
rundaylightanalysis_3 = Honeybee_RunDaylightSimulation(
    HBObjects=flatten(brep_for_daylignting),
    analysisRecipe=gridbasedsimulation,
    writeRad=toggle_4,
    runRad=toggle_4,
    numOfCPUs=Slider(4, range=0..10),
    radFileName=panel_10,
    overwriteResults=Toggle(False))  # -> readMe, analysisType, resultsUnit, results, testPts, resultFiles, radGeoFile, studyFolder, done; plug-in component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
round_7 = Round(Number=rundaylightanalysis_3.results)  # -> Nearest, Floor, Ceiling

panel_60 = Panel(rundaylightanalysis_3.results)
bnd = Bounds(Numbers=panel_60)
panel_61 = Panel(bnd)
split_5 = TextSplit(Text=panel_61, Separators="To")
item_13 = ListItem(List=split_5, Index=0, Wrap=True)  # -> Item, Item1, Item2
min = Panel(item_13.Item)
max = Panel(item_13.Item2)
round_8 = Round(Number=min)  # -> Nearest, Floor, Ceiling
round_9 = Round(Number=max)  # -> Nearest, Floor, Ceiling

legendpar_20 = Ladybug_LegendParameters(lowBound=Slider(0, range=0..25000), highBound=Slider(5000, range=0..25000), decimalPlaces=Slider(1, range=0..2))  # -> legendPar; plug-in component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
number_slider_65 = Slider(0.5, range=0..1)
multiplication_7 = Multiplication(A=number_slider_65, B=-1)
dom_2 = ConstructDomain(DomainStart=number_slider_65, DomainEnd=multiplication_7)
concat_9 = Concatenate(
    FragmentA=rundaylightanalysis_3.analysisType,
    FragmentB="_",
    FragmentC=panel_8,
    FragmentD="_Min",
    FragmentE=round_8.Nearest,
    FragmentF="_Max",
    FragmentG=round_9.Nearest)
recolormesh_2 = Ladybug_RecolorMesh(
    analysisResult=rundaylightanalysis_3.results,
    inputMesh=gentestpts.mesh,
    heightDomain=dom_2,
    legendPar=legendpar_20,
    analysisTitle=concat_9,
    legendTitle=rundaylightanalysis_3.resultsUnit)  # -> readMe, newMesh, newLegend, legendBasePt, meshColors, legendColors; plug-in component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
tag_4 = TextTag3D(Location=gentestpts.testPoints, Text=round_7.Nearest, Size=Slider(0.1, range=0.1..1), Justification=7)

panel_62 = Panel(concat_9)
