# Grasshopper definition Annual Daylight Analysis_RajikaM.gh (Grasshopper 0.9.70)
# plug-ins: Python Interpreter

honeybee = Honeybee_Honeybee(defaultFolder="c:\honeybee")  # -> Vviiiiiiiiiizzz; plug-in component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
ladybug = Ladybug_Ladybug(defaultFolder="c:\ladybug")  # -> Vviiiiiiiiiizzz; plug-in component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
exterior_wall = Brep(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)

# ---- group: ceiling
ceiling = Brep([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])

# ----
ledge = Brep(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)

# ---- group: floor
floor = Brep(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)

# ----
walls = Brep([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])
wall_surface_with_opening = Brep(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)
# Geometry Preparation
panel = Panel("0")
createhbsrfs = Honeybee_createHBSrfs(geometry=wall_surface_with_opening, srfType="0")  # -> readMe, simplify(HBSurface); plug-in component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
createhbsrfs_2 = Honeybee_createHBSrfs(geometry=flatten(exterior_wall), srfType="0")  # -> readMe, simplify(HBSurface); plug-in component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
createhbsrfs_3 = Honeybee_createHBSrfs(geometry=flatten(floor), srfType="2")  # -> readMe, simplify(HBSurface); plug-in component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
createhbsrfs_4 = Honeybee_createHBSrfs(geometry=flatten(ledge), srfType="2")  # -> readMe, simplify(HBSurface); plug-in component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
createhbsrfs_5 = Honeybee_createHBSrfs(geometry=ceiling, srfType="3")  # -> readMe, simplify(HBSurface); plug-in component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
# Honeybee default materials will be assigned
# based on surface type
createhbsrfs_6 = Honeybee_createHBSrfs(geometry=walls, srfType=panel)  # -> readMe, simplify(HBSurface); plug-in component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
glass = Brep(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)
preview = CustomPreview(Geometry=glass, Shader=ColourSwatch(SwatchColor=RGBA(80, 222, 255, 160)))
addhbglz = Honeybee_addHBGlz(HBObj=createhbsrfs.HBSurface, childSurfaces=flatten(glass))  # -> simplify(HBObjWGLZ); plug-in component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

# ---- group: Make all surfaces except the exterior wall adiabatic
makeadiabatic = Honeybee_MakeAdiabatic(HBSrfs=flatten([createhbsrfs_6.HBSurface, createhbsrfs_5.HBSurface, createhbsrfs_3.HBSurface]))  # -> HBSrfs; plug-in component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

# ----
bldgprograms = Honeybee_bldgPrograms({"Office": 0, "Retail": 1, "MidriseApartment": 2, "PrimarySchool": 3, "SecondarySchool": 4, "SmallHotel": 5, "LargeHotel": 6, "Hospital": 7, "Outpatient": 8, "Warehouse": 9, "SuperMarket": 10, "FullServiceRestaurant": 11, "QuickServiceRestaurant": 12}, selected="MidriseApartment")
listzoneprograms = Honeybee_ListZonePrograms(bldgProgram=bldgprograms)  # -> MidriseApartmentZonePrograms; plug-in component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
item = ListItem(List=listzoneprograms, Index=0, Wrap=True)

# ---- group: collect all honeybee surfaces
brep = Brep(flatten([makeadiabatic, addhbglz, createhbsrfs_4.HBSurface, createhbsrfs_2.HBSurface]))

# ----
panel_2 = Panel(item)
createhbzones = Honeybee_createHBZones(name="test_room", zoneProgram=item, HBSurfaces=flatten(brep))  # -> readMe, HBZone; plug-in component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
panel_3 = Panel("Bronze Tinted Glass window  double glaze unit has VT = .45 SHGC=.5")
wires = BrepWireframe(Brep=createhbzones.HBZone, Density=-1)
epglassmat = Honeybee_EnergyPlusGlassMaterial(name=panel_3, solarTransmittance=Slider(0.45, range=0..1), visibleTransmittance=Slider(0.5, range=0..1))  # -> EPMaterial; plug-in component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
epwindowairgap = Honeybee_EnergyPlusWindowAirGap(name="AIR_10mm", thickness="0.010")  # -> EPMaterial; plug-in component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
epconstruction = Honeybee_EnergyPlusConstruction(name="Bronze Glass", layer_1=epglassmat, layer_2=epwindowairgap, layer_3=epglassmat)  # -> EPConstruction; plug-in component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

# ---- group: HB Zone With Glazing
brep_2 = Brep(createhbzones.HBZone)

# ----
brep_3 = Brep([<brep referenced from the Rhino model> x4])
open_weather_file = Ladybug_OpenEPWWeatherFile(open=Toggle(True))  # -> epwFile; plug-in component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
createhbsrfs_7 = Honeybee_createHBSrfs(geometry=brep_3, srfType="6", EPConstruction=epconstruction)  # -> readMe, simplify(HBSurface); plug-in component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
genhbzonetestpts = Honeybee_GenerateZoneTestPoints(
    HBZone=createhbzones.HBZone,
    gridSize=Slider(0.4, range=0..1),
    distBaseSrf=Slider(0.762, range=0..1),
    moveTestMesh=Toggle(True))  # -> readMe, simplify(testPoints), simplify(ptsVectors), simplify(facesArea), simplify(mesh); plug-in component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
radparameters = Honeybee_RADParameters(quality=0, ab="3")  # -> readMe, radParameters; plug-in component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
number_slider = Slider(90, range=0..1000)
wires_2 = BrepWireframe(Brep=createhbsrfs_7.HBSurface, Density=-1)
annualdaylightsimulation = Honeybee_AnnualDaylightSimulation(
    north=number_slider,
    epwWeatherFile=open_weather_file,
    testPoints=genhbzonetestpts.testPoints,
    ptsVectors=genhbzonetestpts.ptsVectors,
    testMesh=genhbzonetestpts.mesh,
    radParameters=radparameters.radParameters)  # -> analysisRecipe; plug-in component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
northarrow = Ladybug_North(north=number_slider)  # -> northSign; plug-in component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
# Put the recipie together!
toggle = BooleanToggle(True)
# Run the analysis
rundaylightanalysis = Honeybee_RunDaylightSimulation(
    HBObjects=flatten([brep_2, createhbsrfs_7.HBSurface]),
    analysisRecipe=annualdaylightsimulation,
    writeRad=toggle,
    runRad=toggle)  # -> readMe, analysisType, resultsUnit, results, testPts, resultFiles, radGeoFile, studyFolder, done; plug-in component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
occupancygenerator = Honeybee_DaysimOccupancyGenerator(weekendDays=[1, 2], writeTheOcc=Toggle(True))  # -> occupancyFile; plug-in component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
# Generate annual results
readannualresultsi = Honeybee_ReadAnnualResultI(
    illFilesAddress=rundaylightanalysis.resultFiles,
    testPoints=simplify(rundaylightanalysis.testPts),
    occupancyFiles=occupancygenerator,
    runIt=Toggle(True))  # -> DLA, UDLI_Less_100, UDLI_100_2000, UDLI_More_2000, CDA, sDA, annualProfiles, htmReport; plug-in component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
gradientlibrary = Ladybug_GradientLibrary(gradIndex=Slider(1, range=0..10))  # -> customColors; plug-in component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
pt = Point(<point referenced from the Rhino model>)
legendpar = Ladybug_LegendParameters(
    lowBound=Slider(1, range=0..100),
    highBound=Slider(100, range=0..100),
    numSegments=Slider(9, range=0..10),
    customColors=flatten(gradientlibrary),
    legendLocation=pt)  # -> legendPar; plug-in component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
mjoin = MeshJoin(Meshes=genhbzonetestpts.mesh)

# ---- group: make it 3D!
dom = ConstructDomain(DomainStart=0, DomainEnd=Slider(0, range=0..1))

# ----
# Visualize the results
recolormesh = Ladybug_RecolorMesh(
    analysisResult=readannualresultsi.UDLI_More_2000,
    inputMesh=mjoin,
    heightDomain=dom,
    legendPar=legendpar,
    analysisTitle=rundaylightanalysis.analysisType,
    legendTitle="%")  # -> readMe, newMesh, newLegend, legendBasePt, meshColors, legendColors; plug-in component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
