# Grasshopper definition Glare_Analysis_RajikaM.gh (Grasshopper 0.9.70)
# plug-ins: Python Interpreter, embryoA

honeybee = Honeybee_Honeybee(defaultFolder="c:\honeybee")  # -> Vviiiiiiiiiizzz; plug-in component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
ladybug = Ladybug_Ladybug(defaultFolder="c:\ladybug")  # -> Vviiiiiiiiiizzz; plug-in component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
exterior_wall = Brep(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)

# ---- group: ceiling
ceiling = Brep([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])

# ----
ledge = Brep(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)
walls = Brep([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])

# ---- group: floor
floor = Brep(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)

# ----
wall_surface_with_opening = Brep(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)
# Geometry Preparation
panel = Panel("0")
createhbsrfs = Honeybee_createHBSrfs(geometry=flatten(exterior_wall), srfType="0")  # -> readMe, simplify(HBSurface); plug-in component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
createhbsrfs_2 = Honeybee_createHBSrfs(geometry=flatten(floor), srfType="2")  # -> readMe, simplify(HBSurface); plug-in component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
createhbsrfs_3 = Honeybee_createHBSrfs(geometry=flatten(ledge), srfType="2")  # -> readMe, simplify(HBSurface); plug-in component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
createhbsrfs_4 = Honeybee_createHBSrfs(geometry=wall_surface_with_opening, srfType="0")  # -> readMe, simplify(HBSurface); plug-in component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
createhbsrfs_5 = Honeybee_createHBSrfs(geometry=ceiling, srfType="3")  # -> readMe, simplify(HBSurface); plug-in component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
# Honeybee default materials will be assigned
# based on surface type
createhbsrfs_6 = Honeybee_createHBSrfs(geometry=walls, srfType=panel)  # -> readMe, simplify(HBSurface); plug-in component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
glass = Brep(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)
preview = CustomPreview(Geometry=glass, Shader=ColourSwatch(SwatchColor=RGBA(80, 222, 255, 160)))
addhbglz = Honeybee_addHBGlz(HBObj=createhbsrfs_4.HBSurface, childSurfaces=flatten(glass))  # -> simplify(HBObjWGLZ); plug-in component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

# ---- group: Make all surfaces except the exterior wall adiabatic
makeadiabatic = Honeybee_MakeAdiabatic(HBSrfs=flatten([createhbsrfs_6.HBSurface, createhbsrfs_5.HBSurface, createhbsrfs_2.HBSurface]))  # -> HBSrfs; plug-in component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

# ----
bldgprograms = Honeybee_bldgPrograms({"Office": 0, "Retail": 1, "MidriseApartment": 2, "PrimarySchool": 3, "SecondarySchool": 4, "SmallHotel": 5, "LargeHotel": 6, "Hospital": 7, "Outpatient": 8, "Warehouse": 9, "SuperMarket": 10, "FullServiceRestaurant": 11, "QuickServiceRestaurant": 12}, selected="MidriseApartment")
listzoneprograms = Honeybee_ListZonePrograms(bldgProgram=bldgprograms)  # -> MidriseApartmentZonePrograms; plug-in component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
item = ListItem(List=listzoneprograms, Index=0, Wrap=True)

# ---- group: collect all honeybee surfaces
brep = Brep(flatten([makeadiabatic, addhbglz, createhbsrfs_3.HBSurface, createhbsrfs.HBSurface]))

# ----
panel_2 = Panel(item)
createhbzones = Honeybee_createHBZones(name="test_room", zoneProgram=item, HBSurfaces=flatten(brep))  # -> readMe, HBZone; plug-in component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
wires = BrepWireframe(Brep=createhbzones.HBZone, Density=-1)
panel_3 = Panel("Bronze Tinted Glass window  double glaze unit has VT = .45 SHGC=.5")
epglassmat = Honeybee_EnergyPlusGlassMaterial(name=panel_3, solarTransmittance=Slider(0.45, range=0..1), visibleTransmittance=Slider(0.5, range=0..1))  # -> EPMaterial; plug-in component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
open_weather_file = Ladybug_OpenEPWWeatherFile(open=Toggle(True))  # -> epwFile; plug-in component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
epwindowairgap = Honeybee_EnergyPlusWindowAirGap(name="AIR_10mm", thickness="0.010")  # -> EPMaterial; plug-in component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
number_slider = Slider(90, range=0..100)

# ---- group: For better visualization - Doesn't effect the results of the analysis
importlocation = Ladybug_ImportLocation(epwFile=open_weather_file)  # -> location; plug-in component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
sunpath = Ladybug_SunPath(
    north=number_slider,
    location=importlocation,
    hour="9",
    day="21",
    month="3",
    timeStep=1,
    sunPathScale=Slider(0.2, range=0..1),
    dailyOrAnnualSunPath=True)  # -> readMe, sunVectors, sunAltitudes, sunAzimuths, port, sunSpheresMesh, sunPathCrvs, legend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; plug-in component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

# ----
epconstruction = Honeybee_EnergyPlusConstruction(name="newGlass_Cnstr", layer_1=epglassmat, layer_2=epwindowairgap, layer_3=epglassmat)  # -> EPConstruction; plug-in component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
northarrow = Ladybug_North(north=number_slider, scale=".05")  # -> northSign; plug-in component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
genclimatebasedsky = Honeybee_GenerateClimateBasedSky(north=number_slider, weatherFile=open_weather_file, month="3", day="21", hour="9")  # -> radiationValues, skyFilePath; plug-in component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
genavgsky = Honeybee_GenerateAverageSky(north=number_slider, weatherFile=open_weather_file, month="3", hour="9")  # -> radiationValues, skyFilePath; plug-in component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
brep_2 = Brep([<brep referenced from the Rhino model> x4])
brep_3 = Brep(<brep referenced from the Rhino model>)
# Shading
createhbsrfs_7 = Honeybee_createHBSrfs(geometry=brep_3, srfType="6", EPConstruction=epconstruction)  # -> readMe, simplify(HBSurface); plug-in component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
createhbsrfs_8 = Honeybee_createHBSrfs(geometry=brep_2)  # -> readMe, simplify(HBSurface); plug-in component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
panel_4 = Panel([genclimatebasedsky.radiationValues, genavgsky.radiationValues])
doy_hoy = Ladybug_DOY_HOY(days="21", months="3", hours="9")  # -> HOY, DOY, date; plug-in component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
set_the_view_to_fisheye_for_glare_analys = Panel("1")  # "set the view to FishEye for Glare Analysis"
radparameters = Honeybee_RADParameters(ab="3")  # -> readMe, radParameters; plug-in component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
wires_2 = BrepWireframe(Brep=[createhbsrfs_7.HBSurface, createhbsrfs_8.HBSurface], Density=-1)
# Analysis Recipe
imagebasedsimulation = Honeybee_ImageBasedSimulation(
    skyFile=genavgsky.skyFilePath,
    cameraType=set_the_view_to_fisheye_for_glare_analys,
    simulationType=2,
    radParameters=radparameters.radParameters,
    backupImages=0)  # -> analysisRecipe; plug-in component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
toggle = BooleanToggle(True)
# Run the analysis
rundaylightanalysis = Honeybee_RunDaylightSimulation(
    HBObjects=flatten([createhbsrfs_8.HBSurface, createhbzones.HBZone, createhbsrfs_7.HBSurface]),
    analysisRecipe=imagebasedsimulation,
    writeRad=toggle,
    runRad=toggle,
    numOfCPUs="4",
    radFileName=doy_hoy.date,
    overwriteResults=True)  # -> readMe, analysisType, resultsUnit, results, testPts, luminance_files, radGeoFile, studyFolder, done; plug-in component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
panel_5 = Panel("""Radiance
Grasshopper
Honeybee
Glare
Daylight
Set View
HBExampleFiles""")
panel_6 = Panel("""This file shows how to run a glare analysis using Honeybee. This example is using same geometry as the other daylighting examples [[1](http://hydrashare.github.io/hydra/viewer?owner=mostaphaRoudsari&fork=hydra_1&id=Surface_by_surface_geometry_preparation_for_daylight_simulation_II), [2](http://hydrashare.github.io/hydra/viewer?owner=mostaphaRoudsari&fork=hydra_1&id=Find_when_sun_is_visible_to_a_point)].
The example is uses Averaged Climate-based Sky for glare analysis which uses the average value for that hour during the whole month.""")
md_slider = MDSlider(
    slider_value=Point(0.5215606689, 0.5079524343, 0.5),
    SliderMode=0,
    x_domain=Domain(-1, 1),
    y_domain=Domain(-1, 1),
    z_domain=Domain(0, 1))
panel_7 = Panel("C:\Users\Administrator\Dropbox\ladybug\helpDesk\PennDesign2015\Daylight_Glare_Analysis.png")
exporthydra = Hydra_ExportFile(
    fileName="Glare Analysis",
    fileDescription=panel_6,
    fileTags=panel_5,
    targetFolder="C:\Users\Administrator\Documents\GitHub\hydra_1",
    includeRhino=Toggle(True),
    additionalImgs=panel_7,
    export=Toggle(False))  # -> readMe; inputs fileDescription: list, changeLog: list, fileTags: list, includeRhino: Boolean, GHForThumb: Boolean, additionalImgs: list, export: Boolean; plug-in component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
falsecolor = Honeybee_FalseColor(
    HDRFilePath=rundaylightanalysis.luminance_files,
    contourBands=False,
    maskThreshold=0.1,
    useAlterColors=False,
    render=Toggle(True))  # -> outputFilePath; plug-in component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
glareanalysis = Honeybee_GlareAnalysis(HDRImagePath=rundaylightanalysis.luminance_files, runIt=Toggle(True))  # -> readMe, glareCheckImage, DGP, DGI, imageWithTaskArea; plug-in component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
# DGP: Daylight glare probability:
# Imperceptible Glare [0.35 > DGP]
# Perceptible Glare [0.4 > DGP >= 0.35]
# Disturbing Glare [0.45 > DGP >= 0.4]
# Intolerable Glare [DGP >= 0.45]
panel_8 = Panel(glareanalysis.DGP)
hdr_tif = Honeybee_ConvertHDRToTIF(HDRFilePath=falsecolor, adjustExposure=False)  # -> TIFFFilePath; plug-in component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
number_slider_2 = Slider(0.8, range=0..1)
hdr_tif_2 = Honeybee_ConvertHDRToTIF(HDRFilePath=glareanalysis.glareCheckImage, adjustExposure=Toggle(False))  # -> TIFFFilePath; plug-in component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
panel_9 = Panel(hdr_tif)
image = ImageFromPath(P=hdr_tif_2, S=number_slider_2)
image_2 = ImageFromPath(P=hdr_tif, S=number_slider_2)

pt = Point(Point(3, 2.544838682, 0.1224289629))
# set the view
comfortmannequin = Ladybug_ComfortMannequin(rotationAngle="175", bodyLocation=pt)  # -> mannequinMesh, legend, legendBasePt; plug-in component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

# ---- group: Person's face!
item_2 = ListItem(List=comfortmannequin.mannequinMesh, Index=121, Wrap=True)

# ----
preview_2 = CustomPreview(Geometry=item_2, Shader=ColourSwatch(SwatchColor=RGB(255, 0, 0)))

facen = FaceNormals(Mesh=item_2)  # -> Centers, Normals
settheview = Ladybug_SetTheView(cameraLocation=facen.Centers, cameraDirection=facen.Normals, uvLookAround=md_slider)  # -> readMe; plug-in component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
