# Grasshopper definition Mathur_Pegah.gh (Grasshopper 0.9.76)
# plug-ins: Python Interpreter

panel = Panel("""Honeybee
Energy
Daylighting
EnergyPlus
Daysim
Radiance""")
ladybug = Ladybug_Ladybug()  # -> Vviiiiiiiiiizzz; plug-in component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
honeybee = Honeybee_Honeybee()  # -> Vviiiiiiiiiizzz; plug-in component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
panel_2 = Panel("This is an example that shows how to integrate results of daylighting simulation with an energy simulation")

# ---- group: floor
floor = Brep(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)

# ----
ledge = Brep(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)

# ---- group: ceiling
ceiling = Brep([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])

# ----
walls = Brep([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])
wall_surface_with_opening = Brep(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)
brep = Brep(<brep referenced from the Rhino model>)
exporthydra = Hydra_ExportFile(
    fileName="Integrated_Daylight_and_Energy_similation",
    fileDescription=panel_2,
    fileTags=panel,
    targetFolder="C:\Users\Administrator\Documents\GitHub\hydra_1",
    export=Toggle(False))  # -> readMe; inputs fileDescription: list, changeLog: list, fileTags: list, includeRhino: Boolean, GHForThumb: Boolean, additionalImgs: list, export: Boolean; plug-in component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
# Geometry Preparation
panel_3 = Panel("0")
toggle = BooleanToggle(True)
mass2zone = Honeybee_Masses2Zones(zoneMasses=flatten(brep), isConditioned=True, maxRoofAngle=30, createHBZones=Toggle(True))  # -> readMe, HBZones; plug-in component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
createhbsrfs = Honeybee_createHBSrfs(geometry=flatten([floor, ledge]), srfType="2")  # -> readMe, simplify(HBSurface); plug-in component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
createhbsrfs_2 = Honeybee_createHBSrfs(geometry=ceiling, srfType="3")  # -> readMe, simplify(HBSurface); plug-in component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
createhbsrfs_3 = Honeybee_createHBSrfs(geometry=wall_surface_with_opening, srfType="0")  # -> readMe, simplify(HBSurface); plug-in component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
createhbsrfs_4 = Honeybee_createHBSrfs(geometry=walls, srfType=panel_3)  # -> readMe, simplify(HBSurface); plug-in component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
radopaquematerial = Honeybee_RadianceOpaqueMaterial(RReflectance=0, GReflectance=0, BReflectance=0, roughness=0.05, specularity=0)  # -> avrgRef, RADMaterial; plug-in component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
glass = Brep(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)
makeadiabaticbytype = Honeybee_MakeAdiabaticByType(HBZones=mass2zone.HBZones, roofs=toggle, ceilings=toggle, floors=toggle, exposedFloors=toggle, groundFloors=toggle)  # -> HBZones; plug-in component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
preview = CustomPreview(Geometry=glass, Shader=ColourSwatch(SwatchColor=RGBA(80, 222, 255, 160)))
addhbglz = Honeybee_addHBGlz(HBObj=createhbsrfs_3.HBSurface, childSurfaces=flatten(glass))  # -> simplify(HBObjWGLZ); plug-in component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
# Honeybee default materials will be assigned
# based on surface type
bldgprograms = Honeybee_bldgPrograms({"Office": 0, "Retail": 1, "MidriseApartment": 2, "PrimarySchool": 3, "SecondarySchool": 4, "SmallHotel": 5, "LargeHotel": 6, "Hospital": 7, "Outpatient": 8, "Warehouse": 9, "SuperMarket": 10, "FullServiceRestaurant": 11, "QuickServiceRestaurant": 12}, selected="MidriseApartment")

# ---- group: Make all surfaces except the facade with window adiabatic
makeadiabatic = Honeybee_MakeAdiabatic(HBSrfs=flatten([createhbsrfs_4.HBSurface, createhbsrfs_2.HBSurface, createhbsrfs.HBSurface]))  # -> HBSrfs; plug-in component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

# ----
glazingcreator = Honeybee_GlazingBasedOnRatio(HBObjects=createhbsrfs_3.HBSurface, glzRatio=Slider(0.3, range=0..1), runIt=Toggle(True))  # -> readMe, HBObjWGLZ; plug-in component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
decompose_honeybee_zone = Honeybee_DecomposeHBZone(HBZone=makeadiabaticbytype)  # -> HBSurfaces; plug-in component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
Y = UnitY(Factor=1)
listzoneprograms = Honeybee_ListZonePrograms(bldgProgram=bldgprograms)  # -> MidriseApartmentZonePrograms; plug-in component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
Z = UnitZ(Factor=1)
brep_shade_2 = Brep([<brep referenced from the Rhino model> x22])
item = ListItem(List=listzoneprograms, Index=0, Wrap=True)
brep_shade_4 = Brep([<brep referenced from the Rhino model> x21])
brep_2 = Brep(<brep referenced from the Rhino model>)
brep_shade_1 = Brep([<brep referenced from the Rhino model> x20])
brep_shade_3 = Brep([<brep referenced from the Rhino model> x21])
amp = Amplitude(Vector=Y, Amplitude=Slider(-0.532, range=-10..0))

# ---- group: collect all honeybee surfaces
brep_3 = Brep(flatten([makeadiabatic, glazingcreator.HBObjWGLZ]))

# ----
number_slider = Slider(8, range=2..20)

bldgprograms_2 = Honeybee_bldgPrograms({"Office": 0, "Retail": 1, "MidriseApartment": 2, "PrimarySchool": 3, "SecondarySchool": 4, "SmallHotel": 5, "LargeHotel": 6, "Hospital": 7, "Outpatient": 8, "Warehouse": 9, "SuperMarket": 10, "FullServiceRestaurant": 11, "QuickServiceRestaurant": 12}, selected="MidriseApartment")
listzoneprograms_2 = Honeybee_ListZonePrograms(bldgProgram=bldgprograms_2)  # -> MidriseApartmentZonePrograms; plug-in component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
item_2 = ListItem(List=listzoneprograms_2, Index=2, Wrap=True)
panel_4 = Panel(item_2)
createhbzones = Honeybee_createHBZones(name="corridor", zoneProgram=item_2, HBSurfaces=flatten(decompose_honeybee_zone), isConditioned=Toggle(False))  # -> readMe, HBZone; plug-in component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

brep_shape_5 = Brep([<brep referenced from the Rhino model> x20])
amp_2 = Amplitude(Vector=Z, Amplitude=Slider(-0.297, range=-10..0))
brep_4 = Brep(<brep referenced from the Rhino model>)
number_slider_2 = Slider(12, range=2..20)
panel_5 = Panel(item)
hb_epcontextsrf = HoneybeeEPContextSurfaces(shdSurfaces=flatten(brep_shape_5))  # -> HBContext; inputs shdSurfaces: list of GeometryBase, justBoundingBox: Boolean
# ---------- hb_epcontextsrf: Python ----------
"""
prepare shading/context geometries

    Args:
        northVectorOrRotation: A vector that shows North or a number that shows
                               the rotation of the North from the Y axis
        bldgMasses: List of closed Breps as thermal zones.
    Returns:
        report: ...
        thermalZones: Thermal zone's geometries for visualiza
"""

ghenv.Component.Name = 'Honeybee EP context Surfaces'
ghenv.Component.NickName = 'HB_EPContextSrf'
ghenv.Component.Message = 'VER 0.0.58\nNOV_20_2015'
ghenv.Component.Category = "Honeybee"
ghenv.Component.SubCategory = "09 | Energy | Energy"
#compatibleHBVersion = VER 0.0.57\nNOV_01_2015
#compatibleLBVersion = VER 0.0.59\nFEB_01_2015
ghenv.Component.AdditionalHelpFromDocStrings = "2"

import rhinoscriptsyntax as rs
import Rhino as rc
import scriptcontext as sc
import os
import System
import Grasshopper.Kernel as gh
import uuid

tolerance = sc.doc.ModelAbsoluteTolerance
import math


def main(shdSurfaces, EPTransSchedule, meshingSettings, justBoundingBox):
    
    # import the classes
    if sc.sticky.has_key('honeybee_release'):

        try:
            if not sc.sticky['honeybee_release'].isCompatible(ghenv.Component): return -1
        except:
            warning = "You need a newer version of Honeybee to use this compoent." + \
            " Use updateHoneybee component to update userObjects.\n" + \
            "If you have already updated userObjects drag Honeybee_Honeybee component " + \
            "into canvas and try again."
            w = gh.GH_RuntimeMessageLevel.Warning
            ghenv.Component.AddRuntimeMessage(w, warning)
            return -1
        
        # don't customize this part
        hb_EPSrf = sc.sticky["honeybee_EPSurface"]
        hb_EPSHDSurface = sc.sticky["honeybee_EPShdSurface"]
        hb_RADMaterialAUX = sc.sticky["honeybee_RADMaterialAUX"]
        hb_EPObjectsAux = sc.sticky["honeybee_EPObjectsAUX"]()
        HBScheduleList = sc.sticky["honeybee_ScheduleLib"].keys()

        ########################################################################
        #----------------------------------------------------------------------#
        shdBreps = []
        # create bounding box of shading geometries
        if justBoundingBox:
            for brep in shdSurfaces:
                if brep.Faces.Count>1 or not brep.Faces[0].IsPlanar(sc.doc.ModelAbsoluteTolerance):
                    shdBreps.append(brep.GetBoundingBox(True).ToBrep())
                else:
                    shdBreps.append(brep)
        else:
            shdBreps = shdSurfaces
        
        shadingClasses = []
        shadingMeshPreview = []
        
        if meshingSettings == None:
            mp = rc.Geometry.MeshingParameters.Minimal
            mp.SimplePlanes = True
        else:
            mp = meshingSettings
        
        def getRadMaterialName(radMaterial):
            nameStr = radMaterial.split(" ")[2]
            name =  nameStr.split("\n")[0]
            return name
        
        for brepCount, brep in enumerate(shdBreps):
            if brep != None:
                isPlanar = True
                # check planarity
                for face in brep.Faces:
                    if not face.IsPlanar(tolerance):
                        isPlanar = False
                        break
                
                shadingBreps = []
                if not isPlanar:
                    meshArray = rc.Geometry.Mesh.CreateFromBrep(brep, mp)
                    for mesh in meshArray:
                        for meshFace in range(mesh.Faces.Count):
                            vertices = list(mesh.Faces.GetFaceVertices(meshFace))[1:]
                            vertices = vertices + [sc.doc.ModelAbsoluteTolerance]
                            # create the brep from mesh
                            shdBrep = rc.Geometry.Brep.CreateFromCornerPoints(*vertices)
                            shadingBreps.append(shdBrep)
                else:
                    for face in brep.Faces:
                        shadingBreps.append(face.DuplicateFace(False))
                
                for faceCount, shdBrep in enumerate(shadingBreps):
                        thisShading = hb_EPSHDSurface(shdBrep, 1000*brepCount + faceCount, 'shdSrf_' + `brepCount` + '_' + `faceCount` + "_" + str(uuid.uuid4()))
                        
                        # add transmittance schedule if any
                        if EPTransSchedule!=None:
                            schedule= EPTransSchedule.upper()
                            if schedule!=None and not schedule.lower().endswith(".csv") and schedule not in HBScheduleList:
                                msg = "Cannot find " + schedule + " in Honeybee schedule library."
                                print msg
                                ghenv.Component.AddRuntimeMessage(gh.GH_RuntimeMessageLevel.Warning, msg)
                                return -1
                            elif schedule!=None and schedule.lower().endswith(".csv"):
                                # check if csv file is existed
                                if not os.path.isfile(schedule):
                                    msg = "Cannot find the shchedule file: " + schedule
                                    print msg
                                    ghenv.Component.AddRuntimeMessage(gh.GH_RuntimeMessageLevel.Warning, msg)
                                    return -1
                            
                            thisShading.TransmittanceSCH = schedule
                        
                        # add the Rad Material if any
                        if RADMaterial!=None:
                            # if it is just the name of the material make sure it is already defined
                            if len(RADMaterial.split(" ")) == 1:
                                # if the material is not in the library add it to the library
                                if not hb_RADMaterialAUX.isMatrialExistInLibrary(RADMaterial):
                                    warningMsg = "Can't find " + RADMaterial + " in RAD Material Library.\n" + \
                                                "Add the material to the library and try again."
                                    ghenv.Component.AddRuntimeMessage(gh.GH_RuntimeMessageLevel.Warning, warningMsg)
                                    return
                                
                                try:
                                    thisShading.setRADMaterial(RADMaterial)
                                except Exception, e:
                                    print e
                                    warningMsg = "You are using an old version of Honeybee_Honeybee! Update your files and try again."
                                    print warningMsg
                                    ghenv.Component.AddRuntimeMessage(gh.GH_RuntimeMessageLevel.Warning, warningMsg)
                                    return
                                
                                addedToLib = True
                            else:
                                
                                # try to add the material to the library
                                addedToLib, thisShading.RadMaterial = hb_RADMaterialAUX.analyseRadMaterials(RADMaterial, True)
                                
                            if addedToLib==False:
                                warningMsg = "Failed to add " + RADMaterial + " to the Library."
                                ghenv.Component.AddRuntimeMessage(gh.GH_RuntimeMessageLevel.Warning, warningMsg)
                                return
                        
                        # add shading to the list
                        shadingClasses.append(thisShading)
                
        # add to the hive
        hb_hive = sc.sticky["honeybee_Hive"]()
        HBContext  = hb_hive.addToHoneybeeHive(shadingClasses, ghenv.Component.InstanceGuid.ToString())
        return HBContext
        ################################################################################################
    else:
        print "You should first let Honeybee to fly..."
        w = gh.GH_RuntimeMessageLevel.Warning
        ghenv.Component.AddRuntimeMessage(w, "You should first let Honeybee to fly...")
        return -1
        

if _shdSurfaces and _shdSurfaces[0]!=None:
    # add cleaning function
    result= main(_shdSurfaces, EPTransSchedule_, meshingSettings_, justBoundingBox_)
    
    if result != -1: HBContext = result
# ---------- end hb_epcontextsrf ----------
createhbzones_2 = Honeybee_createHBZones(name="test_room", zoneProgram=item, HBSurfaces=flatten(brep_3), isConditioned=Toggle(False))  # -> readMe, HBZone; plug-in component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
arrlinear = LinearArray(Geometry=brep_2, Direction=amp, Count=number_slider_2)  # -> Geometry, Transform
arrlinear_2 = LinearArray(Geometry=brep_4, Direction=amp_2, Count=number_slider)  # -> Geometry, Transform
range = Range(Domain=Domain(0, 1), Steps=number_slider_2)

panel_6 = Panel("http://apps1.eere.energy.gov/buildings/energyplus/weatherdata/4_north_and_central_america_wmo_region_4/1_usa/USA_PA_Philadelphia.Intl.AP.724080_TMY3.zip")
number_slider_3 = Slider(120, range=0..180)
open_epw_stat = Ladybug_OpenEPWAndSTATWeatherFiles(weatherFileURL=panel_6)  # -> epwFile, statFile; disabled; plug-in component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
northarrow = Ladybug_North(north=number_slider_3, scale=".05")  # -> northSign; plug-in component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

wires = BrepWireframe(Brep=createhbzones_2.HBZone, Density=-1)
solveadjc = Honeybee_SolveAdjacencies(HBZones=flatten([createhbzones_2.HBZone, createhbzones.HBZone]), removeCurrentAdjc=False, findAdjc=Toggle(True))  # -> readMe, HBZonesWADJ; plug-in component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
graph = GraphMapper(simplify(range), x0=0, x1=1, y0=0, y1=1, container_name="Conic", Cx=0.07129409164, Cy=0.7277992964)
# http://apps1.eere.energy.gov/buildings/energyplus/weatherdata/4_north_and_central_america_wmo_region_4/1_usa/USA_FL_Miami.Intl.AP.722020_TMY3.zip.AP.724080_TMY3.zip
toggle_2 = BooleanToggle(True)
rev = ReverseList(List=arrlinear_2.Geometry)
rev_2 = ReverseList(List=arrlinear.Geometry)
range_2 = Range(Domain=Domain(0, 1), Steps=number_slider)
open_weather_file = Ladybug_OpenEPWWeatherFile(open=toggle_2)  # -> epwFile; plug-in component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
flip = Flip(Surface=floor)  # -> Surface, Result
graph_2 = GraphMapper(simplify(range_2), x0=0, x1=1, y0=0, y1=1, container_name="Conic", Cx=0.1610351503, Cy=0.6903344989)
multiplication = Multiplication(A=graph, B=Slider(-0.882, range=-10..50))
gentestpts = Honeybee_GenerateTestPoints(testSurface=flip.Surface, gridSize=".5", distBaseSrf=".762", moveTestMesh=True)  # -> readMe, simplify(testPoints), simplify(ptsVectors), simplify(facesArea), simplify(mesh); plug-in component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
importepw = Ladybug_ImportEpw(epwFile=open_weather_file)  # -> readMe, latitude, location, dryBulbTemperature, dewPointTemperature, relativeHumidity, windSpeed, windDirection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; plug-in component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
radparameters = Honeybee_RADParameters(quality=0)  # -> readMe, radParameters; plug-in component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
scale_nu = ScaleNU(Geometry=rev_2, Plane=rev_2, ScaleX=multiplication, ScaleY=1, ScaleZ=1)  # -> Geometry, Transform
importlocation = Ladybug_ImportLocation(epwFile=open_weather_file)  # -> location; plug-in component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
multiplication_2 = Multiplication(A=graph_2, B=Slider(0.732, range=-10..50))
analysisperiod = Ladybug_AnalysisPeriod()  # -> readMe, analysisPeriod; plug-in component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
srfpt = SurfacePoints(Surface=scale_nu.Geometry)  # -> Points, Weights, Greville, UCount, VCount
scale_nu_2 = ScaleNU(Geometry=rev, Plane=rev, ScaleX=multiplication_2, ScaleY=1, ScaleZ=1)  # -> Geometry, Transform
item_3 = ListItem(List=srfpt.Points, Index=0, Wrap=True)  # -> flatten(Item)
annualdaylightsimulation = Honeybee_AnnualDaylightSimulation(
    north=number_slider_3,
    epwWeatherFile=open_weather_file,
    testPoints=gentestpts.testPoints,
    ptsVectors=gentestpts.ptsVectors,
    testMesh=gentestpts.mesh,
    radParameters=radparameters.radParameters)  # -> analysisRecipe; plug-in component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
srfpt_2 = SurfacePoints(Surface=scale_nu_2.Geometry)  # -> Points, Weights, Greville, UCount, VCount
sunpath = Ladybug_SunPath(
    north=number_slider_3,
    location=importlocation,
    hour="11",
    day="21",
    month="3",
    timeStep=1,
    analysisPeriod=analysisperiod.analysisPeriod,
    sunPathScale=".1",
    annualHourlyData=flatten(importepw.globalHorizontalRadiation),
    dailyOrAnnualSunPath=True)  # -> readMe, sunVectors, sunAltitudes, sunAzimuths, port, sunSpheresMesh, sunPathCrvs, legend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; plug-in component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
rad = Radians(Degrees=Slider(153, range=0..360))
item_4 = ListItem(List=srfpt_2.Points, Index=0, Wrap=True)  # -> flatten(Item)
brep_5 = Brep(flatten([scale_nu.Geometry, scale_nu_2.Geometry]))
# Run Annual Daylight
toggle_3 = BooleanToggle(True)
toggle_4 = BooleanToggle(False)
Y_2 = UnitY(Factor=1)
rad_2 = Radians(Degrees=Slider(12, range=0..360))
rot3d = Rotate3D(Geometry=scale_nu.Geometry, Angle=rad, Center=item_3, Axis=Vector(0, 0, 1))  # -> Geometry, Transform
occupancygenerator = Honeybee_DaysimOccupancyGenerator(weekendDays=[1, 2], writeTheOcc=Toggle(True))  # -> occupancyFile; plug-in component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
panel_7 = Panel(sunpath.sunVectors)
rundaylightanalysis = Honeybee_RunDaylightSimulation(
    HBObjects=flatten([createhbzones_2.HBZone, hb_epcontextsrf]),
    analysisRecipe=annualdaylightsimulation,
    writeRad=toggle_3,
    runRad=toggle_3,
    numOfCPUs=Slider(8, range=0..10),
    overwriteResults=True)  # -> readMe, analysisType, resultsUnit, results, testPts, resultFiles, radGeoFile, studyFolder, done; plug-in component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
gethbzoneepschedules = Honeybee_GetZoneEnergyPlusSchedules(HBZone=createhbzones_2.HBZone)  # -> occupancySchedule, occupancyActivitySch, heatingSetPtSchedule, coolingSetPtSchedule, lightingSchedule, equipmentSchedule, infiltrationSchedule; plug-in component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
rot3d_2 = Rotate3D(Geometry=scale_nu_2.Geometry, Angle=rad_2, Center=item_4, Axis=Y_2)  # -> Geometry, Transform
panel_8 = Panel(sunpath.sunAltitudes)
updatehoneybee = Honeybee_UpdateHoneybee(updateThisFile=toggle_4, updateAllUObjects=toggle_4)  # -> readMe; plug-in component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
updateladybug = Ladybug_UpdateLadybug(updateThisFile=toggle_4, updateAllUObjects=toggle_4)  # -> readMe; plug-in component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
panel_9 = Panel(sunpath.sunAzimuths)
brep_6 = Brep([rot3d.Geometry, rot3d_2.Geometry])
epglassmat = Honeybee_EnergyPlusGlassMaterial()  # -> EPMaterial; plug-in component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
# Generate lighting Schedule
readannualresultsi = Honeybee_ReadAnnualResultI(
    illFilesAddress=rundaylightanalysis.resultFiles,
    testPoints=simplify(rundaylightanalysis.testPts),
    occupancyFiles=occupancygenerator,
    DLAIllumThresholds=300,
    runIt=Toggle(True))  # -> DLA, UDLI_Less_100, UDLI_100_2000, UDLI_More_2000, CDA, sDA, annualProfiles, htmReport; plug-in component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
# update lighting schedule
setepzoneschedules = Honeybee_SetEnergyPlusZoneSchedules(HBZones=solveadjc.HBZonesWADJ, lightingSchedules=readannualresultsi.annualProfiles)  # -> schedules, simplify(HBZones); plug-in component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
callfromepconstrlibrary = Honeybee_CallFromEPConstructionLibrary(keywords="Thermotech_low_SHGC")  # -> EPMaterials, EPWindowMaterils, EPConstructions; plug-in component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

# ---- group: just for visualization
# Compare Schedules!
dsannualprofiles = Honeybee_DaysimAnnualProfiles(annualProfiles=readannualresultsi.annualProfiles)  # -> simplify(occupancyProfile), simplify(shadingProfiles), simplify(lightingControlProfiles), simplify(dgpProfile); plug-in component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
convertepschvalues = Honeybee_ConvertEnergyPlusScheduleToValues(schName=gethbzoneepschedules.lightingSchedule)  # -> values; plug-in component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

# ----
panel_10 = Panel(callfromepconstrlibrary.EPConstructions)
item_5 = ListItem(List=callfromepconstrlibrary.EPWindowMaterils, Index=Slider(3, range=0..10), Wrap=True)
legendpar = Ladybug_LegendParameters(lowBound="0", highBound="100")  # -> legendPar; plug-in component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
panel_11 = Panel(readannualresultsi.sDA)
setepnatvent = Honeybee_SetEPAirFlow(
    HBZones=setepzoneschedules.HBZones,
    naturalVentilationType="1",
    minIndoorTempForNatVent="24",
    maxOutdoorTempForNatVent="28")  # -> readMe, simplify(HBZones); plug-in component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
callfromepconstrlibrary_2 = Honeybee_CallFromEPConstructionLibrary(keywords="mass")  # -> EPMaterials, EPWindowMaterils, EPConstructions; plug-in component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
epwindowmat = Honeybee_EnergyPlusWindowMaterial(name="aa", U_Value="0.17", SHGC="0.25", VT="0.4")  # -> EPMaterial; plug-in component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
recolormesh = Ladybug_ReColorMesh(analysisResult=readannualresultsi.DLA, legendPar=legendpar)  # -> readMe, newMesh, newLegend, legendBasePt, meshColors, legendColors; plug-in component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
toggle_5 = BooleanToggle(True)
_3dchart = Ladybug_3DChart(inputData=flatten([dsannualprofiles.lightingControlProfiles, convertepschvalues]))  # -> readMe, graphMesh, graphCurves, legend, legendBasePts, title, titleBasePts, dataPts, conditionalHOY; plug-in component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
item_6 = ListItem(List=callfromepconstrlibrary_2.EPConstructions, Index=Slider(3, range=0..90), Wrap=True)
ladybug_2 = Ladybug_Ladybug()  # -> Vviiiiiiiiiizzz; plug-in component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
honeybee_2 = Honeybee_Honeybee()  # -> Vviiiiiiiiiizzz; plug-in component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
epconstruction = Honeybee_EnergyPlusConstruction(name="Thermotech_low_SHGC", layer_1=epwindowmat)  # -> EPConstruction; plug-in component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
panel_12 = Panel(callfromepconstrlibrary_2.EPConstructions)
epoutput = Honeybee_GenerateEPOutput(
    zoneEnergyUse=toggle_5,
    zoneGainsAndLosses=toggle_5,
    zoneComfortMetrics=toggle_5,
    surfaceTempAnalysis="False",
    timestep="hourly")  # -> report, flatten(simulationOutputs); plug-in component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
toggle_6 = BooleanToggle(False)
setepzonecnstr = Honeybee_SetEPZoneConstruction(HBZone=setepnatvent.HBZones, wallEPConstruction=item_6, windowEPConstruction=epconstruction)  # -> simplify(modifiedHBZone); plug-in component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
toggle_7 = BooleanToggle(False)
updatehoneybee_2 = Honeybee_UpdateHoneybee(updateThisFile=toggle_6, updateAllUObjects=toggle_6)  # -> readMe; plug-in component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
importepw_2 = Ladybug_ImportEpw(epwFile=open_weather_file)  # -> readMe, latitude, location, dryBulbTemperature, dewPointTemperature, relativeHumidity, windSpeed, windDirection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; plug-in component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
updateladybug_2 = Ladybug_UpdateLadybug(updateThisFile=toggle_6, updateAllUObjects=toggle_6)  # -> readMe; plug-in component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
# Run the analysis
runenergysimulation = Honeybee_RunEnergySimulation(
    north=number_slider_3,
    epwFile=open_weather_file,
    HBZones=flatten(setepzonecnstr),
    HBContext=flatten(hb_epcontextsrf),
    simulationOutputs=flatten(epoutput.simulationOutputs),
    writeIdf=toggle_7,
    runEnergyPlus=toggle_7)  # -> report, idfFileAddress, resultFileAddress; plug-in component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
setloadsandschedules = Honeybee_SetLoadsAndSchedules()  # -> currentSchedules, currentLoads, HBZones; plug-in component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
analysisperiod_2 = Ladybug_AnalysisPeriod(fromHour=Slider(1, range=0..10), toHour=Slider(24, range=0..24))  # -> readMe, analysisPeriod; plug-in component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
epwindowairgap = Honeybee_EnergyPlusWindowAirGap(name="AIR_10MM", thickness="0.010")  # -> EPMaterial; plug-in component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
readepresult = Honeybee_ReadEPResult(resultFileAddress=runenergysimulation.resultFileAddress)  # -> totalThermalEnergy, thermalEnergyBalance, cooling, heating, electricLight, electricEquip, fanElectric, pumpElectric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; plug-in component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
toggle_8 = BooleanToggle(True)
epglassmat_2 = Honeybee_EnergyPlusGlassMaterial(name="otherglass")  # -> EPMaterial; plug-in component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
epconstruction_2 = Honeybee_EnergyPlusConstruction(name="Thermotech_low_SHGC", layer_1=epwindowmat, layer_2=epwindowairgap, layer_3=epglassmat_2)  # -> EPConstruction; plug-in component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
adaptivecomfortcalculator = Ladybug_AdaptiveComfortCalculator(dryBulbTemperature=readepresult.airTemperature, prevailingOutdoorTemp=importepw_2.dryBulbTemperature, runIt=toggle_8)  # -> readMe, port, comfortableOrNot, conditionOfPerson, degreesFromTarget, port_2, targetTemperature, upperTemperatureBound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; plug-in component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
pmvcomfortcalculator = Ladybug_PMVComfortCalculator(
    dryBulbTemperature=readepresult.airTemperature,
    meanRadiantTemperature=readepresult.meanRadTemperature,
    relativeHumidity=importepw_2.relativeHumidity,
    analysisPeriod=analysisperiod_2.analysisPeriod,
    calcBalanceTemperature=False,
    runIt=toggle_8)  # -> readMe, port, predictedMeanVote, percentPeopleDissatisfied, standardEffectiveTemperature, port_2, comfortableOrNot, percentOfTimeComfortable, port_3, balanceTemperature; plug-in component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
separatedata = Ladybug_SeparateData(inputList=flatten(readepresult.heating))  # -> numbers, strings; plug-in component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
separatedata_2 = Ladybug_SeparateData(inputList=flatten(readepresult.cooling))  # -> numbers, strings; plug-in component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
separatedata_3 = Ladybug_SeparateData(inputList=flatten(readepresult.electricLight))  # -> numbers, strings; plug-in component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
ma = MassAddition(Input=separatedata.numbers)  # -> Result, PartialResults
ma_2 = MassAddition(Input=separatedata_3.numbers)  # -> Result, PartialResults
ma_3 = MassAddition(Input=separatedata_2.numbers)  # -> Result, PartialResults
panel_13 = Panel("""Cooling, Heating
& Lighting Loads""")
total_cooling = Panel(ma_3.Result)
total_heating = Panel(ma.Result)
lighting = Panel(ma_2.Result)
panel_14 = Panel(adaptivecomfortcalculator.percentHotCold)
panel_15 = Panel(pmvcomfortcalculator.predictedMeanVote)
panel_16 = Panel(adaptivecomfortcalculator.percentOfTimeComfortable)
panel_17 = Panel(pmvcomfortcalculator.percentOfTimeComfortable)
box = Box()
cluster = Cluster(
    inputdata=[readepresult.cooling, readepresult.electricLight, readepresult.heating],
    altyaxistitle=panel_13,
    basepoint="20, 0, 0",
    xscale=Slider(0.5, range=0..1),
    yscale=Slider(0.7, range=0..1))
panel_18 = Panel(adaptivecomfortcalculator.conditionOfPerson)
_3dchart_2 = Ladybug_3DChart(inputData=flatten(pmvcomfortcalculator.comfortableOrNot), xScale="0.25")  # -> readMe, graphMesh, graphCurves, legend, legendBasePts, title, titleBasePts, dataPts, conditionalHOY; plug-in component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
panel_19 = Panel(pmvcomfortcalculator.comfortableOrNot)
_3dchart_3 = Ladybug_3DChart(inputData=flatten(adaptivecomfortcalculator.conditionOfPerson), xScale="0.25")  # -> readMe, graphMesh, graphCurves, legend, legendBasePts, title, titleBasePts, dataPts, conditionalHOY; plug-in component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
_3dchart_4 = Ladybug_3DChart(inputData=flatten(adaptivecomfortcalculator.comfortableOrNot), xScale="0.25")  # -> readMe, graphMesh, graphCurves, legend, legendBasePts, title, titleBasePts, dataPts, conditionalHOY; plug-in component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

# ==== cluster Cluster
inputdata = ClusterInput()
altyaxistitle = ClusterInput()
basepoint = ClusterInput()
xscale = ClusterInput()
yscale = ClusterInput()
barchart = Ladybug_MonthlyBarChart(inputData=flatten(inputdata), altYAxisTitle=altyaxistitle, basePoint=basepoint, xScale=xscale, yScale=yscale)  # -> readMe, dataMesh, dataCurves, dataCrvColors, graphAxes, graphLabels, title, titleBasePt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; plug-in component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
