# Grasshopper definition Pegah Mathur.gh (Grasshopper 0.9.76)
# plug-ins: Python Interpreter

brep = Brep(<brep referenced from the Rhino model>)
toggle = BooleanToggle(True)
mass2zone = Honeybee_Masses2Zones(zoneMasses=flatten(brep), isConditioned=True, maxRoofAngle=30, createHBZones=Toggle(True))  # -> readMe, HBZones; plug-in component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
makeadiabaticbytype = Honeybee_MakeAdiabaticByType(HBZones=mass2zone.HBZones, roofs=toggle, ceilings=toggle, floors=toggle, exposedFloors=toggle, groundFloors=toggle)  # -> HBZones; plug-in component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
decompose_honeybee_zone = Honeybee_DecomposeHBZone(HBZone=makeadiabaticbytype)  # -> HBSurfaces; plug-in component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

bldgprograms = Honeybee_bldgPrograms({"Office": 0, "Retail": 1, "MidriseApartment": 2, "PrimarySchool": 3, "SecondarySchool": 4, "SmallHotel": 5, "LargeHotel": 6, "Hospital": 7, "Outpatient": 8, "Warehouse": 9, "SuperMarket": 10, "FullServiceRestaurant": 11, "QuickServiceRestaurant": 12}, selected="MidriseApartment")
listzoneprograms = Honeybee_ListZonePrograms(bldgProgram=bldgprograms)  # -> MidriseApartmentZonePrograms; plug-in component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
item = ListItem(List=listzoneprograms, Index=2, Wrap=True)
panel = Panel(item)
createhbzones = Honeybee_createHBZones(name="corridor", zoneProgram=item, HBSurfaces=flatten(decompose_honeybee_zone), isConditioned=Toggle(False))  # -> readMe, HBZone; plug-in component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

button = Button()
button_2 = Button()
toggle_2 = BooleanToggle(True)
toggle_3 = BooleanToggle(True)
button_3 = Button()
panel_2 = Panel("""Honeybee
Energy
Daylighting
EnergyPlus
Daysim
Radiance""")
honeybee = Honeybee_Honeybee()  # -> Vviiiiiiiiiizzz; plug-in component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
ladybug = Ladybug_Ladybug()  # -> Vviiiiiiiiiizzz; plug-in component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
updateladybug = Ladybug_UpdateLadybug(updateThisFile=toggle_3, updateAllUObjects=toggle_3)  # -> readMe; plug-in component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
updatehoneybee = Honeybee_UpdateHoneybee(updateThisFile=toggle_2, updateAllUObjects=toggle_2)  # -> readMe; plug-in component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
panel_3 = Panel("This is an example that shows how to integrate results of daylighting simulation with an energy simulation")
panel_4 = Panel(updateladybug)
panel_5 = Panel(updatehoneybee)

# ---- group: floor
floor = Brep(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)

# ----
ledge = Brep(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)

# ---- group: ceiling
ceiling = Brep([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])

# ----
walls = Brep([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])
wall_surface_with_opening = Brep(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)
exporthydra = Hydra_ExportFile(
    fileName="Integrated_Daylight_and_Energy_similation",
    fileDescription=panel_3,
    fileTags=panel_2,
    targetFolder="C:\Users\Administrator\Documents\GitHub\hydra_1",
    export=Toggle(False))  # -> readMe; inputs fileDescription: list, changeLog: list, fileTags: list, includeRhino: Boolean, GHForThumb: Boolean, additionalImgs: list, export: Boolean; plug-in component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
# Geometry Preparation
panel_6 = Panel("0")
createhbsrfs = Honeybee_createHBSrfs(geometry=flatten([floor, ledge]), srfType="2")  # -> readMe, simplify(HBSurface); plug-in component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
createhbsrfs_2 = Honeybee_createHBSrfs(geometry=ceiling, srfType="3")  # -> readMe, simplify(HBSurface); plug-in component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
createhbsrfs_3 = Honeybee_createHBSrfs(geometry=wall_surface_with_opening, srfType="0")  # -> readMe, simplify(HBSurface); plug-in component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
createhbsrfs_4 = Honeybee_createHBSrfs(geometry=walls, srfType=panel_6)  # -> readMe, simplify(HBSurface); plug-in component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
glass = Brep(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)
preview = CustomPreview(Geometry=glass, Shader=ColourSwatch(SwatchColor=RGBA(80, 222, 255, 160)))
# Honeybee default materials will be assigned
# based on surface type
bldgprograms_2 = Honeybee_bldgPrograms({"Office": 0, "Retail": 1, "MidriseApartment": 2, "PrimarySchool": 3, "SecondarySchool": 4, "SmallHotel": 5, "LargeHotel": 6, "Hospital": 7, "Outpatient": 8, "Warehouse": 9, "SuperMarket": 10, "FullServiceRestaurant": 11, "QuickServiceRestaurant": 12}, selected="MidriseApartment")
addhbglz = Honeybee_addHBGlz(HBObj=createhbsrfs_3.HBSurface, childSurfaces=flatten(glass))  # -> simplify(HBObjWGLZ); plug-in component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

# ---- group: Make all surfaces except the facade with window adiabatic
makeadiabatic = Honeybee_MakeAdiabatic(HBSrfs=flatten([createhbsrfs_4.HBSurface, createhbsrfs_2.HBSurface, createhbsrfs.HBSurface]))  # -> HBSrfs; plug-in component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

# ----
glazingcreator = Honeybee_GlazingBasedOnRatio(HBObjects=createhbsrfs_3.HBSurface, glzRatio=Slider(0.8, range=0..1), breakUpWindow=Toggle(False), runIt=Toggle(True))  # -> readMe, HBObjWGLZ; plug-in component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
brep_shade_1 = Brep([<brep referenced from the Rhino model> x20])
listzoneprograms_2 = Honeybee_ListZonePrograms(bldgProgram=bldgprograms_2)  # -> MidriseApartmentZonePrograms; plug-in component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
brep_shade_2 = Brep([<brep referenced from the Rhino model> x23])
item_2 = ListItem(List=listzoneprograms_2, Index=0, Wrap=True)

# ---- group: collect all honeybee surfaces
brep_2 = Brep(flatten([makeadiabatic, glazingcreator.HBObjWGLZ]))

# ----
panel_7 = Panel(item_2)
brep_3 = Brep([<brep referenced from the Rhino model> x170])
hb_epcontextsrf = HoneybeeEPContextSurfaces(shdSurfaces=flatten(brep_3))  # -> HBContext; inputs shdSurfaces: list of GeometryBase, justBoundingBox: Boolean
# ---------- hb_epcontextsrf: Python ----------
"""
prepare shading/context geometries

    Args:
        northVectorOrRotation: A vector that shows North or a number that shows
                               the rotation of the North from the Y axis
        bldgMasses: List of closed Breps as thermal zones.
    Returns:
        report: ...
        thermalZones: Thermal zone's geometries for visualiza
"""

ghenv.Component.Name = 'Honeybee EP context Surfaces'
ghenv.Component.NickName = 'HB_EPContextSrf'
ghenv.Component.Message = 'VER 0.0.58\nNOV_20_2015'
ghenv.Component.Category = "Honeybee"
ghenv.Component.SubCategory = "09 | Energy | Energy"
#compatibleHBVersion = VER 0.0.57\nNOV_01_2015
#compatibleLBVersion = VER 0.0.59\nFEB_01_2015
ghenv.Component.AdditionalHelpFromDocStrings = "2"

import rhinoscriptsyntax as rs
import Rhino as rc
import scriptcontext as sc
import os
import System
import Grasshopper.Kernel as gh
import uuid

tolerance = sc.doc.ModelAbsoluteTolerance
import math


def main(shdSurfaces, EPTransSchedule, meshingSettings, justBoundingBox):
    
    # import the classes
    if sc.sticky.has_key('honeybee_release'):

        try:
            if not sc.sticky['honeybee_release'].isCompatible(ghenv.Component): return -1
        except:
            warning = "You need a newer version of Honeybee to use this compoent." + \
            " Use updateHoneybee component to update userObjects.\n" + \
            "If you have already updated userObjects drag Honeybee_Honeybee component " + \
            "into canvas and try again."
            w = gh.GH_RuntimeMessageLevel.Warning
            ghenv.Component.AddRuntimeMessage(w, warning)
            return -1
        
        # don't customize this part
        hb_EPSrf = sc.sticky["honeybee_EPSurface"]
        hb_EPSHDSurface = sc.sticky["honeybee_EPShdSurface"]
        hb_RADMaterialAUX = sc.sticky["honeybee_RADMaterialAUX"]
        hb_EPObjectsAux = sc.sticky["honeybee_EPObjectsAUX"]()
        HBScheduleList = sc.sticky["honeybee_ScheduleLib"].keys()

        ########################################################################
        #----------------------------------------------------------------------#
        shdBreps = []
        # create bounding box of shading geometries
        if justBoundingBox:
            for brep in shdSurfaces:
                if brep.Faces.Count>1 or not brep.Faces[0].IsPlanar(sc.doc.ModelAbsoluteTolerance):
                    shdBreps.append(brep.GetBoundingBox(True).ToBrep())
                else:
                    shdBreps.append(brep)
        else:
            shdBreps = shdSurfaces
        
        shadingClasses = []
        shadingMeshPreview = []
        
        if meshingSettings == None:
            mp = rc.Geometry.MeshingParameters.Minimal
            mp.SimplePlanes = True
        else:
            mp = meshingSettings
        
        def getRadMaterialName(radMaterial):
            nameStr = radMaterial.split(" ")[2]
            name =  nameStr.split("\n")[0]
            return name
        
        for brepCount, brep in enumerate(shdBreps):
            if brep != None:
                isPlanar = True
                # check planarity
                for face in brep.Faces:
                    if not face.IsPlanar(tolerance):
                        isPlanar = False
                        break
                
                shadingBreps = []
                if not isPlanar:
                    meshArray = rc.Geometry.Mesh.CreateFromBrep(brep, mp)
                    for mesh in meshArray:
                        for meshFace in range(mesh.Faces.Count):
                            vertices = list(mesh.Faces.GetFaceVertices(meshFace))[1:]
                            vertices = vertices + [sc.doc.ModelAbsoluteTolerance]
                            # create the brep from mesh
                            shdBrep = rc.Geometry.Brep.CreateFromCornerPoints(*vertices)
                            shadingBreps.append(shdBrep)
                else:
                    for face in brep.Faces:
                        shadingBreps.append(face.DuplicateFace(False))
                
                for faceCount, shdBrep in enumerate(shadingBreps):
                        thisShading = hb_EPSHDSurface(shdBrep, 1000*brepCount + faceCount, 'shdSrf_' + `brepCount` + '_' + `faceCount` + "_" + str(uuid.uuid4()))
                        
                        # add transmittance schedule if any
                        if EPTransSchedule!=None:
                            schedule= EPTransSchedule.upper()
                            if schedule!=None and not schedule.lower().endswith(".csv") and schedule not in HBScheduleList:
                                msg = "Cannot find " + schedule + " in Honeybee schedule library."
                                print msg
                                ghenv.Component.AddRuntimeMessage(gh.GH_RuntimeMessageLevel.Warning, msg)
                                return -1
                            elif schedule!=None and schedule.lower().endswith(".csv"):
                                # check if csv file is existed
                                if not os.path.isfile(schedule):
                                    msg = "Cannot find the shchedule file: " + schedule
                                    print msg
                                    ghenv.Component.AddRuntimeMessage(gh.GH_RuntimeMessageLevel.Warning, msg)
                                    return -1
                            
                            thisShading.TransmittanceSCH = schedule
                        
                        # add the Rad Material if any
                        if RADMaterial!=None:
                            # if it is just the name of the material make sure it is already defined
                            if len(RADMaterial.split(" ")) == 1:
                                # if the material is not in the library add it to the library
                                if not hb_RADMaterialAUX.isMatrialExistInLibrary(RADMaterial):
                                    warningMsg = "Can't find " + RADMaterial + " in RAD Material Library.\n" + \
                                                "Add the material to the library and try again."
                                    ghenv.Component.AddRuntimeMessage(gh.GH_RuntimeMessageLevel.Warning, warningMsg)
                                    return
                                
                                try:
                                    thisShading.setRADMaterial(RADMaterial)
                                except Exception, e:
                                    print e
                                    warningMsg = "You are using an old version of Honeybee_Honeybee! Update your files and try again."
                                    print warningMsg
                                    ghenv.Component.AddRuntimeMessage(gh.GH_RuntimeMessageLevel.Warning, warningMsg)
                                    return
                                
                                addedToLib = True
                            else:
                                
                                # try to add the material to the library
                                addedToLib, thisShading.RadMaterial = hb_RADMaterialAUX.analyseRadMaterials(RADMaterial, True)
                                
                            if addedToLib==False:
                                warningMsg = "Failed to add " + RADMaterial + " to the Library."
                                ghenv.Component.AddRuntimeMessage(gh.GH_RuntimeMessageLevel.Warning, warningMsg)
                                return
                        
                        # add shading to the list
                        shadingClasses.append(thisShading)
                
        # add to the hive
        hb_hive = sc.sticky["honeybee_Hive"]()
        HBContext  = hb_hive.addToHoneybeeHive(shadingClasses, ghenv.Component.InstanceGuid.ToString())
        return HBContext
        ################################################################################################
    else:
        print "You should first let Honeybee to fly..."
        w = gh.GH_RuntimeMessageLevel.Warning
        ghenv.Component.AddRuntimeMessage(w, "You should first let Honeybee to fly...")
        return -1
        

if _shdSurfaces and _shdSurfaces[0]!=None:
    # add cleaning function
    result= main(_shdSurfaces, EPTransSchedule_, meshingSettings_, justBoundingBox_)
    
    if result != -1: HBContext = result
# ---------- end hb_epcontextsrf ----------
createhbzones_2 = Honeybee_createHBZones(name="test_room", zoneProgram=item_2, HBSurfaces=flatten(brep_2), isConditioned=Toggle(False))  # -> readMe, HBZone; plug-in component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
wires = BrepWireframe(Brep=createhbzones_2.HBZone, Density=-1)
solveadjc = Honeybee_SolveAdjacencies(HBZones=flatten([createhbzones.HBZone, createhbzones_2.HBZone]), removeCurrentAdjc=False, findAdjc=Toggle(True))  # -> readMe, HBZonesWADJ; plug-in component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

number_slider = Slider(90, range=0..360)
northarrow = Ladybug_North(north=number_slider, scale=".05")  # -> northSign; plug-in component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

open_weather_file = Ladybug_OpenEPWWeatherFile(open=Toggle(True))  # -> epwFile; plug-in component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
flip = Flip(Surface=floor)  # -> Surface, Result
gentestpts = Honeybee_GenerateTestPoints(testGeometry=flip.Surface, gridSize=".5", distBaseSrf=".762", moveTestMesh=True)  # -> readMe, simplify(testPoints), simplify(ptsVectors), simplify(facesArea), simplify(mesh); plug-in component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
radparameters = Honeybee_RADParameters(quality=0, ab="3")  # -> readMe, radParameters; plug-in component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

panel_8 = Panel("1-24")
genclimatebasedsky = Honeybee_GenerateClimateBasedSky(north=number_slider, weatherFile=open_weather_file, month="1-12", day="1-31")  # -> radiationValues, skyFilePath; plug-in component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
test_surfaces = Brep(<brep referenced from the Rhino model>)
gentestpts_2 = Honeybee_GenerateTestPoints(testGeometry=test_surfaces, gridSize=Slider(0.3, range=0..1), distBaseSrf=".762", moveTestMesh=True)  # -> readMe, simplify(testPoints), simplify(ptsVectors), simplify(facesArea), simplify(mesh); plug-in component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
gradientlibrary = Ladybug_GradientLibrary(gradIndex="1")  # -> customColors; plug-in component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
gridbasedsimulation = Honeybee_GridBasedSimulation(
    skyFile=genclimatebasedsky.skyFilePath,
    testPoints=gentestpts_2.testPoints,
    ptsVectors=gentestpts_2.ptsVectors,
    testMesh=gentestpts_2.mesh,
    simulationType=0,
    radParameters=radparameters.radParameters)  # -> analysisRecipe; plug-in component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
legendpar = Ladybug_LegendParameters(lowBound="100", highBound="2000", customColors=flatten(gradientlibrary))  # -> legendPar; plug-in component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
recolormesh = Ladybug_ReColorMesh(legendPar=legendpar)  # -> readMe, newMesh, newLegend, legendBasePt, meshColors, legendColors; plug-in component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

importepw = Ladybug_ImportEpw(epwFile=open_weather_file)  # -> readMe, latitude, location, dryBulbTemperature, dewPointTemperature, relativeHumidity, windSpeed, windDirection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; plug-in component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
analysisperiod = Ladybug_AnalysisPeriod()  # -> readMe, analysisPeriod; plug-in component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
importlocation = Ladybug_ImportLocation(epwFile=open_weather_file)  # -> location; plug-in component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
panel_9 = Panel("21")  # disabled
panel_10 = Panel("3")  # disabled
panel_11 = Panel("11")  # disabled
annualdaylightsimulation = Honeybee_AnnualDaylightSimulation(
    north=number_slider,
    epwWeatherFile=open_weather_file,
    testPoints=gentestpts.testPoints,
    ptsVectors=gentestpts.ptsVectors,
    testMesh=gentestpts.mesh,
    radParameters=radparameters.radParameters)  # -> analysisRecipe; plug-in component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
sunpath = Ladybug_SunPath(
    north=number_slider,
    location=importlocation,
    hour=panel_11,
    day=panel_9,
    month=panel_10,
    timeStep=1,
    analysisPeriod=analysisperiod.analysisPeriod,
    sunPathScale=".1",
    annualHourlyData=flatten(importepw.globalHorizontalRadiation),
    dailyOrAnnualSunPath=True)  # -> readMe, sunVectors, sunAltitudes, sunAzimuths, port, sunSpheresMesh, sunPathCrvs, legend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; plug-in component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
# Run Annual Daylight
toggle_4 = BooleanToggle(True)
toggle_5 = BooleanToggle(False)
panel_12 = Panel(sunpath.sunVectors)
# Generate lighting Schedule
rundaylightanalysis = Honeybee_RunDaylightSimulation(
    HBObjects=flatten([createhbzones_2.HBZone, hb_epcontextsrf]),
    analysisRecipe=annualdaylightsimulation,
    writeRad=toggle_4,
    runRad=toggle_4,
    numOfCPUs=Slider(8, range=0..10),
    overwriteResults=True)  # -> readMe, analysisType, resultsUnit, results, testPts, resultFiles, radGeoFile, studyFolder, done; plug-in component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
panel_13 = Panel(sunpath.sunAltitudes)
updatehoneybee_2 = Honeybee_UpdateHoneybee(updateThisFile=toggle_5, updateAllUObjects=toggle_5)  # -> readMe; plug-in component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
updateladybug_2 = Ladybug_UpdateLadybug(updateThisFile=toggle_5, updateAllUObjects=toggle_5)  # -> readMe; plug-in component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
panel_14 = Panel(sunpath.sunAzimuths)
gethbzoneepschedules = Honeybee_GetZoneEnergyPlusSchedules(HBZone=createhbzones_2.HBZone)  # -> occupancySchedule, occupancyActivitySch, heatingSetPtSchedule, coolingSetPtSchedule, lightingSchedule, equipmentSchedule, infiltrationSchedule; plug-in component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
occupancygenerator = Honeybee_DaysimOccupancyGenerator(weekendDays=[1, 2], writeTheOcc=Toggle(True))  # -> occupancyFile; plug-in component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
epglassmat = Honeybee_EnergyPlusGlassMaterial()  # -> EPMaterial; plug-in component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
callfromepconstrlibrary = Honeybee_CallFromEPConstructionLibrary(keywords="window")  # -> EPMaterials, EPWindowMaterils, EPConstructions; plug-in component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
panel_15 = Panel(callfromepconstrlibrary.EPConstructions)
item_3 = ListItem(List=callfromepconstrlibrary.EPConstructions, Index=Slider(1, range=0..10), Wrap=True)
panel_16 = Panel(item_3)
legendpar_2 = Ladybug_LegendParameters(lowBound="0", highBound="100")  # -> legendPar; plug-in component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
callfromepconstrlibrary_2 = Honeybee_CallFromEPConstructionLibrary(keywords="mass")  # -> EPMaterials, EPWindowMaterils, EPConstructions; plug-in component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
epwindowmat = Honeybee_EnergyPlusWindowMaterial(name="aa", U_Value="0.12", SHGC="0.15", VT="0.4")  # -> EPMaterial; plug-in component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
readannualresultsi = Honeybee_ReadAnnualResultI(
    illFilesAddress=rundaylightanalysis.resultFiles,
    testPoints=simplify(rundaylightanalysis.testPts),
    occupancyFiles=occupancygenerator,
    DLAIllumThresholds=300,
    runIt=Toggle(True))  # -> DLA, UDLI_Less_100, UDLI_100_2000, UDLI_More_2000, CDA, sDA, annualProfiles, htmReport; plug-in component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
# update lighting schedule
setepzoneschedules = Honeybee_SetEnergyPlusZoneSchedules(HBZones=solveadjc.HBZonesWADJ, lightingSchedules=readannualresultsi.annualProfiles)  # -> schedules, simplify(HBZones); plug-in component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

# ---- group: just for visualization
# Compare Schedules!
dsannualprofiles = Honeybee_DaysimAnnualProfiles(annualProfiles=readannualresultsi.annualProfiles)  # -> simplify(occupancyProfile), simplify(shadingProfiles), simplify(lightingControlProfiles), simplify(dgpProfile); plug-in component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
convertepschvalues = Honeybee_ConvertEnergyPlusScheduleToValues(schName=gethbzoneepschedules.lightingSchedule)  # -> values; plug-in component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
_3dchart = Ladybug_3DChart(inputData=flatten([convertepschvalues, dsannualprofiles.lightingControlProfiles]))  # -> readMe, graphMesh, graphCurves, legend, legendBasePts, title, titleBasePts, dataPts, conditionalHOY; plug-in component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

# ----
setepnatvent = Honeybee_SetEPAirFlow(
    HBZones=setepzoneschedules.HBZones,
    naturalVentilationType="1",
    minIndoorTempForNatVent="24",
    maxOutdoorTempForNatVent="28")  # -> readMe, simplify(HBZones); plug-in component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
recolormesh_2 = Ladybug_RecolorMesh(analysisResult=readannualresultsi.DLA, inputMesh=gentestpts.mesh)  # -> readMe, newMesh, newLegend, legendBasePt, meshColors, legendColors; plug-in component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
item_4 = ListItem(List=callfromepconstrlibrary_2.EPConstructions, Index=Slider(3, range=0..10), Wrap=True)
epconstruction = Honeybee_EnergyPlusConstruction(layer_1=epwindowmat)  # -> EPConstruction; plug-in component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
toggle_6 = BooleanToggle(True)
recolormesh_3 = Ladybug_ReColorMesh(analysisResult=readannualresultsi.DLA, legendPar=legendpar_2)  # -> readMe, newMesh, newLegend, legendBasePt, meshColors, legendColors; plug-in component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
panel_17 = Panel(item_4)
epoutput = Honeybee_GenerateEPOutput(
    zoneEnergyUse=toggle_6,
    zoneGainsAndLosses=toggle_6,
    zoneComfortMetrics=toggle_6,
    surfaceTempAnalysis="False",
    timestep="hourly")  # -> report, flatten(simulationOutputs); plug-in component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
panel_18 = Panel(readannualresultsi.sDA)
honeybee_2 = Honeybee_Honeybee()  # -> Vviiiiiiiiiizzz; plug-in component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
toggle_7 = BooleanToggle(True)
ladybug_2 = Ladybug_Ladybug()  # -> Vviiiiiiiiiizzz; plug-in component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
callfromepconstrlibrary_3 = Honeybee_CallFromEPConstructionLibrary(keywords="exterior")  # -> EPMaterials, EPWindowMaterils, EPConstructions; plug-in component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
callfromepconstrlibrary_4 = Honeybee_CallFromEPConstructionLibrary(keywords="roof")  # -> EPMaterials, EPWindowMaterils, EPConstructions; plug-in component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
importepw_2 = Ladybug_ImportEpw(epwFile=open_weather_file)  # -> readMe, latitude, location, dryBulbTemperature, dewPointTemperature, relativeHumidity, windSpeed, windDirection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; plug-in component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
setloadsandschedules = Honeybee_SetLoadsAndSchedules()  # -> currentSchedules, currentLoads, HBZones; plug-in component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
toggle_8 = BooleanToggle(False)
item_5 = ListItem(List=callfromepconstrlibrary_4.EPConstructions, Index=Slider(1, range=0..10), Wrap=True)
item_6 = ListItem(List=callfromepconstrlibrary_3.EPConstructions, Index=Slider(1, range=0..10), Wrap=True)
setepzonecnstr = Honeybee_SetEPZoneConstruction(
    HBZone=setepnatvent.HBZones,
    wallEPConstruction=item_4,
    windowEPConstruction=item_3,
    roofEPConstruction=item_5,
    floorEPConstruction=item_6)  # -> simplify(modifiedHBZone); plug-in component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
# Run the analysis
runenergysimulation = Honeybee_RunEnergySimulation(
    north=number_slider,
    epwFile=open_weather_file,
    HBZones=flatten(setepzonecnstr),
    HBContext=flatten(hb_epcontextsrf),
    simulationOutputs=flatten(epoutput.simulationOutputs),
    writeIdf=toggle_7,
    runEnergyPlus=toggle_7)  # -> report, idfFileAddress, resultFileAddress; plug-in component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
analysisperiod_2 = Ladybug_AnalysisPeriod(fromHour=Slider(1, range=0..10), toHour=Slider(24, range=0..24))  # -> readMe, analysisPeriod; plug-in component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
toggle_9 = BooleanToggle(True)
readepresult = Honeybee_ReadEPResult(resultFileAddress=runenergysimulation.resultFileAddress)  # -> port, port_2, port_3, port_4, electricLight, electricEquip, fanElectric, port_5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; plug-in component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
updatehoneybee_3 = Honeybee_UpdateHoneybee(updateThisFile=toggle_8, updateAllUObjects=toggle_8)  # -> readMe; plug-in component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
panel_19 = Panel(item_5)
panel_20 = Panel(item_6)
updateladybug_3 = Ladybug_UpdateLadybug(updateThisFile=toggle_8, updateAllUObjects=toggle_8)  # -> readMe; plug-in component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
adaptivecomfortcalculator = Ladybug_AdaptiveComfortCalculator(dryBulbTemperature=readepresult.airTemperature, prevailingOutdoorTemp=importepw_2.dryBulbTemperature, runIt=toggle_9)  # -> readMe, port, comfortableOrNot, conditionOfPerson, degreesFromTarget, port_2, targetTemperature, upperTemperatureBound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; plug-in component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
separatedata = Ladybug_SeparateData(inputList=flatten(readepresult.port_3))  # -> numbers, strings; plug-in component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
separatedata_2 = Ladybug_SeparateData(inputList=flatten(readepresult.port_4))  # -> numbers, strings; plug-in component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
separatedata_3 = Ladybug_SeparateData(inputList=flatten(readepresult.electricLight))  # -> numbers, strings; plug-in component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
pmvcomfortcalculator = Ladybug_PMVComfortCalculator(
    dryBulbTemperature=readepresult.airTemperature,
    meanRadiantTemperature=readepresult.meanRadTemperature,
    relativeHumidity=importepw_2.relativeHumidity,
    analysisPeriod=analysisperiod_2.analysisPeriod,
    calcBalanceTemperature=False,
    runIt=toggle_9)  # -> readMe, port, predictedMeanVote, percentPeopleDissatisfied, standardEffectiveTemperature, port_2, comfortableOrNot, percentOfTimeComfortable, port_3, balanceTemperature; plug-in component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
ma = MassAddition(Input=separatedata_2.numbers)  # -> Result, PartialResults
ma_2 = MassAddition(Input=separatedata_3.numbers)  # -> Result, PartialResults
ma_3 = MassAddition(Input=separatedata.numbers)  # -> Result, PartialResults
panel_21 = Panel("""Cooling, Heating
& Lighting Loads""")
panel_22 = Panel(adaptivecomfortcalculator.percentHotCold)
panel_23 = Panel(adaptivecomfortcalculator.conditionOfPerson)
total_cooling = Panel(ma_3.Result)
total_heating = Panel(ma.Result)
lighting = Panel(ma_2.Result)
panel_24 = Panel(adaptivecomfortcalculator.percentOfTimeComfortable)
panel_25 = Panel(pmvcomfortcalculator.predictedMeanVote)
panel_26 = Panel(pmvcomfortcalculator.percentOfTimeComfortable)
cluster = Cluster(
    inputdata=[readepresult.port_3, readepresult.electricLight, readepresult.port_4],
    altyaxistitle=panel_21,
    basepoint="20, 0, 0",
    xscale=Slider(0.5, range=0..1),
    yscale=Slider(0.7, range=0..1))
_3dchart_2 = Ladybug_3DChart(inputData=flatten(readepresult.totalSolarGain), xScale="0.25")  # -> readMe, graphMesh, graphCurves, legend, legendBasePts, title, titleBasePts, dataPts, conditionalHOY; plug-in component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
_3dchart_3 = Ladybug_3DChart(inputData=flatten(pmvcomfortcalculator.comfortableOrNot), xScale="0.25")  # -> readMe, graphMesh, graphCurves, legend, legendBasePts, title, titleBasePts, dataPts, conditionalHOY; plug-in component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
panel_27 = Panel(pmvcomfortcalculator.comfortableOrNot)
_3dchart_4 = Ladybug_3DChart(inputData=flatten(adaptivecomfortcalculator.degreesFromTarget), xScale="0.25")  # -> readMe, graphMesh, graphCurves, legend, legendBasePts, title, titleBasePts, dataPts, conditionalHOY; plug-in component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
_3dchart_5 = Ladybug_3DChart(inputData=flatten(adaptivecomfortcalculator.comfortableOrNot), xScale="0.25")  # -> readMe, graphMesh, graphCurves, legend, legendBasePts, title, titleBasePts, dataPts, conditionalHOY; plug-in component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

# ==== cluster Cluster
inputdata = ClusterInput()
altyaxistitle = ClusterInput()
basepoint = ClusterInput()
xscale = ClusterInput()
yscale = ClusterInput()
barchart = Ladybug_MonthlyBarChart(inputData=flatten(inputdata), altYAxisTitle=altyaxistitle, basePoint=basepoint, xScale=xscale, yScale=yscale)  # -> readMe, dataMesh, dataCurves, dataCrvColors, graphAxes, graphLabels, title, titleBasePt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; plug-in component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
