# Grasshopper definition Peng_Mingbo_final.gh (Grasshopper 0.9.76)
# plug-ins: Python Interpreter, ItemSelector, embryoA

# Orientation
number_slider = Slider(45, range=0..100)

# ----
# Step2 Orientation
panel = Panel("""0
30
60
90
120
150
180
210
240
270
300
330""")
number_slider_2 = Slider(9, range=0..11)
# Room Preparation
toggle = BooleanToggle(False)
item = ListItem(List=panel, Index=number_slider_2, Wrap=True)
fly = Ladybug_fly(inputSliders=number_slider_2, fly=toggle)  # -> Vviiiiiiiiiizzz; plug-in component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
list = Honeybee_ItemSelector([item, number_slider], {"270", "45.0"}, selected="270")

# ----
# EPW Preparation
panel_2 = Panel("C:\Users\Mingbo\AppData\Roaming\Ladybug\USA_FL_Miami\USA_FL_Miami.Intl.AP.722020_TMY3.epw")

# ---- group: New UTCI range
ladybug = Ladybug_Ladybug()  # -> Vviiiiiiiiiizzz; plug-in component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
honeybee = Honeybee_Honeybee()  # -> Vviiiiiiiiiizzz; plug-in component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
updatehoneybee = Honeybee_UpdateHoneybee(updateThisFile=Button(), updateAllUObjects=Button())  # -> readMe; plug-in component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
updateladybug = Ladybug_UpdateLadybug(updateThisFile=Button(), updateAllUObjects=Button())  # -> readMe; plug-in component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

# ----
glass = Brep(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)

# ---- group: furniture
furniture = Brep([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])

# ---- group: glass facade (solid)
glass_2 = Brep(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)

# ---- group: floor
floor = Brep(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)

# ----
ledge = Brep(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)

# ---- group: FrontGround
brep = Brep(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)

# ---- group: ceiling
ceiling = Brep([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])

# ----
walls = Brep([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])
area = Area(Geometry=glass_2)  # -> Area, Centroid
scale = Scale(Geometry=glass_2, Center=area.Centroid, Factor=Slider(0.6, range=0..1))  # -> Geometry, Transform
radglassmaterial = Honeybee_RadianceGlassMaterial(materialName="0.65", RTransmittance="0.65", GTransmittance="0.65", BTransmittance="0.65", refractiveIndex=1.52)  # -> avrgTrans, RADMaterial; plug-in component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
M = M(geometry=glass_2, srftype="0")
M_2 = M(geometry=furniture, srftype="0")  # -> flatten(hbsurface)
bldgprograms = Honeybee_bldgPrograms({"Office": 0, "Retail": 1, "MidriseApartment": 2, "PrimarySchool": 3, "SecondarySchool": 4, "SmallHotel": 5, "LargeHotel": 6, "Hospital": 7, "Outpatient": 8, "Warehouse": 9, "SuperMarket": 10, "FullServiceRestaurant": 11, "QuickServiceRestaurant": 12}, selected="MidriseApartment")
listzoneprograms = Honeybee_ListZonePrograms(bldgProgram=bldgprograms)  # -> MidriseApartmentZonePrograms; plug-in component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
list_2 = Honeybee_ItemSelector(
    listzoneprograms,
    {"MidriseApartment::Apartment", "MidriseApartment::Office", "MidriseApartment::Corridor"}, selected="MidriseApartment::Apartment")
M_3 = M(geometry=brep, srftype=0)
M_4 = M(geometry=[floor, ledge], srftype="2")
M_5 = M(geometry=walls, srftype="0")
M_6 = M(geometry=ceiling, srftype="1")
addhbglz = Honeybee_addHBGlz(HBObj=M, childSurfaces=flatten(scale.Geometry), RADMaterials=radglassmaterial.RADMaterial)  # -> simplify(HBObjWGLZ); plug-in component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

# ---- group: Pt 4 orientation
pt = Point(Point(6.001341682, -3.272620442, 0))

# ----
merge = Merge(Data1=M_5, Data2=M_6, Data3=M_4, Data4=addhbglz)  # -> flatten(Result)
panel_3 = Panel(list_2)
northarrow = Ladybug_North(north=list, scale=".05")  # -> northSign; plug-in component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
createhbzones = Honeybee_createHBZones(name="Miami_Testroom", zoneProgram=list_2, HBSurfaces=flatten(merge), isConditioned=Toggle(False))  # -> readMe, HBZone; plug-in component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
wires = BrepWireframe(Brep=[createhbzones.HBZone, furniture], Density=-1)

# ----
# Step3 GlazingRatio
number_slider_3 = Slider(0, range=0..1)
panel_4 = Panel("""270
45""")
item_2 = ListItem(List=panel_4, Index=number_slider_3, Wrap=True)
fly_2 = Ladybug_fly(inputSliders=number_slider_3, fly=Toggle(False))  # -> Vviiiiiiiiiizzz; plug-in component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

# ---- group: Month
number_slider_4 = Slider(0, range=0..2)
panel_5 = Panel("""6
9
12""")
item_3 = ListItem(List=panel_5, Index=number_slider_4, Wrap=True)

# ---- group: Hour
# fly for Glare
number_slider_5 = Slider(0, range=0..2)
panel_6 = Panel("""9
12
15""")
item_4 = ListItem(List=panel_6, Index=number_slider_5, Wrap=True)

# ----
fly_3 = Ladybug_fly(inputSliders=[number_slider_4, number_slider_5], fly=Toggle(False))  # -> Vviiiiiiiiiizzz; plug-in component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
flip = Flip(Surface=floor)  # -> Surface, Result
# Daylighting simulation
toggle_2 = BooleanToggle(False)
panel_7 = Panel("C:\Users\Mingbo\OneDrive\UPenn\BuildingSimulation\SimulationFinal")
gentestpts = Honeybee_GenerateTestPoints(testGeometry=flip.Surface, gridSize="0.5", distBaseSrf="0.762", moveTestMesh=True)  # -> readMe, simplify(testPoints), simplify(ptsVectors), simplify(facesArea), simplify(mesh); plug-in component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
radparameters = Honeybee_RADParameters(quality=0)  # -> readMe, radParameters; plug-in component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
genclimatebasedsky = Honeybee_GenerateClimateBasedSky(north=list, weatherFile=panel_2, month=item_3, day=21, hour=item_4)  # -> radiationValues, skyFilePath; plug-in component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
genavgsky = Honeybee_GenerateAverageSky(north=list, weatherFile=panel_2, month=item_3, hour=item_4)  # -> radiationValues, skyFilePath; plug-in component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
list_3 = Honeybee_ItemSelector(
    ["Baseline", "Orientation", "GlazingRatio", "MaterialVent"],
    {"Baseline", "Orientation", "GlazingRatio", "MaterialVent"}, selected="MaterialVent")
concat = Concatenate(FragmentA=list, FragmentB="deg_60glz")

# ----
# Set View
number_slider_6 = Slider(28, range=0..100)
mcam = MCam(lenslength=number_slider_6)

list_4 = ValueList({"Energy": "EnergyPlus", "AnnualDaylight": "annualSimulation"}, selected="AnnualDaylight")
imagebasedsimulation = Honeybee_ImageBasedSimulation(skyFile=genavgsky.skyFilePath, cameraType=1, simulationType=2, radParameters=radparameters.radParameters, backupImages=0)  # -> analysisRecipe; plug-in component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
# DLRecipe
annualdaylightsimulation = Honeybee_AnnualDaylightSimulation(
    north=list,
    epwWeatherFile=panel_2,
    testPoints=gentestpts.testPoints,
    ptsVectors=gentestpts.ptsVectors,
    testMesh=gentestpts.mesh,
    radParameters=radparameters.radParameters)  # -> analysisRecipe; plug-in component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
gridbasedsimulation = Honeybee_GridBasedSimulation(
    skyFile=genclimatebasedsky.skyFilePath,
    testPoints=gentestpts.testPoints,
    ptsVectors=gentestpts.ptsVectors,
    testMesh=gentestpts.mesh,
    simulationType=0,
    radParameters=radparameters.radParameters)  # -> analysisRecipe; plug-in component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
list_5 = Honeybee_ItemSelector(
    [annualdaylightsimulation, gridbasedsimulation, imagebasedsimulation],
    {"Honybee.Recipe.imageBasedSimulation", "Honybee.Recipe.annualSimulation", "Honybee.Recipe.gridBasedSimulation"}, selected="Honybee.Recipe.annualSimulation")
panel_8 = Panel("3000")

# ---- group: SolarAdjustedMRT
data = Data(["key:location/dataType/units/frequency/startsAt/endsAt", "Miami_Intl_Ap_FL_USA", "Solar-Adjusted Mean Radiant Temperature", "C", "Hourly", "Grasshopper.Kernel.Types.GH_ObjectWrapper"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])

# ----
panel_9 = Panel("C:\Users\Mingbo\OneDrive\UPenn\ARCH 753 Building Simulation\Final\img\")
occupancygenerator = Honeybee_DaysimOccupancyGenerator(weekendDays=[1, 2], writeTheOcc=Toggle(True))  # -> occupancyFile; plug-in component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

merge_2 = Merge(
    Data1=ColourSwatch(SwatchColor=RGB(196, 237, 255)),
    Data2=ColourSwatch(SwatchColor=RGB(134, 222, 170)),
    Data3=ColourSwatch(SwatchColor=RGB(243, 214, 214)),
    Data4=ColourSwatch(SwatchColor=RGB(233, 174, 174)),
    Data5=ColourSwatch(SwatchColor=RGB(255, 128, 128)),
    Data6=ColourSwatch(SwatchColor=RGB(255, 85, 85)))

# ----
# Raincover
# Climate
# UTCI
# MRT
# Sunpath
toggle_3 = BooleanToggle(False)
importepw = Ladybug_ImportEpw(epwFile=panel_2)  # -> readMe, latitude, location, dryBulbTemperature, dewPointTemperature, relativeHumidity, windSpeed, windDirection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; plug-in component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
gencumulativeskymtx = Ladybug_GenCumulativeSkyMtx(epwFile=panel_2, skyDensity=0, useOldRes=True, runIt=toggle_3)  # -> readMe, cumulativeSkyMtx; plug-in component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
panel_10 = Panel(importepw.location)
analysisperiod = Ladybug_AnalysisPeriod()  # -> readMe, analysisPeriod; plug-in component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
solaradjusttemperature = Ladybug_OutdoorSolarTemperatureAdjustor(
    location=importepw.location,
    cumSkyMtxOrDirNormRad=gencumulativeskymtx.cumulativeSkyMtx,
    meanRadTemperature=importepw.dryBulbTemperature,
    north=graft(number_slider),
    analysisPeriodOrHOY=analysisperiod.analysisPeriod,
    runIt=Toggle(False))  # -> readMe, port, effectiveRadiantField, MRTDelta, solarAdjustedMRT, port_2, mannequinMesh, legend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; disabled; plug-in component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
windrose = Ladybug_WindRose(
    north=number_slider,
    hourlyWindDirection=importepw.windDirection,
    hourlyWindSpeed=importepw.windSpeed,
    scale=Slider(0.1, range=0..1),
    runIt=Toggle(True))  # -> readMe, calmRoseMesh, windRoseMesh, windRoseCrvs, windRoseCenPts, legend, legendBasePts, title; disabled; plug-in component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
outdoorcomfortcalculator = Ladybug_OutdoorComfortCalculator(
    dryBulbTemperature=importepw.dryBulbTemperature,
    meanRadiantTemperature=data,
    relativeHumidity=importepw.relativeHumidity,
    runIt=Toggle(True))  # -> readMe, port, universalThermalClimateIndex, comfortableOrNot, thermalStress, conditionOfPerson, port_2, percentOfTimeComfortable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; plug-in component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
cdd_hdd = Ladybug_CDD_HDD(hourlyDryBulbTemperature=importepw.dryBulbTemperature)  # -> readMe, daily_coolingDegDays, daily_heatingDegDays, monthly_coolingDegDays, monthly_heatingDegDays, annual_coolingDegDays, annual_heatingDegDays; plug-in component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
analysisperiod_2 = Ladybug_AnalysisPeriod()  # -> readMe, analysisPeriod; plug-in component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
panel_11 = Panel("a>800")
panel_12 = Panel("a>8")
selectandaveragedata = Ladybug_AverageData(annualHourlyData=importepw.liquidPrecipitationDepth, totalOrAverage=Toggle(True))  # -> readMe, selHourlyData, totaledDaily, totaledMonthly, totMonthlyPerHour, totAnalysisPeriod; plug-in component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
psychchart = Ladybug_PsychrometricChart(dryBulbTemperature=importepw.dryBulbTemperature, relativeHumidity=importepw.relativeHumidity, runIt=Toggle(False))  # -> readMe, port, totalComfortPercent, totalComfortOrNot, strategyNames, strategyPercentOfTime, strategyOrNot, port_2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; plug-in component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
sunpath = Ladybug_SunPath(
    north=list,
    location=importepw.location,
    hour=item_4,
    day="21",
    month=item_3,
    timeStep=1,
    sunPathScale=Slider(0.1, range=0..0.1),
    dailyOrAnnualSunPath=True)  # -> readMe, sunVectors, sunAltitudes, sunAzimuths, port, sunSpheresMesh, sunPathCrvs, legend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; disabled; plug-in component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
panel_13 = Panel([cdd_hdd.annual_coolingDegDays, cdd_hdd.annual_heatingDegDays])
legendpar = Ladybug_LegendParameters(lowBound="0")  # -> legendPar; plug-in component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
legendpar_2 = Ladybug_LegendParameters(lowBound="-1", highBound="4", numSegments="6", customColors=flatten(merge_2), decimalPlaces=0, removeLessThan=True)  # -> legendPar; plug-in component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
python = PythonScript(UTCI=outdoorcomfortcalculator.universalThermalClimateIndex)  # -> out, UTCI_Category; inputs UTCI: list
# ---------- python: Python ----------
u = []
for num in UTCI:
   try: 
       if float(num) >=9 and float(num) <=26: u.append(0)
       elif float(num) >26 and float(num) <=32: u.append(1)
       elif float(num) >32 and float(num) <=38: u.append(2)
       elif float(num) >38 and float(num) <=46: u.append(3)
       elif float(num) >46: u.append(4)
       elif float(num) >0 and float(num) <9: u.append(-1)
       elif float(num) >-13 and float(num) <=0: u.append(-2)
       elif float(num) >-27 and float(num) <=13: u.append(-3)
       elif float(num) >-40 and float(num) <=27: u.append(-4)
       elif float(num) <=-40 : u.append(-5)
       elif num == '°C': u.append('UTCI Category')
   except: u.append(num)
UTCI_Category = u
# ---------- end python ----------
barchart = Ladybug_MonthlyBarChart(inputData=flatten(selectandaveragedata.totaledMonthly))  # -> readMe, dataMesh, dataCurves, dataCrvColors, graphAxes, graphLabels, title, titleBasePt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; plug-in component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
barchart_2 = Ladybug_MonthlyBarChart(inputData=flatten([cdd_hdd.monthly_coolingDegDays, cdd_hdd.monthly_heatingDegDays]), legendPar=legendpar)  # -> readMe, dataMesh, dataCurves, dataCrvColors, graphAxes, graphLabels, title, titleBasePt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; plug-in component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
swatch = ColourSwatch(SwatchColor=RGB(255, 0, 0))
dots = DotDisplay(Point=sunpath.sunPositions, Colour=ColourSwatch(SwatchColor=RGB(0, 166, 255)), Size=Slider(0.14, range=0..1))
preview = CustomPreview(Geometry=sunpath.sunPathCrvs, Shader=ColourSwatch(SwatchColor=RGB(0, 0, 0)))

cluster = Cluster()
cluster_2 = Cluster_2()
list_6 = ValueList({"NoVent": 0, "NatrVent": 1}, selected="NatrVent")

epwindowmat = Honeybee_EnergyPlusWindowMaterial(name="SHGC", U_Value="0.3704", SHGC="0.6", VT="0.73")  # -> EPMaterial; plug-in component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
callfromepconstrlibrary = Honeybee_CallFromEPConstructionLibrary(keywords="mass")  # -> ThermMaterials, EPMaterials, EPWindowMaterials, EPConstructions; plug-in component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
callfromepconstrlibrary_2 = Honeybee_CallFromEPConstructionLibrary(keywords="roof")  # -> ThermMaterials, EPMaterials, EPWindowMaterials, EPConstructions; plug-in component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
epconstruction = Honeybee_EnergyPlusConstruction(name="lowE", layer_1=epwindowmat)  # -> EPConstruction; plug-in component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
item_5 = ListItem(List=callfromepconstrlibrary.EPConstructions, Index=Slider(14, range=0..100), Wrap=True)
item_6 = ListItem(List=callfromepconstrlibrary_2.EPConstructions, Index=Slider(46, range=0..100), Wrap=True)
decomposeepconstruction = Honeybee_DecomposeEPConstruction(cnstrName=item_6)  # -> materials, comments, UValue_SI, UValue_IP, RValue_SI, RValue_IP; plug-in component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
decomposeepconstruction_2 = Honeybee_DecomposeEPConstruction(cnstrName=item_5)  # -> materials, comments, UValue_SI, UValue_IP, RValue_SI, RValue_IP; plug-in component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
panel_14 = Panel(item_6)
panel_15 = Panel(item_5)
python_2 = PythonScript(x=decomposeepconstruction.RValue_IP, y=decomposeepconstruction_2.RValue_IP, z="SHGC")  # -> out, a
# ---------- python_2: Python ----------
if isinstance(x,float):
    x= round(x,1)

a = str(x)+"RF_"+str(round(y,1))+"WL"+str(z)
# ---------- end python_2 ----------
# Construction Material
panel_16 = Panel("""Material:RoofVegetation,
GreenRoof,                        !- Name
    0.2,                     !- Height of Plants {m}
    1,                       !- Leaf Area Index {dimensionless}
    0.22,                    !- Leaf Reflectivity {dimensionless}
    0.95,                    !- Leaf Emissivity
    180,                     !- Minimum Stomatal Resistance {s/m}
    Green Roof Soil,         !- Soil Layer Name
    MediumRough,             !- Roughness
    0.1,                     !- Thickness {m}
    0.35,                    !- Conductivity of Dry Soil {W/m-K}
    1100,                    !- Density of Dry Soil {kg/m3}
    1200,                    !- Specific Heat of Dry Soil {J/kg-K}
    0.9,                     !- Thermal Absorptance
    0.7,                     !- Solar Absorptance
    0.75,                    !- Visible Absorptance
    0.3,                     !- Saturation Volumetric Moisture Content of the Soil Layer
    0.01,                    !- Residual Volumetric Moisture Content of the Soil Layer
    0.1,                     !- Initial Volumetric Moisture Content of the Soil Layer
    Advanced;                !- Moisture Diffusion Calculation Method""")
panel_17 = Panel(decomposeepconstruction.RValue_IP)
panel_18 = Panel(decomposeepconstruction_2.RValue_IP)
list_7 = Honeybee_ItemSelector(
    decomposeepconstruction.materials,
    {"Metal Roofing", "Metal Roof Insulation R-27.79 IP", "Metal Decking"}, selected="Metal Roofing")
list_8 = Honeybee_ItemSelector(
    decomposeepconstruction_2.materials,
    {"1IN Stucco", "8IN Concrete HW", "Wall Insulation [46]", "1/2IN Gypsum"}, selected="8IN Concrete HW")
callfromepconstrlibrary_3 = Honeybee_CallFromEPConstructionLibrary(keywords="concrete")  # -> EPMaterials, EPWindowMaterils, EPConstructions; plug-in component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
decomposeepmaterial = Honeybee_DecomposeEPMaterial(materialName=simplify(list_7))  # -> names, values, comments, UValue_SI, UValue_IP, RValue_SI, RValue_IP; plug-in component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
decomposeepmaterial_2 = Honeybee_DecomposeEPMaterial(materialName=simplify(list_8))  # -> names, values, comments, UValue_SI, UValue_IP, RValue_SI, RValue_IP; plug-in component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
item_7 = ListItem(List=callfromepconstrlibrary_3.EPMaterials, Index=0, Wrap=True)
panel_19 = Panel([decomposeepmaterial.values, decomposeepmaterial.names])
panel_20 = Panel([decomposeepmaterial_2.names, decomposeepmaterial_2.values])
panel_21 = Panel(decomposeepmaterial.comments)
epconstruction_2 = Honeybee_EnergyPlusConstruction(name="vegRoof", layer_1=panel_16, layer_2=item_7)  # -> EPConstruction; plug-in component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
panel_22 = Panel(decomposeepmaterial_2.comments)

# ----
# Natural Ventilation
setepnatvent = Honeybee_SetEPAirFlow(
    HBZones=createhbzones.HBZone,
    naturalVentilationType=list_6,
    minIndoorTempForNatVent="24",
    maxOutdoorTempForNatVent="28",
    fractionOfGlzAreaOperable="1")  # -> readMe, simplify(HBZones); plug-in component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
isgood = PythonScript(x=importepw.dryBulbTemperature)  # -> out, a; inputs x: list
# ---------- isgood: Python ----------
a =[]

for i in x:
    try:
        if i <22:a.append(0)
        elif i>28:a.append(0)
        else: a.append(1)
    except: a.append(i)
# ---------- end isgood ----------
# Naming
concat_2 = Concatenate(FragmentA="24", FragmentC="Li_Ho_", FragmentB="28", FragmentD=python_2.a)
dlfolder = PythonScript(recipe=list_5, dir=panel_7, folder=list_3, month=item_3, hour=item_4, DLver=concat, EGver=concat_2)  # -> out, DLdir, DLfolder, EGdir, EGfolder; inputs recipe: list; disabled
# ---------- dlfolder: Python ----------
ghenv.Component.Message = 'VER 0.0.01\nDEC_05_2015'

recipe = str(recipe[0])

#for img & grid simulation
if recipe.find("annualSimulation")== -1:
    DLfolder = "m"+str(month)+"-h"+str(hour)
    DLdir = str(dir)+"\\"+folder

# for annual simualtion
else:
    
    DLdir = str(dir)
    DLfolder = folder
    if DLver !=None:
        DLdir = DLdir+"\\"+DLfolder
        DLfolder = DLver

EGdir = str(dir)
EGfolder = folder
if EGver !=None:
    EGdir = EGdir+"\\"+EGfolder
    EGfolder = EGver
# ---------- end dlfolder ----------
rundaylightanalysis = Honeybee_RunDaylightSimulation(
    HBObjects=flatten(createhbzones.HBZone),
    analysisRecipe=list_5,
    writeRad=toggle_2,
    runRad=toggle_2,
    numOfCPUs="6",
    workingDir=dlfolder.DLdir,
    radFileName=dlfolder.DLfolder,
    overwriteResults=True)  # -> readMe, analysisType, resultsUnit, results, testPts, resultFiles, radGeoFile, studyFolder, done; plug-in component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
lookupfolder = LookUpFolder(
    MasterDir=dlfolder.DLdir,
    subStudyFolder=list_4,
    itemIndex=Slider(7, range=0..11),
    refreshList=Button(ExpressionNormal="true", ExpressionPressed="False"),
    getResultFiles=Toggle(True))  # -> FolderNames, DirList, FolderName, resultFiles; inputs itemIndex: Int32
# ---------- lookupfolder: Python ----------
ghenv.Component.Message = 'VER 0.0.05\nDEC_07_2015'

import os


if refreshList == 1 and os.path.isdir(MasterDir):
    MasterDir = str(MasterDir)
    DirList = []
    resultFiles = []
    try:
        FolderNames = os.listdir( MasterDir )
        FolderNames.sort()
    except:FolderNames= ['no Folder']
    for i in FolderNames:
        DirList.append(MasterDir+"\\" + str(i)+ "\\"+subStudyFolder)
    if itemIndex != None:
        FolderName = FolderNames[itemIndex]
        resultDir = DirList[itemIndex]



if getResultFiles == 1:
    
    if subStudyFolder == "EnergyPlus" and os.path.isdir(resultDir):
        fileNames = os.listdir( resultDir )
        fileNames.sort()
        for fileName in fileNames:
            #print fileName
            if fileName.lower().find(str(FolderName)+".csv") != -1:
                print fileName
                resultFiles.append(resultDir+"\\"+ fileName)
                
    elif subStudyFolder == "annualSimulation" and os.path.isdir(resultDir):
        fileNames = os.listdir( resultDir )
        fileNames.sort()
        
        for fileName in fileNames:
            #print fileName
            if fileName.lower().endswith(".ill") and (fileName.find("space")== -1 or fileName.split("_")[-2]!="space"):
                print fileName
                resultFiles.append(resultDir+"\\"+ fileName)
    else:resultFiles=['There is no valid folder!']
# ---------- end lookupfolder ----------
panel_23 = Panel(lookupfolder.FolderNames)
dlresult = PythonScript(Recipe=list_5, results=rundaylightanalysis.resultFiles, run=Toggle(True))  # -> out, annual, image, grid; inputs Recipe: list, run: Boolean
# ---------- dlresult: Python ----------
ghenv.Component.Message = 'VER 0.0.02\nDEC_06_2015'


if results != "There is no valid folder!":
    if run ==1:
        x = str(Recipe[0])
        if x.find("annualSimulation")>= 0:
            annual = results
        elif x.find("image")>= 0:
            image = results
        elif x.find("grid")>= 0:
            grid = results
else: print "There is no valid folder!"
# ---------- end dlresult ----------
# IMG
m_hdr = MHDR(hdrimagepath=dlresult.image)
# Annual
readannualresultsi = Honeybee_ReadAnnualResultI(
    illFilesAddress=dlresult.annual,
    testPoints=simplify(gentestpts.testPoints),
    occupancyFiles=occupancygenerator,
    DLAIllumThresholds=300,
    runIt=Toggle(True))  # -> DLA, UDLI_Less_100, UDLI_100_2000, UDLI_More_2000, CDA, sDA, annualProfiles, htmReport; plug-in component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
copygif = PythonScript(StudyDir=dlfolder.DLdir, TDir=panel_9, TFolder=list_3, runCopy=Button())  # -> out, GIF
# ---------- copygif: Python ----------
ghenv.Component.Message = 'VER 0.0.01\nDEC_05_2015'

import os
import shutil
import ctypes
gifFiles = []


if StudyDir!=None:
    for dirpath, dirnames, filenames in os.walk(StudyDir):
        for filename in filenames:
            if filename.lower().endswith(".gif"):
              gifFiles.append(os.path.join(dirpath, filename))
GIF = gifFiles

if runCopy ==1:
    if gifFiles != None:
        j =0
        for i in gifFiles:
            shutil.copy(i,TDir+"\\"+TFolder)
            j+=1
        if j == len(gifFiles):
            MessageBox = ctypes.windll.user32.MessageBoxW
            MessageBox(None, 'Happy coping! Done!', '', 0)
# ---------- end copygif ----------
dla2sda = DLA2sDA(A=readannualresultsi.DLA)  # -> or_equal_to, a
panel_24 = Panel(copygif.GIF)
concat_3 = Concatenate(FragmentA=rundaylightanalysis.analysisType, FragmentC="sDA:", FragmentB=readannualresultsi.sDA)
image = ImageFromPath(P=m_hdr, S="0.25")
# GRID
recolormesh = Ladybug_RecolorMesh(analysisResult=rundaylightanalysis.results, inputMesh=gentestpts.mesh)  # -> readMe, newMesh, newLegend, legendBasePt, meshColors, legendColors; disabled; plug-in component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
# 100-2000
recolormesh_2 = Ladybug_RecolorMesh(
    analysisResult=readannualresultsi.UDLI_100_2000,
    inputMesh=gentestpts.mesh,
    legendPar=cluster_2,
    analysisTitle=concat_3,
    legendTitle="%")  # -> readMe, newMesh, newLegend, legendBasePt, meshColors, legendColors; plug-in component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
# DLA
recolormesh_3 = Ladybug_RecolorMesh(analysisResult=dla2sda.or_equal_to, inputMesh=gentestpts.mesh, legendPar=cluster, analysisTitle=concat_3)  # -> readMe, newMesh, newLegend, legendBasePt, meshColors, legendColors; plug-in component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
panel_25 = Panel(concat_3)
list_9 = ValueList({"EnergyUse": 1, "Gain&Losses": 2, "Comfort": 3, "SurfTemp": 6, "SurfEnergy": 7, "GlazingSolar": 8, "-----", "isMonthly?": "monthly"}, selected=["EnergyUse", "Gain&Losses", "Comfort", "SurfTemp", "SurfEnergy", "GlazingSolar"])
# Construction
setepzonecnstr = Honeybee_SetEPZoneConstruction(HBZone=setepnatvent.HBZones, wallEPConstruction=item_5, windowEPConstruction=epconstruction, roofEPConstruction=item_6)  # -> simplify(modifiedHBZone); plug-in component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
toggle_4 = BooleanToggle(False)
m_out = MOut(x=list_9)
list_10 = ValueList({"Energy": "EnergyPlus", "AnnualDaylight": "annualSimulation"}, selected="Energy")
# Energy simulation
runenergysimulation = Honeybee_RunEnergySimulation(
    north=list,
    epwFile=panel_2,
    HBZones=flatten(setepzonecnstr),
    simulationOutputs=flatten(m_out),
    writeIdf=toggle_4,
    runEnergyPlus=toggle_4,
    workingDir=dlfolder.EGdir,
    idfFileName=dlfolder.EGfolder)  # -> report, idfFileAddress, resultFileAddress; plug-in component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
# Read Result
lookupfolder_2 = LookUpFolder(
    MasterDir=dlfolder.EGdir,
    subStudyFolder=list_10,
    itemIndex=Slider(5, range=0..11),
    refreshList=Button(ExpressionNormal="true", ExpressionPressed="False"),
    getResultFiles=Toggle(True))  # -> FolderNames, DirList, FolderName, resultFiles; inputs itemIndex: Int32
# ---------- lookupfolder_2: Python ----------
ghenv.Component.Message = 'VER 0.0.05\nDEC_07_2015'

import os

if refreshList == 1 and os.path.isdir(MasterDir):
    MasterDir = str(MasterDir)
    DirList = []
    resultFiles = []
    try:
        FolderNames = os.listdir( MasterDir )
        FolderNames.sort()
    except:FolderNames= ['no Folder']
    for i in FolderNames:
        DirList.append(MasterDir+"\\" + str(i)+ "\\"+subStudyFolder)
    if itemIndex != None:
        FolderName = FolderNames[itemIndex]
        resultDir = DirList[itemIndex]


if getResultFiles == 1:
    
    if subStudyFolder == "EnergyPlus" and os.path.isdir(resultDir):
        fileNames = os.listdir( resultDir )
        fileNames.sort()
        for fileName in fileNames:
            print fileName
            if fileName.find(str(FolderName)+".csv") != -1:
                print fileName
                resultFiles.append(resultDir+"\\"+ fileName)
                
    elif subStudyFolder == "annualSimulation" and os.path.isdir(resultDir):
        fileNames = os.listdir( resultDir )
        fileNames.sort()
        
        for fileName in fileNames:
            #print fileName
            if fileName.lower().endswith(".ill") and (fileName.find("space")== -1 or fileName.split("_")[-2]!="space"):
                print fileName
                resultFiles.append(resultDir+"\\"+ fileName)
    else:resultFiles=['There is no valid folder!']
# ---------- end lookupfolder_2 ----------
panel_26 = Panel(lookupfolder_2.FolderNames)
readepsrfresult = Honeybee_ReadEPSurfaceResult(resultFileAddress=runenergysimulation.resultFileAddress)  # -> surfaceIndoorTemp, surfaceOutdoorTemp, surfaceEnergyFlow, opaqueEnergyFlow, glazEnergyFlow, windowTotalSolarEnergy, windowBeamEnergy, windowDiffEnergy, windowTransmissivity, otherSurfaceData; plug-in component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
readepresult = Honeybee_ReadEPResult(resultFileAddress=runenergysimulation.resultFileAddress)  # -> totalThermalEnergy, thermalEnergyBalance, cooling, heating, electricLight, electricEquip, fanElectric, pumpElectric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; plug-in component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
selectandaveragedata_2 = Ladybug_AverageData(annualHourlyData=readepresult.airTemperature, totalOrAverage=0)  # -> readMe, selHourlyData, averagedDaily, averagedMonthly, avrMonthlyPerHour, avrAnalysisPeriod; plug-in component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
separatedata = Ladybug_SeparateData(inputList=flatten(selectandaveragedata_2.avrAnalysisPeriod))  # -> numbers, strings; plug-in component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
round = PythonScript(Data=separatedata.numbers, p=2)  # -> out, data; inputs p: Int32
# ---------- round: Python ----------
if Data != None and p!=None:
    data = round(Data,p)
# ---------- end round ----------

# ---- group: Step3 SHG / 270-100glz
data_2 = Data(["key:location/dataType/units/frequency/startsAt/endsAt", "Miami Intl Ap FL USA TMY3 ", "Total Solar Gain for MIAMI_TESTROOM", "kWh", "Hourly", "Grasshopper.Kernel.Types.GH_ObjectWrapper"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])

# ---- group: Step3 SHG / 270-60glz
data_3 = Data(["key:location/dataType/units/frequency/startsAt/endsAt", "Miami Intl Ap FL USA TMY3 ", "Total Solar Gain for MIAMI_TESTROOM", "kWh", "Hourly", "Grasshopper.Kernel.Types.GH_ObjectWrapper"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])

# ----
cluster_3 = Cluster_3()
pmvcomfortcalculator = Ladybug_PMVComfortCalculator(
    dryBulbTemperature=readepresult.airTemperature,
    meanRadiantTemperature=readepresult.meanRadTemperature,
    relativeHumidity=readepresult.relativeHumidity,
    calcBalanceTemperature=False)  # -> readMe, port, predictedMeanVote, percentPeopleDissatisfied, standardEffectiveTemperature, port_2, comfortableOrNot, percentOfTimeComfortable, port_3, balanceTemperature; plug-in component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
adaptivecomfortcalculator = Ladybug_AdaptiveComfortCalculator(
    dryBulbTemperature=readepresult.airTemperature,
    meanRadiantTemperature=readepresult.meanRadTemperature,
    prevailingOutdoorTemp=importepw.dryBulbTemperature,
    runIt=Toggle(True))  # -> readMe, port, comfortableOrNot, conditionOfPerson, degreesFromTarget, port_2, targetTemperature, upperTemperatureBound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; plug-in component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
round_2 = PythonScript(Data=adaptivecomfortcalculator.percentOfTimeComfortable, p=2)  # -> out, data; inputs p: Int32; same code as round
concat_4 = Concatenate(FragmentA=round_2.data, FragmentC="-", FragmentB=round.data)  # -> flatten(Result)
rec = DataRecorder(concat_4, DataLimit=-10, RecordData=True)
panel_27 = Panel(rec)
colorsurfaces = Honeybee_ColorSurfacesByEPResult(srfData=readepsrfresult.surfaceIndoorTemp, HBZones=flatten(setepzonecnstr), legendPar=cluster_3, runIt=Toggle(False))  # -> readMe, srfColoredMesh, zoneWireFrame, legend, legendBasePt, analysisTitle, srfBreps, srfColors, srfValues, normalizedSrfData; plug-in component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

separatedata_2 = Ladybug_SeparateData(inputList=flatten(readepresult.totalSolarGain))  # -> numbers, strings; plug-in component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
number_slider_7 = Slider(0, range=0..1)
panel_28 = Panel("""surfTempBack
surfTempFront""")
concat_5 = Concatenate(FragmentA=panel_9, FragmentC=list_3, FragmentB="\surtTemp")
fly_4 = Ladybug_fly(inputSliders=number_slider_7, fly=Toggle(False))  # -> Vviiiiiiiiiizzz; plug-in component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
ma = MassAddition(Input=separatedata_2.numbers)  # -> Result, PartialResults
item_8 = ListItem(List=panel_28, Index=number_slider_7, Wrap=True)
concat_6 = Concatenate(
    FragmentA=lookupfolder_2.FolderName,
    FragmentC="-CFT-",
    FragmentB=adaptivecomfortcalculator.percentOfTimeComfortable,
    FragmentE="-SHG-",
    FragmentD=ma.Result)
captureview = Ladybug_CaptureView(fileName=concat_6, folder=concat_5, viewNames=item_8, imageWidth="800", imageHeight="800", capture=Toggle(False))  # -> imagePath; plug-in component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
panel_29 = Panel(captureview)

separatedata_3 = Ladybug_SeparateData(inputList=flatten(adaptivecomfortcalculator.comfortableOrNot))  # -> numbers, strings; plug-in component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
occupied_hour = OccupiedHour(L=separatedata_3.numbers)
mgraph = MGraph(inputdata=adaptivecomfortcalculator.comfortableOrNot)
panel_30 = Panel("""    hoursPerPeriod = [0,3, 6,9, 12,15, 18,21, 24]
    hourNames = ["00:00","03:00","06:00", "09:00","12:00","15:00","18:00","21:00","24:00"]""")
panel_31 = Panel(occupied_hour)
panel_32 = Panel(adaptivecomfortcalculator.percentOfTimeComfortable)

# ==== cluster M
srftype = ClusterInput()
geometry = ClusterInput()
createhbsrfs = Honeybee_createHBSrfs(geometry=geometry, srfType=srftype)  # -> readMe, simplify(HBSurface); plug-in component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
hbsurface = ClusterOutput(createhbsrfs.HBSurface)

# ==== cluster MOut
x = ClusterInput()
panel = Panel(x)
python = PythonScript(x=x)  # -> out, a, b, c, h, i, d, e, f, g; inputs x: list
# ---------- python: Python ----------
a, b, c, d,e,f,g = 0,0,0,0,0,0,0
for i in x:
    if   i == 1: a =1
    elif i == 2: b =1
    elif i == 3: c =1
    elif i == 6: d =1
    elif i == 7: e =1
    elif i == 8: f =1
    elif i =="monthly": g =1
# ---------- end python ----------
epoutput = Honeybee_GenerateEPOutput(
    zoneEnergyUse=python.a,
    zoneGainsAndLosses=python.b,
    zoneComfortMetrics=python.c,
    surfaceTempAnalysis=python.d,
    surfaceEnergyAnalysis=python.e,
    glazingSolarAnalysis=python.f,
    timestep=python.g)  # -> report, flatten(simulationOutputs); plug-in component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
panel_2 = Panel([python.a, python.b, python.c, python.d, python.e, python.f, python.g])
simulationoutputs = ClusterOutput(epoutput.simulationOutputs)

# ==== cluster MCam
pt = Point(Point(2.962428299, 2.501571056, 0))
md_slider = MDSlider(
    slider_value=Point(0.4975608267, 0.5024384289, 0.5),
    SliderMode=0,
    x_domain=Domain(-1, 1),
    y_domain=Domain(-1, 1),
    z_domain=Domain(0, 1))
comfortmannequin = Ladybug_ComfortMannequin(rotationAngle="180", bodyLocation=pt)  # -> mannequinMesh, legend, legendBasePt; plug-in component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
data = Data(Point(2.962428331, 2.417174339, 1.168404996))
lenslength = ClusterInput()
settheview = Ladybug_SetTheView(cameraLocation=data, cameraDirection="{0.0,1.0,0.0}", lensLength=lenslength)  # plug-in component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
item = ListItem(List=comfortmannequin.mannequinMesh, Index="121", Wrap=True)
mannequinmesh = ClusterOutput(comfortmannequin.mannequinMesh)

# ==== cluster MHDR
toggle = BooleanToggle(True)
hdrimagepath = ClusterInput()
glareanalysis = Honeybee_GlareAnalysis(HDRImagePath=hdrimagepath, runIt=toggle)  # -> readMe, glareCheckImage, DGP, DGI, imageWithTaskArea; plug-in component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
falsecolor = Honeybee_FalseColor(
    HDRFilePath=glareanalysis.glareCheckImage,
    legendUnit="lux",
    contourLines=1,
    contourBands=False,
    maskThreshold=0.1,
    useAlterColors=False,
    render=toggle)  # -> outputFilePath; plug-in component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
hdr_gif = Honeybee_ConvertHDRToGIF(HDRFilePath=falsecolor, adjustExposure=False)  # -> GIFFilePath; plug-in component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
giffilepath = ClusterOutput(hdr_gif)

# ==== cluster DLA2sDA
panel = Panel("50")
A = ClusterInput()
larger = LargerThan(FirstNumber=A, SecondNumber=panel)  # -> LargerThan, OrEqualTo
ma = MassAddition(Input=larger.OrEqualTo)  # -> Result, PartialResults
lng = ListLength(List=larger.OrEqualTo)
division = Division(A=ma.Result, B=lng)
multiplication = Multiplication(A=division, B=100)
round = Round(Number=multiplication)  # -> Nearest, Floor, Ceiling
python = PythonScript(x=round.Nearest)  # -> a
# ---------- python: Python ----------
a = "sDA:" + str(x) + "%"
print a
# ---------- end python ----------
panel_2 = Panel(round.Nearest)
a = ClusterOutput(python)
or_equal_to = ClusterOutput(larger.OrEqualTo)

# ==== cluster Cluster
legendpar = Ladybug_LegendParameters(
    lowBound="0",
    highBound="1",
    numSegments="2",
    customColors=flatten([ColourSwatch(SwatchColor=RGB(227, 227, 227)), ColourSwatch(SwatchColor=RGB(255, 250, 92))]))  # -> legendPar; plug-in component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
legendpar_2 = ClusterOutput(legendpar)

# ==== cluster Cluster_2
legendpar = Ladybug_LegendParameters(lowBound="0", highBound="100")  # -> legendPar; plug-in component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
legendpar_2 = ClusterOutput(legendpar)

# ==== cluster Cluster_3
legendpar = Ladybug_LegendParameters(lowBound="30", highBound="35")  # -> legendPar; plug-in component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
legendpar_2 = ClusterOutput(legendpar)

# ==== cluster MGraph
low = ClusterInput()
high = ClusterInput()
inputdata = ClusterInput()
gradientlibrary = Ladybug_GradientLibrary(gradIndex=Slider(0, range=0..21))  # -> customColors; plug-in component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
panel = Panel(gradientlibrary)
swatch = ColourSwatch(SwatchColor=RGB(199, 199, 199))
item = ListItem(List=inputdata, Index=2, Wrap=True)
panel_2 = Panel(ColourSwatch(SwatchColor=RGB(232, 255, 140)))
python = PythonScript(x=item, y=gradientlibrary, low=low, high=high)  # -> out, a, b, c, cc, d; inputs x: list, y: list
# ---------- python: Python ----------
x = str(x[0])

RHColor = ['255,255,255','209,229,240','146,197,222','67,147,195','33,102,172','5,48,97']
CloudCoverColor = ['93,190,255','255,255,255','217,217,217','83,114,115']
isGood =['222,222,222','78,191,255']
#print x
if x.find("Predicted Mean Vote")!= -1:
    a = -3
    b = 3
    c =7
    cc =y
elif x.find("Adaptive Comfort") !=-1:
    a = -1
    b = 1
    c =3
    cc =y
elif x.find("Comfortable Or Not") !=-1:
    a = 0
    b = 1
    c =2
    cc = ['199,199,199','232,255,140']
elif x.find("Percentage of People Dissatisfied") !=-1:
    a = 0
    b = 100
    d = 0
    cc =y
elif x.find("Air Temperature") !=-1: #indoor Temp
    a = 18
    b = 30
    d = 0
    cc =y
elif x.find("Humidity") !=-1:
    a = 0
    b = 100
    d = 0
    cc =RHColor
elif x.find("Cloud Cover") !=-1:
    a = 0
    b = 10
    d = 0
    cc =CloudCoverColor
elif x.find("Solar Gain") !=-1:
    if low:a = low
    else:a = 0
    if high:b = high
    else:b = 1
    cc =y
    
elif x.find("0")!=-1 or x.find("1")!=-1:
    a = 0
    b = 1
    c=2
    cc =isGood
else:
    if low:a = low
    if high:b = high
    cc =y
# ---------- end python ----------
panel_3 = Panel(item)
legendpar = Ladybug_LegendParameters(
    lowBound=python.a,
    highBound=python.b,
    numSegments=python.c,
    customColors=flatten(python.cc),
    decimalPlaces=python.d,
    removeLessThan=1)  # -> legendPar; plug-in component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
_3dchart = Ladybug_3DChart(inputData=flatten(inputdata), xScale="0.25", zScale="0", legendPar=legendpar)  # -> readMe, graphMesh, graphCurves, legend, legendBasePts, title, titleBasePts, dataPts, conditionalHOY; plug-in component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
graphcurves = ClusterOutput([_3dchart.graphCurves, _3dchart.legend, _3dchart.title, _3dchart.graphMesh])

# ==== cluster OccupiedHour
panel = Panel("""1
1
1
1
1
1
1
1
1
0
0
0
0
0
0
0
0
0
1
1
1
1
1
1""")
L = ClusterInput()
cull = CullPattern(List=L, CullPattern=panel)
avr = Average(Input=cull)
am = ClusterOutput(avr)
