# Grasshopper definition Rong_Shengliang_Final_1211.gh (Grasshopper 0.9.76)
# plug-ins: Python Interpreter

panel = Panel("http://apps1.eere.energy.gov/buildings/energyplus/weatherdata/5_southwest_pacific_wmo_region_5/MYS_Kuala.Lumpur.486470_IWEC.zip")

# ---- group: ceiling
ceiling_without_skylight = Brep([<brep referenced from the Rhino model> x2])

# ----
ceiling_with_skylight = Brep([<brep referenced from the Rhino model> x2])

# ---- group: floor
inside_floor = Brep(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)

# ---- group: Walls
south_wall = Brep(<brep referenced from the Rhino model>)
north_wall = Brep([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])
east_wall = Brep(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)
west_wall = Brep([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])

# ----
ledge = Brep([<brep referenced from the Rhino model> x2])
open_epw_stat = Ladybug_OpenEPWAndSTATWeatherFiles(weatherFileURL=panel)  # -> epwFile, statFile; plug-in component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
toggle = BooleanToggle(True)
flip = Flip(Surface=ceiling_without_skylight)  # -> Surface, Result
flip_2 = Flip(Surface=ceiling_with_skylight)  # -> Surface, Result
flip_3 = Flip(Surface=ledge)  # -> Surface, Result
flip_4 = Flip(Surface=west_wall)  # -> Surface, Result
flip_5 = Flip(Surface=inside_floor)  # -> Surface, Result
flip_6 = Flip(Surface=east_wall)  # -> Surface, Result
flip_7 = Flip(Surface=north_wall)  # -> Surface, Result
flip_8 = Flip(Surface=south_wall)  # -> Surface, Result
updatehoneybee = Honeybee_UpdateHoneybee(sourceDirectory=toggle, updateThisFile=toggle, updateAllUObjects=toggle)  # -> readMe; plug-in component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
updateladybug = Ladybug_UpdateLadybug(sourceDirectory=toggle, updateThisFile=toggle, updateAllUObjects=toggle)  # -> readMe; plug-in component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
ladybug = Ladybug_Ladybug(defaultFolder="c:/ladybug")  # -> Vviiiiiiiiiizzz; plug-in component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
honeybee = Honeybee_Honeybee(defaultFolder="c:/honeybee")  # -> Vviiiiiiiiiizzz; plug-in component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
outside_floor = Brep(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)
createhbsrfs = Honeybee_createHBSrfs(geometry=flip_4.Surface, srfType="0")  # -> readMe, simplify(HBSurface); plug-in component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
createhbsrfs_2 = Honeybee_createHBSrfs(geometry=flip.Surface, srfType="3")  # -> readMe, simplify(HBSurface); plug-in component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
createhbsrfs_3 = Honeybee_createHBSrfs(geometry=flatten(flip_8.Surface), srfType="0")  # -> readMe, simplify(HBSurface); plug-in component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
createhbsrfs_4 = Honeybee_createHBSrfs(geometry=flip_6.Surface, srfType="0")  # -> readMe, simplify(HBSurface); plug-in component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
createhbsrfs_5 = Honeybee_createHBSrfs(geometry=flatten(flip_5.Surface), srfType="2")  # -> readMe, simplify(HBSurface); plug-in component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
createhbsrfs_6 = Honeybee_createHBSrfs(geometry=flatten(flip_3.Surface), srfType="0")  # -> readMe, simplify(HBSurface); plug-in component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
createhbsrfs_7 = Honeybee_createHBSrfs(geometry=flip_7.Surface, srfType="0")  # -> readMe, simplify(HBSurface); plug-in component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
createhbsrfs_8 = Honeybee_createHBSrfs(geometry=flip_2.Surface, srfType="0")  # -> readMe, simplify(HBSurface); plug-in component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
createhbsrfs_9 = Honeybee_createHBSrfs(geometry=outside_floor, srfName="Outside Floor", srfType="2.75")  # -> readMe, simplify(HBSurface); plug-in component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
toggle_2 = BooleanToggle(True)
n_e_w_wall = Brep([createhbsrfs_4.HBSurface, createhbsrfs_7.HBSurface, createhbsrfs.HBSurface])
toggle_3 = BooleanToggle(True)
glazingcreator = Honeybee_GlazingBasedOnRatio(HBObjects=createhbsrfs_8.HBSurface, glzRatio=Slider(0.8, range=0..1), runIt=Toggle(True))  # -> readMe, HBObjWGLZ; plug-in component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
glazingcreator_2 = Honeybee_GlazingBasedOnRatio(HBObjects=n_e_w_wall, glzRatio=Slider(0.8, range=0..1), breakUpWindow=toggle_3, runIt=toggle_3)  # -> readMe, HBObjWGLZ; plug-in component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
glazingcreator_3 = Honeybee_GlazingBasedOnRatio(HBObjects=createhbsrfs_3.HBSurface, glzRatio=Slider(0.83, range=0..1), breakUpWindow=toggle_2, runIt=toggle_2)  # -> readMe, HBObjWGLZ; plug-in component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
preview = CustomPreview(Geometry=createhbsrfs_9.HBSurface, Shader=ColourSwatch(SwatchColor=RGBA(0, 0, 0, 160)))
number_slider = Slider(1, range=0..1)
bldgprograms = Honeybee_bldgPrograms({"Office": 0, "Retail": 1, "MidriseApartment": 2, "PrimarySchool": 3, "SecondarySchool": 4, "SmallHotel": 5, "LargeHotel": 6, "Hospital": 7, "Outpatient": 8, "Warehouse": 9, "SuperMarket": 10, "FullServiceRestaurant": 11, "QuickServiceRestaurant": 12}, selected="MidriseApartment")
listzoneprograms = Honeybee_ListZonePrograms(bldgProgram=bldgprograms)  # -> MidriseApartmentZonePrograms; plug-in component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
radmirrormaterial = Honeybee_RadianceMirrorMaterial(materialName="mirror", RReflectance=number_slider, GReflectance=number_slider, BReflectance=number_slider)  # -> RADMaterial; plug-in component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
item = ListItem(List=listzoneprograms, Index=0, Wrap=True)

# ---- group: collect all honeybee surfaces
brep = Brep(flatten([createhbsrfs_6.HBSurface, createhbsrfs_5.HBSurface, glazingcreator_3.HBObjWGLZ, glazingcreator_2.HBObjWGLZ, createhbsrfs_2.HBSurface, glazingcreator.HBObjWGLZ]))

# ----
panel_2 = Panel(item)
wires = BrepWireframe(Brep=glazingcreator_3.HBObjWGLZ, Density=-1)
brep_2 = Brep([<brep referenced from the Rhino model> x5])
analysisperiod = Ladybug_AnalysisPeriod(fromMonth=Slider(1, range=0..1), toMonth=Slider(12, range=0..100))  # -> readMe, analysisPeriod; plug-in component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
preview_2 = CustomPreview(
    Geometry=[glazingcreator_3.HBObjWGLZ, glazingcreator_2.HBObjWGLZ, glazingcreator.HBObjWGLZ],
    Shader=ColourSwatch(SwatchColor=RGBA(3, 234, 255, 160)))
createhbzones = Honeybee_createHBZones(name="test_room", zoneProgram=item, HBSurfaces=flatten(brep), isConditioned=Toggle(False))  # -> readMe, HBZone; plug-in component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
createhbsrfs_10 = Honeybee_createHBSrfs(geometry=brep_2, srfType="2.75", RADMaterial=radmirrormaterial)  # -> readMe, simplify(HBSurface); plug-in component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
wires_2 = BrepWireframe(Brep=createhbzones.HBZone, Density=-1)
brep_3 = Brep([<brep referenced from the Rhino model> x20])
preview_3 = CustomPreview(Geometry=[wires_2, wires], Shader=ColourSwatch(SwatchColor=RGB(0, 0, 0)))
createhbsrfs_11 = Honeybee_createHBSrfs(geometry=brep_3, srfType=Slider(6, range=0..10))  # -> readMe, simplify(HBSurface); plug-in component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

number_slider_2 = Slider(90, range=0..100)
open_epw_stat_2 = Ladybug_OpenEPWAndSTATWeatherFiles(weatherFileURL=panel)  # -> epwFile, statFile; plug-in component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
northarrow = Ladybug_North(north=number_slider_2, scale=".05")  # -> northSign; plug-in component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

# ---- group: Climate Analysis
gradientlibrary = Ladybug_GradientLibrary(gradIndex=Slider(7, range=0..10))  # -> reverse(customColors); plug-in component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
importepw = Ladybug_ImportEpw(epwFile=open_epw_stat.epwFile)  # -> readMe, latitude, location, dryBulbTemperature, dewPointTemperature, relativeHumidity, windSpeed, windDirection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; plug-in component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
panel_3 = Panel(importepw.modelYear)
separatedata = Ladybug_SeparateData(inputList=flatten(panel_3))  # -> numbers, strings; plug-in component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
bnd = Bounds(Numbers=separatedata.numbers)
panel_4 = Panel(bnd)
pmvcomfortpar = Ladybug_PMVComfortParameters(humidRatioUpBound="0.03")  # -> comfortPar; plug-in component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
legendpar = Ladybug_LegendParameters(lowBound=Slider(0, range=0..100), highBound=Slider(890, range=0..1000), customColors=flatten(gradientlibrary))  # -> legendPar; plug-in component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
toggle_4 = BooleanToggle(True)
panel_5 = Panel("""0.5
0.8
1""")
separatedata_2 = Ladybug_SeparateData(inputList=flatten(importepw.dryBulbTemperature))  # -> numbers, strings; plug-in component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
separatedata_3 = Ladybug_SeparateData(inputList=flatten(importepw.relativeHumidity))  # -> numbers, strings; plug-in component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
pt = Point(<point referenced from the Rhino model>)
psychchart = Ladybug_PsychrometricChart(
    dryBulbTemperature=importepw.dryBulbTemperature,
    relativeHumidity=importepw.relativeHumidity,
    barometricPressure=importepw.barometricPressure,
    clothingLevel=panel_5,
    mergeComfPolygons=toggle_4,
    comfortPar=pmvcomfortpar,
    annualHourlyData=flatten([importepw.dryBulbTemperature, importepw.relativeHumidity]),
    basePoint=pt,
    legendPar=legendpar,
    runIt=toggle_4)  # -> readMe, port, totalComfortPercent, totalComfortOrNot, strategyNames, strategyPercentOfTime, strategyOrNot, port_2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; disabled; plug-in component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
int = Integer(separatedata_3.numbers)
int_2 = Integer(separatedata_2.numbers)
smaller = SmallerThan(FirstNumber=int_2, SecondNumber="35")  # -> SmallerThan, OrEqualTo
smaller_2 = SmallerThan(FirstNumber=int, SecondNumber="76")  # -> SmallerThan, OrEqualTo
larger = LargerThan(FirstNumber=int_2, SecondNumber="30")  # -> LargerThan, OrEqualTo
larger_2 = LargerThan(FirstNumber=int, SecondNumber="41")  # -> LargerThan, OrEqualTo
wires_3 = BrepWireframe(Brep=psychchart.comfortPolygons, Density=-1)
and = GateAnd(A=larger.OrEqualTo, B=smaller.OrEqualTo)
and_2 = GateAnd(A=larger_2.OrEqualTo, B=smaller_2.OrEqualTo)
preview_4 = CustomPreview(Geometry=psychchart.chartCurvesAndTxt, Shader=ColourSwatch(SwatchColor=RGB(0, 0, 0)))
preview_5 = CustomPreview(Geometry=[psychchart.comfortPolygons, wires_3], Shader=ColourSwatch(SwatchColor=RGB(85, 255, 0)))
preview_6 = CustomPreview(Geometry=psychchart.chartHourPoints, Shader=ColourSwatch(SwatchColor=RGB(255, 0, 0)))
and_3 = GateAnd(A=and, B=and_2)
preview_7 = CustomPreview(Geometry=[psychchart.psychChartMesh, psychchart.legend], Shader=ColourSwatch(SwatchColor=RGB(0, 0, 0)))
pt_2 = Point(psychchart.chartHourPoints)
int_3 = Integer(and_3)
circle = CircleCNR(Center=psychchart.chartHourPoints, Normal=Vector(0, 0, 1), Radius=Slider(0.004, range=0..1))
pt_3 = Point(<point referenced from the Rhino model>)
ma = MassAddition(Input=int_3)  # -> Result, PartialResults
_3dchart = Ladybug_3DChart(
    inputData=flatten([importepw.dryBulbTemperature, importepw.relativeHumidity, importepw.directNormalRadiation, importepw.diffuseHorizontalRadiation, psychchart.totalComfortOrNot, importepw.windSpeed]),
    basePoint=pt_3,
    xScale="0.015",
    yScale="0.1",
    zScale="0",
    legendPar=legendpar,
    condStatement="30<a<35 and 41<b<76 and f<1")  # -> readMe, graphMesh, graphCurves, legend, legendBasePts, title, titleBasePts, dataPts, conditionalHOY; disabled; plug-in component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
panel_6 = Panel(ma.Result)
analysisperiod_2 = Ladybug_AnalysisPeriod()  # -> readMe, analysisPeriod; plug-in component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
sunpath = Ladybug_SunPath(
    north=number_slider_2,
    location=importepw.location,
    hour=12,
    day=21,
    month=12,
    timeStep=1,
    analysisPeriod=analysisperiod_2.analysisPeriod,
    sunPathScale="0.025",
    annualHourlyData=flatten(importepw.directNormalRadiation),
    conditionalStatement="a>500",
    dailyOrAnnualSunPath=True)  # -> readMe, sunVectors, sunAltitudes, sunAzimuths, port, sunSpheresMesh, sunPathCrvs, legend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; disabled; plug-in component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
pt_4 = Point(<point referenced from the Rhino model>)
_3dchart_2 = Ladybug_3DChart(
    inputData=flatten([importepw.dryBulbTemperature, importepw.relativeHumidity, importepw.directNormalRadiation, importepw.diffuseHorizontalRadiation, psychchart.totalComfortOrNot, importepw.windSpeed]),
    basePoint=pt_4,
    xScale="0.015",
    yScale="0.1",
    zScale="0",
    legendPar=legendpar,
    condStatement="f>0")  # -> readMe, graphMesh, graphCurves, legend, legendBasePts, title, titleBasePts, dataPts, conditionalHOY; disabled; plug-in component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

# ----
separatedata_4 = Ladybug_SeparateData(inputList=flatten(importepw.directNormalRadiation))  # -> numbers, strings; plug-in component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
separatedata_5 = Ladybug_SeparateData(inputList=flatten(importepw.dryBulbTemperature))  # -> numbers, strings; plug-in component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
larger_3 = LargerThan(FirstNumber=separatedata_5.numbers, SecondNumber="34")  # -> LargerThan, OrEqualTo
larger_4 = LargerThan(FirstNumber=separatedata_4.numbers, SecondNumber="500")  # -> LargerThan, OrEqualTo
or = GateOr(A=larger_4.LargerThan, B=larger_3.LargerThan)
int_4 = Integer(or)
csvschedule = Honeybee_CreateCSVSchedule(values=int_4, scheduleName="BlinsSched", writeFile=Toggle(True))  # -> readMe, csvSchedule; plug-in component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

panel_7 = Panel(int_4)
windrose = Ladybug_WindRose(
    north=number_slider_2,
    hourlyWindDirection=importepw.windDirection,
    hourlyWindSpeed=importepw.windSpeed,
    runIt=Toggle(False))  # -> readMe, calmRoseMesh, windRoseMesh, windRoseCrvs, windRoseCenPts, legend, legendBasePts, title; plug-in component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
epwindowshades = Honeybee_EnergyPlusWindowShadeGenerator(
    HBObjects=glazingcreator_3.HBObjWGLZ,
    blindsSchedule=csvschedule.csvSchedule,
    north=number_slider_2,
    depth=Slider(0.1, range=0..1),
    numOfShds=Slider(8, range=0..10),
    distToGlass=Slider(0, range=0..100),
    runIt=Toggle(True))  # -> readMe, port, HBObjWShades, port_2, windowBreps, shadeBreps, port_3, zoneData1Tree, zoneData2Tree, zoneData3Tree; plug-in component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
gencumsky = Honeybee_GenerateCumulativeSky(weatherFile=open_epw_stat_2.epwFile, analysisPeriod=analysisperiod.analysisPeriod, generateSky=Toggle(True))  # -> skyFilePath; plug-in component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

# ---- group: Radiation map
brep_4 = Brep([flip_8.Surface, flip_7.Surface, flip_6.Surface, flip_4.Surface, flip_3.Surface])
wires_4 = BrepWireframe(Brep=brep_4, Density=-1)
brep_5 = Brep([flip_2.Surface, outside_floor, flip.Surface])
createhbsrfs_12 = Honeybee_createHBSrfs(geometry=brep_4)  # -> readMe, simplify(HBSurface); plug-in component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
createhbsrfs_13 = Honeybee_createHBSrfs(geometry=brep_5)  # -> readMe, simplify(HBSurface); plug-in component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
preview_8 = CustomPreview(Geometry=wires_4, Shader=ColourSwatch(SwatchColor=RGBA(61, 44, 44, 64)))
gentestpts = Honeybee_GenerateTestPoints(
    testSurface=createhbsrfs_13.HBSurface,
    gridSize=Slider(0.2, range=0..1),
    distBaseSrf=Slider(0, range=0..100),
    moveTestMesh=Toggle(False))  # -> readMe, simplify(testPoints), simplify(ptsVectors), simplify(facesArea), simplify(mesh); plug-in component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
gentestpts_2 = Honeybee_GenerateTestPoints(
    testSurface=createhbsrfs_12.HBSurface,
    gridSize=Slider(0.2, range=0..1),
    distBaseSrf=Slider(0, range=0..100),
    moveTestMesh=Toggle(False))  # -> readMe, simplify(testPoints), simplify(ptsVectors), simplify(facesArea), simplify(mesh); plug-in component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
radparameters = Honeybee_RADParameters(quality=0)  # -> readMe, radParameters; plug-in component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
radparameters_2 = Honeybee_RADParameters(quality=0)  # -> readMe, radParameters; plug-in component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
gridbasedsimulation = Honeybee_GridBasedSimulation(
    skyFile=gencumsky,
    testPoints=gentestpts.testPoints,
    ptsVectors=gentestpts.ptsVectors,
    testMesh=gentestpts.mesh,
    simulationType="1",
    radParameters=radparameters.radParameters)  # -> analysisRecipe; plug-in component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
gridbasedsimulation_2 = Honeybee_GridBasedSimulation(
    skyFile=gencumsky,
    testPoints=gentestpts_2.testPoints,
    ptsVectors=gentestpts_2.ptsVectors,
    testMesh=gentestpts_2.mesh,
    simulationType="1",
    radParameters=radparameters_2.radParameters)  # -> analysisRecipe; plug-in component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
toggle_5 = BooleanToggle(True)
toggle_6 = BooleanToggle(True)
mjoin = MeshJoin(Meshes=gentestpts.mesh)
mjoin_2 = MeshJoin(Meshes=gentestpts_2.mesh)
rundaylightanalysis = Honeybee_RunDaylightSimulation(
    HBObjects=flatten(createhbsrfs_13.HBSurface),
    analysisRecipe=gridbasedsimulation,
    writeRad=toggle_5,
    runRad=toggle_5,
    numOfCPUs=Slider(3, range=0..10),
    overwriteResults=True)  # -> readMe, analysisType, resultsUnit, cumulative_radiation_values, testPts, cumulative_radiation_files, radGeoFile, studyFolder, done; disabled; plug-in component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
rundaylightanalysis_2 = Honeybee_RunDaylightSimulation(
    HBObjects=flatten(createhbsrfs_12.HBSurface),
    analysisRecipe=gridbasedsimulation_2,
    writeRad=toggle_6,
    runRad=toggle_6,
    numOfCPUs=Slider(3, range=0..10),
    overwriteResults=True)  # -> readMe, analysisType, resultsUnit, cumulative_radiation_values, testPts, cumulative_radiation_files, radGeoFile, studyFolder, done; disabled; plug-in component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
panel_8 = Panel(rundaylightanalysis_2.resultsUnit)
gradientlibrary_2 = Ladybug_GradientLibrary(gradIndex=Slider(1, range=0..10))  # -> customColors; plug-in component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
legendpar_2 = Ladybug_LegendParameters(lowBound=Slider(400, range=0..10000), highBound=Slider(800, range=0..10000), customColors=flatten(gradientlibrary_2))  # -> legendPar; plug-in component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
recolormesh = Ladybug_RecolorMesh(
    analysisResult=rundaylightanalysis_2.cumulative_radiation_values,
    inputMesh=mjoin_2,
    legendPar=legendpar_2,
    analysisTitle=rundaylightanalysis_2.analysisType,
    legendTitle=rundaylightanalysis_2.resultsUnit)  # -> readMe, newMesh, newLegend, legendBasePt, meshColors, legendColors; plug-in component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
recolormesh_2 = Ladybug_RecolorMesh(
    analysisResult=rundaylightanalysis.cumulative_radiation_values,
    inputMesh=mjoin,
    legendPar=legendpar_2,
    legendTitle=rundaylightanalysis.resultsUnit)  # -> readMe, newMesh, newLegend, legendBasePt, meshColors, legendColors; plug-in component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
mesh = Mesh(recolormesh.newMesh)
geo = Geometry(recolormesh.newLegend)
bang = ExplodeTree(Data=geo)  # -> Branch0, Branch1
mesh_2 = Mesh(recolormesh_2.newMesh)
pt_5 = Point(<point referenced from the Rhino model>)
geo_2 = Geometry(bang.Branch0)
move = Move(Geometry=geo_2, Motion=pt_5)  # -> Geometry, Transform
panel_9 = Panel(bang.Branch0)

# ----
createhbsrfs_14 = Honeybee_createHBSrfs(geometry=epwindowshades.shadeBreps, srfType=Slider(6, range=0..10))  # -> readMe, simplify(HBSurface); plug-in component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
hb_epcontextsrf = HoneybeeEPContextSurfaces(shdSurfaces=flatten(createhbsrfs_11.HBSurface))  # -> HBContext; inputs shdSurfaces: list of Brep, justBoundingBox: Boolean
# ---------- hb_epcontextsrf: Python ----------
"""
prepare shading/context geometries

    Args:
        northVectorOrRotation: A vector that shows North or a number that shows
                               the rotation of the North from the Y axis
        bldgMasses: List of closed Breps as thermal zones.
    Returns:
        report: ...
        thermalZones: Thermal zone's geometries for visualiza
"""

ghenv.Component.Name = 'Honeybee EP context Surfaces'
ghenv.Component.NickName = 'HB_EPContextSrf'
ghenv.Component.Message = 'VER 0.0.58\nNOV_20_2015'
ghenv.Component.Category = "Honeybee"
ghenv.Component.SubCategory = "09 | Energy | Energy"
#compatibleHBVersion = VER 0.0.57\nNOV_01_2015
#compatibleLBVersion = VER 0.0.59\nFEB_01_2015
ghenv.Component.AdditionalHelpFromDocStrings = "2"

import rhinoscriptsyntax as rs
import Rhino as rc
import scriptcontext as sc
import os
import System
import Grasshopper.Kernel as gh
import uuid

tolerance = sc.doc.ModelAbsoluteTolerance
import math


def main(shdSurfaces, EPTransSchedule, meshingSettings, justBoundingBox):
    
    # import the classes
    if sc.sticky.has_key('honeybee_release'):

        try:
            if not sc.sticky['honeybee_release'].isCompatible(ghenv.Component): return -1
        except:
            warning = "You need a newer version of Honeybee to use this compoent." + \
            " Use updateHoneybee component to update userObjects.\n" + \
            "If you have already updated userObjects drag Honeybee_Honeybee component " + \
            "into canvas and try again."
            w = gh.GH_RuntimeMessageLevel.Warning
            ghenv.Component.AddRuntimeMessage(w, warning)
            return -1
        
        # don't customize this part
        hb_EPSrf = sc.sticky["honeybee_EPSurface"]
        hb_EPSHDSurface = sc.sticky["honeybee_EPShdSurface"]
        hb_RADMaterialAUX = sc.sticky["honeybee_RADMaterialAUX"]
        hb_EPObjectsAux = sc.sticky["honeybee_EPObjectsAUX"]()
        HBScheduleList = sc.sticky["honeybee_ScheduleLib"].keys()

        ########################################################################
        #----------------------------------------------------------------------#
        shdBreps = []
        # create bounding box of shading geometries
        if justBoundingBox:
            for brep in shdSurfaces:
                if brep.Faces.Count>1 or not brep.Faces[0].IsPlanar(sc.doc.ModelAbsoluteTolerance):
                    shdBreps.append(brep.GetBoundingBox(True).ToBrep())
                else:
                    shdBreps.append(brep)
        else:
            shdBreps = shdSurfaces
        
        shadingClasses = []
        shadingMeshPreview = []
        
        if meshingSettings == None:
            mp = rc.Geometry.MeshingParameters.Minimal
            mp.SimplePlanes = True
        else:
            mp = meshingSettings
        
        def getRadMaterialName(radMaterial):
            nameStr = radMaterial.split(" ")[2]
            name =  nameStr.split("\n")[0]
            return name
        
        for brepCount, brep in enumerate(shdBreps):
            if brep != None:
                isPlanar = True
                # check planarity
                for face in brep.Faces:
                    if not face.IsPlanar(tolerance):
                        isPlanar = False
                        break
                
                shadingBreps = []
                if not isPlanar:
                    meshArray = rc.Geometry.Mesh.CreateFromBrep(brep, mp)
                    for mesh in meshArray:
                        for meshFace in range(mesh.Faces.Count):
                            vertices = list(mesh.Faces.GetFaceVertices(meshFace))[1:]
                            vertices = vertices + [sc.doc.ModelAbsoluteTolerance]
                            # create the brep from mesh
                            shdBrep = rc.Geometry.Brep.CreateFromCornerPoints(*vertices)
                            shadingBreps.append(shdBrep)
                else:
                    for face in brep.Faces:
                        shadingBreps.append(face.DuplicateFace(False))
                
                for faceCount, shdBrep in enumerate(shadingBreps):
                        thisShading = hb_EPSHDSurface(shdBrep, 1000*brepCount + faceCount, 'shdSrf_' + `brepCount` + '_' + `faceCount` + "_" + str(uuid.uuid4()))
                        
                        # add transmittance schedule if any
                        if EPTransSchedule!=None:
                            schedule= EPTransSchedule.upper()
                            if schedule!=None and not schedule.lower().endswith(".csv") and schedule not in HBScheduleList:
                                msg = "Cannot find " + schedule + " in Honeybee schedule library."
                                print msg
                                ghenv.Component.AddRuntimeMessage(gh.GH_RuntimeMessageLevel.Warning, msg)
                                return -1
                            elif schedule!=None and schedule.lower().endswith(".csv"):
                                # check if csv file is existed
                                if not os.path.isfile(schedule):
                                    msg = "Cannot find the shchedule file: " + schedule
                                    print msg
                                    ghenv.Component.AddRuntimeMessage(gh.GH_RuntimeMessageLevel.Warning, msg)
                                    return -1
                            
                            thisShading.TransmittanceSCH = schedule
                        
                        # add the Rad Material if any
                        if RADMaterial!=None:
                            # if it is just the name of the material make sure it is already defined
                            if len(RADMaterial.split(" ")) == 1:
                                # if the material is not in the library add it to the library
                                if not hb_RADMaterialAUX.isMatrialExistInLibrary(RADMaterial):
                                    warningMsg = "Can't find " + RADMaterial + " in RAD Material Library.\n" + \
                                                "Add the material to the library and try again."
                                    ghenv.Component.AddRuntimeMessage(gh.GH_RuntimeMessageLevel.Warning, warningMsg)
                                    return
                                
                                try:
                                    thisShading.setRADMaterial(RADMaterial)
                                except Exception, e:
                                    print e
                                    warningMsg = "You are using an old version of Honeybee_Honeybee! Update your files and try again."
                                    print warningMsg
                                    ghenv.Component.AddRuntimeMessage(gh.GH_RuntimeMessageLevel.Warning, warningMsg)
                                    return
                                
                                addedToLib = True
                            else:
                                
                                # try to add the material to the library
                                addedToLib, thisShading.RadMaterial = hb_RADMaterialAUX.analyseRadMaterials(RADMaterial, True)
                                
                            if addedToLib==False:
                                warningMsg = "Failed to add " + RADMaterial + " to the Library."
                                ghenv.Component.AddRuntimeMessage(gh.GH_RuntimeMessageLevel.Warning, warningMsg)
                                return
                        
                        # add shading to the list
                        shadingClasses.append(thisShading)
                
        # add to the hive
        hb_hive = sc.sticky["honeybee_Hive"]()
        HBContext  = hb_hive.addToHoneybeeHive(shadingClasses, ghenv.Component.InstanceGuid.ToString())
        return HBContext
        ################################################################################################
    else:
        print "You should first let Honeybee to fly..."
        w = gh.GH_RuntimeMessageLevel.Warning
        ghenv.Component.AddRuntimeMessage(w, "You should first let Honeybee to fly...")
        return -1
        

if _shdSurfaces and _shdSurfaces[0]!=None:
    # add cleaning function
    result= main(_shdSurfaces, EPTransSchedule_, meshingSettings_, justBoundingBox_)
    
    if result != -1: HBContext = result
# ---------- end hb_epcontextsrf ----------
wires_5 = BrepWireframe(Brep=createhbsrfs_11.HBSurface, Density=ColourSwatch(SwatchColor=RGB(0, 0, 0)))
preview_9 = CustomPreview(Geometry=createhbsrfs_14.HBSurface, Shader=ColourSwatch(SwatchColor=RGB(255, 205, 3)))
preview_10 = CustomPreview(Geometry=northarrow, Shader=ColourSwatch(SwatchColor=RGB(0, 0, 0)))
flip_9 = Flip(Surface=createhbsrfs_5.HBSurface)  # -> Surface, Result
panel_10 = Panel("DLAIllumThresholds")
panel_11 = Panel("UDLI_Less_100")

# ---- group: Daylighting
# Generate lighting Schedule
panel_12 = Panel(".5")
panel_13 = Panel(".762")
genhbzonetestpts = Honeybee_GenerateZoneTestPoints(HBZone=createhbzones.HBZone, gridSize=panel_12, distBaseSrf=panel_13, moveTestMesh=True)  # -> readMe, simplify(testPoints), simplify(ptsVectors), simplify(facesArea), simplify(mesh); plug-in component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
radparameters_3 = Honeybee_RADParameters(quality=0)  # -> readMe, radParameters; plug-in component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
toggle_7 = BooleanToggle(True)
item_2 = ListItem(List=genhbzonetestpts.testPoints, Index="60", Wrap=True)
annualdaylightsimulation = Honeybee_AnnualDaylightSimulation(
    north=number_slider_2,
    epwWeatherFile=open_epw_stat_2.epwFile,
    testPoints=genhbzonetestpts.testPoints,
    ptsVectors=genhbzonetestpts.ptsVectors,
    testMesh=genhbzonetestpts.mesh,
    radParameters=radparameters_3.radParameters)  # -> analysisRecipe; plug-in component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
sph = Sphere(Base=item_2, Radius=Slider(0.1, range=0..0.1))
lightingcontrol = Honeybee_LightingControlRecipe(
    controlType="4",
    sensorPoints=item_2,
    lightingPower=250,
    lightingSetpoint=300,
    ballastLossFactor=20,
    standbyPower=3,
    delayTime=5)  # -> lightingControlGroup; plug-in component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
gethbzoneepschedules = Honeybee_GetZoneEnergyPlusSchedules(HBZone=createhbzones.HBZone)  # -> occupancySchedule, occupancyActivitySch, heatingSetPtSchedule, coolingSetPtSchedule, lightingSchedule, equipmentSchedule, infiltrationSchedule; plug-in component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
rundaylightanalysis_3 = Honeybee_RunDaylightSimulation(
    HBObjects=flatten([createhbsrfs_9.HBSurface, createhbzones.HBZone, createhbsrfs_10.HBSurface]),
    analysisRecipe=annualdaylightsimulation,
    writeRad=toggle_7,
    runRad=toggle_7,
    numOfCPUs=Slider(3, range=0..10),
    overwriteResults=True)  # -> readMe, analysisType, resultsUnit, results, testPts, annual_analysis_files, radGeoFile, studyFolder, done; plug-in component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
readannualresultsi = Honeybee_ReadAnnualResultI(
    illFilesAddress=rundaylightanalysis_3.annual_analysis_files,
    testPoints=simplify(rundaylightanalysis_3.testPts),
    ptsVectors=genhbzonetestpts.ptsVectors,
    occupancyFiles=gethbzoneepschedules.lightingSchedule,
    DLAIllumThresholds="100",
    lightingControlGroups=lightingcontrol,
    runIt=Toggle(True))  # -> DLA, UDLI_Less_100, UDLI_100_2000, UDLI_More_2000, CDA, sDA, annualProfiles, htmReport; plug-in component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
gradientlibrary_3 = Ladybug_GradientLibrary(gradIndex=Slider(1, range=0..1))  # -> customColors; plug-in component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
legendpar_3 = Ladybug_LegendParameters(
    lowBound=Slider(0, range=0..100),
    highBound=Slider(100, range=0..100),
    numSegments=Slider(10, range=0..10),
    customColors=flatten(gradientlibrary_3))  # -> legendPar; plug-in component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
panel_14 = Panel(readannualresultsi.sDA)
panel_15 = Panel("UDLI_100_2000")
recolormesh_3 = Ladybug_RecolorMesh(
    analysisResult=readannualresultsi.UDLI_More_2000,
    inputMesh=genhbzonetestpts.mesh,
    legendPar=legendpar_3,
    analysisTitle="UDLI_more_2000",
    legendTitle="%")  # -> readMe, newMesh, newLegend, legendBasePt, meshColors, legendColors; plug-in component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

# ----
gentestpts_3 = Honeybee_GenerateTestPoints(testSurface=flip_9.Surface, gridSize=panel_12, distBaseSrf=panel_13, moveTestMesh=True)  # -> readMe, simplify(testPoints), simplify(ptsVectors), simplify(facesArea), simplify(mesh); plug-in component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
setepzoneschedules = Honeybee_SetEnergyPlusZoneSchedules(HBZones=createhbzones.HBZone, lightingSchedules=readannualresultsi.annualProfiles)  # -> schedules, simplify(HBZones); plug-in component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

setepnatvent = Honeybee_SetEPAirFlow(
    HBZones=setepzoneschedules.HBZones,
    naturalVentilationType="1",
    minIndoorTempForNatVent="24",
    maxOutdoorTempForNatVent="40")  # -> readMe, simplify(HBZones); plug-in component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
zoneattributelist = Honeybee_ZoneAttributeList({"Name": "name", "Zone Program": "zoneProgram", "Zone Floor Area": "zoneFloorArea", "Zone Volume": "zoneVolume", "Building Program": "bldgProgram", "Is Conditioned": "isConditioned", "Occupancy Schedule": "occupancySchedule", "Occupancy Activity Schedule": "occupancyActivitySch", "Heating SetPoint Schedule": "heatingSetPtSchedule", "Cooling SetPoint Schedule": "coolingSetPtSchedule"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}, selected="Natural Ventilation": "natVent")
labelzones = Honeybee_LabelZones(HBZones=flatten(setepnatvent.HBZones), attribute=zoneattributelist)  # -> zoneTxtLabels, labelBasePts, brepTxtLabels, zoneWireFrames; plug-in component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

# ---- group: Daylighting / just for visualization
# Compare Schedules!
convertepschvalues = Honeybee_ConvertEnergyPlusScheduleToValues(schName=gethbzoneepschedules.lightingSchedule)  # -> values; plug-in component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
dsannualprofiles = Honeybee_DaysimAnnualProfiles(annualProfiles=readannualresultsi.annualProfiles)  # -> simplify(occupancyProfile), simplify(shadingProfiles), simplify(lightingControlProfiles), simplify(dgpProfile); plug-in component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
_3dchart_3 = Ladybug_3DChart(inputData=flatten([convertepschvalues, dsannualprofiles.lightingControlProfiles]), xScale=Slider(0.15, range=0..1))  # -> readMe, graphMesh, graphCurves, legend, legendBasePts, title, titleBasePts, dataPts, conditionalHOY; plug-in component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

# ----
number_slider_3 = Slider(0, range=0..100)
domain = Domain(Slider(1, range=0..1))
setepnatvent_2 = Honeybee_SetEPAirFlow(
    HBZones=setepnatvent.HBZones,
    naturalVentilationType="2",
    minIndoorTempForNatVent="24",
    maxOutdoorTempForNatVent="40",
    operableEffectiveArea="1",
    inletOutletHeight=Slider(20, range=0..100),
    windDischargeCoeff=number_slider_3,
    windowAngle2North=number_slider_3)  # -> readMe, simplify(HBZones); plug-in component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
callfromepconstrlibrary = Honeybee_CallFromEPConstructionLibrary(keywords="wood")  # -> ThermMaterials, EPMaterials, EPWindowMaterials, EPConstructions; plug-in component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
panel_16 = Panel(callfromepconstrlibrary.EPConstructions)
item_3 = ListItem(List=callfromepconstrlibrary.EPConstructions, Index=0, Wrap=True)
setepzonecnstr = Honeybee_SetEPZoneConstruction(HBZone=setepnatvent_2.HBZones, wallEPConstruction=panel_16, roofEPConstruction=panel_16)  # -> simplify(modifiedHBZone); plug-in component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
panel_17 = Panel(item_3)
toggle_8 = BooleanToggle(True)
epoutput = Honeybee_GenerateEPOutput(
    zoneEnergyUse=toggle_8,
    zoneGainsAndLosses="False",
    zoneComfortMetrics=toggle_8,
    surfaceTempAnalysis="False",
    timestep="hourly")  # -> report, flatten(simulationOutputs); plug-in component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
toggle_9 = BooleanToggle(True)
# Run the analysis
runenergysimulation = Honeybee_RunEnergySimulation(
    north=number_slider_2,
    epwFile=open_epw_stat_2.epwFile,
    HBZones=flatten(setepzonecnstr),
    simulationOutputs=flatten(epoutput.simulationOutputs),
    writeIdf=toggle_9,
    runEnergyPlus=toggle_9)  # -> report, idfFileAddress, resultFileAddress; plug-in component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
panel_18 = Panel("""Material:RoofVegetation,
GreenRoof,                        !- Name
    0.2,                     !- Height of Plants {m}
    1,                       !- Leaf Area Index {dimensionless}
    0.22,                    !- Leaf Reflectivity {dimensionless}
    0.95,                    !- Leaf Emissivity
    180,                     !- Minimum Stomatal Resistance {s/m}
    Green Roof Soil,         !- Soil Layer Name
    MediumRough,             !- Roughness
    0.1,                     !- Thickness {m}
    0.35,                    !- Conductivity of Dry Soil {W/m-K}
    1100,                    !- Density of Dry Soil {kg/m3}
    1200,                    !- Specific Heat of Dry Soil {J/kg-K}
    0.9,                     !- Thermal Absorptance
    0.7,                     !- Solar Absorptance
    0.75,                    !- Visible Absorptance
    0.3,                     !- Saturation Volumetric Moisture Content of the Soil Layer
    0.01,                    !- Residual Volumetric Moisture Content of the Soil Layer
    0.1,                     !- Initial Volumetric Moisture Content of the Soil Layer
    Advanced;                !- Moisture Diffusion Calculation Method""")
adaptcomfrecipe = Honeybee_AdaptiveComfortAnalysisRecipe()  # -> comfRecipe; plug-in component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
readepresult = Honeybee_ReadEPResult(resultFileAddress=runenergysimulation.resultFileAddress)  # -> port, port_2, port_3, port_4, electricLight, electricEquip, fanElectric, port_5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; plug-in component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
callfromepconstrlibrary_2 = Honeybee_CallFromEPConstructionLibrary(keywords="wood")  # -> EPMaterials, EPWindowMaterils, EPConstructions; plug-in component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
separatedata_6 = Ladybug_SeparateData(inputList=flatten(readepresult.electricLight))  # -> numbers, strings; plug-in component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
item_4 = ListItem(List=callfromepconstrlibrary_2.EPMaterials, Index=0, Wrap=True)
ma_2 = MassAddition(Input=separatedata_6.numbers)  # -> Result, PartialResults
epconstruction = Honeybee_EnergyPlusConstruction(name="Roof", layer_1=panel_18, layer_2=item_4)  # -> EPConstruction; plug-in component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
total_lighting = Panel(ma_2.Result)
pt_6 = Point(<point referenced from the Rhino model>)
pmvcomfortpar_2 = Ladybug_PMVComfortParameters(humidRatioUpBound="0.03")  # -> comfortPar; plug-in component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
epconstruction_2 = Honeybee_EnergyPlusConstruction(name="wall", layer_1=callfromepconstrlibrary_2.EPMaterials)  # -> EPConstruction; plug-in component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
panel_19 = Panel("""0.5
0.8
1""")
gradientlibrary_4 = Ladybug_GradientLibrary(gradIndex=Slider(7, range=0..10))  # -> reverse(customColors); plug-in component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
number_slider_4 = Slider(20.9, range=0..100)
number_slider_5 = Slider(35.8, range=0..100)
psychchart_2 = Ladybug_PsychrometricChart(
    dryBulbTemperature=readepresult.airTemperature,
    relativeHumidity=readepresult.relativeHumidity,
    clothingLevel=panel_19,
    mergeComfPolygons=Toggle(True),
    comfortPar=pmvcomfortpar_2,
    basePoint=pt_6,
    scale=Slider(0.5, range=0..1),
    legendPar=legendpar,
    runIt=Toggle(True))  # -> readMe, port, totalComfortPercent, totalComfortOrNot, strategyNames, strategyPercentOfTime, strategyOrNot, port_2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; plug-in component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
legendpar_4 = Ladybug_LegendParameters(customColors=flatten(gradientlibrary_4))  # -> legendPar; plug-in component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
preview_11 = CustomPreview(Geometry=psychchart_2.chartHourPoints, Shader=ColourSwatch(SwatchColor=RGB(255, 0, 0)))
preview_12 = CustomPreview(
    Geometry=[psychchart_2.psychChartMesh, psychchart_2.legend],
    Shader={ambient=RGB(0, 0, 0), diffuse=RGB(255, 105, 180), emission=RGB(76, 32, 54), shine=0.5, specular=RGB(255, 255, 255), transparency=0})
preview_13 = CustomPreview(Geometry=psychchart_2.chartCurvesAndTxt, Shader=ColourSwatch(SwatchColor=RGB(0, 0, 0)))
preview_14 = CustomPreview(Geometry=psychchart_2.comfortPolygons, Shader=ColourSwatch(SwatchColor=RGB(85, 255, 0)))
pt_7 = Point(<point referenced from the Rhino model>)
_3dchart_4 = Ladybug_3DChart(
    inputData=flatten([psychchart_2.totalComfortOrNot, readepresult.airTemperature, readepresult.relativeHumidity]),
    basePoint=pt_7,
    xScale="0.015",
    yScale="0.1",
    zScale="0",
    legendPar=legendpar_4,
    condStatement="c<1")  # -> readMe, graphMesh, graphCurves, legend, legendBasePts, title, titleBasePts, dataPts, conditionalHOY; plug-in component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
