# Grasshopper definition Rong_Shengliang_Integrated_Daylight_and_Energy_similation_Final.gh (Grasshopper 0.9.76)
# plug-ins: Python Interpreter

toggle = BooleanToggle(False)
honeybee = Honeybee_Honeybee(defaultFolder="c:\honeybee")  # -> Vviiiiiiiiiizzz; plug-in component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
ladybug = Ladybug_Ladybug(defaultFolder="c:\ladybug")  # -> Vviiiiiiiiiizzz; plug-in component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
updateladybug = Ladybug_UpdateLadybug(updateThisFile=toggle, updateAllUObjects=toggle)  # -> readMe; plug-in component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
updatehoneybee = Honeybee_UpdateHoneybee(updateThisFile=toggle, updateAllUObjects=toggle)  # -> readMe; plug-in component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
callfromepconstrlibrary = Honeybee_CallFromEPConstructionLibrary()  # -> ThermMaterials, EPMaterials, EPWindowMaterials, EPConstructions; plug-in component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
exterior_wall = Brep(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)

# ---- group: ceiling
ceiling = Brep([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])

# ---- group: floor
floor = Brep(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)

# ----
walls = Brep([<brep referenced from the Rhino model> x3])
ledge = Brep(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)
wall_surface_with_opening = Brep(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)
inbetween_wall = Brep([<brep referenced from the Rhino model> x3])
flip = Flip(Surface=floor)  # -> Surface, Result

number_slider = Slider(45, range=0..100)
panel = Panel("http://apps1.eere.energy.gov/buildings/energyplus/weatherdata/4_north_and_central_america_wmo_region_4/1_usa/USA_PA_Philadelphia.Intl.AP.724080_TMY3.zip")
northarrow = Ladybug_North(north=number_slider, scale=".05")  # -> northSign; plug-in component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
open_epw_stat = Ladybug_OpenEPWAndSTATWeatherFiles(weatherFileURL=panel)  # -> epwFile, statFile; plug-in component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

searchepconstruction = Honeybee_SearchEPConstruction(EPConstrList=callfromepconstrlibrary.EPConstructions, standard="2", climateZone="4", surfaceType=Slider(0, range=0..100))  # -> EPSelectedConstr; plug-in component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
flip_2 = Flip(Surface=wall_surface_with_opening)  # -> Surface, Result
glass = Brep(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)
createhbsrfs = Honeybee_createHBSrfs(geometry=flip_2.Surface, srfType="0")  # -> readMe, simplify(HBSurface); plug-in component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
createhbsrfs_2 = Honeybee_createHBSrfs(geometry=flatten(exterior_wall), srfType="0")  # -> readMe, simplify(HBSurface); plug-in component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
createhbsrfs_3 = Honeybee_createHBSrfs(geometry=flatten(ledge), srfType="2")  # -> readMe, simplify(HBSurface); plug-in component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
createhbsrfs_4 = Honeybee_createHBSrfs(geometry=ceiling, srfType="3")  # -> readMe, simplify(HBSurface); plug-in component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
# Honeybee default materials will be assigned
# based on surface type
createhbsrfs_5 = Honeybee_createHBSrfs(geometry=walls, srfType="0")  # -> readMe, simplify(HBSurface); plug-in component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
createhbsrfs_6 = Honeybee_createHBSrfs(geometry=flatten(flip.Surface), srfType="2")  # -> readMe, simplify(HBSurface); plug-in component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
createhbsrfs_7 = Honeybee_createHBSrfs(geometry=inbetween_wall, srfType="0")  # -> readMe, simplify(HBSurface); plug-in component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
glazingcreator = Honeybee_GlazingBasedOnRatio(
    HBObjects=createhbsrfs.HBSurface,
    glzRatio=Slider(0.5, range=0..1),
    breakUpDist=Slider(4, range=0..10),
    runIt=Toggle(True))  # -> readMe, HBObjWGLZ; plug-in component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

# ---- group: Shading Design
epwindowshades = Honeybee_EnergyPlusWindowShadeGenerator(
    HBObjects=glazingcreator.HBObjWGLZ,
    depth=Slider(0.2, range=0..1),
    distBetween=Slider(0.1, range=0..1),
    shdAngle=Slider(5, range=0..100),
    interiorOrExter=Toggle(True),
    distToGlass=Slider(0, range=0..1),
    runIt=Toggle(True))  # -> readMe, port, HBObjWShades, port_2, windowBreps, shadeBreps, port_3, zoneData1Tree, zoneData2Tree, zoneData3Tree; plug-in component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
createhbsrfs_8 = Honeybee_createHBSrfs(geometry=epwindowshades.shadeBreps, srfType="6")  # -> readMe, simplify(HBSurface); plug-in component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
hb_epcontextsrf = HoneybeeEPContextSurfaces(shdSurfaces=flatten(createhbsrfs_8.HBSurface))  # -> HBContext; inputs shdSurfaces: list of GeometryBase, justBoundingBox: Boolean
# ---------- hb_epcontextsrf: Python ----------
"""
prepare shading/context geometries

    Args:
        northVectorOrRotation: A vector that shows North or a number that shows
                               the rotation of the North from the Y axis
        bldgMasses: List of closed Breps as thermal zones.
    Returns:
        report: ...
        thermalZones: Thermal zone's geometries for visualiza
"""

ghenv.Component.Name = 'Honeybee EP context Surfaces'
ghenv.Component.NickName = 'HB_EPContextSrf'
ghenv.Component.Message = 'VER 0.0.58\nNOV_20_2015'
ghenv.Component.Category = "Honeybee"
ghenv.Component.SubCategory = "09 | Energy | Energy"
#compatibleHBVersion = VER 0.0.57\nNOV_01_2015
#compatibleLBVersion = VER 0.0.59\nFEB_01_2015
ghenv.Component.AdditionalHelpFromDocStrings = "2"

import rhinoscriptsyntax as rs
import Rhino as rc
import scriptcontext as sc
import os
import System
import Grasshopper.Kernel as gh
import uuid

tolerance = sc.doc.ModelAbsoluteTolerance
import math


def main(shdSurfaces, EPTransSchedule, meshingSettings, justBoundingBox):
    
    # import the classes
    if sc.sticky.has_key('honeybee_release'):

        try:
            if not sc.sticky['honeybee_release'].isCompatible(ghenv.Component): return -1
        except:
            warning = "You need a newer version of Honeybee to use this compoent." + \
            " Use updateHoneybee component to update userObjects.\n" + \
            "If you have already updated userObjects drag Honeybee_Honeybee component " + \
            "into canvas and try again."
            w = gh.GH_RuntimeMessageLevel.Warning
            ghenv.Component.AddRuntimeMessage(w, warning)
            return -1
        
        # don't customize this part
        hb_EPSrf = sc.sticky["honeybee_EPSurface"]
        hb_EPSHDSurface = sc.sticky["honeybee_EPShdSurface"]
        hb_RADMaterialAUX = sc.sticky["honeybee_RADMaterialAUX"]
        hb_EPObjectsAux = sc.sticky["honeybee_EPObjectsAUX"]()
        HBScheduleList = sc.sticky["honeybee_ScheduleLib"].keys()

        ########################################################################
        #----------------------------------------------------------------------#
        shdBreps = []
        # create bounding box of shading geometries
        if justBoundingBox:
            for brep in shdSurfaces:
                if brep.Faces.Count>1 or not brep.Faces[0].IsPlanar(sc.doc.ModelAbsoluteTolerance):
                    shdBreps.append(brep.GetBoundingBox(True).ToBrep())
                else:
                    shdBreps.append(brep)
        else:
            shdBreps = shdSurfaces
        
        shadingClasses = []
        shadingMeshPreview = []
        
        if meshingSettings == None:
            mp = rc.Geometry.MeshingParameters.Minimal
            mp.SimplePlanes = True
        else:
            mp = meshingSettings
        
        def getRadMaterialName(radMaterial):
            nameStr = radMaterial.split(" ")[2]
            name =  nameStr.split("\n")[0]
            return name
        
        for brepCount, brep in enumerate(shdBreps):
            if brep != None:
                isPlanar = True
                # check planarity
                for face in brep.Faces:
                    if not face.IsPlanar(tolerance):
                        isPlanar = False
                        break
                
                shadingBreps = []
                if not isPlanar:
                    meshArray = rc.Geometry.Mesh.CreateFromBrep(brep, mp)
                    for mesh in meshArray:
                        for meshFace in range(mesh.Faces.Count):
                            vertices = list(mesh.Faces.GetFaceVertices(meshFace))[1:]
                            vertices = vertices + [sc.doc.ModelAbsoluteTolerance]
                            # create the brep from mesh
                            shdBrep = rc.Geometry.Brep.CreateFromCornerPoints(*vertices)
                            shadingBreps.append(shdBrep)
                else:
                    for face in brep.Faces:
                        shadingBreps.append(face.DuplicateFace(False))
                
                for faceCount, shdBrep in enumerate(shadingBreps):
                        thisShading = hb_EPSHDSurface(shdBrep, 1000*brepCount + faceCount, 'shdSrf_' + `brepCount` + '_' + `faceCount` + "_" + str(uuid.uuid4()))
                        
                        # add transmittance schedule if any
                        if EPTransSchedule!=None:
                            schedule= EPTransSchedule.upper()
                            if schedule!=None and not schedule.lower().endswith(".csv") and schedule not in HBScheduleList:
                                msg = "Cannot find " + schedule + " in Honeybee schedule library."
                                print msg
                                ghenv.Component.AddRuntimeMessage(gh.GH_RuntimeMessageLevel.Warning, msg)
                                return -1
                            elif schedule!=None and schedule.lower().endswith(".csv"):
                                # check if csv file is existed
                                if not os.path.isfile(schedule):
                                    msg = "Cannot find the shchedule file: " + schedule
                                    print msg
                                    ghenv.Component.AddRuntimeMessage(gh.GH_RuntimeMessageLevel.Warning, msg)
                                    return -1
                            
                            thisShading.TransmittanceSCH = schedule
                        
                        # add the Rad Material if any
                        if RADMaterial!=None:
                            # if it is just the name of the material make sure it is already defined
                            if len(RADMaterial.split(" ")) == 1:
                                # if the material is not in the library add it to the library
                                if not hb_RADMaterialAUX.isMatrialExistInLibrary(RADMaterial):
                                    warningMsg = "Can't find " + RADMaterial + " in RAD Material Library.\n" + \
                                                "Add the material to the library and try again."
                                    ghenv.Component.AddRuntimeMessage(gh.GH_RuntimeMessageLevel.Warning, warningMsg)
                                    return
                                
                                try:
                                    thisShading.setRADMaterial(RADMaterial)
                                except Exception, e:
                                    print e
                                    warningMsg = "You are using an old version of Honeybee_Honeybee! Update your files and try again."
                                    print warningMsg
                                    ghenv.Component.AddRuntimeMessage(gh.GH_RuntimeMessageLevel.Warning, warningMsg)
                                    return
                                
                                addedToLib = True
                            else:
                                
                                # try to add the material to the library
                                addedToLib, thisShading.RadMaterial = hb_RADMaterialAUX.analyseRadMaterials(RADMaterial, True)
                                
                            if addedToLib==False:
                                warningMsg = "Failed to add " + RADMaterial + " to the Library."
                                ghenv.Component.AddRuntimeMessage(gh.GH_RuntimeMessageLevel.Warning, warningMsg)
                                return
                        
                        # add shading to the list
                        shadingClasses.append(thisShading)
                
        # add to the hive
        hb_hive = sc.sticky["honeybee_Hive"]()
        HBContext  = hb_hive.addToHoneybeeHive(shadingClasses, ghenv.Component.InstanceGuid.ToString())
        return HBContext
        ################################################################################################
    else:
        print "You should first let Honeybee to fly..."
        w = gh.GH_RuntimeMessageLevel.Warning
        ghenv.Component.AddRuntimeMessage(w, "You should first let Honeybee to fly...")
        return -1
        

if _shdSurfaces and _shdSurfaces[0]!=None:
    # add cleaning function
    result= main(_shdSurfaces, EPTransSchedule_, meshingSettings_, justBoundingBox_)
    
    if result != -1: HBContext = result
# ---------- end hb_epcontextsrf ----------
wires = BrepWireframe(Brep=hb_epcontextsrf, Density=-1)
preview = CustomPreview(Geometry=[wires, hb_epcontextsrf], Shader=ColourSwatch(SwatchColor=RGB(255, 255, 255)))

# ----
preview_2 = CustomPreview(Geometry=glazingcreator.HBObjWGLZ, Shader=ColourSwatch(SwatchColor=RGB(0, 252, 252)))

# ---- group: Make all surfaces except the exterior wall adiabatic
makeadiabatic = Honeybee_MakeAdiabatic(HBSrfs=flatten([createhbsrfs_5.HBSurface, createhbsrfs_4.HBSurface, createhbsrfs_6.HBSurface, createhbsrfs_3.HBSurface, createhbsrfs_2.HBSurface]))  # -> HBSrfs; plug-in component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

# ----
bldgprograms = Honeybee_bldgPrograms({"Office": 0, "Retail": 1, "MidriseApartment": 2, "PrimarySchool": 3, "SecondarySchool": 4, "SmallHotel": 5, "LargeHotel": 6, "Hospital": 7, "Outpatient": 8, "Warehouse": 9, "SuperMarket": 10, "FullServiceRestaurant": 11, "QuickServiceRestaurant": 12}, selected="MidriseApartment")
listzoneprograms = Honeybee_ListZonePrograms(bldgProgram=bldgprograms)  # -> MidriseApartmentZonePrograms; plug-in component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
callfromepconstrlibrary_2 = Honeybee_CallFromEPConstructionLibrary()  # -> ThermMaterials, EPMaterials, EPWindowMaterials, EPConstructions; plug-in component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
item = ListItem(List=listzoneprograms, Index=0, Wrap=True)

# ---- group: collect all honeybee surfaces
brep = Brep(flatten([makeadiabatic, glazingcreator.HBObjWGLZ, createhbsrfs_7.HBSurface, createhbsrfs_8.HBSurface]))

# ----
panel_2 = Panel(item)
searchepconstruction_2 = Honeybee_SearchEPConstruction(
    EPConstrList=callfromepconstrlibrary_2.EPConstructions,
    standard="2",
    climateZone="4",
    surfaceType=Slider(0, range=0..100))  # -> EPSelectedConstr; plug-in component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
decomposebytype = Honeybee_DecomposeBasedOnType()  # -> walls, interiorWalls, airWalls, windows, interiorWindows, skylights, roofs, ceilings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; plug-in component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
panel_3 = Panel("""1
5""")
panel_4 = Panel("""4
3
2""")
item_2 = ListItem(List=decomposebytype.walls, Index=panel_4, Wrap=True)
item_3 = ListItem(List=decomposebytype.walls, Index=panel_3, Wrap=True)

# ---- group: Daylighting
# Generate lighting Schedule
toggle_2 = BooleanToggle(False)
gentestpts = Honeybee_GenerateTestPoints(testSurface=flip.Surface, gridSize=".5", distBaseSrf=".762", moveTestMesh=True)  # -> readMe, simplify(testPoints), simplify(ptsVectors), simplify(facesArea), simplify(mesh); plug-in component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
radparameters = Honeybee_RADParameters(quality=0)  # -> readMe, radParameters; plug-in component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
createhbzones = Honeybee_createHBZones(name="test_room", zoneProgram=item, HBSurfaces=flatten(brep), isConditioned=toggle_2)  # -> readMe, HBZone; plug-in component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
wires_2 = BrepWireframe(Brep=createhbzones.HBZone, Density=-1)
toggle_3 = BooleanToggle(True)
item_4 = ListItem(List=gentestpts.testPoints, Index="58", Wrap=True)
annualdaylightsimulation = Honeybee_AnnualDaylightSimulation(
    north=number_slider,
    epwWeatherFile=open_epw_stat.epwFile,
    testPoints=gentestpts.testPoints,
    ptsVectors=gentestpts.ptsVectors,
    testMesh=gentestpts.mesh,
    radParameters=radparameters.radParameters)  # -> analysisRecipe; plug-in component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
sph = Sphere(Base=item_4, Radius=Slider(0.1, range=0..0.1))
lightingcontrol = Honeybee_LightingControlRecipe(
    controlType="4",
    sensorPoints=item_4,
    lightingPower=250,
    lightingSetpoint=300,
    ballastLossFactor=20,
    standbyPower=3,
    delayTime=5)  # -> lightingControlGroup; plug-in component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
gethbzoneepschedules = Honeybee_GetZoneEnergyPlusSchedules(HBZone=createhbzones.HBZone)  # -> occupancySchedule, occupancyActivitySch, heatingSetPtSchedule, coolingSetPtSchedule, lightingSchedule, equipmentSchedule, infiltrationSchedule; plug-in component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
rundaylightanalysis = Honeybee_RunDaylightSimulation(
    HBObjects=flatten(createhbzones.HBZone),
    analysisRecipe=annualdaylightsimulation,
    writeRad=toggle_3,
    runRad=toggle_3,
    numOfCPUs=Slider(4, range=0..10),
    overwriteResults=True)  # -> readMe, analysisType, resultsUnit, results, testPts, annual_analysis_files, radGeoFile, studyFolder, done; disabled; plug-in component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
readannualresultsi = Honeybee_ReadAnnualResultI(
    illFilesAddress=rundaylightanalysis.annual_analysis_files,
    testPoints=simplify(rundaylightanalysis.testPts),
    DLAIllumThresholds=300,
    lightingControlGroups=lightingcontrol,
    runIt=Toggle(True))  # -> DLA, UDLI_Less_100, UDLI_100_2000, UDLI_More_2000, CDA, sDA, annualProfiles, htmReport; plug-in component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
convertepschvalues = Honeybee_ConvertEnergyPlusScheduleToValues(schName=gethbzoneepschedules.occupancySchedule)  # -> values; plug-in component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
gradientlibrary = Ladybug_GradientLibrary(gradIndex=Slider(1, range=0..1))  # -> customColors; plug-in component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
panel_5 = Panel("UDLI_100_2000")
panel_6 = Panel(readannualresultsi.sDA)
pt = Point(<point referenced from the Rhino model>)
legendpar = Ladybug_LegendParameters(
    lowBound=Slider(0, range=0..100),
    highBound=Slider(100, range=0..100),
    numSegments=Slider(10, range=0..10),
    customColors=flatten(gradientlibrary))  # -> legendPar; plug-in component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
recolormesh = Ladybug_RecolorMesh(analysisResult=readannualresultsi.UDLI_Less_100, inputMesh=gentestpts.mesh, legendPar=legendpar)  # -> readMe, newMesh, newLegend, legendBasePt, meshColors, legendColors; plug-in component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
panel_7 = Panel("%")

# ----
item_5 = ListItem(List=decomposebytype.walls, Index="0", Wrap=True)
createhbsrfs_9 = Honeybee_createHBSrfs(geometry=decomposebytype.groundFloors, srfType="2")  # -> readMe, simplify(HBSurface); plug-in component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
createhbsrfs_10 = Honeybee_createHBSrfs(geometry=decomposebytype.roofs, srfType="3")  # -> readMe, simplify(HBSurface); plug-in component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
createhbsrfs_11 = Honeybee_createHBSrfs(geometry=item_2, srfType="0", EPConstruction=searchepconstruction_2)  # -> readMe, simplify(HBSurface); plug-in component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
brep_2 = Brep(item_5)
panel_8 = Panel(decomposebytype.walls)
createhbsrfs_12 = Honeybee_createHBSrfs(geometry=brep_2, srfType="0")  # -> readMe, simplify(HBSurface); plug-in component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
makeadiabatic_2 = Honeybee_MakeAdiabatic(HBSrfs=flatten([createhbsrfs_10.HBSurface, createhbsrfs_12.HBSurface, createhbsrfs_9.HBSurface]))  # -> HBSrfs; plug-in component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
createhbzones_2 = Honeybee_createHBZones(HBSurfaces=flatten([makeadiabatic_2, createhbsrfs_11.HBSurface, item_3]), isConditioned=True)  # -> readMe, HBZone; plug-in component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

# ---- group: Outdoor Comfort
importepw = Ladybug_ImportEpw(epwFile=open_epw_stat.epwFile)  # -> readMe, latitude, location, dryBulbTemperature, dewPointTemperature, relativeHumidity, windSpeed, windDirection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; plug-in component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
pmvcomfortpar = Ladybug_PMVComfortParameters(humidRatioUpBound="0.03")  # -> comfortPar; plug-in component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
pt_2 = Point(<point referenced from the Rhino model>)
toggle_4 = BooleanToggle(True)
panel_9 = Panel("""0.6
1
1.5""")
toggle_5 = BooleanToggle(True)
pt_3 = Point(<point referenced from the Rhino model>)
psychchart = Ladybug_PsychrometricChart(
    dryBulbTemperature=importepw.dryBulbTemperature,
    relativeHumidity=importepw.relativeHumidity,
    barometricPressure=importepw.barometricPressure,
    clothingLevel=panel_9,
    mergeComfPolygons=Toggle(True),
    comfortPar=pmvcomfortpar,
    basePoint=pt_3,
    scale=Slider(0.5, range=0..1),
    runIt=Toggle(True))  # -> readMe, port, totalComfortPercent, totalComfortOrNot, strategyNames, strategyPercentOfTime, strategyOrNot, port_2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; plug-in component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
panel_10 = Panel(psychchart.totalComfortPercent)
pt_4 = Point(<point referenced from the Rhino model>)
legendpar_2 = Ladybug_LegendParameters(numSegments=Slider(10, range=0..10))  # -> legendPar; plug-in component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
_3dchart = Ladybug_3DChart(
    inputData=flatten([psychchart.totalComfortOrNot, importepw.dryBulbTemperature, importepw.directNormalRadiation, importepw.windSpeed]),
    basePoint=pt_4,
    xScale="0.0625",
    yScale="0.25",
    zScale="0",
    legendPar=legendpar_2,
    condStatement="d<1")  # -> readMe, graphMesh, graphCurves, legend, legendBasePts, title, titleBasePts, dataPts, conditionalHOY; plug-in component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

# ---- group: Corridor
bldgprograms_2 = Honeybee_bldgPrograms({"Office": 0, "Retail": 1, "MidriseApartment": 2, "PrimarySchool": 3, "SecondarySchool": 4, "SmallHotel": 5, "LargeHotel": 6, "Hospital": 7, "Outpatient": 8, "Warehouse": 9, "SuperMarket": 10, "FullServiceRestaurant": 11, "QuickServiceRestaurant": 12}, selected="MidriseApartment")
listzoneprograms_2 = Honeybee_ListZonePrograms(bldgProgram=bldgprograms_2)  # -> MidriseApartmentZonePrograms; plug-in component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
item_6 = ListItem(List=listzoneprograms_2, Index=Slider(2, range=0..10), Wrap=True)
panel_11 = Panel(item_6)
brep_3 = Brep(<brep referenced from the Rhino model>)
mass2zone = Honeybee_Masses2Zones(
    zoneMasses=flatten(brep_3),
    zoneNames="Corridor",
    zonePrograms=panel_11,
    isConditioned=Toggle(False),
    maxRoofAngle=30,
    createHBZones=Toggle(True))  # -> readMe, HBZones; plug-in component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
wires_3 = BrepWireframe(Brep=mass2zone.HBZones, Density=-1)

# ---- group: Daylighting / just for visualization
# Compare Schedules!
convertepschvalues_2 = Honeybee_ConvertEnergyPlusScheduleToValues(schName=gethbzoneepschedules.lightingSchedule)  # -> values; plug-in component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
dsannualprofiles = Honeybee_DaysimAnnualProfiles(annualProfiles=readannualresultsi.annualProfiles)  # -> simplify(occupancyProfile), simplify(shadingProfiles), simplify(lightingControlProfiles), simplify(dgpProfile); plug-in component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
_3dchart_2 = Ladybug_3DChart(inputData=flatten([convertepschvalues_2, dsannualprofiles.lightingControlProfiles]), basePoint=pt)  # -> readMe, graphMesh, graphCurves, legend, legendBasePts, title, titleBasePts, dataPts, conditionalHOY; plug-in component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

# ----
solaradjusttemperature = Ladybug_OutdoorSolarTemperatureAdjustor(
    location=importepw.location,
    cumSkyMtxOrDirNormRad=importepw.directNormalRadiation,
    diffuseHorizRad=importepw.diffuseHorizontalRadiation,
    meanRadTemperature=importepw.dryBulbTemperature,
    bodyLocation=pt_2,
    north=number_slider,
    runIt=toggle_4)  # -> readMe, port, effectiveRadiantField, MRTDelta, solarAdjustedMRT, port_2, mannequinMesh, port_3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; plug-in component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
number_slider_2 = Slider(0.01, range=0..0.01)
outdoorcomfortcalculator = Ladybug_OutdoorComfortCalculator(
    dryBulbTemperature=importepw.dryBulbTemperature,
    meanRadiantTemperature=solaradjusttemperature.solarAdjustedMRT,
    windSpeed_tenMeters=importepw.windSpeed,
    relativeHumidity=importepw.relativeHumidity,
    runIt=toggle_5)  # -> readMe, port, universalThermalClimateIndex, comfortableOrNot, thermalStress, conditionOfPerson, port_2, percentOfTimeComfortable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; plug-in component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
toggle_6 = BooleanToggle(True)
toggle_7 = BooleanToggle(True)
epoutput = Honeybee_GenerateEPOutput(
    zoneEnergyUse=toggle_7,
    zoneGainsAndLosses="False",
    zoneComfortMetrics=toggle_7,
    surfaceTempAnalysis="False",
    timestep="hourly")  # -> report, flatten(simulationOutputs); plug-in component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
panel_12 = Panel("""Cooling, Heating
& Lighting Loads""")
pt_5 = Point(<point referenced from the Rhino model>)
pmvcomfortpar_2 = Ladybug_PMVComfortParameters(humidRatioUpBound="0.03")  # -> comfortPar; plug-in component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
toggle_8 = BooleanToggle(True)
panel_13 = Panel("""0.6
1
1.5""")
pt_6 = Point(<point referenced from the Rhino model>)
gradientlibrary_2 = Ladybug_GradientLibrary(gradIndex=Slider(1, range=0..1))  # -> customColors; plug-in component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
legendpar_3 = Ladybug_LegendParameters(lowBound="-3", highBound="3", numSegments=Slider(7, range=0..10), customColors=flatten(gradientlibrary_2))  # -> legendPar; plug-in component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

# ---- group: Natural Ventilation
# 1) AutoCalulated Window-Based Natural Ventilation
brep_4 = Brep(flatten([makeadiabatic, glazingcreator.HBObjWGLZ, createhbsrfs_7.HBSurface]))
# update lighting schedule
createhbzones_3 = Honeybee_createHBZones(name="test_room", zoneProgram=item, HBSurfaces=flatten(brep_4), isConditioned=toggle_2)  # -> readMe, HBZone; plug-in component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
wires_4 = BrepWireframe(Brep=[createhbzones_3.HBZone, mass2zone.HBZones], Density=-1)
setepzoneschedules = Honeybee_SetEnergyPlusZoneSchedules(HBZones=createhbzones_3.HBZone, lightingSchedules=readannualresultsi.annualProfiles)  # -> schedules, simplify(HBZones); plug-in component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
number_slider_3 = Slider(0.01, range=0..0.1)
epglassmat = Honeybee_EnergyPlusGlassMaterial(
    name="Solarban_70XL",
    thickness=number_slider_3,
    solarTransmittance=Slider(0.5, range=0..1),
    emissivity=Slider(0.5, range=0..1),
    conductivity=number_slider_2)  # -> EPMaterial; plug-in component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
epglassmat_2 = Honeybee_EnergyPlusGlassMaterial(name="Glass_2", thickness=number_slider_3, conductivity=number_slider_2)  # -> EPMaterial; plug-in component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
epwindowairgap = Honeybee_EnergyPlusWindowAirGap(name="Air gap", thickness=Slider(0.03, range=0..0.1))  # -> EPMaterial; plug-in component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
epconstruction = Honeybee_EnergyPlusConstruction(name="Curtain wall", layer_1=epglassmat, layer_2=epwindowairgap, layer_3=epglassmat_2)  # -> EPConstruction; plug-in component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

setepnatvent = Honeybee_SetEPAirFlow(
    HBZones=setepzoneschedules.HBZones,
    naturalVentilationType="1",
    minIndoorTempForNatVent="24",
    maxOutdoorTempForNatVent="30")  # -> readMe, simplify(HBZones); plug-in component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
zoneattributelist = Honeybee_ZoneAttributeList({"Name": "name", "Zone Program": "zoneProgram", "Zone Floor Area": "zoneFloorArea", "Zone Volume": "zoneVolume", "Building Program": "bldgProgram", "Is Conditioned": "isConditioned", "Occupancy Schedule": "occupancySchedule", "Occupancy Activity Schedule": "occupancyActivitySch", "Heating SetPoint Schedule": "heatingSetPtSchedule", "Cooling SetPoint Schedule": "coolingSetPtSchedule"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}, selected="Natural Ventilation": "natVent")
labelzones = Honeybee_LabelZones(HBZones=flatten(setepnatvent.HBZones), attribute=zoneattributelist)  # -> zoneTxtLabels, labelBasePts, brepTxtLabels, zoneWireFrames; plug-in component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

setepzonecnstr = Honeybee_SetEPZoneConstruction(HBZone=setepnatvent.HBZones, windowEPConstruction=epconstruction)  # -> simplify(modifiedHBZone); plug-in component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

# ----
solveadjc = Honeybee_SolveAdjacencies(HBZones=flatten([setepzonecnstr, mass2zone.HBZones]), removeCurrentAdjc=False, findAdjc=Toggle(True))  # -> readMe, HBZonesWADJ; plug-in component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

# ----
# Run the analysis
runenergysimulation = Honeybee_RunEnergySimulation(
    north=number_slider,
    epwFile=open_epw_stat.epwFile,
    HBZones=flatten(solveadjc.HBZonesWADJ),
    HBContext=flatten(hb_epcontextsrf),
    simulationOutputs=flatten(epoutput.simulationOutputs),
    writeIdf=toggle_6,
    runEnergyPlus=toggle_6)  # -> report, idfFileAddress, resultFileAddress; disabled; plug-in component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
decomposebytype_2 = Honeybee_DecomposeBasedOnType(HBZone=solveadjc.HBZonesWADJ)  # -> walls, interiorWalls, airWalls, windows, interiorWindows, skylights, roofs, ceilings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; plug-in component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
brep_5 = Brep(decomposebytype_2.interiorWalls)
readepresult = Honeybee_ReadEPResult(resultFileAddress=runenergysimulation.resultFileAddress)  # -> totalThermalEnergy, thermalEnergyBalance, cooling, heating, electricLight, electricEquip, fanElectric, pumpElectric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; plug-in component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
separatedata = Ladybug_SeparateData(inputList=flatten(readepresult.cooling))  # -> numbers, strings; plug-in component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
separatedata_2 = Ladybug_SeparateData(inputList=flatten(readepresult.heating))  # -> numbers, strings; plug-in component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
separatedata_3 = Ladybug_SeparateData(inputList=flatten(readepresult.electricLight))  # -> numbers, strings; plug-in component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
ma = MassAddition(Input=separatedata.numbers)  # -> Result, PartialResults
ma_2 = MassAddition(Input=separatedata_2.numbers)  # -> Result, PartialResults
ma_3 = MassAddition(Input=separatedata_3.numbers)  # -> Result, PartialResults
total_cooling = Panel(ma.Result)
total_heating = Panel(ma_2.Result)
total_lighting = Panel(ma_3.Result)
viewer = ParamViewer(readepresult.airTemperature)
addition = Addition(A=total_cooling, B=total_heating)
total_load = Panel(addition)
barchart = Ladybug_MonthlyBarChart(
    inputData=flatten([readepresult.cooling, readepresult.electricLight, readepresult.heating]),
    altYAxisTitle=panel_12,
    basePoint="20, 0, 0",
    xScale=Slider(0.5, range=0..1),
    yScale=Slider(0.7, range=0..1))  # -> readMe, dataMesh, dataCurves, dataCrvColors, graphAxes, graphLabels, title, titleBasePt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; plug-in component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
pmvcomfortcalculator = Ladybug_PMVComfortCalculator(
    dryBulbTemperature=readepresult.airTemperature,
    meanRadiantTemperature=readepresult.meanRadTemperature,
    relativeHumidity=readepresult.relativeHumidity,
    calcBalanceTemperature=False,
    runIt=toggle_8)  # -> readMe, port, predictedMeanVote, percentPeopleDissatisfied, standardEffectiveTemperature, port_2, comfortableOrNot, percentOfTimeComfortable, port_3, balanceTemperature; plug-in component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
adaptivecomfortcalculator = Ladybug_AdaptiveComfortCalculator(
    dryBulbTemperature=readepresult.airTemperature,
    meanRadiantTemperature=readepresult.meanRadTemperature,
    prevailingOutdoorTemp=importepw.dryBulbTemperature,
    runIt=toggle_8)  # -> readMe, port, comfortableOrNot, conditionOfPerson, degreesFromTarget, port_2, targetTemperature, upperTemperatureBound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; plug-in component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
psychchart_2 = Ladybug_PsychrometricChart(
    dryBulbTemperature=readepresult.airTemperature,
    relativeHumidity=readepresult.relativeHumidity,
    barometricPressure=importepw.barometricPressure,
    clothingLevel=panel_13,
    mergeComfPolygons=Toggle(True),
    comfortPar=pmvcomfortpar_2,
    basePoint=pt_5,
    scale=Slider(0.5, range=0..1),
    runIt=Toggle(True))  # -> readMe, port, totalComfortPercent, totalComfortOrNot, strategyNames, strategyPercentOfTime, strategyOrNot, port_2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; plug-in component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
pmv = Panel(pmvcomfortcalculator.percentOfTimeComfortable)
adaptive = Panel(adaptivecomfortcalculator.percentHotCold)
panel_14 = Panel(psychchart_2.totalComfortPercent)
_3dchart_3 = Ladybug_3DChart(
    inputData=flatten([psychchart_2.totalComfortOrNot, importepw.dryBulbTemperature, importepw.directNormalRadiation, importepw.windSpeed]),
    basePoint=pt_6,
    xScale="0.0625",
    yScale="0.25",
    zScale="0",
    condStatement="e<1")  # -> readMe, graphMesh, graphCurves, legend, legendBasePts, title, titleBasePts, dataPts, conditionalHOY; plug-in component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
