# Grasshopper definition Shading Design V3 10_16.gh (Grasshopper 0.9.76)
# plug-ins: Python Interpreter

activitieslist = Ladybug_ActivitiesMetList({"Sleeping": 0.7, "Reclining": 0.8, "Sitting": 1.0, "Typing": 1.1, "Standing": 1.2, "Driving": 1.5, "Cooking": 1.8, "House Cleaning": 2.7, "Strolling": 1.7, "Walking 2mph": 2.0, "Walking 3mph": 2.6, "Walking 4mph": 3.8, "Running 9mph": 9.5, "Lifting 10lbs": 2.1, "Lifting 100lbs": 4.0, "Shoveling": 4.4, "Dancing": 3.4, "Basketball": 6.3}, selected="Sitting")
building_context = Brep([<brep referenced from the Rhino model> x2])
analysisperiod = Ladybug_AnalysisPeriod()  # -> readMe, analysisPeriod; plug-in component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
ladybug = Ladybug_Ladybug()  # -> Vviiiiiiiiiizzz; plug-in component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
seating_point = Point(<point referenced from the Rhino model>)
path = FilePath("\\juno.design.upenn.edu\home\grad\arch\srong\Desktop\EPW file\USA_PA_Philadelphia.Intl.AP.724080_TMY3.epw")
importepw = Ladybug_ImportEpw(epwFile=path)  # -> readMe, latitude, location, dryBulbTemperature, dewPointTemperature, relativeHumidity, windSpeed, windDirection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; plug-in component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
solaradjusttemperature = Ladybug_OutdoorSolarTemperatureAdjustor(
    location=importepw.location,
    cumSkyMtxOrDirNormRad=importepw.directNormalRadiation,
    diffuseHorizRad=importepw.diffuseHorizontalRadiation,
    meanRadTemperature=importepw.dryBulbTemperature,
    bodyPosture=activitieslist,
    rotationAngle=Slider(70, range=0..100),
    bodyLocation=seating_point,
    contextShading=building_context,
    analysisPeriodOrHOY=analysisperiod.analysisPeriod,
    parallel=Toggle(True),
    runIt=Toggle(True))  # -> readMe, port, effectiveRadiantField, MRTDelta, solarAdjustedMRT, port_2, mannequinMesh, port_3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; disabled; plug-in component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

# ---- group: Calculation and Comparison
_2_100_building_context = Brep([<brep referenced from the Rhino model> x5])
_2_60_building_context = Brep([<brep referenced from the Rhino model> x5])
_1_0_building_context = Brep([<brep referenced from the Rhino model> x5])

# ---- group: May to Sep Need Shading
outdoorcomfortcalculator = Ladybug_OutdoorComfortCalculator(
    dryBulbTemperature=importepw.dryBulbTemperature,
    meanRadiantTemperature=solaradjusttemperature.solarAdjustedMRT,
    windSpeed_tenMeters=importepw.windSpeed,
    relativeHumidity=importepw.relativeHumidity,
    runIt=Toggle(True))  # -> readMe, port, universalThermalClimateIndex, comfortableOrNot, thermalStress, conditionOfPerson, port_2, percentOfTimeComfortable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; disabled; plug-in component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
range = Range(Domain=Domain(0, 1), Steps=10)
panel = Panel("0.25")
panel_2 = Panel("a>0")
gradient = Gradient(LowerLimit=0, UpperLimit=1, Parameter=range, stops=[0.15: RGB(255, 255, 255), 0.85: RGB(220, 0, 40)])
pt = Point(<point referenced from the Rhino model>)
legendpar = Ladybug_LegendParameters(lowBound=Slider(1, range=0..1), highBound=Slider(3, range=0..10), customColors=flatten(gradient))  # -> legendPar; plug-in component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
_3dchart = Ladybug_3DChart(
    inputData=flatten(outdoorcomfortcalculator.conditionOfPerson),
    basePoint=pt,
    xScale=panel,
    zScale="0",
    legendPar=legendpar,
    condStatement=panel_2)  # -> readMe, graphMesh, graphCurves, legend, legendBasePts, title, titleBasePts, dataPts, conditionalHOY; disabled; plug-in component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

# ---- group: Calculation and Comparison / Method 1
activitieslist_2 = Ladybug_ActivitiesMetList({"Sleeping": 0.7, "Reclining": 0.8, "Sitting": 1.0, "Typing": 1.1, "Standing": 1.2, "Driving": 1.5, "Cooking": 1.8, "House Cleaning": 2.7, "Strolling": 1.7, "Walking 2mph": 2.0, "Walking 3mph": 2.6, "Walking 4mph": 3.8, "Running 9mph": 9.5, "Lifting 10lbs": 2.1, "Lifting 100lbs": 4.0, "Shoveling": 4.4, "Dancing": 3.4, "Basketball": 6.3}, selected="Sitting")
analysisperiod_2 = Ladybug_AnalysisPeriod()  # -> readMe, analysisPeriod; plug-in component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
seating_point_2 = Point([<point referenced from the Rhino model> x3])
solaradjusttemperature_2 = Ladybug_OutdoorSolarTemperatureAdjustor(
    location=importepw.location,
    cumSkyMtxOrDirNormRad=importepw.directNormalRadiation,
    diffuseHorizRad=importepw.diffuseHorizontalRadiation,
    meanRadTemperature=importepw.dryBulbTemperature,
    bodyPosture=activitieslist_2,
    rotationAngle=Slider(70, range=0..100),
    bodyLocation=seating_point_2,
    contextShading=_1_0_building_context,
    analysisPeriodOrHOY=analysisperiod_2.analysisPeriod,
    parallel=Toggle(True),
    runIt=Toggle(True))  # -> readMe, port, effectiveRadiantField, MRTDelta, solarAdjustedMRT, port_2, mannequinMesh, port_3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; plug-in component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
outdoorcomfortcalculator_2 = Ladybug_OutdoorComfortCalculator(
    dryBulbTemperature=importepw.dryBulbTemperature,
    meanRadiantTemperature=solaradjusttemperature_2.solarAdjustedMRT,
    windSpeed_tenMeters=importepw.windSpeed,
    relativeHumidity=importepw.relativeHumidity,
    runIt=Toggle(True))  # -> readMe, port, universalThermalClimateIndex, comfortableOrNot, thermalStress, conditionOfPerson, port_2, percentOfTimeComfortable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; plug-in component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

# ---- group: Calculation and Comparison / Method2 100% shading
activitieslist_3 = Ladybug_ActivitiesMetList({"Sleeping": 0.7, "Reclining": 0.8, "Sitting": 1.0, "Typing": 1.1, "Standing": 1.2, "Driving": 1.5, "Cooking": 1.8, "House Cleaning": 2.7, "Strolling": 1.7, "Walking 2mph": 2.0, "Walking 3mph": 2.6, "Walking 4mph": 3.8, "Running 9mph": 9.5, "Lifting 10lbs": 2.1, "Lifting 100lbs": 4.0, "Shoveling": 4.4, "Dancing": 3.4, "Basketball": 6.3}, selected="Sitting")
analysisperiod_3 = Ladybug_AnalysisPeriod()  # -> readMe, analysisPeriod; plug-in component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
seating_point_3 = Point([<point referenced from the Rhino model> x3])
solaradjusttemperature_3 = Ladybug_OutdoorSolarTemperatureAdjustor(
    location=importepw.location,
    cumSkyMtxOrDirNormRad=importepw.directNormalRadiation,
    diffuseHorizRad=importepw.diffuseHorizontalRadiation,
    meanRadTemperature=importepw.dryBulbTemperature,
    bodyPosture=activitieslist_3,
    rotationAngle=Slider(70, range=0..100),
    bodyLocation=seating_point_3,
    contextShading=_2_100_building_context,
    analysisPeriodOrHOY=analysisperiod_3.analysisPeriod,
    parallel=Toggle(True),
    runIt=Toggle(True))  # -> readMe, port, effectiveRadiantField, MRTDelta, solarAdjustedMRT, port_2, mannequinMesh, port_3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; plug-in component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
outdoorcomfortcalculator_3 = Ladybug_OutdoorComfortCalculator(
    dryBulbTemperature=importepw.dryBulbTemperature,
    meanRadiantTemperature=solaradjusttemperature_3.solarAdjustedMRT,
    windSpeed_tenMeters=importepw.windSpeed,
    relativeHumidity=importepw.relativeHumidity,
    runIt=Toggle(True))  # -> readMe, port, universalThermalClimateIndex, comfortableOrNot, thermalStress, conditionOfPerson, port_2, percentOfTimeComfortable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; plug-in component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

# ---- group: Calculation and Comparison / Method2 60%shading
activitieslist_4 = Ladybug_ActivitiesMetList({"Sleeping": 0.7, "Reclining": 0.8, "Sitting": 1.0, "Typing": 1.1, "Standing": 1.2, "Driving": 1.5, "Cooking": 1.8, "House Cleaning": 2.7, "Strolling": 1.7, "Walking 2mph": 2.0, "Walking 3mph": 2.6, "Walking 4mph": 3.8, "Running 9mph": 9.5, "Lifting 10lbs": 2.1, "Lifting 100lbs": 4.0, "Shoveling": 4.4, "Dancing": 3.4, "Basketball": 6.3}, selected="Sitting")
analysisperiod_4 = Ladybug_AnalysisPeriod()  # -> readMe, analysisPeriod; plug-in component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
seating_point_4 = Point([<point referenced from the Rhino model> x3])
solaradjusttemperature_4 = Ladybug_OutdoorSolarTemperatureAdjustor(
    location=importepw.location,
    cumSkyMtxOrDirNormRad=importepw.directNormalRadiation,
    diffuseHorizRad=importepw.diffuseHorizontalRadiation,
    meanRadTemperature=importepw.dryBulbTemperature,
    bodyPosture=activitieslist_4,
    rotationAngle=Slider(70, range=0..100),
    bodyLocation=seating_point_4,
    contextShading=_2_60_building_context,
    analysisPeriodOrHOY=analysisperiod_4.analysisPeriod,
    parallel=Toggle(True),
    runIt=Toggle(True))  # -> readMe, port, effectiveRadiantField, MRTDelta, solarAdjustedMRT, port_2, mannequinMesh, port_3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; plug-in component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
outdoorcomfortcalculator_4 = Ladybug_OutdoorComfortCalculator(
    dryBulbTemperature=importepw.dryBulbTemperature,
    meanRadiantTemperature=solaradjusttemperature_4.solarAdjustedMRT,
    windSpeed_tenMeters=importepw.windSpeed,
    relativeHumidity=importepw.relativeHumidity,
    runIt=Toggle(True))  # -> readMe, port, universalThermalClimateIndex, comfortableOrNot, thermalStress, conditionOfPerson, port_2, percentOfTimeComfortable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; plug-in component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

# ----
panel_3 = Panel([outdoorcomfortcalculator.percentHeatStress, outdoorcomfortcalculator.percentColdStress])
panel_4 = Panel(outdoorcomfortcalculator.percentOfTimeComfortable)

# ---- group: Method 2
_2_testsurface_for_short_west = Brep(<brep referenced from the Rhino model>)
_3_testsurface_for_short_east = Brep(<brep referenced from the Rhino model>)
_1_testsurface_for_long = Brep(<brep referenced from the Rhino model>)
_1_long_bench = Brep(<brep referenced from the Rhino model>)
_3_short_right = Brep(<brep referenced from the Rhino model>)
_2_short_left = Brep(<brep referenced from the Rhino model>)
entwine = Entwine(Branch00=_1_long_bench, Branch01=_2_short_left, Branch02=_3_short_right, FlattenInputs=True)  # -> simplify(Result)
entwine_2 = Entwine(
    Branch00=_1_testsurface_for_long,
    Branch01=_2_testsurface_for_short_west,
    Branch02=_3_testsurface_for_short_east,
    FlattenInputs=True)
panel_5 = Panel(entwine_2)
entwine_3 = Entwine(
    Branch00=outdoorcomfortcalculator.universalThermalClimateIndex,
    Branch01=outdoorcomfortcalculator.universalThermalClimateIndex,
    Branch02=outdoorcomfortcalculator.universalThermalClimateIndex,
    FlattenInputs=True)
building_context_2 = Brep([<brep referenced from the Rhino model> x2])
comfortshadebenefit = Ladybug_ComfortShadeBenefitEvaluator(
    location=importepw.location,
    temperatures=entwine_3,
    balanceTemperature=Slider(20, range=0..100),
    testShades=entwine_2,
    testRegion=entwine,
    context=building_context_2,
    delNonIntersect=False,
    parallel=Toggle(True),
    runIt=Toggle(True))  # -> readMe, port, sunVectors, regionTestPts, shadeMesh, legend, legendBasePoint, port_2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; disabled; plug-in component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
shadecreator = Honeybee_OptimalShadeCreator(
    shadeMesh=comfortshadebenefit.shadeMesh,
    shadeNetEffect=comfortshadebenefit.shadeNetEffect,
    percentToKeep=Slider(60, range=0..100))  # -> readMe, energySavedByShade, areaOfShade, newColoredMesh, newShadeBrep; disabled; plug-in component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

# ---- group: METHOD 1
analysisperiod_5 = Ladybug_AnalysisPeriod(fromMonth=Slider(4, range=0..10), toMonth=Slider(10, range=0..10))  # -> readMe, analysisPeriod; plug-in component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
pt_2 = Point(<point referenced from the Rhino model>)
sunpath = Ladybug_SunPath(
    location=importepw.location,
    hour=12,
    day=21,
    month=12,
    timeStep=1,
    analysisPeriod=analysisperiod_5.analysisPeriod,
    centerPt=pt_2,
    sunPathScale=panel,
    annualHourlyData=flatten(outdoorcomfortcalculator.conditionOfPerson),
    conditionalStatement=panel_2,
    legendPar=legendpar,
    dailyOrAnnualSunPath=True)  # -> readMe, sunVectors, sunAltitudes, sunAzimuths, port, sunSpheresMesh, sunPathCrvs, legend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; disabled; plug-in component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
_2_testsurface_for_short_west_2 = Brep(<brep referenced from the Rhino model>)
_3_testsurface_for_short_east_2 = Brep(<brep referenced from the Rhino model>)
_1_testsurface_for_long_2 = Brep(<brep referenced from the Rhino model>)
number_slider = Slider(0, range=0..100)
number_slider_2 = Slider(1, range=0..1)
toggle = BooleanToggle(True)
toggle_2 = BooleanToggle(True)
_1_long_bench_2 = Brep(<brep referenced from the Rhino model>)
_3_short_right_2 = Brep(<brep referenced from the Rhino model>)
_2_short_left_2 = Brep(<brep referenced from the Rhino model>)

# ----
shddesigner = Ladybug_ShadingDesigner(
    glzSrf=flatten([_1_long_bench_2, _2_short_left_2, _3_short_right_2]),
    depthOrVector=flatten(sunpath.sunVectors),
    numOfShds=number_slider_2,
    distBetween=number_slider,
    runIt=toggle,
    optionalShdSrf=[_1_testsurface_for_long_2, _2_testsurface_for_short_west_2, _3_testsurface_for_short_east_2],
    mergeVectors=Toggle(True),
    horOrVertical=toggle_2)  # -> readMe, shadingSrfs; disabled; plug-in component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

# ---- group: Calculation and Comparison
# {0;0;0} is for Long Bench
# heat stress
# cold stress
# overall
# 
# {0;0;1} is for Short Bench West
# heat stress
# cold stress
# overall
# 
# {0;0;2} is for Short Bench East
# heat stress
# cold stress
# overall
# Conclusion:
# The best shading result came from the Comfort shading evaluator 100% keeping;
# However the difference between the three Variations is not that obvious,except for the Short Bench East.
addition = Addition(A=outdoorcomfortcalculator_2.percentHeatStress, B=outdoorcomfortcalculator_2.percentColdStress)
method_1 = Panel([outdoorcomfortcalculator_2.percentHeatStress, outdoorcomfortcalculator_2.percentColdStress, addition])
addition_2 = Addition(A=outdoorcomfortcalculator_3.percentHeatStress, B=outdoorcomfortcalculator_3.percentColdStress)
method_2_100 = Panel([outdoorcomfortcalculator_3.percentHeatStress, outdoorcomfortcalculator_3.percentColdStress, addition_2])
addition_3 = Addition(A=outdoorcomfortcalculator_4.percentHeatStress, B=outdoorcomfortcalculator_4.percentColdStress)
method_2_60 = Panel([outdoorcomfortcalculator_4.percentHeatStress, outdoorcomfortcalculator_4.percentColdStress, addition_3])
