# Grasshopper definition Vyas_Janki_Shading Design_Meyerson.gh (Grasshopper 0.9.76)
# plug-ins: Python Interpreter

ladybug = Ladybug_Ladybug()  # -> out; plug-in component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

panel = Panel("http://apps1.eere.energy.gov/buildings/energyplus/weatherdata/4_north_and_central_america_wmo_region_4/1_usa/USA_PA_Philadelphia.Intl.AP.724080_TMY3.zip")
open_epw_stat = Ladybug_OpenEPWAndSTATWeatherFiles(weatherFileURL=panel)  # -> epwFile, statFile; plug-in component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
importepw = Ladybug_ImportEpw(epwFile=open_epw_stat.epwFile)  # -> Output, latitude, location, dryBulbTemperature, dewPointTemperature, relativeHumidity, windSpeed, windDirection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; plug-in component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

# ----
# point on parallel bench
point = Point(<point referenced from the Rhino model>)

# ----
# point on left perpendicular bench
# point on right perpendicular bench
point_2 = Point(<point referenced from the Rhino model>)

analysisperiod = Ladybug_AnalysisPeriod()  # -> out, analysisPeriod; plug-in component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
point_3 = Point(<point referenced from the Rhino model>)
solaradjusttemperature = Ladybug_OutdoorSolarTemperatureAdjustor(
    location=importepw.location,
    cumSkyMtxOrDirNormRad=importepw.directNormalRadiation,
    diffuseHorizRad=importepw.diffuseHorizontalRadiation,
    meanRadTemperature=importepw.dryBulbTemperature,
    bodyPosture=Slider(1, range=0..1),
    rotationAngle=Slider(270, range=0..360),
    bodyLocation=point_3,
    north="5",
    analysisPeriodOrHOY=analysisperiod.analysisPeriod,
    runIt=Toggle(False))  # -> readMe, port, effectiveRadiantField, MRTDelta, solarAdjustedMRT, port_2, mannequinMesh, port_3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; plug-in component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

outdoorcomfortcalculator = Ladybug_OutdoorComfortCalculator(
    dryBulbTemperature=importepw.dryBulbTemperature,
    meanRadiantTemperature=solaradjusttemperature.solarAdjustedMRT,
    windSpeed_tenMeters=importepw.windSpeed,
    relativeHumidity=importepw.relativeHumidity,
    runIt=Toggle(False))  # -> out, port, universalThermalClimateIndex, comfortableOrNot, thermalStress, conditionOfPerson, port_2, percentOfTimeComfortable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; plug-in component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

analysisperiod_2 = Ladybug_AnalysisPeriod()  # -> out, analysisPeriod; plug-in component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
sunpath = Ladybug_SunPath(
    north="5",
    location=importepw.location,
    hour=12,
    day=21,
    month=12,
    timeStep=1,
    analysisPeriod=analysisperiod_2.analysisPeriod,
    annualHourlyData=flatten(outdoorcomfortcalculator.conditionOfPerson),
    dailyOrAnnualSunPath=True)  # -> out, sunVectors, sunAltitudes, sunAzimuths, port, sunSpheresMesh, sunPathCrvs, legend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; plug-in component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

panel_2 = Panel(outdoorcomfortcalculator.percentOfTimeComfortable)

brep = Brep([<brep referenced from the Rhino model> x3])
brep_2 = Brep(<brep referenced from the Rhino model>)
brep_3 = Brep(<brep referenced from the Rhino model>)
comfortshadebenefit = Ladybug_ComfortShadeBenefitEvaluator(
    location=importepw.location,
    temperatures=outdoorcomfortcalculator.universalThermalClimateIndex,
    balanceTemperature="20",
    testShades=brep_2,
    testRegion=brep_3,
    gridSize="1",
    context=brep,
    skyResolution="4",
    delNonIntersect=False,
    parallel=Toggle(True),
    runIt=Toggle(False))  # -> out, port, sunVectors, regionTestPts, shadeMesh, legend, legendBasePoint, port_2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; plug-in component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

shadecreator = Honeybee_OptimalShadeCreator(
    shadeMesh=comfortshadebenefit.shadeMesh,
    shadeNetEffect=comfortshadebenefit.shadeNetEffect,
    levelOfPerform=Slider(3, range=0..10))  # -> out, energySavedByShade, areaOfShade, newColoredMesh, newShadeBrep; plug-in component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
panel_3 = Panel(comfortshadebenefit.shadeHarmfulness)
panel_4 = Panel(comfortshadebenefit.shadeHelpfulness)
panel_5 = Panel(shadecreator.areaOfShade)
