# Grasshopper definition Vyas_Janki_Shading Design_Meyerson_R1_Version1.gh (Grasshopper 0.9.76)
# plug-ins: Python Interpreter

panel = Panel("http://apps1.eere.energy.gov/buildings/energyplus/weatherdata/4_north_and_central_america_wmo_region_4/1_usa/USA_PA_Philadelphia.Intl.AP.724080_TMY3.zip")
open_epw_stat = Ladybug_OpenEPWAndSTATWeatherFiles(weatherFileURL=panel)  # -> epwFile, statFile; plug-in component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
importepw = Ladybug_ImportEpw(epwFile=open_epw_stat.epwFile)  # -> Output, latitude, location, dryBulbTemperature, dewPointTemperature, relativeHumidity, windSpeed, windDirection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; plug-in component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

ladybug = Ladybug_Ladybug()  # -> out; plug-in component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

analysisperiod = Ladybug_AnalysisPeriod()  # -> out, analysisPeriod; plug-in component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
library_and_meyerson = Brep([<brep referenced from the Rhino model> x3])
point = Point(<point referenced from the Rhino model>)
solaradjusttemperature = Ladybug_OutdoorSolarTemperatureAdjustor(
    location=importepw.location,
    cumSkyMtxOrDirNormRad=importepw.directNormalRadiation,
    diffuseHorizRad=importepw.diffuseHorizontalRadiation,
    meanRadTemperature=importepw.dryBulbTemperature,
    bodyPosture="1",
    rotationAngle="270",
    bodyLocation=point,
    contextShading=library_and_meyerson,
    north="5",
    analysisPeriodOrHOY=analysisperiod.analysisPeriod,
    runIt=Toggle(True))  # -> readMe, port, effectiveRadiantField, MRTDelta, solarAdjustedMRT, port_2, mannequinMesh, port_3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; plug-in component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

analysisperiod_2 = Ladybug_AnalysisPeriod()  # -> out, analysisPeriod; plug-in component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
library_and_meyerson_2 = Brep([<brep referenced from the Rhino model> x3])
point_2 = Point(<point referenced from the Rhino model>)
solaradjusttemperature_2 = Ladybug_OutdoorSolarTemperatureAdjustor(
    location=importepw.location,
    cumSkyMtxOrDirNormRad=importepw.directNormalRadiation,
    diffuseHorizRad=importepw.diffuseHorizontalRadiation,
    meanRadTemperature=importepw.dryBulbTemperature,
    bodyPosture="1",
    rotationAngle="180",
    bodyLocation=point_2,
    contextShading=library_and_meyerson_2,
    north="5",
    analysisPeriodOrHOY=analysisperiod_2.analysisPeriod,
    runIt=Toggle(True))  # -> readMe, port, effectiveRadiantField, MRTDelta, solarAdjustedMRT, port_2, mannequinMesh, port_3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; plug-in component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

analysisperiod_3 = Ladybug_AnalysisPeriod()  # -> out, analysisPeriod; plug-in component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
library_and_meyerson_3 = Brep([<brep referenced from the Rhino model> x3])
point_3 = Point(<point referenced from the Rhino model>)
solaradjusttemperature_3 = Ladybug_OutdoorSolarTemperatureAdjustor(
    location=importepw.location,
    cumSkyMtxOrDirNormRad=importepw.directNormalRadiation,
    diffuseHorizRad=importepw.diffuseHorizontalRadiation,
    meanRadTemperature=importepw.dryBulbTemperature,
    bodyPosture="1",
    rotationAngle="90",
    bodyLocation=point_3,
    contextShading=library_and_meyerson_3,
    north="5",
    analysisPeriodOrHOY=analysisperiod_3.analysisPeriod,
    runIt=Toggle(True))  # -> readMe, port, effectiveRadiantField, MRTDelta, solarAdjustedMRT, port_2, mannequinMesh, port_3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; plug-in component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

outdoorcomfortcalculator = Ladybug_OutdoorComfortCalculator(
    dryBulbTemperature=importepw.dryBulbTemperature,
    meanRadiantTemperature=solaradjusttemperature.solarAdjustedMRT,
    windSpeed_tenMeters=importepw.windSpeed,
    relativeHumidity=importepw.relativeHumidity,
    runIt=Toggle(True))  # -> out, port, universalThermalClimateIndex, comfortableOrNot, thermalStress, conditionOfPerson, port_2, percentOfTimeComfortable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; plug-in component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

outdoorcomfortcalculator_2 = Ladybug_OutdoorComfortCalculator(
    dryBulbTemperature=importepw.dryBulbTemperature,
    meanRadiantTemperature=solaradjusttemperature_2.solarAdjustedMRT,
    windSpeed_tenMeters=importepw.windSpeed,
    relativeHumidity=importepw.relativeHumidity,
    runIt=Toggle(True))  # -> out, port, universalThermalClimateIndex, comfortableOrNot, thermalStress, conditionOfPerson, port_2, percentOfTimeComfortable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; plug-in component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

outdoorcomfortcalculator_3 = Ladybug_OutdoorComfortCalculator(
    dryBulbTemperature=importepw.dryBulbTemperature,
    meanRadiantTemperature=solaradjusttemperature_3.solarAdjustedMRT,
    windSpeed_tenMeters=importepw.windSpeed,
    relativeHumidity=importepw.relativeHumidity,
    runIt=Toggle(True))  # -> out, port, universalThermalClimateIndex, comfortableOrNot, thermalStress, conditionOfPerson, port_2, percentOfTimeComfortable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; plug-in component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

# ---- group: Right Perpendicular
library_and_meyerson_4 = Brep([<brep referenced from the Rhino model> x3])
brep = Brep(<brep referenced from the Rhino model>)
brep_2 = Brep(<brep referenced from the Rhino model>)
comfortshadebenefit = Ladybug_ComfortShadeBenefitEvaluator(
    location=importepw.location,
    temperatures=outdoorcomfortcalculator.universalThermalClimateIndex,
    balanceTemperature="20",
    testShades=brep,
    testRegion=brep_2,
    gridSize="1",
    context=library_and_meyerson_4,
    skyResolution="4",
    delNonIntersect=False,
    parallel=Toggle(True),
    runIt=Toggle(True))  # -> out, port, sunVectors, regionTestPts, shadeMesh, legend, legendBasePoint, port_2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; plug-in component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

# ----
panel_2 = Panel(outdoorcomfortcalculator.percentOfTimeComfortable)
panel_3 = Panel(outdoorcomfortcalculator.percentComfForShortPeriod)
panel_4 = Panel(outdoorcomfortcalculator.percentHeatStress)
panel_5 = Panel(outdoorcomfortcalculator.percentColdStress)

# ---- group: Parallel Bench
brep_3 = Brep(<brep referenced from the Rhino model>)
brep_4 = Brep(<brep referenced from the Rhino model>)

library_and_meyerson_5 = Brep([<brep referenced from the Rhino model> x3])
comfortshadebenefit_2 = Ladybug_ComfortShadeBenefitEvaluator(
    location=importepw.location,
    temperatures=outdoorcomfortcalculator_2.universalThermalClimateIndex,
    balanceTemperature="20",
    testShades=brep_3,
    testRegion=brep_4,
    gridSize="1",
    context=library_and_meyerson_5,
    skyResolution="4",
    delNonIntersect=False,
    parallel=Toggle(True),
    runIt=Toggle(True))  # -> out, port, sunVectors, regionTestPts, shadeMesh, legend, legendBasePoint, port_2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; plug-in component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

# ---- group: Left Perpendicular
library_and_meyerson_6 = Brep([<brep referenced from the Rhino model> x3])
brep_5 = Brep(<brep referenced from the Rhino model>)
brep_6 = Brep(<brep referenced from the Rhino model>)
comfortshadebenefit_3 = Ladybug_ComfortShadeBenefitEvaluator(
    location=importepw.location,
    temperatures=outdoorcomfortcalculator_3.universalThermalClimateIndex,
    balanceTemperature="20",
    testShades=brep_5,
    testRegion=brep_6,
    gridSize="1",
    context=library_and_meyerson_6,
    skyResolution="4",
    delNonIntersect=False,
    parallel=Toggle(True),
    runIt=Toggle(True))  # -> out, port, sunVectors, regionTestPts, shadeMesh, legend, legendBasePoint, port_2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; plug-in component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

# ----
panel_6 = Panel(outdoorcomfortcalculator_2.percentOfTimeComfortable)
panel_7 = Panel(outdoorcomfortcalculator_2.percentComfForShortPeriod)
panel_8 = Panel(outdoorcomfortcalculator_2.percentHeatStress)
panel_9 = Panel(outdoorcomfortcalculator_2.percentColdStress)

panel_10 = Panel(comfortshadebenefit.shadeHarmfulness)
shadecreator = Honeybee_OptimalShadeCreator(shadeMesh=comfortshadebenefit.shadeMesh, shadeNetEffect=comfortshadebenefit.shadeNetEffect)  # -> out, energySavedByShade, areaOfShade, newColoredMesh, newShadeBrep; plug-in component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
panel_11 = Panel(comfortshadebenefit.shadeHelpfulness)
panel_12 = Panel(shadecreator.areaOfShade)

panel_13 = Panel(outdoorcomfortcalculator_3.percentColdStress)
panel_14 = Panel(outdoorcomfortcalculator_3.percentOfTimeComfortable)
panel_15 = Panel(outdoorcomfortcalculator_3.percentComfForShortPeriod)
panel_16 = Panel(outdoorcomfortcalculator_3.percentHeatStress)

panel_17 = Panel(comfortshadebenefit_2.shadeHarmfulness)
shadecreator_2 = Honeybee_OptimalShadeCreator(
    shadeMesh=comfortshadebenefit_2.shadeMesh,
    shadeNetEffect=comfortshadebenefit_2.shadeNetEffect,
    levelOfPerform=Slider(3, range=0..10))  # -> out, energySavedByShade, areaOfShade, newColoredMesh, newShadeBrep; plug-in component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
panel_18 = Panel(comfortshadebenefit_2.shadeHelpfulness)
panel_19 = Panel(shadecreator_2.areaOfShade)

panel_20 = Panel(comfortshadebenefit_3.shadeHarmfulness)
shadecreator_3 = Honeybee_OptimalShadeCreator(shadeMesh=comfortshadebenefit_3.shadeMesh, shadeNetEffect=comfortshadebenefit_3.shadeNetEffect)  # -> out, energySavedByShade, areaOfShade, newColoredMesh, newShadeBrep; plug-in component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
panel_21 = Panel(comfortshadebenefit_3.shadeHelpfulness)
panel_22 = Panel(shadecreator_3.areaOfShade)
