# Grasshopper definition Vyas_Janki_Melbourne_ClimateDefinitions.gh (Grasshopper 0.9.76)
# plug-ins: Python Interpreter

honeybee = Honeybee_Honeybee()  # -> out; plug-in component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
ladybug = Ladybug_Ladybug()  # -> out; plug-in component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
boolean_toggle = BooleanToggle(True)
updateladybug = Ladybug_UpdateLadybug(updateThisFile=boolean_toggle, updateAllUObjects=boolean_toggle)  # -> out; plug-in component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
updatehoneybee = Honeybee_UpdateHoneybee(sourceDirectory=boolean_toggle, updateThisFile=boolean_toggle)  # -> out; plug-in component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

# ---- group: SKYDOME
legendpar = Ladybug_LegendParameters(lowBound="0", highBound="55")  # -> legendPar; plug-in component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
point = Point(<point referenced from the Rhino model>)
skydome = Ladybug_SkyDome(centerPoint=point, legendPar=legendpar, showTotalOnly=Toggle(False), runIt=Toggle(False), bakeIt=False)  # -> out, skyPatchesMesh, baseCrvs, legend, legendBasePts, skyPatchesCenPts, skyPatchesAreas, skyPatchesAsBrep, values; plug-in component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

# ----
panel = Panel("http://apps1.eere.energy.gov/buildings/energyplus/weatherdata/5_southwest_pacific_wmo_region_5/AUS_VIC.Melbourne.948680_RMY.zip")
panel_2 = Panel("http://apps1.eere.energy.gov/buildings/energyplus/weatherdata/5_southwest_pacific_wmo_region_5/AUS_VIC.Melbourne.948680_RMY.zip")
open_epw_stat = Ladybug_OpenEPWAndSTATWeatherFiles(weatherFileURL=panel)  # -> epwFile, statFile; plug-in component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
open_epw_stat_2 = Ladybug_OpenEPWAndSTATWeatherFiles(weatherFileURL=panel_2)  # -> epwFile, statFile; plug-in component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
importepw = Ladybug_ImportEpw(epwFile=open_epw_stat.epwFile)  # -> Output, latitude, location, dryBulbTemperature, dewPointTemperature, relativeHumidity, windSpeed, windDirection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; plug-in component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
importepw_2 = Ladybug_ImportEpw(epwFile=open_epw_stat_2.epwFile)  # -> Output, latitude, location, dryBulbTemperature, dewPointTemperature, relativeHumidity, windSpeed, windDirection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; plug-in component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
analysisperiod = Ladybug_AnalysisPeriod()  # -> out, analysisPeriod; plug-in component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
solaradjusttemperature = Ladybug_OutdoorSolarTemperatureAdjustor(
    location=importepw_2.location,
    cumSkyMtxOrDirNormRad=importepw_2.directNormalRadiation,
    diffuseHorizRad=importepw_2.diffuseHorizontalRadiation,
    meanRadTemperature=importepw_2.dryBulbTemperature,
    analysisPeriodOrHOY=analysisperiod.analysisPeriod,
    runIt=Toggle(True))  # -> readMe, port, effectiveRadiantField, MRTDelta, solarAdjustedMRT, port_2, mannequinMesh, port_3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; plug-in component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
ms2mph = Ladybug_ms2mph(ms=importepw.windSpeed)  # -> mph; plug-in component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

# ---- group: WIND SPEED
windboundaryprofile = Ladybug_WindBoundaryProfile(
    windSpeed_tenMeters=ms2mph,
    windDirection=importepw.windDirection,
    terrainType="1",
    annualHourlyData=flatten(importepw.dryBulbTemperature),
    windProfileHeight="500")  # -> out, port, windSpeeds, windDirections, windVectors, vectorAnchorPts, port_2, windVectorMesh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; plug-in component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

# ---- group: SUNPATH
analysisperiod_2 = Ladybug_AnalysisPeriod()  # -> out, analysisPeriod; plug-in component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
panel_3 = Panel("""03
06
12""")
panel_4 = Panel("""09
12
15""")
panel_5 = Panel("""21
21
21""")
point_2 = Point(<point referenced from the Rhino model>)
sunpath = Ladybug_SunPath(
    north="45",
    location=importepw.location,
    hour=panel_4,
    day=panel_5,
    month=panel_3,
    timeStep=1,
    centerPt=point_2,
    sunPathScale=".5",
    sunScale="2",
    dailyOrAnnualSunPath=True)  # -> out, sunVectors, sunAltitudes, sunAzimuths, port, sunSpheresMesh, sunPathCrvs, legend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; plug-in component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
text_tag_3d = TextTag3D(
    Location=sunpath.sunPositions,
    Text=sunpath.sunPositionsInfo,
    Size="3",
    Colour=ColourSwatch(SwatchColor=RGB(255, 0, 0)),
    Justification=7)
custom_preview = CustomPreview(Geometry=sunpath.sunPathCrvs, Shader=ColourSwatch(SwatchColor=RGB(153, 153, 153)))

# ---- group: RADIATION ROSE
gencumulativeskymtx = Ladybug_GenCumulativeSkyMtx(epwFile=open_epw_stat.epwFile, skyDensity=0, useOldRes=True, runIt=Toggle(True))  # -> out, cumulativeSkyMtx; plug-in component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
analysisperiod_3 = Ladybug_AnalysisPeriod(fromMonth="12", fromDay="21", toMonth="03", toDay="20")  # -> out, analysisPeriod; plug-in component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
analysisperiod_4 = Ladybug_AnalysisPeriod(fromMonth="03", fromDay="21", toMonth="06", toDay="20")  # -> out, analysisPeriod; plug-in component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
analysisperiod_5 = Ladybug_AnalysisPeriod(fromMonth="06", fromDay="21", toMonth="09", toDay="20")  # -> out, analysisPeriod; plug-in component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
analysisperiod_6 = Ladybug_AnalysisPeriod(fromMonth="09", fromDay="21", toMonth="12", toDay="20")  # -> out, analysisPeriod; plug-in component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
selectskymtx = Ladybug_selectSkyMtx(
    cumulativeSkyMtx=gencumulativeskymtx.cumulativeSkyMtx,
    analysisPeriod=analysisperiod_3.analysisPeriod,
    removeDiffuse=False,
    removeDirect=False)  # -> out, selectedSkyMtx; plug-in component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
selectskymtx_2 = Ladybug_selectSkyMtx(
    cumulativeSkyMtx=gencumulativeskymtx.cumulativeSkyMtx,
    analysisPeriod=analysisperiod_4.analysisPeriod,
    removeDiffuse=False,
    removeDirect=False)  # -> out, selectedSkyMtx; plug-in component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
selectskymtx_3 = Ladybug_selectSkyMtx(
    cumulativeSkyMtx=gencumulativeskymtx.cumulativeSkyMtx,
    analysisPeriod=analysisperiod_6.analysisPeriod,
    removeDiffuse=False,
    removeDirect=False)  # -> out, selectedSkyMtx; plug-in component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
selectskymtx_4 = Ladybug_selectSkyMtx(
    cumulativeSkyMtx=gencumulativeskymtx.cumulativeSkyMtx,
    analysisPeriod=analysisperiod_5.analysisPeriod,
    removeDiffuse=False,
    removeDirect=False)  # -> out, selectedSkyMtx; plug-in component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
legendpar_2 = Ladybug_LegendParameters(lowBound="0", highBound="250")  # -> legendPar; plug-in component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
number_slider = Slider(1, range=0..1)
point_3 = Point(<point referenced from the Rhino model>)
point_4 = Point(<point referenced from the Rhino model>)
point_5 = Point(<point referenced from the Rhino model>)
point_6 = Point(<point referenced from the Rhino model>)
radiationrose = Ladybug_RadiationRose(
    selectedSkyMtx=selectskymtx.selectedSkyMtx,
    centerPoint=point_3,
    scale=number_slider,
    arrowHeadScale=1,
    legendPar=legendpar_2,
    runIt=Toggle(True))  # -> out, radiationArrowsMesh, radRoseBaseCrvs, legend, legendBasePts, radRoseEndPts, radRoseValues; plug-in component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
radiationrose_2 = Ladybug_RadiationRose(
    selectedSkyMtx=selectskymtx_4.selectedSkyMtx,
    centerPoint=point_6,
    scale=number_slider,
    arrowHeadScale=1,
    legendPar=legendpar_2,
    runIt=Toggle(True))  # -> out, radiationArrowsMesh, radRoseBaseCrvs, legend, legendBasePts, radRoseEndPts, radRoseValues; plug-in component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
radiationrose_3 = Ladybug_RadiationRose(
    selectedSkyMtx=selectskymtx_2.selectedSkyMtx,
    centerPoint=point_4,
    scale=number_slider,
    arrowHeadScale=1,
    legendPar=legendpar_2,
    runIt=Toggle(True))  # -> out, radiationArrowsMesh, radRoseBaseCrvs, legend, legendBasePts, radRoseEndPts, radRoseValues; plug-in component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
radiationrose_4 = Ladybug_RadiationRose(
    selectedSkyMtx=selectskymtx_3.selectedSkyMtx,
    centerPoint=point_5,
    scale=number_slider,
    arrowHeadScale=1,
    legendPar=legendpar_2,
    runIt=Toggle(True))  # -> out, radiationArrowsMesh, radRoseBaseCrvs, legend, legendBasePts, radRoseEndPts, radRoseValues; plug-in component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
custom_preview_2 = CustomPreview(
    Geometry=[radiationrose.radRoseBaseCrvs, radiationrose_3.radRoseBaseCrvs, radiationrose_2.radRoseBaseCrvs, radiationrose_4.radRoseBaseCrvs, radiationrose_3.legend, radiationrose.legend, radiationrose_2.legend, radiationrose_4.legend],
    Shader=ColourSwatch(SwatchColor=RGB(102, 102, 102)))

# ----
boolean_toggle_2 = BooleanToggle(True)

# ---- group: Hot or Cold
outdoorcomfortcalculator = Ladybug_OutdoorComfortCalculator(
    dryBulbTemperature=importepw_2.dryBulbTemperature,
    meanRadiantTemperature=solaradjusttemperature.solarAdjustedMRT,
    windSpeed_tenMeters=importepw_2.windSpeed,
    relativeHumidity=importepw_2.relativeHumidity,
    runIt=boolean_toggle_2)  # -> out, port, universalThermalClimateIndex, comfortableOrNot, thermalStress, conditionOfPerson, port_2, percentOfTimeComfortable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; plug-in component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

# ----
analysisperiod_7 = Ladybug_AnalysisPeriod(fromMonth="12", fromDay="21", toMonth="03", toDay="20")  # -> out, analysisPeriod; plug-in component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
selectandaveragedata = Ladybug_AverageData(annualHourlyData=importepw_2.dryBulbTemperature, analysisPeriod=analysisperiod_7.analysisPeriod)  # -> readMe, selHourlyData, averagedDaily, averagedMonthly, avrMonthlyPerHour, avrAnalysisPeriod; plug-in component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
selectandaveragedata_2 = Ladybug_AverageData(annualHourlyData=importepw_2.windSpeed, analysisPeriod=analysisperiod_7.analysisPeriod)  # -> readMe, selHourlyData, averagedDaily, averagedMonthly, avrMonthlyPerHour, avrAnalysisPeriod; plug-in component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
selectandaveragedata_3 = Ladybug_AverageData(annualHourlyData=solaradjusttemperature.solarAdjustedMRT, analysisPeriod=analysisperiod_7.analysisPeriod)  # -> readMe, selHourlyData, averagedDaily, averagedMonthly, avrMonthlyPerHour, avrAnalysisPeriod; plug-in component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
selectandaveragedata_4 = Ladybug_AverageData(annualHourlyData=importepw_2.relativeHumidity, analysisPeriod=analysisperiod_7.analysisPeriod)  # -> readMe, selHourlyData, averagedDaily, averagedMonthly, avrMonthlyPerHour, avrAnalysisPeriod; plug-in component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
outdoorcomfortcalculator_2 = Ladybug_OutdoorComfortCalculator(
    dryBulbTemperature=selectandaveragedata.selHourlyData,
    meanRadiantTemperature=selectandaveragedata_3.selHourlyData,
    windSpeed_tenMeters=selectandaveragedata_2.selHourlyData,
    relativeHumidity=selectandaveragedata_4.selHourlyData,
    runIt=boolean_toggle_2)  # -> out, port, universalThermalClimateIndex, comfortableOrNot, thermalStress, conditionOfPerson, port_2, percentOfTimeComfortable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; plug-in component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
gradientlibrary = Ladybug_GradientLibrary(gradIndex="12")  # -> customColors; plug-in component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
legendpar_3 = Ladybug_LegendParameters(
    lowBound="-3",
    highBound="3",
    numSegments="7",
    customColors=flatten(gradientlibrary),
    legendScale="1",
    decimalPlaces="0",
    removeLessThan=Toggle(True))  # -> legendPar; plug-in component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
_3dchart = Ladybug_3DChart(inputData=flatten(outdoorcomfortcalculator_2.conditionOfPerson), basePoint="0,1500", xScale=".25", legendPar=legendpar_3)  # -> out, graphMesh, graphCurves, legend, legendBasePts, title, titleBasePts, dataPts, conditionalHOY; plug-in component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

panel_6 = Panel(outdoorcomfortcalculator.percentOfTimeComfortable)
panel_7 = Panel(outdoorcomfortcalculator.percentHeatStress)
panel_8 = Panel(outdoorcomfortcalculator.percentColdStress)

# ---- group: Hot or Cold
analysisperiod_8 = Ladybug_AnalysisPeriod(fromMonth="03", fromDay="21", toMonth="06", toDay="20")  # -> out, analysisPeriod; plug-in component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
outdoorcomfortcalculator_3 = Ladybug_OutdoorComfortCalculator(
    dryBulbTemperature=importepw_2.dryBulbTemperature,
    meanRadiantTemperature=solaradjusttemperature.solarAdjustedMRT,
    windSpeed_tenMeters=importepw_2.windSpeed,
    relativeHumidity=importepw_2.relativeHumidity,
    analysisPeriod=analysisperiod_8.analysisPeriod,
    runIt=boolean_toggle_2)  # -> out, port, universalThermalClimateIndex, comfortableOrNot, thermalStress, conditionOfPerson, port_2, percentOfTimeComfortable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; plug-in component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
gradientlibrary_2 = Ladybug_GradientLibrary(gradIndex="12")  # -> customColors; plug-in component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
legendpar_4 = Ladybug_LegendParameters(
    lowBound="-3",
    highBound="3",
    numSegments="7",
    customColors=flatten(gradientlibrary_2),
    legendScale="1",
    decimalPlaces="0",
    removeLessThan=Toggle(True))  # -> legendPar; plug-in component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
_3dchart_2 = Ladybug_3DChart(inputData=flatten(outdoorcomfortcalculator_3.conditionOfPerson), xScale=".25", legendPar=legendpar_4)  # -> out, graphMesh, graphCurves, legend, legendBasePts, title, titleBasePts, dataPts, conditionalHOY; plug-in component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

# ----
analysisperiod_9 = Ladybug_AnalysisPeriod(fromMonth="09", fromDay="21", toMonth="12", toDay="20")  # -> out, analysisPeriod; plug-in component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
outdoorcomfortcalculator_4 = Ladybug_OutdoorComfortCalculator(
    dryBulbTemperature=importepw_2.dryBulbTemperature,
    meanRadiantTemperature=solaradjusttemperature.solarAdjustedMRT,
    windSpeed_tenMeters=importepw_2.windSpeed,
    relativeHumidity=importepw_2.relativeHumidity,
    analysisPeriod=analysisperiod_9.analysisPeriod,
    runIt=boolean_toggle_2)  # -> out, port, universalThermalClimateIndex, comfortableOrNot, thermalStress, conditionOfPerson, port_2, percentOfTimeComfortable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; plug-in component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
gradientlibrary_3 = Ladybug_GradientLibrary(gradIndex="12")  # -> customColors; plug-in component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
legendpar_5 = Ladybug_LegendParameters(
    lowBound="-3",
    highBound="3",
    numSegments="7",
    customColors=flatten(gradientlibrary_3),
    legendScale="1",
    decimalPlaces="0",
    removeLessThan=Toggle(True))  # -> legendPar; plug-in component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
_3dchart_3 = Ladybug_3DChart(inputData=flatten(outdoorcomfortcalculator_4.conditionOfPerson), basePoint="0,1000", xScale=".25", legendPar=legendpar_5)  # -> out, graphMesh, graphCurves, legend, legendBasePts, title, titleBasePts, dataPts, conditionalHOY; plug-in component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

analysisperiod_10 = Ladybug_AnalysisPeriod(fromMonth="06", fromDay="21", toMonth="09", toDay="20")  # -> out, analysisPeriod; plug-in component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
outdoorcomfortcalculator_5 = Ladybug_OutdoorComfortCalculator(
    dryBulbTemperature=importepw_2.dryBulbTemperature,
    meanRadiantTemperature=solaradjusttemperature.solarAdjustedMRT,
    windSpeed_tenMeters=importepw_2.windSpeed,
    relativeHumidity=importepw_2.relativeHumidity,
    analysisPeriod=analysisperiod_10.analysisPeriod,
    runIt=boolean_toggle_2)  # -> out, port, universalThermalClimateIndex, comfortableOrNot, thermalStress, conditionOfPerson, port_2, percentOfTimeComfortable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; plug-in component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
gradientlibrary_4 = Ladybug_GradientLibrary(gradIndex="12")  # -> customColors; plug-in component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
legendpar_6 = Ladybug_LegendParameters(
    lowBound="-3",
    highBound="3",
    numSegments="7",
    customColors=flatten(gradientlibrary_4),
    legendScale="1",
    decimalPlaces="0",
    removeLessThan=Toggle(True))  # -> legendPar; plug-in component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
_3dchart_4 = Ladybug_3DChart(inputData=flatten(outdoorcomfortcalculator_5.conditionOfPerson), basePoint="0,500", xScale=".25", legendPar=legendpar_6)  # -> out, graphMesh, graphCurves, legend, legendBasePts, title, titleBasePts, dataPts, conditionalHOY; plug-in component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

# ---- group: WIND ROSE
gradientlibrary_5 = Ladybug_GradientLibrary(gradIndex="18")  # -> customColors; plug-in component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
legendpar_7 = Ladybug_LegendParameters(lowBound="0", highBound="18", customColors=flatten(gradientlibrary_5))  # -> legendPar; plug-in component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
analysisperiod_11 = Ladybug_AnalysisPeriod(fromMonth="09", fromDay="21", toMonth="12", toDay="20")  # -> out, analysisPeriod; plug-in component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
analysisperiod_12 = Ladybug_AnalysisPeriod(fromMonth="06", fromDay="21", toMonth="09", toDay="20")  # -> out, analysisPeriod; plug-in component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
analysisperiod_13 = Ladybug_AnalysisPeriod(fromMonth="12", fromDay="21", toMonth="03", toDay="20")  # -> out, analysisPeriod; plug-in component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
analysisperiod_14 = Ladybug_AnalysisPeriod(fromMonth="03", fromDay="21", toMonth="06", toDay="20")  # -> out, analysisPeriod; plug-in component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
point_7 = Point(<point referenced from the Rhino model>)
point_8 = Point(<point referenced from the Rhino model>)
point_9 = Point(<point referenced from the Rhino model>)
point_10 = Point(<point referenced from the Rhino model>)
windrose = Ladybug_WindRose(
    north=0,
    hourlyWindDirection=importepw.windDirection,
    hourlyWindSpeed=importepw.windSpeed,
    analysisPeriod=analysisperiod_12.analysisPeriod,
    centerPoint=point_7,
    maxFrequency="25",
    legendPar=legendpar_7,
    runIt=Toggle(False))  # -> out, calmRoseMesh, windRoseMesh, windRoseCrvs, windRoseCenPts, legend, legendBasePts, title; plug-in component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
windrose_2 = Ladybug_WindRose(
    north=0,
    hourlyWindDirection=importepw.windDirection,
    hourlyWindSpeed=importepw.windSpeed,
    analysisPeriod=analysisperiod_13.analysisPeriod,
    centerPoint=point_8,
    maxFrequency="25",
    legendPar=legendpar_7,
    runIt=Toggle(True))  # -> out, calmRoseMesh, windRoseMesh, windRoseCrvs, windRoseCenPts, legend, legendBasePts, title; plug-in component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
windrose_3 = Ladybug_WindRose(
    north=0,
    hourlyWindDirection=importepw.windDirection,
    hourlyWindSpeed=importepw.windSpeed,
    analysisPeriod=analysisperiod_11.analysisPeriod,
    centerPoint=point_9,
    maxFrequency="25",
    legendPar=legendpar_7,
    runIt=Toggle(False))  # -> out, calmRoseMesh, windRoseMesh, windRoseCrvs, windRoseCenPts, legend, legendBasePts, title; plug-in component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
windrose_4 = Ladybug_WindRose(
    north=0,
    hourlyWindDirection=importepw.windDirection,
    hourlyWindSpeed=importepw.windSpeed,
    analysisPeriod=analysisperiod_14.analysisPeriod,
    centerPoint=point_10,
    maxFrequency="25",
    legendPar=legendpar_7,
    runIt=Toggle(False))  # -> out, calmRoseMesh, windRoseMesh, windRoseCrvs, windRoseCenPts, legend, legendBasePts, title; plug-in component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
custom_preview_3 = CustomPreview(
    Geometry=[windrose_2.windRoseCrvs, windrose_2.legend, windrose_4.windRoseCrvs, windrose_4.legend, windrose.windRoseCrvs, windrose.legend, windrose_3.windRoseCrvs, windrose_3.legend],
    Shader=ColourSwatch(SwatchColor=RGB(102, 102, 102)))

# ---- group: PSYCHROMETRIC CHART
solaradjusttemperature_2 = Ladybug_OutdoorSolarTemperatureAdjustor(
    location=importepw.location,
    cumSkyMtxOrDirNormRad=importepw.directNormalRadiation,
    diffuseHorizRad=importepw.diffuseHorizontalRadiation,
    meanRadTemperature=importepw.dryBulbTemperature,
    runIt=Toggle(True))  # -> readMe, port, effectiveRadiantField, MRTDelta, solarAdjustedMRT, port_2, mannequinMesh, port_3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; plug-in component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
panel_9 = Panel(solaradjusttemperature_2.solarAdjustedMRT)
ladybug_activities_met_list = Ladybug_ActivitiesMetList({"Sleeping": 0.7, "Reclining": 0.8, "Sitting": 1.0, "Typing": 1.1, "Standing": 1.2, "Driving": 1.5, "Cooking": 1.8, "House Cleaning": 2.7, "Strolling": 1.7, "Walking 2mph": 2.0, "Walking 3mph": 2.6, "Walking 4mph": 3.8, "Running 9mph": 9.5, "Lifting 10lbs": 2.1, "Lifting 100lbs": 4.0, "Shoveling": 4.4, "Dancing": 3.4, "Basketball": 6.3}, selected="Typing")
f2c = Ladybug_F2C(F=solaradjusttemperature_2.solarAdjustedMRT)  # -> C; plug-in component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
point_11 = Point(<point referenced from the Rhino model>)
psychchart = Ladybug_PsychrometricChart(
    dryBulbTemperature=importepw.dryBulbTemperature,
    relativeHumidity=importepw.relativeHumidity,
    barometricPressure=importepw.barometricPressure,
    meanRadTemperature=solaradjusttemperature_2.solarAdjustedMRT,
    metabolicRate=ladybug_activities_met_list,
    clothingLevel="1",
    basePoint=point_11,
    runIt=Toggle(True))  # -> out, port, totalComfortPercent, totalComfortOrNot, strategyNames, strategyPercentOfTime, strategyOrNot, port_2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; plug-in component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
custom_preview_4 = CustomPreview(
    Geometry=[psychchart.psychChartMesh, psychchart.chartCurvesAndTxt, psychchart.legend],
    Shader=ColourSwatch(SwatchColor=RGB(102, 102, 102)))

# ----
panel_10 = Panel(outdoorcomfortcalculator_3.percentOfTimeComfortable)
panel_11 = Panel(outdoorcomfortcalculator_3.percentHeatStress)
panel_12 = Panel(outdoorcomfortcalculator_3.percentColdStress)
panel_13 = Panel(outdoorcomfortcalculator_5.percentOfTimeComfortable)
panel_14 = Panel(outdoorcomfortcalculator_5.percentHeatStress)
panel_15 = Panel(outdoorcomfortcalculator_5.percentColdStress)
panel_16 = Panel(outdoorcomfortcalculator_2.percentHeatStress)
panel_17 = Panel(outdoorcomfortcalculator_2.percentColdStress)
panel_18 = Panel(outdoorcomfortcalculator_2.percentOfTimeComfortable)
panel_19 = Panel(outdoorcomfortcalculator_4.percentOfTimeComfortable)
panel_20 = Panel(outdoorcomfortcalculator_4.percentComfForShortPeriod)
panel_21 = Panel(outdoorcomfortcalculator_4.percentHeatStress)
panel_22 = Panel("http://apps1.eere.energy.gov/buildings/energyplus/weatherdata/5_southwest_pacific_wmo_region_5/AUS_VIC.Melbourne.948680_RMY.zip")
open_epw_stat_3 = Ladybug_OpenEPWAndSTATWeatherFiles(weatherFileURL=panel_22)  # -> epwFile, statFile; plug-in component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
panel_23 = Panel("http://apps1.eere.energy.gov/buildings/energyplus/weatherdata/5_southwest_pacific_wmo_region_5/AUS_VIC.Melbourne.948680_RMY.zip")
importepw_3 = Ladybug_ImportEpw(epwFile=open_epw_stat_3.epwFile)  # -> Output, latitude, location, dryBulbTemperature, dewPointTemperature, relativeHumidity, windSpeed, windDirection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; plug-in component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
open_epw_stat_4 = Ladybug_OpenEPWAndSTATWeatherFiles(weatherFileURL=panel_23)  # -> epwFile, statFile; plug-in component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

# ---- group: SKY COVER
analysisperiod_15 = Ladybug_AnalysisPeriod(fromMonth="03", fromDay="21", toMonth="06", toDay="20")  # -> out, analysisPeriod; plug-in component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
analysisperiod_16 = Ladybug_AnalysisPeriod(fromMonth="12", fromDay="21", toMonth="03", toDay="20")  # -> out, analysisPeriod; plug-in component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
analysisperiod_17 = Ladybug_AnalysisPeriod(fromMonth="06", fromDay="21", toMonth="09", toDay="20")  # -> out, analysisPeriod; plug-in component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
analysisperiod_18 = Ladybug_AnalysisPeriod(fromMonth="09", fromDay="21", toMonth="12", toDay="20")  # -> out, analysisPeriod; plug-in component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
selectandaveragedata_5 = Ladybug_AverageData(annualHourlyData=importepw_3.totalSkyCover, analysisPeriod=analysisperiod_16.analysisPeriod)  # -> readMe, selHourlyData, averagedDaily, averagedMonthly, avrMonthlyPerHour, avrAnalysisPeriod; plug-in component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
selectandaveragedata_6 = Ladybug_AverageData(annualHourlyData=importepw_3.totalSkyCover, analysisPeriod=analysisperiod_15.analysisPeriod)  # -> readMe, selHourlyData, averagedDaily, averagedMonthly, avrMonthlyPerHour, avrAnalysisPeriod; plug-in component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
selectandaveragedata_7 = Ladybug_AverageData(annualHourlyData=importepw_3.totalSkyCover, analysisPeriod=analysisperiod_17.analysisPeriod)  # -> readMe, selHourlyData, averagedDaily, averagedMonthly, avrMonthlyPerHour, avrAnalysisPeriod; plug-in component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
selectandaveragedata_8 = Ladybug_AverageData(annualHourlyData=importepw_3.totalSkyCover, analysisPeriod=analysisperiod_18.analysisPeriod)  # -> readMe, selHourlyData, averagedDaily, averagedMonthly, avrMonthlyPerHour, avrAnalysisPeriod; plug-in component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
gradientlibrary_6 = Ladybug_GradientLibrary(gradIndex="21")  # -> customColors; plug-in component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
legendpar_8 = Ladybug_LegendParameters(customColors=flatten(gradientlibrary_6), removeLessThan=Toggle(True))  # -> legendPar; plug-in component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
_3dchart_5 = Ladybug_3DChart(inputData=flatten(selectandaveragedata_8.selHourlyData), basePoint="30000,30000", xScale=".25", legendPar=legendpar_8)  # -> out, graphMesh, graphCurves, legend, legendBasePts, title, titleBasePts, dataPts, conditionalHOY; plug-in component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
_3dchart_6 = Ladybug_3DChart(inputData=flatten(selectandaveragedata_5.selHourlyData), basePoint="45000,30000", xScale=".25", legendPar=legendpar_8)  # -> out, graphMesh, graphCurves, legend, legendBasePts, title, titleBasePts, dataPts, conditionalHOY; plug-in component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
_3dchart_7 = Ladybug_3DChart(inputData=flatten(selectandaveragedata_6.selHourlyData), basePoint="0,30000", xScale=".25", legendPar=legendpar_8)  # -> out, graphMesh, graphCurves, legend, legendBasePts, title, titleBasePts, dataPts, conditionalHOY; plug-in component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
_3dchart_8 = Ladybug_3DChart(inputData=flatten(selectandaveragedata_7.selHourlyData), basePoint="15000,30000", xScale=".25", legendPar=legendpar_8)  # -> out, graphMesh, graphCurves, legend, legendBasePts, title, titleBasePts, dataPts, conditionalHOY; plug-in component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
custom_preview_5 = CustomPreview(
    Geometry=[_3dchart_7.graphMesh, _3dchart_7.graphCurves, _3dchart_8.graphCurves, _3dchart_8.graphMesh, _3dchart_5.graphMesh, _3dchart_5.graphCurves, _3dchart_6.graphMesh, _3dchart_6.graphCurves],
    Shader=ColourSwatch(SwatchColor=RGB(102, 102, 102)))

# ----
importepw_4 = Ladybug_ImportEpw(epwFile=open_epw_stat_4.epwFile)  # -> Output, latitude, location, dryBulbTemperature, dewPointTemperature, relativeHumidity, windSpeed, windDirection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; plug-in component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

# ---- group: AIR TEMPERATURE
analysisperiod_19 = Ladybug_AnalysisPeriod(fromMonth="03", fromDay="21", toMonth="06", toDay="20")  # -> out, analysisPeriod; plug-in component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
analysisperiod_20 = Ladybug_AnalysisPeriod(fromMonth="12", fromDay="21", toMonth="03", toDay="20")  # -> out, analysisPeriod; plug-in component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
analysisperiod_21 = Ladybug_AnalysisPeriod(fromMonth="06", fromDay="21", toMonth="09", toDay="20")  # -> out, analysisPeriod; plug-in component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
analysisperiod_22 = Ladybug_AnalysisPeriod(fromMonth="09", fromDay="21", toMonth="12", toDay="20")  # -> out, analysisPeriod; plug-in component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
c2f = Ladybug_C2F(C=importepw_3.dryBulbTemperature)  # -> F; plug-in component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
selectandaveragedata_9 = Ladybug_AverageData(annualHourlyData=c2f, analysisPeriod=analysisperiod_20.analysisPeriod)  # -> readMe, selHourlyData, averagedDaily, averagedMonthly, avrMonthlyPerHour, avrAnalysisPeriod; plug-in component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
selectandaveragedata_10 = Ladybug_AverageData(annualHourlyData=c2f, analysisPeriod=analysisperiod_19.analysisPeriod)  # -> readMe, selHourlyData, averagedDaily, averagedMonthly, avrMonthlyPerHour, avrAnalysisPeriod; plug-in component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
selectandaveragedata_11 = Ladybug_AverageData(annualHourlyData=c2f, analysisPeriod=analysisperiod_21.analysisPeriod)  # -> readMe, selHourlyData, averagedDaily, averagedMonthly, avrMonthlyPerHour, avrAnalysisPeriod; plug-in component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
selectandaveragedata_12 = Ladybug_AverageData(annualHourlyData=c2f, analysisPeriod=analysisperiod_22.analysisPeriod)  # -> readMe, selHourlyData, averagedDaily, averagedMonthly, avrMonthlyPerHour, avrAnalysisPeriod; plug-in component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
gradientlibrary_7 = Ladybug_GradientLibrary(gradIndex="12")  # -> customColors; plug-in component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
legendpar_9 = Ladybug_LegendParameters(lowBound="30", highBound="100", numSegments="8", customColors=flatten(gradientlibrary_7), removeLessThan=Toggle(True))  # -> legendPar; plug-in component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
_3dchart_9 = Ladybug_3DChart(inputData=flatten(selectandaveragedata_10.selHourlyData), xScale=".25", legendPar=legendpar_9)  # -> out, graphMesh, graphCurves, legend, legendBasePts, title, titleBasePts, dataPts, conditionalHOY; plug-in component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
_3dchart_10 = Ladybug_3DChart(inputData=flatten(selectandaveragedata_11.selHourlyData), basePoint="15000,0", xScale=".25", legendPar=legendpar_9)  # -> out, graphMesh, graphCurves, legend, legendBasePts, title, titleBasePts, dataPts, conditionalHOY; plug-in component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
_3dchart_11 = Ladybug_3DChart(inputData=flatten(selectandaveragedata_12.selHourlyData), basePoint="30000,0", xScale=".25", legendPar=legendpar_9)  # -> out, graphMesh, graphCurves, legend, legendBasePts, title, titleBasePts, dataPts, conditionalHOY; plug-in component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
_3dchart_12 = Ladybug_3DChart(inputData=flatten(selectandaveragedata_9.selHourlyData), basePoint="45000,0", xScale=".25", legendPar=legendpar_9)  # -> out, graphMesh, graphCurves, legend, legendBasePts, title, titleBasePts, dataPts, conditionalHOY; plug-in component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
custom_preview_6 = CustomPreview(
    Geometry=[_3dchart_12.graphCurves, _3dchart_12.legend, _3dchart_11.graphCurves, _3dchart_11.legend, _3dchart_10.graphCurves, _3dchart_10.legend, _3dchart_9.legend, _3dchart_9.graphCurves],
    Shader=ColourSwatch(SwatchColor=RGB(102, 102, 102)))

# ----
c2f_2 = Ladybug_C2F(C=importepw_4.dryBulbTemperature)  # -> F; plug-in component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
cdd_hdd = Ladybug_CDD_HDD(hourlyDryBulbTemperature=c2f_2, coolingBaseTemperature="75", heatingBaseTemperature="50")  # -> out, daily_coolingDegDays, daily_heatingDegDays, monthly_coolingDegDays, monthly_heatingDegDays, annual_coolingDegDays, annual_heatingDegDays; plug-in component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
panel_24 = Panel(cdd_hdd.monthly_coolingDegDays)
gradientlibrary_8 = Ladybug_GradientLibrary(gradIndex="11")  # -> customColors; plug-in component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
legendpar_10 = Ladybug_LegendParameters()  # -> legendPar; plug-in component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
barchart = Ladybug_MonthlyBarChart(
    inputData=flatten([cdd_hdd.monthly_heatingDegDays, cdd_hdd.monthly_coolingDegDays]),
    stackValues=Toggle(False),
    altTitle="MONTHLY HEATING/COOLING DEGREE DAYS",
    altYAxisTitle="DEGREE DAYS",
    legendPar=legendpar_10)  # -> out, dataMesh, dataCurves, dataCrvColors, graphAxes, graphLabels, title, titleBasePt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; plug-in component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

# ---- group: RELATIVE HUMIDITY
analysisperiod_23 = Ladybug_AnalysisPeriod(fromMonth="03", fromDay="21", toMonth="06", toDay="20")  # -> out, analysisPeriod; plug-in component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
analysisperiod_24 = Ladybug_AnalysisPeriod(fromMonth="12", fromDay="21", toMonth="03", toDay="20")  # -> out, analysisPeriod; plug-in component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
analysisperiod_25 = Ladybug_AnalysisPeriod(fromMonth="06", fromDay="21", toMonth="09", toDay="20")  # -> out, analysisPeriod; plug-in component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
analysisperiod_26 = Ladybug_AnalysisPeriod(fromMonth="09", fromDay="21", toMonth="12", toDay="20")  # -> out, analysisPeriod; plug-in component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
selectandaveragedata_13 = Ladybug_AverageData(annualHourlyData=importepw_3.relativeHumidity, analysisPeriod=analysisperiod_24.analysisPeriod)  # -> readMe, selHourlyData, averagedDaily, averagedMonthly, avrMonthlyPerHour, avrAnalysisPeriod; plug-in component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
selectandaveragedata_14 = Ladybug_AverageData(annualHourlyData=importepw_3.relativeHumidity, analysisPeriod=analysisperiod_23.analysisPeriod)  # -> readMe, selHourlyData, averagedDaily, averagedMonthly, avrMonthlyPerHour, avrAnalysisPeriod; plug-in component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
selectandaveragedata_15 = Ladybug_AverageData(annualHourlyData=importepw_3.relativeHumidity, analysisPeriod=analysisperiod_25.analysisPeriod)  # -> readMe, selHourlyData, averagedDaily, averagedMonthly, avrMonthlyPerHour, avrAnalysisPeriod; plug-in component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
selectandaveragedata_16 = Ladybug_AverageData(annualHourlyData=importepw_3.relativeHumidity, analysisPeriod=analysisperiod_26.analysisPeriod)  # -> readMe, selHourlyData, averagedDaily, averagedMonthly, avrMonthlyPerHour, avrAnalysisPeriod; plug-in component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
legendpar_11 = Ladybug_LegendParameters(lowBound="60", highBound="100", numSegments="9", customColors=flatten(gradientlibrary_8), removeLessThan=Toggle(True))  # -> legendPar; plug-in component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
_3dchart_13 = Ladybug_3DChart(inputData=flatten(selectandaveragedata_14.selHourlyData), basePoint="0,15000", xScale=".25", legendPar=legendpar_11)  # -> out, graphMesh, graphCurves, legend, legendBasePts, title, titleBasePts, dataPts, conditionalHOY; plug-in component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
_3dchart_14 = Ladybug_3DChart(inputData=flatten(selectandaveragedata_15.selHourlyData), basePoint="15000,15000", xScale=".25", legendPar=legendpar_11)  # -> out, graphMesh, graphCurves, legend, legendBasePts, title, titleBasePts, dataPts, conditionalHOY; plug-in component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
_3dchart_15 = Ladybug_3DChart(inputData=flatten(selectandaveragedata_16.selHourlyData), basePoint="30000,15000", xScale=".25", legendPar=legendpar_11)  # -> out, graphMesh, graphCurves, legend, legendBasePts, title, titleBasePts, dataPts, conditionalHOY; plug-in component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
_3dchart_16 = Ladybug_3DChart(inputData=flatten(selectandaveragedata_13.selHourlyData), basePoint="45000,15000", xScale=".25", legendPar=legendpar_11)  # -> out, graphMesh, graphCurves, legend, legendBasePts, title, titleBasePts, dataPts, conditionalHOY; plug-in component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
custom_preview_7 = CustomPreview(
    Geometry=[_3dchart_16.graphCurves, _3dchart_16.legend, _3dchart_15.graphCurves, _3dchart_15.legend, _3dchart_14.graphCurves, _3dchart_14.legend, _3dchart_13.legend, _3dchart_13.graphCurves],
    Shader=ColourSwatch(SwatchColor=RGB(102, 102, 102)))
