# Grasshopper definition Vyas_Janki_Melbourne_DaylightDefinition.gh (Grasshopper 0.9.76)
# plug-ins: Python Interpreter

ladybug = Ladybug_Ladybug()  # -> Vviiiiiiiiiizzz; plug-in component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
honeybee = Honeybee_Honeybee()  # -> Vviiiiiiiiiizzz; plug-in component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
toggle = BooleanToggle(False)
toggle_2 = BooleanToggle(False)
updateladybug = Ladybug_UpdateLadybug(updateThisFile=toggle, updateAllUObjects=toggle)  # -> readMe; plug-in component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
updatehoneybee = Honeybee_UpdateHoneybee(updateThisFile=toggle_2, updateAllUObjects=toggle_2)  # -> readMe; plug-in component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
panel = Panel(updateladybug)
panel_2 = Panel(updatehoneybee)
panel_3 = Panel("http://apps1.eere.energy.gov/buildings/energyplus/weatherdata/5_southwest_pacific_wmo_region_5/AUS_VIC.Melbourne.948680_RMY.zip")
number_slider = Slider(270, range=0..360)

# ---- group: furniture
furniture = Brep([<brep referenced from the Rhino model> x12])

# ---- group: glass facade
glass = Brep(<brep referenced from the Rhino model>)

# ---- group: ceiling
ceiling = Brep([<brep referenced from the Rhino model> x2])

# ---- group: floor
floor = Brep(<brep referenced from the Rhino model>)

# ----
radopaquematerial = Honeybee_RadianceOpaqueMaterial(materialName="generic_35", RReflectance=".35", GReflectance=".35", BReflectance=".35", roughness=0.05, specularity=0)  # -> avrgRef, RADMaterial; plug-in component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
radglassmaterial = Honeybee_RadianceGlassMaterial(materialName="glass_.65", RTransmittance=".65", GTransmittance=".65", BTransmittance=".65", refractiveIndex=1.52)  # -> avrgTrans, RADMaterial; plug-in component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
ledge = Brep(<brep referenced from the Rhino model>)
# Geometry Preparation
walls = Brep([<brep referenced from the Rhino model> x2])
createhbsrfs = Honeybee_createHBSrfs(geometry=[ledge, furniture], RADMaterial=radopaquematerial.RADMaterial)  # -> readMe, simplify(HBSurface); plug-in component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
createhbsrfs_2 = Honeybee_createHBSrfs(geometry=glass, RADMaterial=radglassmaterial.RADMaterial)  # -> readMe, simplify(HBSurface); plug-in component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
createhbsrfs_3 = Honeybee_createHBSrfs(geometry=floor, srfType="2")  # -> readMe, simplify(HBSurface); plug-in component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
createhbsrfs_4 = Honeybee_createHBSrfs(geometry=ceiling, srfType="3")  # -> readMe, simplify(HBSurface); plug-in component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
createhbsrfs_5 = Honeybee_createHBSrfs(geometry=walls, srfType="0")  # -> readMe, simplify(HBSurface); plug-in component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

shading_device_2 = Brep([<brep referenced from the Rhino model> x14])
shading_device_1 = Brep([<brep referenced from the Rhino model> x12])

radopaquematerial_2 = Honeybee_RadianceOpaqueMaterial(materialName="Red Oak", RReflectance=".35", GReflectance=".35", BReflectance=".35", roughness=0.05, specularity=0)  # -> avrgRef, RADMaterial; plug-in component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
shading_device_3 = Brep([<brep referenced from the Rhino model> x2])
createhbsrfs_6 = Honeybee_createHBSrfs(geometry=shading_device_1, RADMaterial=radopaquematerial_2.RADMaterial)  # -> readMe, simplify(HBSurface); plug-in component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

northarrow = Ladybug_North(north=number_slider, scale=".05")  # -> northSign; plug-in component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
open_epw_stat = Ladybug_OpenEPWAndSTATWeatherFiles(weatherFileURL=panel_3)  # -> epwFile, statFile; plug-in component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

test_surfaces = Brep(<brep referenced from the Rhino model>)
flip = Flip(Surface=test_surfaces)  # -> Surface, Result
gentestpts = Honeybee_GenerateTestPoints(testGeometry=flip.Surface, gridSize=Slider(0.3, range=0..1), distBaseSrf=".762", moveTestMesh=True)  # -> out, simplify(testPoints), simplify(ptsVectors), simplify(facesArea), simplify(mesh); plug-in component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

genclimatebasedsky = Honeybee_GenerateClimateBasedSky(north=number_slider, weatherFile=open_epw_stat.epwFile, month="03", day="21", hour="12")  # -> radiationValues, skyFilePath; plug-in component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
doy_hoy = Ladybug_DOY_HOY(days="21", months="03", hours="12")  # -> HOY, DOY, date; plug-in component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
importlocation = Ladybug_ImportLocation(epwFile=open_epw_stat.epwFile)  # -> location; plug-in component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

# ---- group: collect all honeybee surfaces
brep = Brep(flatten([createhbsrfs_5.HBSurface, createhbsrfs_4.HBSurface, createhbsrfs_3.HBSurface, createhbsrfs.HBSurface, createhbsrfs_2.HBSurface, createhbsrfs_6.HBSurface]))

# ----
explodelocation = Ladybug_DecomposeLocation(location=importlocation)  # -> locationName, latitude, longitude, timeZone, elevation; plug-in component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

# ----
# Analysis Recipe
# Run the analysis
# Result Visualization
radparameters = Honeybee_RADParameters(quality=0)  # -> readMe, radParameters; plug-in component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
annualdaylightsimulation = Honeybee_AnnualDaylightSimulation(
    north=number_slider,
    epwWeatherFile=open_epw_stat.epwFile,
    testPoints=gentestpts.testPoints,
    ptsVectors=gentestpts.ptsVectors,
    testMesh=gentestpts.mesh,
    radParameters=radparameters.radParameters)  # -> analysisRecipe; plug-in component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
panel_4 = Panel(radparameters.readMe)
boolean_toggle = BooleanToggle(True)
rundaylightanalysis = Honeybee_RunDaylightSimulation(
    HBObjects=flatten(brep),
    analysisRecipe=annualdaylightsimulation,
    writeRad=boolean_toggle,
    runRad=boolean_toggle,
    numOfCPUs="4",
    radFileName=doy_hoy.date,
    overwriteResults=True)  # -> out, analysisType, resultsUnit, results, testPts, annual_analysis_files, radGeoFile, studyFolder, done; plug-in component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
occupancygenerator = Honeybee_DaysimOccupancyGenerator(weekendDays=[1, 2], writeTheOcc=Toggle(True))  # -> occupancyFile; plug-in component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
gradientlibrary = Ladybug_GradientLibrary(gradIndex="1")  # -> customColors; plug-in component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
legendpar = Ladybug_LegendParameters(
    lowBound="0",
    highBound="100",
    numSegments="11",
    customColors=flatten(gradientlibrary),
    legendLocation="8,1",
    legendScale=".75",
    decimalPlaces="0",
    removeLessThan=Toggle(True))  # -> legendPar; plug-in component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
readannualresultsi = Honeybee_ReadAnnualResultI(
    illFilesAddress=rundaylightanalysis.annual_analysis_files,
    testPoints=simplify(rundaylightanalysis.testPts),
    occupancyFiles=occupancygenerator,
    DLAIllumThresholds=300,
    runIt=Toggle(True))  # -> DLA, UDLI_Less_100, UDLI_100_2000, UDLI_More_2000, CDA, sDA, annualProfiles, htmReport; plug-in component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
recolormesh = Ladybug_RecolorMesh(
    analysisResult=readannualresultsi.UDLI_More_2000,
    inputMesh=gentestpts.mesh,
    legendPar=legendpar,
    analysisTitle=[">2000", "USEFUL DAYLIGHT ILLUMINANCE"],
    legendTitle="% (lux)")  # -> out, newMesh, newLegend, legendBasePt, meshColors, legendColors; plug-in component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
panel_5 = Panel(readannualresultsi.sDA)

convertepschvalues = Honeybee_ConvertEnergyPlusScheduleToValues(schName=occupancygenerator)  # -> values; plug-in component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
_3dchart = Ladybug_3DChart(inputData=flatten(convertepschvalues))  # -> out, graphMesh, graphCurves, legend, legendBasePts, title, titleBasePts, dataPts, conditionalHOY; plug-in component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

radparameters_2 = Honeybee_RADParameters(quality=0, ab="3")  # -> readMe, radParameters; plug-in component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
gridbasedsimulation = Honeybee_GridBasedSimulation(
    skyFile=genclimatebasedsky.skyFilePath,
    testPoints=gentestpts.testPoints,
    ptsVectors=gentestpts.ptsVectors,
    testMesh=gentestpts.mesh,
    simulationType=0,
    radParameters=radparameters_2.radParameters)  # -> analysisRecipe; plug-in component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
panel_6 = Panel(radparameters_2.readMe)
toggle_3 = BooleanToggle(False)
rundaylightanalysis_2 = Honeybee_RunDaylightSimulation(
    HBObjects=flatten(brep),
    analysisRecipe=gridbasedsimulation,
    writeRad=toggle_3,
    runRad=toggle_3,
    numOfCPUs="4",
    radFileName=doy_hoy.date,
    overwriteResults=True)  # -> readMe, analysisType, resultsUnit, results, testPts, resultFiles, radGeoFile, studyFolder, done; plug-in component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
panel_7 = Panel(rundaylightanalysis_2.studyFolder)
gradientlibrary_2 = Ladybug_GradientLibrary(gradIndex="1")  # -> customColors; plug-in component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
legendpar_2 = Ladybug_LegendParameters(
    lowBound="0",
    highBound="2000",
    customColors=flatten(gradientlibrary_2),
    legendLocation="8,1",
    legendScale=".75",
    decimalPlaces="0",
    removeLessThan=Toggle(False))  # -> legendPar; plug-in component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
dom = ConstructDomain(DomainStart="-.5", DomainEnd=".5")

# ---- group: Study Title
merge = Merge(
    Data2=flatten(rundaylightanalysis_2.analysisType),
    Data3=flatten(doy_hoy.date),
    Data4=flatten(explodelocation.locationName))
join = TextJoin(Text=merge)
panel_8 = Panel(join)

# ----
recolormesh_2 = Ladybug_ReColorMesh(
    analysisResult=rundaylightanalysis_2.results,
    inputMesh=gentestpts.mesh,
    heightDomain=dom,
    legendPar=legendpar_2,
    analysisTitle=join,
    legendTitle=rundaylightanalysis_2.resultsUnit)  # -> readMe, newMesh, newLegend, legendBasePt, meshColors, legendColors; plug-in component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
