# Grasshopper definition Vyas_Janki_Melbourne_EnergyDaylightDefinition_Design270.gh (Grasshopper 0.9.76)
# plug-ins: Python Interpreter

honeybee = Honeybee_Honeybee()  # -> Vviiiiiiiiiizzz; plug-in component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
ladybug = Ladybug_Ladybug()  # -> Vviiiiiiiiiizzz; plug-in component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
toggle = BooleanToggle(True)

# ---- group: GEOMETRY / ceiling
ceiling = Brep([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])

# ---- group: GEOMETRY / floor
floor = Brep(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)

# ---- group: GEOMETRY
# Geometry Preparation
wall_surface_with_opening = Brep(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)
createhbsrfs = Honeybee_createHBSrfs(geometry=wall_surface_with_opening, srfType="0")  # -> readMe, simplify(HBSurface); plug-in component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
exterior_wall = Brep(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)
walls = Brep([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])
ledge = Brep(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)
glass = Brep(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)
preview = CustomPreview(Geometry=exterior_wall, Shader=ColourSwatch(SwatchColor=RGB(255, 0, 0)))
addhbglz = Honeybee_addHBGlz(HBObj=createhbsrfs.HBSurface, childSurfaces=flatten(glass))  # -> simplify(HBObjWGLZ); plug-in component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
createhbsrfs_2 = Honeybee_createHBSrfs(geometry=flatten(exterior_wall), srfType="0")  # -> readMe, simplify(HBSurface); plug-in component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
preview_2 = CustomPreview(Geometry=glass, Shader=ColourSwatch(SwatchColor=RGBA(80, 222, 255, 160)))
createhbsrfs_3 = Honeybee_createHBSrfs(geometry=flatten(ledge), srfType="2")  # -> readMe, simplify(HBSurface); plug-in component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
createhbsrfs_4 = Honeybee_createHBSrfs(geometry=flatten(floor), srfType="2")  # -> readMe, simplify(HBSurface); plug-in component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
createhbsrfs_5 = Honeybee_createHBSrfs(geometry=ceiling, srfType="3")  # -> readMe, simplify(HBSurface); plug-in component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
createhbsrfs_6 = Honeybee_createHBSrfs(geometry=walls, srfType="0")  # -> readMe, simplify(HBSurface); plug-in component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

# ----
updatehoneybee = Honeybee_UpdateHoneybee(updateThisFile=toggle, updateAllUObjects=toggle)  # -> out; plug-in component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
updateladybug = Ladybug_UpdateLadybug(updateThisFile=toggle, updateAllUObjects=toggle)  # -> out; plug-in component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
flip = Flip(Surface=floor)  # -> Surface, Result
panel = Panel("http://apps1.eere.energy.gov/buildings/energyplus/weatherdata/5_southwest_pacific_wmo_region_5/AUS_VIC.Melbourne.948680_RMY.zip")

# ---- group: GEOMETRY / collect all honeybee surfaces
brep = Brep(flatten([addhbglz, createhbsrfs_3.HBSurface, createhbsrfs_2.HBSurface, createhbsrfs_6.HBSurface, createhbsrfs_5.HBSurface, createhbsrfs_4.HBSurface]))

# ---- group: ZONE PROGRAM
bldgprograms = Honeybee_bldgPrograms({"Office": 0, "Retail": 1, "MidriseApartment": 2, "PrimarySchool": 3, "SecondarySchool": 4, "SmallHotel": 5, "LargeHotel": 6, "Hospital": 7, "Outpatient": 8, "Warehouse": 9, "SuperMarket": 10, "FullServiceRestaurant": 11, "QuickServiceRestaurant": 12}, selected="MidriseApartment")
listzoneprograms = Honeybee_ListZonePrograms(bldgProgram=bldgprograms)  # -> MidriseApartmentZonePrograms; plug-in component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
item = ListItem(List=listzoneprograms, Index=0, Wrap=True)
panel_2 = Panel(item)
createhbzones = Honeybee_createHBZones(name="Designcase Residence", zoneProgram=item, HBSurfaces=flatten(brep), isConditioned=Toggle(False))  # -> readMe, HBZone; plug-in component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
wires = BrepWireframe(Brep=createhbzones.HBZone, Density=-1)

# ----
gentestpts = Honeybee_GenerateTestPoints(testGeometry=flip.Surface, gridSize=".5", distBaseSrf=".762", moveTestMesh=True)  # -> out, simplify(testPoints), simplify(ptsVectors), simplify(facesArea), simplify(mesh); plug-in component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
open_epw_stat = Ladybug_OpenEPWAndSTATWeatherFiles(weatherFileURL=panel)  # -> epwFile, statFile; plug-in component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

# ---- group: DAYLIGHT RECIPE AND SIMULATION
number_slider = Slider(270, range=0..360)
radparameters = Honeybee_RADParameters(quality=0)  # -> readMe, radParameters; plug-in component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
northarrow = Ladybug_North(north=number_slider, scale=".05")  # -> northSign; plug-in component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
annualdaylightsimulation = Honeybee_AnnualDaylightSimulation(
    north=number_slider,
    epwWeatherFile=open_epw_stat.epwFile,
    testPoints=gentestpts.testPoints,
    ptsVectors=gentestpts.ptsVectors,
    testMesh=gentestpts.mesh,
    radParameters=radparameters.radParameters)  # -> analysisRecipe; plug-in component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
panel_3 = Panel("D:\OneDrive - PennO365\01_ARCH 753 Bldg Perf Sim\P1_Climate Report\Melbourne\Baseline Images\Daylighting")
# Run Annual Daylight
toggle_2 = BooleanToggle(True)
rundaylightanalysis = Honeybee_RunDaylightSimulation(
    HBObjects=flatten(createhbzones.HBZone),
    analysisRecipe=annualdaylightsimulation,
    writeRad=toggle_2,
    runRad=toggle_2,
    numOfCPUs=Slider(8, range=0..10),
    workingDir=panel_3,
    overwriteResults=True)  # -> readMe, analysisType, resultsUnit, results, testPts, annual_analysis_files, radGeoFile, studyFolder, done; plug-in component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

# ----
importepw = Ladybug_ImportEpw(epwFile=open_epw_stat.epwFile)  # -> Output, latitude, location, dryBulbTemperature, dewPointTemperature, relativeHumidity, windSpeed, windDirection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; plug-in component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

# ---- group: NIGHT FLUSH
panel_4 = Panel("""1
1
1
1
1
1
1
0
0
0
0
0
0
0
0
0
0
0
0
0
0
1
1
1""")
duplicate_data = DuplicateData(Data=panel_4, Number=365, Order=True)
csvschedule = Honeybee_CreateCSVSchedule(values=duplicate_data, scheduleName="NightFlushSched", writeFile=Toggle(False))  # -> readMe, csvSchedule; plug-in component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
setepnatvent = Honeybee_SetEPAirFlow(
    HBZones=createhbzones.HBZone,
    naturalVentilationType="3",
    minIndoorTempForNatVent="20",
    maxOutdoorTempForNatVent="24",
    openingAreaFractionalSched=csvschedule.csvSchedule,
    fanFlowRate="0.5")  # -> readMe, simplify(HBZones); plug-in component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

# ----
panel_5 = Panel("""3
6
12""")
panel_6 = Panel("""3
6
12""")
analysisperiod = Ladybug_AnalysisPeriod(fromMonth=panel_5, fromDay="21", fromHour="0", toMonth=panel_6, toDay="21", toHour="24")  # -> out, analysisPeriod; plug-in component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
c2f = Ladybug_C2F(C=importepw.dryBulbTemperature)  # -> F; plug-in component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
selectandaveragedata = Ladybug_AverageData(annualHourlyData=c2f, analysisPeriod=analysisperiod.analysisPeriod)  # -> readMe, selHourlyData, averagedDaily, averagedMonthly, avrMonthlyPerHour, avrAnalysisPeriod; plug-in component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
separatedata = Ladybug_SeparateData(inputList=flatten(selectandaveragedata.selHourlyData))  # -> numbers, strings; plug-in component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
range = Range(Domain=separatedata.numbers, Steps="1")
panel_7 = Panel(selectandaveragedata.averagedDaily)

# ---- group: WINDOW VENTILATION
zoneattributelist = Honeybee_ZoneAttributeList({"Name": "name", "Zone Program": "zoneProgram", "Zone Floor Area": "zoneFloorArea", "Zone Volume": "zoneVolume", "Building Program": "bldgProgram", "Is Conditioned": "isConditioned", "Occupancy Schedule": "occupancySchedule", "Occupancy Activity Schedule": "occupancyActivitySch", "Heating SetPoint Schedule": "heatingSetPtSchedule", "Cooling SetPoint Schedule": "coolingSetPtSchedule"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}, selected="Natural Ventilation": "natVent")
setepnatvent_2 = Honeybee_SetEPAirFlow(HBZones=createhbzones.HBZone, naturalVentilationType="1", minIndoorTempForNatVent="24", maxOutdoorTempForNatVent="28")  # -> readMe, simplify(HBZones); plug-in component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
labelzones = Honeybee_LabelZones(HBZones=flatten(setepnatvent_2.HBZones), attribute=zoneattributelist)  # -> zoneTxtLabels, labelBasePts, brepTxtLabels, zoneWireFrames; plug-in component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

# ----
panel_8 = Panel("""9
12
15""")
panel_9 = Panel("""21
21
21""")
panel_10 = Panel("""3
6
12""")
pt = Point(<point referenced from the Rhino model>)
sunpath = Ladybug_SunPath(
    north=number_slider,
    location=importepw.location,
    hour=panel_8,
    day=panel_9,
    month=panel_10,
    timeStep=1,
    centerPt=pt,
    sunPathScale=".1",
    dailyOrAnnualSunPath=Toggle(True))  # -> out, sunVectors, sunAltitudes, sunAzimuths, port, sunSpheresMesh, sunPathCrvs, legend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; plug-in component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

callfromepconstrlibrary = Honeybee_CallFromEPConstructionLibrary()  # -> ThermMaterials, EPMaterials, EPWindowMaterials, EPConstructions; plug-in component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
searchepconstruction = Honeybee_SearchEPConstruction(EPConstrList=callfromepconstrlibrary.EPConstructions, standard="ashrae 189.1", climateZone="4c", surfaceType="FLOOR")  # -> EPSelectedConstr; plug-in component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

callfromepconstrlibrary_2 = Honeybee_CallFromEPConstructionLibrary()  # -> ThermMaterials, EPMaterials, EPWindowMaterials, EPConstructions; plug-in component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
searchepconstruction_2 = Honeybee_SearchEPConstruction(
    EPConstrList=callfromepconstrlibrary_2.EPConstructions,
    standard="ashrae 189.1",
    climateZone="4c",
    surfaceType="ROOF",
    keywords="METAL")  # -> EPSelectedConstr; plug-in component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

# ---- group: WALL CONSTRUCTION NOT USED
callfromepconstrlibrary_3 = Honeybee_CallFromEPConstructionLibrary()  # -> ThermMaterials, EPMaterials, EPWindowMaterials, EPConstructions; plug-in component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
searchepconstruction_3 = Honeybee_SearchEPConstruction(
    EPConstrList=callfromepconstrlibrary_3.EPConstructions,
    standard="ashrae 189.1",
    climateZone="4c",
    surfaceType="WALL",
    keywords="metal")  # -> EPSelectedConstr; plug-in component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
cherry_picker = CherryPicker(searchepconstruction_3, ListIndex=0)

# ---- group: ALT WALL CONSTRUCTION
callfromepconstrlibrary_4 = Honeybee_CallFromEPConstructionLibrary()  # -> ThermMaterials, EPMaterials, EPWindowMaterials, EPConstructions; plug-in component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
searchepconstruction_4 = Honeybee_SearchEPConstruction(
    EPConstrList=callfromepconstrlibrary_4.EPConstructions,
    standard="ashrae 90.1-2010",
    climateZone="4",
    surfaceType="WALL",
    keywords="MASS ALT-RES")  # -> EPSelectedConstr; plug-in component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

# ---- group: SHADING STRUCTURE
shade_2 = Brep([<brep referenced from the Rhino model> x19])
shade_3 = Brep([<brep referenced from the Rhino model> x2])
shade = Brep([<brep referenced from the Rhino model> x30])
hb_epcontextsrf = HoneybeeEPContextSurfaces(shdSurfaces=flatten(shade))  # -> HBContext; inputs shdSurfaces: list of Brep, justBoundingBox: Boolean
# ---------- hb_epcontextsrf: Python ----------
"""
prepare shading/context geometries

    Args:
        northVectorOrRotation: A vector that shows North or a number that shows
                               the rotation of the North from the Y axis
        bldgMasses: List of closed Breps as thermal zones.
    Returns:
        report: ...
        thermalZones: Thermal zone's geometries for visualiza
"""

ghenv.Component.Name = 'Honeybee EP context Surfaces'
ghenv.Component.NickName = 'HB_EPContextSrf'
ghenv.Component.Message = 'VER 0.0.58\nNOV_20_2015'
ghenv.Component.Category = "Honeybee"
ghenv.Component.SubCategory = "09 | Energy | Energy"
#compatibleHBVersion = VER 0.0.57\nNOV_01_2015
#compatibleLBVersion = VER 0.0.59\nFEB_01_2015
ghenv.Component.AdditionalHelpFromDocStrings = "2"

import rhinoscriptsyntax as rs
import Rhino as rc
import scriptcontext as sc
import os
import System
import Grasshopper.Kernel as gh
import uuid

tolerance = sc.doc.ModelAbsoluteTolerance
import math


def main(shdSurfaces, EPTransSchedule, meshingSettings, justBoundingBox):
    
    # import the classes
    if sc.sticky.has_key('honeybee_release'):

        try:
            if not sc.sticky['honeybee_release'].isCompatible(ghenv.Component): return -1
        except:
            warning = "You need a newer version of Honeybee to use this compoent." + \
            " Use updateHoneybee component to update userObjects.\n" + \
            "If you have already updated userObjects drag Honeybee_Honeybee component " + \
            "into canvas and try again."
            w = gh.GH_RuntimeMessageLevel.Warning
            ghenv.Component.AddRuntimeMessage(w, warning)
            return -1
        
        # don't customize this part
        hb_EPSrf = sc.sticky["honeybee_EPSurface"]
        hb_EPSHDSurface = sc.sticky["honeybee_EPShdSurface"]
        hb_RADMaterialAUX = sc.sticky["honeybee_RADMaterialAUX"]
        hb_EPObjectsAux = sc.sticky["honeybee_EPObjectsAUX"]()
        HBScheduleList = sc.sticky["honeybee_ScheduleLib"].keys()

        ########################################################################
        #----------------------------------------------------------------------#
        shdBreps = []
        # create bounding box of shading geometries
        if justBoundingBox:
            for brep in shdSurfaces:
                if brep.Faces.Count>1 or not brep.Faces[0].IsPlanar(sc.doc.ModelAbsoluteTolerance):
                    shdBreps.append(brep.GetBoundingBox(True).ToBrep())
                else:
                    shdBreps.append(brep)
        else:
            shdBreps = shdSurfaces
        
        shadingClasses = []
        shadingMeshPreview = []
        
        if meshingSettings == None:
            mp = rc.Geometry.MeshingParameters.Minimal
            mp.SimplePlanes = True
        else:
            mp = meshingSettings
        
        def getRadMaterialName(radMaterial):
            nameStr = radMaterial.split(" ")[2]
            name =  nameStr.split("\n")[0]
            return name
        
        for brepCount, brep in enumerate(shdBreps):
            if brep != None:
                isPlanar = True
                # check planarity
                for face in brep.Faces:
                    if not face.IsPlanar(tolerance):
                        isPlanar = False
                        break
                
                shadingBreps = []
                if not isPlanar:
                    meshArray = rc.Geometry.Mesh.CreateFromBrep(brep, mp)
                    for mesh in meshArray:
                        for meshFace in range(mesh.Faces.Count):
                            vertices = list(mesh.Faces.GetFaceVertices(meshFace))[1:]
                            vertices = vertices + [sc.doc.ModelAbsoluteTolerance]
                            # create the brep from mesh
                            shdBrep = rc.Geometry.Brep.CreateFromCornerPoints(*vertices)
                            shadingBreps.append(shdBrep)
                else:
                    for face in brep.Faces:
                        shadingBreps.append(face.DuplicateFace(False))
                
                for faceCount, shdBrep in enumerate(shadingBreps):
                        thisShading = hb_EPSHDSurface(shdBrep, 1000*brepCount + faceCount, 'shdSrf_' + `brepCount` + '_' + `faceCount` + "_" + str(uuid.uuid4()))
                        
                        # add transmittance schedule if any
                        if EPTransSchedule!=None:
                            schedule= EPTransSchedule.upper()
                            if schedule!=None and not schedule.lower().endswith(".csv") and schedule not in HBScheduleList:
                                msg = "Cannot find " + schedule + " in Honeybee schedule library."
                                print msg
                                ghenv.Component.AddRuntimeMessage(gh.GH_RuntimeMessageLevel.Warning, msg)
                                return -1
                            elif schedule!=None and schedule.lower().endswith(".csv"):
                                # check if csv file is existed
                                if not os.path.isfile(schedule):
                                    msg = "Cannot find the shchedule file: " + schedule
                                    print msg
                                    ghenv.Component.AddRuntimeMessage(gh.GH_RuntimeMessageLevel.Warning, msg)
                                    return -1
                            
                            thisShading.TransmittanceSCH = schedule
                        
                        # add the Rad Material if any
                        if RADMaterial!=None:
                            # if it is just the name of the material make sure it is already defined
                            if len(RADMaterial.split(" ")) == 1:
                                # if the material is not in the library add it to the library
                                if not hb_RADMaterialAUX.isMatrialExistInLibrary(RADMaterial):
                                    warningMsg = "Can't find " + RADMaterial + " in RAD Material Library.\n" + \
                                                "Add the material to the library and try again."
                                    ghenv.Component.AddRuntimeMessage(gh.GH_RuntimeMessageLevel.Warning, warningMsg)
                                    return
                                
                                try:
                                    thisShading.setRADMaterial(RADMaterial)
                                except Exception, e:
                                    print e
                                    warningMsg = "You are using an old version of Honeybee_Honeybee! Update your files and try again."
                                    print warningMsg
                                    ghenv.Component.AddRuntimeMessage(gh.GH_RuntimeMessageLevel.Warning, warningMsg)
                                    return
                                
                                addedToLib = True
                            else:
                                
                                # try to add the material to the library
                                addedToLib, thisShading.RadMaterial = hb_RADMaterialAUX.analyseRadMaterials(RADMaterial, True)
                                
                            if addedToLib==False:
                                warningMsg = "Failed to add " + RADMaterial + " to the Library."
                                ghenv.Component.AddRuntimeMessage(gh.GH_RuntimeMessageLevel.Warning, warningMsg)
                                return
                        
                        # add shading to the list
                        shadingClasses.append(thisShading)
                
        # add to the hive
        hb_hive = sc.sticky["honeybee_Hive"]()
        HBContext  = hb_hive.addToHoneybeeHive(shadingClasses, ghenv.Component.InstanceGuid.ToString())
        return HBContext
        ################################################################################################
    else:
        print "You should first let Honeybee to fly..."
        w = gh.GH_RuntimeMessageLevel.Warning
        ghenv.Component.AddRuntimeMessage(w, "You should first let Honeybee to fly...")
        return -1
        

if _shdSurfaces and _shdSurfaces[0]!=None:
    # add cleaning function
    result= main(_shdSurfaces, EPTransSchedule_, meshingSettings_, justBoundingBox_)
    
    if result != -1: HBContext = result
# ---------- end hb_epcontextsrf ----------

# ----
setepzonecnstr = Honeybee_SetEPZoneConstruction(
    HBZone=setepnatvent_2.HBZones,
    wallEPConstruction=searchepconstruction_4,
    roofEPConstruction=searchepconstruction_2,
    floorEPConstruction=searchepconstruction)  # -> simplify(modifiedHBZone); plug-in component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

# ---- group: LIGHTING SCHEDULE
item_2 = ListItem(List=gentestpts.testPoints, Index="58", Wrap=True)
sph = Sphere(Base=item_2, Radius=Slider(0.1, range=0..0.1))
lightingcontrol = Honeybee_LightingControlRecipe(
    controlType="4",
    sensorPoints=item_2,
    lightingPower=250,
    lightingSetpoint=300,
    ballastLossFactor=20,
    standbyPower=3,
    delayTime=5)  # -> lightingControlGroup; plug-in component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
gethbzoneepschedules = Honeybee_GetZoneEnergyPlusSchedules(HBZone=createhbzones.HBZone)  # -> occupancySchedule, occupancyActivitySch, heatingSetPtSchedule, coolingSetPtSchedule, lightingSchedule, equipmentSchedule, infiltrationSchedule; plug-in component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
# Generate
# Lighting Schedule
readannualresultsi = Honeybee_ReadAnnualResultI(
    illFilesAddress=rundaylightanalysis.annual_analysis_files,
    testPoints=simplify(rundaylightanalysis.testPts),
    occupancyFiles=gethbzoneepschedules.lightingSchedule,
    DLAIllumThresholds=300,
    lightingControlGroups=lightingcontrol,
    runIt=Toggle(True))  # -> DLA, UDLI_Less_100, UDLI_100_2000, UDLI_More_2000, CDA, sDA, annualProfiles, htmReport; plug-in component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
# update lighting schedule
setepzoneschedules = Honeybee_SetEnergyPlusZoneSchedules(HBZones=setepzonecnstr, lightingSchedules=readannualresultsi.annualProfiles)  # -> schedules, simplify(HBZones); plug-in component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

# ---- group: DAYLIGHT GRIDS
gradientlibrary = Ladybug_GradientLibrary(gradIndex="1")  # -> customColors; plug-in component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
legendpar = Ladybug_LegendParameters(
    lowBound="0",
    highBound="100",
    numSegments="11",
    customColors=flatten(gradientlibrary),
    legendLocation="8,1",
    legendScale=".75",
    decimalPlaces="0",
    removeLessThan=Toggle(True))  # -> legendPar; plug-in component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
recolormesh = Ladybug_RecolorMesh(
    analysisResult=readannualresultsi.UDLI_Less_100,
    inputMesh=gentestpts.mesh,
    legendPar=legendpar,
    analysisTitle=["Useful Daylight Illuminance", "100-2000 lux"],
    legendTitle="%")  # -> out, newMesh, newLegend, legendBasePt, meshColors, legendColors; plug-in component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

# ---- group: WINDOW
callfromepconstrlibrary_5 = Honeybee_CallFromEPConstructionLibrary()  # -> ThermMaterials, EPMaterials, EPWindowMaterials, EPConstructions; plug-in component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
panel_11 = Panel("WINDOW")
searchepconstruction_5 = Honeybee_SearchEPConstruction(
    EPConstrList=callfromepconstrlibrary_5.EPConstructions,
    standard="ashrae 90.1-2010",
    climateZone="4",
    keywords="EXTWINDOW METAL")  # -> EPSelectedConstr; plug-in component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
cherry_picker_2 = CherryPicker(searchepconstruction_5, ListIndex=0)

# ---- group: ENERGY SIMULATION
toggle_3 = BooleanToggle(True)
epoutput = Honeybee_GenerateEPOutput(
    zoneEnergyUse=toggle_3,
    zoneGainsAndLosses=toggle_3,
    zoneComfortMetrics=toggle_3,
    surfaceTempAnalysis="False",
    timestep="hourly")  # -> report, flatten(simulationOutputs); plug-in component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
toggle_4 = BooleanToggle(True)
# Run the analysis
runenergysimulation = Honeybee_RunEnergySimulation(
    north=number_slider,
    epwFile=open_epw_stat.epwFile,
    HBZones=flatten(setepzoneschedules.HBZones),
    simulationOutputs=flatten(epoutput.simulationOutputs),
    writeIdf=toggle_4,
    runEnergyPlus=toggle_4)  # -> report, idfFileAddress, resultFileAddress; plug-in component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
readepresult = Honeybee_ReadEPResult(resultFileAddress=runenergysimulation.resultFileAddress)  # -> port, port_2, port_3, port_4, electricLight, electricEquip, fanElectric, port_5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; plug-in component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

# ----
text_tag_3d = TextTag3D(
    Location=gentestpts.testPoints,
    Text=readannualresultsi.UDLI_100_2000,
    Size=".1",
    Colour=ColourSwatch(SwatchColor=RGB(255, 255, 255)),
    Justification=7)
panel_12 = Panel(readannualresultsi.annualProfiles)

# ---- group: just for visualization
# Compare Schedules!
panel_13 = Panel("16")
gradientlibrary_2 = Ladybug_GradientLibrary(gradIndex=panel_13)  # -> customColors; plug-in component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
legendpar_2 = Ladybug_LegendParameters(customColors=flatten(gradientlibrary_2))  # -> legendPar; plug-in component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
dsannualprofiles = Honeybee_DaysimAnnualProfiles(annualProfiles=readannualresultsi.annualProfiles)  # -> simplify(occupancyProfile), simplify(shadingProfiles), simplify(lightingControlProfiles), simplify(dgpProfile); plug-in component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
convertepschvalues = Honeybee_ConvertEnergyPlusScheduleToValues(schName=gethbzoneepschedules.lightingSchedule)  # -> values; plug-in component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
_3dchart = Ladybug_3DChart(inputData=flatten([convertepschvalues, dsannualprofiles.lightingControlProfiles]), xScale=".25", legendPar=legendpar_2)  # -> readMe, graphMesh, graphCurves, legend, legendBasePts, title, titleBasePts, dataPts, conditionalHOY; plug-in component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

# ----
panel_14 = Panel(runenergysimulation.resultFileAddress)
boolean_toggle = BooleanToggle(True)
boolean_toggle_2 = BooleanToggle(True)

separatedata_2 = Ladybug_SeparateData(inputList=flatten(readepresult.electricLight))  # -> numbers, strings; plug-in component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
selectandaveragedata_2 = Ladybug_AverageData(annualHourlyData=readepresult.electricLight, totalOrAverage=Toggle(True))  # -> readMe, selHourlyData, totaledDaily, totaledMonthly, totMonthlyPerHour, totAnalysisPeriod; plug-in component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
ma = MassAddition(Input=separatedata_2.numbers)  # -> Result, PartialResults
total_lighting = Panel(ma.Result)
barchart = Ladybug_MonthlyBarChart(
    inputData=flatten(selectandaveragedata_2.totaledMonthly),
    altYAxisTitle="Lighting Loads (kWh)",
    basePoint="20, 0, 0",
    xScale=Slider(0.5, range=0..1),
    yScale=Slider(0.7, range=0..1))  # -> readMe, dataMesh, dataCurves, dataCrvColors, graphAxes, graphLabels, title, titleBasePt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; plug-in component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

# ---- group: SOLAR GAIN
legendpar_3 = Ladybug_LegendParameters(lowBound="0", highBound="8.1", numSegments="6", removeLessThan=boolean_toggle)  # -> legendPar; plug-in component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
_3dchart_2 = Ladybug_3DChart(inputData=flatten(readepresult.totalSolarGain), xScale=".25", legendPar=legendpar_3)  # -> out, graphMesh, graphCurves, legend, legendBasePts, title, titleBasePts, dataPts, conditionalHOY; plug-in component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

# ----
gradientlibrary_3 = Ladybug_GradientLibrary(gradIndex="1")  # -> customColors; plug-in component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

# ---- group: PMV COMFORT CHART
legendpar_4 = Ladybug_LegendParameters(decimalPlaces="0", removeLessThan=Toggle(True))  # -> legendPar; plug-in component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
panel_15 = Panel("""0.8
1.0
1.2
1.7""")
panel_16 = Panel("""0.5
0.75
1.0
1.0""")
c2f_2 = Ladybug_C2F(C=readepresult.airTemperature)  # -> F; plug-in component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
psychchart = Ladybug_PsychrometricChart(
    dryBulbTemperature=c2f_2,
    relativeHumidity=readepresult.relativeHumidity,
    metabolicRate=panel_15,
    clothingLevel=panel_16,
    mergeComfPolygons=boolean_toggle_2,
    legendPar=legendpar_4,
    runIt=boolean_toggle_2)  # -> out, port, totalComfortPercent, totalComfortOrNot, strategyNames, strategyPercentOfTime, strategyOrNot, port_2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; plug-in component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
panel_17 = Panel(psychchart.totalComfortPercent)
legendpar_5 = Ladybug_LegendParameters(
    lowBound="0",
    highBound="2",
    numSegments="3",
    customColors=reverse(flatten(gradientlibrary_3)),
    legendScale="1",
    decimalPlaces="0",
    removeLessThan=Toggle(True))  # -> legendPar; plug-in component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
panel_18 = Panel(psychchart.totalComfortOrNot)
_3dchart_3 = Ladybug_3DChart(inputData=flatten(psychchart.totalComfortOrNot), xScale=".25", legendPar=legendpar_5)  # -> out, graphMesh, graphCurves, legend, legendBasePts, title, titleBasePts, dataPts, conditionalHOY; plug-in component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

# ---- group: ADAPTIVE COMFORT CHART
c2f_3 = Ladybug_C2F(C=readepresult.airTemperature)  # -> F; plug-in component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
c2f_4 = Ladybug_C2F(C=readepresult.meanRadTemperature)  # -> F; plug-in component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
c2f_5 = Ladybug_C2F(C=importepw.dryBulbTemperature)  # -> F; plug-in component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
adaptivechart = Ladybug_AdaptiveComfortChart(dryBulbTemperature=c2f_3, meanRadiantTemperature=c2f_4, prevailingOutdoorTemp=c2f_5, runIt=Toggle(True))  # -> out, comfPercentOfTime, percentHotCold, comfortableOrNot, conditionOfPerson, degreesFromTarget, port, chartCurvesAndTxt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; plug-in component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
panel_19 = Panel(adaptivechart.comfPercentOfTime)
panel_20 = Panel(adaptivechart.percentHotCold)
legendpar_6 = Ladybug_LegendParameters(
    lowBound="-1",
    highBound="1",
    numSegments="3",
    customColors=flatten(gradientlibrary_3),
    legendScale="1",
    decimalPlaces="0",
    removeLessThan=Toggle(True))  # -> legendPar; plug-in component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
panel_21 = Panel(adaptivechart.conditionOfPerson)
_3dchart_4 = Ladybug_3DChart(inputData=flatten(adaptivechart.conditionOfPerson), basePoint="0,400", xScale=".25", legendPar=legendpar_6)  # -> out, graphMesh, graphCurves, legend, legendBasePts, title, titleBasePts, dataPts, conditionalHOY; plug-in component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

# ---- group: SOLAR GAIN
legendpar_7 = Ladybug_LegendParameters(lowBound="-0.35", highBound="0.1", numSegments="5", legendScale="1.25", removeLessThan=boolean_toggle)  # -> legendPar; plug-in component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
_3dchart_5 = Ladybug_3DChart(inputData=flatten(readepresult.infiltrationEnergy), xScale=".25", legendPar=legendpar_7)  # -> out, graphMesh, graphCurves, legend, legendBasePts, title, titleBasePts, dataPts, conditionalHOY; plug-in component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

# ---- group: Comfortable or Not
gradientlibrary_4 = Ladybug_GradientLibrary(gradIndex="16")  # -> customColors; plug-in component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
legendpar_8 = Ladybug_LegendParameters(
    numSegments="2",
    customColors=reverse(flatten(gradientlibrary_4)),
    legendScale="1.5",
    decimalPlaces="0",
    removeLessThan=Toggle(True))  # -> legendPar; plug-in component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
_3dchart_6 = Ladybug_3DChart(xScale=".25", legendPar=legendpar_8)  # -> out, graphMesh, graphCurves, legend, legendBasePts, title, titleBasePts, dataPts, conditionalHOY; plug-in component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
