# Grasshopper definition Vyas_Janki_Melbourne_Glare Analysis.gh (Grasshopper 0.9.76)
# plug-ins: Python Interpreter, embryoA

ladybug = Ladybug_Ladybug()  # -> Vviiiiiiiiiizzz; plug-in component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
honeybee = Honeybee_Honeybee()  # -> Vviiiiiiiiiizzz; plug-in component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
panel = Panel("http://apps1.eere.energy.gov/buildings/energyplus/weatherdata/4_north_and_central_america_wmo_region_4/1_usa/USA_PA_Philadelphia.Intl.AP.724080_TMY3.zip")
open_epw_stat = Ladybug_OpenEPWAndSTATWeatherFiles(weatherFileURL=panel)  # -> epwFile, statFile; plug-in component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
radopaquematerial = Honeybee_RadianceOpaqueMaterial(materialName="generic_35", RReflectance=".35", GReflectance=".35", BReflectance=".35", roughness=0.05, specularity=0)  # -> avrgRef, RADMaterial; plug-in component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
radglassmaterial = Honeybee_RadianceGlassMaterial(materialName="glass_.65", RTransmittance=".65", GTransmittance=".65", BTransmittance=".65", refractiveIndex=1.52)  # -> avrgTrans, RADMaterial; plug-in component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
radopaquematerial_2 = Honeybee_RadianceOpaqueMaterial(materialName="Red Oak", RReflectance=".35", GReflectance=".35", BReflectance=".35", roughness=0.05, specularity=0)  # -> avrgRef, RADMaterial; plug-in component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

# ---- group: furniture
furniture = Brep([<brep referenced from the Rhino model> x12])

# ----
ledge = Brep(<brep referenced from the Rhino model>)

# ---- group: glass facade
glass = Brep(<brep referenced from the Rhino model>)

# ---- group: ceiling
ceiling = Brep([<brep referenced from the Rhino model> x2])

# ---- group: floor
floor = Brep(<brep referenced from the Rhino model>)

# ----
walls = Brep([<brep referenced from the Rhino model> x2])
shading_device = Brep([<brep referenced from the Rhino model> x30])
number_slider = Slider(270, range=0..360)
# Geometry Preparation
panel_2 = Panel("0")
# Assign specific materials
createhbsrfs = Honeybee_createHBSrfs(geometry=[ledge, furniture], RADMaterial=radopaquematerial.RADMaterial)  # -> readMe, simplify(HBSurface); plug-in component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
createhbsrfs_2 = Honeybee_createHBSrfs(geometry=shading_device, RADMaterial=radopaquematerial_2.RADMaterial)  # -> readMe, simplify(HBSurface); plug-in component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
createhbsrfs_3 = Honeybee_createHBSrfs(geometry=glass, RADMaterial=radglassmaterial.RADMaterial)  # -> readMe, simplify(HBSurface); plug-in component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
createhbsrfs_4 = Honeybee_createHBSrfs(geometry=floor, srfType="2")  # -> readMe, simplify(HBSurface); plug-in component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
createhbsrfs_5 = Honeybee_createHBSrfs(geometry=ceiling, srfType="3")  # -> readMe, simplify(HBSurface); plug-in component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
# Honeybee default materials will be assigned
# based on surface type
createhbsrfs_6 = Honeybee_createHBSrfs(geometry=walls, srfType=panel_2)  # -> readMe, simplify(HBSurface); plug-in component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
genclimatebasedsky = Honeybee_GenerateClimateBasedSky(north=number_slider, weatherFile=open_epw_stat.epwFile, month="12", day="21", hour="15")  # -> radiationValues, skyFilePath; plug-in component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
genavgsky = Honeybee_GenerateAverageSky(north=number_slider, weatherFile=open_epw_stat.epwFile, month="12", hour="15")  # -> radiationValues, skyFilePath; plug-in component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
northarrow = Ladybug_North(north=number_slider, scale=".05")  # -> northSign; plug-in component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
panel_3 = Panel([genclimatebasedsky.radiationValues, genavgsky.radiationValues])
set_the_view_to_fisheye_for_glare_analys = Panel("1")  # "set the view to FishEye for Glare Analysis"
radparameters = Honeybee_RADParameters(quality=0, ab="4")  # -> readMe, radParameters; plug-in component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
doy_hoy = Ladybug_DOY_HOY(days="21", months="12", hours="15")  # -> HOY, DOY, date; plug-in component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

# ---- group: collect all honeybee surfaces
brep = Brep(flatten([createhbsrfs_6.HBSurface, createhbsrfs_5.HBSurface, createhbsrfs_4.HBSurface, createhbsrfs.HBSurface, createhbsrfs_3.HBSurface]))

# ----
# Analysis Recipe
imagebasedsimulation = Honeybee_ImageBasedSimulation(
    skyFile=genavgsky.skyFilePath,
    rhinoViewsName="Interior Fisheye 01",
    cameraType=set_the_view_to_fisheye_for_glare_analys,
    simulationType=2,
    radParameters=radparameters.radParameters,
    backupImages=0)  # -> analysisRecipe; plug-in component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
wires = BrepWireframe(Brep=brep, Density=-1)
toggle = BooleanToggle(True)
# Run the analysis
rundaylightanalysis = Honeybee_RunDaylightSimulation(
    HBObjects=flatten(brep),
    analysisRecipe=imagebasedsimulation,
    writeRad=toggle,
    runRad=toggle,
    numOfCPUs="8",
    radFileName=doy_hoy.date,
    overwriteResults=True)  # -> readMe, analysisType, resultsUnit, results, testPts, luminance_files, radGeoFile, studyFolder, done; plug-in component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
glareanalysis = Honeybee_GlareAnalysis(HDRImagePath=rundaylightanalysis.luminance_files, runIt=Toggle(True))  # -> readMe, glareCheckImage, DGP, DGI, imageWithTaskArea; plug-in component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
panel_4 = Panel(glareanalysis.DGP)
# DGP: Daylight glare probability:
# Imperceptible Glare [0.35 > DGP]
# Perceptible Glare [0.4 > DGP >= 0.35]
# Disturbing Glare [0.45 > DGP >= 0.4]
# Intolerable Glare [DGP >= 0.45]
toggle_2 = BooleanToggle(True)
hdr_tif = Honeybee_ConvertHDRToTIF(HDRFilePath=glareanalysis.glareCheckImage, adjustExposure=toggle_2)  # -> TIFFFilePath; plug-in component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
# Visualize the results
image = ImageFromPath(P=hdr_tif, S=Slider(1, range=0..1))
panel_5 = Panel(hdr_tif)
