# Grasshopper definition Vyas_Janki_Shading Design_Meyerson_R1_Version2.gh (Grasshopper 0.9.76)
# plug-ins: Python Interpreter

ladybug = Ladybug_Ladybug()  # -> out; plug-in component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

panel = Panel("http://apps1.eere.energy.gov/buildings/energyplus/weatherdata/4_north_and_central_america_wmo_region_4/1_usa/USA_PA_Philadelphia.Intl.AP.724080_TMY3.zip")
open_epw_stat = Ladybug_OpenEPWAndSTATWeatherFiles(weatherFileURL=panel)  # -> epwFile, statFile; plug-in component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
importepw = Ladybug_ImportEpw(epwFile=open_epw_stat.epwFile)  # -> Output, latitude, location, dryBulbTemperature, dewPointTemperature, relativeHumidity, windSpeed, windDirection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; plug-in component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

# ----
# point on left perpendicular bench
point = Point(<point referenced from the Rhino model>)

# ----
# point on parallel bench
point_2 = Point(<point referenced from the Rhino model>)

# ----
# point on right perpendicular bench
point_3 = Point(<point referenced from the Rhino model>)

library_and_meyerson = Brep([<brep referenced from the Rhino model> x2])
shading_design = Brep([<brep referenced from the Rhino model> x59])

analysisperiod = Ladybug_AnalysisPeriod()  # -> out, analysisPeriod; plug-in component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
solaradjusttemperature = Ladybug_OutdoorSolarTemperatureAdjustor(
    location=importepw.location,
    cumSkyMtxOrDirNormRad=importepw.directNormalRadiation,
    diffuseHorizRad=importepw.diffuseHorizontalRadiation,
    meanRadTemperature=importepw.dryBulbTemperature,
    bodyPosture=Slider(1, range=0..1),
    rotationAngle=Slider(180, range=0..360),
    bodyLocation=point_2,
    contextShading=[library_and_meyerson, shading_design],
    north="5",
    analysisPeriodOrHOY=analysisperiod.analysisPeriod,
    runIt=Toggle(True))  # -> readMe, port, effectiveRadiantField, MRTDelta, solarAdjustedMRT, port_2, mannequinMesh, port_3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; plug-in component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

outdoorcomfortcalculator = Ladybug_OutdoorComfortCalculator(
    dryBulbTemperature=importepw.dryBulbTemperature,
    meanRadiantTemperature=solaradjusttemperature.solarAdjustedMRT,
    windSpeed_tenMeters=importepw.windSpeed,
    relativeHumidity=importepw.relativeHumidity,
    runIt=Toggle(True))  # -> out, port, universalThermalClimateIndex, comfortableOrNot, thermalStress, conditionOfPerson, port_2, percentOfTimeComfortable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; plug-in component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

shading_design_2 = Brep([<brep referenced from the Rhino model> x59])
panel_2 = Panel(outdoorcomfortcalculator.percentComfForShortPeriod)
panel_3 = Panel(outdoorcomfortcalculator.percentHeatStress)
panel_4 = Panel(outdoorcomfortcalculator.percentColdStress)
panel_5 = Panel(outdoorcomfortcalculator.percentOfTimeComfortable)
area = Area(Geometry=shading_design_2)  # -> Area, Centroid
mass_addition = MassAddition(Input=area.Area)  # -> Result, PartialResults
shading_design_3 = Brep([<brep referenced from the Rhino model> x59])

brep = Brep(<brep referenced from the Rhino model>)
entwine = Entwine(Branch00=brep, Branch01=brep, Branch02=brep, FlattenInputs=True)  # -> simplify(graft(Result))
entwine_2 = Entwine(
    Branch00=outdoorcomfortcalculator.universalThermalClimateIndex,
    Branch01=outdoorcomfortcalculator.universalThermalClimateIndex,
    Branch02=outdoorcomfortcalculator.universalThermalClimateIndex,
    FlattenInputs=True)  # -> simplify(Result)
brep_2 = Brep(simplify(graft([<brep referenced from the Rhino model> x3])))
library_and_meyerson_2 = Brep([<brep referenced from the Rhino model> x2])
comfortshadebenefit = Ladybug_ComfortShadeBenefitEvaluator(
    location=importepw.location,
    temperatures=entwine_2,
    balanceTemperature="20",
    testShades=entwine,
    testRegion=brep_2,
    gridSize="1",
    context=[shading_design_3, library_and_meyerson_2],
    skyResolution="4",
    delNonIntersect=False,
    parallel=Toggle(True),
    runIt=Toggle(True))  # -> out, port, sunVectors, regionTestPts, shadeMesh, legend, legendBasePoint, port_2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; plug-in component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
panel_6 = Panel(comfortshadebenefit.shadeHarmfulness)
shadecreator = Honeybee_OptimalShadeCreator(shadeMesh=comfortshadebenefit.shadeMesh, shadeNetEffect=comfortshadebenefit.shadeNetEffect)  # -> out, energySavedByShade, areaOfShade, newColoredMesh, newShadeBrep; plug-in component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
panel_7 = Panel(comfortshadebenefit.shadeHelpfulness)
panel_8 = Panel(shadecreator.areaOfShade)

panel_9 = Panel(mass_addition.Result)
