# Grasshopper definition Wan_Yuntian_Building Performance Simulation_Final Report_GH.gh (Grasshopper 0.9.76)
# plug-ins: Python Interpreter

epglassmat = Honeybee_EnergyPlusGlassMaterial(name="brandnewglass1")  # -> EPMaterial; plug-in component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
panel = Panel("""Honeybee
Energy
Daylighting
EnergyPlus
Daysim
Radiance
HBExampleFiles""")
panel_2 = Panel("This is an example that shows how to integrate results of daylighting simulation with an energy simulation")
ladybug = Ladybug_Ladybug()  # -> Vviiiiiiiiiizzz; plug-in component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
honeybee = Honeybee_Honeybee()  # -> Vviiiiiiiiiizzz; plug-in component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
exporthydra = Hydra_ExportFile(
    fileName="Integrated_Daylight_and_Energy_similation",
    fileDescription=panel_2,
    fileTags=panel,
    targetFolder="C:\Users\Administrator\Documents\GitHub\hydra_1",
    export=Toggle(False))  # -> readMe; inputs fileDescription: list, changeLog: list, fileTags: list, includeRhino: Boolean, GHForThumb: Boolean, additionalImgs: list, export: Boolean; plug-in component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
updatehoneybee = Honeybee_UpdateHoneybee(updateAllUObjects=Toggle(False))  # -> readMe; plug-in component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
updateladybug = Ladybug_UpdateLadybug(updateAllUObjects=Toggle(False))  # -> readMe; plug-in component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
north = Slider(270, range=0..1000)

number_slider = Slider(45, range=0..100)
panel_3 = Panel("http://apps1.eere.energy.gov/buildings/energyplus/weatherdata/2_asia_wmo_region_2/ARE_Abu.Dhabi.412170_IWEC.zip")
northarrow = Ladybug_North(north=north, scale=".05")  # -> northSign; plug-in component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
open_epw_stat = Ladybug_OpenEPWAndSTATWeatherFiles(weatherFileURL=panel_3)  # -> epwFile, statFile; plug-in component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

callfromepconstrlibrary = Honeybee_CallFromEPConstructionLibrary(keywords="WINDOW")  # -> ThermMaterials, EPMaterials, EPWindowMaterials, EPConstructions; plug-in component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

# ----
# Shading
number_slider_2 = Slider(0.5, range=0..1)
brep = Brep([<brep referenced from the Rhino model> x51])
radopaquematerial = Honeybee_RadianceOpaqueMaterial(
    materialName="wall",
    RReflectance=number_slider_2,
    GReflectance=number_slider_2,
    BReflectance=number_slider_2,
    roughness=0.05,
    specularity=0)  # -> avrgRef, RADMaterial; plug-in component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
preview = CustomPreview(Geometry=brep, Shader=ColourSwatch(SwatchColor=RGBA(199, 185, 98, 160)))
hb_epcontextsrf = HoneybeeEPContextSurfaces(shdSurfaces=flatten(brep), RADMaterial=radopaquematerial.RADMaterial)  # -> HBContext; inputs shdSurfaces: list of GeometryBase, justBoundingBox: Boolean
# ---------- hb_epcontextsrf: Python ----------
"""
prepare shading/context geometries

    Args:
        northVectorOrRotation: A vector that shows North or a number that shows
                               the rotation of the North from the Y axis
        bldgMasses: List of closed Breps as thermal zones.
    Returns:
        report: ...
        thermalZones: Thermal zone's geometries for visualiza
"""

ghenv.Component.Name = 'Honeybee EP context Surfaces'
ghenv.Component.NickName = 'HB_EPContextSrf'
ghenv.Component.Message = 'VER 0.0.58\nNOV_20_2015'
ghenv.Component.Category = "Honeybee"
ghenv.Component.SubCategory = "09 | Energy | Energy"
#compatibleHBVersion = VER 0.0.57\nNOV_01_2015
#compatibleLBVersion = VER 0.0.59\nFEB_01_2015
ghenv.Component.AdditionalHelpFromDocStrings = "2"

import rhinoscriptsyntax as rs
import Rhino as rc
import scriptcontext as sc
import os
import System
import Grasshopper.Kernel as gh
import uuid

tolerance = sc.doc.ModelAbsoluteTolerance
import math


def main(shdSurfaces, EPTransSchedule, meshingSettings, justBoundingBox):
    
    # import the classes
    if sc.sticky.has_key('honeybee_release'):

        try:
            if not sc.sticky['honeybee_release'].isCompatible(ghenv.Component): return -1
        except:
            warning = "You need a newer version of Honeybee to use this compoent." + \
            " Use updateHoneybee component to update userObjects.\n" + \
            "If you have already updated userObjects drag Honeybee_Honeybee component " + \
            "into canvas and try again."
            w = gh.GH_RuntimeMessageLevel.Warning
            ghenv.Component.AddRuntimeMessage(w, warning)
            return -1
        
        # don't customize this part
        hb_EPSrf = sc.sticky["honeybee_EPSurface"]
        hb_EPSHDSurface = sc.sticky["honeybee_EPShdSurface"]
        hb_RADMaterialAUX = sc.sticky["honeybee_RADMaterialAUX"]
        hb_EPObjectsAux = sc.sticky["honeybee_EPObjectsAUX"]()
        HBScheduleList = sc.sticky["honeybee_ScheduleLib"].keys()

        ########################################################################
        #----------------------------------------------------------------------#
        shdBreps = []
        # create bounding box of shading geometries
        if justBoundingBox:
            for brep in shdSurfaces:
                if brep.Faces.Count>1 or not brep.Faces[0].IsPlanar(sc.doc.ModelAbsoluteTolerance):
                    shdBreps.append(brep.GetBoundingBox(True).ToBrep())
                else:
                    shdBreps.append(brep)
        else:
            shdBreps = shdSurfaces
        
        shadingClasses = []
        shadingMeshPreview = []
        
        if meshingSettings == None:
            mp = rc.Geometry.MeshingParameters.Minimal
            mp.SimplePlanes = True
        else:
            mp = meshingSettings
        
        def getRadMaterialName(radMaterial):
            nameStr = radMaterial.split(" ")[2]
            name =  nameStr.split("\n")[0]
            return name
        
        for brepCount, brep in enumerate(shdBreps):
            if brep != None:
                isPlanar = True
                # check planarity
                for face in brep.Faces:
                    if not face.IsPlanar(tolerance):
                        isPlanar = False
                        break
                
                shadingBreps = []
                if not isPlanar:
                    meshArray = rc.Geometry.Mesh.CreateFromBrep(brep, mp)
                    for mesh in meshArray:
                        for meshFace in range(mesh.Faces.Count):
                            vertices = list(mesh.Faces.GetFaceVertices(meshFace))[1:]
                            vertices = vertices + [sc.doc.ModelAbsoluteTolerance]
                            # create the brep from mesh
                            shdBrep = rc.Geometry.Brep.CreateFromCornerPoints(*vertices)
                            shadingBreps.append(shdBrep)
                else:
                    for face in brep.Faces:
                        shadingBreps.append(face.DuplicateFace(False))
                
                for faceCount, shdBrep in enumerate(shadingBreps):
                        thisShading = hb_EPSHDSurface(shdBrep, 1000*brepCount + faceCount, 'shdSrf_' + `brepCount` + '_' + `faceCount` + "_" + str(uuid.uuid4()))
                        
                        # add transmittance schedule if any
                        if EPTransSchedule!=None:
                            schedule= EPTransSchedule.upper()
                            if schedule!=None and not schedule.lower().endswith(".csv") and schedule not in HBScheduleList:
                                msg = "Cannot find " + schedule + " in Honeybee schedule library."
                                print msg
                                ghenv.Component.AddRuntimeMessage(gh.GH_RuntimeMessageLevel.Warning, msg)
                                return -1
                            elif schedule!=None and schedule.lower().endswith(".csv"):
                                # check if csv file is existed
                                if not os.path.isfile(schedule):
                                    msg = "Cannot find the shchedule file: " + schedule
                                    print msg
                                    ghenv.Component.AddRuntimeMessage(gh.GH_RuntimeMessageLevel.Warning, msg)
                                    return -1
                            
                            thisShading.TransmittanceSCH = schedule
                        
                        # add the Rad Material if any
                        if RADMaterial!=None:
                            # if it is just the name of the material make sure it is already defined
                            if len(RADMaterial.split(" ")) == 1:
                                # if the material is not in the library add it to the library
                                if not hb_RADMaterialAUX.isMatrialExistInLibrary(RADMaterial):
                                    warningMsg = "Can't find " + RADMaterial + " in RAD Material Library.\n" + \
                                                "Add the material to the library and try again."
                                    ghenv.Component.AddRuntimeMessage(gh.GH_RuntimeMessageLevel.Warning, warningMsg)
                                    return
                                
                                try:
                                    thisShading.setRADMaterial(RADMaterial)
                                except Exception, e:
                                    print e
                                    warningMsg = "You are using an old version of Honeybee_Honeybee! Update your files and try again."
                                    print warningMsg
                                    ghenv.Component.AddRuntimeMessage(gh.GH_RuntimeMessageLevel.Warning, warningMsg)
                                    return
                                
                                addedToLib = True
                            else:
                                
                                # try to add the material to the library
                                addedToLib, thisShading.RadMaterial = hb_RADMaterialAUX.analyseRadMaterials(RADMaterial, True)
                                
                            if addedToLib==False:
                                warningMsg = "Failed to add " + RADMaterial + " to the Library."
                                ghenv.Component.AddRuntimeMessage(gh.GH_RuntimeMessageLevel.Warning, warningMsg)
                                return
                        
                        # add shading to the list
                        shadingClasses.append(thisShading)
                
        # add to the hive
        hb_hive = sc.sticky["honeybee_Hive"]()
        HBContext  = hb_hive.addToHoneybeeHive(shadingClasses, ghenv.Component.InstanceGuid.ToString())
        return HBContext
        ################################################################################################
    else:
        print "You should first let Honeybee to fly..."
        w = gh.GH_RuntimeMessageLevel.Warning
        ghenv.Component.AddRuntimeMessage(w, "You should first let Honeybee to fly...")
        return -1
        

if _shdSurfaces and _shdSurfaces[0]!=None:
    # add cleaning function
    result= main(_shdSurfaces, EPTransSchedule_, meshingSettings_, justBoundingBox_)
    
    if result != -1: HBContext = result
# ---------- end hb_epcontextsrf ----------

# ---- group: floor
floor = Brep(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)

# ---- group: ceiling
ceiling = Brep([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])

# ----
flip = Flip(Surface=floor)  # -> Surface, Result
item = ListItem(List=callfromepconstrlibrary.EPConstructions, Index="49", Wrap=True)

# ----
# Orientation
number_slider_3 = Slider(0.1, range=0..0.1)
importlocation = Ladybug_ImportLocation(epwFile=open_epw_stat.epwFile)  # -> location; plug-in component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
sunpath = Ladybug_SunPath(
    north=north,
    location=importlocation,
    hour=12,
    day=21,
    month=12,
    timeStep=1,
    sunPathScale=number_slider_3,
    dailyOrAnnualSunPath=True)  # -> readMe, sunVectors, sunAltitudes, sunAzimuths, port, sunSpheresMesh, sunPathCrvs, legend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; plug-in component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

toggle = BooleanToggle(False)

# ----
# Annual Daylight Simulation
panel_4 = Panel(".5")
gentestpts = Honeybee_GenerateTestPoints(testSurface=flip.Surface, gridSize=panel_4, distBaseSrf=".762", moveTestMesh=True)  # -> readMe, simplify(testPoints), simplify(ptsVectors), simplify(facesArea), simplify(mesh); plug-in component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

item_2 = ListItem(List=gentestpts.testPoints, Index=Slider(11, range=0..100), Wrap=True)
sph = Sphere(Base=item_2, Radius=1)
lightingcontrol = Honeybee_LightingControlRecipe(
    controlType="4",
    sensorPoints=item_2,
    lightingPower=250,
    lightingSetpoint=300,
    ballastLossFactor=20,
    standbyPower=3,
    delayTime=5)  # -> lightingControlGroup; plug-in component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

toggle_2 = BooleanToggle(True)
toggle_3 = BooleanToggle(True)
occupancygenerator = Honeybee_DaysimOccupancyGenerator(weekendDays=[1, 2], writeTheOcc=Toggle(True))  # -> occupancyFile; plug-in component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
panel_5 = Panel(occupancygenerator)

pt = Point(<point referenced from the Rhino model>)

number_slider_4 = Slider(64.47, range=0..100)
legendpar = Ladybug_LegendParameters(highBound=Slider(3, range=0..10))  # -> legendPar; plug-in component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

# ----
# Geometry Preparation
# Honeybee default materials will be assigned
# based on surface type
ledge = Brep(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)
walls = Brep([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])
wall_surface_with_opening = Brep(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)
callfromepconstrlibrary_2 = Honeybee_CallFromEPConstructionLibrary(keywords="mass")  # -> ThermMaterials, EPMaterials, EPWindowMaterials, EPConstructions; plug-in component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
createhbsrfs = Honeybee_createHBSrfs(geometry=flatten(flip.Surface), srfType="2", EPBC="Adiabatic")  # -> readMe, simplify(HBSurface); plug-in component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
createhbsrfs_2 = Honeybee_createHBSrfs(geometry=ceiling, srfType=Slider(3, range=0..10), EPBC="Adiabatic")  # -> readMe, simplify(HBSurface); plug-in component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
createhbsrfs_3 = Honeybee_createHBSrfs(geometry=wall_surface_with_opening, srfType="0")  # -> readMe, simplify(HBSurface); plug-in component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
item_3 = ListItem(List=callfromepconstrlibrary_2.EPConstructions, Index="62", Wrap=True)
createhbsrfs_4 = Honeybee_createHBSrfs(geometry=[walls, ledge], srfType="0", EPConstruction=item_3)  # -> readMe, simplify(HBSurface); plug-in component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
glass = Brep(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)
preview_2 = CustomPreview(Geometry=glass, Shader=ColourSwatch(SwatchColor=RGBA(80, 222, 255, 160)))
addhbglz = Honeybee_addHBGlz(HBObj=createhbsrfs_3.HBSurface, childSurfaces=flatten(glass), EPConstructions=item)  # -> simplify(HBObjWGLZ); plug-in component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
bldgprograms = Honeybee_bldgPrograms({"Office": 0, "Retail": 1, "MidriseApartment": 2, "PrimarySchool": 3, "SecondarySchool": 4, "SmallHotel": 5, "LargeHotel": 6, "Hospital": 7, "Outpatient": 8, "Warehouse": 9, "SuperMarket": 10, "FullServiceRestaurant": 11, "QuickServiceRestaurant": 12}, selected="MidriseApartment")
listzoneprograms = Honeybee_ListZonePrograms(bldgProgram=bldgprograms)  # -> MidriseApartmentZonePrograms; plug-in component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
item_4 = ListItem(List=listzoneprograms, Index=0, Wrap=True)
panel_6 = Panel(item_4)

panel_7 = Panel(callfromepconstrlibrary_2.EPConstructions)

# ---- group: collect all honeybee surfaces
brep_2 = Brep(flatten([addhbglz, createhbsrfs_4.HBSurface, createhbsrfs.HBSurface, createhbsrfs_2.HBSurface]))

# ----
createhbzones = Honeybee_createHBZones(name="test_room", zoneProgram=item_4, HBSurfaces=flatten(brep_2), isConditioned=Toggle(False))  # -> readMe, HBZone; plug-in component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
wires = BrepWireframe(Brep=createhbzones.HBZone, Density=-1)

getepschedules = Honeybee_GetEnergyPlusSchedules(zoneProgram=panel_6)  # -> occupancySchedule, occupancyActivitySch, heatingSetPtSchedule, coolingSetPtSchedule, lightingSchedule, equipmentSchedule, infiltrationSchedule; plug-in component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
panel_8 = Panel(getepschedules.occupancySchedule)

# ----
# 1) AutoCalulated Window-Based Natural Ventilation
toggle_4 = BooleanToggle(True)
solveadjc = Honeybee_SolveAdjacencies(HBZones=flatten(createhbzones.HBZone), altConstruction="Air Wall", removeCurrentAdjc=False, findAdjc=toggle_4)  # -> readMe, HBZonesWADJ; plug-in component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

# ----
# Run Annual Daylight
radparameters = Honeybee_RADParameters(quality=0)  # -> readMe, radParameters; plug-in component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
annualdaylightsimulation = Honeybee_AnnualDaylightSimulation(
    north=north,
    epwWeatherFile=open_epw_stat.epwFile,
    testPoints=gentestpts.testPoints,
    ptsVectors=gentestpts.ptsVectors,
    testMesh=gentestpts.mesh,
    radParameters=radparameters.radParameters)  # -> analysisRecipe; plug-in component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
brep_3 = Brep([createhbzones.HBZone, hb_epcontextsrf])
rundaylightanalysis = Honeybee_RunDaylightSimulation(
    HBObjects=flatten(brep_3),
    analysisRecipe=annualdaylightsimulation,
    writeRad=toggle,
    runRad=toggle,
    numOfCPUs=Slider(6, range=0..10),
    overwriteResults=True)  # -> readMe, analysisType, resultsUnit, results, testPts, resultFiles, radGeoFile, studyFolder, done; plug-in component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
panel_9 = Panel(rundaylightanalysis.resultFiles)

setepnatvent = Honeybee_SetEPAirFlow(HBZones=solveadjc.HBZonesWADJ, naturalVentilationType="1", minIndoorTempForNatVent="24", maxOutdoorTempForNatVent="28")  # -> readMe, simplify(HBZones); plug-in component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
zoneattributelist = Honeybee_ZoneAttributeList({"Name": "name", "Zone Program": "zoneProgram", "Zone Floor Area": "zoneFloorArea", "Zone Volume": "zoneVolume", "Building Program": "bldgProgram", "Is Conditioned": "isConditioned", "Occupancy Schedule": "occupancySchedule", "Occupancy Activity Schedule": "occupancyActivitySch", "Heating SetPoint Schedule": "heatingSetPtSchedule", "Cooling SetPoint Schedule": "coolingSetPtSchedule"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}, selected="Natural Ventilation": "natVent")
labelzones = Honeybee_LabelZones(HBZones=flatten(setepnatvent.HBZones), attribute=zoneattributelist)  # -> zoneTxtLabels, labelBasePts, brepTxtLabels, zoneWireFrames; plug-in component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

# ----
# Generate lighting Schedule
gethbzoneepschedules = Honeybee_GetZoneEnergyPlusSchedules(HBZone=createhbzones.HBZone)  # -> occupancySchedule, occupancyActivitySch, heatingSetPtSchedule, coolingSetPtSchedule, lightingSchedule, equipmentSchedule, infiltrationSchedule; plug-in component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
number_slider_5 = Slider(100, range=0..100)
readannualresultsi = Honeybee_ReadAnnualResultI(
    illFilesAddress=rundaylightanalysis.resultFiles,
    testPoints=simplify(rundaylightanalysis.testPts),
    occupancyFiles=gethbzoneepschedules.lightingSchedule,
    DLAIllumThresholds=Slider(300, range=0..1000),
    lightingControlGroups=lightingcontrol,
    runIt=Toggle(True))  # -> DLA, UDLI_Less_100, UDLI_100_2000, UDLI_More_2000, CDA, sDA, annualProfiles, htmReport; plug-in component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

# ----
# update lighting schedule
setepzoneschedules = Honeybee_SetEnergyPlusZoneSchedules(HBZones=createhbzones.HBZone, lightingSchedules=readannualresultsi.annualProfiles)  # -> schedules, simplify(HBZones); plug-in component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
epoutput = Honeybee_GenerateEPOutput(
    zoneEnergyUse=toggle_3,
    zoneGainsAndLosses=toggle_3,
    zoneComfortMetrics=toggle_3,
    surfaceTempAnalysis="False",
    glazingSolarAnalysis=toggle_3,
    timestep="hourly")  # -> report, flatten(simulationOutputs); plug-in component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
setepzoneloads = Honeybee_SetEnergyPlusZoneLoads(HBZones=setepzoneschedules.HBZones)  # -> loads, HBZones; plug-in component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

# ----
# Run the analysis
runenergysimulation = Honeybee_RunEnergySimulation(
    north=north,
    epwFile=open_epw_stat.epwFile,
    HBZones=flatten([setepzoneloads.HBZones, setepnatvent.HBZones]),
    HBContext=flatten(hb_epcontextsrf),
    simulationOutputs=flatten(epoutput.simulationOutputs),
    writeIdf=toggle_2,
    runEnergyPlus=toggle_2)  # -> report, idfFileAddress, resultFileAddress; plug-in component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
readepsrfresult = Honeybee_ReadEPSurfaceResult(resultFileAddress=runenergysimulation.resultFileAddress)  # -> port, port_2, port_3, port_4, port_5, windowTotalSolarEnergy, windowBeamEnergy, windowDiffEnergy, port_6, port_7; plug-in component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
readepresult = Honeybee_ReadEPResult(resultFileAddress=runenergysimulation.resultFileAddress)  # -> port, port_2, port_3, port_4, electricLight, electricEquip, fanElectric, port_5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; plug-in component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
panel_10 = Panel(readepsrfresult.windowBeamEnergy)
separatedata = Ladybug_SeparateData(inputList=flatten(readepresult.electricEquip))  # -> numbers, strings; plug-in component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
panel_11 = Panel(readepresult.totalSolarGain)
separatedata_2 = Ladybug_SeparateData(inputList=flatten(readepresult.electricLight))  # -> numbers, strings; plug-in component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
ma = MassAddition(Input=separatedata.numbers)  # -> Result, PartialResults
ma_2 = MassAddition(Input=separatedata_2.numbers)  # -> Result, PartialResults
total_cooling = Panel(ma.Result)
total_heating = Panel(ma_2.Result)

# ---- group: just for visualization
# Annual Daylight Visualization
# Compare Schedules!
dsannualprofiles = Honeybee_DaysimAnnualProfiles(annualProfiles=readannualresultsi.annualProfiles)  # -> simplify(occupancyProfile), simplify(shadingProfiles), simplify(lightingControlProfiles), simplify(dgpProfile); plug-in component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
convertepschvalues = Honeybee_ConvertEnergyPlusScheduleToValues(schName=gethbzoneepschedules.lightingSchedule)  # -> values; plug-in component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
_3dchart = Ladybug_3DChart(
    inputData=flatten([convertepschvalues, dsannualprofiles.lightingControlProfiles]),
    basePoint=pt,
    xScale=Slider(0.4, range=0..1))  # -> readMe, graphMesh, graphCurves, legend, legendBasePts, title, titleBasePts, dataPts, conditionalHOY; plug-in component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

# ----
gradientlibrary = Ladybug_GradientLibrary(gradIndex="1")  # -> customColors; plug-in component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
legendpar_2 = Ladybug_LegendParameters(lowBound="0", highBound="100", customColors=flatten(gradientlibrary))  # -> legendPar; plug-in component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
dom = ConstructDomain(DomainStart="-.5", DomainEnd=".5")
recolormesh = Ladybug_RecolorMesh(
    analysisResult=readannualresultsi.UDLI_More_2000,
    inputMesh=gentestpts.mesh,
    heightDomain=dom,
    legendPar=legendpar_2,
    legendTitle=rundaylightanalysis.resultsUnit)  # -> readMe, newMesh, newLegend, legendBasePt, meshColors, legendColors; plug-in component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

# ----
# Comfort
importepw = Ladybug_ImportEpw(epwFile=open_epw_stat.epwFile)  # -> readMe, latitude, location, dryBulbTemperature, dewPointTemperature, relativeHumidity, windSpeed, windDirection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; plug-in component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
pmvcomfortcalculator = Ladybug_PMVComfortCalculator(
    dryBulbTemperature=readepresult.airTemperature,
    meanRadiantTemperature=readepresult.meanRadTemperature,
    relativeHumidity=readepresult.relativeHumidity,
    calcBalanceTemperature=False,
    runIt=Toggle(True))  # -> readMe, port, predictedMeanVote, percentPeopleDissatisfied, standardEffectiveTemperature, port_2, comfortableOrNot, percentOfTimeComfortable, port_3, balanceTemperature; plug-in component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
adaptivecomfortcalculator = Ladybug_AdaptiveComfortCalculator(
    dryBulbTemperature=readepresult.airTemperature,
    meanRadiantTemperature=readepresult.meanRadTemperature,
    prevailingOutdoorTemp=importepw.dryBulbTemperature,
    runIt=Toggle(True))  # -> readMe, port, comfortableOrNot, conditionOfPerson, degreesFromTarget, port_2, targetTemperature, upperTemperatureBound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; plug-in component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
panel_12 = Panel(adaptivecomfortcalculator.percentOfTimeComfortable)
panel_13 = Panel(pmvcomfortcalculator.percentOfTimeComfortable)

_3dchart_2 = Ladybug_3DChart(inputData=flatten(adaptivecomfortcalculator.conditionOfPerson), xScale=Slider(0.4, range=0..1))  # -> readMe, graphMesh, graphCurves, legend, legendBasePts, title, titleBasePts, dataPts, conditionalHOY; plug-in component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
_3dchart_3 = Ladybug_3DChart(
    inputData=flatten([readepresult.totalSolarGain, adaptivecomfortcalculator.conditionOfPerson, readepresult.airTemperature]),
    xScale=Slider(0.4, range=0..1),
    legendPar=legendpar)  # -> readMe, graphMesh, graphCurves, legend, legendBasePts, title, titleBasePts, dataPts, conditionalHOY; plug-in component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

# ----
# Visualization
number_slider_6 = Slider(0.1, range=0..1)
_3dchart_4 = Ladybug_3DChart(inputData=flatten(readepresult.airTemperature), xScale=number_slider_6)  # -> readMe, graphMesh, graphCurves, legend, legendBasePts, title, titleBasePts, dataPts, conditionalHOY; plug-in component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
pt_2 = Point(<point referenced from the Rhino model>)
number_slider_7 = Slider(0.1, range=0..0.1)
pt_3 = Point(<point referenced from the Rhino model>)
psychchart = Ladybug_PsychrometricChart(
    dryBulbTemperature=readepresult.airTemperature,
    relativeHumidity=readepresult.relativeHumidity,
    basePoint=pt_2,
    runIt=Toggle(True))  # -> readMe, port, totalComfortPercent, totalComfortOrNot, strategyNames, strategyPercentOfTime, strategyOrNot, port_2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; plug-in component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
pt_4 = Point(<point referenced from the Rhino model>)
pt_5 = Point(<point referenced from the Rhino model>)
adaptivechart = Ladybug_AdaptiveComfortChart(
    dryBulbTemperature=readepresult.airTemperature,
    meanRadiantTemperature=readepresult.meanRadTemperature,
    prevailingOutdoorTemp=importepw.dryBulbTemperature,
    basePoint=pt_3,
    runIt=Toggle(True))  # -> readMe, comfPercentOfTime, percentHotCold, comfortableOrNot, conditionOfPerson, degreesFromTarget, port, chartCurvesAndTxt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; plug-in component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
_3dchart_5 = Ladybug_3DChart(inputData=flatten(adaptivecomfortcalculator.comfortableOrNot), basePoint=pt_4, xScale=Slider(0.4, range=0..1))  # -> readMe, graphMesh, graphCurves, legend, legendBasePts, title, titleBasePts, dataPts, conditionalHOY; plug-in component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
_3dchart_6 = Ladybug_3DChart(
    inputData=flatten([adaptivecomfortcalculator.comfortableOrNot, adaptivecomfortcalculator.conditionOfPerson, pmvcomfortcalculator.comfortableOrNot]),
    basePoint=pt_5,
    xScale=number_slider_7,
    yScale=number_slider_7,
    zScale=number_slider_7)  # -> readMe, graphMesh, graphCurves, legend, legendBasePts, title, titleBasePts, dataPts, conditionalHOY; plug-in component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

# ----
# Run the analysis
# Result Visualization
# Analysis Recipe
panel_14 = Panel("http://apps1.eere.energy.gov/buildings/energyplus/weatherdata/2_asia_wmo_region_2/ARE_Abu.Dhabi.412170_IWEC.zip")
open_epw_stat_2 = Ladybug_OpenEPWAndSTATWeatherFiles(weatherFileURL=panel_14)  # -> epwFile, statFile; plug-in component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
number_slider_8 = Slider(45, range=0..100)
importlocation_2 = Ladybug_ImportLocation(epwFile=open_epw_stat_2.epwFile)  # -> location; plug-in component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
genclimatebasedsky = Honeybee_GenerateClimateBasedSky(north=number_slider_8, weatherFile=open_epw_stat_2.epwFile, month="12", day="21", hour="15")  # -> radiationValues, skyFilePath; plug-in component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
northarrow_2 = Ladybug_North(north=number_slider_8, scale=".05")  # -> northSign; plug-in component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
explodelocation = Ladybug_DecomposeLocation(location=importlocation_2)  # -> locationName, latitude, longitude, timeZone, elevation; plug-in component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
test_surfaces = Brep(flip.Surface)
radparameters_2 = Honeybee_RADParameters(quality=0, ab="3")  # -> readMe, radParameters; plug-in component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
gentestpts_2 = Honeybee_GenerateTestPoints(testSurface=test_surfaces, gridSize=Slider(0.3, range=0..1), distBaseSrf="0.75", moveTestMesh=True)  # -> readMe, simplify(testPoints), simplify(ptsVectors), simplify(facesArea), simplify(mesh); plug-in component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
doy_hoy = Ladybug_DOY_HOY(days="21", months="12", hours="15")  # -> HOY, DOY, date; plug-in component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
gridbasedsimulation = Honeybee_GridBasedSimulation(
    skyFile=genclimatebasedsky.skyFilePath,
    testPoints=gentestpts_2.testPoints,
    ptsVectors=gentestpts_2.ptsVectors,
    testMesh=gentestpts_2.mesh,
    simulationType=0,
    radParameters=radparameters_2.radParameters)  # -> analysisRecipe; plug-in component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
toggle_5 = BooleanToggle(True)
rundaylightanalysis_2 = Honeybee_RunDaylightSimulation(overwriteResults=True)  # -> readMe, analysisType, resultsUnit, results, testPts, resultFiles, radGeoFile, studyFolder, done; plug-in component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
pt_6 = Point(gentestpts_2.testPoints)
gradientlibrary_2 = Ladybug_GradientLibrary(gradIndex="1")  # -> customColors; plug-in component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
dom_2 = ConstructDomain(DomainStart="-.5", DomainEnd=".5")

rundaylightanalysis_3 = Honeybee_RunDaylightSimulation(
    HBObjects=flatten([brep_2, hb_epcontextsrf]),
    analysisRecipe=gridbasedsimulation,
    writeRad=toggle_5,
    runRad=toggle_5,
    numOfCPUs="4",
    radFileName=doy_hoy.date,
    overwriteResults=True)  # -> readMe, analysisType, resultsUnit, illuminance_values, testPts, illuminance_files, radGeoFile, studyFolder, done; plug-in component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

# ---- group: Study Title
merge = Merge(
    Data2=flatten(rundaylightanalysis_3.analysisType),
    Data3=flatten(doy_hoy.date),
    Data4=flatten(explodelocation.locationName))
join = TextJoin(Text=merge)

# ----
# daylight simulation
annualdaylightsimulation_2 = Honeybee_AnnualDaylightSimulation(
    epwWeatherFile=open_epw_stat_2.epwFile,
    testPoints=gentestpts_2.testPoints,
    ptsVectors=gentestpts_2.ptsVectors,
    testMesh=gentestpts_2.mesh,
    radParameters=radparameters_2.radParameters)  # -> analysisRecipe; disabled; plug-in component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
legendpar_3 = Ladybug_LegendParameters(lowBound=Slider(100, range=0..100), highBound=Slider(3000, range=0..10000), customColors=flatten(gradientlibrary_2))  # -> legendPar; plug-in component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
recolormesh_2 = Ladybug_RecolorMesh(
    analysisResult=rundaylightanalysis_3.illuminance_values,
    inputMesh=gentestpts_2.mesh,
    heightDomain=dom_2,
    legendPar=legendpar_3,
    analysisTitle=join,
    legendTitle=rundaylightanalysis_3.resultsUnit)  # -> readMe, newMesh, newLegend, legendBasePt, meshColors, legendColors; plug-in component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

panel_15 = Panel(rundaylightanalysis_3.studyFolder)
tag = TextTag3D(Location=pt_6, Text=rundaylightanalysis_3.illuminance_values, Size=Slider(0.04, range=0..0.1), Justification=7)
panel_16 = Panel(rundaylightanalysis_3.illuminance_files)
bnd = Bounds(Numbers=rundaylightanalysis_3.illuminance_values)
panel_17 = Panel(bnd)
panel_18 = Panel(join)
