# Grasshopper definition Yao_Xi_Shading.gh (Grasshopper 0.9.72)
# plug-ins: Python Interpreter

ladybug = Ladybug_Ladybug()  # -> Vviiiiiiiiiizzz; plug-in component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
path = FilePath("\\juno.design.upenn.edu\home\GRAD\ARCH\xiyao\My Documents\753\USA_PA_Philadelphia.Intl.AP.724080_TMY3\USA_PA_Philadelphia.Intl.AP.724080_TMY3.epw")
importepw = Ladybug_ImportEpw(epwFile=path)  # -> readMe, latitude, location, dryBulbTemperature, dewPointTemperature, relativeHumidity, windSpeed, windDirection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; plug-in component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
analysisperiod = Ladybug_AnalysisPeriod()  # -> readMe, analysisPeriod; plug-in component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
panel = Panel("4")  # disabled
panel_2 = Panel("24")  # disabled
panel_3 = Panel("12")  # disabled
panel_4 = Panel("8")  # disabled
panel_5 = Panel("1")  # disabled
panel_6 = Panel("1")  # disabled
pt = Point(<point referenced from the Rhino model>)
series = Series(Start=panel_5, Step=1, Count=panel_2)  # disabled
brep = Brep([<brep referenced from the Rhino model> x2])
series_2 = Series(Start=panel_6, Step=panel, Count=panel_4)  # disabled
series_3 = Series(Start=panel_5, Step=1, Count=panel_3)  # disabled
solaradjusttemperature = Ladybug_OutdoorSolarTemperatureAdjustor(
    location=importepw.location,
    cumSkyMtxOrDirNormRad=importepw.directNormalRadiation,
    diffuseHorizRad=importepw.diffuseHorizontalRadiation,
    meanRadTemperature=importepw.dryBulbTemperature,
    bodyPosture=Slider(1, range=0..2),
    bodyLocation=pt,
    contextShading=brep,
    analysisPeriodOrHOY=analysisperiod.analysisPeriod,
    parallel=Toggle(True),
    runIt=Toggle(True))  # -> readMe, port, effectiveRadiantField, MRTDelta, solarAdjustedMRT, port_2, mannequinMesh, port_3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; plug-in component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
sunpath = Ladybug_SunPath(
    location=importepw.location,
    hour=series,
    day=series_2,
    month=series_3,
    timeStep=1,
    annualHourlyData=flatten(importepw.directNormalRadiation),
    dailyOrAnnualSunPath=True)  # -> readMe, sunVectors, sunAltitudes, sunAzimuths, port, sunSpheresMesh, sunPathCrvs, legend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; disabled; plug-in component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
branchdatadailymonthlyhourly = Ladybug_BranchData()  # -> dataEachDay, dataEachMonth, dataEachHour; plug-in component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
series_4 = Series(Start=0, Step=1, Count="31")
series_5 = Series(Start="3", Step=1, Count="7")
series_6 = Series(Start="8", Step=1, Count="12")
toggle = BooleanToggle(True)  # disabled
doy_hoy = Ladybug_DOY_HOY(days=series_4, months=series_5, hours=series_6)  # -> HOY, DOY, date; plug-in component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
outdoorcomfortcalculator = Ladybug_OutdoorComfortCalculator(
    dryBulbTemperature=importepw.dryBulbTemperature,
    meanRadiantTemperature=solaradjusttemperature.solarAdjustedMRT,
    windSpeed_tenMeters=importepw.windSpeed,
    relativeHumidity=importepw.relativeHumidity,
    runIt=Toggle(True))  # -> readMe, port, universalThermalClimateIndex, comfortableOrNot, thermalStress, conditionOfPerson, port_2, percentOfTimeComfortable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; plug-in component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
panel_7 = Panel("0.1")  # disabled
bang = ExplodeTree(Data=sunpath.sunVectors)  # -> Branch0, Branch1; disabled
brep_2 = Brep([<brep referenced from the Rhino model> x3])  # disabled
panel_8 = Panel("2")  # disabled
brep_3 = Brep([<brep referenced from the Rhino model> x2])  # disabled
sunlighthoursanalysis = Ladybug_SunlightHoursAnalysis(
    geometry=flatten(brep_2),
    gridSize=panel_8,
    disFromBase=panel_7,
    sunVectors=flatten(sunpath.sunVectors),
    timeStep=1,
    runIt=toggle)  # -> readMe, contextMesh, analysisMesh, testPts, testVec, port, sunlightHoursResult, sunlightHoursMesh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; disabled; plug-in component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
srf = Surface(<surface referenced from the Rhino model>)  # disabled
addition = Addition(A=doy_hoy.HOY, B=7)
shadowstudy = Ladybug_ShadowStudy(geometry=[brep_3, srf], sunVector=bang.Branch0)  # -> readMe, shadow, shade; disabled; plug-in component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
pt_2 = Point(Point(88.47226712, 166.2122937, 0))
item = ListItem(List=outdoorcomfortcalculator.conditionOfPerson, Index=addition, Wrap=True)
_3dchart = Ladybug_3DChart(inputData=flatten(outdoorcomfortcalculator.conditionOfPerson), basePoint=pt_2, xScale="0.25", zScale="0")  # -> readMe, graphMesh, graphCurves, legend, legendBasePts, titleText, titleBasePts, conditionalHOY; plug-in component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
panel_9 = Panel(sunlighthoursanalysis.readMe)  # disabled
larger = LargerThan(FirstNumber=outdoorcomfortcalculator.conditionOfPerson, SecondNumber="-1")  # -> LargerThan, OrEqualTo
smaller = SmallerThan(FirstNumber=outdoorcomfortcalculator.conditionOfPerson, SecondNumber="1")  # -> SmallerThan, OrEqualTo
panel_10 = Panel(outdoorcomfortcalculator.conditionOfPerson)
larger_2 = LargerThan(FirstNumber=item, SecondNumber="-1")  # -> LargerThan, OrEqualTo
smaller_2 = SmallerThan(FirstNumber=item, SecondNumber="1")  # -> SmallerThan, OrEqualTo
panel_11 = Panel(doy_hoy.HOY)
and = GateAnd(A=larger.OrEqualTo, B=smaller.OrEqualTo)
and_2 = GateAnd(A=larger_2.OrEqualTo, B=smaller_2.OrEqualTo)
int = Integer(and)
preview = CustomPreview(Geometry=[_3dchart.graphCurves, _3dchart.legend], Shader=ColourSwatch(SwatchColor=RGB(0, 0, 0)))
int_2 = Integer(and_2)
panel_12 = Panel(".5")  # disabled
toggle_2 = BooleanToggle(True)  # disabled
toggle_3 = BooleanToggle(True)  # disabled
ma = MassAddition(Input=int)  # -> Result, PartialResults
panel_13 = Panel("7")  # disabled
panel_14 = Panel("20")  # disabled
ma_2 = MassAddition(Input=int_2)  # -> Result, PartialResults
brep_4 = Brep(<brep referenced from the Rhino model>)  # disabled
srf_2 = Surface(<surface referenced from the Rhino model>)  # disabled
panel_15 = Panel(ma.Result)
panel_16 = Panel(ma_2.Result)
comfortshadebenefit = Ladybug_ComfortShadeBenefitEvaluator(
    location=importepw.location,
    temperatures=outdoorcomfortcalculator.universalThermalClimateIndex,
    balanceTemperature=panel_14,
    testShades=srf_2,
    testRegion=brep_4,
    gridSize=panel_12,
    skyResolution=panel_13,
    delNonIntersect=False,
    parallel=toggle_3,
    runIt=toggle_2)  # -> readMe, port, sunVectors, regionTestPts, shadeMesh, legend, legendBasePoint, port_2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; disabled; plug-in component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
number_slider = Slider(75, range=0..100)  # disabled
shadecreator = Honeybee_OptimalShadeCreator(shadeMesh=comfortshadebenefit.shadeMesh, shadeNetEffect=comfortshadebenefit.shadeNetEffect, percentToKeep=number_slider)  # -> readMe, energySavedByShade, areaOfShade, newColoredMesh, newShadeBrep; disabled; plug-in component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
panel_17 = Panel(shadecreator.energySavedByShade)  # disabled
swatch = ColourSwatch(SwatchColor=RGB(0, 0, 0))  # disabled
panel_18 = Panel(shadecreator.areaOfShade)  # disabled
panel_19 = Panel(shadecreator.newColoredMesh)  # disabled
preview_2 = CustomPreview(Geometry=shadecreator.newShadeBrep, Shader=swatch)  # disabled
