# Grasshopper definition Yao_Xi_Shading.gh (Grasshopper 0.9.72)
# plug-ins: Python Interpreter

ladybug = Ladybug_Ladybug()  # -> Vviiiiiiiiiizzz; plug-in component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
path = FilePath("\\juno.design.upenn.edu\home\GRAD\ARCH\xiyao\My Documents\753\USA_PA_Philadelphia.Intl.AP.724080_TMY3\USA_PA_Philadelphia.Intl.AP.724080_TMY3.epw")
importepw = Ladybug_ImportEpw(epwFile=path)  # -> readMe, latitude, location, dryBulbTemperature, dewPointTemperature, relativeHumidity, windSpeed, windDirection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; plug-in component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
analysisperiod = Ladybug_AnalysisPeriod()  # -> readMe, analysisPeriod; plug-in component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
pt = Point(Point(-8.789294959, 3.041699643, 1.5))
brep = Brep([<brep referenced from the Rhino model> x2])
solaradjusttemperature = Ladybug_OutdoorSolarTemperatureAdjustor(
    location=importepw.location,
    cumSkyMtxOrDirNormRad=importepw.directNormalRadiation,
    diffuseHorizRad=importepw.diffuseHorizontalRadiation,
    meanRadTemperature=importepw.dryBulbTemperature,
    bodyPosture=Slider(1, range=0..2),
    bodyLocation=pt,
    contextShading=brep,
    analysisPeriodOrHOY=analysisperiod.analysisPeriod,
    parallel=Toggle(True),
    runIt=Toggle(True))  # -> readMe, port, effectiveRadiantField, MRTDelta, solarAdjustedMRT, port_2, mannequinMesh, port_3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; plug-in component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
outdoorcomfortcalculator = Ladybug_OutdoorComfortCalculator(
    dryBulbTemperature=importepw.dryBulbTemperature,
    meanRadiantTemperature=solaradjusttemperature.solarAdjustedMRT,
    windSpeed_tenMeters=importepw.windSpeed,
    relativeHumidity=importepw.relativeHumidity,
    runIt=Toggle(True))  # -> readMe, port, universalThermalClimateIndex, comfortableOrNot, thermalStress, conditionOfPerson, port_2, percentOfTimeComfortable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; plug-in component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
larger = LargerThan(FirstNumber=outdoorcomfortcalculator.conditionOfPerson, SecondNumber="-1")  # -> LargerThan, OrEqualTo
smaller = SmallerThan(FirstNumber=outdoorcomfortcalculator.conditionOfPerson, SecondNumber="1")  # -> SmallerThan, OrEqualTo
and = GateAnd(A=larger.OrEqualTo, B=smaller.OrEqualTo)
pt_2 = Point(Point(88.47226712, 166.2122937, 0))
int = Integer(and)
ma = MassAddition(Input=int)  # -> Result, PartialResults
_3dchart = Ladybug_3DChart(inputData=flatten(outdoorcomfortcalculator.conditionOfPerson), basePoint=pt_2, xScale="0.25", zScale="0")  # -> readMe, graphMesh, graphCurves, legend, legendBasePts, titleText, titleBasePts, conditionalHOY; plug-in component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
panel = Panel(ma.Result)
preview = CustomPreview(Geometry=[_3dchart.graphCurves, _3dchart.legend], Shader=ColourSwatch(SwatchColor=RGB(0, 0, 0)))
busstop_shade = Brep(<brep referenced from the Rhino model>)
brep_2 = Brep(<brep referenced from the Rhino model>)
comfortshadebenefit = Ladybug_ComfortShadeBenefitEvaluator(
    location=importepw.location,
    temperatures=outdoorcomfortcalculator.universalThermalClimateIndex,
    balanceTemperature="20",
    testShades=busstop_shade,
    testRegion=brep_2,
    gridSize=".5",
    skyResolution="7",
    delNonIntersect=False,
    parallel=Toggle(True),
    runIt=Toggle(True))  # -> readMe, port, sunVectors, regionTestPts, shadeMesh, legend, legendBasePoint, port_2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; plug-in component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
shadecreator = Honeybee_OptimalShadeCreator(
    shadeMesh=comfortshadebenefit.shadeMesh,
    shadeNetEffect=comfortshadebenefit.shadeNetEffect,
    percentToKeep=Slider(60, range=0..100))  # -> readMe, energySavedByShade, areaOfShade, newColoredMesh, newShadeBrep; plug-in component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
panel_2 = Panel(shadecreator.energySavedByShade)
panel_3 = Panel(shadecreator.areaOfShade)
panel_4 = Panel(shadecreator.newColoredMesh)
preview_2 = CustomPreview(Geometry=shadecreator.newShadeBrep, Shader=ColourSwatch(SwatchColor=RGB(0, 0, 0)))
