# Grasshopper definition ComfortHour.gh (Grasshopper 0.9.72)
# plug-ins: Python Interpreter

callfromepconstrlibrary = Honeybee_CallFromEPConstructionLibrary()  # -> EPMaterials, EPWindowMaterils, EPConstructions; plug-in component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
searchepconstruction = Honeybee_SearchEPConstruction(EPConstrList=callfromepconstrlibrary.EPConstructions, standard="2", climateZone="2")  # -> EPSelectedConstr; plug-in component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
callfromepconstrlibrary_2 = Honeybee_CallFromEPConstructionLibrary()  # -> EPMaterials, EPWindowMaterils, EPConstructions; plug-in component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
item = ListItem(List=searchepconstruction, Index="5", Wrap=True)
item_2 = ListItem(List=searchepconstruction, Index="0", Wrap=True)
honeybee = Honeybee_Honeybee()  # -> Vviiiiiiiiiizzz; plug-in component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
ladybug = Ladybug_Ladybug()  # -> Vviiiiiiiiiizzz; plug-in component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
searchepconstruction_2 = Honeybee_SearchEPConstruction(EPConstrList=callfromepconstrlibrary_2.EPConstructions, standard="2", climateZone="2")  # -> EPSelectedConstr; plug-in component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
panel = Panel(searchepconstruction)
exterior_wall = Brep(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)
walls = Brep([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])

# ---- group: ceiling
ceiling = Brep([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])

# ---- group: floor
floor = Brep(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)

# ----
ledge = Brep(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)
wall_surface_with_opening = Brep(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)
item_3 = ListItem(List=searchepconstruction_2, Index="4", Wrap=True)
epwindowmat = Honeybee_EnergyPlusWindowMaterial(U_Value="0.08", SHGC="0.240", VT="0.42")  # -> EPMaterial; plug-in component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
# Geometry Preparation
panel_2 = Panel("0")
createhbsrfs = Honeybee_createHBSrfs(geometry=wall_surface_with_opening, srfType="0", EPConstruction=item_3)  # -> readMe, simplify(HBSurface); plug-in component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
createhbsrfs_2 = Honeybee_createHBSrfs(geometry=flatten(exterior_wall), srfType="0", EPConstruction=item)  # -> readMe, simplify(HBSurface); plug-in component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
createhbsrfs_3 = Honeybee_createHBSrfs(geometry=flatten(floor), srfType="2", EPConstruction=item_2)  # -> readMe, simplify(HBSurface); plug-in component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
createhbsrfs_4 = Honeybee_createHBSrfs(geometry=flatten(ledge), srfType="2", EPConstruction=item)  # -> readMe, simplify(HBSurface); plug-in component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
createhbsrfs_5 = Honeybee_createHBSrfs(geometry=ceiling, srfType="3")  # -> readMe, simplify(HBSurface); plug-in component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
createhbsrfs_6 = Honeybee_createHBSrfs(geometry=walls, srfType=panel_2, EPConstruction=item)  # -> readMe, simplify(HBSurface); plug-in component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
epconstruction = Honeybee_EnergyPlusConstruction(layer_1=epwindowmat)  # -> EPConstruction; plug-in component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
furnitures = Brep([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])
srf = Surface([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])
addhbglz = Honeybee_addHBGlz(HBObj=createhbsrfs.HBSurface, childSurfaces=flatten(srf), EPConstruction=epconstruction)  # -> simplify(HBObjWGLZ); plug-in component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
glazingcreator = Honeybee_GlazingBasedOnRatio(
    HBObjects=createhbsrfs.HBSurface,
    glzRatio="0.6",
    breakUpWindow=Toggle(True),
    windowHeight=Slider(1.904, range=0..3),
    sillHeight=Slider(0.092, range=0..2),
    splitGlzVertDist=[Slider(0.2, range=0..1), Slider(0.2, range=0..1)],
    runIt=Toggle(True))  # -> readMe, HBObjWGLZ; plug-in component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

# ---- group: Make all surfaces except the exterior wall adiabatic
makeadiabatic = Honeybee_MakeAdiabatic(HBSrfs=flatten([createhbsrfs_6.HBSurface, createhbsrfs_5.HBSurface, createhbsrfs_3.HBSurface]))  # -> HBSrfs; plug-in component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

# ----
bldgprograms = Honeybee_bldgPrograms({"Office": 0, "Retail": 1, "MidriseApartment": 2, "PrimarySchool": 3, "SecondarySchool": 4, "SmallHotel": 5, "LargeHotel": 6, "Hospital": 7, "Outpatient": 8, "Warehouse": 9, "SuperMarket": 10, "FullServiceRestaurant": 11, "QuickServiceRestaurant": 12}, selected="MidriseApartment")
listzoneprograms = Honeybee_ListZonePrograms(bldgProgram=bldgprograms)  # -> MidriseApartmentZonePrograms; plug-in component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
item_4 = ListItem(List=listzoneprograms, Index=0, Wrap=True)

# ---- group: collect all honeybee surfaces
brep = Brep(flatten([makeadiabatic, createhbsrfs_4.HBSurface, createhbsrfs_2.HBSurface, addhbglz]))

# ----
panel_3 = Panel(item_4)
createhbzones = Honeybee_createHBZones(name="test_room", zoneProgram=item_4, HBSurfaces=flatten(brep), isConditioned=Toggle(False))  # -> readMe, HBZone; plug-in component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

number_slider = Slider(60, range=45..135)
number_slider_2 = Slider(45, range=45..135)
number_slider_3 = Slider(131, range=45..135)
galapagos = Galapagos(fitness=adaptivecomfortcalculator, gene=[number_slider_2, number_slider_3, number_slider])
crv = Curve(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)
crv_2 = Curve(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)
crv_3 = Curve(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)
crv_4 = Curve(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)
crv_5 = Curve(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)
crv_6 = Curve(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)
rad = Radians(Degrees=number_slider_2)
Y = UnitY(Factor="-0.29")
# Fins & Shading Control
rad_2 = Radians(Degrees=number_slider_2)
Y_2 = UnitY(Factor="-0.29")
Y_3 = UnitY(Factor="-0.29")
Y_4 = UnitY(Factor="-0.29")
Y_5 = UnitY(Factor="-0.29")
rad_3 = Radians(Degrees=number_slider_2)
pcen = PolygonCenter(Polyline=crv_6)  # -> CenterV, CenterE, CenterA
rad_4 = Radians(Degrees=number_slider_3)
rad_5 = Radians(Degrees=number_slider_3)
pcen_2 = PolygonCenter(Polyline=crv)  # -> CenterV, CenterE, CenterA
rad_6 = Radians(Degrees=number_slider)
Y_6 = UnitY(Factor="-0.29")
multiplication = Multiplication(A=Y_5, B=["2", "3", "4"])
rotate = Rotate(Geometry=crv_6, Angle=rad_2, Plane=pcen.CenterV)  # -> Geometry, Transform
pcen_3 = PolygonCenter(Polyline=crv_2)  # -> CenterV, CenterE, CenterA
pcen_4 = PolygonCenter(Polyline=crv_4)  # -> CenterV, CenterE, CenterA
Z = UnitZ(Factor="-0.952")
panel_4 = Panel("90")
rotate_2 = Rotate(Geometry=crv, Angle=rad, Plane=pcen_2.CenterV)  # -> Geometry, Transform
Z_2 = UnitZ(Factor="-0.952")
multiplication_2 = Multiplication(A=Y_4, B=["2", "3", "4"])
pcen_5 = PolygonCenter(Polyline=crv_3)  # -> CenterV, CenterE, CenterA
pcen_6 = PolygonCenter(Polyline=crv_5)  # -> CenterV, CenterE, CenterA
multiplication_3 = Multiplication(A=Y, B=["2", "3", "4"])
multiplication_4 = Multiplication(A=Y_6, B=["2", "3", "4"])
extr = Extrude(Base=rotate.Geometry, Direction=Z)
multiplication_5 = Multiplication(A=Y_2, B=["2", "3", "4"])
rotate_3 = Rotate(Geometry=crv_4, Angle=rad_6, Plane=pcen_4.CenterV)  # -> Geometry, Transform
Z_3 = UnitZ(Factor="-0.952")
multiplication_6 = Multiplication(A=Y_3, B=["2", "3", "4"])
Z_4 = UnitZ(Factor="-0.952")
extr_2 = Extrude(Base=rotate_2.Geometry, Direction=Z_2)
rotate_4 = Rotate(Geometry=crv_2, Angle=rad_3, Plane=pcen_3.CenterV)  # -> Geometry, Transform
rotate_5 = Rotate(Geometry=crv_3, Angle=rad_5, Plane=pcen_5.CenterV)  # -> Geometry, Transform
rotate_6 = Rotate(Geometry=crv_5, Angle=rad_4, Plane=pcen_6.CenterV)  # -> Geometry, Transform
Z_5 = UnitZ(Factor="-0.952")
Z_6 = UnitZ(Factor="-0.952")
move = Move(Geometry=extr_2, Motion=[multiplication_2, Y_4])  # -> Geometry, Transform
move_2 = Move(Geometry=extr, Motion=[multiplication_4, Y_6])  # -> Geometry, Transform
extr_3 = Extrude(Base=rotate_3.Geometry, Direction=Z_3)
move_3 = Move(Geometry=extr_3, Motion=[multiplication_6, Y_3])  # -> Geometry, Transform
extr_4 = Extrude(Base=rotate_4.Geometry, Direction=Z_4)
move_4 = Move(Geometry=extr_4, Motion=[multiplication_3, Y])  # -> Geometry, Transform
extr_5 = Extrude(Base=rotate_5.Geometry, Direction=Z_5)
move_5 = Move(Geometry=extr_5, Motion=[multiplication_5, Y_2])  # -> Geometry, Transform
extr_6 = Extrude(Base=rotate_6.Geometry, Direction=Z_6)
move_6 = Move(Geometry=extr_6, Motion=[multiplication, Y_5])  # -> Geometry, Transform
merge = Merge(Data1=extr, Data2=move_2.Geometry)
merge_2 = Merge(Data1=extr_2, Data2=move.Geometry)
merge_3 = Merge(Data1=extr_4, Data2=move_4.Geometry)
merge_4 = Merge(Data1=extr_5, Data2=move_5.Geometry)
merge_5 = Merge(Data1=extr_3, Data2=move_3.Geometry)
merge_6 = Merge(Data1=extr_6, Data2=move_6.Geometry)
brep_2 = Brep([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])
merge_7 = Merge(Data1=merge, Data2=merge_2, Data3=merge_3, Data4=merge_4, Data5=merge_5, Data6=merge_6, Data7=brep_2)

wires = BrepWireframe(Brep=createhbzones.HBZone, Density=-1)

number_slider_4 = Slider(45, range=0..100)
northarrow = Ladybug_North(north=number_slider_4, scale=".05")  # -> northSign; plug-in component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

path = FilePath("E:\753\MEX_Mexico.City.766790_IWEC\MEX_Mexico.City.766790_IWEC.epw")
panel_5 = Panel("12")  # disabled
panel_6 = Panel("21")  # disabled
panel_7 = Panel("15")  # disabled
createhbsrfs_7 = Honeybee_createHBSrfs(geometry=merge_7)  # -> readMe, simplify(HBSurface); plug-in component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
# Natural Ventilation
setepnatvent = Honeybee_SetEPAirFlow(HBZones=createhbzones.HBZone, naturalVentilationType="1", minIndoorTempForNatVent="18", minOutdoorTempForNatVent="18")  # -> readMe, simplify(HBZones); plug-in component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
hb_epcontextsrf = HoneybeeEPContextSurfaces(shdSurfaces=simplify(merge_7))  # -> HBContext; inputs shdSurfaces: list of GeometryBase, justBoundingBox: Boolean
# ---------- hb_epcontextsrf: Python ----------
"""
prepare shading/context geometries

    Args:
        northVectorOrRotation: A vector that shows North or a number that shows
                               the rotation of the North from the Y axis
        bldgMasses: List of closed Breps as thermal zones.
    Returns:
        report: ...
        thermalZones: Thermal zone's geometries for visualiza
"""

ghenv.Component.Name = 'Honeybee EP context Surfaces'
ghenv.Component.NickName = 'HB_EPContextSrf'
ghenv.Component.Message = 'VER 0.0.58\nNOV_20_2015'
ghenv.Component.Category = "Honeybee"
ghenv.Component.SubCategory = "09 | Energy | Energy"
#compatibleHBVersion = VER 0.0.57\nNOV_01_2015
#compatibleLBVersion = VER 0.0.59\nFEB_01_2015
ghenv.Component.AdditionalHelpFromDocStrings = "2"

import rhinoscriptsyntax as rs
import Rhino as rc
import scriptcontext as sc
import os
import System
import Grasshopper.Kernel as gh
import uuid

tolerance = sc.doc.ModelAbsoluteTolerance
import math


def main(shdSurfaces, EPTransSchedule, meshingSettings, justBoundingBox):
    
    # import the classes
    if sc.sticky.has_key('honeybee_release'):

        try:
            if not sc.sticky['honeybee_release'].isCompatible(ghenv.Component): return -1
        except:
            warning = "You need a newer version of Honeybee to use this compoent." + \
            " Use updateHoneybee component to update userObjects.\n" + \
            "If you have already updated userObjects drag Honeybee_Honeybee component " + \
            "into canvas and try again."
            w = gh.GH_RuntimeMessageLevel.Warning
            ghenv.Component.AddRuntimeMessage(w, warning)
            return -1
        
        # don't customize this part
        hb_EPSrf = sc.sticky["honeybee_EPSurface"]
        hb_EPSHDSurface = sc.sticky["honeybee_EPShdSurface"]
        hb_RADMaterialAUX = sc.sticky["honeybee_RADMaterialAUX"]
        hb_EPObjectsAux = sc.sticky["honeybee_EPObjectsAUX"]()
        HBScheduleList = sc.sticky["honeybee_ScheduleLib"].keys()

        ########################################################################
        #----------------------------------------------------------------------#
        shdBreps = []
        # create bounding box of shading geometries
        if justBoundingBox:
            for brep in shdSurfaces:
                if brep.Faces.Count>1 or not brep.Faces[0].IsPlanar(sc.doc.ModelAbsoluteTolerance):
                    shdBreps.append(brep.GetBoundingBox(True).ToBrep())
                else:
                    shdBreps.append(brep)
        else:
            shdBreps = shdSurfaces
        
        shadingClasses = []
        shadingMeshPreview = []
        
        if meshingSettings == None:
            mp = rc.Geometry.MeshingParameters.Minimal
            mp.SimplePlanes = True
        else:
            mp = meshingSettings
        
        def getRadMaterialName(radMaterial):
            nameStr = radMaterial.split(" ")[2]
            name =  nameStr.split("\n")[0]
            return name
        
        for brepCount, brep in enumerate(shdBreps):
            if brep != None:
                isPlanar = True
                # check planarity
                for face in brep.Faces:
                    if not face.IsPlanar(tolerance):
                        isPlanar = False
                        break
                
                shadingBreps = []
                if not isPlanar:
                    meshArray = rc.Geometry.Mesh.CreateFromBrep(brep, mp)
                    for mesh in meshArray:
                        for meshFace in range(mesh.Faces.Count):
                            vertices = list(mesh.Faces.GetFaceVertices(meshFace))[1:]
                            vertices = vertices + [sc.doc.ModelAbsoluteTolerance]
                            # create the brep from mesh
                            shdBrep = rc.Geometry.Brep.CreateFromCornerPoints(*vertices)
                            shadingBreps.append(shdBrep)
                else:
                    for face in brep.Faces:
                        shadingBreps.append(face.DuplicateFace(False))
                
                for faceCount, shdBrep in enumerate(shadingBreps):
                        thisShading = hb_EPSHDSurface(shdBrep, 1000*brepCount + faceCount, 'shdSrf_' + `brepCount` + '_' + `faceCount` + "_" + str(uuid.uuid4()))
                        
                        # add transmittance schedule if any
                        if EPTransSchedule!=None:
                            schedule= EPTransSchedule.upper()
                            if schedule!=None and not schedule.lower().endswith(".csv") and schedule not in HBScheduleList:
                                msg = "Cannot find " + schedule + " in Honeybee schedule library."
                                print msg
                                ghenv.Component.AddRuntimeMessage(gh.GH_RuntimeMessageLevel.Warning, msg)
                                return -1
                            elif schedule!=None and schedule.lower().endswith(".csv"):
                                # check if csv file is existed
                                if not os.path.isfile(schedule):
                                    msg = "Cannot find the shchedule file: " + schedule
                                    print msg
                                    ghenv.Component.AddRuntimeMessage(gh.GH_RuntimeMessageLevel.Warning, msg)
                                    return -1
                            
                            thisShading.TransmittanceSCH = schedule
                        
                        # add the Rad Material if any
                        if RADMaterial!=None:
                            # if it is just the name of the material make sure it is already defined
                            if len(RADMaterial.split(" ")) == 1:
                                # if the material is not in the library add it to the library
                                if not hb_RADMaterialAUX.isMatrialExistInLibrary(RADMaterial):
                                    warningMsg = "Can't find " + RADMaterial + " in RAD Material Library.\n" + \
                                                "Add the material to the library and try again."
                                    ghenv.Component.AddRuntimeMessage(gh.GH_RuntimeMessageLevel.Warning, warningMsg)
                                    return
                                
                                try:
                                    thisShading.setRADMaterial(RADMaterial)
                                except Exception, e:
                                    print e
                                    warningMsg = "You are using an old version of Honeybee_Honeybee! Update your files and try again."
                                    print warningMsg
                                    ghenv.Component.AddRuntimeMessage(gh.GH_RuntimeMessageLevel.Warning, warningMsg)
                                    return
                                
                                addedToLib = True
                            else:
                                
                                # try to add the material to the library
                                addedToLib, thisShading.RadMaterial = hb_RADMaterialAUX.analyseRadMaterials(RADMaterial, True)
                                
                            if addedToLib==False:
                                warningMsg = "Failed to add " + RADMaterial + " to the Library."
                                ghenv.Component.AddRuntimeMessage(gh.GH_RuntimeMessageLevel.Warning, warningMsg)
                                return
                        
                        # add shading to the list
                        shadingClasses.append(thisShading)
                
        # add to the hive
        hb_hive = sc.sticky["honeybee_Hive"]()
        HBContext  = hb_hive.addToHoneybeeHive(shadingClasses, ghenv.Component.InstanceGuid.ToString())
        return HBContext
        ################################################################################################
    else:
        print "You should first let Honeybee to fly..."
        w = gh.GH_RuntimeMessageLevel.Warning
        ghenv.Component.AddRuntimeMessage(w, "You should first let Honeybee to fly...")
        return -1
        

if _shdSurfaces and _shdSurfaces[0]!=None:
    # add cleaning function
    result= main(_shdSurfaces, EPTransSchedule_, meshingSettings_, justBoundingBox_)
    
    if result != -1: HBContext = result
# ---------- end hb_epcontextsrf ----------
toggle = BooleanToggle(True)
epoutput = Honeybee_GenerateEPOutput(
    zoneEnergyUse=toggle,
    zoneGainsAndLosses="False",
    zoneComfortMetrics=toggle,
    surfaceTempAnalysis="False",
    timestep="hourly")  # -> report, flatten(simulationOutputs); plug-in component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
number_slider_5 = Slider(500, range=0..1000)  # disabled
number_slider_6 = Slider(2000, range=0..10000)  # disabled

# ----
# To set analysis period for Galapagos
panel_8 = Panel("1")
analysisperiod = Ladybug_AnalysisPeriod(fromMonth=panel_8, toMonth="3")  # -> readMe, analysisPeriod; plug-in component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

toggle_2 = BooleanToggle(True)
legendpar = Ladybug_LegendParameters(lowBound=number_slider_5, highBound=number_slider_6)  # -> legendPar; disabled; plug-in component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

floor_2 = Brep(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)  # disabled
genclimatebasedsky = Honeybee_GenerateClimateBasedSky(north=number_slider_4, weatherFile=path, month=panel_5, day=panel_6, hour=panel_7)  # -> radiationValues, skyFilePath; disabled; plug-in component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
panel_9 = Panel("3")  # disabled
panel_10 = Panel("0.5")  # disabled
panel_11 = Panel("0.762")  # disabled
flip = Flip(Surface=floor_2)  # -> Surface, Result; disabled
gentestpts = Honeybee_GenerateTestPoints(testSurface=flip.Surface, gridSize=panel_10, distBaseSrf=panel_11, moveTestMesh=True)  # -> readMe, simplify(testPoints), simplify(ptsVectors), simplify(facesArea), simplify(mesh); disabled; plug-in component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
radparameters = Honeybee_RADParameters(quality=0, ad=panel_9)  # -> readMe, radParameters; disabled; plug-in component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
panel_12 = Panel("0")  # disabled
gridbasedsimulation = Honeybee_GridBasedSimulation(
    skyFile=genclimatebasedsky.skyFilePath,
    testPoints=gentestpts.testPoints,
    ptsVectors=gentestpts.ptsVectors,
    testMesh=gentestpts.mesh,
    simulationType=panel_12,
    radParameters=radparameters.radParameters)  # -> analysisRecipe; disabled; plug-in component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
toggle_3 = BooleanToggle(True)  # disabled
rundaylightanalysis = Honeybee_RunDaylightSimulation(
    HBObjects=flatten([createhbzones.HBZone, createhbsrfs_7.HBSurface]),
    analysisRecipe=gridbasedsimulation,
    writeRad=toggle_3,
    runRad=toggle_3,
    overwriteResults=True)  # -> readMe, analysisType, resultsUnit, illuminance_values, testPts, resultFiles, radGeoFile, studyFolder, done; disabled; plug-in component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
panel_13 = Panel("Illuminance Value(Lux)")  # disabled
panel_14 = Panel("Daylight Analysis")  # disabled
panel_15 = Panel(rundaylightanalysis.illuminance_values)  # disabled
recolormesh = Ladybug_ReColorMesh(
    analysisResult=flatten(rundaylightanalysis.illuminance_values),
    inputMesh=gentestpts.mesh,
    legendPar=legendpar,
    analysisTitle=panel_14,
    legendTitle=panel_13)  # -> readMe, newMesh, newLegend, legendBasePt, meshColors, legendColors; disabled; plug-in component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

runenergysimulation = Honeybee_RunEnergySimulation(
    north=number_slider_4,
    epwFile=path,
    HBZones=flatten(setepnatvent.HBZones),
    HBContext=flatten(hb_epcontextsrf),
    simulationOutputs=flatten(epoutput.simulationOutputs),
    writeIdf=toggle_2,
    runEnergyPlus=toggle_2)  # -> report, idfFileAddress, resultFileAddress; plug-in component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
number_slider_7 = Slider(2, range=0..10)  # disabled
legendpar_2 = Ladybug_LegendParameters(numSegments=number_slider_7)  # -> legendPar; disabled; plug-in component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
importepw = Ladybug_ImportEpw(epwFile=path)  # -> readMe, latitude, location, dryBulbTemperature, dewPointTemperature, relativeHumidity, windSpeed, windDirection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; plug-in component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
panel_16 = Panel(importepw.dryBulbTemperature)
importepw_2 = Ladybug_ImportEpw(epwFile=path)  # -> readMe, latitude, location, dryBulbTemperature, dewPointTemperature, relativeHumidity, windSpeed, windDirection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; plug-in component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
readepresult = Honeybee_ReadEPResult(resultFileAddress=runenergysimulation.resultFileAddress)  # -> port, port_2, port_3, port_4, electricLight, electricEquip, fanElectric, port_5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; plug-in component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
panel_17 = Panel(readepresult.meanRadTemperature)
_3dchart = Ladybug_3DChart(inputData=flatten([readepresult.meanRadTemperature, importepw.dryBulbTemperature]), xScale=Slider(0.25, range=0..1))  # -> readMe, graphMesh, graphCurves, legend, legendBasePts, title, titleBasePts, dataPts, conditionalHOY; plug-in component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
panel_18 = Panel(readepresult.airTemperature)
# Lighting Electricity
split = SplitList(List=readepresult.electricLight, Index="7")  # -> ListA, ListB
ma = MassAddition(Input=split.ListB)  # -> Result, PartialResults
panel_19 = Panel(ma.Result)
toggle_4 = BooleanToggle(True)
# Comfort
pmvcomfortcalculator = Ladybug_PMVComfortCalculator(
    dryBulbTemperature=readepresult.airTemperature,
    meanRadiantTemperature=readepresult.meanRadTemperature,
    windSpeed="0.05",
    relativeHumidity=readepresult.relativeHumidity,
    clothingLevel="1",
    calcBalanceTemperature=toggle_4,
    runIt=toggle_4)  # -> readMe, port, predictedMeanVote, percentPeopleDissatisfied, standardEffectiveTemperature, port_2, comfortableOrNot, percentOfTimeComfortable, port_3, balanceTemperature; plug-in component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
panel_20 = Panel(pmvcomfortcalculator.percentOfTimeComfortable)

panel_21 = Panel("7")  # disabled
panel_22 = Panel("1")  # disabled
panel_23 = Panel("24")  # disabled
number_slider_8 = Slider(45, range=0..100)  # disabled
legendpar_3 = Ladybug_LegendParameters(numSegments=panel_21)  # -> legendPar; disabled; plug-in component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
series = Series(Start=panel_22, Step=1, Count=panel_23)  # disabled
number_slider_9 = Slider(0.1, range=0..0.1)  # disabled
panel_24 = Panel("""1
2
3
4
5
6""")  # disabled
pt = Point(<point referenced from the Rhino model>)  # disabled
# Mapping Comfort on Sunpath
sunpath = Ladybug_SunPath(
    north=number_slider_8,
    location=importepw.location,
    hour=series,
    day=21,
    month=panel_24,
    timeStep=1,
    centerPt=pt,
    sunPathScale=number_slider_9,
    annualHourlyData=flatten(pmvcomfortcalculator.predictedMeanVote),
    legendPar=legendpar_3,
    dailyOrAnnualSunPath=True)  # -> readMe, sunVectors, sunAltitudes, sunAzimuths, port, sunSpheresMesh, sunPathCrvs, legend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; disabled; plug-in component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
day_month_hour_calculator = Ladybug_Day_Month_Hour(HOY=sunpath.sunPositionsHOY)  # -> day, month, hour, date; disabled; plug-in component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
panel_25 = Panel("1")  # disabled
ln = Line(StartPoint=sunpath.sunPathCenPts, EndPoint=sunpath.sunPositions)  # disabled
Z_7 = UnitZ(Factor=panel_25)  # disabled
move_7 = Move(Geometry=sunpath.sunPositions, Motion=Z_7)  # -> Geometry, Transform; disabled
tag = TextTag(Location=move_7.Geometry, Text=day_month_hour_calculator.date)  # disabled

adaptivecomfortcalculator = Ladybug_AdaptiveComfortCalculator(
    dryBulbTemperature=readepresult.airTemperature,
    meanRadiantTemperature=readepresult.meanRadTemperature,
    prevailingOutdoorTemp=importepw_2.dryBulbTemperature,
    windSpeed="0.3",
    runIt=Toggle(True))  # -> readMe, port, comfortableOrNot, conditionOfPerson, degreesFromTarget, port_2, targetTemperature, upperTemperatureBound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; plug-in component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
panel_26 = Panel(adaptivecomfortcalculator.percentOfTimeComfortable)
panel_27 = Panel(adaptivecomfortcalculator.percentHotCold)
larger = LargerThan(FirstNumber=pmvcomfortcalculator.comfortableOrNot, SecondNumber=0)  # -> LargerThan, OrEqualTo
larger_2 = LargerThan(FirstNumber=adaptivecomfortcalculator.comfortableOrNot, SecondNumber="0")  # -> LargerThan, OrEqualTo
ma_2 = MassAddition(Input=larger.LargerThan)  # -> Result, PartialResults
ma_3 = MassAddition(Input=larger_2.LargerThan)  # -> Result, PartialResults
panel_28 = Panel(ma_2.Result)
panel_29 = Panel(ma_3.Result)
_3dchart_2 = Ladybug_3DChart(inputData=flatten([adaptivecomfortcalculator.conditionOfPerson, pmvcomfortcalculator.predictedMeanVote]), xScale="0.25")  # -> readMe, graphMesh, graphCurves, legend, legendBasePts, title, titleBasePts, dataPts, conditionalHOY; plug-in component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

# ----
# Lighting Schedule
panel_30 = Panel(".5")  # disabled
panel_31 = Panel(".762")  # disabled
flip_2 = Flip(Surface=floor)  # -> Surface, Result; disabled
radparameters_2 = Honeybee_RADParameters(quality=0)  # -> readMe, radParameters; disabled; plug-in component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
gentestpts_2 = Honeybee_GenerateTestPoints(testSurface=flip_2.Surface, gridSize=panel_30, distBaseSrf=panel_31, moveTestMesh=True)  # -> readMe, simplify(testPoints), simplify(ptsVectors), simplify(facesArea), simplify(mesh); disabled; plug-in component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
panel_32 = Panel("58")  # disabled
number_slider_10 = Slider(0.1, range=0..0.1)  # disabled
annualdaylightsimulation = Honeybee_AnnualDaylightSimulation(
    north=number_slider_4,
    epwWeatherFile=path,
    testPoints=gentestpts_2.testPoints,
    ptsVectors=gentestpts_2.ptsVectors,
    testMesh=gentestpts_2.mesh,
    radParameters=radparameters_2.radParameters)  # -> analysisRecipe; disabled; plug-in component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
item_5 = ListItem(List=gentestpts_2.testPoints, Index=panel_32, Wrap=True)  # disabled
sph = Sphere(Base=item_5, Radius=number_slider_10)  # disabled
number_slider_11 = Slider(3, range=0..10)  # disabled
panel_33 = Panel("4")  # disabled
toggle_5 = BooleanToggle(True)  # disabled
lightingcontrol = Honeybee_LightingControlRecipe(
    controlType=panel_33,
    sensorPoints=item_5,
    lightingPower=250,
    lightingSetpoint=300,
    ballastLossFactor=20,
    standbyPower=3,
    delayTime=5)  # -> lightingControlGroup; disabled; plug-in component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
gethbzoneepschedules = Honeybee_GetZoneEnergyPlusSchedules(HBZone=createhbzones.HBZone)  # -> occupancySchedule, occupancyActivitySch, heatingSetPtSchedule, coolingSetPtSchedule, lightingSchedule, equipmentSchedule, infiltrationSchedule; disabled; plug-in component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
rundaylightanalysis_2 = Honeybee_RunDaylightSimulation(
    HBObjects=flatten([createhbzones.HBZone, createhbsrfs_7.HBSurface]),
    analysisRecipe=annualdaylightsimulation,
    writeRad=toggle_5,
    runRad=toggle_5,
    numOfCPUs=number_slider_11,
    overwriteResults=True)  # -> readMe, analysisType, resultsUnit, results, testPts, annual_analysis_files, radGeoFile, studyFolder, done; disabled; plug-in component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
panel_34 = Panel([rundaylightanalysis_2.analysisType, rundaylightanalysis_2.resultsUnit])  # disabled
panel_35 = Panel(rundaylightanalysis_2.annual_analysis_files)  # disabled
toggle_6 = BooleanToggle(True)  # disabled
readannualresultsi = Honeybee_ReadAnnualResultI(
    illFilesAddress=rundaylightanalysis_2.annual_analysis_files,
    testPoints=simplify(rundaylightanalysis_2.testPts),
    occupancyFiles=gethbzoneepschedules.lightingSchedule,
    DLAIllumThresholds=300,
    lightingControlGroups=lightingcontrol,
    runIt=toggle_6)  # -> DLA, UDLI_Less_100, UDLI_100_2000, UDLI_More_2000, CDA, sDA, annualProfiles, htmReport; disabled; plug-in component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
number_slider_12 = Slider(0.25, range=0..1)  # disabled

# ---- group: just for visualization
dsannualprofiles = Honeybee_DaysimAnnualProfiles(annualProfiles=readannualresultsi.annualProfiles)  # -> simplify(occupancyProfile), simplify(shadingProfiles), simplify(lightingControlProfiles), simplify(dgpProfile); disabled; plug-in component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
convertepschvalues = Honeybee_ConvertEnergyPlusScheduleToValues(schName=gethbzoneepschedules.lightingSchedule)  # -> values; disabled; plug-in component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

# ----
panel_36 = Panel(readannualresultsi.UDLI_Less_100)  # disabled

_3dchart_3 = Ladybug_3DChart(
    inputData=flatten([dsannualprofiles.lightingControlProfiles, convertepschvalues]),
    xScale=number_slider_12,
    legendPar=legendpar_2)  # -> readMe, graphMesh, graphCurves, legend, legendBasePts, title, titleBasePts, dataPts, conditionalHOY; disabled; plug-in component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
