# Grasshopper definition Visual Comfort.gh (Grasshopper 0.9.72)
# plug-ins: Python Interpreter, embryoA

number_slider = Slider(132, range=45..135)
number_slider_2 = Slider(45, range=45..135)
crv = Curve(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)
crv_2 = Curve(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)
crv_3 = Curve(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)
crv_4 = Curve(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)
crv_5 = Curve(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)
crv_6 = Curve(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)
rad = Radians(Degrees=number_slider_2)
Y = UnitY(Factor="-0.29")
rad_2 = Radians(Degrees=number_slider_2)
Y_2 = UnitY(Factor="-0.29")
Y_3 = UnitY(Factor="-0.29")
Y_4 = UnitY(Factor="-0.29")
Y_5 = UnitY(Factor="-0.29")
rad_3 = Radians(Degrees=number_slider_2)
pcen = PolygonCenter(Polyline=crv_5)  # -> CenterV, CenterE, CenterA
rad_4 = Radians(Degrees=number_slider)
rad_5 = Radians(Degrees=number_slider)
pcen_2 = PolygonCenter(Polyline=crv)  # -> CenterV, CenterE, CenterA
rad_6 = Radians(Degrees=Slider(60, range=45..135))
Y_6 = UnitY(Factor="-0.29")
multiplication = Multiplication(A=Y_5, B=["2", "3", "4"])
rotate = Rotate(Geometry=crv_5, Angle=rad_2, Plane=pcen.CenterV)  # -> Geometry, Transform
pcen_3 = PolygonCenter(Polyline=crv_2)  # -> CenterV, CenterE, CenterA
pcen_4 = PolygonCenter(Polyline=crv_4)  # -> CenterV, CenterE, CenterA
Z = UnitZ(Factor="-0.952")
panel = Panel("90")
rotate_2 = Rotate(Geometry=crv, Angle=rad, Plane=pcen_2.CenterV)  # -> Geometry, Transform
Z_2 = UnitZ(Factor="-0.952")
multiplication_2 = Multiplication(A=Y_4, B=["2", "3", "4"])
pcen_5 = PolygonCenter(Polyline=crv_3)  # -> CenterV, CenterE, CenterA
pcen_6 = PolygonCenter(Polyline=crv_6)  # -> CenterV, CenterE, CenterA
multiplication_3 = Multiplication(A=Y, B=["2", "3", "4"])
multiplication_4 = Multiplication(A=Y_6, B=["2", "3", "4"])
extr = Extrude(Base=rotate.Geometry, Direction=Z)
multiplication_5 = Multiplication(A=Y_2, B=["2", "3", "4"])
rotate_3 = Rotate(Geometry=crv_4, Angle=rad_6, Plane=pcen_4.CenterV)  # -> Geometry, Transform
Z_3 = UnitZ(Factor="-0.952")
multiplication_6 = Multiplication(A=Y_3, B=["2", "3", "4"])
Z_4 = UnitZ(Factor="-0.952")
extr_2 = Extrude(Base=rotate_2.Geometry, Direction=Z_2)
rotate_4 = Rotate(Geometry=crv_2, Angle=rad_3, Plane=pcen_3.CenterV)  # -> Geometry, Transform
rotate_5 = Rotate(Geometry=crv_3, Angle=rad_5, Plane=pcen_5.CenterV)  # -> Geometry, Transform
rotate_6 = Rotate(Geometry=crv_6, Angle=rad_4, Plane=pcen_6.CenterV)  # -> Geometry, Transform
Z_5 = UnitZ(Factor="-0.952")
Z_6 = UnitZ(Factor="-0.952")
move = Move(Geometry=extr_2, Motion=[multiplication_2, Y_4])  # -> Geometry, Transform
move_2 = Move(Geometry=extr, Motion=[multiplication_4, Y_6])  # -> Geometry, Transform
extr_3 = Extrude(Base=rotate_3.Geometry, Direction=Z_3)
move_3 = Move(Geometry=extr_3, Motion=[multiplication_6, Y_3])  # -> Geometry, Transform
extr_4 = Extrude(Base=rotate_4.Geometry, Direction=Z_4)
move_4 = Move(Geometry=extr_4, Motion=[multiplication_3, Y])  # -> Geometry, Transform
extr_5 = Extrude(Base=rotate_5.Geometry, Direction=Z_5)
move_5 = Move(Geometry=extr_5, Motion=[multiplication_5, Y_2])  # -> Geometry, Transform
extr_6 = Extrude(Base=rotate_6.Geometry, Direction=Z_6)
move_6 = Move(Geometry=extr_6, Motion=[multiplication, Y_5])  # -> Geometry, Transform
merge = Merge(Data1=extr, Data2=move_2.Geometry)
merge_2 = Merge(Data1=extr_2, Data2=move.Geometry)
merge_3 = Merge(Data1=extr_4, Data2=move_4.Geometry)
merge_4 = Merge(Data1=extr_5, Data2=move_5.Geometry)
merge_5 = Merge(Data1=extr_3, Data2=move_3.Geometry)
merge_6 = Merge(Data1=extr_6, Data2=move_6.Geometry)
brep = Brep([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])
merge_7 = Merge(Data1=merge, Data2=merge_2, Data3=merge_3, Data4=merge_4, Data5=merge_5, Data6=merge_6, Data7=brep)
honeybee = Honeybee_Honeybee()  # -> Vviiiiiiiiiizzz; plug-in component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
ladybug = Ladybug_Ladybug()  # -> Vviiiiiiiiiizzz; plug-in component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
wall_surface_with_opening = Brep(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)
path = FilePath("E:\753\MEX_Mexico.City.766790_IWEC\MEX_Mexico.City.766790_IWEC.epw")
createhbsrfs = Honeybee_createHBSrfs(geometry=wall_surface_with_opening, srfType="0")  # -> readMe, simplify(HBSurface); plug-in component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
radopaquematerial = Honeybee_RadianceOpaqueMaterial(materialName="generic_35", RReflectance=".35", GReflectance=".35", BReflectance=".35", roughness=0.05, specularity=0)  # -> avrgRef, RADMaterial; plug-in component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

# ---- group: furniture
furniture = Brep([<brep referenced from the Rhino model> x12])

# ----
ledge = Brep(<brep referenced from the Rhino model>)

# ---- group: floor
floor = Brep(<brep referenced from the Rhino model>)

# ---- group: ceiling
ceiling = Brep([<brep referenced from the Rhino model> x2])

# ----
walls = Brep([<brep referenced from the Rhino model> x2])
number_slider_3 = Slider(45, range=0..100)

# ---- group: For better visualization - Doesn't effect the results of the analysis
importlocation = Ladybug_ImportLocation(epwFile=path)  # -> location; plug-in component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
sunpath = Ladybug_SunPath(
    north=number_slider_3,
    location=importlocation,
    hour="9",
    day="21",
    month="12",
    timeStep=1,
    sunPathScale=Slider(0.2, range=0..1),
    dailyOrAnnualSunPath=True)  # -> readMe, sunVectors, sunAltitudes, sunAzimuths, port, sunSpheresMesh, sunPathCrvs, legend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; plug-in component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

# ----
# Geometry Preparation
panel_2 = Panel("0")
glazingcreator = Honeybee_GlazingBasedOnRatio(
    HBObjects=createhbsrfs.HBSurface,
    glzRatio="0.6",
    breakUpWindow=Toggle(True),
    windowHeight=Slider(1.904, range=0..3),
    sillHeight=Slider(0.092, range=0..2),
    splitGlzVertDist=[Slider(0.2, range=0..1), Slider(0.2, range=0..1)],
    runIt=Toggle(True))  # -> readMe, HBObjWGLZ; plug-in component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
# Assign specific materials
createhbsrfs_2 = Honeybee_createHBSrfs(geometry=[ledge, furniture], RADMaterial=radopaquematerial.RADMaterial)  # -> readMe, simplify(HBSurface); plug-in component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
createhbsrfs_3 = Honeybee_createHBSrfs(geometry=floor, srfType="2")  # -> readMe, simplify(HBSurface); plug-in component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
createhbsrfs_4 = Honeybee_createHBSrfs(geometry=ceiling, srfType="3")  # -> readMe, simplify(HBSurface); plug-in component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
genclimatebasedsky = Honeybee_GenerateClimateBasedSky(north=number_slider_3, weatherFile=path, month="12", day="21", hour="9")  # -> radiationValues, skyFilePath; plug-in component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
# Honeybee default materials will be assigned
# based on surface type
createhbsrfs_5 = Honeybee_createHBSrfs(geometry=walls, srfType=panel_2)  # -> readMe, simplify(HBSurface); plug-in component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
genavgsky = Honeybee_GenerateAverageSky(north=number_slider_3, weatherFile=path, month="12", hour="9")  # -> radiationValues, skyFilePath; plug-in component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
northarrow = Ladybug_North(north=number_slider_3, scale=".05")  # -> northSign; plug-in component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
panel_3 = Panel([genclimatebasedsky.radiationValues, genavgsky.radiationValues])
createhbsrfs_6 = Honeybee_createHBSrfs(geometry=merge_7)  # -> readMe, simplify(HBSurface); plug-in component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
set_the_view_to_fisheye_for_glare_analys = Panel("1")  # "set the view to FishEye for Glare Analysis"
radparameters = Honeybee_RADParameters(quality=0, ab="3")  # -> readMe, radParameters; plug-in component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
doy_hoy = Ladybug_DOY_HOY(days="21", months="12", hours="9")  # -> HOY, DOY, date; plug-in component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

# ---- group: collect all honeybee surfaces
brep_2 = Brep(flatten([createhbsrfs_5.HBSurface, createhbsrfs_4.HBSurface, createhbsrfs_3.HBSurface, createhbsrfs_2.HBSurface, glazingcreator.HBObjWGLZ, createhbsrfs_6.HBSurface]))

# ----
# Analysis Recipe
imagebasedsimulation = Honeybee_ImageBasedSimulation(
    skyFile=genavgsky.skyFilePath,
    cameraType=set_the_view_to_fisheye_for_glare_analys,
    simulationType=2,
    radParameters=radparameters.radParameters,
    backupImages=0)  # -> analysisRecipe; plug-in component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
wires = BrepWireframe(Brep=brep_2, Density=-1)
toggle = BooleanToggle(True)
rundaylightanalysis = Honeybee_RunDaylightSimulation(
    HBObjects=flatten(brep_2),
    analysisRecipe=imagebasedsimulation,
    writeRad=toggle,
    runRad=toggle,
    numOfCPUs="4",
    radFileName=doy_hoy.date,
    overwriteResults=True)  # -> readMe, analysisType, resultsUnit, results, testPts, luminance_files, radGeoFile, studyFolder, done; plug-in component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
md_slider = MDSlider(
    slider_value=Point(0.6227807766, 0.4896597513, 0.5),
    SliderMode=0,
    x_domain=Domain(-1, 1),
    y_domain=Domain(-1, 1),
    z_domain=Domain(0, 1))
glareanalysis = Honeybee_GlareAnalysis(HDRImagePath=rundaylightanalysis.luminance_files, runIt=Toggle(True))  # -> readMe, glareCheckImage, DGP, DGI, imageWithTaskArea; plug-in component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
falsecolor = Honeybee_FalseColor(
    HDRFilePath=rundaylightanalysis.luminance_files,
    contourBands=False,
    maskThreshold=0.1,
    useAlterColors=False,
    render=Toggle(True))  # -> outputFilePath; plug-in component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
# DGP: Daylight glare probability:
# Imperceptible Glare [0.35 > DGP]
# Perceptible Glare [0.4 > DGP >= 0.35]
# Disturbing Glare [0.45 > DGP >= 0.4]
# Intolerable Glare [DGP >= 0.45]
panel_4 = Panel(glareanalysis.DGP)
hdr_tif = Honeybee_ConvertHDRToTIF(HDRFilePath=glareanalysis.glareCheckImage, adjustExposure=Toggle(False))  # -> TIFFFilePath; plug-in component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
hdr_tif_2 = Honeybee_ConvertHDRToTIF(HDRFilePath=falsecolor, adjustExposure=False)  # -> TIFFFilePath; plug-in component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
number_slider_4 = Slider(0.8, range=0..1)
image = ImageFromPath(P=hdr_tif, S=number_slider_4)
image_2 = ImageFromPath(P=hdr_tif_2, S=number_slider_4)

pt = Point(Point(3, 2.544838682, 0.1224289629))
# set the view
comfortmannequin = Ladybug_ComfortMannequin(rotationAngle="175", bodyLocation=pt)  # -> mannequinMesh, legend, legendBasePt; plug-in component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

# ---- group: Person's face!
item = ListItem(List=comfortmannequin.mannequinMesh, Index=121, Wrap=True)

# ----
preview = CustomPreview(Geometry=item, Shader=ColourSwatch(SwatchColor=RGB(255, 0, 0)))

facen = FaceNormals(Mesh=item)  # -> Centers, Normals
settheview = Ladybug_SetTheView(cameraLocation=facen.Centers, cameraDirection=facen.Normals, uvLookAround=md_slider)  # -> readMe; plug-in component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
