# Grasshopper definition Barria_Jose.gh (Grasshopper 0.9.76)
# plug-ins: Python Interpreter, Bifocals, embryoA

number_slider = Slider(0, range=0..2)
number_slider_2 = Slider(0, range=0..2)
honeybee = Honeybee_Honeybee()  # -> Vviiiiiiiiiizzz; plug-in component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
ladybug = Ladybug_Ladybug()  # -> Vviiiiiiiiiizzz; plug-in component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
# Animate sliders
button = Button()
months = Panel("""3
6
12""")
hours = Panel("""9
12
15""")
# Glass material
panel = Panel("tvis_60")
fly = Ladybug_fly(inputSliders=[number_slider_2, number_slider], fly=button)  # -> Vviiiiiiiiiizzz; plug-in component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
panel_2 = Panel("https://www.energyplus.net/weather-download/north_and_central_america_wmo_region_4/USA/PA/USA_PA_Philadelphia.Intl.AP.724080_TMY3/all")
item = ListItem(List=hours, Index=number_slider, Wrap=True)
item_2 = ListItem(List=months, Index=number_slider_2, Wrap=True)
radglassmaterial = Honeybee_RadianceGlassMaterial(materialName=panel, RTransmittance="0.6", GTransmittance="0.6", BTransmittance="0.6", refractiveIndex=1.52)  # -> avrgTrans, RADMaterial; plug-in component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
epw_stat = Ladybug_OpenEPWAndSTATWeatherFiles(weatherFileURL=panel_2)  # -> epwFile, statFile; plug-in component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
panel_3 = Panel("""3
6
12""")
panel_4 = Panel("""9
12
15""")

brep = Brep([<brep referenced from the Rhino model> x2])

brep_2 = Brep([<brep referenced from the Rhino model> x5])
brep_3 = Brep(<brep referenced from the Rhino model>)

path = FilePath("C:\ladybug\Philadelphia_International_Ap_PA_USA\Philadelphia_International_Ap_PA_USA.epw")
importlocation = Ladybug_ImportLocation(epwFile=path)  # -> location; plug-in component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

brep_4 = Brep([<brep referenced from the Rhino model> x5])
brep_shading = Brep(<brep referenced from the Rhino model>)

brep_5 = Brep([<brep referenced from the Rhino model> x2])

genclimatebasedsky = Honeybee_GenerateClimateBasedSky(weatherFile=epw_stat.epwFile, month=item_2, day="21", hour=item)  # -> radiationValues, skyFilePath; plug-in component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
createhbsrfs = Honeybee_createHBSrfs()  # -> readMe, simplify(flatten(HBSurface)); plug-in component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
createhbsrfs_2 = Honeybee_createHBSrfs(geometry=brep_5, RADMaterial=radglassmaterial.RADMaterial)  # -> readMe, simplify(HBSurface); plug-in component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
sunpath = Ladybug_SunPath(
    location=importlocation,
    hour=panel_4,
    day=21,
    month=panel_3,
    timeStep=1,
    sunPathScale=Slider(0.2, range=0..1),
    dailyOrAnnualSunPath=True)  # -> readMe, sunVectors, sunAltitudes, sunAzimuths, port, sunSpheresMesh, sunPathCrvs, legend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; plug-in component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
doy_hoy = Ladybug_DOY_HOY(days="21", months=item_2, hours=item)  # -> HOY, DOY, date; plug-in component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
brep_6 = Brep(flatten([createhbsrfs.HBSurface, createhbsrfs_2.HBSurface]))
preview = CustomPreview(Geometry=createhbsrfs_2.HBSurface, Shader=ColourSwatch(SwatchColor=RGBA(129, 150, 235, 74)))
preview_2 = CustomPreview(Geometry=createhbsrfs.HBSurface, Shader=ColourSwatch(SwatchColor=RGBA(217, 206, 206, 208)))
dsparameters = Honeybee_DSParameters(outputUnits="1", dgp_imageSize=250, onlyRunGlareAnalysis=True)  # -> DSParameters; plug-in component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
brep_7 = Brep(<brep referenced from the Rhino model>)
radparameters = Honeybee_RADParameters(
    quality=Slider(2, range=0..500),
    ab=Slider(5, range=0..500),
    ad=Slider(1000, range=0..3000),
    as=Slider(20, range=0..500),
    ar=Slider(300, range=0..500),
    aa=Slider(0.1, range=0..500))  # -> readMe, radParameters; plug-in component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
gentestpts = Honeybee_GenerateTestPoints(testGeometry=brep_7, gridSize=".5", distBaseSrf=Slider(0.762, range=0..1), moveTestMesh=Toggle(False))  # -> readMe, simplify(testPoints), simplify(ptsVectors), simplify(facesArea), simplify(mesh); plug-in component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
imagebasedsimulation = Honeybee_ImageBasedSimulation(skyFile=genclimatebasedsky.skyFilePath, rhinoViewsName="fisheye", cameraType="1", simulationType="2", backupImages=0)  # -> analysisRecipe; plug-in component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
gridbasedsimulation = Honeybee_GridBasedSimulation(
    skyFile=genclimatebasedsky.skyFilePath,
    testPoints=gentestpts.testPoints,
    ptsVectors=gentestpts.ptsVectors,
    testMesh=gentestpts.mesh,
    simulationType=0)  # -> analysisRecipe; plug-in component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
annualdaylightsimulation = Honeybee_AnnualDaylightSimulation(
    epwWeatherFile=epw_stat.epwFile,
    testPoints=gentestpts.testPoints,
    ptsVectors=gentestpts.ptsVectors,
    testMesh=gentestpts.mesh,
    radParameters=radparameters.radParameters,
    DSParameters=dsparameters)  # -> analysisRecipe; plug-in component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
toggle = BooleanToggle(True)
toggle_2 = BooleanToggle(False)
rundaylightanalysis = Honeybee_RunDaylightSimulation(
    HBObjects=flatten(brep_6),
    analysisRecipe=annualdaylightsimulation,
    writeRad=toggle,
    runRad=toggle,
    numOfCPUs="8",
    workingDir="C:\ladybug\tareabps",
    radFileName="dling",
    exportInteriorWalls=True,
    overwriteResults=True)  # -> readMe, analysisType, resultsUnit, results, testPts, resultFiles, radGeoFile, studyFolder, done; plug-in component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
rundaylightanalysis_2 = Honeybee_RunDaylightSimulation(
    analysisRecipe=annualdaylightsimulation,
    writeRad=toggle_2,
    runRad=toggle_2,
    numOfCPUs="8",
    workingDir="C:\ladybug\tareabps",
    radFileName="dling",
    overwriteResults=True)  # -> readMe, analysisType, resultsUnit, results, testPts, resultFiles, radGeoFile, studyFolder, done; plug-in component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
occupancygenerator = Honeybee_DaysimOccupancyGenerator(weekendDays=[1, 2], writeTheOcc=Toggle(True))  # -> occupancyFile; plug-in component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
panel_5 = Panel([rundaylightanalysis_2.analysisType, rundaylightanalysis_2.resultsUnit])
falsecolor = Honeybee_FalseColor(contourBands=False, maskThreshold=0.1, useAlterColors=False, render=Toggle(True))  # -> outputFilePath; plug-in component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
hdr_tif = Honeybee_ConvertHDRToTIF(HDRFilePath=falsecolor, adjustExposure=False)  # -> TIFFFilePath; plug-in component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
readradresults = Honeybee_ReadRADResult(analysisType=rundaylightanalysis.analysisType, writeToFile=False)  # -> readMe, unit, values; plug-in component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
panel_6 = Panel(rundaylightanalysis.resultFiles)
glareanalysis = Honeybee_GlareAnalysis(runIt=Toggle(True))  # -> readMe, glareCheckImage, DGP, DGI, imageWithTaskArea; plug-in component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
panel_7 = Panel(rundaylightanalysis_2.results)
panel_8 = Panel(rundaylightanalysis.resultsUnit)
readannualresultsi = Honeybee_ReadAnnualResultI(
    illFilesAddress=rundaylightanalysis_2.resultFiles,
    testPoints=simplify(gentestpts.testPoints),
    ptsVectors=gentestpts.ptsVectors,
    occupancyFiles=occupancygenerator,
    DLAIllumThresholds="200",
    runIt=Toggle(True))  # -> DLA, UDLI_Less_100, UDLI_100_2000, UDLI_More_2000, CDA, sDA, annualProfiles, htmReport; plug-in component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
image = ImageFromPath(P=hdr_tif, S=Slider(0.5, range=0..1))
doy_hoy_2 = Ladybug_DOY_HOY(days=Slider(1, range=1..31), months=Slider(3, range=1..12), hours=Slider(10, range=1..24))  # -> HOY, DOY, date; plug-in component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
# capture the viewport to an image
join = TextJoin(Text=[item_2, "21", item], Join="_")
readdshourlyresults = Honeybee_ReadHourlyResultsFromAnnualDaylightStudy(illFilesAddress=panel_6, testPoints=rundaylightanalysis.testPts, HOY=doy_hoy_2.HOY)  # -> iIllumLevelsNoDynamicSHD, iIllumLevelsDynamicSHDGroupI, iIllumLevelsDynamicSHDGroupII, iIlluminanceBasedOnOccupancy, shadingGroupInEffect; plug-in component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
legendpar = Ladybug_LegendParameters(highBound="100")  # -> legendPar; plug-in component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
gradientlibrary = Ladybug_GradientLibrary(gradIndex="1")  # -> customColors; plug-in component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
hdr_tif_2 = Honeybee_ConvertHDRToTIF(adjustExposure=False)  # -> TIFFFilePath; plug-in component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
panel_9 = Panel(doy_hoy.date)
panel_10 = Panel(join)
pt = Point(<point referenced from the Rhino model>)
legendpar_2 = Ladybug_LegendParameters(lowBound="300", highBound="2000", numSegments="6", customColors=flatten(gradientlibrary), legendLocation=pt)  # -> legendPar; plug-in component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
captureview = Ladybug_CaptureView(
    fileName=panel_10,
    folder="C:\ladybug\tareabps\fotos\annualshaded",
    imageWidth="1600",
    imageHeight="800",
    capture=Toggle(True))  # -> imagePath; plug-in component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
recolormesh = Ladybug_ReColorMesh(analysisResult=readdshourlyresults.iIllumLevelsNoDynamicSHD, inputMesh=gentestpts.mesh, legendPar=legendpar)  # -> readMe, newMesh, newLegend, legendBasePt, meshColors, legendColors; plug-in component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
concat = Concatenate(FragmentA=rundaylightanalysis_2.analysisType, FragmentC=panel_9)
image_2 = ImageFromPath(P=hdr_tif_2, S=Slider(0.5, range=0..1))
panel_11 = Panel(captureview)
recolormesh_2 = Ladybug_RecolorMesh(analysisResult=readannualresultsi.DLA, inputMesh=gentestpts.mesh, legendPar=legendpar_2)  # -> readMe, newMesh, newLegend, legendBasePt, meshColors, legendColors; plug-in component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
panel_12 = Panel(recolormesh_2.readMe)
