# Grasshopper definition Barria_Jose_Final.gh (Grasshopper 0.9.76)
# plug-ins: Python Interpreter, embryoA

brep = Brep([<brep referenced from the Rhino model> x7])
bldgprograms = Honeybee_bldgPrograms({"Office": 0, "Retail": 1, "MidriseApartment": 2, "PrimarySchool": 3, "SecondarySchool": 4, "SmallHotel": 5, "LargeHotel": 6, "Hospital": 7, "Outpatient": 8, "Warehouse": 9, "SuperMarket": 10, "FullServiceRestaurant": 11, "QuickServiceRestaurant": 12}, selected="MidriseApartment")
listzoneprograms = Honeybee_ListZonePrograms(bldgProgram=bldgprograms)  # -> MidriseApartmentZonePrograms; plug-in component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
# Plug In Model Here
list = ValueList({"Exterior Window [R1.0, SHGC 0.7]": "ASHRAE 90.1-2004 EXTWINDOW CLIMATEZONE ALT-WARE 1-8", "Exterior Window [R1.7, SHGC 0.39]": "ASHRAE 90.1-2004 EXTWINDOW CLIMATEZONE 4-6", "Exterior Window [R1.9, SHGC 0.39]": "ASHRAE 90.1-2004 EXTWINDOW CLIMATEZONE ALT-RES 4-6", "Exterior Window [R0.7, SHGC 0.65]": "Dbl LoE (e3=.1) Clr 3mm/13mm Arg"}, selected="Exterior Window [R1.9, SHGC 0.39]")
list_2 = ValueList({"Exterior Wall [R5.5]": "ASHRAE 90.1-2004 EXTWALL METAL CLIMATEZONE 4", "Exterior Wall [R5.8]": "ASHRAE 90.1-2004 EXTWALL MASS CLIMATEZONE 3-4", "Exterior Wall [R7.2]": "ASHRAE 90.1-2004 EXTWALL STEELFRAME CLIMATEZONE 1-4", "Exterior Wall [R8.7]": "ASHRAE 90.1-2004 EXTWALL MASS CLIMATEZONE ALT-RES 4", "Exterior Wall [R10.4]": "ASHRAE 90.1-2004 EXTWALL WOODFRAME CLIMATEZONE 1-7", "Exterior Wall [R14.8]": "ASHRAE 90.1-2004 EXTWALL STEELFRAME CLIMATEZONE ALT-RES 4-6", "Exterior Wall [R34.4]": "ASHRAE 189.1-2009 EXTROOF IEAD CLIMATEZONE 7-8"}, selected="Exterior Wall [R34.4]")
list_3 = ValueList({"Exterior Roof [R9.2]": "ASHRAE 90.1-2004 EXTROOF METAL CLIMATEZONE 3-4", "Exterior Roof [R14.8]": "ASHRAE 90.1-2004 EXTROOF IEAD CLIMATEZONE 1-4", "Exterior Roof [R34.4]": "ASHRAE 189.1-2009 EXTROOF IEAD CLIMATEZONE 7-8"}, selected="Exterior Roof [R34.4]")
item = ListItem(List=listzoneprograms, Index="0", Wrap=True)

radglassmaterial = Honeybee_RadianceGlassMaterial(materialName="Ventanas", RTransmittance=".6", GTransmittance=".6", BTransmittance=".6", refractiveIndex=1.52)  # -> avrgTrans, RADMaterial; plug-in component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
brep_2 = Brep(<brep referenced from the Rhino model>)
# Case 1
brep_3 = Brep(<brep referenced from the Rhino model>)
brep_4 = Brep([<brep referenced from the Rhino model> x3])
brep_5 = Brep(<brep referenced from the Rhino model>)
brep_6 = Brep([<brep referenced from the Rhino model> x3])
createhbsrfs = Honeybee_createHBSrfs(geometry=brep_3, srfName="Roof", srfType="1", EPBC="Adiabatic")  # -> readMe, simplify(HBSurface); plug-in component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
createhbsrfs_2 = Honeybee_createHBSrfs(geometry=brep_4, srfName="WallsIn", srfType="0", EPBC="Adiabatic")  # -> readMe, simplify(HBSurface); plug-in component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
createhbsrfs_3 = Honeybee_createHBSrfs(geometry=brep_5, srfName="Floor", srfType="2", EPBC="Adiabatic")  # -> readMe, simplify(HBSurface); plug-in component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
createhbsrfs_4 = Honeybee_createHBSrfs(geometry=brep_2, srfName="WallsEx", srfType="0", EPBC="Outdoors")  # -> readMe, simplify(HBSurface); plug-in component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
createhbsrfs_5 = Honeybee_createHBSrfs(geometry=brep_6, srfName="Ventanas", srfType="5", EPBC="Outdoors")  # -> readMe, simplify(HBSurface); plug-in component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
createhbzones = Honeybee_createHBZones(
    name="Latham810",
    zoneProgram=item,
    HBSurfaces=flatten([createhbsrfs_3.HBSurface, createhbsrfs_2.HBSurface, createhbsrfs_4.HBSurface, createhbsrfs.HBSurface]),
    isConditioned=Toggle(False))  # -> readMe, HBZone; plug-in component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
addhbglz = Honeybee_addHBGlz(HBObj=createhbzones.HBZone, childSurfaces=flatten(createhbsrfs_5.HBSurface), RADMaterials=radglassmaterial.RADMaterial)  # -> HBObjWGLZ; plug-in component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
hb_epcontextsrf = HoneybeeEPContextSurfaces()  # -> HBContext; inputs shdSurfaces: list of Brep, justBoundingBox: Boolean
# ---------- hb_epcontextsrf: Python ----------
"""
prepare shading/context geometries

    Args:
        northVectorOrRotation: A vector that shows North or a number that shows
                               the rotation of the North from the Y axis
        bldgMasses: List of closed Breps as thermal zones.
    Returns:
        report: ...
        thermalZones: Thermal zone's geometries for visualiza
"""

ghenv.Component.Name = 'Honeybee EP context Surfaces'
ghenv.Component.NickName = 'HB_EPContextSrf'
ghenv.Component.Message = 'VER 0.0.60\nAUG_10_2016'
ghenv.Component.IconDisplayMode = ghenv.Component.IconDisplayMode.application
ghenv.Component.Category = "Honeybee"
ghenv.Component.SubCategory = "10 | Energy | Energy"
#compatibleHBVersion = VER 0.0.57\nNOV_01_2015
#compatibleLBVersion = VER 0.0.59\nFEB_01_2015
ghenv.Component.AdditionalHelpFromDocStrings = "2"

import rhinoscriptsyntax as rs
import Rhino as rc
import scriptcontext as sc
import os
import System
import Grasshopper.Kernel as gh
import uuid

tolerance = sc.doc.ModelAbsoluteTolerance
import math


def main(shdSurfaces, EPTransSchedule, meshingSettings, justBoundingBox):
    
    # import the classes
    if sc.sticky.has_key('honeybee_release'):

        try:
            if not sc.sticky['honeybee_release'].isCompatible(ghenv.Component): return -1
            if sc.sticky['honeybee_release'].isInputMissing(ghenv.Component): return -1
        except:
            warning = "You need a newer version of Honeybee to use this compoent." + \
            " Use updateHoneybee component to update userObjects.\n" + \
            "If you have already updated userObjects drag Honeybee_Honeybee component " + \
            "into canvas and try again."
            w = gh.GH_RuntimeMessageLevel.Warning
            ghenv.Component.AddRuntimeMessage(w, warning)
            return -1
        
        # don't customize this part
        hb_EPSrf = sc.sticky["honeybee_EPSurface"]
        hb_EPSHDSurface = sc.sticky["honeybee_EPShdSurface"]
        hb_RADMaterialAUX = sc.sticky["honeybee_RADMaterialAUX"]
        hb_EPObjectsAux = sc.sticky["honeybee_EPObjectsAUX"]()
        HBScheduleList = sc.sticky["honeybee_ScheduleLib"].keys()

        ########################################################################
        #----------------------------------------------------------------------#
        shdBreps = []
        # create bounding box of shading geometries
        if justBoundingBox:
            for brep in shdSurfaces:
                if brep.Faces.Count>1 or not brep.Faces[0].IsPlanar(sc.doc.ModelAbsoluteTolerance):
                    shdBreps.append(brep.GetBoundingBox(True).ToBrep())
                else:
                    shdBreps.append(brep)
        else:
            shdBreps = shdSurfaces
        
        shadingClasses = []
        shadingMeshPreview = []
        
        if meshingSettings == None:
            mp = rc.Geometry.MeshingParameters.Minimal
            mp.SimplePlanes = True
        else:
            mp = meshingSettings
        
        def getRadMaterialName(radMaterial):
            nameStr = radMaterial.split(" ")[2]
            name =  nameStr.split("\n")[0]
            return name
        
        for brepCount, brep in enumerate(shdBreps):
            if brep != None:
                isPlanar = True
                # check planarity
                for face in brep.Faces:
                    if not face.IsPlanar(tolerance):
                        isPlanar = False
                        break
                
                shadingBreps = []
                if not isPlanar:
                    meshArray = rc.Geometry.Mesh.CreateFromBrep(brep, mp)
                    for mesh in meshArray:
                        for meshFace in range(mesh.Faces.Count):
                            vertices = list(mesh.Faces.GetFaceVertices(meshFace))[1:]
                            vertices = vertices + [sc.doc.ModelAbsoluteTolerance]
                            # create the brep from mesh
                            shdBrep = rc.Geometry.Brep.CreateFromCornerPoints(*vertices)
                            shadingBreps.append(shdBrep)
                else:
                    for face in brep.Faces:
                        shadingBreps.append(face.DuplicateFace(False))
                
                for faceCount, shdBrep in enumerate(shadingBreps):
                        thisShading = hb_EPSHDSurface(shdBrep, 1000*brepCount + faceCount, 'shdSrf_' + `brepCount` + '_' + `faceCount` + "_" + str(uuid.uuid4()))
                        
                        # add transmittance schedule if any
                        if EPTransSchedule!=None:
                            schedule= EPTransSchedule.upper()
                            if schedule!=None and not schedule.lower().endswith(".csv") and schedule not in HBScheduleList:
                                msg = "Cannot find " + schedule + " in Honeybee schedule library."
                                print msg
                                ghenv.Component.AddRuntimeMessage(gh.GH_RuntimeMessageLevel.Warning, msg)
                                return -1
                            elif schedule!=None and schedule.lower().endswith(".csv"):
                                # check if csv file is existed
                                if not os.path.isfile(schedule):
                                    msg = "Cannot find the shchedule file: " + schedule
                                    print msg
                                    ghenv.Component.AddRuntimeMessage(gh.GH_RuntimeMessageLevel.Warning, msg)
                                    return -1
                            
                            thisShading.TransmittanceSCH = schedule
                        
                        # add the Rad Material if any
                        if RADMaterial!=None:
                            # if it is just the name of the material make sure it is already defined
                            if len(RADMaterial.split(" ")) == 1:
                                # if the material is not in the library add it to the library
                                if not hb_RADMaterialAUX.isMatrialExistInLibrary(RADMaterial):
                                    warningMsg = "Can't find " + RADMaterial + " in RAD Material Library.\n" + \
                                                "Add the material to the library and try again."
                                    ghenv.Component.AddRuntimeMessage(gh.GH_RuntimeMessageLevel.Warning, warningMsg)
                                    return
                                
                                try:
                                    thisShading.setRADMaterial(RADMaterial)
                                except Exception, e:
                                    print e
                                    warningMsg = "You are using an old version of Honeybee_Honeybee! Update your files and try again."
                                    print warningMsg
                                    ghenv.Component.AddRuntimeMessage(gh.GH_RuntimeMessageLevel.Warning, warningMsg)
                                    return
                                
                                addedToLib = True
                            else:
                                
                                # try to add the material to the library
                                addedToLib, thisShading.RadMaterial = hb_RADMaterialAUX.analyseRadMaterials(RADMaterial, True)
                                
                            if addedToLib==False:
                                warningMsg = "Failed to add " + RADMaterial + " to the Library."
                                ghenv.Component.AddRuntimeMessage(gh.GH_RuntimeMessageLevel.Warning, warningMsg)
                                return
                        
                        # add shading to the list
                        shadingClasses.append(thisShading)
                
        # add to the hive
        hb_hive = sc.sticky["honeybee_Hive"]()
        HBContext  = hb_hive.addToHoneybeeHive(shadingClasses, ghenv.Component.InstanceGuid.ToString())
        return HBContext
        ################################################################################################
    else:
        print "You should first let Honeybee to fly..."
        w = gh.GH_RuntimeMessageLevel.Warning
        ghenv.Component.AddRuntimeMessage(w, "You should first let Honeybee to fly...")
        return -1
        

if _shdSurfaces and _shdSurfaces[0]!=None:
    # add cleaning function
    result= main(_shdSurfaces, EPTransSchedule_, meshingSettings_, justBoundingBox_)
    
    if result != -1: HBContext = result
# ---------- end hb_epcontextsrf ----------

radglassmaterial_2 = Honeybee_RadianceGlassMaterial(materialName="Ventanas", RTransmittance=".6", GTransmittance=".6", BTransmittance=".6", refractiveIndex=1.52)  # -> avrgTrans, RADMaterial; plug-in component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
# Case 2
brep_7 = Brep(<brep referenced from the Rhino model>)
brep_8 = Brep([<brep referenced from the Rhino model> x3])
brep_9 = Brep(<brep referenced from the Rhino model>)
brep_10 = Brep(<brep referenced from the Rhino model>)
brep_11 = Brep([<brep referenced from the Rhino model> x3])
brep_12 = Brep([<brep referenced from the Rhino model> x12])
createhbsrfs_6 = Honeybee_createHBSrfs(geometry=brep_7, srfName="Roof", srfType="1", EPBC="Adiabatic")  # -> readMe, simplify(HBSurface); plug-in component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
createhbsrfs_7 = Honeybee_createHBSrfs(geometry=brep_8, srfName="WallsIn", srfType="0", EPBC="Adiabatic")  # -> readMe, simplify(HBSurface); plug-in component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
createhbsrfs_8 = Honeybee_createHBSrfs(geometry=brep_10, srfName="Floor", srfType="2", EPBC="Adiabatic")  # -> readMe, simplify(HBSurface); plug-in component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
createhbsrfs_9 = Honeybee_createHBSrfs(geometry=brep_9, srfName="WallsEx", srfType="0", EPBC="Outdoors")  # -> readMe, simplify(HBSurface); plug-in component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
createhbsrfs_10 = Honeybee_createHBSrfs(geometry=brep_11, srfName="Ventanas", srfType="5", EPBC="Outdoors")  # -> readMe, simplify(HBSurface); plug-in component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
createhbzones_2 = Honeybee_createHBZones(
    name="Latham810",
    zoneProgram=item,
    HBSurfaces=flatten([createhbsrfs_8.HBSurface, createhbsrfs_7.HBSurface, createhbsrfs_9.HBSurface, createhbsrfs_6.HBSurface]),
    isConditioned=Toggle(False))  # -> readMe, HBZone; plug-in component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
addhbglz_2 = Honeybee_addHBGlz(
    HBObj=createhbzones_2.HBZone,
    childSurfaces=flatten(createhbsrfs_10.HBSurface),
    RADMaterials=radglassmaterial_2.RADMaterial)  # -> HBObjWGLZ; plug-in component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
hb_epcontextsrf_2 = HoneybeeEPContextSurfaces(shdSurfaces=flatten(brep_12))  # -> HBContext; inputs shdSurfaces: list of Brep, justBoundingBox: Boolean; same code as hb_epcontextsrf

radglassmaterial_3 = Honeybee_RadianceGlassMaterial(materialName="Ventanas", RTransmittance=".6", GTransmittance=".6", BTransmittance=".6", refractiveIndex=1.52)  # -> avrgTrans, RADMaterial; plug-in component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
# Case 3
brep_13 = Brep(<brep referenced from the Rhino model>)
brep_14 = Brep([<brep referenced from the Rhino model> x3])
brep_15 = Brep(<brep referenced from the Rhino model>)
brep_16 = Brep(<brep referenced from the Rhino model>)
brep_17 = Brep(<brep referenced from the Rhino model>)
createhbsrfs_11 = Honeybee_createHBSrfs(geometry=brep_13, srfName="Roof", srfType="1", EPBC="Adiabatic")  # -> readMe, simplify(HBSurface); plug-in component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
createhbsrfs_12 = Honeybee_createHBSrfs(geometry=brep_14, srfName="WallsIn", srfType="0", EPBC="Adiabatic")  # -> readMe, simplify(HBSurface); plug-in component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
createhbsrfs_13 = Honeybee_createHBSrfs(geometry=brep_16, srfName="Floor", srfType="2", EPBC="Adiabatic")  # -> readMe, simplify(HBSurface); plug-in component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
createhbsrfs_14 = Honeybee_createHBSrfs(geometry=brep_15, srfName="WallsEx", srfType="0", EPBC="Outdoors")  # -> readMe, simplify(HBSurface); plug-in component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
createhbsrfs_15 = Honeybee_createHBSrfs(geometry=brep_17, srfName="Ventanas", srfType="5", EPBC="Outdoors")  # -> readMe, simplify(HBSurface); plug-in component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
createhbzones_3 = Honeybee_createHBZones(
    name="Latham810",
    zoneProgram=item,
    HBSurfaces=flatten([createhbsrfs_13.HBSurface, createhbsrfs_12.HBSurface, createhbsrfs_14.HBSurface, createhbsrfs_11.HBSurface]),
    isConditioned=Toggle(False))  # -> readMe, HBZone; plug-in component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
addhbglz_3 = Honeybee_addHBGlz(
    HBObj=createhbzones_3.HBZone,
    childSurfaces=flatten(createhbsrfs_15.HBSurface),
    RADMaterials=radglassmaterial_3.RADMaterial)  # -> HBObjWGLZ; plug-in component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

radglassmaterial_4 = Honeybee_RadianceGlassMaterial(materialName="Ventanas", RTransmittance=".6", GTransmittance=".6", BTransmittance=".6", refractiveIndex=1.52)  # -> avrgTrans, RADMaterial; plug-in component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
# Case 4
brep_18 = Brep(<brep referenced from the Rhino model>)
brep_19 = Brep([<brep referenced from the Rhino model> x3])
brep_20 = Brep(<brep referenced from the Rhino model>)
brep_21 = Brep(<brep referenced from the Rhino model>)
brep_22 = Brep(<brep referenced from the Rhino model>)
brep_23 = Brep([<brep referenced from the Rhino model> x5])
createhbsrfs_16 = Honeybee_createHBSrfs(geometry=brep_18, srfName="Roof", srfType="1", EPBC="Adiabatic")  # -> readMe, simplify(HBSurface); plug-in component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
createhbsrfs_17 = Honeybee_createHBSrfs(geometry=brep_19, srfName="WallsIn", srfType="0", EPBC="Adiabatic")  # -> readMe, simplify(HBSurface); plug-in component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
createhbsrfs_18 = Honeybee_createHBSrfs(geometry=brep_20, srfName="Floor", srfType="2", EPBC="Adiabatic")  # -> readMe, simplify(HBSurface); plug-in component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
createhbsrfs_19 = Honeybee_createHBSrfs(geometry=brep_21, srfName="WallsEx", srfType="0", EPBC="Outdoors")  # -> readMe, simplify(HBSurface); plug-in component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
createhbsrfs_20 = Honeybee_createHBSrfs(geometry=brep_22, srfName="Ventanas", srfType="5", EPBC="Outdoors")  # -> readMe, simplify(HBSurface); plug-in component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
createhbzones_4 = Honeybee_createHBZones(
    name="Latham810",
    zoneProgram=item,
    HBSurfaces=flatten([createhbsrfs_18.HBSurface, createhbsrfs_17.HBSurface, createhbsrfs_19.HBSurface, createhbsrfs_16.HBSurface]),
    isConditioned=Toggle(False))  # -> readMe, HBZone; plug-in component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
addhbglz_4 = Honeybee_addHBGlz(
    HBObj=createhbzones_4.HBZone,
    childSurfaces=flatten(createhbsrfs_20.HBSurface),
    RADMaterials=radglassmaterial_4.RADMaterial)  # -> HBObjWGLZ; plug-in component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
hb_epcontextsrf_3 = HoneybeeEPContextSurfaces(shdSurfaces=flatten(brep_23))  # -> HBContext; inputs shdSurfaces: list of Brep, justBoundingBox: Boolean; same code as hb_epcontextsrf

radglassmaterial_5 = Honeybee_RadianceGlassMaterial(materialName="Ventanas", RTransmittance=".6", GTransmittance=".6", BTransmittance=".6", refractiveIndex=1.52)  # -> avrgTrans, RADMaterial; plug-in component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
# Case 5
brep_24 = Brep(<brep referenced from the Rhino model>)
brep_25 = Brep(<brep referenced from the Rhino model>)
brep_26 = Brep([<brep referenced from the Rhino model> x3])
brep_27 = Brep(<brep referenced from the Rhino model>)
brep_28 = Brep(<brep referenced from the Rhino model>)
brep_29 = Brep([<brep referenced from the Rhino model> x10])
createhbsrfs_21 = Honeybee_createHBSrfs(geometry=brep_24, srfName="Roof", srfType="1", EPBC="Adiabatic")  # -> readMe, simplify(HBSurface); plug-in component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
createhbsrfs_22 = Honeybee_createHBSrfs(geometry=brep_26, srfName="WallsIn", srfType="0", EPBC="Adiabatic")  # -> readMe, simplify(HBSurface); plug-in component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
createhbsrfs_23 = Honeybee_createHBSrfs(geometry=brep_27, srfName="Floor", srfType="2", EPBC="Adiabatic")  # -> readMe, simplify(HBSurface); plug-in component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
createhbsrfs_24 = Honeybee_createHBSrfs(geometry=brep_25, srfName="WallsEx", srfType="0", EPBC="Outdoors")  # -> readMe, simplify(HBSurface); plug-in component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
createhbsrfs_25 = Honeybee_createHBSrfs(geometry=brep_28, srfName="Ventanas", srfType="5", EPBC="Outdoors")  # -> readMe, simplify(HBSurface); plug-in component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
createhbzones_5 = Honeybee_createHBZones(
    name="Latham810",
    zoneProgram=item,
    HBSurfaces=flatten([createhbsrfs_23.HBSurface, createhbsrfs_22.HBSurface, createhbsrfs_24.HBSurface, createhbsrfs_21.HBSurface]),
    isConditioned=Toggle(False))  # -> readMe, HBZone; plug-in component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
addhbglz_5 = Honeybee_addHBGlz(
    HBObj=createhbzones_5.HBZone,
    childSurfaces=flatten(createhbsrfs_25.HBSurface),
    RADMaterials=radglassmaterial_5.RADMaterial)  # -> HBObjWGLZ; plug-in component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
hb_epcontextsrf_4 = HoneybeeEPContextSurfaces(shdSurfaces=flatten(brep_29))  # -> HBContext; inputs shdSurfaces: list of Brep, justBoundingBox: Boolean; same code as hb_epcontextsrf

radglassmaterial_6 = Honeybee_RadianceGlassMaterial(materialName="Ventanas", RTransmittance=".6", GTransmittance=".6", BTransmittance=".6", refractiveIndex=1.52)  # -> avrgTrans, RADMaterial; plug-in component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
brep_30 = Brep(<brep referenced from the Rhino model>)
# Final Case
brep_31 = Brep(<brep referenced from the Rhino model>)
brep_32 = Brep([<brep referenced from the Rhino model> x3])
brep_33 = Brep(<brep referenced from the Rhino model>)
brep_34 = Brep(<brep referenced from the Rhino model>)
brep_35 = Brep([<brep referenced from the Rhino model> x10])
createhbsrfs_26 = Honeybee_createHBSrfs(geometry=brep_31, srfName="Roof", srfType="1", EPBC="Adiabatic")  # -> readMe, simplify(HBSurface); plug-in component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
createhbsrfs_27 = Honeybee_createHBSrfs(geometry=brep_32, srfName="WallsIn", srfType="0", EPBC="Adiabatic")  # -> readMe, simplify(HBSurface); plug-in component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
createhbsrfs_28 = Honeybee_createHBSrfs(geometry=brep_33, srfName="Floor", srfType="2", EPBC="Adiabatic")  # -> readMe, simplify(HBSurface); plug-in component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
createhbsrfs_29 = Honeybee_createHBSrfs(geometry=brep_30, srfName="WallsEx", srfType="0", EPBC="Outdoors")  # -> readMe, simplify(HBSurface); plug-in component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
createhbsrfs_30 = Honeybee_createHBSrfs(geometry=brep_34, srfName="Ventanas", srfType="5", EPBC="Outdoors")  # -> readMe, simplify(HBSurface); plug-in component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
hb_epcontextsrf_5 = HoneybeeEPContextSurfaces(shdSurfaces=flatten(brep_35))  # -> HBContext; inputs shdSurfaces: list of Brep, justBoundingBox: Boolean; same code as hb_epcontextsrf
createhbzones_6 = Honeybee_createHBZones(
    name="Latham810",
    zoneProgram=item,
    HBSurfaces=flatten([createhbsrfs_28.HBSurface, createhbsrfs_27.HBSurface, createhbsrfs_29.HBSurface, createhbsrfs_26.HBSurface]),
    isConditioned=Toggle(False))  # -> readMe, HBZone; plug-in component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
addhbglz_6 = Honeybee_addHBGlz(
    HBObj=createhbzones_6.HBZone,
    childSurfaces=flatten(createhbsrfs_30.HBSurface),
    RADMaterials=radglassmaterial_6.RADMaterial)  # -> HBObjWGLZ; plug-in component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

panel = Panel(createhbzones_6.readMe)
setepzonecnstr = Honeybee_SetEPZoneConstruction(HBZone=addhbglz_5, wallEPConstruction=list_2, windowEPConstruction=list, roofEPConstruction=list_3)  # -> simplify(modifiedHBZone); plug-in component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
ach2m3_s_m2_calculator = HoneybeeInfORventPerAreaCalculator(HBZones=flatten(setepzonecnstr), airChangeHour=Slider(0.2, range=0..10))  # -> out, infORventPerArea, allFloors; plug-in component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
setepzoneloads = Honeybee_SetEnergyPlusZoneLoads(HBZones=flatten(setepzonecnstr), infiltrationRatePerArea=ach2m3_s_m2_calculator.infORventPerArea)  # -> loads, HBZones; plug-in component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
setepnatvent = Honeybee_SetEPAirFlow(
    HBZones=setepzonecnstr,
    naturalVentilationType="1",
    minIndoorTempForNatVent="24",
    maxOutdoorTempForNatVent="26",
    fractionOfGlzAreaOperable="1")  # -> readMe, simplify(HBZones); plug-in component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
panel_2 = Panel("""1
2
3
4
5""")
glzparamlist = Honeybee_GlazingParametersList(northGlzParam=0, westGlzParam=0, southGlzParam=".7", eastGlzParam=0)  # -> glzParamList; plug-in component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
panel_3 = Panel("https://www.energyplus.net/weather-download/north_and_central_america_wmo_region_4/USA/PA/USA_PA_Philadelphia.Intl.AP.724080_TMY3/all")
brep_36 = Brep(<brep referenced from the Rhino model>)
radglassmaterial_7 = Honeybee_RadianceGlassMaterial(materialName="Vidrio", RTransmittance=".7", GTransmittance=".7", BTransmittance=".7", refractiveIndex=1.52)  # -> avrgTrans, RADMaterial; plug-in component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
# Run_E+
# Run_Annualbased
toggle = BooleanToggle(True)
# Run_Imagebased
toggle_2 = BooleanToggle(False)
toggle_3 = BooleanToggle(False)
# Run_Gridbased
toggle_4 = BooleanToggle(False)
# Toggle_Dates
button = Button()
box = DomainBox(Base=brep_36, X="4.8", Y="5", Z="3.5")
honeybee = Honeybee_Honeybee()  # -> Vviiiiiiiiiizzz; plug-in component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
ladybug = Ladybug_Ladybug()  # -> Vviiiiiiiiiizzz; plug-in component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
epw_stat = Ladybug_OpenEPWAndSTATWeatherFiles(weatherFileURL=panel_3, workingDir="C:\BPS_Final\EPW")  # -> epwFile, statFile; plug-in component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
colour = ColourPicker(PickedColour=RGB(0, 0, 0))
mass2zone = Honeybee_Masses2Zones(zoneMasses=flatten(box), isConditioned=Toggle(False), maxRoofAngle=30, createHBZones=Toggle(True))  # -> readMe, HBZones; plug-in component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
decompose_honeybee_zone = Honeybee_DecomposeHBZone(HBZone=mass2zone.HBZones)  # -> HBSurfaces; plug-in component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
item_2 = ListItem(List=decompose_honeybee_zone, Index=panel_2, Wrap=True)
makeadiabatic = Honeybee_MakeAdiabatic(HBSrfs=item_2)  # -> HBSrfs; plug-in component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
item_3 = ListItem(List=decompose_honeybee_zone, Index="0", Wrap=True)
mass2zone_2 = Honeybee_Masses2Zones(zoneMasses=flatten([item_3, makeadiabatic]), isConditioned=Toggle(False), maxRoofAngle=30, createHBZones=Toggle(True))  # -> readMe, HBZones; plug-in component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
glazingcreator = Honeybee_GlazingBasedOnRatio(HBObjects=mass2zone_2.HBZones, glzRatio=glzparamlist, runIt=Toggle(True))  # -> readMe, HBObjWGLZ; plug-in component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
decomposebytype = Honeybee_DecomposeBasedOnType(HBZone=glazingcreator.HBObjWGLZ)  # -> walls, interiorWalls, airWalls, windows, interiorWindows, skylights, roofs, ceilings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; plug-in component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
brep_37 = Brep([decomposebytype.undergroundSlabs, decomposebytype.walls, decomposebytype.roofs])
brep_38 = Brep(decomposebytype.windows)
legendpar = Ladybug_LegendParameters(
    lowBound="0",
    highBound="18",
    customColors=flatten([ColourSwatch(SwatchColor=RGB(143, 188, 255)), ColourSwatch(SwatchColor=RGB(5, 73, 107))]))  # -> legendPar; plug-in component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
createhbsrfs_31 = Honeybee_createHBSrfs(geometry=brep_37)  # -> readMe, simplify(HBSurface); plug-in component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
createhbsrfs_32 = Honeybee_createHBSrfs(geometry=brep_38, RADMaterial=radglassmaterial_7.RADMaterial)  # -> readMe, simplify(HBSurface); plug-in component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
wires = BrepWireframe(Brep=[setepnatvent.HBZones, hb_epcontextsrf_5], Density=-1)
importepw = Ladybug_ImportEpw(epwFile=epw_stat.epwFile)  # -> readMe, latitude, location, dryBulbTemperature, dewPointTemperature, relativeHumidity, windSpeed, windDirection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; plug-in component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
panel_4 = Panel(importepw.location)

# ----
# lluvia
swatch = ColourSwatch(SwatchColor=RGB(252, 252, 252))
legendpar_2 = Ladybug_LegendParameters(lowBound="0", highBound="100", customColors=flatten([swatch, ColourSwatch(SwatchColor=RGB(25, 92, 125))]))  # -> legendPar; plug-in component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
pt = Point(Point(92.40346113, -8.18838156, 0))
_3dchart = Ladybug_3DChart(inputData=flatten(importepw.relativeHumidity), basePoint=pt, xScale=".02", yScale=".1", legendPar=legendpar_2)  # -> readMe, graphMesh, graphCurves, legend, legendBasePts, title, titleBasePts, dataPts, conditionalHOY; plug-in component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

# ----
# temperatura
panel_5 = Panel("37")
legendpar_3 = Ladybug_LegendParameters(lowBound="-14", highBound=panel_5)  # -> legendPar; plug-in component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
pt_2 = Point(Point(95.75311451, 36.514746, 0))
_3dchart_2 = Ladybug_3DChart(inputData=flatten(importepw.dryBulbTemperature), basePoint=pt_2, xScale=".02", yScale=".1", legendPar=legendpar_3)  # -> readMe, graphMesh, graphCurves, legend, legendBasePts, title, titleBasePts, dataPts, conditionalHOY; plug-in component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

# ----
# Fall
panel_6 = Panel("10")
analysisperiod = Ladybug_AnalysisPeriod(fromMonth=panel_6, fromDay="1", fromHour="0", toMonth="12", toDay="29", toHour="24")  # -> readMe, analysisPeriod; plug-in component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
windrose = Ladybug_WindRose(
    north=0,
    hourlyWindDirection=importepw.windDirection,
    hourlyWindSpeed=importepw.windSpeed,
    annualHourlyData=flatten(importepw.dryBulbTemperature),
    analysisPeriod=analysisperiod.analysisPeriod,
    legendPar=legendpar,
    runIt=Toggle(True))  # -> readMe, calmRoseMesh, windRoseMesh, windRoseCrvs, windRoseCenPts, legend, legendBasePts, title; plug-in component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

# ----
# Summer
panel_7 = Panel("7")
analysisperiod_2 = Ladybug_AnalysisPeriod(fromMonth=panel_7, fromDay="1", fromHour="0", toMonth="9", toDay="29", toHour="24")  # -> readMe, analysisPeriod; plug-in component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
windrose_2 = Ladybug_WindRose(
    north=0,
    hourlyWindDirection=importepw.windDirection,
    hourlyWindSpeed=importepw.windSpeed,
    annualHourlyData=flatten(importepw.dryBulbTemperature),
    analysisPeriod=analysisperiod_2.analysisPeriod,
    legendPar=legendpar,
    runIt=Toggle(True))  # -> readMe, calmRoseMesh, windRoseMesh, windRoseCrvs, windRoseCenPts, legend, legendBasePts, title; plug-in component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

panel_8 = Panel(setepnatvent.readMe)
preview = CustomPreview(Geometry=wires, Shader=colour)

# ----
# Spring
panel_9 = Panel("4")
analysisperiod_3 = Ladybug_AnalysisPeriod(fromMonth=panel_9, fromDay="1", fromHour="0", toMonth="6", toDay="29", toHour="24")  # -> readMe, analysisPeriod; plug-in component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
windrose_3 = Ladybug_WindRose(
    north=0,
    hourlyWindDirection=importepw.windDirection,
    hourlyWindSpeed=importepw.windSpeed,
    annualHourlyData=flatten(importepw.dryBulbTemperature),
    analysisPeriod=analysisperiod_3.analysisPeriod,
    legendPar=legendpar,
    runIt=Toggle(True))  # -> readMe, calmRoseMesh, windRoseMesh, windRoseCrvs, windRoseCenPts, legend, legendBasePts, title; plug-in component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

# ----
# Winter
panel_10 = Panel("1")
analysisperiod_4 = Ladybug_AnalysisPeriod(fromMonth=panel_10, fromDay="1", fromHour="0", toMonth="3", toDay="29", toHour="24")  # -> readMe, analysisPeriod; plug-in component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
windrose_4 = Ladybug_WindRose(
    north=0,
    hourlyWindDirection=importepw.windDirection,
    hourlyWindSpeed=importepw.windSpeed,
    annualHourlyData=flatten(importepw.dryBulbTemperature),
    analysisPeriod=analysisperiod_4.analysisPeriod,
    legendPar=legendpar,
    runIt=Toggle(True))  # -> readMe, calmRoseMesh, windRoseMesh, windRoseCrvs, windRoseCenPts, legend, legendBasePts, title; plug-in component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

brep_39 = Brep([createhbsrfs_31.HBSurface, createhbsrfs_32.HBSurface])
panel_11 = Panel("""9
12
15""")
panel_12 = Panel("""3
6
12""")
pt_3 = Point(<point referenced from the Rhino model>)
pt_4 = Point(<point referenced from the Rhino model>)
windrose_5 = Ladybug_WindRose(
    north=0,
    hourlyWindDirection=importepw.windDirection,
    hourlyWindSpeed=importepw.windSpeed,
    annualHourlyData=[importepw.dryBulbTemperature, importepw.relativeHumidity],
    conditionalStatement="18<a<23 and 80>b",
    legendPar=legendpar,
    runIt=Toggle(True))  # -> readMe, calmRoseMesh, windRoseMesh, windRoseCrvs, windRoseCenPts, legend, legendBasePts, title; plug-in component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
item_4 = ListItem(List=decompose_honeybee_zone, Index="4", Wrap=True)
vec2pt = Vector2Pt(PointA=pt_3, PointB=pt_4, Unitize=False)  # -> Vector, Length
vdis = VectorDisplay(Anchor=pt_3, Vector=vec2pt.Vector)
sunpath = Ladybug_SunPath(
    north=vec2pt.Vector,
    location=importepw.location,
    hour=panel_11,
    day="21",
    month=panel_12,
    timeStep=1,
    sunPathScale=".1",
    dailyOrAnnualSunPath=True)  # -> readMe, sunVectors, sunAltitudes, sunAzimuths, port, sunSpheresMesh, sunPathCrvs, legend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; plug-in component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
brep_40 = Brep(item_4)
toggle_5 = BooleanToggle(True)
pt_5 = Point(<point referenced from the Rhino model>)
vdis_2 = VectorDisplay(Anchor=sunpath.sunPositions, Vector=sunpath.sunVectors)
epoutput = Honeybee_GenerateEPOutput(
    zoneEnergyUse=toggle_5,
    zoneGainsAndLosses=toggle_5,
    zoneComfortMetrics=toggle_5,
    comfortMapVariables=toggle_5,
    zoneHVACParams=toggle_5,
    surfaceTempAnalysis=toggle_5,
    surfaceEnergyAnalysis=toggle_5)  # -> report, flatten(simulationOutputs); plug-in component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
runenergysimulation = Honeybee_RunEnergySimulation(
    epwFile=epw_stat.epwFile,
    HBZones=flatten(addhbglz_6),
    HBContext=flatten(hb_epcontextsrf_5),
    simulationOutputs=flatten(epoutput.simulationOutputs),
    writeIdf=toggle,
    runEnergyPlus=toggle)  # -> report, idfFileAddress, resultFileAddress; plug-in component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
readepsrfresult = Honeybee_ReadEPSurfaceResult(resultFileAddress=runenergysimulation.resultFileAddress)  # -> surfaceIndoorTemp, surfaceOutdoorTemp, surfaceEnergyFlow, opaqueEnergyFlow, glazEnergyFlow, port, port_2, port_3, windowTransmissivity, port_4; plug-in component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

# ----
# Annualbased
panel_13 = Panel(".76")
flip = Flip(Surface=createhbsrfs_28.HBSurface)  # -> Surface, Result
gentestpts = Honeybee_GenerateTestPoints(testGeometry=brep_27, gridSize=".5", distBaseSrf=panel_13, moveTestMesh=Toggle(False))  # -> readMe, simplify(testPoints), simplify(ptsVectors), simplify(facesArea), simplify(mesh); plug-in component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
annualdaylightsimulation = Honeybee_AnnualDaylightSimulation(
    epwWeatherFile=epw_stat.epwFile,
    testPoints=gentestpts.testPoints,
    ptsVectors=gentestpts.ptsVectors,
    testMesh=gentestpts.mesh)  # -> analysisRecipe; plug-in component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
rundaylightanalysis = Honeybee_RunDaylightSimulation(
    HBObjects=flatten(hb_epcontextsrf_4),
    analysisRecipe=annualdaylightsimulation,
    writeRad=toggle_2,
    runRad=toggle_2,
    numOfCPUs="8",
    workingDir="C:\BPS_Final\TestInfo",
    overwriteResults=True)  # -> readMe, analysisType, resultsUnit, results, testPts, resultFiles, radGeoFile, studyFolder, done; plug-in component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
occupancygenerator = Honeybee_DaysimOccupancyGenerator(weekendDays="0", writeTheOcc=Toggle(True))  # -> occupancyFile; plug-in component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
readannualresultsi = Honeybee_ReadAnnualResultI(
    illFilesAddress=rundaylightanalysis.resultFiles,
    testPoints=simplify(gentestpts.testPoints),
    ptsVectors=gentestpts.ptsVectors,
    occupancyFiles=occupancygenerator,
    DLAIllumThresholds="300",
    runIt=Toggle(True))  # -> DLA, UDLI_Less_100, UDLI_100_2000, UDLI_More_2000, CDA, sDA, annualProfiles, htmReport; plug-in component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
legendpar_4 = Ladybug_LegendParameters(lowBound="0", highBound="100")  # -> legendPar; plug-in component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
recolormesh = Ladybug_RecolorMesh(
    analysisResult=readannualresultsi.UDLI_More_2000,
    inputMesh=gentestpts.mesh,
    legendPar=legendpar_4,
    analysisTitle=" ",
    bakeIt="2")  # -> readMe, newMesh, newLegend, legendBasePt, meshColors, legendColors; plug-in component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

readepresult = Honeybee_ReadEPResult(resultFileAddress=runenergysimulation.resultFileAddress)  # -> port, port_2, port_3, port_4, electricLight, electricEquip, port_5, port_6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; plug-in component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
colorsurfaces = Honeybee_ColorSurfacesByEPResult(srfData=readepsrfresult.surfaceIndoorTemp, HBZones=flatten(setepnatvent.HBZones), runIt=Toggle(True))  # -> readMe, srfColoredMesh, zoneWireFrame, legend, legendBasePt, analysisTitle, srfBreps, srfColors, srfValues, port; plug-in component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
panel_14 = Panel(readannualresultsi.sDA)

outdoorcomfortcalculator = Ladybug_OutdoorComfortCalculator(
    dryBulbTemperature=importepw.dryBulbTemperature,
    windSpeed_tenMeters=importepw.windSpeed,
    relativeHumidity=importepw.relativeHumidity,
    runIt=Toggle(True))  # -> readMe, port, universalThermalClimateIndex, comfortableOrNot, thermalStress, conditionOfPerson, port_2, percentOfTimeComfortable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; plug-in component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
# UTCI
_3dchart_3 = Ladybug_3DChart(inputData=flatten(outdoorcomfortcalculator.thermalStress), xScale=".02", yScale=".1")  # -> readMe, graphMesh, graphCurves, legend, legendBasePts, title, titleBasePts, dataPts, conditionalHOY; plug-in component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

psychchart = Ladybug_PsychrometricChart(dryBulbTemperature=readepresult.airTemperature, relativeHumidity=readepresult.relativeHumidity, runIt=Toggle(False))  # -> readMe, port, totalComfortPercent, totalComfortOrNot, strategyNames, strategyPercentOfTime, strategyOrNot, port_2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; plug-in component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
adaptivecomfortcalculator = Ladybug_AdaptiveComfortCalculator(
    dryBulbTemperature=readepresult.airTemperature,
    meanRadiantTemperature=readepresult.meanRadTemperature,
    prevailingOutdoorTemp=importepw.dryBulbTemperature,
    runIt=Toggle(True))  # -> readMe, port, comfortableOrNot, conditionOfPerson, degreesFromTarget, port_2, targetTemperature, upperTemperatureBound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; plug-in component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
gradientlibrary = Ladybug_GradientLibrary(gradIndex="19")  # -> customColors; plug-in component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
energybalance = Honeybee_ConstructEnergyBalance(
    HBZones=flatten(setepnatvent.HBZones),
    cooling=readepresult.port_3,
    heating=readepresult.port_4,
    electricLight=readepresult.electricLight,
    peopleGains=readepresult.peopleGains,
    totalSolarGain=readepresult.totalSolarGain,
    infiltrationEnergy=readepresult.infiltrationEnergy,
    natVentEnergy=readepresult.port_8,
    surfaceEnergyFlow=readepsrfresult.surfaceEnergyFlow)  # -> readMe, port, flrNormEnergyBal, flrNormBalWStorage, port_2, modelEnergyBalance, energyBalWithStorage; plug-in component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
legendpar_5 = Ladybug_LegendParameters(lowBound="600", highBound="600", customColors=flatten(gradientlibrary))  # -> legendPar; plug-in component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
toggle_6 = BooleanToggle(True)
pt_6 = Point(<point referenced from the Rhino model>)
selectandaveragedata = Ladybug_AverageData(annualHourlyData=energybalance.modelEnergyBalance, totalOrAverage=Toggle(True))  # -> readMe, selHourlyData, totaledDaily, totaledMonthly, totMonthlyPerHour, totAnalysisPeriod; plug-in component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
pt_7 = Point(<point referenced from the Rhino model>)
_3dchart_4 = Ladybug_3DChart(inputData=flatten(adaptivecomfortcalculator.conditionOfPerson), basePoint=pt_6, xScale=".02", yScale=".1")  # -> readMe, graphMesh, graphCurves, legend, legendBasePts, title, titleBasePts, dataPts, conditionalHOY; plug-in component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
barchart = Ladybug_MonthlyBarChart(
    inputData=flatten(selectandaveragedata.totaledMonthly),
    stackValues=toggle_6,
    plotFromZero=toggle_6,
    basePoint=pt_7,
    legendPar=legendpar_5)  # -> readMe, dataMesh, dataCurves, dataCrvColors, graphAxes, graphLabels, title, titleBasePt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; plug-in component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
panel_15 = Panel("""Comfortable (%): 
hot (%):         
cold (%):        """)
comfortable_hot_cold = Panel([adaptivecomfortcalculator.percentOfTimeComfortable, adaptivecomfortcalculator.percentHotCold])
num = Number(comfortable_hot_cold)
expression = Expression(x=num, Expression="Round(x, 2)")
flip_2 = FlipMatrix(Data=panel_15)  # -> simplify(Data)
flip_3 = FlipMatrix(Data=expression)  # -> simplify(Data)
panel_16 = Panel([flip_2, flip_3])
join = TextJoin(Text=panel_16)
join_2 = TextJoin(Text=flatten(join))
pt_8 = Point(Point(19.85070168, -13.30973703, 0))
tag = TextTag3D(Location=pt_8, Text=join_2, Size=1, Colour=ColourSwatch(SwatchColor=RGB(0, 0, 0)), Justification=5)

# ----
# Imagebased
panel_17 = Panel("1200")
pt_9 = Point(<point referenced from the Rhino model>)
pt_10 = Point(<point referenced from the Rhino model>)
vec2pt_2 = Vector2Pt(PointA=pt_10, PointB=pt_9, Unitize=False)  # -> Vector, Length
settheview = Ladybug_SetTheView(cameraLocation=pt_10, cameraDirection=vec2pt_2.Vector)  # plug-in component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

# ----
# Gridbased
flip_4 = Flip(Surface=brep_33)  # -> Surface, Result
toggle_7 = BooleanToggle(False)
number_slider = Slider(0, range=0..2)
panel_18 = Panel("""3
6
12""")
number_slider_2 = Slider(0, range=0..2)
panel_19 = Panel("""9
12
15""")
item_5 = ListItem(List=panel_18, Index=number_slider_2, Wrap=True)
item_6 = ListItem(List=panel_19, Index=number_slider, Wrap=True)
genclimatebasedsky = Honeybee_GenerateClimateBasedSky(weatherFile=epw_stat.epwFile, month=item_5, day="21", hour="9")  # -> radiationValues, skyFilePath; plug-in component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
fly = Ladybug_fly(inputSliders=[number_slider_2, number_slider], fly=button)  # -> Vviiiiiiiiiizzz; plug-in component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
join_3 = TextJoin(Text=[item_5, "21", item_6], Join="_")
panel_20 = Panel(join_3)
legendpar_6 = Ladybug_LegendParameters(lowBound="300", highBound="2000")  # -> legendPar; plug-in component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
captureview = Ladybug_CaptureView(
    fileName=panel_20,
    folder="C:\BPS_Final\ResultImgs",
    viewNames="Top",
    imageWidth="1600",
    imageHeight="1200",
    capture=Toggle(True))  # -> imagePath; plug-in component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
panel_21 = Panel(captureview)

imagebasedsimulation = Honeybee_ImageBasedSimulation(
    skyFile=genclimatebasedsky.skyFilePath,
    rhinoViewsName="Trabajo",
    cameraType="1",
    simulationType=2,
    imageWidth=panel_17,
    imageHeight=panel_17,
    backupImages=0)  # -> analysisRecipe; plug-in component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
rundaylightanalysis_2 = Honeybee_RunDaylightSimulation(
    HBObjects=flatten(addhbglz_6),
    analysisRecipe=imagebasedsimulation,
    writeRad=toggle_3,
    runRad=toggle_3,
    workingDir="C:\BPS_Final\TestInfo",
    radFileName=panel_20,
    overwriteResults=True)  # -> readMe, analysisType, resultsUnit, results, testPts, resultFiles, radGeoFile, studyFolder, done; plug-in component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
glareanalysis = Honeybee_GlareAnalysis(HDRImagePath=rundaylightanalysis_2.resultFiles, runIt=Toggle(True))  # -> readMe, glareCheckImage, DGP, DGI, imageWithTaskArea; plug-in component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
falsecolor = Honeybee_FalseColor(
    HDRFilePath=rundaylightanalysis_2.resultFiles,
    contourBands=False,
    maskThreshold=0.1,
    useAlterColors=False,
    render=Toggle(False))  # -> outputFilePath; plug-in component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
hdr_tif = Honeybee_ConvertHDRToTIF(HDRFilePath=glareanalysis.glareCheckImage, adjustExposure=False)  # -> TIFFFilePath; plug-in component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
hdr_tif_2 = Honeybee_ConvertHDRToTIF(HDRFilePath=falsecolor, adjustExposure=False)  # -> TIFFFilePath; plug-in component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
hdr_gif = Honeybee_ConvertHDRToGIF(HDRFilePath=[glareanalysis.glareCheckImage, falsecolor], adjustExposure=False)  # -> GIFFilePath; plug-in component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
image = ImageFromPath(P=hdr_tif_2, S=".2")
image_2 = ImageFromPath(P=hdr_tif, S=".2")

gentestpts_2 = Honeybee_GenerateTestPoints(testGeometry=flip_4.Surface, gridSize=".25", distBaseSrf=".76", moveTestMesh=True)  # -> readMe, simplify(testPoints), simplify(ptsVectors), simplify(facesArea), simplify(mesh); plug-in component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

gridbasedsimulation = Honeybee_GridBasedSimulation(
    skyFile=genclimatebasedsky.skyFilePath,
    testPoints=gentestpts_2.testPoints,
    ptsVectors=gentestpts_2.ptsVectors,
    testMesh=gentestpts_2.mesh,
    simulationType=0)  # -> analysisRecipe; plug-in component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
rundaylightanalysis_3 = Honeybee_RunDaylightSimulation(
    HBObjects=flatten([addhbglz_6, hb_epcontextsrf_5]),
    analysisRecipe=gridbasedsimulation,
    writeRad=toggle_4,
    runRad=toggle_4,
    numOfCPUs="8",
    workingDir="C:\BPS_Final\TestInfo",
    radFileName=panel_20,
    overwriteResults=True)  # -> readMe, analysisType, resultsUnit, results, testPts, resultFiles, radGeoFile, studyFolder, done; plug-in component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
recolormesh_2 = Ladybug_RecolorMesh(analysisResult=rundaylightanalysis_3.results, inputMesh=gentestpts_2.mesh, legendPar=legendpar_6, analysisTitle=" ")  # -> readMe, newMesh, newLegend, legendBasePt, meshColors, legendColors; plug-in component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
