# Grasshopper definition Fan_Cao.gh (Grasshopper 0.9.76)
# plug-ins: Python Interpreter, Bifocals, embryoA

number_slider = Slider(0.6, range=0..1)
windows = Brep([<brep referenced from the Rhino model> x3])
wall = Brep(<brep referenced from the Rhino model>)
wall_2 = Brep([<brep referenced from the Rhino model> x2])
createhbsrfs = Honeybee_createHBSrfs(geometry=wall, srfType="0")  # -> readMe, simplify(HBSurface); plug-in component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
createhbsrfs_2 = Honeybee_createHBSrfs(geometry=wall_2, srfType="2")  # -> readMe, simplify(HBSurface); plug-in component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
radglassmaterial = Honeybee_RadianceGlassMaterial(
    materialName="Glass",
    RTransmittance=number_slider,
    GTransmittance=number_slider,
    BTransmittance=number_slider,
    refractiveIndex=1.52)  # -> avrgTrans, RADMaterial; plug-in component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
geo = Geometry(<brep referenced from the Rhino model>)
mass2zone = Honeybee_Masses2Zones(zoneMasses=flatten(geo), isConditioned=True, maxRoofAngle=30, createHBZones=Toggle(True))  # -> readMe, HBZones; plug-in component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
createhbsrfs_3 = Honeybee_createHBSrfs(geometry=windows, RADMaterial=radglassmaterial.RADMaterial)  # -> readMe, simplify(HBSurface); plug-in component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
brep = Brep([createhbsrfs_3.HBSurface, createhbsrfs.HBSurface, createhbsrfs_2.HBSurface])
brep_2 = Brep(brep)
panel = Panel("https://www.energyplus.net/weather-download/north_and_central_america_wmo_region_4/USA/PA/USA_PA_Philadelphia.Intl.AP.724080_TMY3/all")
genhbzonetestpts = Honeybee_GenerateZoneTestPoints(
    HBZone=mass2zone.HBZones,
    gridSize=Slider(0.5, range=0..1),
    distBaseSrf=Slider(0.762, range=0..1),
    moveTestMesh=Toggle(True))  # -> readMe, simplify(testPoints), simplify(ptsVectors), simplify(facesArea), simplify(mesh); plug-in component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
epw_stat = Ladybug_OpenEPWAndSTATWeatherFiles(weatherFileURL=panel)  # -> epwFile, statFile; plug-in component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
wires = BrepWireframe(Brep=brep_2, Density=-1)
annualdaylightsimulation = Honeybee_AnnualDaylightSimulation(
    epwWeatherFile=epw_stat.epwFile,
    testPoints=genhbzonetestpts.testPoints,
    ptsVectors=genhbzonetestpts.ptsVectors,
    testMesh=genhbzonetestpts.mesh)  # -> analysisRecipe; plug-in component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
toggle = BooleanToggle(False)
rundaylightanalysis = Honeybee_RunDaylightSimulation(
    HBObjects=flatten(brep_2),
    analysisRecipe=annualdaylightsimulation,
    writeRad=toggle,
    runRad=toggle,
    overwriteResults=True)  # -> readMe, analysisType, resultsUnit, results, testPts, resultFiles, radGeoFile, studyFolder, done; plug-in component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
occupancygenerator = Honeybee_DaysimOccupancyGenerator(weekendDays=[1, 2], writeTheOcc=Toggle(True))  # -> occupancyFile; plug-in component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
gradientlibrary = Ladybug_GradientLibrary(gradIndex=Slider(0, range=0..10))  # -> customColors; plug-in component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
readannualresultsi = Honeybee_ReadAnnualResultI(
    illFilesAddress=rundaylightanalysis.resultFiles,
    testPoints=simplify(rundaylightanalysis.testPts),
    occupancyFiles=occupancygenerator,
    DLAIllumThresholds=300,
    runIt=Toggle(True))  # -> DLA, UDLI_Less_100, UDLI_100_2000, UDLI_More_2000, CDA, sDA, annualProfiles, htmReport; plug-in component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
legendpar = Ladybug_LegendParameters(
    lowBound=Slider(0, range=0..100),
    highBound=Slider(100, range=0..100),
    numSegments=Slider(10, range=0..10),
    customColors=flatten(gradientlibrary))  # -> legendPar; plug-in component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
dom = ConstructDomain(DomainStart=0, DomainEnd=Slider(1, range=0..1))
panel_2 = Panel("%")  # disabled
recolormesh = Ladybug_RecolorMesh(
    analysisResult=readannualresultsi.UDLI_Less_100,
    inputMesh=genhbzonetestpts.mesh,
    heightDomain=dom,
    legendPar=legendpar,
    analysisTitle=rundaylightanalysis.analysisType,
    legendTitle=panel_2)  # -> readMe, newMesh, newLegend, legendBasePt, meshColors, legendColors; plug-in component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

honeybee = Honeybee_Honeybee(defaultFolder="c:\honeybee")  # -> Vviiiiiiiiiizzz; plug-in component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
ladybug = Ladybug_Ladybug(defaultFolder="c:\ladybug")  # -> Vviiiiiiiiiizzz; plug-in component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

# ----
# Finally for complex geometries or
# geometries that are not going to change
# it is better to export them as rad files
# using RAD>Mesh and use them as
# additional files.
number_slider_2 = Slider(0.6, range=0..1)
panel_3 = Panel("https://www.energyplus.net/weather-download/north_and_central_america_wmo_region_4/USA/PA/USA_PA_Philadelphia.Intl.AP.724080_TMY3/all")
windows_2 = Brep([<brep referenced from the Rhino model> x3])
wall_3 = Brep(<brep referenced from the Rhino model>)
wall_4 = Brep([<brep referenced from the Rhino model> x2])
epw_stat_2 = Ladybug_OpenEPWAndSTATWeatherFiles(weatherFileURL=panel_3)  # -> epwFile, statFile; plug-in component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
createhbsrfs_4 = Honeybee_createHBSrfs(geometry=wall_3, srfType="0")  # -> readMe, simplify(HBSurface); plug-in component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
createhbsrfs_5 = Honeybee_createHBSrfs(geometry=wall_4, srfType="2")  # -> readMe, simplify(HBSurface); plug-in component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
radglassmaterial_2 = Honeybee_RadianceGlassMaterial(
    materialName="Glass",
    RTransmittance=number_slider_2,
    GTransmittance=number_slider_2,
    BTransmittance=number_slider_2,
    refractiveIndex=1.52)  # -> avrgTrans, RADMaterial; plug-in component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
createhbsrfs_6 = Honeybee_createHBSrfs(geometry=windows_2, RADMaterial=radglassmaterial_2.RADMaterial)  # -> readMe, simplify(HBSurface); plug-in component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
number_slider_3 = Slider(45, range=0..100)
genclimatebasedsky = Honeybee_GenerateClimateBasedSky(north=number_slider_3, weatherFile=epw_stat_2.epwFile, month="3", day="21", hour="9")  # -> radiationValues, skyFilePath; plug-in component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
genavgsky = Honeybee_GenerateAverageSky(north=number_slider_3, weatherFile=epw_stat_2.epwFile, month="3", hour="9")  # -> radiationValues, skyFilePath; plug-in component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
northarrow = Ladybug_North(north=number_slider_3, scale=".05")  # -> northSign; plug-in component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
md_slider = MDSlider(
    slider_value=Point(0.6571696212, 0.4806354802, 0.5),
    SliderMode=0,
    x_domain=Domain(-1, 1),
    y_domain=Domain(-1, 1),
    z_domain=Domain(0, 1))
brep_3 = Brep([createhbsrfs_6.HBSurface, createhbsrfs_4.HBSurface, createhbsrfs_5.HBSurface])
panel_4 = Panel([genclimatebasedsky.radiationValues, genavgsky.radiationValues])
set_the_view_to_fisheye_for_glare_analys = Panel("1")  # "set the view to FishEye for Glare Analysis"
radparameters = Honeybee_RADParameters(quality=0, ab="3")  # -> readMe, radParameters; plug-in component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
doy_hoy = Ladybug_DOY_HOY(days="21", months="3", hours="9")  # -> HOY, DOY, date; plug-in component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
imagebasedsimulation = Honeybee_ImageBasedSimulation(
    skyFile=genavgsky.skyFilePath,
    cameraType=set_the_view_to_fisheye_for_glare_analys,
    simulationType=2,
    radParameters=radparameters.radParameters,
    backupImages=0)  # -> analysisRecipe; plug-in component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
toggle_2 = BooleanToggle(False)
panel_5 = Panel("""Radiance
Grasshopper
Honeybee
Glare
Daylight
Set View
HBExampleFiles""")
panel_6 = Panel("""This file shows how to run a glare analysis using Honeybee. This example is using same geometry as the other daylighting examples [[1](http://hydrashare.github.io/hydra/viewer?owner=mostaphaRoudsari&fork=hydra_1&id=Surface_by_surface_geometry_preparation_for_daylight_simulation_II), [2](http://hydrashare.github.io/hydra/viewer?owner=mostaphaRoudsari&fork=hydra_1&id=Find_when_sun_is_visible_to_a_point)].
The example is uses Averaged Climate-based Sky for glare analysis which uses the average value for that hour during the whole month.""")
panel_7 = Panel("C:\Users\Administrator\Dropbox\ladybug\helpDesk\PennDesign2015\Daylight_Glare_Analysis.png")
number_slider_4 = Slider(0.35, range=0..1)
geo_2 = Geometry([<brep referenced from the Rhino model> x27])
exporthydra = Hydra_ExportFile(
    fileName="Glare Analysis",
    fileDescription=panel_6,
    fileTags=panel_5,
    targetFolder="C:\Users\Administrator\Documents\GitHub\hydra_1",
    includeRhino=Toggle(True),
    additionalImgs=panel_7,
    export=Toggle(False))  # -> readMe; inputs fileDescription: list, changeLog: list, fileTags: list, includeRhino: Boolean, GHForThumb: Boolean, additionalImgs: list, export: Boolean; plug-in component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
radopaquematerial = Honeybee_RadianceOpaqueMaterial(
    materialName="context_material",
    RReflectance=number_slider_4,
    GReflectance=number_slider_4,
    BReflectance=number_slider_4,
    roughness=0.05,
    specularity=0)  # -> avrgRef, RADMaterial; plug-in component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
msh2rad = Honeybee_MSH2RAD(
    mesh=geo_2,
    RADMaterial=radopaquematerial.RADMaterial,
    workingDir="c:\ladybug",
    radFileName="ParisProjectContext",
    writeRAD=Toggle(True))  # -> materialFile, radianceFile; plug-in component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
merge = Merge(Data1=msh2rad.materialFile, Data2=msh2rad.radianceFile)
panel_8 = Panel(merge)
number_slider_5 = Slider(0.8, range=0..1)

# ---- group: For better visualization - Doesn't effect the results of the analysis
importlocation = Ladybug_ImportLocation(epwFile=epw_stat_2.epwFile)  # -> location; plug-in component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
sunpath = Ladybug_SunPath(
    north=number_slider_3,
    location=importlocation,
    hour="9",
    day="21",
    month="3",
    timeStep=1,
    sunPathScale=Slider(0.2, range=0..1),
    dailyOrAnnualSunPath=True)  # -> readMe, sunVectors, sunAltitudes, sunAzimuths, port, sunSpheresMesh, sunPathCrvs, legend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; disabled; plug-in component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

# ---- group: collect all honeybee surfaces
brep_4 = Brep(flatten(brep_3))

# ----
# run the analysis
# visualize the results
# prepare a recipe
# Generate sky
# Animate sliders
# capture the viewport to an image
number_slider_6 = Slider(0.6, range=0..1)
windows_3 = Brep([<brep referenced from the Rhino model> x3])
wall_5 = Brep(<brep referenced from the Rhino model>)
geo_3 = Geometry(<brep referenced from the Rhino model>)
wall_6 = Brep([<brep referenced from the Rhino model> x2])
number_slider_7 = Slider(0, range=0..2)
number_slider_8 = Slider(0, range=0..2)
createhbsrfs_7 = Honeybee_createHBSrfs(geometry=wall_5, srfType="0")  # -> readMe, simplify(HBSurface); plug-in component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
createhbsrfs_8 = Honeybee_createHBSrfs(geometry=wall_6, srfType="2")  # -> readMe, simplify(HBSurface); plug-in component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
radglassmaterial_3 = Honeybee_RadianceGlassMaterial(
    materialName="Glass",
    RTransmittance=number_slider_6,
    GTransmittance=number_slider_6,
    BTransmittance=number_slider_6,
    refractiveIndex=1.52)  # -> avrgTrans, RADMaterial; plug-in component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
hours = Panel("""9
12
15""")
months = Panel("""3
6
12""")
createhbsrfs_9 = Honeybee_createHBSrfs(geometry=windows_3, RADMaterial=radglassmaterial_3.RADMaterial)  # -> readMe, simplify(HBSurface); plug-in component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
fly = Ladybug_fly(inputSliders=[number_slider_7, number_slider_8], fly=Button())  # -> Vviiiiiiiiiizzz; plug-in component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
item = ListItem(List=hours, Index=number_slider_8, Wrap=True)
item_2 = ListItem(List=months, Index=number_slider_7, Wrap=True)
panel_9 = Panel("""9
12
15""")
panel_10 = Panel("""3
6
12""")
brep_5 = Brep([createhbsrfs_9.HBSurface, createhbsrfs_7.HBSurface, createhbsrfs_8.HBSurface])
path = FilePath("C:\Users\CF\Google 云端硬盘\Myself\2016Fall\ARCH-753-001-Building Performance Simulation\Weather\USA_PA_Philadelphia-NE.Philadelphia.AP.724085_TMY3\USA_PA_Philadelphia-NE.Philadelphia.AP.724085_TMY3.epw")
importlocation_2 = Ladybug_ImportLocation(epwFile=path)  # -> location; plug-in component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
sunpath_2 = Ladybug_SunPath(
    location=importlocation_2,
    hour=panel_9,
    day=21,
    month=panel_10,
    timeStep=1,
    sunPathScale=Slider(0.2, range=0..1),
    dailyOrAnnualSunPath=True)  # -> readMe, sunVectors, sunAltitudes, sunAzimuths, port, sunSpheresMesh, sunPathCrvs, legend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; plug-in component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
genclimatebasedsky_2 = Honeybee_GenerateClimateBasedSky(weatherFile=path, month=item_2, day="21", hour=item)  # -> radiationValues, skyFilePath; plug-in component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
doy_hoy_2 = Ladybug_DOY_HOY(days="21", months=item_2, hours=item)  # -> HOY, DOY, date; plug-in component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
toggle_3 = BooleanToggle(False)
panel_11 = Panel(doy_hoy_2.date)
legendpar_2 = Ladybug_LegendParameters(lowBound="300", highBound="2000")  # -> legendPar; plug-in component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
join = TextJoin(Text=[item_2, "21", item], Join="_")
panel_12 = Panel(join)
captureview = Ladybug_CaptureView(fileName=panel_12, capture=Toggle(True))  # -> imagePath; plug-in component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
panel_13 = Panel(captureview)

flip = Flip(Surface=geo_3)  # -> Surface, Result

gentestpts = Honeybee_GenerateTestPoints(
    testGeometry=flip.Surface,
    gridSize=Slider(0.5, range=0..1),
    distBaseSrf=Slider(0.762, range=-3.001..2.002),
    moveTestMesh=True)  # -> readMe, simplify(testPoints), simplify(ptsVectors), simplify(facesArea), simplify(mesh); plug-in component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
gridbasedsimulation = Honeybee_GridBasedSimulation(
    skyFile=genclimatebasedsky_2.skyFilePath,
    testPoints=gentestpts.testPoints,
    ptsVectors=gentestpts.ptsVectors,
    testMesh=gentestpts.mesh,
    simulationType=0)  # -> analysisRecipe; plug-in component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
rundaylightanalysis_2 = Honeybee_RunDaylightSimulation(HBObjects=flatten(brep_5), analysisRecipe=gridbasedsimulation, writeRad=toggle_3, runRad=toggle_3, overwriteResults=True)  # -> readMe, analysisType, resultsUnit, results, testPts, resultFiles, radGeoFile, studyFolder, done; plug-in component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
concat = Concatenate(FragmentA=rundaylightanalysis_2.analysisType, FragmentC=panel_11)
recolormesh_2 = Ladybug_RecolorMesh(
    analysisResult=rundaylightanalysis_2.results,
    inputMesh=gentestpts.mesh,
    legendPar=legendpar_2,
    analysisTitle=concat,
    legendTitle=rundaylightanalysis_2.resultsUnit)  # -> readMe, newMesh, newLegend, legendBasePt, meshColors, legendColors; plug-in component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

pt = Point(Point(-1.063078684, -3.778793716, 0))
comfortmannequin = Ladybug_ComfortMannequin(rotationAngle="175", bodyLocation=pt)  # -> mannequinMesh, legend, legendBasePt; plug-in component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

# ---- group: Person's face!
item_3 = ListItem(List=comfortmannequin.mannequinMesh, Index=121, Wrap=True)

# ----
preview = CustomPreview(Geometry=item_3, Shader=ColourSwatch(SwatchColor=RGB(255, 0, 0)))

facen = FaceNormals(Mesh=item_3)  # -> Centers, Normals
settheview = Ladybug_SetTheView(cameraLocation=facen.Centers, cameraDirection=facen.Normals, uvLookAround=md_slider)  # -> readMe; plug-in component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
rundaylightanalysis_3 = Honeybee_RunDaylightSimulation(
    HBObjects=flatten(brep_4),
    analysisRecipe=imagebasedsimulation,
    writeRad=toggle_2,
    runRad=toggle_2,
    numOfCPUs="4",
    radFileName=doy_hoy.date,
    additionalRadFiles=merge,
    overwriteResults=True)  # -> readMe, analysisType, resultsUnit, results, testPts, resultFiles, radGeoFile, studyFolder, done; plug-in component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
glareanalysis = Honeybee_GlareAnalysis(HDRImagePath=rundaylightanalysis_3.resultFiles, runIt=Toggle(True))  # -> readMe, glareCheckImage, DGP, DGI, imageWithTaskArea; plug-in component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
falsecolor = Honeybee_FalseColor(
    HDRFilePath=rundaylightanalysis_3.resultFiles,
    contourBands=False,
    maskThreshold=0.1,
    useAlterColors=False,
    render=Toggle(True))  # -> outputFilePath; plug-in component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
panel_14 = Panel(glareanalysis.DGP)
hdr_tif = Honeybee_ConvertHDRToTIF(HDRFilePath=glareanalysis.glareCheckImage, adjustExposure=Toggle(True))  # -> TIFFFilePath; plug-in component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
hdr_tif_2 = Honeybee_ConvertHDRToTIF(HDRFilePath=falsecolor, adjustExposure=False)  # -> TIFFFilePath; plug-in component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
image = ImageFromPath(P=hdr_tif, S=number_slider_5)
image_2 = ImageFromPath(P=hdr_tif_2, S=number_slider_5)
