# Grasshopper definition Fan_Cao.gh (Grasshopper 0.9.76)
# plug-ins: Python Interpreter, Bifocals

ladybug = Ladybug_Ladybug()  # -> Vviiiiiiiiiizzz; plug-in component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

# ---- group: WWR
# Wall to Window Ratio
wwr_north = Slider(0, range=0..1)
wwr_west = Slider(0.27, range=0..1)
wwr_south = Slider(0.41, range=0..1)
wwr_east = Slider(0, range=0..1)

# ----
honeybee = Honeybee_Honeybee()  # -> Vviiiiiiiiiizzz; plug-in component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
# Rotation Angle
number_slider = Slider(90, range=-90..180)

shading_depth = Slider(0.9, range=0..1)
number_of_blinds = Slider(4, range=0..10)
# Blinds
add_blinds = BooleanToggle(True)

# ----
# Construction
list = ValueList({"Exterior Wall [R5.5]": "ASHRAE 90.1-2004 EXTWALL METAL CLIMATEZONE 4", "Exterior Wall [R5.8]": "ASHRAE 90.1-2004 EXTWALL MASS CLIMATEZONE 3-4", "Exterior Wall [R7.2]": "ASHRAE 90.1-2004 EXTWALL STEELFRAME CLIMATEZONE 1-4", "Exterior Wall [R8.7]": "ASHRAE 90.1-2004 EXTWALL MASS CLIMATEZONE ALT-RES 4", "Exterior Wall [R10.4]": "ASHRAE 90.1-2004 EXTWALL WOODFRAME CLIMATEZONE 1-7", "Exterior Wall [R14.8]": "ASHRAE 90.1-2004 EXTWALL STEELFRAME CLIMATEZONE ALT-RES 4-6", "Exterior Wall [R34.4]": "ASHRAE 189.1-2009 EXTROOF IEAD CLIMATEZONE 7-8"}, selected="Exterior Wall [R5.8]")
list_2 = ValueList({"Exterior Roof [R9.2]": "ASHRAE 90.1-2004 EXTROOF METAL CLIMATEZONE 3-4", "Exterior Roof [R14.8]": "ASHRAE 90.1-2004 EXTROOF IEAD CLIMATEZONE 1-4", "Exterior Roof [R34.4]": "ASHRAE 189.1-2009 EXTROOF IEAD CLIMATEZONE 7-8"}, selected="Exterior Roof [R34.4]")
number_slider_2 = Slider(2, range=0..10)
list_3 = ValueList({"Exterior Window [R1.0, SHGC 0.7]": "ASHRAE 90.1-2004 EXTWINDOW CLIMATEZONE ALT-WARE 1-8", "Exterior Window [R1.7, SHGC 0.39]": "ASHRAE 90.1-2004 EXTWINDOW CLIMATEZONE 4-6", "Exterior Window [R1.9, SHGC 0.39]": "ASHRAE 90.1-2004 EXTWINDOW CLIMATEZONE ALT-RES 4-6", "Exterior Window [R0.7, SHGC 0.65]": "Dbl LoE (e3=.1) Clr 3mm/13mm Arg"}, selected="Exterior Window [R1.7, SHGC 0.39]")

run_energyplus = BooleanToggle(True)
# Thermal Mass
list_4 = ValueList({"Existing Slab Construction": "0", "+4 Inches Concrete": "1", "+8 Inches Concrete": "2"}, selected="Existing Slab Construction")

bldgprograms = Honeybee_bldgPrograms({"Office": 0, "Retail": 1, "MidriseApartment": 2, "PrimarySchool": 3, "SecondarySchool": 4, "SmallHotel": 5, "LargeHotel": 6, "Hospital": 7, "Outpatient": 8, "Warehouse": 9, "SuperMarket": 10, "FullServiceRestaurant": 11, "QuickServiceRestaurant": 12}, selected="Office")
listzoneprograms = Honeybee_ListZonePrograms(bldgProgram=bldgprograms)  # -> OfficeZonePrograms; plug-in component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
item = ListItem(List=listzoneprograms, Index=10, Wrap=True)

box = DomainBox(Base=PlaneXY(0, 0, 0), X=Domain(0, 5), Y=Domain(0, 12), Z=Domain(0, 4.2))
mass2zone = Honeybee_Masses2Zones(zoneMasses=flatten(box), zonePrograms=item, isConditioned=Toggle(True), maxRoofAngle=30, createHBZones=Toggle(True))  # -> readMe, HBZones; plug-in component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
glzparamlist = Honeybee_GlazingParametersList(northGlzParam=wwr_north, westGlzParam=wwr_west, southGlzParam=wwr_south, eastGlzParam=wwr_east)  # -> glzParamList; plug-in component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
# Geometry
toggle = BooleanToggle(True)

callfromepconstrlibrary = Honeybee_CallFromEPConstructionLibrary(keywords="floor")  # -> ThermMaterials, EPMaterials, EPWindowMaterials, EPConstructions; plug-in component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
item_2 = ListItem(List=callfromepconstrlibrary.EPConstructions, Index=Slider(0, range=0..100), Wrap=True)
decomposeepconstruction = Honeybee_DecomposeEPConstruction(cnstrName=item_2)  # -> flatten(materials), comments, UValue_SI, UValue_IP, RValue_SI, RValue_IP; plug-in component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

callfromepconstrlibrary_2 = Honeybee_CallFromEPConstructionLibrary(keywords="slab")  # -> ThermMaterials, EPMaterials, EPWindowMaterials, EPConstructions; plug-in component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
item_3 = ListItem(List=callfromepconstrlibrary_2.EPConstructions, Index="2", Wrap=True)
decomposeepconstruction_2 = Honeybee_DecomposeEPConstruction(cnstrName=item_3)  # -> flatten(materials), comments, UValue_SI, UValue_IP, RValue_SI, RValue_IP; plug-in component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

glazingcreator = Honeybee_GlazingBasedOnRatio(HBObjects=mass2zone.HBZones, glzRatio=glzparamlist, breakUpDist=toggle, runIt=Toggle(True))  # -> readMe, HBObjWGLZ; plug-in component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
volume = Volume(Geometry=glazingcreator.HBObjWGLZ)  # -> Volume, Centroid
rotatehbobj = Honeybee_RotateHoneybee(HBObj=glazingcreator.HBObjWGLZ, angle=number_slider, cenPt=volume.Centroid)  # -> HBObj; plug-in component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
wires = BrepWireframe(Brep=rotatehbobj, Density=-1)

panel = Panel("""MAT-CC05 4 HW CONCRETE
MAT-CC05 8 HW CONCRETE""")
panel_2 = Panel(decomposeepconstruction.materials)
item_4 = ListItem(List=decomposeepconstruction.materials, Index=0, Wrap=True)  # -> Item, Item1
item_5 = ListItem(List=panel, Index=0, Wrap=True)  # -> Item, Item1
panel_3 = Panel(item_2)
epconstruction = Honeybee_EnergyPlusConstruction(name="floor_cnstr_2", layer_1=item_4.Item, layer_2=item_4.Item1, layer_3=item_5.Item1)  # -> EPConstruction; plug-in component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
epconstruction_2 = Honeybee_EnergyPlusConstruction(name="floor_cnstr_1", layer_1=item_4.Item, layer_2=item_4.Item1, layer_3=item_5.Item)  # -> EPConstruction; plug-in component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

setepzonecnstr = Honeybee_SetEPZoneConstruction(HBZone=rotatehbobj, wallEPConstruction=list, windowEPConstruction=list_3, roofEPConstruction=list_2)  # -> simplify(modifiedHBZone); plug-in component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

panel_4 = Panel("""Construction,
    Dbl LoE (e3=.1) Clr 3mm/13mm Arg,  !- Name
    CLEAR 3MM,               !- Outside Layer
    ARGON 13MM,              !- Layer 2
    LoE CLEAR 3MM Rev;       !- Layer 3""")
panel_5 = Panel("""WindowMaterial:Gas,
    ARGON 13MM,               !- Name
    Argon,                   !- Gas Type
    0.0127;                  !- Thickness {m}""")
panel_6 = Panel("""WindowMaterial:Glazing,
    LoE CLEAR 3MM Rev,       !- Name
    SpectralAverage,         !- Optical Data Type
    ,                        !- Window Glass Spectral Data Set Name
    0.003,                   !- Thickness {m}
    0.630,                   !- Solar Transmittance at Normal Incidence
    0.220,                   !- Front Side Solar Reflectance at Normal Incidence
    0.190,                   !- Back Side Solar Reflectance at Normal Incidence
    0.850,                   !- Visible Transmittance at Normal Incidence
    0.079,                   !- Front Side Visible Reflectance at Normal Incidence
    0.056,                   !- Back Side Visible Reflectance at Normal Incidence
    0.0,                     !- Infrared Transmittance at Normal Incidence
    0.10,                    !- Front Side Infrared Hemispherical Emissivity
    0.84,                    !- Back Side Infrared Hemispherical Emissivity
    0.9;                     !- Conductivity {W/m-K}""")
toggle_2 = BooleanToggle(True)
addtoeplibrary = Honeybee_AddToEnergyPlusLibrary(EPObject=[panel_4, panel_5, panel_6], addToProjectLib=toggle_2, overwrite=toggle_2)  # -> readMe; plug-in component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

filter = StreamFilter(Gate=list_4, Stream0=panel_3, Stream1=epconstruction_2, Stream2=epconstruction)
# Construction
setepzoneundergroundcnstr = Honeybee_SetEPZoneUndergroundConstruction(HBZone=flatten(setepzonecnstr), groundFloorEPConstruction=filter)  # -> simplify(modifiedHBZone); plug-in component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
ach2m3_s_m2_calculator = HoneybeeInfORventPerAreaCalculator(HBZones=flatten(setepzoneundergroundcnstr), airChangeHour=number_slider_2)  # -> out, infORventPerArea, allFloors; plug-in component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

decomposebytype = Honeybee_DecomposeBasedOnType(HBZone=setepzoneundergroundcnstr)  # -> walls, interiorWalls, airWalls, windows, interiorWindows, skylights, roofs, ceilings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; plug-in component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
# Blinds
shddesigner = Ladybug_ShadingDesigner(
    glzSrf=flatten(decomposebytype.windows),
    depthOrVector=flatten(shading_depth),
    numOfShds=number_of_blinds,
    runIt=add_blinds,
    port_4=False)  # -> readMe, shadingSrfs; plug-in component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
wires_2 = BrepWireframe(Brep=shddesigner.shadingSrfs, Density=-1)
hb_epcontextsrf = HoneybeeEPContextSurfaces(shdSurfaces=flatten(shddesigner.shadingSrfs))  # -> HBContext; inputs shdSurfaces: list of Brep, justBoundingBox: Boolean
# ---------- hb_epcontextsrf: Python ----------
"""
prepare shading/context geometries

    Args:
        northVectorOrRotation: A vector that shows North or a number that shows
                               the rotation of the North from the Y axis
        bldgMasses: List of closed Breps as thermal zones.
    Returns:
        report: ...
        thermalZones: Thermal zone's geometries for visualiza
"""

ghenv.Component.Name = 'Honeybee EP context Surfaces'
ghenv.Component.NickName = 'HB_EPContextSrf'
ghenv.Component.Message = 'VER 0.0.59\nJAN_26_2016'
ghenv.Component.IconDisplayMode = ghenv.Component.IconDisplayMode.application
ghenv.Component.Category = "Honeybee"
ghenv.Component.SubCategory = "09 | Energy | Energy"
#compatibleHBVersion = VER 0.0.57\nNOV_01_2015
#compatibleLBVersion = VER 0.0.59\nFEB_01_2015
ghenv.Component.AdditionalHelpFromDocStrings = "2"

import rhinoscriptsyntax as rs
import Rhino as rc
import scriptcontext as sc
import os
import System
import Grasshopper.Kernel as gh
import uuid

tolerance = sc.doc.ModelAbsoluteTolerance
import math


def main(shdSurfaces, EPTransSchedule, meshingSettings, justBoundingBox):
    
    # import the classes
    if sc.sticky.has_key('honeybee_release'):

        try:
            if not sc.sticky['honeybee_release'].isCompatible(ghenv.Component): return -1
            if sc.sticky['honeybee_release'].isInputMissing(ghenv.Component): return -1
        except:
            warning = "You need a newer version of Honeybee to use this compoent." + \
            " Use updateHoneybee component to update userObjects.\n" + \
            "If you have already updated userObjects drag Honeybee_Honeybee component " + \
            "into canvas and try again."
            w = gh.GH_RuntimeMessageLevel.Warning
            ghenv.Component.AddRuntimeMessage(w, warning)
            return -1
        
        # don't customize this part
        hb_EPSrf = sc.sticky["honeybee_EPSurface"]
        hb_EPSHDSurface = sc.sticky["honeybee_EPShdSurface"]
        hb_RADMaterialAUX = sc.sticky["honeybee_RADMaterialAUX"]
        hb_EPObjectsAux = sc.sticky["honeybee_EPObjectsAUX"]()
        HBScheduleList = sc.sticky["honeybee_ScheduleLib"].keys()

        ########################################################################
        #----------------------------------------------------------------------#
        shdBreps = []
        # create bounding box of shading geometries
        if justBoundingBox:
            for brep in shdSurfaces:
                if brep.Faces.Count>1 or not brep.Faces[0].IsPlanar(sc.doc.ModelAbsoluteTolerance):
                    shdBreps.append(brep.GetBoundingBox(True).ToBrep())
                else:
                    shdBreps.append(brep)
        else:
            shdBreps = shdSurfaces
        
        shadingClasses = []
        shadingMeshPreview = []
        
        if meshingSettings == None:
            mp = rc.Geometry.MeshingParameters.Minimal
            mp.SimplePlanes = True
        else:
            mp = meshingSettings
        
        def getRadMaterialName(radMaterial):
            nameStr = radMaterial.split(" ")[2]
            name =  nameStr.split("\n")[0]
            return name
        
        for brepCount, brep in enumerate(shdBreps):
            if brep != None:
                isPlanar = True
                # check planarity
                for face in brep.Faces:
                    if not face.IsPlanar(tolerance):
                        isPlanar = False
                        break
                
                shadingBreps = []
                if not isPlanar:
                    meshArray = rc.Geometry.Mesh.CreateFromBrep(brep, mp)
                    for mesh in meshArray:
                        for meshFace in range(mesh.Faces.Count):
                            vertices = list(mesh.Faces.GetFaceVertices(meshFace))[1:]
                            vertices = vertices + [sc.doc.ModelAbsoluteTolerance]
                            # create the brep from mesh
                            shdBrep = rc.Geometry.Brep.CreateFromCornerPoints(*vertices)
                            shadingBreps.append(shdBrep)
                else:
                    for face in brep.Faces:
                        shadingBreps.append(face.DuplicateFace(False))
                
                for faceCount, shdBrep in enumerate(shadingBreps):
                        thisShading = hb_EPSHDSurface(shdBrep, 1000*brepCount + faceCount, 'shdSrf_' + `brepCount` + '_' + `faceCount` + "_" + str(uuid.uuid4()))
                        
                        # add transmittance schedule if any
                        if EPTransSchedule!=None:
                            schedule= EPTransSchedule.upper()
                            if schedule!=None and not schedule.lower().endswith(".csv") and schedule not in HBScheduleList:
                                msg = "Cannot find " + schedule + " in Honeybee schedule library."
                                print msg
                                ghenv.Component.AddRuntimeMessage(gh.GH_RuntimeMessageLevel.Warning, msg)
                                return -1
                            elif schedule!=None and schedule.lower().endswith(".csv"):
                                # check if csv file is existed
                                if not os.path.isfile(schedule):
                                    msg = "Cannot find the shchedule file: " + schedule
                                    print msg
                                    ghenv.Component.AddRuntimeMessage(gh.GH_RuntimeMessageLevel.Warning, msg)
                                    return -1
                            
                            thisShading.TransmittanceSCH = schedule
                        
                        # add the Rad Material if any
                        if RADMaterial!=None:
                            # if it is just the name of the material make sure it is already defined
                            if len(RADMaterial.split(" ")) == 1:
                                # if the material is not in the library add it to the library
                                if not hb_RADMaterialAUX.isMatrialExistInLibrary(RADMaterial):
                                    warningMsg = "Can't find " + RADMaterial + " in RAD Material Library.\n" + \
                                                "Add the material to the library and try again."
                                    ghenv.Component.AddRuntimeMessage(gh.GH_RuntimeMessageLevel.Warning, warningMsg)
                                    return
                                
                                try:
                                    thisShading.setRADMaterial(RADMaterial)
                                except Exception, e:
                                    print e
                                    warningMsg = "You are using an old version of Honeybee_Honeybee! Update your files and try again."
                                    print warningMsg
                                    ghenv.Component.AddRuntimeMessage(gh.GH_RuntimeMessageLevel.Warning, warningMsg)
                                    return
                                
                                addedToLib = True
                            else:
                                
                                # try to add the material to the library
                                addedToLib, thisShading.RadMaterial = hb_RADMaterialAUX.analyseRadMaterials(RADMaterial, True)
                                
                            if addedToLib==False:
                                warningMsg = "Failed to add " + RADMaterial + " to the Library."
                                ghenv.Component.AddRuntimeMessage(gh.GH_RuntimeMessageLevel.Warning, warningMsg)
                                return
                        
                        # add shading to the list
                        shadingClasses.append(thisShading)
                
        # add to the hive
        hb_hive = sc.sticky["honeybee_Hive"]()
        HBContext  = hb_hive.addToHoneybeeHive(shadingClasses, ghenv.Component.InstanceGuid.ToString())
        return HBContext
        ################################################################################################
    else:
        print "You should first let Honeybee to fly..."
        w = gh.GH_RuntimeMessageLevel.Warning
        ghenv.Component.AddRuntimeMessage(w, "You should first let Honeybee to fly...")
        return -1
        

if _shdSurfaces and _shdSurfaces[0]!=None:
    # add cleaning function
    result= main(_shdSurfaces, EPTransSchedule_, meshingSettings_, justBoundingBox_)
    
    if result != -1: HBContext = result
# ---------- end hb_epcontextsrf ----------
preview = CustomPreview(Geometry=wires_2, Shader=ColourSwatch(SwatchColor=RGBA(0, 0, 0, 194)))

# ----
# infiltration rate
ach2m3_s_m2_calculator_2 = HoneybeeInfORventPerAreaCalculator(HBZones=flatten(setepzoneundergroundcnstr), airChangeHour=number_slider_2)  # -> out, infORventPerArea, allFloors; plug-in component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
setepzoneloads = Honeybee_SetEnergyPlusZoneLoads(
    HBZones=flatten(setepzoneundergroundcnstr),
    infiltrationRatePerArea=ach2m3_s_m2_calculator_2.infORventPerArea,
    numOfPeoplePerArea=Slider(0.2, range=0..1),
    ventilationPerArea=ach2m3_s_m2_calculator.infORventPerArea)  # -> loads, HBZones; plug-in component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

toggle_3 = BooleanToggle(True)
panel_7 = Panel("https://www.energyplus.net/weather-download/north_and_central_america_wmo_region_4/USA/PA/USA_PA_Philadelphia.Intl.AP.724080_TMY3/all")
epoutput = Honeybee_GenerateEPOutput(
    zoneEnergyUse=toggle_3,
    zoneGainsAndLosses=toggle_3,
    zoneComfortMetrics=toggle_3,
    zoneHVACParams=toggle_3,
    surfaceTempAnalysis=toggle_3,
    surfaceEnergyAnalysis=toggle_3)  # -> report, flatten(simulationOutputs); plug-in component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
epw_stat = Ladybug_OpenEPWAndSTATWeatherFiles(weatherFileURL=panel_7)  # -> epwFile, statFile; plug-in component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
rep = ReplaceText(Text="base_case", Find=" ", Replace="_", RecursiveReplace=False)
path = FilePath(epw_stat.epwFile)
runenergysimulation = Honeybee_RunEnergySimulation(
    epwFile=path,
    HBZones=flatten(setepzoneloads.HBZones),
    HBContext=flatten(hb_epcontextsrf),
    simulationOutputs=flatten(epoutput.simulationOutputs),
    writeIdf=run_energyplus,
    runEnergyPlus=run_energyplus,
    idfFileName=rep)  # -> report, idfFileAddress, resultFileAddress; plug-in component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
readepresult = Honeybee_ReadEPResult(resultFileAddress=runenergysimulation.resultFileAddress)  # -> totalThermalEnergy, thermalEnergyBalance, cooling, heating, electricLight, electricEquip, port, port_2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; plug-in component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
readepsrfresult = Honeybee_ReadEPSurfaceResult(resultFileAddress=runenergysimulation.resultFileAddress)  # -> surfaceIndoorTemp, surfaceOutdoorTemp, surfaceEnergyFlow, opaqueEnergyFlow, glazEnergyFlow, port, port_2, port_3, port_4, port_5; plug-in component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
readepresult_2 = Honeybee_ReadEPResult(resultFileAddress=runenergysimulation.resultFileAddress)  # -> totalThermalLoad, thermalLoadBalance, cooling, heating, electricLight, electricEquip, port, port_2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; plug-in component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
panel_8 = Panel(runenergysimulation.resultFileAddress)
importepw = Ladybug_ImportEpw(epwFile=path)  # -> readMe, latitude, location, dryBulbTemperature, dewPointTemperature, relativeHumidity, windSpeed, windDirection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; plug-in component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

# ----
# MAKE AN ENERGY BALANCE AND PLOT IT ON A CHART
energybalance = Honeybee_ConstructEnergyBalance(
    HBZones=flatten(setepzoneloads.HBZones),
    cooling=readepresult.cooling,
    heating=readepresult.heating,
    electricLight=readepresult.electricLight,
    electricEquip=readepresult.electricEquip,
    peopleGains=readepresult.peopleGains,
    totalSolarGain=readepresult.totalSolarGain,
    infiltrationEnergy=readepresult.infiltrationEnergy,
    outdoorAirEnergy=readepresult.outdoorAirEnergy,
    natVentEnergy=readepresult.port_3,
    surfaceEnergyFlow=readepsrfresult.surfaceEnergyFlow)  # -> readMe, modelEnergyBalance, energyBalWithStorage; plug-in component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
gradientlibrary = Ladybug_GradientLibrary(gradIndex="19")  # -> customColors; plug-in component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
selectandaveragedata = Ladybug_AverageData(annualHourlyData=energybalance.energyBalWithStorage, totalOrAverage=Toggle(True))  # -> readMe, selHourlyData, totaledDaily, totaledMonthly, totMonthlyPerHour, totAnalysisPeriod; plug-in component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
legendpar = Ladybug_LegendParameters(lowBound="-7000", highBound="7000")  # -> legendPar; plug-in component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

adaptivecomfortcalculator = Ladybug_AdaptiveComfortCalculator(
    dryBulbTemperature=readepresult_2.airTemperature,
    meanRadiantTemperature=readepresult_2.meanRadTemperature,
    prevailingOutdoorTemp=importepw.dryBulbTemperature,
    runIt=Toggle(True))  # -> readMe, port, comfortableOrNot, conditionOfPerson, degreesFromTarget, port_2, targetTemperature, upperTemperatureBound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; plug-in component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
legendpar_2 = Ladybug_LegendParameters(lowBound="-1", highBound="1", numSegments="3")  # -> legendPar; plug-in component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
gradientlibrary_2 = Ladybug_GradientLibrary(gradIndex=Slider(19, range=1..20))  # -> customColors; plug-in component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
vec = VectorXYZ(XComponent="20", YComponent="35", ZComponent=0)  # -> Vector, Length
pt = Point(Point(23.10617158, 0, 0))
move = Move(Geometry=pt, Motion=vec.Vector)  # -> Geometry, Transform
legendpar_3 = Ladybug_LegendParameters(customColors=flatten(gradientlibrary_2))  # -> legendPar; plug-in component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
panel_9 = Panel("""Comfortable (%): 
hot (%):         
cold (%):        """)
comfortable_hot_cold = Panel([adaptivecomfortcalculator.percentOfTimeComfortable, adaptivecomfortcalculator.percentHotCold])
psychchart = Ladybug_PsychrometricChart(
    dryBulbTemperature=readepresult_2.airTemperature,
    relativeHumidity=readepresult_2.relativeHumidity,
    basePoint=move.Geometry,
    runIt=Toggle(True))  # -> readMe, port, totalComfortPercent, totalComfortOrNot, strategyNames, strategyPercentOfTime, strategyOrNot, port_2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; plug-in component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
_3dchart = Ladybug_3DChart(
    inputData=flatten(adaptivecomfortcalculator.conditionOfPerson),
    basePoint=pt,
    xScale=".025",
    yScale="0.125",
    zScale=Slider(0, range=0..100),
    legendPar=legendpar_2)  # -> readMe, graphMesh, graphCurves, legend, legendBasePts, title, titleBasePts, dataPts, conditionalHOY; plug-in component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
barchart = Ladybug_MonthlyBarChart(
    inputData=flatten(selectandaveragedata.totaledMonthly),
    stackValues=Toggle(True),
    plotFromZero=Toggle(True),
    altTitle="Office Energy Balance",
    altYAxisTitle="Energy (kWh)",
    legendPar=legendpar_3)  # -> readMe, dataMesh, dataCurves, dataCrvColors, graphAxes, graphLabels, title, titleBasePt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; plug-in component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
num = Number(comfortable_hot_cold)
expression = Expression(x=num, Expression="Round(x, 2)")
flip = FlipMatrix(Data=panel_9)  # -> simplify(Data)
flip_2 = FlipMatrix(Data=expression)  # -> simplify(Data)
panel_10 = Panel([flip, flip_2])
preview_2 = CustomPreview(Geometry=barchart.graphAxes, Shader=ColourSwatch(SwatchColor=RGB(0, 0, 0)))
panel_11 = Panel(barchart.readMe)
join = TextJoin(Text=panel_10)
join_2 = TextJoin(Text=flatten(join))
pt_2 = Point(Point(-17, 4, 0))
tag = TextTag3D(Location=pt_2, Text=join_2, Size=1, Colour=ColourSwatch(SwatchColor=RGB(0, 0, 0)), Justification=5)
