# Grasshopper definition Fan_Cao_Fianl.gh (Grasshopper 0.9.76)
# plug-ins: Python Interpreter, Bifocals, embryoA

ladybug = Ladybug_Ladybug()  # -> Vviiiiiiiiiizzz; plug-in component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
honeybee = Honeybee_Honeybee()  # -> Vviiiiiiiiiizzz; plug-in component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

panel = Panel("https://www.energyplus.net/weather-download/north_and_central_america_wmo_region_4/USA/WA/USA_WA_Seattle-Boeing.Field.727935_TMY3/all")  # disabled
epw_stat = Ladybug_OpenEPWAndSTATWeatherFiles(weatherFileURL=panel)  # -> epwFile, statFile; disabled; plug-in component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
importepw = Ladybug_ImportEpw(epwFile=epw_stat.epwFile)  # -> readMe, latitude, location, dryBulbTemperature, dewPointTemperature, relativeHumidity, windSpeed, windDirection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; disabled; plug-in component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
# sun path envionment ----humidity
importlocation = Ladybug_ImportLocation(epwFile=epw_stat.epwFile)  # -> location; disabled; plug-in component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
lng = ListLength(List=importepw.relativeHumidity)  # disabled
number_slider = Slider(8, range=8..17)  # disabled
panel_2 = Panel("7")  # disabled
subtraction = Subtraction(A=lng, B=1)  # disabled
dom = ConstructDomain(DomainStart=panel_2, DomainEnd=subtraction)  # disabled
subset = SubList(List=importepw.relativeHumidity, Domain=dom, Wrap=True)  # -> List, Index; disabled
panel_3 = Panel("0")  # disabled
panel_4 = Panel("12")  # disabled
number_slider_2 = Slider(60, range=0..100)  # disabled
panel_5 = Panel("1")  # disabled
panel_6 = Panel("31")  # disabled
panel_7 = Panel("24")  # disabled
bnd = Bounds(Numbers=subset.List)  # disabled
analysisperiod = Ladybug_AnalysisPeriod(fromMonth=panel_5, fromDay=panel_5, fromHour=panel_3, toMonth=panel_4, toDay=panel_6, toHour=panel_7)  # -> readMe, analysisPeriod; disabled; plug-in component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
swatch = ColourSwatch(SwatchColor=RGB(8, 175, 255))  # disabled
swatch_2 = ColourSwatch(SwatchColor=RGB(255, 252, 0))  # disabled
dedomain = DeconstructDomain(Domain=bnd)  # -> Start, End; disabled
toggle = BooleanToggle(True)  # disabled
panel_8 = Panel("a > 60")  # disabled
number_slider_3 = Slider(0.06, range=0..0.1)  # disabled
legendpar = Ladybug_LegendParameters(lowBound=number_slider_2, highBound=dedomain.End, customColors=flatten([swatch_2, swatch]))  # -> legendPar; disabled; plug-in component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
sunpath = Ladybug_SunPath(
    location=importlocation,
    hour=12,
    month=12,
    timeStep=1,
    analysisPeriod=analysisperiod.analysisPeriod,
    sunPathScale=number_slider_3,
    annualHourlyData=flatten(importepw.relativeHumidity),
    conditionalStatement=panel_8,
    legendPar=legendpar,
    dailyOrAnnualSunPath=toggle)  # -> readMe, sunVectors, sunAltitudes, sunAzimuths, port, sunSpheresMesh, sunPathCrvs, legend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; disabled; plug-in component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
swatch_3 = ColourSwatch(SwatchColor=RGB(0, 0, 0))  # disabled
preview = CustomPreview(Geometry=sunpath.sunPathCrvs, Shader=swatch_3)  # disabled

panel_9 = Panel("https://www.energyplus.net/weather-download/north_and_central_america_wmo_region_4/USA/WA/USA_WA_Seattle-Boeing.Field.727935_TMY3/all")  # disabled
epw_stat_2 = Ladybug_OpenEPWAndSTATWeatherFiles(weatherFileURL=panel_9)  # -> epwFile, statFile; disabled; plug-in component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
importepw_2 = Ladybug_ImportEpw(epwFile=epw_stat_2.epwFile)  # -> readMe, latitude, location, dryBulbTemperature, dewPointTemperature, relativeHumidity, windSpeed, windDirection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; disabled; plug-in component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
# sun path envionment ----wind speed
importlocation_2 = Ladybug_ImportLocation(epwFile=epw_stat_2.epwFile)  # -> location; disabled; plug-in component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
lng_2 = ListLength(List=importepw_2.windSpeed)  # disabled
number_slider_4 = Slider(8, range=8..17)  # disabled
panel_10 = Panel("7")  # disabled
subtraction_2 = Subtraction(A=lng_2, B=1)  # disabled
dom_2 = ConstructDomain(DomainStart=panel_10, DomainEnd=subtraction_2)  # disabled
subset_2 = SubList(List=importepw_2.windSpeed, Domain=dom_2, Wrap=True)  # -> List, Index; disabled
panel_11 = Panel("0")  # disabled
panel_12 = Panel("12")  # disabled
number_slider_5 = Slider(5, range=0..100)  # disabled
panel_13 = Panel("1")  # disabled
panel_14 = Panel("31")  # disabled
panel_15 = Panel("24")  # disabled
bnd_2 = Bounds(Numbers=subset_2.List)  # disabled
analysisperiod_2 = Ladybug_AnalysisPeriod(fromMonth=panel_13, fromDay=panel_13, fromHour=panel_11, toMonth=panel_12, toDay=panel_14, toHour=panel_15)  # -> readMe, analysisPeriod; disabled; plug-in component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
swatch_4 = ColourSwatch(SwatchColor=RGB(8, 175, 255))  # disabled
swatch_5 = ColourSwatch(SwatchColor=RGB(255, 252, 0))  # disabled
dedomain_2 = DeconstructDomain(Domain=bnd_2)  # -> Start, End; disabled
toggle_2 = BooleanToggle(True)  # disabled
number_slider_6 = Slider(0.06, range=0..0.1)  # disabled
panel_16 = Panel("a > 5")  # disabled
legendpar_2 = Ladybug_LegendParameters(lowBound=number_slider_5, highBound=dedomain_2.End, customColors=flatten([swatch_5, swatch_4]))  # -> legendPar; disabled; plug-in component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
sunpath_2 = Ladybug_SunPath(
    location=importlocation_2,
    hour=12,
    month=12,
    timeStep=1,
    analysisPeriod=analysisperiod_2.analysisPeriod,
    sunPathScale=number_slider_6,
    annualHourlyData=flatten(importepw_2.windSpeed),
    conditionalStatement=panel_16,
    legendPar=legendpar_2,
    dailyOrAnnualSunPath=toggle_2)  # -> readMe, sunVectors, sunAltitudes, sunAzimuths, port, sunSpheresMesh, sunPathCrvs, legend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; disabled; plug-in component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
swatch_6 = ColourSwatch(SwatchColor=RGB(0, 0, 0))  # disabled
preview_2 = CustomPreview(Geometry=sunpath_2.sunPathCrvs, Shader=swatch_6)  # disabled

panel_17 = Panel("https://www.energyplus.net/weather-download/north_and_central_america_wmo_region_4/USA/WA/USA_WA_Seattle-Boeing.Field.727935_TMY3/all")  # disabled
# Environment
epw_stat_3 = Ladybug_OpenEPWAndSTATWeatherFiles(weatherFileURL=panel_17)  # -> epwFile, statFile; disabled; plug-in component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
importepw_3 = Ladybug_ImportEpw(epwFile=epw_stat_3.epwFile)  # -> readMe, latitude, location, dryBulbTemperature, dewPointTemperature, relativeHumidity, windSpeed, windDirection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; disabled; plug-in component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
toggle_3 = BooleanToggle(True)  # disabled
outdoorcomfortcalculator = Ladybug_OutdoorComfortCalculator(
    dryBulbTemperature=importepw_3.dryBulbTemperature,
    windSpeed_tenMeters=importepw_3.windSpeed,
    relativeHumidity=importepw_3.relativeHumidity,
    runIt=toggle_3)  # -> readMe, port, universalThermalClimateIndex, comfortableOrNot, thermalStress, conditionOfPerson, port_2, percentOfTimeComfortable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; disabled; plug-in component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
number_slider_7 = Slider(0.3, range=0..1)  # disabled
_3dchart = Ladybug_3DChart(inputData=flatten(importepw_3.windSpeed), xScale=number_slider_7)  # -> readMe, graphMesh, graphCurves, legend, legendBasePts, title, titleBasePts, dataPts, conditionalHOY; disabled; plug-in component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
panel_18 = Panel([outdoorcomfortcalculator.percentOfTimeComfortable, outdoorcomfortcalculator.percentHeatStress, outdoorcomfortcalculator.percentColdStress])  # disabled

east_side_ratio = Slider(0.3, range=0..1)  # disabled
north_side_ratio = Slider(0.2, range=0..1)  # disabled

panel_19 = Panel("https://www.energyplus.net/weather-download/north_and_central_america_wmo_region_4/USA/WA/USA_WA_Seattle-Boeing.Field.727935_TMY3/all")  # disabled
# psychromatic
epw_stat_4 = Ladybug_OpenEPWAndSTATWeatherFiles(weatherFileURL=panel_19)  # -> epwFile, statFile; disabled; plug-in component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
# wind rose
importepw_4 = Ladybug_ImportEpw(epwFile=epw_stat_4.epwFile)  # -> readMe, latitude, location, dryBulbTemperature, dewPointTemperature, relativeHumidity, windSpeed, windDirection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; disabled; plug-in component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
panel_20 = Panel("0")  # disabled
panel_21 = Panel("12")  # disabled
panel_22 = Panel("1")  # disabled
panel_23 = Panel("31")  # disabled
panel_24 = Panel("24")  # disabled
analysisperiod_3 = Ladybug_AnalysisPeriod(fromMonth=panel_22, fromDay=panel_22, fromHour=panel_20, toMonth=panel_21, toDay=panel_23, toHour=panel_24)  # -> readMe, analysisPeriod; disabled; plug-in component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
toggle_4 = BooleanToggle(True)  # disabled
panel_25 = Panel("a < 2")  # disabled
windrose = Ladybug_WindRose(
    north=0,
    hourlyWindDirection=importepw_4.windDirection,
    hourlyWindSpeed=importepw_4.windSpeed,
    annualHourlyData=flatten([importepw_4.dryBulbTemperature, importepw_4.relativeHumidity]),
    analysisPeriod=analysisperiod_3.analysisPeriod,
    conditionalStatement=panel_25,
    runIt=toggle_4)  # -> readMe, calmRoseMesh, windRoseMesh, windRoseCrvs, windRoseCenPts, legend, legendBasePts, title; disabled; plug-in component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
swatch_7 = ColourSwatch(SwatchColor=RGB(71, 71, 71))  # disabled
# Run Annual Daylight
preview_3 = CustomPreview(Geometry=windrose.windRoseCrvs, Shader=swatch_7)  # disabled

panel_26 = Panel("https://www.energyplus.net/weather-download/north_and_central_america_wmo_region_4/USA/WA/USA_WA_Seattle-Boeing.Field.727935_TMY3/all")  # disabled
epw_stat_5 = Ladybug_OpenEPWAndSTATWeatherFiles(weatherFileURL=panel_26)  # -> epwFile, statFile; disabled; plug-in component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
importepw_5 = Ladybug_ImportEpw(epwFile=epw_stat_5.epwFile)  # -> readMe, latitude, location, dryBulbTemperature, dewPointTemperature, relativeHumidity, windSpeed, windDirection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; disabled; plug-in component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
# Daylight Annual
toggle_5 = BooleanToggle(True)  # disabled
psychchart = Ladybug_PsychrometricChart(
    dryBulbTemperature=importepw_5.dryBulbTemperature,
    relativeHumidity=importepw_5.relativeHumidity,
    barometricPressure=importepw_5.barometricPressure,
    runIt=toggle_5)  # -> readMe, port, totalComfortPercent, totalComfortOrNot, strategyNames, strategyPercentOfTime, strategyOrNot, port_2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; disabled; plug-in component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
swatch_8 = ColourSwatch(SwatchColor=RGB(71, 71, 71))  # disabled
preview_4 = CustomPreview(Geometry=[psychchart.chartCurvesAndTxt, psychchart.comfortPolygons], Shader=swatch_8)  # disabled

east_side_ratio_2 = Slider(0.2, range=0..1)  # disabled
north_side_ratio_2 = Slider(0.2, range=0..1)  # disabled

# ----
# Step 1
# Change the angle
# Step 2
# Change the windows size
# Step 3
# Compare two methods
number_slider_8 = Slider(270, range=0..360)  # disabled
geo = Geometry(<brep referenced from the Rhino model>)  # disabled
volume = Volume(Geometry=geo)  # -> Volume, Centroid; disabled
rad = Radians(Degrees=number_slider_8)  # disabled
rotate = Rotate(Geometry=geo, Angle=rad, Plane=volume.Centroid)  # -> Geometry, Transform; disabled
toggle_6 = BooleanToggle(True)  # disabled
wires = BrepWireframe(Brep=rotate.Geometry, Density=-1)  # disabled
swatch_9 = ColourSwatch(SwatchColor=RGB(0, 0, 0))  # disabled
mass2zone = Honeybee_Masses2Zones(zoneMasses=flatten(rotate.Geometry), isConditioned=True, maxRoofAngle=30, createHBZones=toggle_6)  # -> readMe, HBZones; disabled; plug-in component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
preview_5 = CustomPreview(Geometry=wires, Shader=swatch_9)  # disabled
number_slider_9 = Slider(0.03, range=0..0.1)  # disabled
decompose_honeybee_zone = Honeybee_DecomposeHBZone(HBZone=mass2zone.HBZones)  # -> HBSurfaces; disabled; plug-in component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
number_slider_10 = Slider(4, range=0..10)  # disabled
number_slider_11 = Slider(3, range=0..10)  # disabled
pt = Point(<point referenced from the Rhino model>)  # disabled
lng_3 = ListLength(List=decompose_honeybee_zone)  # disabled
northarrow = Ladybug_North(centerPt=pt, scale=number_slider_9)  # -> northSign; disabled; plug-in component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
item = ListItem(List=decompose_honeybee_zone, Index=number_slider_10, Wrap=True)  # disabled
item_2 = ListItem(List=decompose_honeybee_zone, Index=number_slider_11, Wrap=True)  # disabled
panel_27 = Panel(lng_3)  # disabled
swatch_10 = ColourSwatch(SwatchColor=RGB(0, 0, 0))  # disabled
toggle_7 = BooleanToggle(True)  # disabled
toggle_8 = BooleanToggle(True)  # disabled
preview_6 = CustomPreview(Geometry=northarrow, Shader=swatch_10)  # disabled
glazingcreator = Honeybee_GlazingBasedOnRatio(HBObjects=item_2, glzRatio=east_side_ratio_2, runIt=toggle_7)  # -> readMe, HBObjWGLZ; disabled; plug-in component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
glazingcreator_2 = Honeybee_GlazingBasedOnRatio(HBObjects=item, glzRatio=north_side_ratio_2, runIt=toggle_8)  # -> readMe, HBObjWGLZ; disabled; plug-in component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
panel_28 = Panel("https://www.energyplus.net/weather-download/north_and_central_america_wmo_region_4/USA/WA/USA_WA_Seattle-Boeing.Field.727935_TMY3/all")  # disabled
replace = ReplaceItems(
    List=decompose_honeybee_zone,
    Item=[glazingcreator.HBObjWGLZ, glazingcreator_2.HBObjWGLZ],
    Indices=[number_slider_11, number_slider_10],
    Wrap=False)  # disabled
toggle_9 = BooleanToggle(True)  # disabled
panel_29 = Panel("Myroom")  # disabled
toggle_10 = BooleanToggle(False)  # disabled
geo_2 = Geometry(replace)  # disabled
epw_stat_6 = Ladybug_OpenEPWAndSTATWeatherFiles(weatherFileURL=panel_28)  # -> epwFile, statFile; disabled; plug-in component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
epoutput = Honeybee_GenerateEPOutput(zoneGainsAndLosses="False", zoneComfortMetrics=toggle_9, surfaceTempAnalysis="False")  # -> report, flatten(simulationOutputs); disabled; plug-in component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
createhbzones = Honeybee_createHBZones(name=panel_29, HBSurfaces=flatten(geo_2), isConditioned=toggle_10)  # -> readMe, HBZone; disabled; plug-in component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
toggle_11 = BooleanToggle(True)  # disabled
runenergysimulation = Honeybee_RunEnergySimulation(
    epwFile=epw_stat_6.epwFile,
    HBZones=flatten(createhbzones.HBZone),
    simulationOutputs=flatten(epoutput.simulationOutputs),
    writeIdf=toggle_11,
    runEnergyPlus=toggle_11)  # -> report, idfFileAddress, resultFileAddress; disabled; plug-in component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
readepresult = Honeybee_ReadEPResult(resultFileAddress=runenergysimulation.resultFileAddress)  # -> port, port_2, port_3, port_4, port_5, port_6, port_7, port_8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; disabled; plug-in component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
selectandaveragedata = Ladybug_AverageData(annualHourlyData=readepresult.relativeHumidity)  # -> readMe, selHourlyData, averagedDaily, averagedMonthly, avrMonthlyPerHour, avrAnalysisPeriod; disabled; plug-in component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
toggle_12 = BooleanToggle(True)  # disabled
toggle_13 = BooleanToggle(False)  # disabled
barchart = Ladybug_MonthlyBarChart(inputData=flatten(selectandaveragedata.averagedMonthly), plotFromZero=toggle_12)  # -> readMe, dataMesh, dataCurves, dataCrvColors, graphAxes, graphLabels, title, titleBasePt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; disabled; plug-in component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
psychchart_2 = Ladybug_PsychrometricChart(dryBulbTemperature=readepresult.airTemperature, relativeHumidity=readepresult.relativeHumidity, runIt=toggle_13)  # -> readMe, port, totalComfortPercent, totalComfortOrNot, strategyNames, strategyPercentOfTime, strategyOrNot, port_2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; disabled; plug-in component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
toggle_14 = BooleanToggle(True)  # disabled
_3dchart_2 = Ladybug_3DChart(inputData=flatten(readepresult.relativeHumidity))  # -> readMe, graphMesh, graphCurves, legend, legendBasePts, title, titleBasePts, dataPts, conditionalHOY; disabled; plug-in component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
importepw_6 = Ladybug_ImportEpw(epwFile=epw_stat_6.epwFile)  # -> readMe, latitude, location, dryBulbTemperature, dewPointTemperature, relativeHumidity, windSpeed, windDirection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; disabled; plug-in component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
pmvcomfortcalculator = Ladybug_PMVComfortCalculator(
    dryBulbTemperature=readepresult.airTemperature,
    meanRadiantTemperature=readepresult.meanRadTemperature,
    relativeHumidity=readepresult.relativeHumidity,
    calcBalanceTemperature=False,
    runIt=toggle_14)  # -> readMe, port, predictedMeanVote, percentPeopleDissatisfied, standardEffectiveTemperature, port_2, comfortableOrNot, percentOfTimeComfortable, port_3, balanceTemperature; disabled; plug-in component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
panel_30 = Panel(pmvcomfortcalculator.percentOfTimeComfortable)  # disabled
toggle_15 = BooleanToggle(True)  # disabled
panel_31 = Panel(selectandaveragedata.averagedMonthly)  # disabled
panel_32 = Panel("-3")  # disabled
panel_33 = Panel("3")  # disabled
adaptivecomfortcalculator = Ladybug_AdaptiveComfortCalculator(
    dryBulbTemperature=readepresult.airTemperature,
    meanRadiantTemperature=readepresult.meanRadTemperature,
    prevailingOutdoorTemp=importepw_6.dryBulbTemperature,
    runIt=toggle_15)  # -> readMe, port, comfortableOrNot, conditionOfPerson, degreesFromTarget, port_2, targetTemperature, upperTemperatureBound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; disabled; plug-in component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
legendpar_3 = Ladybug_LegendParameters(lowBound=panel_32, highBound=panel_33, numSegments=7)  # -> legendPar; disabled; plug-in component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
number_slider_12 = Slider(0.2, range=0..1)  # disabled
number_slider_13 = Slider(0.06, range=0..0.1)  # disabled
number_slider_14 = Slider(0.2, range=0..1)  # disabled
lng_4 = ListLength(List=panel_31)  # disabled
panel_34 = Panel("7")  # disabled
swatch_11 = ColourSwatch(SwatchColor=RGB(0, 0, 0))  # disabled
subtraction_3 = Subtraction(A=lng_4, B=1)  # disabled
_3dchart_3 = Ladybug_3DChart(
    inputData=flatten(pmvcomfortcalculator.predictedMeanVote),
    xScale=number_slider_13,
    yScale=number_slider_12,
    zScale=number_slider_14,
    legendPar=legendpar_3)  # -> readMe, graphMesh, graphCurves, legend, legendBasePts, title, titleBasePts, dataPts, conditionalHOY; disabled; plug-in component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
panel_35 = Panel(adaptivecomfortcalculator.percentOfTimeComfortable)  # disabled
number_slider_15 = Slider(2, range=0..10)  # disabled
dom_3 = ConstructDomain(DomainStart=panel_34, DomainEnd=subtraction_3)  # disabled
panel_36 = Panel("1")  # disabled
panel_37 = Panel("-1")  # disabled
pt_2 = Point(<point referenced from the Rhino model>)  # disabled
subset_3 = SubList(List=panel_31, Domain=dom_3, Wrap=True)  # -> List, Index; disabled
tag = TextTag3D(
    Location=pt_2,
    Text=pmvcomfortcalculator.percentOfTimeComfortable,
    Size=number_slider_15,
    Colour=swatch_11,
    Justification=7)  # disabled
swatch_12 = ColourSwatch(SwatchColor=RGB(0, 0, 0))  # disabled
legendpar_4 = Ladybug_LegendParameters(lowBound=panel_37, highBound=panel_36, numSegments=3)  # -> legendPar; disabled; plug-in component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
number_slider_16 = Slider(0.3, range=0..1)  # disabled
ma = MassAddition(Input=subset_3.List)  # -> Result, PartialResults; disabled
preview_7 = CustomPreview(Geometry=[_3dchart_3.graphCurves, _3dchart_3.legend], Shader=swatch_12)  # disabled
division = Division(A=ma.Result, B=12)  # disabled
panel_38 = Panel(division)  # disabled
_3dchart_4 = Ladybug_3DChart(inputData=flatten(adaptivecomfortcalculator.conditionOfPerson), xScale=number_slider_16, legendPar=legendpar_4)  # -> readMe, graphMesh, graphCurves, legend, legendBasePts, title, titleBasePts, dataPts, conditionalHOY; disabled; plug-in component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
swatch_13 = ColourSwatch(SwatchColor=RGB(0, 0, 0))  # disabled
preview_8 = CustomPreview(Geometry=[_3dchart_4.graphCurves, _3dchart_4.legend], Shader=swatch_13)  # disabled

geo_3 = Geometry(<brep referenced from the Rhino model>)  # disabled
geo_4 = Geometry(<brep referenced from the Rhino model>)  # disabled
volume_2 = Volume(Geometry=geo_3)  # -> Volume, Centroid; disabled
rad_2 = Radians(Degrees=number_slider_8)  # disabled
rotate_2 = Rotate(Geometry=geo_4, Angle=rad_2, Plane=volume_2.Centroid)  # -> Geometry, Transform; disabled
# Show the different angle
wires_2 = BrepWireframe(Brep=rotate_2.Geometry, Density=-1)  # disabled
swatch_14 = ColourSwatch(SwatchColor=RGB(0, 0, 0))  # disabled
preview_9 = CustomPreview(Geometry=wires_2, Shader=swatch_14)  # disabled
number_slider_17 = Slider(0.03, range=0..0.1)  # disabled
pt_3 = Point(<point referenced from the Rhino model>)  # disabled
northarrow_2 = Ladybug_North(centerPt=pt_3, scale=number_slider_17)  # -> northSign; disabled; plug-in component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
swatch_15 = ColourSwatch(SwatchColor=RGB(0, 0, 0))  # disabled
preview_10 = CustomPreview(Geometry=northarrow_2, Shader=swatch_15)  # disabled

toggle_16 = BooleanToggle(True)  # disabled
geo_5 = Geometry(<brep referenced from the Rhino model>)  # disabled
mass2zone_2 = Honeybee_Masses2Zones(zoneMasses=flatten(geo_5), isConditioned=True, maxRoofAngle=30, createHBZones=toggle_16)  # -> readMe, HBZones; disabled; plug-in component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
decompose_honeybee_zone_2 = Honeybee_DecomposeHBZone(HBZone=mass2zone_2.HBZones)  # -> HBSurfaces; disabled; plug-in component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
lng_5 = ListLength(List=decompose_honeybee_zone_2)  # disabled
number_slider_18 = Slider(4, range=0..10)  # disabled
number_slider_19 = Slider(3, range=0..10)  # disabled
# PMV & Adaptive Comfort
panel_39 = Panel(lng_5)  # disabled
item_3 = ListItem(List=decompose_honeybee_zone_2, Index=number_slider_18, Wrap=True)  # disabled
item_4 = ListItem(List=decompose_honeybee_zone_2, Index=number_slider_19, Wrap=True)  # disabled
toggle_17 = BooleanToggle(True)  # disabled
toggle_18 = BooleanToggle(True)  # disabled
glazingcreator_3 = Honeybee_GlazingBasedOnRatio(HBObjects=item_4, glzRatio=east_side_ratio, runIt=toggle_17)  # -> readMe, HBObjWGLZ; disabled; plug-in component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
glazingcreator_4 = Honeybee_GlazingBasedOnRatio(HBObjects=item_3, glzRatio=north_side_ratio, runIt=toggle_18)  # -> readMe, HBObjWGLZ; disabled; plug-in component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
panel_40 = Panel("https://www.energyplus.net/weather-download/north_and_central_america_wmo_region_4/USA/WA/USA_WA_Seattle-Boeing.Field.727935_TMY3/all")  # disabled
replace_2 = ReplaceItems(
    List=decompose_honeybee_zone_2,
    Item=[glazingcreator_3.HBObjWGLZ, glazingcreator_4.HBObjWGLZ],
    Indices=[number_slider_19, number_slider_18],
    Wrap=False)  # disabled
toggle_19 = BooleanToggle(True)  # disabled
panel_41 = Panel("Myroom")  # disabled
toggle_20 = BooleanToggle(False)  # disabled
geo_6 = Geometry(replace_2)  # disabled
epoutput_2 = Honeybee_GenerateEPOutput(zoneGainsAndLosses="False", zoneComfortMetrics=toggle_19, surfaceTempAnalysis="False")  # -> report, flatten(simulationOutputs); disabled; plug-in component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
epw_stat_7 = Ladybug_OpenEPWAndSTATWeatherFiles(weatherFileURL=panel_40)  # -> epwFile, statFile; disabled; plug-in component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
createhbzones_2 = Honeybee_createHBZones(name=panel_41, HBSurfaces=flatten(geo_6), isConditioned=toggle_20)  # -> readMe, HBZone; disabled; plug-in component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
toggle_21 = BooleanToggle(True)  # disabled
runenergysimulation_2 = Honeybee_RunEnergySimulation(
    epwFile=epw_stat_7.epwFile,
    HBZones=flatten(createhbzones_2.HBZone),
    simulationOutputs=flatten(epoutput_2.simulationOutputs),
    writeIdf=toggle_21,
    runEnergyPlus=toggle_21)  # -> report, idfFileAddress, resultFileAddress; disabled; plug-in component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
readepresult_2 = Honeybee_ReadEPResult(resultFileAddress=runenergysimulation_2.resultFileAddress)  # -> port, port_2, port_3, port_4, port_5, port_6, port_7, port_8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; disabled; plug-in component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
toggle_22 = BooleanToggle(True)  # disabled
importepw_7 = Ladybug_ImportEpw(epwFile=epw_stat_7.epwFile)  # -> readMe, latitude, location, dryBulbTemperature, dewPointTemperature, relativeHumidity, windSpeed, windDirection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; disabled; plug-in component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
pmvcomfortcalculator_2 = Ladybug_PMVComfortCalculator(
    dryBulbTemperature=readepresult_2.airTemperature,
    meanRadiantTemperature=readepresult_2.meanRadTemperature,
    relativeHumidity=readepresult_2.relativeHumidity,
    calcBalanceTemperature=False,
    runIt=toggle_22)  # -> readMe, port, predictedMeanVote, percentPeopleDissatisfied, standardEffectiveTemperature, port_2, comfortableOrNot, percentOfTimeComfortable, port_3, balanceTemperature; disabled; plug-in component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
panel_42 = Panel(pmvcomfortcalculator_2.percentOfTimeComfortable)  # disabled
toggle_23 = BooleanToggle(True)  # disabled
panel_43 = Panel("-3")  # disabled
panel_44 = Panel("3")  # disabled
adaptivecomfortcalculator_2 = Ladybug_AdaptiveComfortCalculator(
    dryBulbTemperature=readepresult_2.airTemperature,
    meanRadiantTemperature=readepresult_2.meanRadTemperature,
    prevailingOutdoorTemp=importepw_7.dryBulbTemperature,
    runIt=toggle_23)  # -> readMe, port, comfortableOrNot, conditionOfPerson, degreesFromTarget, port_2, targetTemperature, upperTemperatureBound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; disabled; plug-in component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
legendpar_5 = Ladybug_LegendParameters(lowBound=panel_43, highBound=panel_44, numSegments=7)  # -> legendPar; disabled; plug-in component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
number_slider_20 = Slider(0.3, range=0..1)  # disabled
_3dchart_5 = Ladybug_3DChart(inputData=flatten(pmvcomfortcalculator_2.predictedMeanVote), xScale=number_slider_20, legendPar=legendpar_5)  # -> readMe, graphMesh, graphCurves, legend, legendBasePts, title, titleBasePts, dataPts, conditionalHOY; disabled; plug-in component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
panel_45 = Panel(adaptivecomfortcalculator_2.percentOfTimeComfortable)  # disabled
panel_46 = Panel("1")  # disabled
panel_47 = Panel("-1")  # disabled
swatch_16 = ColourSwatch(SwatchColor=RGB(0, 0, 0))  # disabled
legendpar_6 = Ladybug_LegendParameters(lowBound=panel_47, highBound=panel_46, numSegments=3)  # -> legendPar; disabled; plug-in component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
number_slider_21 = Slider(0.3, range=0..1)  # disabled
preview_11 = CustomPreview(Geometry=[_3dchart_5.graphCurves, _3dchart_5.legend], Shader=swatch_16)  # disabled
_3dchart_6 = Ladybug_3DChart(inputData=flatten(adaptivecomfortcalculator_2.conditionOfPerson), xScale=number_slider_21, legendPar=legendpar_6)  # -> readMe, graphMesh, graphCurves, legend, legendBasePts, title, titleBasePts, dataPts, conditionalHOY; disabled; plug-in component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
swatch_17 = ColourSwatch(SwatchColor=RGB(0, 0, 0))  # disabled
preview_12 = CustomPreview(Geometry=[_3dchart_6.graphCurves, _3dchart_6.legend], Shader=swatch_17)  # disabled

east_side_ratio_3 = Slider(0.2, range=0..1)
north_side_ratio_3 = Slider(0.2, range=0..1)

geo_7 = Geometry(<brep referenced from the Rhino model>)
volume_3 = Volume(Geometry=geo_7)  # -> Volume, Centroid
rad_3 = Radians(Degrees=Slider(0, range=0..360))
rotate_3 = Rotate(Geometry=geo_7, Angle=rad_3, Plane=volume_3.Centroid)  # -> Geometry, Transform
panel_48 = Panel(dedomain_2.End)  # disabled
wires_3 = BrepWireframe(Brep=rotate_3.Geometry, Density=-1)  # disabled
swatch_18 = ColourSwatch(SwatchColor=RGB(0, 0, 0))  # disabled
mass2zone_3 = Honeybee_Masses2Zones(zoneMasses=flatten(rotate_3.Geometry), isConditioned=True, maxRoofAngle=30, createHBZones=Toggle(True))  # -> readMe, HBZones; plug-in component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
preview_13 = CustomPreview(Geometry=wires_3, Shader=swatch_18)  # disabled
number_slider_22 = Slider(0.03, range=0..0.1)  # disabled
decompose_honeybee_zone_3 = Honeybee_DecomposeHBZone(HBZone=mass2zone_3.HBZones)  # -> HBSurfaces; plug-in component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
number_slider_23 = Slider(4, range=0..10)
number_slider_24 = Slider(3, range=0..10)
pt_4 = Point(<point referenced from the Rhino model>)  # disabled
lng_6 = ListLength(List=decompose_honeybee_zone_3)
northarrow_3 = Ladybug_North(centerPt=pt_4, scale=number_slider_22)  # -> northSign; disabled; plug-in component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
item_5 = ListItem(List=decompose_honeybee_zone_3, Index=number_slider_23, Wrap=True)
item_6 = ListItem(List=decompose_honeybee_zone_3, Index=number_slider_24, Wrap=True)
panel_49 = Panel(lng_6)
swatch_19 = ColourSwatch(SwatchColor=RGB(0, 0, 0))  # disabled
preview_14 = CustomPreview(Geometry=northarrow_3, Shader=swatch_19)  # disabled
glazingcreator_5 = Honeybee_GlazingBasedOnRatio(HBObjects=item_6, glzRatio=east_side_ratio_3, runIt=Toggle(True))  # -> readMe, HBObjWGLZ; plug-in component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
glazingcreator_6 = Honeybee_GlazingBasedOnRatio(HBObjects=item_5, glzRatio=north_side_ratio_3, runIt=Toggle(True))  # -> readMe, HBObjWGLZ; plug-in component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

number_slider_25 = Slider(2, range=0..10)  # disabled
panel_50 = Panel("1")  # disabled
panel_51 = Panel("0")  # disabled
number_slider_26 = Slider(0.3, range=0..1)  # disabled
legendpar_7 = Ladybug_LegendParameters(lowBound=panel_51, highBound=panel_50, numSegments=number_slider_25)  # -> legendPar; disabled; plug-in component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
_3dchart_7 = Ladybug_3DChart(inputData=flatten(outdoorcomfortcalculator.comfortableOrNot), xScale=number_slider_26, legendPar=legendpar_7)  # -> readMe, graphMesh, graphCurves, legend, legendBasePts, title, titleBasePts, dataPts, conditionalHOY; disabled; plug-in component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

number_slider_27 = Slider(3, range=0..10)  # disabled
panel_52 = Panel("1")  # disabled
panel_53 = Panel("-1")  # disabled
number_slider_28 = Slider(0.3, range=0..1)  # disabled
legendpar_8 = Ladybug_LegendParameters(lowBound=panel_53, highBound=panel_52, numSegments=number_slider_27)  # -> legendPar; disabled; plug-in component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
_3dchart_8 = Ladybug_3DChart(inputData=flatten(outdoorcomfortcalculator.thermalStress), xScale=number_slider_28, legendPar=legendpar_8)  # -> readMe, graphMesh, graphCurves, legend, legendBasePts, title, titleBasePts, dataPts, conditionalHOY; disabled; plug-in component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

panel_54 = Panel("https://www.energyplus.net/weather-download/north_and_central_america_wmo_region_4/USA/WA/USA_WA_Seattle-Boeing.Field.727935_TMY3/all")  # disabled
toggle_24 = BooleanToggle(True)  # disabled
replace_3 = ReplaceItems(
    List=decompose_honeybee_zone_3,
    Item=[glazingcreator_5.HBObjWGLZ, glazingcreator_6.HBObjWGLZ],
    Indices=[number_slider_24, number_slider_23],
    Wrap=False)
geo_8 = Geometry(replace_3)
epw_stat_8 = Ladybug_OpenEPWAndSTATWeatherFiles(weatherFileURL=panel_54)  # -> epwFile, statFile; disabled; plug-in component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
geo_9 = Geometry([<brep referenced from the Rhino model> x12])
createhbzones_3 = Honeybee_createHBZones(name="Myroom", HBSurfaces=flatten(geo_8), isConditioned=Toggle(False))  # -> readMe, HBZone; plug-in component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
epoutput_3 = Honeybee_GenerateEPOutput(zoneGainsAndLosses="False", zoneComfortMetrics=toggle_24, surfaceTempAnalysis="False")  # -> report, flatten(simulationOutputs); disabled; plug-in component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
hb_epcontextsrf = HoneybeeEPContextSurfaces(shdSurfaces=flatten(geo_9))  # -> HBContext; inputs shdSurfaces: list of Brep, justBoundingBox: Boolean
# ---------- hb_epcontextsrf: Python ----------
"""
prepare shading/context geometries

    Args:
        northVectorOrRotation: A vector that shows North or a number that shows
                               the rotation of the North from the Y axis
        bldgMasses: List of closed Breps as thermal zones.
    Returns:
        report: ...
        thermalZones: Thermal zone's geometries for visualiza
"""

ghenv.Component.Name = 'Honeybee EP context Surfaces'
ghenv.Component.NickName = 'HB_EPContextSrf'
ghenv.Component.Message = 'VER 0.0.60\nNOV_04_2016'
ghenv.Component.IconDisplayMode = ghenv.Component.IconDisplayMode.application
ghenv.Component.Category = "Honeybee"
ghenv.Component.SubCategory = "10 | Energy | Energy"
#compatibleHBVersion = VER 0.0.57\nNOV_04_2016
#compatibleLBVersion = VER 0.0.59\nFEB_01_2015
ghenv.Component.AdditionalHelpFromDocStrings = "2"

import rhinoscriptsyntax as rs
import Rhino as rc
import scriptcontext as sc
import os
import System
import Grasshopper.Kernel as gh
import uuid

tolerance = sc.doc.ModelAbsoluteTolerance
import math


def main(shdSurfaces, EPTransSchedule, meshingSettings, justBoundingBox):
    
    # import the classes
    if sc.sticky.has_key('honeybee_release'):

        try:
            if not sc.sticky['honeybee_release'].isCompatible(ghenv.Component): return -1
            if sc.sticky['honeybee_release'].isInputMissing(ghenv.Component): return -1
        except:
            warning = "You need a newer version of Honeybee to use this compoent." + \
            " Use updateHoneybee component to update userObjects.\n" + \
            "If you have already updated userObjects drag Honeybee_Honeybee component " + \
            "into canvas and try again."
            w = gh.GH_RuntimeMessageLevel.Warning
            ghenv.Component.AddRuntimeMessage(w, warning)
            return -1
        
        # don't customize this part
        hb_EPSrf = sc.sticky["honeybee_EPSurface"]
        hb_EPSHDSurface = sc.sticky["honeybee_EPShdSurface"]
        hb_RADMaterialAUX = sc.sticky["honeybee_RADMaterialAUX"]
        hb_EPObjectsAux = sc.sticky["honeybee_EPObjectsAUX"]()
        HBScheduleList = sc.sticky["honeybee_ScheduleLib"].keys()

        ########################################################################
        #----------------------------------------------------------------------#
        shdBreps = []
        # create bounding box of shading geometries
        if justBoundingBox:
            for brep in shdSurfaces:
                if brep.Faces.Count>1 or not brep.Faces[0].IsPlanar(sc.doc.ModelAbsoluteTolerance):
                    shdBreps.append(brep.GetBoundingBox(True).ToBrep())
                else:
                    shdBreps.append(brep)
        else:
            shdBreps = shdSurfaces
        
        shadingClasses = []
        shadingMeshPreview = []
        
        if meshingSettings == None:
            mp = rc.Geometry.MeshingParameters.Minimal
            mp.SimplePlanes = True
        else:
            mp = meshingSettings
        
        def getRadMaterialName(radMaterial):
            nameStr = radMaterial.split(" ")[2]
            name =  nameStr.split("\n")[0]
            return name
        
        for brepCount, brep in enumerate(shdBreps):
            if brep != None:
                isPlanar = True
                # check planarity
                for face in brep.Faces:
                    if not face.IsPlanar(tolerance):
                        isPlanar = False
                        break
                
                shadingBreps = []
                if not isPlanar:
                    meshArray = rc.Geometry.Mesh.CreateFromBrep(brep, mp)
                    for mesh in meshArray:
                        for meshFace in range(mesh.Faces.Count):
                            vertices = list(mesh.Faces.GetFaceVertices(meshFace))[1:]
                            vertices = vertices + [sc.doc.ModelAbsoluteTolerance]
                            # create the brep from mesh
                            shdBrep = rc.Geometry.Brep.CreateFromCornerPoints(*vertices)
                            shadingBreps.append(shdBrep)
                else:
                    for face in brep.Faces:
                        shadingBreps.append(face.DuplicateFace(False))
                
                for faceCount, shdBrep in enumerate(shadingBreps):
                        thisShading = hb_EPSHDSurface(shdBrep, 1000*brepCount + faceCount, 'shdSrf_' + `brepCount` + '_' + `faceCount` + "_" + str(uuid.uuid4()))
                        
                        # add transmittance schedule if any
                        if EPTransSchedule!=None:
                            schedule= EPTransSchedule.upper()
                            if schedule!=None and not schedule.lower().endswith(".csv") and schedule not in HBScheduleList:
                                msg = "Cannot find " + schedule + " in Honeybee schedule library."
                                print msg
                                ghenv.Component.AddRuntimeMessage(gh.GH_RuntimeMessageLevel.Warning, msg)
                                return -1
                            elif schedule!=None and schedule.lower().endswith(".csv"):
                                # check if csv file is existed
                                if not os.path.isfile(schedule):
                                    msg = "Cannot find the shchedule file: " + schedule
                                    print msg
                                    ghenv.Component.AddRuntimeMessage(gh.GH_RuntimeMessageLevel.Warning, msg)
                                    return -1
                            
                            thisShading.TransmittanceSCH = schedule
                        
                        # add the Rad Material if any
                        if RADMaterial!=None:
                            # if it is just the name of the material make sure it is already defined
                            if len(RADMaterial.split(" ")) == 1:
                                # if the material is not in the library add it to the library
                                if not hb_RADMaterialAUX.isMatrialExistInLibrary(RADMaterial):
                                    warningMsg = "Can't find " + RADMaterial + " in RAD Material Library.\n" + \
                                                "Add the material to the library and try again."
                                    ghenv.Component.AddRuntimeMessage(gh.GH_RuntimeMessageLevel.Warning, warningMsg)
                                    return
                                
                                try:
                                    thisShading.setRADMaterial(RADMaterial)
                                except Exception, e:
                                    print e
                                    warningMsg = "You are using an old version of Honeybee_Honeybee! Update your files and try again."
                                    print warningMsg
                                    ghenv.Component.AddRuntimeMessage(gh.GH_RuntimeMessageLevel.Warning, warningMsg)
                                    return
                                
                                addedToLib = True
                            else:
                                
                                # try to add the material to the library
                                addedToLib, thisShading.RadMaterial = hb_RADMaterialAUX.analyseRadMaterials(RADMaterial, True)
                                
                            if addedToLib==False:
                                warningMsg = "Failed to add " + RADMaterial + " to the Library."
                                ghenv.Component.AddRuntimeMessage(gh.GH_RuntimeMessageLevel.Warning, warningMsg)
                                return
                        
                        # add shading to the list
                        shadingClasses.append(thisShading)
                
        # add to the hive
        hb_hive = sc.sticky["honeybee_Hive"]()
        HBContext  = hb_hive.addToHoneybeeHive(shadingClasses, ghenv.Component)
        return HBContext
        ################################################################################################
    else:
        print "You should first let Honeybee to fly..."
        w = gh.GH_RuntimeMessageLevel.Warning
        ghenv.Component.AddRuntimeMessage(w, "You should first let Honeybee to fly...")
        return -1
        

if _shdSurfaces and _shdSurfaces[0]!=None:
    # add cleaning function
    result= main(_shdSurfaces, EPTransSchedule_, meshingSettings_, justBoundingBox_)
    
    if result != -1: HBContext = result
# ---------- end hb_epcontextsrf ----------
callfromepconstrlibrary = Honeybee_CallFromEPConstructionLibrary(keywords="floor")  # -> ThermMaterials, EPMaterials, EPWindowMaterials, EPConstructions; plug-in component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

list = ValueList({"Exterior Wall [R5.5]": "ASHRAE 90.1-2004 EXTWALL METAL CLIMATEZONE 4", "Exterior Wall [R5.8]": "ASHRAE 90.1-2004 EXTWALL MASS CLIMATEZONE 3-4", "Exterior Wall [R7.2]": "ASHRAE 90.1-2004 EXTWALL STEELFRAME CLIMATEZONE 1-4", "Exterior Wall [R8.7]": "ASHRAE 90.1-2004 EXTWALL MASS CLIMATEZONE ALT-RES 4", "Exterior Wall [R10.4]": "ASHRAE 90.1-2004 EXTWALL WOODFRAME CLIMATEZONE 1-7", "Exterior Wall [R14.8]": "ASHRAE 90.1-2004 EXTWALL STEELFRAME CLIMATEZONE ALT-RES 4-6", "Exterior Wall [R34.4]": "ASHRAE 189.1-2009 EXTROOF IEAD CLIMATEZONE 7-8"}, selected="Exterior Wall [R34.4]")
list_2 = ValueList({"Exterior Window [R1.0, SHGC 0.7]": "ASHRAE 90.1-2004 EXTWINDOW CLIMATEZONE ALT-WARE 1-8", "Exterior Window [R1.7, SHGC 0.39]": "ASHRAE 90.1-2004 EXTWINDOW CLIMATEZONE 4-6", "Exterior Window [R1.9, SHGC 0.39]": "ASHRAE 90.1-2004 EXTWINDOW CLIMATEZONE ALT-RES 4-6", "Exterior Window [R0.7, SHGC 0.65]": "Dbl LoE (e3=.1) Clr 3mm/13mm Arg"}, selected="Exterior Window [R1.7, SHGC 0.39]")
list_3 = ValueList({"Exterior Roof [R9.2]": "ASHRAE 90.1-2004 EXTROOF METAL CLIMATEZONE 3-4", "Exterior Roof [R14.8]": "ASHRAE 90.1-2004 EXTROOF IEAD CLIMATEZONE 1-4", "Exterior Roof [R34.4]": "ASHRAE 189.1-2009 EXTROOF IEAD CLIMATEZONE 7-8"}, selected="Exterior Roof [R34.4]")

toggle_25 = BooleanToggle(True)
item_7 = ListItem(List=callfromepconstrlibrary.EPConstructions, Index=33, Wrap=True)
number_slider_29 = Slider(0.1, range=0..0.1)  # disabled
setepzonecnstr = Honeybee_SetEPZoneConstruction(
    HBZones=createhbzones_3.HBZone,
    wallEPConstruction=list,
    windowEPConstruction=list_2,
    roofEPConstruction=list_3,
    floorEPConstruction=item_7)  # -> simplify(modifiedHBZones); plug-in component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
ach2m3_s_m2_calculator = Honeybee_infORventPerAreaCalculator(HBZones=flatten(setepzonecnstr), airFlowRate=number_slider_29)  # -> readMe, infORventPerArea, allFloors; disabled; plug-in component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
runenergysimulation_3 = Honeybee_RunEnergySimulation(
    epwFile=epw_stat_8.epwFile,
    HBZones=flatten(setepzonecnstr),
    HBContext=flatten(hb_epcontextsrf),
    simulationOutputs=flatten(epoutput_3.simulationOutputs),
    writeIdf=toggle_25,
    runEnergyPlus=toggle_25)  # -> report, idfFileAddress, resultFileAddress; plug-in component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
setepzoneloads = Honeybee_SetEnergyPlusZoneLoads(HBZones=setepzonecnstr, ventilationPerArea=ach2m3_s_m2_calculator.infORventPerArea)  # -> loads, HBZones; disabled; plug-in component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
readepresult_3 = Honeybee_ReadEPResult(resultFileAddress=runenergysimulation_3.resultFileAddress)  # -> totalThermalLoad, thermalLoadBalance, cooling, heating, electricLight, electricEquip, fanElectric, pumpElectric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; plug-in component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
selectandaveragedata_2 = Ladybug_AverageData(annualHourlyData=readepresult_3.relativeHumidity)  # -> readMe, selHourlyData, averagedDaily, averagedMonthly, avrMonthlyPerHour, avrAnalysisPeriod; plug-in component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
toggle_26 = BooleanToggle(False)  # disabled
barchart_2 = Ladybug_MonthlyBarChart(inputData=flatten(selectandaveragedata_2.averagedMonthly), plotFromZero=Toggle(True))  # -> readMe, dataMesh, dataCurves, dataCrvColors, graphAxes, graphLabels, title, titleBasePt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; plug-in component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
psychchart_3 = Ladybug_PsychrometricChart(dryBulbTemperature=readepresult_3.airTemperature, relativeHumidity=readepresult_3.relativeHumidity, runIt=toggle_26)  # -> readMe, port, totalComfortPercent, totalComfortOrNot, strategyNames, strategyPercentOfTime, strategyOrNot, port_2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; plug-in component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
_3dchart_9 = Ladybug_3DChart(inputData=flatten(readepresult_3.relativeHumidity))  # -> readMe, graphMesh, graphCurves, legend, legendBasePts, title, titleBasePts, dataPts, conditionalHOY; disabled; plug-in component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
importepw_8 = Ladybug_ImportEpw(epwFile=epw_stat_8.epwFile)  # -> readMe, latitude, location, dryBulbTemperature, dewPointTemperature, relativeHumidity, windSpeed, windDirection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; disabled; plug-in component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
pmvcomfortcalculator_3 = Ladybug_PMVComfortCalculator(
    dryBulbTemperature=readepresult_3.airTemperature,
    meanRadiantTemperature=readepresult_3.meanRadTemperature,
    relativeHumidity=readepresult_3.relativeHumidity,
    calcBalanceTemperature=False,
    runIt=Toggle(True))  # -> readMe, port, predictedMeanVote, percentPeopleDissatisfied, standardEffectiveTemperature, port_2, comfortableOrNot, percentOfTimeComfortable, port_3, balanceTemperature; plug-in component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
panel_55 = Panel(pmvcomfortcalculator_3.percentOfTimeComfortable)  # disabled
toggle_27 = BooleanToggle(True)  # disabled
panel_56 = Panel(selectandaveragedata_2.averagedMonthly)
adaptivecomfortcalculator_3 = Ladybug_AdaptiveComfortCalculator(
    dryBulbTemperature=readepresult_3.airTemperature,
    meanRadiantTemperature=readepresult_3.meanRadTemperature,
    prevailingOutdoorTemp=importepw_8.dryBulbTemperature,
    runIt=toggle_27)  # -> readMe, port, comfortableOrNot, conditionOfPerson, degreesFromTarget, port_2, targetTemperature, upperTemperatureBound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; disabled; plug-in component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
legendpar_9 = Ladybug_LegendParameters(lowBound="-3", highBound="3", numSegments=7, removeLessThan=Toggle(True))  # -> legendPar; plug-in component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
lng_7 = ListLength(List=panel_56)
subtraction_4 = Subtraction(A=lng_7, B=1)
_3dchart_10 = Ladybug_3DChart(
    inputData=flatten(pmvcomfortcalculator_3.predictedMeanVote),
    xScale=Slider(0.3, range=0..1),
    legendPar=legendpar_9,
    condStatement="-1 < a < 1")  # -> readMe, graphMesh, graphCurves, legend, legendBasePts, title, titleBasePts, dataPts, conditionalHOY; plug-in component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
panel_57 = Panel(adaptivecomfortcalculator_3.percentOfTimeComfortable)  # disabled
dom_4 = ConstructDomain(DomainStart="7", DomainEnd=subtraction_4)
panel_58 = Panel("1")  # disabled
panel_59 = Panel("-1")  # disabled
pt_5 = Point(<point referenced from the Rhino model>)
subset_4 = SubList(List=panel_56, Domain=dom_4, Wrap=True)  # -> List, Index
tag_2 = TextTag3D(
    Location=pt_5,
    Text=pmvcomfortcalculator_3.percentOfTimeComfortable,
    Size=Slider(2, range=0..10),
    Colour=ColourSwatch(SwatchColor=RGB(0, 0, 0)),
    Justification=7)
legendpar_10 = Ladybug_LegendParameters(lowBound=panel_59, highBound=panel_58, numSegments=3)  # -> legendPar; plug-in component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
number_slider_30 = Slider(0.3, range=0..1)  # disabled
ma_2 = MassAddition(Input=subset_4.List)  # -> Result, PartialResults
preview_15 = CustomPreview(Geometry=[_3dchart_10.graphCurves, _3dchart_10.legend], Shader=ColourSwatch(SwatchColor=RGB(0, 0, 0)))
division_2 = Division(A=ma_2.Result, B=12)
_3dchart_11 = Ladybug_3DChart(inputData=flatten(adaptivecomfortcalculator_3.conditionOfPerson), xScale=number_slider_30, legendPar=legendpar_10)  # -> readMe, graphMesh, graphCurves, legend, legendBasePts, title, titleBasePts, dataPts, conditionalHOY; disabled; plug-in component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
panel_60 = Panel(division_2)
swatch_20 = ColourSwatch(SwatchColor=RGB(0, 0, 0))  # disabled
preview_16 = CustomPreview(Geometry=[_3dchart_11.graphCurves, _3dchart_11.legend], Shader=swatch_20)  # disabled

# ----
# Finally for complex geometries or
# geometries that are not going to change
# it is better to export them as rad files
# using RAD>Mesh and use them as
# additional files.
number_slider_31 = Slider(0.6, range=0..1)  # disabled
panel_61 = Panel("https://www.energyplus.net/weather-download/north_and_central_america_wmo_region_4/USA/PA/USA_PA_Philadelphia.Intl.AP.724080_TMY3/all")  # disabled
panel_62 = Panel("Glass")  # disabled
panel_63 = Panel("0")  # disabled
windows = Brep([<brep referenced from the Rhino model> x3])  # disabled
wall = Brep(<brep referenced from the Rhino model>)  # disabled
wall_2 = Brep([<brep referenced from the Rhino model> x2])  # disabled
panel_64 = Panel("2")  # disabled
epw_stat_9 = Ladybug_OpenEPWAndSTATWeatherFiles(weatherFileURL=panel_61)  # -> epwFile, statFile; disabled; plug-in component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
createhbsrfs = Honeybee_createHBSrfs(geometry=wall, srfType=panel_63)  # -> readMe, simplify(HBSurface); disabled; plug-in component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
createhbsrfs_2 = Honeybee_createHBSrfs(geometry=wall_2, srfType=panel_64)  # -> readMe, simplify(HBSurface); disabled; plug-in component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
radglassmaterial = Honeybee_RadianceGlassMaterial(
    materialName=panel_62,
    RTransmittance=number_slider_31,
    GTransmittance=number_slider_31,
    BTransmittance=number_slider_31,
    refractiveIndex=1.52)  # -> avrgTrans, RADMaterial; disabled; plug-in component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
panel_65 = Panel("3")  # disabled
panel_66 = Panel("21")  # disabled
panel_67 = Panel("9")  # disabled
# Glare
createhbsrfs_3 = Honeybee_createHBSrfs(geometry=windows, RADMaterial=radglassmaterial.RADMaterial)  # -> readMe, simplify(HBSurface); disabled; plug-in component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
number_slider_32 = Slider(45, range=0..100)  # disabled
panel_68 = Panel(".05")  # disabled
genclimatebasedsky = Honeybee_GenerateClimateBasedSky(north=number_slider_32, weatherFile=epw_stat_9.epwFile, month=panel_65, day=panel_66, hour=panel_67)  # -> radiationValues, skyFilePath; disabled; plug-in component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
genavgsky = Honeybee_GenerateAverageSky(north=number_slider_32, weatherFile=epw_stat_9.epwFile, month=panel_65, hour=panel_67)  # -> radiationValues, skyFilePath; disabled; plug-in component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
northarrow_4 = Ladybug_North(north=number_slider_32, scale=panel_68)  # -> northSign; disabled; plug-in component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
md_slider = MDSlider(
    slider_value=Point(0.6404013285, 0.4684433356, 0.5),
    SliderMode=0,
    x_domain=Domain(-1, 1),
    y_domain=Domain(-1, 1),
    z_domain=Domain(0, 1))  # disabled
brep = Brep([createhbsrfs_3.HBSurface, createhbsrfs.HBSurface, createhbsrfs_2.HBSurface])  # disabled
panel_69 = Panel([genclimatebasedsky.radiationValues, genavgsky.radiationValues])  # disabled
panel_70 = Panel("3")  # disabled
set_the_view_to_fisheye_for_glare_analys = Panel("1")  # "set the view to FishEye for Glare Analysis"; disabled
radparameters = Honeybee_RADParameters(quality=0, ab=panel_70)  # -> readMe, radParameters; disabled; plug-in component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
doy_hoy = Ladybug_DOY_HOY(days=panel_66, months=panel_65, hours=panel_67)  # -> HOY, DOY, date; disabled; plug-in component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
imagebasedsimulation = Honeybee_ImageBasedSimulation(
    skyFile=genavgsky.skyFilePath,
    cameraType=set_the_view_to_fisheye_for_glare_analys,
    simulationType=2,
    radParameters=radparameters.radParameters,
    backupImages=0)  # -> analysisRecipe; disabled; plug-in component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
toggle_28 = BooleanToggle(True)  # disabled
panel_71 = Panel("4")  # disabled
panel_72 = Panel("""Radiance
Grasshopper
Honeybee
Glare
Daylight
Set View
HBExampleFiles""")  # disabled
panel_73 = Panel("""This file shows how to run a glare analysis using Honeybee. This example is using same geometry as the other daylighting examples [[1](http://hydrashare.github.io/hydra/viewer?owner=mostaphaRoudsari&fork=hydra_1&id=Surface_by_surface_geometry_preparation_for_daylight_simulation_II), [2](http://hydrashare.github.io/hydra/viewer?owner=mostaphaRoudsari&fork=hydra_1&id=Find_when_sun_is_visible_to_a_point)].
The example is uses Averaged Climate-based Sky for glare analysis which uses the average value for that hour during the whole month.""")  # disabled
panel_74 = Panel("C:\Users\Administrator\Documents\GitHub\hydra_1")  # disabled
panel_75 = Panel("Glare Analysis")  # disabled
panel_76 = Panel("C:\Users\Administrator\Dropbox\ladybug\helpDesk\PennDesign2015\Daylight_Glare_Analysis.png")  # disabled
toggle_29 = BooleanToggle(False)  # disabled
toggle_30 = BooleanToggle(True)  # disabled
number_slider_33 = Slider(0.35, range=0..1)  # disabled
panel_77 = Panel("context_material")  # disabled
geo_10 = Geometry([<brep referenced from the Rhino model> x27])  # disabled
exporthydra = Hydra_ExportFile(
    fileName=panel_75,
    fileDescription=panel_73,
    fileTags=panel_72,
    targetFolder=panel_74,
    includeRhino=toggle_30,
    additionalImgs=panel_76,
    export=toggle_29)  # -> readMe; inputs fileDescription: list, changeLog: list, fileTags: list, includeRhino: Boolean, GHForThumb: Boolean, additionalImgs: list, export: Boolean; disabled; plug-in component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
radopaquematerial = Honeybee_RadianceOpaqueMaterial(
    materialName=panel_77,
    RReflectance=number_slider_33,
    GReflectance=number_slider_33,
    BReflectance=number_slider_33,
    roughness=0.05,
    specularity=0)  # -> avrgRef, RADMaterial; disabled; plug-in component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
panel_78 = Panel("c:\ladybug")  # disabled
panel_79 = Panel("ParisProjectContext")  # disabled
toggle_31 = BooleanToggle(True)  # disabled
msh2rad = Honeybee_MSH2RAD(mesh=geo_10, RADMaterial=radopaquematerial.RADMaterial, workingDir=panel_78, radFileName=panel_79, writeRAD=toggle_31)  # -> materialFile, radianceFile; disabled; plug-in component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
merge = Merge(Data1=msh2rad.materialFile, Data2=msh2rad.radianceFile)  # disabled
panel_80 = Panel(merge)  # disabled
toggle_32 = BooleanToggle(True)  # disabled
toggle_33 = BooleanToggle(True)  # disabled
toggle_34 = BooleanToggle(True)  # disabled
number_slider_34 = Slider(0.8, range=0..1)  # disabled

# ---- group: For better visualization - Doesn't effect the results of the analysis
importlocation_3 = Ladybug_ImportLocation(epwFile=epw_stat_9.epwFile)  # -> location; disabled; plug-in component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
number_slider_35 = Slider(0.2, range=0..1)  # disabled
sunpath_3 = Ladybug_SunPath(
    north=number_slider_32,
    location=importlocation_3,
    hour=panel_67,
    day=panel_66,
    month=panel_65,
    timeStep=1,
    sunPathScale=number_slider_35,
    dailyOrAnnualSunPath=True)  # -> readMe, sunVectors, sunAltitudes, sunAzimuths, port, sunSpheresMesh, sunPathCrvs, legend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; disabled; plug-in component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

# ---- group: collect all honeybee surfaces
brep_2 = Brep(flatten(brep))  # disabled

# ----
# roof
# wall
# floor
# window
# Generate annual results
# Visualize the results
walls = Geometry([<brep referenced from the Rhino model> x6])  # disabled
ceiling = Geometry(<brep referenced from the Rhino model>)  # disabled
walls_2 = Geometry(<brep referenced from the Rhino model>)  # disabled
walls_3 = Geometry([<brep referenced from the Rhino model> x3])  # disabled
panel_81 = Panel("0")  # disabled
panel_82 = Panel("1")  # disabled
panel_83 = Panel("2")  # disabled
panel_84 = Panel("5")  # disabled
createhbsrfs_4 = Honeybee_createHBSrfs(geometry=walls, srfType=panel_81)  # -> readMe, simplify(HBSurface); disabled; plug-in component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
createhbsrfs_5 = Honeybee_createHBSrfs(geometry=ceiling, srfType=panel_82)  # -> readMe, simplify(HBSurface); disabled; plug-in component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
createhbsrfs_6 = Honeybee_createHBSrfs(geometry=walls_2, srfType=panel_83)  # -> readMe, simplify(HBSurface); disabled; plug-in component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
createhbsrfs_7 = Honeybee_createHBSrfs(geometry=walls_3, srfType=panel_84)  # -> readMe, simplify(HBSurface); disabled; plug-in component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
panel_85 = Panel("https://www.energyplus.net/weather-download/north_and_central_america_wmo_region_4/USA/WA/USA_WA_Seattle-Boeing.Field.727935_TMY3/all")  # disabled
epw_stat_10 = Ladybug_OpenEPWAndSTATWeatherFiles(weatherFileURL=panel_85)  # -> epwFile, statFile; disabled; plug-in component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
number_slider_36 = Slider(0.762, range=0..1)  # disabled
number_slider_37 = Slider(0.5, range=0..1)  # disabled
geo_11 = Geometry([createhbsrfs_5.HBSurface, createhbsrfs_4.HBSurface, createhbsrfs_6.HBSurface, createhbsrfs_7.HBSurface])  # disabled
panel_86 = Panel("My room")  # disabled
createhbzones_4 = Honeybee_createHBZones(name=panel_86, HBSurfaces=flatten(geo_11), isConditioned=True)  # -> readMe, HBZone; disabled; plug-in component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
genhbzonetestpts = Honeybee_GenerateZoneTestPoints(HBZone=createhbzones_4.HBZone, gridSize=number_slider_37, distBaseSrf=number_slider_36, moveTestMesh=True)  # -> readMe, simplify(testPoints), simplify(ptsVectors), simplify(facesArea), simplify(mesh); disabled; plug-in component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
panel_87 = Panel(genhbzonetestpts.mesh)  # disabled
annualdaylightsimulation = Honeybee_AnnualDaylightSimulation(
    epwWeatherFile=epw_stat_10.epwFile,
    testPoints=genhbzonetestpts.testPoints,
    ptsVectors=genhbzonetestpts.ptsVectors,
    testMesh=genhbzonetestpts.mesh)  # -> analysisRecipe; disabled; plug-in component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
wires_4 = BrepWireframe(Brep=createhbzones_4.HBZone, Density=-1)  # disabled
toggle_35 = BooleanToggle(True)  # disabled
toggle_36 = BooleanToggle(True)  # disabled
panel_88 = Panel("4")  # disabled
rundaylightanalysis = Honeybee_RunDaylightSimulation(
    HBObjects=flatten(createhbzones_4.HBZone),
    analysisRecipe=annualdaylightsimulation,
    writeRad=toggle_36,
    runRad=toggle_36,
    numOfCPUs=panel_88,
    overwriteResults=toggle_35)  # -> readMe, analysisType, resultsUnit, results, testPts, annual_analysis_files, radGeoFile, studyFolder, done; disabled; plug-in component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
toggle_37 = BooleanToggle(True)  # disabled
occupancygenerator = Honeybee_DaysimOccupancyGenerator(weekendDays=[1, 2], writeTheOcc=toggle_37)  # -> occupancyFile; disabled; plug-in component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
toggle_38 = BooleanToggle(True)  # disabled
readannualresultsi = Honeybee_ReadAnnualResultI(
    illFilesAddress=rundaylightanalysis.annual_analysis_files,
    testPoints=simplify(rundaylightanalysis.testPts),
    occupancyFiles=occupancygenerator,
    DLAIllumThresholds=300,
    runIt=toggle_38)  # -> DLA, UDLI_Less_100, UDLI_100_2000, UDLI_More_2000, CDA, sDA, annualProfiles, htmReport; disabled; plug-in component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
number_slider_38 = Slider(1, range=0..10)  # disabled
number_slider_39 = Slider(100, range=0..100)  # disabled
number_slider_40 = Slider(0, range=0..100)  # disabled
gradientlibrary = Ladybug_GradientLibrary(gradIndex=number_slider_38)  # -> customColors; disabled; plug-in component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
number_slider_41 = Slider(6, range=0..10)  # disabled
number_slider_42 = Slider(1, range=0..1)  # disabled
legendpar_11 = Ladybug_LegendParameters(
    lowBound=number_slider_40,
    highBound=number_slider_39,
    numSegments=number_slider_41,
    customColors=flatten(gradientlibrary))  # -> legendPar; disabled; plug-in component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
panel_89 = Panel("%")  # disabled

# ---- group: make it 3D!
dom_5 = ConstructDomain(DomainStart=0, DomainEnd=number_slider_42)  # disabled

# ----
recolormesh = Ladybug_RecolorMesh(
    analysisResult=readannualresultsi.UDLI_More_2000,
    inputMesh=genhbzonetestpts.mesh,
    heightDomain=dom_5,
    legendPar=legendpar_11,
    analysisTitle=rundaylightanalysis.analysisType,
    legendTitle=panel_89)  # -> readMe, newMesh, newLegend, legendBasePt, meshColors, legendColors; disabled; plug-in component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

panel_90 = Panel(readannualresultsi.sDA)  # disabled

panel_91 = Panel("175")  # disabled
pt_6 = Point(<point referenced from the Rhino model>)  # disabled
comfortmannequin = Ladybug_ComfortMannequin(rotationAngle=panel_91, bodyLocation=pt_6)  # -> mannequinMesh, legend, legendBasePt; disabled; plug-in component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
swatch_21 = ColourSwatch(SwatchColor=RGB(255, 0, 0))  # disabled

# ---- group: Person's face!
item_8 = ListItem(List=comfortmannequin.mannequinMesh, Index=121, Wrap=True)  # disabled

# ----
preview_17 = CustomPreview(Geometry=item_8, Shader=swatch_21)  # disabled

facen = FaceNormals(Mesh=item_8)  # -> Centers, Normals; disabled
settheview = Ladybug_SetTheView(cameraLocation=facen.Centers, cameraDirection=facen.Normals, uvLookAround=md_slider)  # -> readMe; disabled; plug-in component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
rundaylightanalysis_2 = Honeybee_RunDaylightSimulation(
    HBObjects=flatten(brep_2),
    analysisRecipe=imagebasedsimulation,
    writeRad=toggle_28,
    runRad=toggle_28,
    numOfCPUs=panel_71,
    radFileName=doy_hoy.date,
    additionalRadFiles=merge,
    overwriteResults=True)  # -> readMe, analysisType, resultsUnit, results, testPts, resultFiles, radGeoFile, studyFolder, done; disabled; plug-in component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
glareanalysis = Honeybee_GlareAnalysis(HDRImagePath=rundaylightanalysis_2.resultFiles, runIt=toggle_32)  # -> readMe, glareCheckImage, DGP, DGI, imageWithTaskArea; disabled; plug-in component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
falsecolor = Honeybee_FalseColor(
    HDRFilePath=rundaylightanalysis_2.resultFiles,
    contourBands=False,
    maskThreshold=0.1,
    useAlterColors=False,
    render=toggle_33)  # -> outputFilePath; disabled; plug-in component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
panel_92 = Panel(glareanalysis.DGP)  # disabled
hdr_tif = Honeybee_ConvertHDRToTIF(HDRFilePath=glareanalysis.glareCheckImage, adjustExposure=toggle_34)  # -> TIFFFilePath; disabled; plug-in component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
hdr_tif_2 = Honeybee_ConvertHDRToTIF(HDRFilePath=falsecolor, adjustExposure=False)  # -> TIFFFilePath; disabled; plug-in component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
image = ImageFromPath(P=hdr_tif, S=number_slider_34)  # disabled
image_2 = ImageFromPath(P=hdr_tif_2, S=number_slider_34)  # disabled

panel_93 = Panel(rundaylightanalysis_2.resultFiles)  # disabled

# ----
# roof
# wall
# floor
# Generate annual results
# Visualize the results
# window
# shading
panel_94 = Panel("floor")  # disabled
callfromepconstrlibrary_2 = Honeybee_CallFromEPConstructionLibrary(keywords=panel_94)  # -> ThermMaterials, EPMaterials, EPWindowMaterials, EPConstructions; disabled; plug-in component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
list_4 = ValueList({"Exterior Roof [R9.2]": "ASHRAE 90.1-2004 EXTROOF METAL CLIMATEZONE 3-4", "Exterior Roof [R14.8]": "ASHRAE 90.1-2004 EXTROOF IEAD CLIMATEZONE 1-4", "Exterior Roof [R34.4]": "ASHRAE 189.1-2009 EXTROOF IEAD CLIMATEZONE 7-8"}, selected="Exterior Roof [R34.4]")  # disabled
list_5 = ValueList({"Exterior Window [R1.0, SHGC 0.7]": "ASHRAE 90.1-2004 EXTWINDOW CLIMATEZONE ALT-WARE 1-8", "Exterior Window [R1.7, SHGC 0.39]": "ASHRAE 90.1-2004 EXTWINDOW CLIMATEZONE 4-6", "Exterior Window [R1.9, SHGC 0.39]": "ASHRAE 90.1-2004 EXTWINDOW CLIMATEZONE ALT-RES 4-6", "Exterior Window [R0.7, SHGC 0.65]": "Dbl LoE (e3=.1) Clr 3mm/13mm Arg"}, selected="Exterior Window [R1.7, SHGC 0.39]")  # disabled
item_9 = ListItem(List=callfromepconstrlibrary_2.EPConstructions, Index=0, Wrap=True)  # disabled
list_6 = ValueList({"Exterior Wall [R5.5]": "ASHRAE 90.1-2004 EXTWALL METAL CLIMATEZONE 4", "Exterior Wall [R5.8]": "ASHRAE 90.1-2004 EXTWALL MASS CLIMATEZONE 3-4", "Exterior Wall [R7.2]": "ASHRAE 90.1-2004 EXTWALL STEELFRAME CLIMATEZONE 1-4", "Exterior Wall [R8.7]": "ASHRAE 90.1-2004 EXTWALL MASS CLIMATEZONE ALT-RES 4", "Exterior Wall [R10.4]": "ASHRAE 90.1-2004 EXTWALL WOODFRAME CLIMATEZONE 1-7", "Exterior Wall [R14.8]": "ASHRAE 90.1-2004 EXTWALL STEELFRAME CLIMATEZONE ALT-RES 4-6", "Exterior Wall [R34.4]": "ASHRAE 189.1-2009 EXTROOF IEAD CLIMATEZONE 7-8"}, selected="Exterior Wall [R5.8]")  # disabled
walls_4 = Geometry([<brep referenced from the Rhino model> x6])  # disabled
ceiling_2 = Geometry(<brep referenced from the Rhino model>)  # disabled
walls_5 = Geometry(<brep referenced from the Rhino model>)  # disabled
geo_12 = Geometry([<brep referenced from the Rhino model> x12])  # disabled
walls_6 = Geometry([<brep referenced from the Rhino model> x3])  # disabled
panel_95 = Panel("2")  # disabled
panel_96 = Panel("5")  # disabled
panel_97 = Panel("6")  # disabled
createhbsrfs_8 = Honeybee_createHBSrfs(geometry=walls_4, EPConstruction=list_6)  # -> readMe, simplify(HBSurface); disabled; plug-in component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
createhbsrfs_9 = Honeybee_createHBSrfs(geometry=ceiling_2, EPConstruction=list_4)  # -> readMe, simplify(HBSurface); disabled; plug-in component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
createhbsrfs_10 = Honeybee_createHBSrfs(geometry=walls_5, srfType=panel_95, EPConstruction=item_9)  # -> readMe, simplify(HBSurface); disabled; plug-in component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
createhbsrfs_11 = Honeybee_createHBSrfs(geometry=walls_6, srfType=panel_96, EPConstruction=list_5)  # -> readMe, simplify(HBSurface); disabled; plug-in component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
createhbsrfs_12 = Honeybee_createHBSrfs(geometry=geo_12, srfType=panel_97)  # -> readMe, simplify(HBSurface); disabled; plug-in component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
panel_98 = Panel("https://www.energyplus.net/weather-download/north_and_central_america_wmo_region_4/USA/WA/USA_WA_Seattle-Boeing.Field.727935_TMY3/all")  # disabled
epw_stat_11 = Ladybug_OpenEPWAndSTATWeatherFiles(weatherFileURL=panel_98)  # -> epwFile, statFile; disabled; plug-in component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
geo_13 = Geometry([createhbsrfs_9.HBSurface, createhbsrfs_8.HBSurface, createhbsrfs_11.HBSurface, createhbsrfs_10.HBSurface])  # disabled
panel_99 = Panel("Myroom")  # disabled
hb_epcontextsrf_2 = HoneybeeEPContextSurfaces(shdSurfaces=flatten(createhbsrfs_12.HBSurface))  # -> HBContext; inputs shdSurfaces: list of Brep, justBoundingBox: Boolean; disabled; same code as hb_epcontextsrf
createhbzones_5 = Honeybee_createHBZones(name=panel_99, HBSurfaces=flatten(geo_13), isConditioned=True)  # -> readMe, HBZone; disabled; plug-in component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
number_slider_43 = Slider(0.762, range=0..1)  # disabled
number_slider_44 = Slider(0.5, range=0..1)  # disabled
genhbzonetestpts_2 = Honeybee_GenerateZoneTestPoints(HBZone=createhbzones_5.HBZone, gridSize=number_slider_44, distBaseSrf=number_slider_43, moveTestMesh=True)  # -> readMe, simplify(testPoints), simplify(ptsVectors), simplify(facesArea), simplify(mesh); disabled; plug-in component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
wires_5 = BrepWireframe(Brep=createhbzones_5.HBZone, Density=-1)  # disabled
panel_100 = Panel(genhbzonetestpts_2.mesh)  # disabled
annualdaylightsimulation_2 = Honeybee_AnnualDaylightSimulation(
    epwWeatherFile=epw_stat_11.epwFile,
    testPoints=genhbzonetestpts_2.testPoints,
    ptsVectors=genhbzonetestpts_2.ptsVectors,
    testMesh=genhbzonetestpts_2.mesh)  # -> analysisRecipe; disabled; plug-in component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
toggle_39 = BooleanToggle(False)  # disabled
toggle_40 = BooleanToggle(True)  # disabled
panel_101 = Panel("4")  # disabled
rundaylightanalysis_3 = Honeybee_RunDaylightSimulation(
    HBObjects=flatten([createhbzones_5.HBZone, createhbsrfs_12.HBSurface]),
    analysisRecipe=annualdaylightsimulation_2,
    writeRad=toggle_40,
    runRad=toggle_40,
    numOfCPUs=panel_101,
    overwriteResults=toggle_39)  # -> readMe, analysisType, resultsUnit, results, testPts, annual_analysis_files, radGeoFile, studyFolder, done; disabled; plug-in component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
toggle_41 = BooleanToggle(True)  # disabled
occupancygenerator_2 = Honeybee_DaysimOccupancyGenerator(weekendDays=[1, 2], writeTheOcc=toggle_41)  # -> occupancyFile; disabled; plug-in component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
toggle_42 = BooleanToggle(True)  # disabled
readannualresultsi_2 = Honeybee_ReadAnnualResultI(
    illFilesAddress=rundaylightanalysis_3.annual_analysis_files,
    testPoints=simplify(rundaylightanalysis_3.testPts),
    occupancyFiles=occupancygenerator_2,
    DLAIllumThresholds=300,
    runIt=toggle_42)  # -> DLA, UDLI_Less_100, UDLI_100_2000, UDLI_More_2000, CDA, sDA, annualProfiles, htmReport; disabled; plug-in component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
number_slider_45 = Slider(1, range=0..10)  # disabled
number_slider_46 = Slider(100, range=0..100)  # disabled
number_slider_47 = Slider(0, range=0..100)  # disabled
gradientlibrary_2 = Ladybug_GradientLibrary(gradIndex=number_slider_45)  # -> customColors; disabled; plug-in component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
number_slider_48 = Slider(6, range=0..10)  # disabled
number_slider_49 = Slider(1, range=0..1)  # disabled
legendpar_12 = Ladybug_LegendParameters(
    lowBound=number_slider_47,
    highBound=number_slider_46,
    numSegments=number_slider_48,
    customColors=flatten(gradientlibrary_2))  # -> legendPar; disabled; plug-in component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
panel_102 = Panel("%")  # disabled
panel_103 = Panel(readannualresultsi_2.sDA)  # disabled

# ---- group: make it 3D!
dom_6 = ConstructDomain(DomainStart=0, DomainEnd=number_slider_49)  # disabled

# ----
recolormesh_2 = Ladybug_RecolorMesh(
    analysisResult=readannualresultsi_2.UDLI_More_2000,
    inputMesh=genhbzonetestpts_2.mesh,
    heightDomain=dom_6,
    legendPar=legendpar_12,
    analysisTitle=rundaylightanalysis_3.analysisType,
    legendTitle=panel_102)  # -> readMe, newMesh, newLegend, legendBasePt, meshColors, legendColors; disabled; plug-in component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
