# Grasshopper definition Fan_Cao.gh (Grasshopper 0.9.76)
# plug-ins: Python Interpreter

panel = Panel("https://www.energyplus.net/weather-download/north_and_central_america_wmo_region_4/USA/PA/USA_PA_Philadelphia.Intl.AP.724080_TMY3/all")
ladybug = Ladybug_Ladybug(defaultFolder="c:/ladybug")  # -> Vviiiiiiiiiizzz; plug-in component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
epw_stat = Ladybug_OpenEPWAndSTATWeatherFiles(weatherFileURL=panel)  # -> epwFile, statFile; plug-in component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
importepw = Ladybug_ImportEpw(epwFile=epw_stat.epwFile)  # -> readMe, latitude, location, dryBulbTemperature, dewPointTemperature, relativeHumidity, windSpeed, windDirection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; plug-in component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
analysisperiod = Ladybug_AnalysisPeriod()  # -> readMe, analysisPeriod; plug-in component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
analysisperiod_2 = Ladybug_AnalysisPeriod()  # -> readMe, analysisPeriod; plug-in component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
line = Line(Line((-102.3446363, 324.5902896, -257.2096947), (-101.9729119, 327.617742, -257.2096947)))
brep = Brep(<brep referenced from the Rhino model>)
analysisperiod_3 = Ladybug_AnalysisPeriod()  # -> readMe, analysisPeriod; plug-in component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
line_2 = Line(Line((-102.3446363, 324.5902896, -257.2096947), (-101.9729119, 327.617742, -257.2096947)))
brep_2 = Brep(<brep referenced from the Rhino model>)
vec = Vector(line)
vec_2 = Vector(line_2)
area = Area(Geometry=brep)  # -> Area, Centroid
toggle = BooleanToggle(True)
unit = UnitVector(Vector=vec)
area_2 = Area(Geometry=brep_2)  # -> Area, Centroid
toggle_2 = BooleanToggle(True)
unit_2 = UnitVector(Vector=vec_2)
brep_3 = Brep([<brep referenced from the Rhino model> x3])
brep_4 = Brep([<brep referenced from the Rhino model> x2])
toggle_3 = BooleanToggle(True)
solaradjusttemperature = Ladybug_OutdoorSolarTemperatureAdjustor(
    location=importepw.location,
    cumSkyMtxOrDirNormRad=importepw.directNormalRadiation,
    diffuseHorizRad=importepw.diffuseHorizontalRadiation,
    baseTemperature=importepw.dryBulbTemperature,
    baseDryBulbOrMRT=Toggle(True),
    horizInfraredRad=importepw.horizontalInfraredRadiation,
    bodyLocation=area.Centroid,
    contextShading=brep_3,
    north=unit,
    analysisPeriodOrHOY=analysisperiod.analysisPeriod,
    parallel=toggle,
    runIt=toggle)  # -> readMe, port, effectiveRadiantField, MRTDelta, solarAdjustedMRT, port_2, mannequinMesh, port_3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; plug-in component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
solaradjusttemperature_2 = Ladybug_OutdoorSolarTemperatureAdjustor(
    location=importepw.location,
    cumSkyMtxOrDirNormRad=importepw.directNormalRadiation,
    diffuseHorizRad=importepw.diffuseHorizontalRadiation,
    baseTemperature=importepw.dryBulbTemperature,
    baseDryBulbOrMRT=Toggle(True),
    horizInfraredRad=importepw.horizontalInfraredRadiation,
    bodyLocation=area_2.Centroid,
    contextShading=brep_4,
    north=unit_2,
    analysisPeriodOrHOY=analysisperiod_2.analysisPeriod,
    parallel=toggle_2,
    runIt=toggle_2)  # -> readMe, port, effectiveRadiantField, MRTDelta, solarAdjustedMRT, port_2, mannequinMesh, port_3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; plug-in component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
solaradjusttemperature_3 = Ladybug_OutdoorSolarTemperatureAdjustor(
    location=importepw.location,
    cumSkyMtxOrDirNormRad=importepw.directNormalRadiation,
    diffuseHorizRad=importepw.diffuseHorizontalRadiation,
    baseTemperature=importepw.dryBulbTemperature,
    baseDryBulbOrMRT=Toggle(True),
    horizInfraredRad=importepw.horizontalInfraredRadiation,
    analysisPeriodOrHOY=analysisperiod_3.analysisPeriod,
    parallel=toggle_3,
    runIt=toggle_3)  # -> readMe, port, effectiveRadiantField, MRTDelta, solarAdjustedMRT, port_2, mannequinMesh, port_3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; plug-in component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
# With solar radiation effect
toggle_4 = BooleanToggle(True)
# Fully Shaded
outdoorcomfortcalculator = Ladybug_OutdoorComfortCalculator(
    dryBulbTemperature=importepw.dryBulbTemperature,
    windSpeed_tenMeters=importepw.windSpeed,
    relativeHumidity=importepw.relativeHumidity,
    runIt=toggle_4)  # -> readMe, port, universalThermalClimateIndex, comfortableOrNot, thermalStress, conditionOfPerson, port_2, percentOfTimeComfortable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; plug-in component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
outdoorcomfortcalculator_2 = Ladybug_OutdoorComfortCalculator(
    dryBulbTemperature=importepw.dryBulbTemperature,
    meanRadiantTemperature=solaradjusttemperature_3.solarAdjustedMRT,
    windSpeed_tenMeters=importepw.windSpeed,
    relativeHumidity=importepw.relativeHumidity,
    runIt=Toggle(True))  # -> readMe, port, universalThermalClimateIndex, comfortableOrNot, thermalStress, conditionOfPerson, port_2, percentOfTimeComfortable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; plug-in component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
# With solar radiation effect
# + Meyerson Hall building
outdoorcomfortcalculator_3 = Ladybug_OutdoorComfortCalculator(
    dryBulbTemperature=importepw.dryBulbTemperature,
    meanRadiantTemperature=solaradjusttemperature.solarAdjustedMRT,
    windSpeed_tenMeters=importepw.windSpeed,
    relativeHumidity=importepw.relativeHumidity,
    runIt=Toggle(True))  # -> readMe, port, universalThermalClimateIndex, comfortableOrNot, thermalStress, conditionOfPerson, port_2, percentOfTimeComfortable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; plug-in component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
# With solar radiation effect
# + Meyerson Hall building
outdoorcomfortcalculator_4 = Ladybug_OutdoorComfortCalculator(
    dryBulbTemperature=importepw.dryBulbTemperature,
    meanRadiantTemperature=solaradjusttemperature_2.solarAdjustedMRT,
    windSpeed_tenMeters=importepw.windSpeed,
    relativeHumidity=importepw.relativeHumidity,
    runIt=Toggle(True))  # -> readMe, port, universalThermalClimateIndex, comfortableOrNot, thermalStress, conditionOfPerson, port_2, percentOfTimeComfortable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; plug-in component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

panel_2 = Panel([outdoorcomfortcalculator.percentComfForShortPeriod, outdoorcomfortcalculator_2.percentComfForShortPeriod, outdoorcomfortcalculator_4.percentComfForShortPeriod, outdoorcomfortcalculator_3.percentComfForShortPeriod])
panel_3 = Panel([outdoorcomfortcalculator.percentHeatStress, outdoorcomfortcalculator_2.percentHeatStress, outdoorcomfortcalculator_4.percentHeatStress, outdoorcomfortcalculator_3.percentHeatStress])

legendpar = Ladybug_LegendParameters(numSegments="3")  # -> legendPar; plug-in component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
analysisperiod_4 = Ladybug_AnalysisPeriod()  # -> readMe, analysisPeriod; plug-in component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
analysisperiod_5 = Ladybug_AnalysisPeriod()  # -> readMe, analysisPeriod; plug-in component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
_3dchart = Ladybug_3DChart(
    inputData=flatten([outdoorcomfortcalculator.thermalStress, outdoorcomfortcalculator_2.thermalStress, outdoorcomfortcalculator_4.thermalStress, outdoorcomfortcalculator_3.thermalStress]),
    xScale="0.2",
    zScale="0",
    legendPar=legendpar)  # -> readMe, graphMesh, graphCurves, legend, legendBasePts, title, titleBasePts, dataPts, conditionalHOY; plug-in component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
sunpath = Ladybug_SunPath(
    north=unit,
    location=importepw.location,
    hour=12,
    day=21,
    month=12,
    timeStep=1,
    analysisPeriod=analysisperiod_4.analysisPeriod,
    centerPt=area.Centroid,
    sunPathScale=Slider(0.3, range=0..1),
    sunScale=Slider(0.5, range=0..1),
    annualHourlyData=flatten(outdoorcomfortcalculator_3.conditionOfPerson),
    legendPar=legendpar,
    dailyOrAnnualSunPath=True)  # -> readMe, sunVectors, sunAltitudes, sunAzimuths, port, sunSpheresMesh, sunPathCrvs, legend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; plug-in component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
sunpath_2 = Ladybug_SunPath(
    north=unit_2,
    location=importepw.location,
    hour=12,
    day=21,
    month=12,
    timeStep=1,
    analysisPeriod=analysisperiod_5.analysisPeriod,
    centerPt=area_2.Centroid,
    sunPathScale=Slider(0.3, range=0..1),
    sunScale=Slider(0.5, range=0..1),
    annualHourlyData=flatten(outdoorcomfortcalculator_4.conditionOfPerson),
    legendPar=legendpar,
    dailyOrAnnualSunPath=True)  # -> readMe, sunVectors, sunAltitudes, sunAzimuths, port, sunSpheresMesh, sunPathCrvs, legend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; plug-in component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
panel_4 = Panel(sunpath.sunAltitudes)
panel_5 = Panel(sunpath_2.sunAltitudes)
bnd = Bounds(Numbers=panel_4)
bnd_2 = Bounds(Numbers=panel_5)
panel_6 = Panel(bnd)
panel_7 = Panel(bnd_2)
