# Grasshopper definition Fan_Cao.gh (Grasshopper 0.9.76)
# plug-ins: Python Interpreter

ladybug = Ladybug_Ladybug()  # -> Vviiiiiiiiiizzz; plug-in component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
honeybee = Honeybee_Honeybee()  # -> Vviiiiiiiiiizzz; plug-in component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

# ---- group: geometry
box = DomainBox(Base=PlaneXY(0, 0, 0), X=Slider(4, range=0..10), Y=Slider(4.2, range=0..10), Z=Slider(3.2, range=0..10))
toggle = BooleanToggle(True)
mass2zone = Honeybee_Masses2Zones(zoneMasses=flatten(box), isConditioned=True, maxRoofAngle=30, createHBZones=toggle)  # -> readMe, HBZones; plug-in component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
panel = Panel("""0
0
0
.8""")
glazingcreator = Honeybee_GlazingBasedOnRatio(HBObjects=mass2zone.HBZones, glzRatio=panel, runIt=toggle)  # -> readMe, HBObjWGLZ; plug-in component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
wires = BrepWireframe(Brep=glazingcreator.HBObjWGLZ, Density=-1)
decomposebytype = Honeybee_DecomposeBasedOnType(HBZone=glazingcreator.HBObjWGLZ)  # -> walls, interiorWalls, airWalls, windows, interiorWindows, skylights, roofs, ceilings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; plug-in component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

# ----
panel_2 = Panel("https://www.energyplus.net/weather-download/north_and_central_america_wmo_region_4/USA/PA/USA_PA_Philadelphia.Intl.AP.724080_TMY3/all")
epw_stat = Ladybug_OpenEPWAndSTATWeatherFiles(weatherFileURL=panel_2)  # -> epwFile, statFile; plug-in component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
panel_3 = Panel("https://www.energyplus.net/weather-download/north_and_central_america_wmo_region_4/USA/PA/USA_PA_Philadelphia.Intl.AP.724080_TMY3/all")  # disabled
ladybug_2 = Ladybug_Ladybug()  # -> Vviiiiiiiiiizzz; disabled; plug-in component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
epw_stat_2 = Ladybug_OpenEPWAndSTATWeatherFiles(weatherFileURL=panel_3)  # -> epwFile, statFile; disabled; plug-in component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
panel_4 = Panel(epw_stat_2.epwFile)  # disabled
panel_5 = Panel(ladybug_2)  # disabled
importepw = Ladybug_ImportEpw(epwFile=epw_stat.epwFile)  # -> readMe, latitude, location, dryBulbTemperature, dewPointTemperature, relativeHumidity, windSpeed, windDirection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; plug-in component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
number_slider = Slider(8, range=8..17)
importepw_2 = Ladybug_ImportEpw(epwFile=epw_stat_2.epwFile)  # -> readMe, latitude, location, dryBulbTemperature, dewPointTemperature, relativeHumidity, windSpeed, windDirection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; disabled; plug-in component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
series = Series(Start="1", Step=1, Count="12")
importlocation = Ladybug_ImportLocation(epwFile=epw_stat.epwFile)  # -> location; plug-in component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
series_2 = Series(Start=0, Step=1, Count="24")
number_slider_2 = Slider(0, range=0..100)  # disabled
panel_6 = Panel("18 < a < 25 and 20 < b <60 and 2 < c < 10")  # disabled
legendpar = Ladybug_LegendParameters(
    lowBound="0",
    highBound="10",
    customColors=flatten([ColourSwatch(SwatchColor=RGB(255, 255, 255)), ColourSwatch(SwatchColor=RGB(0, 0, 0))]))  # -> legendPar; plug-in component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
panel_7 = Panel("0.1")  # disabled
panel_8 = Panel("18 < b < 25 and 40 < c <60 and 1 < a < 3")  # disabled
toggle_2 = BooleanToggle(True)  # disabled
_3dchart = Ladybug_3DChart(
    inputData=flatten([importepw_2.dryBulbTemperature, importepw_2.relativeHumidity, importepw_2.windSpeed, importepw_2.windDirection]),
    xScale=panel_7,
    zScale=number_slider_2)  # -> readMe, graphMesh, graphCurves, legend, legendBasePts, title, titleBasePts, dataPts, conditionalHOY; disabled; plug-in component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
sunpath = Ladybug_SunPath(
    location=importlocation,
    hour=series_2,
    day=21,
    month=series,
    timeStep=1,
    sunPathScale=Slider(0.06, range=0..0.1),
    annualHourlyData=flatten(importepw.totalSkyCover),
    conditionalStatement="a < 6",
    legendPar=legendpar,
    dailyOrAnnualSunPath=Toggle(True))  # -> readMe, sunVectors, sunAltitudes, sunAzimuths, port, sunSpheresMesh, sunPathCrvs, legend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; plug-in component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
windrose = Ladybug_WindRose(
    north=0,
    hourlyWindDirection=importepw_2.windDirection,
    hourlyWindSpeed=importepw_2.windSpeed,
    annualHourlyData=flatten([importepw_2.dryBulbTemperature, importepw_2.relativeHumidity]),
    conditionalStatement=panel_8,
    runIt=toggle_2)  # -> readMe, calmRoseMesh, windRoseMesh, windRoseCrvs, windRoseCenPts, legend, legendBasePts, title; disabled; plug-in component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
lng = ListLength(List=_3dchart.conditionalHOY)  # disabled
panel_9 = Panel(lng)  # disabled
crv = Curve(sunpath.sunPathCrvs)
multiplication = Multiplication(A=sunpath.sunVectors, B=2)
vdis = VectorDisplay(Anchor=sunpath.sunPositions, Vector=multiplication)
brep = Brep([decomposebytype.walls, decomposebytype.roofs, decomposebytype.groundFloors])
brep_2 = Brep(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)
mesh = MeshBrep(
    Brep=brep,
    Settings={GridMaxCount=0, GridMinCount=16, JaggedSeams=False, MaxEdgeLength=0, MinEdgeLength=0.0001, MinTolerance=0, Refine=True, RefineAngle=0, RelativeTolerance=0.65, SimplePlanes=True, Tolerance=0})
area = Area(Geometry=brep_2)  # -> Area, Centroid
mjoin = MeshJoin(Meshes=flatten(mesh))
rev = Reverse(Vector=sunpath.sunVectors)
meshray = MeshRay(Mesh=mjoin, Point=area.Centroid, Direction=rev)  # -> Point, Hit
dispatch = Dispatch(List=sunpath.sunPositions, DispatchPattern=meshray.Hit)  # -> ListA, ListB
lng_2 = ListLength(List=dispatch.ListB)
panel_10 = Panel(lng_2)
preview = CustomPreview(
    Geometry=dispatch.ListB,
    Shader={ambient=RGB(0, 0, 0), diffuse=RGB(255, 105, 180), emission=RGB(76, 32, 54), shine=0.5, specular=RGB(255, 255, 255), transparency=0})
