# Grasshopper definition Castro_Dyan.gh (Grasshopper 0.9.76)
# plug-ins: Python Interpreter

number_slider = Slider(0, range=0..2)
number_slider_2 = Slider(0, range=0..2)
ladybug = Ladybug_Ladybug()  # -> Vviiiiiiiiiizzz; plug-in component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
honeybee = Honeybee_Honeybee()  # -> Vviiiiiiiiiizzz; plug-in component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
# Animate sliders
button = Button()
hours = Panel("""9
12
15""")
months = Panel("""3
6
12""")
# Glass material
panel = Panel("tvis_60")
fly = Ladybug_fly(inputSliders=[number_slider_2, number_slider], fly=button)  # -> Vviiiiiiiiiizzz; plug-in component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
item = ListItem(List=hours, Index=number_slider, Wrap=True)
item_2 = ListItem(List=months, Index=number_slider_2, Wrap=True)
radglassmaterial = Honeybee_RadianceGlassMaterial(materialName=panel, RTransmittance="0.6", GTransmittance="0.6", BTransmittance="0.6", refractiveIndex=1.52)  # -> avrgTrans, RADMaterial; plug-in component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
panel_2 = Panel("""9
12
15""")
panel_3 = Panel("""3
6
12""")
path = FilePath("C:\Users\dycastro\Desktop\ARCH753\0926_Week2\Climate-Analysis_Philly\USA_PA_Philadelphia.Intl.AP.724080_TMY3\USA_PA_Philadelphia.Intl.AP.724080_TMY3.epw")
panel_4 = Panel(path)
# Prepare geometries
brep = Brep([<brep referenced from the Rhino model> x17])

# ---- group: glass
brep_2 = Brep(<brep referenced from the Rhino model>)

# ----
importlocation = Ladybug_ImportLocation(epwFile=path)  # -> location; plug-in component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
flip = Flip(Surface=brep_2)  # -> Surface, Result
# Generate sky
genclimatebasedsky = Honeybee_GenerateClimateBasedSky(weatherFile=path, month=item_2, day="21", hour=item)  # -> radiationValues, skyFilePath; plug-in component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
createhbsrfs = Honeybee_createHBSrfs(geometry=brep)  # -> readMe, simplify(flatten(HBSurface)); plug-in component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
createhbsrfs_2 = Honeybee_createHBSrfs(geometry=flip.Surface, RADMaterial=radglassmaterial.RADMaterial)  # -> readMe, simplify(HBSurface); plug-in component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
doy_hoy = Ladybug_DOY_HOY(days="21", months=item_2, hours=item)  # -> HOY, DOY, date; plug-in component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
sunpath = Ladybug_SunPath(
    location=importlocation,
    hour=panel_2,
    day=21,
    month=panel_3,
    timeStep=1,
    sunPathScale=Slider(0.2, range=0..1),
    dailyOrAnnualSunPath=True)  # -> readMe, sunVectors, sunAltitudes, sunAzimuths, port, sunSpheresMesh, sunPathCrvs, legend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; plug-in component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
brep_3 = Brep(flatten([createhbsrfs.HBSurface, createhbsrfs_2.HBSurface]))
preview = CustomPreview(Geometry=createhbsrfs_2.HBSurface, Shader=ColourSwatch(SwatchColor=RGBA(129, 150, 235, 11)))
item_3 = ListItem(List=brep, Index=Slider(13, range=0..16), Wrap=True)
preview_2 = CustomPreview(Geometry=createhbsrfs.HBSurface, Shader=ColourSwatch(SwatchColor=RGBA(217, 206, 206, 57)))
flip_2 = Flip(Surface=item_3)  # -> Surface, Result
gentestpts = Honeybee_GenerateTestPoints(testGeometry=flip_2.Surface, gridSize=Slider(0.5, range=0..1), distBaseSrf=Slider(0.762, range=0..1), moveTestMesh=True)  # -> readMe, simplify(testPoints), simplify(ptsVectors), simplify(facesArea), simplify(mesh); plug-in component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
# prepare a recipe
gridbasedsimulation = Honeybee_GridBasedSimulation(
    skyFile=genclimatebasedsky.skyFilePath,
    testPoints=gentestpts.testPoints,
    ptsVectors=gentestpts.ptsVectors,
    testMesh=gentestpts.mesh,
    simulationType=0)  # -> analysisRecipe; plug-in component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
toggle = BooleanToggle(True)
# run the analysis
rundaylightanalysis = Honeybee_RunDaylightSimulation(HBObjects=flatten(brep_3), analysisRecipe=gridbasedsimulation, writeRad=toggle, runRad=toggle, overwriteResults=True)  # -> readMe, analysisType, resultsUnit, illuminance_values, testPts, illuminance_files, radGeoFile, studyFolder, done; plug-in component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
panel_5 = Panel(doy_hoy.date)
legendpar = Ladybug_LegendParameters(lowBound="300", highBound="2000")  # -> legendPar; plug-in component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
# capture the viewport to an image
join = TextJoin(Text=[item_2, "21", item], Join="_")
# visualize the results
concat = Concatenate(FragmentA=rundaylightanalysis.analysisType, FragmentC=panel_5)
panel_6 = Panel(join)
recolormesh = Ladybug_RecolorMesh(
    analysisResult=rundaylightanalysis.illuminance_values,
    inputMesh=gentestpts.mesh,
    legendPar=legendpar,
    analysisTitle=concat,
    legendTitle=rundaylightanalysis.resultsUnit)  # -> readMe, newMesh, newLegend, legendBasePt, meshColors, legendColors; plug-in component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
captureview = Ladybug_CaptureView(fileName=panel_6, capture=Toggle(True))  # -> imagePath; plug-in component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
panel_7 = Panel(captureview)
