# Grasshopper definition Castro_Dyan.gh (Grasshopper 0.9.76)
# plug-ins: Python Interpreter

honeybee = Honeybee_Honeybee()  # -> Vviiiiiiiiiizzz; plug-in component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
ladybug = Ladybug_Ladybug()  # -> Vviiiiiiiiiizzz; plug-in component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
panel = Panel("https://www.energyplus.net/weather-download/north_and_central_america_wmo_region_4/USA/MI/USA_MI_Detroit.Metro.AP.725370_TMY3/all")
epw_stat = Ladybug_OpenEPWAndSTATWeatherFiles(weatherFileURL=panel)  # -> epwFile, statFile; plug-in component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
panel_2 = Panel(honeybee)
brep = Brep(<brep referenced from the Rhino model>)
# Glass material
panel_3 = Panel("tvis_60")
mass2zone = Honeybee_Masses2Zones(zoneMasses=flatten(brep), isConditioned=Toggle(False), maxRoofAngle=30, createHBZones=Toggle(True))  # -> readMe, HBZones; plug-in component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
radglassmaterial = Honeybee_RadianceGlassMaterial(materialName=panel_3, RTransmittance="0.6", GTransmittance="0.6", BTransmittance="0.6", refractiveIndex=1.52)  # -> avrgTrans, RADMaterial; plug-in component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
solveadjc = Honeybee_SolveAdjacencies(HBZones=flatten(mass2zone.HBZones), removeCurrentAdjc=False, findAdjc=Toggle(True))  # -> readMe, HBZonesWADJ; plug-in component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

# ---- group: BLINDS
add_blinds = BooleanToggle(True)
shading_depth = Slider(0.3, range=0..1)
number_of_blinds = Slider(4, range=0..10)

# ---- group: ROTATION
number_slider = Slider(45, range=-90..90)

# ----
run_energyplus = BooleanToggle(False)

# ---- group: WINDOW
brep_2 = Brep(<brep referenced from the Rhino model>)

# ----
addhbglz = Honeybee_addHBGlz(HBObj=solveadjc.HBZonesWADJ, childSurfaces=flatten(brep_2))  # -> HBObjWGLZ; plug-in component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
volume = Volume(Geometry=addhbglz)  # -> Volume, Centroid
decomposebytype = Honeybee_DecomposeBasedOnType(HBZone=addhbglz)  # -> walls, interiorWalls, airWalls, windows, interiorWindows, skylights, roofs, ceilings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; plug-in component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
rotatehbobj = Honeybee_RotateHoneybee(HBObj=addhbglz, angle=number_slider, cenPt=volume.Centroid)  # -> HBObj; plug-in component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
wires = BrepWireframe(Brep=rotatehbobj, Density=-1)
toggle = BooleanToggle(True)
preview = CustomPreview(Geometry=decomposebytype.walls, Shader=ColourSwatch(SwatchColor=RGBA(222, 58, 58, 130)))
preview_2 = CustomPreview(Geometry=decomposebytype.groundFloors, Shader=ColourSwatch(SwatchColor=RGBA(58, 194, 222, 130)))
preview_3 = CustomPreview(Geometry=decomposebytype.windows, Shader=ColourSwatch(SwatchColor=RGBA(162, 240, 250, 176)))
makeadiabaticbytype = Honeybee_MakeAdiabaticByType(HBZones=rotatehbobj, roofs=toggle, groundFloors=toggle)  # -> HBZones; plug-in component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
setepzoneschedules = Honeybee_SetEnergyPlusZoneSchedules(HBZones=makeadiabaticbytype)  # -> schedules, simplify(HBZones); plug-in component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
run_energyplus_2 = BooleanToggle(False)

shading_depth_2 = Slider(0.3, range=0..1)
number_of_blinds_2 = Slider(4, range=0..10)
add_blinds_2 = BooleanToggle(True)

list = ValueList({"Exterior Window [R1.0, SHGC 0.7]": "ASHRAE 90.1-2004 EXTWINDOW CLIMATEZONE ALT-WARE 1-8", "Exterior Window [R1.7, SHGC 0.39]": "ASHRAE 90.1-2004 EXTWINDOW CLIMATEZONE 4-6", "Exterior Window [R1.9, SHGC 0.39]": "ASHRAE 90.1-2004 EXTWINDOW CLIMATEZONE ALT-RES 4-6", "Exterior Window [R0.7, SHGC 0.65]": "Dbl LoE (e3=.1) Clr 3mm/13mm Arg"}, selected="Exterior Window [R1.9, SHGC 0.39]")
list_2 = ValueList({"Exterior Roof [R9.2]": "ASHRAE 90.1-2004 EXTROOF METAL CLIMATEZONE 3-4", "Exterior Roof [R14.8]": "ASHRAE 90.1-2004 EXTROOF IEAD CLIMATEZONE 1-4", "Exterior Roof [R34.4]": "ASHRAE 189.1-2009 EXTROOF IEAD CLIMATEZONE 7-8"}, selected="Exterior Roof [R34.4]")
# Construction
list_3 = ValueList({"Exterior Wall [R5.5]": "ASHRAE 90.1-2004 EXTWALL METAL CLIMATEZONE 4", "Exterior Wall [R5.8]": "ASHRAE 90.1-2004 EXTWALL MASS CLIMATEZONE 3-4", "Exterior Wall [R7.2]": "ASHRAE 90.1-2004 EXTWALL STEELFRAME CLIMATEZONE 1-4", "Exterior Wall [R8.7]": "ASHRAE 90.1-2004 EXTWALL MASS CLIMATEZONE ALT-RES 4", "Exterior Wall [R10.4]": "ASHRAE 90.1-2004 EXTWALL WOODFRAME CLIMATEZONE 1-7", "Exterior Wall [R14.8]": "ASHRAE 90.1-2004 EXTWALL STEELFRAME CLIMATEZONE ALT-RES 4-6", "Exterior Wall [R34.4]": "ASHRAE 189.1-2009 EXTROOF IEAD CLIMATEZONE 7-8"}, selected="Exterior Wall [R34.4]")

# ----
# Rotation Angle
# Blinds
number_slider_2 = Slider(45, range=0..1000)
# Thermal Mass
list_4 = ValueList({"Existing Slab Construction": "0", "+4 Inches Concrete": "1", "+8 Inches Concrete": "2"}, selected="Existing Slab Construction")

panel_4 = Panel("""Construction,
    Dbl LoE (e3=.1) Clr 3mm/13mm Arg,  !- Name
    CLEAR 3MM,               !- Outside Layer
    ARGON 13MM,              !- Layer 2
    LoE CLEAR 3MM Rev;       !- Layer 3""")
panel_5 = Panel("""WindowMaterial:Gas,
    ARGON 13MM,               !- Name
    Argon,                   !- Gas Type
    0.0127;                  !- Thickness {m}""")
panel_6 = Panel("""WindowMaterial:Glazing,
    LoE CLEAR 3MM Rev,       !- Name
    SpectralAverage,         !- Optical Data Type
    ,                        !- Window Glass Spectral Data Set Name
    0.003,                   !- Thickness {m}
    0.630,                   !- Solar Transmittance at Normal Incidence
    0.220,                   !- Front Side Solar Reflectance at Normal Incidence
    0.190,                   !- Back Side Solar Reflectance at Normal Incidence
    0.850,                   !- Visible Transmittance at Normal Incidence
    0.079,                   !- Front Side Visible Reflectance at Normal Incidence
    0.056,                   !- Back Side Visible Reflectance at Normal Incidence
    0.0,                     !- Infrared Transmittance at Normal Incidence
    0.10,                    !- Front Side Infrared Hemispherical Emissivity
    0.84,                    !- Back Side Infrared Hemispherical Emissivity
    0.9;                     !- Conductivity {W/m-K}""")
toggle_2 = BooleanToggle(True)
addtoeplibrary = Honeybee_AddToEnergyPlusLibrary(EPObject=[panel_4, panel_5, panel_6], addToProjectLib=toggle_2, overwrite=toggle_2)  # -> readMe; plug-in component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

# ---- group: CLIMATE ANALYSIS
importepw = Ladybug_ImportEpw(epwFile=epw_stat.epwFile)  # -> readMe, latitude, location, dryBulbTemperature, dewPointTemperature, relativeHumidity, windSpeed, windDirection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; plug-in component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
panel_7 = Panel("12")  # disabled

# ----
brep_3 = Brep(<brep referenced from the Rhino model>)
mass2zone_2 = Honeybee_Masses2Zones(zoneMasses=flatten(brep_3), isConditioned=Toggle(False), maxRoofAngle=30, createHBZones=Toggle(True))  # -> readMe, HBZones; plug-in component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

# ---- group: CLIMATE ANALYSIS / RADIATION ROSE
number_slider_3 = Slider(12, range=0..12)  # disabled
number_slider_4 = Slider(3, range=0..12)  # disabled
number_slider_5 = Slider(21, range=0..31)  # disabled
number_slider_6 = Slider(21, range=0..31)  # disabled
toggle_3 = BooleanToggle(False)  # disabled
toggle_4 = BooleanToggle(True)  # disabled
toggle_5 = BooleanToggle(False)  # disabled
gencumulativeskymtx = Ladybug_GenCumulativeSkyMtx(epwFile=epw_stat.epwFile, skyDensity=0, useOldRes=toggle_3, runIt=toggle_4)  # -> readMe, cumulativeSkyMtx; disabled; plug-in component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
analysisperiod = Ladybug_AnalysisPeriod(fromMonth=number_slider_3, fromDay=number_slider_5, toMonth=number_slider_4, toDay=number_slider_6)  # -> readMe, analysisPeriod; disabled; plug-in component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
selectskymtx = Ladybug_selectSkyMtx(
    cumulativeSkyMtx=gencumulativeskymtx.cumulativeSkyMtx,
    analysisPeriod=analysisperiod.analysisPeriod,
    removeDiffuse=False,
    removeDirect=False)  # -> readMe, selectedSkyMtx; disabled; plug-in component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
number_slider_7 = Slider(1000, range=0..1000)  # disabled
number_slider_8 = Slider(0, range=0..1000)  # disabled
swatch = ColourSwatch(SwatchColor=RGB(255, 0, 0))  # disabled
swatch_2 = ColourSwatch(SwatchColor=RGB(238, 255, 130))  # disabled
merge = Merge(Data1=swatch, Data2=swatch_2)  # disabled
legendpar = Ladybug_LegendParameters(lowBound=number_slider_8, highBound=number_slider_7, customColors=reverse(flatten(merge)))  # -> legendPar; disabled; plug-in component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
panel_8 = Panel("32")  # disabled
toggle_6 = BooleanToggle(True)  # disabled
toggle_7 = BooleanToggle(True)  # disabled
radiationrose = Ladybug_RadiationRose(
    selectedSkyMtx=selectskymtx.selectedSkyMtx,
    surfaceTiltAngle=panel_8,
    scale=panel_7,
    arrowHeadScale=1,
    legendPar=legendpar,
    showTotalOnly=toggle_6,
    bakeIt=toggle_5,
    runIt=toggle_7)  # -> readMe, radiationArrowsMesh, radRoseBaseCrvs, legend, legendBasePts, radRoseEndPts, radRoseValues; disabled; plug-in component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
number_slider_9 = Slider(1500, range=0..1000000)  # disabled
tag = TextTag3D(Location=radiationrose.radRoseEndPts, Text=radiationrose.radRoseValues, Size=number_slider_9, Justification=7)  # disabled

# ---- group: CLIMATE ANALYSIS / WINDROSE
number_slider_10 = Slider(9, range=1..12)  # disabled
number_slider_11 = Slider(21, range=1..31)  # disabled
number_slider_12 = Slider(12, range=1..12)  # disabled
number_slider_13 = Slider(21, range=1..31)  # disabled
number_slider_14 = Slider(15, range=0..20)  # disabled
swatch_3 = ColourSwatch(SwatchColor=RGB(255, 255, 128))  # disabled
swatch_4 = ColourSwatch(SwatchColor=RGB(12, 82, 0))  # disabled
merge_2 = Merge(Data1=swatch_3, Data2=swatch_4)  # disabled
legendpar_2 = Ladybug_LegendParameters(highBound=number_slider_14, customColors=flatten(merge_2))  # -> legendPar; disabled; plug-in component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
analysisperiod_2 = Ladybug_AnalysisPeriod(fromMonth=number_slider_10, fromDay=number_slider_11, toMonth=number_slider_12, toDay=number_slider_13)  # -> readMe, analysisPeriod; disabled; plug-in component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
toggle_8 = BooleanToggle(False)  # disabled
toggle_9 = BooleanToggle(True)  # disabled
windrose = Ladybug_WindRose(
    north=0,
    hourlyWindDirection=importepw.windDirection,
    hourlyWindSpeed=importepw.windSpeed,
    analysisPeriod=analysisperiod_2.analysisPeriod,
    legendPar=legendpar_2,
    bakeIt=toggle_8,
    runIt=toggle_9)  # -> readMe, calmRoseMesh, windRoseMesh, windRoseCrvs, windRoseCenPts, legend, legendBasePts, title; disabled; plug-in component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

# ---- group: CLIMATE ANALYSIS
cdd_hdd = Ladybug_CDD_HDD(hourlyDryBulbTemperature=importepw.dryBulbTemperature)  # -> readMe, daily_coolingDegDays, daily_heatingDegDays, monthly_coolingDegDays, monthly_heatingDegDays, annual_coolingDegDays, annual_heatingDegDays; plug-in component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
panel_9 = Panel(cdd_hdd.annual_coolingDegDays)

# ----
solveadjc_2 = Honeybee_SolveAdjacencies(HBZones=flatten(mass2zone_2.HBZones), removeCurrentAdjc=False, findAdjc=Toggle(True))  # -> readMe, HBZonesWADJ; plug-in component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
brep_4 = Brep(<brep referenced from the Rhino model>)
addhbglz_2 = Honeybee_addHBGlz(HBObj=solveadjc_2.HBZonesWADJ, childSurfaces=flatten(brep_4))  # -> HBObjWGLZ; plug-in component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

callfromepconstrlibrary = Honeybee_CallFromEPConstructionLibrary(keywords="floor")  # -> ThermMaterials, EPMaterials, EPWindowMaterials, EPConstructions; plug-in component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
item = ListItem(List=callfromepconstrlibrary.EPConstructions, Index=Slider(0, range=0..100), Wrap=True)
decomposeepconstruction = Honeybee_DecomposeEPConstruction(cnstrName=item)  # -> flatten(materials), comments, UValue_SI, UValue_IP, RValue_SI, RValue_IP; plug-in component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

callfromepconstrlibrary_2 = Honeybee_CallFromEPConstructionLibrary(keywords="slab")  # -> ThermMaterials, EPMaterials, EPWindowMaterials, EPConstructions; plug-in component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
item_2 = ListItem(List=callfromepconstrlibrary_2.EPConstructions, Index="2", Wrap=True)
decomposeepconstruction_2 = Honeybee_DecomposeEPConstruction(cnstrName=item_2)  # -> flatten(materials), comments, UValue_SI, UValue_IP, RValue_SI, RValue_IP; plug-in component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

wires_2 = BrepWireframe(Brep=addhbglz_2, Density=-1)

decomposebytype_2 = Honeybee_DecomposeBasedOnType(HBZone=rotatehbobj)  # -> walls, interiorWalls, airWalls, windows, interiorWindows, skylights, roofs, ceilings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; plug-in component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
shddesigner = Ladybug_ShadingDesigner(
    glzSrf=flatten(decomposebytype_2.windows),
    depthOrVector=flatten(shading_depth),
    numOfShds=number_of_blinds,
    runIt=add_blinds,
    port_4=False)  # -> readMe, shadingSrfs; plug-in component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
wires_3 = BrepWireframe(Brep=shddesigner.shadingSrfs, Density=-1)
hb_epcontextsrf = HoneybeeEPContextSurfaces(shdSurfaces=flatten(shddesigner.shadingSrfs))  # -> HBContext; inputs shdSurfaces: list of Brep, justBoundingBox: Boolean
# ---------- hb_epcontextsrf: Python ----------
"""
prepare shading/context geometries

    Args:
        northVectorOrRotation: A vector that shows North or a number that shows
                               the rotation of the North from the Y axis
        bldgMasses: List of closed Breps as thermal zones.
    Returns:
        report: ...
        thermalZones: Thermal zone's geometries for visualiza
"""

ghenv.Component.Name = 'Honeybee EP context Surfaces'
ghenv.Component.NickName = 'HB_EPContextSrf'
ghenv.Component.Message = 'VER 0.0.60\nNOV_04_2016'
ghenv.Component.IconDisplayMode = ghenv.Component.IconDisplayMode.application
ghenv.Component.Category = "Honeybee"
ghenv.Component.SubCategory = "10 | Energy | Energy"
#compatibleHBVersion = VER 0.0.57\nNOV_04_2016
#compatibleLBVersion = VER 0.0.59\nFEB_01_2015
ghenv.Component.AdditionalHelpFromDocStrings = "2"

import rhinoscriptsyntax as rs
import Rhino as rc
import scriptcontext as sc
import os
import System
import Grasshopper.Kernel as gh
import uuid

tolerance = sc.doc.ModelAbsoluteTolerance
import math


def main(shdSurfaces, EPTransSchedule, meshingSettings, justBoundingBox):
    
    # import the classes
    if sc.sticky.has_key('honeybee_release'):

        try:
            if not sc.sticky['honeybee_release'].isCompatible(ghenv.Component): return -1
            if sc.sticky['honeybee_release'].isInputMissing(ghenv.Component): return -1
        except:
            warning = "You need a newer version of Honeybee to use this compoent." + \
            " Use updateHoneybee component to update userObjects.\n" + \
            "If you have already updated userObjects drag Honeybee_Honeybee component " + \
            "into canvas and try again."
            w = gh.GH_RuntimeMessageLevel.Warning
            ghenv.Component.AddRuntimeMessage(w, warning)
            return -1
        
        # don't customize this part
        hb_EPSrf = sc.sticky["honeybee_EPSurface"]
        hb_EPSHDSurface = sc.sticky["honeybee_EPShdSurface"]
        hb_RADMaterialAUX = sc.sticky["honeybee_RADMaterialAUX"]
        hb_EPObjectsAux = sc.sticky["honeybee_EPObjectsAUX"]()
        HBScheduleList = sc.sticky["honeybee_ScheduleLib"].keys()

        ########################################################################
        #----------------------------------------------------------------------#
        shdBreps = []
        # create bounding box of shading geometries
        if justBoundingBox:
            for brep in shdSurfaces:
                if brep.Faces.Count>1 or not brep.Faces[0].IsPlanar(sc.doc.ModelAbsoluteTolerance):
                    shdBreps.append(brep.GetBoundingBox(True).ToBrep())
                else:
                    shdBreps.append(brep)
        else:
            shdBreps = shdSurfaces
        
        shadingClasses = []
        shadingMeshPreview = []
        
        if meshingSettings == None:
            mp = rc.Geometry.MeshingParameters.Minimal
            mp.SimplePlanes = True
        else:
            mp = meshingSettings
        
        def getRadMaterialName(radMaterial):
            nameStr = radMaterial.split(" ")[2]
            name =  nameStr.split("\n")[0]
            return name
        
        for brepCount, brep in enumerate(shdBreps):
            if brep != None:
                isPlanar = True
                # check planarity
                for face in brep.Faces:
                    if not face.IsPlanar(tolerance):
                        isPlanar = False
                        break
                
                shadingBreps = []
                if not isPlanar:
                    meshArray = rc.Geometry.Mesh.CreateFromBrep(brep, mp)
                    for mesh in meshArray:
                        for meshFace in range(mesh.Faces.Count):
                            vertices = list(mesh.Faces.GetFaceVertices(meshFace))[1:]
                            vertices = vertices + [sc.doc.ModelAbsoluteTolerance]
                            # create the brep from mesh
                            shdBrep = rc.Geometry.Brep.CreateFromCornerPoints(*vertices)
                            shadingBreps.append(shdBrep)
                else:
                    for face in brep.Faces:
                        shadingBreps.append(face.DuplicateFace(False))
                
                for faceCount, shdBrep in enumerate(shadingBreps):
                        thisShading = hb_EPSHDSurface(shdBrep, 1000*brepCount + faceCount, 'shdSrf_' + `brepCount` + '_' + `faceCount` + "_" + str(uuid.uuid4()))
                        
                        # add transmittance schedule if any
                        if EPTransSchedule!=None:
                            schedule= EPTransSchedule.upper()
                            if schedule!=None and not schedule.lower().endswith(".csv") and schedule not in HBScheduleList:
                                msg = "Cannot find " + schedule + " in Honeybee schedule library."
                                print msg
                                ghenv.Component.AddRuntimeMessage(gh.GH_RuntimeMessageLevel.Warning, msg)
                                return -1
                            elif schedule!=None and schedule.lower().endswith(".csv"):
                                # check if csv file is existed
                                if not os.path.isfile(schedule):
                                    msg = "Cannot find the shchedule file: " + schedule
                                    print msg
                                    ghenv.Component.AddRuntimeMessage(gh.GH_RuntimeMessageLevel.Warning, msg)
                                    return -1
                            
                            thisShading.TransmittanceSCH = schedule
                        
                        # add the Rad Material if any
                        if RADMaterial!=None:
                            # if it is just the name of the material make sure it is already defined
                            if len(RADMaterial.split(" ")) == 1:
                                # if the material is not in the library add it to the library
                                if not hb_RADMaterialAUX.isMatrialExistInLibrary(RADMaterial):
                                    warningMsg = "Can't find " + RADMaterial + " in RAD Material Library.\n" + \
                                                "Add the material to the library and try again."
                                    ghenv.Component.AddRuntimeMessage(gh.GH_RuntimeMessageLevel.Warning, warningMsg)
                                    return
                                
                                try:
                                    thisShading.setRADMaterial(RADMaterial)
                                except Exception, e:
                                    print e
                                    warningMsg = "You are using an old version of Honeybee_Honeybee! Update your files and try again."
                                    print warningMsg
                                    ghenv.Component.AddRuntimeMessage(gh.GH_RuntimeMessageLevel.Warning, warningMsg)
                                    return
                                
                                addedToLib = True
                            else:
                                
                                # try to add the material to the library
                                addedToLib, thisShading.RadMaterial = hb_RADMaterialAUX.analyseRadMaterials(RADMaterial, True)
                                
                            if addedToLib==False:
                                warningMsg = "Failed to add " + RADMaterial + " to the Library."
                                ghenv.Component.AddRuntimeMessage(gh.GH_RuntimeMessageLevel.Warning, warningMsg)
                                return
                        
                        # add shading to the list
                        shadingClasses.append(thisShading)
                
        # add to the hive
        hb_hive = sc.sticky["honeybee_Hive"]()
        HBContext  = hb_hive.addToHoneybeeHive(shadingClasses, ghenv.Component)
        return HBContext
        ################################################################################################
    else:
        print "You should first let Honeybee to fly..."
        w = gh.GH_RuntimeMessageLevel.Warning
        ghenv.Component.AddRuntimeMessage(w, "You should first let Honeybee to fly...")
        return -1
        

if _shdSurfaces and _shdSurfaces[0]!=None:
    # add cleaning function
    result= main(_shdSurfaces, EPTransSchedule_, meshingSettings_, justBoundingBox_)
    
    if result != -1: HBContext = result
# ---------- end hb_epcontextsrf ----------
preview_4 = CustomPreview(Geometry=wires_3, Shader=ColourSwatch(SwatchColor=RGBA(0, 0, 0, 194)))

number_slider_15 = Slider(1.5, range=0..5)  # disabled
volume_2 = Volume(Geometry=addhbglz_2)  # -> Volume, Centroid
decomposebytype_3 = Honeybee_DecomposeBasedOnType(HBZone=addhbglz_2)  # -> walls, interiorWalls, airWalls, windows, interiorWindows, skylights, roofs, ceilings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; plug-in component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
rotatehbobj_2 = Honeybee_RotateHoneybee(HBObj=addhbglz_2, angle=number_slider_2, cenPt=volume_2.Centroid)  # -> HBObj; plug-in component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
wires_4 = BrepWireframe(Brep=rotatehbobj_2, Density=-1)
preview_5 = CustomPreview(Geometry=decomposebytype_3.walls, Shader=ColourSwatch(SwatchColor=RGBA(222, 58, 58, 130)))
preview_6 = CustomPreview(Geometry=decomposebytype_3.groundFloors, Shader=ColourSwatch(SwatchColor=RGBA(58, 194, 222, 130)))
preview_7 = CustomPreview(Geometry=decomposebytype_3.windows, Shader=ColourSwatch(SwatchColor=RGBA(162, 240, 250, 176)))

panel_10 = Panel("""MAT-CC05 4 HW CONCRETE
MAT-CC05 8 HW CONCRETE""")
panel_11 = Panel(decomposeepconstruction.materials)
item_3 = ListItem(List=decomposeepconstruction.materials, Index=0, Wrap=True)  # -> Item, Item1
item_4 = ListItem(List=panel_10, Index=0, Wrap=True)  # -> Item, Item1
panel_12 = Panel(item)
epconstruction = Honeybee_EnergyPlusConstruction(name="floor_cnstr_2", layer_1=item_3.Item, layer_2=item_3.Item1, layer_3=item_4.Item1)  # -> EPConstruction; plug-in component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
epconstruction_2 = Honeybee_EnergyPlusConstruction(name="floor_cnstr_1", layer_1=item_3.Item, layer_2=item_3.Item1, layer_3=item_4.Item)  # -> EPConstruction; plug-in component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

# ---- group: CLIMATE ANALYSIS
toggle_10 = BooleanToggle(False)
pt = Point(<point referenced from the Rhino model>)

# ---- group: CLIMATE ANALYSIS / COMFORT
toggle_11 = BooleanToggle(True)  # disabled
outdoorcomfortcalculator = Ladybug_OutdoorComfortCalculator(
    dryBulbTemperature=importepw.dryBulbTemperature,
    windSpeed_tenMeters=importepw.windSpeed,
    relativeHumidity=importepw.relativeHumidity,
    runIt=toggle_11)  # -> readMe, port, universalThermalClimateIndex, comfortableOrNot, thermalStress, conditionOfPerson, port_2, percentOfTimeComfortable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; disabled; plug-in component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
swatch_5 = ColourSwatch(SwatchColor=RGB(112, 143, 255))  # disabled
swatch_6 = ColourSwatch(SwatchColor=RGB(242, 247, 92))  # disabled
swatch_7 = ColourSwatch(SwatchColor=RGB(224, 98, 81))  # disabled
panel_13 = Panel("5")  # disabled
col = Colour([swatch_7, swatch_6, swatch_5])  # disabled
legendpar_3 = Ladybug_LegendParameters(numSegments=panel_13, customColors=reverse(flatten(col)))  # -> legendPar; disabled; plug-in component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
panel_14 = Panel("100")  # disabled
panel_15 = Panel("-700")  # disabled
vec = VectorXYZ(XComponent=panel_14, YComponent=panel_15, ZComponent=0)  # -> Vector, Length; disabled
number_slider_16 = Slider(0.25, range=0..1)  # disabled
number_slider_17 = Slider(0, range=0..100)  # disabled
move = Move(Geometry=pt, Motion=vec.Vector)  # -> Geometry, Transform; disabled
_3dchart = Ladybug_3DChart(
    inputData=flatten(outdoorcomfortcalculator.conditionOfPerson),
    basePoint=move.Geometry,
    xScale=number_slider_16,
    zScale=number_slider_17,
    legendPar=legendpar_3,
    bakeIt=toggle_10)  # -> readMe, graphMesh, graphCurves, legend, legendBasePts, title, titleBasePts, dataPts, conditionalHOY; disabled; plug-in component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

# ---- group: CLIMATE ANALYSIS / HUMIDITY
swatch_8 = ColourSwatch(SwatchColor=RGB(255, 255, 255))  # disabled
swatch_9 = ColourSwatch(SwatchColor=RGB(33, 110, 110))  # disabled
panel_16 = Panel("0")  # disabled
col_2 = Colour([swatch_9, swatch_8])  # disabled
selectandaveragedata = Ladybug_AverageData(annualHourlyData=importepw.relativeHumidity)  # -> readMe, selHourlyData, averagedDaily, averagedMonthly, avrMonthlyPerHour, avrAnalysisPeriod; disabled; plug-in component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
legendpar_4 = Ladybug_LegendParameters(lowBound=panel_16, customColors=reverse(flatten(col_2)))  # -> legendPar; disabled; plug-in component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
panel_17 = Panel("100")  # disabled
panel_18 = Panel("-300")  # disabled
vec_2 = VectorXYZ(XComponent=panel_17, YComponent=panel_18, ZComponent=0)  # -> Vector, Length; disabled
number_slider_18 = Slider(0.25, range=0..1)  # disabled
number_slider_19 = Slider(0, range=0..100)  # disabled
move_2 = Move(Geometry=pt, Motion=vec_2.Vector)  # -> Geometry, Transform; disabled
_3dchart_2 = Ladybug_3DChart(
    inputData=flatten(selectandaveragedata.selHourlyData),
    basePoint=move_2.Geometry,
    xScale=number_slider_18,
    zScale=number_slider_19,
    legendPar=legendpar_4,
    bakeIt=toggle_10)  # -> readMe, graphMesh, graphCurves, legend, legendBasePts, title, titleBasePts, dataPts, conditionalHOY; disabled; plug-in component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

# ---- group: CLIMATE ANALYSIS / TEMPERATURE
number_slider_20 = Slider(20, range=0..100)  # disabled
swatch_10 = ColourSwatch(SwatchColor=RGB(112, 143, 255))  # disabled
swatch_11 = ColourSwatch(SwatchColor=RGB(242, 247, 92))  # disabled
swatch_12 = ColourSwatch(SwatchColor=RGB(224, 98, 81))  # disabled
number_slider_21 = Slider(45, range=0..100)  # disabled
neg = Negative(Value=number_slider_20)  # disabled
col_3 = Colour([swatch_10, swatch_11, swatch_12])  # disabled
selectandaveragedata_2 = Ladybug_AverageData(annualHourlyData=importepw.dryBulbTemperature)  # -> readMe, selHourlyData, averagedDaily, averagedMonthly, avrMonthlyPerHour, avrAnalysisPeriod; disabled; plug-in component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
legendpar_5 = Ladybug_LegendParameters(lowBound=neg, highBound=number_slider_21, customColors=flatten(col_3))  # -> legendPar; disabled; plug-in component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
panel_19 = Panel("100")  # disabled
panel_20 = Panel("100")  # disabled
vec_3 = VectorXYZ(XComponent=panel_19, YComponent=panel_20, ZComponent=0)  # -> Vector, Length; disabled
number_slider_22 = Slider(0.25, range=0..1)  # disabled
number_slider_23 = Slider(0, range=0..100)  # disabled
move_3 = Move(Geometry=pt, Motion=vec_3.Vector)  # -> Geometry, Transform; disabled
_3dchart_3 = Ladybug_3DChart(
    inputData=flatten(selectandaveragedata_2.selHourlyData),
    basePoint=move_3.Geometry,
    xScale=number_slider_22,
    zScale=number_slider_23,
    legendPar=[legendpar_5, legendpar_4],
    bakeIt=toggle_10)  # -> readMe, graphMesh, graphCurves, legend, legendBasePts, title, titleBasePts, dataPts, conditionalHOY; disabled; plug-in component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

# ---- group: CLIMATE ANALYSIS / CLOUD COVER
panel_21 = Panel("1")  # disabled
swatch_13 = ColourSwatch(SwatchColor=RGB(85, 73, 117))  # disabled
panel_22 = Panel("0")  # disabled
swatch_14 = ColourSwatch(SwatchColor=RGB(255, 240, 125))  # disabled
legendpar_6 = Ladybug_LegendParameters(lowBound=panel_22, highBound=panel_21, customColors=reverse([swatch_13, swatch_14]))  # -> legendPar; disabled; plug-in component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
panel_23 = Panel("100")  # disabled
panel_24 = Panel("-1100")  # disabled
vec_4 = VectorXYZ(XComponent=panel_23, YComponent=panel_24, ZComponent=0)  # -> Vector, Length; disabled
number_slider_24 = Slider(0, range=0..100)  # disabled
number_slider_25 = Slider(0.5, range=0..1)  # disabled
panel_25 = Panel("a < 6")  # disabled
move_4 = Move(Geometry=pt, Motion=vec_4.Vector)  # -> Geometry, Transform; disabled
_3dchart_4 = Ladybug_3DChart(
    inputData=flatten(importepw.totalSkyCover),
    basePoint=move_4.Geometry,
    xScale=number_slider_25,
    yScale=number_slider_15,
    zScale=number_slider_24,
    legendPar=legendpar_6,
    condStatement=panel_25,
    bakeIt=toggle_10)  # -> readMe, graphMesh, graphCurves, legend, legendBasePts, title, titleBasePts, dataPts, conditionalHOY; disabled; plug-in component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

# ----
captureview = Ladybug_CaptureView(fileName="annual_UDLI_more2000", viewNames="Iso", capture=Toggle(False))  # -> imagePath; plug-in component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
panel_26 = Panel(captureview)
# Construction
setepzonecnstr = Honeybee_SetEPZoneConstruction(HBZone=rotatehbobj_2, wallEPConstruction=list_3, windowEPConstruction=list, roofEPConstruction=list_2)  # -> simplify(modifiedHBZone); plug-in component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
filter = StreamFilter(Gate=list_4, Stream0=panel_12, Stream1=epconstruction_2, Stream2=epconstruction)

panel_27 = Panel("""Construction,
    Dbl LoE (e3=.1) Clr 3mm/13mm Arg,  !- Name
    CLEAR 3MM,               !- Outside Layer
    ARGON 13MM,              !- Layer 2
    LoE CLEAR 3MM Rev;       !- Layer 3""")
panel_28 = Panel("""WindowMaterial:Gas,
    ARGON 13MM,               !- Name
    Argon,                   !- Gas Type
    0.0127;                  !- Thickness {m}""")
panel_29 = Panel("""WindowMaterial:Glazing,
    LoE CLEAR 3MM Rev,       !- Name
    SpectralAverage,         !- Optical Data Type
    ,                        !- Window Glass Spectral Data Set Name
    0.003,                   !- Thickness {m}
    0.630,                   !- Solar Transmittance at Normal Incidence
    0.220,                   !- Front Side Solar Reflectance at Normal Incidence
    0.190,                   !- Back Side Solar Reflectance at Normal Incidence
    0.850,                   !- Visible Transmittance at Normal Incidence
    0.079,                   !- Front Side Visible Reflectance at Normal Incidence
    0.056,                   !- Back Side Visible Reflectance at Normal Incidence
    0.0,                     !- Infrared Transmittance at Normal Incidence
    0.10,                    !- Front Side Infrared Hemispherical Emissivity
    0.84,                    !- Back Side Infrared Hemispherical Emissivity
    0.9;                     !- Conductivity {W/m-K}""")
toggle_12 = BooleanToggle(True)
addtoeplibrary_2 = Honeybee_AddToEnergyPlusLibrary(EPObject=[panel_27, panel_28, panel_29], addToProjectLib=toggle_12, overwrite=toggle_12)  # -> readMe; plug-in component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

setepzoneundergroundcnstr = Honeybee_SetEPZoneUndergroundConstruction(HBZone=flatten(setepzonecnstr), groundFloorEPConstruction=filter)  # -> simplify(modifiedHBZone); plug-in component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

# ----
# infiltration rate
ach2m3_s_m2_calculator = HoneybeeInfORventPerAreaCalculator(HBZones=flatten(setepzoneundergroundcnstr), airChangeHour=Slider(8, range=0..10))  # -> out, infORventPerArea, allFloors; plug-in component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
setepzoneloads = Honeybee_SetEnergyPlusZoneLoads(HBZones=flatten(setepzoneundergroundcnstr))  # -> loads, HBZones; plug-in component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

decomposebytype_4 = Honeybee_DecomposeBasedOnType(HBZone=setepzoneundergroundcnstr)  # -> walls, interiorWalls, airWalls, windows, interiorWindows, skylights, roofs, ceilings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; plug-in component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
# Blinds
shddesigner_2 = Ladybug_ShadingDesigner(
    glzSrf=flatten(decomposebytype_4.windows),
    depthOrVector=flatten(shading_depth_2),
    numOfShds=number_of_blinds_2,
    runIt=add_blinds_2,
    port_4=False)  # -> readMe, shadingSrfs; plug-in component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
wires_5 = BrepWireframe(Brep=shddesigner_2.shadingSrfs, Density=-1)
hb_epcontextsrf_2 = HoneybeeEPContextSurfaces(shdSurfaces=flatten(shddesigner_2.shadingSrfs))  # -> HBContext; inputs shdSurfaces: list of Brep, justBoundingBox: Boolean
# ---------- hb_epcontextsrf_2: Python ----------
"""
prepare shading/context geometries

    Args:
        northVectorOrRotation: A vector that shows North or a number that shows
                               the rotation of the North from the Y axis
        bldgMasses: List of closed Breps as thermal zones.
    Returns:
        report: ...
        thermalZones: Thermal zone's geometries for visualiza
"""

ghenv.Component.Name = 'Honeybee EP context Surfaces'
ghenv.Component.NickName = 'HB_EPContextSrf'
ghenv.Component.Message = 'VER 0.0.59\nJAN_26_2016'
ghenv.Component.IconDisplayMode = ghenv.Component.IconDisplayMode.application
ghenv.Component.Category = "Honeybee"
ghenv.Component.SubCategory = "09 | Energy | Energy"
#compatibleHBVersion = VER 0.0.57\nNOV_01_2015
#compatibleLBVersion = VER 0.0.59\nFEB_01_2015
ghenv.Component.AdditionalHelpFromDocStrings = "2"

import rhinoscriptsyntax as rs
import Rhino as rc
import scriptcontext as sc
import os
import System
import Grasshopper.Kernel as gh
import uuid

tolerance = sc.doc.ModelAbsoluteTolerance
import math


def main(shdSurfaces, EPTransSchedule, meshingSettings, justBoundingBox):
    
    # import the classes
    if sc.sticky.has_key('honeybee_release'):

        try:
            if not sc.sticky['honeybee_release'].isCompatible(ghenv.Component): return -1
            if sc.sticky['honeybee_release'].isInputMissing(ghenv.Component): return -1
        except:
            warning = "You need a newer version of Honeybee to use this compoent." + \
            " Use updateHoneybee component to update userObjects.\n" + \
            "If you have already updated userObjects drag Honeybee_Honeybee component " + \
            "into canvas and try again."
            w = gh.GH_RuntimeMessageLevel.Warning
            ghenv.Component.AddRuntimeMessage(w, warning)
            return -1
        
        # don't customize this part
        hb_EPSrf = sc.sticky["honeybee_EPSurface"]
        hb_EPSHDSurface = sc.sticky["honeybee_EPShdSurface"]
        hb_RADMaterialAUX = sc.sticky["honeybee_RADMaterialAUX"]
        hb_EPObjectsAux = sc.sticky["honeybee_EPObjectsAUX"]()
        HBScheduleList = sc.sticky["honeybee_ScheduleLib"].keys()

        ########################################################################
        #----------------------------------------------------------------------#
        shdBreps = []
        # create bounding box of shading geometries
        if justBoundingBox:
            for brep in shdSurfaces:
                if brep.Faces.Count>1 or not brep.Faces[0].IsPlanar(sc.doc.ModelAbsoluteTolerance):
                    shdBreps.append(brep.GetBoundingBox(True).ToBrep())
                else:
                    shdBreps.append(brep)
        else:
            shdBreps = shdSurfaces
        
        shadingClasses = []
        shadingMeshPreview = []
        
        if meshingSettings == None:
            mp = rc.Geometry.MeshingParameters.Minimal
            mp.SimplePlanes = True
        else:
            mp = meshingSettings
        
        def getRadMaterialName(radMaterial):
            nameStr = radMaterial.split(" ")[2]
            name =  nameStr.split("\n")[0]
            return name
        
        for brepCount, brep in enumerate(shdBreps):
            if brep != None:
                isPlanar = True
                # check planarity
                for face in brep.Faces:
                    if not face.IsPlanar(tolerance):
                        isPlanar = False
                        break
                
                shadingBreps = []
                if not isPlanar:
                    meshArray = rc.Geometry.Mesh.CreateFromBrep(brep, mp)
                    for mesh in meshArray:
                        for meshFace in range(mesh.Faces.Count):
                            vertices = list(mesh.Faces.GetFaceVertices(meshFace))[1:]
                            vertices = vertices + [sc.doc.ModelAbsoluteTolerance]
                            # create the brep from mesh
                            shdBrep = rc.Geometry.Brep.CreateFromCornerPoints(*vertices)
                            shadingBreps.append(shdBrep)
                else:
                    for face in brep.Faces:
                        shadingBreps.append(face.DuplicateFace(False))
                
                for faceCount, shdBrep in enumerate(shadingBreps):
                        thisShading = hb_EPSHDSurface(shdBrep, 1000*brepCount + faceCount, 'shdSrf_' + `brepCount` + '_' + `faceCount` + "_" + str(uuid.uuid4()))
                        
                        # add transmittance schedule if any
                        if EPTransSchedule!=None:
                            schedule= EPTransSchedule.upper()
                            if schedule!=None and not schedule.lower().endswith(".csv") and schedule not in HBScheduleList:
                                msg = "Cannot find " + schedule + " in Honeybee schedule library."
                                print msg
                                ghenv.Component.AddRuntimeMessage(gh.GH_RuntimeMessageLevel.Warning, msg)
                                return -1
                            elif schedule!=None and schedule.lower().endswith(".csv"):
                                # check if csv file is existed
                                if not os.path.isfile(schedule):
                                    msg = "Cannot find the shchedule file: " + schedule
                                    print msg
                                    ghenv.Component.AddRuntimeMessage(gh.GH_RuntimeMessageLevel.Warning, msg)
                                    return -1
                            
                            thisShading.TransmittanceSCH = schedule
                        
                        # add the Rad Material if any
                        if RADMaterial!=None:
                            # if it is just the name of the material make sure it is already defined
                            if len(RADMaterial.split(" ")) == 1:
                                # if the material is not in the library add it to the library
                                if not hb_RADMaterialAUX.isMatrialExistInLibrary(RADMaterial):
                                    warningMsg = "Can't find " + RADMaterial + " in RAD Material Library.\n" + \
                                                "Add the material to the library and try again."
                                    ghenv.Component.AddRuntimeMessage(gh.GH_RuntimeMessageLevel.Warning, warningMsg)
                                    return
                                
                                try:
                                    thisShading.setRADMaterial(RADMaterial)
                                except Exception, e:
                                    print e
                                    warningMsg = "You are using an old version of Honeybee_Honeybee! Update your files and try again."
                                    print warningMsg
                                    ghenv.Component.AddRuntimeMessage(gh.GH_RuntimeMessageLevel.Warning, warningMsg)
                                    return
                                
                                addedToLib = True
                            else:
                                
                                # try to add the material to the library
                                addedToLib, thisShading.RadMaterial = hb_RADMaterialAUX.analyseRadMaterials(RADMaterial, True)
                                
                            if addedToLib==False:
                                warningMsg = "Failed to add " + RADMaterial + " to the Library."
                                ghenv.Component.AddRuntimeMessage(gh.GH_RuntimeMessageLevel.Warning, warningMsg)
                                return
                        
                        # add shading to the list
                        shadingClasses.append(thisShading)
                
        # add to the hive
        hb_hive = sc.sticky["honeybee_Hive"]()
        HBContext  = hb_hive.addToHoneybeeHive(shadingClasses, ghenv.Component.InstanceGuid.ToString())
        return HBContext
        ################################################################################################
    else:
        print "You should first let Honeybee to fly..."
        w = gh.GH_RuntimeMessageLevel.Warning
        ghenv.Component.AddRuntimeMessage(w, "You should first let Honeybee to fly...")
        return -1
        

if _shdSurfaces and _shdSurfaces[0]!=None:
    # add cleaning function
    result= main(_shdSurfaces, EPTransSchedule_, meshingSettings_, justBoundingBox_)
    
    if result != -1: HBContext = result
# ---------- end hb_epcontextsrf_2 ----------
preview_8 = CustomPreview(Geometry=wires_5, Shader=ColourSwatch(SwatchColor=RGBA(0, 0, 0, 194)))

panel_30 = Panel("0.01")
toggle_13 = BooleanToggle(True)
panel_31 = Panel("https://www.energyplus.net/weather-download/north_and_central_america_wmo_region_4/USA/MI/USA_MI_Detroit.Metro.AP.725370_TMY3/all")
epoutput = Honeybee_GenerateEPOutput(zoneGainsAndLosses=toggle_13, zoneComfortMetrics=toggle_13, surfaceTempAnalysis="False", surfaceEnergyAnalysis=toggle_13)  # -> report, flatten(simulationOutputs); plug-in component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
toggle_14 = BooleanToggle(True)
epw_stat_2 = Ladybug_OpenEPWAndSTATWeatherFiles(weatherFileURL=panel_31)  # -> epwFile, statFile; plug-in component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
rep = ReplaceText(Text="50_percent_glazing", Find=" ", Replace="_", RecursiveReplace=False)
epoutput_2 = Honeybee_GenerateEPOutput(zoneGainsAndLosses=toggle_14, zoneComfortMetrics=toggle_14, surfaceTempAnalysis="False", surfaceEnergyAnalysis=toggle_14)  # -> report, flatten(simulationOutputs); plug-in component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
rep_2 = ReplaceText(Text="50_percent_glazing", Find=" ", Replace="_", RecursiveReplace=False)
path = FilePath(epw_stat_2.epwFile)
runenergysimulation = Honeybee_RunEnergySimulation(
    epwFile=path,
    HBZones=flatten(setepzoneloads.HBZones),
    HBContext=flatten(hb_epcontextsrf_2),
    simulationOutputs=flatten(epoutput.simulationOutputs),
    writeIdf=run_energyplus_2,
    runEnergyPlus=run_energyplus_2,
    idfFileName=rep)  # -> report, idfFileAddress, resultFileAddress; plug-in component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
runenergysimulation_2 = Honeybee_RunEnergySimulation(
    epwFile=epw_stat.epwFile,
    HBZones=flatten(rotatehbobj),
    HBContext=flatten(hb_epcontextsrf),
    simulationOutputs=flatten(epoutput_2.simulationOutputs),
    writeIdf=run_energyplus,
    runEnergyPlus=run_energyplus,
    idfFileName=rep_2)  # -> report, idfFileAddress, resultFileAddress; plug-in component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
panel_32 = Panel(runenergysimulation.resultFileAddress)
legendpar_7 = Ladybug_LegendParameters(lowBound="-100", highBound="100")  # -> legendPar; plug-in component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
readepsrfresult = Honeybee_ReadEPSurfaceResult(resultFileAddress=runenergysimulation.resultFileAddress)  # -> surfaceIndoorTemp, surfaceOutdoorTemp, surfaceEnergyFlow, opaqueEnergyFlow, glazEnergyFlow, windowTotalSolarEnergy, windowBeamEnergy, windowDiffEnergy, windowTransmissivity, otherSurfaceData; plug-in component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
readepresult = Honeybee_ReadEPResult(resultFileAddress=runenergysimulation.resultFileAddress)  # -> totalThermalLoad, thermalLoadBalance, cooling, heating, electricLight, electricEquip, fanElectric, pumpElectric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; plug-in component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
importepw_2 = Ladybug_ImportEpw(epwFile=path)  # -> readMe, latitude, location, dryBulbTemperature, dewPointTemperature, relativeHumidity, windSpeed, windDirection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; plug-in component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
panel_33 = Panel(runenergysimulation_2.resultFileAddress)
legendpar_8 = Ladybug_LegendParameters(lowBound="-100", highBound="100")  # -> legendPar; plug-in component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
readepsrfresult_2 = Honeybee_ReadEPSurfaceResult(resultFileAddress=runenergysimulation_2.resultFileAddress)  # -> surfaceIndoorTemp, surfaceOutdoorTemp, surfaceEnergyFlow, opaqueEnergyFlow, glazEnergyFlow, windowTotalSolarEnergy, windowBeamEnergy, windowDiffEnergy, windowTransmissivity, otherSurfaceData; plug-in component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
readepresult_2 = Honeybee_ReadEPResult(resultFileAddress=runenergysimulation_2.resultFileAddress)  # -> totalThermalLoad, thermalLoadBalance, cooling, heating, electricLight, electricEquip, fanElectric, pumpElectric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; plug-in component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
importepw_3 = Ladybug_ImportEpw(epwFile=epw_stat.epwFile)  # -> readMe, latitude, location, dryBulbTemperature, dewPointTemperature, relativeHumidity, windSpeed, windDirection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; plug-in component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
colorsurfaces = Honeybee_ColorSurfacesByEPResult(
    srfData=readepsrfresult.surfaceEnergyFlow,
    HBZones=flatten(setepzoneloads.HBZones),
    legendPar=legendpar_7,
    runIt=Toggle(True))  # -> readMe, srfColoredMesh, zoneWireFrame, legend, legendBasePt, analysisTitle, srfBreps, srfColors, srfValues, normalizedSrfData; plug-in component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
gradientlibrary = Ladybug_GradientLibrary(gradIndex="1")  # -> customColors; plug-in component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
energybalance = Honeybee_ConstructEnergyBalance(
    HBZones=flatten(setepzoneloads.HBZones),
    peopleGains=readepresult.peopleGains,
    totalSolarGain=readepresult.totalSolarGain,
    infiltrationEnergy=readepresult.infiltrationEnergy,
    surfaceEnergyFlow=readepsrfresult.surfaceEnergyFlow)  # -> readMe, port, flrNormEnergyBal, flrNormBalWStorage, port_2, modelEnergyBalance, energyBalWithStorage; plug-in component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
adaptivecomfortcalculator = Ladybug_AdaptiveComfortCalculator(
    dryBulbTemperature=readepresult.airTemperature,
    meanRadiantTemperature=readepresult.meanRadTemperature,
    prevailingOutdoorTemp=importepw_2.dryBulbTemperature,
    runIt=Toggle(True))  # -> readMe, port, comfortableOrNot, conditionOfPerson, degreesFromTarget, port_2, targetTemperature, upperTemperatureBound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; plug-in component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
energybalance_2 = Honeybee_ConstructEnergyBalance(
    HBZones=flatten(rotatehbobj),
    peopleGains=readepresult_2.peopleGains,
    totalSolarGain=readepresult_2.totalSolarGain,
    infiltrationEnergy=readepresult_2.infiltrationEnergy,
    surfaceEnergyFlow=readepsrfresult_2.surfaceEnergyFlow)  # -> readMe, port, flrNormEnergyBal, flrNormBalWStorage, port_2, modelEnergyBalance, energyBalWithStorage; plug-in component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
gradientlibrary_2 = Ladybug_GradientLibrary(gradIndex="1")  # -> customColors; plug-in component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
rev = ReverseList(List=gradientlibrary)
adaptivecomfortcalculator_2 = Ladybug_AdaptiveComfortCalculator(
    dryBulbTemperature=readepresult_2.airTemperature,
    meanRadiantTemperature=readepresult_2.meanRadTemperature,
    prevailingOutdoorTemp=importepw_3.dryBulbTemperature,
    runIt=Toggle(True))  # -> readMe, port, comfortableOrNot, conditionOfPerson, degreesFromTarget, port_2, targetTemperature, upperTemperatureBound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; plug-in component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
legendpar_9 = Ladybug_LegendParameters(lowBound="-1", highBound="1", numSegments="3")  # -> legendPar; plug-in component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
legendpar_10 = Ladybug_LegendParameters(lowBound="-500", highBound="500", customColors=flatten(rev))  # -> legendPar; plug-in component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
selectandaveragedata_3 = Ladybug_AverageData(annualHourlyData=energybalance.modelEnergyBalance, totalOrAverage=Toggle(True))  # -> readMe, selHourlyData, totaledDaily, totaledMonthly, totMonthlyPerHour, totAnalysisPeriod; plug-in component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
rev_2 = ReverseList(List=gradientlibrary_2)
number_slider_26 = Slider(4, range=0..10)  # disabled
energyplus = BooleanToggle(False)
number_slider_27 = Slider(3, range=0..10)  # disabled
number_slider_28 = Slider(4, range=0..10)  # disabled
vec_5 = VectorXYZ(XComponent=0, YComponent="100", ZComponent=0)  # -> Vector, Length
vec_6 = VectorXYZ(XComponent=0, YComponent="35", ZComponent=0)  # -> Vector, Length
vec_7 = VectorXYZ(XComponent="20", YComponent="35", ZComponent=0)  # -> Vector, Length
legendpar_11 = Ladybug_LegendParameters(lowBound="-1", highBound="1", numSegments="3")  # -> legendPar; plug-in component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
legendpar_12 = Ladybug_LegendParameters(lowBound="-500", highBound="500", customColors=flatten(rev_2))  # -> legendPar; plug-in component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
pt_2 = Point(Point(23.10617158, 0, 0))
selectandaveragedata_4 = Ladybug_AverageData(annualHourlyData=energybalance_2.modelEnergyBalance, totalOrAverage=Toggle(True))  # -> readMe, selHourlyData, totaledDaily, totaledMonthly, totMonthlyPerHour, totAnalysisPeriod; plug-in component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
box = DomainBox(Base=PlaneXY(0, 0, 0), X=number_slider_27, Y=number_slider_28, Z=number_slider_26)  # disabled
move_5 = Move(Geometry=pt_2, Motion=vec_5.Vector)  # -> Geometry, Transform
move_6 = Move(Geometry=pt_2, Motion=vec_6.Vector)  # -> Geometry, Transform
vec_8 = VectorXYZ(XComponent=0, YComponent="120", ZComponent=0)  # -> Vector, Length
vec_9 = VectorXYZ(XComponent=0, YComponent="35", ZComponent=0)  # -> Vector, Length
move_7 = Move(Geometry=pt_2, Motion=vec_7.Vector)  # -> Geometry, Transform
vec_10 = VectorXYZ(XComponent="20", YComponent="35", ZComponent=0)  # -> Vector, Length
pt_3 = Point(Point(23.10617158, 0, 0))
panel_34 = Panel("-3191.97")
move_8 = Move(Geometry=pt_3, Motion=vec_8.Vector)  # -> Geometry, Transform
panel_35 = Panel("""Comfortable (%): 
hot (%):         
cold (%):        """)
comfortable_hot_cold = Panel([adaptivecomfortcalculator.percentOfTimeComfortable, adaptivecomfortcalculator.percentHotCold])
move_9 = Move(Geometry=pt_3, Motion=vec_9.Vector)  # -> Geometry, Transform
move_10 = Move(Geometry=pt_3, Motion=vec_10.Vector)  # -> Geometry, Transform
psychchart = Ladybug_PsychrometricChart(
    dryBulbTemperature=readepresult.airTemperature,
    relativeHumidity=readepresult.relativeHumidity,
    basePoint=move_7.Geometry,
    runIt=Toggle(True))  # -> readMe, port, totalComfortPercent, totalComfortOrNot, strategyNames, strategyPercentOfTime, strategyOrNot, port_2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; plug-in component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
_3dchart_5 = Ladybug_3DChart(
    inputData=flatten(adaptivecomfortcalculator.conditionOfPerson),
    basePoint=pt_2,
    xScale=".025",
    yScale="0.125",
    zScale=Slider(0, range=0..100),
    legendPar=legendpar_9)  # -> readMe, graphMesh, graphCurves, legend, legendBasePts, title, titleBasePts, dataPts, conditionalHOY; plug-in component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
glzparamlist = Honeybee_GlazingParametersList(
    northGlzParam=Slider(0, range=0..0.95),
    westGlzParam=Slider(0, range=0..0.95),
    southGlzParam=Slider(0.51, range=0..0.95),
    eastGlzParam=Slider(0, range=0..0.95))  # -> glzParamList; plug-in component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
mass2zone_3 = Honeybee_Masses2Zones(zoneMasses=flatten(box), isConditioned=Toggle(False), maxRoofAngle=30, createHBZones=Toggle(True))  # -> readMe, HBZones; plug-in component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
barchart = Ladybug_MonthlyBarChart(
    inputData=flatten(selectandaveragedata_3.totaledMonthly),
    stackValues=Toggle(True),
    basePoint=move_5.Geometry,
    xScale=Slider(0.75, range=0..1),
    legendPar=legendpar_10,
    bakeIt=Toggle(False))  # -> readMe, dataMesh, dataCurves, dataCrvColors, graphAxes, graphLabels, title, titleBasePt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; plug-in component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
num = Number(comfortable_hot_cold)

callfromepconstrlibrary_3 = Honeybee_CallFromEPConstructionLibrary(keywords="floor")  # -> ThermMaterials, EPMaterials, EPWindowMaterials, EPConstructions; plug-in component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
item_5 = ListItem(List=callfromepconstrlibrary_3.EPConstructions, Index=Slider(0, range=0..100), Wrap=True)
decomposeepconstruction_3 = Honeybee_DecomposeEPConstruction(cnstrName=item_5)  # -> flatten(materials), comments, UValue_SI, UValue_IP, RValue_SI, RValue_IP; plug-in component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

debrep = DeconstructBrep(Brep=box)  # -> Faces, Edges, Vertices
expression = Expression(x=num, Expression="Round(x, 2)")

callfromepconstrlibrary_4 = Honeybee_CallFromEPConstructionLibrary(keywords="slab")  # -> ThermMaterials, EPMaterials, EPWindowMaterials, EPConstructions; plug-in component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
item_6 = ListItem(List=callfromepconstrlibrary_4.EPConstructions, Index="2", Wrap=True)
decomposeepconstruction_4 = Honeybee_DecomposeEPConstruction(cnstrName=item_6)  # -> flatten(materials), comments, UValue_SI, UValue_IP, RValue_SI, RValue_IP; plug-in component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

flip = FlipMatrix(Data=panel_35)  # -> simplify(Data)
flip_2 = FlipMatrix(Data=expression)  # -> simplify(Data)
tag_2 = TextTag3D(Location=barchart.dataLabelPts, Text=barchart.dataMesh, Size=1, Justification=7)
pt_4 = Point(barchart.dataLabelPts)
glazingcreator = Honeybee_GlazingBasedOnRatio(HBObjects=mass2zone_3.HBZones, glzRatio=glzparamlist, breakUpDist=Toggle(True), runIt=Toggle(True))  # -> readMe, HBObjWGLZ; plug-in component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
item_7 = ListItem(List=debrep.Faces, Index=Slider(4, range=0..5), Wrap=True)
panel_37 = Panel([flip, flip_2])
toggle_15 = BooleanToggle(True)
flip_3 = Flip(Surface=item_7)  # -> Surface, Result
join = TextJoin(Text=panel_37)
gentestpts = Honeybee_GenerateTestPoints(testGeometry=flip_3.Surface, gridSize=Slider(0.4, range=0..1), distBaseSrf=Slider(0.41, range=0..1), moveTestMesh=True)  # -> readMe, simplify(testPoints), simplify(ptsVectors), simplify(facesArea), simplify(mesh); plug-in component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
wires_6 = BrepWireframe(Brep=glazingcreator.HBObjWGLZ, Density=-1)
pt_5 = Point(<point referenced from the Rhino model>)
join_2 = TextJoin(Text=flatten(join))
makeadiabaticbytype_2 = Honeybee_MakeAdiabaticByType(HBZones=glazingcreator.HBObjWGLZ, roofs=toggle_15, groundFloors=toggle_15)  # -> HBZones; plug-in component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
pt_6 = Point(Point(-17, 4, 0))
panel_38 = Panel("https://www.energyplus.net/weather-download/north_and_central_america_wmo_region_4/USA/PA/USA_PA_Philadelphia.Intl.AP.724080_TMY3/all")
vec_11 = VectorXYZ(XComponent="100", YComponent="100", ZComponent=0)  # -> Vector, Length
tag_3 = TextTag3D(Location=pt_6, Text=join_2, Size=1, Colour=ColourSwatch(SwatchColor=RGB(0, 0, 0)), Justification=5)

# ---- group: CONSTRUCTION
number_slider_29 = Slider(8, range=0..10)
list_5 = ValueList({"Exterior Window [R1.0, SHGC 0.7]": "ASHRAE 90.1-2004 EXTWINDOW CLIMATEZONE ALT-WARE 1-8", "Exterior Window [R1.7, SHGC 0.39]": "ASHRAE 90.1-2004 EXTWINDOW CLIMATEZONE 4-6", "Exterior Window [R1.9, SHGC 0.39]": "ASHRAE 90.1-2004 EXTWINDOW CLIMATEZONE ALT-RES 4-6", "Exterior Window [R0.7, SHGC 0.65]": "Dbl LoE (e3=.1) Clr 3mm/13mm Arg"}, selected="Exterior Window [R1.9, SHGC 0.39]")
list_6 = ValueList({"Exterior Roof [R9.2]": "ASHRAE 90.1-2004 EXTROOF METAL CLIMATEZONE 3-4", "Exterior Roof [R14.8]": "ASHRAE 90.1-2004 EXTROOF IEAD CLIMATEZONE 1-4", "Exterior Roof [R34.4]": "ASHRAE 189.1-2009 EXTROOF IEAD CLIMATEZONE 7-8"}, selected="Exterior Roof [R34.4]")
list_7 = ValueList({"Exterior Wall [R5.5]": "ASHRAE 90.1-2004 EXTWALL METAL CLIMATEZONE 4", "Exterior Wall [R5.8]": "ASHRAE 90.1-2004 EXTWALL MASS CLIMATEZONE 3-4", "Exterior Wall [R7.2]": "ASHRAE 90.1-2004 EXTWALL STEELFRAME CLIMATEZONE 1-4", "Exterior Wall [R8.7]": "ASHRAE 90.1-2004 EXTWALL MASS CLIMATEZONE ALT-RES 4", "Exterior Wall [R10.4]": "ASHRAE 90.1-2004 EXTWALL WOODFRAME CLIMATEZONE 1-7", "Exterior Wall [R14.8]": "ASHRAE 90.1-2004 EXTWALL STEELFRAME CLIMATEZONE ALT-RES 4-6", "Exterior Wall [R34.4]": "ASHRAE 189.1-2009 EXTROOF IEAD CLIMATEZONE 7-8"}, selected="Exterior Wall [R34.4]")

# ----
move_11 = Move(Geometry=pt_5, Motion=vec_11.Vector)  # -> Geometry, Transform

panel_39 = Panel("""MAT-CC05 4 HW CONCRETE
MAT-CC05 8 HW CONCRETE""")
panel_40 = Panel(decomposeepconstruction_3.materials)
item_8 = ListItem(List=decomposeepconstruction_3.materials, Index=0, Wrap=True)  # -> Item, Item1
item_9 = ListItem(List=panel_39, Index=0, Wrap=True)  # -> Item, Item1
panel_41 = Panel(item_5)
epconstruction_3 = Honeybee_EnergyPlusConstruction(name="floor_cnstr_2", layer_1=item_8.Item, layer_2=item_8.Item1, layer_3=item_9.Item1)  # -> EPConstruction; plug-in component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
epconstruction_4 = Honeybee_EnergyPlusConstruction(name="floor_cnstr_1", layer_1=item_8.Item, layer_2=item_8.Item1, layer_3=item_9.Item)  # -> EPConstruction; plug-in component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

epw_stat_3 = Ladybug_OpenEPWAndSTATWeatherFiles(weatherFileURL=panel_38)  # -> epwFile, statFile; plug-in component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
setepzoneschedules_2 = Honeybee_SetEnergyPlusZoneSchedules(HBZones=makeadiabaticbytype_2)  # -> schedules, simplify(HBZones); plug-in component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
genhbzonetestpts = Honeybee_GenerateZoneTestPoints(HBZone=makeadiabaticbytype_2, gridSize=Slider(0.3, range=0..1), distBaseSrf=Slider(0.41, range=0..1), moveTestMesh=True)  # -> readMe, simplify(testPoints), simplify(ptsVectors), simplify(facesArea), simplify(mesh); plug-in component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
comfortable_hot_cold_2 = Panel([adaptivecomfortcalculator_2.percentOfTimeComfortable, adaptivecomfortcalculator_2.percentHotCold])
panel_42 = Panel("""Comfortable (%): 
hot (%):         
cold (%):        """)
psychchart_2 = Ladybug_PsychrometricChart(
    dryBulbTemperature=readepresult_2.airTemperature,
    relativeHumidity=readepresult_2.relativeHumidity,
    basePoint=move_10.Geometry,
    runIt=Toggle(True))  # -> readMe, port, totalComfortPercent, totalComfortOrNot, strategyNames, strategyPercentOfTime, strategyOrNot, port_2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; plug-in component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
_3dchart_6 = Ladybug_3DChart(
    inputData=flatten(adaptivecomfortcalculator_2.conditionOfPerson),
    basePoint=pt_3,
    xScale=".025",
    yScale="0.125",
    zScale=Slider(0, range=0..100),
    legendPar=legendpar_11)  # -> readMe, graphMesh, graphCurves, legend, legendBasePts, title, titleBasePts, dataPts, conditionalHOY; plug-in component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
barchart_2 = Ladybug_MonthlyBarChart(
    inputData=flatten(selectandaveragedata_4.totaledMonthly),
    stackValues=Toggle(True),
    basePoint=move_8.Geometry,
    xScale=Slider(0.75, range=0..1),
    legendPar=legendpar_12)  # -> readMe, dataMesh, dataCurves, dataCrvColors, graphAxes, graphLabels, title, titleBasePt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; plug-in component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
num_2 = Number(comfortable_hot_cold_2)

# ---- group: THERMAL MASS
list_8 = ValueList({"Existing Slab Construction": "0", "+4 Inches Concrete": "1", "+8 Inches Concrete": "2"}, selected="Existing Slab Construction")

# ----
expression_2 = Expression(x=num_2, Expression="Round(x, 2)")
setepzonecnstr_2 = Honeybee_SetEPZoneConstruction(HBZone=rotatehbobj, wallEPConstruction=list_7, windowEPConstruction=list_5, roofEPConstruction=list_6)  # -> simplify(modifiedHBZone); plug-in component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
annualdaylightsimulation = Honeybee_AnnualDaylightSimulation(
    epwWeatherFile=epw_stat_3.epwFile,
    testPoints=genhbzonetestpts.testPoints,
    ptsVectors=genhbzonetestpts.ptsVectors,
    testMesh=genhbzonetestpts.mesh)  # -> analysisRecipe; plug-in component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
tag_4 = TextTag3D(Location=barchart_2.dataLabelPts, Text=barchart_2.dataMesh, Size=1, Justification=7)
setepnatvent = Honeybee_SetEPAirFlow(HBZones=setepzoneschedules_2.HBZones, naturalVentilationType=Slider(1, range=0..1))  # -> readMe, simplify(HBZones); plug-in component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
pt_7 = Point(barchart_2.dataLabelPts)
flip_4 = FlipMatrix(Data=panel_42)  # -> simplify(Data)
flip_5 = FlipMatrix(Data=expression_2)  # -> simplify(Data)
panel_43 = Panel([flip_4, flip_5])
filter_2 = StreamFilter(Gate=list_8, Stream0=panel_41, Stream1=epconstruction_4, Stream2=epconstruction_3)
toggle_16 = BooleanToggle(True)
toggle_17 = BooleanToggle(False)
epoutput_3 = Honeybee_GenerateEPOutput(zoneEnergyUse=toggle_16, zoneGainsAndLosses=toggle_16, zoneComfortMetrics=toggle_16, surfaceTempAnalysis="False")  # -> report, flatten(simulationOutputs); plug-in component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
join_3 = TextJoin(Text=panel_43)
join_4 = TextJoin(Text=flatten(join_3))
rundaylightanalysis = Honeybee_RunDaylightSimulation(
    HBObjects=flatten(makeadiabaticbytype_2),
    analysisRecipe=annualdaylightsimulation,
    writeRad=toggle_17,
    runRad=toggle_17,
    overwriteResults=True)  # -> readMe, analysisType, resultsUnit, results, testPts, resultFiles, radGeoFile, studyFolder, done; plug-in component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
item_10 = ListItem(List=rundaylightanalysis.testPts, Index="88", Wrap=True)
points = PointList(Points=rundaylightanalysis.testPts)
# extra, post class bonus tips:
# after getting annual daylight analysis results,
readdshourlyresults = Honeybee_ReadDSResultForAPoint(illFilesAddress=rundaylightanalysis.resultFiles, testPoints=rundaylightanalysis.testPts, targetPoint=item_10)  # -> annualIllumNoDynamicSHD, annualIllumDynamicSHDGroupI, annualIllumDynamicSHDGroupII, iIlluminanceBasedOnOccupancy; plug-in component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
occupancygenerator = Honeybee_DaysimOccupancyGenerator(weekendDays=[1, 2], writeTheOcc=Toggle(True))  # -> occupancyFile; plug-in component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
occupancygenerator_2 = Honeybee_DaysimOccupancyGeneratorBasedOnList()  # -> occupancyFile; plug-in component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
pt_8 = Point(Point(-17, 4, 0))
setepzoneundergroundcnstr_2 = Honeybee_SetEPZoneUndergroundConstruction(HBZone=flatten(setepzonecnstr_2), groundFloorEPConstruction=filter_2)  # -> simplify(modifiedHBZone); plug-in component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
tag_5 = TextTag3D(Location=pt_8, Text=join_4, Size=1, Colour=ColourSwatch(SwatchColor=RGB(0, 0, 0)), Justification=5)
legendpar_13 = Ladybug_LegendParameters(highBound="500")  # -> legendPar; plug-in component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
vec_12 = VectorXYZ(XComponent="100", YComponent="0", ZComponent=0)  # -> Vector, Length
importepw_4 = Ladybug_ImportEpw(epwFile=epw_stat_3.epwFile)  # -> readMe, latitude, location, dryBulbTemperature, dewPointTemperature, relativeHumidity, windSpeed, windDirection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; plug-in component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
runenergysimulation_3 = Honeybee_RunEnergySimulation(
    epwFile=epw_stat_3.epwFile,
    HBZones=flatten(setepnatvent.HBZones),
    simulationOutputs=flatten(epoutput_3.simulationOutputs),
    writeIdf=energyplus,
    runEnergyPlus=energyplus)  # -> report, idfFileAddress, resultFileAddress; plug-in component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
readannualresultsi = Honeybee_ReadAnnualResultI(
    illFilesAddress=rundaylightanalysis.resultFiles,
    testPoints=simplify(rundaylightanalysis.testPts),
    occupancyFiles=occupancygenerator,
    DLAIllumThresholds=300,
    runIt=Toggle(True))  # -> DLA, UDLI_Less_100, UDLI_100_2000, UDLI_More_2000, CDA, sDA, annualProfiles, htmReport; plug-in component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
readepresult_3 = Honeybee_ReadEPResult(resultFileAddress=runenergysimulation_3.resultFileAddress)  # -> totalThermalLoad, thermalLoadBalance, cooling, heating, electricLight, electricEquip, fanElectric, pumpElectric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; plug-in component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

ach2m3_s_m2_calculator_2 = HoneybeeInfORventPerAreaCalculator(HBZones=flatten(setepzoneundergroundcnstr_2), airChangeHour=number_slider_29)  # -> out, infORventPerArea, allFloors; plug-in component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
setepzoneloads_2 = Honeybee_SetEnergyPlusZoneLoads(HBZones=flatten(setepzoneundergroundcnstr_2))  # -> loads, HBZones; plug-in component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

colorsurfaces_2 = Honeybee_ColorSurfacesByEPResult(
    srfData=readepsrfresult_2.surfaceEnergyFlow,
    HBZones=flatten(setepzoneloads_2.HBZones),
    legendPar=legendpar_8,
    runIt=Toggle(True))  # -> readMe, srfColoredMesh, zoneWireFrame, legend, legendBasePt, analysisTitle, srfBreps, srfColors, srfValues, normalizedSrfData; plug-in component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
dsannualprofiles = Honeybee_DaysimAnnualProfiles(annualProfiles=readannualresultsi.annualProfiles)  # -> simplify(occupancyProfile), simplify(shadingProfiles), simplify(lightingControlProfiles), simplify(dgpProfile); plug-in component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
getepschedules = Honeybee_GetEnergyPlusSchedules()  # -> occupancySchedule, occupancyActivitySch, heatingSetPtSchedule, coolingSetPtSchedule, lightingSchedule, equipmentSchedule, infiltrationSchedule; plug-in component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
recolormesh = Ladybug_RecolorMesh(analysisResult=readannualresultsi.UDLI_100_2000, inputMesh=genhbzonetestpts.mesh)  # -> readMe, newMesh, newLegend, legendBasePt, meshColors, legendColors; plug-in component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
num_3 = Number(readepresult_3.electricLight)
ma = MassAddition(Input=num_3)  # -> Result, PartialResults
convertepschvalues = Honeybee_ConvertEnergyPlusScheduleToValues(schName=getepschedules.lightingSchedule)  # -> values; plug-in component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
cullf = CullFaces(Mesh=recolormesh.newMesh, Pattern=recolormesh.newMesh)
panel_44 = Panel(ma.Result)
adaptivecomfortcalculator_3 = Ladybug_AdaptiveComfortCalculator(
    dryBulbTemperature=readepresult_3.airTemperature,
    meanRadiantTemperature=readepresult_3.meanRadTemperature,
    prevailingOutdoorTemp=importepw_4.dryBulbTemperature,
    runIt=Toggle(True))  # -> readMe, port, comfortableOrNot, conditionOfPerson, degreesFromTarget, port_2, targetTemperature, upperTemperatureBound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; plug-in component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
larger = LargerThan(FirstNumber=cullf, SecondNumber=60)  # -> LargerThan, OrEqualTo
vec_13 = VectorXYZ(XComponent="100", YComponent="900", ZComponent=0)  # -> Vector, Length
panel_45 = Panel(convertepschvalues)
pt_9 = Point(<point referenced from the Rhino model>)
move_12 = Move(Geometry=pt_9, Motion=vec_12.Vector)  # -> Geometry, Transform
_3dchart_7 = Ladybug_3DChart(
    inputData=flatten(readdshourlyresults.annualIllumNoDynamicSHD),
    basePoint=move_12.Geometry,
    xScale=Slider(0.25, range=0..1),
    zScale=Slider(0, range=0..100),
    legendPar=legendpar_13)  # -> readMe, graphMesh, graphCurves, legend, legendBasePts, title, titleBasePts, dataPts, conditionalHOY; plug-in component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
dispatch = Dispatch(List=larger.LargerThan, DispatchPattern=larger.LargerThan)  # -> ListA, ListB
move_13 = Move(Geometry=pt_9, Motion=vec_13.Vector)  # -> Geometry, Transform
pt_10 = Point(dispatch.ListA)
vec_14 = VectorXYZ(XComponent="100", YComponent="100", ZComponent=0)  # -> Vector, Length
_3dchart_8 = Ladybug_3DChart(
    inputData=flatten([dsannualprofiles.lightingControlProfiles, dsannualprofiles.occupancyProfile]),
    basePoint=move_13.Geometry,
    xScale=Slider(0.25, range=0..1),
    zScale=Slider(0, range=0..100))  # -> readMe, graphMesh, graphCurves, legend, legendBasePts, title, titleBasePts, dataPts, conditionalHOY; plug-in component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
data = Data(["key:location/dataType/units/frequency/startsAt/endsAt", "Philadelphia International Ap PA USA TMY3 ", "Adaptive Comfort for ZONE_0", "-1 = Cold, 0 = Comfortable, 1 = Hot", "Hourly", "Grasshopper.Kernel.Types.GH_ObjectWrapper"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])
move_14 = Move(Geometry=pt_9, Motion=vec_14.Vector)  # -> Geometry, Transform
legendpar_14 = Ladybug_LegendParameters(numSegments="3")  # -> legendPar; plug-in component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
_3dchart_9 = Ladybug_3DChart(
    inputData=flatten([data, adaptivecomfortcalculator_3.conditionOfPerson, importepw_4.dryBulbTemperature]),
    basePoint=move_14.Geometry,
    xScale=Slider(0.25, range=0..1),
    zScale=Slider(0, range=0..100),
    legendPar=legendpar_14)  # -> readMe, graphMesh, graphCurves, legend, legendBasePts, title, titleBasePts, dataPts, conditionalHOY; plug-in component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

# ---- group: DAYLIGHTING 1
# capture the viewport to an image
number_slider_30 = Slider(0, range=0..2)
number_slider_31 = Slider(0, range=0..2)
hours = Panel("""9
12
15""")
months = Panel("""3
6
12""")
fly = Ladybug_fly(inputSliders=[number_slider_30, number_slider_31], fly=Button())  # -> Vviiiiiiiiiizzz; plug-in component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
item_11 = ListItem(List=hours, Index=number_slider_31, Wrap=True)
item_12 = ListItem(List=months, Index=number_slider_30, Wrap=True)
panel_46 = Panel("""9
12
15""")
panel_47 = Panel("""3
6
12""")
path_2 = FilePath(epw_stat.epwFile)
importlocation = Ladybug_ImportLocation(epwFile=path_2)  # -> location; plug-in component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
genclimatebasedsky = Honeybee_GenerateClimateBasedSky(weatherFile=path_2, month=item_12, day="21", hour=item_11)  # -> radiationValues, skyFilePath; plug-in component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
doy_hoy = Ladybug_DOY_HOY(days="21", months=item_12, hours=item_11)  # -> HOY, DOY, date; plug-in component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
sunpath = Ladybug_SunPath(
    location=importlocation,
    hour=panel_46,
    day=21,
    month=panel_47,
    timeStep=1,
    sunPathScale=Slider(0.2, range=0..1),
    dailyOrAnnualSunPath=True)  # -> readMe, sunVectors, sunAltitudes, sunAzimuths, port, sunSpheresMesh, sunPathCrvs, legend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; plug-in component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
debrep_2 = DeconstructBrep(Brep=brep)  # -> Faces, Edges, Vertices
item_13 = ListItem(List=debrep_2.Faces, Index=Slider(1, range=0..6), Wrap=True)
flip_6 = Flip(Surface=item_13)  # -> Surface, Result
gentestpts_2 = Honeybee_GenerateTestPoints(testGeometry=flip_6.Surface, gridSize=Slider(0.2, range=0..1), distBaseSrf=Slider(0.762, range=0..1), moveTestMesh=True)  # -> readMe, simplify(testPoints), simplify(ptsVectors), simplify(facesArea), simplify(mesh); plug-in component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
gridbasedsimulation = Honeybee_GridBasedSimulation(
    skyFile=genclimatebasedsky.skyFilePath,
    testPoints=gentestpts_2.testPoints,
    ptsVectors=gentestpts_2.ptsVectors,
    testMesh=gentestpts_2.mesh,
    simulationType=0)  # -> analysisRecipe; plug-in component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
toggle_18 = BooleanToggle(False)
join_5 = TextJoin(Text=[item_12, "21", item_11], Join="_")
legendpar_15 = Ladybug_LegendParameters(lowBound="300", highBound="2000")  # -> legendPar; plug-in component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
panel_48 = Panel(join_5)
panel_49 = Panel(doy_hoy.date)
captureview_2 = Ladybug_CaptureView(fileName=panel_48, viewNames="Parallel", capture=Toggle(True))  # -> imagePath; plug-in component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
panel_50 = Panel(captureview_2)

# ---- group: ANNUAL DAYLIGHT
genhbzonetestpts_2 = Honeybee_GenerateZoneTestPoints(HBZone=rotatehbobj, gridSize=Slider(0.2, range=0..1), distBaseSrf=Slider(0.76, range=0..1), moveTestMesh=True)  # -> readMe, simplify(testPoints), simplify(ptsVectors), simplify(facesArea), simplify(mesh); plug-in component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
annualdaylightsimulation_2 = Honeybee_AnnualDaylightSimulation(
    epwWeatherFile=path_2,
    testPoints=genhbzonetestpts_2.testPoints,
    ptsVectors=genhbzonetestpts_2.ptsVectors,
    testMesh=genhbzonetestpts_2.mesh)  # -> analysisRecipe; plug-in component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
toggle_19 = BooleanToggle(True)
occupancygenerator_3 = Honeybee_DaysimOccupancyGenerator(weekendDays=[1, 2], writeTheOcc=Toggle(True))  # -> occupancyFile; plug-in component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
rundaylightanalysis_2 = Honeybee_RunDaylightSimulation(
    HBObjects=flatten(addhbglz),
    analysisRecipe=annualdaylightsimulation_2,
    writeRad=toggle_19,
    runRad=toggle_19,
    overwriteResults=True)  # -> readMe, analysisType, resultsUnit, results, testPts, annual_analysis_files, radGeoFile, studyFolder, done; plug-in component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
readannualresultsi_2 = Honeybee_ReadAnnualResultI(
    illFilesAddress=rundaylightanalysis_2.annual_analysis_files,
    testPoints=simplify(rundaylightanalysis_2.testPts),
    occupancyFiles=occupancygenerator_3,
    DLAIllumThresholds=300,
    runIt=Toggle(True))  # -> DLA, UDLI_Less_100, UDLI_100_2000, UDLI_More_2000, CDA, sDA, annualProfiles, htmReport; plug-in component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
concat = Concatenate(FragmentA=rundaylightanalysis_2.analysisType, FragmentB="UDI < 2000")
recolormesh_2 = Ladybug_RecolorMesh(
    analysisResult=readannualresultsi_2.UDLI_More_2000,
    inputMesh=genhbzonetestpts_2.mesh,
    analysisTitle=concat,
    legendTitle=rundaylightanalysis_2.resultsUnit)  # -> readMe, newMesh, newLegend, legendBasePt, meshColors, legendColors; plug-in component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

# ----
rundaylightanalysis_3 = Honeybee_RunDaylightSimulation(
    HBObjects=flatten(addhbglz),
    analysisRecipe=gridbasedsimulation,
    writeRad=toggle_18,
    runRad=toggle_18,
    overwriteResults=True)  # -> readMe, analysisType, resultsUnit, results, testPts, resultFiles, radGeoFile, studyFolder, done; plug-in component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

# ---- group: DAYLIGHTING 1 (continued)
concat_2 = Concatenate(FragmentA=rundaylightanalysis_3.analysisType, FragmentC=panel_49)
recolormesh_3 = Ladybug_RecolorMesh(
    analysisResult=rundaylightanalysis_3.results,
    inputMesh=genhbzonetestpts_2.mesh,
    legendPar=legendpar_15,
    analysisTitle=concat_2,
    legendTitle=rundaylightanalysis_3.resultsUnit)  # -> readMe, newMesh, newLegend, legendBasePt, meshColors, legendColors; plug-in component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
