# Grasshopper definition Castro_Dyan.gh (Grasshopper 0.9.76)
# plug-ins: Python Interpreter

panel = Panel("https://www.energyplus.net/weather-download/north_and_central_america_wmo_region_4/USA/PA/USA_PA_Philadelphia.Intl.AP.724080_TMY3/all")
ladybug = Ladybug_Ladybug()  # -> Vviiiiiiiiiizzz; plug-in component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
epw_stat = Ladybug_OpenEPWAndSTATWeatherFiles(weatherFileURL=panel)  # -> epwFile, statFile; plug-in component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
importepw = Ladybug_ImportEpw(epwFile=epw_stat.epwFile)  # -> readMe, latitude, location, dryBulbTemperature, dewPointTemperature, relativeHumidity, windSpeed, windDirection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; plug-in component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
analysisperiod = Ladybug_AnalysisPeriod()  # -> readMe, analysisPeriod; plug-in component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
analysisperiod_2 = Ladybug_AnalysisPeriod()  # -> readMe, analysisPeriod; plug-in component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
line = Line(Line((-102.3446363, 324.5902896, -257.2096947), (-101.9729119, 327.617742, -257.2096947)))
brep = Brep(<brep referenced from the Rhino model>)
analysisperiod_3 = Ladybug_AnalysisPeriod()  # -> readMe, analysisPeriod; plug-in component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
vec = Vector(line)
line_2 = Line(Line((-102.3446363, 324.5902896, -257.2096947), (-101.9729119, 327.617742, -257.2096947)))
brep_2 = Brep(<brep referenced from the Rhino model>)
unit = UnitVector(Vector=vec)
toggle = BooleanToggle(True)
vec_2 = Vector(line_2)
area = Area(Geometry=brep)  # -> Area, Centroid
toggle_2 = BooleanToggle(True)
brep_3 = Brep([<brep referenced from the Rhino model> x2])
unit_2 = UnitVector(Vector=vec_2)
toggle_3 = BooleanToggle(True)
area_2 = Area(Geometry=brep_2)  # -> Area, Centroid
brep_4 = Brep([<brep referenced from the Rhino model> x3])
solaradjusttemperature = Ladybug_OutdoorSolarTemperatureAdjustor(
    location=importepw.location,
    cumSkyMtxOrDirNormRad=importepw.directNormalRadiation,
    diffuseHorizRad=importepw.diffuseHorizontalRadiation,
    baseTemperature=importepw.dryBulbTemperature,
    baseDryBulbOrMRT=Toggle(True),
    horizInfraredRad=importepw.horizontalInfraredRadiation,
    bodyLocation=area.Centroid,
    contextShading=brep_3,
    north=unit,
    analysisPeriodOrHOY=analysisperiod.analysisPeriod,
    parallel=toggle,
    runIt=toggle)  # -> readMe, port, effectiveRadiantField, MRTDelta, solarAdjustedMRT, port_2, mannequinMesh, port_3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; plug-in component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
solaradjusttemperature_2 = Ladybug_OutdoorSolarTemperatureAdjustor(
    location=importepw.location,
    cumSkyMtxOrDirNormRad=importepw.directNormalRadiation,
    diffuseHorizRad=importepw.diffuseHorizontalRadiation,
    baseTemperature=importepw.dryBulbTemperature,
    baseDryBulbOrMRT=Toggle(True),
    horizInfraredRad=importepw.horizontalInfraredRadiation,
    analysisPeriodOrHOY=analysisperiod_2.analysisPeriod,
    parallel=toggle_2,
    runIt=toggle_2)  # -> readMe, port, effectiveRadiantField, MRTDelta, solarAdjustedMRT, port_2, mannequinMesh, port_3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; plug-in component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
solaradjusttemperature_3 = Ladybug_OutdoorSolarTemperatureAdjustor(
    location=importepw.location,
    cumSkyMtxOrDirNormRad=importepw.directNormalRadiation,
    diffuseHorizRad=importepw.diffuseHorizontalRadiation,
    baseTemperature=importepw.dryBulbTemperature,
    baseDryBulbOrMRT=Toggle(True),
    horizInfraredRad=importepw.horizontalInfraredRadiation,
    bodyLocation=area_2.Centroid,
    contextShading=brep_4,
    north=unit_2,
    analysisPeriodOrHOY=analysisperiod_3.analysisPeriod,
    parallel=toggle_3,
    runIt=toggle_3)  # -> readMe, port, effectiveRadiantField, MRTDelta, solarAdjustedMRT, port_2, mannequinMesh, port_3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; plug-in component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
# With solar radiation effect
toggle_4 = BooleanToggle(True)
# With solar radiation effect
# + Meyerson Hall building
toggle_5 = BooleanToggle(True)
toggle_6 = BooleanToggle(False)  # disabled
# Fully Shaded
outdoorcomfortcalculator = Ladybug_OutdoorComfortCalculator(
    dryBulbTemperature=importepw.dryBulbTemperature,
    windSpeed_tenMeters=importepw.windSpeed,
    relativeHumidity=importepw.relativeHumidity,
    runIt=toggle_4)  # -> readMe, port, universalThermalClimateIndex, comfortableOrNot, thermalStress, conditionOfPerson, port_2, percentOfTimeComfortable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; plug-in component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
outdoorcomfortcalculator_2 = Ladybug_OutdoorComfortCalculator(
    dryBulbTemperature=importepw.dryBulbTemperature,
    meanRadiantTemperature=solaradjusttemperature_2.solarAdjustedMRT,
    windSpeed_tenMeters=importepw.windSpeed,
    relativeHumidity=importepw.relativeHumidity,
    runIt=Toggle(True))  # -> readMe, port, universalThermalClimateIndex, comfortableOrNot, thermalStress, conditionOfPerson, port_2, percentOfTimeComfortable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; plug-in component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
outdoorcomfortcalculator_3 = Ladybug_OutdoorComfortCalculator(
    dryBulbTemperature=importepw.dryBulbTemperature,
    meanRadiantTemperature=solaradjusttemperature.solarAdjustedMRT,
    windSpeed_tenMeters=importepw.windSpeed,
    relativeHumidity=importepw.relativeHumidity,
    runIt=toggle_5)  # -> readMe, port, universalThermalClimateIndex, comfortableOrNot, thermalStress, conditionOfPerson, port_2, percentOfTimeComfortable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; plug-in component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
outdoorcomfortcalculator_4 = Ladybug_OutdoorComfortCalculator(
    dryBulbTemperature=importepw.dryBulbTemperature,
    meanRadiantTemperature=solaradjusttemperature_3.solarAdjustedMRT,
    windSpeed_tenMeters=importepw.windSpeed,
    relativeHumidity=importepw.relativeHumidity,
    runIt=Toggle(True))  # -> readMe, port, universalThermalClimateIndex, comfortableOrNot, thermalStress, conditionOfPerson, port_2, percentOfTimeComfortable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; plug-in component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
outdoorcomfortcalculator_5 = Ladybug_OutdoorComfortCalculator(
    dryBulbTemperature=importepw.dryBulbTemperature,
    meanRadiantTemperature=solaradjusttemperature.solarAdjustedMRT,
    windSpeed_tenMeters=importepw.windSpeed,
    relativeHumidity=importepw.relativeHumidity,
    runIt=toggle_6)  # -> readMe, port, universalThermalClimateIndex, comfortableOrNot, thermalStress, conditionOfPerson, port_2, percentOfTimeComfortable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; disabled; plug-in component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
toggle_7 = BooleanToggle(True)  # disabled
panel_2 = Panel("7")  # disabled
panel_3 = Panel("0.5")  # disabled
brep_5 = Brep(<brep referenced from the Rhino model>)  # disabled
# Outdoor Comfort Shade Benefit
# see on Hydra
# 
# red - harmful
# blue - helpful
# 
# measured in degree days
# 
# block the blue parts, leave the red parts
comfortshadebenefit = Ladybug_ComfortShadeBenefitEvaluator(
    location=importepw.location,
    temperatures=outdoorcomfortcalculator_5.universalThermalClimateIndex,
    testShades=brep_5,
    testRegion=brep,
    gridSize=panel_3,
    context=brep_3,
    north=unit,
    skyResolution=panel_2,
    delNonIntersect=False,
    parallel=toggle_7,
    runIt=toggle_7)  # -> readMe, port, sunVectors, regionTestPts, shadeMesh, legend, legendBasePoint, port_2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; disabled; plug-in component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
panel_4 = Panel([outdoorcomfortcalculator.percentHeatStress, outdoorcomfortcalculator_2.percentHeatStress, outdoorcomfortcalculator_3.percentHeatStress, outdoorcomfortcalculator_4.percentHeatStress])
number_slider = Slider(48, range=0..100)  # disabled
meshselector = Ladybug_MeshThresholdSelector(inputMesh=comfortshadebenefit.shadeMesh, analysisResult=comfortshadebenefit.shadeNetEffect, percentToKeep=number_slider)  # -> readMe, totalValue, areaMeetsThresh, newColoredMesh, newMeshOutline; disabled; plug-in component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
legendpar = Ladybug_LegendParameters(numSegments="3")  # -> legendPar; plug-in component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
panel_5 = Panel(meshselector.totalValue)  # disabled
panel_6 = Panel(meshselector.areaMeetsThresh)  # disabled
analysisperiod_4 = Ladybug_AnalysisPeriod()  # -> readMe, analysisPeriod; disabled; plug-in component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
number_slider_2 = Slider(0.3, range=0..1)  # disabled
_3dchart = Ladybug_3DChart(
    inputData=flatten([outdoorcomfortcalculator_4.thermalStress, outdoorcomfortcalculator.thermalStress, outdoorcomfortcalculator_2.thermalStress, outdoorcomfortcalculator_3.thermalStress]),
    xScale="0.2",
    zScale="0",
    legendPar=legendpar,
    bakeIt=Toggle(False))  # -> readMe, graphMesh, graphCurves, legend, legendBasePts, title, titleBasePts, dataPts, conditionalHOY; plug-in component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
number_slider_3 = Slider(0.5, range=0..1)  # disabled
panel_7 = Panel("a > 0")  # disabled
sunpath = Ladybug_SunPath(
    north=unit,
    location=importepw.location,
    hour=12,
    day=21,
    month=12,
    timeStep=1,
    analysisPeriod=analysisperiod_4.analysisPeriod,
    centerPt=area.Centroid,
    sunPathScale=number_slider_2,
    sunScale=number_slider_3,
    annualHourlyData=flatten(outdoorcomfortcalculator_3.conditionOfPerson),
    conditionalStatement=panel_7,
    legendPar=legendpar,
    dailyOrAnnualSunPath=True)  # -> readMe, sunVectors, sunAltitudes, sunAzimuths, port, sunSpheresMesh, sunPathCrvs, legend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; disabled; plug-in component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
panel_8 = Panel(_3dchart.readMe)
brep_6 = Brep(<brep referenced from the Rhino model>)  # disabled
mesh = Mesh(<mesh referenced from the Rhino model>)  # disabled
rev = Reverse(Vector=sunpath.sunVectors)  # disabled
meshray = MeshRay(Mesh=mesh, Point=area.Centroid, Direction=rev)  # -> Point, Hit; disabled
