# Grasshopper definition Dhanuka_Mansi.gh (Grasshopper 0.9.76)
# plug-ins: Python Interpreter

panel = Panel("C:\Users\Mansi\AppData\Roaming\Ladybug")
ladybug = Ladybug_Ladybug(defaultFolder=panel)  # -> Vviiiiiiiiiizzz; plug-in component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
honeybee = Honeybee_Honeybee(defaultFolder=panel)  # -> Vviiiiiiiiiizzz; plug-in component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
months = Panel("""3
6
12""")
number_slider = Slider(0, range=0..2)
number_slider_2 = Slider(0, range=0..2)
# Animate sliders
button = Button()
hours = Panel("""9
12
15""")
panel_2 = Panel("https://www.energyplus.net/weather-download/north_and_central_america_wmo_region_4/USA/PA/USA_PA_Philadelphia.Intl.AP.724080_TMY3/all")
panel_3 = Panel(honeybee)
# Glass material
panel_4 = Panel("tvis_60")
fly = Ladybug_fly(inputSliders=[number_slider_2, number_slider], fly=button)  # -> Vviiiiiiiiiizzz; plug-in component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
epw_stat = Ladybug_OpenEPWAndSTATWeatherFiles(weatherFileURL=panel_2)  # -> epwFile, statFile; plug-in component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
item = ListItem(List=hours, Index=number_slider, Wrap=True)
item_2 = ListItem(List=months, Index=number_slider_2, Wrap=True)
panel_5 = Panel("""9
12
15""")
radglassmaterial = Honeybee_RadianceGlassMaterial(materialName=panel_4, RTransmittance="0.6", GTransmittance="0.6", BTransmittance="0.6", refractiveIndex=1.52)  # -> avrgTrans, RADMaterial; plug-in component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
pipeline = GeometryPipeline(
    GroupByLayer=False,
    GroupByType=False,
    IncludeHidden=True,
    IncludeLocked=True,
    LayerFilter="contextfmctower",
    NameFilter="*",
    TypeFilter=1073741848)
pipeline_2 = GeometryPipeline(
    GroupByLayer=False,
    GroupByType=False,
    IncludeHidden=True,
    IncludeLocked=True,
    LayerFilter="Roof",
    NameFilter="*",
    TypeFilter=1073741848)
pipeline_3 = GeometryPipeline(
    GroupByLayer=False,
    GroupByType=False,
    IncludeHidden=True,
    IncludeLocked=True,
    LayerFilter="wall",
    NameFilter="*",
    TypeFilter=1073741848)
pipeline_4 = GeometryPipeline(
    GroupByLayer=False,
    GroupByType=False,
    IncludeHidden=True,
    IncludeLocked=True,
    LayerFilter="door",
    NameFilter="*",
    TypeFilter=1073741848)
pipeline_5 = GeometryPipeline(
    GroupByLayer=False,
    GroupByType=False,
    IncludeHidden=True,
    IncludeLocked=True,
    LayerFilter="window openable",
    NameFilter="*",
    TypeFilter=1073741848)
pipeline_6 = GeometryPipeline(
    GroupByLayer=False,
    GroupByType=False,
    IncludeHidden=True,
    IncludeLocked=True,
    LayerFilter="windowframe",
    NameFilter="*",
    TypeFilter=1073741848)
pipeline_7 = GeometryPipeline(
    GroupByLayer=False,
    GroupByType=False,
    IncludeHidden=True,
    IncludeLocked=True,
    LayerFilter="furniture",
    NameFilter="*",
    TypeFilter=1073741848)
pipeline_8 = GeometryPipeline(
    GroupByLayer=False,
    GroupByType=False,
    IncludeHidden=True,
    IncludeLocked=True,
    LayerFilter="ExteriorWall",
    NameFilter="*",
    TypeFilter=1073741848)
panel_6 = Panel("""3
6
12""")
pt = Point(<point referenced from the Rhino model>)
pipeline_9 = GeometryPipeline(
    GroupByLayer=False,
    GroupByType=False,
    IncludeHidden=True,
    IncludeLocked=True,
    LayerFilter="window",
    NameFilter="*",
    TypeFilter=1073741848)
importlocation = Ladybug_ImportLocation(epwFile=epw_stat.epwFile)  # -> location; plug-in component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
# Prepare geometries
pipeline_10 = GeometryPipeline(
    GroupByLayer=False,
    GroupByType=False,
    IncludeHidden=True,
    IncludeLocked=True,
    LayerFilter="floor",
    NameFilter="*",
    TypeFilter=1073741848)
# Generate sky
genclimatebasedsky = Honeybee_GenerateClimateBasedSky(weatherFile=epw_stat.epwFile, month=item_2, day="21", hour=item)  # -> radiationValues, skyFilePath; plug-in component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
createhbsrfs = Honeybee_createHBSrfs(geometry=pipeline_9, RADMaterial=radglassmaterial.RADMaterial)  # -> readMe, simplify(HBSurface); plug-in component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
doy_hoy = Ladybug_DOY_HOY(days="21", months=item_2, hours=item)  # -> HOY, DOY, date; plug-in component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
sunpath = Ladybug_SunPath(
    location=importlocation,
    hour=panel_5,
    day=21,
    month=panel_6,
    timeStep=1,
    centerPt=pt,
    sunPathScale=Slider(0.05, range=0..0.1),
    dailyOrAnnualSunPath=True)  # -> readMe, sunVectors, sunAltitudes, sunAzimuths, port, sunSpheresMesh, sunPathCrvs, legend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; plug-in component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
createhbsrfs_2 = Honeybee_createHBSrfs(geometry=[pipeline_8, pipeline_7, pipeline_5, pipeline_4, pipeline_3, pipeline_6, pipeline_10, pipeline_2, pipeline])  # -> readMe, simplify(flatten(HBSurface)); plug-in component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
brep = Brep(flatten([createhbsrfs_2.HBSurface, createhbsrfs.HBSurface]))
preview = CustomPreview(Geometry=createhbsrfs.HBSurface, Shader=ColourSwatch(SwatchColor=RGBA(129, 150, 235, 74)))
preview_2 = CustomPreview(Geometry=createhbsrfs_2.HBSurface, Shader=ColourSwatch(SwatchColor=RGBA(217, 206, 206, 208)))
gentestpts = Honeybee_GenerateTestPoints(testGeometry=pipeline_10, gridSize=Slider(0.2, range=0..1), distBaseSrf=Slider(0.764, range=0..1), moveTestMesh=True)  # -> readMe, simplify(testPoints), simplify(ptsVectors), simplify(facesArea), simplify(mesh); plug-in component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
# prepare a recipe
gridbasedsimulation = Honeybee_GridBasedSimulation(
    skyFile=genclimatebasedsky.skyFilePath,
    testPoints=gentestpts.testPoints,
    ptsVectors=gentestpts.ptsVectors,
    testMesh=gentestpts.mesh,
    simulationType=0)  # -> analysisRecipe; plug-in component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
toggle = BooleanToggle(False)
# run the analysis
rundaylightanalysis = Honeybee_RunDaylightSimulation(
    HBObjects=flatten(brep),
    analysisRecipe=gridbasedsimulation,
    writeRad=toggle,
    runRad=toggle,
    numOfCPUs=Slider(4, range=0..10),
    overwriteResults=True)  # -> readMe, analysisType, resultsUnit, results, testPts, resultFiles, radGeoFile, studyFolder, done; plug-in component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
panel_7 = Panel(doy_hoy.date)
legendpar = Ladybug_LegendParameters(lowBound="100", highBound="2000")  # -> legendPar; plug-in component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
# capture the viewport to an image
join = TextJoin(Text=[item_2, "21", item], Join="_")
# visualize the results
concat = Concatenate(FragmentA=rundaylightanalysis.analysisType, FragmentC=panel_7)
panel_8 = Panel(join)
recolormesh = Ladybug_RecolorMesh(
    analysisResult=rundaylightanalysis.results,
    inputMesh=gentestpts.mesh,
    legendPar=legendpar,
    analysisTitle=concat,
    legendTitle=rundaylightanalysis.resultsUnit)  # -> readMe, newMesh, newLegend, legendBasePt, meshColors, legendColors; plug-in component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
captureview = Ladybug_CaptureView(fileName=panel_8, capture=Toggle(False))  # -> imagePath; plug-in component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
panel_9 = Panel(captureview)
ladybug_2 = Ladybug_Ladybug()  # -> Vviiiiiiiiiizzz; plug-in component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
honeybee_2 = Honeybee_Honeybee()  # -> Vviiiiiiiiiizzz; plug-in component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
panel_10 = Panel("https://www.energyplus.net/weather-download/north_and_central_america_wmo_region_4/USA/PA/USA_PA_Philadelphia.Intl.AP.724080_TMY3/all")
epw_stat_2 = Ladybug_OpenEPWAndSTATWeatherFiles(weatherFileURL=panel_10)  # -> epwFile, statFile; plug-in component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
radopaquematerial = Honeybee_RadianceOpaqueMaterial(materialName="generic_35", RReflectance=".35", GReflectance=".35", BReflectance=".35", roughness=0.05, specularity=0)  # -> avrgRef, RADMaterial; plug-in component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
radglassmaterial_2 = Honeybee_RadianceGlassMaterial(materialName="glass_.65", RTransmittance=".65", GTransmittance=".65", BTransmittance=".65", refractiveIndex=1.52)  # -> avrgTrans, RADMaterial; plug-in component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
month = Panel("12")
hour = Panel("12")
days = Panel("21")
number_slider_3 = Slider(0, range=0..100)

# ---- group: For better visualization - Doesn't effect the results of the analysis
importlocation_2 = Ladybug_ImportLocation(epwFile=epw_stat_2.epwFile)  # -> location; plug-in component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
sunpath_2 = Ladybug_SunPath(
    north=number_slider_3,
    location=importlocation_2,
    hour=hour,
    day=days,
    month=month,
    timeStep=1,
    centerPt=pt,
    sunPathScale=Slider(0.2, range=0..1),
    dailyOrAnnualSunPath=True)  # -> readMe, sunVectors, sunAltitudes, sunAzimuths, port, sunSpheresMesh, sunPathCrvs, legend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; plug-in component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

# ----
# Geometry Preparation
panel_11 = Panel("0")
# Assign specific materials
createhbsrfs_3 = Honeybee_createHBSrfs(geometry=pipeline_7, RADMaterial=radopaquematerial.RADMaterial)  # -> readMe, simplify(HBSurface); plug-in component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
createhbsrfs_4 = Honeybee_createHBSrfs(geometry=pipeline_9, RADMaterial=radglassmaterial_2.RADMaterial)  # -> readMe, simplify(HBSurface); plug-in component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
createhbsrfs_5 = Honeybee_createHBSrfs(geometry=pipeline_10, srfType="2")  # -> readMe, simplify(HBSurface); plug-in component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
createhbsrfs_6 = Honeybee_createHBSrfs(geometry=pipeline_2, srfType="3")  # -> readMe, simplify(HBSurface); plug-in component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
genclimatebasedsky_2 = Honeybee_GenerateClimateBasedSky(north=number_slider_3, weatherFile=epw_stat_2.epwFile, month=month, day=days, hour=hour)  # -> radiationValues, skyFilePath; plug-in component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
# Honeybee default materials will be assigned
# based on surface type
createhbsrfs_7 = Honeybee_createHBSrfs(geometry=[pipeline_3, pipeline_8, pipeline_4, pipeline_5, pipeline_6], srfType=panel_11)  # -> readMe, simplify(HBSurface); plug-in component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
genavgsky = Honeybee_GenerateAverageSky(north=number_slider_3, weatherFile=epw_stat_2.epwFile, month=month, hour=hour)  # -> radiationValues, skyFilePath; plug-in component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
northarrow = Ladybug_North(north=number_slider_3, centerPt=pt, scale=".05")  # -> northSign; plug-in component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
panel_12 = Panel([genclimatebasedsky_2.radiationValues, genavgsky.radiationValues])
set_the_view_to_fisheye_for_glare_analys = Panel("1")  # "set the view to FishEye for Glare Analysis"
radparameters = Honeybee_RADParameters(quality=0, ab="3")  # -> readMe, radParameters; plug-in component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
doy_hoy_2 = Ladybug_DOY_HOY(days=days, months=month, hours=hour)  # -> HOY, DOY, date; plug-in component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

# ---- group: collect all honeybee surfaces
brep_2 = Brep(flatten([createhbsrfs_7.HBSurface, createhbsrfs_6.HBSurface, createhbsrfs_5.HBSurface, createhbsrfs_3.HBSurface, createhbsrfs_4.HBSurface]))

# ----
# Analysis Recipe
imagebasedsimulation = Honeybee_ImageBasedSimulation(
    skyFile=genavgsky.skyFilePath,
    cameraType=set_the_view_to_fisheye_for_glare_analys,
    simulationType=2,
    radParameters=radparameters.radParameters,
    backupImages=0)  # -> analysisRecipe; plug-in component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
wires = BrepWireframe(Brep=brep_2, Density=-1)
toggle_2 = BooleanToggle(True)
# Run the analysis
rundaylightanalysis_2 = Honeybee_RunDaylightSimulation(
    HBObjects=flatten(brep_2),
    analysisRecipe=imagebasedsimulation,
    writeRad=toggle_2,
    runRad=toggle_2,
    numOfCPUs="4",
    radFileName=doy_hoy_2.date,
    overwriteResults=True)  # -> readMe, analysisType, resultsUnit, results, testPts, luminance_files, radGeoFile, studyFolder, done; plug-in component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
panel_13 = Panel("""Radiance
Grasshopper
Honeybee
Glare
Daylight
Set View
HBExampleFiles""")
panel_14 = Panel("""This file shows how to run a glare analysis using Honeybee. This example is using same geometry as the other daylighting examples [[1](http://hydrashare.github.io/hydra/viewer?owner=mostaphaRoudsari&fork=hydra_1&id=Surface_by_surface_geometry_preparation_for_daylight_simulation_II), [2](http://hydrashare.github.io/hydra/viewer?owner=mostaphaRoudsari&fork=hydra_1&id=Find_when_sun_is_visible_to_a_point)].
The example is uses Averaged Climate-based Sky for glare analysis which uses the average value for that hour during the whole month.""")
md_slider = MDSlider(
    slider_value=Point(0.5215606689, 0.5079524343, 0.5),
    SliderMode=0,
    x_domain=Domain(-1, 1),
    y_domain=Domain(-1, 1),
    z_domain=Domain(0, 1))
panel_15 = Panel("C:\Users\Administrator\Dropbox\ladybug\helpDesk\PennDesign2015\Daylight_Glare_Analysis.png")
glareanalysis = Honeybee_GlareAnalysis(HDRImagePath=rundaylightanalysis_2.luminance_files, runIt=Toggle(True))  # -> readMe, glareCheckImage, DGP, DGI, imageWithTaskArea; plug-in component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
falsecolor = Honeybee_FalseColor(
    HDRFilePath=rundaylightanalysis_2.luminance_files,
    contourBands=False,
    maskThreshold=0.1,
    useAlterColors=False,
    render=Toggle(True))  # -> outputFilePath; plug-in component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
exporthydra = Hydra_ExportFile(
    fileName="Glare Analysis",
    fileDescription=panel_14,
    fileTags=panel_13,
    targetFolder="C:\Users\Administrator\Documents\GitHub\hydra_1",
    includeRhino=Toggle(True),
    additionalImgs=panel_15,
    export=Toggle(False))  # -> readMe; inputs fileDescription: list, changeLog: list, fileTags: list, includeRhino: Boolean, GHForThumb: Boolean, additionalImgs: list, export: Boolean; plug-in component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
# DGP: Daylight glare probability:
# Imperceptible Glare [0.35 > DGP]
# Perceptible Glare [0.4 > DGP >= 0.35]
# Disturbing Glare [0.45 > DGP >= 0.4]
# Intolerable Glare [DGP >= 0.45]
panel_16 = Panel(glareanalysis.DGP)
hdr_tif = Honeybee_ConvertHDRToTIF(HDRFilePath=glareanalysis.glareCheckImage, adjustExposure=Toggle(True))  # -> TIFFFilePath; plug-in component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
hdr_tif_2 = Honeybee_ConvertHDRToTIF(HDRFilePath=falsecolor, adjustExposure=False)  # -> TIFFFilePath; plug-in component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
number_slider_4 = Slider(0.8, range=0..1)
hdr_gif = Honeybee_ConvertHDRToGIF(HDRFilePath=falsecolor, adjustExposure=False)  # -> GIFFilePath; plug-in component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
panel_17 = Panel(hdr_tif)
panel_18 = Panel(hdr_gif)

pt_2 = Point(<point referenced from the Rhino model>)
# set the view
comfortmannequin = Ladybug_ComfortMannequin(rotationAngle="45", bodyLocation=pt_2)  # -> mannequinMesh, legend, legendBasePt; plug-in component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

# ---- group: Person's face!
item_3 = ListItem(List=comfortmannequin.mannequinMesh, Index=121, Wrap=True)

# ----
preview_3 = CustomPreview(Geometry=item_3, Shader=ColourSwatch(SwatchColor=RGB(255, 0, 0)))

facen = FaceNormals(Mesh=item_3)  # -> Centers, Normals
settheview = Ladybug_SetTheView(cameraLocation=facen.Centers, cameraDirection=facen.Normals, uvLookAround=md_slider)  # -> readMe; plug-in component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
