# Grasshopper definition Dhanuka_Mansi.gh (Grasshopper 0.9.76)
# plug-ins: Python Interpreter

ladybug = Ladybug_Ladybug(defaultFolder="C://ladybug")  # -> Vviiiiiiiiiizzz; plug-in component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
ladybug_2 = Ladybug_Ladybug()  # -> Vviiiiiiiiiizzz; plug-in component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
honeybee = Honeybee_Honeybee()  # -> Vviiiiiiiiiizzz; plug-in component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
months = Panel("""3
6
12""")

# ---- group: WWR
# Wall to Window Ratio
wwr_north = Slider(0, range=0..1)
wwr_west = Slider(0, range=0..1)
wwr_south = Slider(0.13, range=0..1)
wwr_east = Slider(0.24, range=0..1)

# ----
honeybee_2 = Honeybee_Honeybee(defaultFolder="C://ladybug")  # -> Vviiiiiiiiiizzz; plug-in component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
ladybug_3 = Ladybug_Ladybug()  # -> Vviiiiiiiiiizzz; plug-in component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
honeybee_3 = Honeybee_Honeybee()  # -> Vviiiiiiiiiizzz; plug-in component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
# Rotation Angle
number_slider = Slider(0, range=0..360)

list = ValueList({"Exterior Window [R1.0, SHGC 0.7]": "ASHRAE 90.1-2004 EXTWINDOW CLIMATEZONE ALT-WARE 1-8", "Exterior Window [R1.7, SHGC 0.39]": "ASHRAE 90.1-2004 EXTWINDOW CLIMATEZONE 4-6", "Exterior Window [R1.9, SHGC 0.39]": "ASHRAE 90.1-2004 EXTWINDOW CLIMATEZONE ALT-RES 4-6", "Exterior Window [R0.7, SHGC 0.65]": "Dbl LoE (e3=.1) Clr 3mm/13mm Arg"}, selected="Exterior Window [R1.0, SHGC 0.7]")
list_2 = ValueList({"Exterior Roof [R9.2]": "ASHRAE 90.1-2004 EXTROOF METAL CLIMATEZONE 3-4", "Exterior Roof [R14.8]": "ASHRAE 90.1-2004 EXTROOF IEAD CLIMATEZONE 1-4", "Exterior Roof [R34.4]": "ASHRAE 189.1-2009 EXTROOF IEAD CLIMATEZONE 7-8"}, selected="Exterior Roof [R34.4]")
# Construction
list_3 = ValueList({"Exterior Wall [R5.5]": "ASHRAE 90.1-2004 EXTWALL METAL CLIMATEZONE 4", "Exterior Wall [R5.8]": "ASHRAE 90.1-2004 EXTWALL MASS CLIMATEZONE 3-4", "Exterior Wall [R7.2]": "ASHRAE 90.1-2004 EXTWALL STEELFRAME CLIMATEZONE 1-4", "Exterior Wall [R8.7]": "ASHRAE 90.1-2004 EXTWALL MASS CLIMATEZONE ALT-RES 4", "Exterior Wall [R10.4]": "ASHRAE 90.1-2004 EXTWALL WOODFRAME CLIMATEZONE 1-7", "Exterior Wall [R14.8]": "ASHRAE 90.1-2004 EXTWALL STEELFRAME CLIMATEZONE ALT-RES 4-6", "Exterior Wall [R34.4]": "ASHRAE 189.1-2009 EXTROOF IEAD CLIMATEZONE 7-8"}, selected="Exterior Wall [R34.4]")

months_2 = Panel("""3
6
12""")
run_energyplus = BooleanToggle(True)
list_4 = ValueList({"Existing Slab Construction": "0", "+4 Inches Concrete": "1", "+8 Inches Concrete": "2"}, selected="+8 Inches Concrete")
number_slider_2 = Slider(0, range=0..2)
number_slider_3 = Slider(0, range=0..2)
# Animate sliders
button = Button()
hours = Panel("""9
12
15""")
panel = Panel("https://www.energyplus.net/weather-download/north_and_central_america_wmo_region_4/USA/PA/USA_PA_Philadelphia.Intl.AP.724080_TMY3/all")
number_slider_4 = Slider(0, range=0..2)
number_slider_5 = Slider(0, range=0..2)
# Animate sliders
button_2 = Button()
hours_2 = Panel("""9
12
15""")
# Glass material
panel_2 = Panel("tvis_60")
panel_3 = Panel(honeybee)
fly = Ladybug_fly(inputSliders=[number_slider_3, number_slider_2], fly=button)  # -> Vviiiiiiiiiizzz; plug-in component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
panel_4 = Panel("https://www.energyplus.net/weather-download/north_and_central_america_wmo_region_4/USA/PA/USA_PA_Philadelphia.Intl.AP.724080_TMY3/all")
panel_5 = Panel(honeybee_3)
bldgprograms = Honeybee_bldgPrograms({"Office": 0, "Retail": 1, "MidriseApartment": 2, "PrimarySchool": 3, "SecondarySchool": 4, "SmallHotel": 5, "LargeHotel": 6, "Hospital": 7, "Outpatient": 8, "Warehouse": 9, "SuperMarket": 10, "FullServiceRestaurant": 11, "QuickServiceRestaurant": 12}, selected="MidriseApartment")
epw_stat = Ladybug_OpenEPWAndSTATWeatherFiles(weatherFileURL=panel)  # -> epwFile, statFile; plug-in component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
# Glass material
panel_6 = Panel("tvis_60")
fly_2 = Ladybug_fly(inputSliders=[number_slider_5, number_slider_4], fly=button_2)  # -> Vviiiiiiiiiizzz; plug-in component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
item = ListItem(List=hours, Index=number_slider_2, Wrap=True)
item_2 = ListItem(List=months, Index=number_slider_3, Wrap=True)
epw_stat_2 = Ladybug_OpenEPWAndSTATWeatherFiles(weatherFileURL=panel_4)  # -> epwFile, statFile; plug-in component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
panel_7 = Panel("""9
12
15""")
pt = Point(<point referenced from the Rhino model>)
radglassmaterial = Honeybee_RadianceGlassMaterial(materialName=panel_2, RTransmittance="0.6", GTransmittance="0.6", BTransmittance="0.6", refractiveIndex=1.52)  # -> avrgTrans, RADMaterial; plug-in component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
item_3 = ListItem(List=hours_2, Index=number_slider_4, Wrap=True)
item_4 = ListItem(List=months_2, Index=number_slider_5, Wrap=True)
listzoneprograms = Honeybee_ListZonePrograms(bldgProgram=bldgprograms)  # -> MidriseApartmentZonePrograms; plug-in component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
panel_8 = Panel("""9
12
15""")
northarrow = Ladybug_North(centerPt=pt, scale=Slider(0.03, range=0..0.1))  # -> northSign; plug-in component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
pipeline = GeometryPipeline(
    GroupByLayer=False,
    GroupByType=False,
    IncludeHidden=True,
    IncludeLocked=True,
    LayerFilter="contextfmctower",
    NameFilter="*",
    TypeFilter=1073741848)
pipeline_2 = GeometryPipeline(
    GroupByLayer=False,
    GroupByType=False,
    IncludeHidden=True,
    IncludeLocked=True,
    LayerFilter="windowframe",
    NameFilter="*",
    TypeFilter=1073741848)
pipeline_3 = GeometryPipeline(
    GroupByLayer=False,
    GroupByType=False,
    IncludeHidden=True,
    IncludeLocked=True,
    LayerFilter="door",
    NameFilter="*",
    TypeFilter=1073741848)
pipeline_4 = GeometryPipeline(
    GroupByLayer=False,
    GroupByType=False,
    IncludeHidden=True,
    IncludeLocked=True,
    LayerFilter="window openable",
    NameFilter="*",
    TypeFilter=1073741848)
pipeline_5 = GeometryPipeline(
    GroupByLayer=False,
    GroupByType=False,
    IncludeHidden=True,
    IncludeLocked=True,
    LayerFilter="Roof",
    NameFilter="*",
    TypeFilter=1073741848)
pipeline_6 = GeometryPipeline(
    GroupByLayer=False,
    GroupByType=False,
    IncludeHidden=True,
    IncludeLocked=True,
    LayerFilter="furniture",
    NameFilter="*",
    TypeFilter=1073741848)
pipeline_7 = GeometryPipeline(
    GroupByLayer=False,
    GroupByType=False,
    IncludeHidden=True,
    IncludeLocked=True,
    LayerFilter="wall",
    NameFilter="*",
    TypeFilter=1073741848)
pipeline_8 = GeometryPipeline(
    GroupByLayer=False,
    GroupByType=False,
    IncludeHidden=True,
    IncludeLocked=True,
    LayerFilter="ExteriorWall",
    NameFilter="*",
    TypeFilter=1073741848)
radglassmaterial_2 = Honeybee_RadianceGlassMaterial(materialName=panel_6, RTransmittance="0.6", GTransmittance="0.6", BTransmittance="0.6", refractiveIndex=1.52)  # -> avrgTrans, RADMaterial; plug-in component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
pipeline_9 = GeometryPipeline(
    GroupByLayer=False,
    GroupByType=False,
    IncludeHidden=True,
    IncludeLocked=True,
    LayerFilter="floor",
    NameFilter="*",
    TypeFilter=1073741848)
pipeline_10 = GeometryPipeline(
    GroupByLayer=False,
    GroupByType=False,
    IncludeHidden=True,
    IncludeLocked=True,
    LayerFilter="shading",
    NameFilter="*",
    TypeFilter=1073741848)
panel_9 = Panel("""3
6
12""")
pipeline_11 = GeometryPipeline(
    GroupByLayer=False,
    GroupByType=False,
    IncludeHidden=True,
    IncludeLocked=True,
    LayerFilter="wwr",
    NameFilter="*",
    TypeFilter=1073741848)
pipeline_12 = GeometryPipeline(
    GroupByLayer=False,
    GroupByType=False,
    IncludeHidden=True,
    IncludeLocked=True,
    LayerFilter="wwr",
    NameFilter="*",
    TypeFilter=1073741848)
pipeline_13 = GeometryPipeline(
    GroupByLayer=False,
    GroupByType=False,
    IncludeHidden=True,
    IncludeLocked=True,
    LayerFilter="shading",
    NameFilter="*",
    TypeFilter=1073741848)
context = GeometryPipeline(
    GroupByLayer=False,
    GroupByType=False,
    IncludeHidden=True,
    IncludeLocked=True,
    LayerFilter="contextfmctower",
    NameFilter="*",
    TypeFilter=1073741848)
pipeline_14 = GeometryPipeline(
    GroupByLayer=False,
    GroupByType=False,
    IncludeHidden=True,
    IncludeLocked=True,
    LayerFilter="Roof",
    NameFilter="*",
    TypeFilter=1073741848)
pipeline_15 = GeometryPipeline(
    GroupByLayer=False,
    GroupByType=False,
    IncludeHidden=True,
    IncludeLocked=True,
    LayerFilter="wall",
    NameFilter="*",
    TypeFilter=1073741848)
pipeline_16 = GeometryPipeline(
    GroupByLayer=False,
    GroupByType=False,
    IncludeHidden=True,
    IncludeLocked=True,
    LayerFilter="door",
    NameFilter="*",
    TypeFilter=1073741848)
pipeline_17 = GeometryPipeline(
    GroupByLayer=False,
    GroupByType=False,
    IncludeHidden=True,
    IncludeLocked=True,
    LayerFilter="window openable",
    NameFilter="*",
    TypeFilter=1073741848)
pipeline_18 = GeometryPipeline(
    GroupByLayer=False,
    GroupByType=False,
    IncludeHidden=True,
    IncludeLocked=True,
    LayerFilter="windowframe",
    NameFilter="*",
    TypeFilter=1073741848)
pipeline_19 = GeometryPipeline(
    GroupByLayer=False,
    GroupByType=False,
    IncludeHidden=True,
    IncludeLocked=True,
    LayerFilter="furniture",
    NameFilter="*",
    TypeFilter=1073741848)
pipeline_20 = GeometryPipeline(
    GroupByLayer=False,
    GroupByType=False,
    IncludeHidden=True,
    IncludeLocked=True,
    LayerFilter="ExteriorWall",
    NameFilter="*",
    TypeFilter=1073741848)
panel_10 = Panel(radglassmaterial.avrgTrans)
brep = Brep(<brep referenced from the Rhino model>)
panel_11 = Panel("""3
6
12""")
preview = CustomPreview(Geometry=northarrow, Shader=ColourSwatch(SwatchColor=RGB(0, 0, 0)))
pt_2 = Point(<point referenced from the Rhino model>)
item_5 = ListItem(List=listzoneprograms, Index=0, Wrap=True)
pipeline_21 = GeometryPipeline(
    GroupByLayer=False,
    GroupByType=False,
    IncludeHidden=True,
    IncludeLocked=True,
    LayerFilter="windowhalf",
    NameFilter="*",
    TypeFilter=1073741848)
pipeline_22 = GeometryPipeline(
    GroupByLayer=False,
    GroupByType=False,
    IncludeHidden=True,
    IncludeLocked=True,
    LayerFilter="windowfull",
    NameFilter="*",
    TypeFilter=1073741848)
pipeline_23 = GeometryPipeline(
    GroupByLayer=False,
    GroupByType=False,
    IncludeHidden=True,
    IncludeLocked=True,
    LayerFilter="windowhalf",
    NameFilter="*",
    TypeFilter=1073741848)
pipeline_24 = GeometryPipeline(
    GroupByLayer=False,
    GroupByType=False,
    IncludeHidden=True,
    IncludeLocked=True,
    LayerFilter="windowfull",
    NameFilter="*",
    TypeFilter=1073741848)
importlocation = Ladybug_ImportLocation(epwFile=epw_stat.epwFile)  # -> location; plug-in component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
pt_3 = Point(<point referenced from the Rhino model>)
importlocation_2 = Ladybug_ImportLocation(epwFile=epw_stat_2.epwFile)  # -> location; plug-in component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
# Prepare geometries
pipeline_25 = GeometryPipeline(
    GroupByLayer=False,
    GroupByType=False,
    IncludeHidden=True,
    IncludeLocked=True,
    LayerFilter="floor",
    NameFilter="*",
    TypeFilter=1073741848)
# Prepare geometries
panel_12 = Panel("6")
# Generate sky
genclimatebasedsky = Honeybee_GenerateClimateBasedSky(weatherFile=epw_stat.epwFile, month=item_2, day="21", hour=item)  # -> radiationValues, skyFilePath; plug-in component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
# Geometry
mass2zone = Honeybee_Masses2Zones(zoneMasses=flatten(brep), zonePrograms=item_5, isConditioned=Toggle(False), maxRoofAngle=30, createHBZones=Toggle(True))  # -> readMe, HBZones; plug-in component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
doy_hoy = Ladybug_DOY_HOY(days="21", months=item_2, hours=item)  # -> HOY, DOY, date; plug-in component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
sunpath = Ladybug_SunPath(
    location=importlocation,
    hour=panel_7,
    day=21,
    month=panel_9,
    timeStep=1,
    centerPt=pt_2,
    sunPathScale=Slider(0.05, range=0..0.1),
    dailyOrAnnualSunPath=True)  # -> readMe, sunVectors, sunAltitudes, sunAzimuths, port, sunSpheresMesh, sunPathCrvs, legend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; plug-in component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
glzparamlist = Honeybee_GlazingParametersList(northGlzParam=wwr_north, westGlzParam=wwr_west, southGlzParam=wwr_south, eastGlzParam=wwr_east)  # -> glzParamList; plug-in component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
createhbsrfs = Honeybee_createHBSrfs(geometry=pipeline_9, srfType="2")  # -> readMe, simplify(flatten(HBSurface)); plug-in component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
createhbsrfs_2 = Honeybee_createHBSrfs(geometry=pipeline_5, srfType="1", EPConstruction=list_2)  # -> readMe, simplify(flatten(HBSurface)); plug-in component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
createhbsrfs_3 = Honeybee_createHBSrfs(
    geometry=[pipeline_7, pipeline_8, pipeline, pipeline_3, pipeline_4, pipeline_6, pipeline_2, pipeline_11],
    srfType="0",
    EPBC=list_3,
    EPConstruction=list_3)  # -> readMe, simplify(flatten(HBSurface)); plug-in component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
createhbsrfs_4 = Honeybee_createHBSrfs(geometry=pipeline_10, srfType=panel_12)  # -> readMe, simplify(flatten(HBSurface)); plug-in component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
# Generate sky
genclimatebasedsky_2 = Honeybee_GenerateClimateBasedSky(weatherFile=epw_stat_2.epwFile, month=item_4, day="21", hour=item_3)  # -> radiationValues, skyFilePath; plug-in component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
createhbsrfs_5 = Honeybee_createHBSrfs(geometry=pipeline_23, srfType="5", RADMaterial=radglassmaterial.RADMaterial)  # -> readMe, simplify(HBSurface); plug-in component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
doy_hoy_2 = Ladybug_DOY_HOY(days="21", months=item_4, hours=item_3)  # -> HOY, DOY, date; plug-in component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
sunpath_2 = Ladybug_SunPath(
    location=importlocation_2,
    hour=panel_8,
    day=21,
    month=panel_11,
    timeStep=1,
    centerPt=pt_3,
    sunPathScale=Slider(0.05, range=0..0.1),
    dailyOrAnnualSunPath=True)  # -> readMe, sunVectors, sunAltitudes, sunAzimuths, port, sunSpheresMesh, sunPathCrvs, legend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; plug-in component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
createhbsrfs_6 = Honeybee_createHBSrfs(geometry=pipeline_21, RADMaterial=radglassmaterial_2.RADMaterial)  # -> readMe, simplify(HBSurface); plug-in component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
createhbsrfs_7 = Honeybee_createHBSrfs(geometry=[pipeline_20, pipeline_19, pipeline_17, pipeline_16, pipeline_15, pipeline_18, pipeline_25, pipeline_14, context, pipeline_12])  # -> readMe, simplify(flatten(HBSurface)); plug-in component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

callfromepconstrlibrary = Honeybee_CallFromEPConstructionLibrary(keywords="floor")  # -> ThermMaterials, EPMaterials, EPWindowMaterials, EPConstructions; plug-in component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
item_6 = ListItem(List=callfromepconstrlibrary.EPConstructions, Index=Slider(0, range=0..100), Wrap=True)
decomposeepconstruction = Honeybee_DecomposeEPConstruction(cnstrName=item_6)  # -> flatten(materials), comments, UValue_SI, UValue_IP, RValue_SI, RValue_IP; plug-in component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

preview_2 = CustomPreview(Geometry=createhbsrfs_2.HBSurface, Shader=ColourSwatch(SwatchColor=RGBA(217, 206, 206, 208)))
preview_3 = CustomPreview(Geometry=createhbsrfs_3.HBSurface, Shader=ColourSwatch(SwatchColor=RGBA(217, 206, 206, 208)))
preview_4 = CustomPreview(Geometry=createhbsrfs.HBSurface, Shader=ColourSwatch(SwatchColor=RGBA(217, 206, 206, 208)))

callfromepconstrlibrary_2 = Honeybee_CallFromEPConstructionLibrary(keywords="slab")  # -> ThermMaterials, EPMaterials, EPWindowMaterials, EPConstructions; plug-in component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
item_7 = ListItem(List=callfromepconstrlibrary_2.EPConstructions, Index="2", Wrap=True)
decomposeepconstruction_2 = Honeybee_DecomposeEPConstruction(cnstrName=item_7)  # -> flatten(materials), comments, UValue_SI, UValue_IP, RValue_SI, RValue_IP; plug-in component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

preview_5 = CustomPreview(Geometry=createhbsrfs_4.HBSurface, Shader=ColourSwatch(SwatchColor=RGBA(217, 206, 206, 208)))
glazingcreator = Honeybee_GlazingBasedOnRatio(HBObjects=mass2zone.HBZones, glzRatio=glzparamlist, breakUpDist=Toggle(True), runIt=Toggle(True))  # -> readMe, HBObjWGLZ; plug-in component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
preview_6 = CustomPreview(Geometry=createhbsrfs_5.HBSurface, Shader=ColourSwatch(SwatchColor=RGBA(129, 150, 235, 74)))
askme = Honeybee_AskMe(HBObjects=mass2zone.HBZones)  # -> readMe; plug-in component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
brep_2 = Brep(flatten([createhbsrfs_7.HBSurface, createhbsrfs_6.HBSurface]))
preview_7 = CustomPreview(Geometry=createhbsrfs_6.HBSurface, Shader=ColourSwatch(SwatchColor=RGBA(129, 150, 235, 74)))
preview_8 = CustomPreview(Geometry=createhbsrfs_7.HBSurface, Shader=ColourSwatch(SwatchColor=RGBA(217, 206, 206, 208)))
gentestpts = Honeybee_GenerateTestPoints(testGeometry=pipeline_9, gridSize=Slider(0.2, range=0..1), distBaseSrf=Slider(0.764, range=0..1), moveTestMesh=True)  # -> readMe, simplify(testPoints), simplify(ptsVectors), simplify(facesArea), simplify(mesh); plug-in component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
panel_13 = Panel(askme)
volume = Volume(Geometry=glazingcreator.HBObjWGLZ)  # -> Volume, Centroid
gentestpts_2 = Honeybee_GenerateTestPoints(testGeometry=pipeline_25, gridSize=Slider(0.2, range=0..1), distBaseSrf=Slider(0.764, range=0..1), moveTestMesh=True)  # -> readMe, simplify(testPoints), simplify(ptsVectors), simplify(facesArea), simplify(mesh); plug-in component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
rotatehbobj = Honeybee_RotateHoneybee(HBObj=glazingcreator.HBObjWGLZ, angle=number_slider, cenPt=volume.Centroid)  # -> HBObj; plug-in component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
brep_3 = Brep(flatten([createhbsrfs.HBSurface, createhbsrfs_2.HBSurface, createhbsrfs_3.HBSurface, createhbsrfs_5.HBSurface, createhbsrfs_4.HBSurface]))
wires = BrepWireframe(Brep=rotatehbobj, Density=-1)
# prepare a recipe
gridbasedsimulation = Honeybee_GridBasedSimulation(
    skyFile=genclimatebasedsky_2.skyFilePath,
    testPoints=gentestpts_2.testPoints,
    ptsVectors=gentestpts_2.ptsVectors,
    testMesh=gentestpts_2.mesh,
    simulationType=0)  # -> analysisRecipe; plug-in component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

panel_14 = Panel(decomposeepconstruction.materials)
panel_15 = Panel("""MAT-CC05 4 HW CONCRETE
MAT-CC05 8 HW CONCRETE""")
item_8 = ListItem(List=decomposeepconstruction.materials, Index=0, Wrap=True)  # -> Item, Item1
item_9 = ListItem(List=panel_15, Index=0, Wrap=True)  # -> Item, Item1
panel_16 = Panel(item_6)
epconstruction = Honeybee_EnergyPlusConstruction(name="floor_cnstr_2", layer_1=item_8.Item, layer_2=item_8.Item1, layer_3=item_9.Item1)  # -> EPConstruction; plug-in component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
epconstruction_2 = Honeybee_EnergyPlusConstruction(name="floor_cnstr_1", layer_1=item_8.Item, layer_2=item_8.Item1, layer_3=item_9.Item)  # -> EPConstruction; plug-in component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

toggle = BooleanToggle(True)
# Construction
setepzonecnstr = Honeybee_SetEPZoneConstruction(HBZone=rotatehbobj, wallEPConstruction=list_3, windowEPConstruction=list, roofEPConstruction=list_2)  # -> simplify(modifiedHBZone); plug-in component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
panel_17 = Panel("https://www.energyplus.net/weather-download/north_and_central_america_wmo_region_4/USA/PA/USA_PA_Philadelphia.Intl.AP.724080_TMY3/all")
# run the analysis
rundaylightanalysis = Honeybee_RunDaylightSimulation(
    HBObjects=flatten(brep_2),
    analysisRecipe=gridbasedsimulation,
    writeRad=toggle,
    runRad=toggle,
    numOfCPUs=Slider(4, range=0..10),
    overwriteResults=True)  # -> readMe, analysisType, resultsUnit, illuminance_values, testPts, illuminance_files, radGeoFile, studyFolder, done; plug-in component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
epw_stat_3 = Ladybug_OpenEPWAndSTATWeatherFiles(weatherFileURL=panel_17)  # -> epwFile, statFile; plug-in component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
# Put the recipie together!
annualdaylightsimulation = Honeybee_AnnualDaylightSimulation(
    north=number_slider,
    epwWeatherFile=epw_stat_3.epwFile,
    testPoints=gentestpts.testPoints,
    ptsVectors=gentestpts.ptsVectors,
    testMesh=gentestpts.mesh)  # -> analysisRecipe; plug-in component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

panel_18 = Panel("""WindowMaterial:Glazing,
    LoE CLEAR 3MM Rev,       !- Name
    SpectralAverage,         !- Optical Data Type
    ,                        !- Window Glass Spectral Data Set Name
    0.003,                   !- Thickness {m}
    0.630,                   !- Solar Transmittance at Normal Incidence
    0.220,                   !- Front Side Solar Reflectance at Normal Incidence
    0.190,                   !- Back Side Solar Reflectance at Normal Incidence
    0.850,                   !- Visible Transmittance at Normal Incidence
    0.079,                   !- Front Side Visible Reflectance at Normal Incidence
    0.056,                   !- Back Side Visible Reflectance at Normal Incidence
    0.0,                     !- Infrared Transmittance at Normal Incidence
    0.10,                    !- Front Side Infrared Hemispherical Emissivity
    0.84,                    !- Back Side Infrared Hemispherical Emissivity
    0.9;                     !- Conductivity {W/m-K}""")
panel_19 = Panel("""Construction,
    Dbl LoE (e3=.1) Clr 3mm/13mm Arg,  !- Name
    CLEAR 3MM,               !- Outside Layer
    ARGON 13MM,              !- Layer 2
    LoE CLEAR 3MM Rev;       !- Layer 3""")
panel_20 = Panel("""WindowMaterial:Gas,
    ARGON 13MM,               !- Name
    Argon,                   !- Gas Type
    0.0127;                  !- Thickness {m}""")
toggle_2 = BooleanToggle(True)
addtoeplibrary = Honeybee_AddToEnergyPlusLibrary(EPObject=[panel_19, panel_20, panel_18], addToProjectLib=toggle_2, overwrite=toggle_2)  # -> readMe; plug-in component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

filter = StreamFilter(Gate=list_4, Stream0=panel_16, Stream1=epconstruction_2, Stream2=epconstruction)
setepzoneundergroundcnstr = Honeybee_SetEPZoneUndergroundConstruction(HBZone=flatten(setepzonecnstr), groundFloorEPConstruction=filter)  # -> simplify(modifiedHBZone); plug-in component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
panel_21 = Panel(rundaylightanalysis.readMe)
toggle_3 = BooleanToggle(True)
panel_22 = Panel(doy_hoy_2.date)
legendpar = Ladybug_LegendParameters(lowBound="100", highBound="2000", numSegments="5", removeLessThan=Toggle(False))  # -> legendPar; plug-in component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
# capture the viewport to an image
join = TextJoin(Text=[item_4, "21", item_3], Join="_")
# Run the analysis
rundaylightanalysis_2 = Honeybee_RunDaylightSimulation(
    HBObjects=flatten(brep_3),
    analysisRecipe=annualdaylightsimulation,
    writeRad=toggle_3,
    runRad=toggle_3,
    overwriteResults=True)  # -> readMe, analysisType, resultsUnit, results, testPts, annual_analysis_files, radGeoFile, studyFolder, done; plug-in component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
# visualize the results
concat = Concatenate(FragmentA=rundaylightanalysis.analysisType, FragmentC=panel_22)
occupancygenerator = Honeybee_DaysimOccupancyGenerator(weekendDays=[1, 2], writeTheOcc=Toggle(True))  # -> occupancyFile; plug-in component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
panel_23 = Panel(join)
panel_24 = Panel("18")
recolormesh = Ladybug_RecolorMesh(
    analysisResult=rundaylightanalysis.illuminance_values,
    inputMesh=gentestpts_2.mesh,
    legendPar=legendpar,
    analysisTitle=concat,
    legendTitle=rundaylightanalysis.resultsUnit)  # -> readMe, newMesh, newLegend, legendBasePt, meshColors, legendColors; plug-in component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
captureview = Ladybug_CaptureView(fileName=panel_23, capture=Toggle(True))  # -> imagePath; plug-in component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
# Generate annual results
readannualresultsi = Honeybee_ReadAnnualResultI(
    illFilesAddress=rundaylightanalysis_2.annual_analysis_files,
    testPoints=simplify(rundaylightanalysis_2.testPts),
    occupancyFiles=occupancygenerator,
    DLAIllumThresholds="150",
    runIt=Toggle(True))  # -> DLA, UDLI_Less_100, UDLI_100_2000, UDLI_More_2000, CDA, sDA, annualProfiles, htmReport; plug-in component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
setepzoneschedules = Honeybee_SetEnergyPlusZoneSchedules(HBZones=setepzoneundergroundcnstr, lightingSchedules=readannualresultsi.annualProfiles)  # -> schedules, simplify(HBZones); plug-in component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
panel_25 = Panel(setepzoneschedules.schedules)
setepnatvent = Honeybee_SetEPAirFlow(
    HBZones=setepzoneschedules.HBZones,
    naturalVentilationType=Slider(1, range=-2..1),
    minIndoorTempForNatVent="25",
    maxOutdoorTempForNatVent="28",
    fractionOfGlzAreaOperable=Slider(1, range=0..1))  # -> readMe, simplify(HBZones); plug-in component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
panel_26 = Panel(captureview)
decomposebytype = Honeybee_DecomposeBasedOnType(HBZone=setepzoneundergroundcnstr)  # -> walls, interiorWalls, airWalls, windows, interiorWindows, skylights, roofs, ceilings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; plug-in component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
panel_27 = Panel(setepnatvent.readMe)
gradientlibrary = Ladybug_GradientLibrary(gradIndex=Slider(1, range=0..10))  # -> customColors; plug-in component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

# ----
# infiltration rate
ach2m3_s_m2_calculator = HoneybeeInfORventPerAreaCalculator(HBZones=flatten(setepnatvent.HBZones), airChangeHour=Slider(2, range=0..10))  # -> out, infORventPerArea, allFloors; plug-in component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
setepzoneloads = Honeybee_SetEnergyPlusZoneLoads(HBZones=flatten(setepnatvent.HBZones), infiltrationRatePerArea=ach2m3_s_m2_calculator.infORventPerArea)  # -> loads, HBZones; plug-in component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

add_blinds = BooleanToggle(True)
shading_depth = Slider(0.3, range=0..1)
number_of_blinds = Slider(1, range=0..10)

# ----
# Blinds
panel_28 = Panel("{0.5, 0.5, 0}")
Y = UnitY(Factor=1)
evalsrf = EvaluateSurface(Surface=reparameterize(decomposebytype.windows), Point=panel_28)  # -> Point, Normal, Frame
rev = Reverse(Vector=Y)
vdis = VectorDisplay(Anchor=evalsrf.Point, Vector=evalsrf.Normal)
angle = Angle(VectorA=evalsrf.Normal, VectorB=rev)  # -> Angle, Reflex
equals = Equality(FirstNumber=angle.Angle, SecondNumber=0)  # -> Equality, Inequality
dispatch = Dispatch(List=decomposebytype.windows, DispatchPattern=equals.Equality)  # -> ListA, ListB
brep_4 = Brep(dispatch.ListA)
shddesigner = Ladybug_ShadingDesigner(glzSrf=flatten(brep_4), depthOrVector=flatten(shading_depth), numOfShds=number_of_blinds, runIt=add_blinds, port_4=False)  # -> readMe, shadingSrfs; plug-in component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
# South
wires_2 = BrepWireframe(Brep=shddesigner.shadingSrfs, Density=-1)
preview_9 = CustomPreview(Geometry=wires_2, Shader=ColourSwatch(SwatchColor=RGB(0, 0, 0)))

add_blinds_2 = BooleanToggle(False)
shading_depth_2 = Slider(0.3, range=0..1)
number_of_blinds_2 = Slider(3, range=0..10)

X = UnitX(Factor=1)

# ----
# Blinds
panel_29 = Panel("{0.5, 0.5, 0}")
evalsrf_2 = EvaluateSurface(Surface=reparameterize(decomposebytype.windows), Point=panel_29)  # -> Point, Normal, Frame
vdis_2 = VectorDisplay(Anchor=evalsrf_2.Point, Vector=evalsrf_2.Normal)
angle_2 = Angle(VectorA=evalsrf_2.Normal, VectorB=X)  # -> Angle, Reflex
equals_2 = Equality(FirstNumber=angle_2.Angle, SecondNumber=0)  # -> Equality, Inequality
dispatch_2 = Dispatch(List=decomposebytype.windows, DispatchPattern=equals_2.Equality)  # -> ListA, ListB
brep_5 = Brep(dispatch_2.ListA)
shddesigner_2 = Ladybug_ShadingDesigner(
    glzSrf=flatten(brep_5),
    depthOrVector=flatten(shading_depth_2),
    numOfShds=number_of_blinds_2,
    runIt=add_blinds_2,
    port_4=False)  # -> readMe, shadingSrfs; plug-in component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
# East
wires_3 = BrepWireframe(Brep=shddesigner_2.shadingSrfs, Density=-1)
preview_10 = CustomPreview(Geometry=wires_3, Shader=ColourSwatch(SwatchColor=RGB(0, 0, 0)))

# ---- group: make it 3D!
dom = ConstructDomain(DomainStart=0, DomainEnd=Slider(1, range=0..1))

# ----
legendpar_2 = Ladybug_LegendParameters(
    lowBound=Slider(0, range=0..100),
    highBound=Slider(100, range=0..100),
    numSegments=Slider(6, range=0..10),
    customColors=flatten(gradientlibrary))  # -> legendPar; plug-in component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
# Visualize the results
panel_30 = Panel("%")
panel_31 = Panel(setepzoneloads.loads)
recolormesh_2 = Ladybug_RecolorMesh(
    analysisResult=readannualresultsi.DLA,
    inputMesh=gentestpts.mesh,
    heightDomain=dom,
    legendPar=legendpar_2,
    analysisTitle=rundaylightanalysis_2.analysisType,
    legendTitle=panel_30)  # -> readMe, newMesh, newLegend, legendBasePt, meshColors, legendColors; plug-in component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
ladybug_4 = Ladybug_Ladybug()  # -> Vviiiiiiiiiizzz; plug-in component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
honeybee_4 = Honeybee_Honeybee()  # -> Vviiiiiiiiiizzz; plug-in component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
toggle_4 = BooleanToggle(True)
panel_32 = Panel("https://www.energyplus.net/weather-download/north_and_central_america_wmo_region_4/USA/PA/USA_PA_Philadelphia.Intl.AP.724080_TMY3/all")
panel_33 = Panel("https://www.energyplus.net/weather-download/north_and_central_america_wmo_region_4/USA/PA/USA_PA_Philadelphia.Intl.AP.724080_TMY3/all")
hb_epcontextsrf = HoneybeeEPContextSurfaces(shdSurfaces=flatten([shddesigner.shadingSrfs, shddesigner_2.shadingSrfs]))  # -> HBContext; inputs shdSurfaces: list of Brep, justBoundingBox: Boolean
# ---------- hb_epcontextsrf: Python ----------
"""
prepare shading/context geometries

    Args:
        northVectorOrRotation: A vector that shows North or a number that shows
                               the rotation of the North from the Y axis
        bldgMasses: List of closed Breps as thermal zones.
    Returns:
        report: ...
        thermalZones: Thermal zone's geometries for visualiza
"""

ghenv.Component.Name = 'Honeybee EP context Surfaces'
ghenv.Component.NickName = 'HB_EPContextSrf'
ghenv.Component.Message = 'VER 0.0.59\nJAN_26_2016'
ghenv.Component.IconDisplayMode = ghenv.Component.IconDisplayMode.application
ghenv.Component.Category = "Honeybee"
ghenv.Component.SubCategory = "09 | Energy | Energy"
#compatibleHBVersion = VER 0.0.57\nNOV_01_2015
#compatibleLBVersion = VER 0.0.59\nFEB_01_2015
ghenv.Component.AdditionalHelpFromDocStrings = "2"

import rhinoscriptsyntax as rs
import Rhino as rc
import scriptcontext as sc
import os
import System
import Grasshopper.Kernel as gh
import uuid

tolerance = sc.doc.ModelAbsoluteTolerance
import math


def main(shdSurfaces, EPTransSchedule, meshingSettings, justBoundingBox):
    
    # import the classes
    if sc.sticky.has_key('honeybee_release'):

        try:
            if not sc.sticky['honeybee_release'].isCompatible(ghenv.Component): return -1
            if sc.sticky['honeybee_release'].isInputMissing(ghenv.Component): return -1
        except:
            warning = "You need a newer version of Honeybee to use this compoent." + \
            " Use updateHoneybee component to update userObjects.\n" + \
            "If you have already updated userObjects drag Honeybee_Honeybee component " + \
            "into canvas and try again."
            w = gh.GH_RuntimeMessageLevel.Warning
            ghenv.Component.AddRuntimeMessage(w, warning)
            return -1
        
        # don't customize this part
        hb_EPSrf = sc.sticky["honeybee_EPSurface"]
        hb_EPSHDSurface = sc.sticky["honeybee_EPShdSurface"]
        hb_RADMaterialAUX = sc.sticky["honeybee_RADMaterialAUX"]
        hb_EPObjectsAux = sc.sticky["honeybee_EPObjectsAUX"]()
        HBScheduleList = sc.sticky["honeybee_ScheduleLib"].keys()

        ########################################################################
        #----------------------------------------------------------------------#
        shdBreps = []
        # create bounding box of shading geometries
        if justBoundingBox:
            for brep in shdSurfaces:
                if brep.Faces.Count>1 or not brep.Faces[0].IsPlanar(sc.doc.ModelAbsoluteTolerance):
                    shdBreps.append(brep.GetBoundingBox(True).ToBrep())
                else:
                    shdBreps.append(brep)
        else:
            shdBreps = shdSurfaces
        
        shadingClasses = []
        shadingMeshPreview = []
        
        if meshingSettings == None:
            mp = rc.Geometry.MeshingParameters.Minimal
            mp.SimplePlanes = True
        else:
            mp = meshingSettings
        
        def getRadMaterialName(radMaterial):
            nameStr = radMaterial.split(" ")[2]
            name =  nameStr.split("\n")[0]
            return name
        
        for brepCount, brep in enumerate(shdBreps):
            if brep != None:
                isPlanar = True
                # check planarity
                for face in brep.Faces:
                    if not face.IsPlanar(tolerance):
                        isPlanar = False
                        break
                
                shadingBreps = []
                if not isPlanar:
                    meshArray = rc.Geometry.Mesh.CreateFromBrep(brep, mp)
                    for mesh in meshArray:
                        for meshFace in range(mesh.Faces.Count):
                            vertices = list(mesh.Faces.GetFaceVertices(meshFace))[1:]
                            vertices = vertices + [sc.doc.ModelAbsoluteTolerance]
                            # create the brep from mesh
                            shdBrep = rc.Geometry.Brep.CreateFromCornerPoints(*vertices)
                            shadingBreps.append(shdBrep)
                else:
                    for face in brep.Faces:
                        shadingBreps.append(face.DuplicateFace(False))
                
                for faceCount, shdBrep in enumerate(shadingBreps):
                        thisShading = hb_EPSHDSurface(shdBrep, 1000*brepCount + faceCount, 'shdSrf_' + `brepCount` + '_' + `faceCount` + "_" + str(uuid.uuid4()))
                        
                        # add transmittance schedule if any
                        if EPTransSchedule!=None:
                            schedule= EPTransSchedule.upper()
                            if schedule!=None and not schedule.lower().endswith(".csv") and schedule not in HBScheduleList:
                                msg = "Cannot find " + schedule + " in Honeybee schedule library."
                                print msg
                                ghenv.Component.AddRuntimeMessage(gh.GH_RuntimeMessageLevel.Warning, msg)
                                return -1
                            elif schedule!=None and schedule.lower().endswith(".csv"):
                                # check if csv file is existed
                                if not os.path.isfile(schedule):
                                    msg = "Cannot find the shchedule file: " + schedule
                                    print msg
                                    ghenv.Component.AddRuntimeMessage(gh.GH_RuntimeMessageLevel.Warning, msg)
                                    return -1
                            
                            thisShading.TransmittanceSCH = schedule
                        
                        # add the Rad Material if any
                        if RADMaterial!=None:
                            # if it is just the name of the material make sure it is already defined
                            if len(RADMaterial.split(" ")) == 1:
                                # if the material is not in the library add it to the library
                                if not hb_RADMaterialAUX.isMatrialExistInLibrary(RADMaterial):
                                    warningMsg = "Can't find " + RADMaterial + " in RAD Material Library.\n" + \
                                                "Add the material to the library and try again."
                                    ghenv.Component.AddRuntimeMessage(gh.GH_RuntimeMessageLevel.Warning, warningMsg)
                                    return
                                
                                try:
                                    thisShading.setRADMaterial(RADMaterial)
                                except Exception, e:
                                    print e
                                    warningMsg = "You are using an old version of Honeybee_Honeybee! Update your files and try again."
                                    print warningMsg
                                    ghenv.Component.AddRuntimeMessage(gh.GH_RuntimeMessageLevel.Warning, warningMsg)
                                    return
                                
                                addedToLib = True
                            else:
                                
                                # try to add the material to the library
                                addedToLib, thisShading.RadMaterial = hb_RADMaterialAUX.analyseRadMaterials(RADMaterial, True)
                                
                            if addedToLib==False:
                                warningMsg = "Failed to add " + RADMaterial + " to the Library."
                                ghenv.Component.AddRuntimeMessage(gh.GH_RuntimeMessageLevel.Warning, warningMsg)
                                return
                        
                        # add shading to the list
                        shadingClasses.append(thisShading)
                
        # add to the hive
        hb_hive = sc.sticky["honeybee_Hive"]()
        HBContext  = hb_hive.addToHoneybeeHive(shadingClasses, ghenv.Component.InstanceGuid.ToString())
        return HBContext
        ################################################################################################
    else:
        print "You should first let Honeybee to fly..."
        w = gh.GH_RuntimeMessageLevel.Warning
        ghenv.Component.AddRuntimeMessage(w, "You should first let Honeybee to fly...")
        return -1
        

if _shdSurfaces and _shdSurfaces[0]!=None:
    # add cleaning function
    result= main(_shdSurfaces, EPTransSchedule_, meshingSettings_, justBoundingBox_)
    
    if result != -1: HBContext = result
# ---------- end hb_epcontextsrf ----------
epoutput = Honeybee_GenerateEPOutput(
    zoneEnergyUse=toggle_4,
    zoneGainsAndLosses=toggle_4,
    zoneComfortMetrics=toggle_4,
    surfaceTempAnalysis="False",
    surfaceEnergyAnalysis=toggle_4)  # -> report, flatten(simulationOutputs); plug-in component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
epw_stat_4 = Ladybug_OpenEPWAndSTATWeatherFiles(weatherFileURL=panel_32)  # -> epwFile, statFile; plug-in component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
epw_stat_5 = Ladybug_OpenEPWAndSTATWeatherFiles(weatherFileURL=panel_33)  # -> epwFile, statFile; plug-in component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
radopaquematerial = Honeybee_RadianceOpaqueMaterial(materialName="generic_35", RReflectance=".35", GReflectance=".35", BReflectance=".35", roughness=0.05, specularity=0)  # -> avrgRef, RADMaterial; plug-in component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
radglassmaterial_3 = Honeybee_RadianceGlassMaterial(materialName="glass_.65", RTransmittance=".65", GTransmittance=".65", BTransmittance=".65", refractiveIndex=1.52)  # -> avrgTrans, RADMaterial; plug-in component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
month = Panel("12")
hour = Panel("12")
days = Panel("21")
rep = ReplaceText(Text="base_case", Find=" ", Replace="_", RecursiveReplace=False)
number_slider_6 = Slider(0, range=0..100)

# ---- group: For better visualization - Doesn't effect the results of the analysis
importlocation_3 = Ladybug_ImportLocation(epwFile=epw_stat_4.epwFile)  # -> location; plug-in component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
sunpath_3 = Ladybug_SunPath(
    north=number_slider_6,
    location=importlocation_3,
    hour=hour,
    day=days,
    month=month,
    timeStep=1,
    centerPt=pt_3,
    sunPathScale=Slider(0.2, range=0..1),
    dailyOrAnnualSunPath=True)  # -> readMe, sunVectors, sunAltitudes, sunAzimuths, port, sunSpheresMesh, sunPathCrvs, legend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; plug-in component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

# ----
path = FilePath(epw_stat_5.epwFile)
# Geometry Preparation
panel_34 = Panel("0")
runenergysimulation = Honeybee_RunEnergySimulation(
    epwFile=epw_stat_5.epwFile,
    HBZones=flatten(setepzoneloads.HBZones),
    HBContext=flatten(hb_epcontextsrf),
    simulationOutputs=flatten(epoutput.simulationOutputs),
    writeIdf=run_energyplus,
    runEnergyPlus=run_energyplus,
    idfFileName=rep)  # -> report, idfFileAddress, resultFileAddress; plug-in component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
# Assign specific materials
createhbsrfs_8 = Honeybee_createHBSrfs(geometry=pipeline_19, RADMaterial=radopaquematerial.RADMaterial)  # -> readMe, simplify(HBSurface); plug-in component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
createhbsrfs_9 = Honeybee_createHBSrfs(geometry=pipeline_21, RADMaterial=radglassmaterial_3.RADMaterial)  # -> readMe, simplify(HBSurface); plug-in component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
createhbsrfs_10 = Honeybee_createHBSrfs(geometry=pipeline_25, srfType="2")  # -> readMe, simplify(HBSurface); plug-in component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
createhbsrfs_11 = Honeybee_createHBSrfs(geometry=pipeline_14, srfType="3")  # -> readMe, simplify(HBSurface); plug-in component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
genclimatebasedsky_3 = Honeybee_GenerateClimateBasedSky(north=number_slider_6, weatherFile=epw_stat_4.epwFile, month=month, day=days, hour=hour)  # -> radiationValues, skyFilePath; plug-in component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
# Honeybee default materials will be assigned
# based on surface type
createhbsrfs_12 = Honeybee_createHBSrfs(geometry=[pipeline_15, pipeline_20, pipeline_16, pipeline_17, pipeline_18], srfType=panel_34)  # -> readMe, simplify(HBSurface); plug-in component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
genavgsky = Honeybee_GenerateAverageSky(north=number_slider_6, weatherFile=epw_stat_4.epwFile, month=month, hour=hour)  # -> radiationValues, skyFilePath; plug-in component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
northarrow_2 = Ladybug_North(north=number_slider_6, centerPt=pt_3, scale=".05")  # -> northSign; plug-in component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
panel_35 = Panel([genclimatebasedsky_3.radiationValues, genavgsky.radiationValues])
legendpar_3 = Ladybug_LegendParameters(lowBound=Slider(0, range=0..100), highBound=Slider(500, range=0..1000))  # -> legendPar; plug-in component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
set_the_view_to_fisheye_for_glare_analys = Panel("1")  # "set the view to FishEye for Glare Analysis"
radparameters = Honeybee_RADParameters(quality=0, ab="3")  # -> readMe, radParameters; plug-in component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
readepresult = Honeybee_ReadEPResult(resultFileAddress=runenergysimulation.resultFileAddress)  # -> port, port_2, port_3, port_4, electricLight, electricEquip, fanElectric, port_5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; plug-in component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
doy_hoy_3 = Ladybug_DOY_HOY(days=days, months=month, hours=hour)  # -> HOY, DOY, date; plug-in component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
readepsrfresult = Honeybee_ReadEPSurfaceResult(resultFileAddress=runenergysimulation.resultFileAddress)  # -> port, port_2, surfaceEnergyFlow, opaqueEnergyFlow, glazEnergyFlow, port_3, port_4, port_5, port_6, port_7; plug-in component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
importepw = Ladybug_ImportEpw(epwFile=epw_stat_5.epwFile)  # -> readMe, latitude, location, dryBulbTemperature, dewPointTemperature, relativeHumidity, windSpeed, windDirection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; plug-in component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

# ---- group: collect all honeybee surfaces
brep_6 = Brep(flatten([createhbsrfs_12.HBSurface, createhbsrfs_11.HBSurface, createhbsrfs_10.HBSurface, createhbsrfs_8.HBSurface, createhbsrfs_9.HBSurface]))

# ----
# Analysis Recipe
imagebasedsimulation = Honeybee_ImageBasedSimulation(
    skyFile=genavgsky.skyFilePath,
    cameraType=set_the_view_to_fisheye_for_glare_analys,
    simulationType=2,
    radParameters=radparameters.radParameters,
    backupImages=0)  # -> analysisRecipe; plug-in component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
wires_4 = BrepWireframe(Brep=brep_6, Density=-1)
num = Number(readepresult.electricLight)
colorsurfaces = Honeybee_ColorSurfacesByEPResult(
    srfData=readepsrfresult.surfaceEnergyFlow,
    HBZones=flatten(setepzoneloads.HBZones),
    legendPar=legendpar_3,
    runIt=Toggle(True))  # -> readMe, srfColoredMesh, zoneWireFrame, legend, legendBasePt, analysisTitle, srfBreps, srfColors, srfValues, normalizedSrfData; plug-in component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
ma = MassAddition(Input=num)  # -> Result, PartialResults
toggle_5 = BooleanToggle(True)
panel_36 = Panel(ma.Result)
adaptivecomfortcalculator = Ladybug_AdaptiveComfortCalculator(
    dryBulbTemperature=readepresult.airTemperature,
    meanRadiantTemperature=readepresult.meanRadTemperature,
    prevailingOutdoorTemp=importepw.dryBulbTemperature,
    runIt=Toggle(True))  # -> readMe, port, comfortableOrNot, conditionOfPerson, degreesFromTarget, port_2, targetTemperature, upperTemperatureBound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; plug-in component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
# Run the analysis
rundaylightanalysis_3 = Honeybee_RunDaylightSimulation(
    HBObjects=flatten(brep_6),
    analysisRecipe=imagebasedsimulation,
    writeRad=toggle_5,
    runRad=toggle_5,
    numOfCPUs="4",
    radFileName=doy_hoy_3.date,
    overwriteResults=True)  # -> readMe, analysisType, resultsUnit, results, testPts, luminance_files, radGeoFile, studyFolder, done; plug-in component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
panel_37 = Panel("""Radiance
Grasshopper
Honeybee
Glare
Daylight
Set View
HBExampleFiles""")
panel_38 = Panel("""This file shows how to run a glare analysis using Honeybee. This example is using same geometry as the other daylighting examples [[1](http://hydrashare.github.io/hydra/viewer?owner=mostaphaRoudsari&fork=hydra_1&id=Surface_by_surface_geometry_preparation_for_daylight_simulation_II), [2](http://hydrashare.github.io/hydra/viewer?owner=mostaphaRoudsari&fork=hydra_1&id=Find_when_sun_is_visible_to_a_point)].
The example is uses Averaged Climate-based Sky for glare analysis which uses the average value for that hour during the whole month.""")
md_slider = MDSlider(
    slider_value=Point(0.5215606689, 0.5079524343, 0.5),
    SliderMode=0,
    x_domain=Domain(-1, 1),
    y_domain=Domain(-1, 1),
    z_domain=Domain(0, 1))
preview_11 = CustomPreview(Geometry=colorsurfaces.zoneWireFrame, Shader=ColourSwatch(SwatchColor=RGB(0, 0, 0)))
panel_39 = Panel("C:\Users\Administrator\Dropbox\ladybug\helpDesk\PennDesign2015\Daylight_Glare_Analysis.png")
legendpar_4 = Ladybug_LegendParameters(lowBound="-1", highBound="1", numSegments="3")  # -> legendPar; plug-in component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
panel_40 = Panel(adaptivecomfortcalculator.percentOfTimeComfortable)
glareanalysis = Honeybee_GlareAnalysis(HDRImagePath=rundaylightanalysis_3.luminance_files, runIt=Toggle(True))  # -> readMe, glareCheckImage, DGP, DGI, imageWithTaskArea; plug-in component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
falsecolor = Honeybee_FalseColor(
    HDRFilePath=rundaylightanalysis_3.luminance_files,
    contourBands=False,
    maskThreshold=0.1,
    useAlterColors=False,
    render=Toggle(True))  # -> outputFilePath; plug-in component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
vec = VectorXYZ(XComponent="20", YComponent="35", ZComponent=0)  # -> Vector, Length
exporthydra = Hydra_ExportFile(
    fileName="Glare Analysis",
    fileDescription=panel_38,
    fileTags=panel_37,
    targetFolder="C:\Users\Administrator\Documents\GitHub\hydra_1",
    includeRhino=Toggle(True),
    additionalImgs=panel_39,
    export=Toggle(False))  # -> readMe; inputs fileDescription: list, changeLog: list, fileTags: list, includeRhino: Boolean, GHForThumb: Boolean, additionalImgs: list, export: Boolean; plug-in component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
pt_4 = Point(Point(23.10617158, 0, 0))
move = Move(Geometry=pt_4, Motion=vec.Vector)  # -> Geometry, Transform
# DGP: Daylight glare probability:
# Imperceptible Glare [0.35 > DGP]
# Perceptible Glare [0.4 > DGP >= 0.35]
# Disturbing Glare [0.45 > DGP >= 0.4]
# Intolerable Glare [DGP >= 0.45]
panel_41 = Panel(glareanalysis.DGP)
panel_42 = Panel("""Comfortable (%): 
Hot (%):         
Cold (%):        """)
comfortable_hot_cold = Panel([adaptivecomfortcalculator.percentOfTimeComfortable, adaptivecomfortcalculator.percentHotCold])
_3dchart = Ladybug_3DChart(
    inputData=flatten(adaptivecomfortcalculator.conditionOfPerson),
    basePoint=pt_4,
    xScale=".025",
    yScale="0.125",
    zScale=Slider(0, range=0..100),
    legendPar=legendpar_4)  # -> readMe, graphMesh, graphCurves, legend, legendBasePts, title, titleBasePts, dataPts, conditionalHOY; plug-in component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
psychchart = Ladybug_PsychrometricChart(
    dryBulbTemperature=readepresult.airTemperature,
    relativeHumidity=readepresult.relativeHumidity,
    basePoint=move.Geometry,
    runIt=Toggle(True))  # -> readMe, port, totalComfortPercent, totalComfortOrNot, strategyNames, strategyPercentOfTime, strategyOrNot, port_2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; plug-in component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
num_2 = Number(comfortable_hot_cold)
hdr_tif = Honeybee_ConvertHDRToTIF(HDRFilePath=glareanalysis.glareCheckImage, adjustExposure=Toggle(True))  # -> TIFFFilePath; plug-in component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
hdr_tif_2 = Honeybee_ConvertHDRToTIF(HDRFilePath=falsecolor, adjustExposure=False)  # -> TIFFFilePath; plug-in component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
number_slider_7 = Slider(0.8, range=0..1)
expression = Expression(x=num_2, Expression="Round(x, 2)")
hdr_gif = Honeybee_ConvertHDRToGIF(HDRFilePath=falsecolor, adjustExposure=False)  # -> GIFFilePath; plug-in component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
flip = FlipMatrix(Data=panel_42)  # -> simplify(Data)
flip_2 = FlipMatrix(Data=expression)  # -> simplify(Data)
panel_43 = Panel(hdr_tif)
panel_44 = Panel(psychchart.totalComfortPercent)
panel_45 = Panel([flip, flip_2])
panel_46 = Panel(hdr_gif)
join_2 = TextJoin(Text=panel_45)
energybalance = Honeybee_ConstructEnergyBalance(
    HBZones=flatten(setepzoneloads.HBZones),
    electricLight=readepresult.electricLight,
    electricEquip=readepresult.electricEquip,
    fanElectric=readepresult.fanElectric,
    peopleGains=readepresult.peopleGains,
    totalSolarGain=readepresult.totalSolarGain,
    infiltrationEnergy=readepresult.infiltrationEnergy,
    natVentEnergy=readepresult.natVentEnergy,
    surfaceEnergyFlow=readepsrfresult.surfaceEnergyFlow)  # -> readMe, port, flrNormEnergyBal, flrNormBalWStorage, port_2, modelEnergyBalance, energyBalWithStorage; plug-in component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
pt_5 = Point(Point(-43.28450394, 53.67163906, 0))
join_3 = TextJoin(Text=flatten(["Adaptive", join_2]))
gradientlibrary_2 = Ladybug_GradientLibrary(gradIndex="19")  # -> customColors; plug-in component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
tag = TextTag3D(Location=pt_5, Text=join_3, Size=Slider(2, range=0..100), Colour=ColourSwatch(SwatchColor=RGB(0, 0, 0)), Justification=5)
selectandaveragedata = Ladybug_AverageData(annualHourlyData=energybalance.energyBalWithStorage, totalOrAverage=Toggle(True))  # -> readMe, selHourlyData, totaledDaily, totaledMonthly, totMonthlyPerHour, totAnalysisPeriod; plug-in component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
pt_6 = Point(<point referenced from the Rhino model>)
legendpar_5 = Ladybug_LegendParameters(lowBound="-1000", highBound="1000", customColors=flatten(gradientlibrary_2))  # -> legendPar; plug-in component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
barchart = Ladybug_MonthlyBarChart(
    inputData=flatten(selectandaveragedata.totaledMonthly),
    stackValues=Toggle(True),
    altTitle="Apartment Energy Balance Diagram",
    altYAxisTitle="Energy (kwh)",
    basePoint=pt_6,
    xScale=Slider(0.4, range=0..1),
    yScale=Slider(0.8, range=0..1),
    legendPar=legendpar_5)  # -> readMe, dataMesh, dataCurves, dataCrvColors, graphAxes, graphLabels, title, titleBasePt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; plug-in component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
preview_12 = CustomPreview(
    Geometry=[barchart.graphAxes, psychchart.chartCurvesAndTxt, _3dchart.graphMesh, _3dchart.graphCurves],
    Shader=ColourSwatch(SwatchColor=RGB(0, 0, 0)))
pmvcomfortcalculator = Ladybug_PMVComfortCalculator(
    dryBulbTemperature=readepresult.airTemperature,
    meanRadiantTemperature=readepresult.meanRadTemperature,
    relativeHumidity=readepresult.relativeHumidity,
    calcBalanceTemperature=False,
    runIt=Toggle(True))  # -> readMe, port, predictedMeanVote, percentPeopleDissatisfied, standardEffectiveTemperature, port_2, comfortableOrNot, percentOfTimeComfortable, port_3, balanceTemperature; plug-in component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
panel_47 = Panel(pmvcomfortcalculator.predictedMeanVote)

comfortable_hot_cold_2 = Panel(["", pmvcomfortcalculator.percentOfTimeComfortable])
panel_48 = Panel("""Predicted Mean Vote
Comfortable (%):

   """)
num_3 = Number(comfortable_hot_cold_2)
expression_2 = Expression(x=num_3, Expression="Round(x, 2)")
flip_3 = FlipMatrix(Data=panel_48)  # -> simplify(Data)
flip_4 = FlipMatrix(Data=expression_2)  # -> simplify(Data)
panel_49 = Panel([flip_3, flip_4])
join_4 = TextJoin(Text=panel_49)

comfortable_hot_cold_3 = Panel(["", psychchart.totalComfortPercent])
panel_50 = Panel("""Psychrometric Chart
Comfortable (%):

   """)
num_4 = Number(comfortable_hot_cold_3)
expression_3 = Expression(x=num_4, Expression="Round(x, 2)")
flip_5 = FlipMatrix(Data=panel_50)  # -> simplify(Data)
flip_6 = FlipMatrix(Data=expression_3)  # -> simplify(Data)
panel_51 = Panel([flip_5, flip_6])
join_5 = TextJoin(Text=panel_51)

pt_7 = Point(Point(-12.13959478, 53.53320972, 0))
join_6 = TextJoin(Text=flatten(join_5))
tag_2 = TextTag3D(Location=pt_7, Text=join_6, Size=Slider(2, range=0..100), Colour=ColourSwatch(SwatchColor=RGB(0, 0, 0)), Justification=5)

join_7 = TextJoin(Text=flatten(join_4))
pt_8 = Point(Point(-12.00919628, 46.90938137, 0))
tag_3 = TextTag3D(Location=pt_8, Text=join_7, Size=Slider(2, range=0..100), Colour=ColourSwatch(SwatchColor=RGB(0, 0, 0)), Justification=5)

pt_9 = Point(<point referenced from the Rhino model>)
# set the view
comfortmannequin = Ladybug_ComfortMannequin(rotationAngle="45", bodyLocation=pt_9)  # -> mannequinMesh, legend, legendBasePt; plug-in component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

# ---- group: Person's face!
item_10 = ListItem(List=comfortmannequin.mannequinMesh, Index=121, Wrap=True)

# ----
preview_13 = CustomPreview(Geometry=item_10, Shader=ColourSwatch(SwatchColor=RGB(255, 0, 0)))

facen = FaceNormals(Mesh=item_10)  # -> Centers, Normals
settheview = Ladybug_SetTheView(cameraLocation=facen.Centers, cameraDirection=facen.Normals, uvLookAround=md_slider)  # -> readMe; plug-in component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
