# Grasshopper definition Dhanuka_Mansi.gh (Grasshopper 0.9.76)
# plug-ins: Python Interpreter, Kangaroo Components, Weaverbird

# ---- group: Weather Data
panel = Panel("https://www.energyplus.net/weather-download/north_and_central_america_wmo_region_4/USA/PA/USA_PA_Philadelphia.Intl.AP.724080_TMY3/all")
ladybug = Ladybug_Ladybug()  # -> Vviiiiiiiiiizzz; plug-in component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
epw_stat = Ladybug_OpenEPWAndSTATWeatherFiles(weatherFileURL=panel)  # -> epwFile, statFile; plug-in component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
importepw = Ladybug_ImportEpw(epwFile=epw_stat.epwFile)  # -> readMe, latitude, location, dryBulbTemperature, dewPointTemperature, relativeHumidity, windSpeed, windDirection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; plug-in component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

# ----
mesh = Mesh(<mesh referenced from the Rhino model>)
demesh = DeconstructMesh(Mesh=mesh)  # -> Vertices, Faces, Colours, Normals
wbedges = WeaverbirdsMeshEdges(MeshOrPolylines=mesh)
Z = UnitZ(Factor=Slider(1727.36, range=-2000..2000))
springs = SpringsFromLine(Connection=wbedges, Stiffness=1000, Damping=10, RestLength=0, UpperCutoff=0, LowerCutoff=0, Plasticity=0)

# ---- group: North Point
line = Line(Line((-102.3446363, 324.5902896, -257.2096947), (-101.9729119, 327.617742, -257.2096947)))
vec = Vector(line)
unit = UnitVector(Vector=vec)

# ----
uforce = UnaryForce(Point=demesh.Vertices, Force=Z)

# ---- group: Body Location Points
_3_bench = Brep([<brep referenced from the Rhino model> x3])
area = Area(Geometry=_3_bench)  # -> Area, Centroid

# ---- group: Context Meyerson + Fisher Fine Arts
meyerson_fisherfinearts = Brep([<brep referenced from the Rhino model> x2])

# ---- group: Shading Device Basic
shading_device = Mesh(<mesh referenced from the Rhino model>)

# ----
pt = Point([<point referenced from the Rhino model> x4])

# ---- group: Shading Device Design
brep = Brep([<brep referenced from the Rhino model> x2])

# ----
timer = Timer(TimerInterval=50, Target=kangaroo)
kangaroo = KangarooPhysics(ForceObjects=flatten([springs, uforce]), AnchorPoints=pt, Settings=null, Geometry=mesh, SimulationReset=Toggle(False))  # -> Out, Iterations, ParticlesOut, GeometryOut, KE

# ---- group: With Shading Device + Radiation + Meyerson Building
analysisperiod = Ladybug_AnalysisPeriod()  # -> readMe, analysisPeriod; plug-in component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
toggle = BooleanToggle(True)
solaradjusttemperature = Ladybug_OutdoorSolarTemperatureAdjustor(
    location=importepw.location,
    cumSkyMtxOrDirNormRad=importepw.directNormalRadiation,
    diffuseHorizRad=importepw.diffuseHorizontalRadiation,
    baseTemperature=importepw.dryBulbTemperature,
    baseDryBulbOrMRT=Toggle(True),
    horizInfraredRad=importepw.horizontalInfraredRadiation,
    bodyLocation=area.Centroid,
    contextShading=[meyerson_fisherfinearts, shading_device],
    north=unit,
    analysisPeriodOrHOY=analysisperiod.analysisPeriod,
    parallel=toggle,
    runIt=toggle)  # -> readMe, port, effectiveRadiantField, MRTDelta, solarAdjustedMRT, port_2, mannequinMesh, port_3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; plug-in component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
outdoorcomfortcalculator = Ladybug_OutdoorComfortCalculator(
    dryBulbTemperature=importepw.dryBulbTemperature,
    meanRadiantTemperature=solaradjusttemperature.solarAdjustedMRT,
    windSpeed_tenMeters=importepw.windSpeed,
    relativeHumidity=importepw.relativeHumidity,
    runIt=Toggle(True))  # -> readMe, port, universalThermalClimateIndex, comfortableOrNot, thermalStress, conditionOfPerson, port_2, percentOfTimeComfortable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; plug-in component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

# ---- group: Shading Device
brep_2 = Brep(<brep referenced from the Rhino model>)
edges = BrepEdges(Brep=brep_2)  # -> Naked, Interior, NonManifold
item = ListItem(List=edges.Naked, Index=2, Wrap=True)
item_2 = ListItem(List=edges.Naked, Index=0, Wrap=True)
divide = DivideCurve(Curve=item_2, Count=Slider(8, range=0..10), Kinks=False)  # -> Points, Tangents, Parameters
divide_2 = DivideCurve(Curve=item, Count=Slider(8, range=0..10), Kinks=False)  # -> Points, Tangents, Parameters
int = Integer(3)
int_2 = Integer(0)
int_3 = Integer(4)
int_4 = Integer(5)
int_5 = Integer(3)
int_6 = Integer(0)
int_7 = Integer(5)
int_8 = Integer(4)
item_3 = ListItem(List=divide.Points, Index=int_2, Wrap=True)
item_4 = ListItem(List=divide.Points, Index=int, Wrap=True)
item_5 = ListItem(List=divide.Points, Index=int_3, Wrap=True)
item_6 = ListItem(List=divide_2.Points, Index=int_5, Wrap=True)
item_7 = ListItem(List=divide_2.Points, Index=int_8, Wrap=True)
item_8 = ListItem(List=divide.Points, Index=int_4, Wrap=True)
item_9 = ListItem(List=divide_2.Points, Index=int_6, Wrap=True)
item_10 = ListItem(List=divide_2.Points, Index=int_7, Wrap=True)
pipe = Pipe(Curve=[item, item_2], Radius=Slider(0.1, range=0..1), Caps=0)
srf4pt = _4PointSurface(CornerA=item_3, CornerB=item_4, CornerC=item_4, CornerD=item_9)
srf4pt_2 = _4PointSurface(CornerA=item_8, CornerB=item_4, CornerC=item_10)

# ---- group: With Shading Device + Radiation + Meyerson Building
analysisperiod_2 = Ladybug_AnalysisPeriod()  # -> readMe, analysisPeriod; plug-in component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
toggle_2 = BooleanToggle(True)
solaradjusttemperature_2 = Ladybug_OutdoorSolarTemperatureAdjustor(
    location=importepw.location,
    cumSkyMtxOrDirNormRad=importepw.directNormalRadiation,
    diffuseHorizRad=importepw.diffuseHorizontalRadiation,
    baseTemperature=importepw.dryBulbTemperature,
    baseDryBulbOrMRT=Toggle(True),
    horizInfraredRad=importepw.horizontalInfraredRadiation,
    bodyLocation=area.Centroid,
    contextShading=[meyerson_fisherfinearts, brep],
    north=unit,
    analysisPeriodOrHOY=analysisperiod_2.analysisPeriod,
    parallel=toggle_2,
    runIt=toggle_2)  # -> readMe, port, effectiveRadiantField, MRTDelta, solarAdjustedMRT, port_2, mannequinMesh, port_3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; plug-in component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
outdoorcomfortcalculator_2 = Ladybug_OutdoorComfortCalculator(
    dryBulbTemperature=importepw.dryBulbTemperature,
    meanRadiantTemperature=solaradjusttemperature_2.solarAdjustedMRT,
    windSpeed_tenMeters=importepw.windSpeed,
    relativeHumidity=importepw.relativeHumidity,
    runIt=Toggle(True))  # -> readMe, port, universalThermalClimateIndex, comfortableOrNot, thermalStress, conditionOfPerson, port_2, percentOfTimeComfortable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; plug-in component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

# ---- group: Solar Radiation + Meyerson + Context
analysisperiod_3 = Ladybug_AnalysisPeriod()  # -> readMe, analysisPeriod; plug-in component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
toggle_3 = BooleanToggle(True)
solaradjusttemperature_3 = Ladybug_OutdoorSolarTemperatureAdjustor(
    location=importepw.location,
    cumSkyMtxOrDirNormRad=importepw.directNormalRadiation,
    diffuseHorizRad=importepw.diffuseHorizontalRadiation,
    baseTemperature=importepw.dryBulbTemperature,
    baseDryBulbOrMRT=Toggle(True),
    horizInfraredRad=importepw.horizontalInfraredRadiation,
    bodyLocation=area.Centroid,
    contextShading=meyerson_fisherfinearts,
    north=unit,
    analysisPeriodOrHOY=analysisperiod_3.analysisPeriod,
    parallel=toggle_3,
    runIt=toggle_3)  # -> readMe, port, effectiveRadiantField, MRTDelta, solarAdjustedMRT, port_2, mannequinMesh, port_3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; plug-in component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
outdoorcomfortcalculator_3 = Ladybug_OutdoorComfortCalculator(
    dryBulbTemperature=importepw.dryBulbTemperature,
    meanRadiantTemperature=solaradjusttemperature_3.solarAdjustedMRT,
    windSpeed_tenMeters=importepw.windSpeed,
    relativeHumidity=importepw.relativeHumidity,
    runIt=Toggle(True))  # -> readMe, port, universalThermalClimateIndex, comfortableOrNot, thermalStress, conditionOfPerson, port_2, percentOfTimeComfortable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; plug-in component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

# ----
mesh_2 = Mesh(kangaroo.GeometryOut)

# ---- group: With Radiation
analysisperiod_4 = Ladybug_AnalysisPeriod()  # -> readMe, analysisPeriod; plug-in component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
toggle_4 = BooleanToggle(True)
solaradjusttemperature_4 = Ladybug_OutdoorSolarTemperatureAdjustor(
    location=importepw.location,
    cumSkyMtxOrDirNormRad=importepw.directNormalRadiation,
    diffuseHorizRad=importepw.diffuseHorizontalRadiation,
    baseTemperature=importepw.dryBulbTemperature,
    baseDryBulbOrMRT=Toggle(True),
    horizInfraredRad=importepw.horizontalInfraredRadiation,
    analysisPeriodOrHOY=analysisperiod_4.analysisPeriod,
    parallel=toggle_4,
    runIt=toggle_4)  # -> readMe, port, effectiveRadiantField, MRTDelta, solarAdjustedMRT, port_2, mannequinMesh, port_3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; plug-in component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
outdoorcomfortcalculator_4 = Ladybug_OutdoorComfortCalculator(
    dryBulbTemperature=importepw.dryBulbTemperature,
    meanRadiantTemperature=solaradjusttemperature_4.solarAdjustedMRT,
    windSpeed_tenMeters=importepw.windSpeed,
    relativeHumidity=importepw.relativeHumidity,
    runIt=Toggle(True))  # -> readMe, port, universalThermalClimateIndex, comfortableOrNot, thermalStress, conditionOfPerson, port_2, percentOfTimeComfortable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; plug-in component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

# ---- group: Fully Shaded
outdoorcomfortcalculator_5 = Ladybug_OutdoorComfortCalculator(
    dryBulbTemperature=importepw.dryBulbTemperature,
    windSpeed_tenMeters=importepw.windSpeed,
    relativeHumidity=importepw.relativeHumidity,
    runIt=Toggle(True))  # -> readMe, port, universalThermalClimateIndex, comfortableOrNot, thermalStress, conditionOfPerson, port_2, percentOfTimeComfortable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; plug-in component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

# ----
panel_2 = Panel(outdoorcomfortcalculator_3.percentColdStress)
panel_3 = Panel(outdoorcomfortcalculator_3.percentHeatStress)
panel_4 = Panel(outdoorcomfortcalculator_3.percentOfTimeComfortable)
panel_5 = Panel(outdoorcomfortcalculator.percentOfTimeComfortable)
panel_6 = Panel(outdoorcomfortcalculator.percentHeatStress)
panel_7 = Panel(outdoorcomfortcalculator.percentColdStress)
panel_8 = Panel([outdoorcomfortcalculator_5.percentOfTimeComfortable, outdoorcomfortcalculator_4.percentOfTimeComfortable])
panel_9 = Panel(outdoorcomfortcalculator_2.percentOfTimeComfortable)
panel_10 = Panel(outdoorcomfortcalculator_2.percentHeatStress)
panel_11 = Panel(outdoorcomfortcalculator_2.percentColdStress)

# ---- group: 3D Chart
legendpar = Ladybug_LegendParameters(numSegments="3")  # -> legendPar; plug-in component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
_3dchart = Ladybug_3DChart(
    inputData=flatten([outdoorcomfortcalculator_5.thermalStress, outdoorcomfortcalculator_4.thermalStress, outdoorcomfortcalculator_3.thermalStress, outdoorcomfortcalculator.thermalStress, outdoorcomfortcalculator_2.thermalStress]),
    xScale="0.2",
    zScale="0",
    legendPar=legendpar)  # -> readMe, graphMesh, graphCurves, legend, legendBasePts, title, titleBasePts, dataPts, conditionalHOY; plug-in component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

# ----
test_shade = Brep(<brep referenced from the Rhino model>)
comfortshadebenefit = Ladybug_ComfortShadeBenefitEvaluator(
    location=importepw.location,
    temperatures=outdoorcomfortcalculator_3.universalThermalClimateIndex,
    testShades=test_shade,
    testRegion=_3_bench,
    gridSize=Slider(0.3, range=0..1),
    context=meyerson_fisherfinearts,
    north=unit,
    delNonIntersect=False,
    runIt=Toggle(True))  # -> readMe, port, sunVectors, regionTestPts, shadeMesh, legend, legendBasePoint, port_2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; plug-in component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
meshselector = Ladybug_MeshThresholdSelector(
    inputMesh=comfortshadebenefit.shadeMesh,
    analysisResult=comfortshadebenefit.shadeNetEffect,
    percentToKeep=Slider(50, range=0..100))  # -> readMe, totalValue, areaMeetsThresh, newColoredMesh, newMeshOutline; plug-in component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
