# Grasshopper definition Fan_di_Daylight.gh (Grasshopper 0.9.76)
# plug-ins: Python Interpreter

epshademat = Honeybee_EnergyPlusShadeMaterial()  # -> shadeMaterial; plug-in component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
ladybug = Ladybug_Ladybug()  # -> out; plug-in component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
honeybee = Honeybee_Honeybee()  # -> out; plug-in component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
updatehoneybee = Honeybee_UpdateHoneybee(updateAllUObjects=Toggle(True))  # -> out; plug-in component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
domain_box = DomainBox(Base=PlaneXY(0, 0, 0), X=Slider(5, range=0..100), Y=Slider(6, range=0..100), Z=Slider(3, range=0..100))
number_slider = Slider(0.3, range=0..100)
brep_wireframe = BrepWireframe(Brep=domain_box, Density=-1)
mass2zone = Honeybee_Masses2Zones(zoneMasses=flatten(domain_box), isConditioned=True, maxRoofAngle=30, createHBZones=Toggle(True))  # -> out, HBZones; plug-in component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
glzparamlist = Honeybee_GlazingParametersList(northGlzParam=Slider(0.3, range=0..100), westGlzParam=0, southGlzParam=Slider(0.7, range=0..1), eastGlzParam=0)  # -> glzParamList; plug-in component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
brep = Brep([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])
# SHADES
glazingcreator = Honeybee_GlazingBasedOnRatio(glzRatio=glzparamlist, runIt=Toggle(True))  # -> out, HBObjWGLZ; plug-in component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
addhbglz = Honeybee_addHBGlz(HBObj=mass2zone.HBZones, childSurfaces=flatten(brep))  # -> HBObjWGLZ; plug-in component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
brep_2 = Brep()
extrudewindows = Honeybee_ExtrudeWindows(glazings=flatten(brep), thickness=Slider(0.3, range=0..1))  # -> out, windowExtrusions; plug-in component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
brep_wireframe_2 = BrepWireframe(Brep=brep_2, Density=-1)
decomposebytype = Honeybee_DecomposeBasedOnType(HBZone=addhbglz)  # -> walls, interiorWalls, airWalls, windows, interiorWindows, skylights, roofs, ceilings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; plug-in component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
brep_wireframe_3 = BrepWireframe(Brep=addhbglz, Density=-1)
createhbsrfs = Honeybee_createHBSrfs(geometry=extrudewindows.windowExtrusions, srfType="0")  # -> out, simplify(HBSurface); plug-in component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
list_item = ListItem(List=decomposebytype.windows, Index="0", Wrap=True)
shddesigner = Ladybug_ShadingDesigner(glzSrf=flatten(list_item), depthOrVector=flatten("0.3"), numOfShds="2", runIt=Toggle(True), port_4=False)  # -> out, shadingSrfs; plug-in component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
panel = Panel("https://www.energyplus.net/weather-download/north_and_central_america_wmo_region_4/USA/PA/USA_PA_Philadelphia.Intl.AP.724080_TMY3/all")
epw_stat = Ladybug_OpenEPWAndSTATWeatherFiles(weatherFileURL=panel)  # -> epwFile, statFile; plug-in component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
genhbzonetestpts = Honeybee_GenerateZoneTestPoints(HBZone=addhbglz, gridSize=Slider(0.5, range=0..100), distBaseSrf=Slider(0.5, range=0..100), moveTestMesh=Toggle(True))  # -> out, simplify(testPoints), simplify(ptsVectors), simplify(facesArea), simplify(mesh); plug-in component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
createhbsrfs_2 = Honeybee_createHBSrfs(geometry=shddesigner.shadingSrfs, srfType="6")  # -> out, simplify(HBSurface); plug-in component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
genclimatebasedsky = Honeybee_GenerateClimateBasedSky(weatherFile=epw_stat.epwFile, month=Slider(12, range=0..100), day=Slider(21, range=0..100), hour=Slider(9, range=0..100))  # -> out, skyFilePath; plug-in component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
gridbasedsimulation = Honeybee_GridBasedSimulation(
    skyFile=genclimatebasedsky.skyFilePath,
    testPoints=genhbzonetestpts.testPoints,
    ptsVectors=genhbzonetestpts.ptsVectors,
    simulationType=0)  # -> analysisRecipe; plug-in component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
boolean_toggle = BooleanToggle(True)
rundaylightanalysis = Honeybee_RunDaylightSimulation(
    HBObjects=flatten([addhbglz, createhbsrfs_2.HBSurface, createhbsrfs.HBSurface]),
    analysisRecipe=gridbasedsimulation,
    writeRad=boolean_toggle,
    runRad=boolean_toggle,
    overwriteResults=True)  # -> out, analysisType, resultsUnit, illuminance_values, testPts, resultFiles, radGeoFile, studyFolder, done; plug-in component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
gradientlibrary = Ladybug_GradientLibrary(gradIndex=Slider(1, range=0..100))  # -> customColors; plug-in component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
legendpar = Ladybug_LegendParameters(
    lowBound=Slider(200, range=0..200),
    highBound=Slider(2000, range=1..2000),
    numSegments=Slider(10, range=0..100),
    customColors=flatten(gradientlibrary))  # -> legendPar; plug-in component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
construct_domain = ConstructDomain(DomainStart=0, DomainEnd=Slider(1, range=0..100))
recolormesh = Ladybug_RecolorMesh(
    analysisResult=rundaylightanalysis.illuminance_values,
    inputMesh=genhbzonetestpts.mesh,
    heightDomain=construct_domain,
    legendPar=legendpar,
    analysisTitle=rundaylightanalysis.analysisType,
    legendTitle=rundaylightanalysis.resultsUnit)  # -> out, newMesh, newLegend, legendBasePt, meshColors, legendColors; plug-in component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
epwindowshades = Honeybee_EnergyPlusWindowShadeGenerator()  # -> readMe, port, HBObjWShades, port_2, windowBreps, shadeBreps, port_3, zoneData9Tree; plug-in component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
panel_2 = Panel("MidriseApartment::Corridor")
createhbzones = Honeybee_createHBZones(name="zone1", zoneProgram=panel_2, HBSurfaces=flatten(epwindowshades.HBObjWShades), isConditioned=True)  # -> readMe, HBZone; plug-in component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
createhbzones_2 = Honeybee_createHBZones(name="zone1", zoneProgram=panel_2, HBSurfaces=flatten(epwindowshades.HBObjWShades), isConditioned=True)  # -> readMe, HBZone; plug-in component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

preview = CustomPreview(Geometry=epwindowshades.shadeBreps, Shader=ColourSwatch(SwatchColor=RGB(232, 232, 232)))
preview_2 = CustomPreview(Shader=ColourSwatch(SwatchColor=RGB(232, 232, 232)))
