# Grasshopper definition Di_Fan_Final Project.gh (Grasshopper 0.9.76)
# plug-ins: Python Interpreter, ItemSelector, DIVA Daylight, embryoA

# ----
# Room Preparation
# Ceiling
# Walls
# Floors
brep = Brep(<brep referenced from the Rhino model>)
brep_2 = Brep([<brep referenced from the Rhino model> x4])
brep_3 = Brep(<brep referenced from the Rhino model>)
createhbsrfs = Honeybee_createHBSrfs(geometry=[brep, brep_2, brep_3])  # -> out, simplify(HBSurface); plug-in component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
bldgprograms = Honeybee_bldgPrograms({"Office": 0, "Retail": 1, "MidriseApartment": 2, "PrimarySchool": 3, "SecondarySchool": 4, "SmallHotel": 5, "LargeHotel": 6, "Hospital": 7, "Outpatient": 8, "Warehouse": 9, "SuperMarket": 10, "FullServiceRestaurant": 11, "QuickServiceRestaurant": 12}, selected="MidriseApartment")
listzoneprograms = Honeybee_ListZonePrograms(bldgProgram=bldgprograms)  # -> MidriseApartmentZonePrograms; plug-in component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
list = Honeybee_ItemSelector(
    listzoneprograms,
    {"MidriseApartment::Apartment", "MidriseApartment::Office", "MidriseApartment::Corridor"}, selected="MidriseApartment::Apartment")
panel = Panel(list)
createhbzones = Honeybee_createHBZones(
    name="Dream Room in Philadelphia",
    zoneProgram=list,
    HBSurfaces=flatten(createhbsrfs.HBSurface),
    isConditioned=Toggle(False))  # -> out, HBZone; plug-in component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

# ----
# Stategy 1
# Orientation
number_slider = Slider(180, range=-90..180)

honeybee = Honeybee_Honeybee()  # -> out; plug-in component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
ladybug = Ladybug_Ladybug()  # -> out; plug-in component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
updateladybug = Ladybug_UpdateLadybug(updateThisFile=Toggle(True))  # -> out; plug-in component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
updatehoneybee = Honeybee_UpdateHoneybee(updateThisFile=Toggle(True))  # -> out; plug-in component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

# ----
# Climate Data
honeybee_2 = Honeybee_Honeybee()  # -> out; plug-in component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
ladybug_2 = Ladybug_Ladybug()  # -> out; plug-in component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
panel_2 = Panel("https://www.energyplus.net/weather-download/north_and_central_america_wmo_region_4/USA/PA/USA_PA_Philadelphia.Intl.AP.724080_TMY3/all")
panel_3 = Panel("https://www.energyplus.net/weather-download/north_and_central_america_wmo_region_4/USA/PA/USA_PA_Philadelphia.Intl.AP.724080_TMY3/all")
epw_stat = Ladybug_OpenEPWAndSTATWeatherFiles(weatherFileURL=panel_2)  # -> epwFile, statFile; plug-in component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
updateladybug_2 = Ladybug_UpdateLadybug(updateThisFile=Toggle(True))  # -> out; plug-in component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
epw_stat_2 = Ladybug_OpenEPWAndSTATWeatherFiles(weatherFileURL=panel_3)  # -> epwFile, statFile; plug-in component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
importepw = Ladybug_ImportEpw(epwFile=epw_stat.epwFile)  # -> Output, latitude, location, dryBulbTemperature, dewPointTemperature, relativeHumidity, windSpeed, windDirection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; plug-in component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
importepw_2 = Ladybug_ImportEpw(epwFile=epw_stat_2.epwFile)  # -> Output, latitude, location, dryBulbTemperature, dewPointTemperature, relativeHumidity, windSpeed, windDirection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; plug-in component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
gradientlibrary = Ladybug_GradientLibrary(gradIndex=Slider(13, range=0..100))  # -> customColors; plug-in component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
psychchart = Ladybug_PsychrometricChart(
    dryBulbTemperature=importepw.dryBulbTemperature,
    relativeHumidity=importepw.relativeHumidity,
    windSpeed=importepw.windSpeed,
    runIt=Toggle(False))  # -> out, port, totalComfortPercent, totalComfortOrNot, strategyNames, strategyPercentOfTime, strategyOrNot, port_2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; plug-in component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
legendpar = Ladybug_LegendParameters(customColors=flatten(gradientlibrary))  # -> legendPar; plug-in component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
legendpar_2 = Ladybug_LegendParameters(customColors=flatten([ColourSwatch(SwatchColor=RGB(255, 255, 255)), ColourSwatch(SwatchColor=RGB(11, 157, 214))]))  # -> legendPar; plug-in component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
point = Point(<point referenced from the Rhino model>)
gradientlibrary_2 = Ladybug_GradientLibrary(gradIndex=Slider(9, range=0..10))  # -> customColors; plug-in component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
point_2 = Point(<point referenced from the Rhino model>)
colour_swatch = ColourSwatch(SwatchColor=RGB(119, 185, 242))
colour_swatch_2 = ColourSwatch(SwatchColor=RGB(227, 48, 48))
legendpar_3 = Ladybug_LegendParameters(customColors=flatten([ColourSwatch(SwatchColor=RGB(255, 255, 255)), ColourSwatch(SwatchColor=RGB(223, 116, 227))]))  # -> legendPar; plug-in component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
_3dchart = Ladybug_3DChart(
    inputData=flatten(importepw_2.relativeHumidity),
    basePoint=point_2,
    xScale=Slider(0.2, range=0..1),
    zScale=Slider(0, range=0..100),
    legendPar=legendpar_2)  # -> out, graphMesh, graphCurves, legend, legendBasePts, title, titleBasePts, dataPts, conditionalHOY; plug-in component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
gencumulativeskymtx = Ladybug_GenCumulativeSkyMtx(epwFile=epw_stat_2.epwFile, skyDensity=0, useOldRes=True, runIt=Toggle(True))  # -> readMe, cumulativeSkyMtx; plug-in component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
legendpar_4 = Ladybug_LegendParameters(customColors=flatten(gradientlibrary_2))  # -> legendPar; plug-in component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
_3dchart_2 = Ladybug_3DChart(
    inputData=flatten(importepw_2.dewPointTemperature),
    basePoint=point,
    xScale=Slider(0.2, range=0..1),
    zScale=Slider(0, range=0..100),
    legendPar=legendpar)  # -> out, graphMesh, graphCurves, legend, legendBasePts, title, titleBasePts, dataPts, conditionalHOY; plug-in component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
selectskymtx = Ladybug_selectSkyMtx(cumulativeSkyMtx=gencumulativeskymtx.cumulativeSkyMtx, removeDiffuse=False, removeDirect=False)  # -> readMe, selectedSkyMtx; plug-in component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
point_3 = Point(<point referenced from the Rhino model>)
point_4 = Point(<point referenced from the Rhino model>)
analysisperiod = Ladybug_AnalysisPeriod(fromMonth="12", toMonth="2")  # -> out, analysisPeriod; plug-in component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
radiationrose = Ladybug_RadiationRose(selectedSkyMtx=selectskymtx.selectedSkyMtx, centerPoint=point_4, arrowHeadScale=1, runIt=Toggle(True))  # -> readMe, radiationArrowsMesh, radRoseBaseCrvs, legend, legendBasePts, radRoseEndPts, radRoseValues; plug-in component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
boolean_toggle = BooleanToggle(True)
analysisperiod_2 = Ladybug_AnalysisPeriod()  # -> out, analysisPeriod; plug-in component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
windrose = Ladybug_WindRose(
    north=0,
    hourlyWindDirection=importepw_2.windDirection,
    hourlyWindSpeed=importepw_2.windSpeed,
    analysisPeriod=analysisperiod.analysisPeriod,
    legendPar=legendpar_3,
    runIt=Toggle(False))  # -> out, calmRoseMesh, windRoseMesh, windRoseCrvs, windRoseCenPts, legend, legendBasePts, title; plug-in component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
solaradjusttemperature = Ladybug_OutdoorSolarTemperatureAdjustor(
    location=importepw_2.location,
    cumSkyMtxOrDirNormRad=importepw_2.directNormalRadiation,
    diffuseHorizRad=importepw_2.diffuseHorizontalRadiation,
    baseTemperature=importepw_2.dryBulbTemperature,
    horizInfraredRad=importepw_2.horizontalInfraredRadiation,
    analysisPeriodOrHOY=analysisperiod_2.analysisPeriod,
    parallel=boolean_toggle,
    runIt=boolean_toggle)  # -> readMe, port, effectiveRadiantField, MRTDelta, solarAdjustedMRT, port_2, mannequinMesh, port_3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; plug-in component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
outdoorcomfortcalculator = Ladybug_OutdoorComfortCalculator(
    dryBulbTemperature=importepw.dryBulbTemperature,
    meanRadiantTemperature=solaradjusttemperature.solarAdjustedMRT,
    relativeHumidity=importepw.relativeHumidity,
    runIt=Toggle(True))  # -> out, port, universalThermalClimateIndex, comfortableOrNot, thermalStress, conditionOfPerson, port_2, percentOfTimeComfortable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; plug-in component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
panel_4 = Panel([outdoorcomfortcalculator.percentOfTimeComfortable, outdoorcomfortcalculator.percentHeatStress, outdoorcomfortcalculator.percentColdStress])
_3dchart_3 = Ladybug_3DChart(
    inputData=flatten(outdoorcomfortcalculator.conditionOfPerson),
    basePoint=point_3,
    xScale=Slider(0.2, range=0..1),
    zScale=Slider(0, range=0..100),
    legendPar=legendpar_4)  # -> out, graphMesh, graphCurves, legend, legendBasePts, title, titleBasePts, dataPts, conditionalHOY; plug-in component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
gradientlibrary_3 = Ladybug_GradientLibrary(gradIndex=Slider(9, range=0..100))  # -> customColors; plug-in component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
panel_5 = Panel("""6
9
12""")
legendpar_5 = Ladybug_LegendParameters(lowBound="-3", highBound="3", numSegments=Slider(7, range=0..10), customColors=flatten(gradientlibrary_3))  # -> legendPar; plug-in component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
series = Series(Start=Slider(1, range=0..1), Step=1, Count=Slider(24, range=0..100))
point_5 = Point(<point referenced from the Rhino model>)
analysisperiod_3 = Ladybug_AnalysisPeriod()  # -> out, analysisPeriod; plug-in component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
sunpath = Ladybug_SunPath(
    location=importepw_2.location,
    hour=series,
    day=21,
    month=panel_5,
    timeStep=1,
    centerPt=point_5,
    annualHourlyData=flatten(outdoorcomfortcalculator.conditionOfPerson),
    legendPar=legendpar_5,
    dailyOrAnnualSunPath=True)  # -> out, sunVectors, sunAltitudes, sunAzimuths, port, sunSpheresMesh, sunPathCrvs, legend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; plug-in component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
day_month_hour_calculator = Ladybug_Day_Month_Hour()  # -> day, month, hour, date; plug-in component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
Z = UnitZ(Factor="30")
move = Move(Geometry=sunpath.sunPositions, Motion=Z)  # -> Geometry, Transform
tag = TextTag(Location=move.Geometry, Text=day_month_hour_calculator.date)

# ---- group: glass facade
glass = Brep(<brep referenced from the Rhino model>)

# ---- group: furniture
furniture = Brep([<brep referenced from the Rhino model> x11])

# ----
# Original Glazing Ratio
brep_4 = Brep(<brep referenced from the Rhino model>)  # disabled

# ----
# Strategy 2
# Glazing Ratio
# North 20%
# West 40%
# East  40%
brep_5 = Brep([<brep referenced from the Rhino model> x2])
brep_6 = Brep(<brep referenced from the Rhino model>)
brep_7 = Brep(<brep referenced from the Rhino model>)

glare = Glare(
    Name="Temp",
    RhinoScene=False,
    Sky=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,
    Run=False,
    BooleanValue_0=False,
    BooleanValue_1=False,
    BooleanValue_10=False,
    BooleanValue_11=False,
    BooleanValue_12=False,
    BooleanValue_13=False,
    BooleanValue_14=False,
    BooleanValue_15=False,
    BooleanValue_16=False,
    BooleanValue_17=False,
    BooleanValue_18=False,
    BooleanValue_19=False,
    BooleanValue_2=False,
    BooleanValue_20=False,
    BooleanValue_3=False,
    BooleanValue_4=False,
    BooleanValue_5=False,
    BooleanValue_6=False,
    BooleanValue_7=False,
    BooleanValue_8=True,
    BooleanValue_9=False,
    Hidden_0=False,
    Hidden_1=False,
    Hidden_10=True,
    Hidden_11=True,
    Hidden_12=True,
    Hidden_13=True,
    Hidden_14=True,
    Hidden_15=True,
    Hidden_16=True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)  # -> Out, Pic, Image, Falsecolor, Evalglare, DGP, DGR

# ----
# Stategy 4
# Change Material
panel_6 = Panel("Floor")
callfromepconstrlibrary = Honeybee_CallFromEPConstructionLibrary(keywords=panel_6)  # -> ThermMaterials, EPMaterials, EPWindowMaterials, EPConstructions; plug-in component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
callfromepconstrlibrary_2 = Honeybee_CallFromEPConstructionLibrary(keywords="wall")  # -> ThermMaterials, EPMaterials, EPWindowMaterials, EPConstructions; plug-in component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
callfromepconstrlibrary_3 = Honeybee_CallFromEPConstructionLibrary(keywords="window")  # -> ThermMaterials, EPMaterials, EPWindowMaterials, EPConstructions; plug-in component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

panel_7 = Panel(callfromepconstrlibrary.EPConstructions)
analysisperiod_4 = Ladybug_AnalysisPeriod(fromHour="20", toHour="24")  # -> out, analysisPeriod; plug-in component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
analysisperiod_5 = Ladybug_AnalysisPeriod(fromHour="0", toHour="8")  # -> out, analysisPeriod; plug-in component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
legendpar_6 = Ladybug_LegendParameters(customColors=flatten([ColourSwatch(SwatchColor=RGB(255, 255, 255)), ColourSwatch(SwatchColor=RGB(11, 157, 214))]))  # -> legendPar; plug-in component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
point_6 = Point(<point referenced from the Rhino model>)
point_7 = Point(<point referenced from the Rhino model>)

# ----
# Glare Analysis
# Geometry Preparation
# Honeybee default materials will be assigned
# based on surface type
# Run the analysis
# DGP: Daylight glare probability:
# Imperceptible Glare [0.35 > DGP]
# Perceptible Glare [0.4 > DGP >= 0.35]
# Disturbing Glare [0.45 > DGP >= 0.4]
# Intolerable Glare [DGP >= 0.45]
# Assign specific materials
# Analysis Recipe
# set the view
panel_8 = Panel("https://www.energyplus.net/weather-download/north_and_central_america_wmo_region_4/USA/PA/USA_PA_Philadelphia.Intl.AP.724080_TMY3/all")
epw_stat_3 = Ladybug_OpenEPWAndSTATWeatherFiles(weatherFileURL=panel_8)  # -> epwFile, statFile; plug-in component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
radopaquematerial = Honeybee_RadianceOpaqueMaterial(materialName="generic_35", RReflectance=".35", GReflectance=".35", BReflectance=".35", roughness=0.05, specularity=0)  # -> avrgRef, RADMaterial; plug-in component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
radglassmaterial = Honeybee_RadianceGlassMaterial(materialName="glass_.65", RTransmittance=".65", GTransmittance=".65", BTransmittance=".65", refractiveIndex=1.52)  # -> avrgTrans, RADMaterial; plug-in component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
number_slider_2 = Slider(0, range=0..100)
createhbsrfs_2 = Honeybee_createHBSrfs(geometry=furniture, RADMaterial=radopaquematerial.RADMaterial)  # -> readMe, simplify(HBSurface); plug-in component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
createhbsrfs_3 = Honeybee_createHBSrfs(geometry=glass, srfType="5", RADMaterial=radglassmaterial.RADMaterial)  # -> readMe, simplify(HBSurface); plug-in component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
createhbsrfs_4 = Honeybee_createHBSrfs(geometry=brep_3, srfType="2")  # -> readMe, simplify(HBSurface); plug-in component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
createhbsrfs_5 = Honeybee_createHBSrfs(geometry=brep, srfType="3")  # -> readMe, simplify(HBSurface); plug-in component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
genclimatebasedsky = Honeybee_GenerateClimateBasedSky(north=number_slider_2, weatherFile=epw_stat_3.epwFile, month="3", day="21", hour="9")  # -> radiationValues, skyFilePath; plug-in component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
createhbsrfs_6 = Honeybee_createHBSrfs(geometry=brep_2, srfType="0")  # -> readMe, simplify(HBSurface); plug-in component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
genavgsky = Honeybee_GenerateAverageSky(north=number_slider_2, weatherFile=epw_stat_3.epwFile, month="3", hour="9")  # -> radiationValues, skyFilePath; plug-in component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
northarrow = Ladybug_North(north=number_slider_2, scale=".05")  # -> northSign; plug-in component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
panel_9 = Panel([genclimatebasedsky.radiationValues, genavgsky.radiationValues])
set_the_view_to_fisheye_for_glare_analys = Panel("1")  # "set the view to FishEye for Glare Analysis"
radparameters = Honeybee_RADParameters(quality=0, ab="3")  # -> readMe, radParameters; plug-in component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
doy_hoy = Ladybug_DOY_HOY(days="21", months="3", hours="9")  # -> HOY, DOY, date; plug-in component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
point_8 = Point(<point referenced from the Rhino model>)
imagebasedsimulation = Honeybee_ImageBasedSimulation(
    skyFile=genavgsky.skyFilePath,
    cameraType=set_the_view_to_fisheye_for_glare_analys,
    simulationType=2,
    radParameters=radparameters.radParameters,
    backupImages=0)  # -> analysisRecipe; plug-in component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
toggle = BooleanToggle(True)
panel_10 = Panel("""Radiance
Grasshopper
Honeybee
Glare
Daylight
Set View
HBExampleFiles""")
panel_11 = Panel("""This file shows how to run a glare analysis using Honeybee. This example is using same geometry as the other daylighting examples [[1](http://hydrashare.github.io/hydra/viewer?owner=mostaphaRoudsari&fork=hydra_1&id=Surface_by_surface_geometry_preparation_for_daylight_simulation_II), [2](http://hydrashare.github.io/hydra/viewer?owner=mostaphaRoudsari&fork=hydra_1&id=Find_when_sun_is_visible_to_a_point)].
The example is uses Averaged Climate-based Sky for glare analysis which uses the average value for that hour during the whole month.""")
md_slider = MDSlider(
    slider_value=Point(0.5215606689, 0.5079524343, 0.5),
    SliderMode=0,
    x_domain=Domain(-1, 1),
    y_domain=Domain(-1, 1),
    z_domain=Domain(0, 1))
panel_12 = Panel("C:\Users\Administrator\Dropbox\ladybug\helpDesk\PennDesign2015\Daylight_Glare_Analysis.png")
exporthydra = Hydra_ExportFile(
    fileName="Glare Analysis",
    fileDescription=panel_11,
    fileTags=panel_10,
    targetFolder="C:\Users\Administrator\Documents\GitHub\hydra_1",
    includeRhino=Toggle(True),
    additionalImgs=panel_12,
    export=Toggle(False))  # -> readMe; inputs fileDescription: list, changeLog: list, fileTags: list, includeRhino: Boolean, GHForThumb: Boolean, additionalImgs: list, export: Boolean; plug-in component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
hdr_tif = Honeybee_ConvertHDRToTIF(adjustExposure=Toggle(False))  # -> TIFFFilePath; plug-in component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
number_slider_3 = Slider(0.8, range=0..1)
image = ImageFromPath(P=hdr_tif, S=number_slider_3)

# ---- group: For better visualization - Doesn't effect the results of the analysis
importlocation = Ladybug_ImportLocation(epwFile=epw_stat_3.epwFile)  # -> location; plug-in component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
sunpath_2 = Ladybug_SunPath(
    north=number_slider_2,
    location=importlocation,
    hour="9",
    day="21",
    month="3",
    timeStep=1,
    sunPathScale=Slider(0.2, range=0..1),
    dailyOrAnnualSunPath=True)  # -> readMe, sunVectors, sunAltitudes, sunAzimuths, port, sunSpheresMesh, sunPathCrvs, legend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; plug-in component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

# ---- group: collect all honeybee surfaces
brep_8 = Brep(flatten([createhbsrfs_6.HBSurface, createhbsrfs_5.HBSurface, createhbsrfs_4.HBSurface, createhbsrfs_2.HBSurface, createhbsrfs_3.HBSurface]))

# ----
# Daylight Simulation
# SHADES
brep_9 = Brep(<brep referenced from the Rhino model>)
addhbglz = Honeybee_addHBGlz(HBObj=createhbzones.HBZone, childSurfaces=flatten([brep_5, brep_6, brep_7]))  # -> HBObjWGLZ; plug-in component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
decomposebytype = Honeybee_DecomposeBasedOnType(HBZone=addhbglz)  # -> walls, interiorWalls, airWalls, windows, interiorWindows, skylights, roofs, ceilings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; plug-in component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
extrudewindows = Honeybee_ExtrudeWindows(glazings=flatten(brep_9), thickness=Slider(0.1, range=0..1))  # -> out, windowExtrusions; disabled; plug-in component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
brep_wireframe = BrepWireframe(Brep=addhbglz, Density=-1)
shddesigner = Ladybug_ShadingDesigner(glzSrf=flatten(addhbglz), depthOrVector=flatten("0.3"), numOfShds="2", runIt=Toggle(True), port_4=False)  # -> out, shadingSrfs; plug-in component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
panel_13 = Panel("https://www.energyplus.net/weather-download/north_and_central_america_wmo_region_4/USA/PA/USA_PA_Philadelphia.Intl.AP.724080_TMY3/all")
epw_stat_4 = Ladybug_OpenEPWAndSTATWeatherFiles(weatherFileURL=panel_13)  # -> epwFile, statFile; plug-in component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
createhbsrfs_7 = Honeybee_createHBSrfs(geometry=shddesigner.shadingSrfs, srfType="6")  # -> out, simplify(HBSurface); plug-in component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
createhbsrfs_8 = Honeybee_createHBSrfs(geometry=extrudewindows.windowExtrusions, srfType="0")  # -> out, simplify(HBSurface); plug-in component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
genhbzonetestpts = Honeybee_GenerateZoneTestPoints(HBZone=addhbglz, gridSize=Slider(0.5, range=0..100), distBaseSrf=Slider(0.5, range=0..100), moveTestMesh=Toggle(True))  # -> out, simplify(testPoints), simplify(ptsVectors), simplify(facesArea), simplify(mesh); plug-in component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
genclimatebasedsky_2 = Honeybee_GenerateClimateBasedSky(
    weatherFile=epw_stat_4.epwFile,
    month=Slider(3, range=0..100),
    day=Slider(21, range=0..100),
    hour=Slider(12, range=0..100))  # -> out, skyFilePath; plug-in component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
gridbasedsimulation = Honeybee_GridBasedSimulation(
    skyFile=genclimatebasedsky_2.skyFilePath,
    testPoints=genhbzonetestpts.testPoints,
    ptsVectors=genhbzonetestpts.ptsVectors,
    simulationType=0)  # -> analysisRecipe; plug-in component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
boolean_toggle_2 = BooleanToggle(True)
gradientlibrary_4 = Ladybug_GradientLibrary(gradIndex=Slider(0, range=0..100))  # -> customColors; plug-in component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
construct_domain = ConstructDomain(DomainStart=0, DomainEnd=Slider(1, range=0..100))
legendpar_7 = Ladybug_LegendParameters(
    lowBound=Slider(200, range=0..200),
    highBound=Slider(2000, range=1..2000),
    numSegments=Slider(10, range=0..100),
    customColors=flatten(gradientlibrary_4))  # -> legendPar; plug-in component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

list_item = ListItem(List=decomposebytype.windows, Index="0", Wrap=True)
list_item_2 = ListItem(List=decomposebytype.windows, Index="1", Wrap=True)
list_item_3 = ListItem(List=decomposebytype.windows, Index="2", Wrap=True)
shddesigner_2 = Ladybug_ShadingDesigner(glzSrf=flatten(list_item), depthOrVector=flatten("0.3"), numOfShds="8", runIt=Toggle(True), port_4=False)  # -> out, shadingSrfs; plug-in component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
shddesigner_3 = Ladybug_ShadingDesigner(glzSrf=flatten(list_item_2), depthOrVector=flatten("0.3"), numOfShds="4", runIt=Toggle(True), port_4=False)  # -> out, shadingSrfs; plug-in component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
shddesigner_4 = Ladybug_ShadingDesigner(glzSrf=flatten(list_item_3), depthOrVector=flatten("0.3"), numOfShds="12", runIt=Toggle(True), port_4=False)  # -> out, shadingSrfs; plug-in component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
list_item_4 = ListItem(List=decomposebytype.windows, Index="3", Wrap=True)
shddesigner_5 = Ladybug_ShadingDesigner(glzSrf=flatten(list_item_4), depthOrVector=flatten("0.3"), numOfShds="12", runIt=Toggle(True), port_4=False)  # -> out, shadingSrfs; plug-in component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
volume = Volume(Geometry=addhbglz)  # -> Volume, Centroid
rotatehbobj = Honeybee_RotateHoneybee(HBObj=addhbglz, angle=Slider(330, range=0..1000), cenPt=volume.Centroid)  # -> HBObj; disabled; plug-in component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
wires = BrepWireframe(Brep=rotatehbobj, Density=-1)
createhbsrfs_9 = Honeybee_createHBSrfs(
    geometry=[shddesigner_5.shadingSrfs, shddesigner_3.shadingSrfs, shddesigner_2.shadingSrfs, shddesigner_4.shadingSrfs],
    srfType="6")  # -> out, simplify(HBSurface); plug-in component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
createhbzones_2 = Honeybee_createHBZones(HBSurfaces=flatten([createhbsrfs_9.HBSurface, addhbglz]), isConditioned=True)  # -> out, HBZone; plug-in component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

rundaylightanalysis = Honeybee_RunDaylightSimulation(
    HBObjects=flatten([createhbsrfs_9.HBSurface, addhbglz]),
    analysisRecipe=gridbasedsimulation,
    writeRad=boolean_toggle_2,
    runRad=boolean_toggle_2,
    overwriteResults=True)  # -> out, analysisType, resultsUnit, illuminance_values, testPts, illuminance_files, radGeoFile, studyFolder, done; plug-in component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
recolormesh = Ladybug_RecolorMesh(
    analysisResult=rundaylightanalysis.illuminance_values,
    inputMesh=genhbzonetestpts.mesh,
    heightDomain=construct_domain,
    legendPar=legendpar_7,
    analysisTitle=rundaylightanalysis.analysisType,
    legendTitle=rundaylightanalysis.resultsUnit)  # -> out, newMesh, newLegend, legendBasePt, meshColors, legendColors; disabled; plug-in component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

recolormesh_2 = Ladybug_RecolorMesh(
    analysisResult=rundaylightanalysis.illuminance_values,
    inputMesh=genhbzonetestpts.mesh,
    legendPar=legendpar_7,
    analysisTitle=rundaylightanalysis.analysisType,
    legendTitle=rundaylightanalysis.resultsUnit)  # -> out, newMesh, newLegend, legendBasePt, meshColors, legendColors; plug-in component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
recolormesh_3 = Ladybug_RecolorMesh(
    analysisResult=rundaylightanalysis.illuminance_values,
    inputMesh=genhbzonetestpts.mesh,
    legendPar=legendpar_7,
    analysisTitle=rundaylightanalysis.analysisType,
    legendTitle=rundaylightanalysis.resultsUnit)  # -> out, newMesh, newLegend, legendBasePt, meshColors, legendColors; plug-in component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
recolormesh_4 = Ladybug_RecolorMesh(
    analysisResult=rundaylightanalysis.illuminance_values,
    inputMesh=genhbzonetestpts.mesh,
    legendPar=legendpar_7,
    analysisTitle=rundaylightanalysis.analysisType,
    legendTitle=rundaylightanalysis.resultsUnit)  # -> out, newMesh, newLegend, legendBasePt, meshColors, legendColors; plug-in component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
recolormesh_5 = Ladybug_RecolorMesh(
    analysisResult=rundaylightanalysis.illuminance_values,
    inputMesh=genhbzonetestpts.mesh,
    heightDomain=construct_domain,
    legendPar=legendpar_7,
    analysisTitle=rundaylightanalysis.analysisType,
    legendTitle=rundaylightanalysis.resultsUnit)  # -> out, newMesh, newLegend, legendBasePt, meshColors, legendColors; plug-in component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

# ----
# Stategy 3
# Natural Ventilation
panel_14 = Panel("24")
list_2 = ValueList({"NoVent": 0, "NatrVent": 1}, selected="NatrVent")
setepnatvent = Honeybee_SetEPAirFlow(
    HBZones=addhbglz,
    naturalVentilationType=list_2,
    minIndoorTempForNatVent=panel_14,
    maxOutdoorTempForNatVent="28",
    fractionOfGlzAreaOperable="1")  # -> readMe, simplify(HBZones); plug-in component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

pt = Point(Point(3, 2.544838682, 0.1224289629))
comfortmannequin = Ladybug_ComfortMannequin(rotationAngle="0", bodyLocation=point_8)  # -> mannequinMesh, legend, legendBasePt; plug-in component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

# ---- group: Person's face!
item = ListItem(List=comfortmannequin.mannequinMesh, Index=121, Wrap=True)

# ----
wires_2 = BrepWireframe(Brep=brep_8, Density=-1)
rundaylightanalysis_2 = Honeybee_RunDaylightSimulation(
    HBObjects=flatten(brep_8),
    analysisRecipe=imagebasedsimulation,
    writeRad=toggle,
    runRad=toggle,
    numOfCPUs="4",
    radFileName=doy_hoy.date,
    overwriteResults=True)  # -> readMe, analysisType, resultsUnit, results, testPts, luminance_files, radGeoFile, studyFolder, done; plug-in component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
facen = FaceNormals(Mesh=item)  # -> Centers, Normals
settheview = Ladybug_SetTheView(cameraLocation=facen.Centers, cameraDirection=facen.Normals, uvLookAround=md_slider)  # -> readMe; plug-in component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
glareanalysis = Honeybee_GlareAnalysis(HDRImagePath=rundaylightanalysis_2.luminance_files, runIt=Toggle(True))  # -> readMe, glareCheckImage, DGP, DGI, imageWithTaskArea; plug-in component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
falsecolor = Honeybee_FalseColor(
    HDRFilePath=rundaylightanalysis_2.luminance_files,
    contourBands=False,
    maskThreshold=0.1,
    useAlterColors=False,
    render=Toggle(True))  # -> outputFilePath; plug-in component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
panel_15 = Panel(glareanalysis.DGP)
hdr_tif_2 = Honeybee_ConvertHDRToTIF(HDRFilePath=falsecolor, adjustExposure=False)  # -> TIFFFilePath; plug-in component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
image_2 = ImageFromPath(P=hdr_tif_2, S=number_slider_3)

preview = CustomPreview(Geometry=item, Shader=ColourSwatch(SwatchColor=RGB(255, 0, 0)))

glareanalysis_2 = Honeybee_GlareAnalysis(HDRImagePath=rundaylightanalysis_2.luminance_files)  # -> readMe, glareCheckImage, DGP, DGI, glareComfortRange, imageWithTaskArea; plug-in component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

# ----
# Construction Material
list_item_5 = ListItem(List=callfromepconstrlibrary_3.EPConstructions, Index=0, Wrap=True)
list_item_6 = ListItem(List=callfromepconstrlibrary.EPConstructions, Index=Slider(40, range=0..100), Wrap=True)
decomposeepconstruction = Honeybee_DecomposeEPConstruction(cnstrName=list_item_5)  # -> materials, comments, UValue_SI, UValue_IP, RValue_SI, RValue_IP; plug-in component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
panel_16 = Panel(callfromepconstrlibrary_2.EPConstructions)
decomposeepconstruction_2 = Honeybee_DecomposeEPConstruction(cnstrName=list_item_6)  # -> materials, comments, UValue_SI, UValue_IP, RValue_SI, RValue_IP; plug-in component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
list_item_7 = ListItem(List=callfromepconstrlibrary_2.EPConstructions, Index=Slider(11, range=0..1000), Wrap=True)
honeybee_item_selector = Honeybee_ItemSelector(decomposeepconstruction.materials, {"Theoretical Glass [167]"}, selected="Theoretical Glass [167]")
decomposeepconstruction_3 = Honeybee_DecomposeEPConstruction(cnstrName=list_item_7)  # -> materials, comments, UValue_SI, UValue_IP, RValue_SI, RValue_IP; plug-in component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
panel_17 = Panel(decomposeepconstruction_2.materials)
panel_18 = Panel(decomposeepconstruction_3.materials)
decomposeepmaterial = Honeybee_DecomposeEPMaterial(materialName=simplify(honeybee_item_selector))  # -> names, values, comments, UValue_SI, UValue_IP, RValue_SI, RValue_IP; plug-in component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
panel_19 = Panel([decomposeepmaterial.values, decomposeepmaterial.names])
callfromepconstrlibrary_4 = Honeybee_CallFromEPConstructionLibrary(keywords="roof")  # -> ThermMaterials, EPMaterials, EPWindowMaterials, EPConstructions; plug-in component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
callfromepconstrlibrary_5 = Honeybee_CallFromEPConstructionLibrary(keywords="mass")  # -> ThermMaterials, EPMaterials, EPWindowMaterials, EPConstructions; plug-in component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
item_2 = ListItem(List=callfromepconstrlibrary_4.EPConstructions, Index=Slider(71, range=0..100), Wrap=True)
item_3 = ListItem(List=callfromepconstrlibrary_5.EPConstructions, Index=Slider(88, range=0..100), Wrap=True)
panel_20 = Panel(callfromepconstrlibrary_4.EPConstructions)
decomposeepconstruction_4 = Honeybee_DecomposeEPConstruction(cnstrName=item_2)  # -> materials, comments, UValue_SI, UValue_IP, RValue_SI, RValue_IP; plug-in component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
panel_21 = Panel(item_2)
decomposeepconstruction_5 = Honeybee_DecomposeEPConstruction(cnstrName=item_3)  # -> materials, comments, UValue_SI, UValue_IP, RValue_SI, RValue_IP; plug-in component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
panel_22 = Panel(item_3)
list_3 = Honeybee_ItemSelector(
    decomposeepconstruction_4.materials,
    {"Roof Membrane", "IEAD NonRes Roof Insulation-3.03", "Metal Decking"}, selected="Roof Membrane")
panel_23 = Panel(decomposeepconstruction_4.RValue_IP)
list_4 = Honeybee_ItemSelector(
    decomposeepconstruction_5.materials,
    {"1IN Stucco", "8IN CONCRETE HW RefBldg", "Mass NonRes Wall Insulation-1.30", "1/2IN Gypsum"}, selected="8IN CONCRETE HW RefBldg")
panel_24 = Panel(decomposeepconstruction_5.RValue_IP)
decomposeepmaterial_2 = Honeybee_DecomposeEPMaterial(materialName=simplify(list_3))  # -> names, values, comments, UValue_SI, UValue_IP, RValue_SI, RValue_IP; plug-in component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
decomposeepmaterial_3 = Honeybee_DecomposeEPMaterial(materialName=simplify(list_4))  # -> names, values, comments, UValue_SI, UValue_IP, RValue_SI, RValue_IP; plug-in component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
panel_26 = Panel([decomposeepmaterial_2.values, decomposeepmaterial_2.names])
panel_27 = Panel([decomposeepmaterial_3.names, decomposeepmaterial_3.values])
panel_28 = Panel(decomposeepmaterial_2.comments)
panel_29 = Panel(decomposeepmaterial_3.comments)

# ----
# Stategy 4
# Change Material
panel_30 = Panel("SHGC")
panel_31 = Panel(callfromepconstrlibrary_5.EPConstructions)
epwindowmat = Honeybee_EnergyPlusWindowMaterial(name=panel_30, U_Value="0.3704", SHGC="0.6", VT="0.73")  # -> EPMaterial; plug-in component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
epconstruction = Honeybee_EnergyPlusConstruction(name="lowE", layer_1=epwindowmat)  # -> EPConstruction; plug-in component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

setepzonecnstr = Honeybee_SetEPZoneConstruction(
    HBZones=setepnatvent.HBZones,
    wallEPConstruction=list_item_7,
    windowEPConstruction=epconstruction,
    roofEPConstruction=item_2,
    floorEPConstruction=list_item_6)  # -> simplify(modifiedHBZones); plug-in component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

# ----
# Energy Simulation
boolean_toggle_3 = BooleanToggle(True)
panel_32 = Panel("https://www.energyplus.net/weather-download/north_and_central_america_wmo_region_4/USA/PA/USA_PA_Philadelphia.Intl.AP.724080_TMY3/all")
epoutput = Honeybee_GenerateEPOutput(
    zoneEnergyUse=boolean_toggle_3,
    zoneGainsAndLosses=boolean_toggle_3,
    zoneComfortMetrics=boolean_toggle_3,
    zoneHVACParams=boolean_toggle_3,
    surfaceTempAnalysis=boolean_toggle_3,
    surfaceEnergyAnalysis=boolean_toggle_3,
    glazingSolarAnalysis=boolean_toggle_3)  # -> out, flatten(simulationOutputs); plug-in component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
epw_stat_5 = Ladybug_OpenEPWAndSTATWeatherFiles(weatherFileURL=panel_32)  # -> epwFile, statFile; plug-in component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
runenergysimulation = Honeybee_RunEnergySimulation(epwFile=epw_stat_5.epwFile)  # -> out, idfFileAddress, resultFileAddress; plug-in component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
toggle_2 = BooleanToggle(True)
runenergysimulation_2 = Honeybee_RunEnergySimulation(
    epwFile=epw_stat_5.epwFile,
    analysisPeriod=analysisperiod_4.analysisPeriod,
    HBZones=flatten(setepzonecnstr),
    simulationOutputs=flatten(epoutput.simulationOutputs),
    writeIdf=toggle_2,
    runEnergyPlus=toggle_2)  # -> out, idfFileAddress, resultFileAddress; plug-in component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
readepsrfresult = Honeybee_ReadEPSurfaceResult(resultFileAddress=runenergysimulation_2.resultFileAddress)  # -> surfaceIndoorTemp, surfaceOutdoorTemp, surfaceEnergyFlow, opaqueEnergyFlow, glazEnergyFlow, windowTotalSolarEnergy, windowBeamEnergy, windowDiffEnergy, port, port_2; plug-in component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
readepresult = Honeybee_ReadEPResult(resultFileAddress=runenergysimulation_2.resultFileAddress)  # -> port, port_2, port_3, port_4, electricLight, electricEquip, fanElectric, port_5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; plug-in component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
toggle_3 = BooleanToggle(True)
point_9 = Point(<point referenced from the Rhino model>)
colorsurfaces = Honeybee_ColorSurfacesByEPResult(srfData=readepsrfresult.surfaceIndoorTemp, HBZones=flatten(setepzonecnstr), runIt=toggle_3, runIt_2=toggle_3)  # -> readMe, srfColoredMesh, zoneWireFrame, legend, legendBasePt, analysisTitle, srfBreps, srfColors, srfValues, port; disabled; plug-in component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
_3dchart_4 = Ladybug_3DChart(
    inputData=flatten([readepresult.totalSolarGain, readepresult.airTemperature]),
    basePoint=point_9,
    xScale=Slider(0.2, range=0..1),
    zScale=Slider(0, range=0..100))  # -> out, graphMesh, graphCurves, legend, legendBasePts, title, titleBasePts, dataPts, conditionalHOY; plug-in component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
ladybug_activities_met_list = Ladybug_ActivitiesMetList({"Sleeping": 0.7, "Reclining": 0.8, "Sitting": 1.0, "Typing": 1.1, "Standing": 1.2, "Driving": 1.5, "Cooking": 1.8, "House Cleaning": 2.7, "Strolling": 1.7, "Walking 2mph": 2.0, "Walking 3mph": 2.6, "Walking 4mph": 3.8, "Running 9mph": 9.5, "Lifting 10lbs": 2.1, "Lifting 100lbs": 4.0, "Shoveling": 4.4, "Dancing": 3.4, "Basketball": 6.3}, selected="Sitting")
strnum = Ladybug_SeparateData(inputList=flatten(readepresult.totalSolarGain))  # -> numbers, strings; plug-in component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
adaptivecomfortcalculator = Ladybug_AdaptiveComfortCalculator(
    dryBulbTemperature=readepresult.airTemperature,
    meanRadiantTemperature=readepresult.meanRadTemperature,
    prevailingOutdoorTemp=importepw_2.dryBulbTemperature,
    runIt=Toggle(True))  # -> readMe, port, comfortableOrNot, conditionOfPerson, degreesFromTarget, port_2, targetTemperature, upperTemperatureBound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; plug-in component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
pmvcomfortcalculator = Ladybug_PMVComfortCalculator(
    dryBulbTemperature=readepresult.airTemperature,
    meanRadiantTemperature=readepresult.meanRadTemperature,
    relativeHumidity=readepresult.relativeHumidity,
    metabolicRate=ladybug_activities_met_list,
    calcBalanceTemperature=False,
    runIt=Toggle(True))  # -> readMe, port, predictedMeanVote, percentPeopleDissatisfied, standardEffectiveTemperature, port_2, comfortableOrNot, percentOfTimeComfortable, port_3, balanceTemperature; plug-in component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
ma = MassAddition(Input=strnum.numbers)  # -> Result, PartialResults
panel_33 = Panel(readepresult.totalSolarGain)
panel_34 = Panel(ma.Result)
panel_35 = Panel(adaptivecomfortcalculator.percentOfTimeComfortable)
strnum_2 = Ladybug_SeparateData(inputList=flatten(adaptivecomfortcalculator.comfortableOrNot))  # -> numbers, strings; plug-in component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
panel_36 = Panel(pmvcomfortcalculator.percentOfTimeComfortable)
panel_37 = Panel(pmvcomfortcalculator.comfortableOrNot)
mgraph = MGraph(inputdata=adaptivecomfortcalculator.comfortableOrNot)
point_10 = Point(<point referenced from the Rhino model>)
occupied_hour = OccupiedHour(L=strnum_2.numbers)
strnum_3 = Ladybug_SeparateData(inputList=flatten(pmvcomfortcalculator.comfortableOrNot))  # -> numbers, strings; plug-in component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
strnum_4 = Ladybug_SeparateData(inputList=flatten(pmvcomfortcalculator.comfortableOrNot))  # -> numbers, strings; plug-in component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
mgraph_2 = MGraph(inputdata=pmvcomfortcalculator.comfortableOrNot)
panel_38 = Panel(occupied_hour)
psychchart_2 = Ladybug_PsychrometricChart(
    dryBulbTemperature=readepresult.airTemperature,
    relativeHumidity=readepresult.relativeHumidity,
    basePoint=point_10,
    runIt=Toggle(True))  # -> out, port, totalComfortPercent, totalComfortOrNot, strategyNames, strategyPercentOfTime, strategyOrNot, port_2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; plug-in component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
occupied_hour_2 = OccupiedHour(L=strnum_4.numbers)
gradientlibrary_5 = Ladybug_GradientLibrary(gradIndex=Slider(9, range=0..100))  # -> customColors; plug-in component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
point_11 = Point(<point referenced from the Rhino model>)
panel_39 = Panel(occupied_hour_2)
legendpar_8 = Ladybug_LegendParameters(lowBound="-2", highBound="2", customColors=flatten(gradientlibrary_5))  # -> legendPar; plug-in component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
_3dchart_5 = Ladybug_3DChart(
    inputData=flatten(strnum_3.numbers),
    basePoint=point_11,
    xScale=Slider(0.2, range=0..1),
    zScale=Slider(0, range=0..100),
    legendPar=legendpar_8)  # -> out, graphMesh, graphCurves, legend, legendBasePts, title, titleBasePts, dataPts, conditionalHOY; plug-in component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

python = PythonScript(x=decomposeepconstruction_4.RValue_IP, y=decomposeepconstruction_5.RValue_IP, z=panel_30)  # -> out, a
# ---------- python: Python ----------
if isinstance(x,float):
    x= round(x,1)

a = str(x)+"RF_"+str(round(y,1))+"WL"+str(z)
# ---------- end python ----------
concat = Concatenate(FragmentC="Li_Ho_", FragmentD=python.a)

_3dchart_6 = Ladybug_3DChart(
    inputData=flatten(readepresult.relativeHumidity),
    basePoint=point_6,
    xScale=Slider(0.2, range=0..1),
    zScale=Slider(0, range=0..100),
    legendPar=legendpar_6)  # -> out, graphMesh, graphCurves, legend, legendBasePts, title, titleBasePts, dataPts, conditionalHOY; plug-in component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

# ----
# MAKE AN ENERGY BALANCE AND PLOT IT ON A CHART
readepsrfresult_2 = Honeybee_ReadEPSurfaceResult(resultFileAddress=runenergysimulation_2.resultFileAddress)  # -> surfaceIndoorTemp, surfaceOutdoorTemp, surfaceEnergyFlow, opaqueEnergyFlow, glazEnergyFlow, windowTotalSolarEnergy, windowBeamEnergy, windowDiffEnergy, port, port_2; plug-in component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
readepresult_2 = Honeybee_ReadEPResult(resultFileAddress=runenergysimulation_2.resultFileAddress)  # -> port, port_2, port_3, port_4, electricLight, electricEquip, fanElectric, port_5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; plug-in component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
gradientlibrary_6 = Ladybug_GradientLibrary(gradIndex=Slider(19, range=1..20))  # -> customColors; plug-in component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
legendpar_9 = Ladybug_LegendParameters(customColors=flatten(gradientlibrary_6))  # -> legendPar; plug-in component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

energybalance = Honeybee_ConstructEnergyBalance(
    HBZones=flatten(setepzonecnstr),
    electricLight=readepresult_2.electricLight,
    electricEquip=readepresult_2.electricEquip,
    fanElectric=readepresult_2.fanElectric,
    peopleGains=readepresult_2.peopleGains,
    totalSolarGain=readepresult_2.totalSolarGain,
    infiltrationEnergy=readepresult_2.infiltrationEnergy,
    natVentEnergy=readepresult_2.natVentEnergy,
    surfaceEnergyFlow=readepsrfresult_2.surfaceEnergyFlow)  # -> out, port, flrNormEnergyBal, flrNormBalWStorage, port_2, modelEnergyBalance, energyBalWithStorage; plug-in component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

selectandaveragedata = Ladybug_AverageData(annualHourlyData=energybalance.energyBalWithStorage, totalOrAverage=Toggle(True))  # -> readMe, selHourlyData, totaledDaily, totaledMonthly, totMonthlyPerHour, totAnalysisPeriod; plug-in component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
barchart = Ladybug_MonthlyBarChart(
    inputData=flatten(selectandaveragedata.totaledMonthly),
    stackValues=Toggle(True),
    plotFromZero=Toggle(True),
    altTitle="Dream Room Energy Balance",
    altYAxisTitle="Energy (kWh)",
    basePoint=point_7,
    legendPar=legendpar_9)  # -> readMe, dataMesh, dataCurves, dataCrvColors, graphAxes, graphLabels, title, titleBasePt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; plug-in component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
preview_2 = CustomPreview(Geometry=barchart.graphAxes, Shader=ColourSwatch(SwatchColor=RGB(0, 0, 0)))
panel_40 = Panel(barchart.readMe)

# ==== cluster MGraph
low = ClusterInput()
high = ClusterInput()
inputdata = ClusterInput()
gradientlibrary = Ladybug_GradientLibrary(gradIndex=Slider(0, range=0..21))  # -> customColors; plug-in component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
panel = Panel(gradientlibrary)
swatch = ColourSwatch(SwatchColor=RGB(199, 199, 199))
item = ListItem(List=inputdata, Index=2, Wrap=True)
panel_2 = Panel(ColourSwatch(SwatchColor=RGB(232, 255, 140)))
python = PythonScript(x=item, y=gradientlibrary, low=low, high=high)  # -> out, a, b, c, cc, d; inputs x: list, y: list
# ---------- python: Python ----------
x = str(x[0])

RHColor = ['255,255,255','209,229,240','146,197,222','67,147,195','33,102,172','5,48,97']
CloudCoverColor = ['93,190,255','255,255,255','217,217,217','83,114,115']
isGood =['222,222,222','78,191,255']
#print x
if x.find("Predicted Mean Vote")!= -1:
    a = -3
    b = 3
    c =7
    cc =y
elif x.find("Adaptive Comfort") !=-1:
    a = -1
    b = 1
    c =3
    cc =y
elif x.find("Comfortable Or Not") !=-1:
    a = 0
    b = 1
    c =2
    cc = ['199,199,199','232,255,140']
elif x.find("Percentage of People Dissatisfied") !=-1:
    a = 0
    b = 100
    d = 0
    cc =y
elif x.find("Air Temperature") !=-1: #indoor Temp
    a = 18
    b = 30
    d = 0
    cc =y
elif x.find("Humidity") !=-1:
    a = 0
    b = 100
    d = 0
    cc =RHColor
elif x.find("Cloud Cover") !=-1:
    a = 0
    b = 10
    d = 0
    cc =CloudCoverColor
elif x.find("Solar Gain") !=-1:
    if low:a = low
    else:a = 0
    if high:b = high
    else:b = 1
    cc =y
    
elif x.find("0")!=-1 or x.find("1")!=-1:
    a = 0
    b = 1
    c=2
    cc =isGood
else:
    if low:a = low
    if high:b = high
    cc =y
# ---------- end python ----------
panel_3 = Panel(item)
legendpar = Ladybug_LegendParameters(
    lowBound=python.a,
    highBound=python.b,
    numSegments=python.c,
    customColors=flatten(python.cc),
    decimalPlaces=python.d,
    removeLessThan=1)  # -> legendPar; plug-in component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
point = Point(<point referenced from the Rhino model>)
_3dchart = Ladybug_3DChart(inputData=flatten(inputdata), basePoint=point, xScale="0.2", zScale="0", legendPar=legendpar)  # -> readMe, graphMesh, graphCurves, legend, legendBasePts, title, titleBasePts, dataPts, conditionalHOY; plug-in component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
graphcurves = ClusterOutput([_3dchart.graphCurves, _3dchart.legend, _3dchart.title, _3dchart.graphMesh])

# ==== cluster OccupiedHour
panel = Panel("""1
1
1
1
1
1
1
1
1
0
0
0
0
0
0
0
0
0
1
1
1
1
1
1""")
L = ClusterInput()
cull = CullPattern(List=L, CullPattern=panel)
avr = Average(Input=cull)
am = ClusterOutput(avr)
