# Grasshopper definition Fan_di_WeatherDataAnalysis.gh (Grasshopper 0.9.76)
# plug-ins: Python Interpreter

ladybug = Ladybug_Ladybug()  # -> out; plug-in component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
panel = Panel("https://www.energyplus.net/weather-download/north_and_central_america_wmo_region_4/USA/PA/USA_PA_Philadelphia.Intl.AP.724080_TMY3/all")
panel_2 = Panel("https://www.energyplus.net/weather-download/north_and_central_america_wmo_region_4/USA/PA/USA_PA_Philadelphia.Intl.AP.724080_TMY3/all")
northarrow = Ladybug_North()  # -> northSign; plug-in component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
epw_stat = Ladybug_OpenEPWAndSTATWeatherFiles(weatherFileURL=panel)  # -> epwFile, statFile; plug-in component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
updateladybug = Ladybug_UpdateLadybug(updateThisFile=Toggle(True))  # -> out; plug-in component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
epw_stat_2 = Ladybug_OpenEPWAndSTATWeatherFiles(weatherFileURL=panel_2)  # -> epwFile, statFile; plug-in component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
importepw = Ladybug_ImportEpw(epwFile=epw_stat.epwFile)  # -> Output, latitude, location, dryBulbTemperature, dewPointTemperature, relativeHumidity, windSpeed, windDirection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; plug-in component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
importepw_2 = Ladybug_ImportEpw(epwFile=epw_stat_2.epwFile)  # -> Output, latitude, location, dryBulbTemperature, dewPointTemperature, relativeHumidity, windSpeed, windDirection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; plug-in component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
gradientlibrary = Ladybug_GradientLibrary(gradIndex=Slider(13, range=0..100))  # -> customColors; plug-in component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
psychchart = Ladybug_PsychrometricChart(dryBulbTemperature=importepw.dryBulbTemperature, relativeHumidity=importepw.relativeHumidity, runIt=Toggle(False))  # -> out, port, totalComfortPercent, totalComfortOrNot, strategyNames, strategyPercentOfTime, strategyOrNot, port_2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; plug-in component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
legendpar = Ladybug_LegendParameters(customColors=flatten(gradientlibrary))  # -> legendPar; plug-in component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
legendpar_2 = Ladybug_LegendParameters(customColors=flatten([ColourSwatch(SwatchColor=RGB(255, 255, 255)), ColourSwatch(SwatchColor=RGB(11, 157, 214))]))  # -> legendPar; plug-in component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
point = Point(<point referenced from the Rhino model>)
gradientlibrary_2 = Ladybug_GradientLibrary(gradIndex=Slider(9, range=0..10))  # -> customColors; plug-in component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
point_2 = Point(<point referenced from the Rhino model>)
colour_swatch = ColourSwatch(SwatchColor=RGB(119, 185, 242))
colour_swatch_2 = ColourSwatch(SwatchColor=RGB(227, 48, 48))
legendpar_3 = Ladybug_LegendParameters(customColors=flatten([ColourSwatch(SwatchColor=RGB(255, 255, 255)), ColourSwatch(SwatchColor=RGB(223, 116, 227))]))  # -> legendPar; plug-in component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
_3dchart = Ladybug_3DChart(
    inputData=flatten(importepw_2.relativeHumidity),
    basePoint=point_2,
    xScale=Slider(0.2, range=0..1),
    zScale=Slider(0, range=0..100),
    legendPar=legendpar_2)  # -> out, graphMesh, graphCurves, legend, legendBasePts, title, titleBasePts, dataPts, conditionalHOY; plug-in component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
legendpar_4 = Ladybug_LegendParameters(customColors=flatten(gradientlibrary_2))  # -> legendPar; plug-in component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
_3dchart_2 = Ladybug_3DChart(
    inputData=flatten(importepw_2.dewPointTemperature),
    basePoint=point,
    xScale=Slider(0.2, range=0..1),
    zScale=Slider(0, range=0..100),
    legendPar=legendpar)  # -> out, graphMesh, graphCurves, legend, legendBasePts, title, titleBasePts, dataPts, conditionalHOY; plug-in component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
point_3 = Point(<point referenced from the Rhino model>)
analysisperiod = Ladybug_AnalysisPeriod(fromMonth="12", toMonth="2")  # -> out, analysisPeriod; plug-in component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
windrose = Ladybug_WindRose(
    north=0,
    hourlyWindDirection=importepw_2.windDirection,
    hourlyWindSpeed=importepw_2.windSpeed,
    analysisPeriod=analysisperiod.analysisPeriod,
    legendPar=legendpar_3,
    runIt=Toggle(False))  # -> out, calmRoseMesh, windRoseMesh, windRoseCrvs, windRoseCenPts, legend, legendBasePts, title; plug-in component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
boolean_toggle = BooleanToggle(True)
analysisperiod_2 = Ladybug_AnalysisPeriod()  # -> out, analysisPeriod; plug-in component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
solaradjusttemperature = Ladybug_OutdoorSolarTemperatureAdjustor(
    location=importepw_2.location,
    cumSkyMtxOrDirNormRad=importepw_2.directNormalRadiation,
    diffuseHorizRad=importepw_2.diffuseHorizontalRadiation,
    baseTemperature=importepw_2.dryBulbTemperature,
    horizInfraredRad=importepw_2.horizontalInfraredRadiation,
    analysisPeriodOrHOY=analysisperiod_2.analysisPeriod,
    parallel=boolean_toggle,
    runIt=boolean_toggle)  # -> readMe, port, effectiveRadiantField, MRTDelta, solarAdjustedMRT, port_2, mannequinMesh, port_3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; plug-in component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
outdoorcomfortcalculator = Ladybug_OutdoorComfortCalculator(
    dryBulbTemperature=importepw.dryBulbTemperature,
    meanRadiantTemperature=solaradjusttemperature.solarAdjustedMRT,
    relativeHumidity=importepw.relativeHumidity,
    runIt=Toggle(True))  # -> out, port, universalThermalClimateIndex, comfortableOrNot, thermalStress, conditionOfPerson, port_2, percentOfTimeComfortable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; plug-in component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
panel_3 = Panel([outdoorcomfortcalculator.percentOfTimeComfortable, outdoorcomfortcalculator.percentHeatStress, outdoorcomfortcalculator.percentColdStress])
_3dchart_3 = Ladybug_3DChart(
    inputData=flatten(outdoorcomfortcalculator.conditionOfPerson),
    basePoint=point_3,
    xScale=Slider(0.2, range=0..1),
    zScale=Slider(0, range=0..100),
    legendPar=legendpar_4)  # -> out, graphMesh, graphCurves, legend, legendBasePts, title, titleBasePts, dataPts, conditionalHOY; plug-in component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
gradientlibrary_3 = Ladybug_GradientLibrary(gradIndex=Slider(16, range=0..100))  # -> customColors; plug-in component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
number_slider = Slider(9, range=0..10)
panel_4 = Panel("""6
9
12""")
legendpar_5 = Ladybug_LegendParameters(
    lowBound="0",
    highBound="10",
    customColors=flatten([ColourSwatch(SwatchColor=RGB(252, 252, 252)), ColourSwatch(SwatchColor=RGB(255, 196, 48))]))  # -> legendPar; plug-in component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
series = Series(Start=Slider(1, range=0..1), Step=1, Count=Slider(24, range=0..100))
analysisperiod_3 = Ladybug_AnalysisPeriod()  # -> out, analysisPeriod; plug-in component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
point_4 = Point(<point referenced from the Rhino model>)
analysisperiod_4 = Ladybug_AnalysisPeriod()  # -> out, analysisPeriod; plug-in component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
sunpath = Ladybug_SunPath(
    location=importepw_2.location,
    hour=series,
    day=21,
    month=12,
    timeStep=1,
    analysisPeriod=analysisperiod_3.analysisPeriod,
    centerPt=point_4,
    sunScale=Slider(0.5, range=0..1),
    annualHourlyData=flatten(importepw.totalSkyCover),
    conditionalStatement="a<6",
    legendPar=legendpar_5,
    dailyOrAnnualSunPath=True)  # -> out, sunVectors, sunAltitudes, sunAzimuths, port, sunSpheresMesh, sunPathCrvs, legend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; plug-in component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
ln = Line()
day_month_hour_calculator = Ladybug_Day_Month_Hour()  # -> day, month, hour, date; plug-in component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
Z = UnitZ(Factor="30")
move = Move(Geometry=sunpath.sunPositions, Motion=Z)  # -> Geometry, Transform
analysisperiod_5 = Ladybug_AnalysisPeriod()  # -> out, analysisPeriod; plug-in component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
tag = TextTag(Location=move.Geometry, Text=day_month_hour_calculator.date)
