# Grasshopper definition Tai Feng.gh (Grasshopper 0.9.76)
# plug-ins: Python Interpreter, Embryo

panel = Panel("floor")

# ---- group: glass facade
glass = Brep([<brep referenced from the Rhino model> x6])

# ----
# Honeybee default materials will be assigned
# based on surface type
# Geometry Preparation
# Assign specific materials
panel_2 = Panel("glass_.65")
brep = Brep(<brep referenced from the Rhino model>)
radglassmaterial = Honeybee_RadianceGlassMaterial(materialName=panel_2, RTransmittance=".65", GTransmittance=".65", BTransmittance=".65", refractiveIndex=1.52)  # -> avrgTrans, RADMaterial; plug-in component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
walls = Brep([<brep referenced from the Rhino model> x14])
createhbsrfs = Honeybee_createHBSrfs(geometry=brep, srfType="0")  # -> readMe, simplify(HBSurface); plug-in component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
createhbsrfs_2 = Honeybee_createHBSrfs(geometry=walls, srfType="0")  # -> readMe, simplify(HBSurface); plug-in component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
createhbsrfs_3 = Honeybee_createHBSrfs(geometry=glass, RADMaterial=radglassmaterial.RADMaterial)  # -> readMe, simplify(HBSurface); plug-in component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

ladybug = Ladybug_Ladybug()  # -> Vviiiiiiiiiizzz; plug-in component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
honeybee = Honeybee_Honeybee()  # -> Vviiiiiiiiiizzz; plug-in component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
panel_3 = Panel("https://www.energyplus.net/weather-download/north_and_central_america_wmo_region_4/USA/PA/USA_PA_Philadelphia.Intl.AP.724080_TMY3/all")

# ---- group: collect all honeybee surfaces
brep_2 = Brep(flatten([createhbsrfs_2.HBSurface, createhbsrfs_3.HBSurface, createhbsrfs.HBSurface]))

# ----
epw_stat = Ladybug_OpenEPWAndSTATWeatherFiles(weatherFileURL=panel_3)  # -> epwFile, statFile; plug-in component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
number_slider = Slider(0, range=0..100)
item = ListItem(List=brep, Index=Slider(1, range=0..1), Wrap=True)
importlocation = Ladybug_ImportLocation(epwFile=epw_stat.epwFile)  # -> location; plug-in component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
flip = Flip(Surface=item)  # -> Surface, Result
genavgsky = Honeybee_GenerateAverageSky(north=number_slider, weatherFile=epw_stat.epwFile, month="12", hour="9")  # -> radiationValues, skyFilePath; plug-in component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
genclimatebasedsky = Honeybee_GenerateClimateBasedSky(north=number_slider, weatherFile=epw_stat.epwFile, month="12", day="21", hour="9")  # -> radiationValues, skyFilePath; plug-in component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
northarrow = Ladybug_North(north=number_slider, scale=".05")  # -> northSign; plug-in component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
panel_4 = Panel("https://www.energyplus.net/weather-download/north_and_central_america_wmo_region_4/USA/PA/USA_PA_Philadelphia.Intl.AP.724080_TMY3/all")
radparameters = Honeybee_RADParameters(quality=0, ab="3")  # -> readMe, radParameters; plug-in component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
sunpath = Ladybug_SunPath(
    north=number_slider,
    location=importlocation,
    hour="9",
    day="21",
    month="12",
    timeStep=1,
    sunScale=Slider(0.2, range=0..1),
    dailyOrAnnualSunPath=True)  # -> readMe, sunVectors, sunAltitudes, sunAzimuths, port, sunSpheresMesh, sunPathCrvs, legend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; plug-in component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
doy_hoy = Ladybug_DOY_HOY(days="21", months="12", hours="9")  # -> HOY, DOY, date; plug-in component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
gentestpts = Honeybee_GenerateTestPoints(
    testGeometry=flatten(item),
    gridSize=Slider(0.5, range=0..1),
    distBaseSrf=Slider(0.762, range=0..1),
    moveTestMesh=Toggle(True))  # -> readMe, simplify(testPoints), simplify(ptsVectors), simplify(facesArea), simplify(mesh); plug-in component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
epw_stat_2 = Ladybug_OpenEPWAndSTATWeatherFiles(weatherFileURL=panel_4)  # -> epwFile, statFile; plug-in component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
# Analysis Recipe
imagebasedsimulation = Honeybee_ImageBasedSimulation(
    skyFile=genavgsky.skyFilePath,
    cameraType="1",
    simulationType=2,
    radParameters=radparameters.radParameters,
    backupImages=0)  # -> analysisRecipe; plug-in component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
# Put the recipie together!
annualdaylightsimulation = Honeybee_AnnualDaylightSimulation(
    epwWeatherFile=epw_stat_2.epwFile,
    testPoints=flatten(gentestpts.testPoints),
    ptsVectors=flatten(gentestpts.ptsVectors),
    testMesh=flatten(gentestpts.mesh))  # -> analysisRecipe; plug-in component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
# Create ground in front of the room
# for more accurate analysis
brep_3 = Brep(<brep referenced from the Rhino model>)
toggle = BooleanToggle(False)
createhbsrfs_4 = Honeybee_createHBSrfs(geometry=brep_3)  # -> readMe, simplify(HBSurface); plug-in component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
# Run the analysis
rundaylightanalysis = Honeybee_RunDaylightSimulation(
    HBObjects=flatten(brep_2),
    analysisRecipe=imagebasedsimulation,
    writeRad=toggle,
    runRad=toggle,
    numOfCPUs="4",
    radFileName=doy_hoy.date,
    overwriteResults=True)  # -> readMe, analysisType, resultsUnit, results, testPts, resultFiles, radGeoFile, studyFolder, done; plug-in component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
toggle_2 = BooleanToggle(False)
occupancygenerator = Honeybee_DaysimOccupancyGenerator(weekendDays=[1, 2], writeTheOcc=Toggle(True))  # -> occupancyFile; plug-in component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
# Run the analysis
rundaylightanalysis_2 = Honeybee_RunDaylightSimulation(
    HBObjects=flatten(brep_2),
    analysisRecipe=annualdaylightsimulation,
    writeRad=toggle_2,
    runRad=toggle_2,
    numOfCPUs=Slider(4, range=0..10),
    overwriteResults=True)  # -> readMe, analysisType, resultsUnit, results, testPts, flatten(resultFiles), radGeoFile, studyFolder, done; plug-in component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
panel_5 = Panel(rundaylightanalysis.studyFolder)
# Run the analysis for glare
toggle_3 = BooleanToggle(True)
panel_6 = Panel(occupancygenerator)
glareanalysis = Honeybee_GlareAnalysis(HDRImagePath=rundaylightanalysis.resultFiles, runIt=toggle_3)  # -> readMe, glareCheckImage, DGP, DGI, imageWithTaskArea; plug-in component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
panel_7 = Panel(rundaylightanalysis_2.resultFiles)
# Generate annual results
readannualresultsi = Honeybee_ReadAnnualResultI(
    illFilesAddress=rundaylightanalysis_2.resultFiles,
    testPoints=simplify(rundaylightanalysis_2.testPts),
    occupancyFiles=occupancygenerator,
    DLAIllumThresholds=300,
    runIt=Toggle(True))  # -> DLA, UDLI_Less_100, UDLI_100_2000, UDLI_More_2000, CDA, sDA, annualProfiles, htmReport; plug-in component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
falsecolor = Honeybee_FalseColor(
    HDRFilePath=rundaylightanalysis.resultFiles,
    contourBands=False,
    maskThreshold=0.1,
    useAlterColors=False,
    render=Toggle(True))  # -> outputFilePath; plug-in component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
panel_8 = Panel(glareanalysis.DGP)
gradientlibrary = Ladybug_GradientLibrary(gradIndex=Slider(1, range=0..10))  # -> customColors; plug-in component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
panel_9 = Panel(falsecolor)
panel_10 = Panel(readannualresultsi.UDLI_100_2000)
hdr_tif = Honeybee_ConvertHDRToTIF(HDRFilePath=glareanalysis.glareCheckImage, adjustExposure=Toggle(False))  # -> TIFFFilePath; plug-in component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
hdr_tif_2 = Honeybee_ConvertHDRToTIF(HDRFilePath=falsecolor, adjustExposure=False)  # -> TIFFFilePath; plug-in component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
number_slider_2 = Slider(0.7, range=0..1)
legendpar = Ladybug_LegendParameters(
    lowBound=Slider(0, range=0..100),
    highBound=Slider(100, range=0..100),
    numSegments=Slider(6, range=0..10),
    customColors=flatten(gradientlibrary))  # -> legendPar; plug-in component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
panel_11 = Panel(hdr_tif_2)

# ---- group: make it 3D!
dom = ConstructDomain(DomainStart=0, DomainEnd=Slider(1, range=0..1))

# ----
image = ImageFromPath(P=hdr_tif_2, S=number_slider_2)
image_2 = ImageFromPath(P=hdr_tif, S=number_slider_2)
# Visualize the results
recolormesh = Ladybug_RecolorMesh(
    analysisResult=readannualresultsi.UDLI_100_2000,
    inputMesh=flatten(gentestpts.mesh),
    heightDomain=dom,
    legendPar=legendpar,
    analysisTitle=rundaylightanalysis_2.analysisType,
    legendTitle="%")  # -> readMe, newMesh, newLegend, legendBasePt, meshColors, legendColors; plug-in component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
panel_12 = Panel(recolormesh.readMe)
lng = ListLength(List=recolormesh.readMe)
panel_13 = Panel(lng)
