# Grasshopper definition Tai Feng.gh (Grasshopper 0.9.76)
# plug-ins: Python Interpreter, Embryo

# Daylight Simulation
honeybee = Honeybee_Honeybee()  # -> Vviiiiiiiiiizzz; plug-in component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
ladybug = Ladybug_Ladybug()  # -> Vviiiiiiiiiizzz; plug-in component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
run_energyplus = BooleanToggle(False)

# ----
# Process Record of Comfort based on construction material modification
# add blind depth 0.7
# reduce shade to 0.3,12
# cold
# Comfort
# hot
panel = Panel("wall construction")
panel_2 = Panel("more blinds")
# Energy Simulation
panel_3 = Panel("Baseline")
panel_4 = Panel("blinds")
number_slider = Slider(18.66, range=0..100)
number_slider_2 = Slider(19.25, range=0..100)
number_slider_3 = Slider(20.01, range=0..100)
number_slider_4 = Slider(22.8, range=0..100)
number_slider_5 = Slider(24.01, range=0..100)
number_slider_6 = Slider(23.72, range=0..100)
number_slider_7 = Slider(22.83, range=0..100)
number_slider_8 = Slider(29.33, range=0..100)
number_slider_9 = Slider(31.67, range=0..100)
number_slider_10 = Slider(33.84, range=0..100)
number_slider_11 = Slider(35.64, range=0..100)
number_slider_12 = Slider(33.23, range=0..100)
number_slider_13 = Slider(35.75, range=0..100)
number_slider_14 = Slider(41.56, range=0..100)
number_slider_15 = Slider(49.09, range=0..100)
number_slider_16 = Slider(50.66, range=0..100)
number_slider_17 = Slider(41.42, range=0..100)
number_slider_18 = Slider(42.44, range=0..100)
number_slider_19 = Slider(42.76, range=0..100)

# ---- group: 1st modified_window
brep = Brep([<brep referenced from the Rhino model> x4])

# ----
toggle = BooleanToggle(False)

# ---- group: 3rd modified window
brep_2 = Brep([<brep referenced from the Rhino model> x6])

# ---- group: 2nd modified windows
brep_3 = Brep([<brep referenced from the Rhino model> x6])

# ----
updateladybug = Ladybug_UpdateLadybug(updateThisFile=toggle)  # -> readMe; plug-in component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
updatehoneybee = Honeybee_UpdateHoneybee(updateThisFile=toggle)  # -> out; plug-in component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

# ---- group: base model_window
brep_4 = Brep([<brep referenced from the Rhino model> x3])

# ---- group: shading
brep_5 = Brep([<brep referenced from the Rhino model> x17])

# ---- group: wall
brep_6 = Brep([<brep referenced from the Rhino model> x15])

# ---- group: Ceiling
brep_7 = Brep(<brep referenced from the Rhino model>)

# ---- group: ground
brep_8 = Brep(<brep referenced from the Rhino model>)

# ---- group: shading_0.15_6
brep_9 = Brep([<brep referenced from the Rhino model> x12])

# ----
# Geometry for Daylight
# Glass material
panel_6 = Panel("tvis_60")
radglassmaterial = Honeybee_RadianceGlassMaterial(materialName=panel_6, RTransmittance="0.8", GTransmittance="0.8", BTransmittance="0.8", refractiveIndex=1.52)  # -> avrgTrans, RADMaterial; plug-in component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
number_slider_20 = Slider(6, range=0..10)
radglassmaterial_2 = Honeybee_RadianceGlassMaterial(materialName="tvis_60", RTransmittance="0.5", GTransmittance="0.5", BTransmittance="0.5", refractiveIndex=1.52)  # -> avrgTrans, RADMaterial; plug-in component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
createhbsrfs = Honeybee_createHBSrfs(geometry=brep_4, RADMaterial=radglassmaterial.RADMaterial)  # -> readMe, simplify(HBSurface); plug-in component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
createhbsrfs_2 = Honeybee_createHBSrfs(geometry=brep_7, srfType=Slider(1, range=0..10))  # -> readMe, simplify(HBSurface); plug-in component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
createhbsrfs_3 = Honeybee_createHBSrfs(geometry=brep_8, srfType=Slider(2, range=0..10))  # -> readMe, simplify(HBSurface); plug-in component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
createhbsrfs_4 = Honeybee_createHBSrfs(geometry=brep_9, RADMaterial=radglassmaterial_2.RADMaterial)  # -> readMe, simplify(HBSurface); plug-in component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
createhbsrfs_5 = Honeybee_createHBSrfs(geometry=brep_6)  # -> readMe, simplify(HBSurface); plug-in component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
preview = CustomPreview(Geometry=createhbsrfs.HBSurface, Shader=ColourSwatch(SwatchColor=RGBA(27, 225, 235, 74)))
preview_2 = CustomPreview(Geometry=createhbsrfs_5.HBSurface, Shader=ColourSwatch(SwatchColor=RGBA(217, 206, 206, 208)))
brep_10 = Brep(flatten([createhbsrfs_5.HBSurface, createhbsrfs.HBSurface, createhbsrfs_3.HBSurface, createhbsrfs_2.HBSurface]))
item = ListItem(List=brep_8, Index=Slider(1, range=0..1), Wrap=True)
wires = BrepWireframe(Brep=brep_10, Density=-1)

# ---- group: 1st modified wall
brep_11 = Brep([<brep referenced from the Rhino model> x14])

# ---- group: shading_0.3,12
brep_12 = Brep([<brep referenced from the Rhino model> x24])

# ---- group: shading_0.7,18
brep_13 = Brep([<brep referenced from the Rhino model> x36])

# ---- group: 3rd_modified wall
brep_14 = Brep([<brep referenced from the Rhino model> x12])

# ---- group: 2nd modified wall
brep_15 = Brep([<brep referenced from the Rhino model> x13])

# ---- group: 2nd_modi_ window
brep_16 = Brep([<brep referenced from the Rhino model> x6])

# ---- group: base_window
brep_17 = Brep([<brep referenced from the Rhino model> x3])

# ----
# Geometry for Energy Simulation
# Geometry
panel_7 = Panel("""Bedroom
Corridor
Lobby""")
move = Move(Motion=Vector(0, 0, 10))  # -> Geometry, Transform
panel_8 = Panel("""Bedroom
Corridor""")
brep_18 = Brep(<brep referenced from the Rhino model>)
brep_19 = Brep(<brep referenced from the Rhino model>)
brep_20 = Brep(<brep referenced from the Rhino model>)
brep_21 = Brep([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])
item_2 = ListItem(List=brep_21, Index=0, Wrap=True)
mass2zone = Honeybee_Masses2Zones(
    zoneMasses=flatten([brep_19, brep_18]),
    zoneNames=panel_8,
    isConditioned=Toggle(False),
    maxRoofAngle=30,
    createHBZones=Toggle(True))  # -> readMe, HBZones; plug-in component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
addhbglz = Honeybee_addHBGlz(HBObj=mass2zone.HBZones, childSurfaces=flatten(brep_17))  # -> HBObjWGLZ; plug-in component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
flatten = FlattenTree(Tree=addhbglz, Path="{0}")
wires_2 = BrepWireframe(Brep=addhbglz, Density=-1)
item_3 = ListItem(List=flatten, Index=Slider(1, range=0..1), Wrap=True)
solveadjc = Honeybee_SolveAdjacencies(HBZones=flatten(addhbglz), removeCurrentAdjc=False, findAdjc=Toggle(True))  # -> readMe, HBZonesWADJ; plug-in component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
panel_9 = Panel(solveadjc.readMe)
decomposebytype = Honeybee_DecomposeBasedOnType(HBZone=solveadjc.HBZonesWADJ)  # -> walls, interiorWalls, airWalls, windows, interiorWindows, skylights, roofs, ceilings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; plug-in component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
preview_3 = CustomPreview(Geometry=decomposebytype.interiorWindows, Shader=ColourSwatch(SwatchColor=RGBA(84, 232, 250, 176)))

# ---- group: 1st_modi_window
brep_22 = Brep([<brep referenced from the Rhino model> x4])

# ----
# Generate sky
number_slider_21 = Slider(0, range=0..2)
number_slider_22 = Slider(1, range=0..2)
hours = Panel("""9
12
15""")
months = Panel("""3
6
12""")
fly = Ladybug_fly(inputSliders=[number_slider_21, number_slider_22], fly=Button())  # -> Vviiiiiiiiiizzz; plug-in component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
panel_10 = Panel("""3
6
12""")
panel_11 = Panel("""9
12
15""")
item_4 = ListItem(List=hours, Index=number_slider_22, Wrap=True)
item_5 = ListItem(List=months, Index=number_slider_21, Wrap=True)
path = FilePath("C:\ladybug\Philadelphia_International_Ap_PA_USA\Philadelphia_International_Ap_PA_USA.epw")
importlocation = Ladybug_ImportLocation(epwFile=path)  # -> location; plug-in component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
genclimatebasedsky = Honeybee_GenerateClimateBasedSky(weatherFile=path, month=item_5, day="21", hour=item_4)  # -> radiationValues, skyFilePath; plug-in component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
sunpath = Ladybug_SunPath(
    location=importlocation,
    hour=panel_11,
    day=21,
    month=panel_10,
    timeStep=1,
    sunPathScale=Slider(0.2, range=0..1),
    dailyOrAnnualSunPath=True)  # -> readMe, sunVectors, sunAltitudes, sunAzimuths, port, sunSpheresMesh, sunPathCrvs, legend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; plug-in component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
doy_hoy = Ladybug_DOY_HOY(days="21", months=item_5, hours=item_4)  # -> HOY, DOY, date; plug-in component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

list = ValueList({"Exterior Window [R1.0, SHGC 0.7]": "ASHRAE 90.1-2004 EXTWINDOW CLIMATEZONE ALT-WARE 1-8", "Exterior Window [R1.7, SHGC 0.39]": "ASHRAE 90.1-2004 EXTWINDOW CLIMATEZONE 4-6", "Exterior Window [R1.9, SHGC 0.39]": "ASHRAE 90.1-2004 EXTWINDOW CLIMATEZONE ALT-RES 4-6", "Exterior Window [R0.7, SHGC 0.65]": "Dbl LoE (e3=.1) Clr 3mm/13mm Arg"}, selected="Exterior Window [R1.9, SHGC 0.39]")
list_2 = ValueList({"Exterior Roof [R9.2]": "ASHRAE 90.1-2004 EXTROOF METAL CLIMATEZONE 3-4", "Exterior Roof [R14.8]": "ASHRAE 90.1-2004 EXTROOF IEAD CLIMATEZONE 1-4", "Exterior Roof [R34.4]": "ASHRAE 189.1-2009 EXTROOF IEAD CLIMATEZONE 7-8"}, selected="Exterior Roof [R34.4]")
# Construction
list_3 = ValueList({"Exterior Wall [R5.5]": "ASHRAE 90.1-2004 EXTWALL METAL CLIMATEZONE 4", "Exterior Wall [R5.8]": "ASHRAE 90.1-2004 EXTWALL MASS CLIMATEZONE 3-4", "Exterior Wall [R7.2]": "ASHRAE 90.1-2004 EXTWALL STEELFRAME CLIMATEZONE 1-4", "Exterior Wall [R8.7]": "ASHRAE 90.1-2004 EXTWALL MASS CLIMATEZONE ALT-RES 4", "Exterior Wall [R10.4]": "ASHRAE 90.1-2004 EXTWALL WOODFRAME CLIMATEZONE 1-7", "Exterior Wall [R14.8]": "ASHRAE 90.1-2004 EXTWALL STEELFRAME CLIMATEZONE ALT-RES 4-6", "Exterior Wall [R34.4]": "ASHRAE 189.1-2009 EXTROOF IEAD CLIMATEZONE 7-8"}, selected="Exterior Wall [R34.4]")

# ----
# Blinds
add_blinds = BooleanToggle(True)
shading_depth = Slider(0.3, range=0..1)
number_of_blinds = Slider(12, range=0..20)

# ----
# Thermal Mass
# Construction
list_4 = ValueList({"Existing Slab Construction": "0", "+4 Inches Concrete": "1", "+8 Inches Concrete": "2"}, selected="Existing Slab Construction")

callfromepconstrlibrary = Honeybee_CallFromEPConstructionLibrary(keywords="floor")  # -> ThermMaterials, EPMaterials, EPWindowMaterials, EPConstructions; plug-in component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
item_6 = ListItem(List=callfromepconstrlibrary.EPConstructions, Index=Slider(0, range=0..100), Wrap=True)
decomposeepconstruction = Honeybee_DecomposeEPConstruction(cnstrName=item_6)  # -> flatten(materials), comments, UValue_SI, UValue_IP, RValue_SI, RValue_IP; plug-in component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

callfromepconstrlibrary_2 = Honeybee_CallFromEPConstructionLibrary(keywords="slab")  # -> ThermMaterials, EPMaterials, EPWindowMaterials, EPConstructions; plug-in component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
item_7 = ListItem(List=callfromepconstrlibrary_2.EPConstructions, Index="2", Wrap=True)
decomposeepconstruction_2 = Honeybee_DecomposeEPConstruction(cnstrName=item_7)  # -> flatten(materials), comments, UValue_SI, UValue_IP, RValue_SI, RValue_IP; plug-in component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

panel_12 = Panel("""MAT-CC05 4 HW CONCRETE
MAT-CC05 8 HW CONCRETE""")
panel_13 = Panel(decomposeepconstruction.materials)
item_8 = ListItem(List=decomposeepconstruction.materials, Index=0, Wrap=True)  # -> Item, Item1
item_9 = ListItem(List=panel_12, Index=0, Wrap=True)  # -> Item, Item1
panel_14 = Panel(item_6)
epconstruction = Honeybee_EnergyPlusConstruction(name="floor_cnstr_2", layer_1=item_8.Item, layer_2=item_8.Item1, layer_3=item_9.Item1)  # -> EPConstruction; plug-in component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
epconstruction_2 = Honeybee_EnergyPlusConstruction(name="floor_cnstr_1", layer_1=item_8.Item, layer_2=item_8.Item1, layer_3=item_9.Item)  # -> EPConstruction; plug-in component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

setepzonecnstr = Honeybee_SetEPZoneConstruction(HBZones=solveadjc.HBZonesWADJ, wallEPConstruction=list_3, windowEPConstruction=list, roofEPConstruction=list_2)  # -> simplify(modifiedHBZones); plug-in component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
panel_15 = Panel(setepzonecnstr)
filter = StreamFilter(Gate=list_4, Stream0=panel_14, Stream1=epconstruction_2, Stream2=epconstruction)
setepzoneundergroundcnstr = Honeybee_SetEPZoneUndergroundConstruction(HBZones=setepzonecnstr, groundFloorEPConstruction=filter)  # -> simplify(modifiedHBZones); plug-in component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
gradientlibrary = Ladybug_GradientLibrary(gradIndex=Slider(1, range=0..10))  # -> customColors; plug-in component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

# ----
# run the analysis
# visualize the results
# prepare a recipe
number_slider_23 = Slider(0.762, range=0..1)
# Point-in time Illuminance
gentestpts = Honeybee_GenerateTestPoints(testGeometry=item, gridSize=Slider(0.1, range=0..1), distBaseSrf=number_slider_23, moveTestMesh=True)  # -> readMe, simplify(testPoints), simplify(ptsVectors), simplify(facesArea), simplify(mesh); plug-in component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
gridbasedsimulation = Honeybee_GridBasedSimulation(
    skyFile=genclimatebasedsky.skyFilePath,
    testPoints=gentestpts.testPoints,
    ptsVectors=gentestpts.ptsVectors,
    testMesh=gentestpts.mesh,
    simulationType=0)  # -> analysisRecipe; plug-in component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
toggle_2 = BooleanToggle(False)
rundaylightanalysis = Honeybee_RunDaylightSimulation(
    HBObjects=flatten(brep_10),
    analysisRecipe=gridbasedsimulation,
    writeRad=toggle_2,
    runRad=toggle_2,
    overwriteResults=True)  # -> readMe, analysisType, resultsUnit, results, testPts, resultFiles, radGeoFile, studyFolder, done; plug-in component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
panel_16 = Panel(doy_hoy.date)
legendpar = Ladybug_LegendParameters(lowBound="300", highBound="2000", customColors=flatten(gradientlibrary))  # -> legendPar; plug-in component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
concat = Concatenate(FragmentA=rundaylightanalysis.analysisType, FragmentC=panel_16)
recolormesh = Ladybug_RecolorMesh(
    analysisResult=rundaylightanalysis.results,
    inputMesh=gentestpts.mesh,
    legendPar=legendpar,
    analysisTitle=concat,
    legendTitle=rundaylightanalysis.resultsUnit)  # -> readMe, newMesh, newLegend, legendBasePt, meshColors, legendColors; plug-in component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

panel_17 = Panel(rundaylightanalysis.results)

decomposebytype_2 = Honeybee_DecomposeBasedOnType(HBZone=setepzoneundergroundcnstr)  # -> walls, interiorWalls, airWalls, windows, interiorWindows, skylights, roofs, ceilings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; plug-in component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
# Blinds
shddesigner = Ladybug_ShadingDesigner(
    glzSrf=flatten(decomposebytype_2.windows),
    depthOrVector=flatten(shading_depth),
    numOfShds=number_of_blinds,
    runIt=add_blinds,
    port_4=False)  # -> readMe, shadingSrfs; plug-in component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
wires_3 = BrepWireframe(Brep=shddesigner.shadingSrfs, Density=-1)
hb_epcontextsrf = HoneybeeEPContextSurfaces(shdSurfaces=flatten(shddesigner.shadingSrfs))  # -> HBContext; inputs shdSurfaces: list of Brep, justBoundingBox: Boolean
# ---------- hb_epcontextsrf: Python ----------
"""
prepare shading/context geometries

    Args:
        northVectorOrRotation: A vector that shows North or a number that shows
                               the rotation of the North from the Y axis
        bldgMasses: List of closed Breps as thermal zones.
    Returns:
        report: ...
        thermalZones: Thermal zone's geometries for visualiza
"""

ghenv.Component.Name = 'Honeybee EP context Surfaces'
ghenv.Component.NickName = 'HB_EPContextSrf'
ghenv.Component.Message = 'VER 0.0.60\nNOV_04_2016'
ghenv.Component.IconDisplayMode = ghenv.Component.IconDisplayMode.application
ghenv.Component.Category = "Honeybee"
ghenv.Component.SubCategory = "10 | Energy | Energy"
#compatibleHBVersion = VER 0.0.57\nNOV_04_2016
#compatibleLBVersion = VER 0.0.59\nFEB_01_2015
ghenv.Component.AdditionalHelpFromDocStrings = "2"

import rhinoscriptsyntax as rs
import Rhino as rc
import scriptcontext as sc
import os
import System
import Grasshopper.Kernel as gh
import uuid

tolerance = sc.doc.ModelAbsoluteTolerance
import math


def main(shdSurfaces, EPTransSchedule, meshingSettings, justBoundingBox):
    
    # import the classes
    if sc.sticky.has_key('honeybee_release'):

        try:
            if not sc.sticky['honeybee_release'].isCompatible(ghenv.Component): return -1
            if sc.sticky['honeybee_release'].isInputMissing(ghenv.Component): return -1
        except:
            warning = "You need a newer version of Honeybee to use this compoent." + \
            " Use updateHoneybee component to update userObjects.\n" + \
            "If you have already updated userObjects drag Honeybee_Honeybee component " + \
            "into canvas and try again."
            w = gh.GH_RuntimeMessageLevel.Warning
            ghenv.Component.AddRuntimeMessage(w, warning)
            return -1
        
        # don't customize this part
        hb_EPSrf = sc.sticky["honeybee_EPSurface"]
        hb_EPSHDSurface = sc.sticky["honeybee_EPShdSurface"]
        hb_RADMaterialAUX = sc.sticky["honeybee_RADMaterialAUX"]
        hb_EPObjectsAux = sc.sticky["honeybee_EPObjectsAUX"]()
        HBScheduleList = sc.sticky["honeybee_ScheduleLib"].keys()

        ########################################################################
        #----------------------------------------------------------------------#
        shdBreps = []
        # create bounding box of shading geometries
        if justBoundingBox:
            for brep in shdSurfaces:
                if brep.Faces.Count>1 or not brep.Faces[0].IsPlanar(sc.doc.ModelAbsoluteTolerance):
                    shdBreps.append(brep.GetBoundingBox(True).ToBrep())
                else:
                    shdBreps.append(brep)
        else:
            shdBreps = shdSurfaces
        
        shadingClasses = []
        shadingMeshPreview = []
        
        if meshingSettings == None:
            mp = rc.Geometry.MeshingParameters.Minimal
            mp.SimplePlanes = True
        else:
            mp = meshingSettings
        
        def getRadMaterialName(radMaterial):
            nameStr = radMaterial.split(" ")[2]
            name =  nameStr.split("\n")[0]
            return name
        
        for brepCount, brep in enumerate(shdBreps):
            if brep != None:
                isPlanar = True
                # check planarity
                for face in brep.Faces:
                    if not face.IsPlanar(tolerance):
                        isPlanar = False
                        break
                
                shadingBreps = []
                if not isPlanar:
                    meshArray = rc.Geometry.Mesh.CreateFromBrep(brep, mp)
                    for mesh in meshArray:
                        for meshFace in range(mesh.Faces.Count):
                            vertices = list(mesh.Faces.GetFaceVertices(meshFace))[1:]
                            vertices = vertices + [sc.doc.ModelAbsoluteTolerance]
                            # create the brep from mesh
                            shdBrep = rc.Geometry.Brep.CreateFromCornerPoints(*vertices)
                            shadingBreps.append(shdBrep)
                else:
                    for face in brep.Faces:
                        shadingBreps.append(face.DuplicateFace(False))
                
                for faceCount, shdBrep in enumerate(shadingBreps):
                        thisShading = hb_EPSHDSurface(shdBrep, 1000*brepCount + faceCount, 'shdSrf_' + `brepCount` + '_' + `faceCount` + "_" + str(uuid.uuid4()))
                        
                        # add transmittance schedule if any
                        if EPTransSchedule!=None:
                            schedule= EPTransSchedule.upper()
                            if schedule!=None and not schedule.lower().endswith(".csv") and schedule not in HBScheduleList:
                                msg = "Cannot find " + schedule + " in Honeybee schedule library."
                                print msg
                                ghenv.Component.AddRuntimeMessage(gh.GH_RuntimeMessageLevel.Warning, msg)
                                return -1
                            elif schedule!=None and schedule.lower().endswith(".csv"):
                                # check if csv file is existed
                                if not os.path.isfile(schedule):
                                    msg = "Cannot find the shchedule file: " + schedule
                                    print msg
                                    ghenv.Component.AddRuntimeMessage(gh.GH_RuntimeMessageLevel.Warning, msg)
                                    return -1
                            
                            thisShading.TransmittanceSCH = schedule
                        
                        # add the Rad Material if any
                        if RADMaterial!=None:
                            # if it is just the name of the material make sure it is already defined
                            if len(RADMaterial.split(" ")) == 1:
                                # if the material is not in the library add it to the library
                                if not hb_RADMaterialAUX.isMatrialExistInLibrary(RADMaterial):
                                    warningMsg = "Can't find " + RADMaterial + " in RAD Material Library.\n" + \
                                                "Add the material to the library and try again."
                                    ghenv.Component.AddRuntimeMessage(gh.GH_RuntimeMessageLevel.Warning, warningMsg)
                                    return
                                
                                try:
                                    thisShading.setRADMaterial(RADMaterial)
                                except Exception, e:
                                    print e
                                    warningMsg = "You are using an old version of Honeybee_Honeybee! Update your files and try again."
                                    print warningMsg
                                    ghenv.Component.AddRuntimeMessage(gh.GH_RuntimeMessageLevel.Warning, warningMsg)
                                    return
                                
                                addedToLib = True
                            else:
                                
                                # try to add the material to the library
                                addedToLib, thisShading.RadMaterial = hb_RADMaterialAUX.analyseRadMaterials(RADMaterial, True)
                                
                            if addedToLib==False:
                                warningMsg = "Failed to add " + RADMaterial + " to the Library."
                                ghenv.Component.AddRuntimeMessage(gh.GH_RuntimeMessageLevel.Warning, warningMsg)
                                return
                        
                        # add shading to the list
                        shadingClasses.append(thisShading)
                
        # add to the hive
        hb_hive = sc.sticky["honeybee_Hive"]()
        HBContext  = hb_hive.addToHoneybeeHive(shadingClasses, ghenv.Component)
        return HBContext
        ################################################################################################
    else:
        print "You should first let Honeybee to fly..."
        w = gh.GH_RuntimeMessageLevel.Warning
        ghenv.Component.AddRuntimeMessage(w, "You should first let Honeybee to fly...")
        return -1
        

if _shdSurfaces and _shdSurfaces[0]!=None:
    # add cleaning function
    result= main(_shdSurfaces, EPTransSchedule_, meshingSettings_, justBoundingBox_)
    
    if result != -1: HBContext = result
# ---------- end hb_epcontextsrf ----------
preview_4 = CustomPreview(Geometry=wires_3, Shader=ColourSwatch(SwatchColor=RGBA(0, 0, 0, 194)))

# ----
# infiltration rate
ach2m3_s_m2_calculator = HoneybeeInfORventPerAreaCalculator(HBZones=flatten(setepzoneundergroundcnstr), airChangeHour=Slider(2, range=0..10))  # -> out, infORventPerArea, allFloors; plug-in component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
setepzoneloads = Honeybee_SetEnergyPlusZoneLoads(HBZones=flatten(setepzoneundergroundcnstr))  # -> loads, HBZones; plug-in component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

toggle_3 = BooleanToggle(False)
panel_18 = Panel(setepzoneloads.HBZones)

# ----
# Analysis
toggle_4 = BooleanToggle(True)
panel_19 = Panel("https://www.energyplus.net/weather-download/north_and_central_america_wmo_region_4/USA/PA/USA_PA_Philadelphia.Intl.AP.724080_TMY3/all")
epw_stat = Ladybug_OpenEPWAndSTATWeatherFiles(weatherFileURL=panel_19)  # -> epwFile, statFile; plug-in component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
epoutput = Honeybee_GenerateEPOutput(zoneGainsAndLosses=toggle_4, zoneComfortMetrics=toggle_4, surfaceTempAnalysis="False", surfaceEnergyAnalysis=toggle_4)  # -> report, flatten(simulationOutputs); plug-in component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
rep = ReplaceText(Text="50_percent_glazing", Find=" ", Replace="_", RecursiveReplace=False)
path_2 = FilePath(epw_stat.epwFile)
importepw = Ladybug_ImportEpw(epwFile=path_2)  # -> readMe, latitude, location, dryBulbTemperature, dewPointTemperature, relativeHumidity, windSpeed, windDirection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; plug-in component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
runenergysimulation = Honeybee_RunEnergySimulation(
    epwFile=path_2,
    HBZones=flatten(setepzoneloads.HBZones),
    HBContext=flatten(hb_epcontextsrf),
    simulationOutputs=flatten(epoutput.simulationOutputs),
    writeIdf=run_energyplus,
    runEnergyPlus=run_energyplus,
    idfFileName=rep)  # -> report, idfFileAddress, resultFileAddress; plug-in component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
item_10 = ListItem(List=setepzoneloads.HBZones, Index=Slider(0, range=0..100), Wrap=True)
panel_20 = Panel(runenergysimulation.resultFileAddress)
readepsrfresult = Honeybee_ReadEPSurfaceResult(resultFileAddress=runenergysimulation.resultFileAddress)  # -> surfaceIndoorTemp, surfaceOutdoorTemp, surfaceEnergyFlow, opaqueEnergyFlow, glazEnergyFlow, windowTotalSolarEnergy, windowBeamEnergy, windowDiffEnergy, windowTransmissivity, otherSurfaceData; plug-in component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
readepresult = Honeybee_ReadEPResult(resultFileAddress=runenergysimulation.resultFileAddress)  # -> totalThermalLoad, thermalLoadBalance, cooling, heating, electricLight, electricEquip, fanElectric, pumpElectric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; plug-in component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
colorsurfaces = Honeybee_ColorSurfacesByEPResult(srfData=readepsrfresult.surfaceEnergyFlow, HBZones=flatten(item_10), runIt=Toggle(True))  # -> readMe, srfColoredMesh, zoneWireFrame, legend, legendBasePt, analysisTitle, srfBreps, srfColors, srfValues, normalizedSrfData; plug-in component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

pt = Point(Point(23.10617158, 0, 0))

# ----
# Adaptive Comfort
toggle_5 = BooleanToggle(True)
adaptivecomfortcalculator = Ladybug_AdaptiveComfortCalculator(
    dryBulbTemperature=readepresult.airTemperature,
    meanRadiantTemperature=readepresult.meanRadTemperature,
    prevailingOutdoorTemp=importepw.dryBulbTemperature,
    runIt=toggle_5)  # -> readMe, port, comfortableOrNot, conditionOfPerson, degreesFromTarget, port_2, targetTemperature, upperTemperatureBound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; plug-in component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
legendpar_2 = Ladybug_LegendParameters(lowBound="-1", highBound="1", numSegments="3")  # -> legendPar; plug-in component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
_3dchart = Ladybug_3DChart(
    inputData=flatten(adaptivecomfortcalculator.conditionOfPerson),
    basePoint=pt,
    xScale=".025",
    yScale="0.125",
    zScale=Slider(0, range=0..100),
    legendPar=legendpar_2)  # -> readMe, graphMesh, graphCurves, legend, legendBasePts, title, titleBasePts, dataPts, conditionalHOY; plug-in component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

pt_2 = Point(<point referenced from the Rhino model>)

# ----
# Pychrometric Chart
panel_21 = Panel("35")
vec = VectorXYZ(XComponent="140", YComponent="35", ZComponent=0)  # -> Vector, Length
vec_2 = VectorXYZ(XComponent=0, YComponent=panel_21, ZComponent=0)  # -> Vector, Length
move_2 = Move(Geometry=pt, Motion=vec.Vector)  # -> Geometry, Transform
move_3 = Move(Geometry=pt_2, Motion=vec_2.Vector)  # -> Geometry, Transform
psychchart = Ladybug_PsychrometricChart(
    dryBulbTemperature=readepresult.airTemperature,
    relativeHumidity=readepresult.relativeHumidity,
    basePoint=move_2.Geometry,
    runIt=Toggle(True))  # -> readMe, port, totalComfortPercent, totalComfortOrNot, strategyNames, strategyPercentOfTime, strategyOrNot, port_2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; plug-in component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

# ----
# Comfort
panel_22 = Panel("1")
gradientlibrary_2 = Ladybug_GradientLibrary(gradIndex=panel_22)  # -> customColors; plug-in component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
energybalance = Honeybee_ConstructEnergyBalance(
    HBZones=flatten(setepzoneloads.HBZones),
    peopleGains=readepresult.peopleGains,
    totalSolarGain=readepresult.totalSolarGain,
    infiltrationEnergy=readepresult.infiltrationEnergy,
    surfaceEnergyFlow=readepsrfresult.surfaceEnergyFlow)  # -> readMe, port, flrNormEnergyBal, flrNormBalWStorage, port_2, modelEnergyBalance, energyBalWithStorage; plug-in component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
rev = ReverseList(List=gradientlibrary_2)
legendpar_3 = Ladybug_LegendParameters(customColors=flatten(rev))  # -> legendPar; plug-in component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
selectandaveragedata = Ladybug_AverageData(annualHourlyData=energybalance.modelEnergyBalance, totalOrAverage=Toggle(True))  # -> readMe, selHourlyData, totaledDaily, totaledMonthly, totMonthlyPerHour, totAnalysisPeriod; plug-in component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
panel_23 = Panel("-3191.97")
barchart = Ladybug_MonthlyBarChart(
    inputData=flatten(selectandaveragedata.totaledMonthly),
    stackValues=Toggle(True),
    basePoint=move_3.Geometry,
    xScale=Slider(0.75, range=0..1),
    legendPar=legendpar_3)  # -> readMe, dataMesh, dataCurves, dataCrvColors, graphAxes, graphLabels, title, titleBasePt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; plug-in component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
pt_3 = Point(barchart.dataLabelPts)
tag = TextTag3D(Location=barchart.dataLabelPts, Text=barchart.dataMesh, Size=1, Justification=7)

comfortable_hot_cold = Panel([adaptivecomfortcalculator.percentOfTimeComfortable, adaptivecomfortcalculator.percentHotCold])
# Comfort
panel_24 = Panel("""Comfortable (%): 
hot (%):         
cold (%):        """)
num = Number(comfortable_hot_cold)
flip = FlipMatrix(Data=panel_24)  # -> simplify(Data)
expression = Expression(x=num, Expression="Round(x, 2)")
flip_2 = FlipMatrix(Data=expression)  # -> simplify(Data)
panel_25 = Panel([flip, flip_2])
join = TextJoin(Text=panel_25)
join_2 = TextJoin(Text=flatten(join))
pt_4 = Point(Point(-17, 4, 0))
tag_2 = TextTag3D(Location=pt_4, Text=join_2, Size=1, Colour=ColourSwatch(SwatchColor=RGB(0, 0, 0)), Justification=5)

# ----
# Glare
# Run the analysis
# Analysis Recipe
panel_26 = Panel("https://www.energyplus.net/weather-download/north_and_central_america_wmo_region_4/USA/PA/USA_PA_Philadelphia.Intl.AP.724080_TMY3/all")
epw_stat_2 = Ladybug_OpenEPWAndSTATWeatherFiles(weatherFileURL=panel_26)  # -> epwFile, statFile; plug-in component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
number_slider_24 = Slider(0, range=0..100)
importlocation_2 = Ladybug_ImportLocation(epwFile=epw_stat_2.epwFile)  # -> location; plug-in component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
genavgsky = Honeybee_GenerateAverageSky(north=number_slider_24, weatherFile=epw_stat_2.epwFile, month="12", hour="9")  # -> radiationValues, skyFilePath; plug-in component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
genclimatebasedsky_2 = Honeybee_GenerateClimateBasedSky(north=number_slider_24, weatherFile=epw_stat_2.epwFile, month="12", day="21", hour="9")  # -> radiationValues, skyFilePath; plug-in component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
northarrow = Ladybug_North(north=number_slider_24, scale=".05")  # -> northSign; plug-in component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
doy_hoy_2 = Ladybug_DOY_HOY(days="21", months="12", hours="9")  # -> HOY, DOY, date; plug-in component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
sunpath_2 = Ladybug_SunPath(
    north=number_slider_24,
    location=importlocation_2,
    hour="9",
    day="21",
    month="12",
    timeStep=1,
    sunScale=Slider(0.2, range=0..1),
    dailyOrAnnualSunPath=True)  # -> readMe, sunVectors, sunAltitudes, sunAzimuths, port, sunSpheresMesh, sunPathCrvs, legend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; plug-in component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
radparameters = Honeybee_RADParameters(quality=0, ab="3")  # -> readMe, radParameters; plug-in component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
imagebasedsimulation = Honeybee_ImageBasedSimulation(
    skyFile=genavgsky.skyFilePath,
    cameraType="1",
    simulationType=2,
    radParameters=radparameters.radParameters,
    backupImages=0)  # -> analysisRecipe; plug-in component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
number_slider_25 = Slider(0.7, range=0..1)

rundaylightanalysis_2 = Honeybee_RunDaylightSimulation(
    HBObjects=flatten(brep_10),
    analysisRecipe=imagebasedsimulation,
    writeRad=toggle_3,
    runRad=toggle_3,
    numOfCPUs=Slider(4, range=0..10),
    radFileName=doy_hoy_2.date,
    overwriteResults=True)  # -> readMe, analysisType, resultsUnit, results, testPts, resultFiles, radGeoFile, studyFolder, done; plug-in component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

glareanalysis = Honeybee_GlareAnalysis(HDRImagePath=rundaylightanalysis_2.resultFiles, runIt=Toggle(True))  # -> readMe, glareCheckImage, DGP, DGI, imageWithTaskArea; plug-in component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
falsecolor = Honeybee_FalseColor(
    HDRFilePath=rundaylightanalysis_2.resultFiles,
    contourBands=False,
    maskThreshold=0.1,
    useAlterColors=False,
    render=Toggle(True))  # -> outputFilePath; plug-in component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
# Visualization
panel_27 = Panel(glareanalysis.DGP)
panel_28 = Panel(falsecolor)
hdr_tif = Honeybee_ConvertHDRToTIF(HDRFilePath=glareanalysis.glareCheckImage, adjustExposure=Toggle(False))  # -> TIFFFilePath; plug-in component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
hdr_tif_2 = Honeybee_ConvertHDRToTIF(HDRFilePath=falsecolor, adjustExposure=False)  # -> TIFFFilePath; plug-in component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
panel_29 = Panel(hdr_tif_2)
image = ImageFromPath(P=hdr_tif_2, S=number_slider_25)
image_2 = ImageFromPath(P=hdr_tif, S=number_slider_25)

# ----
# Run the analysis
# Visualize the results
# Generate annual results
# Put the recipie together!
number_slider_26 = Slider(0.762, range=0..1)
# DA&UDI
number_slider_27 = Slider(0.1, range=0..1)
panel_30 = Panel("https://www.energyplus.net/weather-download/north_and_central_america_wmo_region_4/USA/PA/USA_PA_Philadelphia.Intl.AP.724080_TMY3/all")
gentestpts_2 = Honeybee_GenerateTestPoints(testGeometry=flatten(item), gridSize=number_slider_27, distBaseSrf=number_slider_26, moveTestMesh=Toggle(True))  # -> readMe, simplify(testPoints), simplify(ptsVectors), simplify(facesArea), simplify(mesh); plug-in component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
epw_stat_3 = Ladybug_OpenEPWAndSTATWeatherFiles(weatherFileURL=panel_30)  # -> epwFile, statFile; plug-in component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
annualdaylightsimulation = Honeybee_AnnualDaylightSimulation(
    epwWeatherFile=epw_stat_3.epwFile,
    testPoints=flatten(gentestpts_2.testPoints),
    ptsVectors=flatten(gentestpts_2.ptsVectors),
    testMesh=flatten(gentestpts_2.mesh))  # -> analysisRecipe; plug-in component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
toggle_6 = BooleanToggle(False)
occupancygenerator = Honeybee_DaysimOccupancyGenerator(weekendDays=[1, 2], writeTheOcc=Toggle(True))  # -> occupancyFile; plug-in component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
rundaylightanalysis_3 = Honeybee_RunDaylightSimulation(
    HBObjects=flatten(brep_10),
    analysisRecipe=annualdaylightsimulation,
    writeRad=toggle_6,
    runRad=toggle_6,
    numOfCPUs=Slider(4, range=0..10),
    overwriteResults=True)  # -> readMe, analysisType, resultsUnit, results, testPts, flatten(resultFiles), radGeoFile, studyFolder, done; plug-in component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
panel_31 = Panel(occupancygenerator)
panel_32 = Panel(rundaylightanalysis_3.resultFiles)
readannualresultsi = Honeybee_ReadAnnualResultI(
    illFilesAddress=rundaylightanalysis_3.resultFiles,
    testPoints=simplify(rundaylightanalysis_3.testPts),
    occupancyFiles=occupancygenerator,
    DLAIllumThresholds=300,
    runIt=Toggle(True))  # -> DLA, UDLI_Less_100, UDLI_100_2000, UDLI_More_2000, CDA, sDA, annualProfiles, htmReport; plug-in component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
gradientlibrary_3 = Ladybug_GradientLibrary(gradIndex=Slider(2, range=0..10))  # -> customColors; plug-in component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
legendpar_4 = Ladybug_LegendParameters(lowBound=Slider(0, range=0..100), highBound=Slider(100, range=0..100), numSegments=Slider(6, range=0..10))  # -> legendPar; plug-in component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
dom = ConstructDomain(DomainStart=0, DomainEnd=Slider(1, range=0..1))

panel_33 = Panel(readannualresultsi.htmReport)
panel_34 = Panel(readannualresultsi.sDA)
recolormesh_2 = Ladybug_RecolorMesh(
    analysisResult=readannualresultsi.DLA,
    inputMesh=gentestpts_2.mesh,
    legendPar=legendpar_4,
    analysisTitle=rundaylightanalysis_3.analysisType,
    legendTitle="%")  # -> readMe, newMesh, newLegend, legendBasePt, meshColors, legendColors; plug-in component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

lng = ListLength(List=recolormesh_2.readMe)
panel_35 = Panel(lng)
panel_36 = Panel(recolormesh_2.readMe)
