# Grasshopper definition Tai Feng.gh (Grasshopper 0.9.76)
# plug-ins: Python Interpreter

panel = Panel("https://www.energyplus.net/weather-download/north_and_central_america_wmo_region_4/USA/PA/USA_PA_Philadelphia.Intl.AP.724080_TMY3/all")
ladybug = Ladybug_Ladybug()  # -> Vviiiiiiiiiizzz; plug-in component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
epw_stat = Ladybug_OpenEPWAndSTATWeatherFiles(weatherFileURL=panel)  # -> epwFile, statFile; plug-in component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
importepw = Ladybug_ImportEpw(epwFile=epw_stat.epwFile)  # -> readMe, latitude, location, dryBulbTemperature, dewPointTemperature, relativeHumidity, windSpeed, windDirection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; plug-in component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
analysisperiod = Ladybug_AnalysisPeriod()  # -> readMe, analysisPeriod; plug-in component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
brep = Brep([<brep referenced from the Rhino model> x3])
area = Area(Geometry=brep)  # -> Area, Centroid
line = Line(Line((-102.3446363, 324.5902896, -257.2096947), (-101.9729119, 327.617742, -257.2096947)))

# ----
# Meyerson Hall building+1st Change
brep_2 = Brep([<brep referenced from the Rhino model> x14])

# ----
# Meyerson Hall building
brep_3 = Brep([<brep referenced from the Rhino model> x13])

# ----
# Meyerson Hall building+3rd Change
brep_4 = Brep([<brep referenced from the Rhino model> x14])

# ----
# Meyerson Hall building+2nd Change
brep_5 = Brep([<brep referenced from the Rhino model> x14])

vec = Vector(line)
toggle = BooleanToggle(True)
unit = UnitVector(Vector=vec)
solaradjusttemperature = Ladybug_OutdoorSolarTemperatureAdjustor(
    location=importepw.location,
    cumSkyMtxOrDirNormRad=importepw.directNormalRadiation,
    diffuseHorizRad=importepw.diffuseHorizontalRadiation,
    baseTemperature=importepw.dryBulbTemperature,
    baseDryBulbOrMRT=Toggle(True),
    horizInfraredRad=importepw.horizontalInfraredRadiation,
    bodyLocation=area.Centroid,
    contextShading=brep_4,
    north=unit,
    analysisPeriodOrHOY=analysisperiod.analysisPeriod,
    parallel=toggle,
    runIt=toggle)  # -> readMe, port, effectiveRadiantField, MRTDelta, solarAdjustedMRT, port_2, mannequinMesh, port_3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; plug-in component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
outdoorcomfortcalculator = Ladybug_OutdoorComfortCalculator(
    dryBulbTemperature=importepw.dryBulbTemperature,
    meanRadiantTemperature=solaradjusttemperature.solarAdjustedMRT,
    windSpeed_tenMeters=importepw.windSpeed,
    relativeHumidity=importepw.relativeHumidity,
    runIt=Toggle(True))  # -> readMe, port, universalThermalClimateIndex, comfortableOrNot, thermalStress, conditionOfPerson, port_2, percentOfTimeComfortable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; plug-in component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
panel_2 = Panel(outdoorcomfortcalculator.percentOfTimeComfortable)
panel_3 = Panel(outdoorcomfortcalculator.percentHeatStress)
number_slider = Slider(2, range=0..10)
number_slider_2 = Slider(2, range=0..10)
number_slider_3 = Slider(2, range=0..10)
number_slider_4 = Slider(1, range=0..1)
number_slider_5 = Slider(1, range=0..1)
number_slider_6 = Slider(1, range=0..1)
busstop_seat = Brep([<brep referenced from the Rhino model> x11])

busstop_shade = Brep(<brep referenced from the Rhino model>)
busstop_seat_2 = Brep([<brep referenced from the Rhino model> x3])
# Calculate Shade Benefit
comfortshadebenefit = Ladybug_ComfortShadeBenefitEvaluator(
    location=importepw.location,
    temperatures=outdoorcomfortcalculator.universalThermalClimateIndex,
    testShades=busstop_shade,
    testRegion=busstop_seat_2,
    gridSize="0.5",
    context=busstop_seat,
    skyResolution="7",
    delNonIntersect=False,
    parallel=Toggle(True),
    runIt=Toggle(False))  # -> readMe, port, sunVectors, regionTestPts, shadeMesh, legend, legendBasePoint, port_2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; plug-in component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

busstop_seat_3 = Brep([<brep referenced from the Rhino model> x11])

busstop_shade_2 = Brep(<brep referenced from the Rhino model>)
busstop_seat_4 = Brep([<brep referenced from the Rhino model> x3])
# Calculate Shade Benefit_2nd_change
comfortshadebenefit_2 = Ladybug_ComfortShadeBenefitEvaluator(
    location=importepw.location,
    temperatures=outdoorcomfortcalculator.universalThermalClimateIndex,
    testShades=busstop_shade_2,
    testRegion=busstop_seat_4,
    gridSize="0.5",
    context=busstop_seat_3,
    skyResolution="7",
    delNonIntersect=False,
    parallel=Toggle(True),
    runIt=Toggle(False))  # -> readMe, port, sunVectors, regionTestPts, shadeMesh, legend, legendBasePoint, port_2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; plug-in component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

busstop_seat_5 = Brep([<brep referenced from the Rhino model> x11])

# ----
# Calculate Shade Benefit_3rd_change
busstop_shade_3 = Brep(<brep referenced from the Rhino model>)
busstop_seat_6 = Brep([<brep referenced from the Rhino model> x3])
comfortshadebenefit_3 = Ladybug_ComfortShadeBenefitEvaluator(
    location=importepw.location,
    temperatures=outdoorcomfortcalculator.universalThermalClimateIndex,
    testShades=busstop_shade_3,
    testRegion=busstop_seat_6,
    gridSize="0.5",
    context=busstop_seat_5,
    skyResolution="7",
    delNonIntersect=False,
    parallel=Toggle(True),
    runIt=Toggle(False))  # -> readMe, port, sunVectors, regionTestPts, shadeMesh, legend, legendBasePoint, port_2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; plug-in component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

# ----
# Pull Out The Areas Where Shade is Most Desirable
meshselector = Ladybug_MeshThresholdSelector(
    inputMesh=comfortshadebenefit_3.shadeMesh,
    analysisResult=comfortshadebenefit_3.shadeNetEffect,
    percentToKeep=Slider(48, range=0..100))  # -> readMe, totalValue, areaMeetsThresh, newColoredMesh, newMeshOutline; plug-in component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
panel_4 = Panel(meshselector.totalValue)
panel_5 = Panel(meshselector.areaMeetsThresh)
preview = CustomPreview(Geometry=meshselector.newMeshOutline, Shader=ColourSwatch(SwatchColor=RGB(0, 0, 0)))

# ----
# Pull Out The Areas Where Shade is Most Desirable
meshselector_2 = Ladybug_MeshThresholdSelector(
    inputMesh=comfortshadebenefit.shadeMesh,
    analysisResult=comfortshadebenefit.shadeNetEffect,
    percentToKeep=Slider(48, range=0..100))  # -> readMe, totalValue, areaMeetsThresh, newColoredMesh, newMeshOutline; plug-in component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
panel_6 = Panel(meshselector_2.totalValue)
panel_7 = Panel(meshselector_2.areaMeetsThresh)
preview_2 = CustomPreview(Geometry=meshselector_2.newMeshOutline, Shader=ColourSwatch(SwatchColor=RGB(0, 0, 0)))

# ----
# Pull Out The Areas Where Shade is Most Desirable
meshselector_3 = Ladybug_MeshThresholdSelector(
    inputMesh=comfortshadebenefit_2.shadeMesh,
    analysisResult=comfortshadebenefit_2.shadeNetEffect,
    percentToKeep=Slider(48, range=0..100))  # -> readMe, totalValue, areaMeetsThresh, newColoredMesh, newMeshOutline; plug-in component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
panel_8 = Panel(meshselector_3.totalValue)
panel_9 = Panel(meshselector_3.areaMeetsThresh)
preview_3 = CustomPreview(Geometry=meshselector_3.newMeshOutline, Shader=ColourSwatch(SwatchColor=RGB(0, 0, 0)))

analysisperiod_2 = Ladybug_AnalysisPeriod()  # -> readMe, analysisPeriod; plug-in component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
legendpar = Ladybug_LegendParameters(numSegments="3")  # -> legendPar; plug-in component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
_3dchart = Ladybug_3DChart(
    inputData=flatten(outdoorcomfortcalculator.thermalStress),
    xScale="0.05",
    yScale=Slider(0.1, range=0..0.1),
    zScale="0",
    legendPar=legendpar)  # -> readMe, graphMesh, graphCurves, legend, legendBasePts, title, titleBasePts, dataPts, conditionalHOY; plug-in component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
sunpath = Ladybug_SunPath(
    north=unit,
    location=importepw.location,
    hour=12,
    day=21,
    month=12,
    timeStep=1,
    analysisPeriod=analysisperiod_2.analysisPeriod,
    centerPt=area.Centroid,
    sunPathScale=Slider(0.1, range=0..1),
    sunScale=Slider(0.5, range=0..1),
    annualHourlyData=flatten(outdoorcomfortcalculator.conditionOfPerson),
    legendPar=legendpar,
    dailyOrAnnualSunPath=True)  # -> readMe, sunVectors, sunAltitudes, sunAzimuths, port, sunSpheresMesh, sunPathCrvs, legend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; plug-in component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
