# Grasshopper definition Esther_Hah_Daylighting.gh (Grasshopper 0.9.76)
# plug-ins: Python Interpreter

ladybug = Ladybug_Ladybug()  # -> Vviiiiiiiiiizzz; plug-in component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
honeybee = Honeybee_Honeybee()  # -> Vviiiiiiiiiizzz; plug-in component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
months = Panel("""3
6
12""")
number_slider = Slider(0, range=0..2)
number_slider_2 = Slider(0, range=0..2)
# Animate sliders
button = Button()
hours = Panel("""9
12
15""")
panel = Panel(honeybee)
# Glass material
panel_2 = Panel("tvis_60")
fly = Ladybug_fly(inputSliders=[number_slider_2, number_slider], fly=button)  # -> Vviiiiiiiiiizzz; plug-in component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
panel_3 = Panel("https://www.energyplus.net/weather-download/north_and_central_america_wmo_region_4/USA/PA/USA_PA_Philadelphia.Intl.AP.724080_TMY3/all")
item = ListItem(List=hours, Index=number_slider, Wrap=True)
path = FilePath("C:\Users\Me\Desktop\MEBD Research Seminar\epw\USA_PA_Philadelphia.Intl.AP.724080_TMY3\USA_PA_Philadelphia.Intl.AP.724080_TMY3.epw")
item_2 = ListItem(List=months, Index=number_slider_2, Wrap=True)
panel_4 = Panel("""9
12
15""")
radglassmaterial = Honeybee_RadianceGlassMaterial(materialName=panel_2, RTransmittance="0.6", GTransmittance="0.6", BTransmittance="0.6", refractiveIndex=1.52)  # -> avrgTrans, RADMaterial; plug-in component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
epw_stat = Ladybug_OpenEPWAndSTATWeatherFiles(weatherFileURL=panel_3)  # -> epwFile, statFile; plug-in component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
panel_5 = Panel("""3
6
12""")
shading_device = Brep(<brep referenced from the Rhino model>)
brep = Brep([<brep referenced from the Rhino model> x25])
# Prepare geometries
brep_2 = Brep(<brep referenced from the Rhino model>)

# ---- group: glass
brep_3 = Brep(<brep referenced from the Rhino model>)

# ----
analysis_surface = Brep(<brep referenced from the Rhino model>)
importlocation = Ladybug_ImportLocation(epwFile=path)  # -> location; plug-in component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
panel_6 = Panel(brep)
# Generate sky
genclimatebasedsky = Honeybee_GenerateClimateBasedSky(weatherFile=epw_stat.epwFile, month=item_2, day="21", hour=item)  # -> radiationValues, skyFilePath; plug-in component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
createhbsrfs = Honeybee_createHBSrfs(geometry=brep_3, RADMaterial=radglassmaterial.RADMaterial)  # -> readMe, simplify(HBSurface); plug-in component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
doy_hoy = Ladybug_DOY_HOY(days="21", months=item_2, hours=item)  # -> HOY, DOY, date; plug-in component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
createhbsrfs_2 = Honeybee_createHBSrfs(geometry=[brep, brep_2, analysis_surface])  # -> readMe, simplify(flatten(HBSurface)); plug-in component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
sunpath = Ladybug_SunPath(
    location=importlocation,
    hour=panel_4,
    day=21,
    month=panel_5,
    timeStep=1,
    sunPathScale=Slider(0.05, range=0..0.1),
    dailyOrAnnualSunPath=True)  # -> readMe, sunVectors, sunAltitudes, sunAzimuths, port, sunSpheresMesh, sunPathCrvs, legend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; plug-in component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
brep_4 = Brep(flatten([createhbsrfs_2.HBSurface, createhbsrfs.HBSurface]))
item_3 = ListItem(List=analysis_surface, Index=Slider(11, range=1..25), Wrap=True)
preview = CustomPreview(Geometry=createhbsrfs.HBSurface, Shader=ColourSwatch(SwatchColor=RGBA(129, 150, 235, 74)))
preview_2 = CustomPreview(Geometry=createhbsrfs_2.HBSurface, Shader=ColourSwatch(SwatchColor=RGBA(217, 206, 206, 208)))
gentestpts = Honeybee_GenerateTestPoints(testGeometry=item_3, gridSize=Slider(0.2, range=0..1), distBaseSrf=Slider(0.762, range=0..1), moveTestMesh=True)  # -> readMe, simplify(testPoints), simplify(ptsVectors), simplify(facesArea), simplify(mesh); plug-in component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
# prepare a recipe
gridbasedsimulation = Honeybee_GridBasedSimulation(
    skyFile=genclimatebasedsky.skyFilePath,
    testPoints=gentestpts.testPoints,
    ptsVectors=gentestpts.ptsVectors,
    testMesh=gentestpts.mesh,
    simulationType=0)  # -> analysisRecipe; plug-in component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
toggle = BooleanToggle(True)
# run the analysis
rundaylightanalysis = Honeybee_RunDaylightSimulation(
    HBObjects=flatten(brep_4),
    analysisRecipe=gridbasedsimulation,
    writeRad=toggle,
    runRad=toggle,
    numOfCPUs=Slider(4, range=0..10),
    overwriteResults=True)  # -> readMe, analysisType, resultsUnit, illuminance_values, testPts, resultFiles, radGeoFile, studyFolder, done; plug-in component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
pt = Point(<point referenced from the Rhino model>)
panel_7 = Panel(doy_hoy.date)
legendpar = Ladybug_LegendParameters(lowBound="300", highBound="2000", legendLocation=pt)  # -> legendPar; plug-in component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
# capture the viewport to an image
join = TextJoin(Text=[item_2, "21", item], Join="_")
# visualize the results
concat = Concatenate(FragmentA=rundaylightanalysis.analysisType, FragmentC=panel_7)
panel_8 = Panel(join)
recolormesh = Ladybug_RecolorMesh(
    analysisResult=rundaylightanalysis.illuminance_values,
    inputMesh=gentestpts.mesh,
    legendPar=legendpar,
    analysisTitle=concat,
    legendTitle=rundaylightanalysis.resultsUnit)  # -> readMe, newMesh, newLegend, legendBasePt, meshColors, legendColors; plug-in component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
captureview = Ladybug_CaptureView(fileName=panel_8, capture=Toggle(True))  # -> imagePath; plug-in component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
panel_9 = Panel(captureview)
