# Grasshopper definition HAH_ESTHER_FINAL.gh (Grasshopper 0.9.76)
# plug-ins: Python Interpreter, ItemSelector

honeybee = Honeybee_Honeybee()  # -> Vviiiiiiiiiizzz; plug-in component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
ladybug = Ladybug_Ladybug()  # -> Vviiiiiiiiiizzz; plug-in component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
panel = Panel("https://www.energyplus.net/weather-download/north_and_central_america_wmo_region_4/USA/PA/USA_PA_Philadelphia.Intl.AP.724080_TMY3/all")  # disabled
panel_2 = Panel("UTCI")
panel_3 = Panel("https://www.energyplus.net/weather-download/north_and_central_america_wmo_region_4/USA/PA/USA_PA_Philadelphia.Intl.AP.724080_TMY3/all")  # disabled
panel_4 = Panel([ladybug, honeybee])
boolean_toggle = BooleanToggle(True)
epw_stat = Ladybug_OpenEPWAndSTATWeatherFiles(weatherFileURL=panel_3)  # -> epwFile, statFile; disabled; plug-in component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
panel_5 = Panel(epw_stat.epwFile)  # disabled
epw_stat_2 = Ladybug_OpenEPWAndSTATWeatherFiles(weatherFileURL=panel)  # -> epwFile, statFile; disabled; plug-in component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
panel_6 = Panel(epw_stat_2.epwFile)  # disabled
panel_7 = Panel("https://www.energyplus.net/weather-download/north_and_central_america_wmo_region_4/USA/PA/USA_PA_Philadelphia.Intl.AP.724080_TMY3/all")  # disabled
updatehoneybee = Honeybee_UpdateHoneybee(updateThisFile=boolean_toggle, updateAllUObjects=boolean_toggle)  # -> out; plug-in component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
updateladybug = Ladybug_UpdateLadybug(updateThisFile=boolean_toggle, updateAllUObjects=boolean_toggle)  # -> out; plug-in component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
epw_stat_3 = Ladybug_OpenEPWAndSTATWeatherFiles(weatherFileURL=panel_7)  # -> epwFile, statFile; disabled; plug-in component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
panel_8 = Panel(epw_stat_3.epwFile)  # disabled
importepw = Ladybug_ImportEpw(epwFile=epw_stat_2.epwFile)  # -> readMe, latitude, location, dryBulbTemperature, dewPointTemperature, relativeHumidity, windSpeed, windDirection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; disabled; plug-in component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
importepw_2 = Ladybug_ImportEpw(epwFile=epw_stat.epwFile)  # -> Output, latitude, location, dryBulbTemperature, dewPointTemperature, relativeHumidity, windSpeed, windDirection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; disabled; plug-in component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
panel_9 = Panel("https://www.energyplus.net/weather-download/north_and_central_america_wmo_region_4/USA/PA/USA_PA_Philadelphia.Intl.AP.724080_TMY3/all")  # disabled

# ---- group: geometry
number_slider = Slider(4.2, range=0..10)  # disabled
number_slider_2 = Slider(3.2, range=0..10)  # disabled
number_slider_3 = Slider(4, range=0..10)  # disabled
domain_box = DomainBox(Base=PlaneXY(0, 0, 0), X=number_slider_3, Y=number_slider, Z=number_slider_2)  # disabled
boolean_toggle_2 = BooleanToggle(True)  # disabled
mass2zone = Honeybee_Masses2Zones(zoneMasses=flatten(domain_box), isConditioned=True, maxRoofAngle=30, createHBZones=boolean_toggle_2)  # -> readMe, HBZones; disabled; plug-in component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
panel_10 = Panel("""0
0
0
.8""")  # disabled
glazingcreator = Honeybee_GlazingBasedOnRatio(HBObjects=mass2zone.HBZones, glzRatio=panel_10, runIt=boolean_toggle_2)  # -> readMe, HBObjWGLZ; disabled; plug-in component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
brep_wireframe = BrepWireframe(Brep=glazingcreator.HBObjWGLZ, Density=-1)  # disabled
decomposebytype = Honeybee_DecomposeBasedOnType(HBZone=glazingcreator.HBObjWGLZ)  # -> walls, interiorWalls, airWalls, windows, interiorWindows, skylights, roofs, ceilings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; disabled; plug-in component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

# ----
boolean_toggle_3 = BooleanToggle(False)  # disabled
boolean_toggle_4 = BooleanToggle(True)  # disabled
epw_stat_4 = Ladybug_OpenEPWAndSTATWeatherFiles(weatherFileURL=panel_9)  # -> epwFile, statFile; disabled; plug-in component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
panel_11 = Panel(epw_stat_4.epwFile)  # disabled
panel_12 = Panel("18 < b < 24 and 20 < c <80 and 2 < a < 10")  # disabled
number_slider_4 = Slider(0, range=0..100)  # disabled
panel_13 = Panel("18 < a < 24 and 20 < b <80 and 2 < c < 10")  # disabled
panel_14 = Panel(".25")  # disabled
boolean_toggle_5 = BooleanToggle(False)  # disabled
panel_15 = Panel("20 < a <80")  # disabled
importepw_3 = Ladybug_ImportEpw(epwFile=epw_stat_3.epwFile)  # -> Output, latitude, location, dryBulbTemperature, dewPointTemperature, relativeHumidity, windSpeed, windDirection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; disabled; plug-in component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
analysisperiod = Ladybug_AnalysisPeriod()  # -> out, analysisPeriod; disabled; plug-in component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
windrose = Ladybug_WindRose(
    north=0,
    hourlyWindDirection=importepw.windDirection,
    hourlyWindSpeed=importepw.windSpeed,
    annualHourlyData=flatten([importepw.dryBulbTemperature, importepw.relativeHumidity]),
    bakeIt=boolean_toggle_3,
    runIt=boolean_toggle_4)  # -> readMe, calmRoseMesh, windRoseMesh, windRoseCrvs, windRoseCenPts, legend, legendBasePts, title; disabled; plug-in component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
boolean_toggle_6 = BooleanToggle(True)  # disabled
_3dchart = Ladybug_3DChart(
    inputData=flatten([importepw.dryBulbTemperature, importepw.relativeHumidity, importepw.windSpeed]),
    xScale=panel_14,
    zScale=number_slider_4,
    condStatement=panel_13,
    bakeIt=boolean_toggle_5)  # -> readMe, graphMesh, graphCurves, legend, legendBasePts, title, titleBasePts, dataPts, conditionalHOY; disabled; plug-in component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
colour_swatch = ColourSwatch(SwatchColor=RGB(118, 18, 167))  # disabled
colour_swatch_2 = ColourSwatch(SwatchColor=RGB(253, 219, 255))  # disabled
importlocation = Ladybug_ImportLocation(epwFile=epw_stat_4.epwFile)  # -> location; disabled; plug-in component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
panel_16 = Panel("18")  # disabled
panel_17 = Panel("18")  # disabled

# ---- group: furniture
furniture = Brep([<brep referenced from the Rhino model> x76])  # disabled

# ----
brep = Brep([<brep referenced from the Rhino model> x8])  # disabled
legendpar = Ladybug_LegendParameters(highBound=panel_16)  # -> legendPar; disabled; plug-in component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
list_length = ListLength(List=_3dchart.conditionalHOY)  # disabled

# ---- group: glass facade
glass = Brep()  # disabled

# ----
importepw_4 = Ladybug_ImportEpw(epwFile=epw_stat_4.epwFile)  # -> readMe, latitude, location, dryBulbTemperature, dewPointTemperature, relativeHumidity, windSpeed, windDirection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; disabled; plug-in component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
panel_18 = Panel("0")  # disabled

# ---- group: floor
floor = Brep(<brep referenced from the Rhino model>)  # disabled

# ---- group: ceiling
ceiling = Brep(<brep referenced from the Rhino model>)  # disabled

# ----
legendpar_2 = Ladybug_LegendParameters(lowBound=panel_18, highBound=panel_17, customColors=flatten([colour_swatch_2, colour_swatch]))  # -> legendPar; disabled; plug-in component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

# ---- group: glass
brep_2 = Brep(<brep referenced from the Rhino model>)  # disabled

# ----
brep_3 = Brep(<brep referenced from the Rhino model>)  # disabled

value_list = ValueList({"Exterior Window [R1.0, SHGC 0.7]": "ASHRAE 90.1-2004 EXTWINDOW CLIMATEZONE ALT-WARE 1-8", "Exterior Window [R1.7, SHGC 0.39]": "ASHRAE 90.1-2004 EXTWINDOW CLIMATEZONE 4-6", "Exterior Window [R1.9, SHGC 0.39]": "ASHRAE 90.1-2004 EXTWINDOW CLIMATEZONE ALT-RES 4-6", "Exterior Window [R0.7, SHGC 0.65]": "Dbl LoE (e3=.1) Clr 3mm/13mm Arg"}, selected="Exterior Window [R1.0, SHGC 0.7]")  # disabled
value_list_2 = ValueList({"Exterior Roof [R9.2]": "ASHRAE 90.1-2004 EXTROOF METAL CLIMATEZONE 3-4", "Exterior Roof [R14.8]": "ASHRAE 90.1-2004 EXTROOF IEAD CLIMATEZONE 1-4", "Exterior Roof [R34.4]": "ASHRAE 189.1-2009 EXTROOF IEAD CLIMATEZONE 7-8"}, selected="Exterior Roof [R9.2]")  # disabled
value_list_3 = ValueList({"Exterior Wall [R5.5]": "ASHRAE 90.1-2004 EXTWALL METAL CLIMATEZONE 4", "Exterior Wall [R5.8]": "ASHRAE 90.1-2004 EXTWALL MASS CLIMATEZONE 3-4", "Exterior Wall [R7.2]": "ASHRAE 90.1-2004 EXTWALL STEELFRAME CLIMATEZONE 1-4", "Exterior Wall [R8.7]": "ASHRAE 90.1-2004 EXTWALL MASS CLIMATEZONE ALT-RES 4", "Exterior Wall [R10.4]": "ASHRAE 90.1-2004 EXTWALL WOODFRAME CLIMATEZONE 1-7", "Exterior Wall [R14.8]": "ASHRAE 90.1-2004 EXTWALL STEELFRAME CLIMATEZONE ALT-RES 4-6", "Exterior Wall [R34.4]": "ASHRAE 189.1-2009 EXTROOF IEAD CLIMATEZONE 7-8"}, selected="Exterior Wall [R5.5]")  # disabled
number_slider_5 = Slider(2, range=0..10)  # disabled

solaradjusttemperature = Ladybug_OutdoorSolarTemperatureAdjustor(
    location=importepw_3.location,
    cumSkyMtxOrDirNormRad=importepw_3.directNormalRadiation,
    diffuseHorizRad=importepw_3.diffuseHorizontalRadiation,
    meanRadTemperature=importepw_3.dryBulbTemperature,
    analysisPeriodOrHOY=analysisperiod.analysisPeriod,
    runIt=boolean_toggle_6)  # -> readMe, port, effectiveRadiantField, MRTDelta, solarAdjustedMRT, port_2, mannequinMesh, port_3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; disabled; plug-in component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
# Visualize the results
panel_19 = Panel(list_length)  # disabled
# Prepare geometries
panel_20 = Panel("0")  # disabled

add_blinds = BooleanToggle(True)  # disabled
shading_depth = Slider(0.4, range=0..1)  # disabled
number_of_blinds = Slider(8, range=0..10)  # disabled

panel_21 = Panel("6")  # disabled
number_slider_6 = Slider(8, range=8..17)  # disabled
panel_22 = Panel("25")  # disabled
number_slider_7 = Slider(0.1, range=0..0.1)  # disabled
number_slider_8 = Slider(0.06, range=0..0.1)  # disabled
panel_23 = Panel("24")  # disabled
panel_24 = Panel("12")  # disabled
panel_25 = Panel("1")  # disabled
colour_swatch_3 = ColourSwatch(SwatchColor=RGB(23, 21, 167))  # disabled
colour_swatch_4 = ColourSwatch(SwatchColor=RGB(123, 219, 255))  # disabled
series = Series(Start=panel_25, Step=1, Count=panel_24)  # disabled
series_2 = Series(Start=0, Step=1, Count=panel_23)  # disabled
panel_26 = Panel("100")  # disabled
panel_27 = Panel("12")  # disabled
panel_28 = Panel("03")  # disabled
panel_29 = Panel("21")  # disabled
panel_30 = Panel("20")  # disabled
panel_31 = Panel("03")  # disabled
panel_32 = Panel("20")  # disabled
panel_33 = Panel("09")  # disabled
panel_34 = Panel("21")  # disabled
panel_35 = Panel("12")  # disabled
panel_36 = Panel("20")  # disabled
panel_37 = Panel("21")  # disabled
panel_38 = Panel("06")  # disabled
panel_39 = Panel("06")  # disabled
panel_40 = Panel("21")  # disabled
panel_41 = Panel("09")  # disabled
panel_42 = Panel("20")  # disabled
panel_43 = Panel("0")  # disabled
analysisperiod_2 = Ladybug_AnalysisPeriod(fromMonth=panel_33, fromDay=panel_34, toMonth=panel_35, toDay=panel_36)  # -> out, analysisPeriod; disabled; plug-in component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
legendpar_3 = Ladybug_LegendParameters(lowBound=panel_43, highBound=panel_26, customColors=flatten([colour_swatch_4, colour_swatch_3]))  # -> legendPar; disabled; plug-in component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
analysisperiod_3 = Ladybug_AnalysisPeriod(fromMonth=panel_39, fromDay=panel_40, toMonth=panel_41, toDay=panel_42)  # -> out, analysisPeriod; disabled; plug-in component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
panel_44 = Panel("a < 6")  # disabled
analysisperiod_4 = Ladybug_AnalysisPeriod(fromMonth=panel_27, fromDay=panel_29, toMonth=panel_28, toDay=panel_30)  # -> out, analysisPeriod; disabled; plug-in component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
analysisperiod_5 = Ladybug_AnalysisPeriod(fromMonth=panel_31, fromDay=panel_37, toMonth=panel_38, toDay=panel_32)  # -> out, analysisPeriod; disabled; plug-in component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
boolean_toggle_7 = BooleanToggle(True)  # disabled
boolean_toggle_8 = BooleanToggle(True)  # disabled
boolean_toggle_9 = BooleanToggle(True)  # disabled
panel_45 = Panel("9")  # disabled
boolean_toggle_10 = BooleanToggle(True)  # disabled
colour_swatch_5 = ColourSwatch(SwatchColor=RGB(51, 50, 50))  # disabled
colour_swatch_6 = ColourSwatch(SwatchColor=RGB(255, 255, 255))  # disabled
panel_46 = Panel("0")  # disabled
panel_47 = Panel("6")  # disabled
boolean_toggle_11 = BooleanToggle(True)  # disabled
boolean_toggle_12 = BooleanToggle(True)  # disabled
panel_48 = Panel("3")  # disabled
point = Point(<point referenced from the Rhino model>)  # disabled
point_2 = Point(<point referenced from the Rhino model>)  # disabled
point_3 = Point(<point referenced from the Rhino model>)  # disabled
point_4 = Point(<point referenced from the Rhino model>)  # disabled
legendpar_4 = Ladybug_LegendParameters(lowBound=panel_46, highBound=panel_47, customColors=flatten([colour_swatch_6, colour_swatch_5]))  # -> legendPar; disabled; plug-in component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
windrose_2 = Ladybug_WindRose(
    north=0,
    hourlyWindDirection=importepw_2.windDirection,
    hourlyWindSpeed=importepw_2.windSpeed,
    analysisPeriod=analysisperiod_3.analysisPeriod,
    centerPoint=point,
    maxFrequency=panel_22,
    legendPar=legendpar,
    runIt=boolean_toggle_8)  # -> out, calmRoseMesh, windRoseMesh, windRoseCrvs, windRoseCenPts, legend, legendBasePts, title; disabled; plug-in component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
sunpath = Ladybug_SunPath(
    location=importlocation,
    hour=series_2,
    day=21,
    month=series,
    timeStep=1,
    sunPathScale=number_slider_8,
    annualHourlyData=flatten(importepw_4.totalSkyCover),
    conditionalStatement=panel_44,
    legendPar=legendpar_4,
    dailyOrAnnualSunPath=boolean_toggle_11,
    bakeIt=boolean_toggle_12)  # -> readMe, sunVectors, sunAltitudes, sunAzimuths, port, sunSpheresMesh, sunPathCrvs, legend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; disabled; plug-in component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
windrose_3 = Ladybug_WindRose(
    north=0,
    hourlyWindDirection=importepw_2.windDirection,
    hourlyWindSpeed=importepw_2.windSpeed,
    analysisPeriod=analysisperiod_4.analysisPeriod,
    centerPoint=point_2,
    maxFrequency=panel_22,
    legendPar=legendpar,
    runIt=boolean_toggle_7)  # -> out, calmRoseMesh, windRoseMesh, windRoseCrvs, windRoseCenPts, legend, legendBasePts, title; disabled; plug-in component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
windrose_4 = Ladybug_WindRose(
    north=0,
    hourlyWindDirection=importepw_2.windDirection,
    hourlyWindSpeed=importepw_2.windSpeed,
    analysisPeriod=analysisperiod_2.analysisPeriod,
    centerPoint=point_3,
    maxFrequency=panel_22,
    legendPar=legendpar,
    runIt=boolean_toggle_9)  # -> out, calmRoseMesh, windRoseMesh, windRoseCrvs, windRoseCenPts, legend, legendBasePts, title; disabled; plug-in component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
windrose_5 = Ladybug_WindRose(
    north=0,
    hourlyWindDirection=importepw_2.windDirection,
    hourlyWindSpeed=importepw_2.windSpeed,
    analysisPeriod=analysisperiod_5.analysisPeriod,
    centerPoint=point_4,
    maxFrequency=panel_22,
    legendPar=legendpar,
    runIt=boolean_toggle_10)  # -> out, calmRoseMesh, windRoseMesh, windRoseCrvs, windRoseCenPts, legend, legendBasePts, title; disabled; plug-in component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
boolean_toggle_13 = BooleanToggle(True)  # disabled
panel_49 = Panel("https://www.energyplus.net/weather-download/north_and_central_america_wmo_region_4/USA/PA/USA_PA_Philadelphia.Intl.AP.724080_TMY3/all")  # disabled
boolean_toggle_14 = BooleanToggle(True)  # disabled

# ---- group: Hot or Cold
outdoorcomfortcalculator = Ladybug_OutdoorComfortCalculator(
    dryBulbTemperature=importepw_3.dryBulbTemperature,
    meanRadiantTemperature=solaradjusttemperature.solarAdjustedMRT,
    windSpeed_tenMeters=importepw_3.windSpeed,
    relativeHumidity=importepw_3.relativeHumidity,
    runIt=boolean_toggle_14)  # -> out, port, universalThermalClimateIndex, comfortableOrNot, thermalStress, conditionOfPerson, port_2, percentOfTimeComfortable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; disabled; plug-in component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

# ----
panel_50 = Panel("12")  # disabled
panel_51 = Panel("21")  # disabled
panel_52 = Panel("03")  # disabled
panel_53 = Panel("20")  # disabled
analysisperiod_6 = Ladybug_AnalysisPeriod(fromMonth=panel_50, fromDay=panel_51, toMonth=panel_52, toDay=panel_53)  # -> out, analysisPeriod; disabled; plug-in component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
selectandaveragedata = Ladybug_AverageData(annualHourlyData=importepw_3.dryBulbTemperature, analysisPeriod=analysisperiod_6.analysisPeriod)  # -> readMe, selHourlyData, averagedDaily, averagedMonthly, avrMonthlyPerHour, avrAnalysisPeriod; disabled; plug-in component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
selectandaveragedata_2 = Ladybug_AverageData(annualHourlyData=importepw_3.windSpeed, analysisPeriod=analysisperiod_6.analysisPeriod)  # -> readMe, selHourlyData, averagedDaily, averagedMonthly, avrMonthlyPerHour, avrAnalysisPeriod; disabled; plug-in component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
selectandaveragedata_3 = Ladybug_AverageData(annualHourlyData=solaradjusttemperature.solarAdjustedMRT, analysisPeriod=analysisperiod_6.analysisPeriod)  # -> readMe, selHourlyData, averagedDaily, averagedMonthly, avrMonthlyPerHour, avrAnalysisPeriod; disabled; plug-in component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
selectandaveragedata_4 = Ladybug_AverageData(annualHourlyData=importepw_3.relativeHumidity, analysisPeriod=analysisperiod_6.analysisPeriod)  # -> readMe, selHourlyData, averagedDaily, averagedMonthly, avrMonthlyPerHour, avrAnalysisPeriod; disabled; plug-in component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
outdoorcomfortcalculator_2 = Ladybug_OutdoorComfortCalculator(
    dryBulbTemperature=selectandaveragedata.selHourlyData,
    meanRadiantTemperature=selectandaveragedata_3.selHourlyData,
    windSpeed_tenMeters=selectandaveragedata_2.selHourlyData,
    relativeHumidity=selectandaveragedata_4.selHourlyData,
    runIt=boolean_toggle_14)  # -> out, port, universalThermalClimateIndex, comfortableOrNot, thermalStress, conditionOfPerson, port_2, percentOfTimeComfortable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; disabled; plug-in component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
panel_54 = Panel("12")  # disabled
gradientlibrary = Ladybug_GradientLibrary(gradIndex=panel_54)  # -> customColors; disabled; plug-in component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
boolean_toggle_15 = BooleanToggle(True)  # disabled
panel_55 = Panel("1")  # disabled
panel_56 = Panel("-3")  # disabled
panel_57 = Panel("3")  # disabled
panel_58 = Panel("7")  # disabled
panel_59 = Panel("0")  # disabled
legendpar_5 = Ladybug_LegendParameters(
    lowBound=panel_56,
    highBound=panel_57,
    numSegments=panel_58,
    customColors=flatten(gradientlibrary),
    legendScale=panel_55,
    decimalPlaces=panel_59,
    removeLessThan=boolean_toggle_15)  # -> legendPar; disabled; plug-in component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
panel_60 = Panel(".25")  # disabled
panel_61 = Panel("0,1500")  # disabled
_3dchart_2 = Ladybug_3DChart(inputData=flatten(outdoorcomfortcalculator_2.conditionOfPerson), xScale=panel_60, yScale=panel_60, legendPar=legendpar_5)  # -> out, graphMesh, graphCurves, legend, legendBasePts, title, titleBasePts, dataPts, conditionalHOY; disabled; plug-in component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

panel_62 = Panel(outdoorcomfortcalculator.percentOfTimeComfortable)  # disabled
panel_63 = Panel(outdoorcomfortcalculator.percentHeatStress)  # disabled
panel_64 = Panel(outdoorcomfortcalculator.percentColdStress)  # disabled
colour_swatch_7 = ColourSwatch(SwatchColor=RGB(102, 102, 102))  # disabled
geometry = Geometry(sunpath.sunPathCrvs)  # disabled
multiplication = Multiplication(A=sunpath.sunVectors, B=2)  # disabled
epw_stat_5 = Ladybug_OpenEPWAndSTATWeatherFiles(weatherFileURL=panel_49)  # -> epwFile, statFile; disabled; plug-in component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
custom_preview = CustomPreview(
    Geometry=[windrose_3.windRoseCrvs, windrose_3.legend, windrose_5.windRoseCrvs, windrose_5.legend, windrose_2.windRoseCrvs, windrose_2.legend, windrose_4.windRoseCrvs, windrose_4.legend],
    Shader=colour_swatch_7)  # disabled
vector_display = VectorDisplay(Anchor=sunpath.sunPositions, Vector=multiplication)  # disabled

panel_65 = Panel("floor")  # disabled
callfromepconstrlibrary = Honeybee_CallFromEPConstructionLibrary(keywords=panel_65)  # -> ThermMaterials, EPMaterials, EPWindowMaterials, EPConstructions; disabled; plug-in component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
number_slider_9 = Slider(0, range=0..100)  # disabled
list_item = ListItem(List=callfromepconstrlibrary.EPConstructions, Index=number_slider_9, Wrap=True)  # disabled
decomposeepconstruction = Honeybee_DecomposeEPConstruction(cnstrName=list_item)  # -> flatten(materials), comments, UValue_SI, UValue_IP, RValue_SI, RValue_IP; disabled; plug-in component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

panel_66 = Panel("slab")  # disabled
callfromepconstrlibrary_2 = Honeybee_CallFromEPConstructionLibrary(keywords=panel_66)  # -> ThermMaterials, EPMaterials, EPWindowMaterials, EPConstructions; disabled; plug-in component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
panel_67 = Panel("2")  # disabled
list_item_2 = ListItem(List=callfromepconstrlibrary_2.EPConstructions, Index=panel_67, Wrap=True)  # disabled
decomposeepconstruction_2 = Honeybee_DecomposeEPConstruction(cnstrName=list_item_2)  # -> flatten(materials), comments, UValue_SI, UValue_IP, RValue_SI, RValue_IP; disabled; plug-in component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

brep_4 = Brep([decomposebytype.walls, decomposebytype.roofs, decomposebytype.groundFloors])  # disabled
brep_5 = Brep(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)  # disabled
mesh_brep = MeshBrep(
    Brep=brep_4,
    Settings={GridMaxCount=0, GridMinCount=16, JaggedSeams=False, MaxEdgeLength=0, MinEdgeLength=0.0001, MinTolerance=0, Refine=True, RefineAngle=0, RelativeTolerance=0.65, SimplePlanes=True, Tolerance=0})  # disabled
area = Area(Geometry=brep_5)  # -> Area, Centroid; disabled
mesh_join = MeshJoin(Meshes=flatten(mesh_brep))  # disabled
reverse = Reverse(Vector=sunpath.sunVectors)  # disabled
number_slider_10 = Slider(3, range=0..10)  # disabled
mesh_ray = MeshRay(Mesh=mesh_join, Point=area.Centroid, Direction=reverse)  # -> Point, Hit; disabled
boolean_toggle_16 = BooleanToggle(True)  # disabled
panel_68 = Panel(outdoorcomfortcalculator_2.percentHeatStress)  # disabled
panel_69 = Panel(outdoorcomfortcalculator_2.percentColdStress)  # disabled
panel_70 = Panel(outdoorcomfortcalculator_2.percentOfTimeComfortable)  # disabled
dispatch = Dispatch(List=sunpath.sunPositions, DispatchPattern=mesh_ray.Hit)  # -> ListA, ListB; disabled
panel_71 = Panel(mesh_ray.Hit)  # disabled
boolean_toggle_17 = BooleanToggle(True)  # disabled
boolean_toggle_18 = BooleanToggle(False)  # disabled

# ---- group: Hot or Cold
panel_72 = Panel("03")  # disabled
panel_73 = Panel("21")  # disabled
panel_74 = Panel("06")  # disabled
panel_75 = Panel("20")  # disabled
analysisperiod_7 = Ladybug_AnalysisPeriod(fromMonth=panel_72, fromDay=panel_73, toMonth=panel_74, toDay=panel_75)  # -> out, analysisPeriod; disabled; plug-in component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
outdoorcomfortcalculator_3 = Ladybug_OutdoorComfortCalculator(
    dryBulbTemperature=importepw_3.dryBulbTemperature,
    meanRadiantTemperature=solaradjusttemperature.solarAdjustedMRT,
    windSpeed_tenMeters=importepw_3.windSpeed,
    relativeHumidity=importepw_3.relativeHumidity,
    analysisPeriod=analysisperiod_7.analysisPeriod,
    runIt=boolean_toggle_14)  # -> out, port, universalThermalClimateIndex, comfortableOrNot, thermalStress, conditionOfPerson, port_2, percentOfTimeComfortable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; disabled; plug-in component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
panel_76 = Panel("12")  # disabled
gradientlibrary_2 = Ladybug_GradientLibrary(gradIndex=panel_76)  # -> customColors; disabled; plug-in component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
boolean_toggle_19 = BooleanToggle(True)  # disabled
panel_77 = Panel("3")  # disabled
panel_78 = Panel("-3")  # disabled
panel_79 = Panel("7")  # disabled
panel_80 = Panel("0")  # disabled
panel_81 = Panel("1")  # disabled
legendpar_6 = Ladybug_LegendParameters(
    lowBound=panel_78,
    highBound=panel_77,
    numSegments=panel_79,
    customColors=flatten(gradientlibrary_2),
    legendScale=panel_81,
    decimalPlaces=panel_80,
    removeLessThan=boolean_toggle_19)  # -> legendPar; disabled; plug-in component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
panel_82 = Panel(".25")  # disabled
_3dchart_3 = Ladybug_3DChart(
    inputData=flatten(outdoorcomfortcalculator_3.conditionOfPerson),
    xScale=panel_82,
    yScale=panel_82,
    legendPar=legendpar_6,
    bakeIt=boolean_toggle_18)  # -> out, graphMesh, graphCurves, legend, legendBasePts, title, titleBasePts, dataPts, conditionalHOY; disabled; plug-in component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

# ----
panel_83 = Panel(outdoorcomfortcalculator_3.percentOfTimeComfortable)  # disabled
panel_84 = Panel(outdoorcomfortcalculator_3.percentHeatStress)  # disabled
panel_85 = Panel(outdoorcomfortcalculator_3.percentColdStress)  # disabled
boolean_toggle_20 = BooleanToggle(False)  # disabled

panel_86 = Panel("06")  # disabled
panel_87 = Panel("21")  # disabled
panel_88 = Panel("09")  # disabled
panel_89 = Panel("20")  # disabled
analysisperiod_8 = Ladybug_AnalysisPeriod(fromMonth=panel_86, fromDay=panel_87, toMonth=panel_88, toDay=panel_89)  # -> out, analysisPeriod; disabled; plug-in component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
outdoorcomfortcalculator_4 = Ladybug_OutdoorComfortCalculator(
    dryBulbTemperature=importepw_3.dryBulbTemperature,
    meanRadiantTemperature=solaradjusttemperature.solarAdjustedMRT,
    windSpeed_tenMeters=importepw_3.windSpeed,
    relativeHumidity=importepw_3.relativeHumidity,
    analysisPeriod=analysisperiod_8.analysisPeriod,
    runIt=boolean_toggle_14)  # -> out, port, universalThermalClimateIndex, comfortableOrNot, thermalStress, conditionOfPerson, port_2, percentOfTimeComfortable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; disabled; plug-in component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
panel_90 = Panel("12")  # disabled
gradientlibrary_3 = Ladybug_GradientLibrary(gradIndex=panel_90)  # -> customColors; disabled; plug-in component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
boolean_toggle_21 = BooleanToggle(True)  # disabled
panel_91 = Panel("1")  # disabled
panel_92 = Panel("-3")  # disabled
panel_93 = Panel("3")  # disabled
panel_94 = Panel("7")  # disabled
panel_95 = Panel("0")  # disabled
legendpar_7 = Ladybug_LegendParameters(
    lowBound=panel_92,
    highBound=panel_93,
    numSegments=panel_94,
    customColors=flatten(gradientlibrary_3),
    legendScale=panel_91,
    decimalPlaces=panel_95,
    removeLessThan=boolean_toggle_21)  # -> legendPar; disabled; plug-in component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
panel_96 = Panel("0,500")  # disabled
panel_97 = Panel(".25")  # disabled
_3dchart_4 = Ladybug_3DChart(
    inputData=flatten(outdoorcomfortcalculator_4.conditionOfPerson),
    xScale=panel_97,
    yScale=panel_97,
    legendPar=legendpar_7,
    bakeIt=boolean_toggle_20)  # -> out, graphMesh, graphCurves, legend, legendBasePts, title, titleBasePts, dataPts, conditionalHOY; disabled; plug-in component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

panel_98 = Panel(outdoorcomfortcalculator_4.percentOfTimeComfortable)  # disabled
panel_99 = Panel(outdoorcomfortcalculator_4.percentHeatStress)  # disabled
panel_100 = Panel(outdoorcomfortcalculator_4.percentColdStress)  # disabled
custom_preview_2 = CustomPreview(
    Geometry=dispatch.ListB,
    Shader={ambient=RGB(0, 0, 0), diffuse=RGB(255, 105, 180), emission=RGB(76, 32, 54), shine=0.5, specular=RGB(255, 255, 255), transparency=0})  # disabled
boolean_toggle_22 = BooleanToggle(False)  # disabled

panel_101 = Panel("09")  # disabled
panel_102 = Panel("21")  # disabled
panel_103 = Panel("12")  # disabled
panel_104 = Panel("20")  # disabled
analysisperiod_9 = Ladybug_AnalysisPeriod(fromMonth=panel_101, fromDay=panel_102, toMonth=panel_103, toDay=panel_104)  # -> out, analysisPeriod; disabled; plug-in component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
outdoorcomfortcalculator_5 = Ladybug_OutdoorComfortCalculator(
    dryBulbTemperature=importepw_3.dryBulbTemperature,
    meanRadiantTemperature=solaradjusttemperature.solarAdjustedMRT,
    windSpeed_tenMeters=importepw_3.windSpeed,
    relativeHumidity=importepw_3.relativeHumidity,
    analysisPeriod=analysisperiod_9.analysisPeriod,
    runIt=boolean_toggle_14)  # -> out, port, universalThermalClimateIndex, comfortableOrNot, thermalStress, conditionOfPerson, port_2, percentOfTimeComfortable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; disabled; plug-in component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
panel_105 = Panel("12")  # disabled
gradientlibrary_4 = Ladybug_GradientLibrary(gradIndex=panel_105)  # -> customColors; disabled; plug-in component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
boolean_toggle_23 = BooleanToggle(True)  # disabled
panel_106 = Panel("1")  # disabled
panel_107 = Panel("3")  # disabled
panel_108 = Panel("-3")  # disabled
panel_109 = Panel("7")  # disabled
panel_110 = Panel("0")  # disabled
legendpar_8 = Ladybug_LegendParameters(
    lowBound=panel_108,
    highBound=panel_107,
    numSegments=panel_109,
    customColors=flatten(gradientlibrary_4),
    legendScale=panel_106,
    decimalPlaces=panel_110,
    removeLessThan=boolean_toggle_23)  # -> legendPar; disabled; plug-in component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
panel_111 = Panel(".25")  # disabled
panel_112 = Panel("0,1000")  # disabled
_3dchart_5 = Ladybug_3DChart(
    inputData=flatten(outdoorcomfortcalculator_5.conditionOfPerson),
    xScale=panel_111,
    yScale=panel_111,
    legendPar=legendpar_8,
    bakeIt=boolean_toggle_22)  # -> out, graphMesh, graphCurves, legend, legendBasePts, title, titleBasePts, dataPts, conditionalHOY; disabled; plug-in component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

panel_113 = Panel(outdoorcomfortcalculator_5.percentOfTimeComfortable)  # disabled
panel_114 = Panel(outdoorcomfortcalculator_5.percentComfForShortPeriod)  # disabled
panel_115 = Panel(outdoorcomfortcalculator_5.percentHeatStress)  # disabled

panel_116 = Panel("""MAT-CC05 4 HW CONCRETE
MAT-CC05 8 HW CONCRETE""")  # disabled
panel_117 = Panel(decomposeepconstruction.materials)  # disabled
list_item_3 = ListItem(List=decomposeepconstruction.materials, Index=0, Wrap=True)  # -> Item, Item1; disabled
list_item_4 = ListItem(List=panel_116, Index=0, Wrap=True)  # -> Item, Item1; disabled
panel_118 = Panel(list_item)  # disabled
panel_119 = Panel("floor_cnstr_2")  # disabled
panel_120 = Panel("floor_cnstr_1")  # disabled
epconstruction = Honeybee_EnergyPlusConstruction(name=panel_120, layer_1=list_item_3.Item, layer_2=list_item_3.Item1, layer_3=list_item_4.Item)  # -> EPConstruction; disabled; plug-in component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
epconstruction_2 = Honeybee_EnergyPlusConstruction(name=panel_119, layer_1=list_item_3.Item, layer_2=list_item_3.Item1, layer_3=list_item_4.Item1)  # -> EPConstruction; disabled; plug-in component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

list_length_2 = ListLength(List=dispatch.ListB)  # disabled
occupancygenerator = Honeybee_DaysimOccupancyGenerator(weekendDays=[1, 2], writeTheOcc=boolean_toggle_17)  # -> occupancyFile; disabled; plug-in component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
panel_121 = Panel(list_length_2)  # disabled
boolean_toggle_24 = BooleanToggle(True)  # disabled
panel_122 = Panel("ILLUMINANCE 3-21-9AM")  # disabled
boolean_toggle_25 = BooleanToggle(True)  # disabled
boolean_toggle_26 = BooleanToggle(False)  # disabled

# ---- group: Hot or Cold
panel_123 = Panel("01")  # disabled
panel_124 = Panel("21")  # disabled
panel_125 = Panel("12")  # disabled
panel_126 = Panel("20")  # disabled
analysisperiod_10 = Ladybug_AnalysisPeriod(fromMonth=panel_123, fromDay=panel_124, toMonth=panel_125, toDay=panel_126)  # -> out, analysisPeriod; disabled; plug-in component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
outdoorcomfortcalculator_6 = Ladybug_OutdoorComfortCalculator(
    dryBulbTemperature=importepw_3.dryBulbTemperature,
    meanRadiantTemperature=solaradjusttemperature.solarAdjustedMRT,
    windSpeed_tenMeters=importepw_3.windSpeed,
    relativeHumidity=importepw_3.relativeHumidity,
    analysisPeriod=analysisperiod_10.analysisPeriod,
    runIt=boolean_toggle_14)  # -> out, port, universalThermalClimateIndex, comfortableOrNot, thermalStress, conditionOfPerson, port_2, percentOfTimeComfortable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; disabled; plug-in component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
panel_127 = Panel("12")  # disabled
gradientlibrary_5 = Ladybug_GradientLibrary(gradIndex=panel_127)  # -> customColors; disabled; plug-in component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
boolean_toggle_27 = BooleanToggle(True)  # disabled
panel_128 = Panel("1")  # disabled
panel_129 = Panel("-3")  # disabled
panel_130 = Panel("3")  # disabled
panel_131 = Panel("7")  # disabled
panel_132 = Panel("0")  # disabled
legendpar_9 = Ladybug_LegendParameters(
    lowBound=panel_129,
    highBound=panel_130,
    numSegments=panel_131,
    customColors=flatten(gradientlibrary_5),
    legendScale=panel_128,
    decimalPlaces=panel_132,
    removeLessThan=boolean_toggle_27)  # -> legendPar; disabled; plug-in component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
panel_133 = Panel(".25")  # disabled
_3dchart_6 = Ladybug_3DChart(
    inputData=flatten(outdoorcomfortcalculator_6.conditionOfPerson),
    xScale=panel_133,
    legendPar=legendpar_9,
    bakeIt=boolean_toggle_26)  # -> out, graphMesh, graphCurves, legend, legendBasePts, title, titleBasePts, dataPts, conditionalHOY; disabled; plug-in component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

# ----
panel_134 = Panel(outdoorcomfortcalculator_6.percentOfTimeComfortable)  # disabled
panel_135 = Panel(outdoorcomfortcalculator_6.percentHeatStress)  # disabled
panel_136 = Panel(outdoorcomfortcalculator_6.percentColdStress)  # disabled
boolean_toggle_28 = BooleanToggle(True)  # disabled
number_slider_11 = Slider(1, range=0..10)  # disabled
number_slider_12 = Slider(6, range=0..10)  # disabled
gradientlibrary_6 = Ladybug_GradientLibrary(gradIndex=number_slider_11)  # -> customColors; disabled; plug-in component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
number_slider_13 = Slider(100, range=0..100)  # disabled
number_slider_14 = Slider(0, range=0..100)  # disabled

panel_137 = Panel("""Construction,
    Dbl LoE (e3=.1) Clr 3mm/13mm Arg,  !- Name
    CLEAR 3MM,               !- Outside Layer
    ARGON 13MM,              !- Layer 2
    LoE CLEAR 3MM Rev;       !- Layer 3""")  # disabled
panel_138 = Panel("""WindowMaterial:Gas,
    ARGON 13MM,               !- Name
    Argon,                   !- Gas Type
    0.0127;                  !- Thickness {m}""")  # disabled
panel_139 = Panel("""WindowMaterial:Glazing,
    LoE CLEAR 3MM Rev,       !- Name
    SpectralAverage,         !- Optical Data Type
    ,                        !- Window Glass Spectral Data Set Name
    0.003,                   !- Thickness {m}
    0.630,                   !- Solar Transmittance at Normal Incidence
    0.220,                   !- Front Side Solar Reflectance at Normal Incidence
    0.190,                   !- Back Side Solar Reflectance at Normal Incidence
    0.850,                   !- Visible Transmittance at Normal Incidence
    0.079,                   !- Front Side Visible Reflectance at Normal Incidence
    0.056,                   !- Back Side Visible Reflectance at Normal Incidence
    0.0,                     !- Infrared Transmittance at Normal Incidence
    0.10,                    !- Front Side Infrared Hemispherical Emissivity
    0.84,                    !- Back Side Infrared Hemispherical Emissivity
    0.9;                     !- Conductivity {W/m-K}""")  # disabled
boolean_toggle_29 = BooleanToggle(True)  # disabled
addtoeplibrary = Honeybee_AddToEnergyPlusLibrary(EPObject=[panel_137, panel_138, panel_139], addToProjectLib=boolean_toggle_29, overwrite=boolean_toggle_29)  # -> readMe; disabled; plug-in component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

number_slider_15 = Slider(1, range=0..1)  # disabled
legendpar_10 = Ladybug_LegendParameters(lowBound=number_slider_14, highBound=number_slider_13, customColors=flatten(gradientlibrary_6))  # -> legendPar; disabled; plug-in component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
panel_140 = Panel("Map Annual Comfort on Sunpath")  # disabled
panel_141 = Panel("This example shows how to map annual comfort on top of a sun path diagram. This Hydra is originally created to answer [this question](http://www.grasshopper3d.com/group/ladybug/forum/topic/show?id=2985220%3ATopic%3A1399454&xg_source=msg)")  # disabled
panel_142 = Panel("""Ladybug
LBExampleFiles
Sun path""")  # disabled
boolean_toggle_30 = BooleanToggle(False)  # disabled
ladybug_2 = Ladybug_Ladybug()  # -> Vviiiiiiiiiizzz; disabled; plug-in component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

# ---- group: make it 3D!
construct_domain = ConstructDomain(DomainStart=0, DomainEnd=number_slider_15)  # disabled

# ----
panel_143 = Panel("https://www.energyplus.net/weather-download/north_and_central_america_wmo_region_4/USA/PA/USA_PA_Philadelphia.Intl.AP.724080_TMY3/all")  # disabled
boolean_toggle_31 = BooleanToggle(False)  # disabled
panel_144 = Panel("%")  # disabled
exporthydra = Hydra_ExportFile(fileName=panel_140, fileDescription=panel_141, fileTags=panel_142, export=boolean_toggle_30)  # -> readMe; inputs fileDescription: list, changeLog: list, fileTags: list, includeRhino: Boolean, GHForThumb: Boolean, additionalImgs: list, export: Boolean; disabled; plug-in component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
panel_145 = Panel(ladybug_2)  # disabled
epw_stat_6 = Ladybug_OpenEPWAndSTATWeatherFiles(weatherFileURL=panel_143)  # -> epwFile, statFile; disabled; plug-in component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
importepw_5 = Ladybug_ImportEpw(epwFile=epw_stat_6.epwFile)  # -> readMe, latitude, location, dryBulbTemperature, dewPointTemperature, relativeHumidity, windSpeed, windDirection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; disabled; plug-in component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
analysisperiod_11 = Ladybug_AnalysisPeriod()  # -> readMe, analysisPeriod; disabled; plug-in component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
boolean_toggle_32 = BooleanToggle(True)  # disabled
solaradjusttemperature_2 = Ladybug_OutdoorSolarTemperatureAdjustor(
    location=importepw_5.location,
    cumSkyMtxOrDirNormRad=importepw_5.directNormalRadiation,
    diffuseHorizRad=importepw_5.diffuseHorizontalRadiation,
    baseTemperature=importepw_5.dryBulbTemperature,
    horizInfraredRad=importepw_5.horizontalInfraredRadiation,
    analysisPeriodOrHOY=analysisperiod_11.analysisPeriod,
    parallel=boolean_toggle_32,
    runIt=boolean_toggle_32)  # -> readMe, port, effectiveRadiantField, MRTDelta, solarAdjustedMRT, port_2, mannequinMesh, port_3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; disabled; plug-in component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
boolean_toggle_33 = BooleanToggle(True)  # disabled
outdoorcomfortcalculator_7 = Ladybug_OutdoorComfortCalculator(
    dryBulbTemperature=importepw_5.dryBulbTemperature,
    meanRadiantTemperature=solaradjusttemperature_2.solarAdjustedMRT,
    windSpeed_tenMeters=importepw_5.windSpeed,
    relativeHumidity=importepw_5.relativeHumidity,
    runIt=boolean_toggle_33)  # -> readMe, port, universalThermalClimateIndex, comfortableOrNot, thermalStress, conditionOfPerson, port_2, percentOfTimeComfortable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; disabled; plug-in component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
panel_146 = Panel("13")  # disabled
gradientlibrary_7 = Ladybug_GradientLibrary(gradIndex=panel_146)  # -> customColors; disabled; plug-in component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
panel_147 = Panel("-3")  # disabled
panel_148 = Panel("3")  # disabled
panel_149 = Panel("7")  # disabled
number_slider_16 = Slider(3, range=0..10)  # disabled
panel_150 = Panel("""6
9
12""")  # disabled
panel_151 = Panel("1")  # disabled
panel_152 = Panel("24")  # disabled
legendpar_11 = Ladybug_LegendParameters(lowBound=panel_147, highBound=panel_148, numSegments=panel_149, customColors=flatten(gradientlibrary_7))  # -> legendPar; disabled; plug-in component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
boolean_toggle_34 = BooleanToggle(True)  # disabled
series_3 = Series(Start=panel_151, Step=1, Count=panel_152)  # disabled
sunpath_2 = Ladybug_SunPath(
    location=importepw_5.location,
    hour=series_3,
    day=21,
    month=panel_150,
    timeStep=1,
    sunPathScale=number_slider_16,
    annualHourlyData=flatten(outdoorcomfortcalculator_7.conditionOfPerson),
    legendPar=legendpar_11,
    dailyOrAnnualSunPath=True,
    bakeIt=boolean_toggle_34)  # -> readMe, sunVectors, sunAltitudes, sunAzimuths, port, sunSpheresMesh, sunPathCrvs, legend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; disabled; plug-in component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

# ---- group: glass
brep_6 = Brep(<brep referenced from the Rhino model>)  # disabled

# ----
# Prepare geometries
# run the analysis
# visualize the results
# Glass material
# prepare a recipe
# Generate sky
# Animate sliders
# capture the viewport to an image
months = Panel("""3
6
12""")  # disabled
number_slider_17 = Slider(0, range=0..2)  # disabled
number_slider_18 = Slider(0, range=0..2)  # disabled
button = Button()  # disabled
hours = Panel("""9
12
15""")  # disabled
panel_153 = Panel("tvis_60")  # disabled
panel_154 = Panel("0.6")  # disabled
fly = Ladybug_fly(inputSliders=[number_slider_18, number_slider_17], fly=button)  # -> Vviiiiiiiiiizzz; disabled; plug-in component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
panel_155 = Panel("https://www.energyplus.net/weather-download/north_and_central_america_wmo_region_4/USA/PA/USA_PA_Philadelphia.Intl.AP.724080_TMY3/all")  # disabled
panel_156 = Panel("21")  # disabled
item = ListItem(List=hours, Index=number_slider_17, Wrap=True)  # disabled
path = FilePath("C:\Users\Me\Desktop\Simulation\epw\USA_PA_Philadelphia.Intl.AP.724080_TMY3\USA_PA_Philadelphia.Intl.AP.724080_TMY3.epw")  # disabled
item_2 = ListItem(List=months, Index=number_slider_18, Wrap=True)  # disabled
panel_157 = Panel("""9
12
15""")  # disabled
radglassmaterial = Honeybee_RadianceGlassMaterial(
    materialName=panel_153,
    RTransmittance=panel_154,
    GTransmittance=panel_154,
    BTransmittance=panel_154,
    refractiveIndex=1.52)  # -> avrgTrans, RADMaterial; disabled; plug-in component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
epw_stat_7 = Ladybug_OpenEPWAndSTATWeatherFiles(weatherFileURL=panel_155)  # -> epwFile, statFile; disabled; plug-in component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
panel_158 = Panel("""3
6
12""")  # disabled
number_slider_19 = Slider(0.05, range=0..0.1)  # disabled
brep_7 = Brep(<brep referenced from the Rhino model>)  # disabled
brep_8 = Brep([<brep referenced from the Rhino model> x7])  # disabled
importlocation_2 = Ladybug_ImportLocation(epwFile=path)  # -> location; disabled; plug-in component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
analysis_surface = Brep(<brep referenced from the Rhino model>)  # disabled
shading_device = Brep([<brep referenced from the Rhino model> x8])  # disabled
panel_159 = Panel(brep_7)  # disabled
genclimatebasedsky = Honeybee_GenerateClimateBasedSky(weatherFile=epw_stat_7.epwFile, month=item_2, day=panel_156, hour=item)  # -> radiationValues, skyFilePath; disabled; plug-in component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
createhbsrfs = Honeybee_createHBSrfs(geometry=brep_6, RADMaterial=radglassmaterial.RADMaterial)  # -> readMe, simplify(HBSurface); disabled; plug-in component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
doy_hoy = Ladybug_DOY_HOY(days=panel_156, months=item_2, hours=item)  # -> HOY, DOY, date; disabled; plug-in component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
createhbsrfs_2 = Honeybee_createHBSrfs(geometry=[brep_7, brep_8, analysis_surface])  # -> readMe, simplify(flatten(HBSurface)); disabled; plug-in component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
sunpath_3 = Ladybug_SunPath(
    location=importlocation_2,
    hour=panel_157,
    day=21,
    month=panel_158,
    timeStep=1,
    sunPathScale=number_slider_19,
    dailyOrAnnualSunPath=True)  # -> readMe, sunVectors, sunAltitudes, sunAzimuths, port, sunSpheresMesh, sunPathCrvs, legend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; disabled; plug-in component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
createhbsrfs_3 = Honeybee_createHBSrfs(geometry=shading_device)  # -> readMe, simplify(flatten(HBSurface)); disabled; plug-in component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
number_slider_20 = Slider(11, range=1..25)  # disabled
swatch = ColourSwatch(SwatchColor=RGBA(129, 150, 235, 74))  # disabled
swatch_2 = ColourSwatch(SwatchColor=RGBA(217, 206, 206, 208))  # disabled
number_slider_21 = Slider(0.2, range=0..1)  # disabled
brep_9 = Brep(flatten([createhbsrfs_2.HBSurface, createhbsrfs.HBSurface, createhbsrfs_3.HBSurface]))  # disabled
number_slider_22 = Slider(0.762, range=0..1)  # disabled
item_3 = ListItem(List=analysis_surface, Index=number_slider_20, Wrap=True)  # disabled
preview = CustomPreview(Geometry=createhbsrfs.HBSurface, Shader=swatch)  # disabled
preview_2 = CustomPreview(Geometry=createhbsrfs_2.HBSurface, Shader=swatch_2)  # disabled
gentestpts = Honeybee_GenerateTestPoints(testGeometry=item_3, gridSize=number_slider_21, distBaseSrf=number_slider_22, moveTestMesh=True)  # -> readMe, simplify(testPoints), simplify(ptsVectors), simplify(facesArea), simplify(mesh); disabled; plug-in component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
gridbasedsimulation = Honeybee_GridBasedSimulation(
    skyFile=genclimatebasedsky.skyFilePath,
    testPoints=gentestpts.testPoints,
    ptsVectors=gentestpts.ptsVectors,
    testMesh=gentestpts.mesh,
    simulationType=0)  # -> analysisRecipe; disabled; plug-in component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
number_slider_23 = Slider(4, range=0..10)  # disabled
toggle = BooleanToggle(True)  # disabled
rundaylightanalysis = Honeybee_RunDaylightSimulation(
    HBObjects=flatten(brep_9),
    analysisRecipe=gridbasedsimulation,
    writeRad=toggle,
    runRad=toggle,
    numOfCPUs=number_slider_23,
    overwriteResults=True)  # -> readMe, analysisType, resultsUnit, illuminance_values, testPts, illuminance_files, radGeoFile, studyFolder, done; disabled; plug-in component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
panel_160 = Panel("300")  # disabled
panel_161 = Panel("2000")  # disabled
panel_162 = Panel("_")  # disabled
pt = Point(Point(-68.8632504, 5.972511295, 3.6576))  # disabled
panel_163 = Panel("")  # disabled
panel_164 = Panel(doy_hoy.date)  # disabled
legendpar_12 = Ladybug_LegendParameters(lowBound=panel_160, highBound=panel_161, legendLocation=pt)  # -> legendPar; disabled; plug-in component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
join = TextJoin(Text=[item_2, panel_156, item], Join=panel_162)  # disabled
panel_165 = Panel("C:\Users\Me\Desktop\Simulation\Room\w shade captured views")  # disabled
concat = Concatenate(FragmentA=rundaylightanalysis.analysisType, FragmentB=panel_163, FragmentC=panel_164)  # disabled
panel_166 = Panel(join)  # disabled
toggle_2 = BooleanToggle(True)  # disabled
recolormesh = Ladybug_RecolorMesh(
    analysisResult=rundaylightanalysis.illuminance_values,
    inputMesh=gentestpts.mesh,
    legendPar=legendpar_12,
    analysisTitle=concat,
    legendTitle=rundaylightanalysis.resultsUnit)  # -> readMe, newMesh, newLegend, legendBasePt, meshColors, legendColors; disabled; plug-in component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
captureview = Ladybug_CaptureView(fileName=panel_166, folder=panel_165, capture=toggle_2)  # -> imagePath; disabled; plug-in component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
panel_167 = Panel(captureview)  # disabled

line = Line(StartPoint=sunpath_2.sunPathCenPts, EndPoint=sunpath_2.sunPositions)  # disabled
day_month_hour_calculator = Ladybug_Day_Month_Hour(HOY=sunpath_2.sunPositionsHOY)  # -> day, month, hour, date; disabled; plug-in component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

# ---- group: geometries / context
brep_10 = Brep([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])  # disabled

# ----
panel_168 = Panel("30")  # disabled

# ---- group: geometries
number_slider_24 = Slider(4.4, range=0..10)  # disabled
brep_wireframe_2 = BrepWireframe(Brep=brep_10, Density=-1)  # disabled
extend_curve = ExtendCurve(Curve=brep_wireframe_2, Type=0, Start=number_slider_24, End=number_slider_24)  # disabled
colour_swatch_8 = ColourSwatch(SwatchColor=RGB(0, 0, 0))  # disabled
colour_swatch_9 = ColourSwatch(SwatchColor=RGBA(255, 255, 255, 144))  # disabled
custom_preview_3 = CustomPreview(Geometry=extend_curve, Shader=colour_swatch_8)  # disabled
custom_preview_4 = CustomPreview(Geometry=brep_10, Shader=colour_swatch_9)  # disabled

# ----
unit_z = UnitZ(Factor=panel_168)  # disabled
move = Move(Geometry=sunpath_2.sunPositions, Motion=unit_z)  # -> Geometry, Transform; disabled
text_tag = TextTag(Location=move.Geometry, Text=day_month_hour_calculator.date)  # disabled
boolean_toggle_35 = BooleanToggle(True)  # disabled

# ----
# DAYLIGHT
# run the analysis
# visualize the results
# Glass material
# prepare a recipe
# Generate sky
# Animate sliders
# capture the viewport to an image
months_2 = Panel("""3
6
12""")  # disabled
number_slider_25 = Slider(0, range=0..2)  # disabled
number_slider_26 = Slider(0, range=0..2)  # disabled
button_2 = Button()  # disabled
hours_2 = Panel("""9
12
15""")  # disabled
panel_169 = Panel("tvis_60")  # disabled
panel_170 = Panel("0.6")  # disabled
fly_2 = Ladybug_fly(inputSliders=[number_slider_26, number_slider_25], fly=button_2)  # -> Vviiiiiiiiiizzz; disabled; plug-in component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
panel_171 = Panel("https://www.energyplus.net/weather-download/north_and_central_america_wmo_region_4/USA/PA/USA_PA_Philadelphia.Intl.AP.724080_TMY3/all")  # disabled
panel_172 = Panel("21")  # disabled
list_item_5 = ListItem(List=hours_2, Index=number_slider_25, Wrap=True)  # disabled
list_item_6 = ListItem(List=months_2, Index=number_slider_26, Wrap=True)  # disabled
radglassmaterial_2 = Honeybee_RadianceGlassMaterial(
    materialName=panel_169,
    RTransmittance=panel_170,
    GTransmittance=panel_170,
    BTransmittance=panel_170,
    refractiveIndex=1.52)  # -> avrgTrans, RADMaterial; disabled; plug-in component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
epw_stat_8 = Ladybug_OpenEPWAndSTATWeatherFiles(weatherFileURL=panel_171)  # -> epwFile, statFile; disabled; plug-in component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
importepw_6 = Ladybug_ImportEpw(epwFile=epw_stat_8.epwFile)  # -> Output, latitude, location, dryBulbTemperature, dewPointTemperature, relativeHumidity, windSpeed, windDirection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; disabled; plug-in component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
analysis_surface_2 = Brep(<brep referenced from the Rhino model>)  # disabled
brep_11 = Brep([<brep referenced from the Rhino model> x7])  # disabled
genclimatebasedsky_2 = Honeybee_GenerateClimateBasedSky(weatherFile=epw_stat_8.epwFile, month=list_item_6, day=panel_172, hour=list_item_5)  # -> radiationValues, skyFilePath; disabled; plug-in component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
createhbsrfs_4 = Honeybee_createHBSrfs(geometry=brep_2, RADMaterial=radglassmaterial_2.RADMaterial)  # -> readMe, simplify(HBSurface); disabled; plug-in component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
doy_hoy_2 = Ladybug_DOY_HOY(days=panel_172, months=list_item_6, hours=list_item_5)  # -> HOY, DOY, date; disabled; plug-in component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
createhbsrfs_5 = Honeybee_createHBSrfs(geometry=[brep_11, analysis_surface_2], srfType=panel_20)  # -> readMe, simplify(flatten(HBSurface)); disabled; plug-in component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
panel_173 = Panel("""9
12
15""")  # disabled
number_slider_27 = Slider(11, range=1..25)  # disabled
colour_swatch_10 = ColourSwatch(SwatchColor=RGBA(129, 150, 235, 74))  # disabled
panel_174 = Panel("""3
6
12""")  # disabled
colour_swatch_11 = ColourSwatch(SwatchColor=RGBA(217, 206, 206, 208))  # disabled
number_slider_28 = Slider(0.2, range=0..1)  # disabled
number_slider_29 = Slider(0.05, range=0..0.1)  # disabled
number_slider_30 = Slider(0.762, range=0..1)  # disabled
custom_preview_5 = CustomPreview(Geometry=createhbsrfs_4.HBSurface, Shader=colour_swatch_10)  # disabled
list_item_7 = ListItem(List=analysis_surface_2, Index=number_slider_27, Wrap=True)  # disabled
custom_preview_6 = CustomPreview(Geometry=createhbsrfs_5.HBSurface, Shader=colour_swatch_11)  # disabled
gentestpts_2 = Honeybee_GenerateTestPoints(testGeometry=list_item_7, gridSize=number_slider_28, distBaseSrf=number_slider_30, moveTestMesh=True)  # -> readMe, simplify(testPoints), simplify(ptsVectors), simplify(facesArea), simplify(mesh); disabled; plug-in component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
sunpath_4 = Ladybug_SunPath(
    location=importepw_6.location,
    hour=panel_45,
    day=21,
    month=panel_48,
    timeStep=1,
    sunPathScale=number_slider_29,
    dailyOrAnnualSunPath=True)  # -> readMe, sunVectors, sunAltitudes, sunAzimuths, port, sunSpheresMesh, sunPathCrvs, legend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; disabled; plug-in component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
gridbasedsimulation_2 = Honeybee_GridBasedSimulation(
    skyFile=genclimatebasedsky_2.skyFilePath,
    testPoints=gentestpts_2.testPoints,
    ptsVectors=gentestpts_2.ptsVectors,
    testMesh=gentestpts_2.mesh,
    simulationType=0)  # -> analysisRecipe; disabled; plug-in component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
number_slider_31 = Slider(4, range=0..10)  # disabled
boolean_toggle_36 = BooleanToggle(True)  # disabled
panel_175 = Panel("300")  # disabled
panel_176 = Panel("2000")  # disabled
panel_177 = Panel("_")  # disabled
point_5 = Point(Point(-90.92314664, 12, 0))  # disabled
panel_178 = Panel("")  # disabled
panel_179 = Panel(doy_hoy_2.date)  # disabled
text_join = TextJoin(Text=[list_item_6, panel_172, list_item_5], Join=panel_177)  # disabled
legendpar_13 = Ladybug_LegendParameters(lowBound=panel_175, highBound=panel_176, legendLocation=point_5)  # -> legendPar; disabled; plug-in component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
panel_180 = Panel("C:\Users\Me\Desktop\Simulation\FINAL\DESIGN 02 W SHADE DAYLIGHT")  # disabled
panel_181 = Panel(text_join)  # disabled
boolean_toggle_37 = BooleanToggle(True)  # disabled
captureview_2 = Ladybug_CaptureView(fileName=panel_181, folder=panel_180, transparBack=boolean_toggle_28, capture=boolean_toggle_37)  # -> imagePath; disabled; plug-in component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
panel_182 = Panel(captureview_2)  # disabled

createhbsrfs_6 = Honeybee_createHBSrfs(geometry=[brep, analysis_surface_2], srfType=panel_21)  # -> readMe, simplify(flatten(HBSurface)); disabled; plug-in component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

brep_12 = Brep(flatten([createhbsrfs_5.HBSurface, createhbsrfs_4.HBSurface, createhbsrfs_6.HBSurface]))  # disabled
rundaylightanalysis_2 = Honeybee_RunDaylightSimulation(
    HBObjects=flatten(brep_12),
    analysisRecipe=gridbasedsimulation_2,
    writeRad=boolean_toggle_36,
    runRad=boolean_toggle_36,
    numOfCPUs=number_slider_31,
    overwriteResults=True)  # -> readMe, analysisType, resultsUnit, illuminance_values, testPts, illuminance_files, radGeoFile, studyFolder, done; disabled; plug-in component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
concatenate = Concatenate(FragmentA=rundaylightanalysis_2.analysisType, FragmentB=panel_178, FragmentC=panel_179)  # disabled
recolormesh_2 = Ladybug_RecolorMesh(
    analysisResult=rundaylightanalysis_2.illuminance_values,
    inputMesh=gentestpts_2.mesh,
    legendPar=legendpar_13,
    analysisTitle=concatenate,
    legendTitle=rundaylightanalysis_2.resultsUnit,
    bakeIt=boolean_toggle_25,
    layerName=panel_122)  # -> readMe, newMesh, newLegend, legendBasePt, meshColors, legendColors; disabled; plug-in component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

# ----
# Energy
# Construction
# infiltration rate
# Wall to Window Ratio
# Rotation Angle
# Blinds
# Construction
# Rotation Angle
# Thermal Mass
# Blinds
# Blinds
# Construction
# Thermal Mass
bldgprograms = Honeybee_bldgPrograms({"Office": 0, "Retail": 1, "MidriseApartment": 2, "PrimarySchool": 3, "SecondarySchool": 4, "SmallHotel": 5, "LargeHotel": 6, "Hospital": 7, "Outpatient": 8, "Warehouse": 9, "SuperMarket": 10, "FullServiceRestaurant": 11, "QuickServiceRestaurant": 12}, selected="MidriseApartment")  # disabled
listzoneprograms = Honeybee_ListZonePrograms(bldgProgram=bldgprograms)  # -> MidriseApartmentZonePrograms; disabled; plug-in component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
honeybee_item_selector = Honeybee_ItemSelector(
    listzoneprograms,
    {"MidriseApartment::Apartment", "MidriseApartment::Office", "MidriseApartment::Corridor"}, selected="MidriseApartment::Apartment")  # disabled
panel_183 = Panel(listzoneprograms)  # disabled
value_list_4 = ValueList({"Existing Slab Construction": "0", "+4 Inches Concrete": "1", "+8 Inches Concrete": "2"}, selected="Existing Slab Construction")  # disabled
brep_13 = Brep(<brep referenced from the Rhino model>)  # disabled
boolean_toggle_38 = BooleanToggle(False)  # disabled
boolean_toggle_39 = BooleanToggle(True)  # disabled
panel_184 = Panel("""hall
room""")  # disabled
number_slider_32 = Slider(1, range=0..1)  # disabled
mass2zone_2 = Honeybee_Masses2Zones(
    zoneMasses=flatten(brep_13),
    zoneNames=panel_184,
    zonePrograms=honeybee_item_selector,
    isConditioned=boolean_toggle_38,
    maxRoofAngle=30,
    createHBZones=boolean_toggle_39)  # -> readMe, HBZones; disabled; plug-in component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
list_item_8 = ListItem(List=brep_13, Index=number_slider_32, Wrap=True)  # disabled
boolean_toggle_40 = BooleanToggle(True)  # disabled
solveadjc = Honeybee_SolveAdjacencies(HBZones=flatten(mass2zone_2.HBZones), removeCurrentAdjc=False, findAdjc=boolean_toggle_40)  # -> readMe, HBZonesWADJ; disabled; plug-in component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
brep_14 = Brep(<brep referenced from the Rhino model>)  # disabled
askme = Honeybee_AskMe(HBObjects=mass2zone_2.HBZones)  # -> readMe; disabled; plug-in component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
addhbglz = Honeybee_addHBGlz(HBObj=solveadjc.HBZonesWADJ, childSurfaces=flatten(brep_14))  # -> HBObjWGLZ; disabled; plug-in component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
panel_185 = Panel(askme)  # disabled
volume = Volume(Geometry=addhbglz)  # -> Volume, Centroid; disabled
gethbzoneeploads = Honeybee_GetZoneEnergyPlusLoads(HBZone=mass2zone_2.HBZones)  # -> equipmentLoadPerArea, infiltrationRatePerArea, lightingDensityPerArea, numOfPeoplePerArea, ventilationPerArea, ventilationPerPerson; disabled; plug-in component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
gethbzoneepschedules = Honeybee_GetZoneEnergyPlusSchedules(HBZone=mass2zone_2.HBZones)  # -> occupancySchedule, occupancyActivitySch, heatingSetPtSchedule, coolingSetPtSchedule, lightingSchedule, equipmentSchedule, infiltrationSchedule; disabled; plug-in component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
decomposebytype_2 = Honeybee_DecomposeBasedOnType(HBZone=addhbglz)  # -> walls, interiorWalls, airWalls, windows, interiorWindows, skylights, roofs, ceilings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; disabled; plug-in component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
brep_wireframe_3 = BrepWireframe(Brep=addhbglz, Density=-1)  # disabled
panel_186 = Panel(gethbzoneepschedules.occupancySchedule)  # disabled
colour_swatch_12 = ColourSwatch(SwatchColor=RGBA(162, 240, 250, 176))  # disabled
custom_preview_7 = CustomPreview(Geometry=decomposebytype_2.windows, Shader=colour_swatch_12)  # disabled
convertepschvalues = Honeybee_ConvertEnergyPlusScheduleToValues(schName=panel_186)  # -> values; disabled; plug-in component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
number_slider_33 = Slider(0.3, range=0..1)  # disabled
boolean_toggle_41 = BooleanToggle(False)  # disabled
panel_187 = Panel("0")  # disabled
_3dchart_7 = Ladybug_3DChart(inputData=flatten(convertepschvalues), xScale=number_slider_33, zScale=panel_187, bakeIt=boolean_toggle_41)  # -> readMe, graphMesh, graphCurves, legend, legendBasePts, title, titleBasePts, dataPts, conditionalHOY; disabled; plug-in component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
number_slider_34 = Slider(0, range=-90..90)  # disabled
rotatehbobj = Honeybee_RotateHoneybee(HBObj=addhbglz, angle=number_slider_34, cenPt=volume.Centroid)  # -> HBObj; disabled; plug-in component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
brep_wireframe_4 = BrepWireframe(Brep=rotatehbobj, Density=-1)  # disabled
stream_filter = StreamFilter(Gate=value_list_4, Stream0=panel_118, Stream1=epconstruction, Stream2=epconstruction_2)  # disabled
panel_188 = Panel("base_case")  # disabled
run_energyplus = BooleanToggle(True)  # disabled
number_slider_35 = Slider(-30, range=-90..90)  # disabled
boolean_toggle_42 = BooleanToggle(False)  # disabled
xy_plane = XYPlane(Origin=Point(0, 0, 0))  # disabled
number_slider_36 = Slider(0, range=0..100)  # disabled
plane_origin = PlaneOrigin(Base=xy_plane, Origin=volume.Centroid)  # disabled
radians = Radians(Degrees=number_slider_36)  # disabled
surface = Surface([<surface referenced from the Rhino model> x10])  # disabled
rotate = Rotate(Angle=radians, Plane=plane_origin)  # -> Geometry, Transform; disabled
panel_189 = Panel("https://www.energyplus.net/weather-download/north_and_central_america_wmo_region_4/USA/PA/USA_PA_Philadelphia.Intl.AP.724080_TMY3/all")  # disabled
boolean_toggle_43 = BooleanToggle(True)  # disabled
epoutput = Honeybee_GenerateEPOutput(zoneGainsAndLosses=boolean_toggle_43, zoneComfortMetrics=boolean_toggle_43, surfaceTempAnalysis="False")  # -> report, flatten(simulationOutputs); disabled; plug-in component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
epw_stat_9 = Ladybug_OpenEPWAndSTATWeatherFiles(weatherFileURL=panel_189)  # -> epwFile, statFile; disabled; plug-in component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
panel_190 = Panel("_")  # disabled
panel_191 = Panel(" ")  # disabled
file_path = FilePath(epw_stat_9.epwFile)  # disabled
replace_text = ReplaceText(Text=panel_188, Find=panel_191, Replace=panel_190, RecursiveReplace=False)  # disabled
importepw_7 = Ladybug_ImportEpw(epwFile=file_path)  # -> readMe, latitude, location, dryBulbTemperature, dewPointTemperature, relativeHumidity, windSpeed, windDirection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; disabled; plug-in component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
boolean_toggle_44 = BooleanToggle(True)  # disabled
panel_192 = Panel("-1")  # disabled
panel_193 = Panel("1")  # disabled
panel_194 = Panel("3")  # disabled
panel_195 = Panel("20")  # disabled
legendpar_14 = Ladybug_LegendParameters(lowBound=panel_192, highBound=panel_193, numSegments=panel_194)  # -> legendPar; disabled; plug-in component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
panel_196 = Panel("35")  # disabled
panel_197 = Panel("40")  # disabled
vector_xyz = VectorXYZ(XComponent=panel_195, YComponent=0, ZComponent=0)  # -> Vector, Length; disabled
panel_198 = Panel(".025")  # disabled
panel_199 = Panel("0.125")  # disabled
vector_xyz_2 = VectorXYZ(XComponent=panel_197, YComponent=panel_196, ZComponent=0)  # -> Vector, Length; disabled
number_slider_37 = Slider(0, range=0..100)  # disabled
point_6 = Point(Point(23.10617158, 0, 0))  # disabled
move_2 = Move(Geometry=point_6, Motion=vector_xyz.Vector)  # -> Geometry, Transform; disabled
move_3 = Move(Geometry=point_6, Motion=vector_xyz_2.Vector)  # -> Geometry, Transform; disabled
boolean_toggle_45 = BooleanToggle(True)  # disabled
panel_200 = Panel("""Comfortable (%): 
hot (%):         
cold (%):        """)  # disabled
flip_matrix = FlipMatrix(Data=panel_200)  # -> simplify(Data); disabled
panel_201 = Panel("")  # disabled
panel_202 = Panel("20")  # disabled
panel_203 = Panel("-45")  # disabled
point_7 = Point(Point(-17, 4, 0))  # disabled
colour_swatch_13 = ColourSwatch(SwatchColor=RGB(0, 0, 0))  # disabled
vector_xyz_3 = VectorXYZ(XComponent=panel_202, YComponent=panel_203, ZComponent=0)  # -> Vector, Length; disabled
move_4 = Move(Geometry=point_6, Motion=vector_xyz_3.Vector)  # -> Geometry, Transform; disabled
panel_204 = Panel("0.6")  # disabled

makeadiabaticbytype = Honeybee_MakeAdiabaticByType(HBZones=addhbglz, floors=boolean_toggle_13)  # -> HBZones; disabled; plug-in component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

# ----
# Geometry Preparation
# Honeybee default materials will be assigned
# based on surface type
# Assign specific materials
number_slider_38 = Slider(0.2, range=0..1)  # disabled
number_slider_39 = Slider(0.8, range=0..1)  # disabled
panel_205 = Panel("0.5")  # disabled
panel_206 = Panel("0.5")  # disabled
panel_207 = Panel("0.2")  # disabled
panel_208 = Panel("0.8")  # disabled
radopaquematerial = Honeybee_RadianceOpaqueMaterial(
    materialName=panel_205,
    RReflectance=panel_206,
    GReflectance=panel_206,
    BReflectance=panel_206,
    roughness=0.05,
    specularity=0)  # -> avrgRef, RADMaterial; disabled; plug-in component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
radopaquematerial_2 = Honeybee_RadianceOpaqueMaterial(
    materialName=panel_208,
    RReflectance=number_slider_39,
    GReflectance=number_slider_39,
    BReflectance=number_slider_39,
    roughness=0.05,
    specularity=0)  # -> avrgRef, RADMaterial; disabled; plug-in component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
radopaquematerial_3 = Honeybee_RadianceOpaqueMaterial(
    materialName=panel_207,
    RReflectance=number_slider_38,
    GReflectance=number_slider_38,
    BReflectance=number_slider_38,
    roughness=0.05,
    specularity=0)  # -> avrgRef, RADMaterial; disabled; plug-in component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
panel_209 = Panel("generic_0.6")  # disabled
panel_210 = Panel("glass_.65")  # disabled
panel_211 = Panel(".65")  # disabled
panel_212 = Panel(".6")  # disabled
radopaquematerial_4 = Honeybee_RadianceOpaqueMaterial(
    materialName=panel_209,
    RReflectance=panel_212,
    GReflectance=panel_212,
    BReflectance=panel_212,
    roughness=0.05,
    specularity=0)  # -> avrgRef, RADMaterial; disabled; plug-in component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
ledge = Brep(<brep referenced from the Rhino model>)  # disabled
radglassmaterial_3 = Honeybee_RadianceGlassMaterial(
    materialName=panel_210,
    RTransmittance=panel_211,
    GTransmittance=panel_211,
    BTransmittance=panel_211,
    refractiveIndex=1.52)  # -> avrgTrans, RADMaterial; disabled; plug-in component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
# DAYLIGHT AUTONOMY
walls = Brep([<brep referenced from the Rhino model> x4])  # disabled
panel_213 = Panel("0")  # disabled
panel_214 = Panel("3")  # disabled
panel_215 = Panel("2")  # disabled
createhbsrfs_7 = Honeybee_createHBSrfs(geometry=ledge, RADMaterial=radopaquematerial_4.RADMaterial)  # -> readMe, simplify(HBSurface); disabled; plug-in component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
createhbsrfs_8 = Honeybee_createHBSrfs(geometry=brep_3, RADMaterial=radglassmaterial_3.RADMaterial)  # -> readMe, simplify(HBSurface); disabled; plug-in component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
createhbsrfs_9 = Honeybee_createHBSrfs(geometry=floor, srfType=panel_215, RADMaterial=radopaquematerial_3.RADMaterial)  # -> readMe, simplify(HBSurface); disabled; plug-in component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
createhbsrfs_10 = Honeybee_createHBSrfs(geometry=ceiling, srfType=panel_214, RADMaterial=radopaquematerial_2.RADMaterial)  # -> readMe, simplify(HBSurface); disabled; plug-in component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
createhbsrfs_11 = Honeybee_createHBSrfs(geometry=walls, srfType=panel_213, RADMaterial=radopaquematerial.RADMaterial)  # -> readMe, simplify(HBSurface); disabled; plug-in component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
number_slider_40 = Slider(5, range=0..12)  # disabled
list_item_9 = ListItem(List=floor, Index=number_slider_40, Wrap=True)  # disabled
number_slider_41 = Slider(0.762, range=0..1)  # disabled
number_slider_42 = Slider(0.5, range=0..1)  # disabled
gentestpts_3 = Honeybee_GenerateTestPoints(testGeometry=list_item_9, gridSize=number_slider_42, distBaseSrf=number_slider_41, moveTestMesh=True)  # -> readMe, simplify(testPoints), simplify(ptsVectors), simplify(facesArea), simplify(mesh); disabled; plug-in component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

# ---- group: collect all honeybee surfaces
brep_15 = Brep(flatten([createhbsrfs_11.HBSurface, createhbsrfs_10.HBSurface, createhbsrfs_9.HBSurface, createhbsrfs_8.HBSurface]))  # disabled

# ----
brep_wireframe_5 = BrepWireframe(Brep=brep_15, Density=-1)  # disabled

annualdaylightsimulation = Honeybee_AnnualDaylightSimulation(epwWeatherFile=epw_stat_5.epwFile, testPoints=gentestpts_3.testPoints)  # -> analysisRecipe; disabled; plug-in component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
rundaylightanalysis_3 = Honeybee_RunDaylightSimulation(
    HBObjects=flatten(brep_15),
    analysisRecipe=annualdaylightsimulation,
    writeRad=boolean_toggle_16,
    runRad=boolean_toggle_16,
    numOfCPUs=number_slider_10,
    overwriteResults=True)  # -> readMe, analysisType, resultsUnit, results, testPts, annual_analysis_files, radGeoFile, studyFolder, done; disabled; plug-in component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
readannualresultsi = Honeybee_ReadAnnualResultI(
    illFilesAddress=rundaylightanalysis_3.annual_analysis_files,
    testPoints=simplify(rundaylightanalysis_3.testPts),
    occupancyFiles=occupancygenerator,
    DLAIllumThresholds=300,
    runIt=boolean_toggle_24)  # -> DLA, UDLI_Less_100, UDLI_100_2000, UDLI_More_2000, CDA, sDA, annualProfiles, htmReport; disabled; plug-in component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
panel_216 = Panel(readannualresultsi.sDA)  # disabled
recolormesh_3 = Ladybug_RecolorMesh(
    analysisResult=readannualresultsi.DLA,
    inputMesh=gentestpts_3.mesh,
    heightDomain=construct_domain,
    legendPar=legendpar_10,
    analysisTitle=rundaylightanalysis_3.analysisType,
    legendTitle=panel_144,
    bakeIt=boolean_toggle_31)  # -> readMe, newMesh, newLegend, legendBasePt, meshColors, legendColors; disabled; plug-in component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

setepzonecnstr = Honeybee_SetEPZoneConstruction(
    HBZone=makeadiabaticbytype,
    wallEPConstruction=value_list_3,
    windowEPConstruction=value_list,
    roofEPConstruction=value_list_2)  # -> simplify(modifiedHBZone); disabled; plug-in component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
setepzoneundergroundcnstr = Honeybee_SetEPZoneUndergroundConstruction(HBZone=flatten(setepzonecnstr), groundFloorEPConstruction=stream_filter)  # -> simplify(modifiedHBZone); disabled; plug-in component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

decomposebytype_3 = Honeybee_DecomposeBasedOnType(HBZone=setepzoneundergroundcnstr)  # -> walls, interiorWalls, airWalls, windows, interiorWindows, skylights, roofs, ceilings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; disabled; plug-in component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
shddesigner = Ladybug_ShadingDesigner(
    glzSrf=flatten(decomposebytype_3.windows),
    depthOrVector=flatten(shading_depth),
    numOfShds=number_of_blinds,
    runIt=add_blinds,
    port_4=False,
    horOrVertical=boolean_toggle_42,
    shdAngle=number_slider_35)  # -> readMe, shadingSrfs; disabled; plug-in component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
brep_wireframe_6 = BrepWireframe(Brep=surface, Density=-1)  # disabled
colour_swatch_14 = ColourSwatch(SwatchColor=RGBA(0, 0, 0, 194))  # disabled
hb_epcontextsrf = HoneybeeEPContextSurfaces(shdSurfaces=flatten(surface))  # -> HBContext; inputs shdSurfaces: list of Brep, justBoundingBox: Boolean; disabled
# ---------- hb_epcontextsrf: Python ----------
"""
prepare shading/context geometries

    Args:
        northVectorOrRotation: A vector that shows North or a number that shows
                               the rotation of the North from the Y axis
        bldgMasses: List of closed Breps as thermal zones.
    Returns:
        report: ...
        thermalZones: Thermal zone's geometries for visualiza
"""

ghenv.Component.Name = 'Honeybee EP context Surfaces'
ghenv.Component.NickName = 'HB_EPContextSrf'
ghenv.Component.Message = 'VER 0.0.60\nNOV_04_2016'
ghenv.Component.IconDisplayMode = ghenv.Component.IconDisplayMode.application
ghenv.Component.Category = "Honeybee"
ghenv.Component.SubCategory = "10 | Energy | Energy"
#compatibleHBVersion = VER 0.0.57\nNOV_04_2016
#compatibleLBVersion = VER 0.0.59\nFEB_01_2015
ghenv.Component.AdditionalHelpFromDocStrings = "2"

import rhinoscriptsyntax as rs
import Rhino as rc
import scriptcontext as sc
import os
import System
import Grasshopper.Kernel as gh
import uuid

tolerance = sc.doc.ModelAbsoluteTolerance
import math


def main(shdSurfaces, EPTransSchedule, meshingSettings, justBoundingBox):
    
    # import the classes
    if sc.sticky.has_key('honeybee_release'):

        try:
            if not sc.sticky['honeybee_release'].isCompatible(ghenv.Component): return -1
            if sc.sticky['honeybee_release'].isInputMissing(ghenv.Component): return -1
        except:
            warning = "You need a newer version of Honeybee to use this compoent." + \
            " Use updateHoneybee component to update userObjects.\n" + \
            "If you have already updated userObjects drag Honeybee_Honeybee component " + \
            "into canvas and try again."
            w = gh.GH_RuntimeMessageLevel.Warning
            ghenv.Component.AddRuntimeMessage(w, warning)
            return -1
        
        # don't customize this part
        hb_EPSrf = sc.sticky["honeybee_EPSurface"]
        hb_EPSHDSurface = sc.sticky["honeybee_EPShdSurface"]
        hb_RADMaterialAUX = sc.sticky["honeybee_RADMaterialAUX"]
        hb_EPObjectsAux = sc.sticky["honeybee_EPObjectsAUX"]()
        HBScheduleList = sc.sticky["honeybee_ScheduleLib"].keys()

        ########################################################################
        #----------------------------------------------------------------------#
        shdBreps = []
        # create bounding box of shading geometries
        if justBoundingBox:
            for brep in shdSurfaces:
                if brep.Faces.Count>1 or not brep.Faces[0].IsPlanar(sc.doc.ModelAbsoluteTolerance):
                    shdBreps.append(brep.GetBoundingBox(True).ToBrep())
                else:
                    shdBreps.append(brep)
        else:
            shdBreps = shdSurfaces
        
        shadingClasses = []
        shadingMeshPreview = []
        
        if meshingSettings == None:
            mp = rc.Geometry.MeshingParameters.Minimal
            mp.SimplePlanes = True
        else:
            mp = meshingSettings
        
        def getRadMaterialName(radMaterial):
            nameStr = radMaterial.split(" ")[2]
            name =  nameStr.split("\n")[0]
            return name
        
        for brepCount, brep in enumerate(shdBreps):
            if brep != None:
                isPlanar = True
                # check planarity
                for face in brep.Faces:
                    if not face.IsPlanar(tolerance):
                        isPlanar = False
                        break
                
                shadingBreps = []
                if not isPlanar:
                    meshArray = rc.Geometry.Mesh.CreateFromBrep(brep, mp)
                    for mesh in meshArray:
                        for meshFace in range(mesh.Faces.Count):
                            vertices = list(mesh.Faces.GetFaceVertices(meshFace))[1:]
                            vertices = vertices + [sc.doc.ModelAbsoluteTolerance]
                            # create the brep from mesh
                            shdBrep = rc.Geometry.Brep.CreateFromCornerPoints(*vertices)
                            shadingBreps.append(shdBrep)
                else:
                    for face in brep.Faces:
                        shadingBreps.append(face.DuplicateFace(False))
                
                for faceCount, shdBrep in enumerate(shadingBreps):
                        thisShading = hb_EPSHDSurface(shdBrep, 1000*brepCount + faceCount, 'shdSrf_' + `brepCount` + '_' + `faceCount` + "_" + str(uuid.uuid4()))
                        
                        # add transmittance schedule if any
                        if EPTransSchedule!=None:
                            schedule= EPTransSchedule.upper()
                            if schedule!=None and not schedule.lower().endswith(".csv") and schedule not in HBScheduleList:
                                msg = "Cannot find " + schedule + " in Honeybee schedule library."
                                print msg
                                ghenv.Component.AddRuntimeMessage(gh.GH_RuntimeMessageLevel.Warning, msg)
                                return -1
                            elif schedule!=None and schedule.lower().endswith(".csv"):
                                # check if csv file is existed
                                if not os.path.isfile(schedule):
                                    msg = "Cannot find the shchedule file: " + schedule
                                    print msg
                                    ghenv.Component.AddRuntimeMessage(gh.GH_RuntimeMessageLevel.Warning, msg)
                                    return -1
                            
                            thisShading.TransmittanceSCH = schedule
                        
                        # add the Rad Material if any
                        if RADMaterial!=None:
                            # if it is just the name of the material make sure it is already defined
                            if len(RADMaterial.split(" ")) == 1:
                                # if the material is not in the library add it to the library
                                if not hb_RADMaterialAUX.isMatrialExistInLibrary(RADMaterial):
                                    warningMsg = "Can't find " + RADMaterial + " in RAD Material Library.\n" + \
                                                "Add the material to the library and try again."
                                    ghenv.Component.AddRuntimeMessage(gh.GH_RuntimeMessageLevel.Warning, warningMsg)
                                    return
                                
                                try:
                                    thisShading.setRADMaterial(RADMaterial)
                                except Exception, e:
                                    print e
                                    warningMsg = "You are using an old version of Honeybee_Honeybee! Update your files and try again."
                                    print warningMsg
                                    ghenv.Component.AddRuntimeMessage(gh.GH_RuntimeMessageLevel.Warning, warningMsg)
                                    return
                                
                                addedToLib = True
                            else:
                                
                                # try to add the material to the library
                                addedToLib, thisShading.RadMaterial = hb_RADMaterialAUX.analyseRadMaterials(RADMaterial, True)
                                
                            if addedToLib==False:
                                warningMsg = "Failed to add " + RADMaterial + " to the Library."
                                ghenv.Component.AddRuntimeMessage(gh.GH_RuntimeMessageLevel.Warning, warningMsg)
                                return
                        
                        # add shading to the list
                        shadingClasses.append(thisShading)
                
        # add to the hive
        hb_hive = sc.sticky["honeybee_Hive"]()
        HBContext  = hb_hive.addToHoneybeeHive(shadingClasses, ghenv.Component)
        return HBContext
        ################################################################################################
    else:
        print "You should first let Honeybee to fly..."
        w = gh.GH_RuntimeMessageLevel.Warning
        ghenv.Component.AddRuntimeMessage(w, "You should first let Honeybee to fly...")
        return -1
        

if _shdSurfaces and _shdSurfaces[0]!=None:
    # add cleaning function
    result= main(_shdSurfaces, EPTransSchedule_, meshingSettings_, justBoundingBox_)
    
    if result != -1: HBContext = result
# ---------- end hb_epcontextsrf ----------
custom_preview_8 = CustomPreview(Geometry=brep_wireframe_6, Shader=colour_swatch_14)  # disabled

ach2m3_s_m2_calculator = HoneybeeInfORventPerAreaCalculator(HBZones=flatten(setepzoneundergroundcnstr), airChangeHour=number_slider_5)  # -> out, infORventPerArea, allFloors; disabled; plug-in component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
setepzoneloads = Honeybee_SetEnergyPlusZoneLoads(HBZones=flatten(setepzoneundergroundcnstr), infiltrationRatePerArea=ach2m3_s_m2_calculator.infORventPerArea)  # -> loads, HBZones; disabled; plug-in component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

runenergysimulation = Honeybee_RunEnergySimulation(
    epwFile=file_path,
    HBZones=flatten(setepzoneloads.HBZones),
    HBContext=flatten(hb_epcontextsrf),
    simulationOutputs=flatten(epoutput.simulationOutputs),
    writeIdf=run_energyplus,
    runEnergyPlus=run_energyplus,
    idfFileName=replace_text)  # -> report, idfFileAddress, resultFileAddress; disabled; plug-in component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
panel_217 = Panel(runenergysimulation.resultFileAddress)  # disabled
readepsrfresult = Honeybee_ReadEPSurfaceResult(resultFileAddress=runenergysimulation.resultFileAddress)  # -> port, port_2, port_3, port_4, port_5, port_6, port_7, port_8, port_9, port_10; disabled; plug-in component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
readepresult = Honeybee_ReadEPResult(resultFileAddress=runenergysimulation.resultFileAddress)  # -> port, port_2, port_3, port_4, port_5, port_6, port_7, port_8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; disabled; plug-in component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
energybalance = Honeybee_ConstructEnergyBalance(
    HBZones=flatten(setepzoneloads.HBZones),
    cooling=readepresult.port_3,
    heating=readepresult.port_4,
    electricLight=readepresult.port_5,
    electricEquip=readepresult.port_6,
    peopleGains=readepresult.peopleGains,
    totalSolarGain=readepresult.totalSolarGain,
    infiltrationEnergy=readepresult.infiltrationEnergy,
    surfaceEnergyFlow=readepsrfresult.port_3)  # -> readMe, port, flrNormEnergyBal, flrNormBalWStorage, port_2, modelEnergyBalance, energyBalWithStorage; disabled; plug-in component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
adaptivecomfortcalculator = Ladybug_AdaptiveComfortCalculator(
    dryBulbTemperature=readepresult.airTemperature,
    meanRadiantTemperature=readepresult.meanRadTemperature,
    prevailingOutdoorTemp=importepw_7.dryBulbTemperature,
    runIt=boolean_toggle_44)  # -> readMe, port, comfortableOrNot, conditionOfPerson, degreesFromTarget, port_2, targetTemperature, upperTemperatureBound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; disabled; plug-in component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
comfortable_hot_cold = Panel([adaptivecomfortcalculator.percentOfTimeComfortable, adaptivecomfortcalculator.percentHotCold])  # disabled
psychchart = Ladybug_PsychrometricChart(
    dryBulbTemperature=readepresult.airTemperature,
    relativeHumidity=readepresult.relativeHumidity,
    basePoint=move_3.Geometry,
    runIt=boolean_toggle_45)  # -> readMe, port, totalComfortPercent, totalComfortOrNot, strategyNames, strategyPercentOfTime, strategyOrNot, port_2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; disabled; plug-in component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
_3dchart_8 = Ladybug_3DChart(
    inputData=flatten(adaptivecomfortcalculator.conditionOfPerson),
    basePoint=move_2.Geometry,
    xScale=panel_198,
    yScale=panel_199,
    zScale=number_slider_37,
    legendPar=legendpar_14)  # -> readMe, graphMesh, graphCurves, legend, legendBasePts, title, titleBasePts, dataPts, conditionalHOY; disabled; plug-in component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
number = Number(comfortable_hot_cold)  # disabled
expression = Expression(Variable_x=number, Expression="Round(x, 2)")  # disabled
flip_matrix_2 = FlipMatrix(Data=expression)  # -> simplify(Data); disabled
panel_218 = Panel([flip_matrix, flip_matrix_2])  # disabled
text_join_2 = TextJoin(Text=panel_218)  # disabled
text_join_3 = TextJoin(Text=flatten(text_join_2), Join=panel_201)  # disabled
text_tag_3d = TextTag3D(Location=point_7, Text=text_join_3, Size=1, Colour=colour_swatch_13, Justification=5)  # disabled

panel_219 = Panel("19")  # disabled
gradientlibrary_8 = Ladybug_GradientLibrary(gradIndex=panel_219)  # -> customColors; disabled; plug-in component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
panel_220 = Panel("150")  # disabled
panel_221 = Panel("-150")  # disabled
boolean_toggle_46 = BooleanToggle(True)  # disabled
selectandaveragedata_5 = Ladybug_AverageData(annualHourlyData=energybalance.energyBalWithStorage, totalOrAverage=boolean_toggle_46)  # -> readMe, selHourlyData, totaledDaily, totaledMonthly, totMonthlyPerHour, totAnalysisPeriod; disabled; plug-in component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
panel_222 = Panel("Base Room/Office Energy Balance")  # disabled
panel_223 = Panel("Energy (kWh)")  # disabled
boolean_toggle_47 = BooleanToggle(True)  # disabled
colour_swatch_15 = ColourSwatch(SwatchColor=RGB(0, 0, 0))  # disabled

legendpar_15 = Ladybug_LegendParameters(lowBound=panel_221, highBound=panel_220, customColors=flatten(gradientlibrary_8))  # -> legendPar; disabled; plug-in component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
barchart = Ladybug_MonthlyBarChart(
    inputData=flatten(selectandaveragedata_5.totaledMonthly),
    stackValues=boolean_toggle_47,
    altTitle=panel_222,
    altYAxisTitle=panel_223,
    basePoint=move_4.Geometry,
    xScale=panel_204,
    yScale=panel_204,
    legendPar=legendpar_15)  # -> readMe, dataMesh, dataCurves, dataCrvColors, graphAxes, graphLabels, title, titleBasePt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; disabled; plug-in component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
strnum = Ladybug_SeparateData(inputList=flatten(selectandaveragedata_5.totaledMonthly))  # -> numbers, strings; disabled; plug-in component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
text_tag_3d_2 = TextTag3D(Location=barchart.dataLabelPts, Size=1, Justification=7)  # disabled
panel_224 = Panel(strnum.numbers)  # disabled
panel_225 = Panel(strnum.strings)  # disabled

custom_preview_9 = CustomPreview(Geometry=barchart.graphAxes, Shader=colour_swatch_15)  # disabled

mesh = Mesh(barchart.dataMesh)  # disabled
