# Grasshopper definition Mingyue Hu_Climate.gh (Grasshopper 0.9.76)
# plug-ins: Python Interpreter

honeybee = Honeybee_Honeybee()  # -> out; plug-in component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
ladybug = Ladybug_Ladybug()  # -> out; plug-in component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
panel = Panel("https://www.energyplus.net/weather-download/north_and_central_america_wmo_region_4/USA/PA/USA_PA_Philadelphia.Intl.AP.724080_TMY3/all")
epw_stat = Ladybug_OpenEPWAndSTATWeatherFiles(weatherFileURL=panel)  # -> epwFile, statFile; plug-in component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
importepw = Ladybug_ImportEpw(epwFile=epw_stat.epwFile)  # -> Output, latitude, location, dryBulbTemperature, dewPointTemperature, relativeHumidity, windSpeed, windDirection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; plug-in component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
swatch = ColourSwatch(SwatchColor=RGB(134, 222, 170))
swatch_2 = ColourSwatch(SwatchColor=RGB(243, 214, 214))
swatch_3 = ColourSwatch(SwatchColor=RGB(196, 237, 255))
swatch_4 = ColourSwatch(SwatchColor=RGB(255, 128, 128))
swatch_5 = ColourSwatch(SwatchColor=RGB(233, 174, 174))
swatch_6 = ColourSwatch(SwatchColor=RGB(255, 85, 85))
number_slider = Slider(0.25, range=0..1)
vector = Vector(Vector(1.041889066, 5.908846518, 0))
legendpar = Ladybug_LegendParameters(customColors=flatten([ColourSwatch(SwatchColor=RGB(196, 237, 255)), ColourSwatch(SwatchColor=RGB(29, 135, 181))]))  # -> legendPar; plug-in component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
legendpar_2 = Ladybug_LegendParameters(lowBound=Slider(-13.9, range=-50..100), highBound=Slider(36.7, range=0..100))  # -> legendPar; plug-in component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
legendpar_3 = Ladybug_LegendParameters(
    numSegments=Slider(3, range=0..10),
    customColors=flatten([ColourSwatch(SwatchColor=RGB(196, 237, 255)), ColourSwatch(SwatchColor=RGB(255, 85, 85))]))  # -> legendPar; plug-in component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
outdoorcomfortcalculator = Ladybug_OutdoorComfortCalculator(
    dryBulbTemperature=importepw.dryBulbTemperature,
    windSpeed_tenMeters=importepw.windSpeed,
    relativeHumidity=importepw.relativeHumidity,
    runIt=Toggle(True))  # -> out, port, universalThermalClimateIndex, comfortableOrNot, thermalStress, conditionOfPerson, port_2, percentOfTimeComfortable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; plug-in component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
adaptivecomfortcalculator = Ladybug_AdaptiveComfortCalculator(dryBulbTemperature=importepw.dryBulbTemperature, prevailingOutdoorTemp=importepw.dryBulbTemperature, runIt=Toggle(True))  # -> out, port, comfortableOrNot, conditionOfPerson, degreesFromTarget, port_2, targetTemperature, upperTemperatureBound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; plug-in component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
_3dchart = Ladybug_3DChart(inputData=flatten(importepw.relativeHumidity), xScale=number_slider, legendPar=legendpar)  # -> out, graphMesh, graphCurves, legend, legendBasePts, title, titleBasePts, dataPts, conditionalHOY; plug-in component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
_3dchart_2 = Ladybug_3DChart(inputData=flatten(importepw.dewPointTemperature), xScale=number_slider, legendPar=legendpar_2)  # -> out, graphMesh, graphCurves, legend, legendBasePts, title, titleBasePts, dataPts, conditionalHOY; plug-in component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
_3dchart_3 = Ladybug_3DChart(inputData=flatten(adaptivecomfortcalculator.conditionOfPerson), xScale=number_slider, legendPar=legendpar_3)  # -> out, graphMesh, graphCurves, legend, legendBasePts, title, titleBasePts, dataPts, conditionalHOY; plug-in component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
legendpar_4 = Ladybug_LegendParameters(customColors=flatten([ColourSwatch(SwatchColor=RGB(196, 237, 255)), ColourSwatch(SwatchColor=RGB(255, 85, 85))]))  # -> legendPar; plug-in component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
legendpar_5 = Ladybug_LegendParameters(customColors=flatten([ColourSwatch(SwatchColor=RGB(196, 237, 255)), ColourSwatch(SwatchColor=RGB(255, 128, 128))]))  # -> legendPar; plug-in component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
psychchart = Ladybug_PsychrometricChart(dryBulbTemperature=importepw.dryBulbTemperature, relativeHumidity=importepw.relativeHumidity, runIt=Toggle(True))  # -> out, port, totalComfortPercent, totalComfortOrNot, strategyNames, strategyPercentOfTime, strategyOrNot, port_2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; plug-in component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
windrose = Ladybug_WindRose(
    north=0,
    hourlyWindDirection=importepw.windDirection,
    hourlyWindSpeed=importepw.windSpeed,
    annualHourlyData=flatten(adaptivecomfortcalculator.conditionOfPerson),
    legendPar=legendpar_5,
    runIt=Toggle(True))  # -> out, calmRoseMesh, windRoseMesh, windRoseCrvs, windRoseCenPts, legend, legendBasePts, title; plug-in component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
_3dchart_4 = Ladybug_3DChart(inputData=flatten(outdoorcomfortcalculator.conditionOfPerson), xScale=Slider(0.25, range=0..1), legendPar=legendpar_4)  # -> out, graphMesh, graphCurves, legend, legendBasePts, title, titleBasePts, dataPts, conditionalHOY; plug-in component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
panel_2 = Panel(psychchart.totalComfortPercent)
