# Grasshopper definition Mingyue Hu_Simulation.gh (Grasshopper 0.9.76)
# plug-ins: Python Interpreter

ladybug = Ladybug_Ladybug()  # -> out; plug-in component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
honeybee = Honeybee_Honeybee()  # -> out; plug-in component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
panel = Panel("https://www.energyplus.net/weather-download/north_and_central_america_wmo_region_4/USA/PA/USA_PA_Philadelphia.Intl.AP.724080_TMY3/all")
epw_stat = Ladybug_OpenEPWAndSTATWeatherFiles(weatherFileURL=panel)  # -> epwFile, statFile; plug-in component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
toggle = BooleanToggle(True)
path = FilePath(epw_stat.epwFile)
vector = Vector(Vector(1.041889066, 5.908846518, 0))

callfromepconstrlibrary = Honeybee_CallFromEPConstructionLibrary(keywords="floor")  # -> ThermMaterials, EPMaterials, EPWindowMaterials, EPConstructions; plug-in component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
item = ListItem(List=callfromepconstrlibrary.EPConstructions, Index=Slider(0, range=0..100), Wrap=True)
decomposeepconstruction = Honeybee_DecomposeEPConstruction(cnstrName=item)  # -> flatten(materials), comments, UValue_SI, UValue_IP, RValue_SI, RValue_IP; plug-in component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

callfromepconstrlibrary_2 = Honeybee_CallFromEPConstructionLibrary(keywords="slab")  # -> ThermMaterials, EPMaterials, EPWindowMaterials, EPConstructions; plug-in component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
item_2 = ListItem(List=callfromepconstrlibrary_2.EPConstructions, Index="2", Wrap=True)
decomposeepconstruction_2 = Honeybee_DecomposeEPConstruction(cnstrName=item_2)  # -> flatten(materials), comments, UValue_SI, UValue_IP, RValue_SI, RValue_IP; plug-in component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

toggle_2 = BooleanToggle(True)
occupancygenerator = Honeybee_DaysimOccupancyGeneratorBasedOnList()  # -> occupancyFile; plug-in component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
occupancygenerator_2 = Honeybee_DaysimOccupancyGenerator(weekendDays=[1, 2], writeTheOcc=Toggle(True))  # -> occupancyFile; plug-in component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
epwindowmat = Honeybee_EnergyPlusWindowMaterial(name="SHGC", U_Value="0.3704", SHGC="0.6", VT="0.73")  # -> EPMaterial; plug-in component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
number_slider = Slider(62, range=0..100)
panel_2 = Panel("""93
63
3""")
epconstruction = Honeybee_EnergyPlusConstruction(name="lowE", layer_1=epwindowmat)  # -> EPConstruction; plug-in component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

panel_3 = Panel("""MAT-CC05 4 HW CONCRETE
MAT-CC05 8 HW CONCRETE""")
panel_4 = Panel(decomposeepconstruction.materials)
item_3 = ListItem(List=decomposeepconstruction.materials, Index=0, Wrap=True)  # -> Item, Item1
item_4 = ListItem(List=panel_3, Index=0, Wrap=True)  # -> Item, Item1
panel_5 = Panel(item)
epconstruction_2 = Honeybee_EnergyPlusConstruction(name="floor_cnstr_2", layer_1=item_3.Item, layer_2=item_3.Item1, layer_3=item_4.Item1)  # -> EPConstruction; plug-in component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
epconstruction_3 = Honeybee_EnergyPlusConstruction(name="floor_cnstr_1", layer_1=item_3.Item, layer_2=item_3.Item1, layer_3=item_4.Item)  # -> EPConstruction; plug-in component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

list = ValueList({"Exterior Window [R1.0, SHGC 0.7]": "ASHRAE 90.1-2004 EXTWINDOW CLIMATEZONE ALT-WARE 1-8", "Exterior Window [R1.7, SHGC 0.39]": "ASHRAE 90.1-2004 EXTWINDOW CLIMATEZONE 4-6", "Exterior Window [R1.9, SHGC 0.39]": "ASHRAE 90.1-2004 EXTWINDOW CLIMATEZONE ALT-RES 4-6", "Exterior Window [R0.7, SHGC 0.65]": "Dbl LoE (e3=.1) Clr 3mm/13mm Arg"}, selected="Exterior Window [R1.0, SHGC 0.7]")
list_2 = ValueList({"Exterior Roof [R9.2]": "ASHRAE 90.1-2004 EXTROOF METAL CLIMATEZONE 3-4", "Exterior Roof [R14.8]": "ASHRAE 90.1-2004 EXTROOF IEAD CLIMATEZONE 1-4", "Exterior Roof [R34.4]": "ASHRAE 189.1-2009 EXTROOF IEAD CLIMATEZONE 7-8"}, selected="Exterior Roof [R9.2]")
# Construction
list_3 = ValueList({"Exterior Wall [R5.5]": "ASHRAE 90.1-2004 EXTWALL METAL CLIMATEZONE 4", "Exterior Wall [R5.8]": "ASHRAE 90.1-2004 EXTWALL MASS CLIMATEZONE 3-4", "Exterior Wall [R7.2]": "ASHRAE 90.1-2004 EXTWALL STEELFRAME CLIMATEZONE 1-4", "Exterior Wall [R8.7]": "ASHRAE 90.1-2004 EXTWALL MASS CLIMATEZONE ALT-RES 4", "Exterior Wall [R10.4]": "ASHRAE 90.1-2004 EXTWALL WOODFRAME CLIMATEZONE 1-7", "Exterior Wall [R14.8]": "ASHRAE 90.1-2004 EXTWALL STEELFRAME CLIMATEZONE ALT-RES 4-6", "Exterior Wall [R34.4]": "ASHRAE 189.1-2009 EXTROOF IEAD CLIMATEZONE 7-8"}, selected="Exterior Wall [R5.5]")
# Thermal Mass
list_4 = ValueList({"Existing Slab Construction": "0", "+4 Inches Concrete": "1", "+8 Inches Concrete": "2"}, selected="Existing Slab Construction")

add_blinds = BooleanToggle(False)
# Blinds
shading_depth = Slider(0.5, range=0..1)
number_of_blinds = Slider(3, range=0..10)

legendpar = Ladybug_LegendParameters(highBound=Slider(500, range=0..1000))  # -> legendPar; plug-in component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

panel_6 = Panel("""Construction,
    Dbl LoE (e3=.1) Clr 3mm/13mm Arg,  !- Name
    CLEAR 3MM,               !- Outside Layer
    ARGON 13MM,              !- Layer 2
    LoE CLEAR 3MM Rev;       !- Layer 3""")
panel_7 = Panel("""WindowMaterial:Gas,
    ARGON 13MM,               !- Name
    Argon,                   !- Gas Type
    0.0127;                  !- Thickness {m}""")
panel_8 = Panel("""WindowMaterial:Glazing,
    LoE CLEAR 3MM Rev,       !- Name
    SpectralAverage,         !- Optical Data Type
    ,                        !- Window Glass Spectral Data Set Name
    0.003,                   !- Thickness {m}
    0.630,                   !- Solar Transmittance at Normal Incidence
    0.220,                   !- Front Side Solar Reflectance at Normal Incidence
    0.190,                   !- Back Side Solar Reflectance at Normal Incidence
    0.850,                   !- Visible Transmittance at Normal Incidence
    0.079,                   !- Front Side Visible Reflectance at Normal Incidence
    0.056,                   !- Back Side Visible Reflectance at Normal Incidence
    0.0,                     !- Infrared Transmittance at Normal Incidence
    0.10,                    !- Front Side Infrared Hemispherical Emissivity
    0.84,                    !- Back Side Infrared Hemispherical Emissivity
    0.9;                     !- Conductivity {W/m-K}""")
toggle_3 = BooleanToggle(True)
addtoeplibrary = Honeybee_AddToEnergyPlusLibrary(EPObject=[panel_6, panel_7, panel_8], addToProjectLib=toggle_3, overwrite=toggle_3)  # -> readMe; plug-in component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

toggle_4 = BooleanToggle(True)
panel_9 = Panel("https://www.energyplus.net/weather-download/north_and_central_america_wmo_region_4/USA/PA/USA_PA_Philadelphia.Intl.AP.724080_TMY3/all")
run_energyplus = BooleanToggle(False)
epoutput = Honeybee_GenerateEPOutput(zoneGainsAndLosses=toggle_4, zoneComfortMetrics=toggle_4, surfaceTempAnalysis="False", surfaceEnergyAnalysis=toggle_4)  # -> report, flatten(simulationOutputs); plug-in component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
epw_stat_2 = Ladybug_OpenEPWAndSTATWeatherFiles(weatherFileURL=panel_9)  # -> epwFile, statFile; plug-in component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
vector_2 = Vector(Vector(1.041889066, 5.908846518, 0))
rep = ReplaceText(Text="50_percent_glazing", Find=" ", Replace="_", RecursiveReplace=False)
# Rotation Angle
number_slider_2 = Slider(0, range=-90..90)
path_2 = FilePath(epw_stat_2.epwFile)
importepw = Ladybug_ImportEpw(epwFile=path_2)  # -> readMe, latitude, location, dryBulbTemperature, dewPointTemperature, relativeHumidity, windSpeed, windDirection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; plug-in component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
gradientlibrary = Ladybug_GradientLibrary(gradIndex="1")  # -> customColors; plug-in component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
rev = ReverseList(List=gradientlibrary)
legendpar_2 = Ladybug_LegendParameters(lowBound="-1", highBound="1", numSegments="3")  # -> legendPar; plug-in component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
legendpar_3 = Ladybug_LegendParameters(customColors=flatten(rev))  # -> legendPar; plug-in component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
vec = VectorXYZ(XComponent=0, YComponent="45", ZComponent=0)  # -> Vector, Length
vec_2 = VectorXYZ(XComponent="140", YComponent="45", ZComponent=0)  # -> Vector, Length
pt = Point(Point(23.10617158, 0, 0))
move = Move(Geometry=pt, Motion=vec_2.Vector)  # -> Geometry, Transform
move_2 = Move(Geometry=pt, Motion=vec.Vector)  # -> Geometry, Transform
panel_10 = Panel("-3191.97")
panel_11 = Panel("""Comfortable (%): 
hot (%):         
cold (%):        """)
flip = FlipMatrix(Data=panel_11)  # -> simplify(Data)
pt_2 = Point(Point(-17, 4, 0))

brep = Brep(<brep referenced from the Rhino model>)
brep_2 = Brep([<brep referenced from the Rhino model> x2])

mass2zone = Honeybee_Masses2Zones(zoneMasses=flatten(brep), isConditioned=True, maxRoofAngle=30, createHBZones=Toggle(True))  # -> out, HBZones; plug-in component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
solveadjc = Honeybee_SolveAdjacencies(HBZones=flatten(mass2zone.HBZones), removeCurrentAdjc=False, findAdjc=Toggle(True))  # -> out, HBZonesWADJ; plug-in component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
addhbglz = Honeybee_addHBGlz(HBObj=solveadjc.HBZonesWADJ, childSurfaces=flatten(brep_2))  # -> HBObjWGLZ; plug-in component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
panel_12 = Panel(mass2zone.HBZones)

wires = BrepWireframe(Brep=addhbglz, Density=-1)
decomposebytype = Honeybee_DecomposeBasedOnType(HBZone=addhbglz)  # -> walls, interiorWalls, airWalls, windows, interiorWindows, skylights, roofs, ceilings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; plug-in component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
preview = CustomPreview(Geometry=decomposebytype.windows, Shader=ColourSwatch(SwatchColor=RGBA(162, 240, 250, 176)))

volume = Volume(Geometry=addhbglz)  # -> Volume, Centroid
rotatehbobj = Honeybee_RotateHoneybee(HBObj=addhbglz, cenPt=volume.Centroid)  # -> HBObj; plug-in component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
makeadiabaticbytype = Honeybee_MakeAdiabaticByType(HBZones=addhbglz, roofs=toggle, groundFloors=toggle)  # -> HBZones; plug-in component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
# create a recipe
genhbzonetestpts = Honeybee_GenerateZoneTestPoints(HBZone=makeadiabaticbytype, gridSize=Slider(1, range=0..1), distBaseSrf=Slider(0.7, range=0..1), moveTestMesh=True)  # -> readMe, simplify(testPoints), simplify(ptsVectors), simplify(facesArea), simplify(mesh); plug-in component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
annualdaylightsimulation = Honeybee_AnnualDaylightSimulation(north=vector, epwWeatherFile=path, testPoints=genhbzonetestpts.testPoints, ptsVectors=genhbzonetestpts.ptsVectors)  # -> analysisRecipe; plug-in component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
# run daylight analysis
rundaylightanalysis = Honeybee_RunDaylightSimulation(
    HBObjects=flatten(makeadiabaticbytype),
    analysisRecipe=annualdaylightsimulation,
    writeRad=toggle_2,
    runRad=toggle_2,
    overwriteResults=True)  # -> readMe, analysisType, resultsUnit, results, testPts, annual_analysis_files, radGeoFile, studyFolder, done; plug-in component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
item_5 = ListItem(List=rundaylightanalysis.testPts, Index=panel_2, Wrap=True)
points = PointList(Points=rundaylightanalysis.testPts)
# calculate UDI
readannualresultsi = Honeybee_ReadAnnualResultI(
    illFilesAddress=rundaylightanalysis.annual_analysis_files,
    testPoints=simplify(rundaylightanalysis.testPts),
    occupancyFiles=occupancygenerator_2,
    DLAIllumThresholds=300,
    runIt=Toggle(True))  # -> DLA, UDLI_Less_100, UDLI_100_2000, UDLI_More_2000, CDA, sDA, annualProfiles, htmReport; plug-in component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
setepzoneschedules = Honeybee_SetEnergyPlusZoneSchedules(HBZones=makeadiabaticbytype, lightingSchedules=readannualresultsi.annualProfiles)  # -> schedules, simplify(HBZones); plug-in component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
readdshourlyresults = Honeybee_ReadDSResultForAPoint(illFilesAddress=rundaylightanalysis.annual_analysis_files, testPoints=rundaylightanalysis.testPts, targetPoint=item_5)  # -> annualIllumNoDynamicSHD, annualIllumDynamicSHDGroupI, annualIllumDynamicSHDGroupII, iIlluminanceBasedOnOccupancy; plug-in component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
panel_13 = Panel(readdshourlyresults.annualIllumNoDynamicSHD)
_3dchart = Ladybug_3DChart(
    inputData=flatten(readdshourlyresults.annualIllumNoDynamicSHD),
    xScale=Slider(0.25, range=0..1),
    zScale=Slider(0, range=0..100),
    legendPar=legendpar)  # -> readMe, graphMesh, graphCurves, legend, legendBasePts, title, titleBasePts, dataPts, conditionalHOY; plug-in component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
setepnatvent = Honeybee_SetEPAirFlow(HBZones=setepzoneschedules.HBZones, naturalVentilationType=Slider(0, range=-1..1))  # -> readMe, simplify(HBZones); plug-in component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

# ----
# Construction
setepzonecnstr = Honeybee_SetEPZoneConstruction(
    HBZones=setepnatvent.HBZones,
    wallEPConstruction=list_3,
    windowEPConstruction=list,
    roofEPConstruction=list_2,
    expFloorEPConstruction=list_4)  # -> simplify(modifiedHBZones); plug-in component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
filter = StreamFilter(Gate=list_4, Stream0=panel_5, Stream1=epconstruction_3, Stream2=epconstruction_2)
setepzoneundergroundcnstr = Honeybee_SetEPZoneUndergroundConstruction(HBZones=setepzonecnstr, groundFloorEPConstruction=filter)  # -> simplify(modifiedHBZones); plug-in component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

# ----
# visualize results
recolormesh = Ladybug_RecolorMesh(analysisResult=readannualresultsi.DLA, inputMesh=genhbzonetestpts.mesh)  # -> readMe, newMesh, newLegend, legendBasePt, meshColors, legendColors; plug-in component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
larger = LargerThan(FirstNumber=readannualresultsi.DLA, SecondNumber=90)  # -> LargerThan, OrEqualTo
not = GateNot(A=larger.LargerThan)
dispatch = Dispatch(List=rundaylightanalysis.testPts, DispatchPattern=larger.LargerThan)  # -> ListA, ListB
pt_3 = Point(dispatch.ListB)
cullf = CullFaces(Mesh=recolormesh.newMesh, Pattern=not)
area = Area(Geometry=cullf)  # -> Area, Centroid
panel_14 = Panel(area.Area)

decomposebytype_2 = Honeybee_DecomposeBasedOnType(HBZone=setepzoneundergroundcnstr)  # -> walls, interiorWalls, airWalls, windows, interiorWindows, skylights, roofs, ceilings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; plug-in component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
shddesigner = Ladybug_ShadingDesigner(
    glzSrf=flatten(decomposebytype_2.windows),
    depthOrVector=flatten(shading_depth),
    numOfShds=number_of_blinds,
    runIt=add_blinds,
    port_4=False)  # -> readMe, shadingSrfs; plug-in component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
wires_2 = BrepWireframe(Brep=shddesigner.shadingSrfs, Density=-1)
preview_2 = CustomPreview(Geometry=wires_2, Shader=ColourSwatch(SwatchColor=RGBA(0, 0, 0, 194)))

# ----
# Blinds
hb_epcontextsrf = HoneybeeEPContextSurfaces(shdSurfaces=flatten(shddesigner.shadingSrfs))  # -> HBContext; inputs shdSurfaces: list of Brep, justBoundingBox: Boolean
# ---------- hb_epcontextsrf: Python ----------
"""
prepare shading/context geometries

    Args:
        northVectorOrRotation: A vector that shows North or a number that shows
                               the rotation of the North from the Y axis
        bldgMasses: List of closed Breps as thermal zones.
    Returns:
        report: ...
        thermalZones: Thermal zone's geometries for visualiza
"""

ghenv.Component.Name = 'Honeybee EP context Surfaces'
ghenv.Component.NickName = 'HB_EPContextSrf'
ghenv.Component.Message = 'VER 0.0.60\nNOV_04_2016'
ghenv.Component.IconDisplayMode = ghenv.Component.IconDisplayMode.application
ghenv.Component.Category = "Honeybee"
ghenv.Component.SubCategory = "10 | Energy | Energy"
#compatibleHBVersion = VER 0.0.57\nNOV_04_2016
#compatibleLBVersion = VER 0.0.59\nFEB_01_2015
ghenv.Component.AdditionalHelpFromDocStrings = "2"

import rhinoscriptsyntax as rs
import Rhino as rc
import scriptcontext as sc
import os
import System
import Grasshopper.Kernel as gh
import uuid

tolerance = sc.doc.ModelAbsoluteTolerance
import math


def main(shdSurfaces, EPTransSchedule, meshingSettings, justBoundingBox):
    
    # import the classes
    if sc.sticky.has_key('honeybee_release'):

        try:
            if not sc.sticky['honeybee_release'].isCompatible(ghenv.Component): return -1
            if sc.sticky['honeybee_release'].isInputMissing(ghenv.Component): return -1
        except:
            warning = "You need a newer version of Honeybee to use this compoent." + \
            " Use updateHoneybee component to update userObjects.\n" + \
            "If you have already updated userObjects drag Honeybee_Honeybee component " + \
            "into canvas and try again."
            w = gh.GH_RuntimeMessageLevel.Warning
            ghenv.Component.AddRuntimeMessage(w, warning)
            return -1
        
        # don't customize this part
        hb_EPSrf = sc.sticky["honeybee_EPSurface"]
        hb_EPSHDSurface = sc.sticky["honeybee_EPShdSurface"]
        hb_RADMaterialAUX = sc.sticky["honeybee_RADMaterialAUX"]
        hb_EPObjectsAux = sc.sticky["honeybee_EPObjectsAUX"]()
        HBScheduleList = sc.sticky["honeybee_ScheduleLib"].keys()

        ########################################################################
        #----------------------------------------------------------------------#
        shdBreps = []
        # create bounding box of shading geometries
        if justBoundingBox:
            for brep in shdSurfaces:
                if brep.Faces.Count>1 or not brep.Faces[0].IsPlanar(sc.doc.ModelAbsoluteTolerance):
                    shdBreps.append(brep.GetBoundingBox(True).ToBrep())
                else:
                    shdBreps.append(brep)
        else:
            shdBreps = shdSurfaces
        
        shadingClasses = []
        shadingMeshPreview = []
        
        if meshingSettings == None:
            mp = rc.Geometry.MeshingParameters.Minimal
            mp.SimplePlanes = True
        else:
            mp = meshingSettings
        
        def getRadMaterialName(radMaterial):
            nameStr = radMaterial.split(" ")[2]
            name =  nameStr.split("\n")[0]
            return name
        
        for brepCount, brep in enumerate(shdBreps):
            if brep != None:
                isPlanar = True
                # check planarity
                for face in brep.Faces:
                    if not face.IsPlanar(tolerance):
                        isPlanar = False
                        break
                
                shadingBreps = []
                if not isPlanar:
                    meshArray = rc.Geometry.Mesh.CreateFromBrep(brep, mp)
                    for mesh in meshArray:
                        for meshFace in range(mesh.Faces.Count):
                            vertices = list(mesh.Faces.GetFaceVertices(meshFace))[1:]
                            vertices = vertices + [sc.doc.ModelAbsoluteTolerance]
                            # create the brep from mesh
                            shdBrep = rc.Geometry.Brep.CreateFromCornerPoints(*vertices)
                            shadingBreps.append(shdBrep)
                else:
                    for face in brep.Faces:
                        shadingBreps.append(face.DuplicateFace(False))
                
                for faceCount, shdBrep in enumerate(shadingBreps):
                        thisShading = hb_EPSHDSurface(shdBrep, 1000*brepCount + faceCount, 'shdSrf_' + `brepCount` + '_' + `faceCount` + "_" + str(uuid.uuid4()))
                        
                        # add transmittance schedule if any
                        if EPTransSchedule!=None:
                            schedule= EPTransSchedule.upper()
                            if schedule!=None and not schedule.lower().endswith(".csv") and schedule not in HBScheduleList:
                                msg = "Cannot find " + schedule + " in Honeybee schedule library."
                                print msg
                                ghenv.Component.AddRuntimeMessage(gh.GH_RuntimeMessageLevel.Warning, msg)
                                return -1
                            elif schedule!=None and schedule.lower().endswith(".csv"):
                                # check if csv file is existed
                                if not os.path.isfile(schedule):
                                    msg = "Cannot find the shchedule file: " + schedule
                                    print msg
                                    ghenv.Component.AddRuntimeMessage(gh.GH_RuntimeMessageLevel.Warning, msg)
                                    return -1
                            
                            thisShading.TransmittanceSCH = schedule
                        
                        # add the Rad Material if any
                        if RADMaterial!=None:
                            # if it is just the name of the material make sure it is already defined
                            if len(RADMaterial.split(" ")) == 1:
                                # if the material is not in the library add it to the library
                                if not hb_RADMaterialAUX.isMatrialExistInLibrary(RADMaterial):
                                    warningMsg = "Can't find " + RADMaterial + " in RAD Material Library.\n" + \
                                                "Add the material to the library and try again."
                                    ghenv.Component.AddRuntimeMessage(gh.GH_RuntimeMessageLevel.Warning, warningMsg)
                                    return
                                
                                try:
                                    thisShading.setRADMaterial(RADMaterial)
                                except Exception, e:
                                    print e
                                    warningMsg = "You are using an old version of Honeybee_Honeybee! Update your files and try again."
                                    print warningMsg
                                    ghenv.Component.AddRuntimeMessage(gh.GH_RuntimeMessageLevel.Warning, warningMsg)
                                    return
                                
                                addedToLib = True
                            else:
                                
                                # try to add the material to the library
                                addedToLib, thisShading.RadMaterial = hb_RADMaterialAUX.analyseRadMaterials(RADMaterial, True)
                                
                            if addedToLib==False:
                                warningMsg = "Failed to add " + RADMaterial + " to the Library."
                                ghenv.Component.AddRuntimeMessage(gh.GH_RuntimeMessageLevel.Warning, warningMsg)
                                return
                        
                        # add shading to the list
                        shadingClasses.append(thisShading)
                
        # add to the hive
        hb_hive = sc.sticky["honeybee_Hive"]()
        HBContext  = hb_hive.addToHoneybeeHive(shadingClasses, ghenv.Component)
        return HBContext
        ################################################################################################
    else:
        print "You should first let Honeybee to fly..."
        w = gh.GH_RuntimeMessageLevel.Warning
        ghenv.Component.AddRuntimeMessage(w, "You should first let Honeybee to fly...")
        return -1
        

if _shdSurfaces and _shdSurfaces[0]!=None:
    # add cleaning function
    result= main(_shdSurfaces, EPTransSchedule_, meshingSettings_, justBoundingBox_)
    
    if result != -1: HBContext = result
# ---------- end hb_epcontextsrf ----------
runenergysimulation = Honeybee_RunEnergySimulation(
    north=vector_2,
    epwFile=path_2,
    HBZones=flatten(setepzoneundergroundcnstr),
    HBContext=flatten(hb_epcontextsrf),
    simulationOutputs=flatten(epoutput.simulationOutputs),
    writeIdf=run_energyplus,
    runEnergyPlus=run_energyplus,
    idfFileName=rep)  # -> out, idfFileAddress, resultFileAddress; plug-in component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
panel_15 = Panel(runenergysimulation.resultFileAddress)
readepsrfresult = Honeybee_ReadEPSurfaceResult(resultFileAddress=runenergysimulation.resultFileAddress)  # -> surfaceIndoorTemp, surfaceOutdoorTemp, surfaceEnergyFlow, opaqueEnergyFlow, glazEnergyFlow, windowTotalSolarEnergy, windowBeamEnergy, windowDiffEnergy, windowTransmissivity, otherSurfaceData; plug-in component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
readepresult = Honeybee_ReadEPResult(resultFileAddress=runenergysimulation.resultFileAddress)  # -> totalThermalLoad, thermalLoadBalance, cooling, heating, electricLight, electricEquip, fanElectric, pumpElectric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; plug-in component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
colorsurfaces = Honeybee_ColorSurfacesByEPResult(srfData=readepsrfresult.surfaceEnergyFlow, HBZones=flatten(setepzoneundergroundcnstr), runIt=Toggle(True))  # -> readMe, srfColoredMesh, zoneWireFrame, legend, legendBasePt, analysisTitle, srfBreps, srfColors, srfValues, normalizedSrfData; plug-in component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
energybalance = Honeybee_ConstructEnergyBalance(
    HBZones=flatten(setepzoneundergroundcnstr),
    peopleGains=readepresult.peopleGains,
    totalSolarGain=readepresult.totalSolarGain,
    infiltrationEnergy=readepresult.infiltrationEnergy,
    surfaceEnergyFlow=readepsrfresult.surfaceEnergyFlow)  # -> readMe, port, flrNormEnergyBal, flrNormBalWStorage, port_2, modelEnergyBalance, energyBalWithStorage; plug-in component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
adaptivecomfortcalculator = Ladybug_AdaptiveComfortCalculator(
    dryBulbTemperature=readepresult.airTemperature,
    meanRadiantTemperature=readepresult.meanRadTemperature,
    prevailingOutdoorTemp=importepw.dryBulbTemperature,
    runIt=Toggle(True))  # -> readMe, port, comfortableOrNot, conditionOfPerson, degreesFromTarget, port_2, targetTemperature, upperTemperatureBound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; plug-in component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
selectandaveragedata = Ladybug_AverageData(annualHourlyData=energybalance.modelEnergyBalance, totalOrAverage=Toggle(True))  # -> readMe, selHourlyData, totaledDaily, totaledMonthly, totMonthlyPerHour, totAnalysisPeriod; plug-in component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
comfortable_hot_cold = Panel([adaptivecomfortcalculator.percentOfTimeComfortable, adaptivecomfortcalculator.percentHotCold])
psychchart = Ladybug_PsychrometricChart(
    dryBulbTemperature=readepresult.airTemperature,
    relativeHumidity=readepresult.relativeHumidity,
    basePoint=move.Geometry,
    runIt=Toggle(True))  # -> readMe, port, totalComfortPercent, totalComfortOrNot, strategyNames, strategyPercentOfTime, strategyOrNot, port_2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; plug-in component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
_3dchart_2 = Ladybug_3DChart(
    inputData=flatten(adaptivecomfortcalculator.conditionOfPerson),
    basePoint=pt,
    xScale=".025",
    yScale="0.125",
    zScale=Slider(0, range=0..100),
    legendPar=legendpar_2)  # -> readMe, graphMesh, graphCurves, legend, legendBasePts, title, titleBasePts, dataPts, conditionalHOY; plug-in component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
barchart = Ladybug_MonthlyBarChart(
    inputData=flatten(selectandaveragedata.totaledMonthly),
    stackValues=Toggle(True),
    basePoint=move_2.Geometry,
    xScale=Slider(0.75, range=0..1),
    legendPar=legendpar_3)  # -> readMe, dataMesh, dataCurves, dataCrvColors, graphAxes, graphLabels, title, titleBasePt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; plug-in component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
num = Number(comfortable_hot_cold)
expression = Expression(x=num, Expression="Round(x, 2)")
flip_2 = FlipMatrix(Data=expression)  # -> simplify(Data)
pt_4 = Point(barchart.dataLabelPts)
tag = TextTag3D(Location=barchart.dataLabelPts, Text=barchart.dataMesh, Size=1, Justification=7)
panel_16 = Panel([flip, flip_2])
join = TextJoin(Text=panel_16)
join_2 = TextJoin(Text=flatten(join))
tag_2 = TextTag3D(Location=pt_2, Text=join_2, Size=1, Colour=ColourSwatch(SwatchColor=RGB(0, 0, 0)), Justification=5)
