# Grasshopper definition Mingyue Hu_Daylight.gh (Grasshopper 0.9.76)
# plug-ins: Python Interpreter, embryoA

number_slider = Slider(0, range=0..2)
number_slider_2 = Slider(0, range=0..2)
ladybug = Ladybug_Ladybug()  # -> Vviiiiiiiiiizzz; plug-in component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
honeybee = Honeybee_Honeybee()  # -> Vviiiiiiiiiizzz; plug-in component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
# Animate sliders
button = Button()
hours = Panel("""9
12
15""")
# Glass material
number_slider_3 = Slider(0.6, range=0..1)
months = Panel("""3
6
12""")
panel = Panel("https://www.energyplus.net/weather-download/north_and_central_america_wmo_region_4/USA/PA/USA_PA_Philadelphia.Intl.AP.724080_TMY3/all")
fly = Ladybug_fly(inputSliders=[number_slider, number_slider_2], fly=button)  # -> Vviiiiiiiiiizzz; plug-in component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
panel_2 = Panel("https://www.energyplus.net/weather-download/north_and_central_america_wmo_region_4/USA/PA/USA_PA_Philadelphia.Intl.AP.724080_TMY3/all")
windows = Brep([<brep referenced from the Rhino model> x2])
wall = Brep([<brep referenced from the Rhino model> x4])
wall_2 = Brep([<brep referenced from the Rhino model> x2])
epw_stat = Ladybug_OpenEPWAndSTATWeatherFiles(weatherFileURL=panel)  # -> epwFile, statFile; plug-in component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
item = ListItem(List=hours, Index=number_slider_2, Wrap=True)
item_2 = ListItem(List=months, Index=number_slider, Wrap=True)
panel_3 = Panel("""9
12
15""")
panel_4 = Panel("""3
6
12""")
createhbsrfs = Honeybee_createHBSrfs(geometry=wall, srfType="0")  # -> readMe, simplify(HBSurface); plug-in component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
createhbsrfs_2 = Honeybee_createHBSrfs(geometry=wall_2, srfType="2")  # -> readMe, simplify(HBSurface); plug-in component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
radglassmaterial = Honeybee_RadianceGlassMaterial(
    materialName="Glass",
    RTransmittance=number_slider_3,
    GTransmittance=number_slider_3,
    BTransmittance=number_slider_3,
    refractiveIndex=1.52)  # -> avrgTrans, RADMaterial; plug-in component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
epw_stat_2 = Ladybug_OpenEPWAndSTATWeatherFiles(weatherFileURL=panel_2)  # -> epwFile, statFile; plug-in component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
# Glass material
number_slider_4 = Slider(0.6, range=0..1)
# Glass material
number_slider_5 = Slider(0.6, range=0..1)
number_slider_6 = Slider(350, range=0..400)
# Prepare geometries
windows_2 = Brep([<brep referenced from the Rhino model> x2])
wall_3 = Brep([<brep referenced from the Rhino model> x4])
# Prepare geometries
windows_3 = Brep([<brep referenced from the Rhino model> x2])
wall_4 = Brep([<brep referenced from the Rhino model> x4])
wall_5 = Brep([<brep referenced from the Rhino model> x2])
wall_6 = Brep([<brep referenced from the Rhino model> x2])
createhbsrfs_3 = Honeybee_createHBSrfs(geometry=windows, RADMaterial=radglassmaterial.RADMaterial)  # -> readMe, simplify(HBSurface); plug-in component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
geo = Geometry(<brep referenced from the Rhino model>)
createhbsrfs_4 = Honeybee_createHBSrfs(geometry=wall_3, srfType="0")  # -> readMe, simplify(HBSurface); plug-in component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
createhbsrfs_5 = Honeybee_createHBSrfs(geometry=wall_5, srfType="2")  # -> readMe, simplify(HBSurface); plug-in component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
createhbsrfs_6 = Honeybee_createHBSrfs(geometry=wall_4, srfType="0")  # -> readMe, simplify(HBSurface); plug-in component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
createhbsrfs_7 = Honeybee_createHBSrfs(geometry=wall_6, srfType="2")  # -> readMe, simplify(HBSurface); plug-in component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
radglassmaterial_2 = Honeybee_RadianceGlassMaterial(
    materialName="Glass",
    RTransmittance=number_slider_4,
    GTransmittance=number_slider_4,
    BTransmittance=number_slider_4,
    refractiveIndex=1.52)  # -> avrgTrans, RADMaterial; plug-in component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
radglassmaterial_3 = Honeybee_RadianceGlassMaterial(
    materialName="Glass",
    RTransmittance=number_slider_5,
    GTransmittance=number_slider_5,
    BTransmittance=number_slider_5,
    refractiveIndex=1.52)  # -> avrgTrans, RADMaterial; plug-in component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
path = FilePath(epw_stat_2.epwFile)
importlocation = Ladybug_ImportLocation(epwFile=path)  # -> location; plug-in component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

# ---- group: For better visualization - Doesn't effect the results of the analysis
importlocation_2 = Ladybug_ImportLocation(epwFile=epw_stat.epwFile)  # -> location; plug-in component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
sunpath = Ladybug_SunPath(
    north=number_slider_6,
    location=importlocation_2,
    hour="15",
    day="21",
    month="09",
    timeStep=1,
    sunPathScale=Slider(0.2, range=0..1),
    dailyOrAnnualSunPath=True)  # -> readMe, sunVectors, sunAltitudes, sunAzimuths, port, sunSpheresMesh, sunPathCrvs, legend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; disabled; plug-in component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

# ----
mass2zone = Honeybee_Masses2Zones(zoneMasses=flatten(geo), isConditioned=True, maxRoofAngle=30, createHBZones=Toggle(True))  # -> readMe, HBZones; plug-in component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
# Generate sky
genclimatebasedsky = Honeybee_GenerateClimateBasedSky(weatherFile=path, month=item_2, day="21", hour=item)  # -> radiationValues, skyFilePath; plug-in component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
genclimatebasedsky_2 = Honeybee_GenerateClimateBasedSky(north=number_slider_6, weatherFile=epw_stat.epwFile, month="09", day="21", hour="15")  # -> radiationValues, skyFilePath; plug-in component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
createhbsrfs_8 = Honeybee_createHBSrfs(geometry=windows_2, RADMaterial=radglassmaterial_2.RADMaterial)  # -> readMe, simplify(HBSurface); plug-in component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
createhbsrfs_9 = Honeybee_createHBSrfs(geometry=windows_3, RADMaterial=radglassmaterial_3.RADMaterial)  # -> readMe, simplify(HBSurface); plug-in component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
genavgsky = Honeybee_GenerateAverageSky(north=number_slider_6, weatherFile=epw_stat.epwFile, month="09", hour="15")  # -> radiationValues, skyFilePath; plug-in component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
northarrow = Ladybug_North(north=number_slider_6, scale=".05")  # -> northSign; plug-in component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
doy_hoy = Ladybug_DOY_HOY(days="21", months=item_2, hours=item)  # -> HOY, DOY, date; plug-in component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
sunpath_2 = Ladybug_SunPath(
    location=importlocation,
    hour=panel_3,
    day=21,
    month=panel_4,
    timeStep=1,
    sunPathScale=Slider(0.2, range=0..1),
    dailyOrAnnualSunPath=True)  # -> readMe, sunVectors, sunAltitudes, sunAzimuths, port, sunSpheresMesh, sunPathCrvs, legend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; plug-in component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
panel_5 = Panel([genclimatebasedsky_2.radiationValues, genavgsky.radiationValues])
set_the_view_to_fisheye_for_glare_analys = Panel("1")  # "set the view to FishEye for Glare Analysis"
brep = Brep([createhbsrfs_3.HBSurface, createhbsrfs.HBSurface, createhbsrfs_2.HBSurface])
brep_2 = Brep(<brep referenced from the Rhino model>)
radparameters = Honeybee_RADParameters(quality=0, ab="3")  # -> readMe, radParameters; plug-in component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
brep_3 = Brep([createhbsrfs_8.HBSurface, createhbsrfs_4.HBSurface, createhbsrfs_5.HBSurface])
brep_4 = Brep([createhbsrfs_9.HBSurface, createhbsrfs_6.HBSurface, createhbsrfs_7.HBSurface])
flip = Flip(Surface=brep_2)  # -> Surface, Result
doy_hoy_2 = Ladybug_DOY_HOY(days="21", months="09", hours="15")  # -> HOY, DOY, date; plug-in component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
brep_5 = Brep(brep)
panel_6 = Panel("https://www.energyplus.net/weather-download/north_and_central_america_wmo_region_4/USA/PA/USA_PA_Philadelphia.Intl.AP.724080_TMY3/all")
gentestpts = Honeybee_GenerateTestPoints(testGeometry=flip.Surface, gridSize=Slider(0.5, range=0..1), distBaseSrf=Slider(0.762, range=0..1), moveTestMesh=True)  # -> readMe, simplify(testPoints), simplify(ptsVectors), simplify(facesArea), simplify(mesh); plug-in component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

# ---- group: collect all honeybee surfaces
brep_6 = Brep(flatten(brep_4))

# ----
brep_7 = Brep(brep_3)
imagebasedsimulation = Honeybee_ImageBasedSimulation(
    skyFile=genavgsky.skyFilePath,
    cameraType=set_the_view_to_fisheye_for_glare_analys,
    simulationType=2,
    radParameters=radparameters.radParameters,
    backupImages=0)  # -> analysisRecipe; plug-in component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
genhbzonetestpts = Honeybee_GenerateZoneTestPoints(
    HBZone=mass2zone.HBZones,
    gridSize=Slider(0.5, range=0..1),
    distBaseSrf=Slider(0.762, range=0..1),
    moveTestMesh=Toggle(True))  # -> readMe, simplify(testPoints), simplify(ptsVectors), simplify(facesArea), simplify(mesh); plug-in component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
epw_stat_3 = Ladybug_OpenEPWAndSTATWeatherFiles(weatherFileURL=panel_6)  # -> epwFile, statFile; plug-in component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
wires = BrepWireframe(Brep=brep_5, Density=-1)
wires_2 = BrepWireframe(Brep=brep_7, Density=-1)
# prepare a recipe
gridbasedsimulation = Honeybee_GridBasedSimulation(
    skyFile=genclimatebasedsky.skyFilePath,
    testPoints=gentestpts.testPoints,
    ptsVectors=gentestpts.ptsVectors,
    testMesh=gentestpts.mesh,
    simulationType=0)  # -> analysisRecipe; plug-in component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
toggle = BooleanToggle(False)
annualdaylightsimulation = Honeybee_AnnualDaylightSimulation(
    epwWeatherFile=epw_stat_3.epwFile,
    testPoints=genhbzonetestpts.testPoints,
    ptsVectors=genhbzonetestpts.ptsVectors,
    testMesh=genhbzonetestpts.mesh)  # -> analysisRecipe; plug-in component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
toggle_2 = BooleanToggle(False)
panel_7 = Panel("""Radiance
Grasshopper
Honeybee
Glare
Daylight
Set View
HBExampleFiles""")
panel_8 = Panel("""This file shows how to run a glare analysis using Honeybee. This example is using same geometry as the other daylighting examples [[1](http://hydrashare.github.io/hydra/viewer?owner=mostaphaRoudsari&fork=hydra_1&id=Surface_by_surface_geometry_preparation_for_daylight_simulation_II), [2](http://hydrashare.github.io/hydra/viewer?owner=mostaphaRoudsari&fork=hydra_1&id=Find_when_sun_is_visible_to_a_point)].
The example is uses Averaged Climate-based Sky for glare analysis which uses the average value for that hour during the whole month.""")
toggle_3 = BooleanToggle(False)
panel_9 = Panel("C:\Users\Administrator\Dropbox\ladybug\helpDesk\PennDesign2015\Daylight_Glare_Analysis.png")
# run the analysis
rundaylightanalysis = Honeybee_RunDaylightSimulation(HBObjects=flatten(brep_7), analysisRecipe=gridbasedsimulation, writeRad=toggle_2, runRad=toggle_2, overwriteResults=True)  # -> readMe, analysisType, resultsUnit, results, testPts, resultFiles, radGeoFile, studyFolder, done; plug-in component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
rundaylightanalysis_2 = Honeybee_RunDaylightSimulation(
    HBObjects=flatten(brep_5),
    analysisRecipe=annualdaylightsimulation,
    writeRad=toggle_3,
    runRad=toggle_3,
    overwriteResults=True)  # -> readMe, analysisType, resultsUnit, results, testPts, resultFiles, radGeoFile, studyFolder, done; plug-in component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
number_slider_7 = Slider(0.35, range=0..1)
geo_2 = Geometry([<brep referenced from the Rhino model> x26])
exporthydra = Hydra_ExportFile(
    fileName="Glare Analysis",
    fileDescription=panel_8,
    fileTags=panel_7,
    targetFolder="C:\Users\Administrator\Documents\GitHub\hydra_1",
    includeRhino=Toggle(True),
    additionalImgs=panel_9,
    export=Toggle(False))  # -> readMe; inputs fileDescription: list, changeLog: list, fileTags: list, includeRhino: Boolean, GHForThumb: Boolean, additionalImgs: list, export: Boolean; plug-in component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
occupancygenerator = Honeybee_DaysimOccupancyGenerator(weekendDays=[1, 2], writeTheOcc=Toggle(True))  # -> occupancyFile; plug-in component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
gradientlibrary = Ladybug_GradientLibrary(gradIndex=Slider(0, range=0..10))  # -> customColors; plug-in component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
panel_10 = Panel(doy_hoy.date)
radopaquematerial = Honeybee_RadianceOpaqueMaterial(
    materialName="context_material",
    RReflectance=number_slider_7,
    GReflectance=number_slider_7,
    BReflectance=number_slider_7,
    roughness=0.05,
    specularity=0)  # -> avrgRef, RADMaterial; plug-in component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
readannualresultsi = Honeybee_ReadAnnualResultI(
    illFilesAddress=rundaylightanalysis_2.resultFiles,
    testPoints=simplify(rundaylightanalysis_2.testPts),
    occupancyFiles=occupancygenerator,
    DLAIllumThresholds=300,
    runIt=Toggle(True))  # -> DLA, UDLI_Less_100, UDLI_100_2000, UDLI_More_2000, CDA, sDA, annualProfiles, htmReport; plug-in component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
# Finally for complex geometries or
# geometries that are not going to change
# it is better to export them as rad files
# using RAD>Mesh and use them as
# additional files.
toggle_4 = BooleanToggle(True)
legendpar = Ladybug_LegendParameters(
    lowBound=Slider(0, range=0..100),
    highBound=Slider(100, range=0..100),
    numSegments=Slider(10, range=0..10),
    customColors=flatten(gradientlibrary))  # -> legendPar; plug-in component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
legendpar_2 = Ladybug_LegendParameters(lowBound="300", highBound="2000")  # -> legendPar; plug-in component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
# capture the viewport to an image
join = TextJoin(Text=[item_2, "21", item], Join="_")
msh2rad = Honeybee_MSH2RAD(
    mesh=geo_2,
    RADMaterial=radopaquematerial.RADMaterial,
    workingDir="c:\ladybug",
    radFileName="ParisProjectContext",
    writeRAD=toggle_4)  # -> materialFile, radianceFile; plug-in component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
concat = Concatenate(FragmentA=rundaylightanalysis.analysisType, FragmentC=panel_10)
dom = ConstructDomain(DomainStart=0, DomainEnd=Slider(1, range=0..1))
panel_11 = Panel(join)
panel_12 = Panel("%")  # disabled
merge = Merge(Data1=msh2rad.materialFile, Data2=msh2rad.radianceFile)
rundaylightanalysis_3 = Honeybee_RunDaylightSimulation(
    HBObjects=flatten(brep_6),
    analysisRecipe=imagebasedsimulation,
    writeRad=toggle,
    runRad=toggle,
    numOfCPUs="4",
    radFileName=doy_hoy_2.date,
    additionalRadFiles=merge,
    overwriteResults=True)  # -> readMe, analysisType, resultsUnit, results, testPts, resultFiles, radGeoFile, studyFolder, done; plug-in component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
panel_13 = Panel(readannualresultsi.sDA)
panel_14 = Panel(merge)
recolormesh = Ladybug_RecolorMesh(
    analysisResult=readannualresultsi.UDLI_100_2000,
    inputMesh=genhbzonetestpts.mesh,
    heightDomain=dom,
    legendPar=legendpar,
    analysisTitle=rundaylightanalysis_2.analysisType,
    legendTitle=panel_12)  # -> readMe, newMesh, newLegend, legendBasePt, meshColors, legendColors; plug-in component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
# visualize the results
recolormesh_2 = Ladybug_RecolorMesh(
    analysisResult=rundaylightanalysis.results,
    inputMesh=gentestpts.mesh,
    legendPar=legendpar_2,
    analysisTitle=concat,
    legendTitle=rundaylightanalysis.resultsUnit)  # -> readMe, newMesh, newLegend, legendBasePt, meshColors, legendColors; plug-in component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
captureview = Ladybug_CaptureView(fileName=panel_11, capture=Toggle(True))  # -> imagePath; plug-in component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
panel_15 = Panel(captureview)
glareanalysis = Honeybee_GlareAnalysis(HDRImagePath=rundaylightanalysis_3.resultFiles, runIt=Toggle(True))  # -> readMe, glareCheckImage, DGP, DGI, imageWithTaskArea; plug-in component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
falsecolor = Honeybee_FalseColor(
    HDRFilePath=rundaylightanalysis_3.resultFiles,
    contourBands=False,
    maskThreshold=0.1,
    useAlterColors=False,
    render=Toggle(True))  # -> outputFilePath; plug-in component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
panel_16 = Panel(glareanalysis.DGP)
hdr_tif = Honeybee_ConvertHDRToTIF(HDRFilePath=glareanalysis.glareCheckImage, adjustExposure=Toggle(True))  # -> TIFFFilePath; plug-in component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
hdr_tif_2 = Honeybee_ConvertHDRToTIF(HDRFilePath=falsecolor, adjustExposure=False)  # -> TIFFFilePath; plug-in component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
number_slider_8 = Slider(0.8, range=0..1)
panel_17 = Panel(hdr_tif)
image = ImageFromPath(P=hdr_tif, S=number_slider_8)
image_2 = ImageFromPath(P=hdr_tif_2, S=number_slider_8)
