# Grasshopper definition Jin_Jieming_Final.gh (Grasshopper 0.9.76)
# plug-ins: Python Interpreter, embryoA

ladybug = Ladybug_Ladybug()  # -> Vviiiiiiiiiizzz; plug-in component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
honeybee = Honeybee_Honeybee()  # -> Vviiiiiiiiiizzz; plug-in component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

# ----
# Windows
# Rotation
# Construction Material
panel = Panel("""Initial Ratio
0.1
0
0
0.1""")
# GH file 1113 with my Apart
ladybug_2 = Ladybug_Ladybug()  # -> Vviiiiiiiiiizzz; plug-in component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

# ---- group: In-Class / Geometry Input
number_slider = Slider(0.6, range=0..1)
windows = Brep([<brep referenced from the Rhino model> x2])
wall = Brep(<brep referenced from the Rhino model>)
wall_2 = Brep(<brep referenced from the Rhino model>)
radglassmaterial = Honeybee_RadianceGlassMaterial(
    materialName="Glass",
    RTransmittance=number_slider,
    GTransmittance=number_slider,
    BTransmittance=number_slider,
    refractiveIndex=1.52)  # -> avrgTrans, RADMaterial; plug-in component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
createhbsrfs = Honeybee_createHBSrfs(geometry=wall, srfType="0")  # -> readMe, simplify(HBSurface); plug-in component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
createhbsrfs_2 = Honeybee_createHBSrfs(geometry=wall_2, srfType="1")  # -> readMe, simplify(HBSurface); plug-in component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
createhbsrfs_3 = Honeybee_createHBSrfs(geometry=windows, RADMaterial=radglassmaterial.RADMaterial)  # -> readMe, simplify(HBSurface); plug-in component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

# ----
window = Brep([<brep referenced from the Rhino model> x4])
panel_2 = Panel("""After Design Ratio
0.3
0.2
0.5
0.1""")

# ---- group: WWR
# Wall to Window Ratio
wwr_north = Slider(0, range=0..1)
wwr_west = Slider(0, range=0..1)
wwr_south = Slider(0, range=0..1)
wwr_east = Slider(0, range=0..1)

# ----
honeybee_2 = Honeybee_Honeybee()  # -> Vviiiiiiiiiizzz; plug-in component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
# Rotation Angle
number_slider_2 = Slider(0, range=-90..90)

shading_depth = Slider(0.5, range=0..1)
number_of_blinds = Slider(3, range=0..10)
# Blinds
add_blinds = BooleanToggle(False)

list = ValueList({"Exterior Window [R1.0, SHGC 0.7]": "ASHRAE 90.1-2004 EXTWINDOW CLIMATEZONE ALT-WARE 1-8", "Exterior Window [R1.7, SHGC 0.39]": "ASHRAE 90.1-2004 EXTWINDOW CLIMATEZONE 4-6", "Exterior Window [R1.9, SHGC 0.39]": "ASHRAE 90.1-2004 EXTWINDOW CLIMATEZONE ALT-RES 4-6", "Exterior Window [R0.7, SHGC 0.65]": "Dbl LoE (e3=.1) Clr 3mm/13mm Arg"}, selected="Exterior Window [R1.9, SHGC 0.39]")
list_2 = ValueList({"Exterior Roof [R9.2]": "ASHRAE 90.1-2004 EXTROOF METAL CLIMATEZONE 3-4", "Exterior Roof [R14.8]": "ASHRAE 90.1-2004 EXTROOF IEAD CLIMATEZONE 1-4", "Exterior Roof [R34.4]": "ASHRAE 189.1-2009 EXTROOF IEAD CLIMATEZONE 7-8"}, selected="Exterior Roof [R34.4]")
# Construction
list_3 = ValueList({"Exterior Wall [R5.5]": "ASHRAE 90.1-2004 EXTWALL METAL CLIMATEZONE 4", "Exterior Wall [R5.8]": "ASHRAE 90.1-2004 EXTWALL MASS CLIMATEZONE 3-4", "Exterior Wall [R7.2]": "ASHRAE 90.1-2004 EXTWALL STEELFRAME CLIMATEZONE 1-4", "Exterior Wall [R8.7]": "ASHRAE 90.1-2004 EXTWALL MASS CLIMATEZONE ALT-RES 4", "Exterior Wall [R10.4]": "ASHRAE 90.1-2004 EXTWALL WOODFRAME CLIMATEZONE 1-7", "Exterior Wall [R14.8]": "ASHRAE 90.1-2004 EXTWALL STEELFRAME CLIMATEZONE ALT-RES 4-6", "Exterior Wall [R34.4]": "ASHRAE 189.1-2009 EXTROOF IEAD CLIMATEZONE 7-8"}, selected="Exterior Wall [R34.4]")

ladybug_3 = Ladybug_Ladybug()  # -> Vviiiiiiiiiizzz; plug-in component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
run_energyplus = BooleanToggle(True)

# ---- group: Original
# run the analysis
# visualize the results
# prepare a recipe
# Generate sky
# Animate sliders
# capture the viewport to an image
number_slider_3 = Slider(0.6, range=0..1)
windows_2 = Brep([<brep referenced from the Rhino model> x2])
wall_3 = Brep(<brep referenced from the Rhino model>)
geo = Geometry(<brep referenced from the Rhino model>)
wall_4 = Brep(<brep referenced from the Rhino model>)
number_slider_4 = Slider(1, range=0..2)
number_slider_5 = Slider(2, range=0..2)
createhbsrfs_4 = Honeybee_createHBSrfs(geometry=wall_3, srfType="0")  # -> readMe, simplify(HBSurface); plug-in component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
createhbsrfs_5 = Honeybee_createHBSrfs(geometry=wall_4, srfType="1")  # -> readMe, simplify(HBSurface); plug-in component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
radglassmaterial_2 = Honeybee_RadianceGlassMaterial(
    materialName="Glass",
    RTransmittance=number_slider_3,
    GTransmittance=number_slider_3,
    BTransmittance=number_slider_3,
    refractiveIndex=1.52)  # -> avrgTrans, RADMaterial; plug-in component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
panel_3 = Panel("https://www.energyplus.net/weather-download/north_and_central_america_wmo_region_4/USA/PA/USA_PA_Philadelphia.Intl.AP.724080_TMY3/all")
hours = Panel("""9
12
15""")
months = Panel("""3
6
12""")
createhbsrfs_6 = Honeybee_createHBSrfs(geometry=windows_2, RADMaterial=radglassmaterial_2.RADMaterial)  # -> readMe, simplify(HBSurface); plug-in component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
epw_stat = Ladybug_OpenEPWAndSTATWeatherFiles(weatherFileURL=panel_3)  # -> epwFile, statFile; plug-in component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
fly = Ladybug_fly(inputSliders=[number_slider_5, number_slider_4], fly=Button())  # -> Vviiiiiiiiiizzz; plug-in component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
item = ListItem(List=hours, Index=number_slider_4, Wrap=True)
item_2 = ListItem(List=months, Index=number_slider_5, Wrap=True)
flip = Flip(Surface=geo)  # -> Surface, Result
panel_4 = Panel("""9
12
15""")
panel_5 = Panel("""3
6
12""")
brep = Brep([createhbsrfs_6.HBSurface, createhbsrfs_4.HBSurface, createhbsrfs_5.HBSurface])
vec = Vector(Vector(0, 10.33076106, 0))
importlocation = Ladybug_ImportLocation(epwFile=epw_stat.epwFile)  # -> location; plug-in component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
sunpath = Ladybug_SunPath(
    north=vec,
    location=importlocation,
    hour=panel_4,
    day=21,
    month=panel_5,
    timeStep=1,
    sunPathScale=Slider(0.2, range=0..1),
    dailyOrAnnualSunPath=True)  # -> readMe, sunVectors, sunAltitudes, sunAzimuths, port, sunSpheresMesh, sunPathCrvs, legend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; plug-in component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
genclimatebasedsky = Honeybee_GenerateClimateBasedSky(weatherFile=epw_stat.epwFile, month=item_2, day="21", hour=item)  # -> radiationValues, skyFilePath; plug-in component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
doy_hoy = Ladybug_DOY_HOY(days="21", months=item_2, hours=item)  # -> HOY, DOY, date; plug-in component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
gentestpts = Honeybee_GenerateTestPoints(
    testGeometry=flip.Surface,
    gridSize=Slider(0.5, range=0..1),
    distBaseSrf=Slider(0.762, range=-3.001..2.002),
    moveTestMesh=True)  # -> readMe, simplify(testPoints), simplify(ptsVectors), simplify(facesArea), simplify(mesh); plug-in component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
gridbasedsimulation = Honeybee_GridBasedSimulation(
    skyFile=genclimatebasedsky.skyFilePath,
    testPoints=gentestpts.testPoints,
    ptsVectors=gentestpts.ptsVectors,
    testMesh=gentestpts.mesh,
    simulationType=0)  # -> analysisRecipe; plug-in component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
toggle = BooleanToggle(False)
rundaylightanalysis = Honeybee_RunDaylightSimulation(
    HBObjects=flatten(brep),
    analysisRecipe=gridbasedsimulation,
    writeRad=toggle,
    runRad=toggle,
    numOfCPUs=6,
    overwriteResults=True)  # -> readMe, analysisType, resultsUnit, results, testPts, resultFiles, radGeoFile, studyFolder, done; plug-in component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
addition = Addition(A=rundaylightanalysis.results, B=400)
subtraction = Subtraction(A=rundaylightanalysis.results, B=1500)
# infiltration rate
panel_6 = Panel(rundaylightanalysis.results)
panel_7 = Panel(doy_hoy.date)
legendpar = Ladybug_LegendParameters(lowBound="300", highBound="2000", numSegments=7)  # -> legendPar; plug-in component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
join = TextJoin(Text=[item_2, "21", item], Join="_")
concat = Concatenate(FragmentA=rundaylightanalysis.analysisType, FragmentC=panel_7)
panel_8 = Panel(join)
panel_9 = Panel("Anual")
captureview = Ladybug_CaptureView(fileName=panel_8, capture=Toggle(True))  # -> imagePath; plug-in component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
# Blinds
recolormesh = Ladybug_RecolorMesh(
    analysisResult=rundaylightanalysis.results,
    inputMesh=gentestpts.mesh,
    legendPar=legendpar,
    analysisTitle=concat,
    legendTitle=rundaylightanalysis.resultsUnit)  # -> readMe, newMesh, newLegend, legendBasePt, meshColors, legendColors; plug-in component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
panel_10 = Panel(captureview)

# ----
# Thermal Mass
list_4 = ValueList({"Existing Slab Construction": "0", "+4 Inches Concrete": "1", "+8 Inches Concrete": "2"}, selected="+4 Inches Concrete")
pt = Point(<point referenced from the Rhino model>)
createhbsrfs_7 = Honeybee_createHBSrfs(geometry=window, srfType="5")  # -> readMe, simplify(HBSurface); plug-in component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

# ---- group: In-Class
geo_2 = Geometry(<brep referenced from the Rhino model>)
mass2zone = Honeybee_Masses2Zones(zoneMasses=flatten(geo_2), isConditioned=True, maxRoofAngle=30, createHBZones=Toggle(True))  # -> readMe, HBZones; plug-in component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
brep_2 = Brep([createhbsrfs_3.HBSurface, createhbsrfs.HBSurface, createhbsrfs_2.HBSurface])
askme = Honeybee_AskMe(HBObjects=brep_2)  # -> readMe; plug-in component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
brep_3 = Brep([brep_2, mass2zone.HBZones])
# Geometry
panel_11 = Panel("https://www.energyplus.net/weather-download/north_and_central_america_wmo_region_4/USA/PA/USA_PA_Philadelphia.Intl.AP.724080_TMY3/all")
panel_12 = Panel(askme)
wires = BrepWireframe(Brep=brep_3, Density=-1)
genhbzonetestpts = Honeybee_GenerateZoneTestPoints(
    HBZone=mass2zone.HBZones,
    gridSize=Slider(0.5, range=0..1),
    distBaseSrf=Slider(0.762, range=0..1),
    moveTestMesh=Toggle(True))  # -> readMe, simplify(testPoints), simplify(ptsVectors), simplify(facesArea), simplify(mesh); plug-in component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
epw_stat_2 = Ladybug_OpenEPWAndSTATWeatherFiles(weatherFileURL=panel_11)  # -> epwFile, statFile; plug-in component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
annualdaylightsimulation = Honeybee_AnnualDaylightSimulation(
    epwWeatherFile=epw_stat_2.epwFile,
    testPoints=genhbzonetestpts.testPoints,
    ptsVectors=genhbzonetestpts.ptsVectors,
    testMesh=genhbzonetestpts.mesh)  # -> analysisRecipe; plug-in component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
toggle_2 = BooleanToggle(False)
rundaylightanalysis_2 = Honeybee_RunDaylightSimulation(
    HBObjects=flatten(brep_3),
    analysisRecipe=annualdaylightsimulation,
    writeRad=toggle_2,
    runRad=toggle_2,
    numOfCPUs=12,
    overwriteResults=True)  # -> readMe, analysisType, resultsUnit, results, testPts, resultFiles, radGeoFile, studyFolder, done; plug-in component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
occupancygenerator = Honeybee_DaysimOccupancyGenerator(weekendDays=[1, 2], writeTheOcc=Toggle(True))  # -> occupancyFile; plug-in component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
gradientlibrary = Ladybug_GradientLibrary(gradIndex=Slider(0, range=0..10))  # -> customColors; plug-in component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
# Construction
toggle_3 = BooleanToggle(True)
number_slider_6 = Slider(300, range=0..1000)
number_slider_7 = Slider(2000, range=0..10000)
readannualresultsi = Honeybee_ReadAnnualResultI(
    illFilesAddress=rundaylightanalysis_2.resultFiles,
    testPoints=simplify(rundaylightanalysis_2.testPts),
    occupancyFiles=occupancygenerator,
    DLAIllumThresholds=300,
    runIt=toggle_3)  # -> DLA, UDLI_Less_100, UDLI_100_2000, UDLI_More_2000, CDA, sDA, annualProfiles, htmReport; plug-in component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
legendpar_2 = Ladybug_LegendParameters(
    lowBound=Slider(0, range=0..100),
    highBound=Slider(100, range=0..100),
    numSegments=Slider(10, range=0..10),
    customColors=flatten(gradientlibrary))  # -> legendPar; plug-in component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
dom = ConstructDomain(DomainStart=0, DomainEnd=Slider(1, range=0..1))
panel_13 = Panel("%")  # disabled
recolormesh_2 = Ladybug_RecolorMesh(
    analysisResult=readannualresultsi.UDLI_100_2000,
    inputMesh=genhbzonetestpts.mesh,
    heightDomain=dom,
    legendPar=legendpar_2,
    analysisTitle=rundaylightanalysis_2.analysisType,
    legendTitle=panel_13)  # -> readMe, newMesh, newLegend, legendBasePt, meshColors, legendColors; plug-in component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

# ---- group: WWR
# Wall to Window Ratio
wwr_north_2 = Slider(0.3, range=0..1)
wwr_west_2 = Slider(0.2, range=0..1)
wwr_south_2 = Slider(0, range=0..1)
wwr_east_2 = Slider(0.4, range=0..1)

# ----
honeybee_3 = Honeybee_Honeybee()  # -> Vviiiiiiiiiizzz; plug-in component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
# Rotation Angle
number_slider_8 = Slider(0, range=-90..90)

shading_depth_2 = Slider(0.5, range=0..1)
number_of_blinds_2 = Slider(3, range=0..10)
# Blinds
add_blinds_2 = BooleanToggle(False)

list_5 = ValueList({"Exterior Window [R1.0, SHGC 0.7]": "ASHRAE 90.1-2004 EXTWINDOW CLIMATEZONE ALT-WARE 1-8", "Exterior Window [R1.7, SHGC 0.39]": "ASHRAE 90.1-2004 EXTWINDOW CLIMATEZONE 4-6", "Exterior Window [R1.9, SHGC 0.39]": "ASHRAE 90.1-2004 EXTWINDOW CLIMATEZONE ALT-RES 4-6", "Exterior Window [R0.7, SHGC 0.65]": "Dbl LoE (e3=.1) Clr 3mm/13mm Arg"}, selected="Exterior Window [R1.0, SHGC 0.7]")
list_6 = ValueList({"Exterior Roof [R9.2]": "ASHRAE 90.1-2004 EXTROOF METAL CLIMATEZONE 3-4", "Exterior Roof [R14.8]": "ASHRAE 90.1-2004 EXTROOF IEAD CLIMATEZONE 1-4", "Exterior Roof [R34.4]": "ASHRAE 189.1-2009 EXTROOF IEAD CLIMATEZONE 7-8"}, selected="Exterior Roof [R9.2]")
# Construction
list_7 = ValueList({"Exterior Wall [R5.5]": "ASHRAE 90.1-2004 EXTWALL METAL CLIMATEZONE 4", "Exterior Wall [R5.8]": "ASHRAE 90.1-2004 EXTWALL MASS CLIMATEZONE 3-4", "Exterior Wall [R7.2]": "ASHRAE 90.1-2004 EXTWALL STEELFRAME CLIMATEZONE 1-4", "Exterior Wall [R8.7]": "ASHRAE 90.1-2004 EXTWALL MASS CLIMATEZONE ALT-RES 4", "Exterior Wall [R10.4]": "ASHRAE 90.1-2004 EXTWALL WOODFRAME CLIMATEZONE 1-7", "Exterior Wall [R14.8]": "ASHRAE 90.1-2004 EXTWALL STEELFRAME CLIMATEZONE ALT-RES 4-6", "Exterior Wall [R34.4]": "ASHRAE 189.1-2009 EXTROOF IEAD CLIMATEZONE 7-8"}, selected="Exterior Wall [R5.5]")

run_energyplus_2 = BooleanToggle(True)
# Thermal Mass
list_8 = ValueList({"Existing Slab Construction": "0", "+4 Inches Concrete": "1", "+8 Inches Concrete": "2"}, selected="Existing Slab Construction")
floor = Brep(<brep referenced from the Rhino model>)
createhbsrfs_8 = Honeybee_createHBSrfs(geometry=floor, srfType="2")  # -> readMe, simplify(HBSurface); plug-in component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

# ---- group: Revise
# run the analysis
# visualize the results
# prepare a recipe
# Generate sky
# Animate sliders
# capture the viewport to an image
number_slider_9 = Slider(0.6, range=0..1)
windows_3 = Brep([<brep referenced from the Rhino model> x4])
wall_5 = Brep(<brep referenced from the Rhino model>)
roof = Brep(<brep referenced from the Rhino model>)
number_slider_10 = Slider(0, range=0..2)
number_slider_11 = Slider(0, range=0..2)
createhbsrfs_9 = Honeybee_createHBSrfs(geometry=wall_5, srfType="0")  # -> readMe, simplify(HBSurface); plug-in component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
createhbsrfs_10 = Honeybee_createHBSrfs(geometry=roof, srfType="1")  # -> readMe, simplify(HBSurface); plug-in component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
radglassmaterial_3 = Honeybee_RadianceGlassMaterial(
    materialName="Glass",
    RTransmittance=number_slider_9,
    GTransmittance=number_slider_9,
    BTransmittance=number_slider_9,
    refractiveIndex=1.52)  # -> avrgTrans, RADMaterial; plug-in component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
panel_14 = Panel("https://www.energyplus.net/weather-download/north_and_central_america_wmo_region_4/USA/PA/USA_PA_Philadelphia.Intl.AP.724080_TMY3/all")
hours_2 = Panel("""9
12
15""")
months_2 = Panel("""3
6
12""")
createhbsrfs_11 = Honeybee_createHBSrfs(geometry=windows_3, srfType=5, RADMaterial=radglassmaterial_3.RADMaterial)  # -> readMe, simplify(HBSurface); plug-in component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
epw_stat_3 = Ladybug_OpenEPWAndSTATWeatherFiles(weatherFileURL=panel_14)  # -> epwFile, statFile; plug-in component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
fly_2 = Ladybug_fly(inputSliders=[number_slider_10, number_slider_11], fly=Button())  # -> Vviiiiiiiiiizzz; plug-in component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
item_3 = ListItem(List=hours_2, Index=number_slider_11, Wrap=True)
item_4 = ListItem(List=months_2, Index=number_slider_10, Wrap=True)
geo_3 = Geometry(<brep referenced from the Rhino model>)
flip_2 = Flip(Surface=geo_3)  # -> Surface, Result
brep_4 = Brep([createhbsrfs_9.HBSurface, createhbsrfs_10.HBSurface, createhbsrfs_11.HBSurface, createhbsrfs_7.HBSurface, createhbsrfs_8.HBSurface])
genclimatebasedsky_2 = Honeybee_GenerateClimateBasedSky(weatherFile=epw_stat_3.epwFile, month=item_4, day="21", hour=item_3)  # -> radiationValues, skyFilePath; plug-in component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
doy_hoy_2 = Ladybug_DOY_HOY(days="21", months=item_4, hours=item_3)  # -> HOY, DOY, date; plug-in component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
gentestpts_2 = Honeybee_GenerateTestPoints(
    testGeometry=flip_2.Surface,
    gridSize=Slider(0.5, range=0..1),
    distBaseSrf=Slider(0.762, range=-3.001..2.002),
    moveTestMesh=True)  # -> readMe, simplify(testPoints), simplify(ptsVectors), simplify(facesArea), simplify(mesh); plug-in component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
gridbasedsimulation_2 = Honeybee_GridBasedSimulation(
    skyFile=genclimatebasedsky_2.skyFilePath,
    testPoints=gentestpts_2.testPoints,
    ptsVectors=gentestpts_2.ptsVectors,
    testMesh=gentestpts_2.mesh,
    simulationType=0)  # -> analysisRecipe; plug-in component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
toggle_4 = BooleanToggle(False)
rundaylightanalysis_3 = Honeybee_RunDaylightSimulation(
    HBObjects=flatten(brep_4),
    analysisRecipe=gridbasedsimulation_2,
    writeRad=toggle_4,
    runRad=toggle_4,
    numOfCPUs=4,
    overwriteResults=True)  # -> readMe, analysisType, resultsUnit, results, testPts, resultFiles, radGeoFile, studyFolder, done; plug-in component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
addition_2 = Addition(A=rundaylightanalysis_3.results, B=400)
subtraction_2 = Subtraction(A=rundaylightanalysis_3.results, B=1700)
# Revised Model
# March 21 12:00
# 13500+LUX
# Really?!
# 
# It should work but I have no idea why is that.
panel_15 = Panel(rundaylightanalysis_3.results)
panel_16 = Panel(doy_hoy_2.date)
legendpar_3 = Ladybug_LegendParameters(lowBound="300", highBound="2000", numSegments=7)  # -> legendPar; plug-in component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
join_2 = TextJoin(Text=[item_4, "21", item_3], Join="_")
concat_2 = Concatenate(FragmentA=rundaylightanalysis_3.analysisType, FragmentC=panel_16)
panel_17 = Panel(join_2)
captureview_2 = Ladybug_CaptureView(fileName=panel_17, capture=Toggle(False))  # -> imagePath; plug-in component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
recolormesh_3 = Ladybug_RecolorMesh(
    analysisResult=rundaylightanalysis_3.results,
    inputMesh=gentestpts_2.mesh,
    legendPar=legendpar_3,
    analysisTitle=concat_2,
    legendTitle=rundaylightanalysis_3.resultsUnit)  # -> readMe, newMesh, newLegend, legendBasePt, meshColors, legendColors; plug-in component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
panel_19 = Panel(captureview_2)

# ----
my_room = Brep(<brep referenced from the Rhino model>)
box = DomainBox(Base=PlaneXY(0, 0, 0), X=Domain(0, 5), Y=Domain(0, 12), Z=Domain(0, 4.2))
mass2zone_2 = Honeybee_Masses2Zones(zoneMasses=flatten(my_room), isConditioned=Toggle(False), maxRoofAngle=30, createHBZones=Toggle(True))  # -> readMe, HBZones; plug-in component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
panel_20 = Panel("""Initial Ratio
0.1
0
0
0.1""")
brep_5 = Brep(flatten(<brep referenced from the Rhino model>))
glzparamlist = Honeybee_GlazingParametersList(
    northGlzParam=Slider(0, range=0..1),
    westGlzParam=wwr_west,
    southGlzParam=Slider(0, range=0..1),
    eastGlzParam=Slider(0, range=0..1))  # -> glzParamList; plug-in component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
my_apt = Brep(<brep referenced from the Rhino model>)
glzparamlist_2 = Honeybee_GlazingParametersList(northGlzParam=wwr_north_2, westGlzParam=wwr_west_2, southGlzParam=wwr_south_2, eastGlzParam=wwr_east_2)  # -> glzParamList; plug-in component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
mass2zone_3 = Honeybee_Masses2Zones(zoneMasses=flatten(brep_5), isConditioned=Toggle(False), maxRoofAngle=30, createHBZones=Toggle(True))  # -> readMe, HBZones; plug-in component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
# Geometry
toggle_5 = BooleanToggle(True)
# Add glazing based on percentage
# In case you want to add custom windows
# use Honeybee_addHBGlz component.
toggle_6 = BooleanToggle(False)

callfromepconstrlibrary = Honeybee_CallFromEPConstructionLibrary(keywords="floor")  # -> ThermMaterials, EPMaterials, EPWindowMaterials, EPConstructions; plug-in component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
item_5 = ListItem(List=callfromepconstrlibrary.EPConstructions, Index=Slider(0, range=0..100), Wrap=True)
decomposeepconstruction = Honeybee_DecomposeEPConstruction(cnstrName=item_5)  # -> flatten(materials), comments, UValue_SI, UValue_IP, RValue_SI, RValue_IP; plug-in component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

callfromepconstrlibrary_2 = Honeybee_CallFromEPConstructionLibrary(keywords="slab")  # -> ThermMaterials, EPMaterials, EPWindowMaterials, EPConstructions; plug-in component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
item_6 = ListItem(List=callfromepconstrlibrary_2.EPConstructions, Index="2", Wrap=True)
decomposeepconstruction_2 = Honeybee_DecomposeEPConstruction(cnstrName=item_6)  # -> flatten(materials), comments, UValue_SI, UValue_IP, RValue_SI, RValue_IP; plug-in component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

glazingcreator = Honeybee_GlazingBasedOnRatio(HBObjects=mass2zone_2.HBZones, glzRatio=glzparamlist, breakUpDist=toggle_5, runIt=Toggle(True))  # -> readMe, HBObjWGLZ; plug-in component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

callfromepconstrlibrary_3 = Honeybee_CallFromEPConstructionLibrary(keywords="floor")  # -> ThermMaterials, EPMaterials, EPWindowMaterials, EPConstructions; plug-in component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
item_7 = ListItem(List=callfromepconstrlibrary_3.EPConstructions, Index=Slider(0, range=0..100), Wrap=True)
decomposeepconstruction_3 = Honeybee_DecomposeEPConstruction(cnstrName=item_7)  # -> flatten(materials), comments, UValue_SI, UValue_IP, RValue_SI, RValue_IP; plug-in component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

callfromepconstrlibrary_4 = Honeybee_CallFromEPConstructionLibrary(keywords="slab")  # -> ThermMaterials, EPMaterials, EPWindowMaterials, EPConstructions; plug-in component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
item_8 = ListItem(List=callfromepconstrlibrary_4.EPConstructions, Index="2", Wrap=True)
decomposeepconstruction_4 = Honeybee_DecomposeEPConstruction(cnstrName=item_8)  # -> flatten(materials), comments, UValue_SI, UValue_IP, RValue_SI, RValue_IP; plug-in component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

glazingcreator_2 = Honeybee_GlazingBasedOnRatio(
    HBObjects=mass2zone_3.HBZones,
    glzRatio=glzparamlist_2,
    breakUpWindow=Toggle(False),
    breakUpDist=Toggle(True),
    runIt=Toggle(True))  # -> readMe, HBObjWGLZ; plug-in component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
volume = Volume(Geometry=glazingcreator.HBObjWGLZ)  # -> Volume, Centroid
rotatehbobj = Honeybee_RotateHoneybee(HBObj=glazingcreator.HBObjWGLZ, angle=Slider(90, range=0..360), cenPt=volume.Centroid)  # -> HBObj; plug-in component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
volume_2 = Volume(Geometry=glazingcreator_2.HBObjWGLZ)  # -> Volume, Centroid
wires_2 = BrepWireframe(Brep=rotatehbobj, Density=-1)
rotatehbobj_2 = Honeybee_RotateHoneybee(HBObj=glazingcreator_2.HBObjWGLZ, angle=number_slider_8, cenPt=volume_2.Centroid)  # -> HBObj; plug-in component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
# Create ground in front of the room
# for more accurate analysis
my_ground_in_front_of_my_apartment = Surface(<surface referenced from the Rhino model>)

panel_22 = Panel("""MAT-CC05 4 HW CONCRETE
MAT-CC05 8 HW CONCRETE""")
panel_23 = Panel(decomposeepconstruction.materials)
item_9 = ListItem(List=decomposeepconstruction.materials, Index=0, Wrap=True)  # -> Item, Item1
item_10 = ListItem(List=panel_22, Index=0, Wrap=True)  # -> Item, Item1
panel_24 = Panel(item_5)
epconstruction = Honeybee_EnergyPlusConstruction(name="floor_cnstr_2", layer_1=item_9.Item, layer_2=item_9.Item1, layer_3=item_10.Item1)  # -> EPConstruction; plug-in component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
epconstruction_2 = Honeybee_EnergyPlusConstruction(name="floor_cnstr_1", layer_1=item_9.Item, layer_2=item_9.Item1, layer_3=item_10.Item)  # -> EPConstruction; plug-in component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

wires_3 = BrepWireframe(Brep=rotatehbobj_2, Density=-1)
createhbsrfs_12 = Honeybee_createHBSrfs(geometry=my_ground_in_front_of_my_apartment)  # -> readMe, simplify(HBSurface); plug-in component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

panel_25 = Panel("""MAT-CC05 4 HW CONCRETE
MAT-CC05 8 HW CONCRETE""")
panel_26 = Panel(decomposeepconstruction_3.materials)
item_11 = ListItem(List=decomposeepconstruction_3.materials, Index=0, Wrap=True)  # -> Item, Item1
item_12 = ListItem(List=panel_25, Index=0, Wrap=True)  # -> Item, Item1
panel_27 = Panel(item_7)
epconstruction_3 = Honeybee_EnergyPlusConstruction(name="floor_cnstr_2", layer_1=item_11.Item, layer_2=item_11.Item1, layer_3=item_12.Item1)  # -> EPConstruction; plug-in component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
epconstruction_4 = Honeybee_EnergyPlusConstruction(name="floor_cnstr_1", layer_1=item_11.Item, layer_2=item_11.Item1, layer_3=item_12.Item)  # -> EPConstruction; plug-in component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

panel_28 = Panel("""Construction,
    Dbl LoE (e3=.1) Clr 3mm/13mm Arg,  !- Name
    CLEAR 3MM,               !- Outside Layer
    ARGON 13MM,              !- Layer 2
    LoE CLEAR 3MM Rev;       !- Layer 3""")
panel_29 = Panel("""WindowMaterial:Gas,
    ARGON 13MM,               !- Name
    Argon,                   !- Gas Type
    0.0127;                  !- Thickness {m}""")
panel_30 = Panel("""WindowMaterial:Glazing,
    LoE CLEAR 3MM Rev,       !- Name
    SpectralAverage,         !- Optical Data Type
    ,                        !- Window Glass Spectral Data Set Name
    0.003,                   !- Thickness {m}
    0.630,                   !- Solar Transmittance at Normal Incidence
    0.220,                   !- Front Side Solar Reflectance at Normal Incidence
    0.190,                   !- Back Side Solar Reflectance at Normal Incidence
    0.850,                   !- Visible Transmittance at Normal Incidence
    0.079,                   !- Front Side Visible Reflectance at Normal Incidence
    0.056,                   !- Back Side Visible Reflectance at Normal Incidence
    0.0,                     !- Infrared Transmittance at Normal Incidence
    0.10,                    !- Front Side Infrared Hemispherical Emissivity
    0.84,                    !- Back Side Infrared Hemispherical Emissivity
    0.9;                     !- Conductivity {W/m-K}""")
toggle_7 = BooleanToggle(True)
addtoeplibrary = Honeybee_AddToEnergyPlusLibrary(EPObject=[panel_28, panel_29, panel_30], addToProjectLib=toggle_7, overwrite=toggle_7)  # -> readMe; plug-in component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

filter = StreamFilter(Gate=list_4, Stream0=panel_24, Stream1=epconstruction_2, Stream2=epconstruction)
# Construction
setepzonecnstr = Honeybee_SetEPZoneConstruction(HBZone=rotatehbobj, wallEPConstruction=list_3, windowEPConstruction=list, roofEPConstruction=list_2)  # -> simplify(modifiedHBZone); plug-in component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

panel_31 = Panel("""Construction,
    Dbl LoE (e3=.1) Clr 3mm/13mm Arg,  !- Name
    CLEAR 3MM,               !- Outside Layer
    ARGON 13MM,              !- Layer 2
    LoE CLEAR 3MM Rev;       !- Layer 3""")
panel_32 = Panel("""WindowMaterial:Gas,
    ARGON 13MM,               !- Name
    Argon,                   !- Gas Type
    0.0127;                  !- Thickness {m}""")
panel_33 = Panel("""WindowMaterial:Glazing,
    LoE CLEAR 3MM Rev,       !- Name
    SpectralAverage,         !- Optical Data Type
    ,                        !- Window Glass Spectral Data Set Name
    0.003,                   !- Thickness {m}
    0.630,                   !- Solar Transmittance at Normal Incidence
    0.220,                   !- Front Side Solar Reflectance at Normal Incidence
    0.190,                   !- Back Side Solar Reflectance at Normal Incidence
    0.850,                   !- Visible Transmittance at Normal Incidence
    0.079,                   !- Front Side Visible Reflectance at Normal Incidence
    0.056,                   !- Back Side Visible Reflectance at Normal Incidence
    0.0,                     !- Infrared Transmittance at Normal Incidence
    0.10,                    !- Front Side Infrared Hemispherical Emissivity
    0.84,                    !- Back Side Infrared Hemispherical Emissivity
    0.9;                     !- Conductivity {W/m-K}""")
toggle_8 = BooleanToggle(True)
addtoeplibrary_2 = Honeybee_AddToEnergyPlusLibrary(EPObject=[panel_31, panel_32, panel_33], addToProjectLib=toggle_8, overwrite=toggle_8)  # -> readMe; plug-in component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

filter_2 = StreamFilter(Gate=list_8, Stream0=panel_27, Stream1=epconstruction_4, Stream2=epconstruction_3)
setepzonecnstr_2 = Honeybee_SetEPZoneConstruction(HBZone=rotatehbobj_2, wallEPConstruction=list_7, windowEPConstruction=list_5, roofEPConstruction=list_6)  # -> simplify(modifiedHBZone); plug-in component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
setepzoneundergroundcnstr = Honeybee_SetEPZoneUndergroundConstruction(HBZone=flatten(setepzonecnstr), groundFloorEPConstruction=filter)  # -> simplify(modifiedHBZone); plug-in component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
setepzoneundergroundcnstr_2 = Honeybee_SetEPZoneUndergroundConstruction(HBZone=flatten(setepzonecnstr_2), groundFloorEPConstruction=filter_2)  # -> simplify(modifiedHBZone); plug-in component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

# ----
# Radiation
panel_34 = Panel("http://apps1.eere.energy.gov/buildings/energyplus/weatherdata/4_north_and_central_america_wmo_region_4/1_usa/USA_NY_New.York-J.F.Kennedy.Intl.AP.744860_TMY3.zip")
epw_stat_4 = Ladybug_OpenEPWAndSTATWeatherFiles(weatherFileURL=panel_34)  # -> epwFile, statFile; plug-in component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
importepw = Ladybug_ImportEpw(epwFile=epw_stat_4.epwFile)  # -> readMe, latitude, location, dryBulbTemperature, dewPointTemperature, relativeHumidity, windSpeed, windDirection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; plug-in component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

decomposebytype = Honeybee_DecomposeBasedOnType(HBZone=setepzoneundergroundcnstr)  # -> walls, interiorWalls, airWalls, windows, interiorWindows, skylights, roofs, ceilings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; plug-in component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
# Blinds
shddesigner = Ladybug_ShadingDesigner(
    glzSrf=flatten(decomposebytype.windows),
    depthOrVector=flatten(shading_depth),
    numOfShds=number_of_blinds,
    runIt=add_blinds,
    port_4=False)  # -> readMe, shadingSrfs; plug-in component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
wires_4 = BrepWireframe(Brep=shddesigner.shadingSrfs, Density=-1)
hb_epcontextsrf = HoneybeeEPContextSurfaces(shdSurfaces=flatten(shddesigner.shadingSrfs))  # -> HBContext; inputs shdSurfaces: list of Brep, justBoundingBox: Boolean
# ---------- hb_epcontextsrf: Python ----------
"""
prepare shading/context geometries

    Args:
        northVectorOrRotation: A vector that shows North or a number that shows
                               the rotation of the North from the Y axis
        bldgMasses: List of closed Breps as thermal zones.
    Returns:
        report: ...
        thermalZones: Thermal zone's geometries for visualiza
"""

ghenv.Component.Name = 'Honeybee EP context Surfaces'
ghenv.Component.NickName = 'HB_EPContextSrf'
ghenv.Component.Message = 'VER 0.0.59\nJAN_26_2016'
ghenv.Component.IconDisplayMode = ghenv.Component.IconDisplayMode.application
ghenv.Component.Category = "Honeybee"
ghenv.Component.SubCategory = "09 | Energy | Energy"
#compatibleHBVersion = VER 0.0.57\nNOV_01_2015
#compatibleLBVersion = VER 0.0.59\nFEB_01_2015
ghenv.Component.AdditionalHelpFromDocStrings = "2"

import rhinoscriptsyntax as rs
import Rhino as rc
import scriptcontext as sc
import os
import System
import Grasshopper.Kernel as gh
import uuid

tolerance = sc.doc.ModelAbsoluteTolerance
import math


def main(shdSurfaces, EPTransSchedule, meshingSettings, justBoundingBox):
    
    # import the classes
    if sc.sticky.has_key('honeybee_release'):

        try:
            if not sc.sticky['honeybee_release'].isCompatible(ghenv.Component): return -1
            if sc.sticky['honeybee_release'].isInputMissing(ghenv.Component): return -1
        except:
            warning = "You need a newer version of Honeybee to use this compoent." + \
            " Use updateHoneybee component to update userObjects.\n" + \
            "If you have already updated userObjects drag Honeybee_Honeybee component " + \
            "into canvas and try again."
            w = gh.GH_RuntimeMessageLevel.Warning
            ghenv.Component.AddRuntimeMessage(w, warning)
            return -1
        
        # don't customize this part
        hb_EPSrf = sc.sticky["honeybee_EPSurface"]
        hb_EPSHDSurface = sc.sticky["honeybee_EPShdSurface"]
        hb_RADMaterialAUX = sc.sticky["honeybee_RADMaterialAUX"]
        hb_EPObjectsAux = sc.sticky["honeybee_EPObjectsAUX"]()
        HBScheduleList = sc.sticky["honeybee_ScheduleLib"].keys()

        ########################################################################
        #----------------------------------------------------------------------#
        shdBreps = []
        # create bounding box of shading geometries
        if justBoundingBox:
            for brep in shdSurfaces:
                if brep.Faces.Count>1 or not brep.Faces[0].IsPlanar(sc.doc.ModelAbsoluteTolerance):
                    shdBreps.append(brep.GetBoundingBox(True).ToBrep())
                else:
                    shdBreps.append(brep)
        else:
            shdBreps = shdSurfaces
        
        shadingClasses = []
        shadingMeshPreview = []
        
        if meshingSettings == None:
            mp = rc.Geometry.MeshingParameters.Minimal
            mp.SimplePlanes = True
        else:
            mp = meshingSettings
        
        def getRadMaterialName(radMaterial):
            nameStr = radMaterial.split(" ")[2]
            name =  nameStr.split("\n")[0]
            return name
        
        for brepCount, brep in enumerate(shdBreps):
            if brep != None:
                isPlanar = True
                # check planarity
                for face in brep.Faces:
                    if not face.IsPlanar(tolerance):
                        isPlanar = False
                        break
                
                shadingBreps = []
                if not isPlanar:
                    meshArray = rc.Geometry.Mesh.CreateFromBrep(brep, mp)
                    for mesh in meshArray:
                        for meshFace in range(mesh.Faces.Count):
                            vertices = list(mesh.Faces.GetFaceVertices(meshFace))[1:]
                            vertices = vertices + [sc.doc.ModelAbsoluteTolerance]
                            # create the brep from mesh
                            shdBrep = rc.Geometry.Brep.CreateFromCornerPoints(*vertices)
                            shadingBreps.append(shdBrep)
                else:
                    for face in brep.Faces:
                        shadingBreps.append(face.DuplicateFace(False))
                
                for faceCount, shdBrep in enumerate(shadingBreps):
                        thisShading = hb_EPSHDSurface(shdBrep, 1000*brepCount + faceCount, 'shdSrf_' + `brepCount` + '_' + `faceCount` + "_" + str(uuid.uuid4()))
                        
                        # add transmittance schedule if any
                        if EPTransSchedule!=None:
                            schedule= EPTransSchedule.upper()
                            if schedule!=None and not schedule.lower().endswith(".csv") and schedule not in HBScheduleList:
                                msg = "Cannot find " + schedule + " in Honeybee schedule library."
                                print msg
                                ghenv.Component.AddRuntimeMessage(gh.GH_RuntimeMessageLevel.Warning, msg)
                                return -1
                            elif schedule!=None and schedule.lower().endswith(".csv"):
                                # check if csv file is existed
                                if not os.path.isfile(schedule):
                                    msg = "Cannot find the shchedule file: " + schedule
                                    print msg
                                    ghenv.Component.AddRuntimeMessage(gh.GH_RuntimeMessageLevel.Warning, msg)
                                    return -1
                            
                            thisShading.TransmittanceSCH = schedule
                        
                        # add the Rad Material if any
                        if RADMaterial!=None:
                            # if it is just the name of the material make sure it is already defined
                            if len(RADMaterial.split(" ")) == 1:
                                # if the material is not in the library add it to the library
                                if not hb_RADMaterialAUX.isMatrialExistInLibrary(RADMaterial):
                                    warningMsg = "Can't find " + RADMaterial + " in RAD Material Library.\n" + \
                                                "Add the material to the library and try again."
                                    ghenv.Component.AddRuntimeMessage(gh.GH_RuntimeMessageLevel.Warning, warningMsg)
                                    return
                                
                                try:
                                    thisShading.setRADMaterial(RADMaterial)
                                except Exception, e:
                                    print e
                                    warningMsg = "You are using an old version of Honeybee_Honeybee! Update your files and try again."
                                    print warningMsg
                                    ghenv.Component.AddRuntimeMessage(gh.GH_RuntimeMessageLevel.Warning, warningMsg)
                                    return
                                
                                addedToLib = True
                            else:
                                
                                # try to add the material to the library
                                addedToLib, thisShading.RadMaterial = hb_RADMaterialAUX.analyseRadMaterials(RADMaterial, True)
                                
                            if addedToLib==False:
                                warningMsg = "Failed to add " + RADMaterial + " to the Library."
                                ghenv.Component.AddRuntimeMessage(gh.GH_RuntimeMessageLevel.Warning, warningMsg)
                                return
                        
                        # add shading to the list
                        shadingClasses.append(thisShading)
                
        # add to the hive
        hb_hive = sc.sticky["honeybee_Hive"]()
        HBContext  = hb_hive.addToHoneybeeHive(shadingClasses, ghenv.Component.InstanceGuid.ToString())
        return HBContext
        ################################################################################################
    else:
        print "You should first let Honeybee to fly..."
        w = gh.GH_RuntimeMessageLevel.Warning
        ghenv.Component.AddRuntimeMessage(w, "You should first let Honeybee to fly...")
        return -1
        

if _shdSurfaces and _shdSurfaces[0]!=None:
    # add cleaning function
    result= main(_shdSurfaces, EPTransSchedule_, meshingSettings_, justBoundingBox_)
    
    if result != -1: HBContext = result
# ---------- end hb_epcontextsrf ----------
preview = CustomPreview(Geometry=wires_4, Shader=ColourSwatch(SwatchColor=RGBA(0, 0, 0, 194)))

# ----
# infiltration rate
ach2m3_s_m2_calculator = HoneybeeInfORventPerAreaCalculator(HBZones=flatten(setepzoneundergroundcnstr), airChangeHour=Slider(4.5, range=0..10))  # -> out, infORventPerArea, allFloors; plug-in component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
setepzoneloads = Honeybee_SetEnergyPlusZoneLoads(HBZones=flatten(setepzoneundergroundcnstr), infiltrationRatePerArea=ach2m3_s_m2_calculator.infORventPerArea)  # -> loads, HBZones; plug-in component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

decomposebytype_2 = Honeybee_DecomposeBasedOnType(HBZone=setepzoneundergroundcnstr_2)  # -> walls, interiorWalls, airWalls, windows, interiorWindows, skylights, roofs, ceilings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; plug-in component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
shddesigner_2 = Ladybug_ShadingDesigner(
    glzSrf=flatten(decomposebytype_2.windows),
    depthOrVector=flatten(shading_depth_2),
    numOfShds=number_of_blinds_2,
    runIt=add_blinds_2,
    port_4=False)  # -> readMe, shadingSrfs; plug-in component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
wires_5 = BrepWireframe(Brep=shddesigner_2.shadingSrfs, Density=-1)
hb_epcontextsrf_2 = HoneybeeEPContextSurfaces(shdSurfaces=flatten(shddesigner_2.shadingSrfs))  # -> HBContext; inputs shdSurfaces: list of Brep, justBoundingBox: Boolean; same code as hb_epcontextsrf
preview_2 = CustomPreview(Geometry=wires_5, Shader=ColourSwatch(SwatchColor=RGBA(0, 0, 0, 194)))

ach2m3_s_m2_calculator_2 = HoneybeeInfORventPerAreaCalculator(HBZones=flatten(setepzoneundergroundcnstr_2), airChangeHour=Slider(2, range=0..10))  # -> out, infORventPerArea, allFloors; plug-in component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
setepzoneloads_2 = Honeybee_SetEnergyPlusZoneLoads(HBZones=flatten(setepzoneundergroundcnstr_2), infiltrationRatePerArea=ach2m3_s_m2_calculator_2.infORventPerArea)  # -> loads, HBZones; plug-in component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

# ----
# 4
# 3
analysisperiod = Ladybug_AnalysisPeriod()  # -> readMe, analysisPeriod; plug-in component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
pt_2 = Point(Point(35.26425865, 24.32257932, 0))
solaradjusttemperature = Ladybug_OutdoorSolarTemperatureAdjustor(
    location=importepw.location,
    cumSkyMtxOrDirNormRad=importepw.directNormalRadiation,
    diffuseHorizRad=importepw.diffuseHorizontalRadiation,
    baseTemperature=importepw.dryBulbTemperature,
    horizInfraredRad=importepw.horizontalInfraredRadiation,
    bodyPosture=Slider(1, range=0..2),
    rotationAngle=Slider(70, range=0..180),
    bodyLocation=pt_2,
    analysisPeriodOrHOY=analysisperiod.analysisPeriod,
    runIt=Toggle(False))  # -> readMe, port, effectiveRadiantField, MRTDelta, solarAdjustedMRT, port_2, mannequinMesh, port_3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; plug-in component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
outdoorcomfortcalculator = Ladybug_OutdoorComfortCalculator(
    dryBulbTemperature=importepw.dryBulbTemperature,
    meanRadiantTemperature=solaradjusttemperature.solarAdjustedMRT,
    windSpeed_tenMeters=importepw.windSpeed,
    relativeHumidity=importepw.relativeHumidity,
    runIt=Toggle(False))  # -> readMe, port, universalThermalClimateIndex, comfortableOrNot, conditionOfPerson, port_2, percentOfTimeComfortable, percentComfForShortPeriod, percentHeatStress, percentColdStress; plug-in component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

# ----
# Calculate Comfort in Shade
# Import EPW Data
# Run Detailed Solar-Adjusted MRT for an Hour
# Compare Comfort in Sun vs. Shade
# Run Simplified Solar-Adjusted MRT + Comfort for a Year
toggle_9 = BooleanToggle(False)
outdoorcomfortcalculator_2 = Ladybug_OutdoorComfortCalculator(
    dryBulbTemperature=importepw.dryBulbTemperature,
    windSpeed_tenMeters=importepw.windSpeed,
    relativeHumidity=importepw.relativeHumidity,
    runIt=toggle_9)  # -> readMe, port, universalThermalClimateIndex, comfortableOrNot, thermalStress, conditionOfPerson, port_2, percentOfTimeComfortable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; plug-in component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
doy_hoy_3 = Ladybug_DOY_HOY(days=Slider(21, range=1..31), months=Slider(12, range=1..12), hours=Slider(10, range=1..24))  # -> HOY, DOY, date; plug-in component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

toggle_10 = BooleanToggle(True)
panel_35 = Panel("https://www.energyplus.net/weather-download/north_and_central_america_wmo_region_4/USA/PA/USA_PA_Philadelphia.Intl.AP.724080_TMY3/all")
epoutput = Honeybee_GenerateEPOutput(zoneGainsAndLosses=toggle_10, zoneComfortMetrics=toggle_10, surfaceTempAnalysis="False")  # -> report, flatten(simulationOutputs); plug-in component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
epw_stat_5 = Ladybug_OpenEPWAndSTATWeatherFiles(weatherFileURL=panel_35)  # -> epwFile, statFile; plug-in component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
toggle_11 = BooleanToggle(True)
panel_36 = Panel("https://www.energyplus.net/weather-download/north_and_central_america_wmo_region_4/USA/PA/USA_PA_Philadelphia.Intl.AP.724080_TMY3/all")
rep = ReplaceText(Text="base_case", Find=" ", Replace="_", RecursiveReplace=False)
epoutput_2 = Honeybee_GenerateEPOutput(zoneGainsAndLosses=toggle_11, zoneComfortMetrics=toggle_11, surfaceTempAnalysis="False")  # -> report, flatten(simulationOutputs); plug-in component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
epw_stat_6 = Ladybug_OpenEPWAndSTATWeatherFiles(weatherFileURL=panel_36)  # -> epwFile, statFile; plug-in component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
rep_2 = ReplaceText(Text="base_case", Find=" ", Replace="_", RecursiveReplace=False)
runenergysimulation = Honeybee_RunEnergySimulation(
    epwFile=epw_stat_5.epwFile,
    HBZones=flatten(setepzoneloads.HBZones),
    HBContext=flatten(hb_epcontextsrf),
    simulationOutputs=flatten(epoutput.simulationOutputs),
    writeIdf=run_energyplus,
    runEnergyPlus=run_energyplus,
    idfFileName=rep)  # -> report, idfFileAddress, resultFileAddress; plug-in component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
path = FilePath(epw_stat_6.epwFile)

# ----
# 1
# 2
toggle_12 = BooleanToggle(False)
gencumulativeskymtx = Ladybug_GenCumulativeSkyMtx(epwFile=epw_stat_4.epwFile, skyDensity=0, useOldRes=True, runIt=toggle_12)  # -> readMe, cumulativeSkyMtx; plug-in component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
pt_3 = Point(Point(35.26425865, 24.32257932, 0))
solaradjusttemperature_2 = Ladybug_OutdoorSolarTemperatureAdjustor(
    location=importepw.location,
    cumSkyMtxOrDirNormRad=gencumulativeskymtx.cumulativeSkyMtx,
    baseTemperature=importepw.dryBulbTemperature,
    horizInfraredRad=importepw.relativeHumidity,
    bodyPosture=Slider(1, range=0..2),
    rotationAngle=Slider(70, range=0..180),
    bodyLocation=pt_3,
    analysisPeriodOrHOY=doy_hoy_3.HOY,
    runIt=Toggle(False))  # -> readMe, port, effectiveRadiantField, MRTDelta, solarAdjustedMRT, port_2, mannequinMesh, legend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; plug-in component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

runenergysimulation_2 = Honeybee_RunEnergySimulation(
    epwFile=path,
    HBZones=flatten(setepzoneloads_2.HBZones),
    HBContext=flatten(hb_epcontextsrf_2),
    simulationOutputs=flatten(epoutput_2.simulationOutputs),
    writeIdf=run_energyplus_2,
    runEnergyPlus=run_energyplus_2,
    idfFileName=rep_2)  # -> report, idfFileAddress, resultFileAddress; plug-in component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
panel_37 = Panel(runenergysimulation.resultFileAddress)

pt_4 = Point(Point(88.47226712, 166.2122937, 0))
_3dchart = Ladybug_3DChart(
    inputData=flatten([outdoorcomfortcalculator_2.conditionOfPerson, outdoorcomfortcalculator.conditionOfPerson]),
    basePoint=pt_4,
    xScale="0.25",
    zScale="0")  # -> readMe, graphMesh, graphCurves, legend, legendBasePts, titleText, titleBasePts, conditionalHOY; plug-in component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
preview_3 = CustomPreview(Geometry=[_3dchart.graphCurves, _3dchart.legend], Shader=ColourSwatch(SwatchColor=RGB(0, 0, 0)))

readepresult = Honeybee_ReadEPResult(resultFileAddress=runenergysimulation.resultFileAddress)  # -> port, port_2, port_3, port_4, port_5, port_6, port_7, port_8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; plug-in component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
importepw_2 = Ladybug_ImportEpw(epwFile=epw_stat_5.epwFile)  # -> readMe, latitude, location, dryBulbTemperature, dewPointTemperature, relativeHumidity, windSpeed, windDirection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; plug-in component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
panel_38 = Panel(runenergysimulation_2.resultFileAddress)
readepresult_2 = Honeybee_ReadEPResult(resultFileAddress=runenergysimulation_2.resultFileAddress)  # -> port, port_2, port_3, port_4, port_5, port_6, port_7, port_8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; plug-in component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
importepw_3 = Ladybug_ImportEpw(epwFile=path)  # -> readMe, latitude, location, dryBulbTemperature, dewPointTemperature, relativeHumidity, windSpeed, windDirection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; plug-in component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
adaptivecomfortcalculator = Ladybug_AdaptiveComfortCalculator(
    dryBulbTemperature=readepresult.airTemperature,
    meanRadiantTemperature=readepresult.meanRadTemperature,
    prevailingOutdoorTemp=importepw_2.dryBulbTemperature,
    runIt=Toggle(True))  # -> readMe, port, comfortableOrNot, conditionOfPerson, degreesFromTarget, port_2, targetTemperature, upperTemperatureBound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; plug-in component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
adaptivecomfortcalculator_2 = Ladybug_AdaptiveComfortCalculator(
    dryBulbTemperature=readepresult_2.airTemperature,
    meanRadiantTemperature=readepresult_2.meanRadTemperature,
    prevailingOutdoorTemp=importepw_3.dryBulbTemperature,
    runIt=Toggle(True))  # -> readMe, port, comfortableOrNot, conditionOfPerson, degreesFromTarget, port_2, targetTemperature, upperTemperatureBound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; plug-in component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
legendpar_4 = Ladybug_LegendParameters(lowBound="-1", highBound="1", numSegments="3")  # -> legendPar; plug-in component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
vec_2 = VectorXYZ(XComponent="20", YComponent="35", ZComponent=0)  # -> Vector, Length
pt_5 = Point(Point(23.10617158, 0, 0))
legendpar_5 = Ladybug_LegendParameters(lowBound="-1", highBound="1", numSegments="3")  # -> legendPar; plug-in component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
move = Move(Geometry=pt_5, Motion=vec_2.Vector)  # -> Geometry, Transform
vec_3 = VectorXYZ(XComponent="20", YComponent="35", ZComponent=0)  # -> Vector, Length
pt_6 = Point(Point(23.10617158, 0, 0))
panel_39 = Panel("""Comfortable (%): 
hot (%):         
cold (%):        """)
comfortable_hot_cold = Panel([adaptivecomfortcalculator.percentOfTimeComfortable, adaptivecomfortcalculator.percentHotCold])
psychchart = Ladybug_PsychrometricChart(
    dryBulbTemperature=readepresult.airTemperature,
    relativeHumidity=readepresult.relativeHumidity,
    basePoint=move.Geometry,
    runIt=Toggle(True))  # -> readMe, port, totalComfortPercent, totalComfortOrNot, strategyNames, strategyPercentOfTime, strategyOrNot, port_2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; plug-in component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
_3dchart_2 = Ladybug_3DChart(
    inputData=flatten(adaptivecomfortcalculator.conditionOfPerson),
    basePoint=pt_5,
    xScale=".025",
    yScale="0.125",
    zScale=Slider(0, range=0..100),
    legendPar=legendpar_4)  # -> readMe, graphMesh, graphCurves, legend, legendBasePts, title, titleBasePts, dataPts, conditionalHOY; plug-in component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
move_2 = Move(Geometry=pt_6, Motion=vec_3.Vector)  # -> Geometry, Transform
num = Number(comfortable_hot_cold)
panel_40 = Panel("""Comfortable (%): 
hot (%):         
cold (%):        """)
comfortable_hot_cold_2 = Panel([adaptivecomfortcalculator_2.percentOfTimeComfortable, adaptivecomfortcalculator_2.percentHotCold])
expression = Expression(x=num, Expression="Round(x, 2)")
psychchart_2 = Ladybug_PsychrometricChart(
    dryBulbTemperature=readepresult_2.airTemperature,
    relativeHumidity=readepresult_2.relativeHumidity,
    basePoint=move_2.Geometry,
    runIt=Toggle(True))  # -> readMe, port, totalComfortPercent, totalComfortOrNot, strategyNames, strategyPercentOfTime, strategyOrNot, port_2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; plug-in component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
_3dchart_3 = Ladybug_3DChart(
    inputData=flatten(adaptivecomfortcalculator_2.conditionOfPerson),
    basePoint=pt_6,
    xScale=".025",
    yScale="0.125",
    zScale=Slider(0, range=0..100),
    legendPar=legendpar_5)  # -> readMe, graphMesh, graphCurves, legend, legendBasePts, title, titleBasePts, dataPts, conditionalHOY; plug-in component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
flip_3 = FlipMatrix(Data=panel_39)  # -> simplify(Data)
flip_4 = FlipMatrix(Data=expression)  # -> simplify(Data)
num_2 = Number(comfortable_hot_cold_2)
expression_2 = Expression(x=num_2, Expression="Round(x, 2)")
panel_41 = Panel([flip_3, flip_4])
flip_5 = FlipMatrix(Data=panel_40)  # -> simplify(Data)
flip_6 = FlipMatrix(Data=expression_2)  # -> simplify(Data)
join_3 = TextJoin(Text=panel_41)
panel_42 = Panel([flip_5, flip_6])
join_4 = TextJoin(Text=flatten(join_3))
pt_7 = Point(Point(-17, 4, 0))
tag = TextTag3D(Location=pt_7, Text=join_4, Size=1, Colour=ColourSwatch(SwatchColor=RGB(0, 0, 0)), Justification=5)
join_5 = TextJoin(Text=panel_42)
join_6 = TextJoin(Text=flatten(join_5))
pt_8 = Point(Point(-17, 4, 0))
tag_2 = TextTag3D(Location=pt_8, Text=join_6, Size=1, Colour=ColourSwatch(SwatchColor=RGB(0, 0, 0)), Justification=5)

# ----
# Fully Shaded
# Overall Legend
# Overall
# With solar radiation effect
# Comfort
# Not Comfort
# Not Comfort Legend
# With solar radiation effect
# + Meyerson Hall building
# With solar radiation effect
# + Meyerson Hall building + Shading System
panel_43 = Panel("https://www.energyplus.net/weather-download/north_and_central_america_wmo_region_4/USA/PA/USA_PA_Philadelphia.Intl.AP.724080_TMY3/all")
ladybug_4 = Ladybug_Ladybug()  # -> Vviiiiiiiiiizzz; plug-in component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
epw_stat_7 = Ladybug_OpenEPWAndSTATWeatherFiles(weatherFileURL=panel_43)  # -> epwFile, statFile; plug-in component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
importepw_4 = Ladybug_ImportEpw(epwFile=epw_stat_7.epwFile)  # -> readMe, latitude, location, dryBulbTemperature, dewPointTemperature, relativeHumidity, windSpeed, windDirection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; plug-in component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
analysisperiod_2 = Ladybug_AnalysisPeriod()  # -> readMe, analysisPeriod; plug-in component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
analysisperiod_3 = Ladybug_AnalysisPeriod()  # -> readMe, analysisPeriod; plug-in component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
line = Line(Line((-102.3446363, 324.5902896, -257.2096947), (-101.9729119, 327.617742, -257.2096947)))
analysisperiod_4 = Ladybug_AnalysisPeriod()  # -> readMe, analysisPeriod; plug-in component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
line_2 = Line(Line((-102.3446363, 324.5902896, -257.2096947), (-101.9729119, 327.617742, -257.2096947)))
brep_6 = Brep(<brep referenced from the Rhino model>)
brep_7 = Brep(<brep referenced from the Rhino model>)
vec_4 = Vector(line)
vec_5 = Vector(line_2)
area = Area(Geometry=brep_6)  # -> Area, Centroid
area_2 = Area(Geometry=brep_7)  # -> Area, Centroid
unit = UnitVector(Vector=vec_4)
unit_2 = UnitVector(Vector=vec_5)
toggle_13 = BooleanToggle(True)
toggle_14 = BooleanToggle(True)
brep_8 = Brep([<brep referenced from the Rhino model> x2])
brep_9 = Brep([<brep referenced from the Rhino model> x3])
toggle_15 = BooleanToggle(True)
solaradjusttemperature_3 = Ladybug_OutdoorSolarTemperatureAdjustor(
    location=importepw_4.location,
    cumSkyMtxOrDirNormRad=importepw_4.directNormalRadiation,
    diffuseHorizRad=importepw_4.diffuseHorizontalRadiation,
    baseTemperature=importepw_4.dryBulbTemperature,
    baseDryBulbOrMRT=Toggle(True),
    horizInfraredRad=importepw_4.horizontalInfraredRadiation,
    analysisPeriodOrHOY=analysisperiod_4.analysisPeriod,
    parallel=toggle_15,
    runIt=toggle_15)  # -> readMe, port, effectiveRadiantField, MRTDelta, solarAdjustedMRT, port_2, mannequinMesh, port_3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; plug-in component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
solaradjusttemperature_4 = Ladybug_OutdoorSolarTemperatureAdjustor(
    location=importepw_4.location,
    cumSkyMtxOrDirNormRad=importepw_4.directNormalRadiation,
    diffuseHorizRad=importepw_4.diffuseHorizontalRadiation,
    baseTemperature=importepw_4.dryBulbTemperature,
    baseDryBulbOrMRT=Toggle(True),
    horizInfraredRad=importepw_4.horizontalInfraredRadiation,
    bodyLocation=area.Centroid,
    contextShading=brep_8,
    north=unit,
    analysisPeriodOrHOY=analysisperiod_2.analysisPeriod,
    parallel=toggle_13,
    runIt=toggle_13)  # -> readMe, port, effectiveRadiantField, MRTDelta, solarAdjustedMRT, port_2, mannequinMesh, port_3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; plug-in component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
solaradjusttemperature_5 = Ladybug_OutdoorSolarTemperatureAdjustor(
    location=importepw_4.location,
    cumSkyMtxOrDirNormRad=importepw_4.directNormalRadiation,
    diffuseHorizRad=importepw_4.diffuseHorizontalRadiation,
    baseTemperature=importepw_4.dryBulbTemperature,
    baseDryBulbOrMRT=Toggle(True),
    horizInfraredRad=importepw_4.horizontalInfraredRadiation,
    bodyLocation=area_2.Centroid,
    contextShading=brep_9,
    north=unit_2,
    analysisPeriodOrHOY=analysisperiod_3.analysisPeriod,
    parallel=toggle_14,
    runIt=toggle_14)  # -> readMe, port, effectiveRadiantField, MRTDelta, solarAdjustedMRT, port_2, mannequinMesh, port_3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; plug-in component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
# Shading Design
outdoorcomfortcalculator_3 = Ladybug_OutdoorComfortCalculator(
    dryBulbTemperature=importepw_4.dryBulbTemperature,
    windSpeed_tenMeters=importepw_4.windSpeed,
    relativeHumidity=importepw_4.relativeHumidity,
    runIt=Toggle(True))  # -> readMe, port, universalThermalClimateIndex, comfortableOrNot, thermalStress, conditionOfPerson, port_2, percentOfTimeComfortable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; plug-in component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
outdoorcomfortcalculator_4 = Ladybug_OutdoorComfortCalculator(
    dryBulbTemperature=importepw_4.dryBulbTemperature,
    meanRadiantTemperature=solaradjusttemperature_3.solarAdjustedMRT,
    windSpeed_tenMeters=importepw_4.windSpeed,
    relativeHumidity=importepw_4.relativeHumidity,
    runIt=Toggle(True))  # -> readMe, port, universalThermalClimateIndex, comfortableOrNot, thermalStress, conditionOfPerson, port_2, percentOfTimeComfortable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; plug-in component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
outdoorcomfortcalculator_5 = Ladybug_OutdoorComfortCalculator(
    dryBulbTemperature=importepw_4.dryBulbTemperature,
    meanRadiantTemperature=solaradjusttemperature_4.solarAdjustedMRT,
    windSpeed_tenMeters=importepw_4.windSpeed,
    relativeHumidity=importepw_4.relativeHumidity,
    runIt=Toggle(True))  # -> readMe, port, universalThermalClimateIndex, comfortableOrNot, thermalStress, conditionOfPerson, port_2, percentOfTimeComfortable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; plug-in component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
outdoorcomfortcalculator_6 = Ladybug_OutdoorComfortCalculator(
    dryBulbTemperature=importepw_4.dryBulbTemperature,
    meanRadiantTemperature=solaradjusttemperature_5.solarAdjustedMRT,
    windSpeed_tenMeters=importepw_4.windSpeed,
    relativeHumidity=importepw_4.relativeHumidity,
    runIt=Toggle(True))  # -> readMe, port, universalThermalClimateIndex, comfortableOrNot, thermalStress, conditionOfPerson, port_2, percentOfTimeComfortable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; plug-in component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
equals = Equality(FirstNumber=outdoorcomfortcalculator_4.thermalStress, SecondNumber=0)  # -> Equality, Inequality
equals_2 = Equality(FirstNumber=outdoorcomfortcalculator_3.thermalStress, SecondNumber=0)  # -> Equality, Inequality
equals_3 = Equality(FirstNumber=outdoorcomfortcalculator_5.thermalStress, SecondNumber=0)  # -> Equality, Inequality
equals_4 = Equality(FirstNumber=outdoorcomfortcalculator_6.thermalStress, SecondNumber=0)  # -> Equality, Inequality
dispatch = Dispatch(List=outdoorcomfortcalculator_4.thermalStress, DispatchPattern=equals.Equality)  # -> ListA, ListB
dispatch_2 = Dispatch(List=outdoorcomfortcalculator_3.thermalStress, DispatchPattern=equals_2.Equality)  # -> ListA, ListB
dispatch_3 = Dispatch(List=outdoorcomfortcalculator_5.thermalStress, DispatchPattern=equals_3.Equality)  # -> ListA, ListB
dispatch_4 = Dispatch(List=outdoorcomfortcalculator_6.thermalStress, DispatchPattern=equals_4.Equality)  # -> ListA, ListB
lng = ListLength(List=dispatch.ListA)
lng_2 = ListLength(List=dispatch_2.ListA)
lng_3 = ListLength(List=dispatch_3.ListA)
lng_4 = ListLength(List=dispatch_4.ListA)
division = Division(A=lng, B=8760)
division_2 = Division(A=lng_2, B=8760)
division_3 = Division(A=lng_3, B=8760)
division_4 = Division(A=lng_4, B=8760)
comfort_hours = Panel(lng)
comfort_percentage = Panel(division)
comfort_hours_2 = Panel(lng_2)
comfort_percentage_2 = Panel(division_2)
comfort_hours_3 = Panel(lng_3)
comfort_percentage_3 = Panel(division_3)
comfort_percentage_4 = Panel(division_4)
comfort_hours_4 = Panel(lng_4)
legendpar_6 = Ladybug_LegendParameters(
    lowBound=-1,
    highBound=1,
    numSegments="3",
    customColors=flatten([ColourSwatch(SwatchColor=RGBA(0, 0, 0, 134)), ColourSwatch(SwatchColor=RGB(255, 255, 0)), ColourSwatch(SwatchColor=RGBA(0, 0, 0, 134))]),
    removeLessThan=0)  # -> legendPar; plug-in component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
legendpar_7 = Ladybug_LegendParameters(numSegments="3")  # -> legendPar; plug-in component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
analysisperiod_5 = Ladybug_AnalysisPeriod()  # -> readMe, analysisPeriod; plug-in component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
_3dchart_4 = Ladybug_3DChart(
    inputData=flatten([outdoorcomfortcalculator_3.thermalStress, outdoorcomfortcalculator_4.thermalStress, outdoorcomfortcalculator_5.thermalStress, outdoorcomfortcalculator_6.thermalStress]),
    xScale="0.2",
    zScale="0",
    legendPar=legendpar_7)  # -> readMe, graphMesh, graphCurves, legend, legendBasePts, title, titleBasePts, dataPts, conditionalHOY; plug-in component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
_3dchart_5 = Ladybug_3DChart(
    inputData=flatten(outdoorcomfortcalculator_6.thermalStress),
    xScale="0.2",
    zScale="0",
    legendPar=legendpar_6,
    condStatement="a == 0")  # -> readMe, graphMesh, graphCurves, legend, legendBasePts, title, titleBasePts, dataPts, conditionalHOY; plug-in component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
_3dchart_6 = Ladybug_3DChart(
    inputData=flatten(outdoorcomfortcalculator_6.thermalStress),
    xScale="0.2",
    zScale="0",
    legendPar=legendpar_6,
    condStatement="a <> 0")  # -> readMe, graphMesh, graphCurves, legend, legendBasePts, title, titleBasePts, dataPts, conditionalHOY; plug-in component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
sunpath_2 = Ladybug_SunPath(
    north=unit,
    location=importepw_4.location,
    hour=12,
    day=21,
    month=12,
    timeStep=4,
    analysisPeriod=analysisperiod_5.analysisPeriod,
    centerPt=area.Centroid,
    sunPathScale=Slider(0.3, range=0..1),
    sunScale=Slider(0.5, range=0..1),
    annualHourlyData=flatten(outdoorcomfortcalculator_5.thermalStress),
    conditionalStatement="a > 0",
    legendPar=legendpar_7,
    dailyOrAnnualSunPath=True)  # -> readMe, sunVectors, sunAltitudes, sunAzimuths, port, sunSpheresMesh, sunPathCrvs, legend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; plug-in component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
number_slider_12 = Slider(0.872, range=0..1)
ln = Line(StartPoint=sunpath_2.sunPositions, EndPoint=area.Centroid)
eval = EvaluateCurve(Curve=ln, Parameter=number_slider_12)  # -> Point, Tangent, Angle
shatter = Shatter(Curve=ln, Parameters=number_slider_12)
item_13 = ListItem(List=shatter, Index=0, Wrap=True)  # -> Item, Item1
crv = Curve(item_13.Item1)

brep_10 = Brep(<brep referenced from the Rhino model>)
brep_11 = Brep(<brep referenced from the Rhino model>)
comfortshadebenefit = Ladybug_ComfortShadeBenefitEvaluator(
    location=importepw_4.location,
    temperatures=outdoorcomfortcalculator_5.universalThermalClimateIndex,
    testShades=brep_10,
    testRegion=brep_11,
    north=unit,
    delNonIntersect=False,
    runIt=Toggle(False))  # -> readMe, port, sunVectors, regionTestPts, shadeMesh, legend, legendBasePoint, port_2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; plug-in component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

# ---- group: Glare
# Finally for complex geometries or
# geometries that are not going to change
# it is better to export them as rad files
# using RAD>Mesh and use them as
# additional files.
panel_44 = Panel("https://www.energyplus.net/weather-download/north_and_central_america_wmo_region_4/USA/PA/USA_PA_Philadelphia.Intl.AP.724080_TMY3/all")
# Glare Analysis
# 这个要用挤出物件
# 不然总是一万多lux
number_slider_13 = Slider(0.6, range=0..1)
windows_4 = Brep([<brep referenced from the Rhino model> x2])
wall_6 = Brep(<brep referenced from the Rhino model>)
floor_2 = Brep(<brep referenced from the Rhino model>)
epw_stat_8 = Ladybug_OpenEPWAndSTATWeatherFiles(weatherFileURL=panel_44)  # -> epwFile, statFile; plug-in component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
createhbsrfs_13 = Honeybee_createHBSrfs(geometry=wall_6, srfType="0")  # -> readMe, simplify(HBSurface); plug-in component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
createhbsrfs_14 = Honeybee_createHBSrfs(geometry=floor_2, srfType="2")  # -> readMe, simplify(HBSurface); plug-in component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
radglassmaterial_4 = Honeybee_RadianceGlassMaterial(
    materialName="Glass",
    RTransmittance=number_slider_13,
    GTransmittance=number_slider_13,
    BTransmittance=number_slider_13,
    refractiveIndex=1.52)  # -> avrgTrans, RADMaterial; plug-in component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
panel_45 = Panel("3")
panel_46 = Panel("21")
panel_47 = Panel("9")
createhbsrfs_15 = Honeybee_createHBSrfs(geometry=windows_4, RADMaterial=radglassmaterial_4.RADMaterial)  # -> readMe, simplify(HBSurface); plug-in component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
number_slider_14 = Slider(45, range=0..100)
genclimatebasedsky_3 = Honeybee_GenerateClimateBasedSky(north=number_slider_14, weatherFile=epw_stat_8.epwFile, month=panel_45, day=panel_46, hour=panel_47)  # -> radiationValues, skyFilePath; plug-in component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
genavgsky = Honeybee_GenerateAverageSky(north=number_slider_14, weatherFile=epw_stat_8.epwFile, month=panel_45, hour=panel_47)  # -> radiationValues, skyFilePath; plug-in component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
northarrow = Ladybug_North(north=number_slider_14, scale=".05")  # -> northSign; plug-in component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
md_slider = MDSlider(
    slider_value=Point(0.9388442621, 0.006121379573, 0.5),
    SliderMode=0,
    x_domain=Domain(-1, 1),
    y_domain=Domain(-1, 1),
    z_domain=Domain(0, 1))
brep_12 = Brep([createhbsrfs_15.HBSurface, createhbsrfs_13.HBSurface, createhbsrfs_14.HBSurface])
panel_48 = Panel([genclimatebasedsky_3.radiationValues, genavgsky.radiationValues])
set_the_view_to_fisheye_for_glare_analys = Panel("1")  # "set the view to FishEye for Glare Analysis"
radparameters = Honeybee_RADParameters(quality=0, ab="3")  # -> readMe, radParameters; plug-in component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
doy_hoy_4 = Ladybug_DOY_HOY(days=panel_46, months=panel_45, hours=panel_47)  # -> HOY, DOY, date; plug-in component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
imagebasedsimulation = Honeybee_ImageBasedSimulation(
    skyFile=genavgsky.skyFilePath,
    cameraType=set_the_view_to_fisheye_for_glare_analys,
    simulationType=2,
    radParameters=radparameters.radParameters,
    backupImages=0)  # -> analysisRecipe; plug-in component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
toggle_16 = BooleanToggle(True)
panel_49 = Panel("""Radiance
Grasshopper
Honeybee
Glare
Daylight
Set View
HBExampleFiles""")
panel_50 = Panel("""This file shows how to run a glare analysis using Honeybee. This example is using same geometry as the other daylighting examples [[1](http://hydrashare.github.io/hydra/viewer?owner=mostaphaRoudsari&fork=hydra_1&id=Surface_by_surface_geometry_preparation_for_daylight_simulation_II), [2](http://hydrashare.github.io/hydra/viewer?owner=mostaphaRoudsari&fork=hydra_1&id=Find_when_sun_is_visible_to_a_point)].
The example is uses Averaged Climate-based Sky for glare analysis which uses the average value for that hour during the whole month.""")
panel_51 = Panel("C:\Users\Administrator\Dropbox\ladybug\helpDesk\PennDesign2015\Daylight_Glare_Analysis.png")
number_slider_15 = Slider(0.35, range=0..1)
geo_4 = Geometry(<brep referenced from the Rhino model>)
exporthydra = Hydra_ExportFile(
    fileName="Glare Analysis",
    fileDescription=panel_50,
    fileTags=panel_49,
    targetFolder="C:\Users\Administrator\Documents\GitHub\hydra_1",
    includeRhino=Toggle(True),
    additionalImgs=panel_51,
    export=Toggle(False))  # -> readMe; inputs fileDescription: list, changeLog: list, fileTags: list, includeRhino: Boolean, GHForThumb: Boolean, additionalImgs: list, export: Boolean; plug-in component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
radopaquematerial = Honeybee_RadianceOpaqueMaterial(
    materialName="context_material",
    RReflectance=number_slider_15,
    GReflectance=number_slider_15,
    BReflectance=number_slider_15,
    roughness=0.05,
    specularity=0)  # -> avrgRef, RADMaterial; plug-in component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
msh2rad = Honeybee_MSH2RAD(
    mesh=geo_4,
    RADMaterial=radopaquematerial.RADMaterial,
    workingDir="c:\ladybug",
    radFileName="ParisProjectContext",
    writeRAD=Toggle(True))  # -> materialFile, radianceFile; plug-in component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
merge = Merge(Data1=msh2rad.materialFile, Data2=msh2rad.radianceFile)
panel_52 = Panel(merge)
number_slider_16 = Slider(0.8, range=0..1)

# ---- group: Glare / For better visualization - Doesn't effect the results of the analysis
importlocation_2 = Ladybug_ImportLocation(epwFile=epw_stat_8.epwFile)  # -> location; plug-in component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
sunpath_3 = Ladybug_SunPath(
    north=number_slider_14,
    location=importlocation_2,
    hour=panel_47,
    day=panel_46,
    month=panel_45,
    timeStep=1,
    sunPathScale=Slider(0.2, range=0..1),
    dailyOrAnnualSunPath=True)  # -> readMe, sunVectors, sunAltitudes, sunAzimuths, port, sunSpheresMesh, sunPathCrvs, legend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; disabled; plug-in component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

# ---- group: Glare / collect all honeybee surfaces
brep_13 = Brep(flatten(brep_12))

# ---- group: Glare
comfortmannequin = Ladybug_ComfortMannequin(rotationAngle="175", bodyLocation=pt)  # -> mannequinMesh, legend, legendBasePt; plug-in component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

# ---- group: Glare / Person's face!
item_14 = ListItem(List=comfortmannequin.mannequinMesh, Index=121, Wrap=True)

# ---- group: Glare (continued)
preview_4 = CustomPreview(Geometry=item_14, Shader=ColourSwatch(SwatchColor=RGB(255, 0, 0)))

facen = FaceNormals(Mesh=item_14)  # -> Centers, Normals
settheview = Ladybug_SetTheView(cameraLocation=facen.Centers, cameraDirection=facen.Normals, uvLookAround=md_slider, lensLength=Slider(5, range=0..100))  # -> readMe; plug-in component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
rundaylightanalysis_4 = Honeybee_RunDaylightSimulation(
    HBObjects=flatten(brep_13),
    analysisRecipe=imagebasedsimulation,
    writeRad=toggle_16,
    runRad=toggle_16,
    numOfCPUs="4",
    radFileName=doy_hoy_4.date,
    additionalRadFiles=merge,
    overwriteResults=True)  # -> readMe, analysisType, resultsUnit, results, testPts, luminance_files, radGeoFile, studyFolder, done; plug-in component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
glareanalysis = Honeybee_GlareAnalysis(HDRImagePath=rundaylightanalysis_4.luminance_files, runIt=Toggle(True))  # -> readMe, glareCheckImage, DGP, DGI, imageWithTaskArea; plug-in component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
falsecolor = Honeybee_FalseColor(
    HDRFilePath=rundaylightanalysis_4.luminance_files,
    contourBands=False,
    maskThreshold=0.1,
    useAlterColors=False,
    render=Toggle(True))  # -> outputFilePath; plug-in component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
panel_53 = Panel(glareanalysis.DGP)
hdr_tif = Honeybee_ConvertHDRToTIF(HDRFilePath=glareanalysis.glareCheckImage, adjustExposure=Toggle(True))  # -> TIFFFilePath; plug-in component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
hdr_tif_2 = Honeybee_ConvertHDRToTIF(HDRFilePath=falsecolor, adjustExposure=False)  # -> TIFFFilePath; plug-in component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
image = ImageFromPath(P=hdr_tif_2, S=number_slider_16)
image_2 = ImageFromPath(P=hdr_tif, S=number_slider_16)

# ----
panel_54 = Panel("This file shows the minimum steps to set up a daylight model for a room in Honeybee. This example uses mass2zones component to prepare the geometries however you can create the geometries surface by surface using createHBSurface.")
panel_55 = Panel("""Grasshopper
Daylighting
Annual
Radiance
Daysim
Honeybee
HBExampleFiles""")
# Annual Daylight Simulation
number_slider_17 = Slider(4.2, range=0..10)
number_slider_18 = Slider(7, range=0..10)
exporthydra_2 = Hydra_ExportFile(
    fileName="Honeybee Annual Daylight Simulation Example",
    fileDescription=panel_54,
    fileTags=panel_55,
    targetFolder="C:\Users\Administrator\Documents\GitHub\hydra_1",
    export=Toggle(False))  # -> readMe; inputs fileDescription: list, changeLog: list, fileTags: list, includeRhino: Boolean, GHForThumb: Boolean, additionalImgs: list, export: Boolean; plug-in component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
# Convert the box to Honeybee zone
# All the material will be set to default
# In case you want to change them search
# for Honeybee_Set Radiance Materials
# component.
box_2 = DomainBox(Base=PlaneXY(0, 0, 0), X=number_slider_17, Y=number_slider_18, Z=Slider(3.2, range=0..10))
mass2zone_4 = Honeybee_Masses2Zones(zoneMasses=flatten(my_apt), isConditioned=True, maxRoofAngle=30, createHBZones=Toggle(True))  # -> readMe, HBZones; plug-in component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
glzparamlist_3 = Honeybee_GlazingParametersList(
    northGlzParam=Slider(0.1, range=0..1),
    westGlzParam=Slider(0, range=0..1),
    southGlzParam=Slider(0, range=0..1),
    eastGlzParam=Slider(0.1, range=0..1))  # -> glzParamList; plug-in component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
glazingcreator_3 = Honeybee_GlazingBasedOnRatio(HBObjects=mass2zone_4.HBZones, glzRatio=glzparamlist_3, breakUpWindow=toggle_6, runIt=Toggle(True))  # -> readMe, HBObjWGLZ; plug-in component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
panel_56 = Panel("https://www.energyplus.net/weather-download/north_and_central_america_wmo_region_4/USA/PA/USA_PA_Philadelphia.Intl.AP.724080_TMY3/all")
pt_9 = ConstructPoint(XCoordinate=number_slider_17, YCoordinate=expr("-x", number_slider_18), ZCoordinate=0)
pt_10 = ConstructPoint(XCoordinate=0, YCoordinate=0, ZCoordinate=0)
epw_stat_9 = Ladybug_OpenEPWAndSTATWeatherFiles(weatherFileURL=panel_56)  # -> epwFile, statFile; plug-in component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
rec_2pt = Rectangle2Pt(Plane=PlaneXY(0, 0, 0), PointA=pt_10, PointB=pt_9, Radius=0)  # -> Rectangle, Length
boundary = BoundarySurfaces(Edges=rec_2pt.Rectangle)
wires_6 = BrepWireframe(Brep=boundary, Density=-1)
createhbsrfs_16 = Honeybee_createHBSrfs(geometry=boundary)  # -> readMe, simplify(HBSurface); plug-in component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
toggle_17 = BooleanToggle(False)
occupancygenerator_2 = Honeybee_DaysimOccupancyGenerator(weekendDays=[1, 2], writeTheOcc=Toggle(True))  # -> occupancyFile; plug-in component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
gradientlibrary_2 = Ladybug_GradientLibrary(gradIndex=Slider(1, range=0..10))  # -> customColors; plug-in component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
legendpar_8 = Ladybug_LegendParameters(
    lowBound=Slider(0, range=0..100),
    highBound=Slider(100, range=0..100),
    numSegments=Slider(6, range=0..10),
    customColors=flatten(gradientlibrary_2))  # -> legendPar; plug-in component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

# ---- group: HB Zone With Glazing
brep_14 = Brep(glazingcreator_3.HBObjWGLZ)

# ---- group: make it 3D!
dom_2 = ConstructDomain(DomainStart=0, DomainEnd=Slider(1, range=0..1))

# ----
wires_7 = BrepWireframe(Brep=brep_14, Density=-1)
genhbzonetestpts_2 = Honeybee_GenerateZoneTestPoints(HBZone=brep_14, gridSize=Slider(0.5, range=0..1), distBaseSrf=Slider(0.762, range=0..1), moveTestMesh=Toggle(True))  # -> readMe, simplify(testPoints), simplify(ptsVectors), simplify(facesArea), simplify(mesh); plug-in component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
# Put the recipie together!
annualdaylightsimulation_2 = Honeybee_AnnualDaylightSimulation(
    epwWeatherFile=epw_stat_9.epwFile,
    testPoints=genhbzonetestpts_2.testPoints,
    ptsVectors=genhbzonetestpts_2.ptsVectors,
    testMesh=genhbzonetestpts_2.mesh)  # -> analysisRecipe; plug-in component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
# Run the analysis
rundaylightanalysis_5 = Honeybee_RunDaylightSimulation(
    HBObjects=flatten([brep_14, createhbsrfs_12.readMe]),
    analysisRecipe=annualdaylightsimulation_2,
    writeRad=toggle_17,
    runRad=toggle_17,
    overwriteResults=True)  # -> readMe, analysisType, resultsUnit, results, testPts, resultFiles, radGeoFile, studyFolder, done; plug-in component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
# Generate annual results
readannualresultsi_2 = Honeybee_ReadAnnualResultI(
    illFilesAddress=rundaylightanalysis_5.resultFiles,
    testPoints=simplify(rundaylightanalysis_5.testPts),
    occupancyFiles=occupancygenerator_2,
    DLAIllumThresholds=300,
    runIt=Toggle(True))  # -> DLA, UDLI_Less_100, UDLI_100_2000, UDLI_More_2000, CDA, sDA, annualProfiles, htmReport; plug-in component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
# Visualize the results
recolormesh_4 = Ladybug_RecolorMesh(
    analysisResult=readannualresultsi_2.UDLI_100_2000,
    inputMesh=genhbzonetestpts_2.mesh,
    heightDomain=dom_2,
    legendPar=legendpar_8,
    analysisTitle=rundaylightanalysis_5.analysisType,
    legendTitle="%")  # -> readMe, newMesh, newLegend, legendBasePt, meshColors, legendColors; plug-in component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

# ----
# SDA!
# UDLI
# CDA
# 等在左边
panel_57 = Panel(readannualresultsi_2.sDA)

# ----
# Comfort Analysis
# Set Up An Energy Simulation
# Set Building Geometry
# Run the Energy Simulation + Get Results
# Visualize the Zones
brep_15 = Brep(<brep referenced from the Rhino model>)
splitmass = Honeybee_SplitBuildingMass(bldgMasses=brep_15, bldgsFlr2FloorHeights="@3", perimeterZoneDepth="@3", runIt=Toggle(True))  # -> readMe, splitBldgMasses; plug-in component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
mass2zone_5 = Honeybee_Masses2Zones(zoneMasses=flatten(splitmass.splitBldgMasses), isConditioned=True, maxRoofAngle=30, createHBZones=Toggle(True))  # -> readMe, HBZones; plug-in component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
solveadjc = Honeybee_SolveAdjacencies(HBZones=flatten(mass2zone_5.HBZones), altConstruction="Air Wall", removeCurrentAdjc=False, findAdjc=Toggle(True))  # -> readMe, HBZonesWADJ; plug-in component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
panel_58 = Panel("""0.2
0.4
0.6
0.4""")
glazingcreator_4 = Honeybee_GlazingBasedOnRatio(HBObjects=solveadjc.HBZonesWADJ, glzRatio=panel_58, breakUpWindow=Toggle(True), runIt=Toggle(True))  # -> readMe, HBObjWGLZ; plug-in component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
setepzonethresholds = Honeybee_SetEnergyPlusZoneThresholds(HBZones=glazingcreator_4.HBObjWGLZ, coolingSetPt="50", coolingSetback="50", heatingSetPt="19", heatingSetback="19")  # -> readMe, HBZones; plug-in component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
panel_59 = Panel("https://www.energyplus.net/weather-download/north_and_central_america_wmo_region_4/USA/PA/USA_PA_Philadelphia-NE.Philadelphia.AP.724085_TMY3/all")
setepnatvent = Honeybee_SetEPAirFlow(HBZones=setepzonethresholds.HBZones, naturalVentilationType="1", minIndoorTempForNatVent="22")  # -> readMe, simplify(HBZones); plug-in component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
open_epw_stat = Ladybug_OpenEPWAndSTATWeatherFiles(weatherFileURL=panel_59)  # -> epwFile, statFile; plug-in component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
panel_60 = Panel(open_epw_stat.epwFile)
importepw_5 = Ladybug_ImportEpw(epwFile=open_epw_stat.epwFile)  # -> readMe, latitude, location, dryBulbTemperature, dewPointTemperature, relativeHumidity, windSpeed, windDirection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; plug-in component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
panel_61 = Panel(importepw_5.readMe)
panel_62 = Panel("This file shows you how to calculate adaptive comfort from Honeybee energy simulation results for a naturally ventilated building.")
panel_63 = Panel("""HBExampleFiles
Honyebee
EPW
Weather
Climate
Energy
Simulation
Model
Adaptive
Comfort
Natural Ventilation
Free Running""")
exporthydra_3 = Hydra_ExportFile(fileName="Indoor Adaptive Comfort", fileDescription=panel_62, fileTags=panel_63, export=Toggle(False))  # -> readMe; inputs fileDescription: list, changeLog: list, fileTags: list, includeRhino: Boolean, GHForThumb: Boolean, additionalImgs: list, export: Boolean; plug-in component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

# ----
# Run the Simulation
panel_64 = Panel("hourly")
epoutput_3 = Honeybee_GenerateEPOutput(zoneGainsAndLosses="False", zoneComfortMetrics=Toggle(True), surfaceTempAnalysis="False", timestep=panel_64)  # -> report, flatten(simulationOutputs); plug-in component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
toggle_18 = BooleanToggle(True)
runenergysimulation_3 = Honeybee_RunEnergySimulation(
    epwFile=open_epw_stat.epwFile,
    HBZones=flatten(setepnatvent.HBZones),
    simulationOutputs=flatten(epoutput_3.simulationOutputs),
    writeIdf=toggle_18,
    runEnergyPlus=toggle_18,
    idfFileName="Test_IDF")  # -> report, idfFileAddress, resultFileAddress; plug-in component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
readepresult_3 = Honeybee_ReadEPResult(resultFileAddress=runenergysimulation_3.resultFileAddress)  # -> totalThermalEnergy, thermalEnergyBalance, cooling, heating, electricLight, electricEquip, fanElectric, pumpElectric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; plug-in component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

decomposebytype_3 = Honeybee_DecomposeBasedOnType(HBZone=setepzonethresholds.HBZones)  # -> walls, interiorWalls, airWalls, windows, interiorWindows, skylights, roofs, ceilings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; plug-in component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
preview_5 = CustomPreview(Geometry=decomposebytype_3.windows, Shader=ColourSwatch(SwatchColor=RGBA(178, 232, 255, 108)))
preview_6 = CustomPreview(Geometry=decomposebytype_3.walls, Shader=ColourSwatch(SwatchColor=RGB(255, 252, 178)))
preview_7 = CustomPreview(Geometry=[decomposebytype_3.groundFloors, decomposebytype_3.floors], Shader=ColourSwatch(SwatchColor=RGB(214, 131, 131)))
preview_8 = CustomPreview(Geometry=decomposebytype_3.roofs, Shader=ColourSwatch(SwatchColor=RGB(128, 128, 128)))

adaptivecomfortcalculator_3 = Ladybug_AdaptiveComfortCalculator(
    dryBulbTemperature=readepresult_3.airTemperature,
    meanRadiantTemperature=readepresult_3.meanRadTemperature,
    prevailingOutdoorTemp=importepw_5.dryBulbTemperature,
    runIt=Toggle(True))  # -> readMe, port, comfortableOrNot, conditionOfPerson, degreesFromTarget, port_2, targetTemperature, upperTemperatureBound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; plug-in component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
panel_65 = Panel(adaptivecomfortcalculator_3.percentOfTimeComfortable)
_3dchart_7 = Ladybug_3DChart(inputData=flatten(adaptivecomfortcalculator_3.conditionOfPerson), xScale=".25", zScale="0")  # -> readMe, graphMesh, graphCurves, legend, legendBasePts, titleText, titleBasePts, conditionalHOY; plug-in component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
preview_9 = CustomPreview(Geometry=[_3dchart_7.graphCurves, _3dchart_7.legend], Shader=ColourSwatch(SwatchColor=RGB(0, 0, 0)))

panel_66 = Panel(adaptivecomfortcalculator_3.readMe)
