# Grasshopper definition jin_jieming_shading Design.gh (Grasshopper 0.9.76)
# plug-ins: Python Interpreter

panel = Panel("https://www.energyplus.net/weather-download/north_and_central_america_wmo_region_4/USA/PA/USA_PA_Philadelphia.Intl.AP.724080_TMY3/all")
ladybug = Ladybug_Ladybug()  # -> Vviiiiiiiiiizzz; plug-in component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
epw_stat = Ladybug_OpenEPWAndSTATWeatherFiles(weatherFileURL=panel)  # -> epwFile, statFile; plug-in component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
importepw = Ladybug_ImportEpw(epwFile=epw_stat.epwFile)  # -> readMe, latitude, location, dryBulbTemperature, dewPointTemperature, relativeHumidity, windSpeed, windDirection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; plug-in component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
analysisperiod = Ladybug_AnalysisPeriod()  # -> readMe, analysisPeriod; plug-in component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
analysisperiod_2 = Ladybug_AnalysisPeriod()  # -> readMe, analysisPeriod; plug-in component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
line = Line(Line((-102.3446363, 324.5902896, -257.2096947), (-101.9729119, 327.617742, -257.2096947)))
analysisperiod_3 = Ladybug_AnalysisPeriod()  # -> readMe, analysisPeriod; plug-in component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
line_2 = Line(Line((-102.3446363, 324.5902896, -257.2096947), (-101.9729119, 327.617742, -257.2096947)))
brep = Brep(<brep referenced from the Rhino model>)
brep_2 = Brep(<brep referenced from the Rhino model>)
vec = Vector(line)
vec_2 = Vector(line_2)
area = Area(Geometry=brep)  # -> Area, Centroid
area_2 = Area(Geometry=brep_2)  # -> Area, Centroid
unit = UnitVector(Vector=vec)
unit_2 = UnitVector(Vector=vec_2)
toggle = BooleanToggle(True)
toggle_2 = BooleanToggle(True)
brep_3 = Brep([<brep referenced from the Rhino model> x2])
brep_4 = Brep([<brep referenced from the Rhino model> x3])
toggle_3 = BooleanToggle(True)
solaradjusttemperature = Ladybug_OutdoorSolarTemperatureAdjustor(
    location=importepw.location,
    cumSkyMtxOrDirNormRad=importepw.directNormalRadiation,
    diffuseHorizRad=importepw.diffuseHorizontalRadiation,
    baseTemperature=importepw.dryBulbTemperature,
    baseDryBulbOrMRT=Toggle(True),
    horizInfraredRad=importepw.horizontalInfraredRadiation,
    analysisPeriodOrHOY=analysisperiod_3.analysisPeriod,
    parallel=toggle_3,
    runIt=toggle_3)  # -> readMe, port, effectiveRadiantField, MRTDelta, solarAdjustedMRT, port_2, mannequinMesh, port_3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; plug-in component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
solaradjusttemperature_2 = Ladybug_OutdoorSolarTemperatureAdjustor(
    location=importepw.location,
    cumSkyMtxOrDirNormRad=importepw.directNormalRadiation,
    diffuseHorizRad=importepw.diffuseHorizontalRadiation,
    baseTemperature=importepw.dryBulbTemperature,
    baseDryBulbOrMRT=Toggle(True),
    horizInfraredRad=importepw.horizontalInfraredRadiation,
    bodyLocation=area.Centroid,
    contextShading=brep_3,
    north=unit,
    analysisPeriodOrHOY=analysisperiod.analysisPeriod,
    parallel=toggle,
    runIt=toggle)  # -> readMe, port, effectiveRadiantField, MRTDelta, solarAdjustedMRT, port_2, mannequinMesh, port_3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; plug-in component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
solaradjusttemperature_3 = Ladybug_OutdoorSolarTemperatureAdjustor(
    location=importepw.location,
    cumSkyMtxOrDirNormRad=importepw.directNormalRadiation,
    diffuseHorizRad=importepw.diffuseHorizontalRadiation,
    baseTemperature=importepw.dryBulbTemperature,
    baseDryBulbOrMRT=Toggle(True),
    horizInfraredRad=importepw.horizontalInfraredRadiation,
    bodyLocation=area_2.Centroid,
    contextShading=brep_4,
    north=unit_2,
    analysisPeriodOrHOY=analysisperiod_2.analysisPeriod,
    parallel=toggle_2,
    runIt=toggle_2)  # -> readMe, port, effectiveRadiantField, MRTDelta, solarAdjustedMRT, port_2, mannequinMesh, port_3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; plug-in component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
# Fully Shaded
outdoorcomfortcalculator = Ladybug_OutdoorComfortCalculator(
    dryBulbTemperature=importepw.dryBulbTemperature,
    windSpeed_tenMeters=importepw.windSpeed,
    relativeHumidity=importepw.relativeHumidity,
    runIt=Toggle(True))  # -> readMe, port, universalThermalClimateIndex, comfortableOrNot, thermalStress, conditionOfPerson, port_2, percentOfTimeComfortable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; plug-in component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
# With solar radiation effect
outdoorcomfortcalculator_2 = Ladybug_OutdoorComfortCalculator(
    dryBulbTemperature=importepw.dryBulbTemperature,
    meanRadiantTemperature=solaradjusttemperature.solarAdjustedMRT,
    windSpeed_tenMeters=importepw.windSpeed,
    relativeHumidity=importepw.relativeHumidity,
    runIt=Toggle(True))  # -> readMe, port, universalThermalClimateIndex, comfortableOrNot, thermalStress, conditionOfPerson, port_2, percentOfTimeComfortable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; plug-in component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
# With solar radiation effect
# + Meyerson Hall building
outdoorcomfortcalculator_3 = Ladybug_OutdoorComfortCalculator(
    dryBulbTemperature=importepw.dryBulbTemperature,
    meanRadiantTemperature=solaradjusttemperature_2.solarAdjustedMRT,
    windSpeed_tenMeters=importepw.windSpeed,
    relativeHumidity=importepw.relativeHumidity,
    runIt=Toggle(True))  # -> readMe, port, universalThermalClimateIndex, comfortableOrNot, thermalStress, conditionOfPerson, port_2, percentOfTimeComfortable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; plug-in component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
# With solar radiation effect
# + Meyerson Hall building + Shading System
outdoorcomfortcalculator_4 = Ladybug_OutdoorComfortCalculator(
    dryBulbTemperature=importepw.dryBulbTemperature,
    meanRadiantTemperature=solaradjusttemperature_3.solarAdjustedMRT,
    windSpeed_tenMeters=importepw.windSpeed,
    relativeHumidity=importepw.relativeHumidity,
    runIt=Toggle(True))  # -> readMe, port, universalThermalClimateIndex, comfortableOrNot, thermalStress, conditionOfPerson, port_2, percentOfTimeComfortable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; plug-in component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
equals = Equality(FirstNumber=outdoorcomfortcalculator_2.thermalStress, SecondNumber=0)  # -> Equality, Inequality
equals_2 = Equality(FirstNumber=outdoorcomfortcalculator.thermalStress, SecondNumber=0)  # -> Equality, Inequality
equals_3 = Equality(FirstNumber=outdoorcomfortcalculator_3.thermalStress, SecondNumber=0)  # -> Equality, Inequality
equals_4 = Equality(FirstNumber=outdoorcomfortcalculator_4.thermalStress, SecondNumber=0)  # -> Equality, Inequality
dispatch = Dispatch(List=outdoorcomfortcalculator_2.thermalStress, DispatchPattern=equals.Equality)  # -> ListA, ListB
dispatch_2 = Dispatch(List=outdoorcomfortcalculator.thermalStress, DispatchPattern=equals_2.Equality)  # -> ListA, ListB
dispatch_3 = Dispatch(List=outdoorcomfortcalculator_3.thermalStress, DispatchPattern=equals_3.Equality)  # -> ListA, ListB
dispatch_4 = Dispatch(List=outdoorcomfortcalculator_4.thermalStress, DispatchPattern=equals_4.Equality)  # -> ListA, ListB
lng = ListLength(List=dispatch.ListA)
lng_2 = ListLength(List=dispatch_2.ListA)
lng_3 = ListLength(List=dispatch_3.ListA)
lng_4 = ListLength(List=dispatch_4.ListA)
division = Division(A=lng, B=8760)
division_2 = Division(A=lng_2, B=8760)
division_3 = Division(A=lng_3, B=8760)
division_4 = Division(A=lng_4, B=8760)
comfort_hours = Panel(lng)
comfort_percentage = Panel(division)
comfort_hours_2 = Panel(lng_2)
comfort_percentage_2 = Panel(division_2)
comfort_hours_3 = Panel(lng_3)
comfort_percentage_3 = Panel(division_3)
comfort_percentage_4 = Panel(division_4)
comfort_hours_4 = Panel(lng_4)
# Not Comfort Legend
swatch = ColourSwatch(SwatchColor=RGBA(0, 0, 0, 134))
legendpar = Ladybug_LegendParameters(
    lowBound=-1,
    highBound=1,
    numSegments="3",
    customColors=flatten([ColourSwatch(SwatchColor=RGBA(0, 0, 0, 134)), ColourSwatch(SwatchColor=RGB(255, 255, 0)), swatch]),
    removeLessThan=0)  # -> legendPar; plug-in component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
# Overall Legend
legendpar_2 = Ladybug_LegendParameters(numSegments="3")  # -> legendPar; plug-in component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
analysisperiod_4 = Ladybug_AnalysisPeriod()  # -> readMe, analysisPeriod; plug-in component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
# Overall
_3dchart = Ladybug_3DChart(
    inputData=flatten([outdoorcomfortcalculator.thermalStress, outdoorcomfortcalculator_2.thermalStress, outdoorcomfortcalculator_3.thermalStress, outdoorcomfortcalculator_4.thermalStress]),
    xScale="0.2",
    zScale="0",
    legendPar=legendpar_2)  # -> readMe, graphMesh, graphCurves, legend, legendBasePts, title, titleBasePts, dataPts, conditionalHOY; plug-in component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
_3dchart_2 = Ladybug_3DChart(
    inputData=flatten(outdoorcomfortcalculator_4.thermalStress),
    xScale="0.2",
    zScale="0",
    legendPar=legendpar,
    condStatement="a == 0")  # -> readMe, graphMesh, graphCurves, legend, legendBasePts, title, titleBasePts, dataPts, conditionalHOY; plug-in component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
# Comfort
_3dchart_3 = Ladybug_3DChart(
    inputData=flatten(outdoorcomfortcalculator_4.thermalStress),
    xScale="0.2",
    zScale="0",
    legendPar=legendpar,
    condStatement="a <> 0")  # -> readMe, graphMesh, graphCurves, legend, legendBasePts, title, titleBasePts, dataPts, conditionalHOY; plug-in component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
# Not Comfort
sunpath = Ladybug_SunPath(
    north=unit,
    location=importepw.location,
    hour=12,
    day=21,
    month=12,
    timeStep=4,
    analysisPeriod=analysisperiod_4.analysisPeriod,
    centerPt=area.Centroid,
    sunPathScale=Slider(0.3, range=0..1),
    sunScale=Slider(0.5, range=0..1),
    annualHourlyData=flatten(outdoorcomfortcalculator_3.thermalStress),
    conditionalStatement="a > 0",
    legendPar=legendpar_2,
    dailyOrAnnualSunPath=True)  # -> readMe, sunVectors, sunAltitudes, sunAzimuths, port, sunSpheresMesh, sunPathCrvs, legend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; plug-in component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
number_slider = Slider(0.872, range=0..1)
ln = Line(StartPoint=sunpath.sunPositions, EndPoint=area.Centroid)

brep_5 = Brep(<brep referenced from the Rhino model>)
brep_6 = Brep(<brep referenced from the Rhino model>)
comfortshadebenefit = Ladybug_ComfortShadeBenefitEvaluator(
    location=importepw.location,
    temperatures=outdoorcomfortcalculator_3.universalThermalClimateIndex,
    testShades=brep_5,
    testRegion=brep_6,
    north=unit,
    delNonIntersect=False,
    runIt=Toggle(False))  # -> readMe, port, sunVectors, regionTestPts, shadeMesh, legend, legendBasePoint, port_2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; plug-in component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

eval = EvaluateCurve(Curve=ln, Parameter=number_slider)  # -> Point, Tangent, Angle
shatter = Shatter(Curve=ln, Parameters=number_slider)
item = ListItem(List=shatter, Index=0, Wrap=True)  # -> Item, Item1
crv = Curve(item.Item1)
