# Grasshopper definition Kamath Ayodh.gh (Grasshopper 0.9.76)
# plug-ins: Python Interpreter

number_slider = Slider(0, range=0..2)
number_slider_2 = Slider(0, range=0..2)
ladybug = Ladybug_Ladybug()  # -> Vviiiiiiiiiizzz; plug-in component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
honeybee = Honeybee_Honeybee()  # -> Vviiiiiiiiiizzz; plug-in component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
hours = Panel("""9
12
15""")
months = Panel("""3
6
12""")
# Animate sliders
path = FilePath("C:\ladybug\Philadelphia_International_Ap_PA_USA\Philadelphia_International_Ap_PA_USA.epw")
item = ListItem(List=months, Index=number_slider, Wrap=True)
item_2 = ListItem(List=hours, Index=number_slider_2, Wrap=True)
fly = Ladybug_fly(inputSliders=[number_slider, number_slider_2], fly=Button())  # -> Vviiiiiiiiiizzz; plug-in component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
# Glass material
radglassmaterial = Honeybee_RadianceGlassMaterial(materialName="tvis_60", RTransmittance="0.6", GTransmittance="0.6", BTransmittance="0.6", refractiveIndex=1.52)  # -> avrgTrans, RADMaterial; plug-in component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
importlocation = Ladybug_ImportLocation(epwFile=path)  # -> location; plug-in component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
panel = Panel("""9
12
15""")
panel_2 = Panel("""3
6
12""")

# ---- group: glass
brep = Brep(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)

# ----
# Prepare geometries
brep_2 = Brep([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])
createhbsrfs = Honeybee_createHBSrfs(geometry=brep_2)  # -> readMe, simplify(flatten(HBSurface)); plug-in component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
createhbsrfs_2 = Honeybee_createHBSrfs(geometry=brep, RADMaterial=radglassmaterial.RADMaterial)  # -> readMe, simplify(HBSurface); plug-in component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
# Generate sky
genclimatebasedsky = Honeybee_GenerateClimateBasedSky(weatherFile=path, month=item, day="21", hour=item_2)  # -> radiationValues, skyFilePath; plug-in component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
sunpath = Ladybug_SunPath(
    location=importlocation,
    hour=panel,
    day=21,
    month=panel_2,
    timeStep=1,
    sunPathScale=Slider(0.2, range=0..1),
    dailyOrAnnualSunPath=True)  # -> readMe, sunVectors, sunAltitudes, sunAzimuths, port, sunSpheresMesh, sunPathCrvs, legend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; plug-in component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
doy_hoy = Ladybug_DOY_HOY(days="21", months=item, hours=item_2)  # -> HOY, DOY, date; plug-in component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
brep_3 = Brep(flatten([createhbsrfs.HBSurface, createhbsrfs_2.HBSurface]))
item_3 = ListItem(List=brep_2, Index=Slider(5, range=0..6), Wrap=True)
preview = CustomPreview(Geometry=createhbsrfs.HBSurface, Shader=ColourSwatch(SwatchColor=RGBA(217, 206, 206, 208)))
preview_2 = CustomPreview(Geometry=createhbsrfs_2.HBSurface, Shader=ColourSwatch(SwatchColor=RGBA(129, 150, 235, 74)))
flip = Flip(Surface=item_3)  # -> Surface, Result
gentestpts = Honeybee_GenerateTestPoints(testGeometry=flip.Surface, gridSize=Slider(0.1, range=0..1), distBaseSrf=Slider(0.65, range=0..1), moveTestMesh=True)  # -> readMe, simplify(testPoints), simplify(ptsVectors), simplify(facesArea), simplify(mesh); plug-in component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
# prepare a recipe
gridbasedsimulation = Honeybee_GridBasedSimulation(
    skyFile=genclimatebasedsky.skyFilePath,
    testPoints=gentestpts.testPoints,
    ptsVectors=gentestpts.ptsVectors,
    testMesh=gentestpts.mesh,
    simulationType=0)  # -> analysisRecipe; plug-in component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
toggle = BooleanToggle(True)
# run the analysis
rundaylightanalysis = Honeybee_RunDaylightSimulation(HBObjects=flatten(brep_3), analysisRecipe=gridbasedsimulation, writeRad=toggle, runRad=toggle, overwriteResults=True)  # -> readMe, analysisType, resultsUnit, illuminance_values, testPts, illuminance_files, radGeoFile, studyFolder, done; plug-in component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
panel_3 = Panel(doy_hoy.date)
# capture the viewport to an image
join = TextJoin(Text=[item, "21", item_2], Join="_")
panel_4 = Panel(join)
legendpar = Ladybug_LegendParameters(lowBound="300", highBound="2000")  # -> legendPar; plug-in component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
# visualize the results
concat = Concatenate(FragmentA=rundaylightanalysis.analysisType, FragmentC=panel_3)
captureview = Ladybug_CaptureView(fileName=panel_4, capture=Toggle(True))  # -> imagePath; plug-in component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
recolormesh = Ladybug_RecolorMesh(
    analysisResult=rundaylightanalysis.illuminance_values,
    inputMesh=gentestpts.mesh,
    legendPar=legendpar,
    analysisTitle=concat,
    legendTitle=rundaylightanalysis.resultsUnit)  # -> readMe, newMesh, newLegend, legendBasePt, meshColors, legendColors; plug-in component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
panel_5 = Panel(captureview)
