# Grasshopper definition Kamath_Ayodh.gh (Grasshopper 0.9.76)

# ---- group: Room Envelope
pt = ConstructPoint(XCoordinate=0, YCoordinate=0, ZCoordinate=0)
number_slider = Slider(4.45, range=0..10)
number_slider_2 = Slider(3.05, range=0..10)
number_slider_3 = Slider(2.5, range=0..10)
X = UnitX(Factor=number_slider)
Y = UnitY(Factor=number_slider_2)
Z = UnitZ(Factor=number_slider_3)
line = LineSDL(Start=pt, Direction=X, Length=number_slider)
line_2 = LineSDL(Start=pt, Direction=Y, Length=number_slider_2)
move = Move(Geometry=line, Motion=Y)  # -> Geometry, Transform
move_2 = Move(Geometry=line_2, Motion=X)  # -> Geometry, Transform
edgesrf = EdgeSurface(CurveA=line, CurveB=move.Geometry, CurveC=line_2, CurveD=move_2.Geometry)
extr = Extrude(Base=edgesrf, Direction=Z)

# ---- group: Front Door
yz = YZPlane(Origin=Point(0, 0, 0))
number_slider_4 = Slider(0.86, range=0..10)
planesrf = PlaneSurface(Plane=yz, XSize=number_slider_4, YSize=Slider(2.01, range=0..10))
subtraction = Subtraction(A=number_slider_2, B=number_slider_4)
subtraction_2 = Subtraction(A=subtraction, B=Slider(0.105, range=0..10))
Y_2 = UnitY(Factor=subtraction_2)
move_3 = Move(Geometry=planesrf, Motion=Y_2)  # -> Geometry, Transform

# ---- group: Windows
number_slider_5 = Slider(0.8, range=0..10)
cill_height = Slider(0.705, range=0..10)
gap = Slider(0.22, range=0..10)
division = Division(A=gap, B=2)
planesrf_2 = PlaneSurface(Plane=yz, XSize=number_slider_5, YSize=Slider(1.58, range=0..10))
Z_2 = UnitZ(Factor=cill_height)
move_4 = Move(Geometry=planesrf_2, Motion=Z_2)  # -> Geometry, Transform
division_2 = Division(A=number_slider_2, B=2)
addition = Addition(A=number_slider_5, B=gap)
addition_2 = Addition(A=division_2, B=division)
multiplication = Multiplication(A=addition, B=-1)
Y_3 = UnitY(Factor=addition_2)
Y_4 = UnitY(Factor=multiplication)
move_5 = Move(Geometry=move_4.Geometry, Motion=Y_3)  # -> Geometry, Transform
move_6 = Move(Geometry=move_5.Geometry, Motion=Y_4)  # -> Geometry, Transform
move_7 = Move(Geometry=move_5.Geometry, Motion=X)  # -> Geometry, Transform
move_8 = Move(Geometry=move_6.Geometry, Motion=X)  # -> Geometry, Transform

# ---- group: Bathroom Door
xz = XZPlane(Origin=Point(0, 0, 0))
number_slider_6 = Slider(1.45, range=0..10)
division_3 = Division(A=number_slider_6, B=2)
planesrf_3 = PlaneSurface(Plane=xz, XSize=number_slider_6, YSize=Slider(2.01, range=0..10))
subtraction_3 = Subtraction(A=Slider(1.45, range=0..10), B=division_3)
X_2 = UnitX(Factor=subtraction_3)
move_9 = Move(Geometry=planesrf_3, Motion=X_2)  # -> Geometry, Transform

# ---- group: Kitchen Door
number_slider_7 = Slider(0.8, range=0..10)
division_4 = Division(A=number_slider_7, B=2)
planesrf_4 = PlaneSurface(Plane=xz, XSize=number_slider_7, YSize=Slider(2.01, range=0..10))
subtraction_4 = Subtraction(A=Slider(2.4, range=0..10), B=division_4)
X_3 = UnitX(Factor=subtraction_4)
move_10 = Move(Geometry=planesrf_4, Motion=X_3)  # -> Geometry, Transform
move_11 = Move(Geometry=move_10.Geometry, Motion=Y)  # -> Geometry, Transform

# ----
split = SplitBrep(Brep=extr, Cutter=move_3.Geometry)
item = ListItem(List=split, Index=1, Wrap=True)
split_2 = SplitBrep(Brep=item, Cutter=move_7.Geometry)
item_2 = ListItem(List=split_2, Index=1, Wrap=True)

# ---- group: Ventilator
number_slider_8 = Slider(0.6, range=0..10)
number_slider_9 = Slider(0.6, range=0..10)
planesrf_5 = PlaneSurface(Plane=yz, XSize=number_slider_8, YSize=number_slider_9)
subtraction_5 = Subtraction(A=number_slider_2, B=number_slider_8)
subtraction_6 = Subtraction(A=number_slider_3, B=number_slider_9)
division_5 = Division(A=subtraction_5, B=2)
Y_5 = UnitY(Factor=division_5)
Z_3 = UnitZ(Factor=subtraction_6)
move_12 = Move(Geometry=planesrf_5, Motion=Y_5)  # -> Geometry, Transform
move_13 = Move(Geometry=move_12.Geometry, Motion=Z_3)  # -> Geometry, Transform

# ----
split_3 = SplitBrep(Brep=item_2, Cutter=move_8.Geometry)
item_3 = ListItem(List=split_3, Index=1, Wrap=True)
split_4 = SplitBrep(Brep=item_3, Cutter=move_9.Geometry)
item_4 = ListItem(List=split_4, Index=1, Wrap=True)
split_5 = SplitBrep(Brep=item_4, Cutter=move_11.Geometry)
item_5 = ListItem(List=split_5, Index=1, Wrap=True)
split_6 = SplitBrep(Brep=item_5, Cutter=move_13.Geometry)
item_6 = ListItem(List=split_6, Index=1, Wrap=True)

# ---- group: Windows
edges = BrepEdges(Brep=move_7.Geometry)  # -> Naked, Interior, NonManifold
edges_2 = BrepEdges(Brep=move_8.Geometry)  # -> Naked, Interior, NonManifold
join = JoinCurves(Curves=edges.Naked, Preserve=False)
join_2 = JoinCurves(Curves=edges_2.Naked, Preserve=False)
offset = Offset(Curve=join, Distance=-0.04, Plane=yz, Corners=1)
offset_2 = Offset(Curve=join_2, Distance=-0.04, Plane=yz, Corners=1)
loft = Loft(
    Curves=flatten([offset, join]),
    Options={Adjust=False, Closed=False, LoftEnds=0, LoftSimp=0, LoftType=0, Rebuild=10, Refit=0.01})
loft_2 = Loft(
    Curves=flatten([offset_2, join_2]),
    Options={Adjust=False, Closed=False, LoftEnds=0, LoftSimp=0, LoftType=0, Rebuild=10, Refit=0.01})
X_4 = UnitX(Factor=0.024)
X_5 = UnitX(Factor=0.024)
extr_2 = Extrude(Base=loft, Direction=X_4)
extr_3 = Extrude(Base=loft_2, Direction=X_5)
boundary = BoundarySurfaces(Edges=offset)
boundary_2 = BoundarySurfaces(Edges=offset_2)
X_6 = UnitX(Factor=0.006)
extr_4 = Extrude(Base=[boundary, boundary_2], Direction=X_6)
X_7 = UnitX(Factor=0.018)
move_14 = Move(Geometry=extr_4, Motion=X_7)  # -> Geometry, Transform
brep = Brep([extr_2, extr_4, extr_3, move_14.Geometry])

# ---- group: Wall Thickness
debrep = DeconstructBrep(Brep=item_6)  # -> Faces, Edges, Vertices
item_7 = ListItem(List=debrep.Faces, Index=1, Wrap=True)
item_8 = ListItem(List=debrep.Faces, Index=2, Wrap=True)
item_9 = ListItem(List=debrep.Faces, Index=3, Wrap=True)
item_10 = ListItem(List=debrep.Faces, Index=5, Wrap=True)
door_thk = Slider(0.045, range=0..1)
interior_wall_thk = Slider(0.1, range=0..1)
exterior_wall_thk = Slider(0.4, range=0..1)
kitchen_wall_srf = Surface(item_8)
west_wall_srf = Surface(item_9)
bathroom_wall_srf = Surface(item_10)
entrance_wall_srf = Surface(item_7)
division_6 = Division(A=exterior_wall_thk, B=2)
X_8 = UnitX(Factor=door_thk)
X_9 = UnitX(Factor=interior_wall_thk)
Y_6 = UnitY(Factor=interior_wall_thk)
X_10 = UnitX(Factor=exterior_wall_thk)
Y_7 = UnitY(Factor=interior_wall_thk)
X_11 = UnitX(Factor=division_6)
rev = Reverse(Vector=X_8)
rev_2 = Reverse(Vector=X_9)
rev_3 = Reverse(Vector=Y_7)

# ---- group: Window Projection
bbox = BoundingBox(Content=[move_7.Geometry, move_8.Geometry], Plane=PlaneXY(0, 0, 0), UnionBox=True)  # -> Box, Box_2
number_slider_10 = Slider(10, range=0..10)
box_corners = BoxCorners(Box=bbox.Box)  # -> CornerA, CornerB, CornerC, CornerD, CornerE, CornerF, CornerG, CornerH
multiplication_2 = Multiplication(A=number_slider_10, B=Slider(0.364, range=0..1))
ln = Line(StartPoint=box_corners.CornerD, EndPoint=box_corners.CornerG)
ln_2 = Line(StartPoint=box_corners.CornerE, EndPoint=box_corners.CornerG)
ln_3 = Line(StartPoint=box_corners.CornerA, EndPoint=box_corners.CornerE)
ln_4 = Line(StartPoint=box_corners.CornerA, EndPoint=box_corners.CornerD)
divide = DivideCurve(Curve=ln_4, Count=2, Kinks=False)  # -> Points, Tangents, Parameters
X_12 = UnitX(Factor=exterior_wall_thk)
join_3 = JoinCurves(Curves=[ln, ln_3, ln_2], Preserve=False)
item_11 = ListItem(List=divide.Points, Index=1, Wrap=True)
X_13 = UnitX(Factor=number_slider_10)
X_14 = UnitX(Factor=multiplication_2)
move_15 = Move(Geometry=join_3, Motion=X_12)  # -> Geometry, Transform
move_16 = Move(Geometry=item_11, Motion=X_13)  # -> Geometry, Transform
move_17 = Move(Geometry=item_11, Motion=X_14)  # -> Geometry, Transform
extr_5 = ExtrudePoint(Base=move_15.Geometry, Point=move_16.Geometry)
yz_2 = YZPlane(Origin=move_17.Geometry)
sec = BrepPlane(Brep=extr_5, Plane=yz_2)  # -> Curves, Points
flip = FlipCurve(Curve=move_15.Geometry, Guide=sec.Curves)  # -> Curve, Flag

# ---- group: Exhaust Fan
exhaust_thk = Slider(0.15, range=0..1)
X_15 = UnitX(Factor=exhaust_thk)
rev_4 = Reverse(Vector=X_15)

# ---- group: To Bake
floor_ceiling = Geometry([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])
closet_space = Geometry([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])
table_brep = Brep([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])
loft_3 = Loft(
    Curves=flatten([flip.Curve, sec.Curves]),
    Options={Adjust=False, Closed=False, LoftEnds=0, LoftSimp=0, LoftType=0, Rebuild=10, Refit=0.01})
neighbor = Geometry([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])
move_18 = Move(Geometry=brep, Motion=X_11)  # -> Geometry, Transform
kitchen = Geometry([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])
extr_6 = Extrude(Base=move_3.Geometry, Direction=rev)
extr_7 = Extrude(Base=entrance_wall_srf, Direction=rev_2)
extr_8 = Extrude(Base=kitchen_wall_srf, Direction=Y_6)
extr_9 = Extrude(Base=west_wall_srf, Direction=X_10)
extr_10 = Extrude(Base=bathroom_wall_srf, Direction=rev_3)
extr_11 = Extrude(Base=move_13.Geometry, Direction=rev_4)
bed = Brep(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)
