# Grasshopper definition Kamath_Ayodh_2.gh (Grasshopper 0.9.76)
# plug-ins: Python Interpreter

# ---- group: Room Envelope
pt = ConstructPoint(XCoordinate=0, YCoordinate=0, ZCoordinate=0)
number_slider = Slider(4.45, range=0..10)
number_slider_2 = Slider(3.05, range=0..10)
number_slider_3 = Slider(2.5, range=0..10)
X = UnitX(Factor=number_slider)
Y = UnitY(Factor=number_slider_2)
Z = UnitZ(Factor=number_slider_3)
line = LineSDL(Start=pt, Direction=X, Length=number_slider)
line_2 = LineSDL(Start=pt, Direction=Y, Length=number_slider_2)
move = Move(Geometry=line, Motion=Y)  # -> Geometry, Transform
move_2 = Move(Geometry=line_2, Motion=X)  # -> Geometry, Transform
edgesrf = EdgeSurface(CurveA=line, CurveB=move.Geometry, CurveC=line_2, CurveD=move_2.Geometry)
extr = Extrude(Base=edgesrf, Direction=Z)

# ---- group: Front Door
yz = YZPlane(Origin=Point(0, 0, 0))
number_slider_4 = Slider(0.86, range=0..10)
planesrf = PlaneSurface(Plane=yz, XSize=number_slider_4, YSize=Slider(2.01, range=0..10))
subtraction = Subtraction(A=number_slider_2, B=number_slider_4)
subtraction_2 = Subtraction(A=subtraction, B=Slider(0.105, range=0..10))
Y_2 = UnitY(Factor=subtraction_2)
move_3 = Move(Geometry=planesrf, Motion=Y_2)  # -> Geometry, Transform

# ---- group: Windows
number_slider_5 = Slider(0.8, range=0..10)
cill_height = Slider(0.705, range=0..10)
gap = Slider(0.22, range=0..10)
division = Division(A=gap, B=2)
planesrf_2 = PlaneSurface(Plane=yz, XSize=number_slider_5, YSize=Slider(1.58, range=0..10))
Z_2 = UnitZ(Factor=cill_height)
move_4 = Move(Geometry=planesrf_2, Motion=Z_2)  # -> Geometry, Transform
division_2 = Division(A=number_slider_2, B=2)
addition = Addition(A=number_slider_5, B=gap)
addition_2 = Addition(A=division_2, B=division)
multiplication = Multiplication(A=addition, B=-1)
Y_3 = UnitY(Factor=addition_2)
Y_4 = UnitY(Factor=multiplication)
move_5 = Move(Geometry=move_4.Geometry, Motion=Y_3)  # -> Geometry, Transform
move_6 = Move(Geometry=move_5.Geometry, Motion=Y_4)  # -> Geometry, Transform
move_7 = Move(Geometry=move_5.Geometry, Motion=X)  # -> Geometry, Transform
move_8 = Move(Geometry=move_6.Geometry, Motion=X)  # -> Geometry, Transform

# ---- group: Bathroom Door
xz = XZPlane(Origin=Point(0, 0, 0))
number_slider_6 = Slider(1.45, range=0..10)
division_3 = Division(A=number_slider_6, B=2)
planesrf_3 = PlaneSurface(Plane=xz, XSize=number_slider_6, YSize=Slider(2.01, range=0..10))
subtraction_3 = Subtraction(A=Slider(1.45, range=0..10), B=division_3)
X_2 = UnitX(Factor=subtraction_3)
move_9 = Move(Geometry=planesrf_3, Motion=X_2)  # -> Geometry, Transform

# ---- group: Kitchen Door
number_slider_7 = Slider(0.8, range=0..10)
division_4 = Division(A=number_slider_7, B=2)
planesrf_4 = PlaneSurface(Plane=xz, XSize=number_slider_7, YSize=Slider(2.01, range=0..10))
subtraction_4 = Subtraction(A=Slider(2.4, range=0..10), B=division_4)
X_3 = UnitX(Factor=subtraction_4)
move_10 = Move(Geometry=planesrf_4, Motion=X_3)  # -> Geometry, Transform
move_11 = Move(Geometry=move_10.Geometry, Motion=Y)  # -> Geometry, Transform

# ---- group: Ladybug
ladybug = Ladybug_Ladybug()  # -> Vviiiiiiiiiizzz; plug-in component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
panel = Panel("https://www.energyplus.net/weather-download/north_and_central_america_wmo_region_4/USA/PA/USA_PA_Philadelphia.Intl.AP.724080_TMY3/all")
epw_stat = Ladybug_OpenEPWAndSTATWeatherFiles(weatherFileURL=panel)  # -> epwFile, statFile; plug-in component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
importepw = Ladybug_ImportEpw(epwFile=epw_stat.epwFile)  # -> readMe, latitude, location, dryBulbTemperature, dewPointTemperature, relativeHumidity, windSpeed, windDirection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; plug-in component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
legendpar = Ladybug_LegendParameters(
    lowBound="0",
    highBound="10",
    customColors=flatten([ColourSwatch(SwatchColor=RGB(255, 255, 255)), ColourSwatch(SwatchColor=RGB(0, 0, 0))]))  # -> legendPar; plug-in component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
Y_5 = UnitY(Factor=1)
series = Series(Start=1, Step=1, Count=24)
series_2 = Series(Start=1, Step=1, Count=31)
series_3 = Series(Start=1, Step=1, Count=12)
rev = Reverse(Vector=Y_5)
sunpath = Ladybug_SunPath(
    north=rev,
    location=importepw.location,
    hour=series,
    day=series_2,
    month=series_3,
    timeStep=1,
    sunScale=0,
    annualHourlyData=flatten(importepw.totalSkyCover),
    conditionalStatement="a < 6",
    legendPar=legendpar,
    dailyOrAnnualSunPath=True)  # -> readMe, sunVectors, sunAltitudes, sunAzimuths, port, sunSpheresMesh, sunPathCrvs, legend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; plug-in component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

# ----
split = SplitBrep(Brep=extr, Cutter=move_3.Geometry)
item = ListItem(List=split, Index=1, Wrap=True)
split_2 = SplitBrep(Brep=item, Cutter=move_7.Geometry)
item_2 = ListItem(List=split_2, Index=1, Wrap=True)

# ---- group: Ventilator
number_slider_8 = Slider(0.6, range=0..10)
number_slider_9 = Slider(0.6, range=0..10)
planesrf_5 = PlaneSurface(Plane=yz, XSize=number_slider_8, YSize=number_slider_9)
subtraction_5 = Subtraction(A=number_slider_2, B=number_slider_8)
subtraction_6 = Subtraction(A=number_slider_3, B=number_slider_9)
division_5 = Division(A=subtraction_5, B=2)
Y_6 = UnitY(Factor=division_5)
Z_3 = UnitZ(Factor=subtraction_6)
move_12 = Move(Geometry=planesrf_5, Motion=Y_6)  # -> Geometry, Transform
move_13 = Move(Geometry=move_12.Geometry, Motion=Z_3)  # -> Geometry, Transform

# ----
split_3 = SplitBrep(Brep=item_2, Cutter=move_8.Geometry)
item_3 = ListItem(List=split_3, Index=1, Wrap=True)
split_4 = SplitBrep(Brep=item_3, Cutter=move_9.Geometry)
item_4 = ListItem(List=split_4, Index=1, Wrap=True)
split_5 = SplitBrep(Brep=item_4, Cutter=move_11.Geometry)
item_5 = ListItem(List=split_5, Index=1, Wrap=True)
split_6 = SplitBrep(Brep=item_5, Cutter=move_13.Geometry)
item_6 = ListItem(List=split_6, Index=1, Wrap=True)

# ---- group: Windows
edges = BrepEdges(Brep=move_7.Geometry)  # -> Naked, Interior, NonManifold
edges_2 = BrepEdges(Brep=move_8.Geometry)  # -> Naked, Interior, NonManifold
join = JoinCurves(Curves=edges.Naked, Preserve=False)
join_2 = JoinCurves(Curves=edges_2.Naked, Preserve=False)
offset = Offset(Curve=join, Distance=-0.04, Plane=yz, Corners=1)
offset_2 = Offset(Curve=join_2, Distance=-0.04, Plane=yz, Corners=1)
loft = Loft(
    Curves=flatten([offset, join]),
    Options={Adjust=False, Closed=False, LoftEnds=0, LoftSimp=0, LoftType=0, Rebuild=10, Refit=0.01})
loft_2 = Loft(
    Curves=flatten([offset_2, join_2]),
    Options={Adjust=False, Closed=False, LoftEnds=0, LoftSimp=0, LoftType=0, Rebuild=10, Refit=0.01})
X_4 = UnitX(Factor=0.024)
X_5 = UnitX(Factor=0.024)
extr_2 = Extrude(Base=loft, Direction=X_4)
extr_3 = Extrude(Base=loft_2, Direction=X_5)
boundary = BoundarySurfaces(Edges=offset)
boundary_2 = BoundarySurfaces(Edges=offset_2)
X_6 = UnitX(Factor=0.006)
extr_4 = Extrude(Base=[boundary, boundary_2], Direction=X_6)
X_7 = UnitX(Factor=0.018)
move_14 = Move(Geometry=extr_4, Motion=X_7)  # -> Geometry, Transform
brep = Brep([extr_2, extr_4, extr_3, move_14.Geometry])

# ---- group: Wall Thickness
debrep = DeconstructBrep(Brep=item_6)  # -> Faces, Edges, Vertices
item_7 = ListItem(List=debrep.Faces, Index=1, Wrap=True)
item_8 = ListItem(List=debrep.Faces, Index=2, Wrap=True)
item_9 = ListItem(List=debrep.Faces, Index=3, Wrap=True)
item_10 = ListItem(List=debrep.Faces, Index=5, Wrap=True)
door_thk = Slider(0.045, range=0..1)
interior_wall_thk = Slider(0.1, range=0..1)
exterior_wall_thk = Slider(0.4, range=0..1)
kitchen_wall_srf = Surface(item_8)
west_wall_srf = Surface(item_9)
bathroom_wall_srf = Surface(item_10)
entrance_wall_srf = Surface(item_7)
division_6 = Division(A=exterior_wall_thk, B=2)
X_8 = UnitX(Factor=door_thk)
X_9 = UnitX(Factor=interior_wall_thk)
Y_7 = UnitY(Factor=interior_wall_thk)
X_10 = UnitX(Factor=exterior_wall_thk)
Y_8 = UnitY(Factor=interior_wall_thk)
X_11 = UnitX(Factor=division_6)
rev_2 = Reverse(Vector=X_8)
rev_3 = Reverse(Vector=X_9)
rev_4 = Reverse(Vector=Y_8)

# ---- group: Window Projection
bbox = BoundingBox(Content=[move_7.Geometry, move_8.Geometry], Plane=PlaneXY(0, 0, 0), UnionBox=True)  # -> Box, Box_2
number_slider_10 = Slider(10, range=0..10)
box_corners = BoxCorners(Box=bbox.Box)  # -> CornerA, CornerB, CornerC, CornerD, CornerE, CornerF, CornerG, CornerH
multiplication_2 = Multiplication(A=number_slider_10, B=Slider(0.364, range=0..1))
ln = Line(StartPoint=box_corners.CornerD, EndPoint=box_corners.CornerG)
ln_2 = Line(StartPoint=box_corners.CornerE, EndPoint=box_corners.CornerG)
ln_3 = Line(StartPoint=box_corners.CornerA, EndPoint=box_corners.CornerE)
ln_4 = Line(StartPoint=box_corners.CornerA, EndPoint=box_corners.CornerD)
divide = DivideCurve(Curve=ln_4, Count=2, Kinks=False)  # -> Points, Tangents, Parameters
X_12 = UnitX(Factor=exterior_wall_thk)
join_3 = JoinCurves(Curves=[ln, ln_3, ln_2], Preserve=False)
item_11 = ListItem(List=divide.Points, Index=1, Wrap=True)
X_13 = UnitX(Factor=number_slider_10)
X_14 = UnitX(Factor=multiplication_2)
move_15 = Move(Geometry=join_3, Motion=X_12)  # -> Geometry, Transform
move_16 = Move(Geometry=item_11, Motion=X_13)  # -> Geometry, Transform
move_17 = Move(Geometry=item_11, Motion=X_14)  # -> Geometry, Transform
extr_5 = ExtrudePoint(Base=move_15.Geometry, Point=move_16.Geometry)
yz_2 = YZPlane(Origin=move_17.Geometry)
sec = BrepPlane(Brep=extr_5, Plane=yz_2)  # -> Curves, Points
flip = FlipCurve(Curve=move_15.Geometry, Guide=sec.Curves)  # -> Curve, Flag

# ---- group: Exhaust Fan
exhaust_thk = Slider(0.15, range=0..1)
X_15 = UnitX(Factor=exhaust_thk)
rev_5 = Reverse(Vector=X_15)

# ---- group: To Bake
floor_ceiling = Geometry([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])
closet_space = Geometry([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])
table_brep = Brep([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])
loft_3 = Loft(
    Curves=flatten([flip.Curve, sec.Curves]),
    Options={Adjust=False, Closed=False, LoftEnds=0, LoftSimp=0, LoftType=0, Rebuild=10, Refit=0.01})
neighbor = Geometry([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])
move_18 = Move(Geometry=brep, Motion=X_11)  # -> Geometry, Transform
kitchen = Geometry([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])
extr_6 = Extrude(Base=move_3.Geometry, Direction=rev_2)
extr_7 = Extrude(Base=entrance_wall_srf, Direction=rev_3)
extr_8 = Extrude(Base=kitchen_wall_srf, Direction=Y_7)
extr_9 = Extrude(Base=west_wall_srf, Direction=X_10)
extr_10 = Extrude(Base=bathroom_wall_srf, Direction=rev_4)
extr_11 = Extrude(Base=move_13.Geometry, Direction=rev_5)
bed = Brep(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)

# ---- group: Glare Hours
item_12 = ListItem(List=table_brep, Index=4, Wrap=True)
area = Area(Geometry=item_12)  # -> Area, Centroid
mesh = MeshBrep(
    Brep=[boundary, boundary_2],
    Settings={GridMaxCount=0, GridMinCount=16, JaggedSeams=False, MaxEdgeLength=0, MinEdgeLength=0.0001, MinTolerance=0, Refine=True, RefineAngle=0, RelativeTolerance=0.65, SimplePlanes=True, Tolerance=0})
multiplication_3 = Multiplication(A=sunpath.sunVectors, B=2)
mjoin = MeshJoin(Meshes=mesh)
rev_6 = Reverse(Vector=multiplication_3)
meshray = MeshRay(Mesh=flatten(mjoin), Point=area.Centroid, Direction=rev_6)  # -> Point, Hit
disjoint = DisjointMesh(Mesh=sunpath.sunSpheresMesh)
dispatch = Dispatch(List=sunpath.sunPositionsInfo, DispatchPattern=meshray.Hit)  # -> ListA, ListB
dispatch_2 = Dispatch(List=disjoint, DispatchPattern=meshray.Hit)  # -> ListA, ListB
geo = Geometry(sunpath.sunPathCrvs)
geo_2 = Geometry(sunpath.legend)
geo_3 = Geometry(sunpath.title)
days_and_times_of_glare_on_table = Panel(dispatch.ListA)
preview = CustomPreview(
    Geometry=dispatch_2.ListA,
    Shader={ambient=RGB(0, 0, 0), diffuse=RGB(255, 105, 180), emission=RGB(76, 32, 54), shine=0.5, specular=RGB(255, 255, 255), transparency=0})

# ----
panel_2 = Panel("""1. This sun path chart shows the sun positions for the times that there is glare at my table.
(Apologies for the inverted North).""")
bbox_2 = BoundingBox(
    Content=[sunpath.sunSpheresMesh, sunpath.sunPathCrvs, sunpath.legend, sunpath.title],
    Plane=PlaneXY(0, 0, 0),
    UnionBox=True)  # -> Box, Box_2
box_corners_2 = BoxCorners(Box=bbox_2.Box)  # -> CornerA, CornerB, CornerC, CornerD, CornerE, CornerF, CornerG, CornerH
tag = TextTag3D(Location=box_corners_2.CornerD, Text=panel_2, Size=10, Justification=7)

# ---- group: Temperature
panel_3 = Panel("22")
panel_4 = Panel("27")
bbox_3 = BoundingBox(Content=[geo_2, geo], Plane=PlaneXY(0, 0, 0), UnionBox=True)  # -> Box, Box_2
number_slider_11 = Slider(250, range=0..1000)
box_corners_3 = BoxCorners(Box=bbox_3.Box)  # -> CornerA, CornerB, CornerC, CornerD, CornerE, CornerF, CornerG, CornerH
legendpar_2 = Ladybug_LegendParameters(customColors=flatten([ColourSwatch(SwatchColor=RGB(0, 120, 255)), ColourSwatch(SwatchColor=RGB(255, 120, 0))]))  # -> legendPar; plug-in component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
pdecon = Deconstruct(Point=box_corners_3.CornerB)  # -> XComponent, YComponent, ZComponent
panel_5 = Panel("""2. My personal comfort level is between 22C and 27C
(I usually feel cold in a typical airconditioned room).
This chart shows temperatures between 22C and 27C.""")
addition_3 = Addition(A=pdecon.XComponent, B=number_slider_11)
pt_2 = ConstructPoint(XCoordinate=addition_3, YCoordinate=pdecon.YComponent, ZCoordinate=pdecon.ZComponent)
_3dchart = Ladybug_3DChart(
    inputData=flatten(importepw.dryBulbTemperature),
    basePoint=pt_2,
    xScale=0.125,
    zScale=0,
    legendPar=legendpar_2,
    condStatement="22 < a < 27")  # -> readMe, graphMesh, graphCurves, legend, legendBasePts, title, titleBasePts, dataPts, conditionalHOY; plug-in component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
lng = ListLength(List=_3dchart.conditionalHOY)
division_7 = Division(A=lng, B=8767)
bbox_4 = BoundingBox(Content=_3dchart.legend, Plane=PlaneXY(0, 0, 0), UnionBox=True)  # -> Box, Box_2
multiplication_4 = Multiplication(A=division_7, B=100)  # -> flatten(Result)
box_corners_4 = BoxCorners(Box=bbox_4.Box)  # -> CornerA, CornerB, CornerC, CornerD, CornerE, CornerF, CornerG, CornerH
comfortable_time = Panel(multiplication_4)
tag_2 = TextTag3D(Location=box_corners_4.CornerC, Text=panel_5, Size=10, Justification=7)

_3dchart_2 = Ladybug_3DChart(inputData=flatten(importepw.dryBulbTemperature), xScale=0.125, zScale=0, condStatement="27 < a")  # -> readMe, graphMesh, graphCurves, legend, legendBasePts, title, titleBasePts, dataPts, conditionalHOY; plug-in component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
lng_2 = ListLength(List=_3dchart_2.conditionalHOY)
division_8 = Division(A=lng_2, B=8767)
multiplication_5 = Multiplication(A=division_8, B=100)  # -> flatten(Result)
hot_time = Panel(multiplication_5)

_3dchart_3 = Ladybug_3DChart(inputData=flatten(importepw.dryBulbTemperature), xScale=0.125, zScale=0, condStatement="22 > a")  # -> readMe, graphMesh, graphCurves, legend, legendBasePts, title, titleBasePts, dataPts, conditionalHOY; plug-in component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
lng_3 = ListLength(List=_3dchart_3.conditionalHOY)
division_9 = Division(A=lng_3, B=8767)
multiplication_6 = Multiplication(A=division_9, B=100)  # -> flatten(Result)
hot_time_2 = Panel(multiplication_6)

# ---- group: Humidity
panel_6 = Panel("30")
panel_7 = Panel("55")
bbox_5 = BoundingBox(Content=_3dchart.graphCurves, Plane=PlaneXY(0, 0, 0), UnionBox=True)  # -> Box, Box_2
box_corners_5 = BoxCorners(Box=bbox_5.Box)  # -> CornerA, CornerB, CornerC, CornerD, CornerE, CornerF, CornerG, CornerH
pdecon_2 = Deconstruct(Point=box_corners_5.CornerD)  # -> XComponent, YComponent, ZComponent
legendpar_3 = Ladybug_LegendParameters(customColors=flatten([ColourSwatch(SwatchColor=RGB(120, 120, 120)), ColourSwatch(SwatchColor=RGB(0, 120, 255))]))  # -> legendPar; plug-in component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
pdecon_3 = Deconstruct(Point=pt_2)  # -> XComponent, YComponent, ZComponent
addition_4 = Addition(A=pdecon_2.YComponent, B=number_slider_11)
pt_3 = ConstructPoint(XCoordinate=pdecon_3.XComponent, YCoordinate=addition_4, ZCoordinate=pdecon_3.ZComponent)
panel_8 = Panel("""3. My personal comfort level is between 30% and 50% RH.
This chart shows RH between
30% and 50%.""")
_3dchart_4 = Ladybug_3DChart(
    inputData=flatten(importepw.relativeHumidity),
    basePoint=pt_3,
    xScale=0.125,
    zScale=0,
    legendPar=legendpar_3,
    condStatement="30 < a < 50")  # -> readMe, graphMesh, graphCurves, legend, legendBasePts, title, titleBasePts, dataPts, conditionalHOY; plug-in component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
lng_4 = ListLength(List=_3dchart_4.conditionalHOY)
division_10 = Division(A=lng_4, B=8767)
bbox_6 = BoundingBox(Content=_3dchart_4.legend, Plane=PlaneXY(0, 0, 0), UnionBox=True)  # -> Box, Box_2
multiplication_7 = Multiplication(A=division_10, B=100)  # -> flatten(Result)
box_corners_6 = BoxCorners(Box=bbox_6.Box)  # -> CornerA, CornerB, CornerC, CornerD, CornerE, CornerF, CornerG, CornerH
comfortable_time_2 = Panel(multiplication_7)
tag_3 = TextTag3D(Location=box_corners_6.CornerC, Text=panel_8, Size=10, Justification=7)

_3dchart_5 = Ladybug_3DChart(inputData=flatten(importepw.relativeHumidity), xScale=0.125, zScale=0, condStatement="a < 50")  # -> readMe, graphMesh, graphCurves, legend, legendBasePts, title, titleBasePts, dataPts, conditionalHOY; plug-in component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
lng_5 = ListLength(List=_3dchart_5.conditionalHOY)
division_11 = Division(A=lng_5, B=8767)
multiplication_8 = Multiplication(A=division_11, B=100)  # -> flatten(Result)
comfortable_time_3 = Panel(multiplication_8)

# ---- group: Wind Speed
panel_9 = Panel("8")
bbox_7 = BoundingBox(Content=_3dchart_4.graphCurves, Plane=PlaneXY(0, 0, 0), UnionBox=True)  # -> Box, Box_2
box_corners_7 = BoxCorners(Box=bbox_7.Box)  # -> CornerA, CornerB, CornerC, CornerD, CornerE, CornerF, CornerG, CornerH
pdecon_4 = Deconstruct(Point=box_corners_7.CornerD)  # -> XComponent, YComponent, ZComponent
legendpar_4 = Ladybug_LegendParameters(customColors=flatten([ColourSwatch(SwatchColor=RGB(120, 120, 120)), ColourSwatch(SwatchColor=RGB(0, 240, 255))]))  # -> legendPar; plug-in component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
pdecon_5 = Deconstruct(Point=pt_2)  # -> XComponent, YComponent, ZComponent
panel_10 = Panel("""4. The EU standard 15242:2006 p.20 states that for
"cowl ventilation in a passive duct for residential
and low size non-residential buildings" wind speed
"in general" is taken to be 8 m/s.
This chart shows wind speeds above 8 m/s.""")
addition_5 = Addition(A=pdecon_4.YComponent, B=number_slider_11)
pt_4 = ConstructPoint(XCoordinate=pdecon_5.XComponent, YCoordinate=addition_5, ZCoordinate=pdecon_5.ZComponent)
_3dchart_6 = Ladybug_3DChart(
    inputData=flatten(importepw.windSpeed),
    basePoint=pt_4,
    xScale=0.125,
    zScale=0,
    legendPar=legendpar_4,
    condStatement="8 < a")  # -> readMe, graphMesh, graphCurves, legend, legendBasePts, title, titleBasePts, dataPts, conditionalHOY; plug-in component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
lng_6 = ListLength(List=_3dchart_6.conditionalHOY)
division_12 = Division(A=lng_6, B=8767)
bbox_8 = BoundingBox(Content=_3dchart_6.legend, Plane=PlaneXY(0, 0, 0), UnionBox=True)  # -> Box, Box_2
multiplication_9 = Multiplication(A=division_12, B=100)  # -> flatten(Result)
box_corners_8 = BoxCorners(Box=bbox_8.Box)  # -> CornerA, CornerB, CornerC, CornerD, CornerE, CornerF, CornerG, CornerH
comfortable_time_4 = Panel(multiplication_9)
tag_4 = TextTag3D(Location=box_corners_8.CornerC, Text=panel_10, Size=10, Justification=7)

# ---- group: Illuminance
panel_11 = Panel("75000")
bbox_9 = BoundingBox(Content=_3dchart_6.graphCurves, Plane=PlaneXY(0, 0, 0), UnionBox=True)  # -> Box, Box_2
box_corners_9 = BoxCorners(Box=bbox_9.Box)  # -> CornerA, CornerB, CornerC, CornerD, CornerE, CornerF, CornerG, CornerH
pdecon_6 = Deconstruct(Point=box_corners_9.CornerD)  # -> XComponent, YComponent, ZComponent
legendpar_5 = Ladybug_LegendParameters(customColors=flatten([ColourSwatch(SwatchColor=RGB(120, 120, 120)), ColourSwatch(SwatchColor=RGB(255, 240, 0))]))  # -> legendPar; plug-in component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
pdecon_7 = Deconstruct(Point=pt_2)  # -> XComponent, YComponent, ZComponent
panel_13 = Panel("""5. The typical illuminance in a home is 150 lux.
The static contrast range of the human eye is  1000:1.
The typical light transmittance of a double glazed window is 50%.
Therefore I will typically have privacy indoors when the illuminance outside is above 75,000 lux.
This chart shows global horizontal illuminance above 75,000 lux.""")
addition_6 = Addition(A=pdecon_6.YComponent, B=number_slider_11)
pt_5 = ConstructPoint(XCoordinate=pdecon_7.XComponent, YCoordinate=addition_6, ZCoordinate=pdecon_7.ZComponent)
_3dchart_7 = Ladybug_3DChart(
    inputData=flatten(importepw.globalHorizontalIlluminance),
    basePoint=pt_5,
    xScale=0.125,
    zScale=0,
    legendPar=legendpar_5,
    condStatement="a > 75000")  # -> readMe, graphMesh, graphCurves, legend, legendBasePts, title, titleBasePts, dataPts, conditionalHOY; plug-in component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
lng_7 = ListLength(List=_3dchart_7.conditionalHOY)
division_13 = Division(A=lng_7, B=8767)
bbox_10 = BoundingBox(Content=_3dchart_7.legend, Plane=PlaneXY(0, 0, 0), UnionBox=True)  # -> Box, Box_2
multiplication_10 = Multiplication(A=division_13, B=100)  # -> flatten(Result)
box_corners_10 = BoxCorners(Box=bbox_10.Box)  # -> CornerA, CornerB, CornerC, CornerD, CornerE, CornerF, CornerG, CornerH
comfortable_time_5 = Panel(multiplication_10)
tag_5 = TextTag3D(Location=box_corners_10.CornerC, Text=panel_13, Size=10, Justification=7)

# ---- group: Climate Change
panel_14 = Panel("""6. A report titled "Toward a Climate Ready Philadelphia" was prepared by the Mayor's Office of Sustainability and ICF International in November 2015. According to this report climate change will have the following efects on the climate data anaysis for my living space:

a. The number of days in a year with temperatures above 95F (35C) will increase ten times.

b. Humidity and precipitation levels will rise.

The result of these effects will mean that passive climate control strategies through cross-ventilation will be less effective than they already are, and I am likely to need an air conditioner to stay comfortable.

This knowledge will deter me from investing in passive climate control strategies as the return on investment will be reduced as the effects of climate change take hold.""")
bbox_11 = BoundingBox(Content=_3dchart_7.graphCurves, Plane=PlaneXY(0, 0, 0), UnionBox=True)  # -> Box, Box_2
box_corners_11 = BoxCorners(Box=bbox_11.Box)  # -> CornerA, CornerB, CornerC, CornerD, CornerE, CornerF, CornerG, CornerH
pdecon_8 = Deconstruct(Point=box_corners_11.CornerD)  # -> XComponent, YComponent, ZComponent
addition_7 = Addition(A=pdecon_8.YComponent, B=350)
pt_6 = ConstructPoint(XCoordinate=pdecon_8.XComponent, YCoordinate=addition_7, ZCoordinate=pdecon_8.ZComponent)
tag_6 = TextTag3D(Location=pt_6, Text=panel_14, Size=10, Justification=7)

# ---- group: Conclusions
intersection = SetIntersection(SetA=_3dchart_2.conditionalHOY, SetB=_3dchart_5.conditionalHOY, SetC=_3dchart_6.conditionalHOY)
intersection_2 = SetIntersection(
    SetA=_3dchart.conditionalHOY,
    SetB=_3dchart_4.conditionalHOY,
    SetC=_3dchart_6.conditionalHOY,
    SetD=_3dchart_7.conditionalHOY)
panel_15 = Panel("""FINAL CONCLUSIONS:

1. The time when passive cooling through cross-ventilation will be effective is miniscule and it is not likely to be an effecitve strategy.

2. The hours of the year when there is glare on the work table are also the most effective for passive heating through solar radiation. Cutting glare on the work table is likely to also reduce heat gain from radiation.

TENTATIVE SOLUTION: A partition with high thermal mass, if placed INSIDE the room, can shield the work table from glare while "storing" raidation received through the window.""")
lng_8 = ListLength(List=intersection_2)
lng_9 = ListLength(List=intersection)
lng_10 = ListLength(List=_3dchart_3.conditionalHOY)
hours_when_room_is_ideal = Panel(lng_8)
hours_when_cross_ventilation_will_be_eff = Panel(lng_9)  # "Hours when cross-ventilation will be effective"
hours_when_heating_is_required = Panel(lng_10)
division_14 = Division(A=lng_8, B=8767)
division_15 = Division(A=lng_9, B=8767)
division_16 = Division(A=lng_10, B=8767)
multiplication_11 = Multiplication(A=division_14, B=100)  # -> flatten(Result)
multiplication_12 = Multiplication(A=division_15, B=100)  # -> flatten(Result)
multiplication_13 = Multiplication(A=division_16, B=100)  # -> flatten(Result)
panel_16 = Panel(multiplication_11)
panel_17 = Panel(multiplication_13)
panel_18 = Panel(multiplication_12)
join_4 = TextJoin(Text=["Hours in the year when cross-ventilation will be effective", hours_when_cross_ventilation_will_be_eff], Join=": ")
join_5 = TextJoin(Text=["Hours in the year when heating is required", hours_when_heating_is_required], Join=": ")
join_6 = TextJoin(Text=["Hours in the year when the room is ideal", hours_when_room_is_ideal], Join=": ")
join_7 = TextJoin(Text=[panel_16, "%"])
join_8 = TextJoin(Text=[panel_18, "%"])
join_9 = TextJoin(Text=[panel_17, "%"])
join_10 = TextJoin(Text=[join_6, join_7], Join="=")
join_11 = TextJoin(Text=[join_4, join_8], Join="=")
join_12 = TextJoin(Text=[join_5, join_9], Join="=")
addition_8 = Addition(A=pdecon_8.YComponent, B=700)
subtraction_7 = Subtraction(A=addition_8, B=25)
subtraction_8 = Subtraction(A=subtraction_7, B=25)
subtraction_9 = Subtraction(A=subtraction_8, B=25)
subtraction_10 = Subtraction(A=subtraction_9, B=25)
pt_7 = ConstructPoint(XCoordinate=pdecon_8.XComponent, YCoordinate=addition_8, ZCoordinate=pdecon_8.ZComponent)
pt_8 = ConstructPoint(XCoordinate=pdecon_8.XComponent, YCoordinate=subtraction_7, ZCoordinate=pdecon_8.ZComponent)
pt_9 = ConstructPoint(XCoordinate=pdecon_8.XComponent, YCoordinate=subtraction_8, ZCoordinate=pdecon_8.ZComponent)
pt_10 = ConstructPoint(XCoordinate=pdecon_8.XComponent, YCoordinate=subtraction_9, ZCoordinate=pdecon_8.ZComponent)
pt_11 = ConstructPoint(XCoordinate=pdecon_8.XComponent, YCoordinate=subtraction_10, ZCoordinate=pdecon_8.ZComponent)
tag_7 = TextTag3D(Location=pt_7, Text="7. Conclusions", Size=10, Justification=7)
tag_8 = TextTag3D(Location=pt_8, Text=join_10, Size=10, Justification=7)
tag_9 = TextTag3D(Location=pt_9, Text=join_11, Size=10, Justification=7)
tag_10 = TextTag3D(Location=pt_10, Text=join_12, Size=10, Justification=7)
tag_11 = TextTag3D(Location=pt_11, Text=panel_15, Size=10, Justification=7)
