# Grasshopper definition Kothari_Bhakti.gh (Grasshopper 0.9.76)
# plug-ins: Python Interpreter

honeybee = Honeybee_Honeybee()  # -> Vviiiiiiiiiizzz; plug-in component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
ladybug = Ladybug_Ladybug()  # -> Vviiiiiiiiiizzz; plug-in component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
panel = Panel("This file shows the minimum steps to set up a daylight model for a room in Honeybee. This example uses mass2zones component to prepare the geometries however you can create the geometries surface by surface using createHBSurface.")
panel_2 = Panel("""Grasshopper
Daylighting
Annual
Radiance
Daysim
Honeybee
HBExampleFiles""")
number_slider = Slider(3.1, range=0..10)
number_slider_2 = Slider(4, range=0..10)
exporthydra = Hydra_ExportFile(
    fileName="Honeybee Annual Daylight Simulation Example",
    fileDescription=panel,
    fileTags=panel_2,
    targetFolder="C:\Users\Administrator\Documents\GitHub\hydra_1",
    export=Toggle(False))  # -> readMe; inputs fileDescription: list, changeLog: list, fileTags: list, includeRhino: Boolean, GHForThumb: Boolean, additionalImgs: list, export: Boolean; plug-in component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
brep = Brep([<brep referenced from the Rhino model> x3])
# Convert the box to Honeybee zone
# All the material will be set to default
# In case you want to change them search
# for Honeybee_Set Radiance Materials
# component.
box = DomainBox(Base=PlaneXY(0, 0, 0), X=number_slider_2, Y=number_slider, Z=Slider(3.2, range=0..10))
createhbsrfs = Honeybee_createHBSrfs(geometry=brep)  # -> readMe, simplify(HBSurface); plug-in component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
mass2zone = Honeybee_Masses2Zones(zoneMasses=flatten(box), isConditioned=True, maxRoofAngle=30, createHBZones=Toggle(True))  # -> readMe, HBZones; plug-in component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
glzparamlist = Honeybee_GlazingParametersList(northGlzParam=0, westGlzParam=0, southGlzParam=0, eastGlzParam=Slider(0.5, range=0..1))  # -> glzParamList; plug-in component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
# Add glazing based on percentage
# In case you want to add custom windows
# use Honeybee_addHBGlz component.
glazingcreator = Honeybee_GlazingBasedOnRatio(HBObjects=mass2zone.HBZones, glzRatio=glzparamlist, runIt=Toggle(True))  # -> readMe, HBObjWGLZ; plug-in component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
panel_3 = Panel("https://www.energyplus.net/weather-download/north_and_central_america_wmo_region_4/USA/PA/USA_PA_Philadelphia.Intl.AP.724080_TMY3/all")

# ---- group: HB Zone With Glazing
brep_2 = Brep(glazingcreator.HBObjWGLZ)

# ----
genhbzonetestpts = Honeybee_GenerateZoneTestPoints(HBZone=brep_2, gridSize=Slider(0.4, range=0..1), distBaseSrf=Slider(0.762, range=0..1), moveTestMesh=Toggle(True))  # -> readMe, simplify(testPoints), simplify(ptsVectors), simplify(facesArea), simplify(mesh); plug-in component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
pt = ConstructPoint(XCoordinate=number_slider_2, YCoordinate=expr("-x", number_slider), ZCoordinate=0)
pt_2 = ConstructPoint(XCoordinate=0, YCoordinate=0, ZCoordinate=0)
epw_stat = Ladybug_OpenEPWAndSTATWeatherFiles(weatherFileURL=panel_3)  # -> epwFile, statFile; plug-in component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
# Create ground in front of the room
# for more accurate analysis
rec_2pt = Rectangle2Pt(Plane=PlaneXY(0, 0, 0), PointA=pt_2, PointB=pt, Radius=0)  # -> Rectangle, Length
wires = BrepWireframe(Brep=brep_2, Density=-1)
boundary = BoundarySurfaces(Edges=rec_2pt.Rectangle)
# Put the recipie together!
annualdaylightsimulation = Honeybee_AnnualDaylightSimulation(
    epwWeatherFile=epw_stat.epwFile,
    testPoints=genhbzonetestpts.testPoints,
    ptsVectors=genhbzonetestpts.ptsVectors,
    testMesh=genhbzonetestpts.mesh)  # -> analysisRecipe; plug-in component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
wires_2 = BrepWireframe(Brep=boundary, Density=-1)
createhbsrfs_2 = Honeybee_createHBSrfs(geometry=boundary)  # -> readMe, simplify(HBSurface); plug-in component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
toggle = BooleanToggle(True)
# Run the analysis
rundaylightanalysis = Honeybee_RunDaylightSimulation(
    HBObjects=flatten([brep_2, createhbsrfs_2.HBSurface]),
    analysisRecipe=annualdaylightsimulation,
    writeRad=toggle,
    runRad=toggle,
    overwriteResults=True)  # -> readMe, analysisType, resultsUnit, results, testPts, annual_analysis_files, radGeoFile, studyFolder, done; plug-in component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
occupancygenerator = Honeybee_DaysimOccupancyGenerator(weekendDays=[1, 2], writeTheOcc=Toggle(True))  # -> occupancyFile; plug-in component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
# Generate annual results
readannualresultsi = Honeybee_ReadAnnualResultI(
    illFilesAddress=rundaylightanalysis.annual_analysis_files,
    testPoints=simplify(rundaylightanalysis.testPts),
    occupancyFiles=occupancygenerator,
    DLAIllumThresholds=300,
    runIt=Toggle(True))  # -> DLA, UDLI_Less_100, UDLI_100_2000, UDLI_More_2000, CDA, sDA, annualProfiles, htmReport; plug-in component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
gradientlibrary = Ladybug_GradientLibrary(gradIndex=Slider(1, range=0..10))  # -> customColors; plug-in component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
legendpar = Ladybug_LegendParameters(
    lowBound=Slider(0, range=0..100),
    highBound=Slider(100, range=0..100),
    numSegments=Slider(6, range=0..10),
    customColors=flatten(gradientlibrary))  # -> legendPar; plug-in component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

# ---- group: make it 3D!
dom = ConstructDomain(DomainStart=0, DomainEnd=Slider(1, range=0..1))

# ----
# Visualize the results
recolormesh = Ladybug_RecolorMesh(
    analysisResult=readannualresultsi.DLA,
    inputMesh=genhbzonetestpts.mesh,
    heightDomain=dom,
    legendPar=legendpar,
    analysisTitle=rundaylightanalysis.analysisType,
    legendTitle="%")  # -> readMe, newMesh, newLegend, legendBasePt, meshColors, legendColors; plug-in component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
