# Grasshopper definition Kothari_Bhakti.gh (Grasshopper 0.9.76)
# plug-ins: Python Interpreter

ladybug = Ladybug_Ladybug()  # -> Vviiiiiiiiiizzz; plug-in component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
# Prepare geometries
# run the analysis
# visualize the results
# Glass material
# prepare a recipe
# Generate sky
# Animate sliders
# capture the viewport to an image
# Prepare geometries
# run the analysis
# visualize the results
# Glass material
# prepare a recipe
# Generate sky
# Animate sliders
# capture the viewport to an image
honeybee = Honeybee_Honeybee()  # -> Vviiiiiiiiiizzz; plug-in component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
number_slider = Slider(0, range=0..2)  # disabled
number_slider_2 = Slider(0, range=0..2)  # disabled
# Animate sliders
button = Button()  # disabled
hours = Panel("""9
12
15""")  # disabled
months = Panel("""3
6
12""")  # disabled
panel = Panel("https://www.energyplus.net/weather-download/north_and_central_america_wmo_region_4/USA/PA/USA_PA_Philadelphia.Intl.AP.724080_TMY3/all")  # disabled
# Prepare geometries
# run the analysis
# Glass material
# prepare a recipe
# Glass material
panel_2 = Panel("tvis_60")  # disabled
panel_3 = Panel("0.6")  # disabled
fly = Ladybug_fly(inputSliders=[number_slider, number_slider_2], fly=button)  # -> Vviiiiiiiiiizzz; disabled; plug-in component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
panel_4 = Panel("21")  # disabled
item = ListItem(List=hours, Index=number_slider_2, Wrap=True)  # disabled
item_2 = ListItem(List=months, Index=number_slider, Wrap=True)  # disabled
epw_stat = Ladybug_OpenEPWAndSTATWeatherFiles(weatherFileURL=panel)  # -> epwFile, statFile; disabled; plug-in component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
radglassmaterial = Honeybee_RadianceGlassMaterial(materialName=panel_2, RTransmittance=panel_3, GTransmittance=panel_3, BTransmittance=panel_3, refractiveIndex=1.52)  # -> avrgTrans, RADMaterial; disabled; plug-in component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
panel_5 = Panel("""9
12
15""")  # disabled
panel_6 = Panel("""3
6
12""")  # disabled
number_slider_3 = Slider(0.2, range=0..1)  # disabled
path = FilePath("C:\ladybug\Philadelphia_International_Ap_PA_USA\Philadelphia_International_Ap_PA_USA.epw")  # disabled
# visualize the results
# Prepare geometries
structure = Brep([<brep referenced from the Rhino model> x9])  # disabled
floor = Brep(<brep referenced from the Rhino model>)  # disabled
importlocation = Ladybug_ImportLocation(epwFile=epw_stat.epwFile)  # -> location; disabled; plug-in component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

# ---- group: glass
brep = Brep(<brep referenced from the Rhino model>)  # disabled

# ----
# Generate sky
number_slider_4 = Slider(1, range=0..1)  # disabled
genclimatebasedsky = Honeybee_GenerateClimateBasedSky(weatherFile=epw_stat.epwFile, month=item_2, day=panel_4, hour=item)  # -> radiationValues, skyFilePath; disabled; plug-in component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
createhbsrfs = Honeybee_createHBSrfs(geometry=[structure, floor])  # -> readMe, simplify(flatten(HBSurface)); disabled; plug-in component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
createhbsrfs_2 = Honeybee_createHBSrfs(geometry=brep, RADMaterial=radglassmaterial.RADMaterial)  # -> readMe, simplify(HBSurface); disabled; plug-in component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
doy_hoy = Ladybug_DOY_HOY(days=panel_4, months=item_2, hours=item)  # -> HOY, DOY, date; disabled; plug-in component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
sunpath = Ladybug_SunPath(
    location=importlocation,
    hour=panel_5,
    day=21,
    month=panel_6,
    timeStep=1,
    sunPathScale=number_slider_3,
    dailyOrAnnualSunPath=True)  # -> readMe, sunVectors, sunAltitudes, sunAzimuths, port, sunSpheresMesh, sunPathCrvs, legend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; disabled; plug-in component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
item_3 = ListItem(Index=number_slider_4, Wrap=True)  # disabled
swatch = ColourSwatch(SwatchColor=RGBA(129, 150, 235, 74))  # disabled
flip = Flip(Surface=item_3)  # -> Surface, Result; disabled
swatch_2 = ColourSwatch(SwatchColor=RGBA(217, 206, 206, 208))  # disabled
brep_2 = Brep(flatten([createhbsrfs.HBSurface, createhbsrfs_2.HBSurface]))  # disabled
askme = Honeybee_AskMe(HBObjects=createhbsrfs.HBSurface)  # -> readMe; disabled; plug-in component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
number_slider_5 = Slider(0.762, range=0..1)  # disabled
brep_3 = Brep(<brep referenced from the Rhino model>)  # disabled
number_slider_6 = Slider(0.3, range=0..1)  # disabled
preview = CustomPreview(Geometry=createhbsrfs_2.HBSurface, Shader=swatch)  # disabled
preview_2 = CustomPreview(Geometry=createhbsrfs.HBSurface, Shader=swatch_2)  # disabled
panel_7 = Panel(askme)  # disabled
gentestpts = Honeybee_GenerateTestPoints(testGeometry=floor, gridSize=number_slider_6, distBaseSrf=number_slider_5, moveTestMesh=True)  # -> readMe, simplify(testPoints), simplify(ptsVectors), simplify(facesArea), simplify(mesh); disabled; plug-in component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
# prepare a recipe
gridbasedsimulation = Honeybee_GridBasedSimulation(
    skyFile=genclimatebasedsky.skyFilePath,
    testPoints=gentestpts.testPoints,
    ptsVectors=gentestpts.ptsVectors,
    testMesh=gentestpts.mesh,
    simulationType=0)  # -> analysisRecipe; disabled; plug-in component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
toggle = BooleanToggle(False)  # disabled
# run the analysis
rundaylightanalysis = Honeybee_RunDaylightSimulation(HBObjects=flatten(brep_2), analysisRecipe=gridbasedsimulation, writeRad=toggle, runRad=toggle, overwriteResults=True)  # -> readMe, analysisType, resultsUnit, results, testPts, resultFiles, radGeoFile, studyFolder, done; disabled; plug-in component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
panel_8 = Panel("300")  # disabled
panel_9 = Panel("2000")  # disabled
panel_10 = Panel("_")  # disabled
panel_11 = Panel("")  # disabled
panel_12 = Panel(doy_hoy.date)  # disabled
legendpar = Ladybug_LegendParameters(lowBound=panel_8, highBound=panel_9)  # -> legendPar; disabled; plug-in component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
# capture the viewport to an image
join = TextJoin(Text=[item_2, panel_4, item], Join=panel_10)  # disabled
# visualize the results
concat = Concatenate(FragmentA=rundaylightanalysis.analysisType, FragmentB=panel_11, FragmentC=panel_12)  # disabled
panel_13 = Panel(join)  # disabled
toggle_2 = BooleanToggle(True)  # disabled
recolormesh = Ladybug_RecolorMesh(
    analysisResult=rundaylightanalysis.results,
    inputMesh=gentestpts.mesh,
    legendPar=legendpar,
    analysisTitle=concat,
    legendTitle=rundaylightanalysis.resultsUnit)  # -> readMe, newMesh, newLegend, legendBasePt, meshColors, legendColors; disabled; plug-in component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
captureview = Ladybug_CaptureView(fileName=panel_13, capture=toggle_2)  # -> imagePath; disabled; plug-in component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
panel_14 = Panel(captureview)  # disabled
number_slider_7 = Slider(0, range=0..2)  # disabled
number_slider_8 = Slider(0, range=0..2)  # disabled
# Animate sliders
button_2 = Button()  # disabled
hours_2 = Panel("""9
12
15""")  # disabled
months_2 = Panel("""3
6
12""")  # disabled
panel_15 = Panel("https://www.energyplus.net/weather-download/north_and_central_america_wmo_region_4/USA/PA/USA_PA_Philadelphia.Intl.AP.724080_TMY3/all")  # disabled
# Glass material
panel_16 = Panel("tvis_60")  # disabled
panel_17 = Panel("0.6")  # disabled
fly_2 = Ladybug_fly(inputSliders=[number_slider_7, number_slider_8], fly=button_2)  # -> Vviiiiiiiiiizzz; disabled; plug-in component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
panel_18 = Panel("21")  # disabled
item_4 = ListItem(List=hours_2, Index=number_slider_8, Wrap=True)  # disabled
item_5 = ListItem(List=months_2, Index=number_slider_7, Wrap=True)  # disabled
epw_stat_2 = Ladybug_OpenEPWAndSTATWeatherFiles(weatherFileURL=panel_15)  # -> epwFile, statFile; disabled; plug-in component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
radglassmaterial_2 = Honeybee_RadianceGlassMaterial(materialName=panel_16, RTransmittance=panel_17, GTransmittance=panel_17, BTransmittance=panel_17, refractiveIndex=1.52)  # -> avrgTrans, RADMaterial; disabled; plug-in component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
panel_19 = Panel("""9
12
15""")  # disabled
panel_20 = Panel("""3
6
12""")  # disabled
number_slider_9 = Slider(0.2, range=0..1)  # disabled
path_2 = FilePath("C:\ladybug\Philadelphia_International_Ap_PA_USA\Philadelphia_International_Ap_PA_USA.epw")  # disabled
# Prepare geometries
structure_2 = Brep([<brep referenced from the Rhino model> x8])  # disabled
floor_2 = Brep(<brep referenced from the Rhino model>)  # disabled
importlocation_2 = Ladybug_ImportLocation(epwFile=epw_stat_2.epwFile)  # -> location; disabled; plug-in component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

# ---- group: glass
brep_4 = Brep(<brep referenced from the Rhino model>)  # disabled

# ----
# Generate sky
number_slider_10 = Slider(1, range=0..1)  # disabled
genclimatebasedsky_2 = Honeybee_GenerateClimateBasedSky(weatherFile=epw_stat_2.epwFile, month=item_5, day=panel_18, hour=item_4)  # -> radiationValues, skyFilePath; disabled; plug-in component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
createhbsrfs_3 = Honeybee_createHBSrfs(geometry=[structure_2, floor_2])  # -> readMe, simplify(flatten(HBSurface)); disabled; plug-in component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
createhbsrfs_4 = Honeybee_createHBSrfs(geometry=brep_4, RADMaterial=radglassmaterial_2.RADMaterial)  # -> readMe, simplify(HBSurface); disabled; plug-in component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
doy_hoy_2 = Ladybug_DOY_HOY(days=panel_18, months=item_5, hours=item_4)  # -> HOY, DOY, date; disabled; plug-in component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
sunpath_2 = Ladybug_SunPath(
    location=importlocation_2,
    hour=panel_19,
    day=21,
    month=panel_20,
    timeStep=1,
    sunPathScale=number_slider_9,
    dailyOrAnnualSunPath=True)  # -> readMe, sunVectors, sunAltitudes, sunAzimuths, port, sunSpheresMesh, sunPathCrvs, legend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; disabled; plug-in component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
item_6 = ListItem(Index=number_slider_10, Wrap=True)  # disabled
swatch_3 = ColourSwatch(SwatchColor=RGBA(129, 150, 235, 74))  # disabled
flip_2 = Flip(Surface=item_6)  # -> Surface, Result; disabled
swatch_4 = ColourSwatch(SwatchColor=RGBA(217, 206, 206, 208))  # disabled
brep_5 = Brep(flatten([createhbsrfs_3.HBSurface, createhbsrfs_4.HBSurface]))  # disabled
askme_2 = Honeybee_AskMe(HBObjects=createhbsrfs_3.HBSurface)  # -> readMe; disabled; plug-in component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
number_slider_11 = Slider(0.762, range=0..1)  # disabled
brep_6 = Brep(<brep referenced from the Rhino model>)  # disabled
number_slider_12 = Slider(0.3, range=0..1)  # disabled
preview_3 = CustomPreview(Geometry=createhbsrfs_4.HBSurface, Shader=swatch_3)  # disabled
preview_4 = CustomPreview(Geometry=createhbsrfs_3.HBSurface, Shader=swatch_4)  # disabled
panel_21 = Panel(askme_2)  # disabled
gentestpts_2 = Honeybee_GenerateTestPoints(testGeometry=floor_2, gridSize=number_slider_12, distBaseSrf=number_slider_11, moveTestMesh=True)  # -> readMe, simplify(testPoints), simplify(ptsVectors), simplify(facesArea), simplify(mesh); disabled; plug-in component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
# prepare a recipe
gridbasedsimulation_2 = Honeybee_GridBasedSimulation(
    skyFile=genclimatebasedsky_2.skyFilePath,
    testPoints=gentestpts_2.testPoints,
    ptsVectors=gentestpts_2.ptsVectors,
    testMesh=gentestpts_2.mesh,
    simulationType=0)  # -> analysisRecipe; disabled; plug-in component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
toggle_3 = BooleanToggle(False)  # disabled
# run the analysis
rundaylightanalysis_2 = Honeybee_RunDaylightSimulation(
    HBObjects=flatten(brep_5),
    analysisRecipe=gridbasedsimulation_2,
    writeRad=toggle_3,
    runRad=toggle_3,
    overwriteResults=True)  # -> readMe, analysisType, resultsUnit, results, testPts, resultFiles, radGeoFile, studyFolder, done; disabled; plug-in component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
panel_22 = Panel("300")  # disabled
panel_23 = Panel("2000")  # disabled
panel_24 = Panel("_")  # disabled
panel_25 = Panel("")  # disabled
panel_26 = Panel(doy_hoy_2.date)  # disabled
legendpar_2 = Ladybug_LegendParameters(lowBound=panel_22, highBound=panel_23)  # -> legendPar; disabled; plug-in component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
# capture the viewport to an image
join_2 = TextJoin(Text=[item_5, panel_18, item_4], Join=panel_24)  # disabled
# visualize the results
concat_2 = Concatenate(FragmentA=rundaylightanalysis_2.analysisType, FragmentB=panel_25, FragmentC=panel_26)  # disabled
panel_27 = Panel(join_2)  # disabled
toggle_4 = BooleanToggle(True)  # disabled
recolormesh_2 = Ladybug_RecolorMesh(
    analysisResult=rundaylightanalysis_2.results,
    inputMesh=gentestpts_2.mesh,
    legendPar=legendpar_2,
    analysisTitle=concat_2,
    legendTitle=rundaylightanalysis_2.resultsUnit)  # -> readMe, newMesh, newLegend, legendBasePt, meshColors, legendColors; disabled; plug-in component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
captureview_2 = Ladybug_CaptureView(fileName=panel_27, capture=toggle_4)  # -> imagePath; disabled; plug-in component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
panel_28 = Panel(captureview_2)  # disabled
number_slider_13 = Slider(0, range=0..2)
number_slider_14 = Slider(0, range=0..2)
# Animate sliders
button_3 = Button()
hours_3 = Panel("""9
12
15""")
months_3 = Panel("""3
6
12""")
panel_29 = Panel("https://www.energyplus.net/weather-download/north_and_central_america_wmo_region_4/USA/PA/USA_PA_Philadelphia.Intl.AP.724080_TMY3/all")
# Glass material
panel_30 = Panel("tvis_60")
fly_3 = Ladybug_fly(inputSliders=[number_slider_13, number_slider_14], fly=button_3)  # -> Vviiiiiiiiiizzz; plug-in component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
item_7 = ListItem(List=hours_3, Index=number_slider_14, Wrap=True)
item_8 = ListItem(List=months_3, Index=number_slider_13, Wrap=True)
epw_stat_3 = Ladybug_OpenEPWAndSTATWeatherFiles(weatherFileURL=panel_29)  # -> epwFile, statFile; plug-in component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
radglassmaterial_3 = Honeybee_RadianceGlassMaterial(materialName=panel_30, RTransmittance="0.6", GTransmittance="0.6", BTransmittance="0.6", refractiveIndex=1.52)  # -> avrgTrans, RADMaterial; plug-in component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
panel_31 = Panel("""9
12
15""")
panel_32 = Panel("""3
6
12""")
path_3 = FilePath("C:\ladybug\Philadelphia_International_Ap_PA_USA\Philadelphia_International_Ap_PA_USA.epw")
# Prepare geometries
structure_3 = Brep([<brep referenced from the Rhino model> x23])
shade = Brep([<brep referenced from the Rhino model> x8])
floor_3 = Brep(<brep referenced from the Rhino model>)
importlocation_3 = Ladybug_ImportLocation(epwFile=epw_stat_3.epwFile)  # -> location; plug-in component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

# ---- group: glass
brep_7 = Brep(<brep referenced from the Rhino model>)

# ----
# Generate sky
number_slider_15 = Slider(1, range=0..1)
genclimatebasedsky_3 = Honeybee_GenerateClimateBasedSky(weatherFile=epw_stat_3.epwFile, month=item_8, day="21", hour=item_7)  # -> radiationValues, skyFilePath; plug-in component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
createhbsrfs_5 = Honeybee_createHBSrfs(geometry=[structure_3, floor_3, shade])  # -> readMe, simplify(flatten(HBSurface)); plug-in component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
createhbsrfs_6 = Honeybee_createHBSrfs(geometry=brep_7, RADMaterial=radglassmaterial_3.RADMaterial)  # -> readMe, simplify(HBSurface); plug-in component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
doy_hoy_3 = Ladybug_DOY_HOY(days="21", months=item_8, hours=item_7)  # -> HOY, DOY, date; plug-in component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
sunpath_3 = Ladybug_SunPath(
    location=importlocation_3,
    hour=panel_31,
    day=21,
    month=panel_32,
    timeStep=1,
    sunPathScale=Slider(0.2, range=0..1),
    dailyOrAnnualSunPath=True)  # -> readMe, sunVectors, sunAltitudes, sunAzimuths, port, sunSpheresMesh, sunPathCrvs, legend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; plug-in component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
item_9 = ListItem(Index=number_slider_15, Wrap=True)
flip_3 = Flip(Surface=item_9)  # -> Surface, Result
brep_8 = Brep(flatten([createhbsrfs_5.HBSurface, createhbsrfs_6.HBSurface]))
askme_3 = Honeybee_AskMe(HBObjects=createhbsrfs_5.HBSurface)  # -> readMe; plug-in component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
brep_9 = Brep(<brep referenced from the Rhino model>)
preview_5 = CustomPreview(Geometry=createhbsrfs_6.HBSurface, Shader=ColourSwatch(SwatchColor=RGBA(129, 150, 235, 74)))
preview_6 = CustomPreview(Geometry=createhbsrfs_5.HBSurface, Shader=ColourSwatch(SwatchColor=RGBA(217, 206, 206, 208)))
panel_33 = Panel(askme_3)
gentestpts_3 = Honeybee_GenerateTestPoints(testGeometry=floor_3, gridSize=Slider(0.3, range=0..1), distBaseSrf=Slider(0.762, range=0..1), moveTestMesh=True)  # -> readMe, simplify(testPoints), simplify(ptsVectors), simplify(facesArea), simplify(mesh); plug-in component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
# prepare a recipe
gridbasedsimulation_3 = Honeybee_GridBasedSimulation(
    skyFile=genclimatebasedsky_3.skyFilePath,
    testPoints=gentestpts_3.testPoints,
    ptsVectors=gentestpts_3.ptsVectors,
    testMesh=gentestpts_3.mesh,
    simulationType=0)  # -> analysisRecipe; plug-in component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
toggle_5 = BooleanToggle(True)
# run the analysis
rundaylightanalysis_3 = Honeybee_RunDaylightSimulation(
    HBObjects=flatten(brep_8),
    analysisRecipe=gridbasedsimulation_3,
    writeRad=toggle_5,
    runRad=toggle_5,
    overwriteResults=True)  # -> readMe, analysisType, resultsUnit, illuminance_values, testPts, illuminance_files, radGeoFile, studyFolder, done; plug-in component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
panel_34 = Panel(doy_hoy_3.date)
legendpar_3 = Ladybug_LegendParameters(lowBound="300", highBound="2000")  # -> legendPar; plug-in component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
# capture the viewport to an image
join_3 = TextJoin(Text=[item_8, "21", item_7], Join="_")
# visualize the results
concat_3 = Concatenate(FragmentA=rundaylightanalysis_3.analysisType, FragmentC=panel_34)
panel_35 = Panel(join_3)
recolormesh_3 = Ladybug_RecolorMesh(
    analysisResult=rundaylightanalysis_3.illuminance_values,
    inputMesh=gentestpts_3.mesh,
    legendPar=legendpar_3,
    analysisTitle=concat_3,
    legendTitle=rundaylightanalysis_3.resultsUnit)  # -> readMe, newMesh, newLegend, legendBasePt, meshColors, legendColors; plug-in component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
captureview_3 = Ladybug_CaptureView(fileName=panel_35, capture=Toggle(True))  # -> imagePath; plug-in component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
panel_36 = Panel(captureview_3)
