# Grasshopper definition Kothari_Bhakti.gh (Grasshopper 0.9.76)
# plug-ins: Python Interpreter, DIVA Daylight

ladybug = Ladybug_Ladybug()  # -> Vviiiiiiiiiizzz; plug-in component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
honeybee = Honeybee_Honeybee()  # -> Vviiiiiiiiiizzz; plug-in component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
panel = Panel("https://www.energyplus.net/weather-download/north_and_central_america_wmo_region_4/USA/PA/USA_PA_Philadelphia.Intl.AP.724080_TMY3/all")
radopaquematerial = Honeybee_RadianceOpaqueMaterial(materialName="generic_35", RReflectance=".35", GReflectance=".35", BReflectance=".35", roughness=0.05, specularity=0)  # -> avrgRef, RADMaterial; plug-in component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
epw_stat = Ladybug_OpenEPWAndSTATWeatherFiles(weatherFileURL=panel)  # -> epwFile, statFile; plug-in component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
radglassmaterial = Honeybee_RadianceGlassMaterial(materialName="glass_.65", RTransmittance=".65", GTransmittance=".65", BTransmittance=".65", refractiveIndex=1.52)  # -> avrgTrans, RADMaterial; plug-in component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

# ---- group: furniture
furniture = Brep([<brep referenced from the Rhino model> x2])

# ----
shad = Brep([<brep referenced from the Rhino model> x3])

# ---- group: ceiling
ceiling = Brep(<brep referenced from the Rhino model>)

# ---- group: glass facade
glass = Brep(<brep referenced from the Rhino model>)

# ---- group: floor
floor = Brep(<brep referenced from the Rhino model>)

# ----
walls = Brep([<brep referenced from the Rhino model> x4])
number_slider = Slider(0, range=0..100)

# ---- group: For better visualization - Doesn't effect the results of the analysis
importlocation = Ladybug_ImportLocation(epwFile=epw_stat.epwFile)  # -> location; plug-in component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
sunpath = Ladybug_SunPath(
    north=number_slider,
    location=importlocation,
    hour="15",
    day="21",
    month="12",
    timeStep=1,
    sunPathScale=Slider(0.2, range=0..1),
    dailyOrAnnualSunPath=True)  # -> readMe, sunVectors, sunAltitudes, sunAzimuths, port, sunSpheresMesh, sunPathCrvs, legend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; plug-in component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

# ----
# Assign specific materials
createhbsrfs = Honeybee_createHBSrfs(geometry=furniture, RADMaterial=radopaquematerial.RADMaterial)  # -> readMe, simplify(HBSurface); plug-in component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
createhbsrfs_2 = Honeybee_createHBSrfs(geometry=glass, RADMaterial=radglassmaterial.RADMaterial)  # -> readMe, simplify(HBSurface); plug-in component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
createhbsrfs_3 = Honeybee_createHBSrfs(geometry=shad, RADMaterial=radopaquematerial.RADMaterial)  # -> readMe, simplify(HBSurface); plug-in component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
createhbsrfs_4 = Honeybee_createHBSrfs(geometry=floor, srfType="2")  # -> readMe, simplify(HBSurface); plug-in component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
createhbsrfs_5 = Honeybee_createHBSrfs(geometry=ceiling, srfType="3")  # -> readMe, simplify(HBSurface); plug-in component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
# Geometry Preparation
# Honeybee default materials will be assigned
# based on surface type
createhbsrfs_6 = Honeybee_createHBSrfs(geometry=walls, srfType="0")  # -> readMe, simplify(HBSurface); plug-in component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
genclimatebasedsky = Honeybee_GenerateClimateBasedSky(north=number_slider, weatherFile=epw_stat.epwFile, month="12", day="21", hour="15")  # -> radiationValues, skyFilePath; plug-in component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
genavgsky = Honeybee_GenerateAverageSky(north=number_slider, weatherFile=epw_stat.epwFile, month="12", hour="15")  # -> radiationValues, skyFilePath; plug-in component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
northarrow = Ladybug_North(north=number_slider, scale=".05")  # -> northSign; plug-in component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
panel_2 = Panel([genclimatebasedsky.radiationValues, genavgsky.radiationValues])
set_the_view_to_fisheye_for_glare_analys = Panel("1")  # "set the view to FishEye for Glare Analysis"
radparameters = Honeybee_RADParameters(quality=0, ab="3")  # -> readMe, radParameters; plug-in component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
doy_hoy = Ladybug_DOY_HOY(days="21", months="12", hours="15")  # -> HOY, DOY, date; plug-in component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
pt = Point(<point referenced from the Rhino model>)

# ---- group: collect all honeybee surfaces
brep = Brep(flatten([createhbsrfs_6.HBSurface, createhbsrfs_5.HBSurface, createhbsrfs_4.HBSurface, createhbsrfs.HBSurface, createhbsrfs_2.HBSurface, createhbsrfs_3.HBSurface]))

# ----
# Analysis Recipe
imagebasedsimulation = Honeybee_ImageBasedSimulation(
    skyFile=genavgsky.skyFilePath,
    cameraType=set_the_view_to_fisheye_for_glare_analys,
    simulationType=2,
    radParameters=radparameters.radParameters,
    backupImages=0)  # -> analysisRecipe; plug-in component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
wires = BrepWireframe(Brep=brep, Density=-1)
panel_3 = Panel("4")
toggle = BooleanToggle(True)
panel_4 = Panel("""This file shows how to run a glare analysis using Honeybee. This example is using same geometry as the other daylighting examples [[1](http://hydrashare.github.io/hydra/viewer?owner=mostaphaRoudsari&fork=hydra_1&id=Surface_by_surface_geometry_preparation_for_daylight_simulation_II), [2](http://hydrashare.github.io/hydra/viewer?owner=mostaphaRoudsari&fork=hydra_1&id=Find_when_sun_is_visible_to_a_point)].
The example is uses Averaged Climate-based Sky for glare analysis which uses the average value for that hour during the whole month.""")
panel_5 = Panel("""Radiance
Grasshopper
Honeybee
Glare
Daylight
Set View
HBExampleFiles""")
# Run the analysis
rundaylightanalysis = Honeybee_RunDaylightSimulation(
    HBObjects=flatten(brep),
    analysisRecipe=imagebasedsimulation,
    writeRad=toggle,
    runRad=toggle,
    radFileName=doy_hoy.date,
    overwriteResults=True)  # -> readMe, analysisType, resultsUnit, results, testPts, luminance_files, radGeoFile, studyFolder, done; plug-in component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
md_slider = MDSlider(
    slider_value=Point(0.7522850967, 0.5041414587, 0.5),
    SliderMode=0,
    x_domain=Domain(-1, 1),
    y_domain=Domain(-1, 1),
    z_domain=Domain(0, 1))
panel_6 = Panel("C:\Users\Administrator\Dropbox\ladybug\helpDesk\PennDesign2015\Daylight_Glare_Analysis.png")
glareanalysis = Honeybee_GlareAnalysis(HDRImagePath=rundaylightanalysis.luminance_files, runIt=Toggle(True))  # -> readMe, glareCheckImage, DGP, DGI, imageWithTaskArea; plug-in component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
exporthydra = Hydra_ExportFile(
    fileName="Glare Analysis",
    fileDescription=panel_4,
    fileTags=panel_5,
    targetFolder="C:\Users\Administrator\Documents\GitHub\hydra_1",
    includeRhino=Toggle(True),
    additionalImgs=panel_6,
    export=Toggle(False))  # -> readMe; inputs fileDescription: list, changeLog: list, fileTags: list, includeRhino: Boolean, GHForThumb: Boolean, additionalImgs: list, export: Boolean; plug-in component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
falsecolor = Honeybee_FalseColor(
    HDRFilePath=rundaylightanalysis.luminance_files,
    contourBands=False,
    maskThreshold=0.1,
    useAlterColors=False,
    render=Toggle(True))  # -> outputFilePath; plug-in component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
# DGP: Daylight glare probability:
# Imperceptible Glare [0.35 > DGP]
# Perceptible Glare [0.4 > DGP >= 0.35]
# Disturbing Glare [0.45 > DGP >= 0.4]
# Intolerable Glare [DGP >= 0.45]
panel_7 = Panel(glareanalysis.DGP)
hdr_tif = Honeybee_ConvertHDRToTIF(HDRFilePath=glareanalysis.glareCheckImage, adjustExposure=Toggle(True))  # -> TIFFFilePath; plug-in component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
hdr_tif_2 = Honeybee_ConvertHDRToTIF(HDRFilePath=falsecolor, adjustExposure=False)  # -> TIFFFilePath; plug-in component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
number_slider_2 = Slider(0.8, range=0..1)
image_viewer = ImageViewer(ImagePath=hdr_tif_2, Scale=number_slider_2)
image_viewer_2 = ImageViewer(ImagePath=hdr_tif, Scale=number_slider_2)

pt_2 = Point(Point(3, 2.544838682, 0.1224289629))
# set the view
comfortmannequin = Ladybug_ComfortMannequin(rotationAngle="175", bodyLocation=pt)  # -> mannequinMesh, legend, legendBasePt; plug-in component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

# ---- group: Person's face!
item = ListItem(List=comfortmannequin.mannequinMesh, Index=121, Wrap=True)

# ----
preview = CustomPreview(Geometry=item, Shader=ColourSwatch(SwatchColor=RGB(255, 0, 0)))

facen = FaceNormals(Mesh=item)  # -> Centers, Normals
settheview = Ladybug_SetTheView(cameraLocation=facen.Centers, cameraDirection=facen.Normals, uvLookAround=md_slider)  # -> readMe; plug-in component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
