# Grasshopper definition Kothari_Bhakti.gh (Grasshopper 0.9.76)
# plug-ins: Python Interpreter, Weaverbird

panel = Panel("https://www.energyplus.net/weather-download/north_and_central_america_wmo_region_4/USA/PA/USA_PA_Philadelphia.Intl.AP.724080_TMY3/all")
ladybug = Ladybug_Ladybug()  # -> Vviiiiiiiiiizzz; plug-in component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
epw_stat = Ladybug_OpenEPWAndSTATWeatherFiles(weatherFileURL=panel)  # -> epwFile, statFile; plug-in component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
analysisperiod = Ladybug_AnalysisPeriod()  # -> readMe, analysisPeriod; plug-in component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

# ----
# Detachable to check
# comfort
bench_buildings = Brep([<brep referenced from the Rhino model> x5])
mey_ff = Brep([<brep referenced from the Rhino model> x2])
benches = Brep([<brep referenced from the Rhino model> x3])
area = Area(Geometry=benches)  # -> Area, Centroid
area_2 = Area(Geometry=bench_buildings)  # -> Area, Centroid

designed_shading = Brep([<brep referenced from the Rhino model> x5])
basic_shading = Brep([<brep referenced from the Rhino model> x4])
importepw = Ladybug_ImportEpw(epwFile=epw_stat.epwFile)  # -> readMe, latitude, location, dryBulbTemperature, dewPointTemperature, relativeHumidity, windSpeed, windDirection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; plug-in component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
line = Line(Line((-102.3446363, 324.5902896, -257.2096947), (-101.9729119, 327.617742, -257.2096947)))
analysisperiod_2 = Ladybug_AnalysisPeriod()  # -> readMe, analysisPeriod; plug-in component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
toggle = BooleanToggle(True)
vec = Vector(line)
unit = UnitVector(Vector=vec)
solaradjusttemperature = Ladybug_OutdoorSolarTemperatureAdjustor(
    location=importepw.location,
    cumSkyMtxOrDirNormRad=importepw.directNormalRadiation,
    diffuseHorizRad=importepw.diffuseHorizontalRadiation,
    baseTemperature=importepw.dryBulbTemperature,
    baseDryBulbOrMRT=Toggle(True),
    horizInfraredRad=importepw.horizontalInfraredRadiation,
    bodyLocation=area.Centroid,
    contextShading=[mey_ff, designed_shading],
    north=unit,
    analysisPeriodOrHOY=analysisperiod.analysisPeriod,
    parallel=toggle,
    runIt=toggle)  # -> readMe, port, effectiveRadiantField, MRTDelta, solarAdjustedMRT, port_2, mannequinMesh, port_3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; plug-in component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
toggle_2 = BooleanToggle(True)
solaradjusttemperature_2 = Ladybug_OutdoorSolarTemperatureAdjustor(
    location=importepw.location,
    cumSkyMtxOrDirNormRad=importepw.directNormalRadiation,
    diffuseHorizRad=importepw.diffuseHorizontalRadiation,
    baseTemperature=importepw.dryBulbTemperature,
    baseDryBulbOrMRT=Toggle(True),
    horizInfraredRad=importepw.horizontalInfraredRadiation,
    analysisPeriodOrHOY=analysisperiod_2.analysisPeriod,
    parallel=toggle_2,
    runIt=toggle_2)  # -> readMe, port, effectiveRadiantField, MRTDelta, solarAdjustedMRT, port_2, mannequinMesh, port_3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; plug-in component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
# Fully Shaded
outdoorcomfortcalculator = Ladybug_OutdoorComfortCalculator(
    dryBulbTemperature=importepw.dryBulbTemperature,
    windSpeed_tenMeters=importepw.windSpeed,
    relativeHumidity=importepw.relativeHumidity,
    runIt=Toggle(True))  # -> readMe, port, universalThermalClimateIndex, comfortableOrNot, thermalStress, conditionOfPerson, port_2, percentOfTimeComfortable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; plug-in component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
# With solar radiation effect
outdoorcomfortcalculator_2 = Ladybug_OutdoorComfortCalculator(
    dryBulbTemperature=importepw.dryBulbTemperature,
    meanRadiantTemperature=solaradjusttemperature_2.solarAdjustedMRT,
    windSpeed_tenMeters=importepw.windSpeed,
    relativeHumidity=importepw.relativeHumidity,
    runIt=Toggle(True))  # -> readMe, port, universalThermalClimateIndex, comfortableOrNot, thermalStress, conditionOfPerson, port_2, percentOfTimeComfortable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; plug-in component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
# With solar radiation effect
# + Meyerson Hall building
# + detachable shading
outdoorcomfortcalculator_3 = Ladybug_OutdoorComfortCalculator(
    dryBulbTemperature=importepw.dryBulbTemperature,
    meanRadiantTemperature=solaradjusttemperature.solarAdjustedMRT,
    windSpeed_tenMeters=importepw.windSpeed,
    relativeHumidity=importepw.relativeHumidity,
    runIt=Toggle(True))  # -> readMe, port, universalThermalClimateIndex, comfortableOrNot, thermalStress, conditionOfPerson, port_2, percentOfTimeComfortable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; plug-in component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
test_shade_plane = Brep([<brep referenced from the Rhino model> x2])

designed_shade = Brep([<brep referenced from the Rhino model> x4])
brep = Brep([<brep referenced from the Rhino model> x3])
comfortshadebenefit = Ladybug_ComfortShadeBenefitEvaluator(
    location=importepw.location,
    temperatures=outdoorcomfortcalculator_3.universalThermalClimateIndex,
    testShades=test_shade_plane,
    testRegion=brep,
    gridSize=Slider(0.5, range=0..1),
    skyResolution=Slider(7, range=0..10),
    delNonIntersect=False,
    parallel=Toggle(True),
    runIt=Toggle(True))  # -> readMe, port, reverse(sunVectors), regionTestPts, shadeMesh, legend, legendBasePoint, port_2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; plug-in component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
meshselector = Ladybug_MeshThresholdSelector(
    inputMesh=comfortshadebenefit.shadeMesh,
    analysisResult=comfortshadebenefit.shadeNetEffect,
    percentToKeep=Slider(81, range=0..100))  # -> readMe, totalValue, areaMeetsThresh, newColoredMesh, newMeshOutline; plug-in component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

panel_2 = Panel(outdoorcomfortcalculator_3.percentColdStress)
panel_3 = Panel(outdoorcomfortcalculator_3.percentHeatStress)
panel_4 = Panel(outdoorcomfortcalculator_3.percentOfTimeComfortable)
panel_5 = Panel([outdoorcomfortcalculator.percentHeatStress, outdoorcomfortcalculator_2.percentHeatStress, outdoorcomfortcalculator_3.percentHeatStress])
legendpar = Ladybug_LegendParameters(numSegments="3")  # -> legendPar; plug-in component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
analysisperiod_3 = Ladybug_AnalysisPeriod()  # -> readMe, analysisPeriod; plug-in component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
_3dchart = Ladybug_3DChart(
    inputData=flatten([outdoorcomfortcalculator.thermalStress, outdoorcomfortcalculator_2.thermalStress, outdoorcomfortcalculator_3.thermalStress]),
    xScale="0.2",
    zScale="0",
    legendPar=legendpar)  # -> readMe, graphMesh, graphCurves, legend, legendBasePts, title, titleBasePts, dataPts, conditionalHOY; plug-in component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
brep_2 = Brep(meshselector.newMeshOutline)
sunpath = Ladybug_SunPath(
    north=unit,
    location=importepw.location,
    hour=12,
    day=21,
    month=12,
    timeStep=1,
    analysisPeriod=analysisperiod_3.analysisPeriod,
    centerPt=area_2.Centroid,
    sunPathScale=Slider(0.3, range=0..1),
    sunScale=Slider(0.5, range=0..1),
    annualHourlyData=flatten(outdoorcomfortcalculator_3.conditionOfPerson),
    legendPar=legendpar,
    dailyOrAnnualSunPath=True)  # -> readMe, sunVectors, sunAltitudes, sunAzimuths, port, sunSpheresMesh, sunPathCrvs, legend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; disabled; plug-in component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
mesh = Mesh(brep_2)
wbthicken = WeaverbirdsMeshThicken(MeshCurves=mesh, Distance=Slider(0.1, range=0..0.1), OffsetType=0)
