# Grasshopper definition Jiyuan Liu.gh (Grasshopper 0.9.75)
# plug-ins: Python Interpreter, embryoA

number_slider = Slider(2, range=0..2)
number_slider_2 = Slider(2, range=0..2)
panel = Panel("https://www.energyplus.net/weather-download/north_and_central_america_wmo_region_4/USA/IL/USA_IL_Chicago-OHare.Intl.AP.725300_TMY3/all")
# Animate sliders
button = Button()
epw_stat = Ladybug_OpenEPWAndSTATWeatherFiles(weatherFileURL=panel)  # -> epwFile, statFile; plug-in component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
hours = Panel("""9
12
15""")
months = Panel("""3
6
12""")
honeybee = Honeybee_Honeybee(defaultFolder="E:\Ladybug+Honeybee")  # -> Vviiiiiiiiiizzz; plug-in component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
ladybug = Ladybug_Ladybug(defaultFolder="E:\Ladybug+Honeybee")  # -> Vviiiiiiiiiizzz; plug-in component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
# Glass material
panel_2 = Panel("tvis_60")
fly = Ladybug_fly(inputSliders=[number_slider, number_slider_2], fly=button)  # -> Vviiiiiiiiiizzz; plug-in component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
importepw = Ladybug_ImportEpw(epwFile=epw_stat.epwFile)  # -> readMe, latitude, location, dryBulbTemperature, dewPointTemperature, relativeHumidity, windSpeed, windDirection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; plug-in component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
item = ListItem(List=months, Index=number_slider, Wrap=True)  # -> flatten(Item)
item_2 = ListItem(List=hours, Index=number_slider_2, Wrap=True)
panel_3 = Panel(honeybee)
radglassmaterial = Honeybee_RadianceGlassMaterial(materialName=panel_2, RTransmittance="0.6", GTransmittance="0.6", BTransmittance="0.6", refractiveIndex=1.52)  # -> avrgTrans, RADMaterial; plug-in component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
panel_4 = Panel("""9
12
15""")
panel_5 = Panel("""3
6
12""")
path = FilePath("C:\ladybug\Philadelphia_International_Ap_PA_USA\Philadelphia_International_Ap_PA_USA.epw")
# Prepare geometries
brep = Brep([<brep referenced from the Rhino model> x7])

# ---- group: glass
brep_2 = Brep([<brep referenced from the Rhino model> x3])

# ----
# Generate sky
genclimatebasedsky = Honeybee_GenerateClimateBasedSky(weatherFile=epw_stat.epwFile, month=item, day="21", hour=item_2)  # -> radiationValues, skyFilePath; plug-in component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
createhbsrfs = Honeybee_createHBSrfs(geometry=brep_2, RADMaterial=radglassmaterial.RADMaterial)  # -> readMe, simplify(HBSurface); plug-in component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
doy_hoy = Ladybug_DOY_HOY(days="21", months=item, hours=item_2)  # -> HOY, DOY, date; plug-in component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
createhbsrfs_2 = Honeybee_createHBSrfs(geometry=brep)  # -> readMe, simplify(flatten(HBSurface)); plug-in component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
importlocation = Ladybug_ImportLocation(epwFile=epw_stat.epwFile)  # -> location; plug-in component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
sunpath = Ladybug_SunPath(
    location=importlocation,
    hour=panel_4,
    day=21,
    month=panel_5,
    timeStep=1,
    sunPathScale=Slider(0.2, range=0..1),
    dailyOrAnnualSunPath=True)  # -> readMe, sunVectors, sunAltitudes, sunAzimuths, port, sunSpheresMesh, sunPathCrvs, legend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; plug-in component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
brep_3 = Brep(flatten([createhbsrfs_2.HBSurface, createhbsrfs.HBSurface]))
preview = CustomPreview(Geometry=createhbsrfs.HBSurface, Shader=ColourSwatch(SwatchColor=RGBA(129, 150, 235, 74)))
item_3 = ListItem(List=brep, Index=Slider(1, range=0..1), Wrap=True)
preview_2 = CustomPreview(Geometry=createhbsrfs_2.HBSurface, Shader=ColourSwatch(SwatchColor=RGBA(217, 206, 206, 208)))
flip = Flip(Surface=item_3)  # -> Surface, Result
toggle = BooleanToggle(True)
epw_stat_2 = Ladybug_OpenEPWAndSTATWeatherFiles(weatherFileURL=panel)  # -> epwFile, statFile; plug-in component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
toggle_2 = BooleanToggle(False)
panel_6 = Panel(doy_hoy.date)
legendpar = Ladybug_LegendParameters(lowBound="300", highBound="2000")  # -> legendPar; plug-in component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
# capture the viewport to an image
join = TextJoin(Text=[item, "21", item_2], Join="_")
occupancygenerator = Honeybee_DaysimOccupancyGenerator(weekendDays=[1, 2], writeTheOcc=Toggle(True))  # -> occupancyFile; plug-in component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
gradientlibrary = Ladybug_GradientLibrary(gradIndex=Slider(1, range=0..10))  # -> customColors; plug-in component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
legendpar_2 = Ladybug_LegendParameters(
    lowBound=Slider(0, range=0..100),
    highBound=Slider(100, range=0..100),
    numSegments=Slider(6, range=0..10),
    customColors=flatten(gradientlibrary))  # -> legendPar; plug-in component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

# ---- group: make it 3D!
# Visualize the results
dom = ConstructDomain(DomainStart=0, DomainEnd=Slider(1, range=0..1))

# ----
radopaquematerial = Honeybee_RadianceOpaqueMaterial(materialName="generic_70", RReflectance=".70", GReflectance=".70", BReflectance=".70", roughness=0.05, specularity=0)  # -> avrgRef, RADMaterial; plug-in component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
furniture = Brep([<brep referenced from the Rhino model> x2])
panel_7 = Panel("9")
panel_8 = Panel(item)
createhbsrfs_3 = Honeybee_createHBSrfs(geometry=furniture, RADMaterial=radopaquematerial.RADMaterial)  # -> readMe, simplify(HBSurface); plug-in component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
panel_9 = Panel("https://www.energyplus.net/weather-download/north_and_central_america_wmo_region_4/USA/IL/USA_IL_Chicago-OHare.Intl.AP.725300_TMY3/all")
epw_stat_3 = Ladybug_OpenEPWAndSTATWeatherFiles(weatherFileURL=panel_9)  # -> epwFile, statFile; plug-in component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
radopaquematerial_2 = Honeybee_RadianceOpaqueMaterial(materialName="generic_35", RReflectance=".35", GReflectance=".35", BReflectance=".35", roughness=0.05, specularity=0)  # -> avrgRef, RADMaterial; plug-in component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
panel_10 = Panel("Shading")
radglassmaterial_2 = Honeybee_RadianceGlassMaterial(materialName="glass_.65", RTransmittance=".65", GTransmittance=".65", BTransmittance=".65", refractiveIndex=1.52)  # -> avrgTrans, RADMaterial; plug-in component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

# ---- group: furniture
furniture_2 = Brep([<brep referenced from the Rhino model> x8])

# ---- group: glass facade
glass = Brep([<brep referenced from the Rhino model> x3])

# ---- group: floor
floor = Brep(<brep referenced from the Rhino model>)

# ----
gentestpts = Honeybee_GenerateTestPoints(testGeometry=floor, gridSize=Slider(0.2, range=0..1), distBaseSrf=Slider(0.7, range=0..1), moveTestMesh=True)  # -> readMe, simplify(testPoints), simplify(ptsVectors), simplify(facesArea), simplify(mesh); plug-in component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
# prepare a recipe
gridbasedsimulation = Honeybee_GridBasedSimulation(
    skyFile=genclimatebasedsky.skyFilePath,
    testPoints=gentestpts.testPoints,
    ptsVectors=gentestpts.ptsVectors,
    testMesh=gentestpts.mesh,
    simulationType=0)  # -> analysisRecipe; plug-in component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
# Put the recipie together!
annualdaylightsimulation = Honeybee_AnnualDaylightSimulation(
    epwWeatherFile=epw_stat_2.epwFile,
    testPoints=gentestpts.testPoints,
    ptsVectors=gentestpts.ptsVectors,
    testMesh=gentestpts.mesh)  # -> analysisRecipe; plug-in component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

# ---- group: ceiling
ceiling = Brep(<brep referenced from the Rhino model>)

# ----
walls = Brep([<brep referenced from the Rhino model> x24])
walls_2 = Brep([<brep referenced from the Rhino model> x5])
number_slider_3 = Slider(0, range=0..100)

# ---- group: For better visualization - Doesn't effect the results of the analysis
importlocation_2 = Ladybug_ImportLocation(epwFile=epw_stat_3.epwFile)  # -> location; plug-in component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
sunpath_2 = Ladybug_SunPath(
    north=number_slider_3,
    location=importlocation_2,
    hour=item_2,
    day="21",
    month=item,
    timeStep=1,
    sunPathScale=Slider(0.2, range=0..1),
    dailyOrAnnualSunPath=True)  # -> readMe, sunVectors, sunAltitudes, sunAzimuths, port, sunSpheresMesh, sunPathCrvs, legend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; plug-in component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

# ----
# Geometry Preparation
panel_11 = Panel("6")
# Assign specific materials
createhbsrfs_4 = Honeybee_createHBSrfs(geometry=furniture_2, RADMaterial=radopaquematerial_2.RADMaterial)  # -> readMe, simplify(HBSurface); plug-in component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
createhbsrfs_5 = Honeybee_createHBSrfs(geometry=glass, RADMaterial=radglassmaterial_2.RADMaterial)  # -> readMe, simplify(HBSurface); plug-in component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
createhbsrfs_6 = Honeybee_createHBSrfs(geometry=floor, srfType="2")  # -> readMe, simplify(HBSurface); plug-in component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
createhbsrfs_7 = Honeybee_createHBSrfs(geometry=ceiling, srfType="3")  # -> readMe, simplify(HBSurface); plug-in component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
# Honeybee default materials will be assigned
# based on surface type
createhbsrfs_8 = Honeybee_createHBSrfs(geometry=walls_2, srfType="0")  # -> readMe, simplify(HBSurface); plug-in component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
createhbsrfs_9 = Honeybee_createHBSrfs(geometry=walls, srfType=panel_11, RADMaterial=radopaquematerial.RADMaterial)  # -> readMe, simplify(HBSurface); plug-in component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
genclimatebasedsky_2 = Honeybee_GenerateClimateBasedSky(north=number_slider_3, weatherFile=epw_stat_3.epwFile, month=item, day="21", hour=item_2)  # -> radiationValues, skyFilePath; plug-in component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
genavgsky = Honeybee_GenerateAverageSky(north=number_slider_3, weatherFile=epw_stat_3.epwFile, month=item, hour=item_2)  # -> radiationValues, skyFilePath; plug-in component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
northarrow = Ladybug_North(north=number_slider_3, scale=".05")  # -> northSign; plug-in component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
panel_12 = Panel([genclimatebasedsky_2.radiationValues, genavgsky.radiationValues])
set_the_view_to_fisheye_for_glare_analys = Panel("1")  # "set the view to FishEye for Glare Analysis"
radparameters = Honeybee_RADParameters(quality=0, ab="3")  # -> readMe, radParameters; plug-in component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
doy_hoy_2 = Ladybug_DOY_HOY(days="21", months=item, hours=item_2)  # -> HOY, DOY, date; plug-in component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

# ---- group: collect all honeybee surfaces
brep_4 = Brep(flatten([createhbsrfs_8.HBSurface, createhbsrfs_7.HBSurface, createhbsrfs_6.HBSurface, createhbsrfs_4.HBSurface, createhbsrfs_5.HBSurface, createhbsrfs_9.HBSurface, createhbsrfs_3.HBSurface]))

# ---- group: HB Zone With Glazing
brep_5 = Brep(brep_4)

# ----
# https://www.energyplus.net/weather-download/north_and_central_america_wmo_region_4/USA/PA/USA_PA_Philadelphia.Intl.AP.724080_TMY3/all
genhbzonetestpts = Honeybee_GenerateZoneTestPoints(HBZone=brep_5, gridSize=Slider(0.5, range=0..1), distBaseSrf=Slider(0.762, range=0..1), moveTestMesh=Toggle(True))  # -> readMe, simplify(testPoints), simplify(ptsVectors), simplify(facesArea), simplify(mesh); plug-in component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
wires = BrepWireframe(Brep=brep_5, Density=-1)
# run the analysis
rundaylightanalysis = Honeybee_RunDaylightSimulation(HBObjects=flatten(brep_4), analysisRecipe=gridbasedsimulation, writeRad=toggle, runRad=toggle, overwriteResults=True)  # -> readMe, analysisType, resultsUnit, illuminance_values, testPts, illuminance_files, radGeoFile, studyFolder, done; plug-in component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
# Run the analysis
rundaylightanalysis_2 = Honeybee_RunDaylightSimulation(
    HBObjects=flatten(brep_5),
    analysisRecipe=annualdaylightsimulation,
    writeRad=toggle_2,
    runRad=toggle_2,
    overwriteResults=True)  # -> readMe, analysisType, resultsUnit, results, testPts, resultFiles, radGeoFile, studyFolder, done; plug-in component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
# visualize the results
concat = Concatenate(FragmentA=rundaylightanalysis.analysisType, FragmentC=panel_6)
recolormesh = Ladybug_RecolorMesh(
    analysisResult=rundaylightanalysis.illuminance_values,
    inputMesh=gentestpts.mesh,
    legendPar=legendpar,
    analysisTitle=concat,
    legendTitle=rundaylightanalysis.resultsUnit)  # -> readMe, newMesh, newLegend, legendBasePt, meshColors, legendColors; plug-in component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
# Generate annual results
readannualresultsi = Honeybee_ReadAnnualResultI(
    illFilesAddress=rundaylightanalysis_2.resultFiles,
    testPoints=simplify(rundaylightanalysis_2.testPts),
    occupancyFiles=occupancygenerator,
    DLAIllumThresholds=300,
    runIt=Toggle(True))  # -> DLA, UDLI_Less_100, UDLI_100_2000, UDLI_More_2000, CDA, sDA, annualProfiles, htmReport; plug-in component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
panel_13 = Panel(readannualresultsi.UDLI_Less_100)
recolormesh_2 = Ladybug_RecolorMesh(
    analysisResult=readannualresultsi.DLA,
    inputMesh=gentestpts.mesh,
    heightDomain=dom,
    legendPar=legendpar_2,
    analysisTitle=rundaylightanalysis_2.analysisType,
    legendTitle="%")  # -> readMe, newMesh, newLegend, legendBasePt, meshColors, legendColors; plug-in component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
# Analysis Recipe
imagebasedsimulation = Honeybee_ImageBasedSimulation(
    skyFile=genavgsky.skyFilePath,
    cameraType=set_the_view_to_fisheye_for_glare_analys,
    simulationType=2,
    radParameters=radparameters.radParameters,
    backupImages=0)  # -> analysisRecipe; plug-in component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
brep_6 = Brep(flatten([createhbsrfs_8.HBSurface, createhbsrfs_7.HBSurface, createhbsrfs_6.HBSurface, createhbsrfs_4.HBSurface, createhbsrfs_5.HBSurface]))
wires_2 = BrepWireframe(Brep=brep_4, Density=-1)
toggle_3 = BooleanToggle(False)
# Run the analysis
rundaylightanalysis_3 = Honeybee_RunDaylightSimulation(
    HBObjects=flatten(brep_4),
    analysisRecipe=imagebasedsimulation,
    writeRad=toggle_3,
    runRad=toggle_3,
    numOfCPUs="4",
    radFileName=doy_hoy_2.date,
    overwriteResults=True)  # -> readMe, analysisType, resultsUnit, results, testPts, resultFiles, radGeoFile, studyFolder, done; plug-in component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
glareanalysis = Honeybee_GlareAnalysis(HDRImagePath=rundaylightanalysis_3.resultFiles, runIt=Toggle(True))  # -> readMe, glareCheckImage, DGP, DGI, imageWithTaskArea; plug-in component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
falsecolor = Honeybee_FalseColor(
    HDRFilePath=rundaylightanalysis_3.resultFiles,
    contourBands=False,
    maskThreshold=0.1,
    useAlterColors=False,
    render=Toggle(True))  # -> outputFilePath; plug-in component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
hdr_tif = Honeybee_ConvertHDRToTIF(HDRFilePath=falsecolor, adjustExposure=False)  # -> TIFFFilePath; plug-in component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
# DGP: Daylight glare probability:
# Imperceptible Glare [0.35 > DGP]
# Perceptible Glare [0.4 > DGP >= 0.35]
# Disturbing Glare [0.45 > DGP >= 0.4]
# Intolerable Glare [DGP >= 0.45]
toggle_4 = BooleanToggle(False)
panel_14 = Panel(join)
captureview = Ladybug_CaptureView(
    fileName=panel_14,
    viewNames="baseanalysis",
    imageWidth=Slider(3000, range=0..10000),
    keepAspectR=Toggle(True),
    capture=Toggle(True))  # -> imagePath; plug-in component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
panel_15 = Panel(captureview)
hdr_tif_2 = Honeybee_ConvertHDRToTIF(HDRFilePath=glareanalysis.glareCheckImage, adjustExposure=toggle_4)  # -> TIFFFilePath; plug-in component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
number_slider_4 = Slider(1.6, range=0..2)
image = ImageFromPath(P=hdr_tif_2, S=number_slider_4)
panel_16 = Panel(glareanalysis.DGP)
image_2 = ImageFromPath(P=hdr_tif, S=number_slider_4)
md_slider = MDSlider(
    slider_value=Point(0.499934871, 0.4983163229, 0.5),
    SliderMode=0,
    x_domain=Domain(-1, 1),
    y_domain=Domain(-1, 1),
    z_domain=Domain(0, 1))

pt = Point(Point(-1.992223237, 3.499265384, 0))
# set the view
comfortmannequin = Ladybug_ComfortMannequin(bodyPosture=Slider(1, range=0..100), rotationAngle="45", bodyLocation=pt)  # -> mannequinMesh, legend, legendBasePt; plug-in component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

# ---- group: Person's face!
item_4 = ListItem(List=comfortmannequin.mannequinMesh, Index=121, Wrap=True)

# ----
preview_3 = CustomPreview(Geometry=item_4, Shader=ColourSwatch(SwatchColor=RGB(255, 0, 0)))

facen = FaceNormals(Mesh=item_4)  # -> Centers, Normals
settheview = Ladybug_SetTheView(cameraLocation=facen.Centers, cameraDirection=facen.Normals, uvLookAround=md_slider, lensLength=Slider(20, range=0..100))  # -> readMe; plug-in component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
