# Grasshopper definition Jiyuan_Liu.gh (Grasshopper 0.9.75)

number_slider = Slider(3, range=0..10)
number_slider_2 = Slider(2.5, range=0..10)
panel = Panel("Room Width")
panel_2 = Panel("Room Height")
panel_3 = Panel("Room Depth")
geo = Geometry(<brep referenced from the Rhino model>)
geo_2 = Geometry(<brep referenced from the Rhino model>)
geo_3 = Geometry(<brep referenced from the Rhino model>)
number_slider_3 = Slider(0, range=0..100)
panel_4 = Panel("AC ")
pt = ConstructPoint(XCoordinate=number_slider_2, YCoordinate=0, ZCoordinate=number_slider_3)
pt_2 = ConstructPoint(XCoordinate=0, YCoordinate=0, ZCoordinate=number_slider_3)
panel_5 = Panel("Desk")
panel_6 = Panel("Bed")
pt_3 = ConstructPoint(XCoordinate=number_slider_2, YCoordinate=number_slider, ZCoordinate=number_slider_3)
pt_4 = ConstructPoint(XCoordinate=0, YCoordinate=number_slider, ZCoordinate=number_slider_3)
srf4pt = _4PointSurface(CornerA=pt, CornerB=pt_3, CornerC=pt_4, CornerD=pt_2)
Z = UnitZ(Factor=Slider(2.5, range=0..10))
edges = BrepEdges(Brep=srf4pt)  # -> Naked, Interior, NonManifold
move = Move(Geometry=srf4pt, Motion=Z)  # -> Geometry, Transform
crv = Curve(edges.Naked)
item = ListItem(List=crv, Index=Slider(1, range=0..100), Wrap=True)
item_2 = ListItem(List=crv, Index=Slider(6, range=0..100), Wrap=True)
item_3 = ListItem(List=crv, Index=Slider(3, range=0..100), Wrap=True)
number_slider_4 = Slider(0.7, range=0..10)
number_slider_5 = Slider(1, range=0..10)
curvepoint = PointOnCurve(item, parameter=0.255)
curvepoint_2 = PointOnCurve(item, parameter=0.459)
curvepoint_3 = PointOnCurve(item, parameter=0.658)
curvepoint_4 = PointOnCurve(item, parameter=0.856)
curvepoint_5 = PointOnCurve(item_3, parameter=0.529)
curvepoint_6 = PointOnCurve(item_3, parameter=0.826)
curvepoint_7 = PointOnCurve(item_2, parameter=0.232)
curvepoint_8 = PointOnCurve(item_2, parameter=0.438)
Z_2 = UnitZ(Factor=Slider(0, range=0..10))
Z_3 = UnitZ(Factor=number_slider_4)
Z_4 = UnitZ(Factor=number_slider_4)
move_2 = Move(Geometry=curvepoint_5, Motion=Z_2)  # -> Geometry, Transform
move_3 = Move(Geometry=curvepoint, Motion=Z_3)  # -> Geometry, Transform
move_4 = Move(Geometry=curvepoint_3, Motion=Z_4)  # -> Geometry, Transform
move_5 = Move(Geometry=curvepoint_6, Motion=Z_2)  # -> Geometry, Transform
move_6 = Move(Geometry=curvepoint_2, Motion=Z_3)  # -> Geometry, Transform
move_7 = Move(Geometry=curvepoint_4, Motion=Z_4)  # -> Geometry, Transform
Z_5 = UnitZ(Factor=number_slider_4)
move_8 = Move(Geometry=curvepoint_7, Motion=Z_5)  # -> Geometry, Transform
move_9 = Move(Geometry=curvepoint_8, Motion=Z_5)  # -> Geometry, Transform
ln = Line(StartPoint=move_2.Geometry, EndPoint=move_5.Geometry)
ln_2 = Line(StartPoint=move_3.Geometry, EndPoint=move_6.Geometry)
ln_3 = Line(StartPoint=move_4.Geometry, EndPoint=move_7.Geometry)
ln_4 = Line(StartPoint=move_8.Geometry, EndPoint=move_9.Geometry)
Z_6 = UnitZ(Factor=Slider(2, range=0..10))
Z_7 = UnitZ(Factor=Slider(1, range=0..10))
Z_8 = UnitZ(Factor=Slider(1, range=0..10))
Z_9 = UnitZ(Factor=Slider(1, range=0..10))
extr = Extrude(Base=ln, Direction=Z_6)
extr_2 = Extrude(Base=ln_3, Direction=Z_8)
extr_3 = Extrude(Base=ln_2, Direction=Z_7)
extr_4 = Extrude(Base=ln_4, Direction=Z_9)
extr_5 = Extrude(Base=crv, Direction=Z)
debrep = DeconstructBrep(Brep=extr_5)  # -> Faces, Edges, Vertices
item_4 = ListItem(List=flatten(debrep.Faces), Index=Slider(1, range=0..1), Wrap=True)
item_5 = ListItem(List=flatten(debrep.Faces), Index=Slider(2, range=0..5), Wrap=True)
item_6 = ListItem(List=flatten(debrep.Faces), Index=Slider(3, range=0..10), Wrap=True)
item_7 = ListItem(List=flatten(debrep.Faces), Index=Slider(0, range=0..100), Wrap=True)
sdiff = SolidDifference(BrepsA=item_4, BrepsB=extr_3)
sdiff_2 = SolidDifference(BrepsA=item_5, BrepsB=extr_4)
brep = Brep([move.Geometry, srf4pt])
sdiff_3 = SolidDifference(BrepsA=item_6, BrepsB=extr)
sdiff_4 = SolidDifference(BrepsA=sdiff, BrepsB=extr_2)
panel_7 = Panel("Orientation")
pi = Pi(Factor=Slider(0.5, range=0..1))
rotate = Rotate(Geometry=[sdiff_4, sdiff_2, item_7, brep, sdiff_3], Angle=pi, Plane=PlaneXY(0, 0, 0))  # -> Geometry, Transform
geo_4 = Geometry(rotate.Geometry)
