# Grasshopper definition Jiyuan_Liu.gh (Grasshopper 0.9.75)
# plug-ins: Python Interpreter

# ---- group: WWR
# Wall to Window Ratio
wwr_north = Slider(0.4, range=0..1)
wwr_west = Slider(0, range=0..1)
wwr_south = Slider(0, range=0..1)
# Rotation Angle
wwr_east = Slider(0.5, range=0..1)

# ----
ladybug = Ladybug_Ladybug(defaultFolder="E:\Ladybug+Honeybee")  # -> Vviiiiiiiiiizzz; plug-in component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
honeybee = Honeybee_Honeybee(defaultFolder="E:\Ladybug+Honeybee")  # -> Vviiiiiiiiiizzz; plug-in component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

shading_depth = Slider(0.2, range=0..1)
number_of_blinds = Slider(4, range=0..10)
# Blinds
add_blinds = BooleanToggle(True)

list = ValueList({"Exterior Window [R1.0, SHGC 0.7]": "ASHRAE 90.1-2004 EXTWINDOW CLIMATEZONE ALT-WARE 1-8", "Exterior Window [R1.7, SHGC 0.39]": "ASHRAE 90.1-2004 EXTWINDOW CLIMATEZONE 4-6", "Exterior Window [R1.9, SHGC 0.39]": "ASHRAE 90.1-2004 EXTWINDOW CLIMATEZONE ALT-RES 4-6", "Exterior Window [R0.7, SHGC 0.65]": "Dbl LoE (e3=.1) Clr 3mm/13mm Arg"}, selected="Exterior Window [R0.7, SHGC 0.65]")
list_2 = ValueList({"Exterior Roof [R9.2]": "ASHRAE 90.1-2004 EXTROOF METAL CLIMATEZONE 3-4", "Exterior Roof [R14.8]": "ASHRAE 90.1-2004 EXTROOF IEAD CLIMATEZONE 1-4", "Exterior Roof [R34.4]": "ASHRAE 189.1-2009 EXTROOF IEAD CLIMATEZONE 7-8"}, selected="Exterior Roof [R34.4]")
# Construction
list_3 = ValueList({"Exterior Wall [R5.5]": "ASHRAE 90.1-2004 EXTWALL METAL CLIMATEZONE 4", "Exterior Wall [R5.8]": "ASHRAE 90.1-2004 EXTWALL MASS CLIMATEZONE 3-4", "Exterior Wall [R7.2]": "ASHRAE 90.1-2004 EXTWALL STEELFRAME CLIMATEZONE 1-4", "Exterior Wall [R8.7]": "ASHRAE 90.1-2004 EXTWALL MASS CLIMATEZONE ALT-RES 4", "Exterior Wall [R10.4]": "ASHRAE 90.1-2004 EXTWALL WOODFRAME CLIMATEZONE 1-7", "Exterior Wall [R14.8]": "ASHRAE 90.1-2004 EXTWALL STEELFRAME CLIMATEZONE ALT-RES 4-6", "Exterior Wall [R34.4]": "ASHRAE 189.1-2009 EXTROOF IEAD CLIMATEZONE 7-8"}, selected="Exterior Wall [R34.4]")

run_energyplus = BooleanToggle(False)

# ---- group: EPW
panel = Panel("https://www.energyplus.net/weather-download/north_and_central_america_wmo_region_4/USA/IL/USA_IL_Chicago-OHare.Intl.AP.725300_TMY3/all")
epw_stat = Ladybug_OpenEPWAndSTATWeatherFiles(weatherFileURL=panel)  # -> epwFile, statFile; plug-in component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
importepw = Ladybug_ImportEpw(epwFile=epw_stat.epwFile)  # -> readMe, latitude, location, dryBulbTemperature, dewPointTemperature, relativeHumidity, windSpeed, windDirection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; plug-in component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

# ----
# Thermal Mass
list_4 = ValueList({"Existing Slab Construction": "0", "+4 Inches Concrete": "1", "+8 Inches Concrete": "2"}, selected="+8 Inches Concrete")

# ---- group: Schedule
lb_schedule = GenePool(Decimals=1, Maximum=1, Minimum=0, Value=[1, 1, 1, 1, 1, 1, 1, 1, 1, 1, 1, 0, 0.5, 1, 1, 1, 1, 1, 0, 0, 1, 1, 1, 1])
lb_schedule_2 = GenePool(Decimals=1, Maximum=1, Minimum=0, Value=[1, 1, 1, 1, 1, 1, 1, 1, 0.5, 0, 0, 0, 0, 0, 0, 0, 0, 0, 1, 1, 1, 1, 1, 1])
dup = DuplicateData(Data="0", Number="24", Order=True)
toggle = BooleanToggle(True)
annualschedule = Honeybee_AnnualSchedule(
    sun=lb_schedule,
    mon=lb_schedule_2,
    tue=lb_schedule_2,
    wed=lb_schedule_2,
    thu=lb_schedule_2,
    fri=lb_schedule_2,
    sat=lb_schedule,
    holiday=dup,
    scheduleName="Home",
    generateValues=toggle,
    writeSchedule=toggle)  # -> readMe, port, schedule, holidays, port_2, weekSchedule, schedIDFText, scheduleValues; plug-in component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
pt = Point(<point referenced from the Rhino model>)
_3dchart = Ladybug_3DChart(inputData=flatten(annualschedule.scheduleValues), basePoint=pt, xScale="0.25", zScale="0")  # -> readMe, graphMesh, graphCurves, legend, legendBasePts, title, titleBasePts, dataPts, conditionalHOY; plug-in component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
preview = CustomPreview(Geometry=_3dchart.graphCurves, Shader=ColourSwatch(SwatchColor=RGB(0, 0, 0)))

# ----
toggle_2 = BooleanToggle(True)
updateladybug = Ladybug_UpdateLadybug(sourceDirectory="E:\Ladybug+Honeybee", updateAllUObjects=toggle_2)  # -> readMe; plug-in component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
updatehoneybee = Honeybee_UpdateHoneybee(sourceDirectory="E:\Ladybug+Honeybee", updateAllUObjects=toggle_2)  # -> readMe; plug-in component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
panel_2 = Panel(honeybee)
panel_3 = Panel(updateladybug)
panel_4 = Panel(updatehoneybee)

callfromepconstrlibrary = Honeybee_CallFromEPConstructionLibrary(keywords="floor")  # -> ThermMaterials, EPMaterials, EPWindowMaterials, EPConstructions; plug-in component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
item = ListItem(List=callfromepconstrlibrary.EPConstructions, Index=Slider(0, range=0..100), Wrap=True)
decomposeepconstruction = Honeybee_DecomposeEPConstruction(cnstrName=item)  # -> flatten(materials), comments, UValue_SI, UValue_IP, RValue_SI, RValue_IP; plug-in component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

callfromepconstrlibrary_2 = Honeybee_CallFromEPConstructionLibrary(keywords="slab")  # -> ThermMaterials, EPMaterials, EPWindowMaterials, EPConstructions; plug-in component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
item_2 = ListItem(List=callfromepconstrlibrary_2.EPConstructions, Index="2", Wrap=True)
decomposeepconstruction_2 = Honeybee_DecomposeEPConstruction(cnstrName=item_2)  # -> flatten(materials), comments, UValue_SI, UValue_IP, RValue_SI, RValue_IP; plug-in component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

toggle_3 = BooleanToggle(True)

panel_5 = Panel("""WindowMaterial:Glazing,
    LoE CLEAR 3MM Rev,       !- Name
    SpectralAverage,         !- Optical Data Type
    ,                        !- Window Glass Spectral Data Set Name
    0.003,                   !- Thickness {m}
    0.630,                   !- Solar Transmittance at Normal Incidence
    0.220,                   !- Front Side Solar Reflectance at Normal Incidence
    0.190,                   !- Back Side Solar Reflectance at Normal Incidence
    0.850,                   !- Visible Transmittance at Normal Incidence
    0.079,                   !- Front Side Visible Reflectance at Normal Incidence
    0.056,                   !- Back Side Visible Reflectance at Normal Incidence
    0.0,                     !- Infrared Transmittance at Normal Incidence
    0.10,                    !- Front Side Infrared Hemispherical Emissivity
    0.84,                    !- Back Side Infrared Hemispherical Emissivity
    0.9;                     !- Conductivity {W/m-K}""")
panel_6 = Panel("""Construction,
    Dbl LoE (e3=.1) Clr 3mm/13mm Arg,  !- Name
    CLEAR 3MM,               !- Outside Layer
    ARGON 13MM,              !- Layer 2
    LoE CLEAR 3MM Rev;       !- Layer 3""")
panel_7 = Panel("""WindowMaterial:Gas,
    ARGON 13MM,               !- Name
    Argon,                   !- Gas Type
    0.0127;                  !- Thickness {m}""")
toggle_4 = BooleanToggle(True)
addtoeplibrary = Honeybee_AddToEnergyPlusLibrary(EPObject=[panel_6, panel_7, panel_5], addToProjectLib=toggle_4, overwrite=toggle_4)  # -> readMe; plug-in component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

panel_8 = Panel(decomposeepconstruction.materials)
panel_9 = Panel("""MAT-CC05 4 HW CONCRETE
MAT-CC05 8 HW CONCRETE""")
item_3 = ListItem(List=decomposeepconstruction.materials, Index=0, Wrap=True)  # -> Item, Item1
item_4 = ListItem(List=panel_9, Index=0, Wrap=True)  # -> Item, Item1
panel_10 = Panel(item)
epconstruction = Honeybee_EnergyPlusConstruction(name="floor_cnstr_1", layer_1=item_3.Item, layer_2=item_3.Item1, layer_3=item_4.Item)  # -> EPConstruction; plug-in component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
epconstruction_2 = Honeybee_EnergyPlusConstruction(name="floor_cnstr_2", layer_1=item_3.Item, layer_2=item_3.Item1, layer_3=item_4.Item1)  # -> EPConstruction; plug-in component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

updatehoneybee_2 = Honeybee_UpdateHoneybee(updateAllUObjects=Toggle(True))  # -> out; plug-in component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
panel_11 = Panel(addtoeplibrary)
filter = StreamFilter(Gate=list_4, Stream0=panel_10, Stream1=epconstruction, Stream2=epconstruction_2)
toggle_5 = BooleanToggle(False)
number_slider = Slider(0, range=0..1)
gradientlibrary = Ladybug_GradientLibrary(gradIndex=Slider(1, range=0..10))  # -> customColors; plug-in component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
legendpar = Ladybug_LegendParameters(
    lowBound=Slider(0, range=0..100),
    highBound=Slider(100, range=0..100),
    numSegments=Slider(6, range=0..10),
    customColors=flatten(gradientlibrary))  # -> legendPar; plug-in component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

# ---- group: make it 3D!
dom = ConstructDomain(DomainStart=0, DomainEnd=Slider(1, range=0..1))

# ----
# Visualize the results
panel_12 = Panel("%")
toggle_6 = BooleanToggle(True)
epoutput = Honeybee_GenerateEPOutput(zoneGainsAndLosses=toggle_6, zoneComfortMetrics=toggle_6, surfaceTempAnalysis="False", surfaceEnergyAnalysis=toggle_6)  # -> report, flatten(simulationOutputs); plug-in component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
rep = ReplaceText(Text="base_case", Find=" ", Replace="_", RecursiveReplace=False)

# ---- group: EPW 1
path = FilePath(epw_stat.epwFile)
importepw_2 = Ladybug_ImportEpw(epwFile=path)  # -> readMe, latitude, location, dryBulbTemperature, dewPointTemperature, relativeHumidity, windSpeed, windDirection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; plug-in component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

# ----
toggle_7 = BooleanToggle(False)
legendpar_2 = Ladybug_LegendParameters(lowBound="-1", highBound="1", numSegments="3")  # -> legendPar; plug-in component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
energybalance = Honeybee_ConstructEnergyBalance()  # -> readMe, port, flrNormEnergyBal, flrNormBalWStorage, port_2, modelEnergyBalance, energyBalWithStorage; plug-in component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
number_slider_2 = Slider(6, range=0..10)
number_slider_3 = Slider(6, range=0..10)
number_slider_4 = Slider(21, range=0..100)
number_slider_5 = Slider(21, range=0..100)
strategylist = Ladybug_PassiveStrategyList({"Evaporative Cooling", "Thermal Mass + Night Vent", "Occupant Use of Fans", "Internal Heat Gain", "Dessicant Dehumidification", "Dehumidification Only", "Humidification Only"}, selected=[])
vec = VectorXYZ(XComponent="20", YComponent="35", ZComponent=0)  # -> Vector, Length
pt_2 = Point(Point(23.10617158, 0, 0))
panel_13 = Panel("a==0")
panel_14 = Panel("a==-1 or a==1")
gradientlibrary_2 = Ladybug_GradientLibrary(gradIndex="1")  # -> customColors; plug-in component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
move = Move(Geometry=pt_2, Motion=vec.Vector)  # -> Geometry, Transform
analysisperiod = Ladybug_AnalysisPeriod(fromMonth=Slider(11, range=0..100), fromDay=number_slider_5, toMonth=Slider(4, range=0..10), toDay=number_slider_5)  # -> readMe, analysisPeriod; plug-in component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
analysisperiod_2 = Ladybug_AnalysisPeriod(fromMonth=Slider(5, range=0..100), fromDay=number_slider_4, toMonth=Slider(9, range=0..10), toDay=number_slider_4)  # -> readMe, analysisPeriod; plug-in component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
rev = ReverseList(List=gradientlibrary_2)
panel_15 = Panel("""Comfortable (%): 
hot (%):         
cold (%):        """)
selectandaveragedata = Ladybug_AverageData(annualHourlyData=energybalance.modelEnergyBalance, totalOrAverage=Toggle(True))  # -> readMe, selHourlyData, totaledDaily, totaledMonthly, totMonthlyPerHour, totAnalysisPeriod; plug-in component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
legendpar_3 = Ladybug_LegendParameters(customColors=flatten(rev))  # -> legendPar; plug-in component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
pt_3 = Point(Point(23.10617158, 0, 0))
vec_2 = VectorXYZ(XComponent=0, YComponent="120", ZComponent=0)  # -> Vector, Length
flip = FlipMatrix(Data=panel_15)  # -> simplify(Data)
move_2 = Move(Geometry=pt_3, Motion=vec_2.Vector)  # -> Geometry, Transform
panel_16 = Panel("-3191.97")

# ----
# Geometry
number_slider_6 = Slider(2.5, range=0..10)
box = DomainBox(Base=PlaneXY(0, 0, 0), X=Slider(3, range=0..10), Y=Slider(2.5, range=0..10), Z=number_slider_6)
mass2zone = Honeybee_Masses2Zones(zoneMasses=flatten(box), isConditioned=Toggle(False), maxRoofAngle=30, createHBZones=Toggle(True))  # -> readMe, HBZones; plug-in component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
glzparamlist = Honeybee_GlazingParametersList(northGlzParam=wwr_north, westGlzParam=wwr_west, southGlzParam=wwr_south, eastGlzParam=wwr_east)  # -> glzParamList; plug-in component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
glazingcreator = Honeybee_GlazingBasedOnRatio(HBObjects=mass2zone.HBZones, glzRatio=glzparamlist, breakUpDist=Toggle(True), runIt=Toggle(True))  # -> readMe, HBObjWGLZ; plug-in component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
volume = Volume(Geometry=glazingcreator.HBObjWGLZ)  # -> Volume, Centroid
rotatehbobj = Honeybee_RotateHoneybee(HBObj=glazingcreator.HBObjWGLZ, angle=Slider(150, range=0..360), cenPt=volume.Centroid)  # -> HBObj; plug-in component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
wires = BrepWireframe(Brep=rotatehbobj, Density=-1)

setepzonecnstr = Honeybee_SetEPZoneConstruction(HBZone=rotatehbobj, wallEPConstruction=list_3, windowEPConstruction=list, roofEPConstruction=list_2)  # -> simplify(modifiedHBZone); plug-in component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
makeadiabaticbytype = Honeybee_MakeAdiabaticByType(HBZones=rotatehbobj, roofs=toggle_3, groundFloors=toggle_3)  # -> HBZones; plug-in component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
# Construction
setepzoneundergroundcnstr = Honeybee_SetEPZoneUndergroundConstruction(HBZone=flatten(setepzonecnstr), groundFloorEPConstruction=filter)  # -> simplify(modifiedHBZone); plug-in component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
brep = Brep(makeadiabaticbytype)

# ----
# infiltration rate
ach2m3_s_m2_calculator = HoneybeeInfORventPerAreaCalculator(HBZones=flatten(setepzoneundergroundcnstr), airChangeHour=Slider(1, range=0..10))  # -> out, infORventPerArea, allFloors; plug-in component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
setepzoneloads = Honeybee_SetEnergyPlusZoneLoads(HBZones=flatten(setepzoneundergroundcnstr), infiltrationRatePerArea=ach2m3_s_m2_calculator.infORventPerArea)  # -> loads, HBZones; plug-in component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

genhbzonetestpts = Honeybee_GenerateZoneTestPoints(HBZone=brep, gridSize=Slider(0.2, range=0..1), distBaseSrf=Slider(0.7, range=0..1), moveTestMesh=True)  # -> readMe, simplify(testPoints), simplify(ptsVectors), simplify(facesArea), simplify(mesh); plug-in component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

decomposebytype = Honeybee_DecomposeBasedOnType(HBZone=setepzoneundergroundcnstr)  # -> walls, interiorWalls, airWalls, windows, interiorWindows, skylights, roofs, ceilings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; plug-in component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
# Blinds
shddesigner = Ladybug_ShadingDesigner(
    glzSrf=flatten(decomposebytype.windows),
    depthOrVector=flatten(shading_depth),
    numOfShds=number_of_blinds,
    runIt=add_blinds,
    port_4=False)  # -> readMe, shadingSrfs; plug-in component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
wires_2 = BrepWireframe(Brep=shddesigner.shadingSrfs, Density=-1)
hb_epcontextsrf = HoneybeeEPContextSurfaces(shdSurfaces=flatten(shddesigner.shadingSrfs))  # -> HBContext; inputs shdSurfaces: list of Brep, justBoundingBox: Boolean
# ---------- hb_epcontextsrf: Python ----------
"""
prepare shading/context geometries

    Args:
        northVectorOrRotation: A vector that shows North or a number that shows
                               the rotation of the North from the Y axis
        bldgMasses: List of closed Breps as thermal zones.
    Returns:
        report: ...
        thermalZones: Thermal zone's geometries for visualiza
"""

ghenv.Component.Name = 'Honeybee EP context Surfaces'
ghenv.Component.NickName = 'HB_EPContextSrf'
ghenv.Component.Message = 'VER 0.0.59\nJAN_26_2016'
ghenv.Component.IconDisplayMode = ghenv.Component.IconDisplayMode.application
ghenv.Component.Category = "Honeybee"
ghenv.Component.SubCategory = "09 | Energy | Energy"
#compatibleHBVersion = VER 0.0.57\nNOV_01_2015
#compatibleLBVersion = VER 0.0.59\nFEB_01_2015
ghenv.Component.AdditionalHelpFromDocStrings = "2"

import rhinoscriptsyntax as rs
import Rhino as rc
import scriptcontext as sc
import os
import System
import Grasshopper.Kernel as gh
import uuid

tolerance = sc.doc.ModelAbsoluteTolerance
import math


def main(shdSurfaces, EPTransSchedule, meshingSettings, justBoundingBox):
    
    # import the classes
    if sc.sticky.has_key('honeybee_release'):

        try:
            if not sc.sticky['honeybee_release'].isCompatible(ghenv.Component): return -1
            if sc.sticky['honeybee_release'].isInputMissing(ghenv.Component): return -1
        except:
            warning = "You need a newer version of Honeybee to use this compoent." + \
            " Use updateHoneybee component to update userObjects.\n" + \
            "If you have already updated userObjects drag Honeybee_Honeybee component " + \
            "into canvas and try again."
            w = gh.GH_RuntimeMessageLevel.Warning
            ghenv.Component.AddRuntimeMessage(w, warning)
            return -1
        
        # don't customize this part
        hb_EPSrf = sc.sticky["honeybee_EPSurface"]
        hb_EPSHDSurface = sc.sticky["honeybee_EPShdSurface"]
        hb_RADMaterialAUX = sc.sticky["honeybee_RADMaterialAUX"]
        hb_EPObjectsAux = sc.sticky["honeybee_EPObjectsAUX"]()
        HBScheduleList = sc.sticky["honeybee_ScheduleLib"].keys()

        ########################################################################
        #----------------------------------------------------------------------#
        shdBreps = []
        # create bounding box of shading geometries
        if justBoundingBox:
            for brep in shdSurfaces:
                if brep.Faces.Count>1 or not brep.Faces[0].IsPlanar(sc.doc.ModelAbsoluteTolerance):
                    shdBreps.append(brep.GetBoundingBox(True).ToBrep())
                else:
                    shdBreps.append(brep)
        else:
            shdBreps = shdSurfaces
        
        shadingClasses = []
        shadingMeshPreview = []
        
        if meshingSettings == None:
            mp = rc.Geometry.MeshingParameters.Minimal
            mp.SimplePlanes = True
        else:
            mp = meshingSettings
        
        def getRadMaterialName(radMaterial):
            nameStr = radMaterial.split(" ")[2]
            name =  nameStr.split("\n")[0]
            return name
        
        for brepCount, brep in enumerate(shdBreps):
            if brep != None:
                isPlanar = True
                # check planarity
                for face in brep.Faces:
                    if not face.IsPlanar(tolerance):
                        isPlanar = False
                        break
                
                shadingBreps = []
                if not isPlanar:
                    meshArray = rc.Geometry.Mesh.CreateFromBrep(brep, mp)
                    for mesh in meshArray:
                        for meshFace in range(mesh.Faces.Count):
                            vertices = list(mesh.Faces.GetFaceVertices(meshFace))[1:]
                            vertices = vertices + [sc.doc.ModelAbsoluteTolerance]
                            # create the brep from mesh
                            shdBrep = rc.Geometry.Brep.CreateFromCornerPoints(*vertices)
                            shadingBreps.append(shdBrep)
                else:
                    for face in brep.Faces:
                        shadingBreps.append(face.DuplicateFace(False))
                
                for faceCount, shdBrep in enumerate(shadingBreps):
                        thisShading = hb_EPSHDSurface(shdBrep, 1000*brepCount + faceCount, 'shdSrf_' + `brepCount` + '_' + `faceCount` + "_" + str(uuid.uuid4()))
                        
                        # add transmittance schedule if any
                        if EPTransSchedule!=None:
                            schedule= EPTransSchedule.upper()
                            if schedule!=None and not schedule.lower().endswith(".csv") and schedule not in HBScheduleList:
                                msg = "Cannot find " + schedule + " in Honeybee schedule library."
                                print msg
                                ghenv.Component.AddRuntimeMessage(gh.GH_RuntimeMessageLevel.Warning, msg)
                                return -1
                            elif schedule!=None and schedule.lower().endswith(".csv"):
                                # check if csv file is existed
                                if not os.path.isfile(schedule):
                                    msg = "Cannot find the shchedule file: " + schedule
                                    print msg
                                    ghenv.Component.AddRuntimeMessage(gh.GH_RuntimeMessageLevel.Warning, msg)
                                    return -1
                            
                            thisShading.TransmittanceSCH = schedule
                        
                        # add the Rad Material if any
                        if RADMaterial!=None:
                            # if it is just the name of the material make sure it is already defined
                            if len(RADMaterial.split(" ")) == 1:
                                # if the material is not in the library add it to the library
                                if not hb_RADMaterialAUX.isMatrialExistInLibrary(RADMaterial):
                                    warningMsg = "Can't find " + RADMaterial + " in RAD Material Library.\n" + \
                                                "Add the material to the library and try again."
                                    ghenv.Component.AddRuntimeMessage(gh.GH_RuntimeMessageLevel.Warning, warningMsg)
                                    return
                                
                                try:
                                    thisShading.setRADMaterial(RADMaterial)
                                except Exception, e:
                                    print e
                                    warningMsg = "You are using an old version of Honeybee_Honeybee! Update your files and try again."
                                    print warningMsg
                                    ghenv.Component.AddRuntimeMessage(gh.GH_RuntimeMessageLevel.Warning, warningMsg)
                                    return
                                
                                addedToLib = True
                            else:
                                
                                # try to add the material to the library
                                addedToLib, thisShading.RadMaterial = hb_RADMaterialAUX.analyseRadMaterials(RADMaterial, True)
                                
                            if addedToLib==False:
                                warningMsg = "Failed to add " + RADMaterial + " to the Library."
                                ghenv.Component.AddRuntimeMessage(gh.GH_RuntimeMessageLevel.Warning, warningMsg)
                                return
                        
                        # add shading to the list
                        shadingClasses.append(thisShading)
                
        # add to the hive
        hb_hive = sc.sticky["honeybee_Hive"]()
        HBContext  = hb_hive.addToHoneybeeHive(shadingClasses, ghenv.Component.InstanceGuid.ToString())
        return HBContext
        ################################################################################################
    else:
        print "You should first let Honeybee to fly..."
        w = gh.GH_RuntimeMessageLevel.Warning
        ghenv.Component.AddRuntimeMessage(w, "You should first let Honeybee to fly...")
        return -1
        

if _shdSurfaces and _shdSurfaces[0]!=None:
    # add cleaning function
    result= main(_shdSurfaces, EPTransSchedule_, meshingSettings_, justBoundingBox_)
    
    if result != -1: HBContext = result
# ---------- end hb_epcontextsrf ----------
preview_2 = CustomPreview(Geometry=wires_2, Shader=ColourSwatch(SwatchColor=RGBA(0, 0, 0, 194)))

annualdaylightsimulation = Honeybee_AnnualDaylightSimulation(epwWeatherFile=epw_stat.epwFile, testPoints=genhbzonetestpts.testPoints, ptsVectors=genhbzonetestpts.ptsVectors)  # -> analysisRecipe; plug-in component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
rundaylightanalysis = Honeybee_RunDaylightSimulation(
    HBObjects=flatten(brep),
    analysisRecipe=annualdaylightsimulation,
    writeRad=toggle_5,
    runRad=toggle_5,
    overwriteResults=True)  # -> readMe, analysisType, resultsUnit, results, testPts, resultFiles, radGeoFile, studyFolder, done; plug-in component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
# Generate annual results
readannualresultsi = Honeybee_ReadAnnualResultI(
    illFilesAddress=rundaylightanalysis.resultFiles,
    testPoints=simplify(rundaylightanalysis.testPts),
    occupancyFiles=annualschedule.schedule,
    DLAIllumThresholds=300,
    runIt=Toggle(True))  # -> DLA, UDLI_Less_100, UDLI_100_2000, UDLI_More_2000, CDA, sDA, annualProfiles, htmReport; plug-in component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
setepzoneschedules = Honeybee_SetEnergyPlusZoneSchedules(
    HBZones=setepzoneloads.HBZones,
    occupancySchedules=annualschedule.schedule,
    lightingSchedules=readannualresultsi.annualProfiles)  # -> schedules, simplify(HBZones); plug-in component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
setepnatvent = Honeybee_SetEPAirFlow(
    HBZones=setepzoneschedules.HBZones,
    naturalVentilationType=Slider(1, range=0..10),
    minOutdoorTempForNatVent=Slider(16, range=10..20),
    maxOutdoorTempForNatVent=Slider(29, range=23..33))  # -> readMe, simplify(HBZones); plug-in component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
panel_17 = Panel(readannualresultsi.DLA)
recolormesh = Ladybug_RecolorMesh(
    analysisResult=readannualresultsi.UDLI_100_2000,
    heightDomain=dom,
    legendPar=legendpar,
    analysisTitle=rundaylightanalysis.analysisType,
    legendTitle=panel_12)  # -> readMe, newMesh, newLegend, legendBasePt, meshColors, legendColors; plug-in component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
recolormesh_2 = Ladybug_RecolorMesh(analysisResult=readannualresultsi.DLA, analysisTitle=rundaylightanalysis.analysisType)  # -> readMe, newMesh, newLegend, legendBasePt, meshColors, legendColors; plug-in component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
runenergysimulation = Honeybee_RunEnergySimulation(
    epwFile=path,
    HBZones=flatten(setepnatvent.HBZones),
    HBContext=flatten(hb_epcontextsrf),
    simulationOutputs=flatten(epoutput.simulationOutputs),
    writeIdf=run_energyplus,
    runEnergyPlus=run_energyplus,
    idfFileName=rep)  # -> report, idfFileAddress, resultFileAddress; plug-in component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
panel_18 = Panel(runenergysimulation.resultFileAddress)
readepresult = Honeybee_ReadEPResult(resultFileAddress=runenergysimulation.resultFileAddress)  # -> totalThermalLoad, thermalLoadBalance, cooling, heating, electricLight, electricEquip, fanElectric, pumpElectric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; plug-in component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
strnum = Ladybug_SeparateData(inputList=flatten(readepresult.airTemperature))  # -> numbers, strings; plug-in component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
lng = ListLength(List=strnum.numbers)
ma = MassAddition(Input=strnum.numbers)  # -> Result, PartialResults
division = Division(A=ma.Result, B=lng)
panel_19 = Panel(division)

readepresult_2 = Honeybee_ReadEPResult(resultFileAddress=panel_18, normByFloorArea=toggle_7)  # -> totalThermalEnergy, thermalEnergyBalance, cooling, heating, electricLight, electricEquip, fanElectric, pumpElectric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; plug-in component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
readepsrfresult = Honeybee_ReadEPSurfaceResult(resultFileAddress=panel_18, normBySrfArea=toggle_7)  # -> surfaceIndoorTemp, surfaceOutdoorTemp, surfaceEnergyFlow, opaqueEnergyFlow, glazEnergyFlow, windowTotalSolarEnergy, windowBeamEnergy, windowDiffEnergy, windowTransmissivity, otherSurfaceData; plug-in component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

adaptivecomfortcalculator = Ladybug_AdaptiveComfortCalculator(
    dryBulbTemperature=readepresult.airTemperature,
    meanRadiantTemperature=readepresult.meanRadTemperature,
    prevailingOutdoorTemp=importepw_2.dryBulbTemperature,
    runIt=Toggle(True))  # -> readMe, port, comfortableOrNot, conditionOfPerson, degreesFromTarget, port_2, targetTemperature, upperTemperatureBound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; plug-in component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

energybalance_2 = Honeybee_ConstructEnergyBalance(
    HBZones=flatten(setepnatvent.HBZones),
    cooling=readepresult_2.cooling,
    heating=readepresult_2.heating,
    electricLight=readepresult_2.electricLight,
    electricEquip=readepresult_2.electricEquip,
    peopleGains=readepresult_2.peopleGains,
    totalSolarGain=readepresult_2.totalSolarGain,
    infiltrationEnergy=readepresult_2.infiltrationEnergy,
    outdoorAirEnergy=readepresult_2.outdoorAirEnergy,
    natVentEnergy=readepresult_2.natVentEnergy,
    surfaceEnergyFlow=readepsrfresult.surfaceEnergyFlow)  # -> readMe, modelEnergyBalance, energyBalWithStorage; plug-in component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
gradientlibrary_3 = Ladybug_GradientLibrary(gradIndex="19")  # -> customColors; plug-in component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
selectandaveragedata_2 = Ladybug_AverageData(annualHourlyData=energybalance_2.energyBalWithStorage, totalOrAverage=Toggle(True))  # -> readMe, selHourlyData, totaledDaily, totaledMonthly, totMonthlyPerHour, totAnalysisPeriod; plug-in component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
legendpar_4 = Ladybug_LegendParameters(lowBound="-4000", highBound="4000", customColors=flatten(gradientlibrary_3))  # -> legendPar; plug-in component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
barchart = Ladybug_MonthlyBarChart(
    inputData=flatten(selectandaveragedata_2.totaledMonthly),
    stackValues=Toggle(True),
    altTitle="Patient Room Energy Balance",
    altYAxisTitle="Energy (kWh)",
    legendPar=legendpar_4)  # -> readMe, dataMesh, dataCurves, dataCrvColors, graphAxes, graphLabels, title, titleBasePt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; plug-in component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
preview_3 = CustomPreview(Geometry=barchart.graphAxes, Shader=ColourSwatch(SwatchColor=RGB(0, 0, 0)))

psychchart = Ladybug_PsychrometricChart(
    dryBulbTemperature=readepresult.airTemperature,
    relativeHumidity=readepresult.relativeHumidity,
    passiveStrategy=strategylist,
    basePoint=move.Geometry,
    runIt=Toggle(True))  # -> readMe, port, totalComfortPercent, totalComfortOrNot, strategyNames, strategyPercentOfTime, strategyOrNot, port_2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; plug-in component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
_3dchart_2 = Ladybug_3DChart(
    inputData=flatten(adaptivecomfortcalculator.conditionOfPerson),
    basePoint=pt_2,
    xScale=".025",
    yScale="0.125",
    zScale=Slider(0, range=0..100),
    legendPar=legendpar_2)  # -> readMe, graphMesh, graphCurves, legend, legendBasePts, title, titleBasePts, dataPts, conditionalHOY; plug-in component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
pt_4 = Point(<point referenced from the Rhino model>)
barchart_2 = Ladybug_MonthlyBarChart(
    inputData=flatten(selectandaveragedata.totaledMonthly),
    stackValues=Toggle(True),
    basePoint=move_2.Geometry,
    xScale=Slider(0.75, range=0..1),
    legendPar=legendpar_3)  # -> readMe, dataMesh, dataCurves, dataCrvColors, graphAxes, graphLabels, title, titleBasePt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; plug-in component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
legendpar_5 = Ladybug_LegendParameters(
    lowBound=Slider(-100, range=-2100..101),
    highBound=Slider(150, range=0..200),
    numSegments=Slider(26, range=0..100),
    legendLocation=pt_4,
    legendScale=Slider(0.7, range=0..1))  # -> legendPar; plug-in component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

# ---- group: Surface
readepsrfresult_2 = Honeybee_ReadEPSurfaceResult(resultFileAddress=runenergysimulation.resultFileAddress)  # -> surfaceIndoorTemp, surfaceOutdoorTemp, surfaceEnergyFlow, opaqueEnergyFlow, glazEnergyFlow, windowTotalSolarEnergy, windowBeamEnergy, windowDiffEnergy, windowTransmissivity, otherSurfaceData; plug-in component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
toggle_8 = BooleanToggle(False)
colorsurfaces = Honeybee_ColorSurfacesByEPResult(
    srfData=readepsrfresult_2.surfaceEnergyFlow,
    HBZones=flatten(setepnatvent.HBZones),
    legendPar=legendpar_5,
    runIt=toggle_8)  # -> readMe, srfColoredMesh, zoneWireFrame, legend, legendBasePt, analysisTitle, srfBreps, srfColors, srfValues, normalizedSrfData; plug-in component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

# ----
pt_5 = Point(Point(-17, 4, 0))
northarrow = Ladybug_North(scale=Slider(0.04, range=0..1))  # -> northSign; plug-in component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
colorsurfaces_2 = Honeybee_ColorSurfacesByEPResult(
    srfData=readepsrfresult_2.surfaceEnergyFlow,
    HBZones=flatten(setepnatvent.HBZones),
    analysisPeriod=analysisperiod_2.analysisPeriod,
    legendPar=legendpar_5,
    runIt=toggle_8)  # -> readMe, srfColoredMesh, zoneWireFrame, legend, legendBasePt, analysisTitle, srfBreps, srfColors, srfValues, normalizedSrfData; plug-in component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
tag = TextTag3D(Location=barchart_2.dataLabelPts, Text=barchart_2.dataMesh, Size=1, Justification=7)
colorsurfaces_3 = Honeybee_ColorSurfacesByEPResult(
    srfData=readepsrfresult_2.surfaceEnergyFlow,
    HBZones=flatten(setepnatvent.HBZones),
    analysisPeriod=analysisperiod.analysisPeriod,
    legendPar=legendpar_5,
    runIt=toggle_8)  # -> readMe, srfColoredMesh, zoneWireFrame, legend, legendBasePt, analysisTitle, srfBreps, srfColors, srfValues, normalizedSrfData; plug-in component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
pt_6 = Point(barchart_2.dataLabelPts)
pt_7 = Point(<point referenced from the Rhino model>)
panel_20 = Panel("""Comfortable (%): 
hot (%):         
cold (%):        """)
panel_21 = Panel("a>80")
area = Area(Geometry=colorsurfaces.srfBreps)  # -> Area, Centroid
legendpar_6 = Ladybug_LegendParameters(
    lowBound=Slider(0, range=0..100),
    highBound=Slider(100, range=0..100),
    numSegments=Slider(21, range=0..30),
    customColors=flatten([ColourSwatch(SwatchColor=RGB(0, 234, 255)), ColourSwatch(SwatchColor=RGB(1, 3, 255))]),
    legendScale=Slider(0.5, range=0..1))  # -> legendPar; plug-in component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
pt_8 = Point(<point referenced from the Rhino model>)
legendpar_7 = Ladybug_LegendParameters(
    lowBound=Slider(-25, range=-100..101),
    highBound=Slider(35, range=0..100),
    numSegments=Slider(13, range=0..100),
    customColors=flatten([ColourSwatch(SwatchColor=RGB(0, 0, 235)), ColourSwatch(SwatchColor=RGB(255, 0, 0))]),
    legendScale=Slider(0.8, range=0..1))  # -> legendPar; plug-in component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
area_2 = Area(Geometry=colorsurfaces_2.srfBreps)  # -> Area, Centroid
area_3 = Area(Geometry=colorsurfaces_3.srfBreps)  # -> Area, Centroid
multiplication = Multiplication(A=area.Area, B=colorsurfaces.srfValues)
pt_9 = Point(Point(7.707728078, 4.328009611, 0))
flip_2 = FlipMatrix(Data=panel_20)  # -> simplify(Data)
multiplication_2 = Multiplication(A=area_2.Area, B=colorsurfaces_2.srfValues)
multiplication_3 = Multiplication(A=area_3.Area, B=colorsurfaces_3.srfValues)
ma_2 = MassAddition(Input=multiplication)  # -> Result, PartialResults
_3dchart_3 = Ladybug_3DChart(
    inputData=flatten(readepresult.relativeHumidity),
    basePoint=pt_8,
    xScale=".025",
    yScale="0.125",
    zScale=Slider(0, range=0..100),
    legendPar=legendpar_6)  # -> readMe, graphMesh, graphCurves, legend, legendBasePts, title, titleBasePts, dataPts, conditionalHOY; plug-in component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
ma_3 = MassAddition(Input=multiplication_2)  # -> Result, PartialResults
_3dchart_4 = Ladybug_3DChart(
    inputData=flatten(readepresult.airTemperature),
    basePoint=pt_7,
    xScale=".025",
    yScale="0.125",
    zScale=Slider(0, range=0..100),
    legendPar=legendpar_7)  # -> readMe, graphMesh, graphCurves, legend, legendBasePts, title, titleBasePts, dataPts, conditionalHOY; plug-in component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
ma_4 = MassAddition(Input=multiplication_3)  # -> Result, PartialResults
comfortable_hot_cold = Panel([adaptivecomfortcalculator.percentOfTimeComfortable, adaptivecomfortcalculator.percentHotCold])
num = Number(comfortable_hot_cold)
expression = Expression(x=num, Expression="Round(x, 2)")
flip_3 = FlipMatrix(Data=expression)  # -> simplify(Data)
panel_22 = Panel([flip, flip_3])
join = TextJoin(Text=panel_22)
join_2 = TextJoin(Text=flatten(join))
tag_2 = TextTag3D(Location=pt_5, Text=join_2, Size=1, Colour=ColourSwatch(SwatchColor=RGB(0, 0, 0)), Justification=5)
num_2 = Number(comfortable_hot_cold)
expression_2 = Expression(x=num_2, Expression="Round(x, 2)")
flip_4 = FlipMatrix(Data=expression_2)  # -> simplify(Data)
panel_23 = Panel([flip_2, flip_4])
panel_24 = Panel(ma_2.Result)
tag_3 = TextTag3D(Location=pt_9, Text=panel_24, Size=1, Colour=ColourSwatch(SwatchColor=RGB(0, 0, 0)), Justification=5)
panel_25 = Panel(ma_3.Result)
panel_26 = Panel(ma_4.Result)
join_3 = TextJoin(Text=panel_23)
join_4 = TextJoin(Text=flatten(join_3))
join_5 = TextJoin(Text=flatten(join_3))
pt_10 = Point(Point(-0.626268136, 9.958606902, 0))
tag_4 = TextTag3D(Location=pt_10, Text=join_5, Size=1, Colour=ColourSwatch(SwatchColor=RGB(0, 0, 0)), Justification=5)
pt_11 = Point(Point(9.685294708, 3.041055575, 0))
join_6 = TextJoin(Text=flatten(join_3))
pt_12 = Point(Point(8.251579463, 1.527763774, 0))
join_7 = TextJoin(Text=flatten(join_3))
tag_5 = TextTag3D(Location=pt_11, Text=panel_25, Size=1, Colour=ColourSwatch(SwatchColor=RGB(0, 0, 0)), Justification=5)
tag_6 = TextTag3D(Location=pt_12, Text=panel_26, Size=1, Colour=ColourSwatch(SwatchColor=RGB(0, 0, 0)), Justification=5)
legendpar_8 = Ladybug_LegendParameters()  # -> legendPar; plug-in component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
