# Grasshopper definition Jiyuan_Liu.gh (Grasshopper 0.9.75)
# plug-ins: Python Interpreter

# https://www.energyplus.net/weather-download/north_and_central_america_wmo_region_4/USA/IL/USA_IL_Chicago-OHare.Intl.AP.725300_TMY3/all
panel = Panel("https://www.energyplus.net/weather-download/north_and_central_america_wmo_region_4/USA/PA/USA_PA_Philadelphia.Intl.AP.724080_TMY3/all")
downloadepw = Ladybug_downloadEPWWeatherFile(download=False)  # -> readMe; plug-in component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
ladybug = Ladybug_Ladybug(defaultFolder="E:\Ladybug+Honeybee")  # -> Vviiiiiiiiiizzz; plug-in component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
epw_stat = Ladybug_OpenEPWAndSTATWeatherFiles(weatherFileURL=panel)  # -> epwFile, statFile; plug-in component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
panel_2 = Panel(ladybug)
importepw = Ladybug_ImportEpw(epwFile=epw_stat.epwFile)  # -> readMe, latitude, location, dryBulbTemperature, dewPointTemperature, relativeHumidity, windSpeed, windDirection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; plug-in component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
legendpar = Ladybug_LegendParameters(lowBound=Slider(-1, range=-1..0), highBound=Slider(1, range=0..1), numSegments=Slider(3, range=0..10))  # -> legendPar; plug-in component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
number_slider = Slider(2, range=0..10)
number_slider_2 = Slider(2, range=0..10)
brep = Brep(<brep referenced from the Rhino model>)
sdivide = DivideSurface(Surface=brep, UCount=number_slider_2, VCount=number_slider_2)  # -> Points, Normals, Parameters
simplify = SimplifyTree(Tree=sdivide.Points, Front=False)
brep_2 = Brep(<brep referenced from the Rhino model>)
brep_3 = Brep(<brep referenced from the Rhino model>)
brep_4 = Brep([<brep referenced from the Rhino model> x2])
brep_5 = Brep(<brep referenced from the Rhino model>)
sdivide_2 = DivideSurface(Surface=brep_5, UCount=number_slider, VCount=number_slider)  # -> Points, Normals, Parameters
simplify_2 = SimplifyTree(Tree=sdivide_2.Points, Front=False)
branch = TreeBranch(Tree=simplify_2, Path=Slider(1, range=0..3), MaintainPaths=True)
analysisperiod = Ladybug_AnalysisPeriod()  # -> readMe, analysisPeriod; plug-in component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
brep_6 = Brep(<brep referenced from the Rhino model>)
item = ListItem(List=branch, Index=Slider(2, range=0..2), Wrap=True)
branch_2 = TreeBranch(Tree=simplify, Path=Slider(1, range=0..3), MaintainPaths=True)
area = Area(Geometry=brep_5)  # -> Area, Centroid
pt = Point(item)
item_2 = ListItem(List=branch_2, Index=Slider(2, range=0..2), Wrap=True)
analysisperiod_2 = Ladybug_AnalysisPeriod()  # -> readMe, analysisPeriod; plug-in component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
area_2 = Area(Geometry=brep)  # -> Area, Centroid
pt_2 = Point(item_2)
toggle = BooleanToggle(True)
toggle_2 = BooleanToggle(True)
panel_3 = Panel("curop")
brep_7 = Brep(<brep referenced from the Rhino model>)
brep_8 = Brep(<brep referenced from the Rhino model>)
brep_9 = Brep(brep_8)
toggle_3 = BooleanToggle(True)
outdoorcomfortcalculator = Ladybug_OutdoorComfortCalculator(
    dryBulbTemperature=importepw.dryBulbTemperature,
    windSpeed_tenMeters=importepw.windSpeed,
    relativeHumidity=importepw.relativeHumidity,
    runIt=Toggle(True))  # -> readMe, port, universalThermalClimateIndex, comfortableOrNot, thermalStress, conditionOfPerson, port_2, percentOfTimeComfortable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; plug-in component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
solaradjusttemperature = Ladybug_OutdoorSolarTemperatureAdjustor(
    location=importepw.location,
    cumSkyMtxOrDirNormRad=importepw.directNormalRadiation,
    diffuseHorizRad=importepw.diffuseHorizontalRadiation,
    baseTemperature=importepw.dryBulbTemperature,
    baseDryBulbOrMRT=toggle,
    horizInfraredRad=importepw.horizontalInfraredRadiation,
    analysisPeriodOrHOY=analysisperiod_2.analysisPeriod,
    parallel=toggle_2,
    runIt=toggle_2)  # -> readMe, port, effectiveRadiantField, MRTDelta, solarAdjustedMRT, port_2, mannequinMesh, port_3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; plug-in component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
solaradjusttemperature_2 = Ladybug_OutdoorSolarTemperatureAdjustor(
    location=importepw.location,
    cumSkyMtxOrDirNormRad=importepw.directNormalRadiation,
    diffuseHorizRad=importepw.diffuseHorizontalRadiation,
    baseTemperature=importepw.dryBulbTemperature,
    baseDryBulbOrMRT=toggle,
    horizInfraredRad=importepw.horizontalInfraredRadiation,
    bodyLocation=area_2.Centroid,
    contextShading=flatten([brep_2, brep_3, brep_9]),
    analysisPeriodOrHOY=analysisperiod.analysisPeriod,
    parallel=toggle_3,
    runIt=toggle_3)  # -> readMe, port, effectiveRadiantField, MRTDelta, solarAdjustedMRT, port_2, mannequinMesh, port_3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; plug-in component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
number_slider_3 = Slider(0, range=0..100)
outdoorcomfortcalculator_2 = Ladybug_OutdoorComfortCalculator(
    dryBulbTemperature=importepw.dryBulbTemperature,
    meanRadiantTemperature=solaradjusttemperature.solarAdjustedMRT,
    windSpeed_tenMeters=importepw.windSpeed,
    relativeHumidity=importepw.relativeHumidity,
    runIt=Toggle(True))  # -> readMe, port, universalThermalClimateIndex, comfortableOrNot, thermalStress, conditionOfPerson, port_2, percentOfTimeComfortable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; plug-in component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
number_slider_4 = Slider(0.3, range=0..1)
number_slider_5 = Slider(0.5, range=0..1)
outdoorcomfortcalculator_3 = Ladybug_OutdoorComfortCalculator(
    dryBulbTemperature=importepw.dryBulbTemperature,
    meanRadiantTemperature=solaradjusttemperature_2.solarAdjustedMRT,
    windSpeed_tenMeters=importepw.windSpeed,
    relativeHumidity=importepw.relativeHumidity,
    runIt=Toggle(True))  # -> readMe, port, universalThermalClimateIndex, comfortableOrNot, thermalStress, conditionOfPerson, port_2, percentOfTimeComfortable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; plug-in component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
brep_10 = Brep(<brep referenced from the Rhino model>)
toggle_4 = BooleanToggle(True)
brep_11 = Brep(<brep referenced from the Rhino model>)
comfortshadebenefit = Ladybug_ComfortShadeBenefitEvaluator(
    location=importepw.location,
    temperatures=outdoorcomfortcalculator_2.universalThermalClimateIndex,
    testShades=brep_11,
    testRegion=brep_4,
    gridSize=".5",
    context=[brep_3, brep_2],
    skyResolution=Slider(7, range=0..10),
    delNonIntersect=False,
    parallel=toggle_4,
    runIt=toggle_4)  # -> readMe, port, sunVectors, regionTestPts, shadeMesh, legend, legendBasePoint, port_2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; plug-in component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
_3dchart = Ladybug_3DChart(
    inputData=flatten([outdoorcomfortcalculator.thermalStress, outdoorcomfortcalculator_2.thermalStress, outdoorcomfortcalculator_3.thermalStress]),
    xScale=number_slider_4,
    zScale=number_slider_3,
    legendPar=legendpar)  # -> readMe, graphMesh, graphCurves, legend, legendBasePts, title, titleBasePts, dataPts, conditionalHOY; plug-in component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
panel_4 = Panel("Background UTCI")
preview = CustomPreview(
    Geometry=[comfortshadebenefit.shadeMesh, comfortshadebenefit.legend],
    Shader={ambient=RGB(0, 0, 0), diffuse=RGB(255, 105, 180), emission=RGB(76, 32, 54), shine=0.5, specular=RGB(255, 255, 255), transparency=0})
_3dchart_2 = Ladybug_3DChart(
    inputData=flatten(outdoorcomfortcalculator_3.thermalStress),
    xScale=number_slider_4,
    zScale=number_slider_3,
    legendPar=legendpar)  # -> readMe, graphMesh, graphCurves, legend, legendBasePts, title, titleBasePts, dataPts, conditionalHOY; plug-in component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
meshselector = Ladybug_MeshThresholdSelector(
    inputMesh=comfortshadebenefit.shadeMesh,
    analysisResult=comfortshadebenefit.shadeNetEffect,
    levelOfPerform=Slider(0, range=0..1))  # -> readMe, totalValue, areaMeetsThresh, newColoredMesh, newMeshOutline; plug-in component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
crv = Curve(meshselector.newMeshOutline)
preview_2 = CustomPreview(Geometry=meshselector.newMeshOutline, Shader=ColourSwatch(SwatchColor=RGB(0, 0, 0)))
boundary = BoundarySurfaces(Edges=crv)
