# Grasshopper definition XIAORAN LIU.gh (Grasshopper 0.9.76)
# plug-ins: Python Interpreter

ladybug = Ladybug_Ladybug()  # -> Vviiiiiiiiiizzz; plug-in component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
honeybee = Honeybee_Honeybee()  # -> Vviiiiiiiiiizzz; plug-in component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
toggle = BooleanToggle(True)
updateladybug = Ladybug_UpdateLadybug(updateThisFile=toggle)  # -> readMe; plug-in component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
updatehoneybee = Honeybee_UpdateHoneybee(updateThisFile=toggle)  # -> out; plug-in component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

# ----
# Generate sky
number_slider = Slider(2, range=0..2)
number_slider_2 = Slider(2, range=0..2)
# Animate sliders
button = Button()
months = Panel("""3
6
12""")
hours = Panel("""9
12
15""")
fly = Ladybug_fly(inputSliders=[number_slider_2, number_slider], fly=button)  # -> Vviiiiiiiiiizzz; plug-in component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
item = ListItem(List=hours, Index=number_slider, Wrap=True)
item_2 = ListItem(List=months, Index=number_slider_2, Wrap=True)
path = FilePath("F:\Upenn\16Fall\Arch753_Building Performance Simulation\EPW_Philadelphia\USA_PA_Philadelphia.Intl.AP.724080_TMY3.epw")
panel = Panel("""9
12
15""")
panel_2 = Panel("""3
6
12""")
genclimatebasedsky = Honeybee_GenerateClimateBasedSky(weatherFile=path, month=item_2, day="21", hour=item)  # -> radiationValues, skyFilePath; plug-in component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
importlocation = Ladybug_ImportLocation(epwFile=path)  # -> location; plug-in component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
doy_hoy = Ladybug_DOY_HOY(days="21", months=item_2, hours=item)  # -> HOY, DOY, date; plug-in component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
sunpath = Ladybug_SunPath(
    location=importlocation,
    hour=panel,
    day=21,
    month=panel_2,
    timeStep=1,
    sunPathScale=Slider(0.2, range=0..1),
    dailyOrAnnualSunPath=True)  # -> readMe, sunVectors, sunAltitudes, sunAzimuths, port, sunSpheresMesh, sunPathCrvs, legend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; plug-in component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

# ---- group: WWR
wwr_north = Slider(0.6, range=0.1..1.1)

# ----
shading_depth = Slider(0.6, range=0..1)
number_of_blinds = Slider(1, range=0..10)
add_blinds = BooleanToggle(True)

list = ValueList({"Exterior Roof [R9.2]": "ASHRAE 90.1-2004 EXTROOF METAL CLIMATEZONE 3-4", "Exterior Roof [R14.8]": "ASHRAE 90.1-2004 EXTROOF IEAD CLIMATEZONE 1-4", "Exterior Roof [R34.4]": "ASHRAE 189.1-2009 EXTROOF IEAD CLIMATEZONE 7-8"}, selected="Exterior Roof [R34.4]")
list_2 = ValueList({"Exterior Wall [R5.5]": "ASHRAE 90.1-2004 EXTWALL METAL CLIMATEZONE 4", "Exterior Wall [R5.8]": "ASHRAE 90.1-2004 EXTWALL MASS CLIMATEZONE 3-4", "Exterior Wall [R7.2]": "ASHRAE 90.1-2004 EXTWALL STEELFRAME CLIMATEZONE 1-4", "Exterior Wall [R8.7]": "ASHRAE 90.1-2004 EXTWALL MASS CLIMATEZONE ALT-RES 4", "Exterior Wall [R10.4]": "ASHRAE 90.1-2004 EXTWALL WOODFRAME CLIMATEZONE 1-7", "Exterior Wall [R14.8]": "ASHRAE 90.1-2004 EXTWALL STEELFRAME CLIMATEZONE ALT-RES 4-6", "Exterior Wall [R34.4]": "ASHRAE 189.1-2009 EXTROOF IEAD CLIMATEZONE 7-8"}, selected="Exterior Wall [R34.4]")
list_3 = ValueList({"Exterior Window [R1.0, SHGC 0.7]": "ASHRAE 90.1-2004 EXTWINDOW CLIMATEZONE ALT-WARE 1-8", "Exterior Window [R1.7, SHGC 0.39]": "ASHRAE 90.1-2004 EXTWINDOW CLIMATEZONE 4-6", "Exterior Window [R1.9, SHGC 0.39]": "ASHRAE 90.1-2004 EXTWINDOW CLIMATEZONE ALT-RES 4-6", "Exterior Window [R0.7, SHGC 0.65]": "Dbl LoE (e3=.1) Clr 3mm/13mm Arg"}, selected="Exterior Window [R0.7, SHGC 0.65]")

# ---- group: celing
wall = Brep(<brep referenced from the Rhino model>)

# ---- group: Wall
wall_2 = Brep([<brep referenced from the Rhino model> x4])

# ---- group: Floor
brep = Brep(<brep referenced from the Rhino model>)

# ---- group: Furniture
brep_2 = Brep([<brep referenced from the Rhino model> x3])

# ---- group: Window
brep_3 = Brep(<brep referenced from the Rhino model>)

# ----
# Glass material
panel_3 = Panel("tvis_60")
radopaquematerial = Honeybee_RadianceOpaqueMaterial(materialName="generic_35", RReflectance=".35", GReflectance=".35", BReflectance=".35", roughness=0.05, specularity=0)  # -> avrgRef, RADMaterial; plug-in component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
radglassmaterial = Honeybee_RadianceGlassMaterial(materialName=panel_3, RTransmittance="0.6", GTransmittance="0.6", BTransmittance="0.6", refractiveIndex=1.52)  # -> avrgTrans, RADMaterial; plug-in component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
createhbsrfs = Honeybee_createHBSrfs(geometry=brep_3, RADMaterial=radglassmaterial.RADMaterial)  # -> readMe, simplify(HBSurface); plug-in component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
createhbsrfs_2 = Honeybee_createHBSrfs(geometry=brep_2)  # -> readMe, simplify(HBSurface); plug-in component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
createhbsrfs_3 = Honeybee_createHBSrfs(geometry=wall_2)  # -> readMe, simplify(flatten(HBSurface)); plug-in component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
createhbsrfs_4 = Honeybee_createHBSrfs(geometry=wall, srfType=Slider(1, range=0..1))  # -> readMe, simplify(flatten(HBSurface)); plug-in component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
createhbsrfs_5 = Honeybee_createHBSrfs(geometry=brep, srfType=Slider(2, range=0..10))  # -> readMe, simplify(HBSurface); plug-in component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
preview = CustomPreview(Geometry=createhbsrfs_5.HBSurface, Shader=ColourSwatch(SwatchColor=RGBA(129, 150, 235, 74)))
preview_2 = CustomPreview(Geometry=createhbsrfs_3.HBSurface, Shader=ColourSwatch(SwatchColor=RGBA(153, 70, 70, 208)))
brep_4 = Brep(flatten([createhbsrfs_2.HBSurface, createhbsrfs_4.HBSurface, createhbsrfs_3.HBSurface, createhbsrfs.HBSurface]))
panel_4 = Panel(brep_4)
wires = BrepWireframe(Brep=brep_4, Density=-1)

# ----
# outdoor comfort simulation
panel_5 = Panel("https://www.energyplus.net/weather-download/north_and_central_america_wmo_region_4/USA/PA/USA_PA_Philadelphia.Intl.AP.724080_TMY3/all")
epw_stat = Ladybug_OpenEPWAndSTATWeatherFiles(weatherFileURL=panel_5)  # -> epwFile, statFile; plug-in component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
importlocation_2 = Ladybug_ImportLocation(epwFile=epw_stat.epwFile)  # -> location; plug-in component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
importepw = Ladybug_ImportEpw(epwFile=epw_stat.epwFile)  # -> readMe, latitude, location, dryBulbTemperature, dewPointTemperature, relativeHumidity, windSpeed, windDirection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; plug-in component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
panel_6 = Panel(importlocation_2)
outdoorcomfortcalculator = Ladybug_OutdoorComfortCalculator(
    dryBulbTemperature=importepw.dryBulbTemperature,
    windSpeed_tenMeters=importepw.windSpeed,
    relativeHumidity=importepw.relativeHumidity,
    runIt=Toggle(True))  # -> readMe, port, universalThermalClimateIndex, comfortableOrNot, thermalStress, conditionOfPerson, port_2, percentOfTimeComfortable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; plug-in component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
panel_7 = Panel(outdoorcomfortcalculator.percentOfTimeComfortable)
panel_8 = Panel(outdoorcomfortcalculator.percentHeatStress)
panel_9 = Panel(outdoorcomfortcalculator.percentColdStress)
pt = Point(<point referenced from the Rhino model>)
psychchart = Ladybug_PsychrometricChart()  # -> readMe, port, totalComfortPercent, totalComfortOrNot, strategyNames, strategyPercentOfTime, strategyOrNot, port_2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; plug-in component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
_3dchart = Ladybug_3DChart(
    inputData=flatten(outdoorcomfortcalculator.conditionOfPerson),
    basePoint=pt,
    xScale=Slider(0.02, range=0..1),
    yScale=Slider(0.06, range=0..0.1),
    zScale=Slider(0, range=0..1))  # -> readMe, graphMesh, graphCurves, legend, legendBasePts, title, titleBasePts, dataPts, conditionalHOY; plug-in component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

# ----
# comprehensive climate analysis
panel_10 = Panel("https://www.energyplus.net/weather-download/north_and_central_america_wmo_region_4/USA/PA/USA_PA_Philadelphia.Intl.AP.724080_TMY3/all")  # disabled
epw_stat_2 = Ladybug_OpenEPWAndSTATWeatherFiles(weatherFileURL=panel_10)  # -> epwFile, statFile; disabled; plug-in component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
importlocation_3 = Ladybug_ImportLocation(epwFile=epw_stat_2.epwFile)  # -> location; disabled; plug-in component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
importepw_2 = Ladybug_ImportEpw(epwFile=epw_stat_2.epwFile)  # -> readMe, latitude, location, dryBulbTemperature, dewPointTemperature, relativeHumidity, windSpeed, windDirection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; disabled; plug-in component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
panel_11 = Panel(importlocation_3)  # disabled
panel_12 = Panel(importepw_2.dryBulbTemperature)  # disabled
panel_13 = Panel(importepw_2.dewPointTemperature)  # disabled
panel_14 = Panel(importepw_2.relativeHumidity)  # disabled
panel_15 = Panel(importepw_2.windSpeed)  # disabled
strnum = Ladybug_SeparateData(inputList=flatten(panel_13))  # -> numbers, strings; disabled; plug-in component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
strnum_2 = Ladybug_SeparateData(inputList=flatten(panel_12))  # -> numbers, strings; disabled; plug-in component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
strnum_3 = Ladybug_SeparateData(inputList=flatten(panel_14))  # -> numbers, strings; disabled; plug-in component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
strnum_4 = Ladybug_SeparateData(inputList=flatten(panel_15))  # -> numbers, strings; disabled; plug-in component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
cdd_hdd = Ladybug_CDD_HDD(hourlyDryBulbTemperature=importepw_2.dryBulbTemperature)  # -> readMe, daily_coolingDegDays, daily_heatingDegDays, monthly_coolingDegDays, monthly_heatingDegDays, annual_coolingDegDays, annual_heatingDegDays; disabled; plug-in component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
number_slider_3 = Slider(0.02, range=0..1)  # disabled
number_slider_4 = Slider(0.06, range=0..1)  # disabled
number_slider_5 = Slider(0, range=0..1)  # disabled
number_slider_6 = Slider(1, range=0..100)  # disabled
number_slider_7 = Slider(0.02, range=0..1)  # disabled
number_slider_8 = Slider(0.06, range=0..1)  # disabled
number_slider_9 = Slider(0, range=0..1)  # disabled
number_slider_10 = Slider(0.02, range=0..1)  # disabled
number_slider_11 = Slider(0.06, range=0..1)  # disabled
number_slider_12 = Slider(0, range=0..1)  # disabled
gradientlibrary = Ladybug_GradientLibrary(gradIndex=number_slider_6)  # -> customColors; disabled; plug-in component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
pt_2 = Point(<point referenced from the Rhino model>)  # disabled
number_slider_13 = Slider(12, range=0..100)  # disabled
pt_3 = Point(<point referenced from the Rhino model>)  # disabled
legendpar = Ladybug_LegendParameters(customColors=flatten(gradientlibrary))  # -> legendPar; disabled; plug-in component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
_3dchart_2 = Ladybug_3DChart(
    inputData=flatten(strnum_2.numbers),
    basePoint=pt_2,
    xScale=number_slider_3,
    yScale=number_slider_4,
    zScale=number_slider_5,
    legendPar=legendpar)  # -> readMe, graphMesh, graphCurves, legend, legendBasePts, title, titleBasePts, dataPts, conditionalHOY; disabled; plug-in component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
number_slider_14 = Slider(19, range=0..100)  # disabled
pt_4 = Point(<point referenced from the Rhino model>)  # disabled
gradientlibrary_2 = Ladybug_GradientLibrary(gradIndex=number_slider_13)  # -> customColors; disabled; plug-in component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
gradientlibrary_3 = Ladybug_GradientLibrary(gradIndex=number_slider_14)  # -> customColors; disabled; plug-in component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
legendpar_2 = Ladybug_LegendParameters(customColors=flatten(gradientlibrary_2))  # -> legendPar; disabled; plug-in component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
_3dchart_3 = Ladybug_3DChart(
    inputData=flatten(strnum_3.numbers),
    basePoint=pt_3,
    xScale=number_slider_7,
    yScale=number_slider_8,
    zScale=number_slider_9,
    legendPar=legendpar_2)  # -> readMe, graphMesh, graphCurves, legend, legendBasePts, title, titleBasePts, dataPts, conditionalHOY; disabled; plug-in component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
legendpar_3 = Ladybug_LegendParameters(customColors=flatten(gradientlibrary_3))  # -> legendPar; disabled; plug-in component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
_3dchart_4 = Ladybug_3DChart(
    inputData=flatten(strnum_4.numbers),
    basePoint=pt_4,
    xScale=number_slider_10,
    yScale=number_slider_11,
    zScale=number_slider_12,
    legendPar=legendpar_3)  # -> readMe, graphMesh, graphCurves, legend, legendBasePts, title, titleBasePts, dataPts, conditionalHOY; disabled; plug-in component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
number_slider_15 = Slider(0.02, range=0..1)  # disabled
number_slider_16 = Slider(0.06, range=0..1)  # disabled
number_slider_17 = Slider(0, range=0..1)  # disabled
number_slider_18 = Slider(9, range=0..100)  # disabled
pt_5 = Point(<point referenced from the Rhino model>)  # disabled
gradientlibrary_4 = Ladybug_GradientLibrary(gradIndex=number_slider_18)  # -> customColors; disabled; plug-in component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
legendpar_4 = Ladybug_LegendParameters(customColors=flatten(gradientlibrary_4))  # -> legendPar; disabled; plug-in component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
_3dchart_5 = Ladybug_3DChart(
    inputData=flatten(strnum.numbers),
    basePoint=pt_5,
    xScale=number_slider_15,
    yScale=number_slider_16,
    zScale=number_slider_17,
    legendPar=legendpar_4)  # -> readMe, graphMesh, graphCurves, legend, legendBasePts, title, titleBasePts, dataPts, conditionalHOY; disabled; plug-in component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

callfromepconstrlibrary = Honeybee_CallFromEPConstructionLibrary(keywords="floor")  # -> ThermMaterials, EPMaterials, EPWindowMaterials, EPConstructions; plug-in component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
item_3 = ListItem(List=callfromepconstrlibrary.EPConstructions, Index=Slider(0, range=0..100), Wrap=True)
decomposeepconstruction = Honeybee_DecomposeEPConstruction(cnstrName=item_3)  # -> flatten(materials), comments, UValue_SI, UValue_IP, RValue_SI, RValue_IP; plug-in component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

callfromepconstrlibrary_2 = Honeybee_CallFromEPConstructionLibrary(keywords="slab")  # -> ThermMaterials, EPMaterials, EPWindowMaterials, EPConstructions; plug-in component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
item_4 = ListItem(List=callfromepconstrlibrary_2.EPConstructions, Index="2", Wrap=True)
decomposeepconstruction_2 = Honeybee_DecomposeEPConstruction(cnstrName=item_4)  # -> flatten(materials), comments, UValue_SI, UValue_IP, RValue_SI, RValue_IP; plug-in component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

# ----
# Run the analysis
# Generate annual results
# Put the recipie together!
number_slider_19 = Slider(0.3, range=-1..5)  # disabled
number_slider_20 = Slider(0.3, range=0..1)  # disabled
gentestpts = Honeybee_GenerateTestPoints(testGeometry=createhbsrfs_5.HBSurface, gridSize=number_slider_20, distBaseSrf=number_slider_19, moveTestMesh=True)  # -> readMe, simplify(testPoints), simplify(ptsVectors), simplify(facesArea), simplify(mesh); disabled; plug-in component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
gridbasedsimulation = Honeybee_GridBasedSimulation(
    skyFile=genclimatebasedsky.skyFilePath,
    testPoints=gentestpts.testPoints,
    ptsVectors=gentestpts.ptsVectors,
    testMesh=gentestpts.mesh,
    simulationType=0)  # -> analysisRecipe; disabled; plug-in component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
toggle_2 = BooleanToggle(False)  # disabled
rundaylightanalysis = Honeybee_RunDaylightSimulation(HBObjects=flatten(brep_4), analysisRecipe=gridbasedsimulation, writeRad=toggle_2, runRad=toggle_2, overwriteResults=True)  # -> readMe, analysisType, resultsUnit, results, testPts, resultFiles, radGeoFile, studyFolder, done; disabled; plug-in component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
panel_16 = Panel(rundaylightanalysis.results)  # disabled
number_slider_21 = Slider(2000, range=0..6000)  # disabled
number_slider_22 = Slider(300, range=0..1000)  # disabled
panel_17 = Panel("")  # disabled
panel_18 = Panel(doy_hoy.date)  # disabled
legendpar_5 = Ladybug_LegendParameters(lowBound=number_slider_22, highBound=number_slider_21)  # -> legendPar; disabled; plug-in component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
concat = Concatenate(FragmentA=rundaylightanalysis.analysisType, FragmentB=panel_17, FragmentC=panel_18)  # disabled
recolormesh = Ladybug_RecolorMesh(
    analysisResult=rundaylightanalysis.results,
    inputMesh=gentestpts.mesh,
    legendPar=legendpar_5,
    analysisTitle=concat,
    legendTitle=rundaylightanalysis.resultsUnit)  # -> readMe, newMesh, newLegend, legendBasePt, meshColors, legendColors; disabled; plug-in component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

panel_19 = Panel("""MAT-CC05 4 HW CONCRETE
MAT-CC05 8 HW CONCRETE""")
panel_20 = Panel(decomposeepconstruction.materials)
item_5 = ListItem(List=decomposeepconstruction.materials, Index=0, Wrap=True)  # -> Item, Item1
item_6 = ListItem(List=panel_19, Index=0, Wrap=True)  # -> Item, Item1
panel_21 = Panel(item_3)
epconstruction = Honeybee_EnergyPlusConstruction(name="floor_cnstr_2", layer_1=item_5.Item, layer_2=item_5.Item1, layer_3=item_6.Item1)  # -> EPConstruction; plug-in component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
epconstruction_2 = Honeybee_EnergyPlusConstruction(name="floor_cnstr_1", layer_1=item_5.Item, layer_2=item_5.Item1, layer_3=item_6.Item)  # -> EPConstruction; plug-in component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

# ----
# capture the viewport to an image
panel_22 = Panel("_")
join = TextJoin(Text=[item_2, "21", item], Join=panel_22)
panel_23 = Panel(join)
captureview = Ladybug_CaptureView(fileName=panel_23, capture=Toggle(True))  # -> imagePath; plug-in component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
panel_24 = Panel(captureview)

panel_25 = Panel("""Construction,
    Dbl LoE (e3=.1) Clr 3mm/13mm Arg,  !- Name
    CLEAR 3MM,               !- Outside Layer
    ARGON 13MM,              !- Layer 2
    LoE CLEAR 3MM Rev;       !- Layer 3""")
panel_26 = Panel("""WindowMaterial:Gas,
    ARGON 13MM,               !- Name
    Argon,                   !- Gas Type
    0.0127;                  !- Thickness {m}""")
panel_27 = Panel("""WindowMaterial:Glazing,
    LoE CLEAR 3MM Rev,       !- Name
    SpectralAverage,         !- Optical Data Type
    ,                        !- Window Glass Spectral Data Set Name
    0.003,                   !- Thickness {m}
    0.630,                   !- Solar Transmittance at Normal Incidence
    0.220,                   !- Front Side Solar Reflectance at Normal Incidence
    0.190,                   !- Back Side Solar Reflectance at Normal Incidence
    0.850,                   !- Visible Transmittance at Normal Incidence
    0.079,                   !- Front Side Visible Reflectance at Normal Incidence
    0.056,                   !- Back Side Visible Reflectance at Normal Incidence
    0.0,                     !- Infrared Transmittance at Normal Incidence
    0.10,                    !- Front Side Infrared Hemispherical Emissivity
    0.84,                    !- Back Side Infrared Hemispherical Emissivity
    0.9;                     !- Conductivity {W/m-K}""")
toggle_3 = BooleanToggle(True)
addtoeplibrary = Honeybee_AddToEnergyPlusLibrary(EPObject=[panel_25, panel_26, panel_27], addToProjectLib=toggle_3, overwrite=toggle_3)  # -> readMe; plug-in component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

panel_29 = Panel("C:\Users\Administrator\Documents\GitHub\hydra_1")  # disabled
panel_30 = Panel("Honeybee Annual Daylight Simulation Example")  # disabled
panel_31 = Panel("This file shows the minimum steps to set up a daylight model for a room in Honeybee. This example uses mass2zones component to prepare the geometries however you can create the geometries surface by surface using createHBSurface.")  # disabled
panel_32 = Panel("""Grasshopper
Daylighting
Annual
Radiance
Daysim
Honeybee
HBExampleFiles""")  # disabled
toggle_4 = BooleanToggle(False)  # disabled
exporthydra = Hydra_ExportFile(fileName=panel_30, fileDescription=panel_31, fileTags=panel_32, targetFolder=panel_29, export=toggle_4)  # -> readMe; inputs fileDescription: list, changeLog: list, fileTags: list, includeRhino: Boolean, GHForThumb: Boolean, additionalImgs: list, export: Boolean; disabled; plug-in component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

panel_33 = Panel("年平均小时温度12.75摄氏度")
panel_34 = Panel("年平均小时湿度65.9摄氏度")
panel_35 = Panel("https://www.energyplus.net/weather-download/north_and_central_america_wmo_region_4/USA/PA/USA_PA_Philadelphia.Intl.AP.724080_TMY3/all")
panel_36 = Panel("https://www.energyplus.net/weather-download/north_and_central_america_wmo_region_4/USA/PA/USA_PA_Philadelphia.Intl.AP.724080_TMY3/all")
epw_stat_3 = Ladybug_OpenEPWAndSTATWeatherFiles(weatherFileURL=panel_35)  # -> epwFile, statFile; plug-in component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
epw_stat_4 = Ladybug_OpenEPWAndSTATWeatherFiles(weatherFileURL=panel_36)  # -> epwFile, statFile; plug-in component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
importepw_3 = Ladybug_ImportEpw(epwFile=epw_stat_3.epwFile)  # -> readMe, latitude, location, dryBulbTemperature, dewPointTemperature, relativeHumidity, windSpeed, windDirection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; plug-in component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
importepw_4 = Ladybug_ImportEpw(epwFile=epw_stat_4.epwFile)  # -> readMe, latitude, location, dryBulbTemperature, dewPointTemperature, relativeHumidity, windSpeed, windDirection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; plug-in component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
panel_37 = Panel(importepw_3.location)
strnum_5 = Ladybug_SeparateData(inputList=flatten(importepw_3.dryBulbTemperature))  # -> numbers, strings; plug-in component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
panel_38 = Panel(importepw_4.location)
strnum_6 = Ladybug_SeparateData(inputList=flatten(importepw_4.relativeHumidity))  # -> numbers, strings; plug-in component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
panel_39 = Panel(strnum_5.numbers)
panel_40 = Panel(strnum_6.numbers)
ma = MassAddition(Input=panel_39)  # -> Result, PartialResults
ma_2 = MassAddition(Input=panel_40)  # -> Result, PartialResults
panel_41 = Panel(ma.Result)
panel_42 = Panel(ma_2.Result)
division = Division(A=panel_41, B="8760")
division_2 = Division(A=panel_42, B="8760")
panel_43 = Panel(division)
panel_44 = Panel(division_2)

# ----
# Geometry
# Wall to Window Ratio
# Construction
# infiltration rate
# Rotation Angle
# Blinds
# Construction
# Blinds
# Thermal Mass
ladybug_2 = Ladybug_Ladybug()  # -> Vviiiiiiiiiizzz; plug-in component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
honeybee_2 = Honeybee_Honeybee()  # -> Vviiiiiiiiiizzz; plug-in component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
run_energyplus = BooleanToggle(True)
# energy_simulation_integrated_daylighting
# Wall to Window Ratio
# Rotation Angle
# Blinds
# Construction
# Thermal Mass
list_4 = ValueList({"Existing Slab Construction": "0", "+4 Inches Concrete": "1", "+8 Inches Concrete": "2"}, selected="Existing Slab Construction")
brep_5 = Brep(<brep referenced from the Rhino model>)
mass2zone = Honeybee_Masses2Zones(zoneMasses=flatten(brep_5), isConditioned=Toggle(False), maxRoofAngle=30, createHBZones=Toggle(True))  # -> readMe, HBZones; plug-in component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
glzparamlist = Honeybee_GlazingParametersList(northGlzParam=wwr_north, westGlzParam=0, southGlzParam=0, eastGlzParam=0)  # -> glzParamList; plug-in component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
glazingcreator = Honeybee_GlazingBasedOnRatio(HBObjects=mass2zone.HBZones, glzRatio=glzparamlist, breakUpDist=Toggle(True), runIt=Toggle(True))  # -> readMe, HBObjWGLZ; plug-in component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
volume = Volume(Geometry=glazingcreator.HBObjWGLZ)  # -> Volume, Centroid
rotatehbobj = Honeybee_RotateHoneybee(HBObj=glazingcreator.HBObjWGLZ, angle=Slider(0, range=-90..190), cenPt=volume.Centroid)  # -> HBObj; plug-in component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
wires_2 = BrepWireframe(Brep=rotatehbobj, Density=-1)
filter = StreamFilter(Gate=list_4, Stream0=panel_21, Stream1=epconstruction_2, Stream2=epconstruction)
setepzonecnstr = Honeybee_SetEPZoneConstruction(HBZone=rotatehbobj, wallEPConstruction=list_2, windowEPConstruction=list_3, roofEPConstruction=list)  # -> simplify(modifiedHBZone); plug-in component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
setepzoneundergroundcnstr = Honeybee_SetEPZoneUndergroundConstruction(HBZone=flatten(setepzonecnstr), groundFloorEPConstruction=filter)  # -> simplify(modifiedHBZone); plug-in component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
toggle_5 = BooleanToggle(True)
panel_45 = Panel("https://www.energyplus.net/weather-download/north_and_central_america_wmo_region_4/USA/PA/USA_PA_Philadelphia.Intl.AP.724080_TMY3/all")
epoutput = Honeybee_GenerateEPOutput(zoneGainsAndLosses=toggle_5, zoneComfortMetrics=toggle_5, surfaceTempAnalysis="False")  # -> report, flatten(simulationOutputs); plug-in component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
epw_stat_5 = Ladybug_OpenEPWAndSTATWeatherFiles(weatherFileURL=panel_45)  # -> epwFile, statFile; plug-in component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
rep = ReplaceText(Text="base_case", Find=" ", Replace="_", RecursiveReplace=False)
path_2 = FilePath(epw_stat_5.epwFile)
importepw_5 = Ladybug_ImportEpw(epwFile=path_2)  # -> readMe, latitude, location, dryBulbTemperature, dewPointTemperature, relativeHumidity, windSpeed, windDirection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; plug-in component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
legendpar_6 = Ladybug_LegendParameters(lowBound="-1", highBound="1", numSegments="3")  # -> legendPar; plug-in component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
vec = VectorXYZ(XComponent="20", YComponent="35", ZComponent=0)  # -> Vector, Length
pt_6 = Point(Point(134, 58, 0))
move = Move(Geometry=pt_6, Motion=vec.Vector)  # -> Geometry, Transform
panel_46 = Panel("""Comfortable (%): 
hot (%):         
cold (%):        """)
flip = FlipMatrix(Data=panel_46)  # -> simplify(Data)
pt_7 = Point(Point(-17, 4, 0))

decomposebytype = Honeybee_DecomposeBasedOnType(HBZone=setepzoneundergroundcnstr)  # -> walls, interiorWalls, airWalls, windows, interiorWindows, skylights, roofs, ceilings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; plug-in component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
shddesigner = Ladybug_ShadingDesigner(
    glzSrf=flatten(decomposebytype.windows),
    depthOrVector=flatten(shading_depth),
    numOfShds=number_of_blinds,
    runIt=add_blinds,
    port_4=False)  # -> readMe, shadingSrfs; plug-in component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
wires_3 = BrepWireframe(Brep=shddesigner.shadingSrfs, Density=-1)
hb_epcontextsrf = HoneybeeEPContextSurfaces(shdSurfaces=flatten(shddesigner.shadingSrfs))  # -> HBContext; inputs shdSurfaces: list of Brep, justBoundingBox: Boolean
# ---------- hb_epcontextsrf: Python ----------
"""
prepare shading/context geometries

    Args:
        northVectorOrRotation: A vector that shows North or a number that shows
                               the rotation of the North from the Y axis
        bldgMasses: List of closed Breps as thermal zones.
    Returns:
        report: ...
        thermalZones: Thermal zone's geometries for visualiza
"""

ghenv.Component.Name = 'Honeybee EP context Surfaces'
ghenv.Component.NickName = 'HB_EPContextSrf'
ghenv.Component.Message = 'VER 0.0.59\nJAN_26_2016'
ghenv.Component.IconDisplayMode = ghenv.Component.IconDisplayMode.application
ghenv.Component.Category = "Honeybee"
ghenv.Component.SubCategory = "09 | Energy | Energy"
#compatibleHBVersion = VER 0.0.57\nNOV_01_2015
#compatibleLBVersion = VER 0.0.59\nFEB_01_2015
ghenv.Component.AdditionalHelpFromDocStrings = "2"

import rhinoscriptsyntax as rs
import Rhino as rc
import scriptcontext as sc
import os
import System
import Grasshopper.Kernel as gh
import uuid

tolerance = sc.doc.ModelAbsoluteTolerance
import math


def main(shdSurfaces, EPTransSchedule, meshingSettings, justBoundingBox):
    
    # import the classes
    if sc.sticky.has_key('honeybee_release'):

        try:
            if not sc.sticky['honeybee_release'].isCompatible(ghenv.Component): return -1
            if sc.sticky['honeybee_release'].isInputMissing(ghenv.Component): return -1
        except:
            warning = "You need a newer version of Honeybee to use this compoent." + \
            " Use updateHoneybee component to update userObjects.\n" + \
            "If you have already updated userObjects drag Honeybee_Honeybee component " + \
            "into canvas and try again."
            w = gh.GH_RuntimeMessageLevel.Warning
            ghenv.Component.AddRuntimeMessage(w, warning)
            return -1
        
        # don't customize this part
        hb_EPSrf = sc.sticky["honeybee_EPSurface"]
        hb_EPSHDSurface = sc.sticky["honeybee_EPShdSurface"]
        hb_RADMaterialAUX = sc.sticky["honeybee_RADMaterialAUX"]
        hb_EPObjectsAux = sc.sticky["honeybee_EPObjectsAUX"]()
        HBScheduleList = sc.sticky["honeybee_ScheduleLib"].keys()

        ########################################################################
        #----------------------------------------------------------------------#
        shdBreps = []
        # create bounding box of shading geometries
        if justBoundingBox:
            for brep in shdSurfaces:
                if brep.Faces.Count>1 or not brep.Faces[0].IsPlanar(sc.doc.ModelAbsoluteTolerance):
                    shdBreps.append(brep.GetBoundingBox(True).ToBrep())
                else:
                    shdBreps.append(brep)
        else:
            shdBreps = shdSurfaces
        
        shadingClasses = []
        shadingMeshPreview = []
        
        if meshingSettings == None:
            mp = rc.Geometry.MeshingParameters.Minimal
            mp.SimplePlanes = True
        else:
            mp = meshingSettings
        
        def getRadMaterialName(radMaterial):
            nameStr = radMaterial.split(" ")[2]
            name =  nameStr.split("\n")[0]
            return name
        
        for brepCount, brep in enumerate(shdBreps):
            if brep != None:
                isPlanar = True
                # check planarity
                for face in brep.Faces:
                    if not face.IsPlanar(tolerance):
                        isPlanar = False
                        break
                
                shadingBreps = []
                if not isPlanar:
                    meshArray = rc.Geometry.Mesh.CreateFromBrep(brep, mp)
                    for mesh in meshArray:
                        for meshFace in range(mesh.Faces.Count):
                            vertices = list(mesh.Faces.GetFaceVertices(meshFace))[1:]
                            vertices = vertices + [sc.doc.ModelAbsoluteTolerance]
                            # create the brep from mesh
                            shdBrep = rc.Geometry.Brep.CreateFromCornerPoints(*vertices)
                            shadingBreps.append(shdBrep)
                else:
                    for face in brep.Faces:
                        shadingBreps.append(face.DuplicateFace(False))
                
                for faceCount, shdBrep in enumerate(shadingBreps):
                        thisShading = hb_EPSHDSurface(shdBrep, 1000*brepCount + faceCount, 'shdSrf_' + `brepCount` + '_' + `faceCount` + "_" + str(uuid.uuid4()))
                        
                        # add transmittance schedule if any
                        if EPTransSchedule!=None:
                            schedule= EPTransSchedule.upper()
                            if schedule!=None and not schedule.lower().endswith(".csv") and schedule not in HBScheduleList:
                                msg = "Cannot find " + schedule + " in Honeybee schedule library."
                                print msg
                                ghenv.Component.AddRuntimeMessage(gh.GH_RuntimeMessageLevel.Warning, msg)
                                return -1
                            elif schedule!=None and schedule.lower().endswith(".csv"):
                                # check if csv file is existed
                                if not os.path.isfile(schedule):
                                    msg = "Cannot find the shchedule file: " + schedule
                                    print msg
                                    ghenv.Component.AddRuntimeMessage(gh.GH_RuntimeMessageLevel.Warning, msg)
                                    return -1
                            
                            thisShading.TransmittanceSCH = schedule
                        
                        # add the Rad Material if any
                        if RADMaterial!=None:
                            # if it is just the name of the material make sure it is already defined
                            if len(RADMaterial.split(" ")) == 1:
                                # if the material is not in the library add it to the library
                                if not hb_RADMaterialAUX.isMatrialExistInLibrary(RADMaterial):
                                    warningMsg = "Can't find " + RADMaterial + " in RAD Material Library.\n" + \
                                                "Add the material to the library and try again."
                                    ghenv.Component.AddRuntimeMessage(gh.GH_RuntimeMessageLevel.Warning, warningMsg)
                                    return
                                
                                try:
                                    thisShading.setRADMaterial(RADMaterial)
                                except Exception, e:
                                    print e
                                    warningMsg = "You are using an old version of Honeybee_Honeybee! Update your files and try again."
                                    print warningMsg
                                    ghenv.Component.AddRuntimeMessage(gh.GH_RuntimeMessageLevel.Warning, warningMsg)
                                    return
                                
                                addedToLib = True
                            else:
                                
                                # try to add the material to the library
                                addedToLib, thisShading.RadMaterial = hb_RADMaterialAUX.analyseRadMaterials(RADMaterial, True)
                                
                            if addedToLib==False:
                                warningMsg = "Failed to add " + RADMaterial + " to the Library."
                                ghenv.Component.AddRuntimeMessage(gh.GH_RuntimeMessageLevel.Warning, warningMsg)
                                return
                        
                        # add shading to the list
                        shadingClasses.append(thisShading)
                
        # add to the hive
        hb_hive = sc.sticky["honeybee_Hive"]()
        HBContext  = hb_hive.addToHoneybeeHive(shadingClasses, ghenv.Component.InstanceGuid.ToString())
        return HBContext
        ################################################################################################
    else:
        print "You should first let Honeybee to fly..."
        w = gh.GH_RuntimeMessageLevel.Warning
        ghenv.Component.AddRuntimeMessage(w, "You should first let Honeybee to fly...")
        return -1
        

if _shdSurfaces and _shdSurfaces[0]!=None:
    # add cleaning function
    result= main(_shdSurfaces, EPTransSchedule_, meshingSettings_, justBoundingBox_)
    
    if result != -1: HBContext = result
# ---------- end hb_epcontextsrf ----------
preview_3 = CustomPreview(Geometry=wires_3, Shader=ColourSwatch(SwatchColor=RGBA(0, 0, 0, 194)))

ach2m3_s_m2_calculator = HoneybeeInfORventPerAreaCalculator(HBZones=flatten(setepzoneundergroundcnstr), airChangeHour=Slider(2, range=0..10))  # -> out, infORventPerArea, allFloors; plug-in component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
setepzoneloads = Honeybee_SetEnergyPlusZoneLoads(HBZones=flatten(setepzoneundergroundcnstr), infiltrationRatePerArea=ach2m3_s_m2_calculator.infORventPerArea)  # -> loads, HBZones; plug-in component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

runenergysimulation = Honeybee_RunEnergySimulation(
    epwFile=path_2,
    HBZones=flatten(setepzoneloads.HBZones),
    HBContext=flatten(hb_epcontextsrf),
    simulationOutputs=flatten(epoutput.simulationOutputs),
    writeIdf=run_energyplus,
    runEnergyPlus=run_energyplus,
    idfFileName=rep)  # -> report, idfFileAddress, resultFileAddress; plug-in component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
panel_47 = Panel(runenergysimulation.resultFileAddress)
readepresult = Honeybee_ReadEPResult(resultFileAddress=runenergysimulation.resultFileAddress)  # -> port, port_2, port_3, port_4, port_5, port_6, port_7, port_8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; plug-in component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
adaptivecomfortcalculator = Ladybug_AdaptiveComfortCalculator(
    dryBulbTemperature=readepresult.airTemperature,
    meanRadiantTemperature=readepresult.meanRadTemperature,
    prevailingOutdoorTemp=importepw_5.dryBulbTemperature,
    runIt=Toggle(True))  # -> readMe, port, comfortableOrNot, conditionOfPerson, degreesFromTarget, port_2, targetTemperature, upperTemperatureBound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; plug-in component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
comfortable_hot_cold = Panel([adaptivecomfortcalculator.percentOfTimeComfortable, adaptivecomfortcalculator.percentHotCold])
psychchart_2 = Ladybug_PsychrometricChart(
    dryBulbTemperature=readepresult.airTemperature,
    relativeHumidity=readepresult.relativeHumidity,
    basePoint=move.Geometry,
    runIt=Toggle(True))  # -> readMe, port, totalComfortPercent, totalComfortOrNot, strategyNames, strategyPercentOfTime, strategyOrNot, port_2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; plug-in component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
_3dchart_6 = Ladybug_3DChart(
    inputData=flatten(adaptivecomfortcalculator.conditionOfPerson),
    basePoint=pt_6,
    xScale=".025",
    yScale="0.125",
    zScale=Slider(0, range=0..100),
    legendPar=legendpar_6)  # -> readMe, graphMesh, graphCurves, legend, legendBasePts, title, titleBasePts, dataPts, conditionalHOY; plug-in component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
num = Number(comfortable_hot_cold)
expression = Expression(x=num, Expression="Round(x, 2)")
flip_2 = FlipMatrix(Data=expression)  # -> simplify(Data)
panel_48 = Panel([flip, flip_2])
join_2 = TextJoin(Text=panel_48)
join_3 = TextJoin(Text=flatten(join_2))
tag = TextTag3D(Location=pt_7, Text=join_3, Size=1, Colour=ColourSwatch(SwatchColor=RGB(0, 0, 0)), Justification=5)

# ----
# Visualize the results
# Generate annual results
# Anuual Daylight simulation
toggle_6 = BooleanToggle(True)
# Test Geometry Anuual Daylight simulation
number_slider_23 = Slider(0.1, range=0..1)
panel_49 = Panel("https://www.energyplus.net/weather-download/north_and_central_america_wmo_region_4/USA/PA/USA_PA_Philadelphia.Intl.AP.724080_TMY3/all")
gentestpts_2 = Honeybee_GenerateTestPoints(testGeometry=brep, gridSize=number_slider_23, distBaseSrf=Slider(0.762, range=0..1), moveTestMesh=toggle_6)  # -> readMe, simplify(testPoints), simplify(ptsVectors), simplify(facesArea), simplify(mesh); plug-in component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
epw_stat_6 = Ladybug_OpenEPWAndSTATWeatherFiles(weatherFileURL=panel_49)  # -> epwFile, statFile; plug-in component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
annualdaylightsimulation = Honeybee_AnnualDaylightSimulation(
    epwWeatherFile=epw_stat_6.epwFile,
    testPoints=flatten(gentestpts_2.testPoints),
    ptsVectors=flatten(gentestpts_2.ptsVectors),
    testMesh=flatten(gentestpts_2.mesh))  # -> analysisRecipe; plug-in component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
toggle_7 = BooleanToggle(True)
rundaylightanalysis_2 = Honeybee_RunDaylightSimulation(
    HBObjects=flatten(brep_4),
    analysisRecipe=annualdaylightsimulation,
    writeRad=toggle_7,
    runRad=toggle_7,
    numOfCPUs=Slider(8, range=0..10),
    overwriteResults=True)  # -> readMe, analysisType, resultsUnit, results, testPts, annual_analysis_files, radGeoFile, studyFolder, done; plug-in component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
occupancygenerator = Honeybee_DaysimOccupancyGenerator(weekendDays=[1, 2], writeTheOcc=Toggle(True))  # -> occupancyFile; plug-in component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
panel_50 = Panel(rundaylightanalysis_2.annual_analysis_files)
readannualresultsi = Honeybee_ReadAnnualResultI(
    illFilesAddress=rundaylightanalysis_2.annual_analysis_files,
    testPoints=simplify(rundaylightanalysis_2.testPts),
    occupancyFiles=occupancygenerator,
    DLAIllumThresholds=300,
    runIt=Toggle(True))  # -> DLA, UDLI_Less_100, UDLI_100_2000, UDLI_More_2000, CDA, sDA, annualProfiles, htmReport; plug-in component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
gradientlibrary_5 = Ladybug_GradientLibrary(gradIndex=Slider(1, range=0..10))  # -> customColors; plug-in component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
panel_51 = Panel(readannualresultsi.UDLI_100_2000)
panel_52 = Panel(readannualresultsi.annualProfiles)
legendpar_7 = Ladybug_LegendParameters(
    lowBound=Slider(0, range=0..100),
    highBound=Slider(100, range=0..100),
    numSegments=Slider(11, range=0..11),
    customColors=gradientlibrary_5)  # -> legendPar; plug-in component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
panel_53 = Panel(readannualresultsi.htmReport)
concat_2 = Concatenate(FragmentA=rundaylightanalysis_2.analysisType, FragmentB="(sDA:", FragmentC=readannualresultsi.sDA, FragmentD=")")
panel_54 = Panel(concat_2)

# ---- group: make it 3D!
dom = ConstructDomain(DomainStart=0, DomainEnd=Slider(1, range=0..1))

# ----
recolormesh_2 = Ladybug_ReColorMesh(
    analysisResult=readannualresultsi.DLA,
    inputMesh=gentestpts_2.mesh,
    heightDomain=dom,
    legendPar=legendpar_7,
    analysisTitle=concat_2,
    legendTitle="%")  # -> readMe, newMesh, newLegend, legendBasePt, meshColors, legendColors; plug-in component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

honeybee_3 = Honeybee_Honeybee()  # -> Vviiiiiiiiiizzz; disabled; plug-in component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
# Honey Bee Zone Anuual Daylight simulation
ladybug_3 = Ladybug_Ladybug()  # -> Vviiiiiiiiiizzz; disabled; plug-in component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
brep_6 = Brep(<brep referenced from the Rhino model>)  # disabled
toggle_8 = BooleanToggle(True)  # disabled
number_slider_24 = Slider(0.6, range=0..1)  # disabled
mass2zone_2 = Honeybee_Masses2Zones(zoneMasses=flatten(brep_6), isConditioned=True, maxRoofAngle=30, createHBZones=toggle_8)  # -> readMe, HBZones; disabled; plug-in component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
glzparamlist_2 = Honeybee_GlazingParametersList(northGlzParam=number_slider_24, westGlzParam=0, southGlzParam=0, eastGlzParam=0)  # -> glzParamList; disabled; plug-in component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
toggle_9 = BooleanToggle(True)  # disabled
glazingcreator_2 = Honeybee_GlazingBasedOnRatio(HBObjects=mass2zone_2.HBZones, glzRatio=glzparamlist_2, runIt=toggle_9)  # -> readMe, HBObjWGLZ; disabled; plug-in component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
number_slider_25 = Slider(0.762, range=0..1)  # disabled
number_slider_26 = Slider(0.5, range=0..1)  # disabled
panel_55 = Panel("https://www.energyplus.net/weather-download/north_and_central_america_wmo_region_4/USA/PA/USA_PA_Philadelphia.Intl.AP.724080_TMY3/all")  # disabled
toggle_10 = BooleanToggle(True)  # disabled
epw_stat_7 = Ladybug_OpenEPWAndSTATWeatherFiles(weatherFileURL=panel_55)  # -> epwFile, statFile; disabled; plug-in component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
toggle_11 = BooleanToggle(True)  # disabled
toggle_12 = BooleanToggle(True)  # disabled
occupancygenerator_2 = Honeybee_DaysimOccupancyGenerator(weekendDays=[1, 2], writeTheOcc=toggle_12)  # -> occupancyFile; disabled; plug-in component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
toggle_13 = BooleanToggle(True)  # disabled
number_slider_27 = Slider(0, range=0..10)  # disabled
number_slider_28 = Slider(100, range=0..100)  # disabled
number_slider_29 = Slider(0, range=0..100)  # disabled
number_slider_30 = Slider(6, range=0..10)  # disabled
gradientlibrary_6 = Ladybug_GradientLibrary(gradIndex=number_slider_27)  # -> customColors; disabled; plug-in component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
number_slider_31 = Slider(1, range=0..1)  # disabled
legendpar_8 = Ladybug_LegendParameters(
    lowBound=number_slider_29,
    highBound=number_slider_28,
    numSegments=number_slider_30,
    customColors=flatten(gradientlibrary_6))  # -> legendPar; disabled; plug-in component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
panel_56 = Panel("%")  # disabled

# ---- group: HB Zone With Glazing
brep_7 = Brep(glazingcreator_2.HBObjWGLZ)  # disabled

# ---- group: make it 3D!
dom_2 = ConstructDomain(DomainStart=0, DomainEnd=number_slider_31)  # disabled

# ----
genhbzonetestpts = Honeybee_GenerateZoneTestPoints(HBZone=brep_7, gridSize=number_slider_26, distBaseSrf=number_slider_25, moveTestMesh=toggle_10)  # -> readMe, simplify(testPoints), simplify(ptsVectors), simplify(facesArea), simplify(mesh); disabled; plug-in component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
wires_4 = BrepWireframe(Brep=brep_7, Density=-1)  # disabled
annualdaylightsimulation_2 = Honeybee_AnnualDaylightSimulation(
    epwWeatherFile=epw_stat_7.epwFile,
    testPoints=genhbzonetestpts.testPoints,
    ptsVectors=genhbzonetestpts.ptsVectors,
    testMesh=genhbzonetestpts.mesh)  # -> analysisRecipe; disabled; plug-in component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
rundaylightanalysis_3 = Honeybee_RunDaylightSimulation(
    HBObjects=flatten(brep_7),
    analysisRecipe=annualdaylightsimulation_2,
    writeRad=toggle_11,
    runRad=toggle_11,
    overwriteResults=True)  # -> readMe, analysisType, resultsUnit, results, testPts, annual_analysis_files, radGeoFile, studyFolder, done; disabled; plug-in component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
readannualresultsi_2 = Honeybee_ReadAnnualResultI(
    illFilesAddress=rundaylightanalysis_3.annual_analysis_files,
    testPoints=simplify(rundaylightanalysis_3.testPts),
    occupancyFiles=occupancygenerator_2,
    DLAIllumThresholds=300,
    runIt=toggle_13)  # -> DLA, UDLI_Less_100, UDLI_100_2000, UDLI_More_2000, CDA, sDA, annualProfiles, htmReport; disabled; plug-in component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
panel_57 = Panel(readannualresultsi_2.sDA)  # disabled
recolormesh_3 = Ladybug_RecolorMesh(
    analysisResult=readannualresultsi_2.UDLI_More_2000,
    inputMesh=genhbzonetestpts.mesh,
    heightDomain=dom_2,
    legendPar=legendpar_8,
    analysisTitle=rundaylightanalysis_3.analysisType,
    legendTitle=panel_56)  # -> readMe, newMesh, newLegend, legendBasePt, meshColors, legendColors; disabled; plug-in component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
