# Grasshopper definition XIAORAN_LIU_final report.gh (Grasshopper 0.9.76)
# plug-ins: Python Interpreter

ladybug = Ladybug_Ladybug()  # -> Vviiiiiiiiiizzz; plug-in component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
honeybee = Honeybee_Honeybee()  # -> Vviiiiiiiiiizzz; plug-in component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
toggle = BooleanToggle(False)
updateladybug = Ladybug_UpdateLadybug(updateThisFile=toggle)  # -> readMe; plug-in component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
updatehoneybee = Honeybee_UpdateHoneybee(updateThisFile=toggle)  # -> out; plug-in component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

ladybug_2 = Ladybug_Ladybug()  # -> Vviiiiiiiiiizzz; plug-in component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

# ----
# Generate sky
number_slider = Slider(2, range=0..2)
number_slider_2 = Slider(2, range=0..2)
# Animate sliders
button = Button()
months = Panel("""3
6
12""")
hours = Panel("""9
12
15""")
fly = Ladybug_fly(inputSliders=[number_slider_2, number_slider], fly=button)  # -> Vviiiiiiiiiizzz; plug-in component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
item = ListItem(List=hours, Index=number_slider, Wrap=True)
item_2 = ListItem(List=months, Index=number_slider_2, Wrap=True)
path = FilePath("F:\Upenn\16Fall\Arch753_Building Performance Simulation\EPW_Philadelphia\USA_PA_Philadelphia.Intl.AP.724080_TMY3.epw")
panel = Panel("""9
12
15""")
panel_2 = Panel("""3
6
12""")
genclimatebasedsky = Honeybee_GenerateClimateBasedSky(weatherFile=path, month=item_2, day="21", hour=item)  # -> radiationValues, skyFilePath; plug-in component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
importlocation = Ladybug_ImportLocation(epwFile=path)  # -> location; plug-in component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
doy_hoy = Ladybug_DOY_HOY(days="21", months=item_2, hours=item)  # -> HOY, DOY, date; plug-in component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
sunpath = Ladybug_SunPath(
    location=importlocation,
    hour=panel,
    day=21,
    month=panel_2,
    timeStep=1,
    sunPathScale=Slider(0.2, range=0..1),
    dailyOrAnnualSunPath=True)  # -> readMe, sunVectors, sunAltitudes, sunAzimuths, port, sunSpheresMesh, sunPathCrvs, legend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; plug-in component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

# ---- group: WWR
wwr_north = Slider(0.3, range=0..1)

wwr_north_2 = Slider(0.3, range=0..1)

# ----
list = ValueList({"Exterior Window [R1.0, SHGC 0.7]": "ASHRAE 90.1-2004 EXTWINDOW CLIMATEZONE ALT-WARE 1-8", "Exterior Window [R1.7, SHGC 0.39]": "ASHRAE 90.1-2004 EXTWINDOW CLIMATEZONE 4-6", "Exterior Window [R1.9, SHGC 0.39]": "ASHRAE 90.1-2004 EXTWINDOW CLIMATEZONE ALT-RES 4-6", "Exterior Window [R0.7, SHGC 0.65]": "Dbl LoE (e3=.1) Clr 3mm/13mm Arg"}, selected="Exterior Window [R1.0, SHGC 0.7]")
list_2 = ValueList({"Exterior Roof [R9.2]": "ASHRAE 90.1-2004 EXTROOF METAL CLIMATEZONE 3-4", "Exterior Roof [R14.8]": "ASHRAE 90.1-2004 EXTROOF IEAD CLIMATEZONE 1-4", "Exterior Roof [R34.4]": "ASHRAE 189.1-2009 EXTROOF IEAD CLIMATEZONE 7-8"}, selected="Exterior Roof [R34.4]")
list_3 = ValueList({"Exterior Wall [R5.5]": "ASHRAE 90.1-2004 EXTWALL METAL CLIMATEZONE 4", "Exterior Wall [R5.8]": "ASHRAE 90.1-2004 EXTWALL MASS CLIMATEZONE 3-4", "Exterior Wall [R7.2]": "ASHRAE 90.1-2004 EXTWALL STEELFRAME CLIMATEZONE 1-4", "Exterior Wall [R8.7]": "ASHRAE 90.1-2004 EXTWALL MASS CLIMATEZONE ALT-RES 4", "Exterior Wall [R10.4]": "ASHRAE 90.1-2004 EXTWALL WOODFRAME CLIMATEZONE 1-7", "Exterior Wall [R14.8]": "ASHRAE 90.1-2004 EXTWALL STEELFRAME CLIMATEZONE ALT-RES 4-6", "Exterior Wall [R34.4]": "ASHRAE 189.1-2009 EXTROOF IEAD CLIMATEZONE 7-8"}, selected="Exterior Wall [R34.4]")

add_blinds = BooleanToggle(False)
shading_depth = Slider(0.5, range=0..1)
number_of_blinds = Slider(3, range=0..10)

honeybee_2 = Honeybee_Honeybee()  # -> Vviiiiiiiiiizzz; plug-in component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

list_4 = ValueList({"Exterior Window [R1.0, SHGC 0.7]": "ASHRAE 90.1-2004 EXTWINDOW CLIMATEZONE ALT-WARE 1-8", "Exterior Window [R1.7, SHGC 0.39]": "ASHRAE 90.1-2004 EXTWINDOW CLIMATEZONE 4-6", "Exterior Window [R1.9, SHGC 0.39]": "ASHRAE 90.1-2004 EXTWINDOW CLIMATEZONE ALT-RES 4-6", "Exterior Window [R0.7, SHGC 0.65]": "Dbl LoE (e3=.1) Clr 3mm/13mm Arg"}, selected="Exterior Window [R1.0, SHGC 0.7]")
list_5 = ValueList({"Exterior Roof [R9.2]": "ASHRAE 90.1-2004 EXTROOF METAL CLIMATEZONE 3-4", "Exterior Roof [R14.8]": "ASHRAE 90.1-2004 EXTROOF IEAD CLIMATEZONE 1-4", "Exterior Roof [R34.4]": "ASHRAE 189.1-2009 EXTROOF IEAD CLIMATEZONE 7-8"}, selected="Exterior Roof [R34.4]")
list_6 = ValueList({"Exterior Wall [R5.5]": "ASHRAE 90.1-2004 EXTWALL METAL CLIMATEZONE 4", "Exterior Wall [R5.8]": "ASHRAE 90.1-2004 EXTWALL MASS CLIMATEZONE 3-4", "Exterior Wall [R7.2]": "ASHRAE 90.1-2004 EXTWALL STEELFRAME CLIMATEZONE 1-4", "Exterior Wall [R8.7]": "ASHRAE 90.1-2004 EXTWALL MASS CLIMATEZONE ALT-RES 4", "Exterior Wall [R10.4]": "ASHRAE 90.1-2004 EXTWALL WOODFRAME CLIMATEZONE 1-7", "Exterior Wall [R14.8]": "ASHRAE 90.1-2004 EXTWALL STEELFRAME CLIMATEZONE ALT-RES 4-6", "Exterior Wall [R34.4]": "ASHRAE 189.1-2009 EXTROOF IEAD CLIMATEZONE 7-8"}, selected="Exterior Wall [R34.4]")

add_blinds_2 = BooleanToggle(False)
shading_depth_2 = Slider(0.5, range=0..1)
number_of_blinds_2 = Slider(3, range=0..10)

run_energyplus = BooleanToggle(False)
# Wall to Window Ratio
# Rotation Angle
# Blinds
# Construction
# Thermal Mass
list_7 = ValueList({"Existing Slab Construction": "0", "+4 Inches Concrete": "1", "+8 Inches Concrete": "2"}, selected="+4 Inches Concrete")

# ---- group: celing
# outdoor comfort simulation
wall = Brep(<brep referenced from the Rhino model>)

# ---- group: Wall
wall_2 = Brep([<brep referenced from the Rhino model> x4])

# ----
brep = Brep([<brep referenced from the Rhino model> x10])

# ---- group: Floor
brep_2 = Brep(<brep referenced from the Rhino model>)

# ---- group: Furniture
brep_3 = Brep([<brep referenced from the Rhino model> x3])

# ---- group: Window
brep_4 = Brep(<brep referenced from the Rhino model>)

# ---- group: celing
wall_3 = Brep(<brep referenced from the Rhino model>)  # disabled

# ---- group: Wall
wall_4 = Brep([<brep referenced from the Rhino model> x4])  # disabled

# ---- group: Floor
brep_5 = Brep(<brep referenced from the Rhino model>)  # disabled

# ---- group: Furniture
brep_6 = Brep([<brep referenced from the Rhino model> x3])  # disabled

# ---- group: Window
brep_7 = Brep(<brep referenced from the Rhino model>)  # disabled

# ----
# Glass material
panel_3 = Panel("tvis_60")  # disabled
panel_4 = Panel("0.6")  # disabled
# 180 changable window baseline model
panel_5 = Panel("generic_35")  # disabled
panel_6 = Panel(".35")  # disabled
radopaquematerial = Honeybee_RadianceOpaqueMaterial(materialName=panel_5, RReflectance=panel_6, GReflectance=panel_6, BReflectance=panel_6, roughness=0.05, specularity=0)  # -> avrgRef, RADMaterial; disabled; plug-in component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
radglassmaterial = Honeybee_RadianceGlassMaterial(materialName=panel_3, RTransmittance=panel_4, GTransmittance=panel_4, BTransmittance=panel_4, refractiveIndex=1.52)  # -> avrgTrans, RADMaterial; disabled; plug-in component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
number_slider_3 = Slider(1, range=0..1)  # disabled
number_slider_4 = Slider(2, range=0..10)  # disabled
createhbsrfs = Honeybee_createHBSrfs(geometry=brep_7, RADMaterial=radglassmaterial.RADMaterial)  # -> readMe, simplify(HBSurface); disabled; plug-in component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
createhbsrfs_2 = Honeybee_createHBSrfs(geometry=brep_6)  # -> readMe, simplify(HBSurface); disabled; plug-in component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
createhbsrfs_3 = Honeybee_createHBSrfs(geometry=wall_4)  # -> readMe, simplify(flatten(HBSurface)); disabled; plug-in component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
createhbsrfs_4 = Honeybee_createHBSrfs(geometry=wall_3, srfType=number_slider_3)  # -> readMe, simplify(flatten(HBSurface)); disabled; plug-in component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
createhbsrfs_5 = Honeybee_createHBSrfs(geometry=brep_5, srfType=number_slider_4)  # -> readMe, simplify(HBSurface); disabled; plug-in component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
swatch = ColourSwatch(SwatchColor=RGBA(129, 150, 235, 74))  # disabled
swatch_2 = ColourSwatch(SwatchColor=RGBA(153, 70, 70, 208))  # disabled
preview = CustomPreview(Geometry=createhbsrfs_5.HBSurface, Shader=swatch)  # disabled
preview_2 = CustomPreview(Geometry=createhbsrfs_3.HBSurface, Shader=swatch_2)  # disabled
brep_8 = Brep(flatten([createhbsrfs_2.HBSurface, createhbsrfs_4.HBSurface, createhbsrfs_3.HBSurface, createhbsrfs.HBSurface]))  # disabled
panel_7 = Panel(brep_8)  # disabled
wires = BrepWireframe(Brep=brep_8, Density=-1)  # disabled

# ---- group: celing
wall_5 = Brep(<brep referenced from the Rhino model>)  # disabled

# ---- group: Wall
wall_6 = Brep([<brep referenced from the Rhino model> x4])  # disabled

# ---- group: Floor
brep_9 = Brep(<brep referenced from the Rhino model>)  # disabled

# ---- group: Furniture
brep_10 = Brep([<brep referenced from the Rhino model> x3])  # disabled

# ---- group: Window
brep_11 = Brep(<brep referenced from the Rhino model>)  # disabled

# ----
# Glass material
panel_8 = Panel("tvis_60")  # disabled
panel_9 = Panel("0.6")  # disabled
# 180 baseline model
panel_10 = Panel("generic_35")  # disabled
panel_11 = Panel(".35")  # disabled
radopaquematerial_2 = Honeybee_RadianceOpaqueMaterial(
    materialName=panel_10,
    RReflectance=panel_11,
    GReflectance=panel_11,
    BReflectance=panel_11,
    roughness=0.05,
    specularity=0)  # -> avrgRef, RADMaterial; disabled; plug-in component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
radglassmaterial_2 = Honeybee_RadianceGlassMaterial(materialName=panel_8, RTransmittance=panel_9, GTransmittance=panel_9, BTransmittance=panel_9, refractiveIndex=1.52)  # -> avrgTrans, RADMaterial; disabled; plug-in component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
number_slider_5 = Slider(1, range=0..1)  # disabled
number_slider_6 = Slider(2, range=0..10)  # disabled
createhbsrfs_6 = Honeybee_createHBSrfs(geometry=brep_11, RADMaterial=radglassmaterial_2.RADMaterial)  # -> readMe, simplify(HBSurface); disabled; plug-in component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
createhbsrfs_7 = Honeybee_createHBSrfs(geometry=brep_10)  # -> readMe, simplify(HBSurface); disabled; plug-in component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
createhbsrfs_8 = Honeybee_createHBSrfs(geometry=wall_6)  # -> readMe, simplify(flatten(HBSurface)); disabled; plug-in component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
createhbsrfs_9 = Honeybee_createHBSrfs(geometry=wall_5, srfType=number_slider_5)  # -> readMe, simplify(flatten(HBSurface)); disabled; plug-in component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
createhbsrfs_10 = Honeybee_createHBSrfs(geometry=brep_9, srfType=number_slider_6)  # -> readMe, simplify(HBSurface); disabled; plug-in component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
swatch_3 = ColourSwatch(SwatchColor=RGBA(129, 150, 235, 74))  # disabled
swatch_4 = ColourSwatch(SwatchColor=RGBA(153, 70, 70, 208))  # disabled
preview_3 = CustomPreview(Geometry=createhbsrfs_10.HBSurface, Shader=swatch_3)  # disabled
preview_4 = CustomPreview(Geometry=createhbsrfs_8.HBSurface, Shader=swatch_4)  # disabled
brep_12 = Brep(flatten([createhbsrfs_7.HBSurface, createhbsrfs_9.HBSurface, createhbsrfs_8.HBSurface, createhbsrfs_6.HBSurface]))  # disabled
panel_12 = Panel(brep_12)  # disabled
wires_2 = BrepWireframe(Brep=brep_12, Density=-1)  # disabled

# ---- group: celing
wall_7 = Brep(<brep referenced from the Rhino model>)  # disabled

# ---- group: Wall
wall_8 = Brep([<brep referenced from the Rhino model> x4])  # disabled

# ---- group: Floor
brep_13 = Brep(<brep referenced from the Rhino model>)  # disabled

# ---- group: Furniture
brep_14 = Brep([<brep referenced from the Rhino model> x3])  # disabled

# ---- group: Window
brep_15 = Brep(<brep referenced from the Rhino model>)  # disabled

# ----
# Glass material
# baseline model
panel_13 = Panel("tvis_60")  # disabled
panel_14 = Panel("0.6")  # disabled
panel_15 = Panel("generic_35")  # disabled
panel_16 = Panel(".35")  # disabled
radopaquematerial_3 = Honeybee_RadianceOpaqueMaterial(
    materialName=panel_15,
    RReflectance=panel_16,
    GReflectance=panel_16,
    BReflectance=panel_16,
    roughness=0.05,
    specularity=0)  # -> avrgRef, RADMaterial; disabled; plug-in component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
radglassmaterial_3 = Honeybee_RadianceGlassMaterial(materialName=panel_13, RTransmittance=panel_14, GTransmittance=panel_14, BTransmittance=panel_14, refractiveIndex=1.52)  # -> avrgTrans, RADMaterial; disabled; plug-in component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
number_slider_7 = Slider(1, range=0..1)  # disabled
number_slider_8 = Slider(2, range=0..10)  # disabled
createhbsrfs_11 = Honeybee_createHBSrfs(geometry=brep_15, RADMaterial=radglassmaterial_3.RADMaterial)  # -> readMe, simplify(HBSurface); disabled; plug-in component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
createhbsrfs_12 = Honeybee_createHBSrfs(geometry=brep_14)  # -> readMe, simplify(HBSurface); disabled; plug-in component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
createhbsrfs_13 = Honeybee_createHBSrfs(geometry=wall_8)  # -> readMe, simplify(flatten(HBSurface)); disabled; plug-in component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
createhbsrfs_14 = Honeybee_createHBSrfs(geometry=wall_7, srfType=number_slider_7)  # -> readMe, simplify(flatten(HBSurface)); disabled; plug-in component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
createhbsrfs_15 = Honeybee_createHBSrfs(geometry=brep_13, srfType=number_slider_8)  # -> readMe, simplify(HBSurface); disabled; plug-in component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
swatch_5 = ColourSwatch(SwatchColor=RGBA(129, 150, 235, 74))  # disabled
swatch_6 = ColourSwatch(SwatchColor=RGBA(153, 70, 70, 208))  # disabled
preview_5 = CustomPreview(Geometry=createhbsrfs_15.HBSurface, Shader=swatch_5)  # disabled
preview_6 = CustomPreview(Geometry=createhbsrfs_13.HBSurface, Shader=swatch_6)  # disabled
brep_16 = Brep(flatten([createhbsrfs_12.HBSurface, createhbsrfs_14.HBSurface, createhbsrfs_13.HBSurface, createhbsrfs_11.HBSurface]))  # disabled
panel_17 = Panel(brep_16)  # disabled
wires_3 = BrepWireframe(Brep=brep_16, Density=-1)  # disabled

createhbsrfs_16 = Honeybee_createHBSrfs(geometry=wall_2)  # -> readMe, simplify(HBSurface); plug-in component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
createhbsrfs_17 = Honeybee_createHBSrfs(geometry=brep_3)  # -> readMe, simplify(HBSurface); plug-in component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
brep_17 = Brep(<brep referenced from the Rhino model>)
createhbsrfs_18 = Honeybee_createHBSrfs(geometry=brep)  # -> readMe, simplify(HBSurface); plug-in component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
mass2zone = Honeybee_Masses2Zones(zoneMasses=flatten(brep_17), isConditioned=Toggle(False), maxRoofAngle=30, createHBZones=Toggle(True))  # -> readMe, HBZones; plug-in component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
brep_18 = Brep(<brep referenced from the Rhino model>)
solveadjc = Honeybee_SolveAdjacencies(HBZones=flatten(mass2zone.HBZones), removeCurrentAdjc=False, findAdjc=Toggle(True))  # -> readMe, HBZonesWADJ; plug-in component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
# Geometry
# Geometry
mass2zone_2 = Honeybee_Masses2Zones(zoneMasses=flatten(brep_18), isConditioned=Toggle(False), maxRoofAngle=30, createHBZones=Toggle(True))  # -> readMe, HBZones; plug-in component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
glzparamlist = Honeybee_GlazingParametersList(northGlzParam=wwr_north_2, westGlzParam=0, southGlzParam=0, eastGlzParam=0)  # -> glzParamList; plug-in component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

# ----
# comprehensive climate analysis
panel_18 = Panel("https://www.energyplus.net/weather-download/north_and_central_america_wmo_region_4/USA/PA/USA_PA_Philadelphia.Intl.AP.724080_TMY3/all")  # disabled
epw_stat = Ladybug_OpenEPWAndSTATWeatherFiles(weatherFileURL=panel_18)  # -> epwFile, statFile; disabled; plug-in component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
importlocation_2 = Ladybug_ImportLocation(epwFile=epw_stat.epwFile)  # -> location; disabled; plug-in component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
importepw = Ladybug_ImportEpw(epwFile=epw_stat.epwFile)  # -> readMe, latitude, location, dryBulbTemperature, dewPointTemperature, relativeHumidity, windSpeed, windDirection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; disabled; plug-in component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
panel_19 = Panel(importlocation_2)  # disabled
panel_20 = Panel(importepw.dryBulbTemperature)  # disabled
panel_21 = Panel(importepw.dewPointTemperature)  # disabled
panel_22 = Panel(importepw.relativeHumidity)  # disabled
panel_23 = Panel(importepw.windSpeed)  # disabled
strnum = Ladybug_SeparateData(inputList=flatten(panel_21))  # -> numbers, strings; disabled; plug-in component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
strnum_2 = Ladybug_SeparateData(inputList=flatten(panel_20))  # -> numbers, strings; disabled; plug-in component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
strnum_3 = Ladybug_SeparateData(inputList=flatten(panel_22))  # -> numbers, strings; disabled; plug-in component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
strnum_4 = Ladybug_SeparateData(inputList=flatten(panel_23))  # -> numbers, strings; disabled; plug-in component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
cdd_hdd = Ladybug_CDD_HDD(hourlyDryBulbTemperature=importepw.dryBulbTemperature)  # -> readMe, daily_coolingDegDays, daily_heatingDegDays, monthly_coolingDegDays, monthly_heatingDegDays, annual_coolingDegDays, annual_heatingDegDays; disabled; plug-in component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
number_slider_9 = Slider(0.02, range=0..1)  # disabled
number_slider_10 = Slider(0.06, range=0..1)  # disabled
number_slider_11 = Slider(0, range=0..1)  # disabled
number_slider_12 = Slider(1, range=0..100)  # disabled
number_slider_13 = Slider(0.02, range=0..1)  # disabled
number_slider_14 = Slider(0.06, range=0..1)  # disabled
number_slider_15 = Slider(0, range=0..1)  # disabled
number_slider_16 = Slider(0.02, range=0..1)  # disabled
number_slider_17 = Slider(0.06, range=0..1)  # disabled
number_slider_18 = Slider(0, range=0..1)  # disabled
gradientlibrary = Ladybug_GradientLibrary(gradIndex=number_slider_12)  # -> customColors; disabled; plug-in component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
pt = Point(<point referenced from the Rhino model>)  # disabled
number_slider_19 = Slider(12, range=0..100)  # disabled
pt_2 = Point(<point referenced from the Rhino model>)  # disabled
legendpar = Ladybug_LegendParameters(customColors=flatten(gradientlibrary))  # -> legendPar; disabled; plug-in component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
_3dchart = Ladybug_3DChart(
    inputData=flatten(strnum_2.numbers),
    basePoint=pt,
    xScale=number_slider_9,
    yScale=number_slider_10,
    zScale=number_slider_11,
    legendPar=legendpar)  # -> readMe, graphMesh, graphCurves, legend, legendBasePts, title, titleBasePts, dataPts, conditionalHOY; disabled; plug-in component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
number_slider_20 = Slider(19, range=0..100)  # disabled
pt_3 = Point(<point referenced from the Rhino model>)  # disabled
gradientlibrary_2 = Ladybug_GradientLibrary(gradIndex=number_slider_19)  # -> customColors; disabled; plug-in component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
gradientlibrary_3 = Ladybug_GradientLibrary(gradIndex=number_slider_20)  # -> customColors; disabled; plug-in component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
legendpar_2 = Ladybug_LegendParameters(customColors=flatten(gradientlibrary_2))  # -> legendPar; disabled; plug-in component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
_3dchart_2 = Ladybug_3DChart(
    inputData=flatten(strnum_3.numbers),
    basePoint=pt_2,
    xScale=number_slider_13,
    yScale=number_slider_14,
    zScale=number_slider_15,
    legendPar=legendpar_2)  # -> readMe, graphMesh, graphCurves, legend, legendBasePts, title, titleBasePts, dataPts, conditionalHOY; disabled; plug-in component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
legendpar_3 = Ladybug_LegendParameters(customColors=flatten(gradientlibrary_3))  # -> legendPar; disabled; plug-in component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
_3dchart_3 = Ladybug_3DChart(
    inputData=flatten(strnum_4.numbers),
    basePoint=pt_3,
    xScale=number_slider_16,
    yScale=number_slider_17,
    zScale=number_slider_18,
    legendPar=legendpar_3)  # -> readMe, graphMesh, graphCurves, legend, legendBasePts, title, titleBasePts, dataPts, conditionalHOY; disabled; plug-in component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
number_slider_21 = Slider(0.02, range=0..1)  # disabled
number_slider_22 = Slider(0.06, range=0..1)  # disabled
number_slider_23 = Slider(0, range=0..1)  # disabled
number_slider_24 = Slider(9, range=0..100)  # disabled
pt_4 = Point(<point referenced from the Rhino model>)  # disabled
gradientlibrary_4 = Ladybug_GradientLibrary(gradIndex=number_slider_24)  # -> customColors; disabled; plug-in component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
legendpar_4 = Ladybug_LegendParameters(customColors=flatten(gradientlibrary_4))  # -> legendPar; disabled; plug-in component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
_3dchart_4 = Ladybug_3DChart(
    inputData=flatten(strnum.numbers),
    basePoint=pt_4,
    xScale=number_slider_21,
    yScale=number_slider_22,
    zScale=number_slider_23,
    legendPar=legendpar_4)  # -> readMe, graphMesh, graphCurves, legend, legendBasePts, title, titleBasePts, dataPts, conditionalHOY; disabled; plug-in component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

panel_24 = Panel("https://www.energyplus.net/weather-download/north_and_central_america_wmo_region_4/USA/PA/USA_PA_Philadelphia.Intl.AP.724080_TMY3/all")
epw_stat_2 = Ladybug_OpenEPWAndSTATWeatherFiles(weatherFileURL=panel_24)  # -> epwFile, statFile; plug-in component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
importlocation_3 = Ladybug_ImportLocation(epwFile=epw_stat_2.epwFile)  # -> location; plug-in component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
importepw_2 = Ladybug_ImportEpw(epwFile=epw_stat_2.epwFile)  # -> readMe, latitude, location, dryBulbTemperature, dewPointTemperature, relativeHumidity, windSpeed, windDirection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; plug-in component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
panel_25 = Panel(importlocation_3)
outdoorcomfortcalculator = Ladybug_OutdoorComfortCalculator(
    dryBulbTemperature=importepw_2.dryBulbTemperature,
    windSpeed_tenMeters=importepw_2.windSpeed,
    relativeHumidity=importepw_2.relativeHumidity,
    runIt=Toggle(True))  # -> readMe, port, universalThermalClimateIndex, comfortableOrNot, thermalStress, conditionOfPerson, port_2, percentOfTimeComfortable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; plug-in component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
panel_26 = Panel(outdoorcomfortcalculator.percentOfTimeComfortable)
panel_27 = Panel(outdoorcomfortcalculator.percentHeatStress)
panel_28 = Panel(outdoorcomfortcalculator.percentColdStress)
pt_5 = Point(<point referenced from the Rhino model>)
psychchart = Ladybug_PsychrometricChart()  # -> readMe, port, totalComfortPercent, totalComfortOrNot, strategyNames, strategyPercentOfTime, strategyOrNot, port_2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; plug-in component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
_3dchart_5 = Ladybug_3DChart(
    inputData=flatten(outdoorcomfortcalculator.conditionOfPerson),
    basePoint=pt_5,
    xScale=Slider(0.02, range=0..1),
    yScale=Slider(0.06, range=0..0.1),
    zScale=Slider(0, range=0..1))  # -> readMe, graphMesh, graphCurves, legend, legendBasePts, title, titleBasePts, dataPts, conditionalHOY; plug-in component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

brep_19 = Brep(<brep referenced from the Rhino model>)

callfromepconstrlibrary = Honeybee_CallFromEPConstructionLibrary(keywords="floor")  # -> ThermMaterials, EPMaterials, EPWindowMaterials, EPConstructions; plug-in component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
item_3 = ListItem(List=callfromepconstrlibrary.EPConstructions, Index=Slider(0, range=0..100), Wrap=True)
decomposeepconstruction = Honeybee_DecomposeEPConstruction(cnstrName=item_3)  # -> flatten(materials), comments, UValue_SI, UValue_IP, RValue_SI, RValue_IP; plug-in component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

callfromepconstrlibrary_2 = Honeybee_CallFromEPConstructionLibrary(keywords="floor")  # -> ThermMaterials, EPMaterials, EPWindowMaterials, EPConstructions; plug-in component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
item_4 = ListItem(List=callfromepconstrlibrary_2.EPConstructions, Index=Slider(0, range=0..100), Wrap=True)
decomposeepconstruction_2 = Honeybee_DecomposeEPConstruction(cnstrName=item_4)  # -> flatten(materials), comments, UValue_SI, UValue_IP, RValue_SI, RValue_IP; plug-in component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

addhbglz = Honeybee_addHBGlz(HBObj=solveadjc.HBZonesWADJ, childSurfaces=flatten(brep_19))  # -> HBObjWGLZ; plug-in component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

callfromepconstrlibrary_3 = Honeybee_CallFromEPConstructionLibrary(keywords="slab")  # -> ThermMaterials, EPMaterials, EPWindowMaterials, EPConstructions; plug-in component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
item_5 = ListItem(List=callfromepconstrlibrary_3.EPConstructions, Index="2", Wrap=True)
decomposeepconstruction_3 = Honeybee_DecomposeEPConstruction(cnstrName=item_5)  # -> flatten(materials), comments, UValue_SI, UValue_IP, RValue_SI, RValue_IP; plug-in component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

callfromepconstrlibrary_4 = Honeybee_CallFromEPConstructionLibrary(keywords="slab")  # -> ThermMaterials, EPMaterials, EPWindowMaterials, EPConstructions; plug-in component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
item_6 = ListItem(List=callfromepconstrlibrary_4.EPConstructions, Index="2", Wrap=True)
decomposeepconstruction_4 = Honeybee_DecomposeEPConstruction(cnstrName=item_6)  # -> flatten(materials), comments, UValue_SI, UValue_IP, RValue_SI, RValue_IP; plug-in component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

glazingcreator = Honeybee_GlazingBasedOnRatio(HBObjects=mass2zone_2.HBZones, glzRatio=glzparamlist, breakUpDist=Toggle(True), runIt=Toggle(True))  # -> readMe, HBObjWGLZ; plug-in component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
wires_4 = BrepWireframe(Brep=addhbglz, Density=-1)
volume = Volume(Geometry=glazingcreator.HBObjWGLZ)  # -> Volume, Centroid
decomposebytype = Honeybee_DecomposeBasedOnType(HBZone=addhbglz)  # -> walls, interiorWalls, airWalls, windows, interiorWindows, skylights, roofs, ceilings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; plug-in component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
rotatehbobj = Honeybee_RotateHoneybee(HBObj=glazingcreator.HBObjWGLZ, angle=Slider(180, range=-90..180), cenPt=volume.Centroid)  # -> HBObj; plug-in component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
wires_5 = BrepWireframe(Brep=rotatehbobj, Density=-1)

panel_29 = Panel("""MAT-CC05 4 HW CONCRETE
MAT-CC05 8 HW CONCRETE""")
panel_30 = Panel(decomposeepconstruction.materials)
item_7 = ListItem(List=decomposeepconstruction.materials, Index=0, Wrap=True)  # -> Item, Item1
item_8 = ListItem(List=panel_29, Index=0, Wrap=True)  # -> Item, Item1
panel_31 = Panel(item_3)
epconstruction = Honeybee_EnergyPlusConstruction(name="floor_cnstr_2", layer_1=item_7.Item, layer_2=item_7.Item1, layer_3=item_8.Item1)  # -> EPConstruction; plug-in component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
epconstruction_2 = Honeybee_EnergyPlusConstruction(name="floor_cnstr_1", layer_1=item_7.Item, layer_2=item_7.Item1, layer_3=item_8.Item)  # -> EPConstruction; plug-in component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

panel_32 = Panel("""MAT-CC05 4 HW CONCRETE
MAT-CC05 8 HW CONCRETE""")
panel_33 = Panel(decomposeepconstruction_2.materials)
item_9 = ListItem(List=decomposeepconstruction_2.materials, Index=0, Wrap=True)  # -> Item, Item1
item_10 = ListItem(List=panel_32, Index=0, Wrap=True)  # -> Item, Item1
panel_34 = Panel(item_4)
epconstruction_3 = Honeybee_EnergyPlusConstruction(name="floor_cnstr_2", layer_1=item_9.Item, layer_2=item_9.Item1, layer_3=item_10.Item1)  # -> EPConstruction; plug-in component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
epconstruction_4 = Honeybee_EnergyPlusConstruction(name="floor_cnstr_1", layer_1=item_9.Item, layer_2=item_9.Item1, layer_3=item_10.Item)  # -> EPConstruction; plug-in component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

# ----
# Run the analysis
# Generate annual results
# Put the recipie together!
number_slider_25 = Slider(0.3, range=-1..5)  # disabled
number_slider_26 = Slider(0.3, range=0..1)  # disabled
gentestpts = Honeybee_GenerateTestPoints(testGeometry=createhbsrfs_15.HBSurface, gridSize=number_slider_26, distBaseSrf=number_slider_25, moveTestMesh=True)  # -> readMe, simplify(testPoints), simplify(ptsVectors), simplify(facesArea), simplify(mesh); disabled; plug-in component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
gridbasedsimulation = Honeybee_GridBasedSimulation(
    skyFile=genclimatebasedsky.skyFilePath,
    testPoints=gentestpts.testPoints,
    ptsVectors=gentestpts.ptsVectors,
    testMesh=gentestpts.mesh,
    simulationType=0)  # -> analysisRecipe; disabled; plug-in component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
toggle_2 = BooleanToggle(False)  # disabled
rundaylightanalysis = Honeybee_RunDaylightSimulation(
    HBObjects=flatten(brep_16),
    analysisRecipe=gridbasedsimulation,
    writeRad=toggle_2,
    runRad=toggle_2,
    overwriteResults=True)  # -> readMe, analysisType, resultsUnit, results, testPts, resultFiles, radGeoFile, studyFolder, done; disabled; plug-in component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
panel_35 = Panel(rundaylightanalysis.results)  # disabled
number_slider_27 = Slider(2000, range=0..6000)  # disabled
number_slider_28 = Slider(300, range=0..1000)  # disabled
panel_36 = Panel("")  # disabled
panel_37 = Panel(doy_hoy.date)  # disabled
legendpar_5 = Ladybug_LegendParameters(lowBound=number_slider_28, highBound=number_slider_27)  # -> legendPar; disabled; plug-in component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
concat = Concatenate(FragmentA=rundaylightanalysis.analysisType, FragmentB=panel_36, FragmentC=panel_37)  # disabled
recolormesh = Ladybug_RecolorMesh(
    analysisResult=rundaylightanalysis.results,
    inputMesh=gentestpts.mesh,
    legendPar=legendpar_5,
    analysisTitle=concat,
    legendTitle=rundaylightanalysis.resultsUnit)  # -> readMe, newMesh, newLegend, legendBasePt, meshColors, legendColors; disabled; plug-in component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

preview_7 = CustomPreview(Geometry=decomposebytype.windows, Shader=ColourSwatch(SwatchColor=RGBA(162, 240, 250, 176)))

# ----
# capture the viewport to an image
panel_38 = Panel("_")
join = TextJoin(Text=[item_2, "21", item], Join=panel_38)
panel_39 = Panel(join)
captureview = Ladybug_CaptureView(fileName=panel_39, capture=Toggle(True))  # -> imagePath; plug-in component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
panel_40 = Panel(captureview)

panel_41 = Panel("""Construction,
    Dbl LoE (e3=.1) Clr 3mm/13mm Arg,  !- Name
    CLEAR 3MM,               !- Outside Layer
    ARGON 13MM,              !- Layer 2
    LoE CLEAR 3MM Rev;       !- Layer 3""")
panel_42 = Panel("""WindowMaterial:Gas,
    ARGON 13MM,               !- Name
    Argon,                   !- Gas Type
    0.0127;                  !- Thickness {m}""")
panel_43 = Panel("""WindowMaterial:Glazing,
    LoE CLEAR 3MM Rev,       !- Name
    SpectralAverage,         !- Optical Data Type
    ,                        !- Window Glass Spectral Data Set Name
    0.003,                   !- Thickness {m}
    0.630,                   !- Solar Transmittance at Normal Incidence
    0.220,                   !- Front Side Solar Reflectance at Normal Incidence
    0.190,                   !- Back Side Solar Reflectance at Normal Incidence
    0.850,                   !- Visible Transmittance at Normal Incidence
    0.079,                   !- Front Side Visible Reflectance at Normal Incidence
    0.056,                   !- Back Side Visible Reflectance at Normal Incidence
    0.0,                     !- Infrared Transmittance at Normal Incidence
    0.10,                    !- Front Side Infrared Hemispherical Emissivity
    0.84,                    !- Back Side Infrared Hemispherical Emissivity
    0.9;                     !- Conductivity {W/m-K}""")
toggle_3 = BooleanToggle(True)
addtoeplibrary = Honeybee_AddToEnergyPlusLibrary(EPObject=[panel_41, panel_42, panel_43], addToProjectLib=toggle_3, overwrite=toggle_3)  # -> readMe; plug-in component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

panel_44 = Panel("""Construction,
    Dbl LoE (e3=.1) Clr 3mm/13mm Arg,  !- Name
    CLEAR 3MM,               !- Outside Layer
    ARGON 13MM,              !- Layer 2
    LoE CLEAR 3MM Rev;       !- Layer 3""")
panel_45 = Panel("""WindowMaterial:Gas,
    ARGON 13MM,               !- Name
    Argon,                   !- Gas Type
    0.0127;                  !- Thickness {m}""")
panel_46 = Panel("""WindowMaterial:Glazing,
    LoE CLEAR 3MM Rev,       !- Name
    SpectralAverage,         !- Optical Data Type
    ,                        !- Window Glass Spectral Data Set Name
    0.003,                   !- Thickness {m}
    0.630,                   !- Solar Transmittance at Normal Incidence
    0.220,                   !- Front Side Solar Reflectance at Normal Incidence
    0.190,                   !- Back Side Solar Reflectance at Normal Incidence
    0.850,                   !- Visible Transmittance at Normal Incidence
    0.079,                   !- Front Side Visible Reflectance at Normal Incidence
    0.056,                   !- Back Side Visible Reflectance at Normal Incidence
    0.0,                     !- Infrared Transmittance at Normal Incidence
    0.10,                    !- Front Side Infrared Hemispherical Emissivity
    0.84,                    !- Back Side Infrared Hemispherical Emissivity
    0.9;                     !- Conductivity {W/m-K}""")
toggle_4 = BooleanToggle(True)
addtoeplibrary_2 = Honeybee_AddToEnergyPlusLibrary(EPObject=[panel_44, panel_45, panel_46], addToProjectLib=toggle_4, overwrite=toggle_4)  # -> readMe; plug-in component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

filter = StreamFilter(Gate=list_7, Stream0=panel_34, Stream1=epconstruction_4, Stream2=epconstruction_3)
# Construction
# Construction
setepzonecnstr = Honeybee_SetEPZoneConstruction(HBZone=rotatehbobj, wallEPConstruction=list_6, windowEPConstruction=list_4, roofEPConstruction=list_5)  # -> simplify(modifiedHBZone); plug-in component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
setepzoneundergroundcnstr = Honeybee_SetEPZoneUndergroundConstruction(HBZone=flatten(setepzonecnstr), groundFloorEPConstruction=filter)  # -> simplify(modifiedHBZone); plug-in component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

# ----
# Blinds
# Blinds
decomposebytype_2 = Honeybee_DecomposeBasedOnType(HBZone=setepzoneundergroundcnstr)  # -> walls, interiorWalls, airWalls, windows, interiorWindows, skylights, roofs, ceilings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; plug-in component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
shddesigner = Ladybug_ShadingDesigner(
    glzSrf=flatten(decomposebytype_2.windows),
    depthOrVector=flatten(shading_depth_2),
    numOfShds=number_of_blinds_2,
    runIt=add_blinds_2,
    port_4=False)  # -> readMe, shadingSrfs; plug-in component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
wires_6 = BrepWireframe(Brep=shddesigner.shadingSrfs, Density=-1)
hb_epcontextsrf = HoneybeeEPContextSurfaces(shdSurfaces=flatten(shddesigner.shadingSrfs))  # -> HBContext; inputs shdSurfaces: list of Brep, justBoundingBox: Boolean
# ---------- hb_epcontextsrf: Python ----------
"""
prepare shading/context geometries

    Args:
        northVectorOrRotation: A vector that shows North or a number that shows
                               the rotation of the North from the Y axis
        bldgMasses: List of closed Breps as thermal zones.
    Returns:
        report: ...
        thermalZones: Thermal zone's geometries for visualiza
"""

ghenv.Component.Name = 'Honeybee EP context Surfaces'
ghenv.Component.NickName = 'HB_EPContextSrf'
ghenv.Component.Message = 'VER 0.0.59\nJAN_26_2016'
ghenv.Component.IconDisplayMode = ghenv.Component.IconDisplayMode.application
ghenv.Component.Category = "Honeybee"
ghenv.Component.SubCategory = "09 | Energy | Energy"
#compatibleHBVersion = VER 0.0.57\nNOV_01_2015
#compatibleLBVersion = VER 0.0.59\nFEB_01_2015
ghenv.Component.AdditionalHelpFromDocStrings = "2"

import rhinoscriptsyntax as rs
import Rhino as rc
import scriptcontext as sc
import os
import System
import Grasshopper.Kernel as gh
import uuid

tolerance = sc.doc.ModelAbsoluteTolerance
import math


def main(shdSurfaces, EPTransSchedule, meshingSettings, justBoundingBox):
    
    # import the classes
    if sc.sticky.has_key('honeybee_release'):

        try:
            if not sc.sticky['honeybee_release'].isCompatible(ghenv.Component): return -1
            if sc.sticky['honeybee_release'].isInputMissing(ghenv.Component): return -1
        except:
            warning = "You need a newer version of Honeybee to use this compoent." + \
            " Use updateHoneybee component to update userObjects.\n" + \
            "If you have already updated userObjects drag Honeybee_Honeybee component " + \
            "into canvas and try again."
            w = gh.GH_RuntimeMessageLevel.Warning
            ghenv.Component.AddRuntimeMessage(w, warning)
            return -1
        
        # don't customize this part
        hb_EPSrf = sc.sticky["honeybee_EPSurface"]
        hb_EPSHDSurface = sc.sticky["honeybee_EPShdSurface"]
        hb_RADMaterialAUX = sc.sticky["honeybee_RADMaterialAUX"]
        hb_EPObjectsAux = sc.sticky["honeybee_EPObjectsAUX"]()
        HBScheduleList = sc.sticky["honeybee_ScheduleLib"].keys()

        ########################################################################
        #----------------------------------------------------------------------#
        shdBreps = []
        # create bounding box of shading geometries
        if justBoundingBox:
            for brep in shdSurfaces:
                if brep.Faces.Count>1 or not brep.Faces[0].IsPlanar(sc.doc.ModelAbsoluteTolerance):
                    shdBreps.append(brep.GetBoundingBox(True).ToBrep())
                else:
                    shdBreps.append(brep)
        else:
            shdBreps = shdSurfaces
        
        shadingClasses = []
        shadingMeshPreview = []
        
        if meshingSettings == None:
            mp = rc.Geometry.MeshingParameters.Minimal
            mp.SimplePlanes = True
        else:
            mp = meshingSettings
        
        def getRadMaterialName(radMaterial):
            nameStr = radMaterial.split(" ")[2]
            name =  nameStr.split("\n")[0]
            return name
        
        for brepCount, brep in enumerate(shdBreps):
            if brep != None:
                isPlanar = True
                # check planarity
                for face in brep.Faces:
                    if not face.IsPlanar(tolerance):
                        isPlanar = False
                        break
                
                shadingBreps = []
                if not isPlanar:
                    meshArray = rc.Geometry.Mesh.CreateFromBrep(brep, mp)
                    for mesh in meshArray:
                        for meshFace in range(mesh.Faces.Count):
                            vertices = list(mesh.Faces.GetFaceVertices(meshFace))[1:]
                            vertices = vertices + [sc.doc.ModelAbsoluteTolerance]
                            # create the brep from mesh
                            shdBrep = rc.Geometry.Brep.CreateFromCornerPoints(*vertices)
                            shadingBreps.append(shdBrep)
                else:
                    for face in brep.Faces:
                        shadingBreps.append(face.DuplicateFace(False))
                
                for faceCount, shdBrep in enumerate(shadingBreps):
                        thisShading = hb_EPSHDSurface(shdBrep, 1000*brepCount + faceCount, 'shdSrf_' + `brepCount` + '_' + `faceCount` + "_" + str(uuid.uuid4()))
                        
                        # add transmittance schedule if any
                        if EPTransSchedule!=None:
                            schedule= EPTransSchedule.upper()
                            if schedule!=None and not schedule.lower().endswith(".csv") and schedule not in HBScheduleList:
                                msg = "Cannot find " + schedule + " in Honeybee schedule library."
                                print msg
                                ghenv.Component.AddRuntimeMessage(gh.GH_RuntimeMessageLevel.Warning, msg)
                                return -1
                            elif schedule!=None and schedule.lower().endswith(".csv"):
                                # check if csv file is existed
                                if not os.path.isfile(schedule):
                                    msg = "Cannot find the shchedule file: " + schedule
                                    print msg
                                    ghenv.Component.AddRuntimeMessage(gh.GH_RuntimeMessageLevel.Warning, msg)
                                    return -1
                            
                            thisShading.TransmittanceSCH = schedule
                        
                        # add the Rad Material if any
                        if RADMaterial!=None:
                            # if it is just the name of the material make sure it is already defined
                            if len(RADMaterial.split(" ")) == 1:
                                # if the material is not in the library add it to the library
                                if not hb_RADMaterialAUX.isMatrialExistInLibrary(RADMaterial):
                                    warningMsg = "Can't find " + RADMaterial + " in RAD Material Library.\n" + \
                                                "Add the material to the library and try again."
                                    ghenv.Component.AddRuntimeMessage(gh.GH_RuntimeMessageLevel.Warning, warningMsg)
                                    return
                                
                                try:
                                    thisShading.setRADMaterial(RADMaterial)
                                except Exception, e:
                                    print e
                                    warningMsg = "You are using an old version of Honeybee_Honeybee! Update your files and try again."
                                    print warningMsg
                                    ghenv.Component.AddRuntimeMessage(gh.GH_RuntimeMessageLevel.Warning, warningMsg)
                                    return
                                
                                addedToLib = True
                            else:
                                
                                # try to add the material to the library
                                addedToLib, thisShading.RadMaterial = hb_RADMaterialAUX.analyseRadMaterials(RADMaterial, True)
                                
                            if addedToLib==False:
                                warningMsg = "Failed to add " + RADMaterial + " to the Library."
                                ghenv.Component.AddRuntimeMessage(gh.GH_RuntimeMessageLevel.Warning, warningMsg)
                                return
                        
                        # add shading to the list
                        shadingClasses.append(thisShading)
                
        # add to the hive
        hb_hive = sc.sticky["honeybee_Hive"]()
        HBContext  = hb_hive.addToHoneybeeHive(shadingClasses, ghenv.Component.InstanceGuid.ToString())
        return HBContext
        ################################################################################################
    else:
        print "You should first let Honeybee to fly..."
        w = gh.GH_RuntimeMessageLevel.Warning
        ghenv.Component.AddRuntimeMessage(w, "You should first let Honeybee to fly...")
        return -1
        

if _shdSurfaces and _shdSurfaces[0]!=None:
    # add cleaning function
    result= main(_shdSurfaces, EPTransSchedule_, meshingSettings_, justBoundingBox_)
    
    if result != -1: HBContext = result
# ---------- end hb_epcontextsrf ----------
preview_8 = CustomPreview(Geometry=wires_6, Shader=ColourSwatch(SwatchColor=RGBA(0, 0, 0, 194)))

# ----
# infiltration rate
# infiltration rate
ach2m3_s_m2_calculator = HoneybeeInfORventPerAreaCalculator(HBZones=flatten(setepzoneundergroundcnstr), airChangeHour=Slider(2, range=0..10))  # -> out, infORventPerArea, allFloors; plug-in component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
setepzoneloads = Honeybee_SetEnergyPlusZoneLoads(HBZones=flatten(setepzoneundergroundcnstr), infiltrationRatePerArea=ach2m3_s_m2_calculator.infORventPerArea)  # -> loads, HBZones; plug-in component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

srf = Surface([<surface referenced from the Rhino model> x11])
createhbsrfs_19 = Honeybee_createHBSrfs(geometry=srf)  # -> readMe, simplify(HBSurface); plug-in component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
createhbsrfs_20 = Honeybee_createHBSrfs()  # -> readMe, simplify(HBSurface); plug-in component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
toggle_5 = BooleanToggle(True)
panel_48 = Panel("https://www.energyplus.net/weather-download/north_and_central_america_wmo_region_4/USA/PA/USA_PA_Philadelphia.Intl.AP.724080_TMY3/all")
epoutput = Honeybee_GenerateEPOutput(zoneGainsAndLosses=toggle_5, zoneComfortMetrics=toggle_5, surfaceTempAnalysis="False")  # -> report, flatten(simulationOutputs); plug-in component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

panel_49 = Panel("C:\Users\Administrator\Documents\GitHub\hydra_1")  # disabled
panel_50 = Panel("Honeybee Annual Daylight Simulation Example")  # disabled
panel_51 = Panel("This file shows the minimum steps to set up a daylight model for a room in Honeybee. This example uses mass2zones component to prepare the geometries however you can create the geometries surface by surface using createHBSurface.")  # disabled
panel_52 = Panel("""Grasshopper
Daylighting
Annual
Radiance
Daysim
Honeybee
HBExampleFiles""")  # disabled
toggle_6 = BooleanToggle(False)  # disabled
exporthydra = Hydra_ExportFile(fileName=panel_50, fileDescription=panel_51, fileTags=panel_52, targetFolder=panel_49, export=toggle_6)  # -> readMe; inputs fileDescription: list, changeLog: list, fileTags: list, includeRhino: Boolean, GHForThumb: Boolean, additionalImgs: list, export: Boolean; disabled; plug-in component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

epw_stat_3 = Ladybug_OpenEPWAndSTATWeatherFiles(weatherFileURL=panel_48)  # -> epwFile, statFile; plug-in component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
rep = ReplaceText(Text="base_case", Find=" ", Replace="_", RecursiveReplace=False)
path_2 = FilePath(epw_stat_3.epwFile)

panel_53 = Panel("年平均小时温度12.75摄氏度")
panel_54 = Panel("年平均小时湿度65.9摄氏度")
panel_55 = Panel("https://www.energyplus.net/weather-download/north_and_central_america_wmo_region_4/USA/PA/USA_PA_Philadelphia.Intl.AP.724080_TMY3/all")
panel_56 = Panel("https://www.energyplus.net/weather-download/north_and_central_america_wmo_region_4/USA/PA/USA_PA_Philadelphia.Intl.AP.724080_TMY3/all")
epw_stat_4 = Ladybug_OpenEPWAndSTATWeatherFiles(weatherFileURL=panel_55)  # -> epwFile, statFile; plug-in component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
epw_stat_5 = Ladybug_OpenEPWAndSTATWeatherFiles(weatherFileURL=panel_56)  # -> epwFile, statFile; plug-in component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
importepw_3 = Ladybug_ImportEpw(epwFile=epw_stat_4.epwFile)  # -> readMe, latitude, location, dryBulbTemperature, dewPointTemperature, relativeHumidity, windSpeed, windDirection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; plug-in component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
importepw_4 = Ladybug_ImportEpw(epwFile=epw_stat_5.epwFile)  # -> readMe, latitude, location, dryBulbTemperature, dewPointTemperature, relativeHumidity, windSpeed, windDirection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; plug-in component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
panel_57 = Panel(importepw_3.location)
strnum_5 = Ladybug_SeparateData(inputList=flatten(importepw_3.dryBulbTemperature))  # -> numbers, strings; plug-in component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
panel_58 = Panel(importepw_4.location)
strnum_6 = Ladybug_SeparateData(inputList=flatten(importepw_4.relativeHumidity))  # -> numbers, strings; plug-in component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
panel_59 = Panel(strnum_5.numbers)
panel_60 = Panel(strnum_6.numbers)
ma = MassAddition(Input=panel_59)  # -> Result, PartialResults
ma_2 = MassAddition(Input=panel_60)  # -> Result, PartialResults
panel_61 = Panel(ma.Result)
panel_62 = Panel(ma_2.Result)
division = Division(A=panel_61, B="8760")
division_2 = Division(A=panel_62, B="8760")
panel_63 = Panel(division)
panel_64 = Panel(division_2)

runenergysimulation = Honeybee_RunEnergySimulation(
    epwFile=path_2,
    HBZones=flatten(setepzoneloads.HBZones),
    HBContext=flatten(hb_epcontextsrf),
    simulationOutputs=flatten(epoutput.simulationOutputs),
    writeIdf=run_energyplus,
    runEnergyPlus=run_energyplus,
    idfFileName=rep)  # -> report, idfFileAddress, resultFileAddress; plug-in component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
panel_65 = Panel(runenergysimulation.idfFileAddress)
readepresult = Honeybee_ReadEPResult(resultFileAddress=runenergysimulation.resultFileAddress)  # -> totalThermalLoad, thermalLoadBalance, cooling, heating, electricLight, electricEquip, fanElectric, pumpElectric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; plug-in component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
importepw_5 = Ladybug_ImportEpw(epwFile=path_2)  # -> readMe, latitude, location, dryBulbTemperature, dewPointTemperature, relativeHumidity, windSpeed, windDirection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; plug-in component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
adaptivecomfortcalculator = Ladybug_AdaptiveComfortCalculator(
    dryBulbTemperature=readepresult.airTemperature,
    meanRadiantTemperature=readepresult.meanRadTemperature,
    prevailingOutdoorTemp=importepw_5.dryBulbTemperature,
    runIt=Toggle(True))  # -> readMe, port, comfortableOrNot, conditionOfPerson, degreesFromTarget, port_2, targetTemperature, upperTemperatureBound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; plug-in component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
legendpar_6 = Ladybug_LegendParameters(lowBound="-1", highBound="1", numSegments="3")  # -> legendPar; plug-in component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
vec = VectorXYZ(XComponent="20", YComponent="35", ZComponent=0)  # -> Vector, Length
pt_6 = Point(Point(23.10617158, 0, 0))
move = Move(Geometry=pt_6, Motion=vec.Vector)  # -> Geometry, Transform
panel_66 = Panel("""Comfortable (%): 
hot (%):         
cold (%):        """)
comfortable_hot_cold = Panel([adaptivecomfortcalculator.percentOfTimeComfortable, adaptivecomfortcalculator.percentHotCold])
psychchart_2 = Ladybug_PsychrometricChart(
    dryBulbTemperature=readepresult.airTemperature,
    relativeHumidity=readepresult.relativeHumidity,
    basePoint=move.Geometry,
    runIt=Toggle(True))  # -> readMe, port, totalComfortPercent, totalComfortOrNot, strategyNames, strategyPercentOfTime, strategyOrNot, port_2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; plug-in component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
_3dchart_6 = Ladybug_3DChart(
    inputData=flatten(adaptivecomfortcalculator.conditionOfPerson),
    basePoint=pt_6,
    xScale=".025",
    yScale="0.125",
    zScale=Slider(0, range=0..100),
    legendPar=legendpar_6)  # -> readMe, graphMesh, graphCurves, legend, legendBasePts, title, titleBasePts, dataPts, conditionalHOY; plug-in component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
num = Number(comfortable_hot_cold)
expression = Expression(x=num, Expression="Round(x, 2)")
flip = FlipMatrix(Data=panel_66)  # -> simplify(Data)
flip_2 = FlipMatrix(Data=expression)  # -> simplify(Data)
panel_67 = Panel([flip, flip_2])
join_2 = TextJoin(Text=panel_67)
join_3 = TextJoin(Text=flatten(join_2))
pt_7 = Point(Point(-17, 4, 0))
tag = TextTag3D(Location=pt_7, Text=join_3, Size=1, Colour=ColourSwatch(SwatchColor=RGB(0, 0, 0)), Justification=5)

# ----
# Glass material
panel_68 = Panel("tvis_60")
radopaquematerial_4 = Honeybee_RadianceOpaqueMaterial(materialName="generic_35", RReflectance=".35", GReflectance=".35", BReflectance=".35", roughness=0.05, specularity=0)  # -> avrgRef, RADMaterial; plug-in component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
radglassmaterial_4 = Honeybee_RadianceGlassMaterial(materialName=panel_68, RTransmittance="0.6", GTransmittance="0.6", BTransmittance="0.6", refractiveIndex=1.52)  # -> avrgTrans, RADMaterial; plug-in component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
preview_9 = CustomPreview(Geometry=createhbsrfs_16.HBSurface, Shader=ColourSwatch(SwatchColor=RGBA(153, 70, 70, 208)))

createhbsrfs_21 = Honeybee_createHBSrfs(geometry=brep_4, RADMaterial=radglassmaterial_4.RADMaterial)  # -> readMe, simplify(HBSurface); plug-in component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
createhbsrfs_22 = Honeybee_createHBSrfs(geometry=brep_2, srfType=Slider(2, range=0..10))  # -> readMe, simplify(HBSurface); plug-in component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
createhbsrfs_23 = Honeybee_createHBSrfs(geometry=wall, srfType=Slider(1, range=0..1))  # -> readMe, simplify(HBSurface); plug-in component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

preview_10 = CustomPreview(Geometry=createhbsrfs_22.HBSurface, Shader=ColourSwatch(SwatchColor=RGBA(129, 150, 235, 74)))
brep_20 = Brep(flatten([createhbsrfs_22.HBSurface, createhbsrfs_16.HBSurface, createhbsrfs_23.HBSurface, createhbsrfs_17.HBSurface, createhbsrfs_21.HBSurface, createhbsrfs_18.HBSurface]))
panel_69 = Panel(brep_20)
wires_7 = BrepWireframe(Brep=brep_20, Density=-1)

# ----
# Visualize the results
# Generate annual results
# Anuual Daylight simulation
toggle_7 = BooleanToggle(True)
# Test Geometry Anuual Daylight simulation
number_slider_29 = Slider(0.3, range=0..1)
panel_70 = Panel("https://www.energyplus.net/weather-download/north_and_central_america_wmo_region_4/USA/PA/USA_PA_Philadelphia.Intl.AP.724080_TMY3/all")
gentestpts_2 = Honeybee_GenerateTestPoints(
    testGeometry=[brep_13, brep_9, brep_5, brep_2],
    gridSize=number_slider_29,
    distBaseSrf=Slider(0.762, range=0..1),
    moveTestMesh=toggle_7)  # -> readMe, simplify(testPoints), simplify(ptsVectors), simplify(facesArea), simplify(mesh); plug-in component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
epw_stat_6 = Ladybug_OpenEPWAndSTATWeatherFiles(weatherFileURL=panel_70)  # -> epwFile, statFile; plug-in component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
annualdaylightsimulation = Honeybee_AnnualDaylightSimulation(
    epwWeatherFile=epw_stat_6.epwFile,
    testPoints=flatten(gentestpts_2.testPoints),
    ptsVectors=flatten(gentestpts_2.ptsVectors),
    testMesh=flatten(gentestpts_2.mesh))  # -> analysisRecipe; plug-in component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
toggle_8 = BooleanToggle(True)
rundaylightanalysis_2 = Honeybee_RunDaylightSimulation(
    HBObjects=flatten([brep_16, brep_12, brep_8, brep_20]),
    analysisRecipe=annualdaylightsimulation,
    writeRad=toggle_8,
    runRad=toggle_8,
    numOfCPUs=Slider(8, range=0..10),
    overwriteResults=True)  # -> readMe, analysisType, resultsUnit, results, testPts, annual_analysis_files, radGeoFile, studyFolder, done; plug-in component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
occupancygenerator = Honeybee_DaysimOccupancyGenerator(weekendDays=[1, 2], writeTheOcc=Toggle(True))  # -> occupancyFile; plug-in component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
panel_71 = Panel(rundaylightanalysis_2.annual_analysis_files)
readannualresultsi = Honeybee_ReadAnnualResultI(
    illFilesAddress=rundaylightanalysis_2.annual_analysis_files,
    testPoints=simplify(rundaylightanalysis_2.testPts),
    occupancyFiles=occupancygenerator,
    DLAIllumThresholds=300,
    runIt=Toggle(True))  # -> DLA, UDLI_Less_100, UDLI_100_2000, UDLI_More_2000, CDA, sDA, annualProfiles, htmReport; plug-in component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
gradientlibrary_5 = Ladybug_GradientLibrary(gradIndex=Slider(0, range=0..10))  # -> customColors; plug-in component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
panel_72 = Panel(readannualresultsi.UDLI_100_2000)
panel_73 = Panel(readannualresultsi.annualProfiles)
legendpar_7 = Ladybug_LegendParameters(
    lowBound=Slider(0, range=0..100),
    highBound=Slider(100, range=0..100),
    numSegments=Slider(11, range=0..11),
    customColors=gradientlibrary_5)  # -> legendPar; plug-in component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
panel_74 = Panel(readannualresultsi.htmReport)
concat_2 = Concatenate(FragmentA=rundaylightanalysis_2.analysisType, FragmentB="(sDA:", FragmentC=readannualresultsi.sDA, FragmentD=")")
panel_75 = Panel(concat_2)

# ---- group: make it 3D!
dom = ConstructDomain(DomainStart=0, DomainEnd=Slider(1, range=0..1))

# ----
recolormesh_2 = Ladybug_RecolorMesh(
    analysisResult=readannualresultsi.UDLI_More_2000,
    inputMesh=gentestpts_2.mesh,
    heightDomain=dom,
    legendPar=legendpar_7,
    analysisTitle=concat_2,
    legendTitle="%")  # -> readMe, newMesh, newLegend, legendBasePt, meshColors, legendColors; plug-in component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

# ----
# Blinds
# Construction
# Thermal Mass
ladybug_3 = Ladybug_Ladybug()  # -> Vviiiiiiiiiizzz; plug-in component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
honeybee_3 = Honeybee_Honeybee()  # -> Vviiiiiiiiiizzz; plug-in component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
run_energyplus_2 = BooleanToggle(True)
list_8 = ValueList({"Existing Slab Construction": "0", "+4 Inches Concrete": "1", "+8 Inches Concrete": "2"}, selected="+4 Inches Concrete")
volume_2 = Volume(Geometry=addhbglz)  # -> Volume, Centroid
rotatehbobj_2 = Honeybee_RotateHoneybee(HBObj=addhbglz, angle=Slider(0, range=-90..180), cenPt=volume_2.Centroid)  # -> HBObj; plug-in component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
wires_8 = BrepWireframe(Brep=rotatehbobj_2, Density=-1)
filter_2 = StreamFilter(Gate=list_8, Stream0=panel_31, Stream1=epconstruction_2, Stream2=epconstruction)
setepzonecnstr_2 = Honeybee_SetEPZoneConstruction(HBZone=rotatehbobj_2, wallEPConstruction=list_3, windowEPConstruction=list, roofEPConstruction=list_2)  # -> simplify(modifiedHBZone); plug-in component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
setepzoneundergroundcnstr_2 = Honeybee_SetEPZoneUndergroundConstruction(HBZone=flatten(setepzonecnstr_2), groundFloorEPConstruction=filter_2)  # -> simplify(modifiedHBZone); plug-in component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
toggle_9 = BooleanToggle(True)
panel_76 = Panel("https://www.energyplus.net/weather-download/north_and_central_america_wmo_region_4/USA/PA/USA_PA_Philadelphia.Intl.AP.724080_TMY3/all")
epoutput_2 = Honeybee_GenerateEPOutput(zoneGainsAndLosses=toggle_9, zoneComfortMetrics=toggle_9, surfaceTempAnalysis="False")  # -> report, flatten(simulationOutputs); plug-in component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
epw_stat_7 = Ladybug_OpenEPWAndSTATWeatherFiles(weatherFileURL=panel_76)  # -> epwFile, statFile; plug-in component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
rep_2 = ReplaceText(Text="base_case", Find=" ", Replace="_", RecursiveReplace=False)
path_3 = FilePath(epw_stat_7.epwFile)
importepw_6 = Ladybug_ImportEpw(epwFile=path_3)  # -> readMe, latitude, location, dryBulbTemperature, dewPointTemperature, relativeHumidity, windSpeed, windDirection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; plug-in component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
legendpar_8 = Ladybug_LegendParameters(lowBound="-1", highBound="1", numSegments="3")  # -> legendPar; plug-in component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
vec_2 = VectorXYZ(XComponent="20", YComponent="35", ZComponent=0)  # -> Vector, Length
pt_8 = Point(Point(24, 69, 0))
move_2 = Move(Geometry=pt_8, Motion=vec_2.Vector)  # -> Geometry, Transform
panel_77 = Panel("""Comfortable (%): 
hot (%):         
cold (%):        """)
flip_3 = FlipMatrix(Data=panel_77)  # -> simplify(Data)
pt_9 = Point(Point(-17, 4, 0))

decomposebytype_3 = Honeybee_DecomposeBasedOnType(HBZone=setepzoneundergroundcnstr_2)  # -> walls, interiorWalls, airWalls, windows, interiorWindows, skylights, roofs, ceilings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; plug-in component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
shddesigner_2 = Ladybug_ShadingDesigner(
    glzSrf=flatten(decomposebytype_3.windows),
    depthOrVector=flatten(shading_depth),
    numOfShds=number_of_blinds,
    runIt=add_blinds,
    port_4=False)  # -> readMe, shadingSrfs; plug-in component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
wires_9 = BrepWireframe(Brep=shddesigner_2.shadingSrfs, Density=-1)
preview_11 = CustomPreview(Geometry=wires_9, Shader=ColourSwatch(SwatchColor=RGBA(0, 0, 0, 194)))
hb_epcontextsrf_2 = HoneybeeEPContextSurfaces(shdSurfaces=flatten(createhbsrfs_19.HBSurface))  # -> HBContext; inputs shdSurfaces: list of Brep, justBoundingBox: Boolean; same code as hb_epcontextsrf

ach2m3_s_m2_calculator_2 = HoneybeeInfORventPerAreaCalculator(HBZones=flatten(setepzoneundergroundcnstr_2), airChangeHour=Slider(2, range=0..10))  # -> out, infORventPerArea, allFloors; plug-in component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
setepzoneloads_2 = Honeybee_SetEnergyPlusZoneLoads(HBZones=flatten(setepzoneundergroundcnstr_2), infiltrationRatePerArea=ach2m3_s_m2_calculator_2.infORventPerArea)  # -> loads, HBZones; plug-in component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

runenergysimulation_2 = Honeybee_RunEnergySimulation(
    epwFile=path_3,
    HBZones=flatten(setepzoneloads_2.HBZones),
    HBContext=flatten(hb_epcontextsrf_2),
    simulationOutputs=flatten(epoutput_2.simulationOutputs),
    writeIdf=run_energyplus_2,
    runEnergyPlus=run_energyplus_2,
    idfFileName=rep_2)  # -> report, idfFileAddress, resultFileAddress; plug-in component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
panel_78 = Panel(runenergysimulation_2.idfFileAddress)
readepresult_2 = Honeybee_ReadEPResult(resultFileAddress=runenergysimulation_2.resultFileAddress)  # -> port, port_2, port_3, port_4, port_5, port_6, port_7, port_8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; plug-in component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
adaptivecomfortcalculator_2 = Ladybug_AdaptiveComfortCalculator(
    dryBulbTemperature=readepresult_2.airTemperature,
    meanRadiantTemperature=readepresult_2.meanRadTemperature,
    prevailingOutdoorTemp=importepw_6.dryBulbTemperature,
    runIt=Toggle(True))  # -> readMe, port, comfortableOrNot, conditionOfPerson, degreesFromTarget, port_2, targetTemperature, upperTemperatureBound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; plug-in component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
comfortable_hot_cold_2 = Panel([adaptivecomfortcalculator_2.percentOfTimeComfortable, adaptivecomfortcalculator_2.percentHotCold])
psychchart_3 = Ladybug_PsychrometricChart(
    dryBulbTemperature=readepresult_2.airTemperature,
    relativeHumidity=readepresult_2.relativeHumidity,
    basePoint=move_2.Geometry,
    runIt=Toggle(True))  # -> readMe, port, totalComfortPercent, totalComfortOrNot, strategyNames, strategyPercentOfTime, strategyOrNot, port_2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; plug-in component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
_3dchart_7 = Ladybug_3DChart(
    inputData=flatten(adaptivecomfortcalculator_2.conditionOfPerson),
    basePoint=pt_8,
    xScale=".025",
    yScale="0.125",
    zScale=Slider(0, range=0..100),
    legendPar=legendpar_8)  # -> readMe, graphMesh, graphCurves, legend, legendBasePts, title, titleBasePts, dataPts, conditionalHOY; plug-in component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
num_2 = Number(comfortable_hot_cold_2)
expression_2 = Expression(x=num_2, Expression="Round(x, 2)")
flip_4 = FlipMatrix(Data=expression_2)  # -> simplify(Data)
panel_79 = Panel([flip_3, flip_4])
join_4 = TextJoin(Text=panel_79)
join_5 = TextJoin(Text=flatten(join_4))
tag_2 = TextTag3D(Location=pt_9, Text=join_5, Size=1, Colour=ColourSwatch(SwatchColor=RGB(0, 0, 0)), Justification=5)

honeybee_4 = Honeybee_Honeybee()  # -> Vviiiiiiiiiizzz; disabled; plug-in component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
# Honey Bee Zone Anuual Daylight simulation
ladybug_4 = Ladybug_Ladybug()  # -> Vviiiiiiiiiizzz; disabled; plug-in component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
brep_21 = Brep(<brep referenced from the Rhino model>)  # disabled
toggle_10 = BooleanToggle(True)  # disabled
number_slider_30 = Slider(0.6, range=0..1)  # disabled
mass2zone_3 = Honeybee_Masses2Zones(zoneMasses=flatten(brep_21), isConditioned=True, maxRoofAngle=30, createHBZones=toggle_10)  # -> readMe, HBZones; disabled; plug-in component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
glzparamlist_2 = Honeybee_GlazingParametersList(northGlzParam=number_slider_30, westGlzParam=0, southGlzParam=0, eastGlzParam=0)  # -> glzParamList; disabled; plug-in component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
toggle_11 = BooleanToggle(True)  # disabled
glazingcreator_2 = Honeybee_GlazingBasedOnRatio(HBObjects=mass2zone_3.HBZones, glzRatio=glzparamlist_2, runIt=toggle_11)  # -> readMe, HBObjWGLZ; disabled; plug-in component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
number_slider_31 = Slider(0.762, range=0..1)  # disabled
number_slider_32 = Slider(0.5, range=0..1)  # disabled
panel_80 = Panel("https://www.energyplus.net/weather-download/north_and_central_america_wmo_region_4/USA/PA/USA_PA_Philadelphia.Intl.AP.724080_TMY3/all")  # disabled
toggle_12 = BooleanToggle(True)  # disabled
epw_stat_8 = Ladybug_OpenEPWAndSTATWeatherFiles(weatherFileURL=panel_80)  # -> epwFile, statFile; disabled; plug-in component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
toggle_13 = BooleanToggle(True)  # disabled
toggle_14 = BooleanToggle(True)  # disabled
occupancygenerator_2 = Honeybee_DaysimOccupancyGenerator(weekendDays=[1, 2], writeTheOcc=toggle_14)  # -> occupancyFile; disabled; plug-in component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
toggle_15 = BooleanToggle(True)  # disabled
number_slider_33 = Slider(0, range=0..10)  # disabled
number_slider_34 = Slider(100, range=0..100)  # disabled
number_slider_35 = Slider(0, range=0..100)  # disabled
number_slider_36 = Slider(6, range=0..10)  # disabled
gradientlibrary_6 = Ladybug_GradientLibrary(gradIndex=number_slider_33)  # -> customColors; disabled; plug-in component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
number_slider_37 = Slider(1, range=0..1)  # disabled
legendpar_9 = Ladybug_LegendParameters(
    lowBound=number_slider_35,
    highBound=number_slider_34,
    numSegments=number_slider_36,
    customColors=flatten(gradientlibrary_6))  # -> legendPar; disabled; plug-in component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
panel_81 = Panel("%")  # disabled

# ---- group: HB Zone With Glazing
brep_22 = Brep(glazingcreator_2.HBObjWGLZ)  # disabled

# ---- group: make it 3D!
dom_2 = ConstructDomain(DomainStart=0, DomainEnd=number_slider_37)  # disabled

# ----
genhbzonetestpts = Honeybee_GenerateZoneTestPoints(HBZone=brep_22, gridSize=number_slider_32, distBaseSrf=number_slider_31, moveTestMesh=toggle_12)  # -> readMe, simplify(testPoints), simplify(ptsVectors), simplify(facesArea), simplify(mesh); disabled; plug-in component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
wires_10 = BrepWireframe(Brep=brep_22, Density=-1)  # disabled
annualdaylightsimulation_2 = Honeybee_AnnualDaylightSimulation(
    epwWeatherFile=epw_stat_8.epwFile,
    testPoints=genhbzonetestpts.testPoints,
    ptsVectors=genhbzonetestpts.ptsVectors,
    testMesh=genhbzonetestpts.mesh)  # -> analysisRecipe; disabled; plug-in component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
rundaylightanalysis_3 = Honeybee_RunDaylightSimulation(
    HBObjects=flatten(brep_22),
    analysisRecipe=annualdaylightsimulation_2,
    writeRad=toggle_13,
    runRad=toggle_13,
    overwriteResults=True)  # -> readMe, analysisType, resultsUnit, results, testPts, annual_analysis_files, radGeoFile, studyFolder, done; disabled; plug-in component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
readannualresultsi_2 = Honeybee_ReadAnnualResultI(
    illFilesAddress=rundaylightanalysis_3.annual_analysis_files,
    testPoints=simplify(rundaylightanalysis_3.testPts),
    occupancyFiles=occupancygenerator_2,
    DLAIllumThresholds=300,
    runIt=toggle_15)  # -> DLA, UDLI_Less_100, UDLI_100_2000, UDLI_More_2000, CDA, sDA, annualProfiles, htmReport; disabled; plug-in component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
panel_82 = Panel(readannualresultsi_2.sDA)  # disabled
recolormesh_3 = Ladybug_RecolorMesh(
    analysisResult=readannualresultsi_2.UDLI_More_2000,
    inputMesh=genhbzonetestpts.mesh,
    heightDomain=dom_2,
    legendPar=legendpar_9,
    analysisTitle=rundaylightanalysis_3.analysisType,
    legendTitle=panel_81)  # -> readMe, newMesh, newLegend, legendBasePt, meshColors, legendColors; disabled; plug-in component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
