# Grasshopper definition XIAORAN_LIU_outdoor_shading.gh (Grasshopper 0.9.76)
# plug-ins: Python Interpreter

panel = Panel("https://www.energyplus.net/weather-download/north_and_central_america_wmo_region_4/USA/PA/USA_PA_Philadelphia.Intl.AP.724080_TMY3/all")
ladybug = Ladybug_Ladybug()  # -> Vviiiiiiiiiizzz; plug-in component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
epw_stat = Ladybug_OpenEPWAndSTATWeatherFiles(weatherFileURL=panel)  # -> epwFile, statFile; plug-in component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
importepw = Ladybug_ImportEpw(epwFile=epw_stat.epwFile)  # -> readMe, latitude, location, dryBulbTemperature, dewPointTemperature, relativeHumidity, windSpeed, windDirection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; plug-in component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
analysisperiod = Ladybug_AnalysisPeriod()  # -> readMe, analysisPeriod; plug-in component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
analysisperiod_2 = Ladybug_AnalysisPeriod()  # -> readMe, analysisPeriod; plug-in component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
line = Line(Line((-102.3446363, 324.5902896, -257.2096947), (-101.9729119, 327.617742, -257.2096947)))
analysisperiod_3 = Ladybug_AnalysisPeriod()  # -> readMe, analysisPeriod; plug-in component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
brep = Brep([<brep referenced from the Rhino model> x2])
line_2 = Line(Line((-102.3446363, 324.5902896, -257.2096947), (-101.9729119, 327.617742, -257.2096947)))
vec = Vector(line)
brep_2 = Brep([<brep referenced from the Rhino model> x2])
area = Area(Geometry=brep)  # -> Area, Centroid
vec_2 = Vector(line_2)
unit = UnitVector(Vector=vec)
toggle = BooleanToggle(True)
brep_3 = Brep([<brep referenced from the Rhino model> x2])
area_2 = Area(Geometry=brep_2)  # -> Area, Centroid
unit_2 = UnitVector(Vector=vec_2)
toggle_2 = BooleanToggle(True)
brep_4 = Brep([<brep referenced from the Rhino model> x3])
toggle_3 = BooleanToggle(True)
solaradjusttemperature = Ladybug_OutdoorSolarTemperatureAdjustor(
    location=importepw.location,
    cumSkyMtxOrDirNormRad=importepw.directNormalRadiation,
    diffuseHorizRad=importepw.diffuseHorizontalRadiation,
    baseTemperature=importepw.dryBulbTemperature,
    baseDryBulbOrMRT=Toggle(True),
    horizInfraredRad=importepw.horizontalInfraredRadiation,
    bodyLocation=area.Centroid,
    contextShading=brep_3,
    north=unit,
    analysisPeriodOrHOY=analysisperiod_2.analysisPeriod,
    parallel=toggle,
    runIt=toggle)  # -> readMe, port, effectiveRadiantField, MRTDelta, solarAdjustedMRT, port_2, mannequinMesh, port_3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; plug-in component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
solaradjusttemperature_2 = Ladybug_OutdoorSolarTemperatureAdjustor(
    location=importepw.location,
    cumSkyMtxOrDirNormRad=importepw.directNormalRadiation,
    diffuseHorizRad=importepw.diffuseHorizontalRadiation,
    baseTemperature=importepw.dryBulbTemperature,
    baseDryBulbOrMRT=Toggle(True),
    horizInfraredRad=importepw.horizontalInfraredRadiation,
    bodyLocation=area_2.Centroid,
    contextShading=brep_4,
    north=unit_2,
    analysisPeriodOrHOY=analysisperiod_3.analysisPeriod,
    parallel=toggle_2,
    runIt=toggle_2)  # -> readMe, port, effectiveRadiantField, MRTDelta, solarAdjustedMRT, port_2, mannequinMesh, port_3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; plug-in component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
solaradjusttemperature_3 = Ladybug_OutdoorSolarTemperatureAdjustor(
    location=importepw.location,
    cumSkyMtxOrDirNormRad=importepw.directNormalRadiation,
    diffuseHorizRad=importepw.diffuseHorizontalRadiation,
    baseTemperature=importepw.dryBulbTemperature,
    baseDryBulbOrMRT=Toggle(True),
    horizInfraredRad=importepw.horizontalInfraredRadiation,
    analysisPeriodOrHOY=analysisperiod.analysisPeriod,
    parallel=toggle_3,
    runIt=toggle_3)  # -> readMe, port, effectiveRadiantField, MRTDelta, solarAdjustedMRT, port_2, mannequinMesh, port_3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; plug-in component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
# With solar radiation effect
toggle_4 = BooleanToggle(True)  # disabled
# Fully Shaded
outdoorcomfortcalculator = Ladybug_OutdoorComfortCalculator(
    dryBulbTemperature=importepw.dryBulbTemperature,
    windSpeed_tenMeters=importepw.windSpeed,
    relativeHumidity=importepw.relativeHumidity,
    runIt=toggle_4)  # -> readMe, port, universalThermalClimateIndex, comfortableOrNot, thermalStress, conditionOfPerson, port_2, percentOfTimeComfortable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; disabled; plug-in component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
outdoorcomfortcalculator_2 = Ladybug_OutdoorComfortCalculator(
    dryBulbTemperature=importepw.dryBulbTemperature,
    meanRadiantTemperature=solaradjusttemperature.solarAdjustedMRT,
    windSpeed_tenMeters=importepw.windSpeed,
    relativeHumidity=importepw.relativeHumidity,
    runIt=Toggle(True))  # -> readMe, port, universalThermalClimateIndex, comfortableOrNot, thermalStress, conditionOfPerson, port_2, percentOfTimeComfortable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; plug-in component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
outdoorcomfortcalculator_3 = Ladybug_OutdoorComfortCalculator(
    dryBulbTemperature=importepw.dryBulbTemperature,
    meanRadiantTemperature=solaradjusttemperature_3.solarAdjustedMRT,
    windSpeed_tenMeters=importepw.windSpeed,
    relativeHumidity=importepw.relativeHumidity,
    runIt=Toggle(True))  # -> readMe, port, universalThermalClimateIndex, comfortableOrNot, thermalStress, conditionOfPerson, port_2, percentOfTimeComfortable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; plug-in component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
outdoorcomfortcalculator_4 = Ladybug_OutdoorComfortCalculator(
    dryBulbTemperature=importepw.dryBulbTemperature,
    meanRadiantTemperature=solaradjusttemperature_2.solarAdjustedMRT,
    windSpeed_tenMeters=importepw.windSpeed,
    relativeHumidity=importepw.relativeHumidity,
    runIt=Toggle(True))  # -> readMe, port, universalThermalClimateIndex, comfortableOrNot, thermalStress, conditionOfPerson, port_2, percentOfTimeComfortable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; plug-in component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
panel_2 = Panel([outdoorcomfortcalculator.percentOfTimeComfortable, outdoorcomfortcalculator_3.percentOfTimeComfortable, outdoorcomfortcalculator_2.percentOfTimeComfortable, outdoorcomfortcalculator_4.percentOfTimeComfortable])
panel_3 = Panel([outdoorcomfortcalculator.percentHeatStress, outdoorcomfortcalculator_3.percentHeatStress, outdoorcomfortcalculator_2.percentHeatStress, outdoorcomfortcalculator_4.percentHeatStress])
panel_4 = Panel("3")  # disabled
legendpar = Ladybug_LegendParameters(numSegments=panel_4)  # -> legendPar; disabled; plug-in component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
panel_5 = Panel("0.2")  # disabled
panel_6 = Panel("0")  # disabled
analysisperiod_4 = Ladybug_AnalysisPeriod()  # -> readMe, analysisPeriod; disabled; plug-in component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
_3dchart = Ladybug_3DChart(
    inputData=flatten([outdoorcomfortcalculator.thermalStress, outdoorcomfortcalculator_3.thermalStress, outdoorcomfortcalculator_2.thermalStress]),
    xScale=panel_5,
    zScale=panel_6,
    legendPar=legendpar)  # -> readMe, graphMesh, graphCurves, legend, legendBasePts, title, titleBasePts, dataPts, conditionalHOY; disabled; plug-in component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
number_slider = Slider(0.3, range=0..1)  # disabled
number_slider_2 = Slider(0.5, range=0..1)  # disabled
line_3 = Line(Line((-102.3446363, 324.5902896, -257.2096947), (-101.9729119, 327.617742, -257.2096947)))  # disabled
vec_3 = Vector(line_3)  # disabled
unit_3 = UnitVector(Vector=vec_3)  # disabled
number_slider_3 = Slider(7, range=0..10)  # disabled
number_slider_4 = Slider(0.5, range=0..1)  # disabled
sunpath = Ladybug_SunPath(
    north=unit,
    location=importepw.location,
    hour=12,
    day=21,
    month=12,
    timeStep=1,
    analysisPeriod=analysisperiod_4.analysisPeriod,
    centerPt=area.Centroid,
    sunPathScale=number_slider,
    sunScale=number_slider_2,
    annualHourlyData=flatten(outdoorcomfortcalculator_2.conditionOfPerson),
    legendPar=legendpar,
    dailyOrAnnualSunPath=True)  # -> readMe, sunVectors, sunAltitudes, sunAzimuths, port, sunSpheresMesh, sunPathCrvs, legend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; disabled; plug-in component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
toggle_5 = BooleanToggle(True)  # disabled
toggle_6 = BooleanToggle(True)  # disabled
brep_5 = Brep(<brep referenced from the Rhino model>)  # disabled
brep_6 = Brep([<brep referenced from the Rhino model> x2])  # disabled
comfortshadebenefit = Ladybug_ComfortShadeBenefitEvaluator(
    location=importepw.location,
    temperatures=outdoorcomfortcalculator_2.universalThermalClimateIndex,
    testShades=brep_5,
    testRegion=brep_6,
    gridSize=number_slider_4,
    north=unit_3,
    skyResolution=number_slider_3,
    delNonIntersect=False,
    parallel=toggle_5,
    runIt=toggle_6)  # -> readMe, port, sunVectors, regionTestPts, shadeMesh, legend, legendBasePoint, port_2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; disabled; plug-in component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

# ----
# Pull Out The Areas Where Shade is Most Desirable
number_slider_5 = Slider(50, range=0..100)  # disabled
meshselector = Ladybug_MeshThresholdSelector(
    inputMesh=comfortshadebenefit.shadeMesh,
    analysisResult=comfortshadebenefit.shadeNetEffect,
    percentToKeep=number_slider_5)  # -> readMe, totalValue, areaMeetsThresh, newColoredMesh, newMeshOutline; disabled; plug-in component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
panel_7 = Panel(meshselector.totalValue)  # disabled
swatch = ColourSwatch(SwatchColor=RGB(68, 191, 31))  # disabled
panel_8 = Panel(meshselector.areaMeetsThresh)  # disabled
preview = CustomPreview(Geometry=meshselector.newMeshOutline, Shader=swatch)  # disabled

mesh = Mesh(sunpath.sunSpheresMesh)  # disabled
# With solar radiation effect+Meyerson Hall Building
# With solar radiation effect
# + Meyerson Hall building+Summer Shading(without)in Summer
# With solar radiation effect
# + Meyerson Hall building+Summer Shading(without)in Winter
panel_9 = Panel("https://www.energyplus.net/weather-download/north_and_central_america_wmo_region_4/USA/PA/USA_PA_Philadelphia.Intl.AP.724080_TMY3/all")
epw_stat_2 = Ladybug_OpenEPWAndSTATWeatherFiles(weatherFileURL=panel_9)  # -> epwFile, statFile; plug-in component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
panel_10 = Panel("https://www.energyplus.net/weather-download/north_and_central_america_wmo_region_4/USA/PA/USA_PA_Philadelphia.Intl.AP.724080_TMY3/all")
# full shaded
panel_11 = Panel("https://www.energyplus.net/weather-download/north_and_central_america_wmo_region_4/USA/PA/USA_PA_Philadelphia.Intl.AP.724080_TMY3/all")
importepw_2 = Ladybug_ImportEpw(epwFile=epw_stat_2.epwFile)  # -> readMe, latitude, location, dryBulbTemperature, dewPointTemperature, relativeHumidity, windSpeed, windDirection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; plug-in component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

# ---- group: annual time
# With solar radiation effect
# + Meyerson Hall building+Summer Shading in Summer
# With solar radiation effect
# + Meyerson Hall building+Summer Shading in Winter
analysisperiod_5 = Ladybug_AnalysisPeriod()  # -> readMe, analysisPeriod; plug-in component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

analysisperiod_6 = Ladybug_AnalysisPeriod()  # -> readMe, analysisPeriod; plug-in component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

# ----
epw_stat_3 = Ladybug_OpenEPWAndSTATWeatherFiles(weatherFileURL=panel_10)  # -> epwFile, statFile; plug-in component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
epw_stat_4 = Ladybug_OpenEPWAndSTATWeatherFiles(weatherFileURL=panel_11)  # -> epwFile, statFile; plug-in component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
brep_7 = Brep([<brep referenced from the Rhino model> x2])
brep_8 = Brep([<brep referenced from the Rhino model> x2])
# With solar radiation effect
importepw_3 = Ladybug_ImportEpw(epwFile=epw_stat_3.epwFile)  # -> readMe, latitude, location, dryBulbTemperature, dewPointTemperature, relativeHumidity, windSpeed, windDirection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; plug-in component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
importepw_4 = Ladybug_ImportEpw(epwFile=epw_stat_4.epwFile)  # -> readMe, latitude, location, dryBulbTemperature, dewPointTemperature, relativeHumidity, windSpeed, windDirection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; plug-in component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
line_4 = Line(Line((-102.3446363, 324.5902896, -257.2096947), (-101.9729119, 327.617742, -257.2096947)))
line_5 = Line(Line((-102.3446363, 324.5902896, -257.2096947), (-101.9729119, 327.617742, -257.2096947)))
area_3 = Area(Geometry=brep_7)  # -> Area, Centroid
area_4 = Area(Geometry=brep_8)  # -> Area, Centroid
toggle_7 = BooleanToggle(True)
toggle_8 = BooleanToggle(True)
vec_4 = Vector(line_4)
vec_5 = Vector(line_5)
brep_9 = Brep([<brep referenced from the Rhino model> x3])
brep_10 = Brep([<brep referenced from the Rhino model> x2])
unit_4 = UnitVector(Vector=vec_4)
unit_5 = UnitVector(Vector=vec_5)
solaradjusttemperature_4 = Ladybug_OutdoorSolarTemperatureAdjustor(
    location=importepw_2.location,
    cumSkyMtxOrDirNormRad=importepw_2.directNormalRadiation,
    diffuseHorizRad=importepw_2.diffuseHorizontalRadiation,
    baseTemperature=importepw_2.dryBulbTemperature,
    baseDryBulbOrMRT=Toggle(True),
    horizInfraredRad=importepw_2.horizontalInfraredRadiation,
    bodyLocation=area_3.Centroid,
    contextShading=brep_9,
    north=unit_4,
    analysisPeriodOrHOY=analysisperiod_5.analysisPeriod,
    parallel=toggle_7,
    runIt=toggle_7)  # -> readMe, port, effectiveRadiantField, MRTDelta, solarAdjustedMRT, port_2, mannequinMesh, port_3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; plug-in component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
solaradjusttemperature_5 = Ladybug_OutdoorSolarTemperatureAdjustor(
    location=importepw_2.location,
    cumSkyMtxOrDirNormRad=importepw_2.directNormalRadiation,
    diffuseHorizRad=importepw_2.diffuseHorizontalRadiation,
    baseTemperature=importepw_2.dryBulbTemperature,
    baseDryBulbOrMRT=Toggle(True),
    horizInfraredRad=importepw_2.horizontalInfraredRadiation,
    bodyLocation=area_4.Centroid,
    contextShading=brep_10,
    north=unit_5,
    analysisPeriodOrHOY=analysisperiod_6.analysisPeriod,
    parallel=toggle_8,
    runIt=toggle_8)  # -> readMe, port, effectiveRadiantField, MRTDelta, solarAdjustedMRT, port_2, mannequinMesh, port_3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; plug-in component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
analysisperiod_7 = Ladybug_AnalysisPeriod()  # -> readMe, analysisPeriod; plug-in component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
toggle_9 = BooleanToggle(True)
analysisperiod_8 = Ladybug_AnalysisPeriod()  # -> readMe, analysisPeriod; plug-in component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
analysisperiod_9 = Ladybug_AnalysisPeriod(
    fromMonth=Slider(10, range=0..10),
    fromDay=Slider(1, range=0..1),
    toMonth=Slider(2, range=0..10),
    toDay=Slider(28, range=0..100))  # -> readMe, analysisPeriod; plug-in component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
line_6 = Line(Line((-102.3446363, 324.5902896, -257.2096947), (-101.9729119, 327.617742, -257.2096947)))
brep_11 = Brep([<brep referenced from the Rhino model> x2])
vec_6 = Vector(line_6)
area_5 = Area(Geometry=brep_11)  # -> Area, Centroid
unit_6 = UnitVector(Vector=vec_6)
analysisperiod_10 = Ladybug_AnalysisPeriod(
    fromMonth=Slider(10, range=0..10),
    fromDay=Slider(1, range=0..1),
    toMonth=Slider(2, range=0..10),
    toDay=Slider(28, range=0..100))  # -> readMe, analysisPeriod; plug-in component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
toggle_10 = BooleanToggle(True)
brep_12 = Brep([<brep referenced from the Rhino model> x2])
solaradjusttemperature_6 = Ladybug_OutdoorSolarTemperatureAdjustor(
    location=importepw_4.location,
    cumSkyMtxOrDirNormRad=importepw_4.directNormalRadiation,
    diffuseHorizRad=importepw_4.diffuseHorizontalRadiation,
    baseTemperature=importepw_4.dryBulbTemperature,
    baseDryBulbOrMRT=Toggle(True),
    horizInfraredRad=importepw_4.horizontalInfraredRadiation,
    analysisPeriodOrHOY=analysisperiod_7.analysisPeriod,
    parallel=toggle_9,
    runIt=toggle_9)  # -> readMe, port, effectiveRadiantField, MRTDelta, solarAdjustedMRT, port_2, mannequinMesh, port_3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; plug-in component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
solaradjusttemperature_7 = Ladybug_OutdoorSolarTemperatureAdjustor(
    location=importepw_3.location,
    cumSkyMtxOrDirNormRad=importepw_3.directNormalRadiation,
    diffuseHorizRad=importepw_3.diffuseHorizontalRadiation,
    baseTemperature=importepw_3.dryBulbTemperature,
    baseDryBulbOrMRT=Toggle(True),
    horizInfraredRad=importepw_3.horizontalInfraredRadiation,
    bodyLocation=area_5.Centroid,
    contextShading=brep_12,
    north=unit_6,
    analysisPeriodOrHOY=analysisperiod_8.analysisPeriod,
    parallel=toggle_10,
    runIt=toggle_10)  # -> readMe, port, effectiveRadiantField, MRTDelta, solarAdjustedMRT, port_2, mannequinMesh, port_3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; plug-in component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
outdoorcomfortcalculator_5 = Ladybug_OutdoorComfortCalculator(
    dryBulbTemperature=importepw_4.dryBulbTemperature,
    windSpeed_tenMeters=importepw_4.windSpeed,
    relativeHumidity=importepw_4.relativeHumidity,
    runIt=Toggle(True))  # -> readMe, port, universalThermalClimateIndex, comfortableOrNot, thermalStress, conditionOfPerson, port_2, percentOfTimeComfortable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; plug-in component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
analysisperiod_11 = Ladybug_AnalysisPeriod(
    fromMonth=Slider(6, range=0..10),
    fromDay=Slider(1, range=0..1),
    toMonth=Slider(8, range=0..10),
    toDay=Slider(31, range=-1..31))  # -> readMe, analysisPeriod; plug-in component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
outdoorcomfortcalculator_6 = Ladybug_OutdoorComfortCalculator(
    dryBulbTemperature=importepw_2.dryBulbTemperature,
    meanRadiantTemperature=solaradjusttemperature_4.solarAdjustedMRT,
    windSpeed_tenMeters=importepw_2.windSpeed,
    relativeHumidity=importepw_2.relativeHumidity,
    analysisPeriod=analysisperiod_9.analysisPeriod,
    runIt=Toggle(True))  # -> readMe, port, universalThermalClimateIndex, comfortableOrNot, thermalStress, conditionOfPerson, port_2, percentOfTimeComfortable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; plug-in component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
outdoorcomfortcalculator_7 = Ladybug_OutdoorComfortCalculator(
    dryBulbTemperature=importepw_2.dryBulbTemperature,
    meanRadiantTemperature=solaradjusttemperature_4.solarAdjustedMRT,
    windSpeed_tenMeters=importepw_2.windSpeed,
    relativeHumidity=importepw_2.relativeHumidity,
    analysisPeriod=analysisperiod_11.analysisPeriod,
    runIt=Toggle(True))  # -> readMe, port, universalThermalClimateIndex, comfortableOrNot, thermalStress, conditionOfPerson, port_2, percentOfTimeComfortable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; plug-in component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
outdoorcomfortcalculator_8 = Ladybug_OutdoorComfortCalculator(
    dryBulbTemperature=importepw_2.dryBulbTemperature,
    meanRadiantTemperature=solaradjusttemperature_5.solarAdjustedMRT,
    windSpeed_tenMeters=importepw_2.windSpeed,
    relativeHumidity=importepw_2.relativeHumidity,
    analysisPeriod=analysisperiod_10.analysisPeriod,
    runIt=Toggle(True))  # -> readMe, port, universalThermalClimateIndex, comfortableOrNot, thermalStress, conditionOfPerson, port_2, percentOfTimeComfortable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; plug-in component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
analysisperiod_12 = Ladybug_AnalysisPeriod(
    fromMonth=Slider(6, range=0..10),
    fromDay=Slider(1, range=0..1),
    toMonth=Slider(8, range=0..10),
    toDay=Slider(31, range=-1..31))  # -> readMe, analysisPeriod; plug-in component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
outdoorcomfortcalculator_9 = Ladybug_OutdoorComfortCalculator(
    dryBulbTemperature=importepw_2.dryBulbTemperature,
    meanRadiantTemperature=solaradjusttemperature_5.solarAdjustedMRT,
    windSpeed_tenMeters=importepw_2.windSpeed,
    relativeHumidity=importepw_2.relativeHumidity,
    analysisPeriod=analysisperiod_12.analysisPeriod,
    runIt=Toggle(True))  # -> readMe, port, universalThermalClimateIndex, comfortableOrNot, thermalStress, conditionOfPerson, port_2, percentOfTimeComfortable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; plug-in component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
outdoorcomfortcalculator_10 = Ladybug_OutdoorComfortCalculator(
    dryBulbTemperature=importepw_4.dryBulbTemperature,
    meanRadiantTemperature=solaradjusttemperature_6.solarAdjustedMRT,
    windSpeed_tenMeters=importepw_4.windSpeed,
    relativeHumidity=importepw_4.relativeHumidity,
    runIt=Toggle(True))  # -> readMe, port, universalThermalClimateIndex, comfortableOrNot, thermalStress, conditionOfPerson, port_2, percentOfTimeComfortable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; plug-in component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
panel_12 = Panel(outdoorcomfortcalculator_7.percentHeatStress)
panel_13 = Panel(outdoorcomfortcalculator_7.percentOfTimeComfortable)
panel_14 = Panel(outdoorcomfortcalculator_6.percentOfTimeComfortable)
panel_15 = Panel(outdoorcomfortcalculator_6.percentHeatStress)
panel_16 = Panel(outdoorcomfortcalculator_5.percentOfTimeComfortable)
panel_17 = Panel(outdoorcomfortcalculator_9.percentHeatStress)
panel_18 = Panel(outdoorcomfortcalculator_9.percentOfTimeComfortable)
panel_19 = Panel(outdoorcomfortcalculator_10.percentOfTimeComfortable)
outdoorcomfortcalculator_11 = Ladybug_OutdoorComfortCalculator(
    dryBulbTemperature=importepw_3.dryBulbTemperature,
    meanRadiantTemperature=solaradjusttemperature_7.solarAdjustedMRT,
    windSpeed_tenMeters=importepw_3.windSpeed,
    relativeHumidity=importepw_3.relativeHumidity,
    runIt=Toggle(True))  # -> readMe, port, universalThermalClimateIndex, comfortableOrNot, thermalStress, conditionOfPerson, port_2, percentOfTimeComfortable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; plug-in component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
panel_20 = Panel(outdoorcomfortcalculator_8.percentOfTimeComfortable)
panel_21 = Panel(outdoorcomfortcalculator_8.percentHeatStress)
legendpar_2 = Ladybug_LegendParameters(numSegments="3")  # -> legendPar; plug-in component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
panel_22 = Panel(outdoorcomfortcalculator_11.percentOfTimeComfortable)
legendpar_3 = Ladybug_LegendParameters(numSegments="3")  # -> legendPar; plug-in component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
_3dchart_2 = Ladybug_3DChart(
    inputData=flatten([outdoorcomfortcalculator_5.thermalStress, outdoorcomfortcalculator_10.thermalStress, outdoorcomfortcalculator_11.thermalStress]),
    xScale="0.2",
    zScale="0",
    legendPar=legendpar_2)  # -> readMe, graphMesh, graphCurves, legend, legendBasePts, title, titleBasePts, dataPts, conditionalHOY; plug-in component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
pt = Point(<point referenced from the Rhino model>)
_3dchart_3 = Ladybug_3DChart(
    inputData=flatten([outdoorcomfortcalculator_7.thermalStress, outdoorcomfortcalculator_6.thermalStress, outdoorcomfortcalculator_9.thermalStress, outdoorcomfortcalculator_8.thermalStress]),
    basePoint=pt,
    xScale="0.4",
    zScale="0",
    legendPar=legendpar_3)  # -> readMe, graphMesh, graphCurves, legend, legendBasePts, title, titleBasePts, dataPts, conditionalHOY; plug-in component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
# With solar radiation effect
# + Meyerson Hall building
panel_23 = Panel("https://www.energyplus.net/weather-download/north_and_central_america_wmo_region_4/USA/PA/USA_PA_Philadelphia.Intl.AP.724080_TMY3/all")
# With solar radiation effect
# + Meyerson Hall building+Summer Shading
panel_24 = Panel("https://www.energyplus.net/weather-download/north_and_central_america_wmo_region_4/USA/PA/USA_PA_Philadelphia.Intl.AP.724080_TMY3/all")
epw_stat_5 = Ladybug_OpenEPWAndSTATWeatherFiles(weatherFileURL=panel_23)  # -> epwFile, statFile; plug-in component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
epw_stat_6 = Ladybug_OpenEPWAndSTATWeatherFiles(weatherFileURL=panel_24)  # -> epwFile, statFile; plug-in component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
importepw_5 = Ladybug_ImportEpw(epwFile=epw_stat_5.epwFile)  # -> readMe, latitude, location, dryBulbTemperature, dewPointTemperature, relativeHumidity, windSpeed, windDirection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; plug-in component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

# ---- group: annual time
analysisperiod_13 = Ladybug_AnalysisPeriod()  # -> readMe, analysisPeriod; plug-in component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

# ----
importepw_6 = Ladybug_ImportEpw(epwFile=epw_stat_6.epwFile)  # -> readMe, latitude, location, dryBulbTemperature, dewPointTemperature, relativeHumidity, windSpeed, windDirection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; plug-in component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

# ---- group: annual time
analysisperiod_14 = Ladybug_AnalysisPeriod()  # -> readMe, analysisPeriod; plug-in component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

# ----
brep_13 = Brep(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)
line_7 = Line(Line((-102.3446363, 324.5902896, -257.2096947), (-101.9729119, 327.617742, -257.2096947)))
area_6 = Area(Geometry=brep_13)  # -> Area, Centroid
brep_14 = Brep(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)
toggle_11 = BooleanToggle(True)
vec_7 = Vector(line_7)
brep_15 = Brep([<brep referenced from the Rhino model> x2])
line_8 = Line(Line((-102.3446363, 324.5902896, -257.2096947), (-101.9729119, 327.617742, -257.2096947)))
area_7 = Area(Geometry=brep_14)  # -> Area, Centroid
unit_7 = UnitVector(Vector=vec_7)
toggle_12 = BooleanToggle(True)
vec_8 = Vector(line_8)
brep_16 = Brep([<brep referenced from the Rhino model> x3])
unit_8 = UnitVector(Vector=vec_8)
solaradjusttemperature_8 = Ladybug_OutdoorSolarTemperatureAdjustor(
    location=importepw_5.location,
    cumSkyMtxOrDirNormRad=importepw_5.directNormalRadiation,
    diffuseHorizRad=importepw_5.diffuseHorizontalRadiation,
    baseTemperature=importepw_5.dryBulbTemperature,
    baseDryBulbOrMRT=Toggle(True),
    horizInfraredRad=importepw_5.horizontalInfraredRadiation,
    bodyLocation=area_6.Centroid,
    contextShading=brep_15,
    north=unit_7,
    analysisPeriodOrHOY=analysisperiod_13.analysisPeriod,
    parallel=toggle_11,
    runIt=toggle_11)  # -> readMe, port, effectiveRadiantField, MRTDelta, solarAdjustedMRT, port_2, mannequinMesh, port_3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; plug-in component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

# ---- group: winter
analysisperiod_15 = Ladybug_AnalysisPeriod(
    fromMonth=Slider(10, range=0..10),
    fromDay=Slider(1, range=0..1),
    toMonth=Slider(2, range=0..10),
    toDay=Slider(28, range=0..100))  # -> readMe, analysisPeriod; plug-in component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
outdoorcomfortcalculator_12 = Ladybug_OutdoorComfortCalculator(
    dryBulbTemperature=importepw_5.dryBulbTemperature,
    meanRadiantTemperature=solaradjusttemperature_8.solarAdjustedMRT,
    windSpeed_tenMeters=importepw_5.windSpeed,
    relativeHumidity=importepw_5.relativeHumidity,
    analysisPeriod=analysisperiod_15.analysisPeriod,
    runIt=Toggle(True))  # -> readMe, port, universalThermalClimateIndex, comfortableOrNot, thermalStress, conditionOfPerson, port_2, percentOfTimeComfortable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; plug-in component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
panel_25 = Panel(outdoorcomfortcalculator_12.percentOfTimeComfortable)

# ----
solaradjusttemperature_9 = Ladybug_OutdoorSolarTemperatureAdjustor(
    location=importepw_6.location,
    cumSkyMtxOrDirNormRad=importepw_6.directNormalRadiation,
    diffuseHorizRad=importepw_6.diffuseHorizontalRadiation,
    baseTemperature=importepw_6.dryBulbTemperature,
    baseDryBulbOrMRT=Toggle(True),
    horizInfraredRad=importepw_6.horizontalInfraredRadiation,
    bodyLocation=area_7.Centroid,
    contextShading=brep_16,
    north=unit_8,
    analysisPeriodOrHOY=analysisperiod_14.analysisPeriod,
    parallel=toggle_12,
    runIt=toggle_12)  # -> readMe, port, effectiveRadiantField, MRTDelta, solarAdjustedMRT, port_2, mannequinMesh, port_3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; plug-in component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

# ---- group: winter
analysisperiod_16 = Ladybug_AnalysisPeriod(
    fromMonth=Slider(10, range=0..10),
    fromDay=Slider(1, range=0..1),
    toMonth=Slider(2, range=0..10),
    toDay=Slider(28, range=0..100))  # -> readMe, analysisPeriod; plug-in component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
outdoorcomfortcalculator_13 = Ladybug_OutdoorComfortCalculator(
    dryBulbTemperature=importepw_6.dryBulbTemperature,
    meanRadiantTemperature=solaradjusttemperature_9.solarAdjustedMRT,
    windSpeed_tenMeters=importepw_6.windSpeed,
    relativeHumidity=importepw_6.relativeHumidity,
    analysisPeriod=analysisperiod_16.analysisPeriod,
    runIt=Toggle(True))  # -> readMe, port, universalThermalClimateIndex, comfortableOrNot, thermalStress, conditionOfPerson, port_2, percentOfTimeComfortable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; plug-in component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
panel_26 = Panel(outdoorcomfortcalculator_13.percentOfTimeComfortable)

# ---- group: summer
analysisperiod_17 = Ladybug_AnalysisPeriod(
    fromMonth=Slider(6, range=0..10),
    fromDay=Slider(1, range=0..1),
    toMonth=Slider(8, range=0..10),
    toDay=Slider(31, range=-1..31))  # -> readMe, analysisPeriod; plug-in component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
outdoorcomfortcalculator_14 = Ladybug_OutdoorComfortCalculator(
    dryBulbTemperature=importepw_5.dryBulbTemperature,
    meanRadiantTemperature=solaradjusttemperature_8.solarAdjustedMRT,
    windSpeed_tenMeters=importepw_5.windSpeed,
    relativeHumidity=importepw_5.relativeHumidity,
    analysisPeriod=analysisperiod_17.analysisPeriod,
    runIt=Toggle(True))  # -> readMe, port, universalThermalClimateIndex, comfortableOrNot, thermalStress, conditionOfPerson, port_2, percentOfTimeComfortable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; plug-in component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
panel_27 = Panel(outdoorcomfortcalculator_14.percentOfTimeComfortable)

analysisperiod_18 = Ladybug_AnalysisPeriod(
    fromMonth=Slider(6, range=0..10),
    fromDay=Slider(1, range=0..1),
    toMonth=Slider(8, range=0..10),
    toDay=Slider(31, range=-1..31))  # -> readMe, analysisPeriod; plug-in component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
outdoorcomfortcalculator_15 = Ladybug_OutdoorComfortCalculator(
    dryBulbTemperature=importepw_6.dryBulbTemperature,
    meanRadiantTemperature=solaradjusttemperature_9.solarAdjustedMRT,
    windSpeed_tenMeters=importepw_6.windSpeed,
    relativeHumidity=importepw_6.relativeHumidity,
    analysisPeriod=analysisperiod_18.analysisPeriod,
    runIt=Toggle(True))  # -> readMe, port, universalThermalClimateIndex, comfortableOrNot, thermalStress, conditionOfPerson, port_2, percentOfTimeComfortable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; plug-in component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
panel_28 = Panel(outdoorcomfortcalculator_15.percentOfTimeComfortable)

# ----
panel_29 = Panel(outdoorcomfortcalculator_14.percentHeatStress)
panel_30 = Panel(outdoorcomfortcalculator_12.percentHeatStress)
panel_31 = Panel(outdoorcomfortcalculator_15.percentHeatStress)
panel_32 = Panel(outdoorcomfortcalculator_13.percentHeatStress)

# ---- group: anotate
panel_33 = Panel("3")  # disabled
legendpar_4 = Ladybug_LegendParameters(numSegments=panel_33)  # -> legendPar; disabled; plug-in component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

panel_34 = Panel("3")  # disabled
legendpar_5 = Ladybug_LegendParameters(numSegments=panel_34)  # -> legendPar; disabled; plug-in component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

# ----
analysisperiod_19 = Ladybug_AnalysisPeriod()  # -> readMe, analysisPeriod; plug-in component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
panel_35 = Panel("0")  # disabled
panel_36 = Panel("0.2")  # disabled
panel_37 = Panel("0")  # disabled
_3dchart_4 = Ladybug_3DChart(
    inputData=flatten([outdoorcomfortcalculator_14.thermalStress, outdoorcomfortcalculator_12.thermalStress]),
    xScale="0.2",
    zScale=panel_35,
    legendPar=legendpar_4)  # -> readMe, graphMesh, graphCurves, legend, legendBasePts, title, titleBasePts, dataPts, conditionalHOY; disabled; plug-in component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
sunpath_2 = Ladybug_SunPath(
    north=unit_7,
    location=importepw_5.location,
    hour=12,
    day=21,
    month=12,
    timeStep=1,
    analysisPeriod=analysisperiod_19.analysisPeriod,
    centerPt=area_6.Centroid,
    sunPathScale=Slider(0.3, range=0..1),
    sunScale=Slider(0.5, range=0..1),
    annualHourlyData=flatten(outdoorcomfortcalculator_14.conditionOfPerson),
    dailyOrAnnualSunPath=True)  # -> readMe, sunVectors, sunAltitudes, sunAzimuths, port, sunSpheresMesh, sunPathCrvs, legend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; disabled; plug-in component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
_3dchart_5 = Ladybug_3DChart(
    inputData=flatten([outdoorcomfortcalculator_15.thermalStress, outdoorcomfortcalculator_13.thermalStress]),
    xScale=panel_36,
    zScale=panel_37,
    legendPar=legendpar_5)  # -> readMe, graphMesh, graphCurves, legend, legendBasePts, title, titleBasePts, dataPts, conditionalHOY; disabled; plug-in component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
mesh_2 = Mesh(sunpath_2.sunSpheresMesh)
