# Grasshopper definition Sajjadi_Mitra.gh (Grasshopper 0.9.75)
# plug-ins: Python Interpreter

toggle = BooleanToggle(True)
honeybee = Honeybee_Honeybee(defaultFolder="C://ladybug")  # -> Vviiiiiiiiiizzz; plug-in component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
ladybug = Ladybug_Ladybug(defaultFolder="C://ladybug")  # -> Vviiiiiiiiiizzz; plug-in component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
updateladybug = Ladybug_UpdateLadybug(updateThisFile=toggle, updateAllUObjects=toggle)  # -> readMe; plug-in component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
downloadepw = Ladybug_downloadEPWWeatherFile(download=Toggle(True))  # -> readMe; plug-in component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
panel = Panel("""9
12
15""")
panel_2 = Panel("""3
6
12""")
updatehoneybee = Honeybee_UpdateHoneybee(updateThisFile=toggle, updateAllUObjects=toggle)  # -> out; plug-in component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
path = FilePath("C:\ladybug\Philadelphia_International_Ap_PA_USA\Philadelphia_International_Ap_PA_USA.epw")
importlocation = Ladybug_ImportLocation(epwFile=path)  # -> location; plug-in component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
sunpath = Ladybug_SunPath(
    location=importlocation,
    hour=panel,
    day=21,
    month=panel_2,
    timeStep=1,
    sunPathScale=Slider(0.2, range=0..1),
    dailyOrAnnualSunPath=True)  # -> readMe, sunVectors, sunAltitudes, sunAzimuths, port, sunSpheresMesh, sunPathCrvs, legend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; plug-in component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
panel_3 = Panel(path)
radopaquematerial = Honeybee_RadianceOpaqueMaterial(materialName="porcelien-70", RReflectance="0.7", GReflectance="0.7", BReflectance="0.7", roughness=0.05, specularity=0)  # -> avrgRef, RADMaterial; plug-in component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
radopaquematerial_2 = Honeybee_RadianceOpaqueMaterial(
    materialName="roller shading-40",
    RReflectance="0.4",
    GReflectance="0.4",
    BReflectance="0.4",
    roughness=0.05,
    specularity=0)  # -> avrgRef, RADMaterial; plug-in component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
radopaquematerial_3 = Honeybee_RadianceOpaqueMaterial(materialName="porcelein-50", RReflectance="0.5", GReflectance="0.5", BReflectance="0.5", roughness=0.05, specularity=0)  # -> avrgRef, RADMaterial; plug-in component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
radopaquematerial_4 = Honeybee_RadianceOpaqueMaterial(
    materialName="tile floor-25",
    RReflectance="0.25",
    GReflectance="0.25",
    BReflectance="0.25",
    roughness=0.05,
    specularity=0)  # -> avrgRef, RADMaterial; plug-in component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
# Glass material
radglassmaterial = Honeybee_RadianceGlassMaterial(materialName="tvis_60", RTransmittance="0.6", GTransmittance="0.6", BTransmittance="0.6", refractiveIndex=1.52)  # -> avrgTrans, RADMaterial; plug-in component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
window = Brep(<brep referenced from the Rhino model>)
floor = Brep(<brep referenced from the Rhino model>)
walls = Brep([<brep referenced from the Rhino model> x7])
# Prepare geometries
shading = Brep([<brep referenced from the Rhino model> x4])
ceiling = Brep(<brep referenced from the Rhino model>)
createhbsrfs = Honeybee_createHBSrfs(geometry=walls, RADMaterial=radopaquematerial_3.RADMaterial)  # -> readMe, simplify(HBSurface); plug-in component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
createhbsrfs_2 = Honeybee_createHBSrfs(geometry=window, RADMaterial=radglassmaterial.RADMaterial)  # -> readMe, simplify(HBSurface); plug-in component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
createhbsrfs_3 = Honeybee_createHBSrfs(geometry=ceiling, RADMaterial=radopaquematerial.RADMaterial)  # -> readMe, simplify(HBSurface); plug-in component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
createhbsrfs_4 = Honeybee_createHBSrfs(geometry=floor, RADMaterial=radopaquematerial_4.RADMaterial)  # -> readMe, simplify(HBSurface); plug-in component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
createhbsrfs_5 = Honeybee_createHBSrfs(geometry=shading, srfType=Slider(6, range=0..10))  # -> readMe, simplify(HBSurface); plug-in component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
preview = CustomPreview(Geometry=createhbsrfs_2.HBSurface, Shader=ColourSwatch(SwatchColor=RGBA(129, 150, 235, 74)))
preview_2 = CustomPreview(Geometry=createhbsrfs_4.HBSurface, Shader=ColourSwatch(SwatchColor=RGBA(217, 206, 206, 208)))
flip = Flip(Surface=floor)  # -> Surface, Result
brep = Brep(flatten([createhbsrfs_2.HBSurface, createhbsrfs_4.HBSurface, createhbsrfs.HBSurface, createhbsrfs_3.HBSurface, createhbsrfs_5.HBSurface]))
panel_4 = Panel("https://www.energyplus.net/weather-download/north_and_central_america_wmo_region_4/USA/PA/USA_PA_Philadelphia.Intl.AP.724080_TMY3/all")
gentestpts = Honeybee_GenerateTestPoints(testGeometry=flip.Surface, gridSize=Slider(0.5, range=0..1), distBaseSrf=Slider(0.742, range=0..1), moveTestMesh=True)  # -> readMe, simplify(testPoints), simplify(ptsVectors), simplify(facesArea), simplify(mesh); plug-in component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
# prepare a recipe
epw_stat = Ladybug_OpenEPWAndSTATWeatherFiles(weatherFileURL=panel_4)  # -> epwFile, statFile; plug-in component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
annualdaylightsimulation = Honeybee_AnnualDaylightSimulation(
    epwWeatherFile=epw_stat.epwFile,
    testPoints=gentestpts.testPoints,
    ptsVectors=gentestpts.ptsVectors,
    testMesh=gentestpts.mesh)  # -> analysisRecipe; plug-in component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
# run the analysis
toggle_2 = BooleanToggle(False)
rundaylightanalysis = Honeybee_RunDaylightSimulation(
    HBObjects=flatten(brep),
    analysisRecipe=annualdaylightsimulation,
    writeRad=toggle_2,
    runRad=toggle_2,
    numOfCPUs=Slider(4, range=0..10),
    overwriteResults=True)  # -> readMe, analysisType, resultsUnit, results, testPts, resultFiles, radGeoFile, studyFolder, done; plug-in component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
occupancygenerator = Honeybee_DaysimOccupancyGenerator(weekendDays=[1, 2], writeTheOcc=Toggle(True))  # -> occupancyFile; plug-in component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
readannualresultsi = Honeybee_ReadAnnualResultI(
    illFilesAddress=rundaylightanalysis.resultFiles,
    testPoints=simplify(rundaylightanalysis.testPts),
    occupancyFiles=occupancygenerator,
    DLAIllumThresholds=300,
    runIt=Toggle(True))  # -> DLA, UDLI_Less_100, UDLI_100_2000, UDLI_More_2000, CDA, sDA, annualProfiles, htmReport; plug-in component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
legendpar = Ladybug_LegendParameters(lowBound="0", highBound="100")  # -> legendPar; plug-in component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
# visualize the results
dom = ConstructDomain(DomainStart=0, DomainEnd=Slider(1, range=0..1))
recolormesh = Ladybug_RecolorMesh(
    analysisResult=readannualresultsi.UDLI_100_2000,
    inputMesh=gentestpts.mesh,
    heightDomain=dom,
    legendPar=legendpar,
    analysisTitle=rundaylightanalysis.analysisType,
    legendTitle=rundaylightanalysis.resultsUnit,
    bakeIt=Toggle(True))  # -> readMe, newMesh, newLegend, legendBasePt, meshColors, legendColors; plug-in component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
panel_5 = Panel(recolormesh.readMe)
