# Grasshopper definition Sajjadi_Mitra.gh (Grasshopper 0.9.75)
# plug-ins: Python Interpreter

number_slider = Slider(2, range=0..2)
honeybee = Honeybee_Honeybee(defaultFolder="c://ladynug")  # -> Vviiiiiiiiiizzz; plug-in component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
ladybug = Ladybug_Ladybug(defaultFolder="c://ladynug")  # -> Vviiiiiiiiiizzz; plug-in component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
number_slider_2 = Slider(0, range=0..2)
panel = Panel("""9
12
15""")
panel_2 = Panel("""3
6
12""")
downloadepw = Ladybug_downloadEPWWeatherFile(download=Toggle(True))  # -> readMe; plug-in component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
# Animate sliders
button = Button()
path = FilePath("C:\ladybug\Philadelphia_International_Ap_PA_USA\Philadelphia_International_Ap_PA_USA.epw")
importlocation = Ladybug_ImportLocation(epwFile=path)  # -> location; plug-in component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
months = Panel("""3
6
12""")
hours = Panel("""9
12
15""")
fly = Ladybug_fly(inputSliders=[number_slider_2, number_slider], fly=button)  # -> Vviiiiiiiiiizzz; plug-in component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
sunpath = Ladybug_SunPath(
    location=importlocation,
    hour=panel,
    day=21,
    month=panel_2,
    timeStep=1,
    sunPathScale=Slider(0.2, range=0..1),
    dailyOrAnnualSunPath=True)  # -> readMe, sunVectors, sunAltitudes, sunAzimuths, port, sunSpheresMesh, sunPathCrvs, legend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; plug-in component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
panel_3 = Panel(path)
item = ListItem(List=hours, Index=number_slider, Wrap=True)
item_2 = ListItem(List=months, Index=number_slider_2, Wrap=True)
# Glass material
panel_4 = Panel("tvis_60")
panel_5 = Panel("https://www.energyplus.net/weather-download/north_and_central_america_wmo_region_4/USA/PA/USA_PA_Philadelphia.Intl.AP.724080_TMY3/all")
radglassmaterial = Honeybee_RadianceGlassMaterial(materialName=panel_4, RTransmittance="0.6", GTransmittance="0.6", BTransmittance="0.6", refractiveIndex=1.52)  # -> avrgTrans, RADMaterial; plug-in component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
ceiling = Brep(<brep referenced from the Rhino model>)
window = Brep(<brep referenced from the Rhino model>)
floor = Brep(<brep referenced from the Rhino model>)
# Prepare geometries
walls = Brep([<brep referenced from the Rhino model> x4])
# Generate sky
epw_stat = Ladybug_OpenEPWAndSTATWeatherFiles(weatherFileURL=panel_5)  # -> epwFile, statFile; plug-in component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
shading = Brep([<brep referenced from the Rhino model> x4])
createhbsrfs = Honeybee_createHBSrfs(geometry=walls)  # -> readMe, simplify(HBSurface); plug-in component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
createhbsrfs_2 = Honeybee_createHBSrfs(geometry=floor)  # -> readMe, simplify(HBSurface); plug-in component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
createhbsrfs_3 = Honeybee_createHBSrfs(geometry=ceiling)  # -> readMe, simplify(HBSurface); plug-in component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
createhbsrfs_4 = Honeybee_createHBSrfs(geometry=shading, srfType=Slider(6, range=0..10))  # -> readMe, simplify(HBSurface); plug-in component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
createhbsrfs_5 = Honeybee_createHBSrfs(geometry=window, RADMaterial=radglassmaterial.RADMaterial)  # -> readMe, simplify(HBSurface); plug-in component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
doy_hoy = Ladybug_DOY_HOY(days="21", months=item_2, hours=item)  # -> HOY, DOY, date; plug-in component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
genclimatebasedsky = Honeybee_GenerateClimateBasedSky(weatherFile=epw_stat.epwFile, month=item_2, day="21", hour=item)  # -> radiationValues, skyFilePath; plug-in component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
preview = CustomPreview(Geometry=createhbsrfs_5.HBSurface, Shader=ColourSwatch(SwatchColor=RGBA(129, 150, 235, 74)))
preview_2 = CustomPreview(Geometry=createhbsrfs_2.HBSurface, Shader=ColourSwatch(SwatchColor=RGBA(217, 206, 206, 208)))
flip = Flip(Surface=floor)  # -> Surface, Result
brep = Brep(flatten([createhbsrfs_5.HBSurface, createhbsrfs_2.HBSurface, createhbsrfs.HBSurface, createhbsrfs_3.HBSurface, createhbsrfs_4.HBSurface]))
gentestpts = Honeybee_GenerateTestPoints(testGeometry=floor, gridSize=Slider(0.5, range=0..1), distBaseSrf=Slider(0.742, range=0..1), moveTestMesh=True)  # -> readMe, simplify(testPoints), simplify(ptsVectors), simplify(facesArea), simplify(mesh); plug-in component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
# prepare a recipe
gridbasedsimulation = Honeybee_GridBasedSimulation(
    skyFile=genclimatebasedsky.skyFilePath,
    testPoints=gentestpts.testPoints,
    ptsVectors=gentestpts.ptsVectors,
    testMesh=gentestpts.mesh,
    simulationType=0)  # -> analysisRecipe; plug-in component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
createhbzones = Honeybee_createHBZones(name="building", isConditioned=True)  # -> readMe, HBZone; plug-in component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
item_3 = ListItem(Index=Slider(1, range=0..1), Wrap=True)
flip_2 = Flip(Surface=item_3)  # -> Surface, Result
toggle = BooleanToggle(False)
# run the analysis
rundaylightanalysis = Honeybee_RunDaylightSimulation(
    HBObjects=flatten(brep),
    analysisRecipe=gridbasedsimulation,
    writeRad=toggle,
    runRad=toggle,
    numOfCPUs=Slider(5, range=0..10),
    overwriteResults=True)  # -> readMe, analysisType, resultsUnit, results, testPts, resultFiles, radGeoFile, studyFolder, done; plug-in component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
panel_6 = Panel(doy_hoy.date)
# capture the viewport to an image
panel_7 = Panel("_")
# visualize the results
toggle_2 = BooleanToggle(True)
legendpar = Ladybug_LegendParameters(lowBound="300", highBound="2000")  # -> legendPar; plug-in component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
join = TextJoin(Text=[item_2, "21", item], Join=panel_7)
updateladybug = Ladybug_UpdateLadybug(updateThisFile=toggle_2, updateAllUObjects=toggle_2)  # -> readMe; plug-in component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
concat = Concatenate(FragmentA=rundaylightanalysis.analysisType, FragmentC=panel_6)
panel_8 = Panel(join)
updatehoneybee = Honeybee_UpdateHoneybee(updateThisFile=toggle_2, updateAllUObjects=toggle_2)  # -> out; plug-in component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
recolormesh = Ladybug_RecolorMesh(
    analysisResult=rundaylightanalysis.results,
    inputMesh=gentestpts.mesh,
    legendPar=legendpar,
    analysisTitle=concat,
    legendTitle=rundaylightanalysis.resultsUnit,
    bakeIt=Toggle(True))  # -> readMe, newMesh, newLegend, legendBasePt, meshColors, legendColors; plug-in component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
captureview = Ladybug_CaptureView(fileName=panel_8, capture=Toggle(True))  # -> imagePath; plug-in component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
panel_9 = Panel(captureview)
panel_10 = Panel(recolormesh.readMe)
