# Grasshopper definition Sajjadi_Mitra.gh (Grasshopper 0.9.75)
# plug-ins: Python Interpreter

honeybee = Honeybee_Honeybee(defaultFolder="c://ladybug")  # -> Vviiiiiiiiiizzz; plug-in component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
ladybug = Ladybug_Ladybug(defaultFolder="c://ladybug")  # -> Vviiiiiiiiiizzz; plug-in component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
panel = Panel("""9
12
15""")
panel_2 = Panel("""3
6
12""")
number_slider = Slider(0, range=0..2)
number_slider_2 = Slider(0, range=0..2)
downloadepw = Ladybug_downloadEPWWeatherFile(download=Toggle(True))  # -> readMe; plug-in component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
path = FilePath("C:\ladybug\Philadelphia_International_Ap_PA_USA\Philadelphia_International_Ap_PA_USA.epw")
importlocation = Ladybug_ImportLocation(epwFile=path)  # -> location; plug-in component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
# Animate sliders
fly = Ladybug_fly(inputSliders=[number_slider_2, number_slider], fly=Toggle(False))  # -> Vviiiiiiiiiizzz; plug-in component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
hours = Panel("""9
12
15""")
months = Panel("""3
6
12""")
sunpath = Ladybug_SunPath(
    location=importlocation,
    hour=panel,
    day=21,
    month=panel_2,
    timeStep=1,
    sunPathScale=Slider(0.2, range=0..1),
    dailyOrAnnualSunPath=True)  # -> readMe, sunVectors, sunAltitudes, sunAzimuths, port, sunSpheresMesh, sunPathCrvs, legend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; plug-in component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
panel_3 = Panel(path)
item = ListItem(List=months, Index=number_slider_2, Wrap=True)
item_2 = ListItem(List=hours, Index=number_slider, Wrap=True)
# Glass material
panel_4 = Panel("tvis_60")
radopaquematerial = Honeybee_RadianceOpaqueMaterial(materialName="porcelien-70", RReflectance="0.7", GReflectance="0.7", BReflectance="0.7", roughness=0.05, specularity=0)  # -> avrgRef, RADMaterial; plug-in component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
radopaquematerial_2 = Honeybee_RadianceOpaqueMaterial(
    materialName="roller shading-40",
    RReflectance="0.4",
    GReflectance="0.4",
    BReflectance="0.4",
    roughness=0.05,
    specularity=0)  # -> avrgRef, RADMaterial; plug-in component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
radopaquematerial_3 = Honeybee_RadianceOpaqueMaterial(materialName="porcelein-50", RReflectance="0.5", GReflectance="0.5", BReflectance="0.5", roughness=0.05, specularity=0)  # -> avrgRef, RADMaterial; plug-in component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
radopaquematerial_4 = Honeybee_RadianceOpaqueMaterial(
    materialName="tile floor-25",
    RReflectance="0.25",
    GReflectance="0.25",
    BReflectance="0.25",
    roughness=0.05,
    specularity=0)  # -> avrgRef, RADMaterial; plug-in component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
radglassmaterial = Honeybee_RadianceGlassMaterial(materialName=panel_4, RTransmittance="0.6", GTransmittance="0.6", BTransmittance="0.6", refractiveIndex=1.52)  # -> avrgTrans, RADMaterial; plug-in component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
# Generate sky
panel_5 = Panel("https://www.energyplus.net/weather-download/north_and_central_america_wmo_region_4/USA/PA/USA_PA_Philadelphia.Intl.AP.724080_TMY3/all")
window = Brep(<brep referenced from the Rhino model>)
floor = Brep(<brep referenced from the Rhino model>)
# Prepare geometries
walls = Brep([<brep referenced from the Rhino model> x7])
shading = Brep([<brep referenced from the Rhino model> x4])
ceiling = Brep(<brep referenced from the Rhino model>)
createhbsrfs = Honeybee_createHBSrfs(geometry=walls, RADMaterial=radopaquematerial_3.RADMaterial)  # -> readMe, simplify(HBSurface); plug-in component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
createhbsrfs_2 = Honeybee_createHBSrfs(geometry=floor, RADMaterial=radopaquematerial_4.RADMaterial)  # -> readMe, simplify(HBSurface); plug-in component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
createhbsrfs_3 = Honeybee_createHBSrfs(geometry=ceiling, RADMaterial=radopaquematerial.RADMaterial)  # -> readMe, simplify(HBSurface); plug-in component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
createhbsrfs_4 = Honeybee_createHBSrfs(geometry=shading, srfType=Slider(6, range=0..10))  # -> readMe, simplify(HBSurface); plug-in component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
createhbsrfs_5 = Honeybee_createHBSrfs(geometry=window, RADMaterial=radglassmaterial.RADMaterial)  # -> readMe, simplify(HBSurface); plug-in component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
epw_stat = Ladybug_OpenEPWAndSTATWeatherFiles(weatherFileURL=panel_5)  # -> epwFile, statFile; plug-in component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
doy_hoy = Ladybug_DOY_HOY(days="21", months=item, hours=item_2)  # -> HOY, DOY, date; plug-in component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
genclimatebasedsky = Honeybee_GenerateClimateBasedSky(weatherFile=epw_stat.epwFile, month=item, day="21", hour=item_2)  # -> radiationValues, skyFilePath; plug-in component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
preview = CustomPreview(Geometry=createhbsrfs_5.HBSurface, Shader=ColourSwatch(SwatchColor=RGBA(129, 150, 235, 74)))
preview_2 = CustomPreview(Geometry=createhbsrfs_2.HBSurface, Shader=ColourSwatch(SwatchColor=RGBA(217, 206, 206, 208)))
flip = Flip(Surface=floor)  # -> Surface, Result
createhbzones = Honeybee_createHBZones(
    HBSurfaces=flatten([createhbsrfs_3.HBSurface, createhbsrfs.HBSurface, createhbsrfs_2.HBSurface, createhbsrfs_5.HBSurface]),
    isConditioned=True)  # -> readMe, HBZone; plug-in component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
brep = Brep(flatten([createhbsrfs_5.HBSurface, createhbsrfs_2.HBSurface, createhbsrfs.HBSurface, createhbsrfs_3.HBSurface, createhbsrfs_4.HBSurface]))
radparameters = Honeybee_RADParameters(quality=Slider(1, range=0..2), ab=Slider(4, range=0..10))  # -> readMe, radParameters; plug-in component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
# prepare a recipe
gentestpts = Honeybee_GenerateTestPoints(testGeometry=flip.Surface, gridSize=Slider(0.5, range=0..1), distBaseSrf=Slider(0.742, range=0..1), moveTestMesh=True)  # -> readMe, simplify(testPoints), simplify(ptsVectors), simplify(facesArea), simplify(mesh); plug-in component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
createhbzones_2 = Honeybee_createHBZones(name="building", isConditioned=True)  # -> readMe, HBZone; plug-in component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
item_3 = ListItem(Index=Slider(1, range=0..1), Wrap=True)
imagebasedsimulation = Honeybee_ImageBasedSimulation(
    skyFile=genclimatebasedsky.skyFilePath,
    rhinoViewsName="Perspective",
    cameraType=Slider(1, range=0..2),
    simulationType=2,
    radParameters=radparameters.radParameters,
    backupImages=0)  # -> analysisRecipe; plug-in component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
gridbasedsimulation = Honeybee_GridBasedSimulation(
    skyFile=genclimatebasedsky.skyFilePath,
    testPoints=gentestpts.testPoints,
    ptsVectors=gentestpts.ptsVectors,
    testMesh=gentestpts.mesh,
    simulationType=0,
    radParameters=radparameters.radParameters)  # -> analysisRecipe; plug-in component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
flip_2 = Flip(Surface=item_3)  # -> Surface, Result
# run the analysis
toggle = BooleanToggle(True)
toggle_2 = BooleanToggle(True)
rundaylightanalysis = Honeybee_RunDaylightSimulation(
    HBObjects=flatten(brep),
    analysisRecipe=gridbasedsimulation,
    writeRad=toggle,
    runRad=toggle,
    numOfCPUs=Slider(4, range=0..10),
    radFileName=doy_hoy.date,
    overwriteResults=True)  # -> readMe, analysisType, resultsUnit, illuminance_values, testPts, illuminance_files, radGeoFile, studyFolder, done; plug-in component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
updateladybug = Ladybug_UpdateLadybug(updateThisFile=toggle_2, updateAllUObjects=toggle_2)  # -> readMe; plug-in component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
updatehoneybee = Honeybee_UpdateHoneybee(updateThisFile=toggle_2, updateAllUObjects=toggle_2)  # -> out; plug-in component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
legendpar = Ladybug_LegendParameters(lowBound="100", highBound="2000")  # -> legendPar; plug-in component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
glareanalysis = Honeybee_GlareAnalysis(runIt=Toggle(False))  # -> readMe, glareCheckImage, DGP, DGI, glareComfortRange, imageWithTaskArea; plug-in component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
# visualize the results for glare Analysis
falsecolor = Honeybee_FalseColor(contourBands=False, maskThreshold=0.1, useAlterColors=False, render=Toggle(False))  # -> outputFilePath; plug-in component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
panel_6 = Panel(doy_hoy.date)
hdr_tif = Honeybee_ConvertHDRToTIF(HDRFilePath=falsecolor, adjustExposure=False)  # -> TIFFFilePath; plug-in component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
hdr_tif_2 = Honeybee_ConvertHDRToTIF(HDRFilePath=glareanalysis.glareCheckImage, adjustExposure=False)  # -> TIFFFilePath; plug-in component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
# capture the viewport to an image
panel_7 = Panel("_")
concat = Concatenate(FragmentA=rundaylightanalysis.analysisType, FragmentC=panel_6)
# visualize the results
recolormesh = Ladybug_RecolorMesh(
    analysisResult=rundaylightanalysis.illuminance_values,
    inputMesh=gentestpts.mesh,
    legendPar=legendpar,
    analysisTitle=concat,
    legendTitle=rundaylightanalysis.resultsUnit,
    bakeIt=Toggle(True))  # -> readMe, newMesh, newLegend, legendBasePt, meshColors, legendColors; plug-in component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
join = TextJoin(Text=[item, "21", item_2], Join=panel_7)
# Set the Location for Glare Analysis
panel_8 = Panel(hdr_tif)
panel_9 = Panel(hdr_tif_2)
panel_10 = Panel(join)
panel_11 = Panel(recolormesh.readMe)
captureview = Ladybug_CaptureView(fileName=panel_10, viewNames="Top", capture=Toggle(True))  # -> imagePath; plug-in component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
md_slider = MDSlider(
    slider_value=Point(0.3471635028, 0.04942135695, 0.5),
    SliderMode=0,
    x_domain=Domain(0, 1),
    y_domain=Domain(0, 1),
    z_domain=Domain(0, 1))
panel_12 = Panel(captureview)
pt = Point(<point referenced from the Rhino model>)
vec = Vector(Vector(44.36517525, -26.48567125, 0))
settheview = Ladybug_SetTheView()  # plug-in component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
