# Grasshopper definition Sajjadi_Mitra.gh (Grasshopper 0.9.75)
# plug-ins: Python Interpreter

number_of_blinds = Slider(4, range=0..10)
shading_depth = Slider(0.3, range=0..1)
add_blinds = BooleanToggle(True)

list = ValueList({"Exterior Window [R1.0, SHGC 0.7]": "ASHRAE 90.1-2004 EXTWINDOW CLIMATEZONE ALT-WARE 1-8", "Exterior Window [R1.7, SHGC 0.39]": "ASHRAE 90.1-2004 EXTWINDOW CLIMATEZONE 4-6", "Exterior Window [R1.9, SHGC 0.39]": "ASHRAE 90.1-2004 EXTWINDOW CLIMATEZONE ALT-RES 4-6", "Exterior Window [R0.7, SHGC 0.65]": "Dbl LoE (e3=.1) Clr 3mm/13mm Arg"}, selected="Exterior Window [R0.7, SHGC 0.65]")
list_2 = ValueList({"Exterior Roof [R9.2]": "ASHRAE 90.1-2004 EXTROOF METAL CLIMATEZONE 3-4", "Exterior Roof [R14.8]": "ASHRAE 90.1-2004 EXTROOF IEAD CLIMATEZONE 1-4", "Exterior Roof [R34.4]": "ASHRAE 189.1-2009 EXTROOF IEAD CLIMATEZONE 7-8"}, selected="Exterior Roof [R34.4]")
list_3 = ValueList({"Exterior Wall [R5.5]": "ASHRAE 90.1-2004 EXTWALL METAL CLIMATEZONE 4", "Exterior Wall [R5.8]": "ASHRAE 90.1-2004 EXTWALL MASS CLIMATEZONE 3-4", "Exterior Wall [R7.2]": "ASHRAE 90.1-2004 EXTWALL STEELFRAME CLIMATEZONE 1-4", "Exterior Wall [R8.7]": "ASHRAE 90.1-2004 EXTWALL MASS CLIMATEZONE ALT-RES 4", "Exterior Wall [R10.4]": "ASHRAE 90.1-2004 EXTWALL WOODFRAME CLIMATEZONE 1-7", "Exterior Wall [R14.8]": "ASHRAE 90.1-2004 EXTWALL STEELFRAME CLIMATEZONE ALT-RES 4-6", "Exterior Wall [R34.4]": "ASHRAE 189.1-2009 EXTROOF IEAD CLIMATEZONE 7-8"}, selected="Exterior Wall [R34.4]")

# ----
# Wall to Window Ratio
number_slider = Slider(0.4, range=0..1)

number_slider_2 = Slider(2, range=0..2)
number_slider_3 = Slider(0, range=0..2)
fly = Ladybug_fly(inputSliders=[number_slider_3, number_slider_2], fly=Toggle(False))  # -> Vviiiiiiiiiizzz; plug-in component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
hours = Panel("""9
12
15""")
months = Panel("""3
6
12""")
item = ListItem(List=hours, Index=number_slider_2, Wrap=True)
item_2 = ListItem(List=months, Index=number_slider_3, Wrap=True)
doy_hoy = Ladybug_DOY_HOY(days="21", months=item_2, hours=item)  # -> HOY, DOY, date; plug-in component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

panel = Panel("""9
12
15""")
panel_2 = Panel("""3
6
12""")
path = FilePath("C:\ladybug\Philadelphia_International_Ap_PA_USA\Philadelphia_International_Ap_PA_USA.epw")
panel_3 = Panel(path)
importlocation = Ladybug_ImportLocation(epwFile=path)  # -> location; plug-in component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
sunpath = Ladybug_SunPath(
    location=importlocation,
    hour=panel,
    day=21,
    month=panel_2,
    timeStep=1,
    sunPathScale=Slider(0.2, range=0..1),
    dailyOrAnnualSunPath=True)  # -> readMe, sunVectors, sunAltitudes, sunAzimuths, port, sunSpheresMesh, sunPathCrvs, legend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; plug-in component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

honeybee = Honeybee_Honeybee(defaultFolder="c://ladybug")  # -> Vviiiiiiiiiizzz; plug-in component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
ladybug = Ladybug_Ladybug(defaultFolder="c://ladybug")  # -> Vviiiiiiiiiizzz; plug-in component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

toggle = BooleanToggle(True)
updateladybug = Ladybug_UpdateLadybug(updateThisFile=toggle, updateAllUObjects=toggle)  # -> readMe; plug-in component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
updatehoneybee = Honeybee_UpdateHoneybee(updateThisFile=toggle, updateAllUObjects=toggle)  # -> out; plug-in component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

# ----
# Set the Ladybug and Honeybee to fly
panel_4 = Panel("C:/ladybug")
honeybee_2 = Honeybee_Honeybee(defaultFolder=panel_4)  # -> Vviiiiiiiiiizzz; plug-in component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
ladybug_2 = Ladybug_Ladybug(defaultFolder=panel_4)  # -> Vviiiiiiiiiizzz; plug-in component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

glzparamlist = Honeybee_GlazingParametersList(northGlzParam=0, westGlzParam=0, southGlzParam=number_slider, eastGlzParam=0)  # -> glzParamList; plug-in component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
glazingcreator = Honeybee_GlazingBasedOnRatio(glzRatio=glzparamlist, runIt=Toggle(True))  # -> readMe, HBObjWGLZ; plug-in component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

# ----
# Point in Time and Glare Analysis
radopaquematerial = Honeybee_RadianceOpaqueMaterial(materialName="porcelien-70", RReflectance="0.7", GReflectance="0.7", BReflectance="0.7", roughness=0.05, specularity=0)  # -> avrgRef, RADMaterial; plug-in component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
radopaquematerial_2 = Honeybee_RadianceOpaqueMaterial(materialName="porcelein-50", RReflectance="0.5", GReflectance="0.5", BReflectance="0.5", roughness=0.05, specularity=0)  # -> avrgRef, RADMaterial; plug-in component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
radopaquematerial_3 = Honeybee_RadianceOpaqueMaterial(
    materialName="tile floor-25",
    RReflectance="0.25",
    GReflectance="0.25",
    BReflectance="0.25",
    roughness=0.05,
    specularity=0)  # -> avrgRef, RADMaterial; plug-in component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

join = TextJoin(Text=[item_2, "21", item], Join="_")
panel_5 = Panel("Top")
panel_6 = Panel(join)
captureview = Ladybug_CaptureView(fileName=panel_6, capture=Toggle(True))  # -> imagePath; plug-in component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
panel_7 = Panel(captureview)

callfromepconstrlibrary = Honeybee_CallFromEPConstructionLibrary(keywords="floor")  # -> ThermMaterials, EPMaterials, EPWindowMaterials, EPConstructions; plug-in component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
item_3 = ListItem(List=callfromepconstrlibrary.EPConstructions, Index=Slider(0, range=0..100), Wrap=True)
decomposeepconstruction = Honeybee_DecomposeEPConstruction(cnstrName=item_3)  # -> flatten(materials), comments, UValue_SI, UValue_IP, RValue_SI, RValue_IP; plug-in component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

panel_8 = Panel("https://www.energyplus.net/weather-download/north_and_central_america_wmo_region_4/USA/PA/USA_PA_Philadelphia.Intl.AP.724080_TMY3/all")
epw_stat = Ladybug_OpenEPWAndSTATWeatherFiles(weatherFileURL=panel_8)  # -> epwFile, statFile; plug-in component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
genclimatebasedsky = Honeybee_GenerateClimateBasedSky(weatherFile=epw_stat.epwFile, month=item_2, day="21", hour=item)  # -> radiationValues, skyFilePath; plug-in component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

callfromepconstrlibrary_2 = Honeybee_CallFromEPConstructionLibrary(keywords="slab")  # -> ThermMaterials, EPMaterials, EPWindowMaterials, EPConstructions; plug-in component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
item_4 = ListItem(List=callfromepconstrlibrary_2.EPConstructions, Index="2", Wrap=True)
decomposeepconstruction_2 = Honeybee_DecomposeEPConstruction(cnstrName=item_4)  # -> flatten(materials), comments, UValue_SI, UValue_IP, RValue_SI, RValue_IP; plug-in component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

panel_9 = Panel("""MAT-CC05 4 HW CONCRETE
MAT-CC05 8 HW CONCRETE""")
panel_10 = Panel(decomposeepconstruction.materials)
item_5 = ListItem(List=decomposeepconstruction.materials, Index=0, Wrap=True)  # -> Item, Item1
item_6 = ListItem(List=panel_9, Index=0, Wrap=True)  # -> Item, Item1
panel_11 = Panel(item_3)
epconstruction = Honeybee_EnergyPlusConstruction(name="floor_cnstr_2", layer_1=item_5.Item, layer_2=item_5.Item1, layer_3=item_6.Item1)  # -> EPConstruction; plug-in component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
epconstruction_2 = Honeybee_EnergyPlusConstruction(name="floor_cnstr_1", layer_1=item_5.Item, layer_2=item_5.Item1, layer_3=item_6.Item)  # -> EPConstruction; plug-in component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

panel_12 = Panel("""Construction,
    Dbl LoE (e3=.1) Clr 3mm/13mm Arg,  !- Name
    CLEAR 3MM,               !- Outside Layer
    ARGON 13MM,              !- Layer 2
    LoE CLEAR 3MM Rev;       !- Layer 3""")
panel_13 = Panel("""WindowMaterial:Gas,
    ARGON 13MM,               !- Name
    Argon,                   !- Gas Type
    0.0127;                  !- Thickness {m}""")
panel_14 = Panel("""WindowMaterial:Glazing,
    LoE CLEAR 3MM Rev,       !- Name
    SpectralAverage,         !- Optical Data Type
    ,                        !- Window Glass Spectral Data Set Name
    0.003,                   !- Thickness {m}
    0.630,                   !- Solar Transmittance at Normal Incidence
    0.220,                   !- Front Side Solar Reflectance at Normal Incidence
    0.190,                   !- Back Side Solar Reflectance at Normal Incidence
    0.850,                   !- Visible Transmittance at Normal Incidence
    0.079,                   !- Front Side Visible Reflectance at Normal Incidence
    0.056,                   !- Back Side Visible Reflectance at Normal Incidence
    0.0,                     !- Infrared Transmittance at Normal Incidence
    0.10,                    !- Front Side Infrared Hemispherical Emissivity
    0.84,                    !- Back Side Infrared Hemispherical Emissivity
    0.9;                     !- Conductivity {W/m-K}""")
toggle_2 = BooleanToggle(True)
addtoeplibrary = Honeybee_AddToEnergyPlusLibrary(EPObject=[panel_12, panel_13, panel_14], addToProjectLib=toggle_2, overwrite=toggle_2)  # -> readMe; plug-in component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

md_slider = MDSlider(
    slider_value=Point(0.4478658537, 0.4524389127, 0.5),
    SliderMode=0,
    x_domain=Domain(0, 1),
    y_domain=Domain(0, 1),
    z_domain=Domain(0, 1))
vec = Vector(Vector(3.046938912, -2.031292608, 0))
pt = Point(Point(-0.0757945003, -2.637648611, 1.4))
settheview = Ladybug_SetTheView()  # plug-in component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

panel_15 = Panel("https://www.energyplus.net/weather-download/north_and_central_america_wmo_region_4/USA/PA/USA_PA_Philadelphia.Intl.AP.724080_TMY3/all")
# set the weather data analysis
panel_16 = Panel("C:/ladybug")
ladybug_3 = Ladybug_Ladybug(defaultFolder=panel_16)  # -> Vviiiiiiiiiizzz; plug-in component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
epw_stat_2 = Ladybug_OpenEPWAndSTATWeatherFiles(weatherFileURL=panel_15)  # -> epwFile, statFile; plug-in component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
panel_17 = Panel(ladybug_3)
importepw = Ladybug_ImportEpw(epwFile=epw_stat_2.epwFile)  # -> readMe, latitude, location, dryBulbTemperature, dewPointTemperature, relativeHumidity, windSpeed, windDirection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; plug-in component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
panel_18 = Panel("18< a <24 and 20< b <80 and 2< c <10")
legendpar = Ladybug_LegendParameters()  # -> legendPar; plug-in component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
_3dchart = Ladybug_3DChart(
    inputData=flatten([importepw.dryBulbTemperature, importepw.relativeHumidity, importepw.windSpeed, importepw.windDirection, importepw.totalSkyCover]),
    xScale="0.1",
    zScale="0",
    legendPar=legendpar)  # -> readMe, graphMesh, graphCurves, legend, legendBasePts, title, titleBasePts, dataPts, conditionalHOY; plug-in component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
series = Series(Start="1", Step=1, Count="12")
barchart = Ladybug_MonthlyBarChart(inputData=flatten(importepw.dryBulbTemperature), stackValues=Toggle(True), legendPar=legendpar)  # -> readMe, dataMesh, dataCurves, dataCrvColors, graphAxes, graphLabels, title, titleBasePt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; plug-in component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
windrose = Ladybug_WindRose(
    north=0,
    hourlyWindDirection=importepw.windDirection,
    hourlyWindSpeed=importepw.windSpeed,
    annualHourlyData=flatten(importepw.totalSkyCover),
    legendPar=legendpar,
    runIt=Toggle(True))  # -> readMe, calmRoseMesh, windRoseMesh, windRoseCrvs, windRoseCenPts, legend, legendBasePts, title; plug-in component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
importlocation_2 = Ladybug_ImportLocation(epwFile=epw_stat_2.epwFile)  # -> location; plug-in component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
series_2 = Series(Start=0, Step=1, Count="24")
sunpath_2 = Ladybug_SunPath(
    location=importlocation_2,
    hour=series_2,
    day=21,
    month=series,
    timeStep=1,
    annualHourlyData=flatten(importepw.totalSkyCover),
    legendPar=legendpar,
    dailyOrAnnualSunPath=True)  # -> readMe, sunVectors, sunAltitudes, sunAzimuths, port, sunSpheresMesh, sunPathCrvs, legend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; plug-in component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

# ----
# Run Energy Plus Simulation
# Geometry
# Natural Ventilation and Lighting Schedule Added
# Construction
# Blinds
# infiltration rate
# Read the results
# Construction
# Blinds
# Thermal Mass
# Rotation Angle
# Pecentage of Comfortable Hours
number_slider_4 = Slider(15, range=0..100)
run_energyplus = BooleanToggle(False)
list_4 = ValueList({"Existing Slab Construction": "0", "+4 Inches Concrete": "1", "+8 Inches Concrete": "2"}, selected="+4 Inches Concrete")
filter = StreamFilter(Gate=list_4, Stream0=panel_11, Stream1=epconstruction_2, Stream2=epconstruction)
vec_2 = VectorXYZ(XComponent=0, YComponent="40", ZComponent=0)  # -> Vector, Length

brep = Brep(<brep referenced from the Rhino model>)
mass2zone = Honeybee_Masses2Zones(zoneMasses=flatten(brep), isConditioned=Toggle(False), maxRoofAngle=30, createHBZones=Toggle(True))  # -> readMe, HBZones; plug-in component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
solveadjc = Honeybee_SolveAdjacencies(HBZones=flatten(mass2zone.HBZones), removeCurrentAdjc=False, findAdjc=Toggle(True))  # -> readMe, HBZonesWADJ; plug-in component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
brep_2 = Brep(<brep referenced from the Rhino model>)
addhbglz = Honeybee_addHBGlz(HBObj=solveadjc.HBZonesWADJ, childSurfaces=flatten(brep_2))  # -> HBObjWGLZ; plug-in component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
askme = Honeybee_AskMe(HBObjects=solveadjc.HBZonesWADJ)  # -> readMe; plug-in component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
panel_19 = Panel(askme)
rotatehbobj = Honeybee_RotateHoneybee(HBObj=addhbglz, angle=Slider(360, range=0..1000))  # -> HBObj; plug-in component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
wires = BrepWireframe(Brep=rotatehbobj, Density=-1)

# ----
# Set the Location for Glare Analysis
# Prepare geometries
# Set the Material
# Set the Ladybug and Honeybee to fly
# run the analysis
# visualize the results for glare Analysis
# Download Energy Plus File
# Update Honeybee and Ladybug
# Glass material
# prepare a glare and daylighting recipe
# visualize the results
# Animate sliders
# Generate sky
# Set Sun Path
# capture the viewport to an image
toggle_3 = BooleanToggle(True)
downloadepw = Ladybug_downloadEPWWeatherFile(download=toggle_3)  # -> readMe; plug-in component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
radglassmaterial = Honeybee_RadianceGlassMaterial(materialName="tvis_60", RTransmittance="0.6", GTransmittance="0.6", BTransmittance="0.6", refractiveIndex=1.52)  # -> avrgTrans, RADMaterial; plug-in component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
toggle_4 = BooleanToggle(True)

window = Brep(<brep referenced from the Rhino model>)
shading = Brep([<brep referenced from the Rhino model> x4])
ceiling = Brep(<brep referenced from the Rhino model>)
walls = Brep([<brep referenced from the Rhino model> x5])
floor = Brep(<brep referenced from the Rhino model>)
createhbsrfs = Honeybee_createHBSrfs(geometry=window, RADMaterial=radglassmaterial.RADMaterial)  # -> readMe, simplify(HBSurface); plug-in component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
createhbsrfs_2 = Honeybee_createHBSrfs(geometry=shading, srfType=Slider(6, range=0..10))  # -> readMe, simplify(HBSurface); plug-in component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
createhbsrfs_3 = Honeybee_createHBSrfs(geometry=ceiling, RADMaterial=radopaquematerial.RADMaterial)  # -> readMe, simplify(HBSurface); plug-in component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
createhbsrfs_4 = Honeybee_createHBSrfs(geometry=floor, RADMaterial=radopaquematerial_3.RADMaterial)  # -> readMe, simplify(HBSurface); plug-in component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
createhbsrfs_5 = Honeybee_createHBSrfs(geometry=walls, RADMaterial=radopaquematerial_2.RADMaterial)  # -> readMe, simplify(HBSurface); plug-in component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

flip = Flip(Surface=floor)  # -> Surface, Result
wires_2 = BrepWireframe(
    Brep=[createhbsrfs_2.HBSurface, createhbsrfs_3.HBSurface, createhbsrfs_5.HBSurface, createhbsrfs_4.HBSurface, createhbsrfs.HBSurface],
    Density=-1)
brep_3 = Brep(flatten([createhbsrfs_3.HBSurface, createhbsrfs_2.HBSurface, createhbsrfs_5.HBSurface, createhbsrfs_4.HBSurface, createhbsrfs.HBSurface]))

gentestpts = Honeybee_GenerateTestPoints(testGeometry=flip.Surface, gridSize=Slider(0.5, range=0..1), distBaseSrf=Slider(0.742, range=0..1), moveTestMesh=True)  # -> readMe, simplify(testPoints), simplify(ptsVectors), simplify(facesArea), simplify(mesh); plug-in component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
radparameters = Honeybee_RADParameters(quality=Slider(1, range=0..2), ab=Slider(4, range=0..10))  # -> readMe, radParameters; plug-in component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
imagebasedsimulation = Honeybee_ImageBasedSimulation(
    skyFile=genclimatebasedsky.skyFilePath,
    rhinoViewsName="Perspective",
    cameraType=Slider(1, range=0..2),
    simulationType=2,
    radParameters=radparameters.radParameters,
    backupImages=0)  # -> analysisRecipe; plug-in component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
gridbasedsimulation = Honeybee_GridBasedSimulation(
    skyFile=genclimatebasedsky.skyFilePath,
    testPoints=gentestpts.testPoints,
    ptsVectors=gentestpts.ptsVectors,
    testMesh=gentestpts.mesh,
    simulationType=0,
    radParameters=radparameters.radParameters)  # -> analysisRecipe; plug-in component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

rundaylightanalysis = Honeybee_RunDaylightSimulation(
    HBObjects=flatten(brep_3),
    analysisRecipe=imagebasedsimulation,
    writeRad=toggle_4,
    runRad=toggle_4,
    numOfCPUs=Slider(5, range=0..10),
    radFileName=doy_hoy.date,
    overwriteResults=True)  # -> readMe, analysisType, resultsUnit, results, testPts, resultFiles, radGeoFile, studyFolder, done; plug-in component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

panel_20 = Panel(doy_hoy.date)
legendpar_2 = Ladybug_LegendParameters(lowBound="300", highBound="2000")  # -> legendPar; plug-in component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
concat = Concatenate(FragmentA=rundaylightanalysis.analysisType, FragmentC=panel_20)
recolormesh = Ladybug_RecolorMesh(
    analysisResult=rundaylightanalysis.results,
    inputMesh=gentestpts.mesh,
    legendPar=legendpar_2,
    analysisTitle=concat,
    legendTitle=rundaylightanalysis.resultsUnit,
    bakeIt=Toggle(True))  # -> readMe, newMesh, newLegend, legendBasePt, meshColors, legendColors; plug-in component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
panel_21 = Panel(recolormesh.readMe)

glareanalysis = Honeybee_GlareAnalysis(HDRImagePath=rundaylightanalysis.resultFiles, runIt=Toggle(True))  # -> readMe, glareCheckImage, DGP, DGI, glareComfortRange, imageWithTaskArea; plug-in component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
falsecolor = Honeybee_FalseColor(
    HDRFilePath=rundaylightanalysis.resultFiles,
    contourBands=False,
    maskThreshold=0.1,
    useAlterColors=False,
    render=Toggle(True))  # -> outputFilePath; plug-in component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
hdr_tif = Honeybee_ConvertHDRToTIF(HDRFilePath=falsecolor, adjustExposure=False)  # -> TIFFFilePath; plug-in component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
hdr_tif_2 = Honeybee_ConvertHDRToTIF(HDRFilePath=glareanalysis.glareCheckImage, adjustExposure=False)  # -> TIFFFilePath; plug-in component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
panel_22 = Panel(hdr_tif)
panel_23 = Panel(hdr_tif_2)

toggle_5 = BooleanToggle(True)
makeadiabaticbytype = Honeybee_MakeAdiabaticByType(HBZones=rotatehbobj, roofs=toggle_5, groundFloors=toggle_5)  # -> HBZones; plug-in component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
panel_24 = Panel(makeadiabaticbytype)

genhbzonetestpts = Honeybee_GenerateZoneTestPoints(HBZone=makeadiabaticbytype, gridSize=Slider(1, range=0..1), distBaseSrf=Slider(0.7, range=0..1), moveTestMesh=True)  # -> readMe, simplify(testPoints), simplify(ptsVectors), simplify(facesArea), simplify(mesh); plug-in component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
toggle_6 = BooleanToggle(False)
occupancygenerator = Honeybee_DaysimOccupancyGenerator(weekendDays=[1, 2], writeTheOcc=Toggle(True))  # -> occupancyFile; plug-in component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
legendpar_3 = Ladybug_LegendParameters(lowBound=Slider(0, range=0..100), highBound=Slider(100, range=0..100))  # -> legendPar; plug-in component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
legendpar_4 = Ladybug_LegendParameters(lowBound=Slider(0, range=0..100), highBound=Slider(100, range=0..100))  # -> legendPar; plug-in component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

panel_25 = Panel("https://www.energyplus.net/weather-download/north_and_central_america_wmo_region_4/USA/PA/USA_PA_Philadelphia.Intl.AP.724080_TMY3/all")
toggle_7 = BooleanToggle(True)
epoutput = Honeybee_GenerateEPOutput(zoneGainsAndLosses=toggle_7, zoneComfortMetrics=toggle_7, surfaceTempAnalysis="False", surfaceEnergyAnalysis=toggle_7)  # -> report, flatten(simulationOutputs); plug-in component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
epw_stat_3 = Ladybug_OpenEPWAndSTATWeatherFiles(weatherFileURL=panel_25)  # -> epwFile, statFile; plug-in component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
path_2 = FilePath(epw_stat_3.epwFile)
rep = ReplaceText(Find=" ", Replace="_", RecursiveReplace=False)

# ----
# annual daylight simulation
annualdaylightsimulation = Honeybee_AnnualDaylightSimulation(epwWeatherFile=epw_stat_3.epwFile, testPoints=genhbzonetestpts.testPoints, ptsVectors=genhbzonetestpts.ptsVectors)  # -> analysisRecipe; plug-in component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
rundaylightanalysis_2 = Honeybee_RunDaylightSimulation(
    HBObjects=flatten(makeadiabaticbytype),
    analysisRecipe=annualdaylightsimulation,
    writeRad=toggle_6,
    runRad=toggle_6,
    overwriteResults=True)  # -> readMe, analysisType, resultsUnit, results, testPts, resultFiles, radGeoFile, studyFolder, done; plug-in component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
readannualresultsi = Honeybee_ReadAnnualResultI(
    illFilesAddress=rundaylightanalysis_2.resultFiles,
    testPoints=simplify(rundaylightanalysis_2.testPts),
    ptsVectors=genhbzonetestpts.ptsVectors,
    occupancyFiles=occupancygenerator,
    DLAIllumThresholds=300,
    runIt=Toggle(True))  # -> DLA, UDLI_Less_100, UDLI_100_2000, UDLI_More_2000, CDA, sDA, annualProfiles, htmReport; plug-in component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
recolormesh_2 = Ladybug_RecolorMesh(
    analysisResult=readannualresultsi.UDLI_100_2000,
    inputMesh=genhbzonetestpts.mesh,
    legendPar=legendpar_3,
    analysisTitle="UDLI 100_2000",
    legendTitle="%")  # -> readMe, newMesh, newLegend, legendBasePt, meshColors, legendColors; plug-in component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
_3dchart_2 = Ladybug_3DChart(
    inputData=flatten(readannualresultsi.UDLI_100_2000),
    basePoint="0,900,0",
    xScale=Slider(0.2, range=0..1),
    zScale=Slider(0, range=0..100),
    legendPar=legendpar_4)  # -> readMe, graphMesh, graphCurves, legend, legendBasePts, title, titleBasePts, dataPts, conditionalHOY; plug-in component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

setepzoneschedules = Honeybee_SetEnergyPlusZoneSchedules(HBZones=makeadiabaticbytype, lightingSchedules=readannualresultsi.annualProfiles)  # -> schedules, simplify(HBZones); plug-in component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
setepnatvent = Honeybee_SetEPAirFlow(
    HBZones=setepzoneschedules.HBZones,
    naturalVentilationType=Slider(1, range=0..1),
    minIndoorTempForNatVent=Slider(25, range=0..100),
    minOutdoorTempForNatVent=number_slider_4,
    fractionOfGlzAreaOperable=Slider(0.8, range=0..1))  # -> readMe, simplify(HBZones); plug-in component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

setepzonecnstr = Honeybee_SetEPZoneConstruction(HBZones=setepnatvent.HBZones, wallEPConstruction=list_3, windowEPConstruction=list, roofEPConstruction=list_2)  # -> simplify(modifiedHBZones); plug-in component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
# Energy Plus Analysis
setepzoneundergroundcnstr = Honeybee_SetEPZoneUndergroundConstruction(HBZones=setepzonecnstr, groundFloorEPConstruction=filter)  # -> simplify(modifiedHBZones); plug-in component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

decomposebytype = Honeybee_DecomposeBasedOnType(HBZone=setepzoneundergroundcnstr)  # -> walls, interiorWalls, airWalls, windows, interiorWindows, skylights, roofs, ceilings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; plug-in component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
shddesigner = Ladybug_ShadingDesigner(
    glzSrf=flatten(decomposebytype.windows),
    depthOrVector=flatten(shading_depth),
    numOfShds=number_of_blinds,
    runIt=add_blinds,
    port_4=False)  # -> readMe, shadingSrfs; plug-in component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
wires_3 = BrepWireframe(Brep=shddesigner.shadingSrfs, Density=-1)
preview = CustomPreview(Geometry=wires_3, Shader=ColourSwatch(SwatchColor=RGBA(0, 0, 0, 194)))

ach2m3_s_m2_calculator = HoneybeeInfORventPerAreaCalculator(HBZones=flatten(setepzoneundergroundcnstr), airChangeHour=Slider(2, range=0..10))  # -> out, infORventPerArea, allFloors; plug-in component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
setepzoneloads = Honeybee_SetEnergyPlusZoneLoads(HBZones=setepzoneundergroundcnstr, infiltrationRatePerArea=ach2m3_s_m2_calculator.infORventPerArea)  # -> loads, HBZones; plug-in component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

# ----
# Weather File Data
importepw_2 = Ladybug_ImportEpw(epwFile=epw_stat_3.epwFile)  # -> readMe, latitude, location, dryBulbTemperature, dewPointTemperature, relativeHumidity, windSpeed, windDirection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; plug-in component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
_3dchart_3 = Ladybug_3DChart(
    inputData=flatten(importepw_2.dryBulbTemperature),
    basePoint="0,600,0",
    xScale=Slider(0.2, range=0..1),
    zScale=Slider(0, range=0..100))  # -> readMe, graphMesh, graphCurves, legend, legendBasePts, title, titleBasePts, dataPts, conditionalHOY; plug-in component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

hb_epcontextsrf = HoneybeeEPContextSurfaces(shdSurfaces=flatten(shddesigner.shadingSrfs))  # -> HBContext; inputs shdSurfaces: list of Brep, justBoundingBox: Boolean
# ---------- hb_epcontextsrf: Python ----------
"""
prepare shading/context geometries

    Args:
        northVectorOrRotation: A vector that shows North or a number that shows
                               the rotation of the North from the Y axis
        bldgMasses: List of closed Breps as thermal zones.
    Returns:
        report: ...
        thermalZones: Thermal zone's geometries for visualiza
"""

ghenv.Component.Name = 'Honeybee EP context Surfaces'
ghenv.Component.NickName = 'HB_EPContextSrf'
ghenv.Component.Message = 'VER 0.0.60\nNOV_04_2016'
ghenv.Component.IconDisplayMode = ghenv.Component.IconDisplayMode.application
ghenv.Component.Category = "Honeybee"
ghenv.Component.SubCategory = "10 | Energy | Energy"
#compatibleHBVersion = VER 0.0.57\nNOV_04_2016
#compatibleLBVersion = VER 0.0.59\nFEB_01_2015
ghenv.Component.AdditionalHelpFromDocStrings = "2"

import rhinoscriptsyntax as rs
import Rhino as rc
import scriptcontext as sc
import os
import System
import Grasshopper.Kernel as gh
import uuid

tolerance = sc.doc.ModelAbsoluteTolerance
import math


def main(shdSurfaces, EPTransSchedule, meshingSettings, justBoundingBox):
    
    # import the classes
    if sc.sticky.has_key('honeybee_release'):

        try:
            if not sc.sticky['honeybee_release'].isCompatible(ghenv.Component): return -1
            if sc.sticky['honeybee_release'].isInputMissing(ghenv.Component): return -1
        except:
            warning = "You need a newer version of Honeybee to use this compoent." + \
            " Use updateHoneybee component to update userObjects.\n" + \
            "If you have already updated userObjects drag Honeybee_Honeybee component " + \
            "into canvas and try again."
            w = gh.GH_RuntimeMessageLevel.Warning
            ghenv.Component.AddRuntimeMessage(w, warning)
            return -1
        
        # don't customize this part
        hb_EPSrf = sc.sticky["honeybee_EPSurface"]
        hb_EPSHDSurface = sc.sticky["honeybee_EPShdSurface"]
        hb_RADMaterialAUX = sc.sticky["honeybee_RADMaterialAUX"]
        hb_EPObjectsAux = sc.sticky["honeybee_EPObjectsAUX"]()
        HBScheduleList = sc.sticky["honeybee_ScheduleLib"].keys()

        ########################################################################
        #----------------------------------------------------------------------#
        shdBreps = []
        # create bounding box of shading geometries
        if justBoundingBox:
            for brep in shdSurfaces:
                if brep.Faces.Count>1 or not brep.Faces[0].IsPlanar(sc.doc.ModelAbsoluteTolerance):
                    shdBreps.append(brep.GetBoundingBox(True).ToBrep())
                else:
                    shdBreps.append(brep)
        else:
            shdBreps = shdSurfaces
        
        shadingClasses = []
        shadingMeshPreview = []
        
        if meshingSettings == None:
            mp = rc.Geometry.MeshingParameters.Minimal
            mp.SimplePlanes = True
        else:
            mp = meshingSettings
        
        def getRadMaterialName(radMaterial):
            nameStr = radMaterial.split(" ")[2]
            name =  nameStr.split("\n")[0]
            return name
        
        for brepCount, brep in enumerate(shdBreps):
            if brep != None:
                isPlanar = True
                # check planarity
                for face in brep.Faces:
                    if not face.IsPlanar(tolerance):
                        isPlanar = False
                        break
                
                shadingBreps = []
                if not isPlanar:
                    meshArray = rc.Geometry.Mesh.CreateFromBrep(brep, mp)
                    for mesh in meshArray:
                        for meshFace in range(mesh.Faces.Count):
                            vertices = list(mesh.Faces.GetFaceVertices(meshFace))[1:]
                            vertices = vertices + [sc.doc.ModelAbsoluteTolerance]
                            # create the brep from mesh
                            shdBrep = rc.Geometry.Brep.CreateFromCornerPoints(*vertices)
                            shadingBreps.append(shdBrep)
                else:
                    for face in brep.Faces:
                        shadingBreps.append(face.DuplicateFace(False))
                
                for faceCount, shdBrep in enumerate(shadingBreps):
                        thisShading = hb_EPSHDSurface(shdBrep, 1000*brepCount + faceCount, 'shdSrf_' + `brepCount` + '_' + `faceCount` + "_" + str(uuid.uuid4()))
                        
                        # add transmittance schedule if any
                        if EPTransSchedule!=None:
                            schedule= EPTransSchedule.upper()
                            if schedule!=None and not schedule.lower().endswith(".csv") and schedule not in HBScheduleList:
                                msg = "Cannot find " + schedule + " in Honeybee schedule library."
                                print msg
                                ghenv.Component.AddRuntimeMessage(gh.GH_RuntimeMessageLevel.Warning, msg)
                                return -1
                            elif schedule!=None and schedule.lower().endswith(".csv"):
                                # check if csv file is existed
                                if not os.path.isfile(schedule):
                                    msg = "Cannot find the shchedule file: " + schedule
                                    print msg
                                    ghenv.Component.AddRuntimeMessage(gh.GH_RuntimeMessageLevel.Warning, msg)
                                    return -1
                            
                            thisShading.TransmittanceSCH = schedule
                        
                        # add the Rad Material if any
                        if RADMaterial!=None:
                            # if it is just the name of the material make sure it is already defined
                            if len(RADMaterial.split(" ")) == 1:
                                # if the material is not in the library add it to the library
                                if not hb_RADMaterialAUX.isMatrialExistInLibrary(RADMaterial):
                                    warningMsg = "Can't find " + RADMaterial + " in RAD Material Library.\n" + \
                                                "Add the material to the library and try again."
                                    ghenv.Component.AddRuntimeMessage(gh.GH_RuntimeMessageLevel.Warning, warningMsg)
                                    return
                                
                                try:
                                    thisShading.setRADMaterial(RADMaterial)
                                except Exception, e:
                                    print e
                                    warningMsg = "You are using an old version of Honeybee_Honeybee! Update your files and try again."
                                    print warningMsg
                                    ghenv.Component.AddRuntimeMessage(gh.GH_RuntimeMessageLevel.Warning, warningMsg)
                                    return
                                
                                addedToLib = True
                            else:
                                
                                # try to add the material to the library
                                addedToLib, thisShading.RadMaterial = hb_RADMaterialAUX.analyseRadMaterials(RADMaterial, True)
                                
                            if addedToLib==False:
                                warningMsg = "Failed to add " + RADMaterial + " to the Library."
                                ghenv.Component.AddRuntimeMessage(gh.GH_RuntimeMessageLevel.Warning, warningMsg)
                                return
                        
                        # add shading to the list
                        shadingClasses.append(thisShading)
                
        # add to the hive
        hb_hive = sc.sticky["honeybee_Hive"]()
        HBContext  = hb_hive.addToHoneybeeHive(shadingClasses, ghenv.Component)
        return HBContext
        ################################################################################################
    else:
        print "You should first let Honeybee to fly..."
        w = gh.GH_RuntimeMessageLevel.Warning
        ghenv.Component.AddRuntimeMessage(w, "You should first let Honeybee to fly...")
        return -1
        

if _shdSurfaces and _shdSurfaces[0]!=None:
    # add cleaning function
    result= main(_shdSurfaces, EPTransSchedule_, meshingSettings_, justBoundingBox_)
    
    if result != -1: HBContext = result
# ---------- end hb_epcontextsrf ----------
importepw_3 = Ladybug_ImportEpw(epwFile=path_2)  # -> readMe, latitude, location, dryBulbTemperature, dewPointTemperature, relativeHumidity, windSpeed, windDirection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; plug-in component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

runenergysimulation = Honeybee_RunEnergySimulation(
    epwFile=epw_stat_3.epwFile,
    HBZones=flatten(setepzoneloads.HBZones),
    HBContext=flatten(hb_epcontextsrf),
    simulationOutputs=flatten(epoutput.simulationOutputs),
    writeIdf=run_energyplus,
    runEnergyPlus=run_energyplus,
    idfFileName=rep)  # -> report, idfFileAddress, resultFileAddress; plug-in component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

panel_26 = Panel(runenergysimulation.resultFileAddress)
readepresult = Honeybee_ReadEPResult(resultFileAddress=runenergysimulation.resultFileAddress)  # -> totalThermalLoad, thermalLoadBalance, cooling, heating, electricLight, electricEquip, fanElectric, pumpElectric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; plug-in component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
readepsrfresult = Honeybee_ReadEPSurfaceResult(resultFileAddress=runenergysimulation.resultFileAddress)  # -> surfaceIndoorTemp, surfaceOutdoorTemp, surfaceEnergyFlow, opaqueEnergyFlow, glazEnergyFlow, windowTotalSolarEnergy, windowBeamEnergy, windowDiffEnergy, windowTransmissivity, otherSurfaceData; plug-in component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
colorsurfaces = Honeybee_ColorSurfacesByEPResult(srfData=readepsrfresult.surfaceEnergyFlow, HBZones=flatten(setepzoneloads.HBZones), runIt=Toggle(True))  # -> readMe, srfColoredMesh, zoneWireFrame, legend, legendBasePt, analysisTitle, srfBreps, srfColors, srfValues, normalizedSrfData; plug-in component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
adaptivecomfortcalculator = Ladybug_AdaptiveComfortCalculator(
    dryBulbTemperature=readepresult.airTemperature,
    meanRadiantTemperature=readepresult.meanRadTemperature,
    prevailingOutdoorTemp=importepw_3.dryBulbTemperature,
    runIt=Toggle(True))  # -> readMe, port, comfortableOrNot, conditionOfPerson, degreesFromTarget, port_2, targetTemperature, upperTemperatureBound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; plug-in component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
pt_2 = Point(Point(23.10617158, 0, 0))
panel_27 = Panel("-1")
panel_28 = Panel("3")
panel_29 = Panel("1")
vec_3 = VectorXYZ(XComponent="20", YComponent="35", ZComponent=0)  # -> Vector, Length
legendpar_5 = Ladybug_LegendParameters()  # -> legendPar; plug-in component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
move = Move(Geometry=pt_2, Motion=vec_3.Vector)  # -> Geometry, Transform
psychchart = Ladybug_PsychrometricChart(
    dryBulbTemperature=readepresult.airTemperature,
    relativeHumidity=readepresult.relativeHumidity,
    basePoint=move.Geometry,
    runIt=Toggle(True))  # -> readMe, port, totalComfortPercent, totalComfortOrNot, strategyNames, strategyPercentOfTime, strategyOrNot, port_2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; plug-in component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
_3dchart_4 = Ladybug_3DChart(
    inputData=flatten(readepresult.airTemperature),
    basePoint=pt_2,
    xScale="0.025",
    yScale="0.125",
    zScale=Slider(0, range=0..100),
    legendPar=legendpar_5)  # -> readMe, graphMesh, graphCurves, legend, legendBasePts, title, titleBasePts, dataPts, conditionalHOY; plug-in component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

move_2 = Move(Geometry=pt_2, Motion=vec_2.Vector)  # -> Geometry, Transform
_3dchart_5 = Ladybug_3DChart(
    inputData=flatten(adaptivecomfortcalculator.conditionOfPerson),
    basePoint="0,280,0",
    xScale=Slider(0.2, range=0..1),
    zScale=Slider(0, range=0..100))  # -> readMe, graphMesh, graphCurves, legend, legendBasePts, title, titleBasePts, dataPts, conditionalHOY; plug-in component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

# ----
# Energy Balance Bar chart
energybalance = Honeybee_ConstructEnergyBalance(
    HBZones=flatten(setepzoneloads.HBZones),
    peopleGains=readepresult.peopleGains,
    totalSolarGain=readepresult.totalSolarGain,
    infiltrationEnergy=readepresult.infiltrationEnergy,
    surfaceEnergyFlow=readepsrfresult.surfaceEnergyFlow)  # -> readMe, port, flrNormEnergyBal, flrNormBalWStorage, port_2, modelEnergyBalance, energyBalWithStorage; plug-in component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
gradientlibrary = Ladybug_GradientLibrary(gradIndex="1")  # -> customColors; plug-in component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
rev = ReverseList(List=gradientlibrary)
selectandaveragedata = Ladybug_AverageData(annualHourlyData=energybalance.modelEnergyBalance, totalOrAverage=Toggle(True))  # -> readMe, selHourlyData, totaledDaily, totaledMonthly, totMonthlyPerHour, totAnalysisPeriod; plug-in component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
legendpar_6 = Ladybug_LegendParameters(customColors=flatten(rev))  # -> legendPar; plug-in component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
barchart_2 = Ladybug_MonthlyBarChart(
    inputData=flatten(selectandaveragedata.totaledMonthly),
    stackValues=Toggle(True),
    basePoint=move_2.Geometry,
    xScale=Slider(0.75, range=0..1),
    legendPar=legendpar_6)  # -> readMe, dataMesh, dataCurves, dataCrvColors, graphAxes, graphLabels, title, titleBasePt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; plug-in component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
tag = TextTag3D(Location=barchart_2.dataLabelPts, Text=barchart_2.dataMesh, Size=1, Justification=7)
pt_3 = Point(barchart_2.dataLabelPts)

panel_30 = Panel("""Comfortable (%): 
hot (%):         
cold (%):        """)
comfortable_hot_cold = Panel([adaptivecomfortcalculator.percentOfTimeComfortable, adaptivecomfortcalculator.percentHotCold])
num = Number(comfortable_hot_cold)
expression = Expression(x=num, Expression="Round(x, 2)")
flip_2 = FlipMatrix(Data=panel_30)  # -> simplify(Data)
flip_3 = FlipMatrix(Data=expression)  # -> simplify(Data)
panel_31 = Panel([flip_2, flip_3])
join_2 = TextJoin(Text=panel_31)
join_3 = TextJoin(Text=flatten(join_2))
pt_4 = Point(Point(-17, 4, 0))
tag_2 = TextTag3D(Location=pt_4, Text=join_3, Size=1, Colour=ColourSwatch(SwatchColor=RGB(0, 0, 0)), Justification=5)
