# Grasshopper definition Sajjadi_Mitra.gh (Grasshopper 0.9.75)
# plug-ins: Python Interpreter

panel = Panel("https://www.energyplus.net/weather-download/north_and_central_america_wmo_region_4/USA/PA/USA_PA_Philadelphia.Intl.AP.724080_TMY3/all")
ladybug = Ladybug_Ladybug(defaultFolder="c:/ladybug")  # -> Vviiiiiiiiiizzz; plug-in component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
epw_stat = Ladybug_OpenEPWAndSTATWeatherFiles(weatherFileURL=panel)  # -> epwFile, statFile; plug-in component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
analysisperiod = Ladybug_AnalysisPeriod()  # -> readMe, analysisPeriod; plug-in component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
importepw = Ladybug_ImportEpw(epwFile=epw_stat.epwFile)  # -> readMe, latitude, location, dryBulbTemperature, dewPointTemperature, relativeHumidity, windSpeed, windDirection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; plug-in component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
analysisperiod_2 = Ladybug_AnalysisPeriod()  # -> readMe, analysisPeriod; plug-in component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
line = Line(Line((-102.3446363, 324.5902896, -257.2096947), (-101.9729119, 327.617742, -257.2096947)))
brep = Brep(<brep referenced from the Rhino model>)
vec = Vector(line)
area = Area(Geometry=brep)  # -> Area, Centroid
unit = UnitVector(Vector=vec)
toggle = BooleanToggle(True)
shading_design = Brep([<brep referenced from the Rhino model> x402])
brep_2 = Brep([<brep referenced from the Rhino model> x2])
toggle_2 = BooleanToggle(True)
toggle_3 = BooleanToggle(True)
solaradjusttemperature = Ladybug_OutdoorSolarTemperatureAdjustor(
    location=importepw.location,
    cumSkyMtxOrDirNormRad=importepw.directNormalRadiation,
    diffuseHorizRad=importepw.diffuseHorizontalRadiation,
    baseTemperature=importepw.dryBulbTemperature,
    baseDryBulbOrMRT=Toggle(True),
    horizInfraredRad=importepw.horizontalInfraredRadiation,
    bodyLocation=area.Centroid,
    contextShading=brep_2,
    analysisPeriodOrHOY=analysisperiod.analysisPeriod,
    parallel=toggle_2,
    runIt=toggle_2)  # -> readMe, port, effectiveRadiantField, MRTDelta, solarAdjustedMRT, port_2, mannequinMesh, port_3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; plug-in component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
solaradjusttemperature_2 = Ladybug_OutdoorSolarTemperatureAdjustor(
    location=importepw.location,
    cumSkyMtxOrDirNormRad=importepw.directNormalRadiation,
    diffuseHorizRad=importepw.diffuseHorizontalRadiation,
    baseTemperature=importepw.dryBulbTemperature,
    baseDryBulbOrMRT=toggle_3,
    horizInfraredRad=importepw.horizontalInfraredRadiation,
    bodyLocation=area.Centroid,
    contextShading=brep_2,
    north=unit,
    analysisPeriodOrHOY=analysisperiod_2.analysisPeriod,
    parallel=toggle,
    runIt=toggle)  # -> readMe, port, effectiveRadiantField, MRTDelta, solarAdjustedMRT, port_2, mannequinMesh, port_3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; plug-in component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
solaradjusttemperature_3 = Ladybug_OutdoorSolarTemperatureAdjustor(
    location=importepw.location,
    cumSkyMtxOrDirNormRad=importepw.directNormalRadiation,
    diffuseHorizRad=importepw.diffuseHorizontalRadiation,
    baseTemperature=importepw.dryBulbTemperature,
    baseDryBulbOrMRT=toggle_3,
    horizInfraredRad=importepw.horizontalInfraredRadiation,
    bodyLocation=area.Centroid,
    contextShading=shading_design,
    north=unit,
    analysisPeriodOrHOY=analysisperiod_2.analysisPeriod,
    parallel=toggle,
    runIt=toggle)  # -> readMe, port, effectiveRadiantField, MRTDelta, solarAdjustedMRT, port_2, mannequinMesh, port_3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; plug-in component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
toggle_4 = BooleanToggle(True)
# With solar radiation effect
toggle_5 = BooleanToggle(True)
# With solar radiation effect
# + Meyerson Hall building
outdoorcomfortcalculator = Ladybug_OutdoorComfortCalculator(
    dryBulbTemperature=importepw.dryBulbTemperature,
    meanRadiantTemperature=solaradjusttemperature_2.solarAdjustedMRT,
    windSpeed_tenMeters=importepw.windSpeed,
    relativeHumidity=importepw.relativeHumidity,
    runIt=toggle_4)  # -> readMe, port, universalThermalClimateIndex, comfortableOrNot, thermalStress, conditionOfPerson, port_2, percentOfTimeComfortable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; plug-in component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
outdoorcomfortcalculator_2 = Ladybug_OutdoorComfortCalculator(
    dryBulbTemperature=importepw.dryBulbTemperature,
    meanRadiantTemperature=solaradjusttemperature_3.solarAdjustedMRT,
    windSpeed_tenMeters=importepw.windSpeed,
    relativeHumidity=importepw.relativeHumidity,
    runIt=toggle_4)  # -> readMe, port, universalThermalClimateIndex, comfortableOrNot, thermalStress, conditionOfPerson, port_2, percentOfTimeComfortable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; plug-in component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
# Fully Shaded
outdoorcomfortcalculator_3 = Ladybug_OutdoorComfortCalculator(
    dryBulbTemperature=importepw.dryBulbTemperature,
    windSpeed_tenMeters=importepw.windSpeed,
    relativeHumidity=importepw.relativeHumidity,
    runIt=toggle_5)  # -> readMe, port, universalThermalClimateIndex, comfortableOrNot, thermalStress, conditionOfPerson, port_2, percentOfTimeComfortable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; plug-in component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
outdoorcomfortcalculator_4 = Ladybug_OutdoorComfortCalculator(
    dryBulbTemperature=importepw.dryBulbTemperature,
    meanRadiantTemperature=solaradjusttemperature.solarAdjustedMRT,
    windSpeed_tenMeters=importepw.windSpeed,
    relativeHumidity=importepw.relativeHumidity,
    runIt=Toggle(True))  # -> readMe, port, universalThermalClimateIndex, comfortableOrNot, thermalStress, conditionOfPerson, port_2, percentOfTimeComfortable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; plug-in component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
panel_2 = Panel(outdoorcomfortcalculator_3.percentOfTimeComfortable)
panel_3 = Panel(outdoorcomfortcalculator_2.percentOfTimeComfortable)
panel_4 = Panel(outdoorcomfortcalculator_2.percentHeatStress)
panel_5 = Panel(outdoorcomfortcalculator_4.percentOfTimeComfortable)
panel_6 = Panel(outdoorcomfortcalculator.percentOfTimeComfortable)
toggle_6 = BooleanToggle(False)
meyerson_hall = Brep([<brep referenced from the Rhino model> x2])
shading_design_2 = Brep([<brep referenced from the Rhino model> x400])
bench = Brep([<brep referenced from the Rhino model> x3])
panel_7 = Panel([outdoorcomfortcalculator_3.percentHeatStress, outdoorcomfortcalculator_4.percentHeatStress, outdoorcomfortcalculator.percentHeatStress])
comfortshadebenefit = Ladybug_ComfortShadeBenefitEvaluator(
    location=importepw.location,
    temperatures=outdoorcomfortcalculator.universalThermalClimateIndex,
    testShades=shading_design_2,
    testRegion=bench,
    gridSize=Slider(0.5, range=0..1),
    context=meyerson_hall,
    north=unit,
    delNonIntersect=False,
    parallel=toggle_6,
    runIt=toggle_6)  # -> readMe, port, sunVectors, regionTestPts, shadeMesh, legend, legendBasePoint, port_2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; plug-in component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
legendpar = Ladybug_LegendParameters(numSegments="3")  # -> legendPar; plug-in component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
_3dchart = Ladybug_3DChart(
    inputData=flatten([outdoorcomfortcalculator_3.thermalStress, outdoorcomfortcalculator_4.thermalStress, outdoorcomfortcalculator.thermalStress, outdoorcomfortcalculator_2.thermalStress]),
    xScale="0.2",
    zScale="0",
    legendPar=legendpar,
    bakeIt=Toggle(True))  # -> readMe, graphMesh, graphCurves, legend, legendBasePts, title, titleBasePts, dataPts, conditionalHOY; plug-in component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
panel_8 = Panel(_3dchart.readMe)
analysisperiod_3 = Ladybug_AnalysisPeriod()  # -> readMe, analysisPeriod; plug-in component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
sunpath = Ladybug_SunPath(
    north=unit,
    location=importepw.location,
    hour=12,
    day=21,
    month=12,
    timeStep=1,
    analysisPeriod=analysisperiod_3.analysisPeriod,
    centerPt=area.Centroid,
    sunPathScale=Slider(0.3, range=0..1),
    sunScale=Slider(0.5, range=0..1),
    annualHourlyData=flatten(outdoorcomfortcalculator.conditionOfPerson),
    legendPar=legendpar,
    dailyOrAnnualSunPath=True)  # -> readMe, sunVectors, sunAltitudes, sunAzimuths, port, sunSpheresMesh, sunPathCrvs, legend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; plug-in component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
