# Grasshopper definition Sanjaya_Natasha_BuildingSimulation-FINAL.gh (Grasshopper 0.9.76)
# plug-ins: Python Interpreter, ItemSelector

# customizable/flexible
occupancygenerator = Honeybee_DaysimOccupancyGeneratorBasedOnList()  # -> occupancyFile; plug-in component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
# Weather
honeybee = Honeybee_Honeybee()  # -> Vviiiiiiiiiizzz; plug-in component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

# ---- group: Base
brep = Brep(<brep referenced from the Rhino model>)
mass2zone = Honeybee_Masses2Zones(zoneMasses=flatten(brep), isConditioned=Toggle(False), maxRoofAngle=30, createHBZones=Toggle(True))  # -> readMe, HBZones; plug-in component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
glzparamlist = Honeybee_GlazingParametersList(northGlzParam=0, westGlzParam=0, southGlzParam=Slider(0.1, range=0..1), eastGlzParam=0)  # -> glzParamList; plug-in component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
glazingcreator = Honeybee_GlazingBasedOnRatio(
    HBObjects=mass2zone.HBZones,
    glzRatio=glzparamlist,
    windowHeight=Slider(0.9, range=0..1),
    sillHeight=Slider(1, range=0..1),
    runIt=Toggle(True))  # -> readMe, HBObjWGLZ; plug-in component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

# ----
panel = Panel("https://www.energyplus.net/weather-download/north_and_central_america_wmo_region_4/USA/PA/USA_PA_Philadelphia.Intl.AP.724080_TMY3/all")
ladybug = Ladybug_Ladybug()  # -> Vviiiiiiiiiizzz; plug-in component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
epw_stat = Ladybug_OpenEPWAndSTATWeatherFiles(weatherFileURL=panel)  # -> epwFile, statFile; plug-in component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
downloadepw = Ladybug_downloadEPWWeatherFile(download=Button())  # -> readMe; plug-in component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
importepw = Ladybug_ImportEpw(epwFile=epw_stat.epwFile)  # -> readMe, latitude, location, dryBulbTemperature, dewPointTemperature, relativeHumidity, windSpeed, windDirection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; plug-in component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
gradientlibrary = Ladybug_GradientLibrary(gradIndex=Slider(11, range=0..22))  # -> customColors; plug-in component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
multiplication = Multiplication(A="-385787.347", B="2")
legendpar = Ladybug_LegendParameters(customColors=flatten(gradientlibrary))  # -> legendPar; plug-in component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
ms2mph = Ladybug_ms2mph(ms=importepw.windSpeed)  # -> mph; plug-in component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
pt = Point(Point(309183, -11974, 0))
Y = UnitY(Factor=multiplication)
move = Move(Geometry=pt, Motion=Y)  # -> Geometry, Transform
pt_2 = Point(Point(309183, -11974, 0))
c2f = Ladybug_C2F(C=importepw.dryBulbTemperature)  # -> F; plug-in component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
gradientlibrary_2 = Ladybug_GradientLibrary(gradIndex=Slider(11, range=0..22))  # -> customColors; plug-in component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
_3dchart = Ladybug_3DChart(
    inputData=flatten([c2f, importepw.relativeHumidity, importepw.windSpeed, importepw.directNormalRadiation, importepw.totalSkyCover]),
    basePoint=pt_2,
    xScale=Slider(0.3, range=0..1),
    zScale="0")  # -> readMe, graphMesh, graphCurves, legend, legendBasePts, title, titleBasePts, dataPts, conditionalHOY; plug-in component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
legendpar_2 = Ladybug_LegendParameters(lowBound="40", highBound="80")  # -> legendPar; plug-in component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
outdoorcomfortcalculator = Ladybug_OutdoorComfortCalculator(
    dryBulbTemperature=importepw.dryBulbTemperature,
    windSpeed_tenMeters=importepw.windSpeed,
    relativeHumidity=importepw.relativeHumidity,
    runIt=Toggle(True))  # -> readMe, port, universalThermalClimateIndex, comfortableOrNot, thermalStress, conditionOfPerson, port_2, percentOfTimeComfortable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; plug-in component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
_3dchart_2 = Ladybug_3DChart(
    inputData=flatten(ms2mph),
    basePoint=move.Geometry,
    xScale=Slider(0.3, range=0..1),
    zScale="0",
    legendPar=legendpar,
    bakeIt=Toggle(False))  # -> readMe, graphMesh, graphCurves, legend, legendBasePts, title, titleBasePts, dataPts, conditionalHOY; disabled; plug-in component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
legendpar_3 = Ladybug_LegendParameters(customColors=flatten(gradientlibrary_2))  # -> legendPar; plug-in component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
multiplication_2 = Multiplication(A="2000", B="1000")
c2f_2 = Ladybug_C2F(C=outdoorcomfortcalculator.universalThermalClimateIndex)  # -> F; plug-in component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
series = Series(Start="1", Step=1, Count="24")
series_2 = Series(Start="1", Step=1, Count="12")
toggle = BooleanToggle(False)
panel_2 = Panel(outdoorcomfortcalculator.percentColdStress)
panel_3 = Panel(c2f_2)
sunpath = Ladybug_SunPath(
    location=importepw.location,
    hour=series,
    day=21,
    month=series_2,
    timeStep=1,
    sunPathScale=Slider(0.5, range=0..1),
    annualHourlyData=flatten(c2f),
    legendPar=legendpar_2,
    dailyOrAnnualSunPath=True)  # -> readMe, sunVectors, sunAltitudes, sunAzimuths, port, sunSpheresMesh, sunPathCrvs, legend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; plug-in component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
windrose = Ladybug_WindRose(
    north=0,
    hourlyWindDirection=importepw.windDirection,
    hourlyWindSpeed=importepw.windSpeed,
    legendPar=legendpar_3,
    bakeIt=toggle,
    runIt=toggle)  # -> readMe, calmRoseMesh, windRoseMesh, windRoseCrvs, windRoseCenPts, legend, legendBasePts, title; plug-in component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
# Base Environmental Analysis
panel_4 = Panel("-385787.347")
X = UnitX(Factor=multiplication_2)
pt_3 = Point(Point(0, 0, 0))
multiplication_3 = Multiplication(A=panel_4, B="2")
legendpar_4 = Ladybug_LegendParameters(numSegments=Slider(3, range=0..10))  # -> legendPar; plug-in component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
X_2 = UnitX(Factor=multiplication_2)
pt_4 = Point(Point(0, 0, 0))
move_2 = Move(Geometry=pt_3, Motion=X)  # -> Geometry, Transform
Y_2 = UnitY(Factor=multiplication_3)
move_3 = Move(Geometry=pt_4, Motion=X_2)  # -> Geometry, Transform
move_4 = Move(Geometry=move_2.Geometry, Motion=Y_2)  # -> Geometry, Transform
_3dchart_3 = Ladybug_3DChart(inputData=flatten(c2f_2), basePoint=move_3.Geometry, xScale=Slider(0.3, range=0..1))  # -> readMe, graphMesh, graphCurves, legend, legendBasePts, title, titleBasePts, dataPts, conditionalHOY; disabled; plug-in component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
_3dchart_4 = Ladybug_3DChart(
    inputData=flatten(outdoorcomfortcalculator.thermalStress),
    basePoint=move_4.Geometry,
    xScale=Slider(0.3, range=0..1),
    legendPar=legendpar_4,
    bakeIt=Toggle(False))  # -> readMe, graphMesh, graphCurves, legend, legendBasePts, title, titleBasePts, dataPts, conditionalHOY; disabled; plug-in component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

number_slider = Slider(0.2, range=0..1)
number_slider_2 = Slider(0.8, range=0..1)
# Glare
panel_5 = Panel("0.5")
radopaquematerial = Honeybee_RadianceOpaqueMaterial(materialName=panel_5, RReflectance="0.5", GReflectance="0.5", BReflectance="0.5", roughness=0.05, specularity=0)  # -> avrgRef, RADMaterial; plug-in component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
radopaquematerial_2 = Honeybee_RadianceOpaqueMaterial(
    materialName="0.8",
    RReflectance=number_slider_2,
    GReflectance=number_slider_2,
    BReflectance=number_slider_2,
    roughness=0.05,
    specularity=0)  # -> avrgRef, RADMaterial; plug-in component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
radopaquematerial_3 = Honeybee_RadianceOpaqueMaterial(
    materialName="0.2",
    RReflectance=number_slider,
    GReflectance=number_slider,
    BReflectance=number_slider,
    roughness=0.05,
    specularity=0)  # -> avrgRef, RADMaterial; plug-in component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

panel_6 = Panel("https://www.energyplus.net/weather-download/north_and_central_america_wmo_region_4/USA/PA/USA_PA_Philadelphia.Intl.AP.724080_TMY3/all")

# ---- group: Iteration 01
brep_2 = Brep(<brep referenced from the Rhino model>)
# Daylighting
mass2zone_2 = Honeybee_Masses2Zones(zoneMasses=flatten(brep_2), isConditioned=Toggle(False), maxRoofAngle=30, createHBZones=Toggle(True))  # -> readMe, HBZones; plug-in component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
glzparamlist_2 = Honeybee_GlazingParametersList(northGlzParam=0, westGlzParam=0, southGlzParam=Slider(0.54, range=0..1), eastGlzParam=0)  # -> glzParamList; plug-in component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
glazingcreator_2 = Honeybee_GlazingBasedOnRatio(
    HBObjects=mass2zone_2.HBZones,
    glzRatio=glzparamlist_2,
    windowHeight="2.025",
    sillHeight=Slider(0.55, range=0..1),
    runIt=Toggle(True))  # -> readMe, HBObjWGLZ; plug-in component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

# ----
epw_stat_2 = Ladybug_OpenEPWAndSTATWeatherFiles(weatherFileURL=panel_6)  # -> epwFile, statFile; plug-in component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

number_of_blinds = Slider(3, range=0..10)  # disabled
add_blinds = BooleanToggle(False)  # disabled
shading_depth = Slider(0.2, range=0..1)  # disabled

list = ValueList({"Exterior Window [R1.0, SHGC 0.7]": "ASHRAE 90.1-2004 EXTWINDOW CLIMATEZONE ALT-WARE 1-8", "Exterior Window [R1.7, SHGC 0.39]": "ASHRAE 90.1-2004 EXTWINDOW CLIMATEZONE 4-6", "Exterior Window [R1.9, SHGC 0.39]": "ASHRAE 90.1-2004 EXTWINDOW CLIMATEZONE ALT-RES 4-6", "Exterior Window [R0.7, SHGC 0.65]": "Dbl LoE (e3=.1) Clr 3mm/13mm Arg"}, selected="Exterior Window [R1.0, SHGC 0.7]")  # disabled
list_2 = ValueList({"Exterior Roof [R9.2]": "ASHRAE 90.1-2004 EXTROOF METAL CLIMATEZONE 3-4", "Exterior Roof [R14.8]": "ASHRAE 90.1-2004 EXTROOF IEAD CLIMATEZONE 1-4", "Exterior Roof [R34.4]": "ASHRAE 189.1-2009 EXTROOF IEAD CLIMATEZONE 7-8"}, selected="Exterior Roof [R9.2]")  # disabled
list_3 = ValueList({"Exterior Wall [R5.5]": "ASHRAE 90.1-2004 EXTWALL METAL CLIMATEZONE 4", "Exterior Wall [R5.8]": "ASHRAE 90.1-2004 EXTWALL MASS CLIMATEZONE 3-4", "Exterior Wall [R7.2]": "ASHRAE 90.1-2004 EXTWALL STEELFRAME CLIMATEZONE 1-4", "Exterior Wall [R8.7]": "ASHRAE 90.1-2004 EXTWALL MASS CLIMATEZONE ALT-RES 4", "Exterior Wall [R10.4]": "ASHRAE 90.1-2004 EXTWALL WOODFRAME CLIMATEZONE 1-7", "Exterior Wall [R14.8]": "ASHRAE 90.1-2004 EXTWALL STEELFRAME CLIMATEZONE ALT-RES 4-6", "Exterior Wall [R34.4]": "ASHRAE 189.1-2009 EXTROOF IEAD CLIMATEZONE 7-8"}, selected="Exterior Wall [R5.5]")  # disabled
number_slider_3 = Slider(2, range=0..10)  # disabled

context = Brep([<brep referenced from the Rhino model> x3])

brep_3 = Brep([<brep referenced from the Rhino model> x2])
wires = BrepWireframe(Brep=brep_3, Density=-1)

# ---- group: Louvers
brep_4 = Brep([<brep referenced from the Rhino model> x10])
wires_2 = BrepWireframe(Brep=brep_4, Density=-1)
createhbsrfs = Honeybee_createHBSrfs(geometry=brep_4, srfType="6")  # -> readMe, simplify(HBSurface); plug-in component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

# ----
brep_5 = Brep(glazingcreator_2.HBObjWGLZ)
brep_6 = Brep(glazingcreator.HBObjWGLZ)
wires_3 = BrepWireframe(Brep=brep_5, Density=-1)
wires_4 = BrepWireframe(Brep=brep_6, Density=-1)

panel_7 = Panel("""0
1
2
3
4
5
6""")
cull_i = CullIndex(List=importepw.totalSkyCover, Indices=panel_7, Wrap=True)
panel_8 = Panel(cull_i)
larger = LargerThan(FirstNumber=panel_8, SecondNumber="1")  # -> LargerThan, OrEqualTo
cull = CullPattern(List=panel_8, CullPattern=larger.LargerThan)
smaller = SmallerThan(FirstNumber=panel_8, SecondNumber="1")  # -> SmallerThan, OrEqualTo
sort = SortList(Keys=panel_8)  # -> Keys, ValuesA
cull_2 = CullPattern(List=panel_8, CullPattern=smaller.OrEqualTo)
panel_9 = Panel(sort.Keys)
panel_10 = Panel(cull_2)
panel_11 = Panel(smaller.SmallerThan)
lng = ListLength(List=panel_8)
lng_2 = ListLength(List=cull_2)
division = Division(A=lng_2, B=lng)
panel_12 = Panel(division)

hb_epcontextsrf = HoneybeeEPContextSurfaces(shdSurfaces=flatten(context))  # -> HBContext; inputs shdSurfaces: list of Brep, justBoundingBox: Boolean
# ---------- hb_epcontextsrf: Python ----------
"""
prepare shading/context geometries

    Args:
        northVectorOrRotation: A vector that shows North or a number that shows
                               the rotation of the North from the Y axis
        bldgMasses: List of closed Breps as thermal zones.
    Returns:
        report: ...
        thermalZones: Thermal zone's geometries for visualiza
"""

ghenv.Component.Name = 'Honeybee EP context Surfaces'
ghenv.Component.NickName = 'HB_EPContextSrf'
ghenv.Component.Message = 'VER 0.0.60\nAUG_10_2016'
ghenv.Component.IconDisplayMode = ghenv.Component.IconDisplayMode.application
ghenv.Component.Category = "Honeybee"
ghenv.Component.SubCategory = "10 | Energy | Energy"
#compatibleHBVersion = VER 0.0.57\nNOV_01_2015
#compatibleLBVersion = VER 0.0.59\nFEB_01_2015
ghenv.Component.AdditionalHelpFromDocStrings = "2"

import rhinoscriptsyntax as rs
import Rhino as rc
import scriptcontext as sc
import os
import System
import Grasshopper.Kernel as gh
import uuid

tolerance = sc.doc.ModelAbsoluteTolerance
import math


def main(shdSurfaces, EPTransSchedule, meshingSettings, justBoundingBox):
    
    # import the classes
    if sc.sticky.has_key('honeybee_release'):

        try:
            if not sc.sticky['honeybee_release'].isCompatible(ghenv.Component): return -1
            if sc.sticky['honeybee_release'].isInputMissing(ghenv.Component): return -1
        except:
            warning = "You need a newer version of Honeybee to use this compoent." + \
            " Use updateHoneybee component to update userObjects.\n" + \
            "If you have already updated userObjects drag Honeybee_Honeybee component " + \
            "into canvas and try again."
            w = gh.GH_RuntimeMessageLevel.Warning
            ghenv.Component.AddRuntimeMessage(w, warning)
            return -1
        
        # don't customize this part
        hb_EPSrf = sc.sticky["honeybee_EPSurface"]
        hb_EPSHDSurface = sc.sticky["honeybee_EPShdSurface"]
        hb_RADMaterialAUX = sc.sticky["honeybee_RADMaterialAUX"]
        hb_EPObjectsAux = sc.sticky["honeybee_EPObjectsAUX"]()
        HBScheduleList = sc.sticky["honeybee_ScheduleLib"].keys()

        ########################################################################
        #----------------------------------------------------------------------#
        shdBreps = []
        # create bounding box of shading geometries
        if justBoundingBox:
            for brep in shdSurfaces:
                if brep.Faces.Count>1 or not brep.Faces[0].IsPlanar(sc.doc.ModelAbsoluteTolerance):
                    shdBreps.append(brep.GetBoundingBox(True).ToBrep())
                else:
                    shdBreps.append(brep)
        else:
            shdBreps = shdSurfaces
        
        shadingClasses = []
        shadingMeshPreview = []
        
        if meshingSettings == None:
            mp = rc.Geometry.MeshingParameters.Minimal
            mp.SimplePlanes = True
        else:
            mp = meshingSettings
        
        def getRadMaterialName(radMaterial):
            nameStr = radMaterial.split(" ")[2]
            name =  nameStr.split("\n")[0]
            return name
        
        for brepCount, brep in enumerate(shdBreps):
            if brep != None:
                isPlanar = True
                # check planarity
                for face in brep.Faces:
                    if not face.IsPlanar(tolerance):
                        isPlanar = False
                        break
                
                shadingBreps = []
                if not isPlanar:
                    meshArray = rc.Geometry.Mesh.CreateFromBrep(brep, mp)
                    for mesh in meshArray:
                        for meshFace in range(mesh.Faces.Count):
                            vertices = list(mesh.Faces.GetFaceVertices(meshFace))[1:]
                            vertices = vertices + [sc.doc.ModelAbsoluteTolerance]
                            # create the brep from mesh
                            shdBrep = rc.Geometry.Brep.CreateFromCornerPoints(*vertices)
                            shadingBreps.append(shdBrep)
                else:
                    for face in brep.Faces:
                        shadingBreps.append(face.DuplicateFace(False))
                
                for faceCount, shdBrep in enumerate(shadingBreps):
                        thisShading = hb_EPSHDSurface(shdBrep, 1000*brepCount + faceCount, 'shdSrf_' + `brepCount` + '_' + `faceCount` + "_" + str(uuid.uuid4()))
                        
                        # add transmittance schedule if any
                        if EPTransSchedule!=None:
                            schedule= EPTransSchedule.upper()
                            if schedule!=None and not schedule.lower().endswith(".csv") and schedule not in HBScheduleList:
                                msg = "Cannot find " + schedule + " in Honeybee schedule library."
                                print msg
                                ghenv.Component.AddRuntimeMessage(gh.GH_RuntimeMessageLevel.Warning, msg)
                                return -1
                            elif schedule!=None and schedule.lower().endswith(".csv"):
                                # check if csv file is existed
                                if not os.path.isfile(schedule):
                                    msg = "Cannot find the shchedule file: " + schedule
                                    print msg
                                    ghenv.Component.AddRuntimeMessage(gh.GH_RuntimeMessageLevel.Warning, msg)
                                    return -1
                            
                            thisShading.TransmittanceSCH = schedule
                        
                        # add the Rad Material if any
                        if RADMaterial!=None:
                            # if it is just the name of the material make sure it is already defined
                            if len(RADMaterial.split(" ")) == 1:
                                # if the material is not in the library add it to the library
                                if not hb_RADMaterialAUX.isMatrialExistInLibrary(RADMaterial):
                                    warningMsg = "Can't find " + RADMaterial + " in RAD Material Library.\n" + \
                                                "Add the material to the library and try again."
                                    ghenv.Component.AddRuntimeMessage(gh.GH_RuntimeMessageLevel.Warning, warningMsg)
                                    return
                                
                                try:
                                    thisShading.setRADMaterial(RADMaterial)
                                except Exception, e:
                                    print e
                                    warningMsg = "You are using an old version of Honeybee_Honeybee! Update your files and try again."
                                    print warningMsg
                                    ghenv.Component.AddRuntimeMessage(gh.GH_RuntimeMessageLevel.Warning, warningMsg)
                                    return
                                
                                addedToLib = True
                            else:
                                
                                # try to add the material to the library
                                addedToLib, thisShading.RadMaterial = hb_RADMaterialAUX.analyseRadMaterials(RADMaterial, True)
                                
                            if addedToLib==False:
                                warningMsg = "Failed to add " + RADMaterial + " to the Library."
                                ghenv.Component.AddRuntimeMessage(gh.GH_RuntimeMessageLevel.Warning, warningMsg)
                                return
                        
                        # add shading to the list
                        shadingClasses.append(thisShading)
                
        # add to the hive
        hb_hive = sc.sticky["honeybee_Hive"]()
        HBContext  = hb_hive.addToHoneybeeHive(shadingClasses, ghenv.Component.InstanceGuid.ToString())
        return HBContext
        ################################################################################################
    else:
        print "You should first let Honeybee to fly..."
        w = gh.GH_RuntimeMessageLevel.Warning
        ghenv.Component.AddRuntimeMessage(w, "You should first let Honeybee to fly...")
        return -1
        

if _shdSurfaces and _shdSurfaces[0]!=None:
    # add cleaning function
    result= main(_shdSurfaces, EPTransSchedule_, meshingSettings_, justBoundingBox_)
    
    if result != -1: HBContext = result
# ---------- end hb_epcontextsrf ----------
louvers = Brep([<brep referenced from the Rhino model> x10])

brep_7 = Brep(<brep referenced from the Rhino model>)
wires_5 = BrepWireframe(Brep=brep_7, Density=-1)
createhbsrfs_2 = Honeybee_createHBSrfs(geometry=brep_7, srfType="2")  # -> readMe, simplify(HBSurface); plug-in component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

context_2 = Brep([<brep referenced from the Rhino model> x3])
hb_epcontextsrf_2 = HoneybeeEPContextSurfaces(shdSurfaces=flatten(context_2))  # -> HBContext; inputs shdSurfaces: list of Brep, justBoundingBox: Boolean; same code as hb_epcontextsrf
genhbzonetestpts = Honeybee_GenerateZoneTestPoints(HBZone=brep_6, gridSize=Slider(0.3, range=0..1), distBaseSrf=Slider(0.7, range=0..1), moveTestMesh=Toggle(True))  # -> readMe, simplify(testPoints), simplify(ptsVectors), simplify(facesArea), simplify(mesh); plug-in component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

# ---- group: furniture
furniture = Brep(<brep referenced from the Rhino model>)

# ----
radopaquematerial_4 = Honeybee_RadianceOpaqueMaterial(materialName="generic_0.35", RReflectance=".35", GReflectance=".35", BReflectance=".35", roughness=0.05, specularity=0)  # -> avrgRef, RADMaterial; plug-in component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
number_slider_4 = Slider(0.25, range=0..1)
ledge = Brep([<brep referenced from the Rhino model> x11])
createhbsrfs_3 = Honeybee_createHBSrfs(geometry=furniture, RADMaterial=radopaquematerial_4.RADMaterial)  # -> readMe, simplify(HBSurface); plug-in component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

# ---- group: glass facade
glass = Brep(<brep referenced from the Rhino model>)

# ---- group: ceiling
ceiling = Brep(<brep referenced from the Rhino model>)

# ---- group: floor
floor = Brep(<brep referenced from the Rhino model>)

# ----
createhbsrfs_4 = Honeybee_createHBSrfs(geometry=louvers, srfType="6")  # -> readMe, simplify(HBSurface); plug-in component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
decomposebytype = Honeybee_DecomposeBasedOnType(HBZone=glazingcreator.HBObjWGLZ)  # -> walls, interiorWalls, airWalls, windows, interiorWindows, skylights, roofs, ceilings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; plug-in component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

panel_13 = Panel("floor")  # disabled
callfromepconstrlibrary = Honeybee_CallFromEPConstructionLibrary(keywords=panel_13)  # -> ThermMaterials, EPMaterials, EPWindowMaterials, EPConstructions; disabled; plug-in component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
number_slider_5 = Slider(0, range=0..100)  # disabled
item = ListItem(List=callfromepconstrlibrary.EPConstructions, Index=number_slider_5, Wrap=True)  # disabled
decomposeepconstruction = Honeybee_DecomposeEPConstruction(cnstrName=item)  # -> flatten(materials), comments, UValue_SI, UValue_IP, RValue_SI, RValue_IP; disabled; plug-in component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

panel_14 = Panel("slab")  # disabled
callfromepconstrlibrary_2 = Honeybee_CallFromEPConstructionLibrary(keywords=panel_14)  # -> ThermMaterials, EPMaterials, EPWindowMaterials, EPConstructions; disabled; plug-in component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
panel_15 = Panel("2")  # disabled
item_2 = ListItem(List=callfromepconstrlibrary_2.EPConstructions, Index=panel_15, Wrap=True)  # disabled
decomposeepconstruction_2 = Honeybee_DecomposeEPConstruction(cnstrName=item_2)  # -> flatten(materials), comments, UValue_SI, UValue_IP, RValue_SI, RValue_IP; disabled; plug-in component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

preview = CustomPreview(
    Geometry=decomposebytype.groundFloors,
    Shader={ambient=RGB(0, 0, 0), diffuse=RGB(255, 105, 180), emission=RGB(76, 32, 54), shine=0.5, specular=RGB(255, 255, 255), transparency=0})
annualdaylightsimulation = Honeybee_AnnualDaylightSimulation(
    epwWeatherFile=epw_stat_2.epwFile,
    testPoints=genhbzonetestpts.testPoints,
    ptsVectors=genhbzonetestpts.ptsVectors,
    testMesh=genhbzonetestpts.mesh)  # -> analysisRecipe; plug-in component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
toggle_2 = BooleanToggle(True)
makeadiabaticbytype = Honeybee_MakeAdiabaticByType(HBZones=glazingcreator.HBObjWGLZ, roofs=toggle_2, groundFloors=toggle_2)  # -> HBZones; plug-in component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
gethbzoneepschedules = Honeybee_GetZoneEnergyPlusSchedules()  # -> occupancySchedule, occupancyActivitySch, heatingSetPtSchedule, coolingSetPtSchedule, lightingSchedule, equipmentSchedule, infiltrationSchedule; plug-in component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
toggle_3 = BooleanToggle(False)
rundaylightanalysis = Honeybee_RunDaylightSimulation(
    HBObjects=flatten([createhbsrfs_2.HBSurface, brep_6, hb_epcontextsrf_2]),
    analysisRecipe=annualdaylightsimulation,
    writeRad=toggle_3,
    runRad=toggle_3,
    overwriteResults=True)  # -> readMe, analysisType, resultsUnit, results, testPts, resultFiles, radGeoFile, studyFolder, done; plug-in component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

# ---- group: Schedule Based on Program
convertepschvalues = Honeybee_ConvertEnergyPlusScheduleToValues(schName=gethbzoneepschedules.lightingSchedule)  # -> values; plug-in component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
_3dchart_5 = Ladybug_3DChart(inputData=flatten(convertepschvalues))  # -> readMe, graphMesh, graphCurves, legend, legendBasePts, title, titleBasePts, dataPts, conditionalHOY; disabled; plug-in component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
panel_16 = Panel(convertepschvalues)

# ----
panel_17 = Panel("""MAT-CC05 4 HW CONCRETE
MAT-CC05 8 HW CONCRETE""")  # disabled
panel_18 = Panel(decomposeepconstruction.materials)  # disabled
item_3 = ListItem(List=decomposeepconstruction.materials, Index=0, Wrap=True)  # -> Item, Item1; disabled
item_4 = ListItem(List=panel_17, Index=0, Wrap=True)  # -> Item, Item1; disabled
panel_19 = Panel(item)  # disabled
panel_20 = Panel("floor_cnstr_2")  # disabled
panel_21 = Panel("floor_cnstr_1")  # disabled
epconstruction = Honeybee_EnergyPlusConstruction(name=panel_21, layer_1=item_3.Item, layer_2=item_3.Item1, layer_3=item_4.Item)  # -> EPConstruction; disabled; plug-in component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
epconstruction_2 = Honeybee_EnergyPlusConstruction(name=panel_20, layer_1=item_3.Item, layer_2=item_3.Item1, layer_3=item_4.Item1)  # -> EPConstruction; disabled; plug-in component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

panel_22 = Panel(rundaylightanalysis.readMe)
occupancygenerator_2 = Honeybee_DaysimOccupancyGenerator(weekendDays=[1, 2], writeTheOcc=Toggle(True))  # -> occupancyFile; plug-in component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
readannualresultsi = Honeybee_ReadAnnualResultI(
    illFilesAddress=rundaylightanalysis.resultFiles,
    testPoints=simplify(rundaylightanalysis.testPts),
    occupancyFiles=occupancygenerator_2,
    DLAIllumThresholds=300,
    runIt=Toggle(False))  # -> DLA, UDLI_Less_100, UDLI_100_2000, UDLI_More_2000, CDA, sDA, annualProfiles, htmReport; plug-in component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

panel_23 = Panel("""Construction,
    Dbl LoE (e3=.1) Clr 3mm/13mm Arg,  !- Name
    CLEAR 3MM,               !- Outside Layer
    ARGON 13MM,              !- Layer 2
    LoE CLEAR 3MM Rev;       !- Layer 3""")  # disabled
panel_24 = Panel("""WindowMaterial:Gas,
    ARGON 13MM,               !- Name
    Argon,                   !- Gas Type
    0.0127;                  !- Thickness {m}""")  # disabled
panel_25 = Panel("""WindowMaterial:Glazing,
    LoE CLEAR 3MM Rev,       !- Name
    SpectralAverage,         !- Optical Data Type
    ,                        !- Window Glass Spectral Data Set Name
    0.003,                   !- Thickness {m}
    0.630,                   !- Solar Transmittance at Normal Incidence
    0.220,                   !- Front Side Solar Reflectance at Normal Incidence
    0.190,                   !- Back Side Solar Reflectance at Normal Incidence
    0.850,                   !- Visible Transmittance at Normal Incidence
    0.079,                   !- Front Side Visible Reflectance at Normal Incidence
    0.056,                   !- Back Side Visible Reflectance at Normal Incidence
    0.0,                     !- Infrared Transmittance at Normal Incidence
    0.10,                    !- Front Side Infrared Hemispherical Emissivity
    0.84,                    !- Back Side Infrared Hemispherical Emissivity
    0.9;                     !- Conductivity {W/m-K}""")  # disabled
toggle_4 = BooleanToggle(True)  # disabled
addtoeplibrary = Honeybee_AddToEnergyPlusLibrary(EPObject=[panel_23, panel_24, panel_25], addToProjectLib=toggle_4, overwrite=toggle_4)  # -> readMe; disabled; plug-in component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

panel_26 = Panel(readannualresultsi.sDA)

number_slider_6 = Slider(77, range=0..100)  # disabled
points = PointList(Points=rundaylightanalysis.testPts)  # disabled
item_5 = ListItem(List=rundaylightanalysis.testPts, Index=number_slider_6, Wrap=True)  # disabled
readdshourlyresults = Honeybee_ReadDSResultForAPoint(illFilesAddress=rundaylightanalysis.resultFiles, testPoints=rundaylightanalysis.testPts, targetPoint=item_5)  # -> annualIllumNoDynamicSHD, annualIllumDynamicSHDGroupI, annualIllumDynamicSHDGroupII, iIlluminanceBasedOnOccupancy; disabled; plug-in component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
number_slider_7 = Slider(0.25, range=0..1)  # disabled
number_slider_8 = Slider(0, range=0..100)  # disabled
_3dchart_6 = Ladybug_3DChart(inputData=flatten(readdshourlyresults.annualIllumNoDynamicSHD), xScale=number_slider_7, zScale=number_slider_8)  # -> readMe, graphMesh, graphCurves, legend, legendBasePts, title, titleBasePts, dataPts, conditionalHOY; disabled; plug-in component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

gradientlibrary_3 = Ladybug_GradientLibrary(gradIndex=Slider(12, range=0..22))  # -> customColors; plug-in component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

# ----
# Run the analysis
# Visualize the results
panel_27 = Panel("15")
genclimatebasedsky = Honeybee_GenerateClimateBasedSky(weatherFile=epw_stat_2.epwFile, month="12", day="21", hour=panel_27)  # -> radiationValues, skyFilePath; plug-in component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
gridbasedsimulation = Honeybee_GridBasedSimulation(
    skyFile=genclimatebasedsky.skyFilePath,
    testPoints=genhbzonetestpts.testPoints,
    ptsVectors=genhbzonetestpts.ptsVectors,
    testMesh=genhbzonetestpts.mesh,
    simulationType=0)  # -> analysisRecipe; plug-in component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
toggle_5 = BooleanToggle(False)
rundaylightanalysis_2 = Honeybee_RunDaylightSimulation(
    HBObjects=flatten([brep_6, hb_epcontextsrf_2, createhbsrfs_2.HBSurface]),
    analysisRecipe=gridbasedsimulation,
    writeRad=toggle_5,
    runRad=toggle_5,
    overwriteResults=True)  # -> readMe, analysisType, resultsUnit, results, testPts, resultFiles, radGeoFile, studyFolder, done; plug-in component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
gradientlibrary_4 = Ladybug_GradientLibrary(gradIndex=Slider(1, range=0..10))  # -> customColors; plug-in component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
panel_28 = Panel(rundaylightanalysis_2.readMe)
legendpar_5 = Ladybug_LegendParameters(
    lowBound=Slider(200, range=0..1000),
    highBound=Slider(2000, range=0..2000),
    numSegments=Slider(10, range=0..10),
    customColors=flatten(gradientlibrary_4))  # -> legendPar; plug-in component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
recolormesh = Ladybug_RecolorMesh(
    analysisResult=rundaylightanalysis_2.results,
    inputMesh=genhbzonetestpts.mesh,
    legendPar=legendpar_5,
    analysisTitle=rundaylightanalysis_2.analysisType,
    legendTitle=rundaylightanalysis_2.resultsUnit,
    bakeIt=Toggle(True),
    layerName="BASE-illuminance_122115")  # -> readMe, newMesh, newLegend, legendBasePt, meshColors, legendColors; plug-in component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
panel_29 = Panel(rundaylightanalysis_2.resultsUnit)

# ---- group: make it 3D!
dom = ConstructDomain(DomainStart=0, DomainEnd=Slider(1, range=0..1))

# ----
legendpar_6 = Ladybug_LegendParameters(lowBound=Slider(0, range=0..100), highBound=Slider(100, range=0..1000))  # -> legendPar; plug-in component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
legendpar_7 = Ladybug_LegendParameters(lowBound=Slider(0, range=0..100), highBound=Slider(100, range=0..1000))  # -> legendPar; plug-in component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

dsannualprofiles = Honeybee_DaysimAnnualProfiles(annualProfiles=readannualresultsi.annualProfiles)  # -> simplify(occupancyProfile), simplify(shadingProfiles), simplify(lightingControlProfiles), simplify(dgpProfile); disabled; plug-in component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
number_slider_9 = Slider(0.25, range=0..1)  # disabled
number_slider_10 = Slider(0, range=0..100)  # disabled
pt_5 = Point(Point(68, 332, 0))  # disabled
_3dchart_7 = Ladybug_3DChart(
    inputData=flatten(dsannualprofiles.lightingControlProfiles),
    basePoint=pt_5,
    xScale=number_slider_9,
    zScale=number_slider_10)  # -> readMe, graphMesh, graphCurves, legend, legendBasePts, title, titleBasePts, dataPts, conditionalHOY; disabled; plug-in component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

# ---- group: make it 3D!
dom_2 = ConstructDomain(DomainStart=0, DomainEnd=Slider(1, range=0..1))

# ----
setepzoneschedules = Honeybee_SetEnergyPlusZoneSchedules(HBZones=makeadiabaticbytype, lightingSchedules=readannualresultsi.annualProfiles)  # -> schedules, simplify(HBZones); plug-in component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
recolormesh_2 = Ladybug_RecolorMesh(
    analysisResult=readannualresultsi.DLA,
    inputMesh=genhbzonetestpts.mesh,
    legendPar=legendpar_6,
    analysisTitle="Daylight Autonomy (DLA)",
    legendTitle="%",
    bakeIt=Toggle(False),
    layerName="Daylight Autonomy")  # -> readMe, newMesh, newLegend, legendBasePt, meshColors, legendColors; plug-in component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
recolormesh_3 = Ladybug_RecolorMesh(
    analysisResult=readannualresultsi.UDLI_100_2000,
    inputMesh=genhbzonetestpts.mesh,
    legendPar=legendpar_7,
    analysisTitle="Useful Daylight Illuminance (UDLI)",
    legendTitle="%",
    bakeIt=Toggle(False),
    layerName="UDLI_100-2000lux")  # -> readMe, newMesh, newLegend, legendBasePt, meshColors, legendColors; plug-in component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
setepnatvent = Honeybee_SetEPAirFlow(HBZones=setepzoneschedules.HBZones, naturalVentilationType=Slider(1, range=-1..3), minIndoorTempForNatVent="20")  # -> readMe, simplify(HBZones); plug-in component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
number_slider_11 = Slider(95, range=0..100)  # disabled
toggle_6 = BooleanToggle(False)
toggle_7 = BooleanToggle(True)
larger_2 = LargerThan(FirstNumber=readannualresultsi.DLA, SecondNumber=number_slider_11)  # -> LargerThan, OrEqualTo; disabled
epoutput = Honeybee_GenerateEPOutput(zoneEnergyUse=toggle_7, zoneGainsAndLosses=toggle_7, zoneComfortMetrics=toggle_7, surfaceTempAnalysis="False")  # -> report, flatten(simulationOutputs); plug-in component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
not = GateNot(A=larger_2.LargerThan)  # disabled
# % area with more than 90% daylight autonomy
dispatch = Dispatch(List=rundaylightanalysis.testPts, DispatchPattern=larger_2.LargerThan)  # -> ListA, ListB; disabled
panel_30 = Panel(larger_2.LargerThan)  # disabled
pt_6 = Point(dispatch.ListB)  # disabled
panel_31 = Panel(dispatch.ListA)  # disabled
cullf = CullFaces(Mesh=recolormesh_2.newMesh, Pattern=not)  # disabled
runenergysimulation = Honeybee_RunEnergySimulation(
    epwFile=epw_stat_2.epwFile,
    HBZones=flatten(setepnatvent.HBZones),
    simulationOutputs=flatten(epoutput.simulationOutputs),
    writeIdf=toggle_6,
    runEnergyPlus=toggle_6)  # -> report, idfFileAddress, resultFileAddress; plug-in component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
area = Area(Geometry=cullf)  # -> Area, Centroid; disabled
panel_32 = Panel(area.Area)  # disabled
readepresult = Honeybee_ReadEPResult(resultFileAddress=runenergysimulation.resultFileAddress)  # -> totalThermalLoad, thermalLoadBalance, cooling, heating, electricLight, electricEquip, fanElectric, pumpElectric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; plug-in component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
importepw_2 = Ladybug_ImportEpw(epwFile=epw_stat_2.epwFile)  # -> readMe, latitude, location, dryBulbTemperature, dewPointTemperature, relativeHumidity, windSpeed, windDirection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; plug-in component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
# Calculate Lighting Energy
num = Number(readepresult.electricLight)
ma = MassAddition(Input=num)  # -> Result, PartialResults
panel_33 = Panel(ma.Result)
# Calculate Annual Comfort
adaptivecomfortcalculator = Ladybug_AdaptiveComfortCalculator(
    dryBulbTemperature=readepresult.airTemperature,
    meanRadiantTemperature=readepresult.meanRadTemperature,
    prevailingOutdoorTemp=importepw_2.dryBulbTemperature,
    runIt=Toggle(True))  # -> readMe, port, comfortableOrNot, conditionOfPerson, degreesFromTarget, port_2, targetTemperature, upperTemperatureBound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; plug-in component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
pt_7 = Point(Point(70, -11, 0))
# Visualize
_3dchart_8 = Ladybug_3DChart(
    inputData=flatten([adaptivecomfortcalculator.conditionOfPerson, importepw_2.dryBulbTemperature]),
    basePoint=pt_7,
    xScale=Slider(0.3, range=0..1),
    zScale=Slider(0, range=0..100))  # -> readMe, graphMesh, graphCurves, legend, legendBasePts, title, titleBasePts, dataPts, conditionalHOY; plug-in component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

# ----
# Construction
# infiltration rate
# Rotation Angle
# Blinds
# Blinds
# Construction
# Thermal Mass
bldgprograms = Honeybee_bldgPrograms({"Office": 0, "Retail": 1, "MidriseApartment": 2, "PrimarySchool": 3, "SecondarySchool": 4, "SmallHotel": 5, "LargeHotel": 6, "Hospital": 7, "Outpatient": 8, "Warehouse": 9, "SuperMarket": 10, "FullServiceRestaurant": 11, "QuickServiceRestaurant": 12}, selected="MidriseApartment")  # disabled
# Energy
listzoneprograms = Honeybee_ListZonePrograms(bldgProgram=bldgprograms)  # -> zonePrograms; disabled; plug-in component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
panel_34 = Panel(listzoneprograms)  # disabled
list_4 = Honeybee_ItemSelector(listzoneprograms)  # disabled
list_5 = ValueList({"Existing Slab Construction": "0", "+4 Inches Concrete": "1", "+8 Inches Concrete": "2"}, selected="Existing Slab Construction")  # disabled
toggle_8 = BooleanToggle(False)  # disabled
toggle_9 = BooleanToggle(True)  # disabled
brep_8 = Brep([<brep referenced from the Rhino model> x2])  # disabled
panel_35 = Panel("""hall
room""")  # disabled
brep_9 = Brep(<brep referenced from the Rhino model>)  # disabled
number_slider_12 = Slider(1, range=0..1)  # disabled
mass2zone_3 = Honeybee_Masses2Zones(
    zoneMasses=flatten(brep_8),
    zoneNames=panel_35,
    zonePrograms=list_4,
    isConditioned=toggle_8,
    maxRoofAngle=30,
    createHBZones=toggle_9)  # -> readMe, HBZones; disabled; plug-in component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
item_6 = ListItem(List=brep_8, Index=number_slider_12, Wrap=True)  # disabled
toggle_10 = BooleanToggle(True)  # disabled
solveadjc = Honeybee_SolveAdjacencies(HBZones=flatten(mass2zone_3.HBZones), removeCurrentAdjc=False, findAdjc=toggle_10)  # -> readMe, HBZonesWADJ; disabled; plug-in component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
brep_10 = Brep(<brep referenced from the Rhino model>)  # disabled
brep_11 = Brep(<brep referenced from the Rhino model>)  # disabled
askme = Honeybee_AskMe(HBObjects=mass2zone_3.HBZones)  # -> readMe; disabled; plug-in component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
addhbglz = Honeybee_addHBGlz(HBObj=solveadjc.HBZonesWADJ, childSurfaces=flatten(brep_11))  # -> HBObjWGLZ; disabled; plug-in component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
panel_36 = Panel(askme)  # disabled
volume = Volume(Geometry=addhbglz)  # -> Volume, Centroid; disabled
gethbzoneeploads = Honeybee_GetZoneEnergyPlusLoads(HBZone=mass2zone_3.HBZones)  # -> equipmentLoadPerArea, infiltrationRatePerArea, lightingDensityPerArea, numOfPeoplePerArea, ventilationPerArea, ventilationPerPerson; disabled; plug-in component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
gethbzoneepschedules_2 = Honeybee_GetZoneEnergyPlusSchedules(HBZone=mass2zone_3.HBZones)  # -> occupancySchedule, occupancyActivitySch, heatingSetPtSchedule, coolingSetPtSchedule, lightingSchedule, equipmentSchedule, infiltrationSchedule; disabled; plug-in component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
decomposebytype_2 = Honeybee_DecomposeBasedOnType(HBZone=addhbglz)  # -> walls, interiorWalls, airWalls, windows, interiorWindows, skylights, roofs, ceilings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; disabled; plug-in component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
rotatehbobj = Honeybee_RotateHoneybee()  # -> HBObj; disabled; plug-in component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
panel_37 = Panel(gethbzoneepschedules_2.occupancySchedule)  # disabled
wires_6 = BrepWireframe(Brep=addhbglz, Density=-1)  # disabled
swatch = ColourSwatch(SwatchColor=RGBA(162, 240, 250, 176))  # disabled
preview_2 = CustomPreview(Geometry=decomposebytype_2.windows, Shader=swatch)  # disabled
convertepschvalues_2 = Honeybee_ConvertEnergyPlusScheduleToValues(schName=panel_37)  # -> values; disabled; plug-in component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
number_slider_13 = Slider(0.3, range=0..1)  # disabled
toggle_11 = BooleanToggle(False)  # disabled
panel_38 = Panel("0")  # disabled
_3dchart_9 = Ladybug_3DChart(inputData=flatten(convertepschvalues_2), xScale=number_slider_13, zScale=panel_38, bakeIt=toggle_11)  # -> readMe, graphMesh, graphCurves, legend, legendBasePts, title, titleBasePts, dataPts, conditionalHOY; disabled; plug-in component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
number_slider_14 = Slider(0, range=-90..90)  # disabled
rotatehbobj_2 = Honeybee_RotateHoneybee(HBObj=addhbglz, angle=number_slider_14, cenPt=volume.Centroid)  # -> HBObj; disabled; plug-in component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
wires_7 = BrepWireframe(Brep=rotatehbobj_2, Density=-1)  # disabled
setepzonecnstr = Honeybee_SetEPZoneConstruction(HBZone=addhbglz, wallEPConstruction=list_3, windowEPConstruction=list, roofEPConstruction=list_2)  # -> simplify(modifiedHBZone); disabled; plug-in component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
filter = StreamFilter(Gate=list_5, Stream0=panel_19, Stream1=epconstruction, Stream2=epconstruction_2)  # disabled
setepzoneundergroundcnstr = Honeybee_SetEPZoneUndergroundConstruction(HBZone=flatten(setepzonecnstr), groundFloorEPConstruction=filter)  # -> simplify(modifiedHBZone); disabled; plug-in component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
panel_39 = Panel("base_case")  # disabled
run_energyplus = BooleanToggle(False)  # disabled
srf = Surface(<surface referenced from the Rhino model>)  # disabled
srf_2 = Surface(<surface referenced from the Rhino model>)  # disabled
area_2 = Area(Geometry=srf)  # -> Area, Centroid; disabled
area_3 = Area(Geometry=srf_2)  # -> Area, Centroid; disabled
division_2 = Division(A=area_3.Area, B=area_2.Area)  # disabled
panel_40 = Panel(division_2)  # disabled
number_slider_15 = Slider(-30, range=-90..90)  # disabled
toggle_12 = BooleanToggle(False)  # disabled
xy = XYPlane(Origin=Point(0, 0, 0))  # disabled
number_slider_16 = Slider(0, range=0..100)  # disabled
pl_origin = PlaneOrigin(Base=xy, Origin=volume.Centroid)  # disabled
rad = Radians(Degrees=number_slider_16)  # disabled
srf_3 = Surface([<surface referenced from the Rhino model> x10])  # disabled
rotate = Rotate(Angle=rad, Plane=pl_origin)  # -> Geometry, Transform; disabled
panel_41 = Panel("https://www.energyplus.net/weather-download/north_and_central_america_wmo_region_4/USA/PA/USA_PA_Philadelphia.Intl.AP.724080_TMY3/all")  # disabled
toggle_13 = BooleanToggle(True)  # disabled
epoutput_2 = Honeybee_GenerateEPOutput(zoneGainsAndLosses=toggle_13, zoneComfortMetrics=toggle_13, surfaceTempAnalysis="False")  # -> report, flatten(simulationOutputs); disabled; plug-in component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
epw_stat_3 = Ladybug_OpenEPWAndSTATWeatherFiles(weatherFileURL=panel_41)  # -> epwFile, statFile; disabled; plug-in component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
panel_42 = Panel(" ")  # disabled
panel_43 = Panel("_")  # disabled
path = FilePath(epw_stat_3.epwFile)  # disabled
rep = ReplaceText(Text=panel_39, Find=panel_42, Replace=panel_43, RecursiveReplace=False)  # disabled
importepw_3 = Ladybug_ImportEpw(epwFile=path)  # -> readMe, latitude, location, dryBulbTemperature, dewPointTemperature, relativeHumidity, windSpeed, windDirection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; disabled; plug-in component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
toggle_14 = BooleanToggle(True)  # disabled
panel_44 = Panel("-1")  # disabled
panel_45 = Panel("1")  # disabled
panel_46 = Panel("3")  # disabled
panel_47 = Panel("20")  # disabled
legendpar_8 = Ladybug_LegendParameters(lowBound=panel_44, highBound=panel_45, numSegments=panel_46)  # -> legendPar; disabled; plug-in component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
panel_48 = Panel("35")  # disabled
panel_49 = Panel("40")  # disabled
panel_50 = Panel(".025")  # disabled
panel_51 = Panel("0.125")  # disabled
vec = VectorXYZ(XComponent=panel_47, YComponent=0, ZComponent=0)  # -> Vector, Length; disabled
number_slider_17 = Slider(0, range=0..100)  # disabled
vec_2 = VectorXYZ(XComponent=panel_49, YComponent=panel_48, ZComponent=0)  # -> Vector, Length; disabled
pt_8 = Point(Point(23.10617158, 0, 0))  # disabled
move_5 = Move(Geometry=pt_8, Motion=vec.Vector)  # -> Geometry, Transform; disabled
move_6 = Move(Geometry=pt_8, Motion=vec_2.Vector)  # -> Geometry, Transform; disabled
toggle_15 = BooleanToggle(True)  # disabled
panel_52 = Panel("""Comfortable (%): 
hot (%):         
cold (%):        """)  # disabled
flip = FlipMatrix(Data=panel_52)  # -> simplify(Data); disabled
panel_53 = Panel("")  # disabled
panel_54 = Panel("20")  # disabled
panel_55 = Panel("-45")  # disabled
pt_9 = Point(Point(-17, 4, 0))  # disabled
swatch_2 = ColourSwatch(SwatchColor=RGB(0, 0, 0))  # disabled
vec_3 = VectorXYZ(XComponent=panel_54, YComponent=panel_55, ZComponent=0)  # -> Vector, Length; disabled
move_7 = Move(Geometry=pt_8, Motion=vec_3.Vector)  # -> Geometry, Transform; disabled
panel_56 = Panel("0.6")  # disabled

decomposebytype_3 = Honeybee_DecomposeBasedOnType(HBZone=setepzoneundergroundcnstr)  # -> walls, interiorWalls, airWalls, windows, interiorWindows, skylights, roofs, ceilings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; disabled; plug-in component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
shddesigner = Ladybug_ShadingDesigner(
    glzSrf=flatten(decomposebytype_3.windows),
    depthOrVector=flatten(shading_depth),
    numOfShds=number_of_blinds,
    runIt=add_blinds,
    port_4=False,
    horOrVertical=toggle_12,
    shdAngle=number_slider_15)  # -> readMe, shadingSrfs; disabled; plug-in component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
wires_8 = BrepWireframe(Brep=srf_3, Density=-1)  # disabled
swatch_3 = ColourSwatch(SwatchColor=RGBA(0, 0, 0, 194))  # disabled
hb_epcontextsrf_3 = HoneybeeEPContextSurfaces(shdSurfaces=flatten(srf_3))  # -> HBContext; inputs shdSurfaces: list of Brep, justBoundingBox: Boolean; disabled
# ---------- hb_epcontextsrf_3: Python ----------
"""
prepare shading/context geometries

    Args:
        northVectorOrRotation: A vector that shows North or a number that shows
                               the rotation of the North from the Y axis
        bldgMasses: List of closed Breps as thermal zones.
    Returns:
        report: ...
        thermalZones: Thermal zone's geometries for visualiza
"""

ghenv.Component.Name = 'Honeybee EP context Surfaces'
ghenv.Component.NickName = 'HB_EPContextSrf'
ghenv.Component.Message = 'VER 0.0.59\nJAN_26_2016'
ghenv.Component.IconDisplayMode = ghenv.Component.IconDisplayMode.application
ghenv.Component.Category = "Honeybee"
ghenv.Component.SubCategory = "09 | Energy | Energy"
#compatibleHBVersion = VER 0.0.57\nNOV_01_2015
#compatibleLBVersion = VER 0.0.59\nFEB_01_2015
ghenv.Component.AdditionalHelpFromDocStrings = "2"

import rhinoscriptsyntax as rs
import Rhino as rc
import scriptcontext as sc
import os
import System
import Grasshopper.Kernel as gh
import uuid

tolerance = sc.doc.ModelAbsoluteTolerance
import math


def main(shdSurfaces, EPTransSchedule, meshingSettings, justBoundingBox):
    
    # import the classes
    if sc.sticky.has_key('honeybee_release'):

        try:
            if not sc.sticky['honeybee_release'].isCompatible(ghenv.Component): return -1
            if sc.sticky['honeybee_release'].isInputMissing(ghenv.Component): return -1
        except:
            warning = "You need a newer version of Honeybee to use this compoent." + \
            " Use updateHoneybee component to update userObjects.\n" + \
            "If you have already updated userObjects drag Honeybee_Honeybee component " + \
            "into canvas and try again."
            w = gh.GH_RuntimeMessageLevel.Warning
            ghenv.Component.AddRuntimeMessage(w, warning)
            return -1
        
        # don't customize this part
        hb_EPSrf = sc.sticky["honeybee_EPSurface"]
        hb_EPSHDSurface = sc.sticky["honeybee_EPShdSurface"]
        hb_RADMaterialAUX = sc.sticky["honeybee_RADMaterialAUX"]
        hb_EPObjectsAux = sc.sticky["honeybee_EPObjectsAUX"]()
        HBScheduleList = sc.sticky["honeybee_ScheduleLib"].keys()

        ########################################################################
        #----------------------------------------------------------------------#
        shdBreps = []
        # create bounding box of shading geometries
        if justBoundingBox:
            for brep in shdSurfaces:
                if brep.Faces.Count>1 or not brep.Faces[0].IsPlanar(sc.doc.ModelAbsoluteTolerance):
                    shdBreps.append(brep.GetBoundingBox(True).ToBrep())
                else:
                    shdBreps.append(brep)
        else:
            shdBreps = shdSurfaces
        
        shadingClasses = []
        shadingMeshPreview = []
        
        if meshingSettings == None:
            mp = rc.Geometry.MeshingParameters.Minimal
            mp.SimplePlanes = True
        else:
            mp = meshingSettings
        
        def getRadMaterialName(radMaterial):
            nameStr = radMaterial.split(" ")[2]
            name =  nameStr.split("\n")[0]
            return name
        
        for brepCount, brep in enumerate(shdBreps):
            if brep != None:
                isPlanar = True
                # check planarity
                for face in brep.Faces:
                    if not face.IsPlanar(tolerance):
                        isPlanar = False
                        break
                
                shadingBreps = []
                if not isPlanar:
                    meshArray = rc.Geometry.Mesh.CreateFromBrep(brep, mp)
                    for mesh in meshArray:
                        for meshFace in range(mesh.Faces.Count):
                            vertices = list(mesh.Faces.GetFaceVertices(meshFace))[1:]
                            vertices = vertices + [sc.doc.ModelAbsoluteTolerance]
                            # create the brep from mesh
                            shdBrep = rc.Geometry.Brep.CreateFromCornerPoints(*vertices)
                            shadingBreps.append(shdBrep)
                else:
                    for face in brep.Faces:
                        shadingBreps.append(face.DuplicateFace(False))
                
                for faceCount, shdBrep in enumerate(shadingBreps):
                        thisShading = hb_EPSHDSurface(shdBrep, 1000*brepCount + faceCount, 'shdSrf_' + `brepCount` + '_' + `faceCount` + "_" + str(uuid.uuid4()))
                        
                        # add transmittance schedule if any
                        if EPTransSchedule!=None:
                            schedule= EPTransSchedule.upper()
                            if schedule!=None and not schedule.lower().endswith(".csv") and schedule not in HBScheduleList:
                                msg = "Cannot find " + schedule + " in Honeybee schedule library."
                                print msg
                                ghenv.Component.AddRuntimeMessage(gh.GH_RuntimeMessageLevel.Warning, msg)
                                return -1
                            elif schedule!=None and schedule.lower().endswith(".csv"):
                                # check if csv file is existed
                                if not os.path.isfile(schedule):
                                    msg = "Cannot find the shchedule file: " + schedule
                                    print msg
                                    ghenv.Component.AddRuntimeMessage(gh.GH_RuntimeMessageLevel.Warning, msg)
                                    return -1
                            
                            thisShading.TransmittanceSCH = schedule
                        
                        # add the Rad Material if any
                        if RADMaterial!=None:
                            # if it is just the name of the material make sure it is already defined
                            if len(RADMaterial.split(" ")) == 1:
                                # if the material is not in the library add it to the library
                                if not hb_RADMaterialAUX.isMatrialExistInLibrary(RADMaterial):
                                    warningMsg = "Can't find " + RADMaterial + " in RAD Material Library.\n" + \
                                                "Add the material to the library and try again."
                                    ghenv.Component.AddRuntimeMessage(gh.GH_RuntimeMessageLevel.Warning, warningMsg)
                                    return
                                
                                try:
                                    thisShading.setRADMaterial(RADMaterial)
                                except Exception, e:
                                    print e
                                    warningMsg = "You are using an old version of Honeybee_Honeybee! Update your files and try again."
                                    print warningMsg
                                    ghenv.Component.AddRuntimeMessage(gh.GH_RuntimeMessageLevel.Warning, warningMsg)
                                    return
                                
                                addedToLib = True
                            else:
                                
                                # try to add the material to the library
                                addedToLib, thisShading.RadMaterial = hb_RADMaterialAUX.analyseRadMaterials(RADMaterial, True)
                                
                            if addedToLib==False:
                                warningMsg = "Failed to add " + RADMaterial + " to the Library."
                                ghenv.Component.AddRuntimeMessage(gh.GH_RuntimeMessageLevel.Warning, warningMsg)
                                return
                        
                        # add shading to the list
                        shadingClasses.append(thisShading)
                
        # add to the hive
        hb_hive = sc.sticky["honeybee_Hive"]()
        HBContext  = hb_hive.addToHoneybeeHive(shadingClasses, ghenv.Component.InstanceGuid.ToString())
        return HBContext
        ################################################################################################
    else:
        print "You should first let Honeybee to fly..."
        w = gh.GH_RuntimeMessageLevel.Warning
        ghenv.Component.AddRuntimeMessage(w, "You should first let Honeybee to fly...")
        return -1
        

if _shdSurfaces and _shdSurfaces[0]!=None:
    # add cleaning function
    result= main(_shdSurfaces, EPTransSchedule_, meshingSettings_, justBoundingBox_)
    
    if result != -1: HBContext = result
# ---------- end hb_epcontextsrf_3 ----------
preview_3 = CustomPreview(Geometry=wires_8, Shader=swatch_3)  # disabled

ach2m3_s_m2_calculator = HoneybeeInfORventPerAreaCalculator(HBZones=flatten(setepzoneundergroundcnstr), airChangeHour=number_slider_3)  # -> out, infORventPerArea, allFloors; disabled; plug-in component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
setepzoneloads = Honeybee_SetEnergyPlusZoneLoads(HBZones=flatten(setepzoneundergroundcnstr), infiltrationRatePerArea=ach2m3_s_m2_calculator.infORventPerArea)  # -> loads, HBZones; disabled; plug-in component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

# ----
# Geometry Preparation
# Honeybee default materials will be assigned
# based on surface type
# Run the analysis
# Assign specific materials
# DGP: Daylight glare probability:
# Imperceptible Glare [0.35 > DGP]
# Perceptible Glare [0.4 > DGP >= 0.35]
# Disturbing Glare [0.45 > DGP >= 0.4]
# Intolerable Glare [DGP >= 0.45]
# Analysis Recipe
# set the view
number_slider_18 = Slider(0, range=0..2)
number_slider_19 = Slider(0, range=0..2)
hours = Panel("""9
12
15""")
months = Panel("""3
6
12""")
fly = Ladybug_fly(inputSliders=[number_slider_19, number_slider_18], fly=Button())  # -> Vviiiiiiiiiizzz; plug-in component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
panel_57 = Panel("https://www.energyplus.net/weather-download/north_and_central_america_wmo_region_4/USA/PA/USA_PA_Philadelphia.Intl.AP.724080_TMY3/all")
item_7 = ListItem(List=months, Index=number_slider_19, Wrap=True)
item_8 = ListItem(List=hours, Index=number_slider_18, Wrap=True)
epw_stat_4 = Ladybug_OpenEPWAndSTATWeatherFiles(weatherFileURL=panel_57)  # -> epwFile, statFile; plug-in component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
radglassmaterial = Honeybee_RadianceGlassMaterial(materialName="glass_.65", RTransmittance=".65", GTransmittance=".65", BTransmittance=".65", refractiveIndex=1.52)  # -> avrgTrans, RADMaterial; plug-in component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
panel_58 = Panel(item_7)
panel_59 = Panel(item_8)
walls = Brep([<brep referenced from the Rhino model> x5])
number_slider_20 = Slider(0, range=0..100)
createhbsrfs_5 = Honeybee_createHBSrfs(geometry=glass, RADMaterial=radglassmaterial.RADMaterial)  # -> readMe, simplify(HBSurface); plug-in component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
createhbsrfs_6 = Honeybee_createHBSrfs(geometry=floor, srfType="2")  # -> readMe, simplify(HBSurface); plug-in component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
createhbsrfs_7 = Honeybee_createHBSrfs(geometry=ceiling, srfType="3")  # -> readMe, simplify(HBSurface); plug-in component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
genclimatebasedsky_2 = Honeybee_GenerateClimateBasedSky(north=number_slider_20, weatherFile=epw_stat_4.epwFile, month=panel_58, day="21", hour=panel_59)  # -> radiationValues, skyFilePath; plug-in component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
createhbsrfs_8 = Honeybee_createHBSrfs(geometry=walls, srfType="0")  # -> readMe, simplify(HBSurface); plug-in component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
genavgsky = Honeybee_GenerateAverageSky(north=number_slider_20, weatherFile=epw_stat_4.epwFile, month=panel_58, hour=panel_59)  # -> radiationValues, skyFilePath; plug-in component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
northarrow = Ladybug_North(north=number_slider_20, scale=".05")  # -> northSign; plug-in component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
geo = Geometry(northarrow)
panel_60 = Panel([genclimatebasedsky_2.radiationValues, genavgsky.radiationValues])
radparameters = Honeybee_RADParameters(quality=1, ab="3")  # -> readMe, radParameters; plug-in component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
doy_hoy = Ladybug_DOY_HOY(days="21", months=panel_58, hours=panel_59)  # -> HOY, DOY, date; plug-in component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
set_the_view_to_fisheye_for_glare_analys = Panel("1")  # "set the view to FishEye for Glare Analysis"
imagebasedsimulation = Honeybee_ImageBasedSimulation(
    skyFile=genavgsky.skyFilePath,
    cameraType=set_the_view_to_fisheye_for_glare_analys,
    simulationType=2,
    imageWidth=Slider(800, range=0..10000),
    imageHeight=Slider(800, range=0..10000),
    radParameters=radparameters.radParameters,
    backupImages=0)  # -> analysisRecipe; plug-in component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
toggle_16 = BooleanToggle(False)
panel_61 = Panel("""Radiance
Grasshopper
Honeybee
Glare
Daylight
Set View
HBExampleFiles""")
panel_62 = Panel("""This file shows how to run a glare analysis using Honeybee. This example is using same geometry as the other daylighting examples [[1](http://hydrashare.github.io/hydra/viewer?owner=mostaphaRoudsari&fork=hydra_1&id=Surface_by_surface_geometry_preparation_for_daylight_simulation_II), [2](http://hydrashare.github.io/hydra/viewer?owner=mostaphaRoudsari&fork=hydra_1&id=Find_when_sun_is_visible_to_a_point)].
The example is uses Averaged Climate-based Sky for glare analysis which uses the average value for that hour during the whole month.""")
area_4 = Area(Geometry=floor)  # -> Area, Centroid
panel_63 = Panel("C:\Users\Administrator\Dropbox\ladybug\helpDesk\PennDesign2015\Daylight_Glare_Analysis.png")
exporthydra = Hydra_ExportFile(
    fileName="Glare Analysis",
    fileDescription=panel_62,
    fileTags=panel_61,
    targetFolder="C:\Users\Administrator\Documents\GitHub\hydra_1",
    includeRhino=Toggle(True),
    additionalImgs=panel_63,
    export=Toggle(False))  # -> readMe; inputs fileDescription: list, changeLog: list, fileTags: list, includeRhino: Boolean, GHForThumb: Boolean, additionalImgs: list, export: Boolean; plug-in component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
pt_10 = Point(<point referenced from the Rhino model>)
md_slider = MDSlider(
    slider_value=Point(0.5014235334, 0.4980185904, 0.5),
    SliderMode=0,
    x_domain=Domain(-1, 1),
    y_domain=Domain(-1, 1),
    z_domain=Domain(0, 1))
number_slider_21 = Slider(0.8, range=0..1)

# ---- group: For better visualization - Doesn't effect the results of the analysis
importlocation = Ladybug_ImportLocation(epwFile=epw_stat_4.epwFile)  # -> location; plug-in component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
sunpath_2 = Ladybug_SunPath(
    north=number_slider_20,
    location=importlocation,
    hour=panel_59,
    day="21",
    month=panel_58,
    timeStep=1,
    sunPathScale=Slider(0.2, range=0..1),
    dailyOrAnnualSunPath=True)  # -> readMe, sunVectors, sunAltitudes, sunAzimuths, port, sunSpheresMesh, sunPathCrvs, legend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; plug-in component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

# ---- group: collect all honeybee surfaces
brep_12 = Brep(flatten([createhbsrfs_8.HBSurface, createhbsrfs_7.HBSurface, createhbsrfs_6.HBSurface, createhbsrfs_5.HBSurface, createhbsrfs_3.HBSurface, createhbsrfs_4.HBSurface]))

# ----
clean = CleanTree(RemoveNulls=True, RemoveInvalid=True, RemoveEmpty=False, Tree=brep_12)
wires_9 = BrepWireframe(Brep=brep_12, Density=-1)
rundaylightanalysis_3 = Honeybee_RunDaylightSimulation(
    HBObjects=flatten([clean, hb_epcontextsrf]),
    analysisRecipe=imagebasedsimulation,
    writeRad=toggle_16,
    runRad=toggle_16,
    numOfCPUs="4",
    radFileName=doy_hoy.date,
    overwriteResults=True)  # -> readMe, analysisType, resultsUnit, results, testPts, resultFiles, radGeoFile, studyFolder, done; plug-in component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
tif_hdr = Honeybee_ConvertTIFToHDR(TIFFFilePath=rundaylightanalysis_3.resultFiles)  # -> HDRFilePath; plug-in component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
falsecolor = Honeybee_FalseColor(
    HDRFilePath=rundaylightanalysis_3.resultFiles,
    legendMax="3000",
    contourBands=False,
    maskThreshold=0.1,
    useAlterColors=False,
    render=Toggle(True))  # -> outputFilePath; plug-in component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
glareanalysis = Honeybee_GlareAnalysis(HDRImagePath=rundaylightanalysis_3.resultFiles, runIt=Toggle(True))  # -> readMe, glareCheckImage, DGP, DGI, imageWithTaskArea; plug-in component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
hdr_tif = Honeybee_ConvertHDRToTIF(HDRFilePath=falsecolor, adjustExposure=Toggle(False))  # -> TIFFFilePath; plug-in component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
panel_64 = Panel(glareanalysis.DGP)
panel_65 = Panel(hdr_tif)
hdr_tif_2 = Honeybee_ConvertHDRToTIF(HDRFilePath=glareanalysis.glareCheckImage, adjustExposure=Toggle(False))  # -> TIFFFilePath; plug-in component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
panel_66 = Panel(hdr_tif_2)

pt_11 = Point(Point(-8.392553729, -35.02288425, 0))
comfortmannequin = Ladybug_ComfortMannequin(rotationAngle="-10", bodyLocation=pt_10)  # -> mannequinMesh, legend, legendBasePt; plug-in component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

# ---- group: Person's face!
item_9 = ListItem(List=comfortmannequin.mannequinMesh, Index=121, Wrap=True)

# ----
preview_4 = CustomPreview(Geometry=item_9, Shader=ColourSwatch(SwatchColor=RGB(255, 0, 0)))

facen = FaceNormals(Mesh=item_9)  # -> Centers, Normals
settheview = Ladybug_SetTheView(cameraLocation=facen.Centers, cameraDirection=facen.Normals, uvLookAround=md_slider)  # -> readMe; plug-in component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

runenergysimulation_2 = Honeybee_RunEnergySimulation(
    epwFile=path,
    HBZones=flatten(setepzoneloads.HBZones),
    HBContext=flatten(hb_epcontextsrf_3),
    simulationOutputs=flatten(epoutput_2.simulationOutputs),
    writeIdf=run_energyplus,
    runEnergyPlus=run_energyplus,
    idfFileName=rep)  # -> report, idfFileAddress, resultFileAddress; disabled; plug-in component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
panel_67 = Panel(runenergysimulation_2.resultFileAddress)  # disabled
readepsrfresult = Honeybee_ReadEPSurfaceResult(resultFileAddress=runenergysimulation_2.resultFileAddress)  # -> surfaceIndoorTemp, surfaceOutdoorTemp, surfaceEnergyFlow, opaqueEnergyFlow, glazEnergyFlow, windowTotalSolarEnergy, windowBeamEnergy, windowDiffEnergy, windowTransmissivity, otherSurfaceData; disabled; plug-in component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
readepresult_2 = Honeybee_ReadEPResult(resultFileAddress=runenergysimulation_2.resultFileAddress)  # -> totalThermalLoad, thermalLoadBalance, cooling, heating, electricLight, electricEquip, fanElectric, pumpElectric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; disabled; plug-in component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
energybalance = Honeybee_ConstructEnergyBalance(
    HBZones=flatten(setepzoneloads.HBZones),
    cooling=readepresult_2.cooling,
    heating=readepresult_2.heating,
    electricLight=readepresult_2.electricLight,
    electricEquip=readepresult_2.electricEquip,
    peopleGains=readepresult_2.peopleGains,
    totalSolarGain=readepresult_2.totalSolarGain,
    infiltrationEnergy=readepresult_2.infiltrationEnergy,
    surfaceEnergyFlow=readepsrfresult.surfaceEnergyFlow)  # -> readMe, port, flrNormEnergyBal, flrNormBalWStorage, port_2, modelEnergyBalance, energyBalWithStorage; disabled; plug-in component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
adaptivecomfortcalculator_2 = Ladybug_AdaptiveComfortCalculator(
    dryBulbTemperature=readepresult_2.airTemperature,
    meanRadiantTemperature=readepresult_2.meanRadTemperature,
    prevailingOutdoorTemp=importepw_3.dryBulbTemperature,
    runIt=toggle_14)  # -> readMe, port, comfortableOrNot, conditionOfPerson, degreesFromTarget, port_2, targetTemperature, upperTemperatureBound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; disabled; plug-in component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
comfortable_hot_cold = Panel([adaptivecomfortcalculator_2.percentOfTimeComfortable, adaptivecomfortcalculator_2.percentHotCold])  # disabled
psychchart = Ladybug_PsychrometricChart(
    dryBulbTemperature=readepresult_2.airTemperature,
    relativeHumidity=readepresult_2.relativeHumidity,
    basePoint=move_6.Geometry,
    runIt=toggle_15)  # -> readMe, port, totalComfortPercent, totalComfortOrNot, strategyNames, strategyPercentOfTime, strategyOrNot, port_2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; disabled; plug-in component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
_3dchart_10 = Ladybug_3DChart(
    inputData=flatten(adaptivecomfortcalculator_2.conditionOfPerson),
    basePoint=move_5.Geometry,
    xScale=panel_50,
    yScale=panel_51,
    zScale=number_slider_17,
    legendPar=legendpar_8)  # -> readMe, graphMesh, graphCurves, legend, legendBasePts, title, titleBasePts, dataPts, conditionalHOY; disabled; plug-in component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
num_2 = Number(comfortable_hot_cold)  # disabled
expression = Expression(x=num_2, Expression="Round(x, 2)")  # disabled
flip_2 = FlipMatrix(Data=expression)  # -> simplify(Data); disabled
panel_68 = Panel([flip, flip_2])  # disabled
join = TextJoin(Text=panel_68)  # disabled
join_2 = TextJoin(Text=flatten(join), Join=panel_53)  # disabled
tag = TextTag3D(Location=pt_9, Text=join_2, Size=1, Colour=swatch_2, Justification=5)  # disabled

panel_69 = Panel("19")  # disabled
gradientlibrary_5 = Ladybug_GradientLibrary(gradIndex=panel_69)  # -> customColors; disabled; plug-in component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
panel_70 = Panel("-100")  # disabled
panel_71 = Panel("100")  # disabled
toggle_17 = BooleanToggle(True)  # disabled
selectandaveragedata = Ladybug_AverageData(annualHourlyData=energybalance.energyBalWithStorage, totalOrAverage=toggle_17)  # -> readMe, selHourlyData, totaledDaily, totaledMonthly, totMonthlyPerHour, totAnalysisPeriod; disabled; plug-in component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
panel_72 = Panel("Base Room/Office Energy Balance")  # disabled
panel_73 = Panel("Energy (kWh)")  # disabled
toggle_18 = BooleanToggle(True)  # disabled
swatch_4 = ColourSwatch(SwatchColor=RGB(0, 0, 0))  # disabled

legendpar_9 = Ladybug_LegendParameters(lowBound=panel_70, highBound=panel_71, customColors=flatten(gradientlibrary_5))  # -> legendPar; disabled; plug-in component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
barchart = Ladybug_MonthlyBarChart(
    inputData=flatten(selectandaveragedata.totaledMonthly),
    stackValues=toggle_18,
    altTitle=panel_72,
    altYAxisTitle=panel_73,
    basePoint=move_7.Geometry,
    xScale=panel_56,
    yScale=panel_56,
    legendPar=legendpar_9)  # -> readMe, dataMesh, dataCurves, dataCrvColors, graphAxes, graphLabels, title, titleBasePt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; disabled; plug-in component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
strnum = Ladybug_SeparateData(inputList=flatten(selectandaveragedata.totaledMonthly))  # -> numbers, strings; disabled; plug-in component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
tag_2 = TextTag3D(Location=barchart.dataLabelPts, Size=1, Justification=7)  # disabled
panel_74 = Panel(strnum.numbers)  # disabled
panel_75 = Panel(strnum.strings)  # disabled

preview_5 = CustomPreview(Geometry=barchart.graphAxes, Shader=swatch_4)  # disabled
