# Grasshopper definition Siram_Neeharika.gh (Grasshopper 0.9.76)
# plug-ins: Python Interpreter

number_slider = Slider(0, range=0..2)
number_slider_2 = Slider(0, range=0..2)
ladybug = Ladybug_Ladybug()  # -> Vviiiiiiiiiizzz; plug-in component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
honeybee = Honeybee_Honeybee()  # -> Vviiiiiiiiiizzz; plug-in component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
# Animate sliders
button = Button()
hours = Panel("""9
12
15""")
months = Panel("""3
6
12""")
panel = Panel("https://www.energyplus.net/weather-download/north_and_central_america_wmo_region_4/USA/PA/USA_PA_Philadelphia.Intl.AP.724080_TMY3/all")
# Glass material
panel_2 = Panel("tvis_60")
fly = Ladybug_fly(inputSliders=[number_slider_2, number_slider], fly=button)  # -> Vviiiiiiiiiizzz; plug-in component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
item = ListItem(List=hours, Index=number_slider, Wrap=True)
item_2 = ListItem(List=months, Index=number_slider_2, Wrap=True)
epw_stat = Ladybug_OpenEPWAndSTATWeatherFiles(weatherFileURL=panel)  # -> epwFile, statFile; plug-in component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
radglassmaterial = Honeybee_RadianceGlassMaterial(materialName=panel_2, RTransmittance="0.6", GTransmittance="0.6", BTransmittance="0.6", refractiveIndex=1.52)  # -> avrgTrans, RADMaterial; plug-in component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
panel_3 = Panel("""9
12
15""")
panel_4 = Panel("""3
6
12""")
# Generate sky
path = FilePath("C:\ladybug\Philadelphia_International_Ap_PA_USA\Philadelphia_International_Ap_PA_USA.epw")
# Prepare geometries
brep = Brep([<brep referenced from the Rhino model> x6])

# ---- group: glass
brep_2 = Brep([<brep referenced from the Rhino model> x2])

# ----
importlocation = Ladybug_ImportLocation(epwFile=epw_stat.epwFile)  # -> location; plug-in component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
genclimatebasedsky = Honeybee_GenerateClimateBasedSky(weatherFile=epw_stat.epwFile, month=item_2, day="21", hour=item)  # -> radiationValues, skyFilePath; plug-in component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
createhbsrfs = Honeybee_createHBSrfs(geometry=brep)  # -> readMe, simplify(flatten(HBSurface)); plug-in component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
createhbsrfs_2 = Honeybee_createHBSrfs(geometry=brep_2, RADMaterial=radglassmaterial.RADMaterial)  # -> readMe, simplify(HBSurface); plug-in component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
doy_hoy = Ladybug_DOY_HOY(days="21", months=item_2, hours=item)  # -> HOY, DOY, date; plug-in component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
sunpath = Ladybug_SunPath(
    location=importlocation,
    hour=panel_3,
    day=21,
    month=panel_4,
    timeStep=1,
    sunPathScale=Slider(0.2, range=0..1),
    dailyOrAnnualSunPath=True)  # -> readMe, sunVectors, sunAltitudes, sunAzimuths, port, sunSpheresMesh, sunPathCrvs, legend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; plug-in component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
brep_3 = Brep(flatten([createhbsrfs.HBSurface, createhbsrfs_2.HBSurface]))
brep_4 = Brep(<brep referenced from the Rhino model>)
preview = CustomPreview(Geometry=createhbsrfs_2.HBSurface, Shader=ColourSwatch(SwatchColor=RGBA(129, 150, 235, 74)))
item_3 = ListItem(List=brep, Index=Slider(1, range=0..1), Wrap=True)
preview_2 = CustomPreview(Geometry=createhbsrfs.HBSurface, Shader=ColourSwatch(SwatchColor=RGBA(217, 206, 206, 208)))
flip = Flip(Surface=brep_4)  # -> Surface, Result
gentestpts = Honeybee_GenerateTestPoints(testGeometry=flip.Surface, gridSize=Slider(0.5, range=0..1), distBaseSrf=Slider(0.762, range=0..1), moveTestMesh=True)  # -> readMe, simplify(testPoints), simplify(ptsVectors), simplify(facesArea), simplify(mesh); plug-in component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
# prepare a recipe
gridbasedsimulation = Honeybee_GridBasedSimulation(
    skyFile=genclimatebasedsky.skyFilePath,
    testPoints=gentestpts.testPoints,
    ptsVectors=gentestpts.ptsVectors,
    testMesh=gentestpts.mesh,
    simulationType=0)  # -> analysisRecipe; plug-in component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
toggle = BooleanToggle(True)
# run the analysis
rundaylightanalysis = Honeybee_RunDaylightSimulation(HBObjects=flatten(brep_3), analysisRecipe=gridbasedsimulation, writeRad=toggle, runRad=toggle, overwriteResults=True)  # -> readMe, analysisType, resultsUnit, results, testPts, resultFiles, radGeoFile, studyFolder, done; plug-in component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
number_slider_3 = Slider(0, range=0..2)
number_slider_4 = Slider(0, range=0..2)
# Animate sliders
button_2 = Button()
hours_2 = Panel("""9
12
15""")
months_2 = Panel("""3
6
12""")
panel_5 = Panel("https://www.energyplus.net/weather-download/north_and_central_america_wmo_region_4/USA/PA/USA_PA_Philadelphia.Intl.AP.724080_TMY3/all")
# Glass material
panel_6 = Panel("tvis_60")
fly_2 = Ladybug_fly(inputSliders=[number_slider_4, number_slider_3], fly=button_2)  # -> Vviiiiiiiiiizzz; plug-in component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
item_4 = ListItem(List=hours_2, Index=number_slider_3, Wrap=True)
item_5 = ListItem(List=months_2, Index=number_slider_4, Wrap=True)
epw_stat_2 = Ladybug_OpenEPWAndSTATWeatherFiles(weatherFileURL=panel_5)  # -> epwFile, statFile; plug-in component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
panel_7 = Panel(doy_hoy.date)
radglassmaterial_2 = Honeybee_RadianceGlassMaterial(materialName=panel_6, RTransmittance="0.6", GTransmittance="0.6", BTransmittance="0.6", refractiveIndex=1.52)  # -> avrgTrans, RADMaterial; plug-in component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
legendpar = Ladybug_LegendParameters(lowBound="300", highBound="4000")  # -> legendPar; plug-in component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
# capture the viewport to an image
join = TextJoin(Text=[item_2, "21", item], Join="_")
panel_8 = Panel("""9
12
15""")
panel_9 = Panel("""3
6
12""")
# visualize the results
concat = Concatenate(FragmentA=rundaylightanalysis.analysisType, FragmentC=panel_7)
panel_10 = Panel(join)
# Prepare geometries
brep_5 = Brep([<brep referenced from the Rhino model> x6])

# ---- group: glass
brep_6 = Brep([<brep referenced from the Rhino model> x2])

# ----
importlocation_2 = Ladybug_ImportLocation(epwFile=epw_stat_2.epwFile)  # -> location; plug-in component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
recolormesh = Ladybug_RecolorMesh(
    analysisResult=rundaylightanalysis.results,
    inputMesh=gentestpts.mesh,
    legendPar=legendpar,
    analysisTitle=concat,
    legendTitle=rundaylightanalysis.resultsUnit)  # -> readMe, newMesh, newLegend, legendBasePt, meshColors, legendColors; plug-in component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
captureview = Ladybug_CaptureView(fileName=panel_10, capture=Toggle(True))  # -> imagePath; plug-in component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
# Generate sky
genclimatebasedsky_2 = Honeybee_GenerateClimateBasedSky(weatherFile=epw_stat_2.epwFile, month=item_5, day="21", hour=item_4)  # -> radiationValues, skyFilePath; plug-in component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
createhbsrfs_3 = Honeybee_createHBSrfs(geometry=brep_5)  # -> readMe, simplify(flatten(HBSurface)); plug-in component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
createhbsrfs_4 = Honeybee_createHBSrfs(geometry=brep_6, RADMaterial=radglassmaterial_2.RADMaterial)  # -> readMe, simplify(HBSurface); plug-in component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
doy_hoy_2 = Ladybug_DOY_HOY(days="21", months=item_5, hours=item_4)  # -> HOY, DOY, date; plug-in component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
sunpath_2 = Ladybug_SunPath(
    location=importlocation_2,
    hour=panel_8,
    day=21,
    month=panel_9,
    timeStep=1,
    sunPathScale=Slider(0.2, range=0..1),
    dailyOrAnnualSunPath=True)  # -> readMe, sunVectors, sunAltitudes, sunAzimuths, port, sunSpheresMesh, sunPathCrvs, legend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; plug-in component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
panel_11 = Panel(captureview)
brep_7 = Brep(flatten([createhbsrfs_3.HBSurface, createhbsrfs_4.HBSurface]))
brep_8 = Brep(<brep referenced from the Rhino model>)
preview_3 = CustomPreview(Geometry=createhbsrfs_4.HBSurface, Shader=ColourSwatch(SwatchColor=RGBA(129, 150, 235, 74)))
item_6 = ListItem(List=brep_5, Index=Slider(1, range=0..1), Wrap=True)
preview_4 = CustomPreview(Geometry=createhbsrfs_3.HBSurface, Shader=ColourSwatch(SwatchColor=RGBA(217, 206, 206, 208)))
flip_2 = Flip(Surface=brep_8)  # -> Surface, Result
gentestpts_2 = Honeybee_GenerateTestPoints(testGeometry=flip_2.Surface, gridSize=Slider(0.5, range=0..1), distBaseSrf=Slider(0.762, range=0..1), moveTestMesh=True)  # -> readMe, simplify(testPoints), simplify(ptsVectors), simplify(facesArea), simplify(mesh); plug-in component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
# prepare a recipe
gridbasedsimulation_2 = Honeybee_GridBasedSimulation(
    skyFile=genclimatebasedsky_2.skyFilePath,
    testPoints=gentestpts_2.testPoints,
    ptsVectors=gentestpts_2.ptsVectors,
    testMesh=gentestpts_2.mesh,
    simulationType=0)  # -> analysisRecipe; plug-in component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
toggle_2 = BooleanToggle(True)
# run the analysis
rundaylightanalysis_2 = Honeybee_RunDaylightSimulation(
    HBObjects=flatten(brep_7),
    analysisRecipe=gridbasedsimulation_2,
    writeRad=toggle_2,
    runRad=toggle_2,
    overwriteResults=True)  # -> readMe, analysisType, resultsUnit, results, testPts, resultFiles, radGeoFile, studyFolder, done; plug-in component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
panel_12 = Panel(doy_hoy_2.date)
legendpar_2 = Ladybug_LegendParameters(lowBound="300", highBound="4000")  # -> legendPar; plug-in component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
# capture the viewport to an image
join_2 = TextJoin(Text=[item_5, "21", item_4], Join="_")
# visualize the results
concat_2 = Concatenate(FragmentA=rundaylightanalysis_2.analysisType, FragmentC=panel_12)
panel_13 = Panel(join_2)
recolormesh_2 = Ladybug_RecolorMesh(
    analysisResult=rundaylightanalysis_2.results,
    inputMesh=gentestpts_2.mesh,
    legendPar=legendpar_2,
    analysisTitle=concat_2,
    legendTitle=rundaylightanalysis_2.resultsUnit)  # -> readMe, newMesh, newLegend, legendBasePt, meshColors, legendColors; plug-in component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
captureview_2 = Ladybug_CaptureView(fileName=panel_13, capture=Toggle(True))  # -> imagePath; plug-in component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
panel_14 = Panel(captureview_2)
number_slider_5 = Slider(0, range=0..2)
number_slider_6 = Slider(0, range=0..2)
# Animate sliders
button_3 = Button()
hours_3 = Panel("""9
12
15""")
months_3 = Panel("""3
6
12""")
panel_15 = Panel("https://www.energyplus.net/weather-download/north_and_central_america_wmo_region_4/USA/PA/USA_PA_Philadelphia.Intl.AP.724080_TMY3/all")
# Glass material
panel_16 = Panel("tvis_60")
fly_3 = Ladybug_fly(inputSliders=[number_slider_5, number_slider_6], fly=button_3)  # -> Vviiiiiiiiiizzz; plug-in component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
item_7 = ListItem(List=hours_3, Index=number_slider_6, Wrap=True)
item_8 = ListItem(List=months_3, Index=number_slider_5, Wrap=True)
epw_stat_3 = Ladybug_OpenEPWAndSTATWeatherFiles(weatherFileURL=panel_15)  # -> epwFile, statFile; plug-in component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
radglassmaterial_3 = Honeybee_RadianceGlassMaterial(materialName=panel_16, RTransmittance="0.6", GTransmittance="0.6", BTransmittance="0.6", refractiveIndex=1.52)  # -> avrgTrans, RADMaterial; plug-in component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
panel_17 = Panel("""9
12
15""")
panel_18 = Panel("""3
6
12""")
path_2 = FilePath("C:\ladybug\Philadelphia_International_Ap_PA_USA\Philadelphia_International_Ap_PA_USA.epw")
# Prepare geometries
brep_9 = Brep([<brep referenced from the Rhino model> x7])
brep_10 = Brep(<brep referenced from the Rhino model>)

# ---- group: glass
brep_11 = Brep([<brep referenced from the Rhino model> x2])

# ----
importlocation_3 = Ladybug_ImportLocation(epwFile=epw_stat_3.epwFile)  # -> location; plug-in component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
# Generate sky
number_slider_7 = Slider(1, range=0..1)
genclimatebasedsky_3 = Honeybee_GenerateClimateBasedSky(weatherFile=epw_stat_3.epwFile, month=item_8, day="21", hour=item_7)  # -> radiationValues, skyFilePath; plug-in component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
createhbsrfs_5 = Honeybee_createHBSrfs(geometry=[brep_9, brep_10])  # -> readMe, simplify(flatten(HBSurface)); plug-in component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
createhbsrfs_6 = Honeybee_createHBSrfs(geometry=brep_11, RADMaterial=radglassmaterial_3.RADMaterial)  # -> readMe, simplify(HBSurface); plug-in component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
doy_hoy_3 = Ladybug_DOY_HOY(days="21", months=item_8, hours=item_7)  # -> HOY, DOY, date; plug-in component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
sunpath_3 = Ladybug_SunPath(
    location=importlocation_3,
    hour=panel_17,
    day=21,
    month=panel_18,
    timeStep=1,
    sunPathScale=Slider(0.2, range=0..1),
    dailyOrAnnualSunPath=True)  # -> readMe, sunVectors, sunAltitudes, sunAzimuths, port, sunSpheresMesh, sunPathCrvs, legend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; plug-in component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
item_9 = ListItem(Index=number_slider_7, Wrap=True)
flip_3 = Flip(Surface=item_9)  # -> Surface, Result
brep_12 = Brep(flatten([createhbsrfs_5.HBSurface, createhbsrfs_6.HBSurface]))
askme = Honeybee_AskMe(HBObjects=createhbsrfs_5.HBSurface)  # -> readMe; plug-in component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
brep_13 = Brep(<brep referenced from the Rhino model>)
preview_5 = CustomPreview(Geometry=createhbsrfs_6.HBSurface, Shader=ColourSwatch(SwatchColor=RGBA(129, 150, 235, 74)))
preview_6 = CustomPreview(Geometry=createhbsrfs_5.HBSurface, Shader=ColourSwatch(SwatchColor=RGBA(217, 206, 206, 208)))
panel_19 = Panel(askme)
gentestpts_3 = Honeybee_GenerateTestPoints(testGeometry=brep_13, gridSize=Slider(0.5, range=0..1), distBaseSrf=Slider(0.762, range=0..1), moveTestMesh=True)  # -> readMe, simplify(testPoints), simplify(ptsVectors), simplify(facesArea), simplify(mesh); plug-in component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
# prepare a recipe
gridbasedsimulation_3 = Honeybee_GridBasedSimulation(
    skyFile=genclimatebasedsky_3.skyFilePath,
    testPoints=gentestpts_3.testPoints,
    ptsVectors=gentestpts_3.ptsVectors,
    testMesh=gentestpts_3.mesh,
    simulationType=0)  # -> analysisRecipe; plug-in component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
toggle_3 = BooleanToggle(True)
# run the analysis
rundaylightanalysis_3 = Honeybee_RunDaylightSimulation(
    HBObjects=flatten(brep_12),
    analysisRecipe=gridbasedsimulation_3,
    writeRad=toggle_3,
    runRad=toggle_3,
    overwriteResults=True)  # -> readMe, analysisType, resultsUnit, results, testPts, resultFiles, radGeoFile, studyFolder, done; plug-in component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
panel_20 = Panel(doy_hoy_3.date)
legendpar_3 = Ladybug_LegendParameters(lowBound="300", highBound="4000")  # -> legendPar; plug-in component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
# capture the viewport to an image
join_3 = TextJoin(Text=[item_8, "21", item_7], Join="_")
# visualize the results
concat_3 = Concatenate(FragmentA=rundaylightanalysis_3.analysisType, FragmentC=panel_20)
panel_21 = Panel(join_3)
number_slider_8 = Slider(0, range=0..2)
recolormesh_3 = Ladybug_RecolorMesh(
    analysisResult=rundaylightanalysis_3.results,
    inputMesh=gentestpts_3.mesh,
    legendPar=legendpar_3,
    analysisTitle=concat_3,
    legendTitle=rundaylightanalysis_3.resultsUnit)  # -> readMe, newMesh, newLegend, legendBasePt, meshColors, legendColors; plug-in component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
number_slider_9 = Slider(0, range=0..2)
captureview_3 = Ladybug_CaptureView(fileName=panel_21, capture=Toggle(True))  # -> imagePath; plug-in component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
panel_22 = Panel(captureview_3)
# Animate sliders
button_4 = Button()
hours_4 = Panel("""9
12
15""")
months_4 = Panel("""3
6
12""")
panel_23 = Panel("https://www.energyplus.net/weather-download/north_and_central_america_wmo_region_4/USA/PA/USA_PA_Philadelphia.Intl.AP.724080_TMY3/all")
# Glass material
panel_24 = Panel("tvis_60")
fly_4 = Ladybug_fly(inputSliders=[number_slider_8, number_slider_9], fly=button_4)  # -> Vviiiiiiiiiizzz; disabled; plug-in component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
item_10 = ListItem(List=hours_4, Index=number_slider_9, Wrap=True)
item_11 = ListItem(List=months_4, Index=number_slider_8, Wrap=True)
epw_stat_4 = Ladybug_OpenEPWAndSTATWeatherFiles(weatherFileURL=panel_23)  # -> epwFile, statFile; plug-in component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
radglassmaterial_4 = Honeybee_RadianceGlassMaterial(materialName=panel_24, RTransmittance="0.6", GTransmittance="0.6", BTransmittance="0.6", refractiveIndex=1.52)  # -> avrgTrans, RADMaterial; plug-in component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
panel_25 = Panel("""9
12
15""")
panel_26 = Panel("""3
6
12""")
path_3 = FilePath("C:\ladybug\Philadelphia_International_Ap_PA_USA\Philadelphia_International_Ap_PA_USA.epw")
# Prepare geometries
brep_14 = Brep([<brep referenced from the Rhino model> x67])
brep_15 = Brep(<brep referenced from the Rhino model>)

# ---- group: glass
brep_16 = Brep(<brep referenced from the Rhino model>)

# ----
importlocation_4 = Ladybug_ImportLocation(epwFile=epw_stat_4.epwFile)  # -> location; plug-in component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
# Generate sky
number_slider_10 = Slider(1, range=0..1)
genclimatebasedsky_4 = Honeybee_GenerateClimateBasedSky(weatherFile=epw_stat_4.epwFile, month=item_11, day="21", hour=item_10)  # -> radiationValues, skyFilePath; plug-in component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
createhbsrfs_7 = Honeybee_createHBSrfs(geometry=[brep_14, brep_15])  # -> readMe, simplify(flatten(HBSurface)); plug-in component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
createhbsrfs_8 = Honeybee_createHBSrfs(geometry=brep_16, RADMaterial=radglassmaterial_4.RADMaterial)  # -> readMe, simplify(HBSurface); plug-in component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
doy_hoy_4 = Ladybug_DOY_HOY(days="21", months=item_11, hours=item_10)  # -> HOY, DOY, date; plug-in component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
sunpath_4 = Ladybug_SunPath(
    location=importlocation_4,
    hour=panel_25,
    day=21,
    month=panel_26,
    timeStep=1,
    sunPathScale=Slider(0.2, range=0..1),
    dailyOrAnnualSunPath=True)  # -> readMe, sunVectors, sunAltitudes, sunAzimuths, port, sunSpheresMesh, sunPathCrvs, legend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; plug-in component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
item_12 = ListItem(Index=number_slider_10, Wrap=True)
flip_4 = Flip(Surface=item_12)  # -> Surface, Result
brep_17 = Brep(flatten([createhbsrfs_7.HBSurface, createhbsrfs_8.HBSurface]))
askme_2 = Honeybee_AskMe(HBObjects=createhbsrfs_7.HBSurface)  # -> readMe; plug-in component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
brep_18 = Brep(<brep referenced from the Rhino model>)
preview_7 = CustomPreview(Geometry=createhbsrfs_8.HBSurface, Shader=ColourSwatch(SwatchColor=RGBA(129, 150, 235, 74)))
preview_8 = CustomPreview(Geometry=createhbsrfs_7.HBSurface, Shader=ColourSwatch(SwatchColor=RGBA(217, 206, 206, 208)))
panel_27 = Panel(askme_2)
gentestpts_4 = Honeybee_GenerateTestPoints(testGeometry=brep_18, gridSize=Slider(0.3, range=0..1), distBaseSrf=Slider(0.762, range=0..1), moveTestMesh=True)  # -> readMe, simplify(testPoints), simplify(ptsVectors), simplify(facesArea), simplify(mesh); plug-in component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
# prepare a recipe
gridbasedsimulation_4 = Honeybee_GridBasedSimulation(
    skyFile=genclimatebasedsky_4.skyFilePath,
    testPoints=gentestpts_4.testPoints,
    ptsVectors=gentestpts_4.ptsVectors,
    testMesh=gentestpts_4.mesh,
    simulationType=0)  # -> analysisRecipe; plug-in component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
toggle_4 = BooleanToggle(True)
# run the analysis
rundaylightanalysis_4 = Honeybee_RunDaylightSimulation(
    HBObjects=flatten(brep_17),
    analysisRecipe=gridbasedsimulation_4,
    writeRad=toggle_4,
    runRad=toggle_4,
    overwriteResults=True)  # -> readMe, analysisType, resultsUnit, illuminance_values, testPts, illuminance_files, radGeoFile, studyFolder, done; plug-in component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
readradresults = Honeybee_ReadRADResult(
    analysisType=rundaylightanalysis_4.analysisType,
    resultFiles=rundaylightanalysis_4.illuminance_files,
    testPts=rundaylightanalysis_4.testPts,
    writeToFile=False)  # -> readMe, unit, values; plug-in component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
tag = TextTag3D(Location=rundaylightanalysis_4.testPts, Text=readradresults.values, Size=Slider(0.05, range=0..0.1), Justification=7)
panel_28 = Panel(doy_hoy_4.date)
legendpar_4 = Ladybug_LegendParameters(lowBound="300", highBound="2000")  # -> legendPar; plug-in component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
# capture the viewport to an image
join_4 = TextJoin(Text=[item_11, "21", item_10], Join="_")
# visualize the results
concat_4 = Concatenate(FragmentA=rundaylightanalysis_4.analysisType, FragmentC=panel_28)
panel_29 = Panel(join_4)
recolormesh_4 = Ladybug_RecolorMesh(
    analysisResult=rundaylightanalysis_4.illuminance_values,
    inputMesh=gentestpts_4.mesh,
    legendPar=legendpar_4,
    analysisTitle=concat_4,
    legendTitle=rundaylightanalysis_4.resultsUnit)  # -> readMe, newMesh, newLegend, legendBasePt, meshColors, legendColors; plug-in component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
captureview_4 = Ladybug_CaptureView(fileName=panel_29, capture=Toggle(True))  # -> imagePath; plug-in component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
panel_30 = Panel(captureview_4)
