# Grasshopper definition Siram_Neeharika_FINAL.gh (Grasshopper 0.9.76)
# plug-ins: Python Interpreter

ladybug = Ladybug_Ladybug()  # -> Vviiiiiiiiiizzz; plug-in component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
ladybug_2 = Ladybug_Ladybug()  # -> Vviiiiiiiiiizzz; plug-in component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
honeybee = Honeybee_Honeybee()  # -> Vviiiiiiiiiizzz; plug-in component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
honeybee_2 = Honeybee_Honeybee()  # -> Vviiiiiiiiiizzz; plug-in component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
toggle = BooleanToggle(True)
# capture the viewport to an image
updatehoneybee = Honeybee_UpdateHoneybee(updateThisFile=toggle, updateAllUObjects=toggle)  # -> readMe; plug-in component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
ladybug_activities_met_list = Ladybug_ActivitiesMetList({"Sleeping": 0.7, "Reclining": 0.8, "Sitting": 1.0, "Typing": 1.1, "Standing": 1.2, "Driving": 1.5, "Cooking": 1.8, "House Cleaning": 2.7, "Strolling": 1.7, "Walking 2mph": 2.0, "Walking 3mph": 2.6, "Walking 4mph": 3.8, "Running 9mph": 9.5, "Lifting 10lbs": 2.1, "Lifting 100lbs": 4.0, "Shoveling": 4.4, "Dancing": 3.4, "Basketball": 6.3}, selected="Typing")
point = Point(<point referenced from the Rhino model>)
pt = Point(Point(9.974619419, -0.07653046987, 0))

panel = Panel("https://www.energyplus.net/weather-download/north_and_central_america_wmo_region_4/USA/PA/USA_PA_Philadelphia.Intl.AP.724080_TMY3/all")
epw_stat = Ladybug_OpenEPWAndSTATWeatherFiles(weatherFileURL=panel)  # -> epwFile, statFile; plug-in component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
panel_2 = Panel(epw_stat.epwFile)
importepw = Ladybug_ImportEpw(epwFile=panel_2)  # -> readMe, latitude, location, dryBulbTemperature, dewPointTemperature, relativeHumidity, windSpeed, windDirection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; plug-in component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
analysisperiod = Ladybug_AnalysisPeriod(
    fromMonth=Slider(6, range=0..100),
    fromDay=Slider(21, range=0..100),
    toMonth=Slider(9, range=0..10),
    toDay=Slider(20, range=0..100))  # -> readMe, analysisPeriod; plug-in component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
analysisperiod_2 = Ladybug_AnalysisPeriod(
    fromMonth=Slider(3, range=0..100),
    fromDay=Slider(21, range=0..100),
    toMonth=Slider(6, range=0..10),
    toDay=Slider(20, range=0..100))  # -> readMe, analysisPeriod; plug-in component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
analysisperiod_3 = Ladybug_AnalysisPeriod(
    fromMonth=Slider(1, range=0..100),
    fromDay=Slider(1, range=0..100),
    toMonth=Slider(3, range=0..10),
    toDay=Slider(20, range=0..100))  # -> readMe, analysisPeriod; plug-in component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
analysisperiod_4 = Ladybug_AnalysisPeriod(
    fromMonth=Slider(9, range=0..100),
    fromDay=Slider(21, range=0..100),
    toMonth=Slider(10, range=0..10),
    toDay=Slider(20, range=0..100))  # -> readMe, analysisPeriod; plug-in component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
pt_2 = Point(Point(606588.6952, -333483.8682, 0))
pt_3 = Point(Point(593796.0435, -160284.228, 0))
pt_4 = Point(Point(602008.3471, 213.9246156, 0))
pt_5 = Point(Point(610468.3129, -486823.1185, 0))
windrose = Ladybug_WindRose(
    north=0,
    hourlyWindDirection=importepw.windDirection,
    hourlyWindSpeed=importepw.windSpeed,
    annualHourlyData=flatten([importepw.dryBulbTemperature, importepw.relativeHumidity]),
    analysisPeriod=analysisperiod.analysisPeriod,
    conditionalStatement="18 < b < 24 and 20 < c < 80 and 2 < a < 10",
    centerPoint=pt_2,
    runIt=Toggle(True))  # -> readMe, calmRoseMesh, windRoseMesh, windRoseCrvs, windRoseCenPts, legend, legendBasePts, title; plug-in component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
windrose_2 = Ladybug_WindRose(
    north=0,
    hourlyWindDirection=importepw.windDirection,
    hourlyWindSpeed=importepw.windSpeed,
    annualHourlyData=flatten([importepw.dryBulbTemperature, importepw.relativeHumidity]),
    analysisPeriod=analysisperiod_2.analysisPeriod,
    conditionalStatement="18 < b < 24 and 20 < c < 80 and 2 < a < 10",
    centerPoint=pt_3,
    runIt=Toggle(True))  # -> readMe, calmRoseMesh, windRoseMesh, windRoseCrvs, windRoseCenPts, legend, legendBasePts, title; plug-in component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
windrose_3 = Ladybug_WindRose(
    north=0,
    hourlyWindDirection=importepw.windDirection,
    hourlyWindSpeed=importepw.windSpeed,
    annualHourlyData=flatten([importepw.dryBulbTemperature, importepw.relativeHumidity]),
    analysisPeriod=analysisperiod_3.analysisPeriod,
    conditionalStatement="18 < b < 24 and 20 < c < 80 and 2 < a < 10",
    centerPoint=pt_4,
    runIt=Toggle(True))  # -> readMe, calmRoseMesh, windRoseMesh, windRoseCrvs, windRoseCenPts, legend, legendBasePts, title; plug-in component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
windrose_4 = Ladybug_WindRose(
    north=0,
    hourlyWindDirection=importepw.windDirection,
    hourlyWindSpeed=importepw.windSpeed,
    annualHourlyData=flatten([importepw.dryBulbTemperature, importepw.relativeHumidity]),
    analysisPeriod=analysisperiod_4.analysisPeriod,
    conditionalStatement="18 < b < 24 and 20 < c < 80 and 2 < a < 10",
    centerPoint=pt_5,
    runIt=Toggle(True))  # -> readMe, calmRoseMesh, windRoseMesh, windRoseCrvs, windRoseCenPts, legend, legendBasePts, title; plug-in component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
preview = CustomPreview(Geometry=windrose_2.windRoseCrvs, Shader=ColourSwatch(SwatchColor=RGB(3, 0, 0)))
preview_2 = CustomPreview(Geometry=windrose.windRoseCrvs, Shader=ColourSwatch(SwatchColor=RGB(3, 0, 0)))
preview_3 = CustomPreview(Geometry=windrose_4.windRoseCrvs, Shader=ColourSwatch(SwatchColor=RGB(3, 0, 0)))
preview_4 = CustomPreview(Geometry=windrose_3.windRoseCrvs, Shader=ColourSwatch(SwatchColor=RGB(3, 0, 0)))
# capture the viewport to an image
selectandaveragedata = Ladybug_AverageData(annualHourlyData=[importepw.dryBulbTemperature, importepw.relativeHumidity, importepw.windSpeed, importepw.windDirection])  # -> readMe, selHourlyData, averagedDaily, averagedMonthly, avrMonthlyPerHour, avrAnalysisPeriod; plug-in component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
# DGP: Daylight glare probability:
# Imperceptible Glare [0.35 > DGP]
# Perceptible Glare [0.4 > DGP >= 0.35]
# Disturbing Glare [0.45 > DGP >= 0.4]
# Intolerable Glare [DGP >= 0.45]
_3dchart = Ladybug_3DChart(
    inputData=flatten(selectandaveragedata.selHourlyData),
    basePoint=pt,
    xScale=Slider(0.005, range=0..1),
    yScale=Slider(0.02, range=0..1),
    zScale=Slider(0, range=0..100))  # -> readMe, graphMesh, graphCurves, legend, legendBasePts, title, titleBasePts, dataPts, conditionalHOY; plug-in component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
preview_5 = CustomPreview(Geometry=_3dchart.graphCurves, Shader=ColourSwatch(SwatchColor=RGB(0, 0, 5)))

panel_3 = Panel("https://www.energyplus.net/weather-download/north_and_central_america_wmo_region_4/USA/PA/USA_PA_Philadelphia.Intl.AP.724080_TMY3/all")
epw_stat_2 = Ladybug_OpenEPWAndSTATWeatherFiles(weatherFileURL=panel_3)  # -> epwFile, statFile; plug-in component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
path = FilePath(panel_3)
importepw_2 = Ladybug_ImportEpw(epwFile=epw_stat_2.epwFile)  # -> readMe, latitude, location, dryBulbTemperature, dewPointTemperature, relativeHumidity, windSpeed, windDirection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; plug-in component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
solaradjusttemperature = Ladybug_OutdoorSolarTemperatureAdjustor(
    location=importepw_2.location,
    cumSkyMtxOrDirNormRad=importepw_2.directNormalRadiation,
    diffuseHorizRad=importepw_2.diffuseHorizontalRadiation,
    meanRadTemperature=importepw_2.dryBulbTemperature,
    runIt=Toggle(True))  # -> readMe, port, effectiveRadiantField, MRTDelta, solarAdjustedMRT, port_2, mannequinMesh, legend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; plug-in component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
solaradjusttemperature_2 = Ladybug_OutdoorSolarTemperatureAdjustor(
    location=importepw_2.location,
    cumSkyMtxOrDirNormRad=importepw_2.directNormalRadiation,
    diffuseHorizRad=importepw_2.diffuseHorizontalRadiation,
    baseDryBulbOrMRT=importepw_2.dryBulbTemperature,
    horizInfraredRad=importepw_2.horizontalInfraredRadiation)  # -> readMe, port, effectiveRadiantField, MRTDelta, solarAdjustedMRT, port_2, mannequinMesh, legend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; plug-in component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
psychchart = Ladybug_PsychrometricChart(
    meanRadTemperature=solaradjusttemperature_2.solarAdjustedMRT,
    metabolicRate=ladybug_activities_met_list,
    clothingLevel="1",
    basePoint=point,
    runIt=Toggle(True))  # -> out, port, totalComfortPercent, totalComfortOrNot, strategyNames, strategyPercentOfTime, strategyOrNot, port_2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; plug-in component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
custom_preview = CustomPreview(
    Geometry=[psychchart.psychChartMesh, psychchart.chartCurvesAndTxt, psychchart.legend],
    Shader=ColourSwatch(SwatchColor=RGB(102, 102, 102)))

analysisperiod_5 = Ladybug_AnalysisPeriod(
    fromMonth=Slider(9, range=0..100),
    fromDay=Slider(21, range=0..100),
    toMonth=Slider(12, range=1..12),
    toDay=Slider(20, range=0..100))  # -> readMe, analysisPeriod; plug-in component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
analysisperiod_6 = Ladybug_AnalysisPeriod(
    fromMonth=Slider(3, range=0..100),
    fromDay=Slider(21, range=0..100),
    toMonth=Slider(6, range=0..10),
    toDay=Slider(20, range=0..100))  # -> readMe, analysisPeriod; plug-in component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
analysisperiod_7 = Ladybug_AnalysisPeriod(
    fromMonth=Slider(6, range=0..100),
    fromDay=Slider(21, range=0..100),
    toMonth=Slider(9, range=0..10),
    toDay=Slider(20, range=0..100))  # -> readMe, analysisPeriod; plug-in component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
gencumulativeskymtx = Ladybug_GenCumulativeSkyMtx(epwFile=epw_stat_2.epwFile, skyDensity=0, useOldRes=True, runIt=Toggle(True))  # -> readMe, cumulativeSkyMtx; plug-in component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
analysisperiod_8 = Ladybug_AnalysisPeriod(
    fromMonth=Slider(1, range=0..100),
    fromDay=Slider(1, range=0..100),
    toMonth=Slider(3, range=0..10),
    toDay=Slider(20, range=0..100))  # -> readMe, analysisPeriod; plug-in component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
legendpar = Ladybug_LegendParameters(lowBound=Slider(0, range=0..600), highBound=Slider(22, range=0..22))  # -> legendPar; plug-in component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
selectskymtx = Ladybug_selectSkyMtx(
    cumulativeSkyMtx=gencumulativeskymtx.cumulativeSkyMtx,
    analysisPeriod=analysisperiod_5.analysisPeriod,
    removeDiffuse=False,
    removeDirect=False)  # -> readMe, selectedSkyMtx; plug-in component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
selectskymtx_2 = Ladybug_selectSkyMtx(
    cumulativeSkyMtx=gencumulativeskymtx.cumulativeSkyMtx,
    analysisPeriod=analysisperiod_7.analysisPeriod,
    removeDiffuse=False,
    removeDirect=False)  # -> readMe, selectedSkyMtx; plug-in component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
selectskymtx_3 = Ladybug_selectSkyMtx(
    cumulativeSkyMtx=gencumulativeskymtx.cumulativeSkyMtx,
    analysisPeriod=analysisperiod_6.analysisPeriod,
    removeDiffuse=False,
    removeDirect=False)  # -> readMe, selectedSkyMtx; plug-in component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
selectskymtx_4 = Ladybug_selectSkyMtx(
    cumulativeSkyMtx=gencumulativeskymtx.cumulativeSkyMtx,
    analysisPeriod=analysisperiod_8.analysisPeriod,
    removeDiffuse=False,
    removeDirect=False)  # -> readMe, selectedSkyMtx; plug-in component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
pt_6 = Point(Point(1309.833441, -1470.318018, 0))
pt_7 = Point(Point(1309.833441, -1044.788384, 0))
pt_8 = Point(Point(1309.833441, -716.4070385, 0))
pt_9 = Point(Point(1309.833441, -302.7742892, 0))
skydome = Ladybug_SkyDome(
    selectedSkyMtx=selectskymtx.selectedSkyMtx,
    centerPoint=pt_6,
    legendPar=legendpar,
    showTotalOnly=False,
    runIt=Toggle(True))  # -> readMe, skyPatchesMesh, baseCrvs, legend, legendBasePts, skyPatchesCenPts, skyPatchesAreas, skyPatchesAsBrep, values; plug-in component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
skydome_2 = Ladybug_SkyDome(
    selectedSkyMtx=selectskymtx_2.selectedSkyMtx,
    centerPoint=pt_7,
    legendPar=legendpar,
    showTotalOnly=False,
    runIt=Toggle(True))  # -> readMe, skyPatchesMesh, baseCrvs, legend, legendBasePts, skyPatchesCenPts, skyPatchesAreas, skyPatchesAsBrep, values; plug-in component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
skydome_3 = Ladybug_SkyDome(
    selectedSkyMtx=selectskymtx_3.selectedSkyMtx,
    centerPoint=pt_8,
    legendPar=legendpar,
    showTotalOnly=False,
    runIt=Toggle(True))  # -> readMe, skyPatchesMesh, baseCrvs, legend, legendBasePts, skyPatchesCenPts, skyPatchesAreas, skyPatchesAsBrep, values; plug-in component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
skydome_4 = Ladybug_SkyDome(
    selectedSkyMtx=selectskymtx_4.selectedSkyMtx,
    centerPoint=pt_9,
    legendPar=legendpar,
    showTotalOnly=False,
    runIt=Toggle(True))  # -> readMe, skyPatchesMesh, baseCrvs, legend, legendBasePts, skyPatchesCenPts, skyPatchesAreas, skyPatchesAsBrep, values; plug-in component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
legendpar_2 = Ladybug_LegendParameters(lowBound=Slider(0, range=0..600), highBound=Slider(600, range=0..600))  # -> legendPar; plug-in component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
preview_6 = CustomPreview(Geometry=skydome.baseCrvs, Shader=ColourSwatch(SwatchColor=RGB(0, 0, 5)))
preview_7 = CustomPreview(Geometry=skydome_2.baseCrvs, Shader=ColourSwatch(SwatchColor=RGB(0, 0, 5)))
preview_8 = CustomPreview(Geometry=skydome_3.baseCrvs, Shader=ColourSwatch(SwatchColor=RGB(0, 0, 5)))
preview_9 = CustomPreview(Geometry=skydome_4.baseCrvs, Shader=ColourSwatch(SwatchColor=RGB(0, 0, 5)))
pt_10 = Point(Point(2469.18346, -1050.506359, 0))
pt_11 = Point(Point(2571.918892, -1418.33198, 0))
pt_12 = Point(Point(2500.632309, -299.6437193, 0))
pt_13 = Point(Point(2481.614753, -686.5341975, 0))
radiationrose = Ladybug_RadiationRose(
    selectedSkyMtx=selectskymtx_2.selectedSkyMtx,
    surfaceTiltAngle=Slider(30, range=-90..90),
    centerPoint=pt_10,
    arrowHeadScale=1,
    legendPar=legendpar_2,
    showTotalOnly=Toggle(True),
    runIt=Toggle(True))  # -> readMe, radiationArrowsMesh, radRoseBaseCrvs, legend, legendBasePts, radRoseEndPts, radRoseValues; plug-in component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
radiationrose_2 = Ladybug_RadiationRose(
    selectedSkyMtx=selectskymtx.selectedSkyMtx,
    surfaceTiltAngle=Slider(30, range=-90..90),
    centerPoint=pt_11,
    arrowHeadScale=1,
    legendPar=legendpar_2,
    showTotalOnly=Toggle(True),
    runIt=Toggle(True))  # -> readMe, radiationArrowsMesh, radRoseBaseCrvs, legend, legendBasePts, radRoseEndPts, radRoseValues; plug-in component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
radiationrose_3 = Ladybug_RadiationRose(
    selectedSkyMtx=selectskymtx_4.selectedSkyMtx,
    surfaceTiltAngle=Slider(30, range=-90..90),
    centerPoint=pt_12,
    arrowHeadScale=1,
    legendPar=legendpar_2,
    showTotalOnly=Toggle(True),
    runIt=Toggle(True))  # -> readMe, radiationArrowsMesh, radRoseBaseCrvs, legend, legendBasePts, radRoseEndPts, radRoseValues; plug-in component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
radiationrose_4 = Ladybug_RadiationRose(
    selectedSkyMtx=selectskymtx_3.selectedSkyMtx,
    surfaceTiltAngle=Slider(30, range=-90..90),
    centerPoint=pt_13,
    arrowHeadScale=1,
    legendPar=legendpar_2,
    showTotalOnly=Toggle(True),
    runIt=Toggle(True))  # -> readMe, radiationArrowsMesh, radRoseBaseCrvs, legend, legendBasePts, radRoseEndPts, radRoseValues; plug-in component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
panel_4 = Panel(radiationrose.radRoseValues)
panel_5 = Panel(radiationrose_2.radRoseValues)
panel_6 = Panel(radiationrose_3.radRoseValues)
panel_7 = Panel(radiationrose_4.radRoseValues)
tag = TextTag3D(
    Location=radiationrose.radRoseEndPts,
    Text=radiationrose.radRoseValues,
    Size=Slider(6000, range=0..10000),
    Justification=7)
tag_2 = TextTag3D(
    Location=radiationrose_2.radRoseEndPts,
    Text=radiationrose_2.radRoseValues,
    Size=Slider(6000, range=0..10000),
    Justification=7)
tag_3 = TextTag3D(
    Location=radiationrose_3.radRoseEndPts,
    Text=radiationrose_3.radRoseValues,
    Size=Slider(6000, range=0..10000),
    Justification=7)
tag_4 = TextTag3D(
    Location=radiationrose_4.radRoseEndPts,
    Text=radiationrose_4.radRoseValues,
    Size=Slider(6000, range=0..10000),
    Justification=7)
preview_10 = CustomPreview(Geometry=radiationrose.radRoseBaseCrvs, Shader=ColourSwatch(SwatchColor=RGB(5, 0, 0)))
preview_11 = CustomPreview(Geometry=radiationrose_2.radRoseBaseCrvs, Shader=ColourSwatch(SwatchColor=RGB(5, 0, 0)))
preview_12 = CustomPreview(Geometry=radiationrose_3.radRoseBaseCrvs, Shader=ColourSwatch(SwatchColor=RGB(5, 0, 0)))
preview_13 = CustomPreview(Geometry=radiationrose_4.radRoseBaseCrvs, Shader=ColourSwatch(SwatchColor=RGB(5, 0, 0)))
pt_14 = Point(Point(1284.023921, -2094.939913, 0))
radiationcallalily = Ladybug_RadiationCallaLily(
    selectedSkyMtx=selectskymtx_4.selectedSkyMtx,
    verAngleStep="10",
    centerPoint=pt_14,
    domeOrLily=Toggle(False),
    runIt=Toggle(True))  # -> readMe, radiationLilyMesh, baseCrvs, legend, testPts, testPtsInfo, values, maxRadPt, maxRadVector, maxRadInfo; plug-in component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
panel_8 = Panel(radiationcallalily.maxRadInfo)
preview_14 = CustomPreview(Geometry=radiationcallalily.baseCrvs, Shader=ColourSwatch(SwatchColor=RGB(0, 0, 5)))

selectandaveragedata_2 = Ladybug_AverageData(annualHourlyData=importepw_2.dryBulbTemperature)  # -> readMe, selHourlyData, averagedDaily, averagedMonthly, avrMonthlyPerHour, avrAnalysisPeriod; plug-in component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
panel_9 = Panel(selectandaveragedata_2.averagedMonthly)
strnum = Ladybug_SeparateData(inputList=flatten(panel_9))  # -> numbers, strings; plug-in component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
panel_10 = Panel(strnum.numbers)
item = ListItem(List=panel_10, Index=Slider(8, range=0..10), Wrap=True)
panel_11 = Panel(item)
adaptivecomfortcalculator = Ladybug_AdaptiveComfortCalculator(prevailingOutdoorTemp=panel_11, runIt=Toggle(True))  # -> readMe, port, comfortableOrNot, conditionOfPerson, degreesFromTarget, port_2, targetTemperature, upperTemperatureBound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; plug-in component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
adaptivecomfortcalculator_2 = Ladybug_AdaptiveComfortCalculator(dryBulbTemperature=importepw_2.dryBulbTemperature, prevailingOutdoorTemp=panel_11, runIt=Toggle(True))  # -> readMe, port, comfortableOrNot, conditionOfPerson, degreesFromTarget, port_2, targetTemperature, upperTemperatureBound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; plug-in component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
panel_12 = Panel("b == 0")  # disabled
toggle_2 = BooleanToggle(True)  # disabled
panel_13 = Panel(adaptivecomfortcalculator.percentOfTimeComfortable)
panel_14 = Panel(adaptivecomfortcalculator_2.percentOfTimeComfortable)
windrose_5 = Ladybug_WindRose(
    north=0,
    hourlyWindDirection=importepw_2.windDirection,
    hourlyWindSpeed=importepw_2.windSpeed,
    annualHourlyData=flatten(adaptivecomfortcalculator_2.conditionOfPerson),
    conditionalStatement=panel_12,
    runIt=toggle_2)  # -> readMe, calmRoseMesh, windRoseMesh, windRoseCrvs, windRoseCenPts, legend, legendBasePts, title; disabled; plug-in component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
legendpar_3 = Ladybug_LegendParameters(numSegments=Slider(3, range=0..10))  # -> legendPar; plug-in component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
legendpar_4 = Ladybug_LegendParameters(numSegments=Slider(3, range=0..10))  # -> legendPar; plug-in component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
pt_15 = Point(Point(1281.246464, -2.906669032, 0))
pt_16 = Point(Point(1281.246464, -2.906669032, 0))
_3dchart_2 = Ladybug_3DChart(
    inputData=flatten(adaptivecomfortcalculator.conditionOfPerson),
    basePoint=pt_15,
    xScale=Slider(0.25, range=0..1),
    zScale=Slider(0, range=0..1),
    legendPar=legendpar_3)  # -> readMe, graphMesh, graphCurves, legend, legendBasePts, title, titleBasePts, dataPts, conditionalHOY; plug-in component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
_3dchart_3 = Ladybug_3DChart(
    inputData=flatten(adaptivecomfortcalculator_2.conditionOfPerson),
    basePoint=pt_16,
    xScale=Slider(0.25, range=0..1),
    zScale=Slider(0, range=0..1),
    legendPar=legendpar_4)  # -> readMe, graphMesh, graphCurves, legend, legendBasePts, title, titleBasePts, dataPts, conditionalHOY; plug-in component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
pt_17 = Point(Point(156.2630339, 5.547464097, 0))

panel_15 = Panel("https://www.energyplus.net/weather-download/north_and_central_america_wmo_region_4/USA/PA/USA_PA_Philadelphia.Intl.AP.724080_TMY3/all")
epw_stat_3 = Ladybug_OpenEPWAndSTATWeatherFiles(weatherFileURL=panel_15)  # -> epwFile, statFile; plug-in component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
panel_16 = Panel(epw_stat_3.epwFile)
importepw_3 = Ladybug_ImportEpw(epwFile=panel_16)  # -> readMe, latitude, location, dryBulbTemperature, dewPointTemperature, relativeHumidity, windSpeed, windDirection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; plug-in component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
analysisperiod_9 = Ladybug_AnalysisPeriod(
    fromMonth=Slider(6, range=0..100),
    fromDay=Slider(21, range=0..100),
    toMonth=Slider(9, range=0..10),
    toDay=Slider(20, range=0..100))  # -> readMe, analysisPeriod; plug-in component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
analysisperiod_10 = Ladybug_AnalysisPeriod(
    fromMonth=Slider(3, range=0..100),
    fromDay=Slider(21, range=0..100),
    toMonth=Slider(6, range=0..10),
    toDay=Slider(20, range=0..100))  # -> readMe, analysisPeriod; plug-in component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
analysisperiod_11 = Ladybug_AnalysisPeriod(
    fromMonth=Slider(1, range=0..100),
    fromDay=Slider(1, range=0..100),
    toMonth=Slider(3, range=0..10),
    toDay=Slider(20, range=0..100))  # -> readMe, analysisPeriod; plug-in component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
analysisperiod_12 = Ladybug_AnalysisPeriod(
    fromMonth=Slider(9, range=0..100),
    fromDay=Slider(21, range=0..100),
    toMonth=Slider(10, range=0..10),
    toDay=Slider(20, range=0..100))  # -> readMe, analysisPeriod; plug-in component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
pt_18 = Point(Point(606588.6952, -333483.8682, 0))
pt_19 = Point(Point(593796.0435, -160284.228, 0))
pt_20 = Point(Point(602008.3471, 213.9246156, 0))
pt_21 = Point(Point(610468.3129, -486823.1185, 0))
windrose_6 = Ladybug_WindRose(
    north=0,
    hourlyWindDirection=importepw_3.windDirection,
    hourlyWindSpeed=importepw_3.windSpeed,
    annualHourlyData=flatten([importepw_3.dryBulbTemperature, importepw_3.relativeHumidity]),
    analysisPeriod=analysisperiod_9.analysisPeriod,
    conditionalStatement="18 < b < 24 and 20 < c < 80 and 2 < a < 10",
    centerPoint=pt_18,
    runIt=Toggle(True))  # -> readMe, calmRoseMesh, windRoseMesh, windRoseCrvs, windRoseCenPts, legend, legendBasePts, title; plug-in component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
windrose_7 = Ladybug_WindRose(
    north=0,
    hourlyWindDirection=importepw_3.windDirection,
    hourlyWindSpeed=importepw_3.windSpeed,
    annualHourlyData=flatten([importepw_3.dryBulbTemperature, importepw_3.relativeHumidity]),
    analysisPeriod=analysisperiod_10.analysisPeriod,
    conditionalStatement="18 < b < 24 and 20 < c < 80 and 2 < a < 10",
    centerPoint=pt_19,
    runIt=Toggle(True))  # -> readMe, calmRoseMesh, windRoseMesh, windRoseCrvs, windRoseCenPts, legend, legendBasePts, title; plug-in component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
windrose_8 = Ladybug_WindRose(
    north=0,
    hourlyWindDirection=importepw_3.windDirection,
    hourlyWindSpeed=importepw_3.windSpeed,
    annualHourlyData=flatten([importepw_3.dryBulbTemperature, importepw_3.relativeHumidity]),
    analysisPeriod=analysisperiod_11.analysisPeriod,
    conditionalStatement="18 < b < 24 and 20 < c < 80 and 2 < a < 10",
    centerPoint=pt_20,
    runIt=Toggle(True))  # -> readMe, calmRoseMesh, windRoseMesh, windRoseCrvs, windRoseCenPts, legend, legendBasePts, title; plug-in component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
windrose_9 = Ladybug_WindRose(
    north=0,
    hourlyWindDirection=importepw_3.windDirection,
    hourlyWindSpeed=importepw_3.windSpeed,
    annualHourlyData=flatten([importepw_3.dryBulbTemperature, importepw_3.relativeHumidity]),
    analysisPeriod=analysisperiod_12.analysisPeriod,
    conditionalStatement="18 < b < 24 and 20 < c < 80 and 2 < a < 10",
    centerPoint=pt_21,
    runIt=Toggle(True))  # -> readMe, calmRoseMesh, windRoseMesh, windRoseCrvs, windRoseCenPts, legend, legendBasePts, title; plug-in component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
preview_15 = CustomPreview(Geometry=windrose_7.windRoseCrvs, Shader=ColourSwatch(SwatchColor=RGB(3, 0, 0)))
preview_16 = CustomPreview(Geometry=windrose_6.windRoseCrvs, Shader=ColourSwatch(SwatchColor=RGB(3, 0, 0)))
preview_17 = CustomPreview(Geometry=windrose_9.windRoseCrvs, Shader=ColourSwatch(SwatchColor=RGB(3, 0, 0)))
preview_18 = CustomPreview(Geometry=windrose_8.windRoseCrvs, Shader=ColourSwatch(SwatchColor=RGB(3, 0, 0)))
selectandaveragedata_3 = Ladybug_AverageData(annualHourlyData=[importepw_3.dryBulbTemperature, importepw_3.relativeHumidity, importepw_3.windSpeed, importepw_3.windDirection])  # -> readMe, selHourlyData, averagedDaily, averagedMonthly, avrMonthlyPerHour, avrAnalysisPeriod; plug-in component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
_3dchart_4 = Ladybug_3DChart(
    inputData=flatten(selectandaveragedata_3.selHourlyData),
    basePoint=pt_17,
    xScale=Slider(0.25, range=0..1),
    yScale=Slider(1, range=0..1),
    zScale=Slider(0, range=0..100))  # -> readMe, graphMesh, graphCurves, legend, legendBasePts, title, titleBasePts, dataPts, conditionalHOY; plug-in component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
preview_19 = CustomPreview(Geometry=_3dchart_4.graphCurves, Shader=ColourSwatch(SwatchColor=RGB(0, 0, 5)))

preview_20 = CustomPreview(Geometry=_3dchart_2.graphCurves, Shader=ColourSwatch(SwatchColor=RGB(0, 0, 5)))
preview_21 = CustomPreview(Geometry=_3dchart_3.graphCurves, Shader=ColourSwatch(SwatchColor=RGB(0, 0, 5)))

callfromepconstrlibrary = Honeybee_CallFromEPConstructionLibrary(keywords="floor")  # -> ThermMaterials, EPMaterials, EPWindowMaterials, EPConstructions; plug-in component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
item_2 = ListItem(List=callfromepconstrlibrary.EPConstructions, Index=Slider(0, range=0..100), Wrap=True)
decomposeepconstruction = Honeybee_DecomposeEPConstruction(cnstrName=item_2)  # -> flatten(materials), comments, UValue_SI, UValue_IP, RValue_SI, RValue_IP; plug-in component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

callfromepconstrlibrary_2 = Honeybee_CallFromEPConstructionLibrary(keywords="slab")  # -> ThermMaterials, EPMaterials, EPWindowMaterials, EPConstructions; plug-in component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
item_3 = ListItem(List=callfromepconstrlibrary_2.EPConstructions, Index="2", Wrap=True)
decomposeepconstruction_2 = Honeybee_DecomposeEPConstruction(cnstrName=item_3)  # -> flatten(materials), comments, UValue_SI, UValue_IP, RValue_SI, RValue_IP; plug-in component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

number_of_blinds = Slider(1, range=0..10)
shading_depth = Slider(0.5, range=0..1)
add_blinds = BooleanToggle(True)

panel_17 = Panel("""MAT-CC05 4 HW CONCRETE
MAT-CC05 8 HW CONCRETE""")
panel_18 = Panel(decomposeepconstruction.materials)
item_4 = ListItem(List=decomposeepconstruction.materials, Index=0, Wrap=True)  # -> Item, Item1
item_5 = ListItem(List=panel_17, Index=0, Wrap=True)  # -> Item, Item1
panel_19 = Panel(item_2)
epconstruction = Honeybee_EnergyPlusConstruction(name="floor_cnstr_2", layer_1=item_4.Item, layer_2=item_4.Item1, layer_3=item_5.Item1)  # -> EPConstruction; plug-in component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
epconstruction_2 = Honeybee_EnergyPlusConstruction(name="floor_cnstr_1", layer_1=item_4.Item, layer_2=item_4.Item1, layer_3=item_5.Item)  # -> EPConstruction; plug-in component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

number_slider = Slider(0, range=0..2)
number_slider_2 = Slider(0, range=0..2)
panel_20 = Panel("https://www.energyplus.net/weather-download/north_and_central_america_wmo_region_4/USA/PA/USA_PA_Philadelphia.Intl.AP.724080_TMY3/all")
hours = Panel("""9
12
15""")
months = Panel("""3
6
12""")
fly = Ladybug_fly(inputSliders=[number_slider, number_slider_2], fly=Button())  # -> Vviiiiiiiiiizzz; plug-in component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
epw_stat_4 = Ladybug_OpenEPWAndSTATWeatherFiles(weatherFileURL=panel_20)  # -> epwFile, statFile; plug-in component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
item_6 = ListItem(List=hours, Index=number_slider_2, Wrap=True)
item_7 = ListItem(List=months, Index=number_slider, Wrap=True)
genclimatebasedsky = Honeybee_GenerateClimateBasedSky(weatherFile=epw_stat_4.epwFile, month=item_7, day="21", hour=item_6)  # -> radiationValues, skyFilePath; plug-in component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
panel_21 = Panel("""9
12
15""")
panel_22 = Panel("""3
6
12""")
radglassmaterial = Honeybee_RadianceGlassMaterial(materialName="tvis_0.6", RTransmittance=".9", GTransmittance=".9", BTransmittance=".9", refractiveIndex=1.52)  # -> avrgTrans, RADMaterial; plug-in component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
panel_23 = Panel("WALL")
panel_24 = Panel("SHADE")
panel_25 = Panel("CEILING")
doy_hoy = Ladybug_DOY_HOY(days="21", months=item_7, hours=item_6)  # -> HOY, DOY, date; plug-in component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
importlocation = Ladybug_ImportLocation(epwFile=epw_stat_4.epwFile)  # -> location; plug-in component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
# Wall to Window Ratio
# Rotation Angle
# Blinds
# Construction
# Thermal Mass
brep = Brep([<brep referenced from the Rhino model> x4])
brep_2 = Brep([<brep referenced from the Rhino model> x62])
brep_3 = Brep(<brep referenced from the Rhino model>)
brep_4 = Brep([<brep referenced from the Rhino model> x5])
brep_5 = Brep([<brep referenced from the Rhino model> x2])
brep_6 = Brep(<brep referenced from the Rhino model>)
createhbsrfs = Honeybee_createHBSrfs(geometry=brep, srfType="0")  # -> readMe, simplify(HBSurface); plug-in component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
createhbsrfs_2 = Honeybee_createHBSrfs(geometry=brep_2, srfType="6")  # -> readMe, simplify(HBSurface); plug-in component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
createhbsrfs_3 = Honeybee_createHBSrfs(geometry=brep_3, srfType="3")  # -> readMe, simplify(HBSurface); plug-in component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
createhbsrfs_4 = Honeybee_createHBSrfs(geometry=brep_6, srfType="2")  # -> readMe, simplify(HBSurface); plug-in component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
createhbsrfs_5 = Honeybee_createHBSrfs(geometry=brep_5, RADMaterial=radglassmaterial.RADMaterial)  # -> readMe, simplify(HBSurface); plug-in component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
sunpath = Ladybug_SunPath(
    location=importlocation,
    hour=panel_21,
    day=21,
    month=panel_22,
    timeStep=1,
    sunPathScale=Slider(0.2, range=0..1),
    dailyOrAnnualSunPath=True)  # -> readMe, sunVectors, sunAltitudes, sunAzimuths, port, sunSpheresMesh, sunPathCrvs, legend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; plug-in component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
gentestpts = Honeybee_GenerateTestPoints(testGeometry=brep_6, gridSize=Slider(0.2, range=0..1), distBaseSrf=Slider(0.5, range=0..1), moveTestMesh=True)  # -> readMe, simplify(testPoints), simplify(ptsVectors), simplify(facesArea), simplify(mesh); plug-in component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
brep_7 = Brep([createhbsrfs_3.HBSurface, createhbsrfs.HBSurface, createhbsrfs_5.HBSurface, createhbsrfs_4.HBSurface, createhbsrfs_2.HBSurface])
gridbasedsimulation = Honeybee_GridBasedSimulation(
    skyFile=genclimatebasedsky.skyFilePath,
    testPoints=gentestpts.testPoints,
    ptsVectors=gentestpts.ptsVectors,
    testMesh=gentestpts.mesh,
    simulationType=0)  # -> analysisRecipe; plug-in component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
annualdaylightsimulation = Honeybee_AnnualDaylightSimulation(
    epwWeatherFile=epw_stat_4.epwFile,
    testPoints=gentestpts.testPoints,
    ptsVectors=gentestpts.ptsVectors,
    testMesh=gentestpts.mesh)  # -> analysisRecipe; plug-in component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
toggle_3 = BooleanToggle(True)
rundaylightanalysis = Honeybee_RunDaylightSimulation(HBObjects=flatten(brep_7), analysisRecipe=gridbasedsimulation, writeRad=toggle_3, runRad=toggle_3, overwriteResults=True)  # -> readMe, analysisType, resultsUnit, illuminance_values, testPts, illuminance_files, radGeoFile, studyFolder, done; plug-in component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
rundaylightanalysis_2 = Honeybee_RunDaylightSimulation(
    HBObjects=flatten(brep_7),
    analysisRecipe=annualdaylightsimulation,
    writeRad=toggle_3,
    runRad=toggle_3,
    overwriteResults=True)  # -> readMe, analysisType, resultsUnit, results, testPts, annual_analysis_files, radGeoFile, studyFolder, done; plug-in component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
panel_27 = Panel(doy_hoy.date)
legendpar_5 = Ladybug_LegendParameters(lowBound="300", highBound="2000")  # -> legendPar; plug-in component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
concat = Concatenate(FragmentA=rundaylightanalysis.analysisType, FragmentC=panel_27)
recolormesh = Ladybug_RecolorMesh(
    analysisResult=rundaylightanalysis.illuminance_values,
    inputMesh=gentestpts.mesh,
    legendPar=legendpar_5,
    analysisTitle=concat,
    legendTitle=rundaylightanalysis.resultsUnit)  # -> readMe, newMesh, newLegend, legendBasePt, meshColors, legendColors; plug-in component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
occupancygenerator = Honeybee_DaysimOccupancyGenerator(weekendDays="0", writeTheOcc=Toggle(True))  # -> occupancyFile; plug-in component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
panel_28 = Panel(recolormesh.readMe)
recolormesh_2 = Ladybug_RecolorMesh(analysisResult=gentestpts.mesh)  # -> readMe, newMesh, newLegend, legendBasePt, meshColors, legendColors; plug-in component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
readannualresultsi = Honeybee_ReadAnnualResultI(
    illFilesAddress=rundaylightanalysis_2.annual_analysis_files,
    testPoints=simplify(rundaylightanalysis.testPts),
    occupancyFiles=occupancygenerator,
    DLAIllumThresholds="300",
    runIt=Toggle(True))  # -> DLA, UDLI_Less_100, UDLI_100_2000, UDLI_More_2000, CDA, sDA, annualProfiles, htmReport; plug-in component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
panel_29 = Panel(readannualresultsi.sDA)
join = TextJoin(Text=[item_7, "21", item_6], Join="_")
panel_30 = Panel(join)
dam = DataDam(DataA=rundaylightanalysis.done, BufferDelay=10000000, BufferMode=0)
join_2 = TextJoin(Join="-")
panel_31 = Panel(join_2)
captureview = Ladybug_CaptureView(fileName=panel_30, capture=Toggle(True))  # -> imagePath; plug-in component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
captureview_2 = Ladybug_CaptureView(fileName=panel_31, capture=[Toggle(True), dam])  # -> imagePath; plug-in component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
panel_32 = Panel(captureview)
panel_33 = Panel(captureview_2)

number_slider_3 = Slider(6, range=0..10)
box = DomainBox(Base=PlaneXY(0, 0, 0), X=number_slider_3, Y=Slider(4, range=0..10), Z=number_slider_3)
orientation = Slider(330, range=0..360)
list = ValueList({"Exterior Window [R1.0, SHGC 0.7]": "ASHRAE 90.1-2004 EXTWINDOW CLIMATEZONE ALT-WARE 1-8", "Exterior Window [R1.7, SHGC 0.39]": "ASHRAE 90.1-2004 EXTWINDOW CLIMATEZONE 4-6", "Exterior Window [R1.9, SHGC 0.39]": "ASHRAE 90.1-2004 EXTWINDOW CLIMATEZONE ALT-RES 4-6", "Exterior Window [R0.7, SHGC 0.65]": "Dbl LoE (e3=.1) Clr 3mm/13mm Arg"}, selected="Exterior Window [R1.0, SHGC 0.7]")
list_2 = ValueList({"Exterior Roof [R9.2]": "ASHRAE 90.1-2004 EXTROOF METAL CLIMATEZONE 3-4", "Exterior Roof [R14.8]": "ASHRAE 90.1-2004 EXTROOF IEAD CLIMATEZONE 1-4", "Exterior Roof [R34.4]": "ASHRAE 189.1-2009 EXTROOF IEAD CLIMATEZONE 7-8"}, selected="Exterior Roof [R34.4]")
list_3 = ValueList({"Existing Slab Construction": "0", "+4 Inches Concrete": "1", "+8 Inches Concrete": "2"}, selected="+8 Inches Concrete")
list_4 = ValueList({"Exterior Wall [R5.5]": "ASHRAE 90.1-2004 EXTWALL METAL CLIMATEZONE 4", "Exterior Wall [R5.8]": "ASHRAE 90.1-2004 EXTWALL MASS CLIMATEZONE 3-4", "Exterior Wall [R7.2]": "ASHRAE 90.1-2004 EXTWALL STEELFRAME CLIMATEZONE 1-4", "Exterior Wall [R8.7]": "ASHRAE 90.1-2004 EXTWALL MASS CLIMATEZONE ALT-RES 4", "Exterior Wall [R10.4]": "ASHRAE 90.1-2004 EXTWALL WOODFRAME CLIMATEZONE 1-7", "Exterior Wall [R14.8]": "ASHRAE 90.1-2004 EXTWALL STEELFRAME CLIMATEZONE ALT-RES 4-6", "Exterior Wall [R34.4]": "ASHRAE 189.1-2009 EXTROOF IEAD CLIMATEZONE 7-8"}, selected="Exterior Wall [R8.7]")
number_slider_4 = Slider(1.5, range=0..10)
run_energyplus = BooleanToggle(True)
glzparamlist = Honeybee_GlazingParametersList(
    northGlzParam=Slider(0.5, range=0..1),
    westGlzParam=Slider(0, range=0..1),
    southGlzParam=Slider(0.25, range=0..1),
    eastGlzParam=Slider(0, range=0..1))  # -> glzParamList; plug-in component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
toggle_4 = BooleanToggle(True)
mass2zone = Honeybee_Masses2Zones(zoneMasses=flatten(box), isConditioned=Toggle(True), maxRoofAngle=30, createHBZones=Toggle(True))  # -> readMe, HBZones; plug-in component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
box_2 = DomainBox(Base=PlaneXY(0, 0, 0), X=Slider(3, range=0..10), Y=Slider(4, range=0..10), Z=Slider(3, range=0..10))
volume = Volume(Geometry=box_2)  # -> Volume, Centroid
glazingcreator = Honeybee_GlazingBasedOnRatio(
    HBObjects=mass2zone.HBZones,
    glzRatio=glzparamlist,
    breakUpDist=Toggle(True),
    windowHeight=Slider(2, range=0..4),
    sillHeight=Slider(1.5, range=0..4),
    splitGlzVertDist=Slider(0.6, range=0..4),
    runIt=Toggle(True))  # -> readMe, HBObjWGLZ; plug-in component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
rotate = Rotate(Geometry=box_2, Angle=degrees(orientation), Plane=volume.Centroid)  # -> Geometry, Transform
glzparamlist_2 = Honeybee_GlazingParametersList(
    northGlzParam=Slider(0, range=0..1),
    westGlzParam=Slider(0, range=0..1),
    southGlzParam=Slider(0, range=0..1),
    eastGlzParam=Slider(0.2, range=0..1))  # -> glzParamList; plug-in component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
mass2zone_2 = Honeybee_Masses2Zones(zoneMasses=flatten(box_2), isConditioned=Toggle(True), maxRoofAngle=30, createHBZones=Toggle(True))  # -> readMe, HBZones; plug-in component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
glazingcreator_2 = Honeybee_GlazingBasedOnRatio(
    HBObjects=mass2zone_2.HBZones,
    glzRatio=glzparamlist_2,
    breakUpWindow=Toggle(True),
    breakUpDist=Slider(2, range=0..4),
    windowHeight=Slider(1.5, range=0..4),
    sillHeight=Slider(0.6, range=0..4),
    runIt=Toggle(True))  # -> readMe, HBObjWGLZ; plug-in component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
volume_2 = Volume(Geometry=glazingcreator_2.HBObjWGLZ)  # -> Volume, Centroid
rotatehbobj = Honeybee_RotateHoneybee(HBObj=glazingcreator_2.HBObjWGLZ, angle=orientation, cenPt=volume_2.Centroid)  # -> HBObj; plug-in component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
setepzonecnstr = Honeybee_SetEPZoneConstruction(HBZones=rotatehbobj, wallEPConstruction=list_4, windowEPConstruction=list, roofEPConstruction=list_2)  # -> simplify(modifiedHBZones); plug-in component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
filter = StreamFilter(Gate=list_3, Stream0=panel_19, Stream1=epconstruction_2, Stream2=epconstruction)
panel_34 = Panel(setepzonecnstr)
setepzoneundergroundcnstr = Honeybee_SetEPZoneUndergroundConstruction(HBZones=setepzonecnstr, groundFloorEPConstruction=filter)  # -> simplify(modifiedHBZones); plug-in component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
number_slider_5 = Slider(28, range=0..30)
number_slider_6 = Slider(24, range=0..30)
ach2m3_s_m2_calculator = Honeybee_infORventPerAreaCalculator(HBZones=flatten(setepzoneundergroundcnstr), airFlowRate=number_slider_4, ACHorM3sM2=Toggle(True))  # -> readMe, infORventPerArea, allFloors; plug-in component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
decomposebytype = Honeybee_DecomposeBasedOnType(HBZone=setepzoneundergroundcnstr)  # -> walls, interiorWalls, airWalls, windows, interiorWindows, skylights, roofs, ceilings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; plug-in component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
panel_35 = Panel("0")
panel_36 = Panel("https://www.energyplus.net/weather-download/north_and_central_america_wmo_region_4/USA/PA/USA_PA_Philadelphia.Intl.AP.724080_TMY3/all")
toggle_5 = BooleanToggle(True)
epw_stat_5 = Ladybug_OpenEPWAndSTATWeatherFiles(weatherFileURL=panel_36)  # -> epwFile, statFile; plug-in component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
setepzoneloads = Honeybee_SetEnergyPlusZoneLoads(HBZones=setepzoneundergroundcnstr, infiltrationRatePerArea=ach2m3_s_m2_calculator.infORventPerArea)  # -> loads, HBZones; plug-in component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
setepnatvent = Honeybee_SetEPAirFlow(
    HBZones=setepzoneloads.HBZones,
    naturalVentilationType="1",
    minIndoorTempForNatVent=number_slider_6,
    maxIndoorTempForNatVent=number_slider_5,
    minOutdoorTempForNatVent=number_slider_6,
    maxOutdoorTempForNatVent=number_slider_5,
    fractionOfGlzAreaOperable="1")  # -> readMe, simplify(HBZones); plug-in component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
epoutput = Honeybee_GenerateEPOutput(
    zoneEnergyUse=toggle_5,
    zoneGainsAndLosses=toggle_5,
    zoneComfortMetrics=toggle_5,
    surfaceTempAnalysis="False",
    surfaceEnergyAnalysis=toggle_5)  # -> report, flatten(simulationOutputs); plug-in component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
shddesigner = Ladybug_ShadingDesigner(
    glzSrf=flatten(decomposebytype.windows),
    depthOrVector=flatten(shading_depth),
    numOfShds=number_of_blinds,
    runIt=add_blinds,
    port_4=False)  # -> readMe, shadingSrfs; plug-in component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
brep_8 = Brep([<brep referenced from the Rhino model> x62])
ach2m3_s_m2_calculator_2 = Honeybee_infORventPerAreaCalculator(HBZones=flatten(mass2zone_2.HBZones), airFlowRate=number_slider_4, ACHorM3sM2=Toggle(False))  # -> readMe, infORventPerArea, allFloors; plug-in component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
wires = BrepWireframe(Brep=shddesigner.shadingSrfs, Density=-1)
createhbsrfs_6 = Honeybee_createHBSrfs(geometry=brep_8, srfType="6")  # -> readMe, simplify(HBSurface); plug-in component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
hb_epcontextsrf = HoneybeeEPContextSurfaces(shdSurfaces=flatten(createhbsrfs_6.HBSurface))  # -> HBContext; inputs shdSurfaces: list of Brep, justBoundingBox: Boolean
# ---------- hb_epcontextsrf: Python ----------
"""
prepare shading/context geometries

    Args:
        northVectorOrRotation: A vector that shows North or a number that shows
                               the rotation of the North from the Y axis
        bldgMasses: List of closed Breps as thermal zones.
    Returns:
        report: ...
        thermalZones: Thermal zone's geometries for visualiza
"""

ghenv.Component.Name = 'Honeybee EP context Surfaces'
ghenv.Component.NickName = 'HB_EPContextSrf'
ghenv.Component.Message = 'VER 0.0.60\nNOV_04_2016'
ghenv.Component.IconDisplayMode = ghenv.Component.IconDisplayMode.application
ghenv.Component.Category = "Honeybee"
ghenv.Component.SubCategory = "10 | Energy | Energy"
#compatibleHBVersion = VER 0.0.57\nNOV_04_2016
#compatibleLBVersion = VER 0.0.59\nFEB_01_2015
ghenv.Component.AdditionalHelpFromDocStrings = "2"

import rhinoscriptsyntax as rs
import Rhino as rc
import scriptcontext as sc
import os
import System
import Grasshopper.Kernel as gh
import uuid

tolerance = sc.doc.ModelAbsoluteTolerance
import math


def main(shdSurfaces, EPTransSchedule, meshingSettings, justBoundingBox):
    
    # import the classes
    if sc.sticky.has_key('honeybee_release'):

        try:
            if not sc.sticky['honeybee_release'].isCompatible(ghenv.Component): return -1
            if sc.sticky['honeybee_release'].isInputMissing(ghenv.Component): return -1
        except:
            warning = "You need a newer version of Honeybee to use this compoent." + \
            " Use updateHoneybee component to update userObjects.\n" + \
            "If you have already updated userObjects drag Honeybee_Honeybee component " + \
            "into canvas and try again."
            w = gh.GH_RuntimeMessageLevel.Warning
            ghenv.Component.AddRuntimeMessage(w, warning)
            return -1
        
        # don't customize this part
        hb_EPSrf = sc.sticky["honeybee_EPSurface"]
        hb_EPSHDSurface = sc.sticky["honeybee_EPShdSurface"]
        hb_RADMaterialAUX = sc.sticky["honeybee_RADMaterialAUX"]
        hb_EPObjectsAux = sc.sticky["honeybee_EPObjectsAUX"]()
        HBScheduleList = sc.sticky["honeybee_ScheduleLib"].keys()

        ########################################################################
        #----------------------------------------------------------------------#
        shdBreps = []
        # create bounding box of shading geometries
        if justBoundingBox:
            for brep in shdSurfaces:
                if brep.Faces.Count>1 or not brep.Faces[0].IsPlanar(sc.doc.ModelAbsoluteTolerance):
                    shdBreps.append(brep.GetBoundingBox(True).ToBrep())
                else:
                    shdBreps.append(brep)
        else:
            shdBreps = shdSurfaces
        
        shadingClasses = []
        shadingMeshPreview = []
        
        if meshingSettings == None:
            mp = rc.Geometry.MeshingParameters.Minimal
            mp.SimplePlanes = True
        else:
            mp = meshingSettings
        
        def getRadMaterialName(radMaterial):
            nameStr = radMaterial.split(" ")[2]
            name =  nameStr.split("\n")[0]
            return name
        
        for brepCount, brep in enumerate(shdBreps):
            if brep != None:
                isPlanar = True
                # check planarity
                for face in brep.Faces:
                    if not face.IsPlanar(tolerance):
                        isPlanar = False
                        break
                
                shadingBreps = []
                if not isPlanar:
                    meshArray = rc.Geometry.Mesh.CreateFromBrep(brep, mp)
                    for mesh in meshArray:
                        for meshFace in range(mesh.Faces.Count):
                            vertices = list(mesh.Faces.GetFaceVertices(meshFace))[1:]
                            vertices = vertices + [sc.doc.ModelAbsoluteTolerance]
                            # create the brep from mesh
                            shdBrep = rc.Geometry.Brep.CreateFromCornerPoints(*vertices)
                            shadingBreps.append(shdBrep)
                else:
                    for face in brep.Faces:
                        shadingBreps.append(face.DuplicateFace(False))
                
                for faceCount, shdBrep in enumerate(shadingBreps):
                        thisShading = hb_EPSHDSurface(shdBrep, 1000*brepCount + faceCount, 'shdSrf_' + `brepCount` + '_' + `faceCount` + "_" + str(uuid.uuid4()))
                        
                        # add transmittance schedule if any
                        if EPTransSchedule!=None:
                            schedule= EPTransSchedule.upper()
                            if schedule!=None and not schedule.lower().endswith(".csv") and schedule not in HBScheduleList:
                                msg = "Cannot find " + schedule + " in Honeybee schedule library."
                                print msg
                                ghenv.Component.AddRuntimeMessage(gh.GH_RuntimeMessageLevel.Warning, msg)
                                return -1
                            elif schedule!=None and schedule.lower().endswith(".csv"):
                                # check if csv file is existed
                                if not os.path.isfile(schedule):
                                    msg = "Cannot find the shchedule file: " + schedule
                                    print msg
                                    ghenv.Component.AddRuntimeMessage(gh.GH_RuntimeMessageLevel.Warning, msg)
                                    return -1
                            
                            thisShading.TransmittanceSCH = schedule
                        
                        # add the Rad Material if any
                        if RADMaterial!=None:
                            # if it is just the name of the material make sure it is already defined
                            if len(RADMaterial.split(" ")) == 1:
                                # if the material is not in the library add it to the library
                                if not hb_RADMaterialAUX.isMatrialExistInLibrary(RADMaterial):
                                    warningMsg = "Can't find " + RADMaterial + " in RAD Material Library.\n" + \
                                                "Add the material to the library and try again."
                                    ghenv.Component.AddRuntimeMessage(gh.GH_RuntimeMessageLevel.Warning, warningMsg)
                                    return
                                
                                try:
                                    thisShading.setRADMaterial(RADMaterial)
                                except Exception, e:
                                    print e
                                    warningMsg = "You are using an old version of Honeybee_Honeybee! Update your files and try again."
                                    print warningMsg
                                    ghenv.Component.AddRuntimeMessage(gh.GH_RuntimeMessageLevel.Warning, warningMsg)
                                    return
                                
                                addedToLib = True
                            else:
                                
                                # try to add the material to the library
                                addedToLib, thisShading.RadMaterial = hb_RADMaterialAUX.analyseRadMaterials(RADMaterial, True)
                                
                            if addedToLib==False:
                                warningMsg = "Failed to add " + RADMaterial + " to the Library."
                                ghenv.Component.AddRuntimeMessage(gh.GH_RuntimeMessageLevel.Warning, warningMsg)
                                return
                        
                        # add shading to the list
                        shadingClasses.append(thisShading)
                
        # add to the hive
        hb_hive = sc.sticky["honeybee_Hive"]()
        HBContext  = hb_hive.addToHoneybeeHive(shadingClasses, ghenv.Component)
        return HBContext
        ################################################################################################
    else:
        print "You should first let Honeybee to fly..."
        w = gh.GH_RuntimeMessageLevel.Warning
        ghenv.Component.AddRuntimeMessage(w, "You should first let Honeybee to fly...")
        return -1
        

if _shdSurfaces and _shdSurfaces[0]!=None:
    # add cleaning function
    result= main(_shdSurfaces, EPTransSchedule_, meshingSettings_, justBoundingBox_)
    
    if result != -1: HBContext = result
# ---------- end hb_epcontextsrf ----------
importepw_4 = Ladybug_ImportEpw(epwFile=epw_stat_5.epwFile)  # -> readMe, latitude, location, dryBulbTemperature, dewPointTemperature, relativeHumidity, windSpeed, windDirection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; plug-in component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
preview_22 = CustomPreview(Geometry=wires, Shader=ColourSwatch(SwatchColor=RGB(201, 24, 24)))
toggle_6 = BooleanToggle(True)
rep = ReplaceText(Text="base_case", Find=" ", Replace="_", RecursiveReplace=False)
setepzoneloads_2 = Honeybee_SetEnergyPlusZoneLoads(HBZones=setepzoneundergroundcnstr, infiltrationRatePerArea=ach2m3_s_m2_calculator_2.infORventPerArea)  # -> loads, HBZones; plug-in component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
epoutput_2 = Honeybee_GenerateEPOutput(
    zoneEnergyUse=toggle_6,
    zoneGainsAndLosses=toggle_6,
    zoneComfortMetrics=toggle_6,
    surfaceTempAnalysis="False",
    surfaceEnergyAnalysis=toggle_6,
    timestep="annual")  # -> report, flatten(simulationOutputs); plug-in component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
runenergysimulation = Honeybee_RunEnergySimulation(
    epwFile=epw_stat_5.epwFile,
    HBZones=flatten(setepnatvent.HBZones),
    HBContext=flatten(hb_epcontextsrf),
    simulationOutputs=flatten(epoutput.simulationOutputs),
    writeIdf=run_energyplus,
    runEnergyPlus=run_energyplus,
    idfFileName=rep)  # -> report, idfFileAddress, resultFileAddress; plug-in component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
run_energyplus_2 = BooleanToggle(True)
readepresult = Honeybee_ReadEPResult(resultFileAddress=runenergysimulation.resultFileAddress)  # -> totalThermalLoad, thermalLoadBalance, cooling, heating, electricLight, electricEquip, fanElectric, port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; plug-in component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
runenergysimulation_2 = Honeybee_RunEnergySimulation(
    epwFile=epw_stat_5.epwFile,
    HBZones=flatten(setepzoneloads_2.HBZones),
    simulationOutputs=flatten(epoutput_2.simulationOutputs),
    writeIdf=run_energyplus_2,
    runEnergyPlus=run_energyplus_2)  # -> report, idfFileAddress, resultFileAddress; plug-in component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
readepresult_2 = Honeybee_ReadEPResult(resultFileAddress=runenergysimulation_2.resultFileAddress)  # -> totalThermalLoad, thermalLoadBalance, cooling, heating, electricLight, electricEquip, port, port_2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; plug-in component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
energybalance = Honeybee_ConstructEnergyBalance(
    HBZones=flatten(mass2zone_2.HBZones),
    cooling=readepresult_2.cooling,
    heating=readepresult_2.heating,
    electricLight=readepresult_2.electricLight,
    electricEquip=readepresult_2.electricEquip,
    peopleGains=readepresult_2.peopleGains,
    totalSolarGain=readepresult_2.totalSolarGain,
    infiltrationEnergy=readepresult_2.infiltrationEnergy,
    mechVentilationEnergy=readepresult_2.mechVentilationEnergy)  # -> readMe, port, flrNormEnergyBal, flrNormBalWStorage, port_2, modelEnergyBalance, energyBalWithStorage; plug-in component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
selectandaveragedata_4 = Ladybug_AverageData(annualHourlyData=energybalance.energyBalWithStorage)  # -> readMe, selHourlyData, averagedDaily, averagedMonthly, avrMonthlyPerHour, avrAnalysisPeriod; plug-in component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
analysisperiod_13 = Ladybug_AnalysisPeriod()  # -> readMe, analysisPeriod; plug-in component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
gradientlibrary = Ladybug_GradientLibrary(gradIndex="19")  # -> customColors; plug-in component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
adaptivecomfortcalculator_3 = Ladybug_AdaptiveComfortCalculator(
    dryBulbTemperature=readepresult.airTemperature,
    meanRadiantTemperature=readepresult.meanRadTemperature,
    prevailingOutdoorTemp=importepw_4.dryBulbTemperature,
    analysisPeriod=analysisperiod_13.analysisPeriod,
    runIt=Toggle(True))  # -> readMe, port, comfortableOrNot, conditionOfPerson, degreesFromTarget, port_2, targetTemperature, upperTemperatureBound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; plug-in component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
selectandaveragedata_5 = Ladybug_AverageData(annualHourlyData=energybalance.energyBalWithStorage, totalOrAverage=Toggle(True))  # -> readMe, selHourlyData, totaledDaily, totaledMonthly, totMonthlyPerHour, totAnalysisPeriod; plug-in component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
legendpar_6 = Ladybug_LegendParameters(lowBound="-2000", highBound="2000", numSegments="41", customColors=flatten(gradientlibrary))  # -> legendPar; plug-in component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
panel_38 = Panel([readepresult.cooling, readepresult.heating])
legendpar_7 = Ladybug_LegendParameters(numSegments="3")  # -> legendPar; plug-in component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
pt_22 = Point(Point(217.242374, 29.10683385, 0))
barchart = Ladybug_MonthlyBarChart(
    inputData=flatten(selectandaveragedata_5.totaledMonthly),
    stackValues=Toggle(True),
    altTitle="Patient Room Energy Balance",
    altYAxisTitle="Energy (kWh)",
    basePoint=pt_22,
    xScale=Slider(0.5, range=0..1),
    yScale=Slider(1, range=0..1),
    legendPar=legendpar_6)  # -> readMe, dataMesh, dataCurves, dataCrvColors, graphAxes, graphLabels, title, titleBasePt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; plug-in component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
preview_23 = CustomPreview(Geometry=barchart.graphAxes, Shader=ColourSwatch(SwatchColor=RGB(0, 0, 0)))
vec = VectorXYZ(XComponent="20", YComponent="35", ZComponent=0)  # -> Vector, Length
pt_23 = Point(Point(2694.852815, -23.27007298, 0))
move = Move(Geometry=pt_23, Motion=vec.Vector)  # -> Geometry, Transform
pt_24 = Point(Point(2696.294436, -68.79753463, 0))
_3dchart_5 = Ladybug_3DChart(
    inputData=flatten(adaptivecomfortcalculator_3.conditionOfPerson),
    basePoint=pt_24,
    xScale=".05",
    yScale=".25",
    zScale=".25",
    legendPar=legendpar_7)  # -> readMe, graphMesh, graphCurves, legend, legendBasePts, title, titleBasePts, dataPts, conditionalHOY; plug-in component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
psychchart_2 = Ladybug_PsychrometricChart(
    dryBulbTemperature=readepresult.airTemperature,
    relativeHumidity=readepresult.relativeHumidity,
    basePoint=move.Geometry,
    runIt=Toggle(True))  # -> readMe, port, totalComfortPercent, totalComfortOrNot, strategyNames, strategyPercentOfTime, strategyOrNot, port_2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; plug-in component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
panel_39 = Panel(adaptivecomfortcalculator_3.percentHotCold)
panel_41 = Panel(adaptivecomfortcalculator_3.percentOfTimeComfortable)
preview_24 = CustomPreview(
    Geometry=[psychchart_2.chartCurvesAndTxt, _3dchart_5.graphCurves, _3dchart_5.graphMesh],
    Shader=ColourSwatch(SwatchColor=RGB(5, 0, 0)))

# ---- group: glass
brep_9 = Brep(<brep referenced from the Rhino model>)

# ----
panel_42 = Panel("""Construction,
    Dbl LoE (e3=.1) Clr 3mm/13mm Arg,  !- Name
    CLEAR 3MM,               !- Outside Layer
    ARGON 13MM,              !- Layer 2
    LoE CLEAR 3MM Rev;       !- Layer 3""")
panel_43 = Panel("""WindowMaterial:Gas,
    ARGON 13MM,               !- Name
    Argon,                   !- Gas Type
    0.0127;                  !- Thickness {m}""")
panel_44 = Panel("""WindowMaterial:Glazing,
    LoE CLEAR 3MM Rev,       !- Name
    SpectralAverage,         !- Optical Data Type
    ,                        !- Window Glass Spectral Data Set Name
    0.003,                   !- Thickness {m}
    0.630,                   !- Solar Transmittance at Normal Incidence
    0.220,                   !- Front Side Solar Reflectance at Normal Incidence
    0.190,                   !- Back Side Solar Reflectance at Normal Incidence
    0.850,                   !- Visible Transmittance at Normal Incidence
    0.079,                   !- Front Side Visible Reflectance at Normal Incidence
    0.056,                   !- Back Side Visible Reflectance at Normal Incidence
    0.0,                     !- Infrared Transmittance at Normal Incidence
    0.10,                    !- Front Side Infrared Hemispherical Emissivity
    0.84,                    !- Back Side Infrared Hemispherical Emissivity
    0.9;                     !- Conductivity {W/m-K}""")
toggle_7 = BooleanToggle(True)
addtoeplibrary = Honeybee_AddToEnergyPlusLibrary(EPObject=[panel_42, panel_43, panel_44], addToProjectLib=toggle_7, overwrite=toggle_7)  # -> readMe; plug-in component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

# ----
# Run the analysis
# Analysis Recipe
# set the view
panel_45 = Panel("tvis_60")
number_slider_7 = Slider(0.35, range=0..1)
number_slider_8 = Slider(0, range=0..2)
number_slider_9 = Slider(0.2, range=0..1)
number_slider_10 = Slider(0, range=0..2)
number_slider_11 = Slider(0.7, range=0..1)
number_slider_12 = Slider(0.5, range=0..1)
number_slider_13 = Slider(0.2, range=0..1)
radglassmaterial_2 = Honeybee_RadianceGlassMaterial(materialName=panel_45, RTransmittance="0.55", GTransmittance="0.55", BTransmittance="0.55", refractiveIndex=1.52)  # -> avrgTrans, RADMaterial; plug-in component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
radopaquematerial = Honeybee_RadianceOpaqueMaterial(
    materialName="SHADING",
    RReflectance=number_slider_7,
    GReflectance=number_slider_7,
    BReflectance=number_slider_7,
    roughness=0.05,
    specularity=0)  # -> avrgRef, RADMaterial; plug-in component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
radopaquematerial_2 = Honeybee_RadianceOpaqueMaterial(
    materialName="FLOOR",
    RReflectance=number_slider_9,
    GReflectance=number_slider_9,
    BReflectance=number_slider_9,
    roughness=0.05,
    specularity=0)  # -> avrgRef, RADMaterial; plug-in component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
radopaquematerial_3 = Honeybee_RadianceOpaqueMaterial(
    materialName="CEILING",
    RReflectance=number_slider_11,
    GReflectance=number_slider_11,
    BReflectance=number_slider_11,
    roughness=0.05,
    specularity=0)  # -> avrgRef, RADMaterial; plug-in component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
radopaquematerial_4 = Honeybee_RadianceOpaqueMaterial(
    materialName="WALLS",
    RReflectance=number_slider_12,
    GReflectance=number_slider_12,
    BReflectance=number_slider_12,
    roughness=0.05,
    specularity=0)  # -> avrgRef, RADMaterial; plug-in component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
radopaquematerial_5 = Honeybee_RadianceOpaqueMaterial(
    materialName="SHADING",
    RReflectance=number_slider_13,
    GReflectance=number_slider_13,
    BReflectance=number_slider_13,
    roughness=0.05,
    specularity=0)  # -> avrgRef, RADMaterial; plug-in component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
hours_2 = Panel("""9
12
15""")
months_2 = Panel("""3
6
12""")
fly_2 = Ladybug_fly(inputSliders=[number_slider_8, number_slider_10], fly=Button())  # -> Vviiiiiiiiiizzz; plug-in component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
brep_10 = Brep([<brep referenced from the Rhino model> x63])
brep_11 = Brep(<brep referenced from the Rhino model>)
brep_12 = Brep(<brep referenced from the Rhino model>)
brep_13 = Brep([<brep referenced from the Rhino model> x3])
brep_14 = Brep([<brep referenced from the Rhino model> x31])
createhbsrfs_7 = Honeybee_createHBSrfs(geometry=brep_10, RADMaterial=radopaquematerial.RADMaterial)  # -> readMe, simplify(flatten(HBSurface)); plug-in component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
item_8 = ListItem(List=hours_2, Index=number_slider_10, Wrap=True)
item_9 = ListItem(List=months_2, Index=number_slider_8, Wrap=True)
createhbsrfs_8 = Honeybee_createHBSrfs(geometry=brep_12, RADMaterial=radopaquematerial_3.RADMaterial)  # -> readMe, simplify(flatten(HBSurface)); plug-in component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
createhbsrfs_9 = Honeybee_createHBSrfs(geometry=brep_13, RADMaterial=radopaquematerial_4.RADMaterial)  # -> readMe, simplify(flatten(HBSurface)); plug-in component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
createhbsrfs_10 = Honeybee_createHBSrfs(geometry=brep_14)  # -> readMe, simplify(flatten(HBSurface)); plug-in component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
createhbsrfs_11 = Honeybee_createHBSrfs(geometry=brep_11, RADMaterial=radopaquematerial_2.RADMaterial)  # -> readMe, simplify(flatten(HBSurface)); plug-in component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
createhbsrfs_12 = Honeybee_createHBSrfs(geometry=brep_9, RADMaterial=radglassmaterial_2.RADMaterial)  # -> readMe, simplify(HBSurface); plug-in component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
panel_46 = Panel("""9
12
15""")
panel_47 = Panel("""3
6
12""")
importlocation_2 = Ladybug_ImportLocation()  # -> location; plug-in component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
sunpath_2 = Ladybug_SunPath(
    location=importlocation_2,
    hour=panel_46,
    day=21,
    month=panel_47,
    timeStep=1,
    sunPathScale=Slider(0.2, range=0..1),
    dailyOrAnnualSunPath=True)  # -> readMe, sunVectors, sunAltitudes, sunAzimuths, port, sunSpheresMesh, sunPathCrvs, legend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; plug-in component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
panel_48 = Panel("https://www.energyplus.net/weather-download/north_and_central_america_wmo_region_4/USA/PA/USA_PA_Philadelphia.Intl.AP.724080_TMY3/all")
epw_stat_6 = Ladybug_OpenEPWAndSTATWeatherFiles(weatherFileURL=panel_48)  # -> epwFile, statFile; plug-in component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
number_slider_14 = Slider(15, range=0..100)
genclimatebasedsky_2 = Honeybee_GenerateClimateBasedSky(north=number_slider_14, weatherFile=epw_stat_6.epwFile, month=item_9, day="21", hour=item_8)  # -> radiationValues, skyFilePath; plug-in component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
genavgsky = Honeybee_GenerateAverageSky(north=number_slider_14, weatherFile=epw_stat_6.epwFile, month=item_9, hour=item_8)  # -> radiationValues, skyFilePath; plug-in component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
northarrow = Ladybug_North(north=number_slider_14, scale=".05")  # -> northSign; plug-in component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
panel_49 = Panel([genclimatebasedsky_2.radiationValues, genavgsky.radiationValues])
set_the_view_to_fisheye_for_glare_analys = Panel("1")  # "set the view to FishEye for Glare Analysis"
radparameters = Honeybee_RADParameters(quality=0, ab="3")  # -> readMe, radParameters; plug-in component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
doy_hoy_2 = Ladybug_DOY_HOY(days="21", months=item_9, hours=item_8)  # -> HOY, DOY, date; plug-in component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
brep_15 = Brep(flatten([createhbsrfs_8.HBSurface, createhbsrfs_9.HBSurface, createhbsrfs_7.HBSurface, createhbsrfs_11.HBSurface, createhbsrfs_12.HBSurface]))
imagebasedsimulation = Honeybee_ImageBasedSimulation(
    skyFile=genavgsky.skyFilePath,
    cameraType=set_the_view_to_fisheye_for_glare_analys,
    simulationType=2,
    radParameters=radparameters.radParameters,
    backupImages=0)  # -> analysisRecipe; plug-in component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
join_3 = TextJoin(Text=[item_9, "21", item_8], Join="_")
wires_2 = BrepWireframe(Brep=brep_15, Density=-1)
panel_50 = Panel(join_3)
toggle_8 = BooleanToggle(True)
rundaylightanalysis_3 = Honeybee_RunDaylightSimulation(
    HBObjects=flatten(brep_15),
    analysisRecipe=imagebasedsimulation,
    writeRad=toggle_8,
    runRad=toggle_8,
    numOfCPUs="4",
    radFileName=doy_hoy_2.date,
    overwriteResults=True)  # -> readMe, analysisType, resultsUnit, results, testPts, resultFiles, radGeoFile, studyFolder, done; plug-in component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
captureview_3 = Ladybug_CaptureView(fileName=panel_50, capture=Toggle(True))  # -> imagePath; plug-in component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
panel_51 = Panel("""Radiance
Grasshopper
Honeybee
Glare
Daylight
Set View
HBExampleFiles""")
panel_52 = Panel("""This file shows how to run a glare analysis using Honeybee. This example is using same geometry as the other daylighting examples [[1](http://hydrashare.github.io/hydra/viewer?owner=mostaphaRoudsari&fork=hydra_1&id=Surface_by_surface_geometry_preparation_for_daylight_simulation_II), [2](http://hydrashare.github.io/hydra/viewer?owner=mostaphaRoudsari&fork=hydra_1&id=Find_when_sun_is_visible_to_a_point)].
The example is uses Averaged Climate-based Sky for glare analysis which uses the average value for that hour during the whole month.""")
md_slider = MDSlider(
    slider_value=Point(0.5215606689, 0.5079524343, 0.5),
    SliderMode=0,
    x_domain=Domain(-1, 1),
    y_domain=Domain(-1, 1),
    z_domain=Domain(0, 1))
panel_53 = Panel(captureview_3)
panel_54 = Panel("C:\Users\Administrator\Dropbox\ladybug\helpDesk\PennDesign2015\Daylight_Glare_Analysis.png")
glareanalysis = Honeybee_GlareAnalysis(HDRImagePath=rundaylightanalysis_3.resultFiles, runIt=Toggle(True))  # -> readMe, glareCheckImage, DGP, DGI, imageWithTaskArea; plug-in component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
falsecolor = Honeybee_FalseColor(
    HDRFilePath=rundaylightanalysis_3.resultFiles,
    contourBands=False,
    maskThreshold=0.1,
    useAlterColors=False,
    render=Toggle(True))  # -> outputFilePath; plug-in component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
exporthydra = Hydra_ExportFile(
    fileName="Glare Analysis",
    fileDescription=panel_52,
    fileTags=panel_51,
    targetFolder="C:\Users\Administrator\Documents\GitHub\hydra_1",
    includeRhino=Toggle(True),
    additionalImgs=panel_54,
    export=Toggle(False))  # -> readMe; inputs fileDescription: list, changeLog: list, fileTags: list, includeRhino: Boolean, GHForThumb: Boolean, additionalImgs: list, export: Boolean; plug-in component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
panel_55 = Panel(glareanalysis.DGP)
hdr_tif = Honeybee_ConvertHDRToTIF(HDRFilePath=glareanalysis.glareCheckImage, adjustExposure=Toggle(False))  # -> TIFFFilePath; plug-in component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
hdr_tif_2 = Honeybee_ConvertHDRToTIF(HDRFilePath=falsecolor, adjustExposure=False)  # -> TIFFFilePath; plug-in component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
number_slider_15 = Slider(0.8, range=0..1)

# ---- group: For better visualization - Doesn't effect the results of the analysis
importlocation_3 = Ladybug_ImportLocation(epwFile=epw_stat_6.epwFile)  # -> location; plug-in component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
sunpath_3 = Ladybug_SunPath(
    north=number_slider_14,
    location=importlocation_3,
    hour=item_8,
    day="21",
    month=item_9,
    timeStep=1,
    sunPathScale=Slider(0.2, range=0..1),
    dailyOrAnnualSunPath=True)  # -> readMe, sunVectors, sunAltitudes, sunAzimuths, port, sunSpheresMesh, sunPathCrvs, legend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; plug-in component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

# ----
pt_25 = Point(Point(3, 2.544838682, 0.1224289629))
comfortmannequin = Ladybug_ComfortMannequin(rotationAngle="175", bodyLocation=pt_25)  # -> mannequinMesh, legend, legendBasePt; plug-in component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

# ---- group: Person's face!
item_10 = ListItem(List=comfortmannequin.mannequinMesh, Index=121, Wrap=True)

# ----
preview_25 = CustomPreview(Geometry=item_10, Shader=ColourSwatch(SwatchColor=RGB(255, 0, 0)))

facen = FaceNormals(Mesh=item_10)  # -> Centers, Normals
settheview = Ladybug_SetTheView(cameraLocation=facen.Centers, cameraDirection=facen.Normals, uvLookAround=md_slider)  # -> readMe; plug-in component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
