# Grasshopper definition Siram_Neeharika.gh (Grasshopper 0.9.76)
# plug-ins: Python Interpreter

# ---- group: WWR
wwr_north = Slider(0, range=0..1)
wwr_west = Slider(0, range=0..1)
wwr_south = Slider(0.5, range=0..1)
wwr_east = Slider(0, range=0..1)

# ----
run_energyplus = BooleanToggle(True)
# Rotation Angle
number_slider = Slider(0.2, range=0..1)
ladybug = Ladybug_Ladybug()  # -> Vviiiiiiiiiizzz; plug-in component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

shading_depth = Slider(0.4, range=0..1)
number_of_blinds = Slider(4, range=0..10)
# Blinds
add_blinds = BooleanToggle(True)

list = ValueList({"Exterior Window [R1.0, SHGC 0.7]": "ASHRAE 90.1-2004 EXTWINDOW CLIMATEZONE ALT-WARE 1-8", "Exterior Window [R1.7, SHGC 0.39]": "ASHRAE 90.1-2004 EXTWINDOW CLIMATEZONE 4-6", "Exterior Window [R1.9, SHGC 0.39]": "ASHRAE 90.1-2004 EXTWINDOW CLIMATEZONE ALT-RES 4-6", "Exterior Window [R0.7, SHGC 0.65]": "Dbl LoE (e3=.1) Clr 3mm/13mm Arg"}, selected="Exterior Window [R1.0, SHGC 0.7]")
list_2 = ValueList({"Exterior Roof [R9.2]": "ASHRAE 90.1-2004 EXTROOF METAL CLIMATEZONE 3-4", "Exterior Roof [R14.8]": "ASHRAE 90.1-2004 EXTROOF IEAD CLIMATEZONE 1-4", "Exterior Roof [R34.4]": "ASHRAE 189.1-2009 EXTROOF IEAD CLIMATEZONE 7-8"}, selected="Exterior Roof [R34.4]")
list_3 = ValueList({"Exterior Wall [R5.5]": "ASHRAE 90.1-2004 EXTWALL METAL CLIMATEZONE 4", "Exterior Wall [R5.8]": "ASHRAE 90.1-2004 EXTWALL MASS CLIMATEZONE 3-4", "Exterior Wall [R7.2]": "ASHRAE 90.1-2004 EXTWALL STEELFRAME CLIMATEZONE 1-4", "Exterior Wall [R8.7]": "ASHRAE 90.1-2004 EXTWALL MASS CLIMATEZONE ALT-RES 4", "Exterior Wall [R10.4]": "ASHRAE 90.1-2004 EXTWALL WOODFRAME CLIMATEZONE 1-7", "Exterior Wall [R14.8]": "ASHRAE 90.1-2004 EXTWALL STEELFRAME CLIMATEZONE ALT-RES 4-6", "Exterior Wall [R34.4]": "ASHRAE 189.1-2009 EXTROOF IEAD CLIMATEZONE 7-8"}, selected="Exterior Wall [R34.4]")

number_slider_2 = Slider(0.045, range=0..1)
# Construction
number_slider_3 = Slider(0.03, range=0..1)
# Thermal Mass
list_4 = ValueList({"Existing Slab Construction": "0", "+4 Inches Concrete": "1", "+8 Inches Concrete": "2"}, selected="+8 Inches Concrete")
# Wall to Window Ratio
panel = Panel("base_case")
honeybee = Honeybee_Honeybee()  # -> Vviiiiiiiiiizzz; plug-in component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
box = DomainBox(Base=PlaneXY(0, 0, 0), X=Slider(3, range=0..10), Y=Slider(4, range=0..10), Z=Slider(3, range=0..10))
glzparamlist = Honeybee_GlazingParametersList(northGlzParam=wwr_north, westGlzParam=wwr_west, southGlzParam=wwr_south, eastGlzParam=number_slider)  # -> glzParamList; plug-in component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
# Geometry
mass2zone = Honeybee_Masses2Zones(zoneMasses=flatten(box), isConditioned=Toggle(False), maxRoofAngle=30, createHBZones=Toggle(True))  # -> readMe, HBZones; plug-in component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

callfromepconstrlibrary = Honeybee_CallFromEPConstructionLibrary(keywords="floor")  # -> ThermMaterials, EPMaterials, EPWindowMaterials, EPConstructions; plug-in component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
item = ListItem(List=callfromepconstrlibrary.EPConstructions, Index=Slider(0, range=0..100), Wrap=True)
decomposeepconstruction = Honeybee_DecomposeEPConstruction(cnstrName=item)  # -> flatten(materials), comments, UValue_SI, UValue_IP, RValue_SI, RValue_IP; plug-in component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

callfromepconstrlibrary_2 = Honeybee_CallFromEPConstructionLibrary(keywords="slab")  # -> ThermMaterials, EPMaterials, EPWindowMaterials, EPConstructions; plug-in component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
item_2 = ListItem(List=callfromepconstrlibrary_2.EPConstructions, Index="2", Wrap=True)
decomposeepconstruction_2 = Honeybee_DecomposeEPConstruction(cnstrName=item_2)  # -> flatten(materials), comments, UValue_SI, UValue_IP, RValue_SI, RValue_IP; plug-in component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

glazingcreator = Honeybee_GlazingBasedOnRatio(
    HBObjects=mass2zone.HBZones,
    glzRatio=glzparamlist,
    breakUpWindow=Toggle(False),
    breakUpDist=Slider(2, range=0..4),
    windowHeight=Slider(1.5, range=0..4),
    sillHeight=Slider(0.6, range=0..4),
    runIt=Toggle(True))  # -> readMe, HBObjWGLZ; plug-in component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
volume = Volume(Geometry=glazingcreator.HBObjWGLZ)  # -> Volume, Centroid
rotatehbobj = Honeybee_RotateHoneybee(HBObj=glazingcreator.HBObjWGLZ, angle=Slider(0, range=-90..360), cenPt=volume.Centroid)  # -> HBObj; plug-in component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
wires = BrepWireframe(Brep=rotatehbobj, Density=-1)

panel_2 = Panel("""MAT-CC05 4 HW CONCRETE
MAT-CC05 8 HW CONCRETE""")
panel_3 = Panel(decomposeepconstruction.materials)
item_3 = ListItem(List=decomposeepconstruction.materials, Index=0, Wrap=True)  # -> Item, Item1
item_4 = ListItem(List=panel_2, Index=0, Wrap=True)  # -> Item, Item1
panel_4 = Panel(item)
epconstruction = Honeybee_EnergyPlusConstruction(name="floor_cnstr_2", layer_1=item_3.Item, layer_2=item_3.Item1, layer_3=item_4.Item1)  # -> EPConstruction; plug-in component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
epconstruction_2 = Honeybee_EnergyPlusConstruction(name="floor_cnstr_1", layer_1=item_3.Item, layer_2=item_3.Item1, layer_3=item_4.Item)  # -> EPConstruction; plug-in component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

panel_5 = Panel("""Construction,
    Dbl LoE (e3=.1) Clr 3mm/13mm Arg,  !- Name
    CLEAR 3MM,               !- Outside Layer
    ARGON 13MM,              !- Layer 2
    LoE CLEAR 3MM Rev;       !- Layer 3""")
panel_6 = Panel("""WindowMaterial:Gas,
    ARGON 13MM,               !- Name
    Argon,                   !- Gas Type
    0.0127;                  !- Thickness {m}""")
panel_7 = Panel("""WindowMaterial:Glazing,
    LoE CLEAR 3MM Rev,       !- Name
    SpectralAverage,         !- Optical Data Type
    ,                        !- Window Glass Spectral Data Set Name
    0.003,                   !- Thickness {m}
    0.630,                   !- Solar Transmittance at Normal Incidence
    0.220,                   !- Front Side Solar Reflectance at Normal Incidence
    0.190,                   !- Back Side Solar Reflectance at Normal Incidence
    0.850,                   !- Visible Transmittance at Normal Incidence
    0.079,                   !- Front Side Visible Reflectance at Normal Incidence
    0.056,                   !- Back Side Visible Reflectance at Normal Incidence
    0.0,                     !- Infrared Transmittance at Normal Incidence
    0.10,                    !- Front Side Infrared Hemispherical Emissivity
    0.84,                    !- Back Side Infrared Hemispherical Emissivity
    0.9;                     !- Conductivity {W/m-K}""")
toggle = BooleanToggle(True)
addtoeplibrary = Honeybee_AddToEnergyPlusLibrary(EPObject=[panel_5, panel_6, panel_7], addToProjectLib=toggle, overwrite=toggle)  # -> readMe; plug-in component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

filter = StreamFilter(Gate=list_4, Stream0=panel_4, Stream1=epconstruction_2, Stream2=epconstruction)
# Construction
setepzonecnstr = Honeybee_SetEPZoneConstruction(HBZone=rotatehbobj, wallEPConstruction=list_3, windowEPConstruction=list, roofEPConstruction=list_2)  # -> simplify(modifiedHBZone); plug-in component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
setepzoneundergroundcnstr = Honeybee_SetEPZoneUndergroundConstruction(HBZone=flatten(setepzonecnstr), groundFloorEPConstruction=filter)  # -> simplify(modifiedHBZone); plug-in component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
panel_8 = Panel("https://www.energyplus.net/weather-download/north_and_central_america_wmo_region_4/USA/PA/USA_PA_Philadelphia.Intl.AP.724080_TMY3/all")
epw_stat = Ladybug_OpenEPWAndSTATWeatherFiles(weatherFileURL=panel_8)  # -> epwFile, statFile; plug-in component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
number_slider_4 = Slider(45, range=-90..90)
ach2m3_s_m2_calculator = Honeybee_infORventPerAreaCalculator()  # -> readMe, infORventPerArea, allFloors; plug-in component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

decomposebytype = Honeybee_DecomposeBasedOnType(HBZone=setepzoneundergroundcnstr)  # -> walls, interiorWalls, airWalls, windows, interiorWindows, skylights, roofs, ceilings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; plug-in component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
# Blinds
shddesigner = Ladybug_ShadingDesigner(
    glzSrf=flatten(decomposebytype.windows),
    depthOrVector=flatten(shading_depth),
    numOfShds=number_of_blinds,
    runIt=add_blinds,
    port_4=False)  # -> readMe, shadingSrfs; plug-in component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
wires_2 = BrepWireframe(Brep=shddesigner.shadingSrfs, Density=-1)
hb_epcontextsrf = HoneybeeEPContextSurfaces(shdSurfaces=flatten(shddesigner.shadingSrfs))  # -> HBContext; inputs shdSurfaces: list of Brep, justBoundingBox: Boolean
# ---------- hb_epcontextsrf: Python ----------
"""
prepare shading/context geometries

    Args:
        northVectorOrRotation: A vector that shows North or a number that shows
                               the rotation of the North from the Y axis
        bldgMasses: List of closed Breps as thermal zones.
    Returns:
        report: ...
        thermalZones: Thermal zone's geometries for visualiza
"""

ghenv.Component.Name = 'Honeybee EP context Surfaces'
ghenv.Component.NickName = 'HB_EPContextSrf'
ghenv.Component.Message = 'VER 0.0.59\nJAN_26_2016'
ghenv.Component.IconDisplayMode = ghenv.Component.IconDisplayMode.application
ghenv.Component.Category = "Honeybee"
ghenv.Component.SubCategory = "09 | Energy | Energy"
#compatibleHBVersion = VER 0.0.57\nNOV_01_2015
#compatibleLBVersion = VER 0.0.59\nFEB_01_2015
ghenv.Component.AdditionalHelpFromDocStrings = "2"

import rhinoscriptsyntax as rs
import Rhino as rc
import scriptcontext as sc
import os
import System
import Grasshopper.Kernel as gh
import uuid

tolerance = sc.doc.ModelAbsoluteTolerance
import math


def main(shdSurfaces, EPTransSchedule, meshingSettings, justBoundingBox):
    
    # import the classes
    if sc.sticky.has_key('honeybee_release'):

        try:
            if not sc.sticky['honeybee_release'].isCompatible(ghenv.Component): return -1
            if sc.sticky['honeybee_release'].isInputMissing(ghenv.Component): return -1
        except:
            warning = "You need a newer version of Honeybee to use this compoent." + \
            " Use updateHoneybee component to update userObjects.\n" + \
            "If you have already updated userObjects drag Honeybee_Honeybee component " + \
            "into canvas and try again."
            w = gh.GH_RuntimeMessageLevel.Warning
            ghenv.Component.AddRuntimeMessage(w, warning)
            return -1
        
        # don't customize this part
        hb_EPSrf = sc.sticky["honeybee_EPSurface"]
        hb_EPSHDSurface = sc.sticky["honeybee_EPShdSurface"]
        hb_RADMaterialAUX = sc.sticky["honeybee_RADMaterialAUX"]
        hb_EPObjectsAux = sc.sticky["honeybee_EPObjectsAUX"]()
        HBScheduleList = sc.sticky["honeybee_ScheduleLib"].keys()

        ########################################################################
        #----------------------------------------------------------------------#
        shdBreps = []
        # create bounding box of shading geometries
        if justBoundingBox:
            for brep in shdSurfaces:
                if brep.Faces.Count>1 or not brep.Faces[0].IsPlanar(sc.doc.ModelAbsoluteTolerance):
                    shdBreps.append(brep.GetBoundingBox(True).ToBrep())
                else:
                    shdBreps.append(brep)
        else:
            shdBreps = shdSurfaces
        
        shadingClasses = []
        shadingMeshPreview = []
        
        if meshingSettings == None:
            mp = rc.Geometry.MeshingParameters.Minimal
            mp.SimplePlanes = True
        else:
            mp = meshingSettings
        
        def getRadMaterialName(radMaterial):
            nameStr = radMaterial.split(" ")[2]
            name =  nameStr.split("\n")[0]
            return name
        
        for brepCount, brep in enumerate(shdBreps):
            if brep != None:
                isPlanar = True
                # check planarity
                for face in brep.Faces:
                    if not face.IsPlanar(tolerance):
                        isPlanar = False
                        break
                
                shadingBreps = []
                if not isPlanar:
                    meshArray = rc.Geometry.Mesh.CreateFromBrep(brep, mp)
                    for mesh in meshArray:
                        for meshFace in range(mesh.Faces.Count):
                            vertices = list(mesh.Faces.GetFaceVertices(meshFace))[1:]
                            vertices = vertices + [sc.doc.ModelAbsoluteTolerance]
                            # create the brep from mesh
                            shdBrep = rc.Geometry.Brep.CreateFromCornerPoints(*vertices)
                            shadingBreps.append(shdBrep)
                else:
                    for face in brep.Faces:
                        shadingBreps.append(face.DuplicateFace(False))
                
                for faceCount, shdBrep in enumerate(shadingBreps):
                        thisShading = hb_EPSHDSurface(shdBrep, 1000*brepCount + faceCount, 'shdSrf_' + `brepCount` + '_' + `faceCount` + "_" + str(uuid.uuid4()))
                        
                        # add transmittance schedule if any
                        if EPTransSchedule!=None:
                            schedule= EPTransSchedule.upper()
                            if schedule!=None and not schedule.lower().endswith(".csv") and schedule not in HBScheduleList:
                                msg = "Cannot find " + schedule + " in Honeybee schedule library."
                                print msg
                                ghenv.Component.AddRuntimeMessage(gh.GH_RuntimeMessageLevel.Warning, msg)
                                return -1
                            elif schedule!=None and schedule.lower().endswith(".csv"):
                                # check if csv file is existed
                                if not os.path.isfile(schedule):
                                    msg = "Cannot find the shchedule file: " + schedule
                                    print msg
                                    ghenv.Component.AddRuntimeMessage(gh.GH_RuntimeMessageLevel.Warning, msg)
                                    return -1
                            
                            thisShading.TransmittanceSCH = schedule
                        
                        # add the Rad Material if any
                        if RADMaterial!=None:
                            # if it is just the name of the material make sure it is already defined
                            if len(RADMaterial.split(" ")) == 1:
                                # if the material is not in the library add it to the library
                                if not hb_RADMaterialAUX.isMatrialExistInLibrary(RADMaterial):
                                    warningMsg = "Can't find " + RADMaterial + " in RAD Material Library.\n" + \
                                                "Add the material to the library and try again."
                                    ghenv.Component.AddRuntimeMessage(gh.GH_RuntimeMessageLevel.Warning, warningMsg)
                                    return
                                
                                try:
                                    thisShading.setRADMaterial(RADMaterial)
                                except Exception, e:
                                    print e
                                    warningMsg = "You are using an old version of Honeybee_Honeybee! Update your files and try again."
                                    print warningMsg
                                    ghenv.Component.AddRuntimeMessage(gh.GH_RuntimeMessageLevel.Warning, warningMsg)
                                    return
                                
                                addedToLib = True
                            else:
                                
                                # try to add the material to the library
                                addedToLib, thisShading.RadMaterial = hb_RADMaterialAUX.analyseRadMaterials(RADMaterial, True)
                                
                            if addedToLib==False:
                                warningMsg = "Failed to add " + RADMaterial + " to the Library."
                                ghenv.Component.AddRuntimeMessage(gh.GH_RuntimeMessageLevel.Warning, warningMsg)
                                return
                        
                        # add shading to the list
                        shadingClasses.append(thisShading)
                
        # add to the hive
        hb_hive = sc.sticky["honeybee_Hive"]()
        HBContext  = hb_hive.addToHoneybeeHive(shadingClasses, ghenv.Component.InstanceGuid.ToString())
        return HBContext
        ################################################################################################
    else:
        print "You should first let Honeybee to fly..."
        w = gh.GH_RuntimeMessageLevel.Warning
        ghenv.Component.AddRuntimeMessage(w, "You should first let Honeybee to fly...")
        return -1
        

if _shdSurfaces and _shdSurfaces[0]!=None:
    # add cleaning function
    result= main(_shdSurfaces, EPTransSchedule_, meshingSettings_, justBoundingBox_)
    
    if result != -1: HBContext = result
# ---------- end hb_epcontextsrf ----------
preview = CustomPreview(Geometry=wires_2, Shader=ColourSwatch(SwatchColor=RGBA(0, 0, 0, 194)))

# ----
# infiltration rate
ach2m3_s_m2_calculator_2 = HoneybeeInfORventPerAreaCalculator(HBZones=flatten(setepzoneundergroundcnstr), airChangeHour=Slider(3, range=0..10))  # -> out, infORventPerArea, allFloors; plug-in component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
setepzoneloads = Honeybee_SetEnergyPlusZoneLoads(HBZones=flatten(setepzoneundergroundcnstr), infiltrationRatePerArea=ach2m3_s_m2_calculator_2.infORventPerArea)  # -> loads, HBZones; plug-in component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

ach2m3_s_m2_calculator_3 = HoneybeeInfORventPerAreaCalculator()  # -> out, infORventPerArea, allFloors; plug-in component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
ach2m3_s_m2_calculator_4 = Honeybee_infORventPerAreaCalculator(HBZones=flatten(mass2zone.HBZones), airFlowRate="1", ACHorM3sM2=Toggle(True))  # -> readMe, infORventPerArea, allFloors; plug-in component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
toggle_2 = BooleanToggle(True)
setepzoneloads_2 = Honeybee_SetEnergyPlusZoneLoads(HBZones=mass2zone.HBZones, numOfPeoplePerArea=".12", ventilationPerArea=ach2m3_s_m2_calculator_4.infORventPerArea)  # -> loads, HBZones; plug-in component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
epoutput = Honeybee_GenerateEPOutput(
    zoneEnergyUse=toggle_2,
    zoneGainsAndLosses=toggle_2,
    zoneComfortMetrics="False",
    surfaceTempAnalysis="False",
    surfaceEnergyAnalysis=toggle_2,
    timestep="HOURLY")  # -> report, flatten(simulationOutputs); plug-in component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
toggle_3 = BooleanToggle(True)
toggle_4 = BooleanToggle(True)
panel_9 = Panel("https://www.energyplus.net/weather-download/north_and_central_america_wmo_region_4/USA/PA/USA_PA_Philadelphia.Intl.AP.724080_TMY3/all")
runenergysimulation = Honeybee_RunEnergySimulation(
    epwFile=epw_stat.epwFile,
    HBZones=flatten(setepzoneloads_2.HBZones),
    simulationOutputs=flatten(epoutput.simulationOutputs),
    writeIdf=toggle_3,
    runEnergyPlus=toggle_3)  # -> report, idfFileAddress, resultFileAddress; plug-in component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
epoutput_2 = Honeybee_GenerateEPOutput(zoneGainsAndLosses=toggle_4, zoneComfortMetrics=toggle_4, surfaceTempAnalysis="False")  # -> report, flatten(simulationOutputs); plug-in component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
epw_stat_2 = Ladybug_OpenEPWAndSTATWeatherFiles(weatherFileURL=panel_9)  # -> epwFile, statFile; plug-in component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
rep = ReplaceText(Text=panel, Find=" ", Replace="_", RecursiveReplace=False)
readepresult = Honeybee_ReadEPResult(resultFileAddress=runenergysimulation.resultFileAddress)  # -> port, port_2, port_3, port_4, electricLight, electricEquip, port_5, port_6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; plug-in component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
readepsrfresult = Honeybee_ReadEPSurfaceResult(resultFileAddress=runenergysimulation.resultFileAddress)  # -> port, port_2, port_3, opaqueEnergyFlow, port_4, port_5, port_6, port_7, port_8, port_9; plug-in component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
path = FilePath(epw_stat_2.epwFile)
runenergysimulation_2 = Honeybee_RunEnergySimulation(
    epwFile=path,
    HBZones=flatten(setepzoneloads.HBZones),
    HBContext=flatten(hb_epcontextsrf),
    simulationOutputs=flatten(epoutput_2.simulationOutputs),
    writeIdf=run_energyplus,
    runEnergyPlus=run_energyplus,
    idfFileName=rep)  # -> report, idfFileAddress, resultFileAddress; plug-in component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
energybalance = Honeybee_ConstructEnergyBalance(
    HBZones=flatten(setepzoneloads_2.HBZones),
    cooling=readepresult.port_3,
    heating=readepresult.port_4,
    electricLight=readepresult.electricLight,
    electricEquip=readepresult.electricEquip,
    fanElectric=readepresult.port_5,
    peopleGains=readepresult.peopleGains,
    totalSolarGain=readepresult.totalSolarGain,
    infiltrationEnergy=readepresult.infiltrationEnergy,
    mechVentilationEnergy=readepresult.port_7,
    natVentEnergy=readepresult.port_8,
    surfaceEnergyFlow=readepsrfresult.port_3)  # -> readMe, port, flrNormEnergyBal, flrNormBalWStorage, port_2, modelEnergyBalance, energyBalWithStorage; plug-in component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
gradientlibrary = Ladybug_GradientLibrary(gradIndex="19")  # -> customColors; plug-in component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
panel_10 = Panel(runenergysimulation_2.resultFileAddress)
readepresult_2 = Honeybee_ReadEPResult(resultFileAddress=runenergysimulation_2.resultFileAddress)  # -> port, port_2, port_3, port_4, port_5, port_6, port_7, port_8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; plug-in component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
importepw = Ladybug_ImportEpw(epwFile=path)  # -> readMe, latitude, location, dryBulbTemperature, dewPointTemperature, relativeHumidity, windSpeed, windDirection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; plug-in component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
selectandaveragedata = Ladybug_AverageData(annualHourlyData=energybalance.energyBalWithStorage, totalOrAverage=Toggle(True))  # -> readMe, selHourlyData, totaledDaily, totaledMonthly, totMonthlyPerHour, totAnalysisPeriod; plug-in component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
legendpar = Ladybug_LegendParameters(lowBound="-2000", highBound="2000", numSegments="9", customColors=flatten(gradientlibrary))  # -> legendPar; plug-in component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
pt = Point(<point referenced from the Rhino model>)
barchart = Ladybug_MonthlyBarChart(
    inputData=flatten(selectandaveragedata.totaledMonthly),
    stackValues=Toggle(True),
    altTitle="Patient Room Energy Balance",
    altYAxisTitle="Energy (kWh)",
    basePoint=pt,
    xScale=Slider(0.5, range=0..1),
    yScale=Slider(1, range=0..1),
    legendPar=legendpar)  # -> readMe, dataMesh, dataCurves, dataCrvColors, graphAxes, graphLabels, title, titleBasePt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; plug-in component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
adaptivecomfortcalculator = Ladybug_AdaptiveComfortCalculator(
    dryBulbTemperature=readepresult_2.airTemperature,
    meanRadiantTemperature=readepresult_2.meanRadTemperature,
    prevailingOutdoorTemp=importepw.dryBulbTemperature,
    runIt=Toggle(True))  # -> readMe, port, comfortableOrNot, conditionOfPerson, degreesFromTarget, port_2, targetTemperature, upperTemperatureBound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; plug-in component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
comfortable_hot_cold = Panel([adaptivecomfortcalculator.percentOfTimeComfortable, adaptivecomfortcalculator.percentHotCold])
preview_2 = CustomPreview(Geometry=barchart.graphAxes, Shader=ColourSwatch(SwatchColor=RGB(0, 0, 0)))
legendpar_2 = Ladybug_LegendParameters(lowBound="-1", highBound="1", numSegments="3")  # -> legendPar; plug-in component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
vec = VectorXYZ(XComponent="20", YComponent="35", ZComponent=0)  # -> Vector, Length
pt_2 = Point(Point(86.78092579, -6.285322019, 0))
move = Move(Geometry=pt_2, Motion=vec.Vector)  # -> Geometry, Transform
comfortable_hot_cold_2 = Panel([adaptivecomfortcalculator.percentOfTimeComfortable, adaptivecomfortcalculator.percentHotCold])
panel_11 = Panel("""Comfortable (%): 
hot (%):         
cold (%):        """)
psychchart = Ladybug_PsychrometricChart(
    dryBulbTemperature=readepresult_2.airTemperature,
    relativeHumidity=readepresult_2.relativeHumidity,
    basePoint=move.Geometry,
    runIt=Toggle(True))  # -> readMe, port, totalComfortPercent, totalComfortOrNot, strategyNames, strategyPercentOfTime, strategyOrNot, port_2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; plug-in component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
_3dchart = Ladybug_3DChart(
    inputData=flatten(adaptivecomfortcalculator.conditionOfPerson),
    basePoint=pt_2,
    xScale=".025",
    yScale="0.125",
    zScale=Slider(0, range=0..100),
    legendPar=legendpar_2)  # -> readMe, graphMesh, graphCurves, legend, legendBasePts, title, titleBasePts, dataPts, conditionalHOY; plug-in component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
num = Number(comfortable_hot_cold_2)
expression = Expression(x=num, Expression="Round(x, 2)")
flip = FlipMatrix(Data=panel_11)  # -> simplify(Data)
flip_2 = FlipMatrix(Data=expression)  # -> simplify(Data)
panel_12 = Panel([flip, flip_2])
join = TextJoin(Text=panel_12)
join_2 = TextJoin(Text=flatten(join))
pt_3 = Point(Point(-17, 4, 0))
tag = TextTag3D(Location=pt_3, Text=join_2, Size=1, Colour=ColourSwatch(SwatchColor=RGB(0, 0, 0)), Justification=5)
