# Grasshopper definition SHENGJI_TAN.gh (Grasshopper 0.9.76)
# plug-ins: Python Interpreter

number_slider = Slider(0, range=0..2)
number_slider_2 = Slider(0, range=0..2)
ladybug = Ladybug_Ladybug()  # -> Vviiiiiiiiiizzz; plug-in component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
honeybee = Honeybee_Honeybee()  # -> Vviiiiiiiiiizzz; plug-in component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
# Animate sliders
button = Button()
panel = Panel("https://www.energyplus.net/weather-download/north_and_central_america_wmo_region_4/USA/PA/USA_PA_Philadelphia.Intl.AP.724080_TMY3/all")
hours = Panel("""9
12
15""")
months = Panel("""3
6
12""")
# Glass material
panel_2 = Panel("tvis_60")
fly = Ladybug_fly(inputSliders=[number_slider_2, number_slider], fly=button)  # -> Vviiiiiiiiiizzz; plug-in component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
downloadepw = Ladybug_downloadEPWWeatherFile(download=Toggle(True))  # -> readMe; plug-in component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
epw_stat = Ladybug_OpenEPWAndSTATWeatherFiles(weatherFileURL=panel)  # -> epwFile, statFile; plug-in component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
item = ListItem(List=months, Index=number_slider_2, Wrap=True)
item_2 = ListItem(List=hours, Index=number_slider, Wrap=True)
number_slider_3 = Slider(0, range=0..10)
radglassmaterial = Honeybee_RadianceGlassMaterial(materialName=panel_2, RTransmittance="0.6", GTransmittance="0.6", BTransmittance="0.6", refractiveIndex=1.52)  # -> avrgTrans, RADMaterial; plug-in component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
fly_2 = Ladybug_fly(inputSliders=number_slider_3, fly=Button())  # -> Vviiiiiiiiiizzz; plug-in component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
radopaquematerial = Honeybee_RadianceOpaqueMaterial(materialName="shading_0.8", RReflectance="0.8", GReflectance="0.8", BReflectance="0.8", roughness=0.05, specularity=0)  # -> avrgRef, RADMaterial; plug-in component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
panel_3 = Panel("""9
12
15""")
panel_4 = Panel("""3
6
12""")
panel_5 = Panel(number_slider_3)
path = FilePath(epw_stat.epwFile)
# Prepare geometries
brep = Brep([<brep referenced from the Rhino model> x87])
brep_2 = Brep([<brep referenced from the Rhino model> x5])

# ---- group: glass
brep_3 = Brep([<brep referenced from the Rhino model> x2])

# ----
importlocation = Ladybug_ImportLocation(epwFile=path)  # -> location; plug-in component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
rec = DataRecorder(panel_5, DataLimit=-10, RecordData=True)
# Generate sky
genclimatebasedsky = Honeybee_GenerateClimateBasedSky(weatherFile=path, month=item, day="21", hour=item_2)  # -> radiationValues, skyFilePath; plug-in component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
createhbsrfs = Honeybee_createHBSrfs(geometry=brep_2)  # -> readMe, simplify(flatten(HBSurface)); plug-in component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
createhbsrfs_2 = Honeybee_createHBSrfs(geometry=brep_3, RADMaterial=radglassmaterial.RADMaterial)  # -> readMe, simplify(HBSurface); plug-in component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
createhbsrfs_3 = Honeybee_createHBSrfs(geometry=brep, RADMaterial=radopaquematerial.RADMaterial)  # -> readMe, simplify(HBSurface); plug-in component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
doy_hoy = Ladybug_DOY_HOY(days="21", months=item, hours=item_2)  # -> HOY, DOY, date; plug-in component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
sunpath = Ladybug_SunPath(
    location=importlocation,
    hour=panel_3,
    day=21,
    month=panel_4,
    timeStep=1,
    sunPathScale=Slider(0.2, range=0..1),
    dailyOrAnnualSunPath=True)  # -> readMe, sunVectors, sunAltitudes, sunAzimuths, port, sunSpheresMesh, sunPathCrvs, legend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; plug-in component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
panel_6 = Panel(rec)
ln = Line(StartPoint=sunpath.sunPathCenPts, EndPoint=sunpath.sunPositions)
brep_4 = Brep(flatten([createhbsrfs.HBSurface, createhbsrfs_3.HBSurface]))
item_3 = ListItem(List=brep_2, Index=Slider(3, range=0..12), Wrap=True)
preview = CustomPreview(Geometry=createhbsrfs.HBSurface, Shader=ColourSwatch(SwatchColor=RGBA(217, 206, 206, 208)))
preview_2 = CustomPreview(Geometry=createhbsrfs_2.HBSurface, Shader=ColourSwatch(SwatchColor=RGBA(129, 150, 235, 74)))
flip = Flip()  # -> Surface, Result; disabled
wires = BrepWireframe(Brep=brep_4, Density=-1)
gentestpts = Honeybee_GenerateTestPoints(testGeometry=item_3, gridSize=Slider(0.5, range=0..1), distBaseSrf=Slider(0.762, range=0..1), moveTestMesh=True)  # -> readMe, simplify(testPoints), simplify(ptsVectors), simplify(facesArea), simplify(mesh); plug-in component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
# prepare a recipe
gridbasedsimulation = Honeybee_GridBasedSimulation(
    skyFile=genclimatebasedsky.skyFilePath,
    testPoints=gentestpts.testPoints,
    ptsVectors=gentestpts.ptsVectors,
    testMesh=gentestpts.mesh,
    simulationType=0)  # -> analysisRecipe; plug-in component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
toggle = BooleanToggle(True)
# run the analysis
rundaylightanalysis = Honeybee_RunDaylightSimulation(
    HBObjects=flatten(brep_4),
    analysisRecipe=gridbasedsimulation,
    writeRad=toggle,
    runRad=toggle,
    numOfCPUs="3",
    overwriteResults=True)  # -> readMe, analysisType, resultsUnit, illuminance_values, testPts, illuminance_files, radGeoFile, studyFolder, done; plug-in component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
panel_7 = Panel(rundaylightanalysis.illuminance_values)
tag = TextTag3D(
    Location=rundaylightanalysis.testPts,
    Text=rundaylightanalysis.illuminance_values,
    Size=0.1,
    Colour=RGB(255, 255, 255),
    Justification=5)
panel_8 = Panel(doy_hoy.date)
pt = Point(Point(2, 0, 0))
legendpar = Ladybug_LegendParameters(lowBound="200", highBound="2000", numSegments="19", legendLocation=pt, legendScale="0.5", fontSize=".15")  # -> legendPar; plug-in component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
# capture the viewport to an image
join = TextJoin(Text=[item, "21", item_2], Join="_")
# visualize the results
concat = Concatenate(FragmentA=rundaylightanalysis.analysisType, FragmentC=panel_8)
panel_9 = Panel(join)
recolormesh = Ladybug_RecolorMesh(
    analysisResult=rundaylightanalysis.illuminance_values,
    inputMesh=gentestpts.mesh,
    legendPar=legendpar,
    analysisTitle=concat,
    legendTitle=rundaylightanalysis.resultsUnit)  # -> readMe, newMesh, newLegend, legendBasePt, meshColors, legendColors; plug-in component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
captureview = Ladybug_CaptureView(fileName=panel_9, capture=Toggle(True))  # -> imagePath; plug-in component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
panel_10 = Panel(captureview)
