# Grasshopper definition SHENGJI_TAN_1 GLARE.gh (Grasshopper 0.9.76)
# plug-ins: Python Interpreter, embryoA

number_slider = Slider(0, range=0..2)
number_slider_2 = Slider(0, range=0..2)
panel = Panel("https://www.energyplus.net/weather-download/north_and_central_america_wmo_region_4/USA/PA/USA_PA_Philadelphia.Intl.AP.724080_TMY3/all")
hours = Panel("""9
12
15""")
months = Panel("""3
6
12""")
fly = Ladybug_fly(inputSliders=[number_slider, number_slider_2], fly=Button())  # -> Vviiiiiiiiiizzz; plug-in component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
epw_stat = Ladybug_OpenEPWAndSTATWeatherFiles(weatherFileURL=panel)  # -> epwFile, statFile; plug-in component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
number_slider_3 = Slider(0.2, range=0..1)
item = ListItem(List=months, Index=number_slider, Wrap=True)
item_2 = ListItem(List=hours, Index=number_slider_2, Wrap=True)
number_slider_4 = Slider(0.8, range=0..1)
number_slider_5 = Slider(0.25, range=0..1)
ladybug = Ladybug_Ladybug()  # -> Vviiiiiiiiiizzz; plug-in component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
honeybee = Honeybee_Honeybee()  # -> Vviiiiiiiiiizzz; plug-in component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
radopaquematerial = Honeybee_RadianceOpaqueMaterial(materialName="0.5", RReflectance="0.5", GReflectance="0.5", BReflectance="0.5", roughness=0.05, specularity=0)  # -> avrgRef, RADMaterial; plug-in component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
radopaquematerial_2 = Honeybee_RadianceOpaqueMaterial(
    materialName="0.8",
    RReflectance=number_slider_4,
    GReflectance=number_slider_4,
    BReflectance=number_slider_4,
    roughness=0.05,
    specularity=0)  # -> avrgRef, RADMaterial; plug-in component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
radopaquematerial_3 = Honeybee_RadianceOpaqueMaterial(
    materialName="0.2",
    RReflectance=number_slider_3,
    GReflectance=number_slider_3,
    BReflectance=number_slider_3,
    roughness=0.05,
    specularity=0)  # -> avrgRef, RADMaterial; plug-in component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
radopaquematerial_4 = Honeybee_RadianceOpaqueMaterial(materialName="generic_0.6", RReflectance=".6", GReflectance=".6", BReflectance=".6", roughness=0.05, specularity=0)  # -> avrgRef, RADMaterial; plug-in component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
ledge = Brep([<brep referenced from the Rhino model> x11])

# ---- group: glass facade
glass = Brep([<brep referenced from the Rhino model> x2])

# ----
radglassmaterial = Honeybee_RadianceGlassMaterial(materialName="glass_.65", RTransmittance=".65", GTransmittance=".65", BTransmittance=".65", refractiveIndex=1.52)  # -> avrgTrans, RADMaterial; plug-in component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

# ---- group: furniture
furniture = Brep([<brep referenced from the Rhino model> x76])

# ---- group: floor
floor = Brep(<brep referenced from the Rhino model>)

# ---- group: ceiling
ceiling = Brep(<brep referenced from the Rhino model>)

# ----
walls = Brep([<brep referenced from the Rhino model> x3])
panel_2 = Panel(item)
panel_3 = Panel(item_2)
number_slider_6 = Slider(0, range=0..100)
# Geometry Preparation
panel_4 = Panel("0")
# Assign specific materials
createhbsrfs = Honeybee_createHBSrfs(geometry=[ledge, furniture], RADMaterial=radopaquematerial_4.RADMaterial)  # -> readMe, simplify(HBSurface); plug-in component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
createhbsrfs_2 = Honeybee_createHBSrfs(geometry=glass, RADMaterial=radglassmaterial.RADMaterial)  # -> readMe, simplify(HBSurface); plug-in component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
createhbsrfs_3 = Honeybee_createHBSrfs(geometry=floor, srfType="2", RADMaterial=radopaquematerial_3.RADMaterial)  # -> readMe, simplify(HBSurface); plug-in component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
createhbsrfs_4 = Honeybee_createHBSrfs(geometry=ceiling, srfType="3", RADMaterial=radopaquematerial_2.RADMaterial)  # -> readMe, simplify(HBSurface); plug-in component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
# Honeybee default materials will be assigned
# based on surface type
createhbsrfs_5 = Honeybee_createHBSrfs(geometry=walls, srfType=panel_4, RADMaterial=radopaquematerial.RADMaterial)  # -> readMe, simplify(HBSurface); plug-in component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
genavgsky = Honeybee_GenerateAverageSky(north=number_slider_6, weatherFile=epw_stat.epwFile, month=panel_2, hour=panel_3)  # -> radiationValues, skyFilePath; plug-in component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
northarrow = Ladybug_North(north=number_slider_6, scale=".05")  # -> northSign; plug-in component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

# ---- group: For better visualization - Doesn't effect the results of the analysis
importlocation = Ladybug_ImportLocation(epwFile=epw_stat.epwFile)  # -> location; plug-in component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
sunpath = Ladybug_SunPath(
    north=number_slider_6,
    location=importlocation,
    hour=panel_3,
    day="21",
    month=panel_2,
    timeStep=1,
    sunPathScale=Slider(0.2, range=0..1),
    dailyOrAnnualSunPath=True)  # -> readMe, sunVectors, sunAltitudes, sunAzimuths, port, sunSpheresMesh, sunPathCrvs, legend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; plug-in component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

# ----
radparameters = Honeybee_RADParameters(quality=1, ab="3")  # -> readMe, radParameters; plug-in component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
doy_hoy = Ladybug_DOY_HOY(days="21", months=panel_2, hours=panel_3)  # -> HOY, DOY, date; plug-in component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
# Analysis Recipe
set_the_view_to_fisheye_for_glare_analys = Panel("1")  # "set the view to FishEye for Glare Analysis"

# ---- group: collect all honeybee surfaces
brep = Brep(flatten([createhbsrfs_5.HBSurface, createhbsrfs_4.HBSurface, createhbsrfs_3.HBSurface, createhbsrfs_2.HBSurface, createhbsrfs.HBSurface]))

# ----
imagebasedsimulation = Honeybee_ImageBasedSimulation(
    skyFile=genavgsky.skyFilePath,
    cameraType=set_the_view_to_fisheye_for_glare_analys,
    simulationType=2,
    imageWidth=Slider(1200, range=0..10000),
    imageHeight=Slider(1200, range=0..10000),
    radParameters=radparameters.radParameters,
    backupImages=0)  # -> analysisRecipe; plug-in component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
wires = BrepWireframe(Brep=brep, Density=-1)
toggle = BooleanToggle(True)
# Run the analysis
rundaylightanalysis = Honeybee_RunDaylightSimulation(
    HBObjects=flatten(brep),
    analysisRecipe=imagebasedsimulation,
    writeRad=toggle,
    runRad=toggle,
    numOfCPUs="4",
    radFileName=doy_hoy.date,
    overwriteResults=True)  # -> readMe, analysisType, resultsUnit, results, testPts, luminance_files, radGeoFile, studyFolder, done; plug-in component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
panel_5 = Panel("""Radiance
Grasshopper
Honeybee
Glare
Daylight
Set View
HBExampleFiles""")
panel_6 = Panel("""This file shows how to run a glare analysis using Honeybee. This example is using same geometry as the other daylighting examples [[1](http://hydrashare.github.io/hydra/viewer?owner=mostaphaRoudsari&fork=hydra_1&id=Surface_by_surface_geometry_preparation_for_daylight_simulation_II), [2](http://hydrashare.github.io/hydra/viewer?owner=mostaphaRoudsari&fork=hydra_1&id=Find_when_sun_is_visible_to_a_point)].
The example is uses Averaged Climate-based Sky for glare analysis which uses the average value for that hour during the whole month.""")
panel_7 = Panel("C:\Users\Administrator\Dropbox\ladybug\helpDesk\PennDesign2015\Daylight_Glare_Analysis.png")
glareanalysis = Honeybee_GlareAnalysis(HDRImagePath=rundaylightanalysis.luminance_files, runIt=Toggle(True))  # -> readMe, glareCheckImage, DGP, DGI, imageWithTaskArea; plug-in component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
falsecolor = Honeybee_FalseColor(
    HDRFilePath=rundaylightanalysis.luminance_files,
    contourBands=False,
    maskThreshold=0.1,
    useAlterColors=False,
    render=Toggle(False))  # -> outputFilePath; plug-in component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
exporthydra = Hydra_ExportFile(
    fileName="Glare Analysis",
    fileDescription=panel_6,
    fileTags=panel_5,
    targetFolder="C:\Users\Administrator\Documents\GitHub\hydra_1",
    includeRhino=Toggle(True),
    additionalImgs=panel_7,
    export=Toggle(False))  # -> readMe; inputs fileDescription: list, changeLog: list, fileTags: list, includeRhino: Boolean, GHForThumb: Boolean, additionalImgs: list, export: Boolean; plug-in component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
md_slider = MDSlider(
    slider_value=Point(0.5014235334, 0.4980185904, 0.5),
    SliderMode=0,
    x_domain=Domain(-1, 1),
    y_domain=Domain(-1, 1),
    z_domain=Domain(0, 1))
# DGP: Daylight glare probability:
# Imperceptible Glare [0.35 > DGP]
# Perceptible Glare [0.4 > DGP >= 0.35]
# Disturbing Glare [0.45 > DGP >= 0.4]
# Intolerable Glare [DGP >= 0.45]
panel_8 = Panel(glareanalysis.DGP)
hdr_tif = Honeybee_ConvertHDRToTIF(HDRFilePath=falsecolor, adjustExposure=False)  # -> TIFFFilePath; plug-in component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
hdr_tif_2 = Honeybee_ConvertHDRToTIF(HDRFilePath=glareanalysis.glareCheckImage, adjustExposure=Toggle(False))  # -> TIFFFilePath; plug-in component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
number_slider_7 = Slider(0.8, range=0..1)
panel_9 = Panel(hdr_tif_2)
panel_10 = Panel(hdr_tif)
image = ImageFromPath(P=hdr_tif_2, S=number_slider_7)
image_2 = ImageFromPath(P=hdr_tif, S=number_slider_7)

pt = Point(Point(0, 2.945719487, 0))
# set the view
comfortmannequin = Ladybug_ComfortMannequin(rotationAngle="0", bodyLocation=pt)  # -> mannequinMesh, legend, legendBasePt; plug-in component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

# ---- group: Person's face!
item_3 = ListItem(List=comfortmannequin.mannequinMesh, Index=121, Wrap=True)

# ----
preview = CustomPreview(Geometry=item_3, Shader=ColourSwatch(SwatchColor=RGB(255, 0, 0)))

facen = FaceNormals(Mesh=item_3)  # -> Centers, Normals
settheview = Ladybug_SetTheView(cameraLocation=facen.Centers, cameraDirection=facen.Normals, uvLookAround=md_slider)  # -> readMe; plug-in component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
