# Grasshopper definition SHENGJI_TAN_2 POINT IN TIME.gh (Grasshopper 0.9.76)
# plug-ins: Python Interpreter

ladybug = Ladybug_Ladybug()  # -> Vviiiiiiiiiizzz; plug-in component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
honeybee = Honeybee_Honeybee()  # -> Vviiiiiiiiiizzz; plug-in component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
number_slider = Slider(0, range=0..2)
number_slider_2 = Slider(0, range=0..2)
number_slider_3 = Slider(0.2, range=0..1)
number_slider_4 = Slider(0.8, range=0..1)
number_slider_5 = Slider(0.25, range=0..1)
ladybug_2 = Ladybug_Ladybug()  # -> Vviiiiiiiiiizzz; plug-in component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
honeybee_2 = Honeybee_Honeybee()  # -> Vviiiiiiiiiizzz; plug-in component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
# Animate sliders
button = Button()
panel = Panel("https://www.energyplus.net/weather-download/north_and_central_america_wmo_region_4/USA/PA/USA_PA_Philadelphia.Intl.AP.724080_TMY3/all")
hours = Panel("""9
12
15""")
months = Panel("""3
6
12""")
radopaquematerial = Honeybee_RadianceOpaqueMaterial(materialName="0.5", RReflectance="0.5", GReflectance="0.5", BReflectance="0.5", roughness=0.05, specularity=0)  # -> avrgRef, RADMaterial; plug-in component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
radopaquematerial_2 = Honeybee_RadianceOpaqueMaterial(
    materialName="0.8",
    RReflectance=number_slider_4,
    GReflectance=number_slider_4,
    BReflectance=number_slider_4,
    roughness=0.05,
    specularity=0)  # -> avrgRef, RADMaterial; plug-in component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
radopaquematerial_3 = Honeybee_RadianceOpaqueMaterial(
    materialName="0.2",
    RReflectance=number_slider_3,
    GReflectance=number_slider_3,
    BReflectance=number_slider_3,
    roughness=0.05,
    specularity=0)  # -> avrgRef, RADMaterial; plug-in component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
fly = Ladybug_fly(inputSliders=[number_slider, number_slider_2], fly=button)  # -> Vviiiiiiiiiizzz; plug-in component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
downloadepw = Ladybug_downloadEPWWeatherFile(download=Toggle(True))  # -> readMe; plug-in component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
epw_stat = Ladybug_OpenEPWAndSTATWeatherFiles(weatherFileURL=panel)  # -> epwFile, statFile; plug-in component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
radopaquematerial_4 = Honeybee_RadianceOpaqueMaterial(materialName="generic_0.6", RReflectance=".6", GReflectance=".6", BReflectance=".6", roughness=0.05, specularity=0)  # -> avrgRef, RADMaterial; plug-in component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
item = ListItem(List=months, Index=number_slider, Wrap=True)
item_2 = ListItem(List=hours, Index=number_slider_2, Wrap=True)
ledge = Brep([<brep referenced from the Rhino model> x11])
radglassmaterial = Honeybee_RadianceGlassMaterial(materialName="glass_.65", RTransmittance=".65", GTransmittance=".65", BTransmittance=".65", refractiveIndex=1.52)  # -> avrgTrans, RADMaterial; plug-in component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

# ---- group: glass facade
glass = Brep([<brep referenced from the Rhino model> x2])

# ---- group: furniture
furniture = Brep([<brep referenced from the Rhino model> x76])

# ---- group: ceiling
ceiling = Brep(<brep referenced from the Rhino model>)

# ---- group: floor
floor = Brep(<brep referenced from the Rhino model>)

# ----
walls = Brep([<brep referenced from the Rhino model> x3])
panel_2 = Panel("""9
12
15""")
panel_3 = Panel("""3
6
12""")
# Geometry Preparation
panel_4 = Panel("0")
path = FilePath(epw_stat.epwFile)
# Assign specific materials
createhbsrfs = Honeybee_createHBSrfs(geometry=[ledge, furniture], RADMaterial=radopaquematerial_4.RADMaterial)  # -> readMe, simplify(HBSurface); plug-in component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
createhbsrfs_2 = Honeybee_createHBSrfs(geometry=glass, RADMaterial=radglassmaterial.RADMaterial)  # -> readMe, simplify(HBSurface); plug-in component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
createhbsrfs_3 = Honeybee_createHBSrfs(geometry=floor, srfType="2", RADMaterial=radopaquematerial_3.RADMaterial)  # -> readMe, simplify(HBSurface); plug-in component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
createhbsrfs_4 = Honeybee_createHBSrfs(geometry=ceiling, srfType="3", RADMaterial=radopaquematerial_2.RADMaterial)  # -> readMe, simplify(HBSurface); plug-in component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
# Honeybee default materials will be assigned
# based on surface type
createhbsrfs_5 = Honeybee_createHBSrfs(geometry=walls, srfType=panel_4, RADMaterial=radopaquematerial.RADMaterial)  # -> readMe, simplify(HBSurface); plug-in component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
importlocation = Ladybug_ImportLocation(epwFile=path)  # -> location; plug-in component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
# Generate sky
genclimatebasedsky = Honeybee_GenerateClimateBasedSky(weatherFile=path, month=Slider(12, range=0..12), day="21", hour=Slider(12, range=9..15))  # -> radiationValues, skyFilePath; plug-in component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
doy_hoy = Ladybug_DOY_HOY(days="21", months=item, hours=item_2)  # -> HOY, DOY, date; plug-in component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
sunpath = Ladybug_SunPath(
    location=importlocation,
    hour=panel_2,
    day=21,
    month=panel_3,
    timeStep=1,
    sunPathScale=Slider(0.017, range=0..1),
    sunScale=Slider(3, range=0..10),
    dailyOrAnnualSunPath=True)  # -> readMe, sunVectors, sunAltitudes, sunAzimuths, port, sunSpheresMesh, sunPathCrvs, legend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; plug-in component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
ln = Line(StartPoint=sunpath.sunPathCenPts, EndPoint=sunpath.sunPositions)
item_3 = ListItem(List=floor, Index=Slider(5, range=0..12), Wrap=True)
sph = Sphere(Base=flatten(sunpath.sunPositions), Radius=Slider(0.2, range=0..1))

# ---- group: collect all honeybee surfaces
brep = Brep(flatten([createhbsrfs_5.HBSurface, createhbsrfs_4.HBSurface, createhbsrfs_3.HBSurface, createhbsrfs.HBSurface, createhbsrfs_2.HBSurface]))

# ----
flip = Flip()  # -> Surface, Result; disabled
gentestpts = Honeybee_GenerateTestPoints(testGeometry=item_3, gridSize=Slider(0.3, range=0..1), distBaseSrf=Slider(0.762, range=0..1), moveTestMesh=True)  # -> readMe, simplify(testPoints), simplify(ptsVectors), simplify(facesArea), simplify(mesh); plug-in component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
wires = BrepWireframe(Brep=brep, Density=-1)
# prepare a recipe
gridbasedsimulation = Honeybee_GridBasedSimulation(
    skyFile=genclimatebasedsky.skyFilePath,
    testPoints=gentestpts.testPoints,
    ptsVectors=gentestpts.ptsVectors,
    testMesh=gentestpts.mesh,
    simulationType=0)  # -> analysisRecipe; plug-in component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
toggle = BooleanToggle(True)
# run the analysis
rundaylightanalysis = Honeybee_RunDaylightSimulation(
    HBObjects=flatten(brep),
    analysisRecipe=gridbasedsimulation,
    writeRad=toggle,
    runRad=toggle,
    numOfCPUs="3",
    overwriteResults=True)  # -> readMe, analysisType, resultsUnit, illuminance_values, testPts, illuminance_files, radGeoFile, studyFolder, done; plug-in component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
tag = TextTag3D(
    Location=rundaylightanalysis.testPts,
    Text=rundaylightanalysis.illuminance_values,
    Size=0.06,
    Colour=RGB(255, 255, 255),
    Justification=5)
panel_5 = Panel(rundaylightanalysis.illuminance_values)
panel_6 = Panel(doy_hoy.date)
pt = Point(Point(2, 0, 0))
legendpar = Ladybug_LegendParameters(lowBound="300", highBound="2000", numSegments="11", legendLocation=pt, legendScale="0.5", fontSize=".15")  # -> legendPar; plug-in component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
# capture the viewport to an image
join = TextJoin(Text=[item, "21", item_2], Join="_")
# visualize the results
concat = Concatenate(FragmentA=rundaylightanalysis.analysisType, FragmentC=panel_6)
recolormesh = Ladybug_RecolorMesh(legendPar=legendpar, analysisTitle=concat)  # -> readMe, newMesh, newLegend, legendBasePt, meshColors, legendColors; plug-in component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
panel_7 = Panel(join)
captureview = Ladybug_CaptureView(
    fileName=panel_7,
    imageWidth=Slider(2400, range=0..10000),
    imageHeight=Slider(1800, range=0..10000),
    capture=Toggle(True))  # -> imagePath; plug-in component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
recolormesh_2 = Ladybug_RecolorMesh(
    analysisResult=rundaylightanalysis.illuminance_values,
    inputMesh=gentestpts.mesh,
    legendPar=legendpar,
    analysisTitle=concat,
    legendTitle=rundaylightanalysis.resultsUnit)  # -> readMe, newMesh, newLegend, legendBasePt, meshColors, legendColors; plug-in component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
panel_8 = Panel(captureview)
