# Grasshopper definition SHENGJI_TAN_2.gh (Grasshopper 0.9.76)
# plug-ins: Python Interpreter

ladybug = Ladybug_Ladybug()  # -> Vviiiiiiiiiizzz; plug-in component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
honeybee = Honeybee_Honeybee()  # -> Vviiiiiiiiiizzz; plug-in component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
number_slider = Slider(6, range=0..10)
box = DomainBox(Base=PlaneXY(0, 0, 0), X=Slider(3, range=0..10), Y=Slider(6, range=0..10), Z=Slider(3, range=0..10))
glzparamlist = Honeybee_GlazingParametersList(northGlzParam=0, westGlzParam=0, southGlzParam=Slider(0.5, range=0..1), eastGlzParam=0)  # -> glzParamList; plug-in component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
# Create HB Zone
mass2zone = Honeybee_Masses2Zones(zoneMasses=flatten(box), isConditioned=Toggle(False), maxRoofAngle=30, createHBZones=Toggle(True))  # -> readMe, HBZones; plug-in component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
# Add openings
glazingcreator = Honeybee_GlazingBasedOnRatio(HBObjects=mass2zone.HBZones, glzRatio=glzparamlist, windowHeight=Slider(1.2, range=0..10), runIt=Toggle(True))  # -> readMe, HBObjWGLZ; plug-in component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
honeybee_decompose_based_on_type = Honeybee_DecomposeBasedOnType(HBZone=glazingcreator.HBObjWGLZ)  # -> walls, interiorWalls, airWalls, windows, interiorWindows, skylights, roofs, ceilings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; plug-in component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
ladybug_shadingdesigner = Ladybug_ShadingDesigner(glzSrf=flatten(honeybee_decompose_based_on_type.windows), mergeVectors=False)  # -> readMe, shadingSrfs; plug-in component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
honeybee_ep_context_surfaces = HoneybeeEPContextSurfaces()  # -> HBContext; inputs shdSurfaces: list of Brep, justBoundingBox: Boolean
# ---------- honeybee_ep_context_surfaces: Python ----------
"""
prepare shading/context geometries

    Args:
        northVectorOrRotation: A vector that shows North or a number that shows
                               the rotation of the North from the Y axis
        bldgMasses: List of closed Breps as thermal zones.
    Returns:
        report: ...
        thermalZones: Thermal zone's geometries for visualiza
"""

ghenv.Component.Name = 'Honeybee EP context Surfaces'
ghenv.Component.NickName = 'HB_EPContextSrf'
ghenv.Component.Message = 'VER 0.0.60\nAUG_10_2016'
ghenv.Component.IconDisplayMode = ghenv.Component.IconDisplayMode.application
ghenv.Component.Category = "Honeybee"
ghenv.Component.SubCategory = "10 | Energy | Energy"
#compatibleHBVersion = VER 0.0.57\nNOV_01_2015
#compatibleLBVersion = VER 0.0.59\nFEB_01_2015
ghenv.Component.AdditionalHelpFromDocStrings = "2"

import rhinoscriptsyntax as rs
import Rhino as rc
import scriptcontext as sc
import os
import System
import Grasshopper.Kernel as gh
import uuid

tolerance = sc.doc.ModelAbsoluteTolerance
import math


def main(shdSurfaces, EPTransSchedule, meshingSettings, justBoundingBox):
    
    # import the classes
    if sc.sticky.has_key('honeybee_release'):

        try:
            if not sc.sticky['honeybee_release'].isCompatible(ghenv.Component): return -1
            if sc.sticky['honeybee_release'].isInputMissing(ghenv.Component): return -1
        except:
            warning = "You need a newer version of Honeybee to use this compoent." + \
            " Use updateHoneybee component to update userObjects.\n" + \
            "If you have already updated userObjects drag Honeybee_Honeybee component " + \
            "into canvas and try again."
            w = gh.GH_RuntimeMessageLevel.Warning
            ghenv.Component.AddRuntimeMessage(w, warning)
            return -1
        
        # don't customize this part
        hb_EPSrf = sc.sticky["honeybee_EPSurface"]
        hb_EPSHDSurface = sc.sticky["honeybee_EPShdSurface"]
        hb_RADMaterialAUX = sc.sticky["honeybee_RADMaterialAUX"]
        hb_EPObjectsAux = sc.sticky["honeybee_EPObjectsAUX"]()
        HBScheduleList = sc.sticky["honeybee_ScheduleLib"].keys()

        ########################################################################
        #----------------------------------------------------------------------#
        shdBreps = []
        # create bounding box of shading geometries
        if justBoundingBox:
            for brep in shdSurfaces:
                if brep.Faces.Count>1 or not brep.Faces[0].IsPlanar(sc.doc.ModelAbsoluteTolerance):
                    shdBreps.append(brep.GetBoundingBox(True).ToBrep())
                else:
                    shdBreps.append(brep)
        else:
            shdBreps = shdSurfaces
        
        shadingClasses = []
        shadingMeshPreview = []
        
        if meshingSettings == None:
            mp = rc.Geometry.MeshingParameters.Minimal
            mp.SimplePlanes = True
        else:
            mp = meshingSettings
        
        def getRadMaterialName(radMaterial):
            nameStr = radMaterial.split(" ")[2]
            name =  nameStr.split("\n")[0]
            return name
        
        for brepCount, brep in enumerate(shdBreps):
            if brep != None:
                isPlanar = True
                # check planarity
                for face in brep.Faces:
                    if not face.IsPlanar(tolerance):
                        isPlanar = False
                        break
                
                shadingBreps = []
                if not isPlanar:
                    meshArray = rc.Geometry.Mesh.CreateFromBrep(brep, mp)
                    for mesh in meshArray:
                        for meshFace in range(mesh.Faces.Count):
                            vertices = list(mesh.Faces.GetFaceVertices(meshFace))[1:]
                            vertices = vertices + [sc.doc.ModelAbsoluteTolerance]
                            # create the brep from mesh
                            shdBrep = rc.Geometry.Brep.CreateFromCornerPoints(*vertices)
                            shadingBreps.append(shdBrep)
                else:
                    for face in brep.Faces:
                        shadingBreps.append(face.DuplicateFace(False))
                
                for faceCount, shdBrep in enumerate(shadingBreps):
                        thisShading = hb_EPSHDSurface(shdBrep, 1000*brepCount + faceCount, 'shdSrf_' + `brepCount` + '_' + `faceCount` + "_" + str(uuid.uuid4()))
                        
                        # add transmittance schedule if any
                        if EPTransSchedule!=None:
                            schedule= EPTransSchedule.upper()
                            if schedule!=None and not schedule.lower().endswith(".csv") and schedule not in HBScheduleList:
                                msg = "Cannot find " + schedule + " in Honeybee schedule library."
                                print msg
                                ghenv.Component.AddRuntimeMessage(gh.GH_RuntimeMessageLevel.Warning, msg)
                                return -1
                            elif schedule!=None and schedule.lower().endswith(".csv"):
                                # check if csv file is existed
                                if not os.path.isfile(schedule):
                                    msg = "Cannot find the shchedule file: " + schedule
                                    print msg
                                    ghenv.Component.AddRuntimeMessage(gh.GH_RuntimeMessageLevel.Warning, msg)
                                    return -1
                            
                            thisShading.TransmittanceSCH = schedule
                        
                        # add the Rad Material if any
                        if RADMaterial!=None:
                            # if it is just the name of the material make sure it is already defined
                            if len(RADMaterial.split(" ")) == 1:
                                # if the material is not in the library add it to the library
                                if not hb_RADMaterialAUX.isMatrialExistInLibrary(RADMaterial):
                                    warningMsg = "Can't find " + RADMaterial + " in RAD Material Library.\n" + \
                                                "Add the material to the library and try again."
                                    ghenv.Component.AddRuntimeMessage(gh.GH_RuntimeMessageLevel.Warning, warningMsg)
                                    return
                                
                                try:
                                    thisShading.setRADMaterial(RADMaterial)
                                except Exception, e:
                                    print e
                                    warningMsg = "You are using an old version of Honeybee_Honeybee! Update your files and try again."
                                    print warningMsg
                                    ghenv.Component.AddRuntimeMessage(gh.GH_RuntimeMessageLevel.Warning, warningMsg)
                                    return
                                
                                addedToLib = True
                            else:
                                
                                # try to add the material to the library
                                addedToLib, thisShading.RadMaterial = hb_RADMaterialAUX.analyseRadMaterials(RADMaterial, True)
                                
                            if addedToLib==False:
                                warningMsg = "Failed to add " + RADMaterial + " to the Library."
                                ghenv.Component.AddRuntimeMessage(gh.GH_RuntimeMessageLevel.Warning, warningMsg)
                                return
                        
                        # add shading to the list
                        shadingClasses.append(thisShading)
                
        # add to the hive
        hb_hive = sc.sticky["honeybee_Hive"]()
        HBContext  = hb_hive.addToHoneybeeHive(shadingClasses, ghenv.Component.InstanceGuid.ToString())
        return HBContext
        ################################################################################################
    else:
        print "You should first let Honeybee to fly..."
        w = gh.GH_RuntimeMessageLevel.Warning
        ghenv.Component.AddRuntimeMessage(w, "You should first let Honeybee to fly...")
        return -1
        

if _shdSurfaces and _shdSurfaces[0]!=None:
    # add cleaning function
    result= main(_shdSurfaces, EPTransSchedule_, meshingSettings_, justBoundingBox_)
    
    if result != -1: HBContext = result
# ---------- end honeybee_ep_context_surfaces ----------
panel = Panel("https://www.energyplus.net/weather-download/north_and_central_america_wmo_region_4/USA/PA/USA_PA_Philadelphia.Intl.AP.724080_TMY3/all")
wires = BrepWireframe(Brep=glazingcreator.HBObjWGLZ, Density=-1)
downloadepw = Ladybug_downloadEPWWeatherFile(download=Toggle(True))  # -> readMe; plug-in component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
epw_stat = Ladybug_OpenEPWAndSTATWeatherFiles(weatherFileURL=panel)  # -> epwFile, statFile; plug-in component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
toggle = BooleanToggle(True)
path = FilePath("C:\ladybug\Philadelphia_International_Ap_PA_USA\Philadelphia_International_Ap_PA_USA.epw")
makeadiabaticbytype = Honeybee_MakeAdiabaticByType(HBZones=glazingcreator.HBObjWGLZ, roofs=toggle, groundFloors=toggle)  # -> HBZones; plug-in component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
# create a recipe
genhbzonetestpts = Honeybee_GenerateZoneTestPoints(HBZone=makeadiabaticbytype, gridSize=Slider(0.5, range=0..1), distBaseSrf=Slider(0.7, range=0..1), moveTestMesh=True)  # -> readMe, simplify(testPoints), simplify(ptsVectors), simplify(facesArea), simplify(mesh); plug-in component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
gethbzoneepschedules = Honeybee_GetZoneEnergyPlusSchedules(HBZone=makeadiabaticbytype)  # -> occupancySchedule, occupancyActivitySch, heatingSetPtSchedule, coolingSetPtSchedule, lightingSchedule, equipmentSchedule, infiltrationSchedule; plug-in component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
annualdaylightsimulation = Honeybee_AnnualDaylightSimulation(epwWeatherFile=epw_stat.epwFile, testPoints=genhbzonetestpts.testPoints, ptsVectors=genhbzonetestpts.ptsVectors)  # -> analysisRecipe; plug-in component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
toggle_2 = BooleanToggle(True)
convertepschvalues = Honeybee_ConvertEnergyPlusScheduleToValues(schName=gethbzoneepschedules.lightingSchedule)  # -> values; plug-in component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
# run daylight analysis
rundaylightanalysis = Honeybee_RunDaylightSimulation(
    HBObjects=flatten(makeadiabaticbytype),
    analysisRecipe=annualdaylightsimulation,
    writeRad=toggle_2,
    runRad=toggle_2,
    overwriteResults=True)  # -> readMe, analysisType, resultsUnit, results, testPts, annual_analysis_files, radGeoFile, studyFolder, done; plug-in component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
occupancygenerator = Honeybee_DaysimOccupancyGeneratorBasedOnList()  # -> occupancyFile; plug-in component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
panel_2 = Panel(convertepschvalues)
occupancygenerator_2 = Honeybee_DaysimOccupancyGenerator(weekendDays=[1, 2], writeTheOcc=Toggle(True))  # -> occupancyFile; plug-in component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
number_slider_2 = Slider(62, range=0..100)
panel_3 = Panel("""93
63
3""")
pt = Point(Point(150.7237141, -1295.344355, 0))
item = ListItem(List=rundaylightanalysis.testPts, Index=panel_3, Wrap=True)
points = PointList(Points=rundaylightanalysis.testPts)
# calculate UDI
readannualresultsi = Honeybee_ReadAnnualResultI(
    illFilesAddress=rundaylightanalysis.annual_analysis_files,
    testPoints=simplify(rundaylightanalysis.testPts),
    occupancyFiles=occupancygenerator_2,
    DLAIllumThresholds=300,
    runIt=Toggle(True))  # -> DLA, UDLI_Less_100, UDLI_100_2000, UDLI_More_2000, CDA, sDA, annualProfiles, htmReport; plug-in component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
dsannualprofiles = Honeybee_DaysimAnnualProfiles(annualProfiles=readannualresultsi.annualProfiles)  # -> simplify(occupancyProfile), simplify(shadingProfiles), simplify(lightingControlProfiles), simplify(dgpProfile); plug-in component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
_3dchart = Ladybug_3DChart(
    inputData=flatten([dsannualprofiles.lightingControlProfiles, convertepschvalues]),
    basePoint=pt,
    xScale=Slider(0.25, range=0..1))  # -> readMe, graphMesh, graphCurves, legend, legendBasePts, title, titleBasePts, dataPts, conditionalHOY; plug-in component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
readdshourlyresults = Honeybee_ReadDSResultForAPoint(illFilesAddress=rundaylightanalysis.annual_analysis_files, testPoints=rundaylightanalysis.testPts, targetPoint=item)  # -> annualIllumNoDynamicSHD, annualIllumDynamicSHDGroupI, annualIllumDynamicSHDGroupII, iIlluminanceBasedOnOccupancy; plug-in component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
legendpar = Ladybug_LegendParameters(highBound=Slider(500, range=0..1000))  # -> legendPar; plug-in component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
pt_2 = Point(Point(145.6611303, -12.87012321, 0))
panel_4 = Panel(readdshourlyresults.annualIllumNoDynamicSHD)
_3dchart_2 = Ladybug_3DChart(
    inputData=flatten(readdshourlyresults.annualIllumNoDynamicSHD),
    basePoint=pt_2,
    xScale="0.25",
    zScale=Slider(0, range=0..100),
    legendPar=legendpar)  # -> readMe, graphMesh, graphCurves, legend, legendBasePts, title, titleBasePts, dataPts, conditionalHOY; plug-in component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
setepzoneschedules = Honeybee_SetEnergyPlusZoneSchedules(HBZones=makeadiabaticbytype, lightingSchedules=readannualresultsi.annualProfiles)  # -> schedules, simplify(HBZones); plug-in component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
dom = ConstructDomain(DomainStart=0, DomainEnd=Slider(1, range=0..1))
# visualize results
recolormesh = Ladybug_RecolorMesh(analysisResult=readannualresultsi.DLA, inputMesh=genhbzonetestpts.mesh, heightDomain=dom)  # -> readMe, newMesh, newLegend, legendBasePt, meshColors, legendColors; plug-in component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
larger = LargerThan(FirstNumber=readannualresultsi.DLA, SecondNumber=90)  # -> LargerThan, OrEqualTo
not = GateNot(A=larger.LargerThan)
dispatch = Dispatch(List=rundaylightanalysis.testPts, DispatchPattern=larger.LargerThan)  # -> ListA, ListB
pt_3 = Point(dispatch.ListB)
cullf = CullFaces(Mesh=recolormesh.newMesh, Pattern=not)
setepnatvent = Honeybee_SetEPAirFlow(HBZones=setepzoneschedules.HBZones, naturalVentilationType=Slider(1, range=0..1))  # -> readMe, simplify(HBZones); plug-in component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
area = Area(Geometry=cullf)  # -> Area, Centroid
panel_5 = Panel(area.Area)
toggle_3 = BooleanToggle(True)
# set outputs
epoutput = Honeybee_GenerateEPOutput(zoneEnergyUse=toggle_3, zoneGainsAndLosses=toggle_3, zoneComfortMetrics=toggle_3, surfaceTempAnalysis="False")  # -> report, flatten(simulationOutputs); plug-in component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
toggle_4 = BooleanToggle(True)
# run energy analysis
runenergysimulation = Honeybee_RunEnergySimulation(
    epwFile=epw_stat.epwFile,
    HBZones=flatten(setepnatvent.HBZones),
    simulationOutputs=flatten(epoutput.simulationOutputs),
    writeIdf=toggle_4,
    runEnergyPlus=toggle_4)  # -> report, idfFileAddress, resultFileAddress; plug-in component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
importepw = Ladybug_ImportEpw(epwFile=epw_stat.epwFile)  # -> readMe, latitude, location, dryBulbTemperature, dewPointTemperature, relativeHumidity, windSpeed, windDirection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; plug-in component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
readepresult = Honeybee_ReadEPResult(resultFileAddress=runenergysimulation.resultFileAddress)  # -> port, port_2, port_3, port_4, electricLight, electricEquip, fanElectric, port_5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; plug-in component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
# calculate lighting energy
num = Number(readepresult.electricLight)
ma = MassAddition(Input=num)  # -> Result, PartialResults
# calculate annual comfort
adaptivecomfortcalculator = Ladybug_AdaptiveComfortCalculator(
    dryBulbTemperature=readepresult.airTemperature,
    meanRadiantTemperature=readepresult.meanRadTemperature,
    prevailingOutdoorTemp=importepw.dryBulbTemperature,
    runIt=Toggle(True))  # -> readMe, port, comfortableOrNot, conditionOfPerson, degreesFromTarget, port_2, targetTemperature, upperTemperatureBound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; plug-in component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
num_2 = Number(3830.710733)
panel_6 = Panel(num_2)
panel_7 = Panel(ma.Result)
panel_8 = Panel(adaptivecomfortcalculator.readMe)
data = Data(["key:location/dataType/units/frequency/startsAt/endsAt", "Philadelphia International Ap PA USA TMY3 ", "Adaptive Comfort for ZONE_2", "-1 = Cold, 0 = Comfortable, 1 = Hot", "Hourly", "Grasshopper.Kernel.Types.GH_ObjectWrapper"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])
pt_4 = Point(Point(162.5861796, 712.4802012, 0))
_3dchart_3 = Ladybug_3DChart(
    inputData=flatten([adaptivecomfortcalculator.conditionOfPerson, importepw.dryBulbTemperature]),
    basePoint=pt_4,
    xScale="0.25")  # -> readMe, graphMesh, graphCurves, legend, legendBasePts, title, titleBasePts, dataPts, conditionalHOY; plug-in component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
