# Grasshopper definition Shengji_Tan_Final_gh_Dec7th2016.gh (Grasshopper 0.9.76)
# plug-ins: Python Interpreter, embryoA

honeybee = Honeybee_Honeybee()  # -> Vviiiiiiiiiizzz; plug-in component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
ladybug = Ladybug_Ladybug()  # -> Vviiiiiiiiiizzz; plug-in component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
toggle = BooleanToggle(False)

list = ValueList({"Exterior Window [R1.0, SHGC 0.7]": "ASHRAE 90.1-2004 EXTWINDOW CLIMATEZONE ALT-WARE 1-8", "Exterior Window [R1.7, SHGC 0.39]": "ASHRAE 90.1-2004 EXTWINDOW CLIMATEZONE 4-6", "Exterior Window [R1.9, SHGC 0.39]": "ASHRAE 90.1-2004 EXTWINDOW CLIMATEZONE ALT-RES 4-6", "Exterior Window [R0.7, SHGC 0.65]": "Dbl LoE (e3=.1) Clr 3mm/13mm Arg"}, selected="Exterior Window [R1.9, SHGC 0.39]")
list_2 = ValueList({"Exterior Roof [R9.2]": "ASHRAE 90.1-2004 EXTROOF METAL CLIMATEZONE 3-4", "Exterior Roof [R14.8]": "ASHRAE 90.1-2004 EXTROOF IEAD CLIMATEZONE 1-4", "Exterior Roof [R34.4]": "ASHRAE 189.1-2009 EXTROOF IEAD CLIMATEZONE 7-8"}, selected="Exterior Roof [R34.4]")
list_3 = ValueList({"Exterior Wall [R5.5]": "ASHRAE 90.1-2004 EXTWALL METAL CLIMATEZONE 4", "Exterior Wall [R5.8]": "ASHRAE 90.1-2004 EXTWALL MASS CLIMATEZONE 3-4", "Exterior Wall [R7.2]": "ASHRAE 90.1-2004 EXTWALL STEELFRAME CLIMATEZONE 1-4", "Exterior Wall [R8.7]": "ASHRAE 90.1-2004 EXTWALL MASS CLIMATEZONE ALT-RES 4", "Exterior Wall [R10.4]": "ASHRAE 90.1-2004 EXTWALL WOODFRAME CLIMATEZONE 1-7", "Exterior Wall [R14.8]": "ASHRAE 90.1-2004 EXTWALL STEELFRAME CLIMATEZONE ALT-RES 4-6", "Exterior Wall [R34.4]": "ASHRAE 189.1-2009 EXTROOF IEAD CLIMATEZONE 7-8"}, selected="Exterior Wall [R34.4]")

bldgprograms = Honeybee_bldgPrograms({"Office": 0, "Retail": 1, "MidriseApartment": 2, "PrimarySchool": 3, "SecondarySchool": 4, "SmallHotel": 5, "LargeHotel": 6, "Hospital": 7, "Outpatient": 8, "Warehouse": 9, "SuperMarket": 10, "FullServiceRestaurant": 11, "QuickServiceRestaurant": 12}, selected="MidriseApartment")
listzoneprograms = Honeybee_ListZonePrograms(bldgProgram=bldgprograms)  # -> MidriseApartmentZonePrograms; plug-in component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
pt = Point(Point(-2, 0, 0))
box = DomainBox(Base=pt, X=Slider(4, range=1..8), Y=Slider(6, range=1..8), Z=Slider(3, range=1..8))
item = ListItem(List=listzoneprograms, Index="1", Wrap=True)
glzparamlist = Honeybee_GlazingParametersList(northGlzParam=0, westGlzParam=0, southGlzParam=Slider(0.4, range=0..1), eastGlzParam=0)  # -> glzParamList; plug-in component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
mass2zone = Honeybee_Masses2Zones(zoneMasses=flatten(box), zonePrograms=item, isConditioned=Toggle(False), maxRoofAngle=30, createHBZones=Toggle(True))  # -> readMe, HBZones; plug-in component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
glazingcreator = Honeybee_GlazingBasedOnRatio(
    HBObjects=mass2zone.HBZones,
    glzRatio=glzparamlist,
    breakUpWindow=Toggle(True),
    windowHeight=Slider(1.2, range=0.6..1.8),
    sillHeight=Slider(1, range=0.6..1.8),
    runIt=Toggle(True))  # -> readMe, HBObjWGLZ; plug-in component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
# GEOMETRY
makeadiabaticbytype = Honeybee_MakeAdiabaticByType(HBZones=glazingcreator.HBObjWGLZ)  # -> HBZones; plug-in component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
volume = Volume(Geometry=makeadiabaticbytype)  # -> Volume, Centroid
rotatehbobj = Honeybee_RotateHoneybee(HBObj=makeadiabaticbytype, angle=Slider(360, range=0..360), cenPt=volume.Centroid)  # -> HBObj; plug-in component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
wires = BrepWireframe(Brep=rotatehbobj, Density=-1)

number_of_blinds = Slider(10, range=0..20)
shading_depth = Slider(0.1, range=0..2)
add_blinds = BooleanToggle(True)

list_4 = ValueList({"Existing Slab Construction": "0", "+4 Inches Concrete": "1", "+8 Inches Concrete": "2"}, selected="+8 Inches Concrete")

panel = Panel("https://www.energyplus.net/weather-download/north_and_central_america_wmo_region_4/USA/PA/USA_PA_Philadelphia.Intl.AP.724080_TMY3/all")
epw_stat = Ladybug_OpenEPWAndSTATWeatherFiles(weatherFileURL=panel)  # -> epwFile, statFile; plug-in component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

updatehoneybee = Honeybee_UpdateHoneybee(updateThisFile=toggle, updateAllUObjects=toggle)  # -> out; plug-in component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
downloadepw = Ladybug_downloadEPWWeatherFile(download=toggle)  # -> readMe; plug-in component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
updateladybug = Ladybug_UpdateLadybug()  # -> readMe; plug-in component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

number_slider = Slider(0, range=-90..360)
pt_2 = Point(Point(4.995037167, 0.7705608349, 0))
northarrow = Ladybug_North(north=number_slider, centerPt=pt_2, scale=Slider(0.03, range=0..1))  # -> northSign; plug-in component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
preview = CustomPreview(Geometry=northarrow, Shader=ColourSwatch(SwatchColor=RGB(0, 0, 0)))

importepw = Ladybug_ImportEpw(epwFile=epw_stat.epwFile)  # -> readMe, latitude, location, dryBulbTemperature, dewPointTemperature, relativeHumidity, windSpeed, windDirection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; plug-in component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
importlocation = Ladybug_ImportLocation(epwFile=epw_stat.epwFile)  # -> location; plug-in component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

number_slider_2 = Slider(12, range=0..100)
pt_3 = Point(<point referenced from the Rhino model>)
sunpath = Ladybug_SunPath(
    north=number_slider,
    location=importlocation,
    hour=number_slider_2,
    day=Slider(21, range=0..100),
    month=number_slider_2,
    timeStep=1,
    centerPt=pt_3,
    sunPathScale=Slider(0.01, range=0..0.1),
    dailyOrAnnualSunPath=True)  # -> readMe, sunVectors, sunAltitudes, sunAzimuths, port, sunSpheresMesh, sunPathCrvs, legend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; plug-in component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
brep = Brep([<brep referenced from the Rhino model> x24])
wires_2 = BrepWireframe(Brep=brep, Density=-1)
ln = Line(StartPoint=sunpath.sunPathCenPts, EndPoint=sunpath.sunPositions)

range = Range(Domain=Domain(0, 1), Steps=10)
analysisperiod = Ladybug_AnalysisPeriod()  # -> readMe, analysisPeriod; plug-in component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
gradient = Gradient(LowerLimit=0, UpperLimit=1, Parameter=range, stops=[0: RGB(255, 255, 255), 1: RGB(0, 0, 0)])
toggle_2 = BooleanToggle(False)
solaradjusttemperature = Ladybug_OutdoorSolarTemperatureAdjustor(
    location=importepw.location,
    cumSkyMtxOrDirNormRad=importepw.directNormalRadiation,
    diffuseHorizRad=importepw.diffuseHorizontalRadiation,
    baseTemperature=importepw.dryBulbTemperature,
    horizInfraredRad=importepw.horizontalInfraredRadiation,
    analysisPeriodOrHOY=analysisperiod.analysisPeriod,
    parallel=toggle_2,
    runIt=toggle_2)  # -> readMe, port, effectiveRadiantField, MRTDelta, solarAdjustedMRT, port_2, mannequinMesh, port_3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; plug-in component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
legendpar = Ladybug_LegendParameters(
    lowBound=Slider(0, range=0..100),
    highBound=Slider(10, range=0..10),
    customColors=flatten(gradient),
    legendScale=Slider(0.5, range=0..1),
    fontSize=Slider(3, range=0..10))  # -> legendPar; plug-in component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
number_slider_3 = Slider(0.2, range=0..1)
number_slider_4 = Slider(1.2, range=0..10)
series = Series(Start=0, Step=1, Count=Slider(24, range=0..100))
series_2 = Series(Start=Slider(1, range=0..1), Step=1, Count=Slider(12, range=0..100))
outdoorcomfortcalculator = Ladybug_OutdoorComfortCalculator(
    dryBulbTemperature=importepw.dryBulbTemperature,
    windSpeed_tenMeters=importepw.windSpeed,
    relativeHumidity=importepw.relativeHumidity,
    runIt=Toggle(False))  # -> readMe, port, universalThermalClimateIndex, comfortableOrNot, thermalStress, conditionOfPerson, port_2, percentOfTimeComfortable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; plug-in component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
pt_4 = Point(Point(-265, -157, 0))
gradientlibrary = Ladybug_GradientLibrary(gradIndex=Slider(13, range=0..100))  # -> customColors; plug-in component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
panel_2 = Panel(gradientlibrary)
legendpar_2 = Ladybug_LegendParameters(
    lowBound="-3",
    highBound="3",
    numSegments=Slider(7, range=0..10),
    customColors=flatten(gradientlibrary),
    legendScale=Slider(0.5, range=0..1),
    fontSize=Slider(3, range=0..10))  # -> legendPar; plug-in component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
vec = VectorXYZ(XComponent=0, YComponent=Slider(-150, range=-150..1000), ZComponent=0)  # -> Vector, Length
series_3 = Series(Start=Slider(1, range=0..1), Step=1, Count=Slider(24, range=0..100))
panel_3 = Panel("""6
9
12""")
move = Move(Geometry=pt_4, Motion=vec.Vector)  # -> Geometry, Transform
sunpath_2 = Ladybug_SunPath(
    north=number_slider,
    location=importlocation,
    hour=series_3,
    day=21,
    month=panel_3,
    timeStep=1,
    centerPt=move.Geometry,
    sunPathScale=number_slider_3,
    sunScale=number_slider_4,
    annualHourlyData=flatten(outdoorcomfortcalculator.conditionOfPerson),
    legendPar=legendpar_2,
    dailyOrAnnualSunPath=True)  # -> readMe, sunVectors, sunAltitudes, sunAzimuths, port, sunSpheresMesh, sunPathCrvs, legend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; plug-in component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

panel_4 = Panel(rotatehbobj)

panel_5 = Panel("""WindowMaterial:Glazing,
    LoE CLEAR 3MM Rev,       !- Name
    SpectralAverage,         !- Optical Data Type
    ,                        !- Window Glass Spectral Data Set Name
    0.003,                   !- Thickness {m}
    0.630,                   !- Solar Transmittance at Normal Incidence
    0.220,                   !- Front Side Solar Reflectance at Normal Incidence
    0.190,                   !- Back Side Solar Reflectance at Normal Incidence
    0.850,                   !- Visible Transmittance at Normal Incidence
    0.079,                   !- Front Side Visible Reflectance at Normal Incidence
    0.056,                   !- Back Side Visible Reflectance at Normal Incidence
    0.0,                     !- Infrared Transmittance at Normal Incidence
    0.10,                    !- Front Side Infrared Hemispherical Emissivity
    0.84,                    !- Back Side Infrared Hemispherical Emissivity
    0.9;                     !- Conductivity {W/m-K}""")
panel_6 = Panel("""Construction,
    Dbl LoE (e3=.1) Clr 3mm/13mm Arg,  !- Name
    CLEAR 3MM,               !- Outside Layer
    ARGON 13MM,              !- Layer 2
    LoE CLEAR 3MM Rev;       !- Layer 3""")
panel_7 = Panel("""WindowMaterial:Gas,
    ARGON 13MM,               !- Name
    Argon,                   !- Gas Type
    0.0127;                  !- Thickness {m}""")
toggle_3 = BooleanToggle(True)
addtoeplibrary = Honeybee_AddToEnergyPlusLibrary(EPObject=[panel_6, panel_7, panel_5], addToProjectLib=toggle_3, overwrite=toggle_3)  # -> readMe; plug-in component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

cluster = Cluster(
    north=number_slider,
    location=importlocation,
    hour=series,
    month=series_2,
    centerpt=pt_4,
    sunpathscale=number_slider_3,
    sunscale=number_slider_4,
    annualhourlydata=importepw.totalSkyCover,
    conditionalstatement="a < 6",
    legendpar=legendpar,
    dailyorannualsunpath=Toggle(False))

number_slider_5 = Slider(8, range=0..10)
number_slider_6 = Slider(0, range=0..100)
annualschedule = Honeybee_AnnualSchedule(
    sun=number_slider_6,
    mon=number_slider_5,
    tue=number_slider_5,
    wed=number_slider_5,
    thu=number_slider_5,
    fri=number_slider_5,
    sat=number_slider_6,
    scheduleName="SOHO",
    schedTypeLimits=Slider(1, range=0..100),
    generateValues=Toggle(True))  # -> readMe, port, schedule, holidays, port_2, weekSchedule, schedIDFText, scheduleValues; plug-in component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
csvschedule = Honeybee_CreateCSVSchedule(analysisPeriod=annualschedule.scheduleValues)  # -> readMe, csvSchedule; plug-in component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

number_slider_7 = Slider(12, range=0..100)
number_slider_8 = Slider(3, range=0..10)

series_4 = Series(Start=1, Step=0, Count=10)
series_5 = Series(Start=0, Step=0, Count=6)
series_6 = Series(Start=1, Step=0, Count=8)
series_7 = Series(Start=1, Step=0, Count=24)
series_8 = Series(Start=1, Step=0, Count=24)
merge = Merge(Data1=series_4, Data2=series_5, Data3=series_6)
dup = DuplicateData(Data=series_7, Number=2, Order=True)
dup_2 = DuplicateData(Data=merge, Number=5, Order=True)
merge_2 = Merge(Data1=dup_2, Data2=dup)
dup_3 = DuplicateData(Data=merge_2, Number=52, Order=True)
# SCHEDULE
panel_8 = Panel(merge_2)
merge_3 = Merge(Data1=flatten(dup_3), Data2=flatten(series_8))
merge_4 = Merge(Data1=flatten(dup_3), Data2=flatten(series_8))
csvschedule_2 = Honeybee_CreateCSVSchedule(values=merge_3, scheduleName="My_schedule", writeFile=Toggle(True))  # -> readMe, csvSchedule; plug-in component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
panel_9 = Panel(csvschedule_2.csvSchedule)

# ----
# HUMIDIY & TEMPERATURE
# UTCI
# OUTDOOR COMFORT
importepw_2 = Ladybug_ImportEpw(epwFile=epw_stat.epwFile)  # -> readMe, latitude, location, dryBulbTemperature, dewPointTemperature, relativeHumidity, windSpeed, windDirection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; plug-in component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
gradientlibrary_2 = Ladybug_GradientLibrary(gradIndex=Slider(8, range=0..10))  # -> customColors; plug-in component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
pt_5 = Point(Point(288, 27, 0))

# ----
# Psychrometric Chart
# Comfortable Hours
importepw_3 = Ladybug_ImportEpw(epwFile=epw_stat.epwFile)  # -> readMe, latitude, location, dryBulbTemperature, dewPointTemperature, relativeHumidity, windSpeed, windDirection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; plug-in component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
pmvcomfortpar = Ladybug_PMVComfortParameters(humidRatioUpBound="0.012")  # -> comfortPar; plug-in component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
pt_6 = Point(<point referenced from the Rhino model>)
panel_10 = Panel("""0.6
1""")
psychchart = Ladybug_PsychrometricChart(
    dryBulbTemperature=importepw_3.dryBulbTemperature,
    relativeHumidity=importepw_3.relativeHumidity,
    barometricPressure=importepw_3.barometricPressure,
    clothingLevel=panel_10,
    mergeComfPolygons=Toggle(False),
    basePoint=pt_6,
    runIt=Toggle(False))  # -> readMe, port, totalComfortPercent, totalComfortOrNot, strategyNames, strategyPercentOfTime, strategyOrNot, port_2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; plug-in component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
panel_11 = Panel(psychchart.totalComfortPercent)
panel_12 = Panel(psychchart.readMe)
preview_2 = CustomPreview(
    Geometry=[psychchart.chartCurvesAndTxt, psychchart.comfortPolygons, psychchart.strategyPolygons],
    Shader=ColourSwatch(SwatchColor=RGB(0, 0, 0)))
pt_7 = Point(<point referenced from the Rhino model>)

day_month_hour_calculator = Ladybug_Day_Month_Hour(HOY=sunpath_2.sunPositionsHOY)  # -> day, month, hour, date; plug-in component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
Z = UnitZ(Factor="5")
move_2 = Move(Geometry=sunpath_2.sunPositions, Motion=Z)  # -> Geometry, Transform
getepschedules = Honeybee_GetEnergyPlusSchedules(zoneProgram=item)  # -> occupancySchedule, occupancyActivitySch, heatingSetPtSchedule, coolingSetPtSchedule, lightingSchedule, equipmentSchedule, infiltrationSchedule; plug-in component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
tag = TextTag(Location=move_2.Geometry, Text=day_month_hour_calculator.date)
getepschedules_2 = Honeybee_GetEnergyPlusSchedules(zoneProgram=item)  # -> occupancySchedule, occupancyActivitySch, heatingSetPtSchedule, coolingSetPtSchedule, lightingSchedule, equipmentSchedule, infiltrationSchedule; plug-in component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
convertepschvalues = Honeybee_ConvertEnergyPlusScheduleToValues(schName=getepschedules.occupancySchedule)  # -> values; plug-in component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

panel_13 = Panel("完全不考虑日照情况下的舒适")
outdoorcomfortcalculator_2 = Ladybug_OutdoorComfortCalculator(
    dryBulbTemperature=importepw_2.dryBulbTemperature,
    windSpeed_tenMeters=importepw_2.windSpeed,
    relativeHumidity=importepw_2.relativeHumidity,
    runIt=Toggle(False))  # -> readMe, port, universalThermalClimateIndex, comfortableOrNot, thermalStress, conditionOfPerson, port_2, percentOfTimeComfortable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; plug-in component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
panel_14 = Panel("""{255,0,0}
{255,255,255}
{0,0,255}""")
legendpar_3 = Ladybug_LegendParameters(highBound=3, numSegments=7, customColors=reverse(flatten(panel_14)))  # -> legendPar; plug-in component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

gradientlibrary_3 = Ladybug_GradientLibrary(gradIndex="1")  # -> customColors; plug-in component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
gradientlibrary_4 = Ladybug_GradientLibrary(gradIndex="6")  # -> customColors; plug-in component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
panel_15 = Panel("""0
-15""")
entwine = Entwine(Branch00=gradientlibrary_3, Branch01=gradientlibrary_4, FlattenInputs=True)
graft = GraftTree(Tree=panel_15, IncludeEmptyLists=True, IncludeNullItems=True)
legendpar_4 = Ladybug_LegendParameters(lowBound=graft)  # -> legendPar; plug-in component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
_3dchart = Ladybug_3DChart(
    inputData=flatten([importepw_2.relativeHumidity, importepw_2.dryBulbTemperature]),
    basePoint=pt_5,
    xScale=Slider(0.03, range=0..0.1),
    yScale=Slider(0.15, range=0..1),
    zScale=Slider(0, range=0..100),
    legendPar=legendpar_4)  # -> readMe, graphMesh, graphCurves, legend, legendBasePts, title, titleBasePts, dataPts, conditionalHOY; plug-in component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

analysisperiod_2 = Ladybug_AnalysisPeriod()  # -> readMe, analysisPeriod; plug-in component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
toggle_4 = BooleanToggle(False)
solaradjusttemperature_2 = Ladybug_OutdoorSolarTemperatureAdjustor(
    location=importepw_2.location,
    cumSkyMtxOrDirNormRad=importepw_2.directNormalRadiation,
    diffuseHorizRad=importepw_2.diffuseHorizontalRadiation,
    baseTemperature=importepw_2.dryBulbTemperature,
    horizInfraredRad=importepw_2.horizontalInfraredRadiation,
    analysisPeriodOrHOY=analysisperiod_2.analysisPeriod,
    parallel=toggle_4,
    runIt=toggle_4)  # -> readMe, port, effectiveRadiantField, MRTDelta, solarAdjustedMRT, port_2, mannequinMesh, port_3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; plug-in component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
outdoorcomfortcalculator_3 = Ladybug_OutdoorComfortCalculator(
    dryBulbTemperature=importepw_2.dryBulbTemperature,
    meanRadiantTemperature=solaradjusttemperature_2.solarAdjustedMRT,
    windSpeed_tenMeters=importepw_2.windSpeed,
    relativeHumidity=importepw_2.relativeHumidity,
    runIt=Toggle(False))  # -> readMe, port, universalThermalClimateIndex, comfortableOrNot, thermalStress, conditionOfPerson, port_2, percentOfTimeComfortable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; plug-in component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
panel_16 = Panel("考虑日照情况下的舒适")

importepw_4 = Ladybug_ImportEpw(epwFile=epw_stat.epwFile)  # -> readMe, latitude, location, dryBulbTemperature, dewPointTemperature, relativeHumidity, windSpeed, windDirection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; plug-in component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
legendpar_5 = Ladybug_LegendParameters(
    lowBound="0",
    highBound="12",
    numSegments="7",
    customColors=flatten([ColourSwatch(SwatchColor=RGB(235, 247, 255)), ColourSwatch(SwatchColor=RGB(3, 58, 94))]),
    legendScale=Slider(0.3, range=0..1))  # -> legendPar; plug-in component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
toggle_5 = BooleanToggle(False)
number_slider_9 = Slider(14, range=0..100)
pt_8 = Point(Point(-635, -52, 0))
windrose = Ladybug_WindRose(
    north=0,
    hourlyWindDirection=importepw_4.windDirection,
    hourlyWindSpeed=importepw_4.windSpeed,
    centerPoint=pt_8,
    maxFrequency=number_slider_9,
    scale=Slider(0.2, range=0..1),
    legendPar=legendpar_5,
    runIt=toggle_5)  # -> readMe, calmRoseMesh, windRoseMesh, windRoseCrvs, windRoseCenPts, legend, legendBasePts, title; plug-in component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
number_slider_10 = Slider(0.2, range=0..1)

strnum = Ladybug_SeparateData(inputList=flatten(convertepschvalues))  # -> numbers, strings; plug-in component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
larger = LargerThan(FirstNumber=strnum.numbers, SecondNumber="0.7")  # -> LargerThan, OrEqualTo

_3dchart_2 = Ladybug_3DChart(inputData=flatten(psychchart.totalComfortOrNot), basePoint=pt_7, xScale="0.03", yScale="0.15", zScale="0")  # -> readMe, graphMesh, graphCurves, legend, legendBasePts, titleText, titleBasePts, conditionalHOY; plug-in component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
preview_3 = CustomPreview(Geometry=[_3dchart_2.graphCurves, _3dchart_2.legend], Shader=ColourSwatch(SwatchColor=RGB(0, 0, 0)))

pt_9 = Point(Point(288, -213, 0))
_3dchart_3 = Ladybug_3DChart(
    inputData=flatten([outdoorcomfortcalculator_2.conditionOfPerson, outdoorcomfortcalculator_3.conditionOfPerson]),
    basePoint=pt_9,
    xScale=Slider(0.03, range=0..0.1),
    yScale=Slider(0.15, range=0..1),
    zScale=Slider(0, range=0..1),
    legendPar=legendpar_3)  # -> readMe, graphMesh, graphCurves, legend, legendBasePts, title, titleBasePts, dataPts, conditionalHOY; plug-in component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

analysisperiod_3 = Ladybug_AnalysisPeriod(fromMonth="1", toMonth="3")  # -> readMe, analysisPeriod; plug-in component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
pt_10 = Point(Point(-704, -166, 0))
windrose_2 = Ladybug_WindRose(
    north=0,
    hourlyWindDirection=importepw_4.windDirection,
    hourlyWindSpeed=importepw_4.windSpeed,
    analysisPeriod=analysisperiod_3.analysisPeriod,
    centerPoint=pt_10,
    maxFrequency=number_slider_9,
    scale="0.2",
    legendPar=legendpar_5,
    runIt=toggle_5)  # -> readMe, calmRoseMesh, windRoseMesh, windRoseCrvs, windRoseCenPts, legend, legendBasePts, title; plug-in component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

analysisperiod_4 = Ladybug_AnalysisPeriod(fromMonth="4", toMonth="6")  # -> readMe, analysisPeriod; plug-in component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
pt_11 = Point(Point(-571, -166, 0))
windrose_3 = Ladybug_WindRose(
    north=0,
    hourlyWindDirection=importepw_4.windDirection,
    hourlyWindSpeed=importepw_4.windSpeed,
    analysisPeriod=analysisperiod_4.analysisPeriod,
    centerPoint=pt_11,
    maxFrequency=number_slider_9,
    scale="0.2",
    legendPar=legendpar_5,
    runIt=toggle_5)  # -> readMe, calmRoseMesh, windRoseMesh, windRoseCrvs, windRoseCenPts, legend, legendBasePts, title; plug-in component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

analysisperiod_5 = Ladybug_AnalysisPeriod(fromMonth="7", toMonth="9")  # -> readMe, analysisPeriod; plug-in component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
pt_12 = Point(Point(-571, -270, 0))
windrose_4 = Ladybug_WindRose(
    north=0,
    hourlyWindDirection=importepw_4.windDirection,
    hourlyWindSpeed=importepw_4.windSpeed,
    analysisPeriod=analysisperiod_5.analysisPeriod,
    centerPoint=pt_12,
    maxFrequency=number_slider_9,
    scale="0.2",
    legendPar=legendpar_5,
    runIt=toggle_5)  # -> readMe, calmRoseMesh, windRoseMesh, windRoseCrvs, windRoseCenPts, legend, legendBasePts, title; plug-in component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

analysisperiod_6 = Ladybug_AnalysisPeriod(fromMonth="10", toMonth="12")  # -> readMe, analysisPeriod; plug-in component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
pt_13 = Point(Point(-704, -270, 0))
windrose_5 = Ladybug_WindRose(
    north=0,
    hourlyWindDirection=importepw_4.windDirection,
    hourlyWindSpeed=importepw_4.windSpeed,
    analysisPeriod=analysisperiod_6.analysisPeriod,
    centerPoint=pt_13,
    maxFrequency=number_slider_9,
    scale="0.2",
    legendPar=legendpar_5,
    runIt=toggle_5)  # -> readMe, calmRoseMesh, windRoseMesh, windRoseCrvs, windRoseCenPts, legend, legendBasePts, title; plug-in component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

legendpar_6 = Ladybug_LegendParameters(lowBound=Slider(0, range=0..100), highBound=Slider(500, range=0..1000), numSegments=Slider(11, range=0..100))  # -> legendPar; plug-in component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

gradientlibrary_5 = Ladybug_GradientLibrary(gradIndex=Slider(9, range=0..10))  # -> customColors; plug-in component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
pt_14 = Point(Point(288, -93, 0))
legendpar_7 = Ladybug_LegendParameters(lowBound="-13", highBound="32", customColors=flatten(gradientlibrary_5))  # -> legendPar; plug-in component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
_3dchart_4 = Ladybug_3DChart(
    inputData=flatten([outdoorcomfortcalculator_2.universalThermalClimateIndex, outdoorcomfortcalculator_3.universalThermalClimateIndex]),
    basePoint=pt_14,
    xScale=Slider(0.03, range=0..0.1),
    yScale=Slider(0.15, range=0..1),
    zScale=Slider(0, range=0..100),
    legendPar=legendpar_7)  # -> readMe, graphMesh, graphCurves, legend, legendBasePts, title, titleBasePts, dataPts, conditionalHOY; plug-in component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

# ----
# CONSTRUCTION
panel_17 = Panel("floor")

callfromepconstrlibrary = Honeybee_CallFromEPConstructionLibrary(keywords=panel_17)  # -> ThermMaterials, EPMaterials, EPWindowMaterials, EPConstructions; plug-in component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
callfromepconstrlibrary_2 = Honeybee_CallFromEPConstructionLibrary(keywords="slab")  # -> ThermMaterials, EPMaterials, EPWindowMaterials, EPConstructions; plug-in component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
panel_18 = Panel("""MAT-CC05 4 HW CONCRETE
MAT-CC05 8 HW CONCRETE""")
item_2 = ListItem(List=panel_18, Index=0, Wrap=True)  # -> Item, Item1

item_3 = ListItem(List=callfromepconstrlibrary.EPConstructions, Index=Slider(0, range=0..100), Wrap=True)

item_4 = ListItem(List=callfromepconstrlibrary_2.EPConstructions, Index="2", Wrap=True)

decomposeepconstruction = Honeybee_DecomposeEPConstruction(cnstrName=item_3)  # -> materials, comments, UValue_SI, UValue_IP, RValue_SI, RValue_IP; plug-in component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
decomposeepconstruction_2 = Honeybee_DecomposeEPConstruction(cnstrName=item_4)  # -> materials, comments, UValue_SI, UValue_IP, RValue_SI, RValue_IP; plug-in component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
panel_19 = Panel(decomposeepconstruction.materials)
item_5 = ListItem(List=decomposeepconstruction.materials, Index=0, Wrap=True)  # -> Item, Item1
panel_20 = Panel(item_3)
epconstruction = Honeybee_EnergyPlusConstruction(name="floor_cnstr_1", layer_1=item_5.Item, layer_2=item_5.Item1, layer_3=item_2.Item)  # -> EPConstruction; plug-in component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
epconstruction_2 = Honeybee_EnergyPlusConstruction(name="floor_cnstr_2", layer_1=item_5.Item, layer_2=item_5.Item1, layer_3=item_2.Item1)  # -> EPConstruction; plug-in component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

filter = StreamFilter(Gate=list_4, Stream0=panel_20, Stream1=epconstruction, Stream2=epconstruction_2)

setepzonecnstr = Honeybee_SetEPZoneConstruction(HBZones=rotatehbobj, wallEPConstruction=list_3, windowEPConstruction=list, roofEPConstruction=list_2)  # -> simplify(modifiedHBZones); plug-in component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
setepzoneundergroundcnstr = Honeybee_SetEPZoneUndergroundConstruction(HBZones=setepzonecnstr, groundFloorEPConstruction=filter)  # -> simplify(modifiedHBZones); plug-in component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

# ----
# BLINDS
decomposebytype = Honeybee_DecomposeBasedOnType(HBZone=setepzoneundergroundcnstr)  # -> walls, interiorWalls, airWalls, windows, interiorWindows, skylights, roofs, ceilings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; plug-in component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
# SUN PATH
number_slider_11 = Slider(0.8, range=0..1)
shddesigner = Ladybug_ShadingDesigner(
    glzSrf=flatten(decomposebytype.windows),
    depthOrVector=flatten(shading_depth),
    numOfShds=number_of_blinds,
    runIt=add_blinds,
    port_4=False,
    shdAngle=Slider(0, range=0..90))  # -> readMe, shadingSrfs; plug-in component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
radopaquematerial = Honeybee_RadianceOpaqueMaterial(
    materialName="blinds",
    RReflectance=number_slider_11,
    GReflectance=number_slider_11,
    BReflectance=number_slider_11,
    roughness=0.05,
    specularity=0)  # -> avrgRef, RADMaterial; plug-in component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
hb_epcontextsrf = HoneybeeEPContextSurfaces(shdSurfaces=flatten(shddesigner.shadingSrfs), RADMaterial=radopaquematerial.RADMaterial)  # -> HBContext; inputs shdSurfaces: list of Brep, justBoundingBox: Boolean
# ---------- hb_epcontextsrf: Python ----------
"""
prepare shading/context geometries

    Args:
        northVectorOrRotation: A vector that shows North or a number that shows
                               the rotation of the North from the Y axis
        bldgMasses: List of closed Breps as thermal zones.
    Returns:
        report: ...
        thermalZones: Thermal zone's geometries for visualiza
"""

ghenv.Component.Name = 'Honeybee EP context Surfaces'
ghenv.Component.NickName = 'HB_EPContextSrf'
ghenv.Component.Message = 'VER 0.0.60\nNOV_04_2016'
ghenv.Component.IconDisplayMode = ghenv.Component.IconDisplayMode.application
ghenv.Component.Category = "Honeybee"
ghenv.Component.SubCategory = "10 | Energy | Energy"
#compatibleHBVersion = VER 0.0.57\nNOV_04_2016
#compatibleLBVersion = VER 0.0.59\nFEB_01_2015
ghenv.Component.AdditionalHelpFromDocStrings = "2"

import rhinoscriptsyntax as rs
import Rhino as rc
import scriptcontext as sc
import os
import System
import Grasshopper.Kernel as gh
import uuid

tolerance = sc.doc.ModelAbsoluteTolerance
import math


def main(shdSurfaces, EPTransSchedule, meshingSettings, justBoundingBox):
    
    # import the classes
    if sc.sticky.has_key('honeybee_release'):

        try:
            if not sc.sticky['honeybee_release'].isCompatible(ghenv.Component): return -1
            if sc.sticky['honeybee_release'].isInputMissing(ghenv.Component): return -1
        except:
            warning = "You need a newer version of Honeybee to use this compoent." + \
            " Use updateHoneybee component to update userObjects.\n" + \
            "If you have already updated userObjects drag Honeybee_Honeybee component " + \
            "into canvas and try again."
            w = gh.GH_RuntimeMessageLevel.Warning
            ghenv.Component.AddRuntimeMessage(w, warning)
            return -1
        
        # don't customize this part
        hb_EPSrf = sc.sticky["honeybee_EPSurface"]
        hb_EPSHDSurface = sc.sticky["honeybee_EPShdSurface"]
        hb_RADMaterialAUX = sc.sticky["honeybee_RADMaterialAUX"]
        hb_EPObjectsAux = sc.sticky["honeybee_EPObjectsAUX"]()
        HBScheduleList = sc.sticky["honeybee_ScheduleLib"].keys()

        ########################################################################
        #----------------------------------------------------------------------#
        shdBreps = []
        # create bounding box of shading geometries
        if justBoundingBox:
            for brep in shdSurfaces:
                if brep.Faces.Count>1 or not brep.Faces[0].IsPlanar(sc.doc.ModelAbsoluteTolerance):
                    shdBreps.append(brep.GetBoundingBox(True).ToBrep())
                else:
                    shdBreps.append(brep)
        else:
            shdBreps = shdSurfaces
        
        shadingClasses = []
        shadingMeshPreview = []
        
        if meshingSettings == None:
            mp = rc.Geometry.MeshingParameters.Minimal
            mp.SimplePlanes = True
        else:
            mp = meshingSettings
        
        def getRadMaterialName(radMaterial):
            nameStr = radMaterial.split(" ")[2]
            name =  nameStr.split("\n")[0]
            return name
        
        for brepCount, brep in enumerate(shdBreps):
            if brep != None:
                isPlanar = True
                # check planarity
                for face in brep.Faces:
                    if not face.IsPlanar(tolerance):
                        isPlanar = False
                        break
                
                shadingBreps = []
                if not isPlanar:
                    meshArray = rc.Geometry.Mesh.CreateFromBrep(brep, mp)
                    for mesh in meshArray:
                        for meshFace in range(mesh.Faces.Count):
                            vertices = list(mesh.Faces.GetFaceVertices(meshFace))[1:]
                            vertices = vertices + [sc.doc.ModelAbsoluteTolerance]
                            # create the brep from mesh
                            shdBrep = rc.Geometry.Brep.CreateFromCornerPoints(*vertices)
                            shadingBreps.append(shdBrep)
                else:
                    for face in brep.Faces:
                        shadingBreps.append(face.DuplicateFace(False))
                
                for faceCount, shdBrep in enumerate(shadingBreps):
                        thisShading = hb_EPSHDSurface(shdBrep, 1000*brepCount + faceCount, 'shdSrf_' + `brepCount` + '_' + `faceCount` + "_" + str(uuid.uuid4()))
                        
                        # add transmittance schedule if any
                        if EPTransSchedule!=None:
                            schedule= EPTransSchedule.upper()
                            if schedule!=None and not schedule.lower().endswith(".csv") and schedule not in HBScheduleList:
                                msg = "Cannot find " + schedule + " in Honeybee schedule library."
                                print msg
                                ghenv.Component.AddRuntimeMessage(gh.GH_RuntimeMessageLevel.Warning, msg)
                                return -1
                            elif schedule!=None and schedule.lower().endswith(".csv"):
                                # check if csv file is existed
                                if not os.path.isfile(schedule):
                                    msg = "Cannot find the shchedule file: " + schedule
                                    print msg
                                    ghenv.Component.AddRuntimeMessage(gh.GH_RuntimeMessageLevel.Warning, msg)
                                    return -1
                            
                            thisShading.TransmittanceSCH = schedule
                        
                        # add the Rad Material if any
                        if RADMaterial!=None:
                            # if it is just the name of the material make sure it is already defined
                            if len(RADMaterial.split(" ")) == 1:
                                # if the material is not in the library add it to the library
                                if not hb_RADMaterialAUX.isMatrialExistInLibrary(RADMaterial):
                                    warningMsg = "Can't find " + RADMaterial + " in RAD Material Library.\n" + \
                                                "Add the material to the library and try again."
                                    ghenv.Component.AddRuntimeMessage(gh.GH_RuntimeMessageLevel.Warning, warningMsg)
                                    return
                                
                                try:
                                    thisShading.setRADMaterial(RADMaterial)
                                except Exception, e:
                                    print e
                                    warningMsg = "You are using an old version of Honeybee_Honeybee! Update your files and try again."
                                    print warningMsg
                                    ghenv.Component.AddRuntimeMessage(gh.GH_RuntimeMessageLevel.Warning, warningMsg)
                                    return
                                
                                addedToLib = True
                            else:
                                
                                # try to add the material to the library
                                addedToLib, thisShading.RadMaterial = hb_RADMaterialAUX.analyseRadMaterials(RADMaterial, True)
                                
                            if addedToLib==False:
                                warningMsg = "Failed to add " + RADMaterial + " to the Library."
                                ghenv.Component.AddRuntimeMessage(gh.GH_RuntimeMessageLevel.Warning, warningMsg)
                                return
                        
                        # add shading to the list
                        shadingClasses.append(thisShading)
                
        # add to the hive
        hb_hive = sc.sticky["honeybee_Hive"]()
        HBContext  = hb_hive.addToHoneybeeHive(shadingClasses, ghenv.Component)
        return HBContext
        ################################################################################################
    else:
        print "You should first let Honeybee to fly..."
        w = gh.GH_RuntimeMessageLevel.Warning
        ghenv.Component.AddRuntimeMessage(w, "You should first let Honeybee to fly...")
        return -1
        

if _shdSurfaces and _shdSurfaces[0]!=None:
    # add cleaning function
    result= main(_shdSurfaces, EPTransSchedule_, meshingSettings_, justBoundingBox_)
    
    if result != -1: HBContext = result
# ---------- end hb_epcontextsrf ----------
wires_3 = BrepWireframe(Brep=shddesigner.shadingSrfs, Density=-1)
preview_4 = CustomPreview(Geometry=wires_3, Shader=ColourSwatch(SwatchColor=RGB(0, 0, 0)))

# ----
# WIND ROSE
panel_21 = Panel(hb_epcontextsrf)

# ----
# ANNUAL DAYLIGHT AUTONOMY
toggle_6 = BooleanToggle(False)
genhbzonetestpts = Honeybee_GenerateZoneTestPoints(HBZone=makeadiabaticbytype, gridSize=Slider(0.3, range=0..1), distBaseSrf=Slider(0.762, range=0..1), moveTestMesh=True)  # -> readMe, simplify(testPoints), simplify(ptsVectors), simplify(facesArea), simplify(mesh); plug-in component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
annualdaylightsimulation = Honeybee_AnnualDaylightSimulation(
    north=number_slider,
    epwWeatherFile=epw_stat.epwFile,
    testPoints=genhbzonetestpts.testPoints,
    ptsVectors=genhbzonetestpts.ptsVectors)  # -> analysisRecipe; plug-in component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
analysisperiod_7 = Ladybug_AnalysisPeriod(fromHour=Slider(10, range=0..10), toHour=Slider(16, range=0..100))  # -> readMe, analysisPeriod; plug-in component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
panel_22 = Panel(analysisperiod_7.analysisPeriod)
number_slider_12 = Slider(4, range=0..10)
brep_2 = Brep([makeadiabaticbytype, hb_epcontextsrf])
rev = ReverseList(List=analysisperiod_7.analysisPeriod)
panel_23 = Panel(rev)
panel_24 = Panel(brep_2)
occupancygenerator = Honeybee_DaysimOccupancyGenerator(weekendDays=[1, 2], writeTheOcc=toggle_6)  # -> occupancyFile; plug-in component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
rundaylightanalysis = Honeybee_RunDaylightSimulation(
    HBObjects=flatten(brep_2),
    analysisRecipe=annualdaylightsimulation,
    writeRad=toggle_6,
    runRad=toggle_6,
    numOfCPUs=number_slider_12,
    overwriteResults=True)  # -> readMe, analysisType, resultsUnit, results, testPts, resultFiles, radGeoFile, studyFolder, done; plug-in component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
panel_25 = Panel(occupancygenerator)
panel_26 = Panel("""93
63
3""")
readannualresultsi = Honeybee_ReadAnnualResultI(
    illFilesAddress=rundaylightanalysis.resultFiles,
    testPoints=simplify(rundaylightanalysis.testPts),
    occupancyFiles=occupancygenerator,
    DLAIllumThresholds=300,
    runIt=toggle_6)  # -> DLA, UDLI_Less_100, UDLI_100_2000, UDLI_More_2000, CDA, sDA, annualProfiles, htmReport; plug-in component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
item_6 = ListItem(List=rundaylightanalysis.testPts, Index=panel_26, Wrap=True)
points = PointList(Points=rundaylightanalysis.testPts)
readdshourlyresults = Honeybee_ReadDSResultForAPoint(illFilesAddress=rundaylightanalysis.resultFiles, testPoints=rundaylightanalysis.testPts, targetPoint=item_6)  # -> annualIllumNoDynamicSHD, annualIllumDynamicSHDGroupI, annualIllumDynamicSHDGroupII, iIlluminanceBasedOnOccupancy; plug-in component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
legendpar_8 = Ladybug_LegendParameters(lowBound=Slider(500, range=0..1000))  # -> legendPar; plug-in component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
pt_15 = Point(Point(64.50329941, -102.69485, 0))
_3dchart_5 = Ladybug_3DChart(
    inputData=flatten(readdshourlyresults.annualIllumNoDynamicSHD),
    basePoint=pt_15,
    xScale=Slider(0.02, range=0..1),
    yScale=Slider(0.1, range=0..1),
    zScale=Slider(0, range=0..100),
    legendPar=legendpar_8)  # -> readMe, graphMesh, graphCurves, legend, legendBasePts, title, titleBasePts, dataPts, conditionalHOY; plug-in component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
panel_27 = Panel(readdshourlyresults.annualIllumNoDynamicSHD)
gradientlibrary_6 = Ladybug_GradientLibrary(gradIndex=Slider(1, range=0..10))  # -> customColors; plug-in component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
legendpar_9 = Ladybug_LegendParameters(
    lowBound=Slider(0, range=0..100),
    highBound=Slider(100, range=0..100),
    numSegments=Slider(6, range=0..10),
    customColors=flatten(gradientlibrary_6))  # -> legendPar; plug-in component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
larger_2 = LargerThan(FirstNumber=readannualresultsi.DLA, SecondNumber=90)  # -> LargerThan, OrEqualTo
dom = ConstructDomain(DomainStart=0, DomainEnd=Slider(1, range=0..1))
not = GateNot(A=larger_2.LargerThan)
dispatch = Dispatch(List=rundaylightanalysis.testPts, DispatchPattern=larger_2.LargerThan)  # -> ListA, ListB
pt_16 = Point(dispatch.ListB)

# ----
# GLARE ANALYSIS
button = Button()
number_slider_13 = Slider(0, range=0..2)
number_slider_14 = Slider(0, range=0..2)
fly = Ladybug_fly(inputSliders=[number_slider_14, number_slider_13], fly=button)  # -> Vviiiiiiiiiizzz; plug-in component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
panel_28 = Panel("""3
6
12""")
panel_29 = Panel("""9
12
15""")
item_7 = ListItem(List=panel_28, Index=number_slider_14, Wrap=True)
panel_30 = Panel(item_7)
item_8 = ListItem(List=panel_29, Index=number_slider_13, Wrap=True)
panel_31 = Panel(item_8)
genavgsky = Honeybee_GenerateAverageSky(north=number_slider, weatherFile=epw_stat.epwFile, month=panel_30, hour=panel_31)  # -> radiationValues, skyFilePath; plug-in component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
radparameters = Honeybee_RADParameters(quality=Slider(1, range=0..10), ab=Slider(3, range=1..3))  # -> readMe, radParameters; plug-in component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
imagebasedsimulation = Honeybee_ImageBasedSimulation(
    skyFile=genavgsky.skyFilePath,
    cameraType=Slider(1, range=0..2),
    simulationType=2,
    imageWidth=Slider(800, range=0..1000),
    imageHeight=Slider(800, range=0..1000),
    radParameters=radparameters.radParameters,
    backupImages=0)  # -> analysisRecipe; plug-in component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
doy_hoy = Ladybug_DOY_HOY(days="21", months=panel_30, hours=panel_31)  # -> HOY, DOY, date; plug-in component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
pt_17 = Point(Point(0, 3, 0))
comfortmannequin = Ladybug_ComfortMannequin(rotationAngle=Slider(0, range=0..360), bodyLocation=pt_17, bakeIt=Toggle(False))  # -> mannequinMesh, legend, legendBasePt; plug-in component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
rundaylightanalysis_2 = Honeybee_RunDaylightSimulation(
    HBObjects=flatten(brep_2),
    analysisRecipe=imagebasedsimulation,
    writeRad=toggle_6,
    runRad=toggle_6,
    numOfCPUs=number_slider_12,
    radFileName=doy_hoy.date,
    overwriteResults=True)  # -> readMe, analysisType, resultsUnit, results, testPts, resultFiles, radGeoFile, studyFolder, done; plug-in component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
falsecolor = Honeybee_FalseColor(
    HDRFilePath=rundaylightanalysis_2.resultFiles,
    contourBands=False,
    maskThreshold=0.1,
    useAlterColors=False,
    render=Toggle(True))  # -> outputFilePath; plug-in component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
glareanalysis = Honeybee_GlareAnalysis(HDRImagePath=rundaylightanalysis_2.resultFiles, runIt=Toggle(True))  # -> readMe, glareCheckImage, DGP, DGI, glareComfortRange, imageWithTaskArea; plug-in component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
item_9 = ListItem(List=comfortmannequin.mannequinMesh, Index=Slider(121, range=0..1000), Wrap=True)
md_slider = MDSlider(
    slider_value=Point(0.5004853039, 0.5004875369, 0.5),
    SliderMode=0,
    x_domain=Domain(-1, 1),
    y_domain=Domain(-1, 1),
    z_domain=Domain(0, 1))
preview_5 = CustomPreview(Geometry=item_9, Shader=ColourSwatch(SwatchColor=RGB(255, 3, 3)))
facen = FaceNormals(Mesh=item_9)  # -> Centers, Normals
panel_32 = Panel(falsecolor)
panel_33 = Panel(glareanalysis.DGP)
settheview = Ladybug_SetTheView(cameraLocation=facen.Centers, cameraDirection=facen.Normals, uvLookAround=md_slider)  # plug-in component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
hdr_tif = Honeybee_ConvertHDRToTIF(HDRFilePath=glareanalysis.glareCheckImage, adjustExposure=Toggle(False))  # -> TIFFFilePath; plug-in component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
number_slider_15 = Slider(0.3, range=0..1)
hdr_tif_2 = Honeybee_ConvertHDRToTIF(HDRFilePath=falsecolor, adjustExposure=False)  # -> TIFFFilePath; plug-in component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
panel_34 = Panel(hdr_tif)
image = ImageFromPath(P=hdr_tif_2, S=number_slider_15)
image_2 = ImageFromPath(P=hdr_tif, S=number_slider_15)

points_2 = PointList(Points=genhbzonetestpts.testPoints)

# ----
# infiltration rate
ach2m3_s_m2_calculator = Honeybee_infORventPerAreaCalculator(HBZones=flatten(setepzoneundergroundcnstr), airFlowRate=Slider(0.5, range=0..10))  # -> readMe, infORventPerArea, allFloors; plug-in component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
setepzoneloads = Honeybee_SetEnergyPlusZoneLoads(
    HBZones=setepzoneundergroundcnstr,
    equipmentLoadPerArea="12",
    infiltrationRatePerArea=ach2m3_s_m2_calculator.infORventPerArea,
    lightingDensityPerArea="9",
    numOfPeoplePerArea="0.2")  # -> loads, HBZones; plug-in component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
toggle_7 = BooleanToggle(True)
setepnatvent = Honeybee_SetEPAirFlow(
    HBZones=setepzoneloads.HBZones,
    naturalVentilationType="3",
    minIndoorTempForNatVent=Slider(25, range=0..30),
    maxOutdoorTempForNatVent=Slider(28, range=0..30),
    fanFlowRate=Slider(3, range=0..10),
    fanEfficiency=Slider(1, range=0..1),
    fanPressureRise=Slider(70, range=0..1000))  # -> readMe, simplify(HBZones); plug-in component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
epoutput = Honeybee_GenerateEPOutput(
    zoneEnergyUse=toggle_7,
    zoneGainsAndLosses=toggle_7,
    zoneComfortMetrics=toggle_7,
    surfaceTempAnalysis="False",
    surfaceEnergyAnalysis=toggle_7)  # -> report, flatten(simulationOutputs); plug-in component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
setepzoneschedules = Honeybee_SetEnergyPlusZoneSchedules(
    HBZones=setepnatvent.HBZones,
    occupancySchedules=csvschedule_2.csvSchedule,
    lightingSchedules=readannualresultsi.annualProfiles)  # -> schedules, simplify(HBZones); plug-in component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
rep = ReplaceText(Text="base_case", Find=" ", Replace="_", RecursiveReplace=False)

item_10 = ListItem(List=rundaylightanalysis.testPts, Index="97", Wrap=True)
readdshourlyresults_2 = Honeybee_ReadDSResultForAPoint(illFilesAddress=rundaylightanalysis.resultFiles, testPoints=rundaylightanalysis.testPts, targetPoint=item_10)  # -> annualIllumNoDynamicSHD, annualIllumDynamicSHDGroupI, annualIllumDynamicSHDGroupII, iIlluminanceBasedOnOccupancy; plug-in component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
panel_35 = Panel(readannualresultsi.sDA)
strnum_2 = Ladybug_SeparateData(inputList=flatten(readdshourlyresults_2.annualIllumNoDynamicSHD))  # -> numbers, strings; plug-in component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
smaller = SmallerThan(FirstNumber=strnum_2.numbers, SecondNumber=120)  # -> SmallerThan, OrEqualTo
vdisex = VectorDisplayEx(Point=facen.Centers, Vector=facen.Normals, Colour=RGB(0, 0, 0), Width=2)
pt_18 = Point(facen.Centers)
num = Number(smaller.OrEqualTo)
and = GateAnd(A=larger.OrEqualTo, B=num)
panel_36 = Panel(num)

# ----
# ENERGY AND COMFORT
toggle_8 = BooleanToggle(False)
exporttoopenstudio = Honeybee_ExportToOpenStudio(
    north=number_slider,
    epwWeatherFile=epw_stat.epwFile,
    HBZones=flatten(setepzoneschedules.HBZones),
    HBContext=flatten(hb_epcontextsrf),
    simulationOutputs=flatten(epoutput.simulationOutputs),
    writeOSM=toggle_8,
    runSimulation=toggle_8,
    openOpenStudio=toggle_8)  # -> readMe, osmFileAddress, idfFileAddress, resultsFileAddress, eioFileAddress, rddFileAddress, studyFolder, model; plug-in component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
readepsrfresult = Honeybee_ReadEPSurfaceResult(resultFileAddress=exporttoopenstudio.resultsFileAddress)  # -> surfaceIndoorTemp, surfaceOutdoorTemp, surfaceEnergyFlow, opaqueEnergyFlow, glazEnergyFlow, windowTotalSolarEnergy, windowBeamEnergy, windowDiffEnergy, windowTransmissivity, otherSurfaceData; plug-in component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
importepw_5 = Ladybug_ImportEpw(epwFile=epw_stat.epwFile)  # -> readMe, latitude, location, dryBulbTemperature, dewPointTemperature, relativeHumidity, windSpeed, windDirection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; plug-in component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
readepresult = Honeybee_ReadEPResult(resultFileAddress=exporttoopenstudio.resultsFileAddress)  # -> totalThermalLoad, thermalLoadBalance, cooling, heating, electricLight, electricEquip, fanElectric, pumpElectric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; plug-in component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
series_9 = Series(Start=0, Step=1, Count=10)
panel_37 = Panel(series_9)
energybalance = Honeybee_ConstructEnergyBalance(
    HBZones=flatten(setepzoneschedules.HBZones),
    cooling=readepresult.cooling,
    heating=readepresult.heating,
    electricLight=readepresult.electricLight,
    electricEquip=readepresult.electricEquip,
    fanElectric=readepresult.fanElectric,
    peopleGains=readepresult.peopleGains,
    totalSolarGain=readepresult.totalSolarGain,
    infiltrationEnergy=readepresult.infiltrationEnergy,
    mechVentilationEnergy=readepresult.mechVentilationEnergy,
    natVentEnergy=readepresult.natVentEnergy,
    surfaceEnergyFlow=readepsrfresult.surfaceEnergyFlow)  # -> readMe, port, flrNormEnergyBal, flrNormBalWStorage, port_2, modelEnergyBalance, energyBalWithStorage; plug-in component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
colorsurfaces = Honeybee_ColorSurfacesByEPResult(
    srfData=readepsrfresult.surfaceEnergyFlow,
    HBZones=flatten(setepzoneschedules.HBZones),
    legendPar=legendpar_6,
    runIt=Toggle(True))  # -> readMe, srfColoredMesh, zoneWireFrame, legend, legendBasePt, analysisTitle, srfBreps, srfColors, srfValues, normalizedSrfData; plug-in component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
ma = MassAddition(Input=panel_37)  # -> Result, PartialResults
adaptivecomfortcalculator = Ladybug_AdaptiveComfortCalculator(
    dryBulbTemperature=readepresult.airTemperature,
    meanRadiantTemperature=readepresult.meanRadTemperature,
    prevailingOutdoorTemp=importepw_5.dryBulbTemperature,
    windSpeed=Slider(0.2, range=0..1),
    runIt=Toggle(True))  # -> readMe, port, comfortableOrNot, conditionOfPerson, degreesFromTarget, port_2, targetTemperature, upperTemperatureBound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; plug-in component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
gradientlibrary_7 = Ladybug_GradientLibrary(gradIndex="19")  # -> customColors; plug-in component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
panel_38 = Panel(ma.Result)
selectandaveragedata = Ladybug_AverageData(annualHourlyData=energybalance.energyBalWithStorage, totalOrAverage=Toggle(True))  # -> readMe, selHourlyData, totaledDaily, totaledMonthly, totMonthlyPerHour, totAnalysisPeriod; plug-in component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
pt_19 = Point(Point(68, 45, 0))
legendpar_10 = Ladybug_LegendParameters(lowBound="-800", highBound="800", customColors=flatten(gradientlibrary_7))  # -> legendPar; plug-in component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
number_slider_16 = Slider(0.7, range=0..1)
legendpar_11 = Ladybug_LegendParameters(lowBound="-1", highBound="1", numSegments="3")  # -> legendPar; plug-in component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
strnum_3 = Ladybug_SeparateData(inputList=flatten(selectandaveragedata.totaledMonthly))  # -> numbers, strings; plug-in component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
barchart = Ladybug_MonthlyBarChart(
    inputData=flatten(selectandaveragedata.totaledMonthly),
    stackValues=Toggle(True),
    altTitle="Soho Energy Balance",
    altYAxisTitle="Energy (kWh)",
    basePoint=pt_19,
    xScale=number_slider_16,
    yScale=number_slider_16,
    legendPar=legendpar_10)  # -> readMe, dataMesh, dataCurves, dataCrvColors, graphAxes, graphLabels, title, titleBasePt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; plug-in component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
panel_39 = Panel(strnum_3.numbers)
vec_2 = VectorXYZ(XComponent="20", YComponent="35", ZComponent=0)  # -> Vector, Length
pt_20 = Point(Point(63.94525144, -50.14035029, 0))
preview_6 = CustomPreview(Geometry=barchart.graphAxes, Shader=ColourSwatch(SwatchColor=RGB(0, 0, 0)))
panel_40 = Panel(strnum_3.strings)
tag_2 = TextTag3D(Location=barchart.dataLabelPts, Size=1, Justification=7)
number_slider_17 = Slider(1.4, range=0..10)
move_3 = Move(Geometry=pt_20, Motion=vec_2.Vector)  # -> Geometry, Transform
panel_41 = Panel("""0.6
1""")
_3dchart_6 = Ladybug_3DChart(
    inputData=flatten(adaptivecomfortcalculator.conditionOfPerson),
    basePoint=pt_20,
    xScale=".025",
    yScale="0.125",
    zScale=Slider(0, range=0..100),
    legendPar=legendpar_11)  # -> readMe, graphMesh, graphCurves, legend, legendBasePts, title, titleBasePts, dataPts, conditionalHOY; plug-in component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
psychchart_2 = Ladybug_PsychrometricChart(
    dryBulbTemperature=readepresult.airTemperature,
    relativeHumidity=readepresult.relativeHumidity,
    clothingLevel=panel_41,
    mergeComfPolygons=Toggle(True),
    basePoint=move_3.Geometry,
    runIt=Toggle(True))  # -> readMe, port, totalComfortPercent, totalComfortOrNot, strategyNames, strategyPercentOfTime, strategyOrNot, port_2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; plug-in component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

panel_42 = Panel(colorsurfaces.srfValues)
recolormesh = Ladybug_RecolorMesh(
    analysisResult=readannualresultsi.DLA,
    inputMesh=genhbzonetestpts.mesh,
    heightDomain=dom,
    legendPar=legendpar_9,
    analysisTitle="DAYLIGHT AUTONOMY",
    legendTitle="%")  # -> readMe, newMesh, newLegend, legendBasePt, meshColors, legendColors; plug-in component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

cullf = CullFaces(Mesh=recolormesh.newLegend, Pattern=not)
area = Area(Geometry=cullf)  # -> Area, Centroid
panel_43 = Panel(area.Area)

_3dchart_7 = Ladybug_3DChart(inputData=flatten(and))  # -> readMe, graphMesh, graphCurves, legend, legendBasePts, title, titleBasePts, dataPts, conditionalHOY; plug-in component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

comfortable_hot_cold = Panel([adaptivecomfortcalculator.percentOfTimeComfortable, adaptivecomfortcalculator.percentHotCold])
panel_44 = Panel("""Comfortable (%): 
hot (%):         
cold (%):        """)
num_2 = Number(comfortable_hot_cold)
expression = Expression(x=num_2, Expression="Round(x, 2)")
flip = FlipMatrix(Data=panel_44)  # -> simplify(Data)
flip_2 = FlipMatrix(Data=expression)  # -> simplify(Data)
panel_45 = Panel([flip, flip_2])
join = TextJoin(Text=panel_45)
join_2 = TextJoin(Text=flatten(join))
pt_21 = Point(Point(0.4785765846, -2.429333943, 0))
tag_3 = TextTag3D(Location=pt_21, Text=join_2, Size="0.35", Colour=ColourSwatch(SwatchColor=RGB(0, 0, 0)), Justification=5)

panel_46 = Panel(psychchart_2.totalComfortPercent)

# ==== cluster Cluster
north = ClusterInput()
location = ClusterInput()
hour = ClusterInput()
month = ClusterInput()
centerpt = ClusterInput()
sunpathscale = ClusterInput()
sunscale = ClusterInput()
annualhourlydata = ClusterInput()
conditionalstatement = ClusterInput()
legendpar = ClusterInput()
dailyorannualsunpath = ClusterInput()
sunpath = Ladybug_SunPath(
    north=north,
    location=location,
    hour=hour,
    day=21,
    month=month,
    timeStep=1,
    centerPt=centerpt,
    sunPathScale=sunpathscale,
    sunScale=sunscale,
    annualHourlyData=flatten(annualhourlydata),
    conditionalStatement=conditionalstatement,
    legendPar=legendpar,
    dailyOrAnnualSunPath=dailyorannualsunpath)  # -> readMe, sunVectors, sunAltitudes, sunAzimuths, port, sunSpheresMesh, sunPathCrvs, legend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; plug-in component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
