# Grasshopper definition SHENGJI TAN.gh (Grasshopper 0.9.76)
# plug-ins: Python Interpreter

panel = Panel("https://www.energyplus.net/weather-download/north_and_central_america_wmo_region_4/USA/PA/USA_PA_Philadelphia.Intl.AP.724080_TMY3/all")
ladybug = Ladybug_Ladybug()  # -> Vviiiiiiiiiizzz; plug-in component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
epw_stat = Ladybug_OpenEPWAndSTATWeatherFiles(weatherFileURL=panel)  # -> epwFile, statFile; plug-in component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
importepw = Ladybug_ImportEpw(epwFile=epw_stat.epwFile)  # -> readMe, latitude, location, dryBulbTemperature, dewPointTemperature, relativeHumidity, windSpeed, windDirection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; plug-in component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
line = Line(Line((-102.3446363, 324.5902896, -257.2096947), (-101.9729119, 327.617742, -257.2096947)))
vec = Vector(line)
unit = UnitVector(Vector=vec)
analysisperiod = Ladybug_AnalysisPeriod()  # -> readMe, analysisPeriod; plug-in component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
analysisperiod_2 = Ladybug_AnalysisPeriod()  # -> readMe, analysisPeriod; plug-in component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
brep = Brep(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)
geo = Geometry([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])
brep_2 = Brep([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])
toggle = BooleanToggle(True)
toggle_2 = BooleanToggle(True)
area = Area(Geometry=brep)  # -> Area, Centroid
merge = Merge(Data1=geo, Data2=brep_2)  # -> flatten(Result)
solaradjusttemperature = Ladybug_OutdoorSolarTemperatureAdjustor(
    location=importepw.location,
    cumSkyMtxOrDirNormRad=importepw.directNormalRadiation,
    diffuseHorizRad=importepw.diffuseHorizontalRadiation,
    baseTemperature=importepw.dryBulbTemperature,
    baseDryBulbOrMRT=Toggle(True),
    horizInfraredRad=importepw.horizontalInfraredRadiation,
    analysisPeriodOrHOY=analysisperiod_2.analysisPeriod,
    parallel=toggle,
    runIt=toggle)  # -> readMe, port, effectiveRadiantField, MRTDelta, solarAdjustedMRT, port_2, mannequinMesh, port_3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; plug-in component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
solaradjusttemperature_2 = Ladybug_OutdoorSolarTemperatureAdjustor(
    location=importepw.location,
    cumSkyMtxOrDirNormRad=importepw.directNormalRadiation,
    diffuseHorizRad=importepw.diffuseHorizontalRadiation,
    baseTemperature=importepw.dryBulbTemperature,
    baseDryBulbOrMRT=Toggle(True),
    horizInfraredRad=importepw.horizontalInfraredRadiation,
    bodyLocation=area.Centroid,
    contextShading=merge,
    north=unit,
    analysisPeriodOrHOY=analysisperiod.analysisPeriod,
    parallel=toggle_2,
    runIt=toggle_2)  # -> readMe, port, effectiveRadiantField, MRTDelta, solarAdjustedMRT, port_2, mannequinMesh, port_3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; plug-in component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
# With solar radiation effect
# + Meyerson Hall building
toggle_3 = BooleanToggle(True)
outdoorcomfortcalculator = Ladybug_OutdoorComfortCalculator(
    dryBulbTemperature=importepw.dryBulbTemperature,
    meanRadiantTemperature=solaradjusttemperature_2.solarAdjustedMRT,
    windSpeed_tenMeters=importepw.windSpeed,
    relativeHumidity=importepw.relativeHumidity,
    runIt=Toggle(True))  # -> readMe, port, universalThermalClimateIndex, comfortableOrNot, thermalStress, conditionOfPerson, port_2, percentOfTimeComfortable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; plug-in component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
# With solar radiation effect
outdoorcomfortcalculator_2 = Ladybug_OutdoorComfortCalculator(
    dryBulbTemperature=importepw.dryBulbTemperature,
    meanRadiantTemperature=solaradjusttemperature.solarAdjustedMRT,
    windSpeed_tenMeters=importepw.windSpeed,
    relativeHumidity=importepw.relativeHumidity,
    runIt=toggle_3)  # -> readMe, port, universalThermalClimateIndex, comfortableOrNot, thermalStress, conditionOfPerson, port_2, percentOfTimeComfortable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; plug-in component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
# Fully Shaded
outdoorcomfortcalculator_3 = Ladybug_OutdoorComfortCalculator(
    dryBulbTemperature=importepw.dryBulbTemperature,
    windSpeed_tenMeters=importepw.windSpeed,
    relativeHumidity=importepw.relativeHumidity,
    runIt=Toggle(True))  # -> readMe, port, universalThermalClimateIndex, comfortableOrNot, thermalStress, conditionOfPerson, port_2, percentOfTimeComfortable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; plug-in component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
panel_2 = Panel("42.751142")
panel_3 = Panel("41.335616")
panel_4 = Panel("41.518265")
panel_5 = Panel("41.826484")
panel_6 = Panel("42.614455")
panel_7 = Panel(outdoorcomfortcalculator.percentOfTimeComfortable)
geo_2 = Geometry([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])
geo_3 = Geometry([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])
geo_4 = Geometry([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])
geo_5 = Geometry([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])
geo_6 = Geometry([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])
panel_8 = Panel(outdoorcomfortcalculator_2.percentOfTimeComfortable)
panel_9 = Panel(outdoorcomfortcalculator_3.percentOfTimeComfortable)
analysisperiod_3 = Ladybug_AnalysisPeriod()  # -> readMe, analysisPeriod; plug-in component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
panel_10 = Panel([outdoorcomfortcalculator_3.percentHeatStress, outdoorcomfortcalculator_2.percentHeatStress, outdoorcomfortcalculator.percentHeatStress])
legendpar = Ladybug_LegendParameters(numSegments="3")  # -> legendPar; plug-in component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
sunpath = Ladybug_SunPath(
    north=unit,
    location=importepw.location,
    hour=12,
    day=21,
    month=12,
    timeStep=1,
    analysisPeriod=analysisperiod_3.analysisPeriod,
    centerPt=area.Centroid,
    sunPathScale=Slider(0.3, range=0..1),
    sunScale=Slider(0.5, range=0..1),
    annualHourlyData=flatten(outdoorcomfortcalculator.conditionOfPerson),
    conditionalStatement="a == 3",
    legendPar=legendpar,
    dailyOrAnnualSunPath=True)  # -> readMe, sunVectors, sunAltitudes, sunAzimuths, port, sunSpheresMesh, sunPathCrvs, legend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; plug-in component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
panel_11 = Panel(sunpath.sunPositionsHOY)
multiplication = Multiplication(A=sunpath.sunVectors, B=-1)
ln = Line(StartPoint=sunpath.sunPathCenPts, EndPoint=sunpath.sunPositions)
vec_2 = Vector(multiplication)
multiplication_2 = Multiplication(A=vec_2, B=10)
sph = Sphere(Base=sunpath.sunPathCenPts, Radius=Slider(5, range=0..100))
vdis = VectorDisplay(Anchor=sunpath.sunPathCenPts, Vector=multiplication_2)
_3dchart = Ladybug_3DChart(
    inputData=flatten([outdoorcomfortcalculator_3.thermalStress, outdoorcomfortcalculator_2.thermalStress, outdoorcomfortcalculator.thermalStress]),
    xScale="0.2",
    zScale="0",
    legendPar=legendpar)  # -> readMe, graphMesh, graphCurves, legend, legendBasePts, title, titleBasePts, dataPts, conditionalHOY; plug-in component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
vdisex = VectorDisplayEx(Point=sunpath.sunPathCenPts, Vector=multiplication_2, Colour=RGB(0, 0, 0), Width=2)
meshray = MeshRay(Mesh=sph, Point=sunpath.sunPathCenPts, Direction=vec_2)  # -> Point, Hit
sph_2 = Sphere(Base=meshray.Point, Radius=Slider(0.653, range=0..8))
